# Grasshopper definition 25Jul23Base.gh (Grasshopper 1.0.7)
# plug-ins: Pufferfish, LunchBox, Colibri, TT Toolbox

data = Data([27.37, 26.59, 27.52, 26.06, 26.8, 27.46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])

panel = Panel("""0.61
1.24
1.42
0.39
0.49
1.44
0.68
0.47
0.67
1.65
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""")
panel_2 = Panel("UwallConcrete Generated")

# ----
# EKB Construction data for UwallMasonry
ekbuwallconcrete = Panel("""0.67
0.68
1.83
2.25
1.19
0.42
0.48
1.69
0.61
1.99
1.9
1.87
0.67
1.32
0.41
0.38
0.27
0.36""")
parcelubem = Panel("""7
4
4
5
17
2
5
5
3
11
0
2
16
1
7
1
2
3""")
blockubem = Panel("""36
46
6
43
42
36
17
8
46
24
39
50
46
42
44
46
37
39""")

# ----
# EKB Construction data for UwallConcrete
ekbuwallconcrete_2 = Panel("""0.68
0.68
0.47
0.56
0.45
0.34
0.34
1.36
1.44
1.48
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""")
parcelubem_2 = Panel("""15
10
14
8
10
20
10
22
4
7
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""")
blockubem_2 = Panel("""17
3
24
17
20
31
49
3
23
24
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""")

panel_3 = Panel("""1.47
0.66
0.43
1.24
1.46
1.57
0.67
1.32
0.35
1.86
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""")
panel_4 = Panel("UwallMasonry Generated")

# ----
# Add Only
# Residential Buildings
infiltrationrate = Panel("""0.00033
0.00040
0.00040
0.00029
0.00036
0.00033
0.00043
0.00032
0.00030
0.00049
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""")
boilereff = Panel("""0.83
0.80
0.87
0.91
0.86
0.87
0.80
0.87
0.94
0.93
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""")
vtwindow = Panel("""0.620
0.253
0.313
0.341
0.603
0.452
0.290
0.440
0.229
0.746
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""")
shgcwindow = Panel("""0.3848
0.7070
0.4448
0.5936
0.3080
0.8053
0.7954
0.3184
0.8263
0.3755
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""")
wwr = Panel("""0.24
0.15
0.19
0.17
0.22
0.13
0.12
0.14
0.27
0.22
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""")
ugroundfloor = Panel("""0.454
1.390
0.326
1.868
0.682
1.954
0.359
0.363
0.503
0.521
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""")
uwindow = Panel("""2.574
2.760
2.106
2.538
2.912
2.894
1.689
1.963
1.263
2.501
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""")
uroof = Panel("""0.524
0.500
0.526
1.008
0.762
0.314
1.159
0.343
2.443
0.921
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""")
uwall = Panel("""0.934
1.130
0.536
0.468
1.572
1.554
0.459
0.413
1.333
0.461
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""")

# ----
# Construction
const_date = Panel("""1980
1980
1980
1980
1980
1980
1980
1980
1980
1980
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""")
parcelubem_3 = Panel("""0
1
2
3
4
5
6
7
0
1
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""")
block_ubem = Panel("""0
0
0
0
0
0
0
0
1
1
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""")

# ----
# Add All Buildings
# https://docs.google.com/spreadsheets/d/1OhTFdR_YYA37wmvLVmGtL0KkaVhocj32rAnVd95tpRM/edit#gid=0
panel_5 = Panel("=IFS(H7537=\"office\", 1, H7537=\"dwelling\",0, H7537=\"public\",2, H7537=\"school\",3)")
data_2 = Data(["1", "1", "0", "0", "0", "0"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])

panel_6 = Panel("""0.23
0.24
0.21
0.18
0.13
0.16
0.20
0.22
0.21
0.17
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""")  # disabled
panel_7 = Panel("UwallConcrete Generated")  # disabled

lng = ListLength(List=data_2)
panel_8 = Panel("exclude non-residential indices")
series = Series(Start=0, Step=1, Count=lng)
data_3 = Data(data_2)
equals = Equality(FirstNumber=data_3, SecondNumber="0")  # -> Equality, Inequality
dispatch = Dispatch(List=series, DispatchPattern=equals.Equality)  # -> ListA, ListB

# ----
# EKB Construction data for UwallConcrete
ekbuwallconcrete_3 = Panel("""0.10
0.16
0.11
0.11
0.10
0.14
0.20
0.12
0.16
0.13
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""")  # disabled
parcelubem_4 = Panel("""2
4
1
2
15
7
1
4
11
1
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""")  # disabled
blockubem_3 = Panel("""0
0
3
3
3
5
1
1
1
2
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""")  # disabled

# ----
# Mixed or Not
panel_9 = Panel("""1
1
1
0
0
0
0
0
1
1
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""")

merge = Merge(Data1=graft(parcelubem), Data2=graft(blockubem))

# ----
# Real Data
# Building
# Parcel No
panel_10 = Panel("""0
1
2
3
4
5
6
7
0
1
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""")

# ----
# BahrıyeUcok-IZMIR
# Real Data
# # of floor
real_data_of_floor = Panel("""6
7
6
6
6
6
6
6
6
7
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""")

# ----
# percentage of
# residential unit with cooling
percentage = Panel("50")
division = Division(A="100", B=percentage)

# ----
# Construction
const_date_2 = Panel("""1960
1960
1960
1960
1960
1960
1975
1960
1960
1980
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""")
parcelubem_5 = Panel("""0
1
2
3
4
5
0
1
2
0
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""")
block_ubem_2 = Panel("""0
0
0
0
0
0
1
1
1
2
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""")

# ----
# neighborhood related data
# 608 residential building
# https://docs.google.com/spreadsheets/d/1dVqoGlL5SpjtWETs8iGa3fb79QarzpHjeZR7tKplJOw/edit#gid=2128463022
# # of Units of
# the building
of_units_of_the_building = Panel("""13
7
15
26
12
12
12
12
9
12
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""")

# ----
# Construction
const_date_3 = Panel("""2014
1990
1988
2015
1993
2015
1960
1970
1960
1967
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""")
parcelubem_6 = Panel("""0
1
2
3
4
5
6
7
8
0
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""")
block_ubem_3 = Panel("""0
0
0
0
0
0
0
0
0
1
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""")

lng_2 = ListLength(List=dispatch.ListA)
division_2 = Division(A=lng_2, B=division)
python = GhPythonScript(x=division_2, y=percentage)  # -> out, a; inputs y: Int32
# ---------- python: Python ----------
__author__ = "Siser"
__version__ = "2023.03.14"

import rhinoscriptsyntax as rs
if y == 0:
    a = y
else:
    a = x
# ---------- end python ----------
round = Round(Number=python.a)  # -> Nearest, Floor, Ceiling
series_2 = Series(Start=0, Step=1, Count=round.Nearest)

# ----
# Add All Buildings
# https://docs.google.com/spreadsheets/d/1OhTFdR_YYA37wmvLVmGtL0KkaVhocj32rAnVd95tpRM/edit#gid=0
panel_11 = Panel("=IFS(H7537=\"office\", 1, H7537=\"dwelling\",0, H7537=\"public\",2, H7537=\"school\",3)")
panel_12 = Panel("""1
1
0
0
0
0
0
0
0
1
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""")

python_2 = GhPythonScript(x=real_data_of_floor)  # -> out, a; inputs x: Int32
# ---------- python_2: Python ----------
__author__ = "Siser"
__version__ = "2022.08.09"

import rhinoscriptsyntax as rs
if x == 0:
    a =1
else:
    a = x
# ---------- end python_2 ----------

# ----
# BAHÇELİEVLER
# neighborhood related data
# 593 residential building
# Add All
# Buildings
# Mixed or Not
panel_13 = Panel("""1
1
0
0
0
0
1
1
1
1
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""")

# ----
# Generated
# # of Units
# Per Floor
division_3 = Division(A=of_units_of_the_building, B=python_2.a)
round_2 = Round(Number=division_3)  # -> Nearest, Floor, Ceiling

# ----
# Add Only
# Residential Buildings
vtwindow_2 = Panel("""0.43
0.17
0.51
0.43
0.42
0.36
0.28
0.55
0.34
0.32
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""")
shgcwindow_2 = Panel("""0.767
0.398
0.330
0.499
0.451
0.592
0.468
0.467
0.361
0.437
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""")
wwr_2 = Panel("""0.23
0.24
0.10
0.21
0.16
0.18
0.13
0.16
0.20
0.22
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""")
ugroundfloor_2 = Panel("""0.75
1.93
0.75
0.57
0.59
1.93
0.75
0.55
0.75
0.74
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""")
uwindow_2 = Panel("""1.20
2.7
2.7
2.60
2.5
1.95
1.20
2.69
2.70
2.90
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""")
uroof_2 = Panel("""0.34
0.39
0.43
0.65
0.58
0.43
0.53
0.36
0.43
0.39
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""")
uwall_2 = Panel("""1.00
0.49
0.49
0.34
0.49
0.39
0.47
0.82
0.47
0.49
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""")

# ----
# check if there is 0 value for # of units
lng_3 = ListLength(List=round_2.Floor)
series_3 = Series(Start=0, Step=1, Count=lng_3)
equals_2 = Equality(FirstNumber=round_2.Floor, SecondNumber="0")  # -> Equality, Inequality
dispatch_2 = Dispatch(List=series_3, DispatchPattern=equals_2.Equality)  # -> ListA, ListB
panel_14 = Panel(dispatch_2.ListA)

# ----
# Add All
# Buildings
# Real Data
# Building
# Parcel No
panel_15 = Panel("""0
1
2
3
4
5
6
7
8
9
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""")

# ----
# residential with cooling indices
jitter = Jitter(List=dispatch.ListA, Jitter=1, Seed=2)  # -> Values, Indices
item = ListItem(List=jitter.Values, Index=series_2, Wrap=True)

# ----
# Mixed or Not
panel_16 = Panel("""0
0
0
0
0
0
0
0
0
1
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""")

# ----
# parcel_block ordered lists
# https://docs.google.com/spreadsheets/d/1OXMzIesyRE01nLoX3t1EUuKLoFw8Ft8k3F_-NCRB1iU/edit#gid=607337562
# Mixed or Not
panel_17 = Panel("""1
1
0
0
1
0
0
1
0
1
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""")

# ----
# parcel_block ordered lists
panel_18 = Panel(round_2.Floor)

# ----
# residential with cooling units
panel_19 = Panel("5")
dup = DuplicateData(Data=panel_19, Number=round.Nearest, Order=True)

# ----
# equipmentDensity
panel_20 = Panel("""3.26
0.69
3.68
4.32
4.19
5.21
2.79
2.49
3.11
2.40
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""")
# YUKARI BAHÇELİEVLER
panel_21 = Panel("""3.81
1.82
1.86
0.96
2.15
2.16
2.24
2.46
1.52
3.23
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""")
merge_2 = Merge(Data1=panel_20, Data2=panel_21)

# ----
# percentage of
# residential unit with cooling
percentage_2 = Panel("0")
division_4 = Division(A="100", B=percentage_2)

# ----
# Add All
# Buildings
# Real Data
# # of floor
# https://docs.google.com/spreadsheets/d/1HeNCj9cvZVeU73J5g7iW2pWBtRtmiiCzG14sOCkgrVs/edit#gid=0
panel_22 = Panel("""4
4
4
4
4
4
5
5
5
5
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""")

# ----
# Real Data
# Building
# Parcel No
panel_23 = Panel("""0
1
2
3
4
5
0
1
2
0
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""")

# ----
# Real Data
# Building
# Parcel No
panel_24 = Panel("""0
1
2
3
4
5
6
7
8
0
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""")

# ----
# %10 of all buildings are masonry
# according to EKB data of Bahçelievler
panel_25 = Panel("10")

# ----
# Cooling scenarios for residential units
replace = ReplaceItems(List=data_3, Item=dup, Indices=item, Wrap=False)

# ----
# EMEK
# neighborhood related data
# https://docs.google.com/spreadsheets/d/1dVqoGlL5SpjtWETs8iGa3fb79QarzpHjeZR7tKplJOw/edit#gid=2128463022
# Real Data
# # of floor
real_data_of_floor_2 = Panel("""9
9
9
10
10
10
4
4
4
1
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""")

# ----
# neighborhood related data
# https://docs.google.com/spreadsheets/d/1L3Ca3pI_2Zk8sqpA5S26HTBe5FzKtIOFTXeKStPdVgI/edit#gid=1110302639
# Real Data
# # of floor
real_data_of_floor_3 = Panel("""6
5
5
6
5
5
5
3
5
5
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""")

# ----
# https://docs.google.com/spreadsheets/d/1OhTFdR_YYA37wmvLVmGtL0KkaVhocj32rAnVd95tpRM/edit#gid=0
block = Panel("""0
0
0
0
0
0
0
0
0
0
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""")
# https://docs.google.com/spreadsheets/d/18MLfzQqm2u-x1I9CiO8GDrrBI3HEgol9LwWBEFC5yFs/edit#gid=0
parcel = Panel("""0
0
0
0
0
0
0
0
0
0
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""")

# ----
# # of Units of
# the building
of_units_of_the_building_2 = Panel("""21
21
21
20
20
20
19
9
13
1
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""")

# ----
# # of Units of
# the building
of_units_of_the_building_3 = Panel("""15
17
11
11
8
12
10
15
8
15
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""")

# ----
# 00.INPUT
# Random Distribution for all Construction Sets: https://docs.google.com/document/d/1WU0D6LcI17LYl9msHEWG7eir8bg52xUF9ubXD48ZJ14/edit
infiltration = Panel("""0.000306
0.000449
0.000338
0.000315
0.000356
0.000303
0.000429
0.000458
0.000496
0.000422
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""")

# ----
# Add All
# Buildings
# # of units per building
sqr = Square(Value=block)
# parcel_block ordered lists
sqr_2 = Square(Value=parcel)
addition = Addition(A=sqr_2, B=sqr)

panel_26 = Panel("""1962
1960
2010
2008
1958
1974
1982
1980
2001
1974
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""")  # disabled
panel_27 = Panel("construction date transformation")
python_3 = GhPythonScript(x=panel_26)  # -> out, a; inputs x: Int32; disabled
# ---------- python_3: Python ----------
__author__ = "Siser"
__version__ = "2022.03.17"

import rhinoscriptsyntax as rs
if x < 1980:
    a = 1960
elif x < 2000 and x >= 1980:
    a = 1980
else:
    a = 2000
# ---------- end python_3 ----------
panel_28 = Panel(python_3.a)  # disabled

# ----
# lightingDensity
panel_29 = Panel("""16.55
15.54
18.15
13.27
17.97
17.25
16.66
18.92
13.80
12.20
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""")
panel_30 = Panel("""18.32
18.03
18.29
13.91
16.59
18.98
16.27
12.67
15.68
14.45
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""")
merge_3 = Merge(Data1=panel_29, Data2=panel_30)

# ----
# Add All
# Buildings
# Construction
const_date_4 = Panel("""1960
1960
2000
2000
1960
1960
1980
1980
2000
1960
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""")
parcelubem_7 = Panel("""0
1
2
3
4
5
6
7
8
9
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""")
block_ubem_4 = Panel("""0
0
0
0
0
0
0
0
0
0
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""")

# ----
# Generated
# # of Units
# Per Floor
division_5 = Division(A=of_units_of_the_building_3, B=real_data_of_floor_3)
round_3 = Round(Number=division_5)  # -> Nearest, Floor, Ceiling

# ----
# python count consecutive duplicates in list, itertools
# https://www.w3resource.com/python-exercises/itertools/python-itertools-exercise-31.php
python_4 = GhPythonScript(x=addition)  # -> out, a; inputs x: list
# ---------- python_4: Python ----------
__author__ = "Siser"
__version__ = "2022.03.08"

import rhinoscriptsyntax as rs
from itertools import groupby
a = [sum(1 for _ in group) for _, group in groupby(x)]
# ---------- end python_4 ----------

# ----
# Generated
# # of Units
# Per Floor
division_6 = Division(A=of_units_of_the_building_2, B=real_data_of_floor_2)
round_4 = Round(Number=division_6)  # -> Nearest, Floor, Ceiling

# ----
# check if there is 0 value for # of units
lng_4 = ListLength(List=round_4.Floor)
series_4 = Series(Start=0, Step=1, Count=lng_4)
equals_3 = Equality(FirstNumber=round_4.Floor, SecondNumber="0")  # -> Equality, Inequality
dispatch_3 = Dispatch(List=series_4, DispatchPattern=equals_3.Equality)  # -> ListA, ListB
panel_31 = Panel(dispatch_3.ListA)

# ----
# check if there is 0 value for # of units
lng_5 = ListLength(List=round_3.Floor)
series_5 = Series(Start=0, Step=1, Count=lng_5)
equals_4 = Equality(FirstNumber=round_3.Floor, SecondNumber="0")  # -> Equality, Inequality
dispatch_4 = Dispatch(List=series_5, DispatchPattern=equals_4.Equality)  # -> ListA, ListB
panel_32 = Panel(dispatch_4.ListA)

panel_33 = Panel("compare two points")  # disabled
python_5 = PythonScript()  # -> out, a; inputs x: list of Point3d; disabled
# ---------- python_5: Python ----------
if x[0] == x[1]:
    a =True
    print("centroids are the same")
else:
    a =False
    print("centroids are not the same")
# ---------- end python_5 ----------

# ----
# Generated
# # of Units
# Per Floor
division_7 = Division(A=python_4.a, B=panel_22)
round_5 = Round(Number=division_7)  # -> Nearest, Floor, Ceiling

# ----
# parcel_block ordered lists
panel_34 = Panel(round_4.Floor)

panel_35 = Panel(round_3.Floor)

# ----
# # of units per building
data_4 = Data(of_units_of_the_building)

# ----
# unitFunction
partition = PartitionList(List=replace, Size=data_4)  # -> simplify(Chunks)

panel_36 = Panel("if x == 0 or x == 5")
python_6 = GhPythonScript(x=partition)  # -> out, a; inputs x: Int32
# ---------- python_6: Python ----------
__author__ = "Siser"
__version__ = "2022.11.25"

import rhinoscriptsyntax as rs
if x == 0 or x==5:
    a=True
else:
    a = False
# ---------- end python_6 ----------

panel_37 = Panel("unitFunction")
dispatch_5 = Dispatch(List=partition, DispatchPattern=python_6.a)  # -> ListA, ListB

panel_38 = Panel(round_5.Floor)

panel_39 = Panel("0")  # disabled
# to see the implementation of cooling,
# 
# check before
# KBEM_Ankara_060522_As-Is.gh file
# cooling units are excluded from Ankara simulations: 0: residential non-cooling
# 5: residential with cooling
# 1: office unit
panel_40 = Panel("if residential")  # disabled
equals_5 = Equality(FirstNumber=panel_12, SecondNumber=panel_39)  # -> Equality, Inequality; disabled
dispatch_6 = Dispatch(List=panel_12, DispatchPattern=equals_5.Equality)  # -> ListA, ListB; disabled

# ----
# LinearInterpolated    People per sqm
panel_41 = Panel("""0.0567
0.0142
0.0284
0.0567
0.0071
0.0709
0.0284
0.0121
0.0362
0.0121
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""")
panel_42 = Panel("""0.0063
0.0314
0.0251
0.0063
0.0063
0.0126
0.0314
0.0251
0.0189
0.0126
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""")
merge_4 = Merge(Data1=panel_41, Data2=panel_42)

# ----
# Internal Loads
boiler_efficiency = Panel("""0.878
0.942
0.915
0.842
0.833
0.903
0.825
0.859
0.893
0.862
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""")

# ----
# # of units per building
data_5 = Data(python_4.a)

panel_43 = Panel("DWELLING")
geo = Geometry([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])

panel_44 = Panel("COMMERCIAL")
geo_2 = Geometry([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])

panel_45 = Panel("PUBLIC")
geo_3 = Geometry([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])

panel_46 = Panel("SCHOOL")
geo_4 = Geometry([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])

geo_5 = Geometry([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])

geo_6 = Geometry([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])

geo_7 = Geometry([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])

geo_8 = Geometry([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])

geo_9 = Geometry([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])

geo_10 = Geometry([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])

geo_11 = Geometry([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])

geo_12 = Geometry([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])

geo_13 = Geometry([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])

geo_14 = Geometry([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])

geo_15 = Geometry([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])

geo_16 = Geometry([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])

# ----
# Read CSV
toggle = BooleanToggle(True)
path = FilePath("C:\KBEM\IP2.1\coolingSetPoint_Izmir_2ndJournal.csv")
readxl = ReadExcelSheet(Run=toggle, FilePath=path, Worksheet="1", Listen=False)  # -> UserMessages, Columns, Rows
branch = TreeBranch(Tree=readxl.Columns, Path="2", MaintainPaths=True)
cull_i = CullIndex(List=branch, Indices="0", Wrap=True)
roundd = RoundToDecimalPlace(NumberX=cull_i, DecimalPlace="2", RoundType=0)  # -> Rounded, Difference

boundary = BoundarySurfaces(Edges=geo_8)
preview = CustomPreview(Geometry=boundary, Material=ColourSwatch(SwatchColor=RGB(204, 0, 255)))

boundary_2 = BoundarySurfaces(Edges=geo_5)
preview_2 = CustomPreview(Geometry=boundary_2, Material=ColourSwatch(SwatchColor=RGB(0, 255, 30)))

boundary_3 = BoundarySurfaces(Edges=geo_6)
preview_3 = CustomPreview(Geometry=boundary_3, Material=ColourSwatch(SwatchColor=RGB(255, 0, 0)))

boundary_4 = BoundarySurfaces(Edges=geo_7)
preview_4 = CustomPreview(Geometry=boundary_4, Material=ColourSwatch(SwatchColor=RGB(0, 38, 255)))

boundary_5 = BoundarySurfaces(Edges=geo)
preview_5 = CustomPreview(Geometry=boundary_5, Material=ColourSwatch(SwatchColor=RGB(204, 0, 255)))

boundary_6 = BoundarySurfaces(Edges=geo_2)
preview_6 = CustomPreview(Geometry=boundary_6, Material=ColourSwatch(SwatchColor=RGB(0, 255, 30)))

boundary_7 = BoundarySurfaces(Edges=geo_3)
preview_7 = CustomPreview(Geometry=boundary_7, Material=ColourSwatch(SwatchColor=RGB(255, 0, 0)))

boundary_8 = BoundarySurfaces(Edges=geo_4)
preview_8 = CustomPreview(Geometry=boundary_8, Material=ColourSwatch(SwatchColor=RGB(0, 38, 255)))

boundary_9 = BoundarySurfaces(Edges=geo_9)
preview_9 = CustomPreview(Geometry=boundary_9, Material=ColourSwatch(SwatchColor=RGB(204, 0, 255)))

boundary_10 = BoundarySurfaces(Edges=geo_10)
preview_10 = CustomPreview(Geometry=boundary_10, Material=ColourSwatch(SwatchColor=RGB(0, 255, 30)))

boundary_11 = BoundarySurfaces(Edges=geo_11)
preview_11 = CustomPreview(Geometry=boundary_11, Material=ColourSwatch(SwatchColor=RGB(255, 0, 0)))

boundary_12 = BoundarySurfaces(Edges=geo_12)
preview_12 = CustomPreview(Geometry=boundary_12, Material=ColourSwatch(SwatchColor=RGB(0, 38, 255)))

boundary_13 = BoundarySurfaces(Edges=geo_13)
preview_13 = CustomPreview(Geometry=boundary_13, Material=ColourSwatch(SwatchColor=RGB(255, 0, 0)))

boundary_14 = BoundarySurfaces(Edges=geo_15)
preview_14 = CustomPreview(Geometry=boundary_14, Material=ColourSwatch(SwatchColor=RGB(0, 255, 30)))

boundary_15 = BoundarySurfaces(Edges=geo_14)
preview_15 = CustomPreview(Geometry=boundary_15, Material=ColourSwatch(SwatchColor=RGB(0, 38, 255)))

boundary_16 = BoundarySurfaces(Edges=geo_16)
preview_16 = CustomPreview(Geometry=boundary_16, Material=ColourSwatch(SwatchColor=RGB(204, 0, 255)))

# ----
# FOR ANKARA, Cooling System Ratio Inside Residential Units, %
lng_6 = ListLength(List=dispatch_6.ListA)  # disabled
panel_59 = Panel("3")  # disabled
pcent = Percentage(Number=lng_6, Percent=panel_59)  # disabled
round_6 = Round(Number=pcent)  # -> Nearest, Floor, Ceiling; disabled
series_6 = Series(Start=0, Step=1, Count=round_6.Floor)  # disabled

panel_60 = Panel(partition)

# ----
# select which residential units will have cooling
listdexs = ListIndices(List=panel_12)  # disabled
# Residential with cooling
dispatch_7 = Dispatch(List=listdexs, DispatchPattern=equals_5.Equality)  # -> ListA, ListB; disabled
jitter_2 = Jitter(List=dispatch_7.ListA, Jitter=1, Seed=2)  # -> Values, Indices; disabled
item_2 = ListItem(List=jitter_2.Values, Index=series_6, Wrap=True)  # disabled

panel_61 = Panel("BLOCK BOUNDARIES")
curve = Curve([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])

curve_2 = Curve([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])

curve_3 = Curve([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])

# ----
# Geometric Input
merge_5 = Merge(Data1=geo_8, Data2=geo_5, Data3=geo_6, Data4=geo_7)

# ----
# Geometric Input
merge_6 = Merge(Data1=geo, Data2=geo_2, Data3=geo_3, Data4=geo_4)

# ----
# total # of parcels in the neighborhood
lng_7 = ListLength(List=merge_6)

series_7 = Series(Start=0, Step=1, Count=lng_7)

# ----
# Geometric Input
merge_7 = Merge(Data1=geo_9, Data2=geo_10, Data3=geo_11, Data4=geo_12)

curve_4 = Curve([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])

# ----
# Geometric Input
merge_8 = Merge(Data1=geo_16, Data2=geo_15, Data3=geo_13, Data4=geo_14)

# ----
# total # of parcels in the neighborhood
lng_8 = ListLength(List=merge_8)

series_8 = Series(Start=0, Step=1, Count=lng_8)

# ----
# add residential with cooling units
panel_65 = Panel("5")  # disabled
replace_2 = ReplaceItems(List=panel_12, Item=panel_65, Indices=item_2, Wrap=False)  # disabled

# ----
# 0: Bahçelievler, Ankara
# 1: Yukarı Bahçelievler, Ankara
# 2: Emek, Ankara
# 3: Bahriye Ucok, Izmir
number_slider = Slider(0, range=0..3)
panel_66 = Panel("""0
1
2
3""")
item_3 = ListItem(List=panel_66, Index=number_slider, Wrap=True)

weave = Weave(
    Pattern=item_3,
    Stream0=boiler_efficiency,
    Stream1=boiler_efficiency,
    Stream2=boiler_efficiency,
    Stream3=boilereff,
    NullGaps=False)
panel_67 = Panel("BoilerEff")

# ----
# neighborhood selection
panel_68 = Panel("""Ank_Bah
Ank_yBah
Ank_Emk
Izm_Bah""")
item_4 = ListItem(List=panel_68, Index=item_3, Wrap=True)

weave_2 = Weave(Pattern=item_3, Stream0=vtwindow_2, Stream1=vtwindow_2, Stream2=vtwindow_2, Stream3=vtwindow, NullGaps=False)
panel_69 = Panel("VT Window")

panel_70 = Panel("Infiltration Rate")
weave_3 = Weave(
    Pattern=item_3,
    Stream0=infiltration,
    Stream1=infiltration,
    Stream2=infiltration,
    Stream3=infiltrationrate,
    NullGaps=False)

weave_4 = Weave(Pattern=item_3, Stream0=shgcwindow_2, Stream1=shgcwindow_2, Stream2=shgcwindow_2, Stream3=shgcwindow, NullGaps=False)
panel_71 = Panel("SHGC Window")

panel_72 = Panel("""minimum stair dimensions
2m*4m""")
# RESULT
# ToDO
# old
# note it down resources
geo_17 = Geometry([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])

panel_73 = Panel("Commercial")
weave_5 = Weave(Pattern=item_3, Stream0=geo_15, Stream1=geo_10, Stream2=geo_5, Stream3=geo_2, NullGaps=False)

panel_74 = Panel("Construction Date")
weave_6 = Weave(Pattern=item_3, Stream0=const_date_4, Stream1=const_date_3, Stream2=const_date_2, Stream3=const_date, NullGaps=False)

# ----
# Real Data
# Building
# Parcel No
weave_7 = Weave(Pattern=item_3, Stream0=panel_15, Stream1=panel_24, Stream2=panel_23, Stream3=panel_10, NullGaps=False)

panel_75 = Panel("parcelsGeometry")
weave_8 = Weave(Pattern=item_3, Stream0=merge_8, Stream1=merge_7, Stream2=merge_5, Stream3=merge_6, NullGaps=False)

weave_9 = Weave(Pattern=item_3, Stream0=wwr_2, Stream1=wwr_2, Stream2=wwr_2, Stream3=wwr, NullGaps=False)
panel_76 = Panel("WWR")

panel_77 = Panel("Public")
weave_10 = Weave(Pattern=item_3, Stream0=geo_13, Stream1=geo_11, Stream2=geo_6, Stream3=geo_3, NullGaps=False)

# ----
# Data Challenges: # of floors and # of units in the building can not match. for some cases # of floors is higher than # of units in the building
# 
# 
# https://docs.google.com/document/d/1INWO2i1du29ZDZWHUi1IJCvi89qGMdNHIzGieotD-bE/edit
panel_78 = Panel("Radius")
_40 = Data(40)

# ----
# Reference Vector
pt = ConstructPoint(XCoordinate=0, YCoordinate=0, ZCoordinate=0)
pt_2 = Point(Point(485242, 4421817, 0))
# VISUAL
# OUTPUT
# INPUT
vec2pt = Vector2Pt(PointA=pt_2, PointB=pt, Unitize=False)  # -> Vector, Length

panel_79 = Panel("parcelUBEM")
weave_11 = Weave(Pattern=item_3, Stream0=parcelubem_7, Stream1=parcelubem_6, Stream2=parcelubem_5, Stream3=parcelubem_3, NullGaps=False)

panel_80 = Panel("""Real Data
# of floor """)
weave_12 = Weave(
    Pattern=item_3,
    Stream0=panel_22,
    Stream1=real_data_of_floor_3,
    Stream2=real_data_of_floor_2,
    Stream3=real_data_of_floor,
    NullGaps=False)

panel_81 = Panel("blockGeometry")
weave_13 = Weave(Pattern=item_3, Stream0=curve_4, Stream1=curve_3, Stream2=curve, Stream3=curve_2, NullGaps=False)

weave_14 = Weave(
    Pattern=item_3,
    Stream0=ugroundfloor_2,
    Stream1=ugroundfloor_2,
    Stream2=ugroundfloor_2,
    Stream3=ugroundfloor,
    NullGaps=False)
panel_82 = Panel("U Ground")

panel_83 = Panel("staircase ratio")

panel_84 = Panel("School")
weave_15 = Weave(Pattern=item_3, Stream0=geo_14, Stream1=geo_12, Stream2=geo_7, Stream3=geo_4, NullGaps=False)

panel_85 = Panel("blockUBEM")
weave_16 = Weave(Pattern=item_3, Stream0=block_ubem_4, Stream1=block_ubem_3, Stream2=block_ubem_2, Stream3=block_ubem, NullGaps=False)

# ----
# VENTILATION PER AREA
# DO NOT USE WITH RESIDENTIAL AND OFFICE UNITS: it works with specific zone types (cleanroom, laboratories)
# http://hydrashare.github.io/hydra/viewer?owner=chriswmackey&fork=hydra_2&id=Customizing_HVAC_Systems&slide=0&scale=2.0000000000000018&offset=-769.4718387139474,-192.523115453532
boolean_toggle = BooleanToggle(False)
ach2m3_s_m2_calculator = Honeybee_infORventPerAreaCalculator(airFlowRate="0.0003", ACHorM3sM2=boolean_toggle)  # -> readMe, infPerAreaFacade, ventPerAreaFloor, allExposed, allFloors; disabled; plug-in component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

# ----
# # of Units of
# the building
weave_17 = Weave(
    Pattern=item_3,
    Stream0=python_4.a,
    Stream1=of_units_of_the_building_3,
    Stream2=of_units_of_the_building_2,
    Stream3=of_units_of_the_building,
    NullGaps=False)

panel_86 = Panel("U Window")
weave_18 = Weave(Pattern=item_3, Stream0=uwindow_2, Stream1=uwindow_2, Stream2=uwindow_2, Stream3=uwindow, NullGaps=False)

# ----
# INFO/EXTRA
floor_height = Panel("3")

# ----
# Generated
# # of Units
# Per Floor
weave_19 = Weave(
    Pattern=item_3,
    Stream0=round_5.Floor,
    Stream1=round_3.Floor,
    Stream2=round_4.Floor,
    Stream3=round_2.Floor,
    NullGaps=False)

panel_87 = Panel("U Roof")
weave_20 = Weave(Pattern=item_3, Stream0=uroof_2, Stream1=uroof_2, Stream2=uroof_2, Stream3=uroof, NullGaps=False)

# ----
# SMALLEST
# SUB-STEPS
# TEST
# SUB-STEPS
# STEPS
tolerance = Panel("0.5")

panel_88 = Panel("U Wall")
weave_21 = Weave(Pattern=item_3, Stream0=uwall_2, Stream1=uwall_2, Stream2=uwall_2, Stream3=uwall, NullGaps=False)

# ----
# Geometric Input
swatch = ColourSwatch(SwatchColor=RGB(0, 0, 0))
wires = BrepWireframe(Brep=weave_8, Density=-1)
preview_17 = CustomPreview(Geometry=wires, Material=swatch)

cls = Closed(Curve=weave_8)  # -> Closed, Periodic
dispatch_8 = Dispatch(List=weave_8, DispatchPattern=cls.Closed)  # -> ListA, ListB

# ---- group: if it is not closed
geo_18 = Geometry(dispatch_8.ListB)

# ----
geo_19 = Geometry(weave_13)
# x
# x
# x
# x
# x
# x
# x
# x
# x
# x
# x
# x
# x
# x
# x
# x
# x
# x
# x
# x
# x
# x
panel_89 = Panel("BLOCK BOUNDARIES")

# ----
# Sort Blocks by X,Y Coordinates
area = Area(Geometry=geo_19)  # -> Area, Centroid
pdecon = Deconstruct(Point=area.Centroid)  # -> graft(XComponent), graft(YComponent), ZComponent
avr = Average(Input=[pdecon.XComponent, pdecon.YComponent])  # -> flatten(ArithmeticMean)
sort = SortList(Keys=avr, ValuesA=geo_19)  # -> Keys, ValuesA

panel_90 = Panel("""SORTED 
BLOCKS""")
sorted_parcels = Geometry(sort.ValuesA)

panel_91 = Panel("PARCELS")
area_2 = Area(Geometry=weave_8)  # -> Area, Centroid

# ----
# Curve selection is important: while setting curves; start selection with the curve at the left bottom corner (so that sorting will start there)
# Building footprint curves in each parcel
incurve = PointInCurve(Point=area_2.Centroid, Curve=graft(sorted_parcels))  # -> Relationship, Point
if_it_is_inside = Panel("2")
equals_6 = Equality(FirstNumber=incurve.Relationship, SecondNumber=if_it_is_inside)  # -> Equality, Inequality
dispatch_9 = Dispatch(List=incurve.Point, DispatchPattern=equals_6.Equality)  # -> simplify(ListA), ListB
fsim = FindSimilarMember(Data=dispatch_9.ListA, Set=area_2.Centroid)  # -> Hit, Index

panel_92 = Panel("""SORTED 
PARCELS""")
item_5 = ListItem(List=weave_8, Index=fsim.Index, Wrap=True)

# ----
# Cull Empty Blocks
lng_9 = ListLength(List=item_5)  # -> flatten(Length)
equals_7 = Equality(FirstNumber=lng_9, SecondNumber="0")  # -> Equality, Inequality
panel_93 = Panel(equals_7.Equality)
viewer = ParamViewer(item_5)
not = GateNot(A=panel_93)
python_7 = PythonScript(InList=panel_93)  # -> TrueList, FalseList; inputs InList: list
# ---------- python_7: Python ----------
TrueList = []
FalseList = []
for id,value in enumerate(InList):
    if value == "True":
        TrueList.append(id)
    else:
        FalseList.append(id)
# ---------- end python_7 ----------
cull = CullPattern(List=viewer, CullPattern=not)
branch_2 = TreeBranch(Tree=item_5, Path=cull, MaintainPaths=True)  # -> simplify(Branch)
lng_10 = ListLength(List=branch_2)  # -> flatten(Length)

partition_2 = PartitionList(List=flatten(branch_2), Size=lng_10)  # -> simplify(Chunks)
panel_94 = Panel("""CULLED 
EMPTY
BLOCKS""")

geo_20 = Geometry(partition_2)

# ---- group: BLOCKS
geo_21 = Geometry(sorted_parcels)
cull_i_2 = CullIndex(List=geo_21, Indices=python_7.TrueList, Wrap=True)

# ----
area_3 = Area(Geometry=geo_20)  # -> Area, Centroid
fline = FitLine(Points=area_3.Centroid)

# ----
# Fit Line for the parcels in the block
null = NullItem(Item=fline)  # -> flatten(NullFlags), InvalidFlags, Description
panel_96 = Panel(null.NullFlags)
python_8 = PythonScript(InList=panel_96)  # -> TrueList, FalseList; inputs InList: list; same code as python_7

crv_cp = CurveClosestPoint(Point=area_3.Centroid, Curve=fline)  # -> Point, Parameter, Distance
avr_2 = Average(Input=crv_cp.Distance)
smaller = SmallerThan(FirstNumber=avr_2, SecondNumber="5")  # -> flatten(SmallerThan), OrEqualTo
panel_97 = Panel(smaller.SmallerThan)
python_9 = PythonScript(InList=panel_97)  # -> TrueList, FalseList; inputs InList: list; same code as python_7

# ----
# Parcels with two or more lines
lng_11 = ListLength(List=cull_i_2)
series_9 = Series(Start=0, Step=1, Count=lng_11)
merge_9 = Merge(Data1=python_8.TrueList, Data2=python_9.TrueList)
cull_i_3 = CullIndex(List=series_9, Indices=merge_9, Wrap=True)

area_4 = Area(Geometry=geo_19)  # -> Area, Centroid
panel_98 = Panel("""CULLED 
EMPTY
PARCELS""")

# ----
# Parcels with less than two lines
item_6 = ListItem(List=series_9, Index=merge_9, Wrap=True)
branch_3 = TreeBranch(Tree=area_3.Centroid, Path=item_6, MaintainPaths=True)
fline_2 = FitLine(Points=branch_3)
avr_3 = Average(Input=area_4.Centroid)
Y = UnitY(Factor="1000")
move = Move(Geometry=avr_3, Motion=Y)  # -> Geometry, Transform
end = EndPoints(Curve=fline_2)  # -> Start, End
vec2pt_2 = Vector2Pt(PointA=avr_3, PointB=move.Geometry, Unitize=Toggle(True))  # -> Vector, Length
vec2pt_3 = Vector2Pt(PointA=end.Start, PointB=end.End, Unitize=Toggle(True))  # -> Vector, Length
dprod = DotProduct(VectorA=vec2pt_3.Vector, VectorB=vec2pt_2.Vector, Unitize=False)

# ----
# horizontal fitted lines:
# parcels with less than two lines
abs = Absolute(Value=dprod)
smaller_2 = SmallerThan(FirstNumber=abs, SecondNumber="0.5")  # -> flatten(SmallerThan), OrEqualTo
viewer_2 = ParamViewer(abs)
dispatch_10 = Dispatch(List=viewer_2, DispatchPattern=smaller_2.SmallerThan)  # -> ListA, ListB
branch_4 = TreeBranch(Tree=geo_20, Path=dispatch_10.ListA, MaintainPaths=True)
area_5 = Area(Geometry=branch_4)  # -> Area, Centroid
pdecon_2 = Deconstruct(Point=area_5.Centroid)  # -> XComponent, YComponent, ZComponent
sort_2 = SortList(Keys=pdecon_2.XComponent, ValuesA=branch_4)  # -> Keys, ValuesA

# ----
# single parcels in the block
# parcels with less than two lines
null_2 = NullItem(Item=dprod)  # -> NullFlags, InvalidFlags, Description
dispatch_11 = Dispatch(List=branch_3, DispatchPattern=null_2.NullFlags)  # -> ListA, ListB
viewer_3 = ParamViewer(dispatch_11.ListA)
dispatch_12 = Dispatch(List=viewer_3, DispatchPattern=flatten(null_2.NullFlags))  # -> ListA, ListB
branch_5 = TreeBranch(Tree=geo_20, Path=dispatch_12.ListA, MaintainPaths=True)

# ----
# vertical fitted lines:
# parcels with less than two lines
abs_2 = Absolute(Value=dprod)
similar = Similarity(FirstNumber=abs_2, SecondNumber="1", Threshold="10")  # -> flatten(Similarity), AbsoluteDifference
panel_99 = Panel(similar.Similarity)
viewer_4 = ParamViewer(abs_2)
dispatch_13 = Dispatch(List=viewer_4, DispatchPattern=panel_99)  # -> ListA, ListB
branch_6 = TreeBranch(Tree=geo_20, Path=dispatch_13.ListA, MaintainPaths=True)
area_6 = Area(Geometry=branch_6)  # -> Area, Centroid
pdecon_3 = Deconstruct(Point=area_6.Centroid)  # -> XComponent, YComponent, ZComponent
sort_3 = SortList(Keys=pdecon_3.YComponent, ValuesA=branch_6)  # -> Keys, ValuesA

# ----
# Parcels with two or more lines
panel_100 = Panel("{}")
split = TextSplit(Text=flatten(dispatch_13.ListA), Separators=flatten("{}"))
split_2 = TextSplit(Text=flatten(dispatch_10.ListA), Separators=flatten(panel_100))
split_3 = TextSplit(Text=flatten(dispatch_12.ListA), Separators=flatten("{}"))
item_7 = ListItem(List=split_2, Index="1", Wrap=True)  # -> flatten(Item)
item_8 = ListItem(List=split, Index="1", Wrap=True)  # -> flatten(Item)
item_9 = ListItem(List=split_3, Index="1", Wrap=True)  # -> flatten(Item)
merge_10 = Merge(Data1=item_9, Data2=item_8, Data3=item_7)
data_6 = Data(item_6)
equals_8 = Equality(FirstNumber=data_6, SecondNumber=graft(merge_10))  # -> Equality, Inequality
panel_101 = Panel(equals_8.Equality)
python_10 = PythonScript(InList=panel_101)  # -> flatten(TrueList), FalseList; inputs InList: list; same code as python_7
cull_i_4 = CullIndex(List=data_6, Indices=python_10.TrueList, Wrap=True)
ins = InsertItems(List=cull_i_3, Item=cull_i_4, Indices=Toggle(False), Wrap=True)
sort_4 = SortList(Keys=ins, ValuesA=ins)  # -> Keys, ValuesA

geo_22 = Geometry(sorted_parcels)
cull_i_5 = CullIndex(List=geo_22, Indices=python_7.TrueList, Wrap=True)
geo_23 = Geometry(simplify(graft(cull_i_5)))

# ----
# Parcels with two or more line indices
data_7 = Data(sort_4.ValuesA)

branch_7 = TreeBranch(Tree=area_3.Centroid, Path=data_7, MaintainPaths=True)
branch_8 = TreeBranch(Tree=geo_23, Path=data_7, MaintainPaths=True)
disc = Discontinuity(Curve=branch_8, Level=1)  # -> simplify(Points), Parameters
area_7 = Area(Geometry=branch_8)  # -> Area, flatten(Centroid)
vec2pt_4 = Vector2Pt(PointA=graft(area_7.Centroid), PointB=simplify(branch_7), Unitize=False)  # -> simplify(Vector), Length
merge_11 = Merge(Data1=branch_7, Data2=disc.Points)
plfit = PlaneFit(Points=merge_11)  # -> Plane, Deviation
unit = UnitVector(Vector=vec2pt_4.Vector)
# Defining Positions of Parcels in the Block
# according to degree
deplane = DeconstructPlane(Plane=plfit.Plane)  # -> Origin, XAxis, YAxis, ZAxis
abs_3 = Absolute(Value=deplane.XAxis)
neg = Negative(Value=abs_3)
dprod_2 = DotProduct(VectorA=neg, VectorB=unit, Unitize=False)
dprod_3 = DotProduct(VectorA=deplane.YAxis, VectorB=unit, Unitize=False)
python_11 = GhPythonScript(x=dprod_2, y=dprod_3)  # -> out, a
# ---------- python_11: Python ----------
__author__ = "jhorikawa"
__version__ = "2020.07.27"

import rhinoscriptsyntax as rs
import math

a = math.atan2(x, y)
# ---------- end python_11 ----------

# ----
# single parcels in the block
# parcels with less than two lines
area_8 = Area(Geometry=branch_5)  # -> Area, Centroid

# ----
# vertical fitted lines:
# parcels with less than two lines
area_9 = Area(Geometry=sort_3.ValuesA)  # -> Area, Centroid

# ----
# horizontal fitted lines:
# parcels with less than two lines
area_10 = Area(Geometry=sort_2.ValuesA)  # -> Area, Centroid

# ----
# # of blocks in the neighborhood
lng_12 = ListLength(List=equals_7.Equality)

# ----
# 01.ORDERING BUILDINGS
# Define Empty List
panel_103 = Panel("empty")
dup_2 = DuplicateData(Data=panel_103, Number=lng_12, Order=True)

# ----
# Buildings degrees of positions
deg = Degrees(Radians=python_11.a)

# ----
# sorted parcels which buildings included
geo_24 = Geometry(geo_21)

area_11 = Area(Geometry=geo_24)  # -> Area, Centroid
sorted_points = Point(flatten(area_11.Centroid))
lng_13 = ListLength(List=sorted_points)
series_10 = Series(Start="0", Step=1, Count=lng_13)  # -> simplify(Series)

# ----
# Empty Blocks
data_8 = Data(python_7.TrueList)
replace_3 = ReplaceItems(List=dup_2, Item="0", Indices=data_8, Wrap=False)

# ----
# Parcels with two or more lines
pdecon_4 = Deconstruct(Point=branch_7)  # -> XComponent, YComponent, ZComponent
addition_2 = Addition(A=pdecon_4.XComponent, B=pdecon_4.YComponent)
division_8 = Division(A=addition_2, B="2")
sort_5 = SortList(Keys=deg, ValuesA=branch_7)  # -> Keys, ValuesA
sort_6 = SortList(Keys=division_8, ValuesA=branch_7)  # -> Keys, ValuesA
item_10 = ListItem(List=sort_6.ValuesA, Index=0, Wrap=True)
equals_9 = Equality(FirstNumber=sort_5.ValuesA, SecondNumber=item_10)  # -> Equality, Inequality
panel_104 = Panel(equals_9.Equality)
python_12 = PythonScript(InList=panel_104)  # -> TrueList, FalseList; inputs InList: list; same code as python_7

data_9 = Data(series_10)
partition_3 = PartitionList(List=data_9, Size="1")  # -> simplify(Chunks)

# ----
# indices of buildings in parcels with two or more line
shift = ShiftList(List=sort_5.ValuesA, Shift=python_12.TrueList, Wrap=True)  # -> simplify(List)

# ----
# indices of buildings in parcels with two or more line
geo_25 = Geometry(shift)

merge_12 = Merge(Data1=geo_25, Data2=area_8.Centroid, Data3=area_9.Centroid, Data4=area_10.Centroid)  # -> simplify(Result)

# ----
# Not-Empty Blocks
tstat = TreeStatistics(Tree=merge_12)  # -> Paths, Length, Count
data_10 = Data(python_7.FalseList)
replace_4 = ReplaceItems(List=replace_3, Item=tstat.Length, Indices=data_10, Wrap=False)

geo_26 = Geometry(flatten(merge_12))
partition_4 = PartitionList(List=geo_26, Size=replace_4)  # -> simplify(Chunks)

listdexs_2 = ListIndices(List=partition_4)
lng_14 = ListLength(List=listdexs_2)
dup_3 = DuplicateData(Data=partition_3, Number=lng_14, Order=True)  # -> simplify(graft(Data))

panel_105 = Panel()

merge_13 = Merge(Data1=simplify(dup_3), Data2=graft(listdexs_2))
join = TextJoin(Text=merge_13, Join="_")  # -> flatten(Result)
null_3 = NullItem(Item=join)  # -> NullFlags, InvalidFlags, Description
lng_15 = ListLength(List=listdexs_2)  # -> flatten(Length)
dispatch_14 = Dispatch(List=join, DispatchPattern=null_3.NullFlags)  # -> ListA, ListB
partition_5 = PartitionList(List=dispatch_14.ListB, Size=lng_15)  # -> simplify(Chunks)

# ----
# Empty List
# tag order for parcels
data_11 = Data(flatten(partition_5))

# ----
# Empty List
# tag order for parcels
data_12 = Data(flatten(partition_5))  # disabled

branch_9 = TreeBranch(Tree=geo_20, Path=data_7, MaintainPaths=True)
sort_7 = SortList(Keys=deg, ValuesA=branch_9)  # -> Keys, ValuesA
shift_2 = ShiftList(List=sort_7.ValuesA, Shift=python_12.TrueList, Wrap=True)  # -> simplify(List)
merge_14 = Merge(Data1=shift_2, Data2=branch_5, Data3=sort_3.ValuesA, Data4=sort_2.ValuesA)

# ----
# # of parcels in the blocks
# complete list of THE NEIGHBORHOOD
lng_16 = ListLength(List=merge_14)  # -> flatten(Length)

# ----
# tag order for parcels
partition_6 = PartitionList(List=data_11, Size=lng_16)  # -> simplify(Chunks)

# ----
# # of parcels in the blocks
# complete list of THE NEIGHBORHOOD
lng_17 = ListLength(List=merge_14)  # -> flatten(Length); disabled

# ----
# tag order for parcels
partition_7 = PartitionList(List=data_12, Size=lng_17)  # -> simplify(Chunks); disabled

panel_106 = Panel("Normalized (sch_x*sch_y)")
panel_107 = Panel(panel_105)

# ----
# tag order for parcels
swatch_2 = ColourSwatch(SwatchColor=RGB(8, 0, 255))
tag = TextTag3D(Location=partition_4, Text=partition_5, Size="3", Colour=swatch_2, Justification=7)

preview_18 = CustomPreview(Geometry=merge_14, Material=ColourSwatch(SwatchColor=RGB(0, 0, 0)))

tstat_2 = TreeStatistics(Tree=merge_14)  # -> Paths, Length, Count
panel_108 = Panel(tstat_2.Paths)

# ----
# block_parcel
panel_109 = Panel(partition_5)

# ----
# public and school buildings excluded list
panel_110 = Panel("PARCELS")
geo_27 = Geometry(merge_14)

panel_111 = Panel("BLOCKS")
geo_28 = Geometry(cull_i_2)

# ----
# Input
lng_18 = ListLength(List=geo_28)
series_11 = Series(Start=0, Step=1, Count=lng_18)
branch_10 = TreeBranch(Tree=geo_27, Path=series_11, MaintainPaths=True)

# ----
# 4edged layout transformation has applied to all parcel layouts due to energy modeling standards of E+ (adjacency problems)
# 4 edges and others
debrep = DeconstructBrep(Brep=flatten(branch_10))  # -> Faces, Edges, Vertices
_4edged_transformation = Panel("4")
lng_19 = ListLength(List=debrep.Vertices)  # -> flatten(Length)
lng_20 = ListLength(List=branch_10)  # -> flatten(Length)
equals_10 = Equality(FirstNumber=lng_19, SecondNumber=_4edged_transformation)  # -> Equality, Inequality
partition_8 = PartitionList(List=flatten(equals_10.Equality), Size=lng_20)  # -> simplify(Chunks)
dispatch_15 = Dispatch(List=branch_10, DispatchPattern=partition_8)  # -> ListA, ListB

panel_112 = Panel("4 edges")
geo_29 = Geometry(dispatch_15.ListA)

panel_113 = Panel("More than 4 edges")
geo_30 = Geometry(dispatch_15.ListB)

geo_31 = Geometry(geo_30)

# ----
# ConvexToConcave
# Transformation
debrep_2 = DeconstructBrep(Brep=flatten(geo_31))  # -> Faces, Edges, simplify(Vertices)
hull = ConvexHull(Points=debrep_2.Vertices, Plane=PlaneXY(0, 0, 0))  # -> flatten(Hull), HullZ, Indices
area_12 = Area(Geometry=flatten(geo_31))  # -> Area, Centroid
original_values = Panel(area_12.Area)
xy = XYPlane(Origin=area_12.Centroid)
scale2area = ScaleToArea(Geometry=hull.Hull, Plane=xy, Area=original_values, FactorX=1, FactorY=1, FactorZ=1)  # -> Scaled, Transform

panel_115 = Panel("""Concave
To
Convex""")
geo_32 = Geometry(scale2area.Scaled)

# ----
# Degree Resolution
degreerangeratio = Panel("15")
division_9 = Division(A="360", B=degreerangeratio)
addition_3 = Addition(A=division_9, B="1")
series_12 = Series(Start=0, Step=degreerangeratio, Count=addition_3)

# ----
# FIT 4 edged rectangle
# select smallest one
area_13 = Area(Geometry=geo_32)  # -> Area, Centroid
pl = ConstructPlane(Origin=area_13.Centroid, XAxis=Vector(1, 0, 0), YAxis=Vector(0, 1, 0))
prot = RotatePlane(Plane=pl, Angle=series_12)
brec = BoundingRectangle(Geometry=graft(geo_32), Plane=prot, Axis=0, Slide=0, Union=True)  # -> flatten(Bounding), DimensionX, DimensionY
lng_21 = ListLength(List=geo_32)  # -> flatten(Length)
lng_22 = ListLength(List=brec.Bounding)
division_10 = Division(A=lng_22, B=lng_21)
partition_9 = PartitionList(List=brec.Bounding, Size=division_10)  # -> simplify(Chunks)
area_14 = Area(Geometry=partition_9)  # -> Area, Centroid
sort_8 = SortList(Keys=area_14.Area, ValuesA=partition_9)  # -> Keys, ValuesA
item_11 = ListItem(List=sort_8.ValuesA, Index=0, Wrap=True)  # -> flatten(Item)

geo_33 = Geometry(geo_30)

lng_23 = ListLength(List=geo_33)  # -> flatten(Length)
geo_34 = Geometry(item_11)
panel_117 = Panel("""4 edged
non organized""")
partition_10 = PartitionList(List=geo_34, Size=lng_23)  # -> simplify(Chunks)

# ----
# EdgeTo4
merge_15 = Merge(Data1=geo_29, Data2=partition_10)

# ----
# non-organized 4edged building floor layouts
geo_35 = Geometry(merge_15)

# ----
# public and school buildings excluded list
# organized non-4edged building floor layouts
geo_36 = Geometry(merge_14)

# ----
# x
# x
# x
# x
# x
# x
# x
# x
# x
# x
# x
# x
# x
# x
# x
# x
# x
# x
# x
# x
# x
# x
panel_118 = Panel("""simplified &
ordered
parcel
layouts""")

# ----
# public and school buildings
merge_16 = Merge(Data1=weave_5, Data2=weave_10, Data3=weave_15)
disc_2 = Discontinuity(Curve=merge_16, Level=1)  # -> Points, Parameters
hull_2 = ConvexHull(Points=disc_2.Points, Plane=PlaneXY(0, 0, 0))  # -> flatten(Hull), HullZ, Indices

# ----
# Re-Organize list
area_15 = Area(Geometry=geo_35)  # -> Area, Centroid
# 02.SIMPLIFICATION
area_16 = Area(Geometry=geo_36)  # -> Area, Centroid
cps = ClosestPoints(Point=area_16.Centroid, Cloud=area_15.Centroid, Count="1")  # -> ClosestPoint, flatten(CPIndex), Distance
lng_24 = ListLength(List=area_16.Centroid)
partition_11 = PartitionList(List=cps.CPIndex, Size=flatten(lng_24))  # -> simplify(Chunks)
item_12 = ListItem(List=geo_35, Index=partition_11, Wrap=True)
area_17 = Area(Geometry=item_12)  # -> Area, Centroid
incurves = PointInCurves(Point=area_17.Centroid, Curves=hull_2.Hull)  # -> Relationship, Index, Point
python_13 = GhPythonScript(x=incurves.Relationship)  # -> out, a; inputs x: list
# ---------- python_13: Python ----------
__author__ = "orcun"
__version__ = "2021.09.25"


import rhinoscriptsyntax as rs
a = []
'2 if it is inside'
for i in range(len(x)): 
    if x[i] == 2:
        a.append(i)
# ---------- end python_13 ----------

# ----
# public and school buildings
item_13 = ListItem(List=partition_6, Index=python_13.a, Wrap=True)  # -> flatten(Item)

# ----
# public and school buildings
data_13 = Data(python_13.a)

# ----
# tag order for parcels
# public and school buildings excluded list
cull_i_6 = CullIndex(List=partition_6, Indices=data_13, Wrap=True)  # -> simplify(List)

lng_25 = ListLength(List=cull_i_6)
dup_4 = DuplicateData(Data="empty", Number=lng_25, Order=True)  # -> simplify(flatten(Data))
panel_119 = Panel("empty list")

# ----
# public and school buildings
item_14 = ListItem(List=partition_6, Index=python_13.a, Wrap=True)  # -> flatten(Item)

# ----
# Entering EKB Data
# for Masonry Wall
panel_120 = Panel("_")
join_2 = TextJoin(Text=merge, Join=panel_120)  # -> simplify(flatten(Result))
mindex = MemberIndex(Set=join_2, Member=item_14)  # -> flatten(Index), Count

# ----
# public and school buildings excluded list
cull_i_7 = CullIndex(List=join_2, Indices=mindex.Index, Wrap=True)

mindex_2 = MemberIndex(Set=flatten(cull_i_6), Member=cull_i_7)  # -> flatten(Index), Count
lng_26 = ListLength(List=mindex_2.Index)
series_13 = Series(Start=0, Step=1, Count=lng_26)
item_15 = ListItem(List=ekbuwallconcrete, Index=series_13, Wrap=True)

# ----
# public and school buildings
item_16 = ListItem(List=partition_7, Index=python_13.a, Wrap=True)  # -> flatten(Item); disabled

# ----
# public and school buildings
data_14 = Data(python_13.a)  # disabled

# ----
# tag order for parcels
# public and school buildings excluded list
cull_i_8 = CullIndex(List=partition_7, Indices=data_14, Wrap=True)  # -> simplify(List); disabled

lng_27 = ListLength(List=cull_i_8)  # disabled
panel_121 = Panel("empty")  # disabled
dup_5 = DuplicateData(Data=panel_121, Number=lng_27, Order=True)  # -> simplify(flatten(Data)); disabled
panel_122 = Panel("empty list")  # disabled

# ----
# # of parcels in the block
data_15 = Data(flatten(lng_24))

# ----
# public and school buildings excluded list
data_16 = Data(python_13.a)

partition_12 = PartitionList(List=series_7, Size=data_15)  # -> simplify(Chunks)
cull_i_9 = CullIndex(List=partition_12, Indices=data_16, Wrap=True)  # -> simplify(flatten(List))

# ----
# # of parcels in the block
data_17 = Data(flatten(lng_24))

panel_123 = Panel("block-list")
data_18 = Data(lng_24)

# ----
# public and school buildings excluded list
data_19 = Data(python_13.a)

partition_13 = PartitionList(List=series_8, Size=data_17)  # -> simplify(Chunks)
cull_i_10 = CullIndex(List=partition_13, Indices=data_19, Wrap=True)  # -> simplify(flatten(List))

# ----
# public and school buildings excluded list
data_20 = Data(python_13.a)

# ----
# Parcel_Block Coordinates
area_18 = Area(Geometry=merge_8)  # -> Area, Centroid
pdecon_5 = Deconstruct(Point=area_18.Centroid)  # -> XComponent, YComponent, ZComponent
partition_14 = PartitionList(List=pdecon_5.XComponent, Size=flatten(data_18))  # -> simplify(Chunks)
partition_15 = PartitionList(List=pdecon_5.YComponent, Size=flatten(data_18))  # -> simplify(Chunks)
cull_i_11 = CullIndex(List=partition_15, Indices=data_20, Wrap=True)  # -> simplify(List)
cull_i_12 = CullIndex(List=partition_14, Indices=data_20, Wrap=True)  # -> simplify(List)
panel_124 = Panel(partition_15)
panel_125 = Panel(partition_14)

# ----
# RENEWABLE_AD
data_21 = Data(flatten(lng_24))  # disabled
data_22 = Data(weave_12)  # disabled
partition_16 = PartitionList(List=data_22, Size=data_21)  # disabled
cull_i_13 = CullIndex(List=partition_16, Indices=python_13.a, Wrap=True)  # -> simplify(List); disabled
panel_126 = Panel("3")  # disabled
multiplication = Multiplication(A=cull_i_13, B=panel_126)  # disabled
Z = UnitZ(Factor=multiplication)  # disabled
extr = Extrude(Base=merge_14, Direction=Z)  # disabled

# ----
# 4-edged
# Ordered
# Parcels
swatch_3 = ColourSwatch(SwatchColor=RGB(255, 255, 255))
geo_37 = Geometry(item_12)
preview_19 = CustomPreview(Geometry=geo_37, Material=swatch_3)

# ----
# public and school buildings excluded list
cull_i_14 = CullIndex(List=item_12, Indices=python_13.a, Wrap=True)  # -> simplify(List)

panel_127 = Panel("# of block")
lng_28 = ListLength(List=merge_14)  # -> flatten(Length)

# ----
# if necessary,
# select and simulate,
# only,
# according to construction date
panel_128 = Panel("construction date")
data_23 = Data(weave_6)

# ----
# CONSTRUCTION DATE SELECTION
# 0 means, no selection according to construction date
panel_129 = Panel("0")
data_24 = Data(panel_129)

partition_17 = PartitionList(List=data_23, Size=lng_28)  # -> simplify(Chunks)

# ----
# public and school buildings excluded list
data_25 = Data(python_13.a)

panel_130 = Panel("""1960
1980
2000""")
equals_11 = Equality(FirstNumber=data_24, SecondNumber=panel_130)  # -> Equality, Inequality
dcon = DeleteConsecutive(Set=equals_11.Equality, Wrap=False)  # -> Set, Count
item_17 = ListItem(List=dcon.Set, Index=0, Wrap=True)
python_14 = GhPythonScript(x=item_17)  # -> out, a
# ---------- python_14: Python ----------
__author__ = "Siser"
__version__ = "2022.01.08"

import rhinoscriptsyntax as rs
if x == True:
    a = 0
else:
    a = 1
# ---------- end python_14 ----------

cull_i_15 = CullIndex(List=partition_17, Indices=data_25, Wrap=True)  # -> simplify(List)

# ----
# organized 4edged
# building PARCELS
geo_38 = Geometry(cull_i_14)

# ----
# selection
# according to
# construction date
equals_12 = Equality(FirstNumber=cull_i_15, SecondNumber=data_24)  # -> Equality, Inequality
dispatch_16 = Dispatch(List=geo_38, DispatchPattern=equals_12.Equality)  # -> ListA, ListB
weave_22 = Weave(Pattern=python_14.a, Stream0=dispatch_16.ListA, Stream1=dispatch_16.ListB, NullGaps=False)  # -> simplify(Weave)

# ----
# if construction date did not entered, no shuffling
python_15 = GhPythonScript(x=panel_129)  # -> out, a; inputs x: Int32
# ---------- python_15: Python ----------
__author__ = "Siser"
__version__ = "2022.02.03"

import rhinoscriptsyntax as rs
if x == 0:
    a = 0
else:
    a = 1
# ---------- end python_15 ----------

# ----
# CONSTRUCTION DATE
# SELECTION PERCENTAGE
panel_131 = Panel("100")

panel_132 = Panel("selection ratio")
data_26 = Data(panel_131)

# ----
# if necessary,
# select and simulate,
# only,
# according to construction date
# and,
# percentage
# indices of
# selection ratio
jitter_3 = Jitter(List=weave_22, Jitter=python_15.a, Seed=2)  # -> simplify(Values), Indices
lng_29 = ListLength(List=weave_22)
division_11 = Division(A=lng_29, B=100)
multiplication_2 = Multiplication(A=division_11, B=data_26)
round_7 = Round(Number=multiplication_2)  # -> Nearest, Floor, Ceiling
series_14 = Series(Start=0, Step=1, Count=round_7.Nearest)  # -> simplify(Series)
item_18 = ListItem(List=jitter_3.Values, Index=series_14, Wrap=True)

# ----
# Ordered Building Layouts
geo_39 = Geometry(item_18)
# x
# x
# x
# x
# x
# x
# x
# x
# x
# x
# x
# x
# x
# x
# x
# x
# x
# x
# x
# x
# x
# x
preview_20 = CustomPreview(Geometry=geo_39, Material=ColourSwatch(SwatchColor=RGB(181, 0, 0)))

# ----
# x
# x
# x
# x
# x
# x
# x
# x
# x
# x
# x
# x
# x
# x
# x
# x
# x
# x
# x
# x
# x
# x
# organized 4edged building PARCELS
geo_40 = Geometry(item_18)

# ----
# Check for UV organization of surface
geo_41 = Geometry(flatten(geo_40))
disc_3 = Discontinuity(Curve=geo_41, Level=1)  # -> Points, Parameters
hull_3 = ConvexHull(Points=disc_3.Points, Plane=PlaneXY(0, 0, 0))  # -> flatten(Hull), HullZ, Indices
boundary_17 = BoundarySurfaces(Edges=hull_3.Hull)
wires_2 = BrepWireframe(Brep=boundary_17, Density=-1)  # -> simplify(Wireframe)
len = Length(Curve=wires_2)
partition_18 = PartitionList(List=boundary_17, Size="1")  # -> simplify(Chunks)
listdexs_3 = ListIndices(List=len)
sort_9 = SortList(Keys=len, ValuesA=listdexs_3)  # -> Keys, reverse(ValuesA)
md_slider = MDSlider(SliderMode=0, slider_value=Point(0.5, 0.5, 0.5), x_domain=Domain(0, 1), y_domain=Domain(0, 1), z_domain=Domain(0, 1))
item_19 = ListItem(List=sort_9.ValuesA, Index=0, Wrap=True)
iso = IsoCurve(Surface=reparameterize(boundary_17), UVPoint=md_slider)  # -> simplify(UIsocurve), VIsocurve
item_20 = ListItem(List=wires_2, Index=item_19, Wrap=True)
colom = CollisionOneMany(Collider=iso.UIsocurve, Obstacles=item_20)  # -> Collision, Index
dispatch_17 = Dispatch(List=partition_18, DispatchPattern=colom.Collision)  # -> simplify(ListA), ListB
clean = CleanTree(RemoveNulls=True, RemoveInvalid=True, RemoveEmpty=Toggle(True), Tree=dispatch_17.ListA)

# ----
# Implementation of Real Data
# for Flat per Floor
# (division numbers,
# percentage for divisions)
unit_per_floor_division = Panel("""1
2
3
4""")
# room number: 50 To 95
# 95 To 140
# 140 To 185
# Implementation of Real Data
# for Unit Sqm
panel_133 = Panel("3")

# ----
# reverse UV of surfaces
data_27 = Data(flatten(clean))
srf = Surface(reparameterize(data_27))
python_16 = PythonScript(s=srf, swapUV=Toggle(True), reverseU=Toggle(False), reverseV=Toggle(False))  # -> out, anchor, uVec, vVec, revSrf; inputs s: Surface, swapUV: Int32, reverseU: Int32, reverseV: Int32
# ---------- python_16: Python ----------
import Rhino

if reverseU:
    uS,uE = s.Domain(0)
    inter0 = Rhino.Geometry.Interval(-uE, -uS)
    s.SetDomain(0,inter0)
    s = s.Reverse(0)

if reverseV:
    vS,vE = s.Domain(1)
    inter1 = Rhino.Geometry.Interval(-vE, -vS)
    s.SetDomain(1,inter1)
    s = s.Reverse(1)

if swapUV:
    s = s.Transpose()

anchor = s.PointAt(0,0)
uend = s.PointAt(0.5,0)
vend = s.PointAt(0,0.5)
uVec = uend - anchor
vVec = vend - anchor

revSrf = s
# ---------- end python_16 ----------

panel_134 = Panel("""UBEM 
Parcel No
List""")
data_28 = Data(weave_7)

# ----
# block number division
panel_135 = Panel("0")
equals_13 = Equality(FirstNumber=data_28, SecondNumber=panel_135)  # -> Equality, Inequality
num = Number(equals_13.Equality)
num_2 = Number("1")
lng_30 = ListLength(List=num)
mindex_3 = MemberIndex(Set=num, Member=num_2)  # -> Index, Count
merge_17 = Merge(Data1="0", Data2=lng_30)
panel_136 = Panel("""0
-1""")
ins_2 = InsertItems(List=mindex_3.Index, Item=merge_17, Indices=panel_136, Wrap=True)
cull_i_16 = CullIndex(List=ins_2, Indices="-1", Wrap=True)
shift_3 = ShiftList(List=ins_2, Shift=1, Wrap=Toggle(False))
subtraction = Subtraction(A=shift_3, B=cull_i_16)

u = ColourSwatch(SwatchColor=RGB(2, 4, 255))
v = ColourSwatch(SwatchColor=RGB(225, 0, 0))
vdisex = VectorDisplayEx(Point=python_16.anchor, Vector=python_16.uVec, Colour=u, Width=3)
vdisex_2 = VectorDisplayEx(Point=python_16.anchor, Vector=python_16.vVec, Colour=v, Width=3)

geo_42 = Geometry(boundary_17)

# ----
# u(uv)and longest edge is at the same orientation
tstat_3 = TreeStatistics(Tree=clean)  # -> Paths, Length, Count
split_4 = TextSplit(Text=tstat_3.Paths, Separators="{}")
item_21 = ListItem(List=split_4, Index="1", Wrap=True)  # -> flatten(Item)
replace_5 = ReplaceItems(List=geo_42, Item=python_16.revSrf, Indices=item_21, Wrap=False)

md_slider_2 = MDSlider(SliderMode=0, slider_value=Point(0.5, 0.5, 0.5), x_domain=Domain(0, 1), y_domain=Domain(0, 1), z_domain=Domain(0, 1))
iso_2 = IsoCurve(Surface=reparameterize(replace_5), UVPoint=md_slider_2)  # -> simplify(UIsocurve), VIsocurve
preview_21 = CustomPreview(Geometry=iso_2.UIsocurve, Material=ColourSwatch(SwatchColor=RGB(47, 255, 0)))

geo_43 = Geometry(flatten(replace_5))

data_29 = Data(weave_12)

# ----
# Arrange
# Surface
# U V values
c_script = CSharpScript()  # -> out, A; inputs x: Surface; disabled
# ---------- c_script: C# ----------
    double pi = 3.1415926535897932384626433832795;
    
    Rhino.Geometry.Point3d p;
    Rhino.Geometry.Vector3d[] UV;
    // Evaluating surfaces at center (median of domain start and end)
    x.Evaluate((x.Domain(0).T0 + x.Domain(0).T1) / 2, (x.Domain(1).T0 + x.Domain(1).T1) / 2, 1, out p, out UV);
    
    // U, V, WorldX, WorldY vectors
    Rhino.Geometry.Vector3d U = UV[0];    
    Rhino.Geometry.Vector3d V = UV[1];    
    Rhino.Geometry.Vector3d X = Rhino.Geometry.Plane.WorldXY.XAxis;
    Rhino.Geometry.Vector3d Y = Rhino.Geometry.Plane.WorldXY.YAxis;
    
    // Unitizing vectors to make tests
    U.Unitize();
    V.Unitize();

    if (Math.Abs(U.X) < Math.Abs(V.X)){ // If this is "true" it means V isocurves are more suitable to be aligned with World X axis than U; U and V needs to be swapped
      x.Transpose(true); //Swapping UV
      if (Vector3d.VectorAngle(V, X) > pi / 2){ // Flipping new U if angle with X is larger than 90°
        x.Reverse(0, true);}
      if (Vector3d.VectorAngle(U, Y) > pi / 2){ // Flipping new V if angle with Y is larger than 90°
        x.Reverse(1, true);}
    }
    else{ // U an V doesn't need to be swapped
      if (Vector3d.VectorAngle(U, X) > pi / 2){ // Flipping U if angle with X is larger than 90°
        x.Reverse(0, true);}
      if (Vector3d.VectorAngle(V, Y) > pi / 2){ // Flipping V if angle with Y is larger than 90°
        x.Reverse(1, true);}
    }
    A = x;
# ---------- end c_script ----------

# ----
# Generated
# # of Units
# Per Floor
data_30 = Data(weave_19)

# ----
# # of Units of
# the building
data_31 = Data(weave_17)

# ----
# Test surface U V values
panel_140 = Panel("0.5,0.5")  # disabled
iso_3 = IsoCurve(Surface=reparameterize(c_script.A), UVPoint=panel_140)  # -> UIsocurve, VIsocurve; disabled
swatch_4 = ColourSwatch(SwatchColor=RGB(255, 0, 0))  # disabled
swatch_5 = ColourSwatch(SwatchColor=RGB(0, 255, 4))  # disabled
# 3.1 - UNIT DIVISION
#   3.1.1 - 2 UNIT PER FLOOR
# Unit division types
# - Floor division with stairs
# - Floor division without stairs
# Adaptation with Real Data
# for unit division
# - L shape
# - Rectangular
# - I shape
# etc.
preview_22 = CustomPreview(Geometry=iso_3.UIsocurve, Material=swatch_4)  # disabled
# Full list control
# - Recording complete information of the unit
# --parcel, building, floor, number in the building
preview_23 = CustomPreview(Geometry=iso_3.VIsocurve, Material=swatch_5)  # disabled

panel_141 = Panel("exclude non-residential buildings")
clean_2 = CleanTree(RemoveNulls=True, RemoveInvalid=True, RemoveEmpty=False, Tree=python_13.a)

clean_3 = CleanTree(RemoveNulls=True, RemoveInvalid=True, RemoveEmpty=False, Tree=python_13.a)

clean_4 = CleanTree(RemoveNulls=True, RemoveInvalid=True, RemoveEmpty=False, Tree=python_13.a)

# ----
# selection according to
# construction date
data_32 = Data(equals_12.Equality)

# ----
# # of Units of the building
toggle_2 = BooleanToggle(True)
partition_19 = PartitionList(List=data_31, Size=subtraction)  # -> simplify(Chunks)
clean_5 = CleanTree(RemoveNulls=True, RemoveInvalid=True, RemoveEmpty=toggle_2, Tree=partition_19)
lng_31 = ListLength(List=clean_5)  # -> flatten(Length)
partition_20 = PartitionList(List=flatten(clean_5), Size=lng_31)  # -> simplify(Chunks)
cull_i_17 = CullIndex(List=partition_20, Indices=clean_4, Wrap=True)  # -> simplify(List)
dispatch_18 = Dispatch(List=cull_i_17, DispatchPattern=data_32)  # -> ListA, ListB
weave_23 = Weave(Pattern=python_14.a, Stream0=dispatch_18.ListA, Stream1=dispatch_18.ListB, NullGaps=False)  # -> simplify(Weave)

# ----
# selection according to
# construction date
data_33 = Data(equals_12.Equality)

# ----
# # of Units Per Floor in the building
toggle_3 = BooleanToggle(True)
partition_21 = PartitionList(List=data_30, Size=subtraction)  # -> simplify(Chunks)
clean_6 = CleanTree(RemoveNulls=True, RemoveInvalid=True, RemoveEmpty=toggle_3, Tree=partition_21)
lng_32 = ListLength(List=clean_6)  # -> flatten(Length)
partition_22 = PartitionList(List=flatten(clean_6), Size=lng_32)  # -> simplify(Chunks)
cull_i_18 = CullIndex(List=partition_22, Indices=clean_2, Wrap=True)  # -> simplify(List)
dispatch_19 = Dispatch(List=cull_i_18, DispatchPattern=data_33)  # -> ListA, ListB
weave_24 = Weave(Pattern=python_14.a, Stream0=dispatch_19.ListA, Stream1=dispatch_19.ListB, NullGaps=False)  # -> simplify(Weave)

# ----
# selection according to
# construction date
data_34 = Data(equals_12.Equality)

data_35 = Data("0.25")

partition_23 = PartitionList(List=geo_43, Size="1")
divide = DivideDomain²(Domain=partition_23, UCount="2", VCount="1")  # -> simplify(Segments)
subsrf = Isotrim(Surface=partition_23, Domain=divide)  # -> simplify(Surface)
md_slider_3 = MDSlider(SliderMode=0, slider_value=Point(0.5, 0.5, 0.5), x_domain=Domain(0, 1), y_domain=Domain(0, 1), z_domain=Domain(0, 1))
item_22 = ListItem(List=subsrf, Index=0, Wrap=True)
evalsrf = EvaluateSurface(Surface=item_22, Point=md_slider_3)  # -> Point, Normal, UDirection, VDirection, Frame
brec_2 = BoundingRectangle(Geometry=subsrf, Plane=evalsrf.Frame, Axis=0, Slide=0, Union=True)  # -> simplify(flatten(Bounding)), DimensionX, DimensionY
area_19 = Area(Geometry=brec_2.Bounding)  # -> Area, Centroid
# rotateStaircase for better floor division, otherwise, units has strange edges
scale = Scale(Geometry=brec_2.Bounding, Center=area_19.Centroid, Factor=data_35)  # -> Geometry, Transform

# ----
# indices of
# selection ratio according to construction date
data_36 = Data(series_14)
panel_145 = Panel("organized list")
item_23 = ListItem(List=simplify(weave_23), Index=simplify(data_36), Wrap=True)  # -> flatten(Item)

data_37 = Data(item_23)
ma = MassAddition(Input=data_37)  # -> Result, PartialResults
total_number_of_units = Panel(ma.Result)

data_38 = Data(item_23)
ma_2 = MassAddition(Input=data_38)  # -> Result, PartialResults
total_number_of_units_2 = Panel(ma_2.Result)

data_39 = Data(item_23)
ma_3 = MassAddition(Input=data_39)  # -> Result, PartialResults
total_number_of_units_3 = Panel(ma_3.Result)

data_40 = Data(item_23)
ma_4 = MassAddition(Input=data_40)  # -> Result, PartialResults
total_number_of_units_4 = Panel(ma_4.Result)

# ----
# 03.FLOORTOUNITDIVISION
panel_146 = Panel(data_34)
panel_147 = Panel(item_23)

# ----
# indices of
# selection ratio according to construction date
data_41 = Data(series_14)
item_24 = ListItem(List=simplify(weave_24), Index=simplify(data_41), Wrap=True)  # -> flatten(Item)

# ----
# # of Units
# Per Floor
# if x == 1:
#     a=1,1
# elif x ==2:
#     a=2,1
# elif x == 3 or x == 4:
#     a=2,2
# elif x==5 or x ==6:
#     a=3,2
# else:
#     a=4,2
python_17 = GhPythonScript(x=item_24)  # -> out, simplify(a); inputs x: Int32
# ---------- python_17: Python ----------
__author__ = "orcun"
__version__ = "2021.11.17"

import rhinoscriptsyntax as rs
if x == 1:
    a=1,1
elif x ==2:
    a=2,1
elif x == 3 or x == 4:
    a=2,2
elif x==5 or x ==6:
    a=3,2
else:
    a=4,2
# ---------- end python_17 ----------
item_25 = ListItem(List=python_17.a, Index=0, Wrap=True)  # -> flatten(Item)
item_26 = ListItem(List=python_17.a, Index=1, Wrap=True)  # -> flatten(Item)

# ----
# # of Units Per Floor
data_42 = Data(item_24)

divide_2 = DivideDomain²(Domain=replace_5, UCount=item_25, VCount=item_26)  # -> simplify(Segments)
partition_24 = PartitionList(List=replace_5, Size="1")
subsrf_2 = Isotrim(Surface=partition_24, Domain=divide_2)  # -> simplify(Surface)
lng_33 = ListLength(List=subsrf_2)  # -> flatten(Length)
lng_34 = ListLength(List=data_42)
series_15 = Series(Start=0, Step=1, Count=lng_34)
equals_14 = Equality(FirstNumber=data_42, SecondNumber=lng_33)  # -> Equality, Inequality
dispatch_20 = Dispatch(List=series_15, DispatchPattern=equals_14.Equality)  # -> ListA, ListB
series_16 = Series(Start=0, Step=1, Count="2")
branch_11 = TreeBranch(Tree=subsrf_2, Path=dispatch_20.ListB, MaintainPaths=True)
item_27 = ListItem(List=branch_11, Index=series_16, Wrap=True)
# Unit per floor Division
sunion = SolidUnion(Breps=item_27)
disc_4 = Discontinuity(Curve=sunion, Level=1)  # -> Points, Parameters
pline = PolyLine(Vertices=disc_4.Points, Closed=Toggle(True))  # -> simplify(Polyline)
cull_i_19 = CullIndex(List=branch_11, Indices=series_16, Wrap=True)  # -> simplify(List)
merge_18 = Merge(Data1=cull_i_19, Data2=pline)
data_43 = Data(dispatch_20.ListB)
tstat_4 = TreeStatistics(Tree=merge_18)  # -> Paths, Length, Count
replace_6 = ReplacePaths(Data=merge_18, Search=tstat_4.Paths, Replace=data_43)

partition_25 = PartitionList(List=equals_14.Equality, Size="1")  # -> simplify(Chunks)
dispatch_21 = Dispatch(List=subsrf_2, DispatchPattern=partition_25)  # -> ListA, ListB
clean_7 = CleanTree(RemoveNulls=True, RemoveInvalid=True, RemoveEmpty=Toggle(True), Tree=dispatch_21.ListA)

# ----
# StairCase
panel_149 = Panel("1")
partition_26 = PartitionList(List=scale.Geometry, Size=panel_149)  # -> simplify(Chunks)

# ----
# Unit per floor
# Divided Units
merge_19 = Merge(Data1=clean_7, Data2=replace_6)

panel_150 = Panel("floor height")
data_44 = Data(floor_height)

# ----
# x
# x
# x
# x
# x
# x
# x
# x
# x
# x
# x
# x
# x
# x
# x
# x
# x
# x
# x
# x
# x
# x
# x
# x
# x
# x
# x
# 
# x
# x
# x
# x
# x
# x
# 
# x
# x
# x
# x
# x
# 
# x
# x
# x
# x
# x
# x
# 
# x
# x
# x
# x
ladybug = Ladybug_Ladybug()  # -> Vviiiiiiiiiizzz; plug-in component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
# Construction Date
# Tüik 6.1 - Households by constrcution year of the building
# 1981-2000: %43,5
# 1980 and before: %23,4
# 2001 and after: %21,8
# Unknown: %11,3
# -------------
# SO AFTER ROUND UP
# before 2000: %80
# 2001 and after:  %20
# construction: construction layers
# - according to construction date
# -- before 80s / 80-00 / after 00
honeybee = Honeybee_Honeybee()  # -> Vviiiiiiiiiizzz; plug-in component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
# Retail, commercial building function determination
# FOR EACH
# building
# 
# How to do?
# Room, unit, elevator area division, M.L.
# 
# resource:endeksa
# 2:bedroom, living room
# 3:bedroom, living room, service (non-conditioning)
# 4:bedroom (x2), living room, service (non-conditioning)
# 3.1 - UNIT DIVISION
panel_151 = Panel(honeybee)

# ----
# # of Units of
# the building
data_45 = Data(item_23)

# ----
# organized 4edged building PARCELS
geo_44 = Geometry(flatten(cull_i_14))

data_46 = Data(floor_height)

data_47 = Data(floor_height)

# ----
# Windowless Unit Test
# https://drive.google.com/drive/u/1/folders/1cVOKlVuLwwMiW8gXvWmfqpKi1dvpFBbl
# Intersected surfaces with adjacent buildings
geo_45 = Geometry()

# ----
# Intersected surfaces with adjacent buildings
geo_46 = Geometry()

bldgprograms = Honeybee_bldgPrograms({"Office": 0, "Retail": 1, "MidriseApartment": 2, "PrimarySchool": 3, "SecondarySchool": 4, "SmallHotel": 5, "LargeHotel": 6, "Hospital": 7, "Outpatient": 8, "Warehouse": 9, "SuperMarket": 10, "FullServiceRestaurant": 11, "QuickServiceRestaurant": 12}, selected="MidriseApartment")
listzoneprograms = Honeybee_ListZonePrograms(bldgProgram=bldgprograms)  # -> MidriseApartmentZonePrograms; plug-in component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
item_28 = ListItem(List=listzoneprograms, Index="1", Wrap=True)

bldgprograms_2 = Honeybee_bldgPrograms({"Office": 0, "Retail": 1, "MidriseApartment": 2, "PrimarySchool": 3, "SecondarySchool": 4, "SmallHotel": 5, "LargeHotel": 6, "Hospital": 7, "Outpatient": 8, "Warehouse": 9, "SuperMarket": 10, "FullServiceRestaurant": 11, "QuickServiceRestaurant": 12}, selected="MidriseApartment")
listzoneprograms_2 = Honeybee_ListZonePrograms(bldgProgram=bldgprograms_2)  # -> MidriseApartmentZonePrograms; plug-in component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
item_29 = ListItem(List=listzoneprograms_2, Index=0, Wrap=True)

data_48 = Data(floor_height)

# ----
# V1, V2: TS-825
# Window Parameters
singlepanebase = Panel("0.9")
singlepanebase_2 = Panel("0.75")
base = Panel("2.4")

data_49 = Data(weave_9)

# ----
# AS-IS V1
# WWR
panel_156 = Panel("0.2")
glzparamlist = Honeybee_GlazingParametersList(northGlzParam=panel_156, westGlzParam=panel_156, southGlzParam=panel_156, eastGlzParam=panel_156)  # -> glzParamList; plug-in component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

panel_157 = Panel("""20.0
20.1
20.2
20.3
20.4
20.5
20.6
20.7
20.8
20.9
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""")

panel_158 = Panel("naming")
lng_35 = ListLength(List=panel_157)
dup_6 = DuplicateData(Data="heatSet", Number=lng_35, Order=True)
merge_20 = Merge(Data1=simplify(graft(panel_157)), Data2=simplify(graft(dup_6)))
# Cooling Set Point Schedules
join_3 = TextJoin(Text=merge_20)  # -> flatten(Result)

panel_159 = Panel("""25.5
25.6
25.7
25.8
25.9
26.0
26.1
26.2
26.3
26.4
26.5
26.6
26.7
26.8
26.9
27.0
27.1
27.2
27.3
27.4
27.5
27.6
27.7
27.8
27.9
28.0""")

lng_36 = ListLength(List=panel_159)
dup_7 = DuplicateData(Data="coolSet", Number=lng_36, Order=True)
merge_21 = Merge(Data1=simplify(graft(panel_159)), Data2=simplify(graft(dup_7)))
join_4 = TextJoin(Text=merge_21)  # -> flatten(Result)

dup_8 = DuplicateData(Data="18", Number="5", Order=True)
dup_9 = DuplicateData(Data=dup_8, Number=graft(lng_35), Order=True)
panel_161 = Panel("set-back")
partition_27 = PartitionList(List=dup_9, Size="5")  # -> simplify(Chunks)

dup_10 = DuplicateData(Data=graft(panel_159), Number="24", Order=True)
constantschedule = Honeybee_ConstantSchedule(value=dup_10, scheduleName=graft(join_4), schedTypeLimits="Temperature")  # -> readMe, flatten(schedule), weekSched, schedIDFText; plug-in component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

dup_11 = DuplicateData(Data=graft(panel_157), Number="19", Order=True)  # -> simplify(Data)
panel_162 = Panel("set point")

dup_12 = DuplicateData(Data="18", Number="5", Order=True)
dup_13 = DuplicateData(Data="21", Number="19", Order=True)
merge_22 = Merge(Data1=dup_12, Data2=dup_13)

merge_23 = Merge(Data1=partition_27, Data2=dup_11)
constantschedule_2 = Honeybee_ConstantSchedule(value=merge_23, scheduleName=graft(join_3), schedTypeLimits="Temperature")  # -> readMe, flatten(schedule), weekSched, schedIDFText; plug-in component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

panel_163 = Panel("CoolingSetPoint schedule List")
data_50 = Data(constantschedule.schedule)

panel_164 = Panel("""coolingSetPoint
Complete List""")
data_51 = Data(panel_159)

# ----
# COOLING-OFF
# RESIDENTIAL
lb_schedule = GenePool(
    Decimals=1,
    Maximum=100,
    Minimum=25,
    Value=[100, 100, 100, 100, 100, 100, 100, 100, 100, 100, 100, 100, 100, 100, 100, 100, 100, 100, 100, 100, 100, 100, 100, 100])
annualschedule = Honeybee_AnnualSchedule(
    sun=lb_schedule,
    mon=lb_schedule,
    tue=lb_schedule,
    wed=lb_schedule,
    thu=lb_schedule,
    fri=lb_schedule,
    sat=lb_schedule,
    scheduleName="COOLING_OFF",
    schedTypeLimits="Temperature",
    runIt=Toggle(True))  # -> readMe, port, schedule, port_2, weekSched, schedIDFText; plug-in component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

panel_165 = Panel("WEEKEND")
lb_schedule_2 = GenePool(
    Decimals=0,
    Maximum=18.001,
    Minimum=18,
    Value=[18, 18, 18, 18, 18, 18, 18, 18.001, 18.001, 18.001, 18.001, 18.001, 18.001, 18.001, 18.001, 18.001, 18.001, 18.001, 18.001, 18, 18, 18, 18, 18])

lb_schedule_3 = GenePool(
    Decimals=0,
    Maximum=100.001,
    Minimum=100,
    Value=[100, 100, 100, 100, 100, 100, 100, 100.001, 100.001, 100.001, 100.001, 100.001, 100.001, 100.001, 100.001, 100.001, 100.001, 100.001, 100.001, 100, 100, 100, 100, 100])

panel_167 = Panel("WEEK-DAYS")
dup_14 = DuplicateData(Data="21", Number="10", Order=True)
dup_15 = DuplicateData(Data="18", Number="7", Order=True)
dup_16 = DuplicateData(Data="18", Number="7", Order=True)
merge_24 = Merge(Data1=dup_16, Data2=dup_14, Data3=dup_15)

dup_17 = DuplicateData(Data="25.5", Number="10", Order=True)
dup_18 = DuplicateData(Data="100", Number="7", Order=True)
dup_19 = DuplicateData(Data="100", Number="7", Order=True)
merge_25 = Merge(Data1=dup_19, Data2=dup_17, Data3=dup_18)

# ----
# Cooling Office
panel_169 = Panel("OFFICE_COOLING_SCHEDULE-ANNUAL")
annualschedule_2 = Honeybee_AnnualSchedule(
    sun=lb_schedule_3,
    mon=merge_25,
    tue=merge_25,
    wed=merge_25,
    thu=merge_25,
    fri=merge_25,
    sat=lb_schedule_3,
    scheduleName=simplify(graft(panel_169)),
    schedTypeLimits="Temperature",
    runIt=Toggle(True))  # -> readMe, port, schedule, port_2, simplify(weekSched), schedIDFText; plug-in component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

panel_170 = Panel("references")

callfromepschlibrary = Honeybee_CallFromEPScheduleLibrary(keywords="apart")  # -> scheduleTypeLimits, scheduleList; plug-in component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
panel_171 = Panel("usethisforLaptop")
item_30 = ListItem(List=callfromepschlibrary.scheduleList, Index="16", Wrap=True)

# ----
# heating Office
panel_172 = Panel("OFFICE_HEATING_SCHEDULE-ANNUAL")
annualschedule_3 = Honeybee_AnnualSchedule(
    sun=merge_24,
    mon=merge_24,
    tue=merge_24,
    wed=merge_24,
    thu=merge_24,
    fri=merge_24,
    sat=merge_24,
    scheduleName=simplify(graft(panel_172)),
    schedTypeLimits="Temperature",
    runIt=Toggle(True))  # -> readMe, port, schedule, port_2, simplify(weekSched), schedIDFText; plug-in component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

# ----
# if outdoor temperature hotter than the indoor temperature then close the natural ventilation
panel_173 = Panel("0")

lng_37 = ListLength(List=merge_14)  # -> flatten(Length)

data_52 = Data(weave_6)

# ----
# %33 for all selection
# -before 80s
# -80-00
# -after 00s
infiltration_rate = Panel("""0.000285
0.0004
0.0005""")

# ----
# public and school buildings excluded list
data_53 = Data(python_13.a)

data_54 = Data(item_28)
panel_176 = Panel(data_54)
geteploads = Honeybee_GetEnergyPlusLoads(zoneProgram=data_54)  # -> equipmentLoadPerArea, infilRatePerArea_Facade, lightingDensityPerArea, numOfPeoplePerArea, ventilationPerArea, ventilationPerPerson; plug-in component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

# ----
# Air Change Rate: Identification of the Retrofit Actions to Achieve Cost-Optimal and
# NZEB Levels for Residential Buildings in Istanbul Considering
# the Remaining Building Lifetime
boolean_toggle_2 = BooleanToggle(True)

m3sm2 = Panel("0.0003")
panel_177 = Panel("IGD")

# ----
# AS-ISV1
panel_178 = Panel("0.0001")

data_55 = Data(item_29)
panel_179 = Panel(data_55)
geteploads_2 = Honeybee_GetEnergyPlusLoads(zoneProgram=data_55)  # -> equipmentLoadPerArea, infilRatePerArea_Facade, lightingDensityPerArea, numOfPeoplePerArea, ventilationPerArea, ventilationPerPerson; plug-in component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

ground_truth_from_municipality_construct = Panel("""1
0
1
1
1
1
1
1
1
1
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""")  # "GROUND TRUTH FROM MUNICIPALITY ConstructionType"
panel_180 = Panel("0=masonry, 1=concrete")

# ----
# ordered buildings list information
data_56 = Data(merge_14)
tstat_5 = TreeStatistics(Tree=data_56)  # -> Paths, Length, Count

# ----
# public and school buildings excluded list
data_57 = Data(python_13.a)

panel_181 = Panel("U-roof")
data_58 = Data(uroof_2)

# ----
# U-Factor no Film [W/m2-K]
panel_182 = Panel("https://unmethours.com/question/55666/what-is-the-basis-for-air-film-resistances-used-to-calculate-u-factor-with-film/")

# ----
# U-Factor no Film [W/m2-K]
panel_183 = Panel("https://unmethours.com/question/55666/what-is-the-basis-for-air-film-resistances-used-to-calculate-u-factor-with-film/")

# ----
# U-Factor no Film [W/m2-K]
panel_184 = Panel("https://unmethours.com/question/55666/what-is-the-basis-for-air-film-resistances-used-to-calculate-u-factor-with-film/")

panel_185 = Panel("U-wall")
data_59 = Data(weave_21)

data_60 = Data(uwall_2)

epopaquemat = Honeybee_EnergyPlusOpaqueMaterial(name="icSivaAlciEsasliInt", thickness="0.02", conductivity="0.51", density="1200", specificHeat="1090")  # -> EPMaterial; plug-in component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
epopaquemat_2 = Honeybee_EnergyPlusOpaqueMaterial(name="icSivaAlciEsasliInt", thickness="0.02", conductivity="0.51", density="1200", specificHeat="1090")  # -> EPMaterial; plug-in component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
epopaquemat_3 = Honeybee_EnergyPlusOpaqueMaterial(name="yatay delikli tugla", thickness="0.085", conductivity="0.33", density="600", specificHeat="900")  # -> EPMaterial; plug-in component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

# ----
# Internal wall
epconstruction = Honeybee_EnergyPlusConstruction(name="CC_Internal_wall", layer_1=epopaquemat, layer_2=epopaquemat_3, layer_3=epopaquemat_2)  # -> EPConstruction; plug-in component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

# ----
# U-Factor no Film [W/m2-K]
panel_187 = Panel("https://unmethours.com/question/55666/what-is-the-basis-for-air-film-resistances-used-to-calculate-u-factor-with-film/")

# ----
# U-Factor no Film [W/m2-K]
panel_188 = Panel("https://unmethours.com/question/55666/what-is-the-basis-for-air-film-resistances-used-to-calculate-u-factor-with-film/")

data_61 = Data(weave_20)

panel_190 = Panel("""simplified &
ordered
parcel
layouts""")
geo_47 = Geometry(flatten(item_12))

panel_191 = Panel("Radius")
data_62 = Data(_40)

floor_height_2 = Panel("3")
data_63 = Data(floor_height)

panel_192 = Panel("SORTED BLOCK BOUNDARIES")
sorted_parcels_2 = Geometry(sort.ValuesA)

data_64 = Data(weave_12)

data_65 = Data(floor_height)

data_66 = Data(floor_height)

geo_48 = Geometry(geo_47)

panel_195 = Panel("""3332
3332
3332
3332
3233
3233
3233
3233
3223
3223
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""")  # disabled
chars = Characters(Text=panel_195)  # -> simplify(Result), Unicode; disabled
panel_196 = Panel(chars.Result)  # disabled
item_31 = ListItem(List=panel_196, Index=1, Wrap=True)  # -> flatten(Item); disabled
item_32 = ListItem(List=panel_196, Index=1, Wrap=True)  # -> flatten(Item); disabled
item_33 = ListItem(List=panel_196, Index=0, Wrap=True)  # -> flatten(Item); disabled
item_34 = ListItem(List=panel_196, Index=2, Wrap=True)  # -> flatten(Item); disabled
panel_197 = Panel(item_33)  # disabled
panel_198 = Panel(item_31)  # disabled
panel_199 = Panel(item_34)  # disabled
panel_200 = Panel(item_32)  # disabled

# ----
# 2nd week - Coldest Week
panel_201 = Panel("13")  # disabled
panel_202 = Panel("1")  # disabled
panel_203 = Panel("7")  # disabled
analysisperiod = Ladybug_AnalysisPeriod(fromMonth=panel_202, fromDay=panel_203, toMonth=panel_202, toDay=panel_201)  # -> readMe, analysisPeriod; disabled; plug-in component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
panel_204 = Panel(analysisperiod.analysisPeriod)  # disabled

# ----
# 15th week - Spring
panel_205 = Panel("14")  # disabled
panel_206 = Panel("4")  # disabled
panel_207 = Panel("8")  # disabled
analysisperiod_2 = Ladybug_AnalysisPeriod(fromMonth=panel_206, fromDay=panel_207, toMonth=panel_206, toDay=panel_205)  # -> readMe, analysisPeriod; disabled; plug-in component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
panel_208 = Panel(analysisperiod_2.analysisPeriod)  # disabled

data_67 = Data(floor_height)

# ----
# if context do not exist
panel_209 = Panel("0")
dup_20 = DuplicateData(Data=panel_209, Number="4", Order=True)

getepschedules = Honeybee_GetEnergyPlusSchedules()  # -> occupancySchedule, occupancyActivitySch, heatingSetPtSchedule, coolingSetPtSchedule, lightingSchedule, equipmentSchedule, infiltrationSchedule; disabled; plug-in component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
decomposeepsch = Honeybee_DecomposeEnergyPlusSchedule(schName=getepschedules.occupancySchedule)  # -> name, schedule, comments; disabled; plug-in component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
convertepschvalues = Honeybee_ConvertEnergyPlusScheduleToValues(schName=decomposeepsch.name)  # -> values, holidays; disabled; plug-in component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
strnum = Ladybug_SeparateData(inputList=flatten(convertepschvalues.values))  # -> numbers, strings; disabled; plug-in component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
panel_210 = Panel("168")  # disabled
partition_28 = PartitionList(List=strnum.numbers, Size=panel_210)  # -> simplify(Chunks); disabled
# x
# x
# x
# x
# x
# x
# x
# x
# x
# x
# x
# x
# x
# x
# x
# x
# x
# x
# x
# x
# x
# x
# x
# x
# x
# 
# x
# x
# x
# x
# 
# x
# x
# x
# x
# x
# X
# x
# X
# X
# X
# X
# X
# 
# X
# X
# X
# X
# X
# X
# 
# X
# X
# X
# X
# X
# X
# 
# X
# X
# X
# X
# X
# X
# X
# X
# X
# 
# X
# X
# X
panel_211 = Panel("0")
branch_12 = TreeBranch(Tree=partition_28, Path=panel_211, MaintainPaths=True)  # disabled
graph = QuickGraph(branch_12, SortOrder=0)  # disabled
# Run Periods
# RunPeriod,
#   Autumn,                           !- Name
#   10,                                      !- Begin Month
#   21,                                      !- Begin Day of Month
#   10,                                     !- End Month
#   27,                                     !- End Day of Month
# Monday,
#   No,                                     !- Use Weather File Holidays and Special Days
#   No,                                     !- Use Weather File Daylight Saving Period
#   No,                                     !- Apply Weekend Holiday Rule
#   Yes,                                    !- Use Weather File Rain Indicators
#   Yes,                                    !- Use Weather File Snow Indicators
#   1;                                      !- Number of Times Runperiod to be Repeated
panel_212 = Panel(branch_12)  # disabled

panel_213 = Panel("if context exist")

# ----
# Window Directions
panel_214 = Panel("""2: no window
3: window""")

# ----
# 28th week - Hottest Week
panel_215 = Panel("14")  # disabled
panel_216 = Panel("7")  # disabled
panel_217 = Panel("8")  # disabled
analysisperiod_3 = Ladybug_AnalysisPeriod(fromMonth=panel_216, fromDay=panel_217, toMonth=panel_216, toDay=panel_215)  # -> readMe, analysisPeriod; disabled; plug-in component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
# Run Periods
# Run Periods
# RunPeriod,
#   Spring,                           !- Name
#   4,                                      !- Begin Month
#   8,                                      !- Begin Day of Month
#   4,                                     !- End Month
#   14,                                     !- End Day of Month
# Monday,
#   No,                                     !- Use Weather File Holidays and Special Days
#   No,                                     !- Use Weather File Daylight Saving Period
#   No,                                     !- Apply Weekend Holiday Rule
#   Yes,                                    !- Use Weather File Rain Indicators
#   Yes,                                    !- Use Weather File Snow Indicators
#   1;                                      !- Number of Times Runperiod to be Repeated
# RunPeriod,
#   Summer,                           !- Name
#   7,                                      !- Begin Month
#   8,                                      !- Begin Day of Month
#   7,                                     !- End Month
#   14,                                     !- End Day of Month
# Monday,
#   No,                                     !- Use Weather File Holidays and Special Days
#   No,                                     !- Use Weather File Daylight Saving Period
#   No,                                     !- Apply Weekend Holiday Rule
#   Yes,                                    !- Use Weather File Rain Indicators
#   Yes,                                    !- Use Weather File Snow Indicators
#   1;                                      !- Number of Times Runperiod to be Repeated
panel_218 = Panel(analysisperiod_3.analysisPeriod)  # disabled

# ----
# 43th week - Autumn
panel_219 = Panel("27")  # disabled
panel_220 = Panel("10")  # disabled
panel_221 = Panel("21")  # disabled
analysisperiod_4 = Ladybug_AnalysisPeriod(fromMonth=panel_220, fromDay=panel_221, toMonth=panel_220, toDay=panel_219)  # -> readMe, analysisPeriod; disabled; plug-in component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
panel_222 = Panel(analysisperiod_4.analysisPeriod)  # disabled

# ----
# formFactor of
# Simulated Units
reference = Panel("https://greenbuildingencyclopaedia.uk/encyclopaedia/files/calculators/equations/form-factor-equation/")

# ----
# if context do not exist
panel_223 = Panel("0")
dup_21 = DuplicateData(Data=panel_223, Number="4", Order=True)

# ----
# Width/Depth ratio of
# Simulated Units
panel_224 = Panel("""width: eastToWest
depth: northToSouth""")

# ----
# Optimized
# Simulation
# Output-hourly
# Zone,Average,Site Outdoor Air Drybulb Temperature
# 
# Output:Variable,*,Zone Ideal Loads Supply Air Total Cooling Energy, hourly;
panel_225 = Panel("""0
1
2
10
12
13
14
23
24
25
26
27
28
29
30
35
36
37""")
toggle_4 = BooleanToggle(True)
panel_226 = Panel("""Output:Variable,*,Zone Operative Temperature, hourly;
Output:Variable,*,Zone Mean Air Temperature, hourly;
Output:Variable,*,Zone Mean Radiant Temperature, hourly;""")
epoutput = Honeybee_GenerateEPOutput(
    zoneEnergyUse=toggle_4,
    zoneGainsAndLosses=toggle_4,
    zoneComfortMetrics=toggle_4,
    surfaceTempAnalysis="False",
    surfaceEnergyAnalysis=toggle_4,
    timestep="hourly")  # -> report, flatten(simulationOutputs); plug-in component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
item_35 = ListItem(List=epoutput.simulationOutputs, Index=panel_225, Wrap=True)
merge_26 = Merge(Data1=item_35, Data2=panel_226)  # -> flatten(Result)

# ----
# Optimized
# Simulation
# Output-annual
# Zone,Average,Site Outdoor Air Drybulb Temperature
# 
# Output:Variable,*,Zone Ideal Loads Supply Air Total Cooling Energy, hourly;
panel_227 = Panel("""0
1
2
10
12
23
24
25
26
27
28
29
30""")
toggle_5 = BooleanToggle(True)
panel_228 = Panel("""Output:Variable,*,Zone Operative Temperature, hourly;
Output:Variable,*,Zone Mean Air Temperature, hourly;
Output:Variable,*,Zone Mean Radiant Temperature, hourly;
Output:Variable,*,Zone Lights Electric Energy, hourly;
Output:Variable,*,Zone Electric Equipment Electric Energy, hourly;
Output:Variable,*,Surface Window Heat Gain Energy, hourly;
Output:Variable,*,Surface Window Heat Loss Energy, hourly;
Output:Variable,*,Surface Average Face Conduction Heat Transfer Energy, hourly;""")
epoutput_2 = Honeybee_GenerateEPOutput(
    zoneEnergyUse=toggle_5,
    zoneGainsAndLosses=toggle_5,
    zoneComfortMetrics=toggle_5,
    surfaceTempAnalysis="False",
    surfaceEnergyAnalysis=toggle_5,
    timestep="annual")  # -> report, flatten(simulationOutputs); plug-in component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
item_36 = ListItem(List=epoutput_2.simulationOutputs, Index=panel_227, Wrap=True)
merge_27 = Merge(Data1=item_36, Data2=panel_228)  # -> flatten(Result)

toggle_6 = BooleanToggle(True)  # disabled
panel_229 = Panel("annual")  # disabled
epoutput_3 = Honeybee_GenerateEPOutput(
    zoneEnergyUse=toggle_6,
    zoneGainsAndLosses=toggle_6,
    zoneComfortMetrics="False",
    surfaceTempAnalysis="False",
    surfaceEnergyAnalysis=toggle_6,
    timestep=panel_229)  # -> report, flatten(simulationOutputs); disabled; plug-in component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

# ----
# Energy Balance
toggle_7 = BooleanToggle(True)  # disabled
panel_230 = Panel("""0
1
2
10
12
13
14
23
24
25
26
27
28
29
30
31
32
35
36
37""")  # disabled
panel_231 = Panel("monthly")  # disabled
epoutput_4 = Honeybee_GenerateEPOutput(
    zoneEnergyUse=toggle_7,
    zoneGainsAndLosses=toggle_7,
    zoneComfortMetrics=toggle_7,
    surfaceTempAnalysis="False",
    surfaceEnergyAnalysis=toggle_7,
    timestep=panel_231)  # -> report, flatten(simulationOutputs); disabled; plug-in component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
item_37 = ListItem(List=epoutput_4.simulationOutputs, Index=panel_230, Wrap=True)  # disabled

panel_232 = Panel("weather data")
path_2 = FilePath("D:\KBEM\IP2.1\EPW\TUR_Ankara_Central_HadCM3-A2-2050.epw")

# ----
# AdaptiveComfort
toggle_8 = BooleanToggle(True)  # disabled
panel_234 = Panel("hourly")  # disabled
epoutput_5 = Honeybee_GenerateEPOutput(
    zoneEnergyUse=toggle_8,
    zoneGainsAndLosses=toggle_8,
    zoneComfortMetrics=toggle_8,
    surfaceTempAnalysis="False",
    surfaceEnergyAnalysis=toggle_8,
    timestep=panel_234)  # -> report, flatten(simulationOutputs); disabled; plug-in component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
panel_235 = Panel("""0
23
31
32
33""")  # disabled
item_38 = ListItem(List=epoutput_5.simulationOutputs, Index=panel_235, Wrap=True)  # disabled

# ----
# Working Direction
panel_236 = Panel("C:\KBEM\IP2.1\2ndJournal\Results")

simcontrol = Honeybee_SimulationControl(maxWarmupDays="150", minWarmupDays="6")  # -> simControls; plug-in component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
energysimpar = Honeybee_EnergySimulationPar(timestep=6, solarDistribution="4", startDayOfWeek="1", simulationControls=simcontrol, terrain="0")  # -> energySimPar; plug-in component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

button = Button()
panel_237 = Panel("Reset CSV Recorders")
python_18 = PythonScript(Toggle=button)
# ---------- python_18: Python ----------
import Grasshopper as gh

if Toggle:
    
    # Get the Grasshopper document and objects
    ghDoc = ghenv.Component.OnPingDocument()
    ghObjects = ghDoc.Objects
    
    # Iterate the GH objects, check type and reset data recorders
    for obj in ghObjects:
        if type(obj) is gh.Kernel.Special.GH_DataRecorder:
            obj.DestroyRecordedData()
            obj.ExpireSolution(True)
# ---------- end python_18 ----------

panel_238 = Panel("Simulation")

panel_239 = Panel("Colibri")

# ----
# Selection
# Slider of
# Building
# there are
# - 593 residential buildings for ank, bahceli
# - 608 residential buildings for izm, Bahriye ucok
filename = Slider(133, range=0..592)

panel_240 = Panel("selected parcel- unitFunctions")
item_39 = ListItem(List=cull_i_9, Index=filename, Wrap=True)
branch_13 = TreeBranch(Tree=partition, Path=item_39, MaintainPaths=True)

panel_241 = Panel("selected parcel")
data_68 = Data(filename)

panel_242 = Panel("Window shgc")
data_69 = Data(weave_4)
item_40 = ListItem(List=data_69, Index=filename, Wrap=True)

panel_243 = Panel("vtWindow")
data_70 = Data(weave_2)
item_41 = ListItem(List=data_70, Index=filename, Wrap=True)

# ----
# V4: Generated
# Window Parameters
panel_244 = Panel("uWindow")
data_71 = Data(weave_18)
item_42 = ListItem(List=data_71, Index=filename, Wrap=True)

# ----
# 05.HBZONE FORMATION
# FORENERGYMODELING
panel_245 = Panel("Building-based EKB")
item_43 = ListItem(List=data_49, Index=filename, Wrap=True)

# ----
# Generated
# WWR
glzparamlist_2 = Honeybee_GlazingParametersList(northGlzParam=item_43, westGlzParam=item_43, southGlzParam=item_43, eastGlzParam=item_43)  # -> glzParamList; plug-in component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

# ----
# Infiltration
# GENERATED
data_72 = Data(weave_3)
item_44 = ListItem(List=data_72, Index=filename, Wrap=True)

partition_29 = PartitionList(List=data_52, Size=lng_37)  # -> simplify(Chunks)
cull_i_20 = CullIndex(List=partition_29, Indices=data_53, Wrap=True)  # -> simplify(flatten(List))
item_45 = ListItem(List=cull_i_20, Index=filename, Wrap=True)

# ----
# Infiltration
# V1
python_19 = GhPythonScript(x=item_45)  # -> out, a; inputs x: Int32
# ---------- python_19: Python ----------
__author__ = "Siser"
__version__ = "2022.02.21"

import rhinoscriptsyntax as rs
if x == 1960:
    a = 0.0005
elif x == 1980:
    a = 0.0004
else:
    a = 0.000285
# ---------- end python_19 ----------

# ----
# information of Selection
# Slider of Building
data_73 = Data(filename)

item_46 = ListItem(List=data_58, Index=filename, Wrap=True)
panel_246 = Panel("Insulation U value")

panel_247 = Panel("uValue Input")
data_74 = Data(item_46)

merge_28 = Merge(Data1="GeneratedConcreteRoof", Data2=filename)
join_5 = TextJoin(Text=merge_28)

merge_29 = Merge(Data1="GeneratedConcreteWall", Data2=filename)
join_6 = TextJoin(Text=merge_29)

merge_30 = Merge(Data1="GeneratedMasonryWall", Data2=filename)
join_7 = TextJoin(Text=merge_30)

item_47 = ListItem(List=data_59, Index=filename, Wrap=True)

data_75 = Data(item_47)

item_48 = ListItem(List=data_60, Index=filename, Wrap=True)

data_76 = Data(item_48)

merge_31 = Merge(Data1="generatedGroundFloor", Data2=filename)
join_8 = TextJoin(Text=merge_31)

item_49 = ListItem(List=data_61, Index=filename, Wrap=True)

data_77 = Data(item_49)

data_78 = Data(weave_14)
item_50 = ListItem(List=data_78, Index=filename, Wrap=True)

panel_254 = Panel("U-GroundFloor")
data_79 = Data(item_50)

item_51 = ListItem(List=data_79, Index=filename, Wrap=True)

data_80 = Data(item_51)

# ----
# index of selected parcel
# 08.OUTPUT MANAGEMENT
data_81 = Data(filename)

construct_domain = ConstructDomain(DomainStart="0", DomainEnd="592")
iteration_selection = IterationSelection(Domain=construct_domain)
iterator = ColibriIterator(fileName=filename, Selection=iteration_selection, RemoteFly=False, ignoreAllWarningMsg=False)  # -> FileName_, Value_N, IterationGenome

# ----
# Select Version
list = ValueList({"V1": 0, "V2": 1, "V3": 2, "V4": 3}, selected="V4")

panel_257 = Panel("Window SHGC")
weave_25 = Weave(Pattern=list, Stream0=singlepanebase_2, Stream1=singlepanebase_2, Stream2=item_40, Stream3=item_40, NullGaps=False)

panel_258 = Panel("Window uValue")
weave_26 = Weave(Pattern=list, Stream0=base, Stream1=base, Stream2=item_42, Stream3=item_42, NullGaps=False)

panel_259 = Panel("Window VT")
weave_27 = Weave(Pattern=list, Stream0=singlepanebase, Stream1=singlepanebase, Stream2=item_41, Stream3=item_41, NullGaps=False)

weave_28 = Weave(Pattern=list, Stream0=glzparamlist, Stream1=glzparamlist, Stream2=glzparamlist_2, Stream3=glzparamlist_2, NullGaps=False)

merge_32 = Merge(Data1="Generated_WINDOW", Data2=weave_26, Data3=weave_25, Data4=weave_27)
join_9 = TextJoin(Text=merge_32, Join="_")

panel_261 = Panel("Window ConstName")
weave_29 = Weave(Pattern=list, Stream0="TS-825_WINDOW", Stream1="TS-825_WINDOW", Stream2=join_9, Stream3=join_9, NullGaps=False)

epwindowmat = Honeybee_EnergyPlusWindowMaterial(name="GLASSUBEM", U_Value=weave_26, SHGC=weave_25, VT=weave_27)  # -> EPMaterial; plug-in component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
epconstruction_2 = Honeybee_EnergyPlusConstruction(name=weave_29, layer_1=epwindowmat)  # -> EPConstruction; plug-in component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

panel_262 = Panel("Naming for Roof")
weave_30 = Weave(Pattern=list, Stream0="TS-825ConcreteRoof", Stream1="TS-825ConcreteRoof", Stream2=join_5, Stream3=join_5, NullGaps=False)

decomposeepconstruction = Honeybee_DecomposeEPConstruction(cnstrName=weave_30)  # -> materials, comments, UValue_SI, UValue_IP, RValue_SI, RValue_IP; plug-in component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
rvalueairfilms = Honeybee_RValueWithAirFilms(uValue_SI=decomposeepconstruction.UValue_SI, surfaceType="2")  # -> UValue_SI_wAir, UValue_IP_wAir, RValue_SI_wAir, RValue_IP_wAir; plug-in component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
panel_263 = Panel(decomposeepconstruction.UValue_SI)

weave_31 = Weave(Pattern=list, Stream0="TS-825ConcreteWall", Stream1="TS-825ConcreteWall", Stream2=join_6, Stream3=join_6, NullGaps=False)

weave_32 = Weave(Pattern=list, Stream0="TS-825MasonryWall", Stream1="TS-825MasonryWall", Stream2=join_7, Stream3=join_7, NullGaps=False)

panel_264 = Panel("Naming for GroundFloor")
weave_33 = Weave(Pattern=list, Stream0="TS-825GROUNDFLOOR", Stream1="TS-825GROUNDFLOOR", Stream2=join_8, Stream3=join_8, NullGaps=False)

decomposeepconstruction_2 = Honeybee_DecomposeEPConstruction(cnstrName=weave_33)  # -> materials, comments, UValue_SI, UValue_IP, RValue_SI, RValue_IP; plug-in component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
panel_265 = Panel(decomposeepconstruction_2.UValue_SI)

merge_33 = Merge(Data1="GeneratedMasonryRoof", Data2=filename)
join_10 = TextJoin(Text=merge_33)
weave_34 = Weave(Pattern=list, Stream0="TS-825MasonryRoof", Stream1="TS-825MasonryRoof", Stream2=join_10, Stream3=join_10, NullGaps=False)

data_82 = Data(weave_28)

# ----
# REMOTE
# CONTROL
image = ImageSampler(Filter="Colour", Interpolate=False, Umax=1, Umin=0, Vmax=1, Vmin=0, Wrap=1)

area_20 = Area(Geometry=sort.ValuesA)  # -> Area, Centroid
tag_of_block = Panel("neighborhoodName2digits_parcelNumber_buildingNumber")
sorted_points_2 = Point(area_20.Centroid)
lng_38 = ListLength(List=sorted_points_2)
series_17 = Series(Start="0", Step=1, Count=lng_38)
int = Integer(series_17)
preview_24 = CustomPreview(Geometry=geo_19, Material=ColourSwatch(SwatchColor=RGB(0, 123, 255)))
tag_2 = TextTag3D(Location=sorted_points_2, Text=int, Size="15", Colour=ColourSwatch(SwatchColor=RGB(255, 0, 0)), Justification=7)

panel_268 = Panel("block_parcel order")
data_83 = Data(flatten(partition_5))

lng_39 = ListLength(List=merge_14)  # -> flatten(Length)

# ----
# public and school buildings excluded list
data_84 = Data(python_13.a)

partition_30 = PartitionList(List=data_83, Size=lng_39)  # -> simplify(Chunks)
cull_i_21 = CullIndex(List=partition_30, Indices=data_84, Wrap=True)  # -> simplify(flatten(List))
item_52 = ListItem(List=cull_i_21, Index=filename, Wrap=True)

panel_270 = Panel("""parcel_block
of simulated parcel""")
item_53 = ListItem(List=cull_i_21, Index=filename, Wrap=True)

panel_271 = Panel("parcel_block")
data_85 = Data(cull_i_21)
item_54 = ListItem(List=data_85, Index=filename, Wrap=True)

# ----
# tag order
# for parcels
swatch_6 = ColourSwatch(SwatchColor=RGB(8, 0, 255))
tag_3 = TextTag3D(Location=partition_4, Text=partition_5, Size="3", Colour=swatch_6, Justification=7)

panel_272 = Panel("coolingScenario")
data_86 = Data(percentage)

# ----
# Indexing
# cool%_block_parcel
panel_273 = Panel(cull_i_21)

# ----
# 08.AS-IS
# INPUT
# PARAMETERS
list_of_recordings = Panel("""(ID)
parcelUBEM
blockUBEM
---------
(UNIT)
verticalPosition
formFactor
totalWindowArea
windowcount
floorArea
z-axis
function
WWRDirectionUnitNorth
WWRDirectionUnitWest
WWRDirectionUnitSouth
WWRDirectionUnitEast
---------
(BUILDING)
uWall
#ofFloor
Infiltration
ObstacleDirectionNorth
ObstacleDirectionWest
ObstacleDirectionSouth
ObstacleDirectionEast""")

panel_274 = Panel("location")
data_87 = Data(item_4)

merge_34 = Merge(Data1=data_86, Data2="p")
join_11 = TextJoin(Text=merge_34)
merge_35 = Merge(Data1=join_11, Data2=item_52)
join_12 = TextJoin(Text=merge_35, Join="_")
merge_36 = Merge(Data1=join_12, Data2=data_87)
join_13 = TextJoin(Text=merge_36, Join="_")

# ----
# Select Occupied Hours
getepschedules_2 = Honeybee_GetEnergyPlusSchedules(zoneProgram=item_29)  # -> occupancySchedule, occupancyActivitySch, heatingSetPtSchedule, coolingSetPtSchedule, lightingSchedule, equipmentSchedule, infiltrationSchedule; plug-in component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
# IOD calculation only for occupied hours
convertepschvalues_2 = Honeybee_ConvertEnergyPlusScheduleToValues(schName=getepschedules_2.occupancySchedule)  # -> values, holidays; plug-in component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
strnum_2 = Ladybug_SeparateData(inputList=flatten(convertepschvalues_2.values))  # -> numbers, strings; plug-in component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
python_20 = GhPythonScript(x=strnum_2.numbers)  # -> out, a
# ---------- python_20: Python ----------
__author__ = "Siser"
__version__ = "2022.03.16"

import rhinoscriptsyntax as rs
if x >0:
    a = 1
else:
    a = 0
# ---------- end python_20 ----------
equals_15 = Equality(FirstNumber=python_20.a, SecondNumber="1")  # -> Equality, Inequality

# ----
# 10.RESULT RECORDINGS
toggle_9 = BooleanToggle(False)

# ----
# UpperBounds
panel_275 = Panel("""key:location/dataType/units/frequency/startsAt/endsAt
Ankara Central_AN_TUR
Dry Bulb Temperature
C
Hourly
(1, 1, 1)
(12, 31, 24)""")
importepw = Ladybug_ImportEpw(epwFile=path_2)  # -> readMe, latitude, location, dryBulbTemperature, dewPointTemperature, relativeHumidity, windSpeed, windDirection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; plug-in component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
dup_22 = DuplicateData(Data=Slider(6, range=0..10), Number=Slider(8760, range=0..10000), Order=True)
merge_37 = Merge(Data1=panel_275, Data2=dup_22)  # -> flatten(Result)
adaptcomfortpar = Ladybug_AdaptiveComfortParameters(ASHRAEorEN=Toggle(True), eightyOrNinetyComf=toggle_9, avgMonthOrRunMean=Toggle(True))  # -> comfortPar; plug-in component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
panel_276 = Panel("not important")
adaptivecomfortcalculator = Ladybug_AdaptiveComfortCalculator(
    dryBulbTemperature=merge_37,
    outdoorTemperature=importepw.dryBulbTemperature,
    windSpeed=importepw.windSpeed,
    comfortPar=adaptcomfortpar,
    runIt=Toggle(True))  # -> readMe, port, comfortableOrNot, conditionOfPerson, degreesFromTarget, port_2, targetTemperature, simplify(upperTemperatureBound)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; plug-in component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
strnum_3 = Ladybug_SeparateData(inputList=flatten(adaptivecomfortcalculator.upperTemperatureBound))  # -> numbers, strings; plug-in component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

panel_277 = Panel("upperTemperatureBoundaries")
dispatch_22 = Dispatch(List=strnum_3.numbers, DispatchPattern=equals_15.Equality)  # -> ListA, ListB

# ----
# GENERATED
data_88 = Data(filename)
item_55 = ListItem(List=weave, Index=data_88, Wrap=True)

# ----
# V1
panel_278 = Panel("0.85")

# ----
# boiler efficiency is building-based
panel_279 = Panel("version implementation")
weave_35 = Weave(Pattern=list, Stream0=panel_278, Stream1=panel_278, Stream2=item_55, Stream3=item_55, NullGaps=False)

doy_hoy = Ladybug_DOY_HOY(days="1", months="5", hours="24")  # -> HOY, DOY, date; plug-in component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

doy_hoy_2 = Ladybug_DOY_HOY(days="30", months="9", hours="1")  # -> HOY, DOY, date; plug-in component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

# ----
# office: # of people per sqm
data_89 = Data(geteploads.numOfPeoplePerArea)

# ----
# # of parcels in the blocks
data_90 = Data(flatten(lng_24))

# ----
# public and school buildings excluded list
data_91 = Data(python_13.a)

panel_280 = Panel("construction Date")
data_92 = Data(item_45)

panel_281 = Panel("VTWindow")
data_93 = Data(weave_27)

panel_282 = Panel("shgcWindow")
data_94 = Data(weave_25)

panel_283 = Panel("parcel_number")
data_95 = Data(weave_11)

panel_284 = Panel("block_number")
data_96 = Data(weave_16)

# ----
# Heating set point of Offices
data_97 = Data("21")

# ----
# .gh FILENAME
python_21 = GhPythonScript()  # -> out, a
# ---------- python_21: Python ----------
__author__ = "Siser"
__version__ = "2023.03.14"

import rhinoscriptsyntax as rs
a = ghenv.LocalScope.ghdoc.Path
# ---------- end python_21 ----------
c_script_2 = CSharpScript()  # -> A
# ---------- c_script_2: C# ----------
    A = RhinoDocument.Path;
# ---------- end c_script_2 ----------
panel_285 = Panel("https://www.grasshopper3d.com/forum/topics/gh-filename-is-python")
panel_286 = Panel(python_21.a)
split_5 = TextSplit(Text=python_21.a, Separators="\")
panel_287 = Panel(c_script_2)
item_56 = ListItem(List=split_5, Index="-1", Wrap=True)
split_6 = TextSplit(Text=item_56, Separators=".")
item_57 = ListItem(List=split_6, Index=0, Wrap=True)

# ----
# Cooling set point of Offices
data_98 = Data("25.5")

panel_288 = Panel("AllV4")
path_3 = FilePath("C:\KBEM\IP2.1\2ndJournal\csvFiles\Output_ResV4_izm_bah_2020.csv")

path_4 = FilePath("C:\KBEM\IP2.1\2ndJournal\csvFiles\All_ResV4_izm_bah_2020.csv")

path_5 = FilePath("C:\KBEM\IP2.1\2ndJournal\csvFiles\All_AllV4_izm_bah_2020.csv")

path_6 = FilePath("C:\KBEM\IP2.1\2ndJournal\csvFiles\0\airTemp.csv")
panel_291 = Panel(path_6)
panel_292 = Panel("AirTemp")

path_7 = FilePath("C:\KBEM\IP2.1\2ndJournal\csvFiles\4\electEquip.csv")
panel_293 = Panel(path_7)
panel_294 = Panel("electEquip")

path_8 = FilePath("C:\KBEM\IP2.1\2ndJournal\csvFiles\3\electLight.csv")
panel_295 = Panel(path_8)
panel_296 = Panel("electLight")

path_9 = FilePath("C:\KBEM\IP2.1\2ndJournal\csvFiles\2\opTemp.csv")
panel_297 = Panel(path_9)
panel_298 = Panel("opTemp")

path_10 = FilePath("C:\KBEM\IP2.1\2ndJournal\csvFiles\1\meanRad.csv")
panel_299 = Panel(path_10)
panel_300 = Panel("meanRad")

split_7 = TextSplit(Text=panel_293, Separators="\")
cull_i_22 = CullIndex(List=split_7, Indices="-1", Wrap=True)
join_14 = TextJoin(Text=cull_i_22, Join="\")
# csvRecordings
panel_301 = Panel(cull_i_22)

split_8 = TextSplit(Text=panel_295, Separators="\")
cull_i_23 = CullIndex(List=split_8, Indices="-1", Wrap=True)
join_15 = TextJoin(Text=cull_i_23, Join="\")
# csvRecordings
panel_302 = Panel(cull_i_23)

split_9 = TextSplit(Text=panel_297, Separators="\")
cull_i_24 = CullIndex(List=split_9, Indices="-1", Wrap=True)
join_16 = TextJoin(Text=cull_i_24, Join="\")
panel_303 = Panel(cull_i_24)

split_10 = TextSplit(Text=panel_291, Separators="\")
cull_i_25 = CullIndex(List=split_10, Indices="-1", Wrap=True)
join_17 = TextJoin(Text=cull_i_25, Join="\")
# csvRecordings
panel_304 = Panel(cull_i_25)

split_11 = TextSplit(Text=panel_299, Separators="\")
cull_i_26 = CullIndex(List=split_11, Indices="-1", Wrap=True)
join_18 = TextJoin(Text=cull_i_26, Join="\")
# csvRecordings
panel_305 = Panel(cull_i_26)

merge_38 = Merge(Data1="electLight", Data2=filename)
join_19 = TextJoin(Text=flatten(merge_38))

merge_39 = Merge(Data1="electLight", Data2=filename)
join_20 = TextJoin(Text=flatten(merge_39))

merge_40 = Merge(Data1="opTemp", Data2=filename)
join_21 = TextJoin(Text=flatten(merge_40))

merge_41 = Merge(Data1="meanRad", Data2=filename)
join_22 = TextJoin(Text=flatten(merge_41))

merge_42 = Merge(Data1="air", Data2=filename)
join_23 = TextJoin(Text=flatten(merge_42))

merge_43 = Merge(Data1=flatten(join_14), Data2=flatten(join_20))  # -> flatten(Result)
join_24 = TextJoin(Text=merge_43, Join="\")
merge_44 = Merge(Data1=join_24, Data2=".csv")
join_25 = TextJoin(Text=merge_44)

merge_45 = Merge(Data1=flatten(join_15), Data2=flatten(join_19))  # -> flatten(Result)
join_26 = TextJoin(Text=merge_45, Join="\")
merge_46 = Merge(Data1=join_26, Data2=".csv")
join_27 = TextJoin(Text=merge_46)

merge_47 = Merge(Data1=flatten(join_16), Data2=flatten(join_21))  # -> flatten(Result)
join_28 = TextJoin(Text=merge_47, Join="\")
merge_48 = Merge(Data1=join_28, Data2=".csv")
join_29 = TextJoin(Text=merge_48)

merge_49 = Merge(Data1=flatten(join_18), Data2=flatten(join_22))  # -> flatten(Result)
# csvRecordings
panel_306 = Panel("\")
join_30 = TextJoin(Text=merge_49, Join=panel_306)
merge_50 = Merge(Data1=join_30, Data2=".csv")
join_31 = TextJoin(Text=merge_50)

merge_51 = Merge(Data1=flatten(join_17), Data2=flatten(join_23))  # -> flatten(Result)
join_32 = TextJoin(Text=merge_51, Join="\")
merge_52 = Merge(Data1=join_32, Data2=".csv")
join_33 = TextJoin(Text=merge_52)

# ----
# equipmentDensity
data_99 = Data(["2.068", "3.842", "2.876", "3.477", "4.558", "3.574"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])

# ----
# lightingDensity
data_100 = Data(["15.6", "17.41", "18.09", "12.06", "14.17", "18.7"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])

# ----
# heatingSetPoint
data_101 = Data([22.59, 21.4, 21.01, 21.38, 20.36, 20.06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])

# ----
# ppl/m2
data_102 = Data(["0.023", "0.015", "0.038", "0.045", "0.053", "0.015"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])

# ----
# Entering EKB Data
# for Concrete Wall
merge_53 = Merge(Data1=graft(parcelubem_2), Data2=graft(blockubem_2))
join_34 = TextJoin(Text=merge_53, Join="_")  # -> simplify(flatten(Result))
mindex_4 = MemberIndex(Set=join_34, Member=item_13)  # -> flatten(Index), Count

# ----
# public and school buildings excluded list
cull_i_27 = CullIndex(List=ekbuwallconcrete_2, Indices=mindex_4.Index, Wrap=True)

# ----
# public and school buildings excluded list
cull_i_28 = CullIndex(List=join_34, Indices=mindex_4.Index, Wrap=True)

mindex_5 = MemberIndex(Set=flatten(cull_i_6), Member=cull_i_28)  # -> flatten(Index), Count

# ----
# EKB Concrete Embedded List
# 1st
replace_7 = ReplaceItems(List=dup_4, Item=cull_i_27, Indices=mindex_5.Index, Wrap=False)

# ----
# Masonry
# Generated
# Random Masonry Construction Values
lng_40 = ListLength(List=flatten(cull_i_6))
merge_54 = Merge(Data1=mindex_5.Index, Data2=mindex_2.Index)
panel_307 = Panel("EKB Data")
series_18 = Series(Start=0, Step=1, Count=lng_40)
cull_i_29 = CullIndex(List=series_18, Indices=merge_54, Wrap=True)
lng_41 = ListLength(List=cull_i_29)
division_12 = Division(A=lng_41, B=panel_25)
round_8 = Round(Number=division_12)  # -> Nearest, Floor, Ceiling
series_19 = Series(Start=0, Step=1, Count=round_8.Floor)
jitter_4 = Jitter(List=cull_i_29, Jitter=1, Seed=2)  # -> Values, Indices
item_58 = ListItem(List=jitter_4.Values, Index=series_19, Wrap=True)
item_59 = ListItem(List=panel_3, Index=series_19, Wrap=True)

# ----
# EKB Masonry Wall Embedded List
# 2nd
data_103 = Data(item_15)
replace_8 = ReplaceItems(List=replace_7, Item=data_103, Indices=mindex_2.Index, Wrap=False)

# ----
# 3rd
# RANDOM Masonry Embedded List
data_104 = Data(item_59)
replace_9 = ReplaceItems(List=replace_8, Item=data_104, Indices=item_58, Wrap=False)

# ----
# Concrete
# Wall Random
cull_i_30 = CullIndex(List=jitter_4.Values, Indices=series_19, Wrap=True)
lng_42 = ListLength(List=cull_i_30)
series_20 = Series(Start=0, Step=1, Count=lng_42)
item_60 = ListItem(List=panel, Index=series_20, Wrap=True)

# ----
# RANDOM Concrete Wall Embedded List
# 4th
data_105 = Data(item_60)
replace_10 = ReplaceItems(List=replace_9, Item=data_105, Indices=cull_i_30, Wrap=False)  # -> simplify(List)

# ----
# Masonry/Concrete Construction Division, EKB
panel_308 = Panel(replace_10)

lng_43 = ListLength(List=cull_i_6)
dup_23 = DuplicateData(Data="1", Number=lng_43, Order=True)  # -> simplify(flatten(Data))
merge_55 = Merge(Data1=flatten(mindex_2.Index), Data2=flatten(item_58))
panel_309 = Panel("EKB Generated Data")
replace_11 = ReplaceItems(List=dup_23, Item="0", Indices=merge_55, Wrap=False)

panel_311 = Panel("ConstructionType")
data_106 = Data(replace_11)

# ----
# extract only
# ''# of residential units''
# in the building
toggle_10 = BooleanToggle(True)
clean_8 = CleanTree(RemoveNulls=True, RemoveInvalid=True, RemoveEmpty=toggle_10, Tree=dispatch_5.ListA)
tstat_6 = TreeStatistics(Tree=clean_8)  # -> Paths, Length, Count
series_21 = Series(Start=0, Step=1, Count=tstat_6.Count)
replace_12 = ReplacePaths(Data=clean_8, Search=tstat_6.Paths, Replace=series_21)

# ----
# only, # of residential units in the building
lng_44 = ListLength(List=replace_12)  # -> flatten(Length)

partition_31 = PartitionList(List=data_99, Size=lng_44)  # -> simplify(Chunks)
branch_14 = TreeBranch(Tree=partition_31, Path=filename, MaintainPaths=True)

# ----
# coolingSetPoint
partition_32 = PartitionList(List=data, Size=lng_44)  # -> simplify(Chunks)
branch_15 = TreeBranch(Tree=partition_32, Path=filename, MaintainPaths=True)

partition_33 = PartitionList(List=data_100, Size=lng_44)  # -> simplify(Chunks)
branch_16 = TreeBranch(Tree=partition_33, Path=filename, MaintainPaths=True)

partition_34 = PartitionList(List=data_101, Size=lng_44)  # -> simplify(Chunks)
branch_17 = TreeBranch(Tree=partition_34, Path=filename, MaintainPaths=True)

partition_35 = PartitionList(List=data_102, Size=lng_44)  # -> simplify(Chunks)
branch_18 = TreeBranch(Tree=partition_35, Path=filename, MaintainPaths=True)

panel_312 = Panel(lng_44)

# ----
# Entering EKB Data
# for Concrete Wall
merge_56 = Merge(Data1=graft(parcelubem_4), Data2=graft(blockubem_3))  # disabled
panel_313 = Panel("_")  # disabled
join_35 = TextJoin(Text=merge_56, Join=panel_313)  # -> simplify(flatten(Result)); disabled
mindex_6 = MemberIndex(Set=join_35, Member=item_16)  # -> flatten(Index), Count; disabled

# ----
# public and school buildings excluded list
cull_i_31 = CullIndex(List=join_35, Indices=mindex_6.Index, Wrap=True)  # disabled

# ----
# public and school buildings excluded list
cull_i_32 = CullIndex(List=ekbuwallconcrete_3, Indices=mindex_6.Index, Wrap=True)  # disabled

mindex_7 = MemberIndex(Set=flatten(cull_i_8), Member=cull_i_31)  # -> flatten(Index), Count; disabled

# ----
# EKB Concrete Embedded List
# 1st
replace_13 = ReplaceItems(List=dup_5, Item=cull_i_32, Indices=mindex_7.Index, Wrap=False)  # disabled

# ----
# HVAC
# heatingSetPoint
panel_314 = Panel("""23.09
20.08
22.53
23.00
21.99
20.90
20.79
23.04
20.68
20.35
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""")
panel_315 = Panel("""23.24
22.89
22.47
22.19
21.14
21.43
21.53
23.65
20.32
21.01
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""")
merge_57 = Merge(Data1=panel_314, Data2=panel_315)

# ----
# coolingSetPoint
data_107 = Data([27.33, 26.8, 25.75, 27.51, 25.99, 27.87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])

lng_45 = ListLength(List=panel_12)
series_22 = Series(Start=0, Step=1, Count=lng_45)

# ----
# WWR
data_108 = Data(flatten(cull_i_8))  # disabled
listdexs_4 = ListIndices(List=data_108)  # disabled

# ----
# Concrete
# Wall Random
cull_i_33 = CullIndex(List=listdexs_4, Indices=mindex_7.Index, Wrap=True)  # disabled
lng_46 = ListLength(List=cull_i_33)  # disabled
series_23 = Series(Start=0, Step=1, Count=lng_46)  # disabled
item_61 = ListItem(List=panel_6, Index=series_23, Wrap=True)  # disabled

# ----
# RANDOM Concrete Wall Embedded List
# 4th
data_109 = Data(item_61)  # disabled
replace_14 = ReplaceItems(List=replace_13, Item=data_109, Indices=cull_i_33, Wrap=False)  # -> simplify(List); disabled

panel_319 = Panel(replace_14)  # disabled

# ----
# Cooling scenarios for residential units
data_110 = Data(panel_12)

equals_16 = Equality(FirstNumber=data_110, SecondNumber="0")  # -> Equality, Inequality
dispatch_23 = Dispatch(List=series_22, DispatchPattern=equals_16.Equality)  # -> ListA, ListB

lng_47 = ListLength(List=dispatch_23.ListA)
division_13 = Division(A=lng_47, B=division_4)
python_22 = GhPythonScript(x=division_13, y=percentage_2)  # -> out, a; inputs y: Int32; same code as python
round_9 = Round(Number=python_22.a)  # -> Nearest, Floor, Ceiling
series_24 = Series(Start=0, Step=1, Count=round_9.Nearest)

# ----
# residential with cooling units
panel_320 = Panel("5")
dup_24 = DuplicateData(Data=panel_320, Number=round_9.Nearest, Order=True)

# ----
# extract only
# ''# of residential units''
# in the building
toggle_11 = BooleanToggle(True)

jitter_5 = Jitter(List=dispatch_23.ListA, Jitter=1, Seed=2)  # -> Values, Indices

# ----
# residential with cooling indices
item_62 = ListItem(List=jitter_5.Values, Index=series_24, Wrap=True)

replace_15 = ReplaceItems(List=data_110, Item=dup_24, Indices=item_62, Wrap=False)

# ----
# unitFunction
partition_36 = PartitionList(List=replace_15, Size=data_5)  # -> simplify(Chunks)

data_111 = Data(partition_36)

python_23 = GhPythonScript(x=data_111)  # -> out, a; inputs x: Int32; same code as python_6

dispatch_24 = Dispatch(List=data_111, DispatchPattern=python_23.a)  # -> ListA, ListB

item_63 = ListItem(List=cull_i_10, Index=filename, Wrap=True)
branch_19 = TreeBranch(Tree=partition_36, Path=item_63, MaintainPaths=True)

weave_36 = Weave(Pattern=item_3, Stream0=branch_19, Stream1=branch_19, Stream2=branch_19, Stream3=branch_13, NullGaps=False)

# ----
# 0: residential non-cooling
# 5: residential with cooling
# 1: office unit
data_112 = Data(weave_36)

# ----
# Zone Program
panel_323 = Panel("1")
equals_17 = Equality(FirstNumber=data_112, SecondNumber=panel_323)  # -> Equality, Inequality
lng_48 = ListLength(List=data_112)
listdexs_5 = ListIndices(List=data_112)
# Naming for Simulated  Zones
dup_25 = DuplicateData(Data="0", Number=lng_48, Order=True)
dispatch_25 = Dispatch(List=listdexs_5, DispatchPattern=equals_17.Equality)  # -> ListA, ListB
replace_16 = ReplaceItems(List=dup_25, Item=item_29, Indices=dispatch_25.ListB, Wrap=False)
replace_17 = ReplaceItems(List=replace_16, Item=item_28, Indices=dispatch_25.ListA, Wrap=False)
panel_324 = Panel(replace_17)

# ----
# 0: residential non-cooling
# 1: office unit
# 5: residential with cooling
data_113 = Data(weave_36)

# ----
# 0: residential non-cooling
# 1: residential with cooling
# 2: office unit
data_114 = Data(weave_36)

uniffuntion_nvi = Panel(weave_36)

# ----
# Function of Units
# (0:residential, 1: office)
data_115 = Data(weave_36)

# ----
# U-value-Window of Building
decomposeepconstruction_3 = Honeybee_DecomposeEPConstruction(cnstrName=weave_29)  # -> materials, comments, UValue_SI, UValue_IP, RValue_SI, RValue_IP; plug-in component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
lng_49 = ListLength(List=weave_36)
data_116 = Data(decomposeepconstruction_3.UValue_SI)
dup_26 = DuplicateData(Data=data_116, Number=lng_49, Order=True)

panel_325 = Panel("cullOfficeUnits")
equals_18 = Equality(FirstNumber=data_115, SecondNumber="1")  # -> Equality, Inequality
dispatch_26 = Dispatch(List=dup_26, DispatchPattern=equals_18.Equality)  # -> ListA, ListB

# ----
# UNIT FUNCTION: 0: residential non-cooling
# 5: residential with cooling
# 2: office unit
data_117 = Data(weave_36)

# ----
# UNIT FUNCTION: 0: residential non-cooling
# 5: residential with cooling
# 2: office unit
data_118 = Data(weave_36)

clean_9 = CleanTree(RemoveNulls=True, RemoveInvalid=True, RemoveEmpty=toggle_11, Tree=dispatch_24.ListA)
tstat_7 = TreeStatistics(Tree=clean_9)  # -> Paths, Length, Count
series_25 = Series(Start=0, Step=1, Count=tstat_7.Count)
replace_18 = ReplacePaths(Data=clean_9, Search=tstat_7.Paths, Replace=series_25)

# ----
# only, # of residential units in the building
lng_50 = ListLength(List=replace_18)  # -> flatten(Length)

partition_37 = PartitionList(List=data_107, Size=lng_50)  # -> simplify(Chunks)
branch_20 = TreeBranch(Tree=partition_37, Path=filename, MaintainPaths=True)

partition_38 = PartitionList(List=merge_57, Size=lng_50)  # -> simplify(Chunks)
branch_21 = TreeBranch(Tree=partition_38, Path=filename, MaintainPaths=True)

partition_39 = PartitionList(List=merge_2, Size=lng_50)  # -> simplify(Chunks)
branch_22 = TreeBranch(Tree=partition_39, Path=filename, MaintainPaths=True)

partition_40 = PartitionList(List=merge_3, Size=lng_50)  # -> simplify(Chunks)
branch_23 = TreeBranch(Tree=partition_40, Path=filename, MaintainPaths=True)

panel_326 = Panel(lng_50)

panel_327 = Panel("Qcool")
weave_37 = Weave(Pattern=item_3, Stream0=branch_20, Stream1=branch_20, Stream2=branch_20, Stream3=branch_15, NullGaps=False)

weave_38 = Weave(Pattern=item_3, Stream0=branch_21, Stream1=branch_21, Stream2=branch_21, Stream3=branch_17, NullGaps=False)
panel_328 = Panel("Qheat")

weave_39 = Weave(Pattern=item_3, Stream0=branch_22, Stream1=branch_22, Stream2=branch_22, Stream3=branch_14, NullGaps=False)
panel_329 = Panel("Qequipment")

weave_40 = Weave(Pattern=item_3, Stream0=branch_23, Stream1=branch_23, Stream2=branch_23, Stream3=branch_16, NullGaps=False)
panel_330 = Panel("Qlighting")

# ----
# only, # of residential units in the building
weave_41 = Weave(Pattern=item_3, Stream0=lng_50, Stream1=lng_50, Stream2=lng_50, Stream3=lng_44, NullGaps=False)

partition_41 = PartitionList(List=merge_4, Size=weave_41)  # -> simplify(Chunks)
branch_24 = TreeBranch(Tree=partition_41, Path=filename, MaintainPaths=True)

panel_331 = Panel("ppl/m2")
weave_42 = Weave(Pattern=item_3, Stream0=branch_24, Stream1=branch_24, Stream2=branch_24, Stream3=branch_18, NullGaps=False)

panel_332 = Panel("""coolingSetPoint
GeneratedData""")
data_119 = Data(weave_37)

roundd_2 = RoundToDecimalPlace(NumberX=data_119, DecimalPlace="1", RoundType=0)  # -> Rounded, Difference

equals_19 = Equality(FirstNumber=graft(roundd_2.Rounded), SecondNumber=simplify(flatten(data_51)))  # -> Equality, Inequality
mindex_8 = MemberIndex(Set=equals_19.Equality, Member=Toggle(True))  # -> flatten(Index), Count

panel_333 = Panel("""heatingSetPoint
GeneratedData""")
data_120 = Data(weave_38)

data_121 = Data(constantschedule_2.schedule)
roundd_3 = RoundToDecimalPlace(NumberX=data_120, DecimalPlace="1", RoundType=0)  # -> Rounded, Difference
data_122 = Data(panel_157)
fsim_2 = FindSimilarMember(Data=roundd_3.Rounded, Set=data_122)  # -> Hit, Index
item_64 = ListItem(List=data_121, Index=fsim_2.Index, Wrap=True)

data_123 = Data(weave_38)

item_65 = ListItem(List=data_50, Index=mindex_8.Index, Wrap=True)
panel_335 = Panel(item_65)

panel_336 = Panel("""generated
equipment density""")
data_124 = Data(weave_39)

# ----
# separate for each residential unit
panel_337 = Panel("LightingDensity")
data_125 = Data(weave_40)

# ----
# LinearInterpolated    People per sqm
data_126 = Data(weave_42)

# ----
# Cooling set point of Residentials
panel_338 = Panel("coolSet")
split_12 = TextSplit(Text=item_65, Separators=panel_338)
item_66 = ListItem(List=split_12, Index=0, Wrap=True)  # -> flatten(Item)
data_127 = Data(item_66)

data_128 = Data(weave_37)

# ----
# Versions
panel_340 = Panel("""HeatingSet
csv recordings""")
data_129 = Data(data_128)

# ----
# TEST: CONSECUTIVE ARRAY
toggle_12 = BooleanToggle(True)  # disabled
path_11 = FilePath("C:\Users\Siser\Dropbox\PC\Downloads\BahariyeUcokUnit - Sheet14.csv")  # disabled
readxl_2 = ReadExcelSheet(Run=toggle_12, FilePath=path_11, Worksheet="1", Listen=False)  # -> UserMessages, Columns, Rows; disabled
data_130 = Data(readxl_2.Columns)  # disabled

# ----
# python count consecutive duplicates in list, itertools
# https://www.w3resource.com/python-exercises/itertools/python-itertools-exercise-31.php
python_24 = GhPythonScript(x=data_130)  # -> out, a; inputs x: list; disabled; same code as python_4

panel_341 = Panel(python_24.a)  # disabled

# ----
# # of Floor of the building
toggle_13 = BooleanToggle(True)
partition_42 = PartitionList(List=data_29, Size=subtraction)  # -> simplify(Chunks)
clean_10 = CleanTree(RemoveNulls=True, RemoveInvalid=True, RemoveEmpty=toggle_13, Tree=partition_42)
lng_51 = ListLength(List=clean_10)  # -> flatten(Length)
partition_43 = PartitionList(List=flatten(clean_10), Size=lng_51)  # -> simplify(Chunks)

# ----
# DATA TREE: building floor info public and schoold buildings excluded
cull_i_34 = CullIndex(List=partition_43, Indices=clean_3, Wrap=True)  # -> simplify(List)

dispatch_27 = Dispatch(List=cull_i_34, DispatchPattern=data_34)  # -> ListA, ListB
weave_43 = Weave(Pattern=python_14.a, Stream0=dispatch_27.ListA, Stream1=dispatch_27.ListB, NullGaps=False)  # -> simplify(Weave)

# ----
# indices of
# selection ratio according to construction date
data_131 = Data(series_14)
item_67 = ListItem(List=simplify(weave_43), Index=simplify(data_131), Wrap=True)

panel_343 = Panel(item_67)
panel_344 = Panel(item_24)

# ----
# 2D to 3D
data_132 = Data(flatten(item_67))
partition_44 = PartitionList(List=data_132, Size="1")  # -> simplify(Chunks)
Z_2 = UnitZ(Factor=data_44)
arrlinear = LinearArray(Geometry=merge_19, Direction=Z_2, Count=partition_44)  # -> Geometry, Transform
geo_49 = Geometry(arrlinear.Geometry)

# ----
# # of floor of
# the building
data_133 = Data(flatten(item_67))

item_68 = ListItem(List=data_45, Index=data_68, Wrap=True)
item_69 = ListItem(List=data_133, Index=data_68, Wrap=True)
division_14 = Division(A=item_68, B=item_69)
round_10 = Round(Number=division_14)  # -> Nearest, Floor, Ceiling
multiplication_3 = Multiplication(A=round_10.Floor, B=item_69)
subtraction_2 = Subtraction(A=item_68, B=multiplication_3)

panel_346 = Panel("# of floor")
panel_347 = Panel(item_69)

# ----
# # of Units of
# the building
panel_348 = Panel(item_68)

# ----
# Simulation Building Selection
item_70 = ListItem(List=geo_44, Index=filename, Wrap=True)
area_21 = Area(Geometry=geo_49)  # -> Area, Centroid
incurve_2 = PointInCurve(Point=area_21.Centroid, Curve=item_70)  # -> Relationship, Point
equals_20 = Equality(FirstNumber=incurve_2.Relationship, SecondNumber="2")  # -> Equality, Inequality
dispatch_28 = Dispatch(List=geo_49, DispatchPattern=equals_20.Equality)  # -> ListA, ListB

geo_50 = Geometry(flatten(partition_26))
area_22 = Area(Geometry=geo_50)  # -> Area, Centroid
panel_349 = Panel("simulated parcel CORE")
incurve_3 = PointInCurve(Point=area_22.Centroid, Curve=item_70)  # -> Relationship, Point
equals_21 = Equality(FirstNumber=incurve_3.Relationship, SecondNumber="2")  # -> Equality, Inequality
dispatch_29 = Dispatch(List=geo_50, DispatchPattern=equals_21.Equality)  # -> ListA, ListB

md_slider_4 = MDSlider(SliderMode=0, slider_value=Point(0.5, 0.5, 0.5), x_domain=Domain(0, 1), y_domain=Domain(0, 1), z_domain=Domain(0, 1))
evalsrf_2 = EvaluateSurface(Surface=dispatch_29.ListA, Point=md_slider_4)  # -> Point, Normal, UDirection, VDirection, Frame

# ----
# # of units per floor
# of the building
panel_350 = Panel(round_10.Floor)

# ----
# add additional units starting from ground:
# -> 1 unit per floor
panel_351 = Panel(subtraction_2)
panel_352 = Panel("EXTRA units")

# ----
# units of simulated parcel
# without EXTRA units (whether there are exist)
clean_11 = CleanTree(RemoveNulls=True, RemoveInvalid=True, RemoveEmpty=Toggle(True), Tree=dispatch_28.ListA)

panel_353 = Panel("additionalUnit")
data_134 = Data(subtraction_2)

# ----
# Floor-based path
# 
# -> each floor has own path
panel_354 = Panel("{")
dup_27 = DuplicateData(Data=panel_354, Number=item_69, Order=True)
dup_28 = DuplicateData(Data=data_68, Number=item_69, Order=True)
dup_29 = DuplicateData(Data=";", Number=item_69, Order=True)
dup_30 = DuplicateData(Data="}", Number=item_69, Order=True)
series_26 = Series(Start=0, Step=1, Count=item_69)
merge_58 = Merge(Data1=graft(dup_27), Data2=graft(dup_28), Data3=graft(dup_29), Data4=graft(series_26), Data5=graft(dup_30))  # -> simplify(Result)
join_36 = TextJoin(Text=merge_58)  # -> flatten(Result)
panel_355 = Panel(join_36)

# ----
# units of simulated parcel
# without additional units (whether there are exist)
geo_51 = Geometry(clean_11)

# ----
# IF,
# there are Extra Units
panel_356 = Panel(data_134)
equals_22 = Equality(FirstNumber=data_134, SecondNumber="0")  # -> Equality, Inequality
python_25 = GhPythonScript(x=equals_22.Equality, y=geo_51)  # -> out, BuildingwithExtraUnit, simplify(BuildingwithoutExtraUnit); inputs x: Boolean, y: list
# ---------- python_25: Python ----------
__author__ = "Siser"
__version__ = "2022.03.04"

import rhinoscriptsyntax as rs
if x == True:
    BuildingwithoutExtraUnit = y
else:
    BuildingwithExtraUnit = y
# ---------- end python_25 ----------

# ----
# units of simulated parcel
# without additional units (whether there are exist)
geo_52 = Geometry(flatten(geo_51))

# ----
# units of simulated parcel
# without additional units
geo_53 = Geometry(flatten(python_25.BuildingwithExtraUnit))

# ----
# units of simulated parcel
# without additional units
geo_54 = Geometry(flatten(python_25.BuildingwithExtraUnit))

# ----
# # of units per floor
# of the building
data_135 = Data(round_10.Floor)

# ----
# Extra Unit Addition to floors
# if there is no extra units, then a = 0
# else
# a=! 0, thus, the floor division changes
panel_357 = Panel("0")
equals_23 = Equality(FirstNumber=subtraction_2, SecondNumber=panel_357)  # -> Equality, Inequality
python_26 = GhPythonScript(x=equals_23.Equality)  # -> out, a; inputs x: Boolean
# ---------- python_26: Python ----------
__author__ = "Siser"
__version__ = "2022.03.04"

import rhinoscriptsyntax as rs
if x == True:
    a = 0
else:
    a = 1
# ---------- end python_26 ----------
# if x == 1:
#     a=1,1
# elif x ==2:
#     a=2,1
# elif x == 3 or x == 4:
#     a=2,2
# elif x==5 or x ==6:
#     a=3,2
# else:
#     a=4,2
addition_4 = Addition(A=data_135, B=python_26.a)

# ----
# floor division for units per floor
# 
# FOR
# SIMULATED PARCEL
python_27 = GhPythonScript(x=addition_4)  # -> out, simplify(a); inputs x: Int32; same code as python_17

# ----
# uv frame of simulated parcel
data_136 = Data(evalsrf_2.Frame)

# ----
# floors with extra units
series_27 = Series(Start=0, Step=1, Count=subtraction_2)
multiplication_4 = Multiplication(A=series_27, B=data_46)
area_23 = Area(Geometry=geo_54)  # -> Area, Centroid
pdecon_6 = Deconstruct(Point=area_23.Centroid)  # -> XComponent, YComponent, ZComponent
round_11 = Round(Number=pdecon_6.ZComponent)  # -> Nearest, Floor, Ceiling
equals_24 = Equality(FirstNumber=graft(multiplication_4), SecondNumber=round_11.Nearest)  # -> Equality, Inequality
dispatch_30 = Dispatch(List=geo_52, DispatchPattern=equals_24.Equality)  # -> ListA, simplify(ListB)
brec_3 = BoundingRectangle(Geometry=dispatch_30.ListA, Plane=data_136, Axis=0, Slide=0, Union=True)  # -> simplify(Bounding), DimensionX, DimensionY

# ----
# floors without extra units
series_28 = Series(Start=0, Step=1, Count=item_69)
cull_i_35 = CullIndex(List=series_28, Indices=series_27, Wrap=True)
multiplication_5 = Multiplication(A=cull_i_35, B=data_47)
area_24 = Area(Geometry=geo_53)  # -> Area, Centroid
pdecon_7 = Deconstruct(Point=area_24.Centroid)  # -> XComponent, YComponent, ZComponent
round_12 = Round(Number=pdecon_7.ZComponent)  # -> Nearest, Floor, Ceiling
equals_25 = Equality(FirstNumber=graft(multiplication_5), SecondNumber=round_12.Nearest)  # -> Equality, Inequality
dispatch_31 = Dispatch(List=geo_52, DispatchPattern=equals_25.Equality)  # -> simplify(ListA), simplify(ListB)

panel_358 = Panel("non-additional units")
geo_55 = Geometry(simplify(dispatch_31.ListA))

# ----
# cull paths of the additional units
data_137 = Data(series_27)

# ----
# New list path for
# floors without extra units
cull_i_36 = CullIndex(List=join_36, Indices=data_137, Wrap=True)
tstat_8 = TreeStatistics(Tree=geo_55)  # -> Paths, Length, Count
replace_19 = ReplacePaths(Data=geo_55, Search=tstat_8.Paths, Replace=cull_i_36)

# ----
# # of units per floor
# of the building
data_138 = Data(round_10.Floor)

# ----
# check whether
# 
# isotrim division number
# 
# is equal to
# 
# # of units per floor
panel_359 = Panel("1")
addition_5 = Addition(A=data_138, B=panel_359)
ma_5 = MassMultiplication(Input=python_27.a)  # -> Result, PartialResults
equals_26 = Equality(FirstNumber=addition_5, SecondNumber=ma_5.Result)  # -> Equality, Inequality
python_28 = GhPythonScript(x=equals_26.Equality)  # -> out, a; inputs x: Boolean; same code as python_26

# ----
# # of Units
# Per Floor with additional units
panel_360 = Panel(addition_5)

# ----
# no additional units
# for the building
geo_56 = Geometry(flatten(python_25.BuildingwithoutExtraUnit))

# ----
# # of units for floor(s) with extra units
weave_44 = Weave(Pattern=python_28.a, Stream0=flatten(ma_5.Result), Stream1=flatten(addition_5), NullGaps=False)

series_29 = Series(Start=0, Step=1, Count=subtraction_2)
item_71 = ListItem(List=join_36, Index=series_29, Wrap=True)

# ----
# # of units per floor
# of the building
data_139 = Data(round_10.Floor)

panel_361 = Panel("Floor-based Path")
data_140 = Data(join_36)

# ----
# BuildingwithoutExtraUnit
area_25 = Area(Geometry=geo_56)  # -> Area, flatten(Centroid)
pdecon_8 = Deconstruct(Point=area_25.Centroid)  # -> XComponent, YComponent, ZComponent
sort_10 = SortList(Keys=pdecon_8.ZComponent, ValuesA=flatten(geo_56))  # -> Keys, ValuesA
partition_45 = PartitionList(List=sort_10.ValuesA, Size=data_139)
tstat_9 = TreeStatistics(Tree=partition_45)  # -> Paths, Length, Count
replace_20 = ReplacePaths(Data=partition_45, Search=tstat_9.Paths, Replace=data_140)

# ----
# Building without
# Extra Units
data_141 = Data(replace_20)

# ----
# Simulated Parcel Bounding Box
geo_57 = Geometry(item_70)

area_26 = Area(Geometry=geo_57)  # -> Area, Centroid

curvepoint = PointOnCurve(geo_45, parameter=0.5)
vec2pt_5 = Vector2Pt(PointA=curvepoint, PointB=area_26.Centroid, Unitize=False)  # -> Vector, Length
move_2 = Move(Geometry=geo_45, Motion=vec2pt_5.Vector)  # -> Geometry, Transform
disc_5 = Discontinuity(Curve=geo_45, Level=1)  # -> simplify(Points), Parameters
disc_6 = Discontinuity(Curve=move_2.Geometry, Level=1)  # -> simplify(Points), Parameters
merge_59 = Merge(Data1=disc_6.Points, Data2=disc_5.Points)  # -> flatten(Result)
hull_4 = ConvexHull(Points=merge_59, Plane=PlaneXY(0, 0, 0))  # -> Hull, HullZ, Indices

# ----
# Fix Windowless Unit Test
merge_60 = Merge(Data1=disc_6.Points, Data2=disc_5.Points)
hull_5 = ConvexHull(Points=merge_60, Plane=PlaneXY(0, 0, 0))  # -> Hull, HullZ, Indices

# ----
# scale-up the text geometry
# 
# because
# 
# for some buildings even a unit has a edge to the intersected surface, center of the unit do not touch the text geometry.
# for example, index of 572
area_27 = Area(Geometry=hull_5.Hull)  # -> Area, Centroid
scale_2 = Scale(Geometry=hull_5.Hull, Center=area_27.Centroid, Factor="1.1")  # -> Geometry, Transform

# ----
# uv frame of simulated parcel
data_142 = Data(evalsrf_2.Frame)

# ----
# floor division for units per floor
# 
# FOR
# SIMULATED PARCEL
data_143 = Data(python_27.a)

# ----
# new path (after extra unit)
data_144 = Data(join_36)

# ----
# # of floor of
# the building
data_145 = Data(flatten(item_67))

panel_362 = Panel("floor number")
item_72 = ListItem(List=flatten(item_67), Index=filename, Wrap=True)

# ----
# Context Shading: Building
# floor number of buildings
data_146 = Data(flatten(item_67))

# ----
# # of floor of
# the building
# index of selected parcel
data_147 = Data(flatten(item_67))
data_148 = Data(filename)
item_73 = ListItem(List=data_147, Index=data_148, Wrap=True)

# ----
# division of floor(s) with extra units
item_74 = ListItem(List=python_27.a, Index=1, Wrap=True)
item_75 = ListItem(List=python_27.a, Index=0, Wrap=True)
boundary_18 = BoundarySurfaces(Edges=brec_3.Bounding)
divide_3 = DivideDomain²(Domain=boundary_18, UCount=item_75, VCount=item_74)
subsrf_3 = Isotrim(Surface=boundary_18, Domain=divide_3)  # -> simplify(Surface)

panel_363 = Panel("""0
1""")
item_76 = ListItem(List=subsrf_3, Index=1, Wrap=True)
item_77 = ListItem(List=subsrf_3, Index=0, Wrap=True)
cull_i_37 = CullIndex(List=subsrf_3, Indices=panel_363, Wrap=True)  # -> simplify(List)

merge_61 = Merge(Data1=item_77, Data2=item_76)
sunion_2 = SolidUnion(Breps=merge_61)
disc_7 = Discontinuity(Curve=sunion_2, Level=1)  # -> Points, Parameters
pline_2 = PolyLine(Vertices=disc_7.Points, Closed=Toggle(True))
merge_62 = Merge(Data1=cull_i_37, Data2=simplify(pline_2))

# ----
# Extra Unit
# https://drive.google.com/drive/u/1/folders/1cVOKlVuLwwMiW8gXvWmfqpKi1dvpFBbl
# units for floor(s) with extra units
weave_45 = Weave(Pattern=python_28.a, Stream0=flatten(subsrf_3), Stream1=flatten(merge_62), NullGaps=False)

partition_46 = PartitionList(List=flatten(weave_45), Size=weave_44)  # -> simplify(Chunks)
tstat_10 = TreeStatistics(Tree=partition_46)  # -> Paths, Length, Count
replace_21 = ReplacePaths(Data=partition_46, Search=tstat_10.Paths, Replace=item_71)

# ----
# Building with
# Extra Units
merge_63 = Merge(Data1=replace_19, Data2=replace_21)

merge_64 = Merge(Data1=data_141, Data2=merge_63)
clean_12 = CleanTree(RemoveNulls=True, RemoveInvalid=True, RemoveEmpty=Toggle(True), Tree=merge_64)

tstat_11 = TreeStatistics(Tree=clean_12)  # -> Paths, Length, Count
panel_364 = Panel(tstat_11.Paths)

# ----
# TEST FOR EACH FLOOR
# 
# if there are more than 2 residential units at the side of intersected surface
# 
# for example, 0_21, 4_28
area_28 = Area(Geometry=clean_12)  # -> Area, Centroid
incurve_4 = PointInCurve(Point=area_28.Centroid, Curve=scale_2.Geometry)  # -> Relationship, Point
equals_27 = Equality(FirstNumber=incurve_4.Relationship, SecondNumber="2")  # -> Equality, Inequality
dispatch_32 = Dispatch(List=area_28.Centroid, DispatchPattern=equals_27.Equality)  # -> ListA, ListB
lng_52 = ListLength(List=dispatch_32.ListA)
larger = LargerThan(FirstNumber=lng_52, SecondNumber="2")  # -> LargerThan, OrEqualTo
panel_365 = Panel(larger.LargerThan)

python_29 = GhPythonScript(x=larger.LargerThan, y=clean_12)  # -> out, simplify(Windowless), simplify(NoWindowless); inputs x: Boolean, y: list
# ---------- python_29: Python ----------
__author__ = "Siser"
__version__ = "2022.03.04"

import rhinoscriptsyntax as rs
if x == True:
    Windowless = y
else:
    NoWindowless= y
# ---------- end python_29 ----------
geo_58 = Geometry(python_29.Windowless)
clean_13 = CleanTree(RemoveNulls=True, RemoveInvalid=True, RemoveEmpty=Toggle(True), Tree=geo_58)
brec_4 = BoundingRectangle(Geometry=clean_13, Plane=data_142, Axis=0, Slide=0, Union=True)  # -> simplify(Bounding), DimensionX, DimensionY
boundary_19 = BoundarySurfaces(Edges=brec_4.Bounding)
md_slider_5 = MDSlider(SliderMode=0, slider_value=Point(0.5, 0.5, 0.5), x_domain=Domain(0, 1), y_domain=Domain(0, 1), z_domain=Domain(0, 1))
iso_4 = IsoCurve(Surface=reparameterize(flatten(boundary_19)), UVPoint=md_slider_5)  # -> simplify(flatten(UIsocurve)), VIsocurve
item_78 = ListItem(List=iso_4.UIsocurve, Index=0, Wrap=True)
equals_28 = Equality(FirstNumber=data_143, SecondNumber="2")  # -> Equality, Inequality
sort_11 = SortList(Keys=data_143)  # -> Keys, ValuesA
dprod_4 = DotProduct(VectorA=item_78, VectorB=geo_46, Unitize=False)
dispatch_33 = Dispatch(List=data_143, DispatchPattern=equals_28.Equality)  # -> ListA, ListB
item_79 = ListItem(List=sort_11.Keys, Index=0, Wrap=True)
python_30 = GhPythonScript(x=dprod_4)  # -> out, output; inputs x: Int32
# ---------- python_30: Python ----------
__author__ = "orcun"
__version__ = "2022.04.08"

import rhinoscriptsyntax as rs
if x == -1 or x==1:
    output = True
else:
    output= False
# ---------- end python_30 ----------
srf_2 = Surface(reparameterize(boundary_19))
item_80 = ListItem(List=data_143, Index=1, Wrap=True)
item_81 = ListItem(List=data_143, Index=0, Wrap=True)

# ----
# 04.GEOMETRYFOR
# BUILDINGENERGYMODELING
dcon_2 = DeleteConsecutive(Set=python_30.output, Wrap=False)  # -> Set, Count

python_31 = PythonScript(s=srf_2, swapUV=dcon_2.Set, reverseU=Toggle(False), reverseV=Toggle(False))  # -> out, anchor, uVec, vVec, revSrf; inputs s: Surface, swapUV: Int32, reverseU: Int32, reverseV: Int32; same code as python_16
divide_4 = DivideDomain²(Domain=python_31.revSrf, UCount=item_81, VCount=item_80)
subsrf_4 = Isotrim(Surface=simplify(python_31.revSrf), Domain=simplify(divide_4))  # -> simplify(Surface)

# ----
# check whether
# 
# isotrim division number
# 
# is equal to
# 
# # of units per floor
toggle_14 = BooleanToggle(True)
clean_14 = CleanTree(RemoveNulls=True, RemoveInvalid=True, RemoveEmpty=toggle_14, Tree=python_29.Windowless)
multiplication_6 = Multiplication(A=item_81, B=item_80)
lng_53 = ListLength(List=clean_14)
equals_29 = Equality(FirstNumber=lng_53, SecondNumber=multiplication_6)  # -> simplify(Equality), Inequality

dispatch_34 = Dispatch(List=subsrf_4, DispatchPattern=equals_29.Equality)  # -> ListA, ListB

# ----
# Windowless
# and
# not equal to
# isotrim division
panel_366 = Panel("""0
1""")
item_82 = ListItem(List=dispatch_34.ListB, Index=1, Wrap=True)
item_83 = ListItem(List=dispatch_34.ListB, Index=0, Wrap=True)
cull_i_38 = CullIndex(List=dispatch_34.ListB, Indices=panel_366, Wrap=True)  # -> simplify(List)
merge_65 = Merge(Data1=item_83, Data2=item_82)
sunion_3 = SolidUnion(Breps=merge_65)
disc_8 = Discontinuity(Curve=sunion_3, Level=1)  # -> Points, Parameters
pline_3 = PolyLine(Vertices=disc_8.Points, Closed=Toggle(True))
merge_66 = Merge(Data1=simplify(cull_i_38), Data2=simplify(pline_3))
clean_15 = CleanTree(RemoveNulls=True, RemoveInvalid=True, RemoveEmpty=Toggle(True), Tree=merge_66)

panel_367 = Panel("NoWindowless")
clean_16 = CleanTree(RemoveNulls=True, RemoveInvalid=True, RemoveEmpty=Toggle(True), Tree=python_29.NoWindowless)

# ----
# Windowless
# and
# equal to isotrim division
toggle_15 = BooleanToggle(True)
clean_17 = CleanTree(RemoveNulls=True, RemoveInvalid=True, RemoveEmpty=toggle_15, Tree=dispatch_34.ListA)

merge_67 = Merge(Data1=simplify(clean_16), Data2=simplify(clean_17), Data3=simplify(clean_15))
wires_3 = BrepWireframe(Brep=merge_67, Density=-1)
join_37 = JoinCurves(Curves=wires_3, Preserve=False)  # -> simplify(flatten(Curves))
lng_54 = ListLength(List=merge_67)  # -> flatten(Length)
partition_47 = PartitionList(List=join_37, Size=lng_54)  # -> simplify(Chunks)

# ----
# No-stairCase
# replace with new path
tstat_12 = TreeStatistics(Tree=partition_47)  # -> Paths, Length, Count
replace_22 = ReplacePaths(Data=partition_47, Search=tstat_12.Paths, Replace=data_144)

# ----
# x
# x
# x
# x
# x
# x
# x
# x
# x
# x
# x
# x
# x
# x
# x
# x
# x
# x
# x
# x
# x
# x
# x
# x
# x
# x
# x
# 
# x
# x
# x
# x
# x
# x
# 
# x
# x
# x
# x
# x
# 
# x
# x
# x
# x
# x
# x
# 
# x
# x
# x
# x
# additional units (example index 0, in bahceli)
# 
# OR
# 
# non-additional units (example index 1, in bahceli)
geo_59 = Geometry(replace_22)

disc_9 = Discontinuity(Curve=geo_59, Level=1)  # -> Points, Parameters
panel_368 = Panel("""SIMULATED 
BUILDING
UNITS""")
brec_5 = BoundingRectangle(Geometry=flatten(disc_9.Points), Plane=evalsrf_2.Frame, Axis=0, Slide=0, Union=True)  # -> Bounding, DimensionX, DimensionY

tstat_13 = TreeStatistics(Tree=geo_59)  # -> Paths, Length, Count
split_13 = TextSplit(Text=tstat_13.Paths, Separators="{}")
item_84 = ListItem(List=split_13, Index=1, Wrap=True)  # -> simplify(Item)
split_14 = TextSplit(Text=item_84, Separators=";")
item_85 = ListItem(List=split_14, Index="1", Wrap=True)  # -> simplify(flatten(Item))
lng_55 = ListLength(List=item_85)
dup_31 = DuplicateData(Data=item_53, Number=lng_55, Order=True)  # -> flatten(Data)
merge_68 = Merge(Data1=simplify(graft(dup_31)), Data2=simplify(graft(item_85)))
join_38 = TextJoin(Text=merge_68, Join=";")

# ----
# select only residential units
lng_56 = ListLength(List=partition_47)
series_30 = Series(Start=0, Step=1, Count=lng_56)  # -> simplify(Series)

boundary_20 = BoundarySurfaces(Edges=geo_59)
Z_3 = UnitZ(Factor=data_48)
extr_2 = Extrude(Base=boundary_20, Direction=Z_3)

# ----
# intersect mass for all units
# -conditioned zones
# -unconditioned zones
# Error: vertex size mismatch between base surface
toggle_16 = BooleanToggle(True)
intersectmass = Honeybee_IntersectMasses(bldgMassesBefore=flatten(extr_2), runIt=toggle_16)  # -> bldgMassesAfter; plug-in component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

panel_369 = Panel("simulated building PARCEL")
geo_60 = Geometry(brec_5.Bounding)

# ----
# radius of the circle is the summation of fit circle radius's and 2 times of the builing height
disc_10 = Discontinuity(Curve=geo_60, Level=1)  # -> Points, Parameters
fcircle = CircleFit(Points=disc_10.Points)  # -> Circle, Radius, Deviation
item_86 = ListItem(List=data_145, Index=data_81, Wrap=True)
data_149 = Data(floor_height)
multiplication_7 = Multiplication(A="2", B=item_86)
multiplication_8 = Multiplication(A=data_149, B=multiplication_7)

addition_6 = Addition(A=fcircle.Radius, B=multiplication_8)

area_29 = Area(Geometry=geo_47)  # -> Area, Centroid
area_30 = Area(Geometry=geo_60)  # -> Area, Centroid
cp = ClosestPoint(Point=area_30.Centroid, Cloud=area_29.Centroid)  # -> ClosestPoint, CPIndex, Distance
item_87 = ListItem(List=geo_47, Index=cp.CPIndex, Wrap=True)
area_31 = Area(Geometry=item_87)  # -> Area, Centroid
area_32 = Area(Geometry=geo_47)  # -> Area, Centroid
circle = CircleCNR(Center=area_31.Centroid, Normal=Vector(0, 0, 1), Radius=addition_6)
incurve_5 = PointInCurve(Point=area_32.Centroid, Curve=circle)  # -> Relationship, Point
equals_30 = Equality(FirstNumber=incurve_5.Relationship, SecondNumber="2")  # -> Equality, Inequality

pop2d = Populate2D(Region=geo_47, Count="25", Seed=1)  # -> simplify(Population)
incurve_6 = PointInCurve(Point=pop2d, Curve=circle)  # -> Relationship, Point
equals_31 = Equality(FirstNumber=incurve_6.Relationship, SecondNumber="2")  # -> Equality, Inequality
dispatch_35 = Dispatch(List=pop2d, DispatchPattern=equals_31.Equality)  # -> flatten(ListA), ListB

incurves_2 = PointInCurves(Point=dispatch_35.ListA, Curves=geo_47)  # -> Relationship, Index, Point
sort_12 = SortList(Keys=incurves_2.Index)  # -> Keys, ValuesA
dcon_3 = DeleteConsecutive(Set=sort_12.Keys, Wrap=False)  # -> Set, Count
equals_32 = Equality(FirstNumber=dcon_3.Set, SecondNumber="-1")  # -> Equality, Inequality
dispatch_36 = Dispatch(List=dcon_3.Set, DispatchPattern=equals_32.Equality)  # -> ListA, ListB
item_88 = ListItem(List=geo_47, Index=dispatch_36.ListB, Wrap=True)

geo_61 = Geometry(brec_5.Bounding)
area_33 = Area(Geometry=geo_61)  # -> Area, Centroid

geo_62 = Geometry(brec_5.Bounding)

# ----
# rectangle geometry do not work with collison component
toggle_17 = BooleanToggle(True)
debrep_3 = DeconstructBrep(Brep=item_88)  # -> Faces, Edges, Vertices
pline_4 = PolyLine(Vertices=debrep_3.Vertices, Closed=toggle_17)  # -> flatten(Polyline)

geo_63 = Geometry(brec_5.Bounding)

disc_11 = Discontinuity(Curve=geo_63, Level=1)  # -> Points, Parameters
area_34 = Area(Geometry=geo_63)  # -> Area, Centroid
boundary_21 = BoundarySurfaces(Edges=geo_63)
ln = Line(StartPoint=disc_11.Points, EndPoint=area_34.Centroid)
srfsplit = SurfaceSplit(Surface=boundary_21, Curves=ln)
wires_4 = BrepWireframe(Brep=srfsplit, Density=-1)
join_39 = JoinCurves(Curves=wires_4, Preserve=False)  # -> flatten(Curves)
scale_3 = Scale(Geometry=join_39, Center=area_34.Centroid, Factor="50")  # -> Geometry, Transform

debrep_4 = DeconstructBrep(Brep=geo_63)  # -> Faces, Edges, Vertices
curvepoint_2 = PointOnCurve(debrep_4.Edges, parameter=0.5)
intcrv = Interpolate(Vertices=curvepoint_2, Degree=3, Periodic=Toggle(True), KnotStyle=1)  # -> Curve, Length, Domain

geo_64 = Geometry(brec_5.Bounding)

geo_65 = Geometry(brec_5.Bounding)

debrep_5 = DeconstructBrep(Brep=geo_64)  # -> Faces, Edges, Vertices
area_35 = Area(Geometry=geo_64)  # -> Area, Centroid
curvepoint_3 = PointOnCurve(debrep_5.Edges, parameter=0.5)
vec2pt_6 = Vector2Pt(PointA=area_35.Centroid, PointB=curvepoint_3, Unitize=Toggle(True))  # -> Vector, Length
move_3 = Move(Geometry=graft(curvepoint_3), Motion=graft(vec2pt_6.Vector))  # -> simplify(Geometry), Transform
disc_12 = Discontinuity(Curve=debrep_5.Edges, Level=1)  # -> simplify(Points), Parameters
merge_69 = Merge(Data1=disc_12.Points, Data2=move_3.Geometry)

# ----
# 00test triangle
area_36 = Area(Geometry=geo_65)  # -> Area, Centroid
disc_13 = Discontinuity(Curve=geo_65, Level=1)  # -> Points, Parameters
boundary_22 = BoundarySurfaces(Edges=geo_65)
ln_2 = Line(StartPoint=disc_13.Points, EndPoint=area_36.Centroid)
srfsplit_2 = SurfaceSplit(Surface=boundary_22, Curves=ln_2)
wires_5 = BrepWireframe(Brep=srfsplit_2, Density=-1)
join_40 = JoinCurves(Curves=wires_5, Preserve=False)  # -> flatten(Curves)
scale_4 = Scale(Geometry=join_40, Center=area_36.Centroid, Factor="50")  # -> Geometry, Transform

area_37 = Area(Geometry=scale_3.Geometry)  # -> Area, Centroid
alongcrv = SortAlongCurve(Points=area_37.Centroid, Curve=intcrv.Curve)  # -> Points, Indices
item_89 = ListItem(List=scale_3.Geometry, Index=alongcrv.Indices, Wrap=True)

area_38 = Area(Geometry=scale_4.Geometry)  # -> Area, Centroid
pdecon_9 = Deconstruct(Point=area_38.Centroid)  # -> XComponent, YComponent, ZComponent
sort_13 = SortList(Keys=pdecon_9.YComponent, ValuesA=scale_4.Geometry)  # -> Keys, reverse(ValuesA)
item_90 = ListItem(List=sort_13.ValuesA, Index=0, Wrap=True)

area_39 = Area(Geometry=scale_4.Geometry)  # -> Area, Centroid
pdecon_10 = Deconstruct(Point=area_39.Centroid)  # -> XComponent, YComponent, ZComponent
sort_14 = SortList(Keys=pdecon_10.XComponent, ValuesA=scale_4.Geometry)  # -> Keys, ValuesA
item_91 = ListItem(List=sort_14.ValuesA, Index=0, Wrap=True)

area_40 = Area(Geometry=scale_4.Geometry)  # -> Area, Centroid
pdecon_11 = Deconstruct(Point=area_40.Centroid)  # -> XComponent, YComponent, ZComponent
sort_15 = SortList(Keys=pdecon_11.YComponent, ValuesA=scale_4.Geometry)  # -> Keys, ValuesA
item_92 = ListItem(List=sort_15.ValuesA, Index=0, Wrap=True)

area_41 = Area(Geometry=scale_4.Geometry)  # -> Area, Centroid
pdecon_12 = Deconstruct(Point=area_41.Centroid)  # -> XComponent, YComponent, ZComponent
sort_16 = SortList(Keys=pdecon_12.XComponent, ValuesA=scale_4.Geometry)  # -> Keys, reverse(ValuesA)
item_93 = ListItem(List=sort_16.ValuesA, Index=0, Wrap=True)

shift_4 = ShiftList(List=item_89, Shift="-1", Wrap=True)
panel_376 = Panel("starts from north")

# ----
# regions start from north
# continues counter-clockwise
merge_70 = Merge(Data1=item_90, Data2=item_91, Data3=item_92, Data4=item_93)

geo_66 = Geometry(brec_5.Bounding)

geo_67 = Geometry(brec_5.Bounding)

geo_68 = Geometry(brec_5.Bounding)

tstat_14 = TreeStatistics(Tree=geo_59)  # -> Paths, Length, Count
split_15 = TextSplit(Text=tstat_14.Paths, Separators="{}")
split_16 = TextSplit(Text=split_15, Separators=";")
clean_18 = CleanTree(RemoveNulls=True, RemoveInvalid=True, RemoveEmpty=False, Tree=split_16)  # -> simplify(flatten(Tree))
item_94 = ListItem(List=clean_18, Index=1, Wrap=True)

tstat_15 = TreeStatistics(Tree=geo_59)  # -> Paths, Length, Count
split_17 = TextSplit(Text=tstat_15.Paths, Separators="{}")
split_18 = TextSplit(Text=split_17, Separators=";")
clean_19 = CleanTree(RemoveNulls=True, RemoveInvalid=True, RemoveEmpty=False, Tree=split_18)  # -> simplify(flatten(Tree))
item_95 = ListItem(List=clean_19, Index=1, Wrap=True)

tstat_16 = TreeStatistics(Tree=geo_59)  # -> Paths, Length, Count
split_19 = TextSplit(Text=tstat_16.Paths, Separators="{}")
split_20 = TextSplit(Text=split_19, Separators=";")
clean_20 = CleanTree(RemoveNulls=True, RemoveInvalid=True, RemoveEmpty=False, Tree=split_20)  # -> simplify(flatten(Tree))
item_96 = ListItem(List=clean_20, Index=1, Wrap=True)

tstat_17 = TreeStatistics(Tree=geo_59)  # -> Paths, Length, Count
split_21 = TextSplit(Text=tstat_17.Paths, Separators="{}")
split_22 = TextSplit(Text=split_21, Separators=";")
clean_21 = CleanTree(RemoveNulls=True, RemoveInvalid=True, RemoveEmpty=False, Tree=split_22)  # -> simplify(flatten(Tree))
item_97 = ListItem(List=clean_21, Index=1, Wrap=True)

lng_57 = ListLength(List=geo_59)  # -> flatten(Length)
series_31 = Series(Start=0, Step=1, Count=simplify(lng_57))  # -> simplify(flatten(Series))
partition_48 = PartitionList(List=lng_57, Size="1")  # -> simplify(Chunks)
dup_32 = DuplicateData(Data=join_38, Number=partition_48, Order=True)  # -> simplify(Data)
rep = ReplaceText(Text=dup_32, Find=";", Replace="_", RecursiveReplace=False)  # -> flatten(Result)

python_32 = GhPythonScript(x=replace_17)  # -> out, a
# ---------- python_32: Python ----------
__author__ = "Siser"
__version__ = "2022.03.07"

import rhinoscriptsyntax as rs
if x == 'MidriseApartment::Apartment':
    a = 'res'
else:
    a = 'off'
# ---------- end python_32 ----------
partition_49 = PartitionList(List=python_32.a, Size=lng_57)  # -> simplify(flatten(Chunks))

merge_71 = Merge(Data1=simplify(graft(rep)), Data2=simplify(graft(series_31)), Data3=simplify(graft(partition_49)))
join_41 = TextJoin(Text=simplify(merge_71), Join="_")  # -> flatten(Result)
partition_50 = PartitionList(List=join_41, Size=lng_57)  # -> simplify(Chunks)
item_98 = ListItem(List=partition_50, Index=series_30, Wrap=True)

panel_380 = Panel("parcel_floor_unit_function")
panel_381 = Panel(partition_50)

# ----
# Conditioned Units
mass2zone = Honeybee_Masses2Zones(
    zoneMasses=flatten(intersectmass),
    zoneNames=flatten(partition_50),
    zonePrograms=replace_17,
    isConditioned=Toggle(True),
    maxRoofAngle=30,
    createHBZones=Toggle(True))  # -> readMe, HBZones; plug-in component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

# ----
# if the # of floor is equal to 1
null_4 = NullItem(Item=mass2zone.HBZones)  # -> flatten(NullFlags), InvalidFlags, Description
dispatch_37 = Dispatch(List=mass2zone.HBZones, DispatchPattern=null_4.NullFlags)  # -> ListA, flatten(ListB)

# ----
# HBzone
# Formation
toggle_18 = BooleanToggle(True)
solveadjc = Honeybee_SolveAdjacencies(HBZones=flatten(dispatch_37.ListB), removeCurrentAdjc=False, findAdjc=toggle_18)  # -> readMe, HBZonesWADJ; plug-in component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

merge_72 = Merge(Data1=solveadjc.HBZonesWADJ)  # -> flatten(Result)
null_5 = NullItem(Item=merge_72)  # -> flatten(NullFlags), InvalidFlags, Description
dispatch_38 = Dispatch(List=merge_72, DispatchPattern=null_5.NullFlags)  # -> ListA, flatten(ListB)
panel_382 = Panel("include intersected surface's zone")
solveadjc_2 = Honeybee_SolveAdjacencies(HBZones=flatten(dispatch_38.ListB), altBC="Adiabatic", removeCurrentAdjc=False, findAdjc=Toggle(True))  # -> readMe, HBZonesWADJ; plug-in component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

# ----
# Window Addition
conditionedunconditioned = Honeybee_SeparateConditionedAndUnconditionedZones(HBZones=flatten(solveadjc_2.HBZonesWADJ))  # -> conditionedZones, unconditionedZones; plug-in component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
# x
# x
# x
# x
# x
# x
# x
# x
# x
# x
# x
# x
# x
# x
# x
# x
# x
# x
# x
# x
# x
# x
# x
# x
# x
# x
# x
# 
# x
# x
# x
# x
# x
# x
# 
# x
# x
# x
# x
# x
# 
# x
# x
# x
# x
# x
# x
# 
# x
# x
# x
# x
glazingcreator = Honeybee_GlazingBasedOnRatio(
    HBObjects=conditionedunconditioned.conditionedZones,
    glzRatio=weave_28,
    breakUpWindow=Toggle(False),
    EPConstructions=epconstruction_2,
    runIt=Toggle(True))  # -> readMe, HBObjWGLZ; plug-in component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

# ----
# ilkim
toggle_19 = BooleanToggle(False)  # disabled
# 06.CONDITIONING
# FORENERGYMODELING
bake = ObjectBake(
    BakeToggle=toggle_19,
    GeometryObjects=glazingcreator.HBObjWGLZ,
    Layer="GH_Bake",
    ObjectName="GH_Obj",
    ObjectColor=RGB(255, 255, 255),
    LayerColor=RGB(255, 255, 255))  # disabled

geo_69 = Geometry(glazingcreator.HBObjWGLZ)
panel_383 = Panel("HBzones")

panel_384 = Panel("residential non-cooling")
equals_33 = Equality(FirstNumber=data_113, SecondNumber="0")  # -> Equality, Inequality
dispatch_39 = Dispatch(List=geo_69, DispatchPattern=equals_33.Equality)  # -> ListA, ListB

# ----
# Residential
# with cooling
panel_385 = Panel("5")
panel_386 = Panel("residential with cooling")
equals_34 = Equality(FirstNumber=data_113, SecondNumber=panel_385)  # -> Equality, Inequality
dispatch_40 = Dispatch(List=geo_69, DispatchPattern=equals_34.Equality)  # -> ListA, ListB

panel_387 = Panel("office unit(s)")
equals_35 = Equality(FirstNumber=data_113, SecondNumber="1")  # -> Equality, Inequality
dispatch_41 = Dispatch(List=geo_69, DispatchPattern=equals_35.Equality)  # -> ListA, ListB

# ----
# Unit Separation by Function
panel_388 = Panel("residential all")
data_150 = Data(dispatch_41.ListB)
item_99 = ListItem(List=geo_69, Index=data_150, Wrap=True)

panel_389 = Panel("#ofResUnits")
lng_58 = ListLength(List=item_99)

# ----
# .csv recordings
dup_33 = DuplicateData(Data="21", Number=lng_58, Order=True)

lng_59 = ListLength(List=item_99)

# ----
# AS-IS V1
# HEATING
# SET POINT
panel_391 = Panel("heatSetV1orV3")
annualschedule_4 = Honeybee_AnnualSchedule(
    sun=merge_22,
    mon=merge_22,
    tue=merge_22,
    wed=merge_22,
    thu=merge_22,
    fri=merge_22,
    sat=merge_22,
    scheduleName=simplify(graft(panel_391)),
    schedTypeLimits="Temperature",
    runIt=Toggle(True))  # -> readMe, port, flatten(schedule), port_2, simplify(weekSched), schedIDFText; plug-in component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
dup_34 = DuplicateData(Data=annualschedule_4.schedule, Number=lng_59, Order=True)

panel_392 = Panel("HeatingSetSchedule")
weave_46 = Weave(Pattern=list, Stream0=dup_34, Stream1=item_64, Stream2=dup_34, Stream3=item_64, NullGaps=False)

panel_393 = Panel("""HeatingSet
csv recordings""")
# Versions
weave_47 = Weave(Pattern=list, Stream0=dup_33, Stream1=data_123, Stream2=dup_33, Stream3=data_123, NullGaps=False)

# ----
# Natural Ventilation will finish 0.5 less than Cooling Set Point
panel_394 = Panel("""coolingSetPoint
GeneratedData""")
lng_60 = ListLength(List=dispatch_40.ListA)
data_151 = Data(weave_37)
series_32 = Series(Start=0, Step=1, Count=lng_60)
item_100 = ListItem(List=data_151, Index=series_32, Wrap=True)
roundd_4 = RoundToDecimalPlace(NumberX=item_100, DecimalPlace="1", RoundType=0)  # -> Rounded, Difference
subtraction_3 = Subtraction(A=roundd_4.Rounded, B="0.5")

panel_395 = Panel("residential all")
item_101 = ListItem(List=data_113, Index=data_150, Wrap=True)

# ----
# Natural Ventilation Office
setepnatvent = Honeybee_SetEPAirFlow(
    HBZones=flatten(dispatch_41.ListA),
    naturalVentilationType="1",
    minIndoorTempForNatVent="23.5",
    maxIndoorTempForNatVent="25.0",
    minOutdoorTempForNatVent="12",
    deltaTempForNatVent="0.0",
    fractionOfGlzAreaOperable="0.4",
    windDrivenCrossVent=Toggle(False))  # -> readMe, simplify(HBZones); plug-in component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

# ----
# Heating set point
panel_396 = Panel("1")
equals_36 = Equality(FirstNumber=item_101, SecondNumber=panel_396)  # -> Equality, Inequality
dispatch_42 = Dispatch(List=weave_46, DispatchPattern=equals_36.Equality)  # -> ListA, ListB

# ----
# RESIDENTIAL
# COOLING-OFF
# UNITS
setepnatvent_2 = Honeybee_SetEPAirFlow(
    HBZones=flatten(dispatch_39.ListA),
    naturalVentilationType="1",
    minIndoorTempForNatVent="23.5",
    minOutdoorTempForNatVent="12",
    deltaTempForNatVent=panel_173,
    fractionOfGlzAreaOperable="0.4",
    windDrivenCrossVent=Toggle(False))  # -> readMe, simplify(HBZones); plug-in component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
setepzoneschedules = Honeybee_SetEnergyPlusZoneSchedules(
    HBZones=setepnatvent_2.HBZones,
    heatingSetPtSchedules=dispatch_42.ListB,
    coolingSetPtSchedules=annualschedule.schedule,
    lightingSchedules=item_30)  # -> schedules, simplify(flatten(HBZones)); plug-in component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

# ----
# RESIDENTIAL COOLING UNITS
# ALL YEAR, OPEN
setepnatvent_3 = Honeybee_SetEPAirFlow(
    HBZones=flatten(dispatch_40.ListA),
    naturalVentilationType="1",
    minIndoorTempForNatVent="23.5",
    maxIndoorTempForNatVent=subtraction_3,
    minOutdoorTempForNatVent="12",
    deltaTempForNatVent="0.0",
    fractionOfGlzAreaOperable="0.4",
    windDrivenCrossVent=Toggle(False))  # -> readMe, simplify(HBZones); plug-in component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
setepzoneschedules_2 = Honeybee_SetEnergyPlusZoneSchedules(HBZones=setepnatvent_3.HBZones, heatingSetPtSchedules=weave_46, coolingSetPtSchedules=item_65, lightingSchedules=item_30)  # -> schedules, simplify(HBZones); plug-in component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

# ----
# V1/V2........
# COOLING-ON
# RESIDENTIAL & SEASONAL
# Heating Set Point Schedules
gethbzoneepschedules = Honeybee_GetZoneEnergyPlusSchedules(HBZone=setepnatvent_3.HBZones)  # -> occupancySchedule, occupancyActivitySch, heatingSetPtSchedule, coolingSetPtSchedule, lightingSchedule, equipmentSchedule, infiltrationSchedule; disabled; plug-in component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
panel_397 = Panel("residential units")  # disabled
item_102 = ListItem(List=gethbzoneepschedules.occupancySchedule, Index=0, Wrap=True)  # disabled
convertepschvalues_3 = Honeybee_ConvertEnergyPlusScheduleToValues(schName=item_102)  # -> values, holidays; disabled; plug-in component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
lb_schedule_4 = GenePool(
    Decimals=1,
    Maximum=100,
    Minimum=25.5,
    Value=[25.5, 25.5, 25.5, 25.5, 25.5, 25.5, 25.5, 25.5, 25.5, 25.5, 25.5, 25.5, 25.5, 25.5, 25.5, 25.5, 25.5, 25.5, 25.5, 25.5, 25.5, 25.5, 25.5, 25.5])  # disabled
strnum_4 = Ladybug_SeparateData(inputList=flatten(convertepschvalues_3.values))  # -> numbers, strings; disabled; plug-in component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
panel_398 = Panel("RESIDENTIAL-COOLING-ONN-SCHEDULE")  # disabled
toggle_20 = BooleanToggle(True)  # disabled
panel_399 = Panel("RESIDENTIAL-COOLING-OFF-SCHEDULE")  # disabled
panel_400 = Panel("Temperature")  # disabled
lb_schedule_5 = GenePool(
    Decimals=0,
    Maximum=100.001,
    Minimum=100,
    Value=[100, 100, 100, 100, 100, 100, 100, 100.001, 100.001, 100.001, 100.001, 100.001, 100.001, 100.001, 100.001, 100.001, 100.001, 100.001, 100.001, 100, 100, 100, 100, 100])  # disabled
python_33 = GhPythonScript(x=strnum_4.numbers, y=lb_schedule_4)  # -> out, a; disabled
# ---------- python_33: Python ----------
__author__ = "Siser"
__version__ = "2022.03.07"

import rhinoscriptsyntax as rs
if x>0:
    a=y
else:
    a=100
# ---------- end python_33 ----------
panel_401 = Panel("15")  # disabled
panel_402 = Panel("4")  # disabled
panel_403 = Panel("10")  # disabled
annualschedule_5 = Honeybee_AnnualSchedule(
    sun=lb_schedule_5,
    mon=lb_schedule_5,
    tue=lb_schedule_5,
    wed=lb_schedule_5,
    thu=lb_schedule_5,
    fri=lb_schedule_5,
    sat=lb_schedule_5,
    scheduleName=panel_399,
    schedTypeLimits=panel_400,
    runIt=toggle_20)  # -> readMe, port, schedule, port_2, weekSched, schedIDFText; disabled; plug-in component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
panel_404 = Panel("RESIDENTIAL_COOLING_SCHEDULE-ANNUAL")  # disabled
annualschedule_6 = Honeybee_AnnualSchedule(
    sun=python_33.a,
    mon=python_33.a,
    tue=python_33.a,
    wed=python_33.a,
    thu=python_33.a,
    fri=python_33.a,
    sat=python_33.a,
    scheduleName=panel_398,
    schedTypeLimits=panel_400,
    runIt=toggle_20)  # -> readMe, port, schedule, port_2, weekSched, schedIDFText; disabled; plug-in component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
analysisperiod_5 = Ladybug_AnalysisPeriod(fromMonth=panel_402, fromDay=panel_401, toMonth=panel_403, toDay=panel_401)  # -> readMe, analysisPeriod; disabled; plug-in component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
honeybee_seasonalschedule = Honeybee_SeasonalSchedule(
    scheduleName=panel_404,
    schedTypeLimits=panel_400,
    baseWeekSched=annualschedule_5.weekSched,
    seasonWeekSched1=annualschedule_6.weekSched,
    analysisPeriod1=analysisperiod_5.analysisPeriod)  # -> readMe, schedule, schedIDFText; disabled; plug-in component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

# ----
# OFFICE UNITS
# WITH COOLING
# ALL YEAR, OPEN
setepzoneschedules_3 = Honeybee_SetEnergyPlusZoneSchedules(
    HBZones=setepnatvent.HBZones,
    heatingSetPtSchedules=annualschedule_3.schedule,
    coolingSetPtSchedules=annualschedule_2.schedule)  # -> schedules, simplify(HBZones); plug-in component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

# ----
# indices
# of
# residential non-cooling
listdexs_6 = ListIndices(List=geo_69)
dispatch_43 = Dispatch(List=listdexs_6, DispatchPattern=equals_33.Equality)  # -> ListA, ListB

# ----
# geometry of residential non-cooling
geo_70 = Geometry(setepzoneschedules.HBZones)

replace_23 = ReplaceItems(List=data_114, Item=geo_70, Indices=dispatch_43.ListA, Wrap=False)

# ----
# indices
# of
# residential cooling
listdexs_7 = ListIndices(List=geo_69)
dispatch_44 = Dispatch(List=listdexs_7, DispatchPattern=equals_34.Equality)  # -> ListA, ListB

# ----
# geometry of residential cooling
geo_71 = Geometry(setepzoneschedules_2.HBZones)

# ----
# merge residential units
# (i.e., cooling, non-cooling)
# index-based
replace_24 = ReplaceItems(List=replace_23, Item=geo_71, Indices=dispatch_44.ListA, Wrap=False)

panel_405 = Panel("CULL office unit(s)")
data_152 = Data(equals_35.Equality)

dispatch_45 = Dispatch(List=replace_24, DispatchPattern=data_152)  # -> ListA, ListB

null_6 = NullItem(Item=dispatch_45.ListB)  # -> NullFlags, InvalidFlags, Description
dispatch_46 = Dispatch(List=dispatch_45.ListB, DispatchPattern=null_6.NullFlags)  # -> ListA, ListB

weave_48 = Weave(Pattern=list, Stream0=python_19.a, Stream1=python_19.a, Stream2=item_44, Stream3=item_44, NullGaps=False)
ach2m3_s_m2_calculator_2 = Honeybee_infORventPerAreaCalculator(HBZones=flatten(dispatch_46.ListB), airFlowRate=weave_48, ACHorM3sM2=Toggle(False))  # -> readMe, infPerAreaFacade, ventPerAreaFloor, allExposed, allFloors; plug-in component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

ach2m3_s_m2_calculator_3 = Honeybee_infORventPerAreaCalculator(HBZones=flatten(dispatch_46.ListB), airFlowRate="0.5", ACHorM3sM2=boolean_toggle_2)  # -> readMe, infPerAreaFacade, ventPerAreaFloor, allExposed, allFloors; plug-in component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

# ----
# OFFICE UNITS
# AS-IS
# All office INTERNAL LOAD parameters are based on DEFAULT midriseapartment:office schedule
panel_406 = Panel("0")
setepzoneloads = Honeybee_SetEnergyPlusZoneLoads(
    HBZones=setepzoneschedules_3.HBZones,
    equipmentLoadPerArea=geteploads.equipmentLoadPerArea,
    infilRatePerArea_Facade=ach2m3_s_m2_calculator_2.infPerAreaFacade,
    lightingDensityPerArea=geteploads.lightingDensityPerArea,
    numOfPeoplePerArea=geteploads.numOfPeoplePerArea,
    ventilationPerArea=geteploads.ventilationPerArea,
    ventilationPerPerson=geteploads.ventilationPerPerson,
    recirculatedAirPerArea=panel_406)  # -> loads, flatten(HBZones); plug-in component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

conditionedunconditioned_2 = Honeybee_SeparateConditionedAndUnconditionedZones(HBZones=flatten(solveadjc.HBZonesWADJ))  # -> conditionedZones, unconditionedZones; disabled; plug-in component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
panel_407 = Panel("Unconditioned Adjacent Zone")

# ----
# indices of all residentials
listdexs_8 = ListIndices(List=geo_69)
dispatch_47 = Dispatch(List=listdexs_8, DispatchPattern=equals_35.Equality)  # -> ListA, ListB

# ----
# .csv recordings
panel_408 = Panel("#ofResUnits")
lng_61 = ListLength(List=item_99)
dup_35 = DuplicateData(Data=geteploads_2.equipmentLoadPerArea, Number=lng_61, Order=True)

panel_409 = Panel("# of residential units")
lng_62 = ListLength(List=dispatch_46.ListB)

lng_63 = ListLength(List=item_99)

# ----
# .csv recordings
# AS-IS V1
# LIGHTING DENSITY
data_153 = Data(geteploads_2.lightingDensityPerArea)
dup_36 = DuplicateData(Data=data_153, Number=lng_63, Order=True)

# ----
# # of people
dup_37 = DuplicateData(Data=geteploads_2.numOfPeoplePerArea, Number=lng_62, Order=True)
weave_49 = Weave(
    Pattern=list,
    Stream0=dup_37,
    Stream1=flatten(data_126),
    Stream2=flatten(dup_37),
    Stream3=flatten(data_126),
    NullGaps=False)

# ----
# GENERATED
# LIGHTING DENSITY
panel_411 = Panel("Lighting Density")
weave_50 = Weave(
    Pattern=list,
    Stream0=dup_36,
    Stream1=flatten(data_125),
    Stream2=flatten(dup_36),
    Stream3=flatten(data_125),
    NullGaps=False)

# ----
# x
# x
# x
# x
# x
# x
# x
# x
# x
# x
# x
# x
# x
# x
# x
# x
# x
# x
# x
# x
# x
# x
# x
# x
# x
# x
# x
# 
# x
# x
# x
# x
# x
# x
# 
# x
# x
# x
# x
# x
# 
# x
# x
# x
# x
# x
# x
# 
# x
# x
# x
# x
# x
# x
# x
# x
# x
# x
# x
# x
# x
# x
# x
# x
# x
# x
# x
# x
# x
# x
# x
# x
# x
# x
# x
# x
# x
# x
# x
# 
# x
# x
# x
# x
# x
# x
# 
# x
# x
# x
# x
# x
# 
# x
# x
# x
# x
# x
# x
# 
# x
# x
# x
# x
# equipmentDensity
weave_51 = Weave(
    Pattern=list,
    Stream0=dup_35,
    Stream1=flatten(data_124),
    Stream2=flatten(dup_35),
    Stream3=flatten(data_124),
    NullGaps=False)

# ----
# RESIDENTIAL UNITS
setepzoneloads_2 = Honeybee_SetEnergyPlusZoneLoads(
    HBZones=dispatch_46.ListB,
    equipmentLoadPerArea=weave_51,
    infilRatePerArea_Facade=ach2m3_s_m2_calculator_2.infPerAreaFacade,
    lightingDensityPerArea=weave_50,
    numOfPeoplePerArea=weave_49,
    ventilationPerArea=ach2m3_s_m2_calculator_3.ventPerAreaFloor,
    ventilationPerPerson=panel_178,
    recirculatedAirPerArea="0")  # -> loads, flatten(HBZones); plug-in component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

data_154 = Data(weave_36)
replace_25 = ReplaceItems(List=data_154, Item=setepzoneloads_2.HBZones, Indices=dispatch_47.ListB, Wrap=False)
replace_26 = ReplaceItems(List=replace_25, Item=setepzoneloads.HBZones, Indices=dispatch_47.ListA, Wrap=False)

# ----
# exclude intersected surface's zone
# 
# merge all units
# - unconditioned units are always at the end
merge_73 = Merge(Data1=flatten(replace_26), Data2=flatten(conditionedunconditioned_2.unconditionedZones))
null_7 = NullItem(Item=merge_73)  # -> NullFlags, InvalidFlags, Description
dispatch_48 = Dispatch(List=merge_73, DispatchPattern=null_7.NullFlags)  # -> ListA, ListB

# ----
# construction type division,
# masonry or
# concrete
partition_51 = PartitionList(List=data_106, Size=tstat_5.Length)  # -> simplify(Chunks)
cull_i_39 = CullIndex(List=simplify(partition_51), Indices=simplify(data_57), Wrap=True)  # -> simplify(flatten(List))
item_103 = ListItem(List=cull_i_39, Index=data_73, Wrap=True)
equals_37 = Equality(FirstNumber=item_103, SecondNumber="0")  # -> Equality, Inequality
dispatch_49 = Dispatch(List=dispatch_48.ListB, DispatchPattern=equals_37.Equality)  # -> ListA, ListB

# ----
# if buildings' construction type concrete
geo_72 = Geometry(dispatch_49.ListB)

# ----
# if buildings' construction type masonry
geo_73 = Geometry(dispatch_49.ListA)

# ----
# UNITS
data_155 = Data(flatten(weave_49))
panel_412 = Panel("TUIK")
tuık = Data(data_126)

data_156 = Data(weave_36)
python_34 = GhPythonScript(x=data_156, y=tuık, z=data_89)  # -> out, a
# ---------- python_34: Python ----------
__author__ = "orcun"
__version__ = "2022.03.30"

import rhinoscriptsyntax as rs
if x == 1:
    a = z
else:
    a = y
# ---------- end python_34 ----------

# ----
# residential: # of people per sqm
data_157 = Data(weave_49)

equals_38 = Equality(FirstNumber=data_156, SecondNumber="1")  # -> Equality, Inequality
dispatch_50 = Dispatch(List=python_34.a, DispatchPattern=equals_38.Equality)  # -> ListA, ListB

# ----
# LightingDensity of
# residential Units (kWh/sqm)
data_158 = Data(weave_50)

# ----
# indices of all residentials
listdexs_9 = ListIndices(List=geo_69)
dispatch_51 = Dispatch(List=listdexs_9, DispatchPattern=equals_35.Equality)  # -> ListA, ListB

# ----
# Heating set point of Residentials
data_159 = Data(weave_47)

# ----
# indices of all residentials
listdexs_10 = ListIndices(List=geo_69)
dispatch_52 = Dispatch(List=listdexs_10, DispatchPattern=equals_35.Equality)  # -> ListA, ListB

replace_27 = ReplaceItems(List=data_117, Item=data_97, Indices=dispatch_51.ListA, Wrap=False)
replace_28 = ReplaceItems(List=replace_27, Item=data_159, Indices=dispatch_51.ListB, Wrap=False)

replace_29 = ReplaceItems(List=data_118, Item=data_98, Indices=dispatch_52.ListA, Wrap=False)

# ----
# Heating Set Point
panel_414 = Panel("cullOfficeUnits")
equals_39 = Equality(FirstNumber=data_115, SecondNumber="1")  # -> Equality, Inequality
dispatch_53 = Dispatch(List=replace_28, DispatchPattern=equals_39.Equality)  # -> ListA, ListB

# ----
# Cooling Set Point
replace_30 = ReplaceItems(List=replace_29, Item=data_127, Indices=dispatch_52.ListB, Wrap=False)

# ----
# Equipment Density of
# residential Units (kWh/sqm)
data_160 = Data(weave_51)

equals_40 = Equality(FirstNumber=data_115, SecondNumber="1")  # -> Equality, Inequality
dispatch_54 = Dispatch(List=replace_30, DispatchPattern=equals_40.Equality)  # -> ListA, ListB

# ----
# Insulated
# Flat roof
# Ankara
base_2 = Panel("0.121445")
epopaquemat_4 = Honeybee_EnergyPlusOpaqueMaterial(
    name="MetalRoofing",
    roughness="MediumSmooth",
    thickness="0.0015",
    conductivity="45.006",
    density="7680",
    specificHeat="418.4",
    thermAbsp="0.9",
    solAbsp="0.6",
    visAbsp="0.6")  # -> EPMaterial; plug-in component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
epopaquemat_5 = Honeybee_EnergyPlusOpaqueMaterial(name="Alci siva", thickness="0.02", conductivity="0.51", density="1200", specificHeat="1090")  # -> EPMaterial; plug-in component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
epopaquemat_6 = Honeybee_EnergyPlusOpaqueMaterial(name="Betonarme", thickness="0.12", conductivity="2.5", density="2400", specificHeat="840")  # -> EPMaterial; plug-in component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

panel_416 = Panel("conductivityOfInsulationMaterial")
data_161 = Data("0.04")

# ----
# R value summation for all other lements of the construction
decomposeepmaterial = Honeybee_DecomposeEPMaterial(materialName=simplify("Betonarme"))  # -> names, values, comments, UValue_SI, UValue_IP, RValue_SI, RValue_IP; plug-in component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
decomposeepmaterial_2 = Honeybee_DecomposeEPMaterial(materialName=simplify("Alci siva"))  # -> names, values, comments, UValue_SI, UValue_IP, RValue_SI, RValue_IP; plug-in component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

merge_74 = Merge(Data2=decomposeepmaterial.RValue_SI, Data3=decomposeepmaterial_2.RValue_SI)
ma_6 = MassAddition(Input=merge_74)  # -> Result, PartialResults

division_15 = Division(A="1", B=data_74)
subtraction_4 = Subtraction(A=division_15, B=ma_6.Result)
multiplication_9 = Multiplication(A=subtraction_4, B=data_161)

data_162 = Data(multiplication_9)
weave_52 = Weave(Pattern=list, Stream0=base_2, Stream1=base_2, Stream2=data_162, Stream3=data_162, NullGaps=False)
epopaquemat_7 = Honeybee_EnergyPlusOpaqueMaterial(name="Cam yunu cati yalitim", thickness=weave_52, conductivity="0.04", density="18", specificHeat="1030")  # -> EPMaterial; plug-in component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
epconstruction_3 = Honeybee_EnergyPlusConstruction(name=weave_30, layer_1=epopaquemat_4, layer_2=epopaquemat_7, layer_3=epopaquemat_6, layer_4=epopaquemat_5)  # -> EPConstruction; plug-in component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

thickness_of_insulation_material = Panel(multiplication_9)

panel_417 = Panel("thickness for u-Roof")
weave_53 = Weave(Pattern=list, Stream0=base_2, Stream1=base_2, Stream2=data_162, Stream3=data_162, NullGaps=False)

# ----
# Thickness of Insulation Material
base_3 = Panel("0.0477")

# ----
# Ankara
# External wall
panel_418 = Panel("dis siva cimento esasli")
epopaquemat_8 = Honeybee_EnergyPlusOpaqueMaterial(name="ic siva alci esasli", thickness="0.02", conductivity="0.51", density="1200", specificHeat="1090")  # -> EPMaterial; plug-in component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
epopaquemat_9 = Honeybee_EnergyPlusOpaqueMaterial(name=panel_418, thickness="0.03", conductivity="1.6", density="2000", specificHeat="840")  # -> EPMaterial; plug-in component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
epopaquemat_10 = Honeybee_EnergyPlusOpaqueMaterial(name="yatay delikli tugla", thickness="0.135", conductivity="0.33", density="600", specificHeat="900")  # -> EPMaterial; plug-in component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

# ----
# R value summation for all other lements of the construction
decomposeepmaterial_3 = Honeybee_DecomposeEPMaterial(materialName=simplify("ic siva alci esasli"))  # -> names, values, comments, UValue_SI, UValue_IP, RValue_SI, RValue_IP; plug-in component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
decomposeepmaterial_4 = Honeybee_DecomposeEPMaterial(materialName=simplify(panel_418))  # -> names, values, comments, UValue_SI, UValue_IP, RValue_SI, RValue_IP; plug-in component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
decomposeepmaterial_5 = Honeybee_DecomposeEPMaterial(materialName=simplify("yatay delikli tugla"))  # -> names, values, comments, UValue_SI, UValue_IP, RValue_SI, RValue_IP; plug-in component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

merge_75 = Merge(Data1=decomposeepmaterial_4.RValue_SI, Data2=decomposeepmaterial_5.RValue_SI, Data3=decomposeepmaterial_3.RValue_SI)
ma_7 = MassAddition(Input=merge_75)  # -> Result, PartialResults

data_163 = Data("0.035")

division_16 = Division(A="1", B=data_75)
subtraction_5 = Subtraction(A=division_16, B=ma_7.Result)
multiplication_10 = Multiplication(A=subtraction_5, B=data_163)

data_164 = Data(multiplication_10)

panel_420 = Panel("thickness for u-Wall")
# Versions
weave_54 = Weave(Pattern=list, Stream0=base_3, Stream1=base_3, Stream2=data_164, Stream3=data_164, NullGaps=False)

thickness_of_insulation_material_2 = Panel(multiplication_10)

data_165 = Data("0.035")

# ----
# 07.CONSTRUCTION
# FOR ENERGY MODELING
weave_55 = Weave(Pattern=list, Stream0=base_3, Stream1=base_3, Stream2=data_164, Stream3=data_164, NullGaps=False)
rvalueairfilms_2 = Honeybee_RValueWithAirFilms(uValue_SI=decomposeepconstruction_2.UValue_SI, surfaceType="3")  # -> UValue_SI_wAir, UValue_IP_wAir, RValue_SI_wAir, RValue_IP_wAir; plug-in component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
base_4 = Panel("0.121445")

epopaquemat_11 = Honeybee_EnergyPlusOpaqueMaterial(name="EPS", thickness=weave_55, conductivity="0.035", density="22", specificHeat="1500")  # -> EPMaterial; plug-in component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
epconstruction_4 = Honeybee_EnergyPlusConstruction(name=weave_31, layer_1=epopaquemat_9, layer_2=epopaquemat_11, layer_3=epopaquemat_10, layer_4=epopaquemat_8)  # -> EPConstruction; plug-in component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

# ----
# U-value-GroundFloor of Building
lng_64 = ListLength(List=weave_36)
data_166 = Data(rvalueairfilms_2.UValue_SI_wAir)
dup_38 = DuplicateData(Data=data_166, Number=lng_64, Order=True)

equals_41 = Equality(FirstNumber=data_115, SecondNumber="1")  # -> Equality, Inequality
dispatch_55 = Dispatch(List=dup_38, DispatchPattern=equals_41.Equality)  # -> ListA, ListB

# ----
# thickness for Ground Floor
base_5 = Panel("0.058774")

decomposeepconstruction_4 = Honeybee_DecomposeEPConstruction(cnstrName=weave_31)  # -> materials, comments, UValue_SI, UValue_IP, RValue_SI, RValue_IP; plug-in component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

rvalueairfilms_3 = Honeybee_RValueWithAirFilms(uValue_SI=decomposeepconstruction_4.UValue_SI, surfaceType="0")  # -> UValue_SI_wAir, UValue_IP_wAir, RValue_SI_wAir, RValue_IP_wAir; plug-in component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

panel_423 = Panel(rvalueairfilms_3.UValue_SI_wAir)

decomposeepconstruction_5 = Honeybee_DecomposeEPConstruction(cnstrName=weave_32)  # -> materials, comments, UValue_SI, UValue_IP, RValue_SI, RValue_IP; plug-in component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

# ----
# V1-Masonry Construction Set
# V1-Concrete Construction Set
setepzonecnstr = Honeybee_SetEPZoneConstruction(HBZones=flatten(geo_72), wallEPConstruction=epconstruction_4, roofEPConstruction=epconstruction_3)  # -> simplify(modifiedHBZones); plug-in component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

rvalueairfilms_4 = Honeybee_RValueWithAirFilms(uValue_SI=decomposeepconstruction_5.UValue_SI, surfaceType="0")  # -> UValue_SI_wAir, UValue_IP_wAir, RValue_SI_wAir, RValue_IP_wAir; plug-in component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

panel_424 = Panel(rvalueairfilms_4.UValue_SI_wAir)

python_35 = GhPythonScript(x=equals_37.Equality)  # -> out, a
# ---------- python_35: Python ----------
__author__ = "orcun"
__version__ = "2022.05.06"

import rhinoscriptsyntax as rs
#0: masonry
#1: concrete
if x == True:
    a = 0
else:
    a = 1
# ---------- end python_35 ----------
panel_425 = Panel("""0: masonry
1: concrete""")
weave_56 = Weave(Pattern=python_35.a, Stream0=rvalueairfilms_4.UValue_SI_wAir, Stream1=rvalueairfilms_3.UValue_SI_wAir, NullGaps=False)

# ----
# references: https://docs.google.com/spreadsheets/d/1WwH0E2wul-ns8CfgSEfoPrmkpj9kjO-c/edit#gid=1172685997
# Thickness of Insulation Material
base_6 = Panel("0.05")

epopaquemat_12 = Honeybee_EnergyPlusOpaqueMaterial(name="externalPlaster", thickness="0.02", conductivity="0.721", density="1762", specificHeat="840")  # -> EPMaterial; plug-in component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
epopaquemat_13 = Honeybee_EnergyPlusOpaqueMaterial(name="internalPlaster", thickness="0.02", conductivity="0.51", density="1200", specificHeat="840")  # -> EPMaterial; plug-in component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
epopaquemat_14 = Honeybee_EnergyPlusOpaqueMaterial(name="solidBrick", thickness="0.2", conductivity="0.5", density="1200", specificHeat="800")  # -> EPMaterial; plug-in component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

# ----
# R value summation for all other lements of the construction
decomposeepmaterial_6 = Honeybee_DecomposeEPMaterial(materialName=simplify("internalPlaster"))  # -> names, values, comments, UValue_SI, UValue_IP, RValue_SI, RValue_IP; plug-in component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
decomposeepmaterial_7 = Honeybee_DecomposeEPMaterial(materialName=simplify("externalPlaster"))  # -> names, values, comments, UValue_SI, UValue_IP, RValue_SI, RValue_IP; plug-in component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
decomposeepmaterial_8 = Honeybee_DecomposeEPMaterial(materialName=simplify("solidBrick"))  # -> names, values, comments, UValue_SI, UValue_IP, RValue_SI, RValue_IP; plug-in component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

merge_76 = Merge(Data1=decomposeepmaterial_7.RValue_SI, Data2=decomposeepmaterial_8.RValue_SI, Data3=decomposeepmaterial_6.RValue_SI)
ma_8 = MassAddition(Input=merge_76)  # -> Result, PartialResults

data_167 = Data("0.035")

division_17 = Division(A="1", B=data_76)
subtraction_6 = Subtraction(A=division_17, B=ma_8.Result)
multiplication_11 = Multiplication(A=subtraction_6, B=data_167)

data_168 = Data(multiplication_11)

thickness_of_insulation_material_3 = Panel(multiplication_11)

weave_57 = Weave(Pattern=list, Stream0=base_6, Stream1=base_6, Stream2=data_168, Stream3=data_168, NullGaps=False)

epopaquemat_15 = Honeybee_EnergyPlusOpaqueMaterial(name="EPS", thickness=weave_57, conductivity="0.035", density="22", specificHeat="1400")  # -> EPMaterial; plug-in component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
epconstruction_5 = Honeybee_EnergyPlusConstruction(name=weave_32, layer_1=epopaquemat_12, layer_2=epopaquemat_15, layer_3=epopaquemat_14, layer_4=epopaquemat_13)  # -> EPConstruction; plug-in component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

# ----
# Ground Floor
panel_427 = Panel("kece polyester")
epopaquemat_16 = Honeybee_EnergyPlusOpaqueMaterial(name=panel_427, thickness="0.003", conductivity="0.19", density="25", specificHeat="1500")  # -> EPMaterial; plug-in component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
epopaquemat_17 = Honeybee_EnergyPlusOpaqueMaterial(name="koruma sapi", thickness="0.05", conductivity="1.4", density="2000", specificHeat="837")  # -> EPMaterial; plug-in component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
epopaquemat_18 = Honeybee_EnergyPlusOpaqueMaterial(name="laminant parke", thickness="0.008", conductivity="0.115", density="938", specificHeat="1600")  # -> EPMaterial; plug-in component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
epopaquemat_19 = Honeybee_EnergyPlusOpaqueMaterial(name="Dolgu cakil", thickness="0.1", conductivity="2.0", density="2000", specificHeat="840")  # -> EPMaterial; plug-in component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
epopaquemat_20 = Honeybee_EnergyPlusOpaqueMaterial(name="Su yalitimi", thickness="0.003", conductivity="0.19", density="3000", specificHeat="780")  # -> EPMaterial; plug-in component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
epopaquemat_21 = Honeybee_EnergyPlusOpaqueMaterial(name="Grobeton", thickness="0.1", conductivity="1.65", density="2200", specificHeat="860")  # -> EPMaterial; plug-in component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
epopaquemat_22 = Honeybee_EnergyPlusOpaqueMaterial(name="Koruma betonu", thickness="0.1", conductivity="1.65", density="2200", specificHeat="860")  # -> EPMaterial; plug-in component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

# ----
# R value summation for all other lements of the construction
decomposeepmaterial_9 = Honeybee_DecomposeEPMaterial(materialName=simplify("Su yalitimi"))  # -> names, values, comments, UValue_SI, UValue_IP, RValue_SI, RValue_IP; plug-in component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
decomposeepmaterial_10 = Honeybee_DecomposeEPMaterial(materialName=simplify("Dolgu cakil"))  # -> names, values, comments, UValue_SI, UValue_IP, RValue_SI, RValue_IP; plug-in component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
decomposeepmaterial_11 = Honeybee_DecomposeEPMaterial(materialName=simplify("XPS"))  # -> names, values, comments, UValue_SI, UValue_IP, RValue_SI, RValue_IP; plug-in component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
decomposeepmaterial_12 = Honeybee_DecomposeEPMaterial(materialName=simplify("Grobeton"))  # -> names, values, comments, UValue_SI, UValue_IP, RValue_SI, RValue_IP; plug-in component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
decomposeepmaterial_13 = Honeybee_DecomposeEPMaterial(materialName=simplify(panel_427))  # -> names, values, comments, UValue_SI, UValue_IP, RValue_SI, RValue_IP; plug-in component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
decomposeepmaterial_14 = Honeybee_DecomposeEPMaterial(materialName=simplify("laminant parke"))  # -> names, values, comments, UValue_SI, UValue_IP, RValue_SI, RValue_IP; plug-in component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
decomposeepmaterial_15 = Honeybee_DecomposeEPMaterial(materialName=simplify("Koruma betonu"))  # -> names, values, comments, UValue_SI, UValue_IP, RValue_SI, RValue_IP; plug-in component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
decomposeepmaterial_16 = Honeybee_DecomposeEPMaterial(materialName=simplify("koruma sapi"))  # -> names, values, comments, UValue_SI, UValue_IP, RValue_SI, RValue_IP; plug-in component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

merge_77 = Merge(
    Data1=decomposeepmaterial_10.RValue_SI,
    Data2=decomposeepmaterial_12.RValue_SI,
    Data3=decomposeepmaterial_9.RValue_SI,
    Data4=decomposeepmaterial_15.RValue_SI,
    Data5=decomposeepmaterial_11.RValue_SI,
    Data6=decomposeepmaterial_13.RValue_SI,
    Data7=decomposeepmaterial_16.RValue_SI,
    Data8=decomposeepmaterial_14.RValue_SI)
ma_9 = MassAddition(Input=merge_77)  # -> Result, PartialResults

division_18 = Division(A="1", B=data_80)
subtraction_7 = Subtraction(A=division_18, B=ma_9.Result)
multiplication_12 = Multiplication(A=subtraction_7, B=data_165)

weave_58 = Weave(Pattern=list, Stream0=base_5, Stream1=base_5, Stream2=multiplication_12, Stream3=multiplication_12, NullGaps=False)

epopaquemat_23 = Honeybee_EnergyPlusOpaqueMaterial(name="XPS", thickness=weave_58, conductivity="0.035", density="25", specificHeat="1200")  # -> EPMaterial; plug-in component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
epconstruction_6 = Honeybee_EnergyPlusConstruction(
    name=weave_33,
    layer_1=epopaquemat_19,
    layer_2=epopaquemat_21,
    layer_3=epopaquemat_20,
    layer_4=epopaquemat_22,
    layer_5=epopaquemat_23,
    layer_6=epopaquemat_16,
    layer_7=epopaquemat_17,
    layer_8=epopaquemat_18)  # -> EPConstruction; plug-in component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

thickness_of_insulation_material_4 = Panel(multiplication_12)

# ----
# Internal Mass Calculation
md_slider_6 = MDSlider(SliderMode=0, slider_value=Point(0.5, 0.5, 0.5), x_domain=Domain(0, 1), y_domain=Domain(0, 1), z_domain=Domain(0, 1))
panel_428 = Panel("""0
2""")
floor_height_6 = Panel("3")

division_19 = Division(A="1", B=data_77)

decomposeepconstruction_6 = Honeybee_DecomposeEPConstruction(cnstrName=weave_34)  # -> materials, comments, UValue_SI, UValue_IP, RValue_SI, RValue_IP; plug-in component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

rvalueairfilms_5 = Honeybee_RValueWithAirFilms(uValue_SI=decomposeepconstruction_6.UValue_SI, surfaceType="2")  # -> UValue_SI_wAir, UValue_IP_wAir, RValue_SI_wAir, RValue_IP_wAir; plug-in component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

panel_430 = Panel(rvalueairfilms_5.UValue_SI_wAir)

python_36 = GhPythonScript(x=equals_37.Equality)  # -> out, a; same code as python_35
weave_59 = Weave(Pattern=python_36.a, Stream0=rvalueairfilms_5.UValue_SI_wAir, Stream1=rvalueairfilms.UValue_SI_wAir, NullGaps=False)

# ----
# references: https://docs.google.com/spreadsheets/d/1WwH0E2wul-ns8CfgSEfoPrmkpj9kjO-c/edit#gid=1172685997
panel_432 = Panel("reinforcedConcrete")
panel_433 = Panel("0.08")
epopaquemat_24 = Honeybee_EnergyPlusOpaqueMaterial(name=panel_432, thickness="0.12", conductivity="2.5", density="2400", specificHeat="860")  # -> EPMaterial; plug-in component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
epopaquemat_25 = Honeybee_EnergyPlusOpaqueMaterial(name="externalPlaster", thickness="0.02", conductivity="0.721", density="1762", specificHeat="840")  # -> EPMaterial; plug-in component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
epopaquemat_26 = Honeybee_EnergyPlusOpaqueMaterial(name="interPlaster", thickness="0.02", conductivity="0.51", density="1200", specificHeat="840")  # -> EPMaterial; plug-in component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

# ----
# R value summation for all other lements of the construction
decomposeepmaterial_17 = Honeybee_DecomposeEPMaterial(materialName=simplify("interPlaster"))  # -> names, values, comments, UValue_SI, UValue_IP, RValue_SI, RValue_IP; plug-in component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
decomposeepmaterial_18 = Honeybee_DecomposeEPMaterial(materialName=simplify("externalPlaster"))  # -> names, values, comments, UValue_SI, UValue_IP, RValue_SI, RValue_IP; plug-in component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
decomposeepmaterial_19 = Honeybee_DecomposeEPMaterial(materialName=simplify(panel_432))  # -> names, values, comments, UValue_SI, UValue_IP, RValue_SI, RValue_IP; plug-in component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

merge_78 = Merge(Data1=decomposeepmaterial_18.RValue_SI, Data2=decomposeepmaterial_19.RValue_SI, Data3=decomposeepmaterial_17.RValue_SI)
ma_10 = MassAddition(Input=merge_78)  # -> Result, PartialResults

data_169 = Data("0.04")

subtraction_8 = Subtraction(A=division_19, B=ma_10.Result)
multiplication_13 = Multiplication(A=subtraction_8, B=data_169)

# ----
# u-valueCalculationofMaterial: Where R = Material Thickness (m) ÷ Thermal Conductivity (W/mK)
# 
# 
# https://www.tatasteeleurope.com/construction/blogs-news/blogs/blog/how-to-calculate-the-u-value-of-a-construction
thickness_of_insulation_material_5 = Panel(multiplication_13)

data_170 = Data(multiplication_13)

weave_60 = Weave(Pattern=list, Stream0=base_4, Stream1=base_4, Stream2=data_170, Stream3=data_170, NullGaps=False)

epopaquemat_27 = Honeybee_EnergyPlusOpaqueMaterial(name="glassWool", thickness=weave_60, conductivity="0.04", density="18", specificHeat="670")  # -> EPMaterial; plug-in component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
epconstruction_7 = Honeybee_EnergyPlusConstruction(name=weave_34, layer_1=epopaquemat_25, layer_2=epopaquemat_27, layer_3=epopaquemat_24, layer_4=epopaquemat_26)  # -> EPConstruction; plug-in component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

setepzonecnstr_2 = Honeybee_SetEPZoneConstruction(HBZones=flatten(geo_73), wallEPConstruction=epconstruction_5, roofEPConstruction=epconstruction_7)  # -> simplify(modifiedHBZones); plug-in component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
merge_79 = Merge(Data1=setepzonecnstr_2, Data2=setepzonecnstr)  # -> flatten(Result)
null_8 = NullItem(Item=merge_79)  # -> NullFlags, InvalidFlags, Description
dispatch_56 = Dispatch(List=merge_79, DispatchPattern=null_8.NullFlags)  # -> ListA, ListB
setepzoneundergroundcnstr = Honeybee_SetEPZoneUndergroundConstruction(HBZones=dispatch_56.ListB, groundFloorEPConstruction=epconstruction_6)  # -> simplify(modifiedHBZones); plug-in component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
setepzoneintcnstr = Honeybee_SetEPZoneInteriorConstruction(HBZones=setepzoneundergroundcnstr, intWallEPConstruction=epconstruction)  # -> simplify(modifiedHBZones); plug-in component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
conditionedunconditioned_3 = Honeybee_SeparateConditionedAndUnconditionedZones(HBZones=flatten(setepzoneintcnstr))  # -> conditionedZones, unconditionedZones; plug-in component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

conditionedunconditioned_4 = Honeybee_SeparateConditionedAndUnconditionedZones(HBZones=flatten(dispatch_56.ListB))  # -> conditionedZones, unconditionedZones; plug-in component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
panel_434 = Panel("simulated thermal zones")

lng_65 = ListLength(List=dispatch_56.ListB)
data_171 = Data(filename)
dup_39 = DuplicateData(Data=data_171, Number=lng_65, Order=True)
rec = DataRecorder(dup_39, DataLimit=-10, RecordData=True)
panel_435 = Panel(rec)

debrep_6 = DeconstructBrep(Brep=conditionedunconditioned_3.conditionedZones)  # -> Faces, Edges, Vertices
item_104 = ListItem(List=debrep_6.Faces, Index=0, Wrap=True)  # -> simplify(graft(Item))
evalsrf_3 = EvaluateSurface(Surface=item_104, Point=md_slider_6)  # -> Point, Normal, UDirection, VDirection, Frame
brec_6 = BoundingRectangle(Geometry=item_104, Plane=evalsrf_3.Frame, Axis=0, Slide=0, Union=True)  # -> Bounding, DimensionX, DimensionY
debrep_7 = DeconstructBrep(Brep=brec_6.Bounding)  # -> Faces, Edges, Vertices
shift_5 = ShiftList(List=debrep_7.Edges, Shift=1, Wrap=True)
item_105 = ListItem(List=debrep_7.Edges, Index=panel_428, Wrap=True)  # -> simplify(Item)
item_106 = ListItem(List=shift_5, Index=panel_428, Wrap=True)  # -> simplify(Item)
curvepoint_4 = PointOnCurve(item_105, parameter=0.5)
curvepoint_5 = PointOnCurve(item_106, parameter=0.5)
item_107 = ListItem(List=curvepoint_4, Index=1, Wrap=True)
item_108 = ListItem(List=curvepoint_5, Index=0, Wrap=True)
item_109 = ListItem(List=curvepoint_5, Index=1, Wrap=True)
item_110 = ListItem(List=curvepoint_4, Index=0, Wrap=True)
ln_3 = Line(StartPoint=item_108, EndPoint=item_109)  # -> simplify(Line)
ln_4 = Line(StartPoint=item_110, EndPoint=item_107)  # -> simplify(Line)
len_2 = Length(Curve=ln_3)  # -> simplify(Length)
len_3 = Length(Curve=ln_4)
division_20 = Division(A=simplify(len_2), B="2")  # -> simplify(Result)

tstat_18 = TreeStatistics(Tree=simplify(len_3))  # -> Paths, Length, Count
tstat_19 = TreeStatistics(Tree=simplify(division_20))  # -> Paths, Length, Count
panel_436 = Panel("replace Path")
replace_31 = ReplacePaths(Data=division_20, Search=tstat_19.Paths, Replace=tstat_18.Paths)

merge_80 = Merge(Data1=simplify(len_3), Data2=simplify(replace_31))  # -> simplify(Result)
ma_11 = MassAddition(Input=merge_80)  # -> Result, PartialResults
multiplication_14 = Multiplication(A=ma_11.Result, B=floor_height_6)  # -> flatten(Result)

# ----
# internal Mass Added Units
addinternalmass = Honeybee_AddInternalMassToZone(HBZones=conditionedunconditioned_3.conditionedZones, srfsOrSrfArea=multiplication_14, EPConstruction=epconstruction)  # -> readMe, HBZones; plug-in component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
merge_81 = Merge(Data1=flatten(addinternalmass.HBZones), Data2=flatten(conditionedunconditioned_3.unconditionedZones))

null_9 = NullItem(Item=merge_81)  # -> NullFlags, InvalidFlags, Description
dispatch_57 = Dispatch(List=merge_81, DispatchPattern=null_9.NullFlags)  # -> ListA, ListB

conditionedunconditioned_5 = Honeybee_SeparateConditionedAndUnconditionedZones(HBZones=flatten(dispatch_57.ListB))  # -> conditionedZones, unconditionedZones; plug-in component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

conditionedunconditioned_6 = Honeybee_SeparateConditionedAndUnconditionedZones(HBZones=flatten(dispatch_57.ListB))  # -> conditionedZones, unconditionedZones; plug-in component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

conditionedunconditioned_7 = Honeybee_SeparateConditionedAndUnconditionedZones(HBZones=flatten(dispatch_57.ListB))  # -> simplify(conditionedZones), unconditionedZones; plug-in component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
decomposebytype = Honeybee_DecomposeBasedOnType(HBZone=conditionedunconditioned_7.conditionedZones)  # -> walls, interiorWalls, airWalls, simplify(windows), interiorWindows, skylights, simplify(roofs), simplify(ceilings)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; plug-in component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

# ----
# x
# x
# x
# x
# x
# x
# x
# x
# x
# x
# x
# x
# x
# x
# x
# x
# x
# x
# x
# x
# x
# x
# x
# x
# x
# x
# x
# 
# x
# x
# x
# x
# x
# x
# 
# x
# x
# x
# x
# x
# 
# x
# x
# x
# x
# x
# x
# 
# x
# x
# x
# x
panel_439 = Panel("conditioned zones")
data_172 = Data(conditionedunconditioned_7.conditionedZones)
decomposebytype_2 = Honeybee_DecomposeBasedOnType(HBZone=data_172)  # -> walls, interiorWalls, airWalls, simplify(windows), interiorWindows, skylights, simplify(roofs), simplify(ceilings)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; plug-in component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

area_42 = Area(Geometry=decomposebytype_2.windows)  # -> Area, Centroid
evalsrf_4 = EvaluateSurface(Surface=decomposebytype_2.windows, Point=area_42.Centroid)  # -> Point, Normal, UDirection, VDirection, Frame
vec = Vector(evalsrf_4.Normal)
vdis = VectorDisplay(Anchor=area_42.Centroid, Vector=vec)

area_43 = Area(Geometry=decomposebytype_2.windows)  # -> Area, Centroid
circle_2 = CircleCNR(Center=area_43.Centroid, Normal=vec, Radius=1)
rotate = RotateDirection(Geometry=circle_2, Center=area_43.Centroid, From=Vector(1, 0, 0), To=Vector(0, 1, 0))  # -> Geometry, Transform
line = LineSDL(Start=area_42.Centroid, Direction=vec, Length=1)
rotax = RotateAxis(Geometry=rotate.Geometry, Angle=degrees("90"), Axis=line)  # -> Geometry, Transform
area_44 = Area(Geometry=rotax.Geometry)  # -> Area, Centroid

srf_3 = Surface(decomposebytype_2.windows)
split_23 = SplitWithBreps(Curve=rotax.Geometry, Brep=srf_3)  # -> Curve, Points
divide_5 = DivideCurve(Curve=split_23.Curve, Count="13", Kinks=False)  # -> Points, Tangents, Parameters
pshift = ShiftPaths(Data=divide_5.Points, Offset=-1)
brepsinc = PointInBreps(Brep=conditionedunconditioned_7.conditionedZones, Point=pshift, Strict=False)  # -> Inside, Index
dispatch_58 = Dispatch(List=pshift, DispatchPattern=brepsinc.Inside)  # -> ListA, ListB

lng_66 = ListLength(List=flatten(conditionedunconditioned_7.conditionedZones))
panel_440 = Panel("#OfUnits")
dup_40 = DuplicateData(Data="0", Number=lng_66, Order=True)

lng_67 = ListLength(List=decomposebytype.roofs)  # -> flatten(Length)

lng_68 = ListLength(List=decomposebytype.groundFloors)  # -> flatten(Length)

dup_41 = DuplicateData(Data="0", Number=lng_68, Order=True)  # -> simplify(Data)
dup_42 = DuplicateData(Data="2", Number=lng_67, Order=True)  # -> simplify(Data)
merge_82 = Merge(Data1=dup_42, Data2=dup_41)

lng_69 = ListLength(List=merge_82)  # -> flatten(Length)
# position of units
# (0:base, 1: middle, 2:roof)
rep_2 = ReplaceText(Text=lng_69, Find="3", Replace="0", RecursiveReplace=False)
mindex_9 = MemberIndex(Set=rep_2, Member="0")  # -> Index, Count
lng_70 = ListLength(List=mindex_9.Index)
dup_43 = DuplicateData(Data="3", Number=lng_70, Order=True)
partition_52 = PartitionList(List=dup_43, Size="1")  # -> simplify(Chunks)
tstat_20 = TreeStatistics(Tree=partition_52)  # -> Paths, Length, Count
replace_32 = ReplacePaths(Data=partition_52, Search=tstat_20.Paths, Replace=mindex_9.Index)
python_37 = GhPythonScript(x=replace_32)  # -> out, a; inputs x: Int32
# ---------- python_37: Python ----------
__author__ = "Siser"
__version__ = "2022.03.02"

import rhinoscriptsyntax as rs
if x == 3:
    a = 1
else:
    pass
# ---------- end python_37 ----------

area_45 = Area(Geometry=decomposebytype.windows)  # -> Area, Centroid
panel_441 = Panel("Window")

panel_442 = Panel(area_43.Centroid)
pdecon_13 = Deconstruct(Point=panel_442)  # -> XComponent, YComponent, graft(ZComponent)
panel_443 = Panel(pdecon_13.ZComponent)

tstat_21 = TreeStatistics(Tree=area_45.Centroid)  # -> Paths, Length, Count
series_33 = Series(Start=0, Step=1, Count="4")
lng_71 = ListLength(List=tstat_21.Length)
dup_44 = DuplicateData(Data=series_33, Number=lng_71, Order=True)
partition_53 = PartitionList(List=dup_44, Size="4")  # -> simplify(Chunks)

panel_444 = Panel("conditioned residential units")
geo_74 = Geometry(conditionedunconditioned_7.conditionedZones)

lng_72 = ListLength(List=dup_44)
dup_45 = DuplicateData(Data="5", Number=lng_72, Order=True)
partition_54 = PartitionList(List=dup_45, Size="4")  # -> simplify(Chunks)

debrep_8 = DeconstructBrep(Brep=geo_74)  # -> Faces, Edges, Vertices
item_111 = ListItem(List=debrep_8.Faces, Index=0, Wrap=True)
evalsrf_5 = EvaluateSurface(Surface=reparameterize(item_111), Point="{0.5, 0.5, 0}")  # -> Point, Normal, UDirection, VDirection, Frame
brec_7 = BoundingRectangle(Geometry=item_111, Plane=evalsrf_5.Frame, Axis=0, Slide=0, Union=True)  # -> Bounding, DimensionX, DimensionY

merge_83 = Merge(Data1=merge_82, Data2=python_37.a)  # -> flatten(Result)
panel_445 = Panel(merge_83)
null_10 = NullItem(Item=merge_83)  # -> NullFlags, InvalidFlags, Description
dispatch_59 = Dispatch(List=merge_83, DispatchPattern=null_10.NullFlags)  # -> ListA, ListB

debrep_9 = DeconstructBrep(Brep=brec_7.Bounding)  # -> Faces, simplify(Edges), Vertices
curvepoint_6 = PointOnCurve(debrep_9.Edges, parameter=0.5)
pdecon_14 = Deconstruct(Point=curvepoint_6)  # -> XComponent, YComponent, ZComponent
sort_17 = SortList(Keys=pdecon_14.YComponent, ValuesA=debrep_9.Edges)  # -> Keys, reverse(simplify(ValuesA))
item_112 = ListItem(List=sort_17.ValuesA, Index=0, Wrap=True)
item_113 = ListItem(List=sort_17.ValuesA, Index=1, Wrap=True)
len_4 = Length(Curve=item_112)
len_5 = Length(Curve=item_113)
division_21 = Division(A=len_4, B=len_5)  # -> flatten(Result)

panel_446 = Panel("external Wall")
geo_75 = Geometry(simplify(decomposebytype.walls))

panel_447 = Panel("roof")
geo_76 = Geometry(decomposebytype.roofs)

# ----
# volume of simulated unit
volume = Volume(Geometry=conditionedunconditioned_7.conditionedZones)  # -> Volume, Centroid

merge_84 = Merge(Data1=geo_75, Data2=geo_76)
area_46 = Area(Geometry=merge_84)  # -> Area, Centroid
ma_12 = MassAddition(Input=area_46.Area)  # -> flatten(Result), PartialResults
division_22 = Division(A=ma_12.Result, B=volume.Volume)

panel_448 = Panel("simulation units")
geo_77 = Geometry(dispatch_57.ListB)

zoneattributelist = Honeybee_ZoneAttributeList({"Name": "name", "Zone Program": "zoneProgram", "Zone Floor Area": "zoneFloorArea", "Zone Volume": "zoneVolume", "Building Program": "bldgProgram", "Is Conditioned": "isConditioned", "HVAC System Type": "HVACSystem", "Occupancy Schedule": "occupancySchedule", "Occupancy Activity Schedule": "occupancyActivitySch", "Heating SetPoint Schedule": "heatingSetPtSchedule"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}, selected="Name")
labelzones = Honeybee_LabelZones(HBZones=flatten(geo_77), attribute=zoneattributelist)  # -> zoneTxtLabels, labelBasePts, brepTxtLabels, zoneWireFrames; plug-in component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
decomposebytype_3 = Honeybee_DecomposeBasedOnType(HBZone=geo_77)  # -> simplify(walls), interiorWalls, airWalls, simplify(windows), interiorWindows, skylights, simplify(roofs), simplify(ceilings)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; plug-in component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
preview_25 = CustomPreview(Geometry=decomposebytype_3.walls, Material=ColourSwatch(SwatchColor=RGBA(236, 255, 23, 138)))
preview_26 = CustomPreview(Geometry=decomposebytype_3.windows, Material=ColourSwatch(SwatchColor=RGB(0, 72, 255)))
preview_27 = CustomPreview(Geometry=decomposebytype_3.roofs, Material=ColourSwatch(SwatchColor=RGBA(191, 89, 0, 174)))
preview_28 = CustomPreview(Geometry=decomposebytype_3.interiorWalls, Material=ColourSwatch(SwatchColor=RGB(121, 0, 191)))
preview_29 = CustomPreview(Geometry=decomposebytype_3.groundFloors, Material=ColourSwatch(SwatchColor=RGB(0, 0, 0)))
preview_30 = CustomPreview(Geometry=decomposebytype_3.floors, Material=ColourSwatch(SwatchColor=RGB(48, 191, 0)))

# ----
# IC
debrep_10 = DeconstructBrep(Brep=geo_77)  # -> Faces, Edges, Vertices
area_47 = Area(Geometry=simplify(debrep_10.Faces))  # -> Area, Centroid
pdecon_15 = Deconstruct(Point=area_47.Centroid)  # -> XComponent, YComponent, ZComponent
sort_18 = SortList(Keys=pdecon_15.ZComponent)  # -> Keys, ValuesA
dcon_4 = DeleteConsecutive(Set=sort_18.Keys, Wrap=False)  # -> Set, Count
item_114 = ListItem(List=dcon_4.Set, Index=0, Wrap=True)
equals_42 = Equality(FirstNumber=pdecon_15.ZComponent, SecondNumber=item_114)  # -> Equality, Inequality
dispatch_60 = Dispatch(List=simplify(debrep_10.Faces), DispatchPattern=simplify(equals_42.Equality))  # -> ListA, ListB
sunion_4 = SolidUnion(Breps=dispatch_60.ListA)
disc_14 = Discontinuity(Curve=sunion_4, Level=1)  # -> Points, Parameters
pline_5 = PolyLine(Vertices=disc_14.Points, Closed=Toggle(True))  # -> flatten(Polyline)

panel_449 = Panel("conditioned HBzones")
geo_78 = Geometry(conditionedunconditioned_7.conditionedZones)

debrep_11 = DeconstructBrep(Brep=geo_78)  # -> Faces, Edges, Vertices
item_115 = ListItem(List=debrep_11.Faces, Index=0, Wrap=True)

panel_450 = Panel("simulated units")
geo_79 = Geometry(conditionedunconditioned_7.conditionedZones)

area_48 = Area(Geometry=item_115)  # -> simplify(flatten(Area)), Centroid

# ----
# total # of residential units
lng_73 = ListLength(List=geo_77)

lng_74 = ListLength(List=conditionedunconditioned_7.unconditionedZones)
# extract unConditioned Zones
panel_452 = Panel("1")
series_34 = Series(Start=panel_452, Step=1, Count=lng_74)
neg_2 = Negative(Value=series_34)

# ----
# If there is a single unit in the building
lng_75 = ListLength(List=geo_77)
equals_43 = Equality(FirstNumber=lng_75, SecondNumber="2")  # -> Equality, Inequality
data_173 = Data(flatten(dispatch_59.ListB))
python_38 = GhPythonScript(x=equals_43.Equality)  # -> out, a; inputs x: Boolean
# ---------- python_38: Python ----------
__author__ = "orcun"
__version__ = "2022.04.06"

import rhinoscriptsyntax as rs
if x == True:
    a = 0
else:
    a=1
# ---------- end python_38 ----------
weave_61 = Weave(Pattern=python_38.a, Stream0="0", Stream1=data_173, NullGaps=False)

panel_453 = Panel("# of units")
lng_76 = ListLength(List=conditionedunconditioned_7.conditionedZones)

# ----
# U-value-Wall of Building
# BUILDING
panel_454 = Panel("3")
roundd_5 = RoundToDecimalPlace(NumberX=weave_56, DecimalPlace=panel_454, RoundType=0)  # -> Rounded, Difference
lng_77 = ListLength(List=conditionedunconditioned_7.conditionedZones)
dup_46 = DuplicateData(Data=roundd_5.Rounded, Number=lng_77, Order=True)

# ----
# U-value-Roof of Building
panel_455 = Panel("3")
roundd_6 = RoundToDecimalPlace(NumberX=weave_59, DecimalPlace=panel_455, RoundType=0)  # -> Rounded, Difference
lng_78 = ListLength(List=conditionedunconditioned_7.conditionedZones)
dup_47 = DuplicateData(Data=roundd_6.Rounded, Number=lng_78, Order=True)

# ----
# If there is an one floor with multiple units
python_39 = GhPythonScript(x=item_73, y=lng_76)  # -> out, a; inputs x: Int32, y: Int32
# ---------- python_39: Python ----------
__author__ = "orcun"
__version__ = "2022.04.06"

import rhinoscriptsyntax as rs
if x == 1 and y!=0:
    a = 1
else:
    a=0
# ---------- end python_39 ----------

# ----
# properties of Units
debrep_12 = DeconstructBrep(Brep=conditionedunconditioned_7.conditionedZones)  # -> simplify(Faces), Edges, Vertices
item_116 = ListItem(List=debrep_12.Faces, Index=0, Wrap=True)
area_49 = Area(Geometry=item_116)  # -> flatten(Area), Centroid

equals_44 = Equality(FirstNumber=data_115, SecondNumber="1")  # -> Equality, Inequality
dispatch_61 = Dispatch(List=dup_47, DispatchPattern=equals_44.Equality)  # -> ListA, ListB

equals_45 = Equality(FirstNumber=data_115, SecondNumber="1")  # -> Equality, Inequality
dispatch_62 = Dispatch(List=dup_46, DispatchPattern=equals_45.Equality)  # -> ListA, ListB

dup_48 = DuplicateData(Data="0", Number=lng_76, Order=True)
weave_62 = Weave(Pattern=python_39.a, Stream0=weave_61, Stream1=dup_48, NullGaps=False)

# ----
# Width/Depth ratio of
# Simulated Units
# # of people per sqm
data_174 = Data(division_21)

equals_46 = Equality(FirstNumber=data_115, SecondNumber="1")  # -> Equality, Inequality
dispatch_63 = Dispatch(List=weave_62, DispatchPattern=equals_46.Equality)  # -> ListA, ListB

pdecon_16 = Deconstruct(Point=area_49.Centroid)  # -> XComponent, YComponent, ZComponent
division_23 = Division(A=pdecon_16.ZComponent, B="3")  # -> flatten(Result)

equals_47 = Equality(FirstNumber=data_115, SecondNumber="1")  # -> Equality, Inequality
dispatch_64 = Dispatch(List=data_174, DispatchPattern=equals_47.Equality)  # -> ListA, ListB

panel_460 = Panel("conditioned units")
lng_79 = ListLength(List=conditionedunconditioned_7.conditionedZones)

lng_80 = ListLength(List=conditionedunconditioned_7.conditionedZones)

lng_81 = ListLength(List=conditionedunconditioned_7.conditionedZones)

lng_82 = ListLength(List=conditionedunconditioned_7.conditionedZones)

# ----
# boiler efficiency
data_175 = Data(weave_35)
dup_49 = DuplicateData(Data=data_175, Number=lng_79, Order=True)

# ----
# Infiltration Rate
lng_83 = ListLength(List=conditionedunconditioned_7.conditionedZones)
dup_50 = DuplicateData(Data=weave_48, Number=lng_83, Order=True)

equals_48 = Equality(FirstNumber=data_115, SecondNumber="1")  # -> Equality, Inequality
dispatch_65 = Dispatch(List=division_23, DispatchPattern=equals_48.Equality)  # -> ListA, ListB

# ----
# verticalPosition
# (2:base, 3: middle, 4:roof)
rec_2 = DataRecorder(dispatch_63.ListB, DataLimit=-10, RecordData=True)
panel_465 = Panel(rec_2)

partition_55 = PartitionList(List=data_95, Size=data_90)  # -> simplify(Chunks)
cull_i_40 = CullIndex(List=partition_55, Indices=data_91, Wrap=True)  # -> flatten(List)
item_117 = ListItem(List=cull_i_40, Index=filename, Wrap=True)
lng_84 = ListLength(List=conditionedunconditioned_7.conditionedZones)
dup_51 = DuplicateData(Data=flatten(item_117), Number=lng_84, Order=True)

# ----
# VT Window
dup_52 = DuplicateData(Data=data_93, Number=lng_81, Order=True)

partition_56 = PartitionList(List=data_96, Size=data_90)  # -> simplify(Chunks)
cull_i_41 = CullIndex(List=partition_56, Indices=data_91, Wrap=True)  # -> flatten(List)
item_118 = ListItem(List=cull_i_41, Index=filename, Wrap=True)
lng_85 = ListLength(List=conditionedunconditioned_7.conditionedZones)
dup_53 = DuplicateData(Data=flatten(item_118), Number=lng_85, Order=True)

# ----
# shgc Window
dup_54 = DuplicateData(Data=data_94, Number=lng_82, Order=True)

# ----
# Construction Date
dup_55 = DuplicateData(Data=data_92, Number=lng_80, Order=True)

equals_49 = Equality(FirstNumber=data_115, SecondNumber="1")  # -> Equality, Inequality
dispatch_66 = Dispatch(List=dup_49, DispatchPattern=equals_49.Equality)  # -> ListA, ListB

equals_50 = Equality(FirstNumber=data_115, SecondNumber="1")  # -> Equality, Inequality
dispatch_67 = Dispatch(List=dup_52, DispatchPattern=equals_50.Equality)  # -> ListA, ListB

equals_51 = Equality(FirstNumber=data_115, SecondNumber="1")  # -> Equality, Inequality
dispatch_68 = Dispatch(List=dup_54, DispatchPattern=equals_51.Equality)  # -> ListA, ListB

equals_52 = Equality(FirstNumber=data_115, SecondNumber="1")  # -> Equality, Inequality
dispatch_69 = Dispatch(List=dup_50, DispatchPattern=equals_52.Equality)  # -> ListA, ListB

equals_53 = Equality(FirstNumber=data_115, SecondNumber="1")  # -> Equality, Inequality
dispatch_70 = Dispatch(List=dup_55, DispatchPattern=equals_53.Equality)  # -> ListA, ListB

# ----
# z-axis value of Units
panel_471 = Panel(dispatch_65.ListB)

equals_54 = Equality(FirstNumber=data_115, SecondNumber="1")  # -> Equality, Inequality
dispatch_71 = Dispatch(List=dup_51, DispatchPattern=equals_54.Equality)  # -> ListA, ListB

# ----
# Name of the Version
panel_473 = Panel("p")
merge_85 = Merge(Data1=percentage, Data2=panel_473)
join_42 = TextJoin(Text=merge_85)
lng_86 = ListLength(List=conditionedunconditioned_7.conditionedZones)
dup_56 = DuplicateData(Data=flatten(join_42), Number=lng_86, Order=True)

panel_474 = Panel("""0
1
2
10
12
23
24
25
26
27
28
29
30""")
lng_87 = ListLength(List=dispatch_71.ListB)
dup_57 = DuplicateData(Data=flatten(join_42), Number=lng_87, Order=True)

equals_55 = Equality(FirstNumber=data_115, SecondNumber="1")  # -> Equality, Inequality
dispatch_72 = Dispatch(List=dup_53, DispatchPattern=equals_55.Equality)  # -> ListA, ListB

# ----
# Parcel info of Building
rec_3 = DataRecorder(dispatch_71.ListB, DataLimit=-10, RecordData=True)
panel_476 = Panel(rec_3)

# ----
# Block value of Building
rec_4 = DataRecorder(dispatch_72.ListB, DataLimit=-10, RecordData=True)
panel_477 = Panel(rec_4)

lng_88 = ListLength(List=dispatch_71.ListB)
panel_478 = Panel("residential")
dup_58 = DuplicateData(Data=flatten(item_57), Number=lng_88, Order=True)

lng_89 = ListLength(List=conditionedunconditioned_7.conditionedZones)
panel_479 = Panel("all")
dup_59 = DuplicateData(Data=flatten(item_57), Number=lng_89, Order=True)

# ----
# detecting circle radius is the 2 times of the building height plus fit cirle radius
multiplication_15 = Multiplication(A=item_72, B=data_63)
debrep_13 = DeconstructBrep(Brep=geo_62)  # -> Faces, Edges, Vertices
fcircle_2 = CircleFit(Points=debrep_13.Vertices)  # -> Circle, Radius, Deviation

# ----
# height of the building
data_176 = Data(multiplication_15)

# ----
# Check whether Added Parcels inside the Block
# Added Parcel Status
panel_480 = Panel("_")
split_24 = TextSplit(Text=item_54, Separators=panel_480)
item_119 = ListItem(List=split_24, Index=-1, Wrap=True)
item_120 = ListItem(List=sorted_parcels_2, Index=item_119, Wrap=True)

multiplication_16 = Multiplication(A=data_176, B="2")
addition_7 = Addition(A=multiplication_16, B=fcircle_2.Radius)

area_50 = Area(Geometry=geo_62)  # -> Area, Centroid

circle_3 = CircleCNR(Center=area_50.Centroid, Normal=Vector(0, 0, 1), Radius=addition_7)

divide_6 = DivideCurve(Curve=circle_3, Count="180", Kinks=False)  # -> Points, Tangents, Parameters

panel_481 = Panel("detecting lines")
ln_5 = Line(StartPoint=area_50.Centroid, EndPoint=divide_6.Points)

lng_90 = ListLength(List=ln_5)

# ----
# center of simulated PARCEL
data_177 = Data(area_50.Centroid)

pt_3 = Point(dispatch_58.ListB)
ln_6 = Line(StartPoint=graft(area_44.Centroid), EndPoint=pt_3)
stretch = Stretch(Geometry=ln_6, Axis=ln_6, Length="50", Rigid=False)

panel_483 = Panel("context Brep")

# ----
# Context Building
area_51 = Area(Geometry=item_88)  # -> Area, Centroid
equals_56 = Equality(FirstNumber=area_51.Centroid, SecondNumber=area_31.Centroid)  # -> Equality, Inequality
panel_484 = Panel("cull intersected parcel")
panel_485 = Panel("collision detection")

dispatch_73 = Dispatch(List=pline_4, DispatchPattern=equals_56.Equality)  # -> ListA, ListB
area_52 = Area(Geometry=dispatch_73.ListA)  # -> Area, Centroid
scale_5 = Scale(Geometry=dispatch_73.ListA, Center=area_52.Centroid, Factor="1.1")  # -> Geometry, Transform

colom_2 = CollisionOneMany(Collider=scale_5.Geometry, Obstacles=simplify(graft(dispatch_73.ListB)))  # -> simplify(flatten(Collision)), simplify(Index)
dispatch_74 = Dispatch(List=dispatch_73.ListB, DispatchPattern=colom_2.Collision)  # -> ListA, ListB

geo_80 = Geometry(dispatch_74.ListB)
area_53 = Area(Geometry=geo_80)  # -> Area, Centroid

# ----
# Context Shading: Added Parcel
vec2pt_7 = Vector2Pt(PointA=area_53.Centroid, PointB=graft(area_33.Centroid), Unitize=False)  # -> Vector, Length
multiplication_17 = Multiplication(A=vec2pt_7.Vector, B="2")
move_4 = Move(Geometry=geo_80, Motion=multiplication_17)  # -> Geometry, Transform

# ----
# OSCInfo
dispatch_75 = Dispatch(List=data_64, DispatchPattern=equals_30.Equality)  # -> ListA, ListB
dispatch_76 = Dispatch(List=dispatch_75.ListA, DispatchPattern=equals_32.Equality)  # -> ListA, ListB
multiplication_18 = Multiplication(A=dispatch_76.ListB, B=data_65)
boundary_23 = BoundarySurfaces(Edges=dispatch_74.ListB)
Z_4 = UnitZ(Factor=multiplication_18)
extr_3 = Extrude(Base=boundary_23, Direction=Z_4)

rint = RegionIntersection(CurvesA=geo_80, CurvesB=simplify(graft(move_4.Geometry)))  # -> simplify(Result)
area_54 = Area(Geometry=flatten(rint))  # -> Area, Centroid
incurves_3 = PointInCurves(Point=area_54.Centroid, Curves=move_4.Geometry)  # -> Relationship, Index, Point
cull_i_42 = CullIndex(List=move_4.Geometry, Indices=incurves_3.Index, Wrap=True)

area_55 = Area(Geometry=cull_i_42)  # -> Area, Centroid
incurves_4 = PointInCurves(Point=area_55.Centroid, Curves=item_120)  # -> Relationship, Index, Point
equals_57 = Equality(FirstNumber=incurves_4.Relationship, SecondNumber="2")  # -> Equality, Inequality
dispatch_77 = Dispatch(List=cull_i_42, DispatchPattern=equals_57.Equality)  # -> ListA, ListB

panel_486 = Panel("context surfaces")
merge_86 = Merge(Data1=dispatch_74.ListB, Data2=dispatch_77.ListB)
debrep_14 = DeconstructBrep(Brep=flatten(merge_86))  # -> Faces, simplify(flatten(Edges)), Vertices

# ----
# Intersection Check
Z_5 = UnitZ(Factor=1)
extr_4 = Extrude(Base=ln_5, Direction=Z_5)
split_25 = SplitWithBrep(Curve=debrep_14.Edges, Brep=graft(extr_4))  # -> flatten(Curve), simplify(Points)
clean_22 = CleanTree(RemoveNulls=True, RemoveInvalid=True, RemoveEmpty=Toggle(True), Tree=split_25.Points)
item_121 = ListItem(List=clean_22, Index=0, Wrap=True)
dcon_5 = DeleteConsecutive(Set=item_121, Wrap=False)  # -> simplify(Set), Count
tstat_22 = TreeStatistics(Tree=dcon_5.Set)  # -> Paths, Length, Count
split_26 = TextSplit(Text=tstat_22.Paths, Separators="{;}")

series_35 = Series(Start=0, Step=1, Count=lng_90)
item_122 = ListItem(List=split_26, Index=2, Wrap=True)  # -> flatten(Item)
item_123 = ListItem(List=split_26, Index=1, Wrap=True)  # -> flatten(Item)
equals_58 = Equality(FirstNumber=graft(series_35), SecondNumber=item_123)  # -> Equality, Inequality
dispatch_78 = Dispatch(List=item_123, DispatchPattern=equals_58.Equality)  # -> simplify(ListA), ListB
lng_91 = ListLength(List=dispatch_78.ListA)
partition_57 = PartitionList(List=item_122, Size=flatten(lng_91))
item_124 = ListItem(List=debrep_14.Edges, Index=partition_57, Wrap=True)  # -> simplify(Item)

curvepoint_7 = PointOnCurve(item_124, parameter=0.5)
dist = Distance(PointA=curvepoint_7, PointB=data_177)  # -> simplify(Distance)
sort_19 = SortList(Keys=dist, ValuesA=item_124)  # -> Keys, ValuesA
item_125 = ListItem(List=sort_19.ValuesA, Index=0, Wrap=True)  # -> flatten(Item)
null_11 = NullItem(Item=item_125)  # -> NullFlags, InvalidFlags, Description
dispatch_79 = Dispatch(List=item_125, DispatchPattern=null_11.NullFlags)  # -> ListA, ListB
curvepoint_8 = PointOnCurve(dispatch_79.ListB, parameter=0.5)
sort_pt = SortPoints(Points=curvepoint_8)  # -> Points, Indices
dcon_6 = DeleteConsecutive(Set=sort_pt.Points, Wrap=False)  # -> Set, Count
geo_81 = Geometry(dispatch_79.ListB)
pdecon_17 = Deconstruct(Point=dcon_6.Set)  # -> XComponent, YComponent, ZComponent
curvepoint_9 = PointOnCurve(geo_81, parameter=0.5)
addition_8 = Addition(A=pdecon_17.XComponent, B=pdecon_17.YComponent)
pdecon_18 = Deconstruct(Point=curvepoint_9)  # -> XComponent, YComponent, ZComponent
roundd_7 = RoundToDecimalPlace(NumberX=addition_8, DecimalPlace="2", RoundType=0)  # -> Rounded, Difference
addition_9 = Addition(A=pdecon_18.XComponent, B=pdecon_18.YComponent)
roundd_8 = RoundToDecimalPlace(NumberX=addition_9, DecimalPlace="2", RoundType=0)  # -> Rounded, Difference
equals_59 = Equality(FirstNumber=roundd_8.Rounded, SecondNumber=graft(roundd_7.Rounded))  # -> Equality, Inequality
dispatch_80 = Dispatch(List=geo_81, DispatchPattern=equals_59.Equality)  # -> simplify(ListA), ListB

item_126 = ListItem(List=dispatch_80.ListA, Index=0, Wrap=True)  # -> flatten(Item)

area_56 = Area(Geometry=geo_48)  # -> Area, Centroid
scale_6 = Scale(Geometry=geo_48, Center=area_56.Centroid, Factor="1.1")  # -> Geometry, Transform
debrep_15 = DeconstructBrep(Brep=scale_6.Geometry)  # -> Faces, Edges, Vertices
pline_6 = PolyLine(Vertices=debrep_15.Vertices, Closed=Toggle(True))  # -> flatten(Polyline)
curvepoint_10 = PointOnCurve(item_126, parameter=0.5)
incurves_5 = PointInCurves(Point=curvepoint_10, Curves=pline_6)  # -> Relationship, Index, Point
sort_20 = SortList(Keys=incurves_5.Index)  # -> Keys, ValuesA
dcon_7 = DeleteConsecutive(Set=sort_20.Keys, Wrap=False)  # -> Set, Count
item_127 = ListItem(List=data_146, Index=dcon_7.Set, Wrap=True)  # -> flatten(Item)

# ----
# average of all context buildings height
ma_13 = MassAddition(Input=item_127)  # -> Result, PartialResults
lng_92 = ListLength(List=item_127)
division_24 = Division(A=ma_13.Result, B=lng_92)

# ----
# average of all context buildings height
data_178 = Data(division_24)

# ----
# OSCInfo_ContextShadingAddedBlocks
multiplication_19 = Multiplication(A=data_178, B=data_66)
boundary_24 = BoundarySurfaces(Edges=dispatch_77.ListB)
Z_6 = UnitZ(Factor=multiplication_19)
extr_5 = Extrude(Base=boundary_24, Direction=Z_6)

brep = Brep(flatten([extr_3, extr_5]))

merge_87 = Merge(Data1=extr_3, Data2=extr_5)
area_57 = Area(Geometry=merge_87)  # -> Area, flatten(Centroid)

merge_88 = Merge(Data1=extr_3, Data2=extr_5)  # -> flatten(Result)
null_12 = NullItem(Item=merge_88)  # -> NullFlags, InvalidFlags, Description
dispatch_81 = Dispatch(List=merge_88, DispatchPattern=null_12.NullFlags)  # -> ListA, ListB
debrep_16 = DeconstructBrep(Brep=dispatch_81.ListB)  # -> simplify(Faces), Edges, Vertices
area_58 = Area(Geometry=debrep_16.Faces)  # -> Area, Centroid
pdecon_19 = Deconstruct(Point=area_58.Centroid)  # -> XComponent, YComponent, ZComponent
sort_21 = SortList(Keys=pdecon_19.ZComponent, ValuesA=debrep_16.Faces)  # -> Keys, reverse(ValuesA)

area_59 = Area(Geometry=dispatch_81.ListB)  # -> Area, Centroid
incurves_6 = PointInCurves(Point=area_59.Centroid, Curves=shift_4)  # -> Relationship, Index, Point
sort_22 = SortList(Keys=incurves_6.Index)  # -> Keys, ValuesA
dcon_8 = DeleteConsecutive(Set=sort_22.Keys, Wrap=False)  # -> Set, Count
equals_60 = Equality(FirstNumber=dcon_8.Set, SecondNumber="-1")  # -> Equality, Inequality
dispatch_82 = Dispatch(List=dcon_8.Set, DispatchPattern=equals_60.Equality)  # -> ListA, ListB

item_128 = ListItem(List=sort_21.ValuesA, Index=0, Wrap=True)
area_60 = Area(Geometry=item_128)  # -> Area, Centroid
incurves_7 = PointInCurves(Point=area_60.Centroid, Curves=shift_4)  # -> Relationship, simplify(Index), Point
equals_61 = Equality(FirstNumber=incurves_7.Index, SecondNumber="-1")  # -> Equality, Inequality
dispatch_83 = Dispatch(List=incurves_7.Index, DispatchPattern=equals_61.Equality)  # -> ListA, ListB

pdecon_20 = Deconstruct(Point=area_60.Centroid)  # -> XComponent, YComponent, ZComponent
sort_23 = SortList(Keys=pdecon_20.ZComponent, ValuesA=area_60.Centroid)  # -> reverse(Keys), reverse(ValuesA)
item_129 = ListItem(List=sort_23.Keys, Index=0, Wrap=True)

# ----
# count
# occurences
# in list
# + partition from
# north to east
sort_24 = SortList(Keys=flatten(dispatch_83.ListB), ValuesA=flatten(item_129))  # -> Keys, ValuesA
dcon_9 = DeleteConsecutive(Set=sort_24.Keys, Wrap=False)  # -> Set, Count
panel_489 = Panel(sort_24.Keys)
equals_62 = Equality(FirstNumber=panel_489, SecondNumber=graft(dcon_9.Set))  # -> Equality, Inequality
dispatch_84 = Dispatch(List=panel_489, DispatchPattern=equals_62.Equality)  # -> simplify(ListA), ListB

# ----
# average distance of context
sort_25 = SortList(Keys=pdecon_19.ZComponent, ValuesA=debrep_16.Faces)  # -> Keys, ValuesA
item_130 = ListItem(List=sort_25.ValuesA, Index=0, Wrap=True)
area_61 = Area(Geometry=item_130)  # -> Area, Centroid
area_62 = Area(Geometry=geo_67)  # -> Area, Centroid
dist_2 = Distance(PointA=area_62.Centroid, PointB=area_61.Centroid)  # -> flatten(Distance)
lng_93 = ListLength(List=dispatch_84.ListA)  # -> flatten(Length)
partition_58 = PartitionList(List=dist_2, Size=lng_93)
avr_4 = Average(Input=partition_58)  # -> flatten(ArithmeticMean)
dup_60 = DuplicateData(Data="0", Number="4", Order=True)
replace_33 = ReplaceItems(List=dup_60, Item=avr_4, Indices=dispatch_82.ListB, Wrap=False)
roundd_9 = RoundToDecimalPlace(NumberX=replace_33, DecimalPlace="1", RoundType=0)  # -> Rounded, Difference
lng_94 = ListLength(List=roundd_9.Rounded)
lng_95 = ListLength(List=conditionedunconditioned_6.conditionedZones)
dup_61 = DuplicateData(Data=roundd_9.Rounded, Number=lng_95, Order=True)
partition_59 = PartitionList(List=dup_61, Size=lng_94)  # -> simplify(Chunks)

multiplication_20 = Multiplication(A=data_67, B=division_24)
Z_7 = UnitZ(Factor=multiplication_20)

# ----
# height of context
lng_96 = ListLength(List=dispatch_84.ListA)  # -> flatten(Length)
partition_60 = PartitionList(List=sort_24.ValuesA, Size=lng_96)
avr_5 = Average(Input=partition_60)  # -> flatten(ArithmeticMean)
dup_62 = DuplicateData(Data="0", Number="4", Order=True)
replace_34 = ReplaceItems(List=dup_62, Item=avr_5, Indices=dispatch_82.ListB, Wrap=False)
roundd_10 = RoundToDecimalPlace(NumberX=replace_34, DecimalPlace="1", RoundType=0)  # -> Rounded, Difference
lng_97 = ListLength(List=roundd_10.Rounded)
lng_98 = ListLength(List=conditionedunconditioned_5.conditionedZones)
dup_63 = DuplicateData(Data=roundd_9.Rounded, Number=lng_98, Order=True)
partition_61 = PartitionList(List=dup_63, Size=lng_97)  # -> simplify(Chunks)

geo_82 = Geometry(item_126)

# ----
# context without ground surface
extr_6 = Extrude(Base=geo_82, Direction=Z_7)

# ----
# context without ground surface
geo_83 = Geometry(extr_6)

colom_3 = CollisionOneMany(Collider=stretch, Obstacles=geo_83)  # -> Collision, Index
dispatch_85 = Dispatch(List=stretch, DispatchPattern=colom_3.Collision)  # -> ListA, ListB
split_27 = SplitWithBreps(Curve=dispatch_85.ListA, Brep=geo_83)  # -> Curve, Points
crv = Curve(split_27.Curve)
item_131 = ListItem(List=crv, Index=0, Wrap=True)
null_13 = NullItem(Item=item_131)  # -> NullFlags, InvalidFlags, Description
dispatch_86 = Dispatch(List=item_131, DispatchPattern=null_13.NullFlags)  # -> ListA, ListB
crv_2 = Curve(dispatch_86.ListB)
len_6 = Length(Curve=crv_2)
end_2 = EndPoints(Curve=crv_2)  # -> Start, End
vec2pt_8 = Vector2Pt(PointA=end_2.Start, PointB=end_2.End, Unitize=False)  # -> Vector, Length
pshift_2 = ShiftPaths(Data=len_6, Offset=-1)
null_14 = NullItem(Item=pshift_2)  # -> NullFlags, InvalidFlags, Description
dispatch_87 = Dispatch(List=pshift_2, DispatchPattern=null_14.NullFlags)  # -> ListA, ListB

angle = Angle(VectorA=graft(evalsrf_4.Normal), VectorB=simplify(vec2pt_8.Vector))  # -> Angle, Reflex
deg_2 = Degrees(Radians=angle.Angle)
larger_2 = LargerThan(FirstNumber=deg_2, SecondNumber="90")  # -> LargerThan, OrEqualTo
python_40 = GhPythonScript(x=simplify(deg_2))  # -> simplify(out), a
# ---------- python_40: Python ----------
__author__ = "ipg"
__version__ = "2022.01.28"

import rhinoscriptsyntax as rs
if x>=90:
    x = x-90
    print(x)
else:
    pass
# ---------- end python_40 ----------
dispatch_88 = Dispatch(List=deg_2, DispatchPattern=larger_2.OrEqualTo)  # -> ListA, ListB
merge_89 = Merge(Data1=dispatch_88.ListB, Data2=python_40.out)  # -> simplify(Result)
pshift_3 = ShiftPaths(Data=merge_89, Offset=-1)

join_43 = BrepJoin(Breps=brep)  # -> flatten(Breps), Closed
volume_2 = Volume(Geometry=join_43.Breps)  # -> Volume, Centroid
bcx = BrepCurve(Brep=flatten(brep), Curve=dispatch_86.ListB)  # -> Curves, Points
crv_cp_2 = CurveCP(Point=volume_2.Centroid, Curve=crv_2)  # -> Point, Parameter, Distance
pshift_4 = ShiftPaths(Data=bcx.Points, Offset=-1)
dist_3 = Distance(PointA=volume_2.Centroid, PointB=crv_cp_2.Point)
sort_26 = SortList(Keys=dist_3, ValuesA=join_43.Breps)  # -> Keys, ValuesA
lng_99 = ListLength(List=pshift_4)
split_28 = SplitList(List=sort_26.ValuesA, Index=lng_99)  # -> ListA, ListB
brep_2 = Brep(simplify(graft(split_28.ListA)))

pshift_5 = ShiftPaths(Data=simplify(brep_2), Offset=-1)
panel_491 = Panel(pshift_5)

multiplication_21 = Multiplication(A=pshift_3, B=dispatch_87.ListB)
python_41 = GhPythonScript(x=multiplication_21)  # -> out, a
# ---------- python_41: Python ----------
__author__ = "ipg"
__version__ = "2022.01.28"

import rhinoscriptsyntax as rs
if x == 0 : 
    x = x + 0.1
    print(x)
else:
    print(x)
# ---------- end python_41 ----------
pshift_6 = ShiftPaths(Data=python_41.out, Offset=-1)
panel_492 = Panel(multiplication_21)

lng_100 = ListLength(List=multiplication_21)  # -> flatten(Length)
data_179 = Data(flatten(brep_2))
partition_62 = PartitionList(List=data_179, Size=lng_100)  # -> simplify(Chunks)
tstat_23 = TreeStatistics(Tree=partition_62)  # -> Paths, Length, Count
tstat_24 = TreeStatistics(Tree=multiplication_21)  # -> Paths, Length, Count
replace_35 = ReplacePaths(Data=partition_62, Search=tstat_23.Paths, Replace=tstat_24.Paths)

debrep_17 = DeconstructBrep(Brep=replace_35)  # -> simplify(Faces), Edges, Vertices
area_63 = Area(Geometry=debrep_17.Faces)  # -> Area, Centroid
pdecon_21 = Deconstruct(Point=area_63.Centroid)  # -> XComponent, YComponent, ZComponent
sort_27 = SortList(Keys=pdecon_21.ZComponent, ValuesA=debrep_17.Faces)  # -> Keys, reverse(ValuesA)
null_15 = NullItem(Item=sort_27.ValuesA)  # -> NullFlags, InvalidFlags, Description
dispatch_89 = Dispatch(List=sort_27.ValuesA, DispatchPattern=null_15.NullFlags)  # -> ListA, ListB
area_64 = Area(Geometry=dispatch_89.ListB)  # -> Area, Centroid
pdecon_22 = Deconstruct(Point=area_64.Centroid)  # -> XComponent, YComponent, ZComponent
sort_28 = SortList(Keys=pdecon_22.ZComponent, ValuesA=area_64.Centroid)  # -> reverse(Keys), reverse(ValuesA)
item_132 = ListItem(List=sort_28.Keys, Index=0, Wrap=True)
null_16 = NullItem(Item=item_132)  # -> NullFlags, InvalidFlags, Description
dispatch_90 = Dispatch(List=item_132, DispatchPattern=null_16.NullFlags)  # -> ListA, simplify(ListB)

pshift_7 = ShiftPaths(Data=dispatch_90.ListB, Offset=-1)
panel_493 = Panel(pshift_7)

geo_84 = Geometry(flatten(extr_6))
panel_494 = Panel("shading Context")

subtraction_9 = Subtraction(A=pshift_7, B=panel_443)
python_42 = GhPythonScript(x=pdecon_13.ZComponent, y=panel_493, z=subtraction_9)  # -> out, a
# ---------- python_42: Python ----------
__author__ = "ipg"
__version__ = "2022.01.28"

import rhinoscriptsyntax as rs
if x > y:
    z = 0
    print(z)
if z < 0 :
    z = 0 
    print(z)
else:
    print(z)
# ---------- end python_42 ----------
pshift_8 = ShiftPaths(Data=python_42.out, Offset=-1)
panel_495 = Panel(pshift_8)

division_25 = Division(A=pshift_8, B=multiplication_21)
panel_496 = Panel(division_25)

area_65 = Area(Geometry=geo_84)  # -> Area, Centroid
incurves_8 = PointInCurves(Point=area_65.Centroid, Curves=merge_70)  # -> Relationship, Index, Point
sort_29 = SortList(Keys=incurves_8.Index)  # -> Keys, ValuesA
dcon_10 = DeleteConsecutive(Set=sort_29.Keys, Wrap=False)  # -> Set, Count

# ----
# 01find directions of external walls
# 2-steps shading selection
# find directions of external walls
# test wether obstacle exist these directions
decomposebytype_4 = Honeybee_DecomposeBasedOnType(HBZone=conditionedunconditioned_4.conditionedZones)  # -> simplify(walls), simplify(interiorWalls), airWalls, simplify(windows), interiorWindows, skylights, roofs, ceilings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; plug-in component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
replace_36 = ReplaceItems(List=dup_20, Item="1", Indices=dcon_10.Set, Wrap=False)

merge_90 = Merge(Data1=extr_6, Data2=geo_68)  # -> flatten(Result)
debrep_18 = DeconstructBrep(Brep=flatten(merge_90))  # -> Faces, Edges, flatten(Vertices)
hull_6 = ConvexHull(Points=debrep_18.Vertices, Plane=PlaneXY(0, 0, 0))  # -> Hull, HullZ, Indices
area_66 = Area(Geometry=hull_6.Hull)  # -> Area, Centroid
scale_7 = Scale(Geometry=hull_6.Hull, Center=area_66.Centroid, Factor="1.05")  # -> Geometry, Transform
boundary_25 = BoundarySurfaces(Edges=scale_7.Geometry)

# ----
# average (it gives
# one result for each
# window unit)
avr_6 = Average(Input=division_25)
panel_497 = Panel(avr_6)

# ----
# summation (it gives
#  one result for each
#  window in the unit)
ma_14 = MassAddition(Input=division_25)  # -> Result, PartialResults
panel_498 = Panel(ma_14.Result)

# ----
# 02test wether obstacle
# exist these directions
area_67 = Area(Geometry=decomposebytype_4.walls)  # -> Area, Centroid
incurves_9 = PointInCurves(Point=area_67.Centroid, Curves=merge_70)  # -> Relationship, Index, Point
item_133 = ListItem(List=replace_36, Index=incurves_9.Index, Wrap=True)  # -> simplify(Item)
replace_37 = ReplaceItems(List=dup_21, Item=item_133, Indices=incurves_9.Index, Wrap=False)  # -> simplify(List)

nullrep = ReplaceNulls(Items=panel_497, Replacements="-1")  # -> Items, Count
pshift_9 = ShiftPaths(Data=nullrep.Items, Offset=-1)

# ----
# null olanları
# -1 ile değiştirdim
# hiç etkisi yok
# demek
panel_499 = Panel("-1")
nullrep_2 = ReplaceNulls(Items=panel_498, Replacements=panel_499)  # -> Items, Count
pshift_10 = ShiftPaths(Data=nullrep_2.Items, Offset=-1)

# ----
# Context Surface
merge_91 = Merge(Data1=flatten(extr_6), Data2=flatten(boundary_25))
hb_epcontextsrf = HoneybeeEPContextSurfaces(shdSurfaces=flatten(merge_91))  # -> HBContext; inputs shdSurfaces: list of Brep, justBoundingBox: Boolean
# ---------- hb_epcontextsrf: Python ----------
"""
prepare shading/context geometries

    Args:
        northVectorOrRotation: A vector that shows North or a number that shows
                               the rotation of the North from the Y axis
        bldgMasses: List of closed Breps as thermal zones.
    Returns:
        report: ...
        thermalZones: Thermal zone's geometries for visualiza
"""

ghenv.Component.Name = 'Honeybee EP context Surfaces'
ghenv.Component.NickName = 'HB_EPContextSrf'
ghenv.Component.Message = 'VER 0.0.66\nJUL_07_2020'
ghenv.Component.IconDisplayMode = ghenv.Component.IconDisplayMode.application
ghenv.Component.Category = "HB-Legacy"
ghenv.Component.SubCategory = "10 | Energy | Energy"
#compatibleHBVersion = VER 0.0.57\nNOV_04_2016
#compatibleLBVersion = VER 0.0.59\nFEB_01_2015
ghenv.Component.AdditionalHelpFromDocStrings = "2"

import rhinoscriptsyntax as rs
import Rhino as rc
import scriptcontext as sc
import os
import System
import Grasshopper.Kernel as gh
import uuid

tolerance = sc.doc.ModelAbsoluteTolerance
import math


def main(shdSurfaces, EPTransSchedule, meshingSettings, justBoundingBox):
    
    # import the classes
    if sc.sticky.has_key('honeybee_release'):

        try:
            if not sc.sticky['honeybee_release'].isCompatible(ghenv.Component): return -1
            if sc.sticky['honeybee_release'].isInputMissing(ghenv.Component): return -1
        except:
            warning = "You need a newer version of Honeybee to use this compoent." + \
            " Use updateHoneybee component to update userObjects.\n" + \
            "If you have already updated userObjects drag Honeybee_Honeybee component " + \
            "into canvas and try again."
            w = gh.GH_RuntimeMessageLevel.Warning
            ghenv.Component.AddRuntimeMessage(w, warning)
            return -1
        
        # don't customize this part
        hb_EPSrf = sc.sticky["honeybee_EPSurface"]
        hb_EPSHDSurface = sc.sticky["honeybee_EPShdSurface"]
        hb_RADMaterialAUX = sc.sticky["honeybee_RADMaterialAUX"]
        hb_EPObjectsAux = sc.sticky["honeybee_EPObjectsAUX"]()
        HBScheduleList = sc.sticky["honeybee_ScheduleLib"].keys()

        ########################################################################
        #----------------------------------------------------------------------#
        shdBreps = []
        # create bounding box of shading geometries
        if justBoundingBox:
            for brep in shdSurfaces:
                if brep.Faces.Count>1 or not brep.Faces[0].IsPlanar(sc.doc.ModelAbsoluteTolerance):
                    shdBreps.append(brep.GetBoundingBox(True).ToBrep())
                else:
                    shdBreps.append(brep)
        else:
            shdBreps = shdSurfaces
        
        shadingClasses = []
        shadingMeshPreview = []
        
        if meshingSettings == None:
            mp = rc.Geometry.MeshingParameters.Minimal
            mp.SimplePlanes = True
        else:
            mp = meshingSettings
        
        def getRadMaterialName(radMaterial):
            nameStr = radMaterial.split(" ")[2]
            name =  nameStr.split("\n")[0]
            return name
        
        for brepCount, brep in enumerate(shdBreps):
            if brep != None:
                isPlanar = True
                # check planarity
                for face in brep.Faces:
                    if not face.IsPlanar(tolerance):
                        isPlanar = False
                        break
                
                shadingBreps = []
                if not isPlanar:
                    meshArray = rc.Geometry.Mesh.CreateFromBrep(brep, mp)
                    for mesh in meshArray:
                        for meshFace in range(mesh.Faces.Count):
                            vertices = list(mesh.Faces.GetFaceVertices(meshFace))[1:]
                            vertices = vertices + [sc.doc.ModelAbsoluteTolerance]
                            # create the brep from mesh
                            shdBrep = rc.Geometry.Brep.CreateFromCornerPoints(*vertices)
                            shadingBreps.append(shdBrep)
                else:
                    for face in brep.Faces:
                        shadingBreps.append(face.DuplicateFace(False))
                
                for faceCount, shdBrep in enumerate(shadingBreps):
                        thisShading = hb_EPSHDSurface(shdBrep, 1000*brepCount + faceCount, 'shdSrf_' + `brepCount` + '_' + `faceCount` + "_" + str(uuid.uuid4()))
                        
                        # add transmittance schedule if any
                        if EPTransSchedule!=None:
                            schedule= EPTransSchedule.upper()
                            if schedule!=None and not schedule.lower().endswith(".csv") and schedule not in HBScheduleList:
                                msg = "Cannot find " + schedule + " in Honeybee schedule library."
                                print msg
                                ghenv.Component.AddRuntimeMessage(gh.GH_RuntimeMessageLevel.Warning, msg)
                                return -1
                            elif schedule!=None and schedule.lower().endswith(".csv"):
                                # check if csv file is existed
                                if not os.path.isfile(schedule):
                                    msg = "Cannot find the shchedule file: " + schedule
                                    print msg
                                    ghenv.Component.AddRuntimeMessage(gh.GH_RuntimeMessageLevel.Warning, msg)
                                    return -1
                            
                            thisShading.TransmittanceSCH = schedule
                        
                        # add the Rad Material if any
                        if RADMaterial!=None:
                            # if it is just the name of the material make sure it is already defined
                            if len(RADMaterial.split(" ")) == 1:
                                # if the material is not in the library add it to the library
                                if not hb_RADMaterialAUX.isMatrialExistInLibrary(RADMaterial):
                                    warningMsg = "Can't find " + RADMaterial + " in RAD Material Library.\n" + \
                                                "Add the material to the library and try again."
                                    ghenv.Component.AddRuntimeMessage(gh.GH_RuntimeMessageLevel.Warning, warningMsg)
                                    return
                                
                                try:
                                    thisShading.setRADMaterial(RADMaterial)
                                except Exception, e:
                                    print e
                                    warningMsg = "You are using an old version of Honeybee_Honeybee! Update your files and try again."
                                    print warningMsg
                                    ghenv.Component.AddRuntimeMessage(gh.GH_RuntimeMessageLevel.Warning, warningMsg)
                                    return
                                
                                addedToLib = True
                            else:
                                
                                # try to add the material to the library
                                addedToLib, thisShading.RadMaterial = hb_RADMaterialAUX.analyseRadMaterials(RADMaterial, True)
                                
                            if addedToLib==False:
                                warningMsg = "Failed to add " + RADMaterial + " to the Library."
                                ghenv.Component.AddRuntimeMessage(gh.GH_RuntimeMessageLevel.Warning, warningMsg)
                                return
                        
                        # add shading to the list
                        shadingClasses.append(thisShading)
                
        # add to the hive
        hb_hive = sc.sticky["honeybee_Hive"]()
        HBContext  = hb_hive.addToHoneybeeHive(shadingClasses, ghenv.Component)
        return HBContext
        ################################################################################################
    else:
        print "You should first let Honeybee to fly..."
        w = gh.GH_RuntimeMessageLevel.Warning
        ghenv.Component.AddRuntimeMessage(w, "You should first let Honeybee to fly...")
        return -1
        

if _shdSurfaces and _shdSurfaces[0]!=None:
    # add cleaning function
    result= main(_shdSurfaces, EPTransSchedule_, meshingSettings_, justBoundingBox_)
    
    if result != -1: HBContext = result
# ---------- end hb_epcontextsrf ----------

context = Brep(hb_epcontextsrf)

panel_500 = Panel("""Obstacle by 
Directions""")
data_180 = Data(replace_37)

exporttoopenstudio = Honeybee_ExportToOpenStudio(
    epwWeatherFile=path_2,
    energySimPar=energysimpar,
    HBZones=flatten(geo_77),
    HBContext=flatten(hb_epcontextsrf),
    simulationOutputs=flatten(merge_27),
    writeOSM=Toggle(False),
    runSimulation="2",
    fileName=join_13,
    workingDir=panel_236)  # -> readMe, osmFileAddress, idfFileAddress, resultFileAddress, eioFileAddress, rddFileAddress, htmlReport, studyFolder, model; plug-in component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

# ----
# Colibri
panel_501 = Panel("C:\KBEM\IP2.1\2ndJournal\Colibri")
data_181 = Data(exporttoopenstudio.resultFileAddress)
parameters = ColibriParameters(Data=flatten(data_181))
img_setting = ImageSetting(ImageSaveAsName="defaultName", Width="2500", Height="2500")
colibri_aggregator = ColibriAggregator(
    Folder=panel_501,
    IterationGenomeID=iterator.IterationGenome,
    IterationPhenomeResults=parameters,
    ImgSetting=img_setting,
    Write=Toggle(False),
    recordingMode=0)

# ----
# Simulated Parcel
# Visualisation
swatch_7 = ColourSwatch(SwatchColor=RGB(0, 0, 0))
wires_6 = BrepWireframe(Brep=merge_91, Density=-1)
preview_31 = CustomPreview(Geometry=hb_epcontextsrf, Material=ColourSwatch(SwatchColor=RGBA(0, 255, 55, 145)))
preview_32 = CustomPreview(Geometry=wires_6, Material=swatch_7)

readepresult = Honeybee_ReadEPResult(resultFileAddress=exporttoopenstudio.resultFileAddress)  # -> totalThermalLoad, thermalLoadBalance, cooling, heating, electricLight, electricEquip, fanElectric, pumpElectric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; plug-in component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

readepsrfresult = Honeybee_ReadEPSurfaceResult(resultFileAddress=exporttoopenstudio.resultFileAddress)  # -> port, port_2, port_3, port_4, port_5, port_6, port_7, port_8, port_9; disabled; plug-in component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
energybalance = Honeybee_ConstructEnergyBalance(
    HBZones=flatten(geo_77),
    cooling=readepresult.cooling,
    heating=readepresult.heating,
    electricLight=readepresult.electricLight,
    electricEquip=readepresult.electricEquip,
    fanElectric=readepresult.fanElectric,
    peopleGains=readepresult.peopleGains,
    totalSolarGain=readepresult.totalSolarGain,
    infiltrationEnergy=readepresult.infiltrationEnergy,
    mechVentilationEnergy=readepresult.mechVentilationEnergy,
    natVentEnergy=readepresult.natVentEnergy,
    surfaceEnergyFlow=readepsrfresult.port_3)  # -> readMe, port, flrNormEnergyBal, flrNormBalWStorage, port_2, modelEnergyBalance, energyBalWithStorage; disabled; plug-in component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
panel_502 = Panel("19")  # disabled
gradientlibrary = Ladybug_GradientLibrary(gradIndex=panel_502)  # -> customColors; disabled; plug-in component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
toggle_21 = BooleanToggle(True)  # disabled
selectandaveragedata = Ladybug_AverageData(annualHourlyData=energybalance.flrNormBalWStorage, totalOrAverage=toggle_21)  # -> readMe, selHourlyData, totaledDaily, totaledMonthly, totMonthlyPerHour, totMonthlyMinPerHour, totMonthlyMaxPerHour; disabled; plug-in component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
legendpar = Ladybug_LegendParameters(customColors=flatten(gradientlibrary))  # -> legendPar; disabled; plug-in component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
toggle_22 = BooleanToggle(True)  # disabled
panel_503 = Panel("EnergyBalance")  # disabled
pt_4 = Point(Point(458, 1813, 0))  # disabled
barchart = Ladybug_MonthlyBarChart(
    inputData=flatten(energybalance.flrNormBalWStorage),
    stackValues=toggle_22,
    altTitle=panel_503,
    basePoint=pt_4,
    legendPar=legendpar)  # -> readMe, dataMesh, dataCurves, dataCrvColors, graphAxes, graphLabels, title, titleBasePt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; disabled; plug-in component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
swatch_8 = ColourSwatch(SwatchColor=RGB(0, 0, 0))  # disabled
preview_33 = CustomPreview(Geometry=barchart.graphAxes, Material=swatch_8)  # disabled

# ----
# 09.SIMULATION
panel_504 = Panel(readepresult.heating)

# ----
# People Gain (kWh/sqm)
flrnorm = Honeybee_NormalizeDataByFloorArea(simData=readepresult.peopleGains, HBZones=flatten(geo_77))  # -> totNormData, zoneNormData; plug-in component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
strnum_5 = Ladybug_SeparateData(inputList=flatten(flrnorm.zoneNormData))  # -> numbers, strings; plug-in component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
ma_15 = MassAddition(Input=strnum_5.numbers)  # -> flatten(Result), PartialResults

# ----
# Bahçeli-Ankara Heating Demand Reference Building, EKB0_4: 80kWh/sqm
strnum_6 = Ladybug_SeparateData(inputList=flatten(readepresult.heating))  # -> numbers, strings; plug-in component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
debrep_19 = DeconstructBrep(Brep=geo_77)  # -> simplify(Faces), Edges, Vertices
item_134 = ListItem(List=debrep_19.Faces, Index=0, Wrap=True)
ma_16 = MassAddition(Input=strnum_6.numbers)  # -> flatten(Result), PartialResults
area_68 = Area(Geometry=item_134)  # -> flatten(Area), Centroid
ma_17 = MassAddition(Input=ma_16.Result)  # -> Result, PartialResults
ma_18 = MassAddition(Input=area_68.Area)  # -> Result, PartialResults
division_26 = Division(A=ma_17.Result, B=ma_18.Result)
panel_505 = Panel(division_26)

# ----
# Total Solar Gain (kWh/sqm)
flrnorm_2 = Honeybee_NormalizeDataByFloorArea(simData=readepresult.totalSolarGain, HBZones=flatten(geo_77))  # -> totNormData, zoneNormData; plug-in component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
strnum_7 = Ladybug_SeparateData(inputList=flatten(flrnorm_2.zoneNormData))  # -> numbers, strings; plug-in component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
ma_19 = MassAddition(Input=strnum_7.numbers)  # -> flatten(Result), PartialResults
equals_63 = Equality(FirstNumber=ma_19.Result, SecondNumber="0")  # -> Equality, Inequality
dispatch_91 = Dispatch(List=ma_19.Result, DispatchPattern=equals_63.Equality)  # -> ListA, ListB

# ----
# Infiltration Energy (kWh/sqm)
flrnorm_3 = Honeybee_NormalizeDataByFloorArea(simData=readepresult.infiltrationEnergy, HBZones=flatten(geo_77))  # -> totNormData, zoneNormData; plug-in component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
strnum_8 = Ladybug_SeparateData(inputList=flatten(flrnorm_3.zoneNormData))  # -> numbers, strings; plug-in component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
ma_20 = MassAddition(Input=strnum_8.numbers)  # -> flatten(Result), PartialResults
dispatch_92 = Dispatch(List=ma_20.Result, DispatchPattern=equals_63.Equality)  # -> ListA, ListB

# ----
# Natural Ventilation Energy (kWh/sqm)
flrnorm_4 = Honeybee_NormalizeDataByFloorArea(simData=readepresult.natVentEnergy, HBZones=flatten(geo_77))  # -> totNormData, zoneNormData; plug-in component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
strnum_9 = Ladybug_SeparateData(inputList=flatten(flrnorm_4.zoneNormData))  # -> numbers, strings; plug-in component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
ma_21 = MassAddition(Input=strnum_9.numbers)  # -> flatten(Result), PartialResults

# ----
# Air Temperature
# (Celcius/sqm)
strnum_10 = Ladybug_SeparateData(inputList=flatten(readepresult.airTemperature))  # -> numbers, strings; plug-in component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
avr_7 = Average(Input=strnum_10.numbers)
dispatch_93 = Dispatch(List=flatten(avr_7), DispatchPattern=equals_63.Equality)  # -> ListA, ListB

readepsrfresult_2 = Honeybee_ReadEPSurfaceResult(resultFileAddress=exporttoopenstudio.resultFileAddress, normBySrfArea=Toggle(True))  # -> surfaceIndoorTemp, surfaceOutdoorTemp, surfaceEnergyFlow, opaqueEnergyFlow, glazEnergyFlow, windowTotalSolarEnergy, windowBeamEnergy, windowDiffEnergy, windowTransmissivity; plug-in component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

# ----
# COOLING ENERGY DEMAND
# (kWh/sqm)
flrnorm_5 = Honeybee_NormalizeDataByFloorArea(simData=readepresult.cooling, HBZones=flatten(geo_77))  # -> totNormData, zoneNormData; plug-in component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
strnum_11 = Ladybug_SeparateData(inputList=flatten(flrnorm_5.zoneNormData))  # -> numbers, strings; plug-in component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
ma_22 = MassAddition(Input=strnum_11.numbers)  # -> flatten(Result), PartialResults

# ----
# HEATING ENERGY DEMAND
# (kWh/sqm)
flrnorm_6 = Honeybee_NormalizeDataByFloorArea(simData=readepresult.heating, HBZones=flatten(geo_77))  # -> totNormData, zoneNormData; plug-in component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
strnum_12 = Ladybug_SeparateData(inputList=flatten(flrnorm_6.zoneNormData))  # -> numbers, strings; plug-in component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
ma_23 = MassAddition(Input=strnum_12.numbers)  # -> flatten(Result), PartialResults

# ----
# exclude
# unconditioned zones
# using total solar gain results
data_182 = Data(equals_63.Equality)

# ----
# Cull Unconditioned Zones
series_36 = Series(Start=0, Step=1, Count=lng_73)
dispatch_94 = Dispatch(List=series_36, DispatchPattern=data_182)  # -> ListA, ListB
branch_25 = TreeBranch(Tree=readepresult.operativeTemperature, Path=dispatch_94.ListB, MaintainPaths=True)

equals_64 = Equality(FirstNumber=data_115, SecondNumber="1")  # -> Equality, Inequality
dispatch_95 = Dispatch(List=dispatch_93.ListB, DispatchPattern=equals_64.Equality)  # -> ListA, ListB

# ----
# opaque Conduction
strnum_13 = Ladybug_SeparateData(inputList=flatten(readepsrfresult_2.opaqueEnergyFlow))  # -> numbers, strings; plug-in component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
ma_24 = MassAddition(Input=strnum_13.numbers)  # -> Result, PartialResults
panel_507 = Panel(strnum_13.numbers)
tstat_25 = TreeStatistics(Tree=readepsrfresult_2.opaqueEnergyFlow)  # -> Paths, Length, Count
tstat_26 = TreeStatistics(Tree=ma_24.Result)  # -> Paths, Length, Count
replace_38 = ReplacePaths(Data=ma_24.Result, Search=tstat_26.Paths, Replace=tstat_25.Paths)
pshift_11 = ShiftPaths(Data=replace_38, Offset=-1)
ma_25 = MassAddition(Input=pshift_11)  # -> flatten(Result), PartialResults

equals_65 = Equality(FirstNumber=data_115, SecondNumber="1")  # -> Equality, Inequality
dispatch_96 = Dispatch(List=ma_15.Result, DispatchPattern=equals_65.Equality)  # -> ListA, ListB

# ----
# glazing Conduction
strnum_14 = Ladybug_SeparateData(inputList=flatten(readepsrfresult_2.glazEnergyFlow))  # -> numbers, strings; plug-in component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
panel_509 = Panel(strnum_14.numbers)
ma_26 = MassAddition(Input=strnum_14.numbers)  # -> Result, PartialResults
tstat_27 = TreeStatistics(Tree=readepsrfresult_2.glazEnergyFlow)  # -> Paths, Length, Count
tstat_28 = TreeStatistics(Tree=ma_26.Result)  # -> Paths, Length, Count
replace_39 = ReplacePaths(Data=ma_26.Result, Search=tstat_28.Paths, Replace=tstat_27.Paths)
pshift_12 = ShiftPaths(Data=replace_39, Offset=-1)
ma_27 = MassAddition(Input=pshift_12)  # -> flatten(Result), PartialResults
panel_510 = Panel(ma_27.Result)

equals_66 = Equality(FirstNumber=data_115, SecondNumber="1")  # -> Equality, Inequality
dispatch_97 = Dispatch(List=ma_23.Result, DispatchPattern=equals_66.Equality)  # -> ListA, ListB

equals_67 = Equality(FirstNumber=data_115, SecondNumber="1")  # -> Equality, Inequality
dispatch_98 = Dispatch(List=ma_22.Result, DispatchPattern=equals_67.Equality)  # -> ListA, ListB

strnum_15 = Ladybug_SeparateData(inputList=flatten(branch_25))  # -> numbers, strings; plug-in component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

equals_68 = Equality(FirstNumber=data_115, SecondNumber="1")  # -> Equality, Inequality
dispatch_99 = Dispatch(List=ma_21.Result, DispatchPattern=equals_68.Equality)  # -> ListA, ListB

equals_69 = Equality(FirstNumber=data_115, SecondNumber="1")  # -> Equality, Inequality
dispatch_100 = Dispatch(List=dispatch_92.ListB, DispatchPattern=equals_69.Equality)  # -> ListA, ListB

equals_70 = Equality(FirstNumber=data_115, SecondNumber="1")  # -> Equality, Inequality
dispatch_101 = Dispatch(List=dispatch_91.ListB, DispatchPattern=equals_70.Equality)  # -> ListA, ListB

panel_516 = Panel("occupiedHours")
dispatch_102 = Dispatch(List=strnum_15.numbers, DispatchPattern=equals_15.Equality)  # -> ListA, ListB

flrnorm_7 = Honeybee_NormalizeDataByFloorArea(simData=readepresult.electricLight, HBZones=flatten(geo_77))  # -> totNormData, zoneNormData; plug-in component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
strnum_16 = Ladybug_SeparateData(inputList=flatten(flrnorm_7.zoneNormData))  # -> numbers, strings; plug-in component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
ma_28 = MassAddition(Input=strnum_16.numbers)  # -> flatten(Result), PartialResults

subtraction_10 = Subtraction(A=dispatch_102.ListA, B=dispatch_22.ListA)
python_43 = GhPythonScript(x=subtraction_10)  # -> out, a
# ---------- python_43: Python ----------
__author__ = "Siser"
__version__ = "2022.03.16"

import rhinoscriptsyntax as rs
if x > 0:
    a = x
else:
    a = 0
# ---------- end python_43 ----------

# ----
# ELECTRICEQUIP ENERGY DEMAND
# (kWh/sqm)
# INDOOR OVERHEATING DEGREES
flrnorm_8 = Honeybee_NormalizeDataByFloorArea(simData=readepresult.electricEquip, HBZones=flatten(geo_77))  # -> totNormData, zoneNormData; plug-in component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
# https://www.sciencedirect.com/science/article/pii/S0360132317302664?via%3Dihub
strnum_17 = Ladybug_SeparateData(inputList=flatten(flrnorm_8.zoneNormData))  # -> numbers, strings; plug-in component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
ma_29 = MassAddition(Input=strnum_17.numbers)  # -> flatten(Result), PartialResults

division_27 = Division(A=ma_23.Result, B=weave_35)

division_28 = Division(A=dispatch_97.ListB, B=weave_35)

# ----
# MECHANICALVENTILATION
# ELECTRICLIGHT DEMAND
# (kWh/sqm)
flrnorm_9 = Honeybee_NormalizeDataByFloorArea(simData=readepresult.mechVentilationEnergy, HBZones=flatten(geo_77))  # -> totNormData, zoneNormData; plug-in component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
strnum_18 = Ladybug_SeparateData(inputList=flatten(flrnorm_9.zoneNormData))  # -> numbers, strings; plug-in component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
ma_30 = MassAddition(Input=strnum_18.numbers)  # -> flatten(Result), PartialResults

# ----
# MEANRADIANTTEMPERATURE
strnum_19 = Ladybug_SeparateData(inputList=flatten(readepresult.meanRadTemperature))  # -> numbers, strings; plug-in component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
avr_8 = Average(Input=strnum_19.numbers)
dispatch_103 = Dispatch(List=flatten(avr_8), DispatchPattern=equals_63.Equality)  # -> ListA, ListB

# ----
# Operative Temperature
strnum_20 = Ladybug_SeparateData(inputList=flatten(readepresult.operativeTemperature))  # -> numbers, strings; plug-in component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
avr_9 = Average(Input=strnum_20.numbers)
dispatch_104 = Dispatch(List=flatten(avr_9), DispatchPattern=equals_63.Equality)  # -> ListA, ListB

# ----
# https://www.researchgate.net/publication/280443859_ASSESSMENT_OF_OVERHEATING_RISK_IN_DWELLINGS
# https://docs.google.com/document/d/1_ABXp2oo5wBXnJP1ug-vCfKyITPYSoL8V3BUiou2ZRM/edit
panel_519 = Panel("1May-30Sept")
subtraction_11 = Subtraction(A=doy_hoy_2.HOY, B=doy_hoy.HOY)
panel_520 = Panel("#of Occupied Hours")
series_37 = Series(Start=doy_hoy.HOY, Step=1, Count=subtraction_11)
# https://www.zerocarbonhub.org/sites/default/files/resources/reports/ZCH-OverheatingEvidenceReview-Definitions.pdf
item_135 = ListItem(List=python_43.a, Index=series_37, Wrap=True)

equals_71 = Equality(FirstNumber=data_115, SecondNumber="1")  # -> Equality, Inequality
dispatch_105 = Dispatch(List=flatten(ma_27.Result), DispatchPattern=equals_71.Equality)  # -> ListA, ListB

equals_72 = Equality(FirstNumber=ma_19.Result, SecondNumber="0")  # -> Equality, Inequality
dispatch_106 = Dispatch(List=ma_28.Result, DispatchPattern=equals_72.Equality)  # -> ListA, ListB

# ----
# GWP electricity
merge_92 = Merge(Data1=graft(dispatch_106.ListB), Data2=graft(ma_29.Result))
ma_31 = MassAddition(Input=merge_92)  # -> flatten(Result), PartialResults
multiplication_22 = Multiplication(A=ma_31.Result, B="0.545")

sort_30 = SortList(Keys=ma_25.Result)  # -> Keys, ValuesA
cull_i_43 = CullIndex(List=sort_30.Keys, Indices=neg_2, Wrap=True)

equals_73 = Equality(FirstNumber=data_115, SecondNumber="1")  # -> Equality, Inequality
dispatch_107 = Dispatch(List=ma_29.Result, DispatchPattern=equals_73.Equality)  # -> ListA, ListB

# ----
# GWP heatingRes
panel_523 = Panel("0.181")
multiplication_23 = Multiplication(A=division_28, B=panel_523)

# ----
# GWP heatingAll
panel_524 = Panel("0.181")
multiplication_24 = Multiplication(A=division_27, B=panel_524)

equals_74 = Equality(FirstNumber=data_115, SecondNumber="1")  # -> Equality, Inequality
dispatch_108 = Dispatch(List=dispatch_103.ListB, DispatchPattern=equals_74.Equality)  # -> ListA, ListB

equals_75 = Equality(FirstNumber=data_115, SecondNumber="1")  # -> Equality, Inequality
dispatch_109 = Dispatch(List=ma_30.Result, DispatchPattern=equals_75.Equality)  # -> ListA, ListB

equals_76 = Equality(FirstNumber=data_115, SecondNumber="1")  # -> Equality, Inequality
dispatch_110 = Dispatch(List=dispatch_104.ListB, DispatchPattern=equals_76.Equality)  # -> ListA, ListB

equals_77 = Equality(FirstNumber=data_115, SecondNumber="1")  # -> Equality, Inequality
dispatch_111 = Dispatch(List=dispatch_106.ListB, DispatchPattern=equals_77.Equality)  # -> ListA, ListB

# ----
# GWP electricity
merge_93 = Merge(Data1=graft(dispatch_111.ListB), Data2=graft(dispatch_107.ListB))
ma_32 = MassAddition(Input=merge_93)  # -> flatten(Result), PartialResults
multiplication_25 = Multiplication(A=ma_32.Result, B="0.545")

equals_78 = Equality(FirstNumber=data_115, SecondNumber="1")  # -> Equality, Inequality
dispatch_112 = Dispatch(List=flatten(cull_i_43), DispatchPattern=equals_78.Equality)  # -> ListA, ListB

ma_33 = MassAddition(Input=item_135)  # -> flatten(Result), PartialResults
division_29 = Division(A=ma_33.Result, B=subtraction_11)

# ----
# IOD
data_183 = Data(division_29)
null_17 = NullItem(Item=data_183)  # -> NullFlags, InvalidFlags, Description
dispatch_113 = Dispatch(List=data_183, DispatchPattern=null_17.NullFlags)  # -> ListA, ListB

equals_79 = Equality(FirstNumber=data_115, SecondNumber="1")  # -> Equality, Inequality
dispatch_114 = Dispatch(List=dispatch_113.ListB, DispatchPattern=equals_79.Equality)  # -> ListA, ListB

# ----
# AdaptiveComfort
# Solar Gain as Reference
flrnorm_10 = Honeybee_NormalizeDataByFloorArea(simData=readepresult.totalSolarGain, HBZones=flatten(geo_77))  # -> totNormData, zoneNormData; plug-in component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
strnum_21 = Ladybug_SeparateData(inputList=flatten(flrnorm_10.zoneNormData))  # -> numbers, strings; plug-in component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
ma_34 = MassAddition(Input=strnum_21.numbers)  # -> flatten(Result), PartialResults
lng_101 = ListLength(List=ma_34.Result)
equals_80 = Equality(FirstNumber=ma_34.Result, SecondNumber="0")  # -> Equality, Inequality
series_38 = Series(Start=0, Step=1, Count=lng_101)
dispatch_115 = Dispatch(List=series_38, DispatchPattern=equals_80.Equality)  # -> ListA, ListB

avr_10 = Average(Input=dispatch_114.ListB)
avr_11 = Average(Input=dispatch_98.ListB)
avr_12 = Average(Input=dispatch_97.ListB)
ma_35 = MassAddition(Input=[dispatch_97.ListB, dispatch_98.ListB])  # -> Result, PartialResults
ma_36 = MassAddition(Input=dispatch_114.ListB)  # -> Result, PartialResults
ma_37 = MassAddition(Input=dispatch_97.ListB)  # -> Result, PartialResults

# ----
# MeanRadAirTemp
strnum_22 = Ladybug_SeparateData(inputList=flatten(readepresult.meanRadTemperature))  # -> numbers, strings; plug-in component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
branch_26 = TreeBranch(Tree=strnum_22.numbers, Path=dispatch_115.ListB, MaintainPaths=True)

# ----
# electLight
strnum_23 = Ladybug_SeparateData(inputList=flatten(readepresult.electricLight))  # -> numbers, strings; plug-in component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
branch_27 = TreeBranch(Tree=strnum_23.numbers, Path=dispatch_115.ListB, MaintainPaths=True)

# ----
# OperativeTemp
strnum_24 = Ladybug_SeparateData(inputList=flatten(readepresult.operativeTemperature))  # -> numbers, strings; plug-in component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
branch_28 = TreeBranch(Tree=strnum_24.numbers, Path=dispatch_115.ListB, MaintainPaths=True)

# ----
# AirTemp
strnum_25 = Ladybug_SeparateData(inputList=flatten(readepresult.airTemperature))  # -> numbers, strings; plug-in component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
branch_29 = TreeBranch(Tree=strnum_25.numbers, Path=dispatch_115.ListB, MaintainPaths=True)

# ----
# equipment
strnum_26 = Ladybug_SeparateData(inputList=flatten(readepresult.electricEquip))  # -> numbers, strings; plug-in component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
branch_30 = TreeBranch(Tree=strnum_26.numbers, Path=dispatch_115.ListB, MaintainPaths=True)

flip = FlipMatrix(Data=branch_26)
avr_13 = Average(Input=flip)  # -> flatten(ArithmeticMean)

flip_2 = FlipMatrix(Data=branch_27)
avr_14 = Average(Input=flip_2)  # -> flatten(ArithmeticMean)

flip_3 = FlipMatrix(Data=branch_28)
avr_15 = Average(Input=flip_3)  # -> flatten(ArithmeticMean)

flip_4 = FlipMatrix(Data=branch_29)
avr_16 = Average(Input=flip_4)  # -> flatten(ArithmeticMean)

flip_5 = FlipMatrix(Data=branch_30)
avr_17 = Average(Input=flip_5)  # -> flatten(ArithmeticMean)

roundd_11 = RoundToDecimalPlace(NumberX=avr_17, DecimalPlace="2", RoundType=0)  # -> Rounded, Difference

roundd_12 = RoundToDecimalPlace(NumberX=avr_16, DecimalPlace="2", RoundType=0)  # -> Rounded, Difference

roundd_13 = RoundToDecimalPlace(NumberX=avr_14, DecimalPlace="2", RoundType=0)  # -> Rounded, Difference

roundd_14 = RoundToDecimalPlace(NumberX=avr_15, DecimalPlace="2", RoundType=0)  # -> Rounded, Difference

roundd_15 = RoundToDecimalPlace(NumberX=avr_13, DecimalPlace="2", RoundType=0)  # -> Rounded, Difference

panel_531 = Panel("csv recording")
c_script_3 = CSharpScript(save=Toggle(True), path=join_25, data=flatten(roundd_11.Rounded))  # inputs save: Boolean, path: String, data: list of String
# ---------- c_script_3: C# ----------
    if(save){
      var fileinfo = new System.IO.FileInfo(path);
      if(!fileinfo.Directory.Exists){
        fileinfo.Directory.Create();
      }
      
      var sw = fileinfo.CreateText();
      for(int i = 0; i < data.Count; i++){
        string row = data[i];
        if(i < data.Count - 1){
          sw.WriteLine(row);
        }else{
          sw.Write(row);
        }
      }
      
      sw.Flush();
      sw.Close();
    }
# ---------- end c_script_3 ----------

c_script_4 = CSharpScript(save=Toggle(True), path=join_27, data=flatten(roundd_13.Rounded))  # inputs save: Boolean, path: String, data: list of String; same code as c_script_3

c_script_5 = CSharpScript(save=Toggle(True), path=join_29, data=flatten(roundd_14.Rounded))  # inputs save: Boolean, path: String, data: list of String; same code as c_script_3

c_script_6 = CSharpScript(save=Toggle(True), path=join_31, data=flatten(roundd_15.Rounded))  # inputs save: Boolean, path: String, data: list of String; same code as c_script_3

c_script_7 = CSharpScript(save=Toggle(True), path=join_33, data=flatten(roundd_12.Rounded))  # inputs save: Boolean, path: String, data: list of String; same code as c_script_3

intcrv_2 = Interpolate(Vertices=merge_69, Degree=3, Periodic=Toggle(True), KnotStyle=1)  # -> flatten(Curve), Length, Domain

area_69 = Area(Geometry=intcrv_2.Curve)  # -> Area, Centroid
# regions start from north
# continues counter-clockwise
pdecon_23 = Deconstruct(Point=area_69.Centroid)  # -> XComponent, YComponent, ZComponent
sort_31 = SortList(Keys=pdecon_23.YComponent, ValuesA=intcrv_2.Curve)  # -> Keys, reverse(ValuesA)
item_136 = ListItem(List=sort_31.ValuesA, Index=0, Wrap=True)

area_70 = Area(Geometry=intcrv_2.Curve)  # -> Area, Centroid
pdecon_24 = Deconstruct(Point=area_70.Centroid)  # -> XComponent, YComponent, ZComponent
sort_32 = SortList(Keys=pdecon_24.XComponent, ValuesA=intcrv_2.Curve)  # -> Keys, reverse(ValuesA)
item_137 = ListItem(List=sort_32.ValuesA, Index=0, Wrap=True)

area_71 = Area(Geometry=intcrv_2.Curve)  # -> Area, Centroid
pdecon_25 = Deconstruct(Point=area_71.Centroid)  # -> XComponent, YComponent, ZComponent
sort_33 = SortList(Keys=pdecon_25.XComponent, ValuesA=intcrv_2.Curve)  # -> Keys, ValuesA
item_138 = ListItem(List=sort_33.ValuesA, Index=0, Wrap=True)

area_72 = Area(Geometry=intcrv_2.Curve)  # -> Area, Centroid
pdecon_26 = Deconstruct(Point=area_72.Centroid)  # -> XComponent, YComponent, ZComponent
sort_34 = SortList(Keys=pdecon_26.YComponent, ValuesA=intcrv_2.Curve)  # -> Keys, ValuesA
item_139 = ListItem(List=sort_34.ValuesA, Index=0, Wrap=True)

merge_94 = Merge(Data1=item_136, Data2=item_138, Data3=item_139, Data4=item_137)

panel_536 = Panel("""Window
Directions""")
incurves_10 = PointInCurves(Point=area_45.Centroid, Curves=merge_94)  # -> Relationship, Index, Point

# ----
# Building & Unit Features
panel_537 = Panel(incurves_10.Index)

cull_i_44 = CullIndex(List=partition_53, Indices=incurves_10.Index, Wrap=True)  # -> simplify(List)
panel_538 = Panel("""NO-Window
Directions""")

replace_40 = ReplaceItems(List=partition_54, Item="3", Indices=incurves_10.Index, Wrap=False)  # -> simplify(List)
replace_41 = ReplaceItems(List=replace_40, Item="2", Indices=cull_i_44, Wrap=False)

# ----
# WWR by directions
lng_102 = ListLength(List=replace_41)  # -> simplify(flatten(Length))
lng_103 = ListLength(List=lng_102)  # -> simplify(Length)
dup_64 = DuplicateData(Data=data_82, Number=lng_103, Order=True)
lng_104 = ListLength(List=data_82)
partition_63 = PartitionList(List=dup_64, Size=lng_104)  # -> simplify(Chunks)

mindex_10 = MemberIndex(Set=replace_41, Member="2")  # -> simplify(Index), Count

panel_539 = Panel("WWR by directions")
replace_42 = ReplaceItems(List=partition_63, Item="0", Indices=mindex_10.Index, Wrap=False)  # -> simplify(List)

panel_540 = Panel("wwrByDirections")
data_184 = Data(replace_42)

equals_81 = Equality(FirstNumber=data_184, SecondNumber="0")  # -> Equality, Inequality
dispatch_116 = Dispatch(List=data_184, DispatchPattern=equals_81.Equality)  # -> ListA, ListB
tmatch = MatchText(Text=data_184, Pattern=dispatch_116.ListB, Case=True)
python_44 = GhPythonScript(x=tmatch)  # -> out, a; inputs x: list
# ---------- python_44: Python ----------
__author__ = "Siser"
__version__ = "2022.02.23"

import rhinoscriptsyntax as rs
TrueList=[]
for i in range(len(x)):
    if x[i] == 'True':
        TrueList.append(i)
    else:
        pass
a = TrueList
# ---------- end python_44 ----------

# ----
# ObstacleShadingCoefficient_IC
mindex_11 = MemberIndex(Set=data_184)  # -> Index, Count; disabled
panel_541 = Panel(pshift_10)

# ----
# SkyExposure_ic
panel_542 = Panel("0")
shadingmask = Ladybug_ShadingMask(centerPtOrPlane=area_43.Centroid, context=hb_epcontextsrf)  # -> contextMask, orientationMask, strategyMask, skyMask, port, contextExposure, orientExposure, strategyExposure, skyExposure; plug-in component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
equals_82 = Equality(FirstNumber=data_184, SecondNumber=panel_542)  # -> Equality, Inequality
dispatch_117 = Dispatch(List=data_184, DispatchPattern=equals_82.Equality)  # -> ListA, ListB
tmatch_2 = MatchText(Text=data_184, Pattern=dispatch_117.ListB, Case=True)
python_45 = GhPythonScript(x=tmatch_2)  # -> out, a; inputs x: list; same code as python_44
replace_43 = ReplaceItems(List=data_184, Item=shadingmask.skyExposure, Indices=python_45.a, Wrap=False)  # -> simplify(List)
panel_543 = Panel(replace_43)

data_185 = Data(replace_42)

# ----
# Window area/floor area
# Obstacle
# Shading
# Coefficient_IC
debrep_20 = DeconstructBrep(Brep=mass2zone.HBZones)  # -> simplify(Faces), Edges, Vertices
item_140 = ListItem(List=debrep_20.Faces, Index=0, Wrap=True)
area_73 = Area(Geometry=decomposebytype.windows)  # -> Area, Centroid
area_74 = Area(Geometry=item_140)  # -> Area, Centroid
division_30 = Division(A=simplify(area_73.Area), B=area_74.Area)
replace_44 = ReplaceItems(List=data_185, Item=division_30, Indices=python_44.a, Wrap=False)  # -> simplify(List)

data_186 = Data(replace_42)

data_187 = Data(replace_42)

# ----
# summation record
# (it gives
# one result for each
# window unit)
replace_45 = ReplaceItems(List=data_186, Item=pshift_10, Indices=python_44.a, Wrap=False)  # -> simplify(List)

# ----
# average record
# (it gives
# one result for each
# window unit)
replace_46 = ReplaceItems(List=data_187, Item=pshift_9, Indices=python_44.a, Wrap=False)  # -> simplify(List)

# ----
# WWRDirectionUnitNorth
item_141 = ListItem(List=replace_42, Index=0, Wrap=True)  # -> flatten(Item)

# ----
# WWRDirectionUnitSouth
item_142 = ListItem(List=replace_42, Index=2, Wrap=True)  # -> flatten(Item)

# ----
# WWRDirectionUnitEast
item_143 = ListItem(List=replace_42, Index=3, Wrap=True)  # -> flatten(Item)

# ----
# WWRDirectionUnitWest
item_144 = ListItem(List=replace_42, Index=1, Wrap=True)  # -> flatten(Item)

# ----
# AvOSC South
item_145 = ListItem(List=replace_46, Index=2, Wrap=True)  # -> flatten(Item)

# ----
# AvOSC North
item_146 = ListItem(List=replace_46, Index=0, Wrap=True)  # -> flatten(Item)

# ----
# AvOSC East
item_147 = ListItem(List=replace_46, Index=3, Wrap=True)  # -> flatten(Item)

# ----
# AvOSC West
item_148 = ListItem(List=replace_46, Index=1, Wrap=True)  # -> flatten(Item)

equals_83 = Equality(FirstNumber=data_115, SecondNumber="1")  # -> Equality, Inequality
dispatch_118 = Dispatch(List=item_141, DispatchPattern=equals_83.Equality)  # -> ListA, ListB

equals_84 = Equality(FirstNumber=data_115, SecondNumber="1")  # -> Equality, Inequality
dispatch_119 = Dispatch(List=item_142, DispatchPattern=equals_84.Equality)  # -> ListA, ListB

equals_85 = Equality(FirstNumber=data_115, SecondNumber="1")  # -> Equality, Inequality
dispatch_120 = Dispatch(List=item_144, DispatchPattern=equals_85.Equality)  # -> ListA, ListB

equals_86 = Equality(FirstNumber=data_115, SecondNumber="1")  # -> Equality, Inequality
dispatch_121 = Dispatch(List=item_143, DispatchPattern=equals_86.Equality)  # -> ListA, ListB

equals_87 = Equality(FirstNumber=data_115, SecondNumber="1")  # -> Equality, Inequality
dispatch_122 = Dispatch(List=item_146, DispatchPattern=equals_87.Equality)  # -> ListA, ListB

equals_88 = Equality(FirstNumber=data_115, SecondNumber="1")  # -> Equality, Inequality
dispatch_123 = Dispatch(List=item_145, DispatchPattern=equals_88.Equality)  # -> ListA, ListB

equals_89 = Equality(FirstNumber=data_115, SecondNumber="1")  # -> Equality, Inequality
dispatch_124 = Dispatch(List=item_147, DispatchPattern=equals_89.Equality)  # -> ListA, ListB

equals_90 = Equality(FirstNumber=data_115, SecondNumber="1")  # -> Equality, Inequality
dispatch_125 = Dispatch(List=item_148, DispatchPattern=equals_90.Equality)  # -> ListA, ListB

# ----
# SumOSC North
item_149 = ListItem(List=replace_45, Index=0, Wrap=True)  # -> flatten(Item)

# ----
# SumOSC West
item_150 = ListItem(List=replace_45, Index=1, Wrap=True)  # -> flatten(Item)

# ----
# SumOSC East
item_151 = ListItem(List=replace_45, Index=3, Wrap=True)  # -> flatten(Item)

# ----
# W/F East
item_152 = ListItem(List=replace_44, Index=3, Wrap=True)  # -> flatten(Item)

# ----
# SumOSC South
item_153 = ListItem(List=replace_45, Index=2, Wrap=True)  # -> flatten(Item)

# ----
# W/F North
item_154 = ListItem(List=replace_44, Index=0, Wrap=True)  # -> flatten(Item)

# ----
# W/F South
item_155 = ListItem(List=replace_44, Index=2, Wrap=True)  # -> flatten(Item)

# ----
# W/F West
item_156 = ListItem(List=replace_44, Index=1, Wrap=True)  # -> flatten(Item)

equals_91 = Equality(FirstNumber=data_115, SecondNumber="1")  # -> Equality, Inequality
dispatch_126 = Dispatch(List=item_149, DispatchPattern=equals_91.Equality)  # -> ListA, ListB

equals_92 = Equality(FirstNumber=data_115, SecondNumber="1")  # -> Equality, Inequality
dispatch_127 = Dispatch(List=item_151, DispatchPattern=equals_92.Equality)  # -> ListA, ListB

equals_93 = Equality(FirstNumber=data_115, SecondNumber="1")  # -> Equality, Inequality
dispatch_128 = Dispatch(List=item_150, DispatchPattern=equals_93.Equality)  # -> ListA, ListB

equals_94 = Equality(FirstNumber=data_115, SecondNumber="1")  # -> Equality, Inequality
dispatch_129 = Dispatch(List=item_155, DispatchPattern=equals_94.Equality)  # -> ListA, ListB

equals_95 = Equality(FirstNumber=data_115, SecondNumber="1")  # -> Equality, Inequality
dispatch_130 = Dispatch(List=item_153, DispatchPattern=equals_95.Equality)  # -> ListA, ListB

equals_96 = Equality(FirstNumber=data_115, SecondNumber="1")  # -> Equality, Inequality
dispatch_131 = Dispatch(List=item_156, DispatchPattern=equals_96.Equality)  # -> ListA, ListB

equals_97 = Equality(FirstNumber=data_115, SecondNumber="1")  # -> Equality, Inequality
dispatch_132 = Dispatch(List=item_154, DispatchPattern=equals_97.Equality)  # -> ListA, ListB

equals_98 = Equality(FirstNumber=data_115, SecondNumber="1")  # -> Equality, Inequality
dispatch_133 = Dispatch(List=item_152, DispatchPattern=equals_98.Equality)  # -> ListA, ListB

separatezonesbyprogram = Honeybee_SeparateZonesByProgram(HBZones=flatten(conditionedunconditioned_7.conditionedZones))  # -> zonePrograms, HBZones; plug-in component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

mindex_12 = MemberIndex(Set=flatten(separatezonesbyprogram.zonePrograms), Member="MidriseApartment::Office")  # -> Index, Count

branch_31 = TreeBranch(Tree=separatezonesbyprogram.HBZones, Path=mindex_12.Index, MaintainPaths=True)

area_75 = Area(Geometry=geo_79)  # -> Area, Centroid
area_76 = Area(Geometry=branch_31)  # -> Area, Centroid
cps_2 = ClosestPoints(Point=area_76.Centroid, Cloud=area_75.Centroid, Count="1")  # -> ClosestPoint, flatten(CPIndex), Distance
panel_563 = Panel("find office units")
panel_564 = Panel(cps_2.CPIndex)

# ----
# floorArea of Units
zoneattributelist_2 = Honeybee_ZoneAttributeList({"Name": "name", "Zone Program": "zoneProgram", "Zone Floor Area": "zoneFloorArea", "Zone Volume": "zoneVolume", "Building Program": "bldgProgram", "Is Conditioned": "isConditioned", "HVAC System Type": "HVACSystem", "Occupancy Schedule": "occupancySchedule", "Occupancy Activity Schedule": "occupancyActivitySch", "Heating SetPoint Schedule": "heatingSetPtSchedule"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}, selected="Zone Floor Area")
labelzones_2 = Honeybee_LabelZones(HBZones=flatten(conditionedunconditioned_7.conditionedZones), attribute=zoneattributelist_2)  # -> zoneTxtLabels, labelBasePts, brepTxtLabels, zoneWireFrames; plug-in component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
roundd_16 = RoundToDecimalPlace(NumberX=labelzones_2.zoneTxtLabels, DecimalPlace="1", RoundType=0)  # -> Rounded, Difference

equals_99 = Equality(FirstNumber=data_115, SecondNumber="1")  # -> Equality, Inequality
dispatch_134 = Dispatch(List=roundd_16.Rounded, DispatchPattern=equals_99.Equality)  # -> ListA, ListB

rec_5 = DataRecorder(dispatch_134.ListB, DataLimit=-10, RecordData=True)
panel_566 = Panel(rec_5)

# ----
# formFactor of Units
data_188 = Data(flatten(division_22))
roundd_17 = RoundToDecimalPlace(NumberX=data_188, DecimalPlace="3", RoundType=0)  # -> Rounded, Difference

equals_100 = Equality(FirstNumber=data_115, SecondNumber="1")  # -> Equality, Inequality
dispatch_135 = Dispatch(List=roundd_17.Rounded, DispatchPattern=equals_100.Equality)  # -> ListA, ListB

rec_6 = DataRecorder(dispatch_135.ListB, DataLimit=-10, RecordData=True)
panel_568 = Panel(rec_6)

# ----
# SkyExposure_East
item_157 = ListItem(List=replace_43, Index=3, Wrap=True)  # -> flatten(Item)

equals_101 = Equality(FirstNumber=data_115, SecondNumber="1")  # -> Equality, Inequality
dispatch_136 = Dispatch(List=item_157, DispatchPattern=equals_101.Equality)  # -> ListA, ListB

data_189 = Data(dispatch_136.ListB)
rec_7 = DataRecorder(data_189, DataLimit=-10, RecordData=True)
panel_570 = Panel(rec_7)

# ----
# SkyExposure_West
item_158 = ListItem(List=replace_43, Index=1, Wrap=True)  # -> flatten(Item)

equals_102 = Equality(FirstNumber=data_115, SecondNumber="1")  # -> Equality, Inequality
dispatch_137 = Dispatch(List=item_158, DispatchPattern=equals_102.Equality)  # -> ListA, ListB

rec_8 = DataRecorder(dispatch_137.ListB, DataLimit=-10, RecordData=True)
panel_572 = Panel(rec_8)

# ----
# SkyExposure_South
item_159 = ListItem(List=replace_43, Index=2, Wrap=True)  # -> flatten(Item)

equals_103 = Equality(FirstNumber=data_115, SecondNumber="1")  # -> Equality, Inequality
dispatch_138 = Dispatch(List=item_159, DispatchPattern=equals_103.Equality)  # -> ListA, ListB

data_190 = Data(dispatch_138.ListB)
rec_9 = DataRecorder(data_190, DataLimit=-10, RecordData=True)
panel_574 = Panel(rec_9)

# ----
# SkyExposure_North
item_160 = ListItem(List=replace_43, Index=0, Wrap=True)  # -> flatten(Item)

equals_104 = Equality(FirstNumber=data_115, SecondNumber="1")  # -> Equality, Inequality
dispatch_139 = Dispatch(List=item_160, DispatchPattern=equals_104.Equality)  # -> ListA, ListB

rec_10 = DataRecorder(dispatch_139.ListB, DataLimit=-10, RecordData=True)
panel_576 = Panel(rec_10)

# ----
# LightingDensity of
# All Units (kWh/sqm)
panel_577 = Panel("office")
data_191 = Data(weave_50)
data_192 = Data(geteploads.lightingDensityPerArea)
data_193 = Data(weave_36)

# ----
# convert 5 to 1
# equalize all residentials
python_46 = GhPythonScript(x=data_193)  # -> out, a; inputs x: Int32
# ---------- python_46: Python ----------
__author__ = "Siser"
__version__ = "2022.11.25"

import rhinoscriptsyntax as rs

if x == 5:
    a =1
else:
    a=x
# ---------- end python_46 ----------

p_n_c = PickNChoose(Pattern=graft(python_46.a), Stream0=data_191, Stream1=data_192)  # -> flatten(Result)

# ----
# Unıt ID
data_194 = Data(join_41)

equals_105 = Equality(FirstNumber=data_115, SecondNumber="1")  # -> Equality, Inequality
dispatch_140 = Dispatch(List=data_194, DispatchPattern=equals_105.Equality)  # -> ListA, ListB

rec_11 = DataRecorder(dispatch_140.ListB, DataLimit=-10, RecordData=True)
panel_580 = Panel(rec_11)

# ----
# ID
panel_581 = Panel(dispatch_140.ListB)

# ----
# Equipment Density of
# All Units (kWh/sqm)
panel_582 = Panel("office")
data_195 = Data(weave_51)
data_196 = Data(geteploads.equipmentLoadPerArea)
data_197 = Data(weave_36)

# ----
# convert 5 to 1
# equalize all residentials
python_47 = GhPythonScript(x=data_197)  # -> out, a; inputs x: Int32; same code as python_46

p_n_c_2 = PickNChoose(Pattern=graft(python_47.a), Stream0=data_195, Stream1=data_196)  # -> flatten(Result)

# ----
# CSV
# RECORDINGS
# OUTPUT
# Residential
list_of_recordings_2 = Panel("""fileName(.gh)
nameOftheVersion
parcelUBEM
blockUBEM
UnitID
HeatEnUse (kWh/m2)
heating_Ideal loads (kWh/m2)
cooling_Ideal loads (kWh/m2)
IOD
GWPheat (kgCO2-eq/m3)	
GWPelect (kgCO2-eq/m3)	
electLight (kWh/m2)
electEquip (kWh/m2)
peopleGain (kWh/m2)
TotSolarGain (kWh/m2)
infiltEnergy (kWh/m2)
natVentEnergy (kWh/m2)
mechVentilation (kWh/m2)
opaqueConduction (kWh)
glazingConduction (kWh)
airTemp (C)
operativeTemp (C)
meanRadiantTemp (C)""")
lng_105 = ListLength(List=list_of_recordings_2)

# ----
# CSV
# RECORDINGS
# ALL
# Residential
list_of_recordings_3 = Panel("""fileName(.gh)
nameOftheVersion
parcelUBEM
blockUBEM
UnitID
verticalPos
formFactor
floorArea
widthToDepth
unitwwrNorth
unitwwrWest
unitwwrSouth
unitwwrEast
skyExposureNorth
skyExposureEast
skyExposureSouth
skyExposureWest
WFNorth
WFWest
WFSouth
WFEast
HeatSet
CoolSet
PeopleDensity
LightDens
equipDens
ConsDate
uWall
uWindow
uRoof
uGroundFloor
SHGCWindow
VTWindow
Infiltration
boilerEfficiency
z-axisOfUnit
HeatEnUse (kWh/m2)
heating_Ideal loads (kWh/m2)
cooling_Ideal loads (kWh/m2)
IOD
GWPheat (kgCO2-eq/m3)	
GWPelect (kgCO2-eq/m3)	
electLight (kWh/m2)
electEquip (kWh/m2)
peopleGain (kWh/m2)
TotSolarGain (kWh/m2)
infiltEnergy (kWh/m2)
natVentEnergy (kWh/m2)
mechVentilation (kWh/m2)
opaqueConduction (kWh)
glazingConduction (kWh)
airTemp (C)
operativeTemp (C)
meanRadiantTemp (C)""")
lng_106 = ListLength(List=list_of_recordings_3)

list_of_recordings_4 = Panel("""fileName(.gh)
nameOftheVersion
parcelUBEM
blockUBEM
UnitID
verticalPos
formFactor
floorArea
widthToDepth
unitwwrNorth
unitwwrWest
unitwwrSouth
unitwwrEast
skyExposureNorth
skyExposureEast
skyExposureSouth
skyExposureWest
WFNorth
WFWest
WFSouth
WFEast
HeatSet
CoolSet
PeopleDensity
LightDens
equipDens
ConsDate
uWall
uWindow
uRoof
uGroundFloor
SHGCWindow
VTWindow
Infiltration
boilerEfficiency
z-axisOfUnit
HeatEnUse (kWh/m2)
heating_Ideal loads (kWh/m2)
cooling_Ideal loads (kWh/m2)
IOD
GWPheat (kgCO2-eq/m3)	
GWPelect (kgCO2-eq/m3)	
electLight (kWh/m2)
electEquip (kWh/m2)
peopleGain (kWh/m2)
TotSolarGain (kWh/m2)
infiltEnergy (kWh/m2)
natVentEnergy (kWh/m2)
mechVentilation (kWh/m2)
opaqueConduction (kWh)
glazingConduction (kWh)
airTemp (C)
operativeTemp (C)
meanRadiantTemp (C)""")

# ----
# CSV
# RECORDINGS
# ALL (input & output)
# ALL (office & residential)
# https://discourse.mcneel.com/t/improvement-of-data-recorder-rec/56940/7
lng_107 = ListLength(List=list_of_recordings_4)
panel_584 = Panel("improved data recorder")

series_39 = Series(Start=0, Step=1, Count=lng_105)

weave_63 = Weave(
    Pattern=series_39,
    Stream0=dup_58,
    Stream1=dup_57,
    Stream2=dispatch_71.ListB,
    Stream3=dispatch_72.ListB,
    Stream4=dispatch_140.ListB,
    Stream5=division_28,
    Stream6=dispatch_97.ListB,
    Stream7=dispatch_98.ListB,
    Stream8=dispatch_114.ListB,
    Stream9=multiplication_23,
    Stream10=multiplication_25,
    Stream11=dispatch_111.ListB,
    Stream12=dispatch_107.ListB,
    Stream13=dispatch_96.ListB,
    Stream14=dispatch_101.ListB,
    Stream15=dispatch_100.ListB,
    Stream16=dispatch_99.ListB,
    Stream17=dispatch_109.ListB,
    Stream18=dispatch_112.ListB,
    Stream19=dispatch_105.ListB,
    Stream20=dispatch_95.ListB,
    Stream21=dispatch_110.ListB,
    Stream22=dispatch_108.ListB,
    NullGaps=False)

partition_64 = PartitionList(List=weave_63, Size=lng_105)  # -> simplify(Chunks)
join_44 = TextJoin(Text=partition_64, Join=",")  # -> simplify(Result)

tstat_29 = TreeStatistics(Tree=join_44)  # -> Paths, Length, Count
lng_108 = ListLength(List=tstat_29.Length)
series_40 = Series(Start=0, Step=1, Count=lng_108)
dup_65 = DuplicateData(Data=item_94, Number=lng_108, Order=True)
dup_66 = DuplicateData(Data="}", Number=lng_108, Order=True)
dup_67 = DuplicateData(Data=";", Number=lng_108, Order=True)
dup_68 = DuplicateData(Data="{", Number=lng_108, Order=True)
merge_95 = Merge(
    Data1=simplify(graft(dup_68)),
    Data2=simplify(graft(dup_65)),
    Data3=simplify(graft(dup_67)),
    Data4=simplify(graft(series_40)),
    Data5=simplify(graft(dup_66)))
join_45 = TextJoin(Text=merge_95)
replace_47 = ReplacePaths(Data=join_44, Search=flatten(tstat_29.Paths), Replace=flatten(join_45))

# ----
# https://discourse.mcneel.com/t/improvement-of-data-recorder-rec/56940/7
toggle_23 = BooleanToggle(True)
data_rec = PythonScript(x=replace_47, enable=toggle_23, reset=button, limit="1000000")  # -> x; inputs x: tree, enable: Boolean, reset: Boolean, limit: Int32
# ---------- data_rec: Python ----------
from Grasshopper import DataTree
if reset or 'rec' not in globals(): rec = DataTree[object]()
if enable and not reset: rec.MergeTree(x)
if limit > 0:
  for branch in rec.Branches:
    if branch.Count > limit:
      branch.RemoveRange(0, branch.Count - limit)
x = rec
# ---------- end data_rec ----------
c_script_8 = CSharpScript(save=Toggle(True), path=path_3, data=flatten(data_rec))  # inputs save: Boolean, path: String, data: list of String; same code as c_script_3

panel_588 = Panel(data_rec)

series_41 = Series(Start=0, Step=1, Count=lng_107)

weave_64 = Weave(
    Pattern=series_41,
    Stream0=dup_59,
    Stream1=dup_56,
    Stream2=dup_51,
    Stream3=dup_53,
    Stream4=data_194,
    Stream5=weave_62,
    Stream6=roundd_17.Rounded,
    Stream7=roundd_16.Rounded,
    Stream8=data_174,
    Stream9=item_141,
    Stream10=item_144,
    Stream11=item_142,
    Stream12=item_143,
    Stream13=item_160,
    Stream14=item_158,
    Stream15=item_159,
    Stream16=item_157,
    Stream17=item_154,
    Stream18=item_156,
    Stream19=item_155,
    Stream20=item_152,
    Stream21=replace_28,
    Stream22=replace_30,
    Stream23=python_34.a,
    Stream24=p_n_c,
    Stream25=p_n_c_2,
    Stream26=dup_55,
    Stream27=dup_46,
    Stream28=dup_26,
    Stream29=dup_47,
    Stream30=dup_38,
    Stream31=dup_54,
    Stream32=dup_52,
    Stream33=dup_50,
    Stream34=dup_49,
    Stream35=division_23,
    Stream36=division_27,
    Stream37=ma_23.Result,
    Stream38=ma_22.Result,
    Stream39=dispatch_113.ListB,
    Stream40=multiplication_24,
    Stream41=multiplication_22,
    Stream42=dispatch_106.ListB,
    Stream43=ma_29.Result,
    Stream44=ma_15.Result,
    Stream45=dispatch_91.ListB,
    Stream46=dispatch_92.ListB,
    Stream47=ma_21.Result,
    Stream48=ma_30.Result,
    Stream49=cull_i_43,
    Stream50=ma_27.Result,
    Stream51=dispatch_93.ListB,
    Stream52=dispatch_104.ListB,
    Stream53=dispatch_103.ListB,
    NullGaps=False)

partition_65 = PartitionList(List=weave_64, Size=lng_107)  # -> simplify(Chunks)
join_46 = TextJoin(Text=partition_65, Join=",")  # -> simplify(Result)

tstat_30 = TreeStatistics(Tree=join_46)  # -> Paths, Length, Count
lng_109 = ListLength(List=tstat_30.Length)
series_42 = Series(Start=0, Step=1, Count=lng_109)
dup_69 = DuplicateData(Data=item_95, Number=lng_109, Order=True)
dup_70 = DuplicateData(Data=";", Number=lng_109, Order=True)
dup_71 = DuplicateData(Data="}", Number=lng_109, Order=True)
dup_72 = DuplicateData(Data="{", Number=lng_109, Order=True)
merge_96 = Merge(
    Data1=simplify(graft(dup_72)),
    Data2=simplify(graft(dup_69)),
    Data3=simplify(graft(dup_70)),
    Data4=simplify(graft(series_42)),
    Data5=simplify(graft(dup_71)))
join_47 = TextJoin(Text=merge_96)
replace_48 = ReplacePaths(Data=join_46, Search=flatten(tstat_30.Paths), Replace=flatten(join_47))

data_rec_2 = PythonScript(x=replace_48, enable=Toggle(True), reset=button, limit="1000000")  # -> x; inputs x: tree, enable: Boolean, reset: Boolean, limit: Int32; same code as data_rec
panel_589 = Panel(data_rec_2)
c_script_9 = CSharpScript(save=Toggle(True), path=path_5, data=flatten(data_rec_2))  # inputs save: Boolean, path: String, data: list of String; same code as c_script_3

series_43 = Series(Start=0, Step=1, Count=lng_106)

weave_65 = Weave(
    Pattern=series_43,
    Stream0=dup_58,
    Stream1=dup_57,
    Stream2=dispatch_71.ListB,
    Stream3=dispatch_72.ListB,
    Stream4=dispatch_140.ListB,
    Stream5=dispatch_63.ListB,
    Stream6=dispatch_135.ListB,
    Stream7=dispatch_134.ListB,
    Stream8=dispatch_64.ListB,
    Stream9=dispatch_118.ListB,
    Stream10=dispatch_120.ListB,
    Stream11=dispatch_119.ListB,
    Stream12=dispatch_121.ListB,
    Stream13=dispatch_139.ListB,
    Stream14=data_189,
    Stream15=data_190,
    Stream16=dispatch_137.ListB,
    Stream17=dispatch_132.ListB,
    Stream18=dispatch_131.ListB,
    Stream19=dispatch_129.ListB,
    Stream20=dispatch_133.ListB,
    Stream21=dispatch_53.ListB,
    Stream22=dispatch_54.ListB,
    Stream23=dispatch_50.ListB,
    Stream24=data_158,
    Stream25=weave_51,
    Stream26=dispatch_70.ListB,
    Stream27=dispatch_62.ListB,
    Stream28=dispatch_26.ListB,
    Stream29=dispatch_61.ListB,
    Stream30=dispatch_55.ListB,
    Stream31=dispatch_68.ListB,
    Stream32=dispatch_67.ListB,
    Stream33=dispatch_69.ListB,
    Stream34=dispatch_66.ListB,
    Stream35=dispatch_65.ListB,
    Stream36=division_28,
    Stream37=dispatch_97.ListB,
    Stream38=dispatch_98.ListB,
    Stream39=dispatch_114.ListB,
    Stream40=multiplication_23,
    Stream41=multiplication_25,
    Stream42=dispatch_111.ListB,
    Stream43=dispatch_107.ListB,
    Stream44=dispatch_96.ListB,
    Stream45=dispatch_101.ListB,
    Stream46=dispatch_100.ListB,
    Stream47=dispatch_99.ListB,
    Stream48=dispatch_109.ListB,
    Stream49=dispatch_112.ListB,
    Stream50=dispatch_105.ListB,
    Stream51=dispatch_95.ListB,
    Stream52=dispatch_110.ListB,
    Stream53=dispatch_108.ListB,
    NullGaps=False)

partition_66 = PartitionList(List=weave_65, Size=lng_106)  # -> simplify(Chunks)
join_48 = TextJoin(Text=partition_66, Join=",")  # -> simplify(Result)

tstat_31 = TreeStatistics(Tree=join_48)  # -> Paths, Length, Count
lng_110 = ListLength(List=tstat_31.Length)
series_44 = Series(Start=0, Step=1, Count=lng_110)
dup_73 = DuplicateData(Data="}", Number=lng_110, Order=True)
dup_74 = DuplicateData(Data=";", Number=lng_110, Order=True)
dup_75 = DuplicateData(Data=item_96, Number=lng_110, Order=True)
dup_76 = DuplicateData(Data="{", Number=lng_110, Order=True)
merge_97 = Merge(
    Data1=simplify(graft(dup_76)),
    Data2=simplify(graft(dup_75)),
    Data3=simplify(graft(dup_74)),
    Data4=simplify(graft(series_44)),
    Data5=simplify(graft(dup_73)))
join_49 = TextJoin(Text=merge_97)
replace_49 = ReplacePaths(Data=join_48, Search=flatten(tstat_31.Paths), Replace=flatten(join_49))

# ----
# https://discourse.mcneel.com/t/improvement-of-data-recorder-rec/56940/7
toggle_24 = BooleanToggle(True)
data_rec_3 = PythonScript(x=replace_49, enable=toggle_24, reset=button, limit="1000000")  # -> x; inputs x: tree, enable: Boolean, reset: Boolean, limit: Int32; same code as data_rec
c_script_10 = CSharpScript(save=Toggle(True), path=path_4, data=flatten(data_rec_3))  # inputs save: Boolean, path: String, data: list of String; same code as c_script_3

panel_592 = Panel(data_rec_3)

list_of_recordings_5 = Panel("""buildingID
heatIdealAvg
heatIdealSum
coolIdealAvg
coolIdealSum
IODAverage
IODSum""")

# ----
# CSV
# RECORDINGS
# Building-Based
lng_111 = ListLength(List=list_of_recordings_5)

series_45 = Series(Start=0, Step=1, Count=lng_111)

weave_66 = Weave(
    Pattern=series_45,
    Stream0=filename,
    Stream1=avr_12,
    Stream2=ma_37.Result,
    Stream3=avr_11,
    Stream4=ma_35.Result,
    Stream5=avr_10,
    Stream6=ma_36.Result,
    NullGaps=False)

partition_67 = PartitionList(List=weave_66, Size=lng_111)  # -> simplify(Chunks)
join_50 = TextJoin(Text=partition_67, Join=",")  # -> simplify(Result)

tstat_32 = TreeStatistics(Tree=join_50)  # -> Paths, Length, Count
lng_112 = ListLength(List=tstat_32.Length)
series_46 = Series(Start=0, Step=1, Count=lng_112)
dup_77 = DuplicateData(Data="}", Number=lng_112, Order=True)
dup_78 = DuplicateData(Data=";", Number=lng_112, Order=True)
dup_79 = DuplicateData(Data=item_97, Number=lng_112, Order=True)
dup_80 = DuplicateData(Data="{", Number=lng_112, Order=True)
merge_98 = Merge(
    Data1=simplify(graft(dup_80)),
    Data2=simplify(graft(dup_79)),
    Data3=simplify(graft(dup_78)),
    Data4=simplify(graft(series_46)),
    Data5=simplify(graft(dup_77)))
join_51 = TextJoin(Text=merge_98)
replace_50 = ReplacePaths(Data=join_50, Search=flatten(tstat_32.Paths), Replace=flatten(join_51))

# ----
# https://discourse.mcneel.com/t/improvement-of-data-recorder-rec/56940/7
toggle_25 = BooleanToggle(True)
data_rec_4 = PythonScript(x=replace_50, enable=toggle_25, reset=button, limit="1000000")  # -> x; inputs x: tree, enable: Boolean, reset: Boolean, limit: Int32; same code as data_rec
path_12 = FilePath("C:\KBEM\IP2.1\2ndJournal\csvFiles\Building_V4_izm_bah_2020.csv")
c_script_11 = CSharpScript(save=Toggle(True), path=path_12, data=flatten(data_rec_4))  # inputs save: Boolean, path: String, data: list of String; same code as c_script_3
