# Grasshopper definition Ankara_040423_Retrofit.gh (Grasshopper 1.0.7)
# plug-ins: Pufferfish, Colibri, TT Toolbox

panel = Panel("""0.61
1.24
1.42
0.39
0.49
1.44
0.68
0.47
0.67
1.65
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""")
panel_2 = Panel("UwallConcrete Generated")

# ----
# EKB Construction data for UwallMasonry
ekbuwallconcrete = Panel("""0.67
0.68
1.83
2.25
1.19
0.42
0.48
1.69
0.61
1.99
1.9
1.87
0.67
1.32
0.41
0.38
0.27
0.36""")
parcelubem = Panel("""7
4
4
5
17
2
5
5
3
11
0
2
16
1
7
1
2
3""")
blockubem = Panel("""36
46
6
43
42
36
17
8
46
24
39
50
46
42
44
46
37
39""")

# ----
# EKB Construction data for UwallConcrete
ekbuwallconcrete_2 = Panel("""0.68
0.68
0.47
0.56
0.45
0.34
0.34
1.36
1.44
1.48
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""")
parcelubem_2 = Panel("""15
10
14
8
10
20
10
22
4
7
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""")
blockubem_2 = Panel("""17
3
24
17
20
31
49
3
23
24
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""")

panel_3 = Panel("""1.47
0.66
0.43
1.24
1.46
1.57
0.67
1.32
0.35
1.86
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""")
panel_4 = Panel("UwallMasonry Generated")

# ----
# Add All Buildings
# https://docs.google.com/spreadsheets/d/1OhTFdR_YYA37wmvLVmGtL0KkaVhocj32rAnVd95tpRM/edit#gid=0
panel_5 = Panel("=IFS(H7537=\"office\", 1, H7537=\"dwelling\",0, H7537=\"public\",2, H7537=\"school\",3)")
panel_6 = Panel("""1
1
0
0
0
0
0
0
0
1
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""")

panel_7 = Panel("0")  # disabled
# to see the implementation of cooling,
# 
# check before
# KBEM_Ankara_060522_As-Is.gh file
# cooling units are excluded from Ankara simulations: 0: residential non-cooling
# 5: residential with cooling
# 1: office unit
panel_8 = Panel("if residential")  # disabled
equals = Equality(FirstNumber=panel_6, SecondNumber=panel_7)  # -> Equality, Inequality; disabled
dispatch = Dispatch(List=panel_6, DispatchPattern=equals.Equality)  # -> ListA, ListB; disabled

# ----
# FOR ANKARA, Cooling System Ratio Inside Residential Units, %
lng = ListLength(List=dispatch.ListA)  # disabled
panel_9 = Panel("3")  # disabled
pcent = Percentage(Number=lng, Percent=panel_9)  # disabled
round = Round(Number=pcent)  # -> Nearest, Floor, Ceiling; disabled
series = Series(Start=0, Step=1, Count=round.Floor)  # disabled

# ----
# select which residential units will have cooling
listdexs = ListIndices(List=panel_6)  # disabled
# Residential with cooling
dispatch_2 = Dispatch(List=listdexs, DispatchPattern=equals.Equality)  # -> ListA, ListB; disabled
jitter = Jitter(List=dispatch_2.ListA, Jitter=1, Seed=2)  # -> Values, Indices; disabled
item = ListItem(List=jitter.Values, Index=series, Wrap=True)  # disabled

# ----
# add residential with cooling units
panel_10 = Panel("5")  # disabled
replace = ReplaceItems(List=panel_6, Item=panel_10, Indices=item, Wrap=False)  # disabled

# ----
# Construction
const_date = Panel("""1960
1960
1960
1960
1960
1960
1975
1960
1960
1980
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""")
parcelubem_3 = Panel("""0
1
2
3
4
5
0
1
2
0
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""")
block_ubem = Panel("""0
0
0
0
0
0
1
1
1
2
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""")

# ----
# Construction
const_date_2 = Panel("""2014
1990
1988
2015
1993
2015
1960
1970
1960
1967
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""")
parcelubem_4 = Panel("""0
1
2
3
4
5
6
7
8
0
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""")
block_ubem_2 = Panel("""0
0
0
0
0
0
0
0
0
1
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""")

panel_11 = Panel("""0.23
0.24
0.21
0.18
0.13
0.16
0.20
0.22
0.21
0.17
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""")

# ----
# EKB Construction data for UwallConcrete
ekbuwallconcrete_3 = Panel("""0.10
0.16
0.11
0.11
0.10
0.14
0.20
0.12
0.16
0.13
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""")
parcelubem_5 = Panel("""2
4
1
2
15
7
1
4
11
1
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""")
blockubem_3 = Panel("""0
0
3
3
3
5
1
1
1
2
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""")

# ----
# BAHÇELİEVLER
# neighborhood related data
# Add All
# Buildings
# Mixed or Not
panel_13 = Panel("""1
1
0
0
0
0
1
1
1
1
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""")

merge = Merge(Data1=graft(parcelubem), Data2=graft(blockubem))

# ----
# heatingSetPoint
panel_14 = Panel("""23.24
22.89
22.47
22.19
21.14
21.43
21.53
23.65
20.32
21.01
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""")
panel_15 = Panel("""23.09
20.08
22.53
23.00
21.99
20.90
20.79
23.04
20.68
20.35
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""")
merge_2 = Merge(Data1=panel_15, Data2=panel_14)

# ----
# Mixed or Not
panel_16 = Panel("""0
0
0
0
0
0
0
0
0
1
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""")

# ----
# Add Only
# Residential Buildings
vtwindow = Panel("""0.43
0.17
0.51
0.43
0.42
0.36
0.28
0.55
0.34
0.32
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""")
shgcwindow = Panel("""0.767
0.398
0.330
0.499
0.451
0.592
0.468
0.467
0.361
0.437
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""")
wwr = Panel("""0.23
0.24
0.10
0.21
0.16
0.18
0.13
0.16
0.20
0.22
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""")
ugroundfloor = Panel("""0.75
1.93
0.75
0.57
0.59
1.93
0.75
0.55
0.75
0.74
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""")
uwindow = Panel("""1.20
2.7
2.7
2.60
2.5
1.95
1.20
2.69
2.70
2.90
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""")
uroof = Panel("""0.34
0.39
0.43
0.65
0.58
0.43
0.53
0.36
0.43
0.39
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""")
uwall = Panel("""1.00
0.49
0.49
0.34
0.49
0.39
0.47
0.82
0.47
0.49
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""")

# ----
# Add All
# Buildings
# Real Data
# Building
# Parcel No
panel_17 = Panel("""0
1
2
3
4
5
6
7
8
9
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""")

# ----
# parcel_block ordered lists
# https://docs.google.com/spreadsheets/d/1OXMzIesyRE01nLoX3t1EUuKLoFw8Ft8k3F_-NCRB1iU/edit#gid=607337562
# Mixed or Not
panel_18 = Panel("""1
1
0
0
1
0
0
1
0
1
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""")

# ----
# Real Data
# Building
# Parcel No
panel_19 = Panel("""0
1
2
3
4
5
0
1
2
0
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""")

panel_20 = Panel("""1962
1960
2010
2008
1958
1974
1982
1980
2001
1974
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""")  # disabled
panel_21 = Panel("construction date transformation")
python = GhPythonScript(x=panel_20)  # -> out, a; inputs x: Int32; disabled
# ---------- python: Python ----------
__author__ = "Siser"
__version__ = "2022.03.17"

import rhinoscriptsyntax as rs
if x < 1980:
    a = 1960
elif x < 2000 and x >= 1980:
    a = 1980
else:
    a = 2000
# ---------- end python ----------
panel_22 = Panel(python.a)  # disabled

# ----
# Add All
# Buildings
# Real Data
# # of floor
# https://docs.google.com/spreadsheets/d/1HeNCj9cvZVeU73J5g7iW2pWBtRtmiiCzG14sOCkgrVs/edit#gid=0
panel_23 = Panel("""4
4
4
4
4
4
5
5
5
5
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""")

# ----
# EMEK
# neighborhood related data
# https://docs.google.com/spreadsheets/d/1dVqoGlL5SpjtWETs8iGa3fb79QarzpHjeZR7tKplJOw/edit#gid=2128463022
# Real Data
# # of floor
real_data_of_floor = Panel("""9
9
9
10
10
10
4
4
4
1
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""")

# ----
# Real Data
# Building
# Parcel No
panel_24 = Panel("""0
1
2
3
4
5
6
7
8
0
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""")

panel_25 = Panel("compare two points")  # disabled
python_2 = PythonScript()  # -> out, a; inputs x: list of Point3d; disabled
# ---------- python_2: Python ----------
if x[0] == x[1]:
    a =True
    print("centroids are the same")
else:
    a =False
    print("centroids are not the same")
# ---------- end python_2 ----------

# ----
# neighborhood related data
# https://docs.google.com/spreadsheets/d/1L3Ca3pI_2Zk8sqpA5S26HTBe5FzKtIOFTXeKStPdVgI/edit#gid=1110302639
# Real Data
# # of floor
real_data_of_floor_2 = Panel("""6
5
5
6
5
5
5
3
5
5
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""")

# ----
# # of Units of
# the building
of_units_of_the_building = Panel("""21
21
21
20
20
20
19
9
13
1
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""")

# ----
# https://docs.google.com/spreadsheets/d/18MLfzQqm2u-x1I9CiO8GDrrBI3HEgol9LwWBEFC5yFs/edit#gid=0
# https://docs.google.com/spreadsheets/d/1OhTFdR_YYA37wmvLVmGtL0KkaVhocj32rAnVd95tpRM/edit#gid=0
parcel = Panel("""0
0
0
0
0
0
0
0
0
0
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""")
block = Panel("""0
0
0
0
0
0
0
0
0
0
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""")

# ----
# Random Distribution for all Construction Sets: https://docs.google.com/document/d/1WU0D6LcI17LYl9msHEWG7eir8bg52xUF9ubXD48ZJ14/edit
# Internal Loads
boiler_efficiency = Panel("""0.878
0.942
0.915
0.842
0.833
0.903
0.825
0.859
0.893
0.862
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""")
infiltration = Panel("""0.000306
0.000449
0.000338
0.000315
0.000356
0.000303
0.000429
0.000458
0.000496
0.000422
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""")

# ----
# # of Units of
# the building
of_units_of_the_building_2 = Panel("""15
17
11
11
8
12
10
15
8
15
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""")

# ----
# Add All
# Buildings
# # of units per building
sqr = Square(Value=block)
# parcel_block ordered lists
sqr_2 = Square(Value=parcel)
addition = Addition(A=sqr_2, B=sqr)

# ----
# ppl/m2
panel_26 = Panel("""0.0542
0.0338
0.0318
0.0101
0.0366
0.0335
0.0313
0.0398
0.0409
0.0260
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""")
# YUKARI BAHÇELİEVLER
panel_27 = Panel("""0.0358
0.0336
0.0390
0.0423
0.0447
0.0444
0.0454
0.0168
0.0383
0.0413
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""")
merge_3 = Merge(Data1=panel_26, Data2=panel_27)

# ----
# Generated
# # of Units
# Per Floor
division = Division(A=of_units_of_the_building, B=real_data_of_floor)
round_2 = Round(Number=division)  # -> Nearest, Floor, Ceiling

# ----
# equipmentDensity
panel_28 = Panel("""3.26
0.69
3.68
4.32
4.19
5.21
2.79
2.49
3.11
2.40
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""")
panel_29 = Panel("""3.81
1.82
1.86
0.96
2.15
2.16
2.24
2.46
1.52
3.23
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""")
merge_4 = Merge(Data1=panel_28, Data2=panel_29)

# ----
# lightingDensity
panel_30 = Panel("""16.55
15.54
18.15
13.27
17.97
17.25
16.66
18.92
13.80
12.20
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""")
panel_31 = Panel("""18.32
18.03
18.29
13.91
16.59
18.98
16.27
12.67
15.68
14.45
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""")
merge_5 = Merge(Data1=panel_30, Data2=panel_31)

# ----
# check if there is 0 value for # of units
lng_2 = ListLength(List=round_2.Floor)
series_2 = Series(Start=0, Step=1, Count=lng_2)
equals_2 = Equality(FirstNumber=round_2.Floor, SecondNumber="0")  # -> Equality, Inequality
dispatch_3 = Dispatch(List=series_2, DispatchPattern=equals_2.Equality)  # -> ListA, ListB
panel_32 = Panel(dispatch_3.ListA)

# ----
# Add All
# Buildings
# Construction
const_date_3 = Panel("""1960
1960
2000
2000
1960
1960
1980
1980
2000
1960
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""")
parcelubem_6 = Panel("""0
1
2
3
4
5
6
7
8
9
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""")
block_ubem_3 = Panel("""0
0
0
0
0
0
0
0
0
0
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""")

# ----
# python count consecutive duplicates in list, itertools
# https://www.w3resource.com/python-exercises/itertools/python-itertools-exercise-31.php
python_3 = GhPythonScript(x=addition)  # -> out, a; inputs x: list
# ---------- python_3: Python ----------
__author__ = "Siser"
__version__ = "2022.03.08"

import rhinoscriptsyntax as rs
from itertools import groupby
a = [sum(1 for _ in group) for _, group in groupby(x)]
# ---------- end python_3 ----------

# ----
# # of units per building
data = Data(python_3.a)

# ----
# unitFunction
partition = PartitionList(List=panel_6, Size=data)  # -> simplify(Chunks)

panel_33 = Panel("unitFunction")
data_2 = Data(partition)

equals_3 = Equality(FirstNumber=data_2, SecondNumber="0")  # -> Equality, Inequality
dispatch_4 = Dispatch(List=data_2, DispatchPattern=equals_3.Equality)  # -> ListA, ListB

# ----
# python count consecutive duplicates in list, itertools
# https://www.w3resource.com/python-exercises/itertools/python-itertools-exercise-31.php
python_4 = GhPythonScript()  # -> out, a; inputs x: list; disabled; same code as python_3

# ----
# Generated
# # of Units
# Per Floor
division_2 = Division(A=of_units_of_the_building_2, B=real_data_of_floor_2)
round_3 = Round(Number=division_2)  # -> Nearest, Floor, Ceiling

# ----
# check if there is 0 value for # of units
lng_3 = ListLength(List=round_3.Floor)
series_3 = Series(Start=0, Step=1, Count=lng_3)
equals_4 = Equality(FirstNumber=round_3.Floor, SecondNumber="0")  # -> Equality, Inequality
dispatch_5 = Dispatch(List=series_3, DispatchPattern=equals_4.Equality)  # -> ListA, ListB
panel_34 = Panel(dispatch_5.ListA)

# ----
# parcel_block ordered lists
panel_35 = Panel(round_2.Floor)

# ----
# %10 of all buildings are masonry
# according to EKB data of Bahçelievler
panel_36 = Panel("10")

# ----
# Generated
# # of Units
# Per Floor
division_3 = Division(A=python_3.a, B=panel_23)
round_4 = Round(Number=division_3)  # -> Nearest, Floor, Ceiling

panel_37 = Panel(round_3.Floor)

panel_38 = Panel(round_4.Floor)

panel_39 = Panel("DWELLING")
geo = Geometry([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])

panel_40 = Panel("COMMERCIAL")
geo_2 = Geometry([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])

panel_41 = Panel("PUBLIC")
geo_3 = Geometry([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])

panel_42 = Panel("SCHOOL")
geo_4 = Geometry([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])

# ----
# LinearInterpolated    People per sqm
panel_43 = Panel("""0.0567
0.0142
0.0284
0.0567
0.0071
0.0709
0.0284
0.0121
0.0362
0.0121
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""")
panel_44 = Panel("""0.0063
0.0314
0.0251
0.0063
0.0063
0.0126
0.0314
0.0251
0.0189
0.0126
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""")
merge_6 = Merge(Data1=panel_43, Data2=panel_44)

geo_5 = Geometry([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])

geo_6 = Geometry([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])

geo_7 = Geometry([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])

geo_8 = Geometry([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])

boundary = BoundarySurfaces(Edges=geo)
preview = CustomPreview(Geometry=boundary, Material=ColourSwatch(SwatchColor=RGB(204, 0, 255)))

boundary_2 = BoundarySurfaces(Edges=geo_2)
preview_2 = CustomPreview(Geometry=boundary_2, Material=ColourSwatch(SwatchColor=RGB(0, 255, 30)))

boundary_3 = BoundarySurfaces(Edges=geo_3)
preview_3 = CustomPreview(Geometry=boundary_3, Material=ColourSwatch(SwatchColor=RGB(255, 0, 0)))

boundary_4 = BoundarySurfaces(Edges=geo_4)
preview_4 = CustomPreview(Geometry=boundary_4, Material=ColourSwatch(SwatchColor=RGB(0, 38, 255)))

geo_9 = Geometry([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])

geo_10 = Geometry([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])

geo_11 = Geometry([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])

geo_12 = Geometry([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])

boundary_5 = BoundarySurfaces(Edges=geo_5)
preview_5 = CustomPreview(Geometry=boundary_5, Material=ColourSwatch(SwatchColor=RGB(255, 0, 0)))

boundary_6 = BoundarySurfaces(Edges=geo_6)
preview_6 = CustomPreview(Geometry=boundary_6, Material=ColourSwatch(SwatchColor=RGB(0, 38, 255)))

boundary_7 = BoundarySurfaces(Edges=geo_8)
preview_7 = CustomPreview(Geometry=boundary_7, Material=ColourSwatch(SwatchColor=RGB(204, 0, 255)))

boundary_8 = BoundarySurfaces(Edges=geo_7)
preview_8 = CustomPreview(Geometry=boundary_8, Material=ColourSwatch(SwatchColor=RGB(0, 255, 30)))

boundary_9 = BoundarySurfaces(Edges=geo_11)
preview_9 = CustomPreview(Geometry=boundary_9, Material=ColourSwatch(SwatchColor=RGB(204, 0, 255)))

boundary_10 = BoundarySurfaces(Edges=geo_12)
preview_10 = CustomPreview(Geometry=boundary_10, Material=ColourSwatch(SwatchColor=RGB(0, 255, 30)))

boundary_11 = BoundarySurfaces(Edges=geo_9)
preview_11 = CustomPreview(Geometry=boundary_11, Material=ColourSwatch(SwatchColor=RGB(255, 0, 0)))

boundary_12 = BoundarySurfaces(Edges=geo_10)
preview_12 = CustomPreview(Geometry=boundary_12, Material=ColourSwatch(SwatchColor=RGB(0, 38, 255)))

panel_53 = Panel("BLOCK BOUNDARIES")
curve = Curve([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])

# ----
# Geometric Input
merge_7 = Merge(Data1=geo, Data2=geo_2, Data3=geo_3, Data4=geo_4)

curve_2 = Curve([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])

curve_3 = Curve([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])

# ----
# Geometric Input
merge_8 = Merge(Data1=geo_8, Data2=geo_7, Data3=geo_5, Data4=geo_6)

# ----
# total # of parcels in the neighborhood
lng_4 = ListLength(List=merge_8)

series_4 = Series(Start=0, Step=1, Count=lng_4)

# ----
# Geometric Input
merge_9 = Merge(Data1=geo_11, Data2=geo_12, Data3=geo_9, Data4=geo_10)

# ----
# 0: Bahçelievler, Ankara
# 1: Yukarı Bahçelievler, Ankara
# 2: Emek, Ankara
number_slider = Slider(0, range=0..2)
panel_56 = Panel("""0
1
2""")
item_2 = ListItem(List=panel_56, Index=number_slider, Wrap=True)

# ----
# COPboiler
toggle = BooleanToggle(True)
path = FilePath("C:\KBEM\IP2.1\Retrofit\RETROFIT_BuildingBased_COPboiler.csv")
readxl = ReadExcelSheet(Run=toggle, FilePath=path, Worksheet="1", Listen=False)  # -> UserMessages, Columns, Rows
roundd = RoundToDecimalPlace(NumberX=readxl.Columns, DecimalPlace="3", RoundType=0)  # -> Rounded, Difference

# ----
# uwindow
toggle_2 = BooleanToggle(True)
path_2 = FilePath("C:\KBEM\IP2.1\Retrofit\RETROFIT_BuildingBased_uwindow.csv")
readxl_2 = ReadExcelSheet(Run=toggle_2, FilePath=path_2, Worksheet="1", Listen=False)  # -> UserMessages, Columns, Rows
roundd_2 = RoundToDecimalPlace(NumberX=readxl_2.Columns, DecimalPlace="3", RoundType=0)  # -> Rounded, Difference

# ----
# shgc
toggle_3 = BooleanToggle(True)
path_3 = FilePath("C:\KBEM\IP2.1\Retrofit\RETROFIT_BuildingBased_shgc.csv")
readxl_3 = ReadExcelSheet(Run=toggle_3, FilePath=path_3, Worksheet="1", Listen=False)  # -> UserMessages, Columns, Rows
roundd_3 = RoundToDecimalPlace(NumberX=readxl_3.Columns, DecimalPlace="3", RoundType=0)  # -> Rounded, Difference

# ----
# uRoof
toggle_4 = BooleanToggle(True)
path_4 = FilePath("C:\KBEM\IP2.1\Retrofit\RETROFIT_BuildingBased_uroof.csv")
readxl_4 = ReadExcelSheet(Run=toggle_4, FilePath=path_4, Worksheet="1", Listen=False)  # -> UserMessages, Columns, Rows
roundd_4 = RoundToDecimalPlace(NumberX=readxl_4.Columns, DecimalPlace="3", RoundType=0)  # -> Rounded, Difference

# ----
# uground
toggle_5 = BooleanToggle(True)
path_5 = FilePath("C:\KBEM\IP2.1\Retrofit\RETROFIT_BuildingBased_uground.csv")
readxl_5 = ReadExcelSheet(Run=toggle_5, FilePath=path_5, Worksheet="1", Listen=False)  # -> UserMessages, Columns, Rows
roundd_5 = RoundToDecimalPlace(NumberX=readxl_5.Columns, DecimalPlace="3", RoundType=0)  # -> Rounded, Difference

# ----
# uWall
toggle_6 = BooleanToggle(True)
path_6 = FilePath("C:\KBEM\IP2.1\Retrofit\RETROFIT_BuildingBased_uwall.csv")
readxl_6 = ReadExcelSheet(Run=toggle_6, FilePath=path_6, Worksheet="1", Listen=False)  # -> UserMessages, Columns, Rows
roundd_6 = RoundToDecimalPlace(NumberX=readxl_6.Columns, DecimalPlace="3", RoundType=0)  # -> Rounded, Difference

# ----
# infiltration
toggle_7 = BooleanToggle(True)
path_7 = FilePath("C:\KBEM\IP2.1\Retrofit\RETROFIT_BuildingBased_infiltration.csv")
readxl_7 = ReadExcelSheet(Run=toggle_7, FilePath=path_7, Worksheet="1", Listen=False)  # -> UserMessages, Columns, Rows
roundd_7 = RoundToDecimalPlace(NumberX=readxl_7.Columns, DecimalPlace="6", RoundType=0)  # -> Rounded, Difference

# ----
# # of units
panel_57 = Panel("""minimum stair dimensions
2m*4m""")
# RESULT
# ToDO
# old
# note it down resources
geo_13 = Geometry([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])

# ----
# Data Challenges: # of floors and # of units in the building can not match. for some cases # of floors is higher than # of units in the building
# 
# 
# https://docs.google.com/document/d/1INWO2i1du29ZDZWHUi1IJCvi89qGMdNHIzGieotD-bE/edit
panel_58 = Panel("Radius")
_40 = Data(40)

# ----
# Reference Vector
pt = ConstructPoint(XCoordinate=0, YCoordinate=0, ZCoordinate=0)
pt_2 = Point(Point(485242, 4421817, 0))
# VISUAL
# OUTPUT
# INPUT
vec2pt = Vector2Pt(PointA=pt_2, PointB=pt, Unitize=False)  # -> Vector, Length

panel_59 = Panel("Commercial")
weave = Weave(Pattern=item_2, Stream0=geo_7, Stream1=geo_12, Stream2=geo_2, NullGaps=False)

# ----
# neighborhood selection
panel_60 = Panel("parcelsGeometry")
weave_2 = Weave(Pattern=item_2, Stream0=merge_8, Stream1=merge_9, Stream2=merge_7, NullGaps=False)

# ----
# Real Data
# Building
# Parcel No
weave_3 = Weave(Pattern=item_2, Stream0=panel_17, Stream1=panel_24, Stream2=panel_19, NullGaps=False)

weave_4 = Weave(Pattern=item_2, Stream0=const_date_3, Stream1=const_date_2, Stream2=const_date, NullGaps=False)
panel_61 = Panel("Construction Date")

panel_62 = Panel("staircase ratio")

panel_63 = Panel("Public")
weave_5 = Weave(Pattern=item_2, Stream0=geo_5, Stream1=geo_9, Stream2=geo_3, NullGaps=False)

# ----
# VENTILATION PER AREA
# DO NOT USE WITH RESIDENTIAL AND OFFICE UNITS: it works with specific zone types (cleanroom, laboratories)
# http://hydrashare.github.io/hydra/viewer?owner=chriswmackey&fork=hydra_2&id=Customizing_HVAC_Systems&slide=0&scale=2.0000000000000018&offset=-769.4718387139474,-192.523115453532
boolean_toggle = BooleanToggle(False)
ach2m3_s_m2_calculator = Honeybee_infORventPerAreaCalculator(airFlowRate="0.0003", ACHorM3sM2=boolean_toggle)  # -> readMe, infPerAreaFacade, ventPerAreaFloor, allExposed, allFloors; plug-in component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

panel_64 = Panel("blockGeometry")
weave_6 = Weave(Pattern=item_2, Stream0=curve_2, Stream1=curve_3, Stream2=curve, NullGaps=False)

weave_7 = Weave(Pattern=item_2, Stream0=parcelubem_6, Stream1=parcelubem_4, Stream2=parcelubem_3, NullGaps=False)
panel_65 = Panel("parcelUBEM")

weave_8 = Weave(Pattern=item_2, Stream0=panel_23, Stream1=real_data_of_floor_2, Stream2=real_data_of_floor, NullGaps=False)
panel_66 = Panel("""Real Data
# of floor """)

# ----
# INFO/EXTRA
floor_height = Panel("3")

panel_67 = Panel("School")
weave_9 = Weave(Pattern=item_2, Stream0=geo_6, Stream1=geo_10, Stream2=geo_4, NullGaps=False)

weave_10 = Weave(Pattern=item_2, Stream0=block_ubem_3, Stream1=block_ubem_2, Stream2=block_ubem, NullGaps=False)
panel_68 = Panel("blockUBEM")

# ----
# # of Units of
# the building
weave_11 = Weave(Pattern=item_2, Stream0=python_3.a, Stream1=of_units_of_the_building_2, Stream2=of_units_of_the_building, NullGaps=False)

# ----
# Building-based
panel_69 = Panel(roundd_6.Rounded)
# SMALLEST
# SUB-STEPS
# TEST
# SUB-STEPS
# STEPS
tolerance = Panel("0.5")

# ----
# Generated
# # of Units
# Per Floor
weave_12 = Weave(Pattern=item_2, Stream0=round_4.Floor, Stream1=round_3.Floor, Stream2=round_2.Floor, NullGaps=False)

data_3 = Data([5.85, 4.16, 5.67, 2.45, 6.8, 4.74, 5.67])

# ----
# Geometric Input
swatch = ColourSwatch(SwatchColor=RGB(0, 0, 0))
wires = BrepWireframe(Brep=weave_2, Density=-1)
preview_13 = CustomPreview(Geometry=wires, Material=swatch)

cls = Closed(Curve=weave_2)  # -> Closed, Periodic
dispatch_6 = Dispatch(List=weave_2, DispatchPattern=cls.Closed)  # -> ListA, ListB

# ---- group: if it is not closed
geo_14 = Geometry(dispatch_6.ListB)

# ----
geo_15 = Geometry(weave_6)
# x
# x
# x
# x
# x
# x
# x
# x
# x
# x
# x
# x
# x
# x
# x
# x
# x
# x
# x
# x
# x
# x
panel_70 = Panel("BLOCK BOUNDARIES")

# ----
# Sort Blocks by X,Y Coordinates
area = Area(Geometry=geo_15)  # -> Area, Centroid
pdecon = Deconstruct(Point=area.Centroid)  # -> graft(XComponent), graft(YComponent), ZComponent
avr = Average(Input=[pdecon.XComponent, pdecon.YComponent])  # -> flatten(ArithmeticMean)
sort = SortList(Keys=avr, ValuesA=geo_15)  # -> Keys, ValuesA

panel_71 = Panel("""SORTED 
BLOCKS""")
sorted_parcels = Geometry(sort.ValuesA)

panel_72 = Panel("PARCELS")
area_2 = Area(Geometry=weave_2)  # -> Area, Centroid

# ----
# Curve selection is important: while setting curves; start selection with the curve at the left bottom corner (so that sorting will start there)
# Building footprint curves in each parcel
incurve = PointInCurve(Point=area_2.Centroid, Curve=graft(sorted_parcels))  # -> Relationship, Point
if_it_is_inside = Panel("2")
equals_5 = Equality(FirstNumber=incurve.Relationship, SecondNumber=if_it_is_inside)  # -> Equality, Inequality
dispatch_7 = Dispatch(List=incurve.Point, DispatchPattern=equals_5.Equality)  # -> simplify(ListA), ListB
fsim = FindSimilarMember(Data=dispatch_7.ListA, Set=area_2.Centroid)  # -> Hit, Index

panel_73 = Panel("""SORTED 
PARCELS""")
item_3 = ListItem(List=weave_2, Index=fsim.Index, Wrap=True)

# ----
# Cull Empty Blocks
lng_5 = ListLength(List=item_3)  # -> flatten(Length)
equals_6 = Equality(FirstNumber=lng_5, SecondNumber="0")  # -> Equality, Inequality
panel_74 = Panel(equals_6.Equality)
viewer = ParamViewer(item_3)
not = GateNot(A=panel_74)
python_5 = PythonScript(InList=panel_74)  # -> TrueList, FalseList; inputs InList: list
# ---------- python_5: Python ----------
TrueList = []
FalseList = []
for id,value in enumerate(InList):
    if value == "True":
        TrueList.append(id)
    else:
        FalseList.append(id)
# ---------- end python_5 ----------
cull = CullPattern(List=viewer, CullPattern=not)
branch = TreeBranch(Tree=item_3, Path=cull, MaintainPaths=True)  # -> simplify(Branch)
lng_6 = ListLength(List=branch)  # -> flatten(Length)

partition_2 = PartitionList(List=flatten(branch), Size=lng_6)  # -> simplify(Chunks)
panel_75 = Panel("""CULLED 
EMPTY
BLOCKS""")

geo_16 = Geometry(partition_2)

# ---- group: BLOCKS
geo_17 = Geometry(sorted_parcels)
cull_i = CullIndex(List=geo_17, Indices=python_5.TrueList, Wrap=True)

# ----
area_3 = Area(Geometry=geo_16)  # -> Area, Centroid
fline = FitLine(Points=area_3.Centroid)

# ----
# Fit Line for the parcels in the block
null = NullItem(Item=fline)  # -> flatten(NullFlags), InvalidFlags, Description
# # of parcels
panel_77 = Panel(null.NullFlags)
python_6 = PythonScript(InList=panel_77)  # -> TrueList, FalseList; inputs InList: list; same code as python_5

crv_cp = CurveClosestPoint(Point=area_3.Centroid, Curve=fline)  # -> Point, Parameter, Distance
avr_2 = Average(Input=crv_cp.Distance)
smaller = SmallerThan(FirstNumber=avr_2, SecondNumber="5")  # -> flatten(SmallerThan), OrEqualTo
panel_78 = Panel(smaller.SmallerThan)
python_7 = PythonScript(InList=panel_78)  # -> TrueList, FalseList; inputs InList: list; same code as python_5

# ----
# Parcels with two or more lines
lng_7 = ListLength(List=cull_i)
series_5 = Series(Start=0, Step=1, Count=lng_7)
merge_10 = Merge(Data1=python_6.TrueList, Data2=python_7.TrueList)
cull_i_2 = CullIndex(List=series_5, Indices=merge_10, Wrap=True)

area_4 = Area(Geometry=geo_15)  # -> Area, Centroid
panel_79 = Panel("""CULLED 
EMPTY
PARCELS""")

# ----
# Parcels with less than two lines
item_4 = ListItem(List=series_5, Index=merge_10, Wrap=True)
branch_2 = TreeBranch(Tree=area_3.Centroid, Path=item_4, MaintainPaths=True)
fline_2 = FitLine(Points=branch_2)
avr_3 = Average(Input=area_4.Centroid)
Y = UnitY(Factor="1000")
move = Move(Geometry=avr_3, Motion=Y)  # -> Geometry, Transform
end = EndPoints(Curve=fline_2)  # -> Start, End
vec2pt_2 = Vector2Pt(PointA=avr_3, PointB=move.Geometry, Unitize=Toggle(True))  # -> Vector, Length
vec2pt_3 = Vector2Pt(PointA=end.Start, PointB=end.End, Unitize=Toggle(True))  # -> Vector, Length
dprod = DotProduct(VectorA=vec2pt_3.Vector, VectorB=vec2pt_2.Vector, Unitize=False)

# ----
# horizontal fitted lines:
# parcels with less than two lines
abs = Absolute(Value=dprod)
smaller_2 = SmallerThan(FirstNumber=abs, SecondNumber="0.5")  # -> flatten(SmallerThan), OrEqualTo
viewer_2 = ParamViewer(abs)
dispatch_8 = Dispatch(List=viewer_2, DispatchPattern=smaller_2.SmallerThan)  # -> ListA, ListB
branch_3 = TreeBranch(Tree=geo_16, Path=dispatch_8.ListA, MaintainPaths=True)
area_5 = Area(Geometry=branch_3)  # -> Area, Centroid
pdecon_2 = Deconstruct(Point=area_5.Centroid)  # -> XComponent, YComponent, ZComponent
sort_2 = SortList(Keys=pdecon_2.XComponent, ValuesA=branch_3)  # -> Keys, ValuesA

# ----
# single parcels in the block
# parcels with less than two lines
null_2 = NullItem(Item=dprod)  # -> NullFlags, InvalidFlags, Description
dispatch_9 = Dispatch(List=branch_2, DispatchPattern=null_2.NullFlags)  # -> ListA, ListB
viewer_3 = ParamViewer(dispatch_9.ListA)
dispatch_10 = Dispatch(List=viewer_3, DispatchPattern=flatten(null_2.NullFlags))  # -> ListA, ListB
branch_4 = TreeBranch(Tree=geo_16, Path=dispatch_10.ListA, MaintainPaths=True)

# ----
# vertical fitted lines:
# parcels with less than two lines
abs_2 = Absolute(Value=dprod)
similar = Similarity(FirstNumber=abs_2, SecondNumber="1", Threshold="10")  # -> flatten(Similarity), AbsoluteDifference
panel_80 = Panel(similar.Similarity)
viewer_4 = ParamViewer(abs_2)
dispatch_11 = Dispatch(List=viewer_4, DispatchPattern=panel_80)  # -> ListA, ListB
branch_5 = TreeBranch(Tree=geo_16, Path=dispatch_11.ListA, MaintainPaths=True)
area_6 = Area(Geometry=branch_5)  # -> Area, Centroid
pdecon_3 = Deconstruct(Point=area_6.Centroid)  # -> XComponent, YComponent, ZComponent
sort_3 = SortList(Keys=pdecon_3.YComponent, ValuesA=branch_5)  # -> Keys, ValuesA

# ----
# Parcels with two or more lines
panel_81 = Panel("{}")
split = TextSplit(Text=flatten(dispatch_11.ListA), Separators=flatten("{}"))
split_2 = TextSplit(Text=flatten(dispatch_8.ListA), Separators=flatten(panel_81))
split_3 = TextSplit(Text=flatten(dispatch_10.ListA), Separators=flatten("{}"))
item_5 = ListItem(List=split_2, Index="1", Wrap=True)  # -> flatten(Item)
item_6 = ListItem(List=split, Index="1", Wrap=True)  # -> flatten(Item)
item_7 = ListItem(List=split_3, Index="1", Wrap=True)  # -> flatten(Item)
merge_11 = Merge(Data1=item_7, Data2=item_6, Data3=item_5)
data_4 = Data(item_4)
equals_7 = Equality(FirstNumber=data_4, SecondNumber=graft(merge_11))  # -> Equality, Inequality
panel_82 = Panel(equals_7.Equality)
python_8 = PythonScript(InList=panel_82)  # -> flatten(TrueList), FalseList; inputs InList: list; same code as python_5
cull_i_3 = CullIndex(List=data_4, Indices=python_8.TrueList, Wrap=True)
ins = InsertItems(List=cull_i_2, Item=cull_i_3, Indices=Toggle(False), Wrap=True)
sort_4 = SortList(Keys=ins, ValuesA=ins)  # -> Keys, ValuesA

geo_18 = Geometry(sorted_parcels)
cull_i_4 = CullIndex(List=geo_18, Indices=python_5.TrueList, Wrap=True)
geo_19 = Geometry(simplify(graft(cull_i_4)))

# ----
# Parcels with two or more line indices
data_5 = Data(sort_4.ValuesA)

branch_6 = TreeBranch(Tree=area_3.Centroid, Path=data_5, MaintainPaths=True)
branch_7 = TreeBranch(Tree=geo_19, Path=data_5, MaintainPaths=True)
disc = Discontinuity(Curve=branch_7, Level=1)  # -> simplify(Points), Parameters
area_7 = Area(Geometry=branch_7)  # -> Area, flatten(Centroid)
vec2pt_4 = Vector2Pt(PointA=graft(area_7.Centroid), PointB=simplify(branch_6), Unitize=False)  # -> simplify(Vector), Length
merge_12 = Merge(Data1=branch_6, Data2=disc.Points)
plfit = PlaneFit(Points=merge_12)  # -> Plane, Deviation
unit = UnitVector(Vector=vec2pt_4.Vector)
# Defining Positions of Parcels in the Block
# according to degree
deplane = DeconstructPlane(Plane=plfit.Plane)  # -> Origin, XAxis, YAxis, ZAxis
abs_3 = Absolute(Value=deplane.XAxis)
neg = Negative(Value=abs_3)
dprod_2 = DotProduct(VectorA=neg, VectorB=unit, Unitize=False)
dprod_3 = DotProduct(VectorA=deplane.YAxis, VectorB=unit, Unitize=False)
python_9 = GhPythonScript(x=dprod_2, y=dprod_3)  # -> out, a
# ---------- python_9: Python ----------
__author__ = "jhorikawa"
__version__ = "2020.07.27"

import rhinoscriptsyntax as rs
import math

a = math.atan2(x, y)
# ---------- end python_9 ----------

# ----
# single parcels in the block
# parcels with less than two lines
area_8 = Area(Geometry=branch_4)  # -> Area, Centroid

# ----
# vertical fitted lines:
# parcels with less than two lines
area_9 = Area(Geometry=sort_3.ValuesA)  # -> Area, Centroid

# ----
# horizontal fitted lines:
# parcels with less than two lines
area_10 = Area(Geometry=sort_2.ValuesA)  # -> Area, Centroid

# ----
# # of blocks in the neighborhood
lng_8 = ListLength(List=equals_6.Equality)

# ----
# 01.ORDERING BUILDINGS
# Define Empty List
panel_84 = Panel("empty")
dup = DuplicateData(Data=panel_84, Number=lng_8, Order=True)

# ----
# Buildings degrees of positions
deg = Degrees(Radians=python_9.a)

# ----
# sorted parcels which buildings included
geo_20 = Geometry(geo_17)

area_11 = Area(Geometry=geo_20)  # -> Area, Centroid
sorted_points = Point(flatten(area_11.Centroid))
lng_9 = ListLength(List=sorted_points)
series_6 = Series(Start="0", Step=1, Count=lng_9)  # -> simplify(Series)

# ----
# Empty Blocks
data_6 = Data(python_5.TrueList)
replace_2 = ReplaceItems(List=dup, Item="0", Indices=data_6, Wrap=False)

# ----
# Parcels with two or more lines
pdecon_4 = Deconstruct(Point=branch_6)  # -> XComponent, YComponent, ZComponent
addition_2 = Addition(A=pdecon_4.XComponent, B=pdecon_4.YComponent)
division_4 = Division(A=addition_2, B="2")
sort_5 = SortList(Keys=deg, ValuesA=branch_6)  # -> Keys, ValuesA
sort_6 = SortList(Keys=division_4, ValuesA=branch_6)  # -> Keys, ValuesA
item_8 = ListItem(List=sort_6.ValuesA, Index=0, Wrap=True)
equals_8 = Equality(FirstNumber=sort_5.ValuesA, SecondNumber=item_8)  # -> Equality, Inequality
panel_85 = Panel(equals_8.Equality)
python_10 = PythonScript(InList=panel_85)  # -> TrueList, FalseList; inputs InList: list; same code as python_5

data_7 = Data(series_6)
partition_3 = PartitionList(List=data_7, Size="1")  # -> simplify(Chunks)

# ----
# indices of buildings in parcels with two or more line
shift = ShiftList(List=sort_5.ValuesA, Shift=python_10.TrueList, Wrap=True)  # -> simplify(List)

# ----
# indices of buildings in parcels with two or more line
geo_21 = Geometry(shift)

merge_13 = Merge(Data1=geo_21, Data2=area_8.Centroid, Data3=area_9.Centroid, Data4=area_10.Centroid)  # -> simplify(Result)

# ----
# Not-Empty Blocks
tstat = TreeStatistics(Tree=merge_13)  # -> Paths, Length, Count
data_8 = Data(python_5.FalseList)
replace_3 = ReplaceItems(List=replace_2, Item=tstat.Length, Indices=data_8, Wrap=False)

geo_22 = Geometry(flatten(merge_13))
partition_4 = PartitionList(List=geo_22, Size=replace_3)  # -> simplify(Chunks)

listdexs_2 = ListIndices(List=partition_4)
lng_10 = ListLength(List=listdexs_2)
dup_2 = DuplicateData(Data=partition_3, Number=lng_10, Order=True)  # -> simplify(graft(Data))

merge_14 = Merge(Data1=graft(listdexs_2), Data2=simplify(dup_2))
join = TextJoin(Text=merge_14, Join="_")  # -> flatten(Result)
null_3 = NullItem(Item=join)  # -> NullFlags, InvalidFlags, Description
lng_11 = ListLength(List=listdexs_2)  # -> flatten(Length)
dispatch_12 = Dispatch(List=join, DispatchPattern=null_3.NullFlags)  # -> ListA, ListB
partition_5 = PartitionList(List=dispatch_12.ListB, Size=lng_11)  # -> simplify(Chunks)

# ----
# Empty List
# tag order for parcels
data_9 = Data(flatten(partition_5))

# ----
# Empty List
# tag order for parcels
data_10 = Data(flatten(partition_5))

branch_8 = TreeBranch(Tree=geo_16, Path=data_5, MaintainPaths=True)
sort_7 = SortList(Keys=deg, ValuesA=branch_8)  # -> Keys, ValuesA
shift_2 = ShiftList(List=sort_7.ValuesA, Shift=python_10.TrueList, Wrap=True)  # -> simplify(List)
merge_15 = Merge(Data1=shift_2, Data2=branch_4, Data3=sort_3.ValuesA, Data4=sort_2.ValuesA)

# ----
# # of parcels in the blocks
# complete list of THE NEIGHBORHOOD
lng_12 = ListLength(List=merge_15)  # -> flatten(Length)

# ----
# tag order for parcels
partition_6 = PartitionList(List=data_9, Size=lng_12)  # -> simplify(Chunks)

# ----
# # of parcels in the blocks
# complete list of THE NEIGHBORHOOD
lng_13 = ListLength(List=merge_15)  # -> flatten(Length)

# ----
# tag order for parcels
partition_7 = PartitionList(List=data_10, Size=lng_13)  # -> simplify(Chunks)

# ----
# tag order for parcels
swatch_2 = ColourSwatch(SwatchColor=RGB(8, 0, 255))
tag = TextTag3D(Location=partition_4, Text=partition_5, Size="3", Colour=swatch_2, Justification=7)

preview_14 = CustomPreview(Geometry=merge_15, Material=ColourSwatch(SwatchColor=RGB(0, 0, 0)))

tstat_2 = TreeStatistics(Tree=merge_15)  # -> Paths, Length, Count
panel_86 = Panel(tstat_2.Paths)

panel_87 = Panel(partition_5)

# ----
# public and school buildings excluded list
panel_88 = Panel("PARCELS")
geo_23 = Geometry(merge_15)

panel_89 = Panel("BLOCKS")
geo_24 = Geometry(cull_i)

# ----
# Input
lng_14 = ListLength(List=geo_24)
series_7 = Series(Start=0, Step=1, Count=lng_14)
branch_9 = TreeBranch(Tree=geo_23, Path=series_7, MaintainPaths=True)

# ----
# 4edged layout transformation has applied to all parcel layouts due to energy modeling standards of E+ (adjacency problems)
# 4 edges and others
debrep = DeconstructBrep(Brep=flatten(branch_9))  # -> Faces, Edges, Vertices
_4edged_transformation = Panel("4")
lng_15 = ListLength(List=debrep.Vertices)  # -> flatten(Length)
lng_16 = ListLength(List=branch_9)  # -> flatten(Length)
equals_9 = Equality(FirstNumber=lng_15, SecondNumber=_4edged_transformation)  # -> Equality, Inequality
partition_8 = PartitionList(List=flatten(equals_9.Equality), Size=lng_16)  # -> simplify(Chunks)
dispatch_13 = Dispatch(List=branch_9, DispatchPattern=partition_8)  # -> ListA, ListB

panel_90 = Panel("4 edges")
geo_25 = Geometry(dispatch_13.ListA)

panel_91 = Panel("More than 4 edges")
geo_26 = Geometry(dispatch_13.ListB)

geo_27 = Geometry(geo_26)

# ----
# ConvexToConcave
# Transformation
debrep_2 = DeconstructBrep(Brep=flatten(geo_27))  # -> Faces, Edges, simplify(Vertices)
hull = ConvexHull(Points=debrep_2.Vertices, Plane=PlaneXY(0, 0, 0))  # -> flatten(Hull), HullZ, Indices
area_12 = Area(Geometry=flatten(geo_27))  # -> Area, Centroid
original_values = Panel(area_12.Area)
xy = XYPlane(Origin=area_12.Centroid)
scale2area = ScaleToArea(Geometry=hull.Hull, Plane=xy, Area=original_values, FactorX=1, FactorY=1, FactorZ=1)  # -> Scaled, Transform

panel_93 = Panel("""Concave
To
Convex""")
geo_28 = Geometry(scale2area.Scaled)

# ----
# Degree Resolution
degreerangeratio = Panel("15")
division_5 = Division(A="360", B=degreerangeratio)
addition_3 = Addition(A=division_5, B="1")
series_8 = Series(Start=0, Step=degreerangeratio, Count=addition_3)

# ----
# FIT 4 edged rectangle
# select smallest one
area_13 = Area(Geometry=geo_28)  # -> Area, Centroid
pl = ConstructPlane(Origin=area_13.Centroid, XAxis=Vector(1, 0, 0), YAxis=Vector(0, 1, 0))
prot = RotatePlane(Plane=pl, Angle=series_8)
brec = BoundingRectangle(Geometry=graft(geo_28), Plane=prot, Axis=0, Slide=0, Union=True)  # -> flatten(Bounding), DimensionX, DimensionY
lng_17 = ListLength(List=geo_28)  # -> flatten(Length)
lng_18 = ListLength(List=brec.Bounding)
division_6 = Division(A=lng_18, B=lng_17)
partition_9 = PartitionList(List=brec.Bounding, Size=division_6)  # -> simplify(Chunks)
area_14 = Area(Geometry=partition_9)  # -> Area, Centroid
sort_8 = SortList(Keys=area_14.Area, ValuesA=partition_9)  # -> Keys, ValuesA
item_9 = ListItem(List=sort_8.ValuesA, Index=0, Wrap=True)  # -> flatten(Item)

geo_29 = Geometry(geo_26)

lng_19 = ListLength(List=geo_29)  # -> flatten(Length)
geo_30 = Geometry(item_9)
panel_95 = Panel("""4 edged
non organized""")
partition_10 = PartitionList(List=geo_30, Size=lng_19)  # -> simplify(Chunks)

# ----
# EdgeTo4
merge_16 = Merge(Data1=geo_25, Data2=partition_10)

# ----
# non-organized 4edged building floor layouts
geo_31 = Geometry(merge_16)

# ----
# public and school buildings excluded list
# organized non-4edged building floor layouts
geo_32 = Geometry(merge_15)

# ----
# public and school buildings
merge_17 = Merge(Data1=weave, Data2=weave_5, Data3=weave_9)
disc_2 = Discontinuity(Curve=merge_17, Level=1)  # -> Points, Parameters
hull_2 = ConvexHull(Points=disc_2.Points, Plane=PlaneXY(0, 0, 0))  # -> flatten(Hull), HullZ, Indices

# ----
# Re-Organize list
area_15 = Area(Geometry=geo_31)  # -> Area, Centroid
# 02.SIMPLIFICATION
area_16 = Area(Geometry=geo_32)  # -> Area, Centroid
cps = ClosestPoints(Point=area_16.Centroid, Cloud=area_15.Centroid, Count="1")  # -> ClosestPoint, flatten(CPIndex), Distance
lng_20 = ListLength(List=area_16.Centroid)
partition_11 = PartitionList(List=cps.CPIndex, Size=flatten(lng_20))  # -> simplify(Chunks)
item_10 = ListItem(List=geo_31, Index=partition_11, Wrap=True)
area_17 = Area(Geometry=item_10)  # -> Area, Centroid
incurves = PointInCurves(Point=area_17.Centroid, Curves=hull_2.Hull)  # -> Relationship, Index, Point
python_11 = GhPythonScript(x=incurves.Relationship)  # -> out, a; inputs x: list
# ---------- python_11: Python ----------
__author__ = "orcun"
__version__ = "2021.09.25"


import rhinoscriptsyntax as rs
a = []
'2 if it is inside'
for i in range(len(x)): 
    if x[i] == 2:
        a.append(i)
# ---------- end python_11 ----------

# ----
# # of parcels in the block
data_11 = Data(flatten(lng_20))

# ----
# public and school buildings excluded list
data_12 = Data(python_11.a)

partition_12 = PartitionList(List=series_4, Size=data_11)  # -> simplify(Chunks)
cull_i_5 = CullIndex(List=partition_12, Indices=data_12, Wrap=True)  # -> simplify(flatten(List))

# ----
# public and school buildings
item_11 = ListItem(List=partition_6, Index=python_11.a, Wrap=True)  # -> flatten(Item)

# ----
# public and school buildings
data_13 = Data(python_11.a)

# ----
# tag order for parcels
# public and school buildings excluded list
cull_i_6 = CullIndex(List=partition_6, Indices=data_13, Wrap=True)  # -> simplify(List)

lng_21 = ListLength(List=cull_i_6)
panel_96 = Panel("empty list")
dup_3 = DuplicateData(Data="empty", Number=lng_21, Order=True)  # -> simplify(flatten(Data))

# ----
# public and school buildings
item_12 = ListItem(List=partition_6, Index=python_11.a, Wrap=True)  # -> flatten(Item)

# ----
# Entering EKB Data
# for Masonry Wall
panel_97 = Panel("_")
join_2 = TextJoin(Text=merge, Join=panel_97)  # -> simplify(flatten(Result))
mindex = MemberIndex(Set=join_2, Member=item_12)  # -> flatten(Index), Count

# ----
# public and school buildings excluded list
cull_i_7 = CullIndex(List=join_2, Indices=mindex.Index, Wrap=True)

mindex_2 = MemberIndex(Set=flatten(cull_i_6), Member=cull_i_7)  # -> flatten(Index), Count
lng_22 = ListLength(List=mindex_2.Index)
series_9 = Series(Start=0, Step=1, Count=lng_22)
item_13 = ListItem(List=ekbuwallconcrete, Index=series_9, Wrap=True)

# ----
# public and school buildings
item_14 = ListItem(List=partition_7, Index=python_11.a, Wrap=True)  # -> flatten(Item)

# ----
# public and school buildings
data_14 = Data(python_11.a)

# ----
# tag order for parcels
# public and school buildings excluded list
cull_i_8 = CullIndex(List=partition_7, Indices=data_14, Wrap=True)  # -> simplify(List)

lng_23 = ListLength(List=cull_i_8)
dup_4 = DuplicateData(Data="empty", Number=lng_23, Order=True)  # -> simplify(flatten(Data))

panel_99 = Panel("block-list")
data_15 = Data(lng_20)

# ----
# public and school buildings excluded list
data_16 = Data(python_11.a)

# ----
# Parcel_Block Coordinates
area_18 = Area(Geometry=merge_8)  # -> Area, Centroid
pdecon_5 = Deconstruct(Point=area_18.Centroid)  # -> XComponent, YComponent, ZComponent
partition_13 = PartitionList(List=pdecon_5.XComponent, Size=flatten(data_15))  # -> simplify(Chunks)
partition_14 = PartitionList(List=pdecon_5.YComponent, Size=flatten(data_15))  # -> simplify(Chunks)
cull_i_9 = CullIndex(List=partition_14, Indices=data_16, Wrap=True)  # -> simplify(List)
cull_i_10 = CullIndex(List=partition_13, Indices=data_16, Wrap=True)  # -> simplify(List)
panel_100 = Panel(partition_14)
panel_101 = Panel(partition_13)

# ----
# RENEWABLE_AD
data_17 = Data(flatten(lng_20))
data_18 = Data(weave_8)
partition_15 = PartitionList(List=data_18, Size=data_17)
cull_i_11 = CullIndex(List=partition_15, Indices=python_11.a, Wrap=True)  # -> simplify(List)
multiplication = Multiplication(A=cull_i_11, B="3")
Z = UnitZ(Factor=multiplication)
extr = Extrude(Base=merge_15, Direction=Z)

# ----
# 4-edged
# Ordered
# Parcels
swatch_3 = ColourSwatch(SwatchColor=RGB(255, 255, 255))
geo_33 = Geometry(item_10)
preview_15 = CustomPreview(Geometry=geo_33, Material=swatch_3)

# ----
# x
# x
# x
# x
# x
# x
# x
# x
# x
# x
# x
# x
# x
# x
# x
# x
# x
# x
# x
# x
# x
# x
panel_102 = Panel("""simplified &
ordered
parcel
layouts""")

# ----
# public and school buildings excluded list
cull_i_12 = CullIndex(List=item_10, Indices=python_11.a, Wrap=True)  # -> simplify(List)

panel_103 = Panel("# of block")
lng_24 = ListLength(List=merge_15)  # -> flatten(Length)

# ----
# if necessary,
# select and simulate,
# only,
# according to construction date
panel_104 = Panel("construction date")
data_19 = Data(weave_4)

# ----
# CONSTRUCTION DATE SELECTION
# 0 means, no selection according to construction date
panel_105 = Panel("0")
data_20 = Data(panel_105)

partition_16 = PartitionList(List=data_19, Size=lng_24)  # -> simplify(Chunks)

# ----
# public and school buildings excluded list
data_21 = Data(python_11.a)

panel_106 = Panel("""1960
1980
2000""")
equals_10 = Equality(FirstNumber=data_20, SecondNumber=panel_106)  # -> Equality, Inequality
dcon = DeleteConsecutive(Set=equals_10.Equality, Wrap=False)  # -> Set, Count
item_15 = ListItem(List=dcon.Set, Index=0, Wrap=True)
python_12 = GhPythonScript(x=item_15)  # -> out, a
# ---------- python_12: Python ----------
__author__ = "Siser"
__version__ = "2022.01.08"

import rhinoscriptsyntax as rs
if x == True:
    a = 0
else:
    a = 1
# ---------- end python_12 ----------

cull_i_13 = CullIndex(List=partition_16, Indices=data_21, Wrap=True)  # -> simplify(List)

# ----
# # of units
toggle_8 = BooleanToggle(True)

panel_107 = Panel("0=masonry, 1=concrete")  # disabled
panel_108 = Panel("0")  # disabled
panel_109 = Panel("1")  # disabled

concrete = Panel("""0.567
1.149
1.024
1.800
1.008
1.740
0.312
2.826
0.531
0.623
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""")  # disabled
lng_25 = ListLength(List=concrete)  # disabled
dup_5 = DuplicateData(Data=panel_109, Number=lng_25, Order=True)  # disabled

masonry = Panel("""0.597
3.534
3.046
0.226
0.695
2.336
1.488
3.046
1.230
3.399
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""")  # disabled
lng_26 = ListLength(List=masonry)  # disabled
dup_6 = DuplicateData(Data=panel_108, Number=lng_26, Order=True)  # disabled

# ----
# public and school buildings excluded list
geo_34 = Geometry(cull_i_12)  # disabled
lng_27 = ListLength(List=flatten(geo_34))  # disabled

concrete_2 = Panel("163")  # disabled
masonry_2 = Panel("18")  # disabled
addition_4 = Addition(A=concrete_2, B=masonry_2)  # disabled

# ----
# organized 4edged
# building PARCELS
geo_35 = Geometry(cull_i_12)

# ----
# selection
# according to
# construction date
equals_11 = Equality(FirstNumber=cull_i_13, SecondNumber=data_20)  # -> Equality, Inequality
dispatch_14 = Dispatch(List=geo_35, DispatchPattern=equals_11.Equality)  # -> ListA, ListB
weave_13 = Weave(Pattern=python_12.a, Stream0=dispatch_14.ListA, Stream1=dispatch_14.ListB, NullGaps=False)  # -> simplify(Weave)

division_7 = Division(A=lng_27, B=addition_4)  # disabled
multiplication_2 = Multiplication(A=concrete_2, B=division_7)  # disabled
round_5 = Round(Number=multiplication_2)  # -> Nearest, Floor, Ceiling; disabled
subtraction = Subtraction(A=lng_27, B=round_5.Nearest)  # disabled

# ----
# all values are average
panel_110 = Panel("scheduleA")
genes = GenePool(Decimals=1, Maximum=1, Minimum=0, Value=[1, 1, 1, 1, 1, 1, 1, 1, 1, 1, 1, 1, 1, 1, 1, 1, 1, 1, 1, 1, 1, 1, 1, 1])

# ----
# Wall Construction
merge_18 = Merge(Data1=dup_6, Data2=dup_5)  # disabled
jitter_2 = Jitter(List=merge_18, Jitter=1, Seed=2)  # -> Values, Indices; disabled
weave_14 = Weave(Pattern=jitter_2.Values, Stream0=masonry, Stream1=concrete, NullGaps=False)  # disabled
panel_111 = Panel(weave_14)  # disabled

# ----
# 1 person
_1_person_percentage = Panel("17.9")

panel_112 = Panel("1 person percentage")
data_22 = Data(_1_person_percentage)

data_23 = Data(_1_person_percentage)

data_24 = Data(_1_person_percentage)

genes_2 = GenePool(
    Decimals=1,
    Maximum=1,
    Minimum=0,
    Value=[1, 1, 1, 1, 1, 1, 1, 1, 1, 1, 0.4, 0.4, 0.4, 0.6, 0.5, 0.5, 0.6, 0.4, 0.4, 0.4, 1, 1, 1, 1])

merge_19 = Merge(Data1=panel_110, Data2="scheduleB")
max = Maximum(A=genes, B=genes_2)
join_3 = TextJoin(Text=merge_19, Join="_")
panel_115 = Panel(join_3)

panel_116 = Panel("saturday")
# Since the leisure time data is not available in TUIK, modeling for the weekend was not done in the UBEM occupancy schedule modeling. SAME weekend values were determined for all daily schedule of occupant profiles.
genes_3 = GenePool(
    Decimals=1,
    Maximum=1,
    Minimum=0,
    Value=[1, 1, 1, 1, 1, 1, 1, 1, 0.3, 0.3, 0.3, 0.3, 0.3, 0.3, 0.7, 0.7, 0.7, 0.7, 0.7, 1, 1, 1, 1, 1])

# ----
# if construction date did not entered, no shuffling
python_13 = GhPythonScript(x=panel_105)  # -> out, a; inputs x: Int32
# ---------- python_13: Python ----------
__author__ = "Siser"
__version__ = "2022.02.03"

import rhinoscriptsyntax as rs
if x == 0:
    a = 0
else:
    a = 1
# ---------- end python_13 ----------

# ----
# seed
panel_117 = Panel("5")

genes_4 = GenePool(
    Decimals=1,
    Maximum=1,
    Minimum=0,
    Value=[1, 1, 1, 1, 1, 1, 1, 0.6, 0.6, 0.4, 0.4, 0, 0, 0, 0, 0, 0, 0.4, 0.4, 0.6, 0.6, 1, 1, 1])

merge_20 = Merge(Data1="scheduleC", Data2="scheduleB", Data3=panel_110)
max_2 = Maximum(A=genes_4, B=genes_2)
max_3 = Maximum(A=max_2, B=genes)
join_4 = TextJoin(Text=merge_20, Join="_")
panel_118 = Panel(join_4)

panel_119 = Panel("sunday")
genes_5 = GenePool(Decimals=1, Maximum=1, Minimum=0, Value=[1, 1, 1, 1, 1, 1, 1, 1, 1, 1, 1, 1, 1, 1, 1, 1, 1, 1, 1, 1, 1, 1, 1, 1])

annualschedule = Honeybee_AnnualSchedule(
    sun=genes_5,
    mon=genes_2,
    tue=genes_2,
    wed=genes_2,
    thu=genes_2,
    fri=genes_2,
    sat=genes_3,
    scheduleName="scheduleB",
    runIt=toggle_8)  # -> readMe, port, schedule, port_2, weekSched, schedIDFText; plug-in component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
panel_120 = Panel(annualschedule.weekSched)

annualschedule_2 = Honeybee_AnnualSchedule(sun=genes_5, mon=genes, tue=genes, wed=genes, thu=genes, fri=genes, sat=genes_3, scheduleName=panel_110, runIt=toggle_8)  # -> readMe, port, schedule, port_2, weekSched, schedIDFText; plug-in component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
panel_121 = Panel(annualschedule_2.weekSched)

panel_122 = Panel("adult")

concrete_3 = Panel(round_5.Nearest)  # disabled
masonry_3 = Panel(subtraction)  # disabled

merge_21 = Merge(Data1="scheduleC", Data2="scheduleB")
max_4 = Maximum(A=genes_4, B=genes_2)
join_5 = TextJoin(Text=merge_21, Join="_")
panel_125 = Panel(join_5)

genes_6 = GenePool(
    Decimals=1,
    Maximum=1,
    Minimum=0,
    Value=[0.9, 0.9, 0.9, 0.9, 0.9, 0.9, 0.9, 0.6, 0.6, 0.5, 0.5, 0.4, 0.4, 0.4, 0.4, 0.4, 0.4, 0.4, 0.4, 0.6, 0.6, 0.9, 0.9, 0.9])

annualschedule_3 = Honeybee_AnnualSchedule(
    sun=genes_5,
    mon=genes_6,
    tue=genes_6,
    wed=genes_6,
    thu=genes_6,
    fri=genes_6,
    sat=genes_3,
    scheduleName="scheduleD",
    runIt=toggle_8)  # -> readMe, port, schedule, port_2, weekSched, schedIDFText; plug-in component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
panel_126 = Panel(annualschedule_3.weekSched)

merge_22 = Merge(Data1="scheduleB", Data2="scheduleD", Data3=panel_110)
max_5 = Maximum(A=genes_2, B=genes_6)
join_6 = TextJoin(Text=merge_22, Join="_")
max_6 = Maximum(A=max_5, B=genes)
panel_127 = Panel(join_6)

merge_23 = Merge(Data1="scheduleC", Data2="scheduleD", Data3=panel_110)
max_7 = Maximum(A=genes_4, B=genes_6)
max_8 = Maximum(A=max_7, B=genes)
join_7 = TextJoin(Text=merge_23, Join="_")
panel_128 = Panel(join_7)

merge_24 = Merge(Data1="scheduleB", Data2="scheduleD")
max_9 = Maximum(A=genes_2, B=genes_6)
join_8 = TextJoin(Text=merge_24, Join="_")
panel_129 = Panel(join_8)

merge_25 = Merge(Data1="scheduleC", Data2="scheduleD")
max_10 = Maximum(A=genes_4, B=genes_6)
join_9 = TextJoin(Text=merge_25, Join="_")
panel_130 = Panel(join_9)

merge_26 = Merge(Data1=panel_110, Data2="scheduleD")
max_11 = Maximum(A=genes, B=genes_6)
join_10 = TextJoin(Text=merge_26, Join="_")
panel_131 = Panel(join_10)

# ----
# CONSTRUCTION DATE
# SELECTION PERCENTAGE
panel_132 = Panel("100")

panel_133 = Panel("selection ratio")
data_25 = Data(panel_132)

# ----
# if necessary,
# select and simulate,
# only,
# according to construction date
# and,
# percentage
# indices of
# selection ratio
jitter_3 = Jitter(List=weave_13, Jitter=python_13.a, Seed=2)  # -> simplify(Values), Indices
lng_28 = ListLength(List=weave_13)
division_8 = Division(A=lng_28, B=100)
multiplication_3 = Multiplication(A=division_8, B=data_25)
round_6 = Round(Number=multiplication_3)  # -> Nearest, Floor, Ceiling
series_10 = Series(Start=0, Step=1, Count=round_6.Nearest)  # -> simplify(Series)
item_16 = ListItem(List=jitter_3.Values, Index=series_10, Wrap=True)

# ----
# Ordered Building Layouts
geo_36 = Geometry(item_16)
# x
# x
# x
# x
# x
# x
# x
# x
# x
# x
# x
# x
# x
# x
# x
# x
# x
# x
# x
# x
# x
# x
preview_16 = CustomPreview(Geometry=geo_36, Material=ColourSwatch(SwatchColor=RGB(181, 0, 0)))

panel_134 = Panel("schedule_D")

panel_135 = Panel("schedule_B")

data_26 = Data(panel_117)
panel_137 = Panel("seed")

# ----
# 2 people
# 2 persons Family with Kids
annualschedule_4 = Honeybee_AnnualSchedule(sun=genes_5, mon=max, tue=max, wed=max, thu=max, fri=max, sat=genes_3, scheduleName=panel_115, runIt=toggle_8)  # -> readMe, port, schedule, port_2, weekSched, schedIDFText; plug-in component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
panel_138 = Panel(annualschedule_4.weekSched)

annualschedule_5 = Honeybee_AnnualSchedule(
    sun=genes_5,
    mon=max_10,
    tue=max_10,
    wed=max_10,
    thu=max_10,
    fri=max_10,
    sat=genes_3,
    scheduleName=join_9,
    runIt=toggle_8)  # -> readMe, port, schedule, port_2, weekSched, schedIDFText; plug-in component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
panel_139 = Panel(annualschedule_5.weekSched)

annualschedule_6 = Honeybee_AnnualSchedule(sun=genes_5, mon=max_9, tue=max_9, wed=max_9, thu=max_9, fri=max_9, sat=genes_3, scheduleName=join_8, runIt=toggle_8)  # -> readMe, port, schedule, port_2, weekSched, schedIDFText; plug-in component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
panel_140 = Panel(annualschedule_6.weekSched)

annualschedule_7 = Honeybee_AnnualSchedule(sun=genes_5, mon=max_4, tue=max_4, wed=max_4, thu=max_4, fri=max_4, sat=genes_3, scheduleName=join_5, runIt=toggle_8)  # -> readMe, port, schedule, port_2, weekSched, schedIDFText; plug-in component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
panel_141 = Panel(annualschedule_7.weekSched)

annualschedule_8 = Honeybee_AnnualSchedule(sun=genes_5, mon=max, tue=max, wed=max, thu=max, fri=max, sat=genes_3, scheduleName=panel_115, runIt=toggle_8)  # -> readMe, port, schedule, port_2, weekSched, schedIDFText; plug-in component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
panel_142 = Panel(annualschedule_8.weekSched)

annualschedule_9 = Honeybee_AnnualSchedule(
    sun=genes_5,
    mon=max_11,
    tue=max_11,
    wed=max_11,
    thu=max_11,
    fri=max_11,
    sat=genes_3,
    scheduleName=join_10,
    runIt=toggle_8)  # -> readMe, port, schedule, port_2, weekSched, schedIDFText; plug-in component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
panel_143 = Panel(annualschedule_9.weekSched)

annualschedule_10 = Honeybee_AnnualSchedule(
    sun=genes_5,
    mon=genes_2,
    tue=genes_2,
    wed=genes_2,
    thu=genes_2,
    fri=genes_2,
    sat=genes_3,
    scheduleName="scheduleB",
    runIt=toggle_8)  # -> readMe, port, schedule, port_2, weekSched, schedIDFText; plug-in component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
panel_144 = Panel(annualschedule_10.weekSched)

annualschedule_11 = Honeybee_AnnualSchedule(sun=genes_5, mon=genes, tue=genes, wed=genes, thu=genes, fri=genes, sat=genes_3, scheduleName=panel_110, runIt=toggle_8)  # -> readMe, port, schedule, port_2, weekSched, schedIDFText; plug-in component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
panel_145 = Panel(annualschedule_11.weekSched)

annualschedule_12 = Honeybee_AnnualSchedule(sun=genes_5, mon=max_9, tue=max_9, wed=max_9, thu=max_9, fri=max_9, sat=genes_3, scheduleName=join_8, runIt=toggle_8)  # -> readMe, port, schedule, port_2, weekSched, schedIDFText; plug-in component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
panel_146 = Panel(annualschedule_12.weekSched)

annualschedule_13 = Honeybee_AnnualSchedule(
    sun=genes_5,
    mon=max_11,
    tue=max_11,
    wed=max_11,
    thu=max_11,
    fri=max_11,
    sat=genes_3,
    scheduleName=join_10,
    runIt=toggle_8)  # -> readMe, port, schedule, port_2, weekSched, schedIDFText; plug-in component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
panel_147 = Panel(annualschedule_13.weekSched)

annualschedule_14 = Honeybee_AnnualSchedule(
    sun=genes_5,
    mon=genes_2,
    tue=genes_2,
    wed=genes_2,
    thu=genes_2,
    fri=genes_2,
    sat=genes_3,
    scheduleName="scheduleB",
    runIt=toggle_8)  # -> readMe, port, schedule, port_2, weekSched, schedIDFText; plug-in component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
panel_148 = Panel(annualschedule_14.weekSched)

annualschedule_15 = Honeybee_AnnualSchedule(
    sun=genes_5,
    mon=genes_6,
    tue=genes_6,
    wed=genes_6,
    thu=genes_6,
    fri=genes_6,
    sat=genes_3,
    scheduleName="scheduleD",
    runIt=toggle_8)  # -> readMe, port, schedule, port_2, weekSched, schedIDFText; plug-in component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
panel_149 = Panel(annualschedule_15.weekSched)

# ----
# x
# x
# x
# x
# x
# x
# x
# x
# x
# x
# x
# x
# x
# x
# x
# x
# x
# x
# x
# x
# x
# x
# organized 4edged building PARCELS
geo_37 = Geometry(item_16)

# ----
# Check for UV organization of surface
geo_38 = Geometry(flatten(geo_37))
disc_3 = Discontinuity(Curve=geo_38, Level=1)  # -> Points, Parameters
hull_3 = ConvexHull(Points=disc_3.Points, Plane=PlaneXY(0, 0, 0))  # -> flatten(Hull), HullZ, Indices
boundary_13 = BoundarySurfaces(Edges=hull_3.Hull)
wires_2 = BrepWireframe(Brep=boundary_13, Density=-1)  # -> simplify(Wireframe)
len = Length(Curve=wires_2)
partition_17 = PartitionList(List=boundary_13, Size="1")  # -> simplify(Chunks)
listdexs_3 = ListIndices(List=len)
sort_9 = SortList(Keys=len, ValuesA=listdexs_3)  # -> Keys, reverse(ValuesA)
md_slider = MDSlider(SliderMode=0, slider_value=Point(0.5, 0.5, 0.5), x_domain=Domain(0, 1), y_domain=Domain(0, 1), z_domain=Domain(0, 1))
item_17 = ListItem(List=sort_9.ValuesA, Index=0, Wrap=True)
iso = IsoCurve(Surface=reparameterize(boundary_13), UVPoint=md_slider)  # -> simplify(UIsocurve), VIsocurve
item_18 = ListItem(List=wires_2, Index=item_17, Wrap=True)
colom = CollisionOneMany(Collider=iso.UIsocurve, Obstacles=item_18)  # -> Collision, Index
dispatch_15 = Dispatch(List=partition_17, DispatchPattern=colom.Collision)  # -> simplify(ListA), ListB
clean = CleanTree(RemoveNulls=True, RemoveInvalid=True, RemoveEmpty=Toggle(True), Tree=dispatch_15.ListA)

_2_people_percentage = Panel("19.1")

panel_150 = Panel("-")

# ----
# 2 persons Family no Family
_2_people_percentage_2 = Panel("2.0")

panel_154 = Panel(panel_142)
panel_155 = Panel("Normalized (sch_x*sch_y)")

panel_158 = Panel(panel_145)

panel_160 = Panel(panel_147)

panel_161 = Panel(panel_146)

panel_165 = Panel(panel_148)

panel_167 = Panel(panel_149)

panel_169 = Panel(panel_140)

panel_171 = Panel(panel_144)

panel_173 = Panel(panel_143)

panel_175 = Panel(panel_141)

panel_177 = Panel(panel_139)

panel_179 = Panel(panel_138)

# ----
# Implementation of Real Data
# for Flat per Floor
# (division numbers,
# percentage for divisions)
unit_per_floor_division = Panel("""1
2
3
4""")
# room number: 50 To 95
# 95 To 140
# 140 To 185
# Implementation of Real Data
# for Unit Sqm
panel_180 = Panel("3")

data_27 = Data(panel_117)

data_28 = Data(panel_117)

# ----
# reverse UV of surfaces
data_29 = Data(flatten(clean))
srf = Surface(reparameterize(data_29))
python_14 = PythonScript(s=srf, swapUV=Toggle(True), reverseU=Toggle(False), reverseV=Toggle(False))  # -> out, anchor, uVec, vVec, revSrf; inputs s: Surface, swapUV: Int32, reverseU: Int32, reverseV: Int32
# ---------- python_14: Python ----------
import Rhino

if reverseU:
    uS,uE = s.Domain(0)
    inter0 = Rhino.Geometry.Interval(-uE, -uS)
    s.SetDomain(0,inter0)
    s = s.Reverse(0)

if reverseV:
    vS,vE = s.Domain(1)
    inter1 = Rhino.Geometry.Interval(-vE, -vS)
    s.SetDomain(1,inter1)
    s = s.Reverse(1)

if swapUV:
    s = s.Transpose()

anchor = s.PointAt(0,0)
uend = s.PointAt(0.5,0)
vend = s.PointAt(0,0.5)
uVec = uend - anchor
vVec = vend - anchor

revSrf = s
# ---------- end python_14 ----------

panel_183 = Panel("""UBEM 
Parcel No
List""")
data_30 = Data(weave_3)

# ----
# block number division
panel_184 = Panel("0")
equals_12 = Equality(FirstNumber=data_30, SecondNumber=panel_184)  # -> Equality, Inequality
num = Number(equals_12.Equality)
num_2 = Number("1")
lng_29 = ListLength(List=num)
mindex_3 = MemberIndex(Set=num, Member=num_2)  # -> Index, Count
merge_27 = Merge(Data1="0", Data2=lng_29)
panel_185 = Panel("""0
-1""")
ins_2 = InsertItems(List=mindex_3.Index, Item=merge_27, Indices=panel_185, Wrap=True)
cull_i_14 = CullIndex(List=ins_2, Indices="-1", Wrap=True)
shift_3 = ShiftList(List=ins_2, Shift=1, Wrap=Toggle(False))
subtraction_2 = Subtraction(A=shift_3, B=cull_i_14)

data_31 = Data(panel_117)

u = ColourSwatch(SwatchColor=RGB(2, 4, 255))
v = ColourSwatch(SwatchColor=RGB(225, 0, 0))
vdisex = VectorDisplayEx(Point=python_14.anchor, Vector=python_14.uVec, Colour=u, Width=3)
vdisex_2 = VectorDisplayEx(Point=python_14.anchor, Vector=python_14.vVec, Colour=v, Width=3)

annualschedule_16 = Honeybee_AnnualSchedule(sun=genes_5, mon=max_8, tue=max_8, wed=max_8, thu=max_8, fri=max_8, sat=genes_3, scheduleName=join_7, runIt=toggle_8)  # -> readMe, port, schedule, port_2, weekSched, schedIDFText; plug-in component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
panel_187 = Panel(annualschedule_16.weekSched)

annualschedule_17 = Honeybee_AnnualSchedule(sun=genes_5, mon=max_6, tue=max_6, wed=max_6, thu=max_6, fri=max_6, sat=genes_3, scheduleName=join_6, runIt=toggle_8)  # -> readMe, port, schedule, port_2, weekSched, schedIDFText; plug-in component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
panel_188 = Panel(annualschedule_17.weekSched)

annualschedule_18 = Honeybee_AnnualSchedule(
    sun=genes_5,
    mon=max_11,
    tue=max_11,
    wed=max_11,
    thu=max_11,
    fri=max_11,
    sat=genes_3,
    scheduleName=join_10,
    runIt=toggle_8)  # -> readMe, port, schedule, port_2, weekSched, schedIDFText; plug-in component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
panel_189 = Panel(annualschedule_18.weekSched)

annualschedule_19 = Honeybee_AnnualSchedule(sun=genes_5, mon=max, tue=max, wed=max, thu=max, fri=max, sat=genes_3, scheduleName=panel_115, runIt=toggle_8)  # -> readMe, port, schedule, port_2, weekSched, schedIDFText; plug-in component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
panel_190 = Panel(annualschedule_19.weekSched)

annualschedule_20 = Honeybee_AnnualSchedule(sun=genes_5, mon=max, tue=max, wed=max, thu=max, fri=max, sat=genes_3, scheduleName=panel_115, runIt=toggle_8)  # -> readMe, port, schedule, port_2, weekSched, schedIDFText; plug-in component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
panel_191 = Panel(annualschedule_20.weekSched)

annualschedule_21 = Honeybee_AnnualSchedule(sun=genes_5, mon=max_3, tue=max_3, wed=max_3, thu=max_3, fri=max_3, sat=genes_3, scheduleName=join_4, runIt=toggle_8)  # -> readMe, port, schedule, port_2, weekSched, schedIDFText; plug-in component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
panel_192 = Panel(annualschedule_21.weekSched)

geo_39 = Geometry(boundary_13)

# ----
# u(uv)and longest edge is at the same orientation
tstat_3 = TreeStatistics(Tree=clean)  # -> Paths, Length, Count
split_4 = TextSplit(Text=tstat_3.Paths, Separators="{}")
item_19 = ListItem(List=split_4, Index="1", Wrap=True)  # -> flatten(Item)
replace_4 = ReplaceItems(List=geo_39, Item=python_14.revSrf, Indices=item_19, Wrap=False)

md_slider_2 = MDSlider(SliderMode=0, slider_value=Point(0.5, 0.5, 0.5), x_domain=Domain(0, 1), y_domain=Domain(0, 1), z_domain=Domain(0, 1))
iso_2 = IsoCurve(Surface=reparameterize(replace_4), UVPoint=md_slider_2)  # -> simplify(UIsocurve), VIsocurve
preview_17 = CustomPreview(Geometry=iso_2.UIsocurve, Material=ColourSwatch(SwatchColor=RGB(47, 255, 0)))

data_32 = Data(panel_117)

data_33 = Data(panel_117)

data_34 = Data(weave_8)

# ----
# Arrange
# Surface
# U V values
c_script = CSharpScript()  # -> out, A; inputs x: Surface; disabled
# ---------- c_script: C# ----------
    double pi = 3.1415926535897932384626433832795;
    
    Rhino.Geometry.Point3d p;
    Rhino.Geometry.Vector3d[] UV;
    // Evaluating surfaces at center (median of domain start and end)
    x.Evaluate((x.Domain(0).T0 + x.Domain(0).T1) / 2, (x.Domain(1).T0 + x.Domain(1).T1) / 2, 1, out p, out UV);
    
    // U, V, WorldX, WorldY vectors
    Rhino.Geometry.Vector3d U = UV[0];    
    Rhino.Geometry.Vector3d V = UV[1];    
    Rhino.Geometry.Vector3d X = Rhino.Geometry.Plane.WorldXY.XAxis;
    Rhino.Geometry.Vector3d Y = Rhino.Geometry.Plane.WorldXY.YAxis;
    
    // Unitizing vectors to make tests
    U.Unitize();
    V.Unitize();

    if (Math.Abs(U.X) < Math.Abs(V.X)){ // If this is "true" it means V isocurves are more suitable to be aligned with World X axis than U; U and V needs to be swapped
      x.Transpose(true); //Swapping UV
      if (Vector3d.VectorAngle(V, X) > pi / 2){ // Flipping new U if angle with X is larger than 90°
        x.Reverse(0, true);}
      if (Vector3d.VectorAngle(U, Y) > pi / 2){ // Flipping new V if angle with Y is larger than 90°
        x.Reverse(1, true);}
    }
    else{ // U an V doesn't need to be swapped
      if (Vector3d.VectorAngle(U, X) > pi / 2){ // Flipping U if angle with X is larger than 90°
        x.Reverse(0, true);}
      if (Vector3d.VectorAngle(V, Y) > pi / 2){ // Flipping V if angle with Y is larger than 90°
        x.Reverse(1, true);}
    }
    A = x;
# ---------- end c_script ----------

# ----
# Generated
# # of Units
# Per Floor
data_35 = Data(weave_12)

panel_198 = Panel(panel_187)

# ----
# # of Units of
# the building
data_36 = Data(weave_11)

panel_200 = Panel(panel_188)

panel_202 = Panel(panel_189)

panel_204 = Panel(panel_192)

geo_40 = Geometry(flatten(replace_4))

panel_207 = Panel(panel_190)

panel_209 = Panel(panel_191)

# ----
# Test surface U V values
panel_210 = Panel("0.5,0.5")  # disabled
iso_3 = IsoCurve(Surface=reparameterize(c_script.A), UVPoint=panel_210)  # -> UIsocurve, VIsocurve; disabled
swatch_4 = ColourSwatch(SwatchColor=RGB(255, 0, 0))  # disabled
swatch_5 = ColourSwatch(SwatchColor=RGB(0, 255, 4))  # disabled
# 3.1 - UNIT DIVISION
#   3.1.1 - 2 UNIT PER FLOOR
# Unit division types
# - Floor division with stairs
# - Floor division without stairs
# Adaptation with Real Data
# for unit division
# - L shape
# - Rectangular
# - I shape
# etc.
preview_18 = CustomPreview(Geometry=iso_3.UIsocurve, Material=swatch_4)  # disabled
# Full list control
# - Recording complete information of the unit
# --parcel, building, floor, number in the building
preview_19 = CustomPreview(Geometry=iso_3.VIsocurve, Material=swatch_5)  # disabled

_2_people_percentage_3 = Panel("1.9")

panel_211 = Panel("exclude non-residential buildings")
clean_2 = CleanTree(RemoveNulls=True, RemoveInvalid=True, RemoveEmpty=False, Tree=python_11.a)

clean_3 = CleanTree(RemoveNulls=True, RemoveInvalid=True, RemoveEmpty=False, Tree=python_11.a)

data_37 = Data("0.25")

clean_4 = CleanTree(RemoveNulls=True, RemoveInvalid=True, RemoveEmpty=False, Tree=python_11.a)

data_38 = Data(panel_117)

# ----
# selection according to
# construction date
data_39 = Data(equals_11.Equality)

# ----
# # of Units of the building
toggle_9 = BooleanToggle(True)
partition_18 = PartitionList(List=data_36, Size=subtraction_2)  # -> simplify(Chunks)
clean_5 = CleanTree(RemoveNulls=True, RemoveInvalid=True, RemoveEmpty=toggle_9, Tree=partition_18)
lng_30 = ListLength(List=clean_5)  # -> flatten(Length)
partition_19 = PartitionList(List=flatten(clean_5), Size=lng_30)  # -> simplify(Chunks)
cull_i_15 = CullIndex(List=partition_19, Indices=clean_4, Wrap=True)  # -> simplify(List)
dispatch_16 = Dispatch(List=cull_i_15, DispatchPattern=data_39)  # -> ListA, ListB
weave_15 = Weave(Pattern=python_12.a, Stream0=dispatch_16.ListA, Stream1=dispatch_16.ListB, NullGaps=False)  # -> simplify(Weave)

# ----
# selection according to
# construction date
data_40 = Data(equals_11.Equality)

# ----
# # of Units Per Floor in the building
toggle_10 = BooleanToggle(True)
partition_20 = PartitionList(List=data_35, Size=subtraction_2)  # -> simplify(Chunks)
clean_6 = CleanTree(RemoveNulls=True, RemoveInvalid=True, RemoveEmpty=toggle_10, Tree=partition_20)
lng_31 = ListLength(List=clean_6)  # -> flatten(Length)
partition_21 = PartitionList(List=flatten(clean_6), Size=lng_31)  # -> simplify(Chunks)
cull_i_16 = CullIndex(List=partition_21, Indices=clean_2, Wrap=True)  # -> simplify(List)
dispatch_17 = Dispatch(List=cull_i_16, DispatchPattern=data_40)  # -> ListA, ListB
weave_16 = Weave(Pattern=python_12.a, Stream0=dispatch_17.ListA, Stream1=dispatch_17.ListB, NullGaps=False)  # -> simplify(Weave)

# ----
# selection according to
# construction date
data_41 = Data(equals_11.Equality)

data_42 = Data("0.25")

partition_22 = PartitionList(List=geo_40, Size="1")
divide = DivideDomain²(Domain=partition_22, UCount="2", VCount="1")  # -> simplify(Segments)
subsrf = Isotrim(Surface=partition_22, Domain=divide)  # -> simplify(Surface)
# 03.FLOORTOUNITDIVISION
md_slider_3 = MDSlider(SliderMode=0, slider_value=Point(0.5, 0.5, 0.5), x_domain=Domain(0, 1), y_domain=Domain(0, 1), z_domain=Domain(0, 1))
item_20 = ListItem(List=subsrf, Index=0, Wrap=True)
evalsrf = EvaluateSurface(Surface=item_20, Point=md_slider_3)  # -> Point, Normal, UDirection, VDirection, Frame
brec_2 = BoundingRectangle(Geometry=subsrf, Plane=evalsrf.Frame, Axis=0, Slide=0, Union=True)  # -> simplify(flatten(Bounding)), DimensionX, DimensionY
area_19 = Area(Geometry=brec_2.Bounding)  # -> Area, Centroid
scale = Scale(Geometry=brec_2.Bounding, Center=area_19.Centroid, Factor=data_42)  # -> Geometry, Transform

# ----
# indices of
# selection ratio according to construction date
data_43 = Data(series_10)
panel_217 = Panel("organized list")
item_21 = ListItem(List=simplify(weave_15), Index=simplify(data_43), Wrap=True)  # -> flatten(Item)

data_44 = Data(item_21)
ma = MassAddition(Input=data_44)  # -> Result, PartialResults
total_number_of_units = Panel(ma.Result)

data_45 = Data(item_21)
ma_2 = MassAddition(Input=data_45)  # -> Result, PartialResults
total_number_of_units_2 = Panel(ma_2.Result)

# ----
# 00.INPUT
data_46 = Data(item_21)
ma_3 = MassAddition(Input=data_46)  # -> Result, PartialResults
total_number_of_units_3 = Panel(ma_3.Result)

# ----
# total #of unit
# in the neighborhood
data_47 = Data(ma_3.Result)

pcent_2 = Percentage(Number=data_47, Percent=data_22)
pcent_3 = Percentage(Number=pcent_2, Percent="86")
pcent_4 = Percentage(Number=pcent_3, Percent="52.8")
round_7 = Round(Number=pcent_4)  # -> Nearest, Floor, Ceiling
dup_7 = DuplicateData(Data=annualschedule_3.schedule, Number=round_7.Nearest, Order=True)

pcent_5 = Percentage(Number=data_47, Percent=data_23)
pcent_6 = Percentage(Number=pcent_5, Percent="86")
pcent_7 = Percentage(Number=pcent_6, Percent="47.2")
round_8 = Round(Number=pcent_7)  # -> Nearest, Floor, Ceiling
dup_8 = DuplicateData(Data=annualschedule.schedule, Number=round_8.Nearest, Order=True)

pcent_8 = Percentage(Number=data_47, Percent=data_24)
pcent_9 = Percentage(Number=pcent_8, Percent="14")
pcent_10 = Percentage(Number=pcent_9, Percent="100")
round_9 = Round(Number=pcent_10)  # -> Nearest, Floor, Ceiling
dup_9 = DuplicateData(Data=annualschedule_2.schedule, Number=round_9.Nearest, Order=True)

merge_28 = Merge(Data1=dup_8, Data2=dup_7, Data3=dup_9)
jitter_4 = Jitter(List=merge_28, Jitter=1, Seed=data_26)  # -> Values, Indices

pcent_11 = Percentage(Number=data_47, Percent="23.44")
round_10 = Round(Number=pcent_11)  # -> Nearest, Floor, Ceiling
dup_10 = DuplicateData(Data=annualschedule_14.schedule, Number=round_10.Nearest, Order=True)

pcent_12 = Percentage(Number=data_47, Percent="3.02")
round_11 = Round(Number=pcent_12)  # -> Nearest, Floor, Ceiling
dup_11 = DuplicateData(Data=annualschedule_11.schedule, Number=round_11.Nearest, Order=True)

pcent_13 = Percentage(Number=data_47, Percent="9.43")
round_12 = Round(Number=pcent_13)  # -> Nearest, Floor, Ceiling
dup_12 = DuplicateData(Data=annualschedule_13.schedule, Number=round_12.Nearest, Order=True)

pcent_14 = Percentage(Number=data_47, Percent="8.41")
round_13 = Round(Number=pcent_14)  # -> Nearest, Floor, Ceiling
dup_13 = DuplicateData(Data=annualschedule_8.schedule, Number=round_13.Nearest, Order=True)

pcent_15 = Percentage(Number=data_47, Percent="29.43")
round_14 = Round(Number=pcent_15)  # -> Nearest, Floor, Ceiling
dup_14 = DuplicateData(Data=annualschedule_15.schedule, Number=round_14.Nearest, Order=True)

pcent_16 = Percentage(Number=data_47, Percent="26.27")
round_15 = Round(Number=pcent_16)  # -> Nearest, Floor, Ceiling
dup_15 = DuplicateData(Data=annualschedule_12.schedule, Number=round_15.Nearest, Order=True)

pcent_17 = Percentage(Number=data_47, Percent="100")
pcent_18 = Percentage(Number=pcent_17, Percent="3.4")
round_16 = Round(Number=pcent_18)  # -> Nearest, Floor, Ceiling
dup_16 = DuplicateData(Data=annualschedule_6.schedule, Number=round_16.Nearest, Order=True)

pcent_19 = Percentage(Number=data_47, Percent="100")
pcent_20 = Percentage(Number=pcent_19, Percent="10.8")
round_17 = Round(Number=pcent_20)  # -> Nearest, Floor, Ceiling
dup_17 = DuplicateData(Data=annualschedule_9.schedule, Number=round_17.Nearest, Order=True)

pcent_21 = Percentage(Number=data_47, Percent="100")
pcent_22 = Percentage(Number=pcent_21, Percent="36.6")
round_18 = Round(Number=pcent_22)  # -> Nearest, Floor, Ceiling
dup_18 = DuplicateData(Data=annualschedule_7.schedule, Number=round_18.Nearest, Order=True)

pcent_23 = Percentage(Number=data_47, Percent="100")
pcent_24 = Percentage(Number=pcent_23, Percent="36.6")
round_19 = Round(Number=pcent_24)  # -> Nearest, Floor, Ceiling
dup_19 = DuplicateData(Data=annualschedule_5.schedule, Number=round_19.Nearest, Order=True)

pcent_25 = Percentage(Number=data_47, Percent="100")
pcent_26 = Percentage(Number=pcent_25, Percent="9.7")
round_20 = Round(Number=pcent_26)  # -> Nearest, Floor, Ceiling
dup_20 = DuplicateData(Data=annualschedule_4.schedule, Number=round_20.Nearest, Order=True)

pcent_27 = Percentage(Number=data_47, Percent="100")
pcent_28 = Percentage(Number=pcent_27, Percent="3")
round_21 = Round(Number=pcent_28)  # -> Nearest, Floor, Ceiling
dup_21 = DuplicateData(Data=annualschedule_10.schedule, Number=round_21.Nearest, Order=True)

merge_29 = Merge(Data1=dup_13, Data2=dup_12, Data3=dup_10, Data4=dup_15, Data5=dup_14, Data6=dup_11)
jitter_5 = Jitter(List=merge_29, Jitter=1, Seed=data_27)  # -> Values, Indices
lng_32 = ListLength(List=jitter_5.Values)
pcent_29 = Percentage(Number=lng_32, Percent=_2_people_percentage_2)
series_11 = Series(Start=0, Step=1, Count=pcent_29)
item_22 = ListItem(List=jitter_5.Values, Index=series_11, Wrap=True)

merge_30 = Merge(Data1=dup_20, Data2=dup_17, Data3=dup_21, Data4=dup_16, Data5=dup_18, Data6=dup_19)
jitter_6 = Jitter(List=merge_30, Jitter=1, Seed=data_28)  # -> Values, Indices
lng_33 = ListLength(List=jitter_6.Values)
pcent_30 = Percentage(Number=lng_33, Percent=_2_people_percentage)
series_12 = Series(Start=0, Step=1, Count=pcent_30)
item_23 = ListItem(List=jitter_6.Values, Index=series_12, Wrap=True)

merge_31 = Merge(Data1=item_23, Data2=item_22)
jitter_7 = Jitter(List=merge_31, Jitter=1, Seed=data_31)  # -> Values, Indices

# ----
# 3 people
# 3 people Family with Kids
merge_32 = Merge(Data1=dup_20, Data2=dup_17, Data3=dup_21, Data4=dup_16, Data5=dup_18, Data6=dup_19)
_3_people_percentage_family_with_kids = Panel("17.3")
jitter_8 = Jitter(List=merge_32, Jitter=1, Seed=data_32)  # -> Values, Indices
lng_34 = ListLength(List=jitter_8.Values)
pcent_31 = Percentage(Number=lng_34, Percent=_3_people_percentage_family_with_kids)
series_13 = Series(Start=0, Step=1, Count=pcent_31)
item_24 = ListItem(List=jitter_8.Values, Index=series_13, Wrap=True)

# ----
# 3 people Family no Family
merge_33 = Merge(Data1=dup_13, Data2=dup_12, Data3=dup_10, Data4=dup_15, Data5=dup_14, Data6=dup_11)
_3_people_percentage_no_family = Panel("0.4")
jitter_9 = Jitter(List=merge_33, Jitter=1, Seed=data_33)  # -> Values, Indices
lng_35 = ListLength(List=jitter_9.Values)
pcent_32 = Percentage(Number=lng_35, Percent=_2_people_percentage_2)
series_14 = Series(Start=0, Step=1, Count=pcent_32)
item_25 = ListItem(List=jitter_9.Values, Index=series_14, Wrap=True)

pcent_33 = Percentage(Number=data_47, Percent="38.05")
round_22 = Round(Number=pcent_33)  # -> Nearest, Floor, Ceiling
dup_22 = DuplicateData(Data=annualschedule_16.schedule, Number=round_22.Nearest, Order=True)

pcent_34 = Percentage(Number=data_47, Percent="11.28")
round_23 = Round(Number=pcent_34)  # -> Nearest, Floor, Ceiling
dup_23 = DuplicateData(Data=annualschedule_18.schedule, Number=round_23.Nearest, Order=True)

pcent_35 = Percentage(Number=data_47, Percent="33.95")
round_24 = Round(Number=pcent_35)  # -> Nearest, Floor, Ceiling
dup_24 = DuplicateData(Data=annualschedule_21.schedule, Number=round_24.Nearest, Order=True)

pcent_36 = Percentage(Number=data_47, Percent="3.51")
round_25 = Round(Number=pcent_36)  # -> Nearest, Floor, Ceiling
dup_25 = DuplicateData(Data=annualschedule_17.schedule, Number=round_25.Nearest, Order=True)

pcent_37 = Percentage(Number=data_47, Percent="3.13")
round_26 = Round(Number=pcent_37)  # -> Nearest, Floor, Ceiling
dup_26 = DuplicateData(Data=annualschedule_19.schedule, Number=round_26.Nearest, Order=True)

pcent_38 = Percentage(Number=data_47, Percent="10.07")
round_27 = Round(Number=pcent_38)  # -> Nearest, Floor, Ceiling
dup_27 = DuplicateData(Data=annualschedule_20.schedule, Number=round_27.Nearest, Order=True)

# ----
# 3 people Family
# with Kids and Elderly
merge_34 = Merge(Data1=dup_27, Data2=dup_23, Data3=dup_26, Data4=dup_25, Data5=dup_24, Data6=dup_22)
jitter_10 = Jitter(List=merge_34, Jitter=1, Seed=data_38)  # -> Values, Indices
lng_36 = ListLength(List=jitter_10.Values)
pcent_39 = Percentage(Number=lng_36, Percent=_2_people_percentage_3)
series_15 = Series(Start=0, Step=1, Count=pcent_39)
item_26 = ListItem(List=jitter_10.Values, Index=series_15, Wrap=True)

# ----
# indices of
# selection ratio according to construction date
data_48 = Data(series_10)
item_27 = ListItem(List=simplify(weave_16), Index=simplify(data_48), Wrap=True)  # -> flatten(Item)

# ----
# # of Units
# Per Floor
# if x == 1:
#     a=1,1
# elif x ==2:
#     a=2,1
# elif x == 3 or x == 4:
#     a=2,2
# elif x==5 or x ==6:
#     a=3,2
# else:
#     a=4,2
python_15 = GhPythonScript(x=item_27)  # -> out, simplify(a); inputs x: Int32
# ---------- python_15: Python ----------
__author__ = "orcun"
__version__ = "2021.11.17"

import rhinoscriptsyntax as rs
if x == 1:
    a=1,1
elif x ==2:
    a=2,1
elif x == 3 or x == 4:
    a=2,2
elif x==5 or x ==6:
    a=3,2
else:
    a=4,2
# ---------- end python_15 ----------
item_28 = ListItem(List=python_15.a, Index=0, Wrap=True)  # -> flatten(Item)
item_29 = ListItem(List=python_15.a, Index=1, Wrap=True)  # -> flatten(Item)

# ----
# # of Units Per Floor
data_49 = Data(item_27)

equals_13 = Equality(FirstNumber=data_49, SecondNumber="1")  # -> Equality, Inequality
lng_37 = ListLength(List=data_49)
series_16 = Series(Start=0, Step=1, Count=lng_37)
dispatch_18 = Dispatch(List=series_16, DispatchPattern=equals_13.Equality)  # -> ListA, ListB
item_30 = ListItem(List=brec_2.Bounding, Index=dispatch_18.ListA, Wrap=True)
area_20 = Area(Geometry=item_30)  # -> Area, Centroid
debrep_3 = DeconstructBrep(Brep=item_30)  # -> Faces, Edges, Vertices
scale_2 = Scale(Geometry=item_30, Center=area_20.Centroid, Factor=data_37)  # -> Geometry, Transform
item_31 = ListItem(List=debrep_3.Vertices, Index=0, Wrap=True)  # -> simplify(Item)
debrep_4 = DeconstructBrep(Brep=scale_2.Geometry)  # -> Faces, Edges, Vertices
item_32 = ListItem(List=debrep_4.Vertices, Index=0, Wrap=True)
move2pt = MoveToPoint(Geometry=scale_2.Geometry, PointA=flatten(item_32), PointB=flatten(item_31))  # -> simplify(Moved), Vector, Transform

# ----
# # of Units Per Floor
data_50 = Data(item_27)

divide_2 = DivideDomain²(Domain=replace_4, UCount=item_28, VCount=item_29)  # -> simplify(Segments)
partition_23 = PartitionList(List=replace_4, Size="1")
subsrf_2 = Isotrim(Surface=partition_23, Domain=divide_2)  # -> simplify(Surface)
lng_38 = ListLength(List=subsrf_2)  # -> flatten(Length)
lng_39 = ListLength(List=data_50)
series_17 = Series(Start=0, Step=1, Count=lng_39)
equals_14 = Equality(FirstNumber=data_50, SecondNumber=lng_38)  # -> Equality, Inequality
dispatch_19 = Dispatch(List=series_17, DispatchPattern=equals_14.Equality)  # -> ListA, ListB
series_18 = Series(Start=0, Step=1, Count="2")
branch_10 = TreeBranch(Tree=subsrf_2, Path=dispatch_19.ListB, MaintainPaths=True)
item_33 = ListItem(List=branch_10, Index=series_18, Wrap=True)
# Unit per floor Division
sunion = SolidUnion(Breps=item_33)
disc_4 = Discontinuity(Curve=sunion, Level=1)  # -> Points, Parameters
pline = PolyLine(Vertices=disc_4.Points, Closed=Toggle(True))  # -> simplify(Polyline)
cull_i_17 = CullIndex(List=branch_10, Indices=series_18, Wrap=True)  # -> simplify(List)
merge_35 = Merge(Data1=cull_i_17, Data2=pline)
data_51 = Data(dispatch_19.ListB)
tstat_4 = TreeStatistics(Tree=merge_35)  # -> Paths, Length, Count
replace_5 = ReplacePaths(Data=merge_35, Search=tstat_4.Paths, Replace=data_51)

partition_24 = PartitionList(List=equals_14.Equality, Size="1")  # -> simplify(Chunks)
dispatch_20 = Dispatch(List=subsrf_2, DispatchPattern=partition_24)  # -> ListA, ListB
clean_7 = CleanTree(RemoveNulls=True, RemoveInvalid=True, RemoveEmpty=Toggle(True), Tree=dispatch_20.ListA)

# ----
# rotateStaircase for better floor division, otherwise, units has strange edges
# StairCase
replace_6 = ReplaceItems(List=scale.Geometry, Item=move2pt.Moved, Indices=dispatch_18.ListA, Wrap=False)
partition_25 = PartitionList(List=replace_6, Size="1")  # -> simplify(Chunks)

data_52 = Data(panel_117)

merge_36 = Merge(Data1=item_24, Data2=item_25, Data3=item_26)
jitter_11 = Jitter(List=merge_36, Jitter=1, Seed=data_52)  # -> Values, Indices

# ----
# Unit per floor
# Divided Units
merge_37 = Merge(Data1=clean_7, Data2=replace_5)

data_53 = Data(panel_117)

# ----
# 4 people
# Family with Kids
merge_38 = Merge(Data1=dup_20, Data2=dup_17, Data3=dup_21, Data4=dup_16, Data5=dup_18, Data6=dup_19)
percentage_family_with_kids = Panel("17.1")
jitter_12 = Jitter(List=merge_38, Jitter=1, Seed=data_53)  # -> Values, Indices
lng_40 = ListLength(List=jitter_12.Values)
pcent_40 = Percentage(Number=lng_40, Percent=percentage_family_with_kids)
series_19 = Series(Start=0, Step=1, Count=pcent_40)
item_34 = ListItem(List=jitter_12.Values, Index=series_19, Wrap=True)

data_54 = Data(panel_117)

# ----
# Family with Kids and Elderly
merge_39 = Merge(Data1=dup_27, Data2=dup_23, Data3=dup_26, Data4=dup_25, Data5=dup_24, Data6=dup_22)
jitter_13 = Jitter(List=merge_39, Jitter=1, Seed=data_54)  # -> Values, Indices
percentage = Panel("2.7")
lng_41 = ListLength(List=jitter_13.Values)
pcent_41 = Percentage(Number=lng_41, Percent=percentage)
series_20 = Series(Start=0, Step=1, Count=pcent_41)
item_35 = ListItem(List=jitter_13.Values, Index=series_20, Wrap=True)

panel_222 = Panel("floor height")
data_55 = Data(floor_height)

# ----
# no need to use anymore, because when a parcel enter into simulation the staircase implementation gets activated
rdiff = RegionDifference(CurvesA=merge_37, CurvesB=partition_25)  # -> simplify(Result); disabled

data_56 = Data(panel_117)

# ----
# Family no Family
merge_40 = Merge(Data1=dup_13, Data2=dup_12, Data3=dup_10, Data4=dup_15, Data5=dup_14, Data6=dup_11)
percentage_no_family = Panel("0.2")
jitter_14 = Jitter(List=merge_40, Jitter=1, Seed=data_56)  # -> Values, Indices
lng_42 = ListLength(List=jitter_14.Values)
pcent_42 = Percentage(Number=lng_42, Percent=_2_people_percentage_2)
series_21 = Series(Start=0, Step=1, Count=pcent_42)
item_36 = ListItem(List=jitter_14.Values, Index=series_21, Wrap=True)

data_57 = Data(panel_117)

merge_41 = Merge(Data1=item_34, Data2=item_36, Data3=item_35)
jitter_15 = Jitter(List=merge_41, Jitter=1, Seed=data_57)  # -> Values, Indices

# ----
# x
# x
# x
# x
# x
# x
# x
# x
# x
# x
# x
# x
# x
# x
# x
# x
# x
# x
# x
# x
# x
# x
# x
# x
# x
# x
# x
# 
# x
# x
# x
# x
# x
# x
# 
# x
# x
# x
# x
# x
# 
# x
# x
# x
# x
# x
# x
# 
# x
# x
# x
# x
ladybug = Ladybug_Ladybug()  # -> Vviiiiiiiiiizzz; plug-in component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
# Construction Date
# Tüik 6.1 - Households by constrcution year of the building
# 1981-2000: %43,5
# 1980 and before: %23,4
# 2001 and after: %21,8
# Unknown: %11,3
# -------------
# SO AFTER ROUND UP
# before 2000: %80
# 2001 and after:  %20
# construction: construction layers
# - according to construction date
# -- before 80s / 80-00 / after 00
honeybee = Honeybee_Honeybee()  # -> Vviiiiiiiiiizzz; plug-in component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
# Retail, commercial building function determination
# FOR EACH
# building
# 
# How to do?
# Room, unit, elevator area division, M.L.
# 
# resource:endeksa
# 2:bedroom, living room
# 3:bedroom, living room, service (non-conditioning)
# 4:bedroom (x2), living room, service (non-conditioning)
# 3.1 - UNIT DIVISION
panel_225 = Panel(honeybee)

data_58 = Data(panel_117)

# ----
# 5 people
# Family with Kids
merge_42 = Merge(Data1=dup_20, Data2=dup_17, Data3=dup_21, Data4=dup_16, Data5=dup_18, Data6=dup_19)
percentage_family_with_kids_2 = Panel("7.6")
jitter_16 = Jitter(List=merge_42, Jitter=1, Seed=data_58)  # -> Values, Indices
lng_43 = ListLength(List=jitter_16.Values)
pcent_43 = Percentage(Number=lng_43, Percent=percentage_family_with_kids_2)
series_22 = Series(Start=0, Step=1, Count=pcent_43)
item_37 = ListItem(List=jitter_16.Values, Index=series_22, Wrap=True)

data_59 = Data(panel_117)

# ----
# Family with Kids and Elderly
merge_43 = Merge(Data1=dup_27, Data2=dup_23, Data3=dup_26, Data4=dup_25, Data5=dup_24, Data6=dup_22)
jitter_17 = Jitter(List=merge_43, Jitter=1, Seed=data_59)  # -> Values, Indices
percentage_2 = Panel("3.1")
lng_44 = ListLength(List=jitter_17.Values)
pcent_44 = Percentage(Number=lng_44, Percent=percentage_2)
series_23 = Series(Start=0, Step=1, Count=pcent_44)
item_38 = ListItem(List=jitter_17.Values, Index=series_23, Wrap=True)

data_60 = Data(panel_117)

# ----
# Family no Family
merge_44 = Merge(Data1=dup_13, Data2=dup_12, Data3=dup_10, Data4=dup_15, Data5=dup_14, Data6=dup_11)
percentage_no_family_2 = Panel("0.1")
jitter_18 = Jitter(List=merge_44, Jitter=1, Seed=data_60)  # -> Values, Indices
lng_45 = ListLength(List=jitter_18.Values)
pcent_45 = Percentage(Number=lng_45, Percent=_2_people_percentage_2)
series_24 = Series(Start=0, Step=1, Count=pcent_45)
item_39 = ListItem(List=jitter_18.Values, Index=series_24, Wrap=True)

# ----
# # of Units of
# the building
data_61 = Data(item_21)

# ----
# organized 4edged building PARCELS
geo_41 = Geometry(flatten(cull_i_12))

data_62 = Data(panel_117)

merge_45 = Merge(Data1=item_37, Data2=item_39, Data3=item_38)
jitter_19 = Jitter(List=merge_45, Jitter=1, Seed=data_62)  # -> Values, Indices

data_63 = Data(panel_117)

# ----
# 6 people
# Family with Kids
merge_46 = Merge(Data1=dup_20, Data2=dup_17, Data3=dup_21, Data4=dup_16, Data5=dup_18, Data6=dup_19)
percentage_family_with_kids_3 = Panel("2.5")
jitter_20 = Jitter(List=merge_46, Jitter=1, Seed=data_63)  # -> Values, Indices
lng_46 = ListLength(List=jitter_20.Values)
pcent_46 = Percentage(Number=lng_46, Percent=percentage_family_with_kids_3)
series_25 = Series(Start=0, Step=1, Count=pcent_46)
item_40 = ListItem(List=jitter_20.Values, Index=series_25, Wrap=True)

data_64 = Data(panel_117)

# ----
# Family with Kids and Elderly
merge_47 = Merge(Data1=dup_27, Data2=dup_23, Data3=dup_26, Data4=dup_25, Data5=dup_24, Data6=dup_22)
jitter_21 = Jitter(List=merge_47, Jitter=1, Seed=data_64)  # -> Values, Indices
percentage_3 = Panel("2.5")
lng_47 = ListLength(List=jitter_21.Values)
pcent_47 = Percentage(Number=lng_47, Percent=percentage_3)
series_26 = Series(Start=0, Step=1, Count=pcent_47)
item_41 = ListItem(List=jitter_21.Values, Index=series_26, Wrap=True)

data_65 = Data(panel_117)

# ----
# Family no Family
merge_48 = Merge(Data1=dup_13, Data2=dup_12, Data3=dup_10, Data4=dup_15, Data5=dup_14, Data6=dup_11)
jitter_22 = Jitter(List=merge_48, Jitter=1, Seed=data_65)  # -> Values, Indices
lng_48 = ListLength(List=jitter_22.Values)
pcent_48 = Percentage(Number=lng_48, Percent=_2_people_percentage_2)
series_27 = Series(Start=0, Step=1, Count=pcent_48)
item_42 = ListItem(List=jitter_22.Values, Index=series_27, Wrap=True)

data_66 = Data(floor_height)

data_67 = Data(floor_height)

data_68 = Data(panel_117)
# OCCUPANCY SCHEDULES
panel_235 = Panel("seed")

merge_49 = Merge(Data1=item_40, Data2=item_42, Data3=item_41)
jitter_23 = Jitter(List=merge_49, Jitter=1, Seed=data_68)  # -> Values, Indices

data_69 = Data(panel_117)

# ----
# 7 people
# Family with Kids
merge_50 = Merge(Data1=dup_20, Data2=dup_17, Data3=dup_21, Data4=dup_16, Data5=dup_18, Data6=dup_19)
percentage_family_with_kids_4 = Panel("1.5")
jitter_24 = Jitter(List=merge_50, Jitter=1, Seed=data_69)  # -> Values, Indices
lng_49 = ListLength(List=jitter_24.Values)
pcent_49 = Percentage(Number=lng_49, Percent=percentage_family_with_kids_4)
series_28 = Series(Start=0, Step=1, Count=pcent_49)
item_43 = ListItem(List=jitter_24.Values, Index=series_28, Wrap=True)

data_70 = Data(panel_117)

# ----
# Family with Kids and Elderly
merge_51 = Merge(Data1=dup_27, Data2=dup_23, Data3=dup_26, Data4=dup_25, Data5=dup_24, Data6=dup_22)
jitter_25 = Jitter(List=merge_51, Jitter=1, Seed=data_70)  # -> Values, Indices
percentage_4 = Panel("3.9")
lng_50 = ListLength(List=jitter_25.Values)
pcent_50 = Percentage(Number=lng_50, Percent=percentage_4)
series_29 = Series(Start=0, Step=1, Count=pcent_50)
item_44 = ListItem(List=jitter_25.Values, Index=series_29, Wrap=True)

data_71 = Data(panel_117)

# ----
# Family no Family
merge_52 = Merge(Data1=dup_13, Data2=dup_12, Data3=dup_10, Data4=dup_15, Data5=dup_14, Data6=dup_11)
jitter_26 = Jitter(List=merge_52, Jitter=1, Seed=data_71)  # -> Values, Indices
lng_51 = ListLength(List=jitter_26.Values)
pcent_51 = Percentage(Number=lng_51, Percent=_2_people_percentage_2)
series_30 = Series(Start=0, Step=1, Count=pcent_51)
item_45 = ListItem(List=jitter_26.Values, Index=series_30, Wrap=True)

data_72 = Data(panel_117)

merge_53 = Merge(Data1=item_43, Data2=item_45, Data3=item_44)
jitter_27 = Jitter(List=merge_53, Jitter=1, Seed=data_72)  # -> Values, Indices

data_73 = Data(floor_height)

# ----
# non-organized ALL building parcels four-edge (non-residential builidngs included)
geo_42 = Geometry(flatten(item_10))

panel_241 = Panel("Radius")
data_74 = Data(_40)

bldgprograms = Honeybee_bldgPrograms({"Office": 0, "Retail": 1, "MidriseApartment": 2, "PrimarySchool": 3, "SecondarySchool": 4, "SmallHotel": 5, "LargeHotel": 6, "Hospital": 7, "Outpatient": 8, "Warehouse": 9, "SuperMarket": 10, "FullServiceRestaurant": 11, "QuickServiceRestaurant": 12}, selected="MidriseApartment")
listzoneprograms = Honeybee_ListZonePrograms(bldgProgram=bldgprograms)  # -> MidriseApartmentZonePrograms; plug-in component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
item_46 = ListItem(List=listzoneprograms, Index="1", Wrap=True)

bldgprograms_2 = Honeybee_bldgPrograms({"Office": 0, "Retail": 1, "MidriseApartment": 2, "PrimarySchool": 3, "SecondarySchool": 4, "SmallHotel": 5, "LargeHotel": 6, "Hospital": 7, "Outpatient": 8, "Warehouse": 9, "SuperMarket": 10, "FullServiceRestaurant": 11, "QuickServiceRestaurant": 12}, selected="MidriseApartment")
listzoneprograms_2 = Honeybee_ListZonePrograms(bldgProgram=bldgprograms_2)  # -> MidriseApartmentZonePrograms; plug-in component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
item_47 = ListItem(List=listzoneprograms_2, Index=0, Wrap=True)

data_75 = Data(floor_height)

bldgprograms_3 = Honeybee_bldgPrograms({"Office": 0, "Retail": 1, "MidriseApartment": 2, "PrimarySchool": 3, "SecondarySchool": 4, "SmallHotel": 5, "LargeHotel": 6, "Hospital": 7, "Outpatient": 8, "Warehouse": 9, "SuperMarket": 10, "FullServiceRestaurant": 11, "QuickServiceRestaurant": 12}, selected="MidriseApartment")
listzoneprograms_3 = Honeybee_ListZonePrograms(bldgProgram=bldgprograms_3)  # -> MidriseApartmentZonePrograms; plug-in component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
item_48 = ListItem(List=listzoneprograms_3, Index=2, Wrap=True)

data_76 = Data(floor_height)

panel_244 = Panel("parcel_block_floor_unit_function")

data_77 = Data(floor_height)

# ----
# simplified &
# ordered
# parcels (non-residentail buildings included)
# Adiabatic Surface Extraction from Intersected Buildings
geo_43 = Geometry(flatten(item_10))

data_78 = Data(floor_height)
# Intersected Building:
# Unconditioned
panel_246 = Panel("floor height")

# ----
# V1, V2: TS-825
# Window Parameters
singlepanebase = Panel("0.9")
singlepanebase_2 = Panel("0.75")
base = Panel("2.4")

panel_247 = Panel("WWR")
data_79 = Data(wwr)

# ----
# AS-IS V1
# WWR
panel_248 = Panel("0.2")
glzparamlist = Honeybee_GlazingParametersList(northGlzParam=panel_248, westGlzParam=panel_248, southGlzParam=panel_248, eastGlzParam=panel_248)  # -> glzParamList; plug-in component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

getepschedules = Honeybee_GetEnergyPlusSchedules(zoneProgram=item_47)  # -> occupancySchedule, occupancyActivitySch, heatingSetPtSchedule, coolingSetPtSchedule, lightingSchedule, equipmentSchedule, infiltrationSchedule; disabled; plug-in component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
# AS-IS V1/V2/V3
# LIGHTING
# SCHEDULE
convertepschvalues = Honeybee_ConvertEnergyPlusScheduleToValues(schName=getepschedules.occupancySchedule)  # -> values, holidays; disabled; plug-in component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
# https://drive.google.com/drive/u/1/folders/18A2Se-Wr7nzwbHcDhlTYeW92EyIVbHKy
strnum = Ladybug_SeparateData(inputList=flatten(convertepschvalues.values))  # -> numbers, strings; disabled; plug-in component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

# ----
# x
# x
# x
# x
# x
# x
# x
# x
# x
# x
# x
# x
# x
# x
# x
# x
# x
# x
# x
# x
# x
# x
# x
# x
# x
# x
# x
# 
# x
# x
# x
# x
# x
# x
# 
# x
# x
# x
# x
# x
# 
# x
# x
# x
# x
# x
# x
# 
# x
# x
# x
# x
# Domain
# Boundaries
panel_249 = Panel("55")
dom = ConstructDomain(DomainStart="135", DomainEnd="385")
dom_2 = ConstructDomain(DomainStart="200", DomainEnd="350")
dom_3 = ConstructDomain(DomainStart=panel_249, DomainEnd="85")
dom_4 = ConstructDomain(DomainStart="74", DomainEnd="200")
dom_5 = ConstructDomain(DomainStart="90", DomainEnd="230")
# 06.CONDITIONING
# FORENERGYMODELING
panel_250 = Panel("hepsiemlak.com")
merge_54 = Merge(Data1=dom_3, Data2=dom_4, Data3=dom_5, Data4=dom, Data5=dom_2)  # -> simplify(Result)

panel_251 = Panel("""20.0
20.1
20.2
20.3
20.4
20.5
20.6
20.7
20.8
20.9
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""")

lng_52 = ListLength(List=panel_251)
panel_252 = Panel("naming")
dup_28 = DuplicateData(Data="heatSet", Number=lng_52, Order=True)
merge_55 = Merge(Data1=simplify(graft(panel_251)), Data2=simplify(graft(dup_28)))
join_11 = TextJoin(Text=merge_55)  # -> flatten(Result)

dup_29 = DuplicateData(Data="18", Number="5", Order=True)
dup_30 = DuplicateData(Data="21.1", Number="19", Order=True)
merge_56 = Merge(Data1=dup_29, Data2=dup_30)

# ----
# Average
# Boundaries
panel_253 = Panel("""64.00
96.67
128.40
199.64
234.86""")

# ----
# binary transformation for occupied hours
python_16 = GhPythonScript(x=strnum.numbers)  # -> out, a; disabled
# ---------- python_16: Python ----------
__author__ = "Siser"
__version__ = "2022.03.16"

import rhinoscriptsyntax as rs
if x >0:
    a = 1
else:
    a = 0
# ---------- end python_16 ----------

callfromepschlibrary = Honeybee_CallFromEPScheduleLibrary(keywords="apart")  # -> scheduleTypeLimits, scheduleList; plug-in component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
panel_254 = Panel("usethisforLaptop")
item_49 = ListItem(List=callfromepschlibrary.scheduleList, Index="16", Wrap=True)

# ----
# 4+1
merge_57 = Merge(Data1=jitter_11.Values, Data2=jitter_15.Values, Data3=jitter_19.Values, Data4=jitter_23.Values, Data5=jitter_27.Values)
jitter_28 = Jitter(List=merge_57, Jitter=1, Seed=2)  # -> flatten(Values), Indices

# ----
# 3+1
merge_58 = Merge(Data1=jitter_7.Values, Data2=jitter_11.Values, Data3=jitter_15.Values, Data4=jitter_19.Values)
jitter_29 = Jitter(List=merge_58, Jitter=1, Seed=2)  # -> flatten(Values), Indices

# ----
# 5+1
merge_59 = Merge(Data1=jitter_15.Values, Data2=jitter_19.Values, Data3=jitter_23.Values, Data4=jitter_27.Values)
jitter_30 = Jitter(List=merge_59, Jitter=1, Seed=2)  # -> flatten(Values), Indices

# ----
# 2+1
merge_60 = Merge(Data1=jitter_4.Values, Data2=jitter_7.Values, Data3=jitter_11.Values)
jitter_31 = Jitter(List=merge_60, Jitter=1, Seed=2)  # -> flatten(Values), Indices

# ----
# 1+1
merge_61 = Merge(Data1=jitter_4.Values, Data2=merge_31)
jitter_32 = Jitter(List=merge_61, Jitter=1, Seed=2)  # -> flatten(Values), Indices

# ----
# COOLING-ON OFFICE
lb_schedule = GenePool(
    Decimals=0,
    Maximum=100.001,
    Minimum=100,
    Value=[100, 100, 100, 100, 100, 100, 100, 100.001, 100.001, 100.001, 100.001, 100.001, 100.001, 100.001, 100.001, 100.001, 100.001, 100.001, 100.001, 100, 100, 100, 100, 100])
lb_schedule_2 = GenePool(
    Decimals=0,
    Maximum=100,
    Minimum=24,
    Value=[100, 100, 100, 100, 100, 100, 100, 100, 24, 24, 24, 24, 24, 24, 24, 24, 24, 24, 24, 24, 100, 100, 100, 100])
toggle_11 = BooleanToggle(True)
annualschedule_22 = Honeybee_AnnualSchedule(
    sun=lb_schedule,
    mon=lb_schedule_2,
    tue=lb_schedule_2,
    wed=lb_schedule_2,
    thu=lb_schedule_2,
    fri=lb_schedule_2,
    sat=lb_schedule_2,
    scheduleName="OFFICE-COOLING-OFF-SCHEDULE",
    schedTypeLimits="Temperature",
    runIt=toggle_11)  # -> readMe, port, schedule, port_2, weekSched, schedIDFText; plug-in component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
annualschedule_23 = Honeybee_AnnualSchedule(
    sun=lb_schedule,
    mon=lb_schedule,
    tue=lb_schedule,
    wed=lb_schedule,
    thu=lb_schedule,
    fri=lb_schedule,
    sat=lb_schedule,
    scheduleName="OFFICE-COOLING-ON-SCHEDULE",
    schedTypeLimits="Temperature",
    runIt=toggle_11)  # -> readMe, port, schedule, port_2, weekSched, schedIDFText; plug-in component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
analysisperiod = Ladybug_AnalysisPeriod(fromMonth="4", fromDay="15", toMonth="10", toDay="15")  # -> readMe, analysisPeriod; plug-in component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
honeybee_seasonalschedule = Honeybee_SeasonalSchedule(
    scheduleName="OFFICE_COOLING_SCHEDULE-ANNUAL",
    schedTypeLimits="Temperature",
    baseWeekSched=annualschedule_23.weekSched,
    seasonWeekSched1=annualschedule_22.weekSched,
    analysisPeriod1=analysisperiod.analysisPeriod)  # -> readMe, schedule, schedIDFText; plug-in component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

# ----
# COOLING-OFF
# RESIDENTIAL
lb_schedule_3 = GenePool(
    Decimals=1,
    Maximum=100,
    Minimum=25,
    Value=[100, 100, 100, 100, 100, 100, 100, 100, 100, 100, 100, 100, 100, 100, 100, 100, 100, 100, 100, 100, 100, 100, 100, 100])
annualschedule_24 = Honeybee_AnnualSchedule(
    sun=lb_schedule_3,
    mon=lb_schedule_3,
    tue=lb_schedule_3,
    wed=lb_schedule_3,
    thu=lb_schedule_3,
    fri=lb_schedule_3,
    sat=lb_schedule_3,
    scheduleName="COOLING_OFF",
    schedTypeLimits="Temperature",
    runIt=Toggle(True))  # -> readMe, port, schedule, port_2, weekSched, schedIDFText; plug-in component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

panel_255 = Panel("references")

# ----
# heating Office
panel_256 = Panel("21")
dup_31 = DuplicateData(Data=panel_256, Number="19", Order=True)
dup_32 = DuplicateData(Data="18", Number="5", Order=True)
merge_62 = Merge(Data1=dup_32, Data2=dup_31)
annualschedule_25 = Honeybee_AnnualSchedule(
    sun=merge_62,
    mon=merge_62,
    tue=merge_62,
    wed=merge_62,
    thu=merge_62,
    fri=merge_62,
    sat=merge_62,
    scheduleName=simplify(graft("heatingOffice")),
    schedTypeLimits="Temperature",
    runIt=Toggle(True))  # -> readMe, port, schedule, port_2, simplify(weekSched), schedIDFText; plug-in component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

# ----
# if outdoor temperature hotter than the indoor temperature then close the natural ventilation
panel_257 = Panel("0")

panel_259 = Panel("references")  # disabled
panel_260 = Panel("25.0")  # disabled
panel_261 = Panel("1")  # disabled
panel_262 = Panel("0.0")  # disabled
panel_263 = Panel("24.0")  # disabled
panel_264 = Panel("12")  # disabled
panel_265 = Panel("0.4")  # disabled

# ----
# BepTr
heating_set_back = Panel("10")
# Conditioning  Temperatures
cooling_set_point_set_back = Panel("100")
heating_set_point = Panel("20")
# ----
# Estimating space heating determinants: An analysis of Greek households: More energy is needed for space heating as the household head becomes older [11,21]. Elderly prefer higher room temperatures and are home owners of rather old, noninsulated dwellings, reasons that contributed to higher per capita energy consumption for space heating [9]. The same holds true in case of Norwegian households, as older people not only prefer a relatively high indoor temperature but also stay at home more than younger ones due to sociological reasons [6,7].
# SCHEDULE_A(i.e., 0to4, 65+) demand warmer spaces than the others thus heating set point starts 2 degree lower. Set back value is the same for all schedules.
panel_266 = Panel("scheduleA")
panel_267 = Panel("SCHEDULE_A: 23, others: 21 ")

# ----
# ASHRAE
# Heating Set Point: distribution for set points:
# 21-23
heating_set_back_2 = Panel("10")
# ANKARA
cooling_set_point = Panel("25")
cooling_set_back = Panel("28")

# ----
# SET POINT SCHEDULES
# Aging population increases energy use: https://news.harvard.edu/gazette/story/2019/06/harvard-research-shows-energy-use-climbs-with-age-and-temperature/
heating_set_points = Panel("""23
21""")
heating_set_points_name = Panel("""A
others""")
cooling_set_points = Panel("""27
25""")

data_80 = Data("5")
data_81 = Data("1")
data_82 = Data("10")

# ----
# Heating Set Point: distribution for set points:
# 21-23
heating_set_back_3 = Panel("10")
cooling_set_point_set_back_2 = Panel("100")

lng_53 = ListLength(List=merge_15)  # -> flatten(Length)

data_83 = Data(weave_4)

heating_set_back_4 = Panel("10")
cooling_set_point_2 = Panel("25")

# ----
# %33 for all selection
# -before 80s
# -80-00
# -after 00s
infiltration_rate = Panel("""0.000285
0.0004
0.0005""")

# ----
# public and school buildings excluded list
data_84 = Data(python_11.a)

# ----
# Air Change Rate: Identification of the Retrofit Actions to Achieve Cost-Optimal and
# NZEB Levels for Residential Buildings in Istanbul Considering
# the Remaining Building Lifetime
boolean_toggle_2 = BooleanToggle(True)

data_85 = Data(merge_49)  # disabled
lng_54 = ListLength(List=data_85)  # disabled
panel_271 = Panel("6")  # disabled
dup_33 = DuplicateData(Data=panel_271, Number=lng_54, Order=True)  # disabled

data_86 = Data(merge_45)  # disabled
lng_55 = ListLength(List=data_86)  # disabled
panel_272 = Panel("5")  # disabled
dup_34 = DuplicateData(Data=panel_272, Number=lng_55, Order=True)  # disabled

data_87 = Data(merge_53)  # disabled
lng_56 = ListLength(List=data_87)  # disabled
panel_273 = Panel("7")  # disabled
dup_35 = DuplicateData(Data=panel_273, Number=lng_56, Order=True)  # disabled

data_88 = Data(merge_36)  # disabled
lng_57 = ListLength(List=data_88)  # disabled
panel_274 = Panel("3")  # disabled
dup_36 = DuplicateData(Data=panel_274, Number=lng_57, Order=True)  # disabled

data_89 = Data(jitter_4.Values)  # disabled
lng_58 = ListLength(List=data_89)  # disabled
panel_275 = Panel("1")  # disabled
dup_37 = DuplicateData(Data=panel_275, Number=lng_58, Order=True)  # disabled

data_90 = Data(merge_41)  # disabled
lng_59 = ListLength(List=data_90)  # disabled
panel_276 = Panel("4")  # disabled
dup_38 = DuplicateData(Data=panel_276, Number=lng_59, Order=True)  # disabled

data_91 = Data(merge_31)  # disabled
lng_60 = ListLength(List=data_91)  # disabled
panel_277 = Panel("2")  # disabled
dup_39 = DuplicateData(Data=panel_277, Number=lng_60, Order=True)  # disabled

m3sm2 = Panel("0.0003")
panel_278 = Panel("IGD")

data_92 = Data(item_46)
panel_279 = Panel(data_92)
geteploads = Honeybee_GetEnergyPlusLoads(zoneProgram=data_92)  # -> equipmentLoadPerArea, infilRatePerArea_Facade, lightingDensityPerArea, numOfPeoplePerArea, ventilationPerArea, ventilationPerPerson; plug-in component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

merge_63 = Merge(Data1=dup_38, Data2=dup_34, Data3=dup_33, Data4=dup_35)  # disabled
jitter_33 = Jitter(List=merge_63, Jitter=1, Seed=2)  # -> flatten(Values), Indices; disabled

merge_64 = Merge(Data1=dup_39, Data2=dup_36, Data3=dup_38, Data4=dup_34)  # disabled
jitter_34 = Jitter(List=merge_64, Jitter=1, Seed=2)  # -> flatten(Values), Indices; disabled

merge_65 = Merge(Data1=dup_36, Data2=dup_38, Data3=dup_34, Data4=dup_33, Data5=dup_35)  # disabled
jitter_35 = Jitter(List=merge_65, Jitter=1, Seed=2)  # -> flatten(Values), Indices; disabled

merge_66 = Merge(Data1=dup_37, Data2=dup_39, Data3=dup_36)  # disabled
jitter_36 = Jitter(List=merge_66, Jitter=1, Seed=2)  # -> flatten(Values), Indices; disabled

merge_67 = Merge(Data1=dup_37, Data2=dup_39)  # disabled
jitter_37 = Jitter(List=merge_67, Jitter=1, Seed=2)  # -> flatten(Values), Indices; disabled

# ----
# AS-ISV1
panel_280 = Panel("0.0001")

data_93 = Data(item_47)
panel_281 = Panel(data_93)
geteploads_2 = Honeybee_GetEnergyPlusLoads(zoneProgram=data_93)  # -> equipmentLoadPerArea, infilRatePerArea_Facade, lightingDensityPerArea, numOfPeoplePerArea, ventilationPerArea, ventilationPerPerson; plug-in component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

ground_truth_from_municipality_construct = Panel("""1
0
1
1
1
1
1
1
1
1
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""")  # "GROUND TRUTH FROM MUNICIPALITY ConstructionType"
panel_282 = Panel("0=masonry, 1=concrete")

# ----
# ordered buildings list information
data_94 = Data(merge_15)
tstat_5 = TreeStatistics(Tree=data_94)  # -> Paths, Length, Count

# ----
# public and school buildings excluded list
data_95 = Data(python_11.a)

panel_283 = Panel("U-roof")
data_96 = Data(roundd_4.Rounded)

# ----
# U-Factor no Film [W/m2-K]
panel_284 = Panel("https://unmethours.com/question/55666/what-is-the-basis-for-air-film-resistances-used-to-calculate-u-factor-with-film/")

# ----
# U-Factor no Film [W/m2-K]
panel_285 = Panel("https://unmethours.com/question/55666/what-is-the-basis-for-air-film-resistances-used-to-calculate-u-factor-with-film/")

# ----
# U-Factor no Film [W/m2-K]
panel_286 = Panel("https://unmethours.com/question/55666/what-is-the-basis-for-air-film-resistances-used-to-calculate-u-factor-with-film/")

panel_287 = Panel("U-wall")
data_97 = Data(roundd_6.Rounded)

data_98 = Data(roundd_6.Rounded)

epopaquemat = Honeybee_EnergyPlusOpaqueMaterial(name="icSivaAlciEsasliInt", thickness="0.02", conductivity="0.51", density="1200", specificHeat="1090")  # -> EPMaterial; plug-in component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
epopaquemat_2 = Honeybee_EnergyPlusOpaqueMaterial(name="icSivaAlciEsasliInt", thickness="0.02", conductivity="0.51", density="1200", specificHeat="1090")  # -> EPMaterial; plug-in component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
epopaquemat_3 = Honeybee_EnergyPlusOpaqueMaterial(name="yatay delikli tugla", thickness="0.085", conductivity="0.33", density="600", specificHeat="900")  # -> EPMaterial; plug-in component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

# ----
# Internal wall
epconstruction = Honeybee_EnergyPlusConstruction(name="CC_Internal_wall", layer_1=epopaquemat, layer_2=epopaquemat_3, layer_3=epopaquemat_2)  # -> EPConstruction; plug-in component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

# ----
# U-Factor no Film [W/m2-K]
panel_289 = Panel("https://unmethours.com/question/55666/what-is-the-basis-for-air-film-resistances-used-to-calculate-u-factor-with-film/")

# ----
# U-Factor no Film [W/m2-K]
panel_290 = Panel("https://unmethours.com/question/55666/what-is-the-basis-for-air-film-resistances-used-to-calculate-u-factor-with-film/")

data_99 = Data(roundd_4.Rounded)

panel_292 = Panel("""simplified &
ordered
parcel
layouts""")
geo_44 = Geometry(flatten(item_10))

data_100 = Data(_40)

floor_height_2 = Panel("3")
data_101 = Data(floor_height)

panel_294 = Panel("SORTED BLOCK BOUNDARIES")
sorted_parcels_2 = Geometry(sort.ValuesA)

data_102 = Data(weave_8)

data_103 = Data(floor_height)

data_104 = Data(floor_height)

geo_45 = Geometry(geo_44)

panel_297 = Panel("""3332
3332
3332
3332
3233
3233
3233
3233
3223
3223
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""")  # disabled
chars = Characters(Text=panel_297)  # -> simplify(Result), Unicode; disabled
panel_298 = Panel(chars.Result)  # disabled
item_50 = ListItem(List=panel_298, Index=1, Wrap=True)  # -> flatten(Item); disabled
item_51 = ListItem(List=panel_298, Index=1, Wrap=True)  # -> flatten(Item); disabled
item_52 = ListItem(List=panel_298, Index=0, Wrap=True)  # -> flatten(Item); disabled
item_53 = ListItem(List=panel_298, Index=2, Wrap=True)  # -> flatten(Item); disabled
panel_299 = Panel(item_52)  # disabled
panel_300 = Panel(item_50)  # disabled
panel_301 = Panel(item_53)  # disabled
panel_302 = Panel(item_51)  # disabled

# ----
# 2nd week - Coldest Week
panel_303 = Panel("13")  # disabled
panel_304 = Panel("1")  # disabled
panel_305 = Panel("7")  # disabled
analysisperiod_2 = Ladybug_AnalysisPeriod(fromMonth=panel_304, fromDay=panel_305, toMonth=panel_304, toDay=panel_303)  # -> readMe, analysisPeriod; disabled; plug-in component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
panel_306 = Panel(analysisperiod_2.analysisPeriod)  # disabled

# ----
# 15th week - Spring
panel_307 = Panel("14")  # disabled
panel_308 = Panel("4")  # disabled
panel_309 = Panel("8")  # disabled
analysisperiod_3 = Ladybug_AnalysisPeriod(fromMonth=panel_308, fromDay=panel_309, toMonth=panel_308, toDay=panel_307)  # -> readMe, analysisPeriod; disabled; plug-in component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
panel_310 = Panel(analysisperiod_3.analysisPeriod)  # disabled

data_105 = Data(floor_height)

# ----
# if context do not exist
panel_311 = Panel("0")
dup_40 = DuplicateData(Data=panel_311, Number="4", Order=True)

getepschedules_2 = Honeybee_GetEnergyPlusSchedules()  # -> occupancySchedule, occupancyActivitySch, heatingSetPtSchedule, coolingSetPtSchedule, lightingSchedule, equipmentSchedule, infiltrationSchedule; disabled; plug-in component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
decomposeepsch = Honeybee_DecomposeEnergyPlusSchedule(schName=getepschedules_2.occupancySchedule)  # -> name, schedule, comments; disabled; plug-in component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
convertepschvalues_2 = Honeybee_ConvertEnergyPlusScheduleToValues(schName=decomposeepsch.name)  # -> values, holidays; disabled; plug-in component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
strnum_2 = Ladybug_SeparateData(inputList=flatten(convertepschvalues_2.values))  # -> numbers, strings; disabled; plug-in component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
panel_312 = Panel("168")  # disabled
partition_26 = PartitionList(List=strnum_2.numbers, Size=panel_312)  # -> simplify(Chunks); disabled
# x
# x
# x
# x
# x
# x
# x
# x
# x
# x
# x
# x
# x
# x
# x
# x
# x
# x
# x
# x
# x
# x
# x
# x
# x
# 
# x
# x
# x
# x
# 
# x
# x
# x
# x
# x
# X
# x
# X
# X
# X
# X
# X
# 
# X
# X
# X
# X
# X
# X
# 
# X
# X
# X
# X
# X
# X
# 
# X
# X
# X
# X
# X
# X
# X
# X
# X
# 
# X
# X
# X
panel_313 = Panel("0")
branch_11 = TreeBranch(Tree=partition_26, Path=panel_313, MaintainPaths=True)  # disabled
graph = QuickGraph(branch_11, SortOrder=0)  # disabled
# Run Periods
# RunPeriod,
#   Autumn,                           !- Name
#   10,                                      !- Begin Month
#   21,                                      !- Begin Day of Month
#   10,                                     !- End Month
#   27,                                     !- End Day of Month
# Monday,
#   No,                                     !- Use Weather File Holidays and Special Days
#   No,                                     !- Use Weather File Daylight Saving Period
#   No,                                     !- Apply Weekend Holiday Rule
#   Yes,                                    !- Use Weather File Rain Indicators
#   Yes,                                    !- Use Weather File Snow Indicators
#   1;                                      !- Number of Times Runperiod to be Repeated
panel_314 = Panel(branch_11)  # disabled

panel_315 = Panel("if context exist")

# ----
# Window Directions
panel_316 = Panel("""2: no window
3: window""")

# ----
# 28th week - Hottest Week
panel_317 = Panel("14")  # disabled
panel_318 = Panel("7")  # disabled
panel_319 = Panel("8")  # disabled
analysisperiod_4 = Ladybug_AnalysisPeriod(fromMonth=panel_318, fromDay=panel_319, toMonth=panel_318, toDay=panel_317)  # -> readMe, analysisPeriod; disabled; plug-in component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
# Run Periods
# Run Periods
# RunPeriod,
#   Spring,                           !- Name
#   4,                                      !- Begin Month
#   8,                                      !- Begin Day of Month
#   4,                                     !- End Month
#   14,                                     !- End Day of Month
# Monday,
#   No,                                     !- Use Weather File Holidays and Special Days
#   No,                                     !- Use Weather File Daylight Saving Period
#   No,                                     !- Apply Weekend Holiday Rule
#   Yes,                                    !- Use Weather File Rain Indicators
#   Yes,                                    !- Use Weather File Snow Indicators
#   1;                                      !- Number of Times Runperiod to be Repeated
# RunPeriod,
#   Summer,                           !- Name
#   7,                                      !- Begin Month
#   8,                                      !- Begin Day of Month
#   7,                                     !- End Month
#   14,                                     !- End Day of Month
# Monday,
#   No,                                     !- Use Weather File Holidays and Special Days
#   No,                                     !- Use Weather File Daylight Saving Period
#   No,                                     !- Apply Weekend Holiday Rule
#   Yes,                                    !- Use Weather File Rain Indicators
#   Yes,                                    !- Use Weather File Snow Indicators
#   1;                                      !- Number of Times Runperiod to be Repeated
panel_320 = Panel(analysisperiod_4.analysisPeriod)  # disabled

# ----
# 43th week - Autumn
panel_321 = Panel("27")  # disabled
panel_322 = Panel("10")  # disabled
panel_323 = Panel("21")  # disabled
analysisperiod_5 = Ladybug_AnalysisPeriod(fromMonth=panel_322, fromDay=panel_323, toMonth=panel_322, toDay=panel_321)  # -> readMe, analysisPeriod; disabled; plug-in component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
panel_324 = Panel(analysisperiod_5.analysisPeriod)  # disabled

# ----
# formFactor of
# Simulated Units
reference = Panel("https://greenbuildingencyclopaedia.uk/encyclopaedia/files/calculators/equations/form-factor-equation/")

# ----
# if context do not exist
panel_325 = Panel("0")
dup_41 = DuplicateData(Data=panel_325, Number="4", Order=True)

# ----
# Width/Depth ratio of
# Simulated Units
panel_326 = Panel("""width: eastToWest
depth: northToSouth""")

# ----
# Optimized
# Simulation
# Output-annual
# Zone,Average,Site Outdoor Air Drybulb Temperature
# 
# Output:Variable,*,Zone Ideal Loads Supply Air Total Cooling Energy, hourly;
panel_327 = Panel("""0
1
2
10
12
13
14
23
24
25
26
27
28
29
30
35
36
37""")
toggle_12 = BooleanToggle(True)
panel_328 = Panel("""Output:Variable,*,Zone Operative Temperature, hourly;
Output:Variable,*,Zone Mean Air Temperature, hourly;
Output:Variable,*,Zone Mean Radiant Temperature, hourly;""")
epoutput = Honeybee_GenerateEPOutput(
    zoneEnergyUse=toggle_12,
    zoneGainsAndLosses=toggle_12,
    zoneComfortMetrics=toggle_12,
    surfaceTempAnalysis="False",
    surfaceEnergyAnalysis=toggle_12,
    timestep="annual")  # -> report, flatten(simulationOutputs); disabled; plug-in component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
item_54 = ListItem(List=epoutput.simulationOutputs, Index=panel_327, Wrap=True)  # disabled
merge_68 = Merge(Data1=item_54, Data2=panel_328)  # -> flatten(Result); disabled

# ----
# Optimized
# Simulation
# Output-hourly
# Zone,Average,Site Outdoor Air Drybulb Temperature
# 
# Output:Variable,*,Zone Ideal Loads Supply Air Total Cooling Energy, hourly;
panel_329 = Panel("""0
1
2
10
12
23
24
25
26
27
28
29
30""")
toggle_13 = BooleanToggle(True)
panel_330 = Panel("""Output:Variable,*,Zone Operative Temperature, hourly;
Output:Variable,*,Zone Mean Air Temperature, hourly;
Output:Variable,*,Zone Mean Radiant Temperature, hourly;
Output:Variable,*,Zone Lights Electric Energy, hourly;
Output:Variable,*,Zone Electric Equipment Electric Energy, hourly;
Output:Variable,*,Surface Window Heat Gain Energy, hourly;
Output:Variable,*,Surface Window Heat Loss Energy, hourly;
Output:Variable,*,Surface Average Face Conduction Heat Transfer Energy, hourly;""")
epoutput_2 = Honeybee_GenerateEPOutput(
    zoneEnergyUse=toggle_13,
    zoneGainsAndLosses=toggle_13,
    zoneComfortMetrics=toggle_13,
    surfaceTempAnalysis="False",
    surfaceEnergyAnalysis=toggle_13,
    timestep="annual")  # -> report, flatten(simulationOutputs); plug-in component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
item_55 = ListItem(List=epoutput_2.simulationOutputs, Index=panel_329, Wrap=True)
merge_69 = Merge(Data1=item_55, Data2=panel_330)  # -> flatten(Result)

toggle_14 = BooleanToggle(True)  # disabled
panel_331 = Panel("annual")  # disabled
epoutput_3 = Honeybee_GenerateEPOutput(
    zoneEnergyUse=toggle_14,
    zoneGainsAndLosses=toggle_14,
    zoneComfortMetrics="False",
    surfaceTempAnalysis="False",
    surfaceEnergyAnalysis=toggle_14,
    timestep=panel_331)  # -> report, flatten(simulationOutputs); disabled; plug-in component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

# ----
# Energy Balance
toggle_15 = BooleanToggle(True)  # disabled
panel_332 = Panel("""0
1
2
10
12
13
14
23
24
25
26
27
28
29
30
31
32
35
36
37""")  # disabled
panel_333 = Panel("monthly")  # disabled
epoutput_4 = Honeybee_GenerateEPOutput(
    zoneEnergyUse=toggle_15,
    zoneGainsAndLosses=toggle_15,
    zoneComfortMetrics=toggle_15,
    surfaceTempAnalysis="False",
    surfaceEnergyAnalysis=toggle_15,
    timestep=panel_333)  # -> report, flatten(simulationOutputs); disabled; plug-in component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
item_56 = ListItem(List=epoutput_4.simulationOutputs, Index=panel_332, Wrap=True)  # disabled

panel_334 = Panel("""0
1
2
10
12
23
24
25
26
27
28
29
30""")

# ----
# AdaptiveComfort
toggle_16 = BooleanToggle(True)  # disabled
panel_336 = Panel("hourly")  # disabled
epoutput_5 = Honeybee_GenerateEPOutput(
    zoneEnergyUse=toggle_16,
    zoneGainsAndLosses=toggle_16,
    zoneComfortMetrics=toggle_16,
    surfaceTempAnalysis="False",
    surfaceEnergyAnalysis=toggle_16,
    timestep=panel_336)  # -> report, flatten(simulationOutputs); disabled; plug-in component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
panel_337 = Panel("""0
23
31
32
33""")  # disabled
item_57 = ListItem(List=epoutput_5.simulationOutputs, Index=panel_337, Wrap=True)  # disabled

simcontrol = Honeybee_SimulationControl(maxWarmupDays="150", minWarmupDays="6")  # -> simControls; plug-in component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
energysimpar = Honeybee_EnergySimulationPar(timestep=6, solarDistribution="4", startDayOfWeek="1", simulationControls=simcontrol, terrain="0")  # -> energySimPar; plug-in component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

path_8 = FilePath("C:\KBEM\IP2.1\epw\TUR_AN_Ankara.Central.171300_TMYx.2004-2018.epw")
panel_338 = Panel("weather data")

panel_339 = Panel("weatherdata")  # disabled
data_106 = Data(path_8)  # disabled

importepw = Ladybug_ImportEpw(epwFile=data_106)  # -> readMe, latitude, location, dryBulbTemperature, dewPointTemperature, relativeHumidity, windSpeed, windDirection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; disabled; plug-in component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
strnum_3 = Ladybug_SeparateData(inputList=flatten(importepw.globalHorizontalIlluminance))  # -> numbers, strings; disabled; plug-in component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

panel_340 = Panel(strnum_3.numbers)  # disabled
panel_341 = Panel("reference")  # disabled

# ----
# close the lights during daylight hours
python_17 = GhPythonScript(x=strnum_3.numbers, y=python_16.a)  # -> out, a; disabled
# ---------- python_17: Python ----------
__author__ = "Siser"
__version__ = "2022.03.16"

import rhinoscriptsyntax as rs
if x <1000:
    a = 1
else:
    a = 0
# ---------- end python_17 ----------

# ----
# close when everyone sleeps
panel_342 = Panel("24")  # disabled
panel_343 = Panel("6")  # disabled
partition_27 = PartitionList(List=simplify(python_17.a), Size=panel_342)  # -> simplify(Chunks); disabled
series_31 = Series(Start=0, Step=1, Count=panel_343)  # disabled
panel_344 = Panel("0")  # disabled
replace_7 = ReplaceItems(List=partition_27, Item=panel_344, Indices=series_31, Wrap=False)  # -> simplify(List); disabled

# ----
# 1st
# 2nd
# 3rd
data_107 = Data(flatten(replace_7))  # disabled

panel_345 = Panel("binaryLightSchedule")  # disabled
toggle_17 = BooleanToggle(False)  # disabled
csvschedule = Honeybee_CreateCSVSchedule(values=data_107, scheduleName=panel_345, writeFile=toggle_17)  # -> readMe, csvSchedule; disabled; plug-in component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
panel_346 = Panel("usethisforDesktop")  # disabled

button = Button()
panel_347 = Panel("Reset CSV Recorders")
python_18 = PythonScript(Toggle=button)
# ---------- python_18: Python ----------
import Grasshopper as gh

if Toggle:
    
    # Get the Grasshopper document and objects
    ghDoc = ghenv.Component.OnPingDocument()
    ghObjects = ghDoc.Objects
    
    # Iterate the GH objects, check type and reset data recorders
    for obj in ghObjects:
        if type(obj) is gh.Kernel.Special.GH_DataRecorder:
            obj.DestroyRecordedData()
            obj.ExpireSolution(True)
# ---------- end python_18 ----------

panel_348 = Panel("Colibri")

# ----
# Working Direction
panel_349 = Panel("C:\KBEM\IP2.1\RetrofitResults\idf")

panel_350 = Panel("Simulation")

# ----
# Selection
# Slider of
# Building
# there are 599 residential buildings
filename = Slider(2, range=0..5929)

panel_351 = Panel("selected parcel- unitFunctions")
item_58 = ListItem(List=cull_i_5, Index=filename, Wrap=True)
branch_12 = TreeBranch(Tree=partition, Path=item_58, MaintainPaths=True)

panel_352 = Panel("selected parcel")
data_108 = Data(filename)

data_109 = Data(filename)

# ----
# 0: residential non-cooling
# 5: residential with cooling
# 1: office unit
data_110 = Data(branch_12)

# ----
# Zone Program
panel_354 = Panel("1")
equals_15 = Equality(FirstNumber=data_110, SecondNumber=panel_354)  # -> Equality, Inequality
lng_61 = ListLength(List=data_110)
listdexs_4 = ListIndices(List=data_110)
dispatch_21 = Dispatch(List=listdexs_4, DispatchPattern=equals_15.Equality)  # -> ListA, ListB
# Naming for Simulated  Zones
dup_42 = DuplicateData(Data="0", Number=lng_61, Order=True)
replace_8 = ReplaceItems(List=dup_42, Item=item_47, Indices=dispatch_21.ListB, Wrap=False)
replace_9 = ReplaceItems(List=replace_8, Item=item_46, Indices=dispatch_21.ListA, Wrap=False)
panel_355 = Panel(replace_9)

panel_356 = Panel("Window shgc")
data_111 = Data(roundd_3.Rounded)
item_59 = ListItem(List=data_111, Index=filename, Wrap=True)

panel_357 = Panel("vtWindow")
data_112 = Data(vtwindow)
item_60 = ListItem(List=data_112, Index=filename, Wrap=True)

# ----
# V3: Generated
# Window Parameters
panel_358 = Panel("uWindow")
data_113 = Data(roundd_2.Rounded)
item_61 = ListItem(List=data_113, Index=filename, Wrap=True)

panel_359 = Panel("Building-based EKB")
item_62 = ListItem(List=data_79, Index=filename, Wrap=True)

# ----
# Generated
# WWR
glzparamlist_2 = Honeybee_GlazingParametersList(northGlzParam=item_62, westGlzParam=item_62, southGlzParam=item_62, eastGlzParam=item_62)  # -> glzParamList; plug-in component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

# ----
# Unit Separation by Function
panel_360 = Panel("""0: residential non-cooling
1: office unit""")
data_114 = Data(branch_12)

# ----
# 0: residential non-cooling
# 1: residential with cooling
# 2: office unit
data_115 = Data(branch_12)

# ----
# Infiltration
# GENERATED
data_116 = Data(roundd_7.Rounded)
item_63 = ListItem(List=data_116, Index=filename, Wrap=True)

partition_28 = PartitionList(List=data_83, Size=lng_53)  # -> simplify(Chunks)
cull_i_18 = CullIndex(List=partition_28, Indices=data_84, Wrap=True)  # -> simplify(flatten(List))
item_64 = ListItem(List=cull_i_18, Index=filename, Wrap=True)

# ----
# Infiltration
# V1
python_19 = GhPythonScript(x=item_64)  # -> out, a; inputs x: Int32
# ---------- python_19: Python ----------
__author__ = "Siser"
__version__ = "2022.02.21"

import rhinoscriptsyntax as rs
if x == 1960:
    a = 0.0005
elif x == 1980:
    a = 0.0004
else:
    a = 0.000285
# ---------- end python_19 ----------

# ----
# information of Selection
# Slider of Building
data_117 = Data(filename)

item_65 = ListItem(List=data_96, Index=filename, Wrap=True)
panel_361 = Panel("Insulation U value")

panel_362 = Panel("uValue Input")
data_118 = Data(item_65)

merge_70 = Merge(Data1="GeneratedConcreteRoof", Data2=filename)
join_12 = TextJoin(Text=merge_70)

merge_71 = Merge(Data1="GeneratedConcreteWall", Data2=filename)
join_13 = TextJoin(Text=merge_71)

merge_72 = Merge(Data1="GeneratedMasonryWall", Data2=filename)
join_14 = TextJoin(Text=merge_72)

item_66 = ListItem(List=data_97, Index=filename, Wrap=True)

data_119 = Data(item_66)

item_67 = ListItem(List=data_98, Index=filename, Wrap=True)

data_120 = Data(item_67)

merge_73 = Merge(Data1="generatedGroundFloor", Data2=filename)
join_15 = TextJoin(Text=merge_73)

item_68 = ListItem(List=data_99, Index=filename, Wrap=True)

data_121 = Data(item_68)

data_122 = Data(roundd_5.Rounded)
item_69 = ListItem(List=data_122, Index=filename, Wrap=True)

panel_369 = Panel("U-GroundFloor")
data_123 = Data(item_69)

item_70 = ListItem(List=data_123, Index=filename, Wrap=True)

data_124 = Data(item_70)

# ----
# index of selected parcel
# 08.OUTPUT MANAGEMENT
data_125 = Data(filename)

construct_domain = ConstructDomain(DomainStart="0", DomainEnd="5929")
iteration_selection = IterationSelection(Domain=construct_domain)
iterator = ColibriIterator(fileName=filename, Selection=iteration_selection, RemoteFly=False, ignoreAllWarningMsg=False)  # -> FileName_, Value_N, IterationGenome

# ----
# Function of Units
# (0:residential, 1: office)
data_126 = Data(branch_12)

panel_372 = Panel("cullOfficeUnits")
equals_16 = Equality(FirstNumber=data_126, SecondNumber="1")  # -> Equality, Inequality
dispatch_22 = Dispatch(DispatchPattern=equals_16.Equality)  # -> ListA, ListB

# ----
# Select Version
list = ValueList({"V1": 0, "V2": 1, "V3": 2, "V4": 3}, selected="V4")

panel_373 = Panel("Window SHGC")
weave_17 = Weave(Pattern=list, Stream0=singlepanebase_2, Stream1=singlepanebase_2, Stream2=item_59, Stream3=item_59, NullGaps=False)

panel_374 = Panel("Window uValue")
weave_18 = Weave(Pattern=list, Stream0=base, Stream1=base, Stream2=item_61, Stream3=item_61, NullGaps=False)

panel_375 = Panel("Window VT")
weave_19 = Weave(Pattern=list, Stream0=singlepanebase, Stream1=singlepanebase, Stream2=item_60, Stream3=item_60, NullGaps=False)

weave_20 = Weave(Pattern=list, Stream0=glzparamlist, Stream1=glzparamlist, Stream2=glzparamlist_2, Stream3=glzparamlist_2, NullGaps=False)

merge_74 = Merge(Data1=flatten("Generated_WINDOW"), Data2=flatten(weave_18), Data3=flatten(weave_17), Data4=flatten(weave_19))
join_16 = TextJoin(Text=merge_74, Join="_")

panel_377 = Panel("Window ConstName")
weave_21 = Weave(Pattern=list, Stream0="TS-825_WINDOW", Stream1="TS-825_WINDOW", Stream2=join_16, Stream3=join_16, NullGaps=False)

epwindowmat = Honeybee_EnergyPlusWindowMaterial(name="GLASSUBEM", U_Value=weave_18, SHGC=weave_17, VT=weave_19)  # -> EPMaterial; plug-in component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
epconstruction_2 = Honeybee_EnergyPlusConstruction(name=weave_21, layer_1=epwindowmat)  # -> EPConstruction; plug-in component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

panel_378 = Panel("Naming for Roof")
weave_22 = Weave(
    Pattern=list,
    Stream0="TS-825ConcreteRoof",
    Stream1="TS-825ConcreteRoof",
    Stream2=join_12,
    Stream3=join_12,
    NullGaps=False)

decomposeepconstruction = Honeybee_DecomposeEPConstruction(cnstrName=weave_22)  # -> materials, comments, UValue_SI, UValue_IP, RValue_SI, RValue_IP; plug-in component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
panel_379 = Panel("2")  # disabled
rvalueairfilms = Honeybee_RValueWithAirFilms(uValue_SI=decomposeepconstruction.UValue_SI, surfaceType=panel_379)  # -> UValue_SI_wAir, UValue_IP_wAir, RValue_SI_wAir, RValue_IP_wAir; disabled; plug-in component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
panel_380 = Panel(decomposeepconstruction.UValue_SI)

weave_23 = Weave(
    Pattern=list,
    Stream0="TS-825ConcreteWall",
    Stream1="TS-825ConcreteWall",
    Stream2=join_13,
    Stream3=join_13,
    NullGaps=False)

decomposeepconstruction_2 = Honeybee_DecomposeEPConstruction(cnstrName=weave_23)  # -> materials, comments, UValue_SI, UValue_IP, RValue_SI, RValue_IP; plug-in component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

weave_24 = Weave(Pattern=list, Stream0="TS-825MasonryWall", Stream1="TS-825MasonryWall", Stream2=join_14, Stream3=join_14, NullGaps=False)

decomposeepconstruction_3 = Honeybee_DecomposeEPConstruction(cnstrName=weave_24)  # -> materials, comments, UValue_SI, UValue_IP, RValue_SI, RValue_IP; plug-in component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
panel_381 = Panel(decomposeepconstruction_3.UValue_SI)

panel_382 = Panel("Naming for GroundFloor")
weave_25 = Weave(Pattern=list, Stream0="TS-825GROUNDFLOOR", Stream1="TS-825GROUNDFLOOR", Stream2=join_15, Stream3=join_15, NullGaps=False)

decomposeepconstruction_4 = Honeybee_DecomposeEPConstruction(cnstrName=weave_25)  # -> materials, comments, UValue_SI, UValue_IP, RValue_SI, RValue_IP; plug-in component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
panel_383 = Panel(decomposeepconstruction_4.UValue_SI)

merge_75 = Merge(Data1="GeneratedMasonryRoof", Data2=filename)
join_17 = TextJoin(Text=merge_75)
weave_26 = Weave(Pattern=list, Stream0="TS-825MasonryRoof", Stream1="TS-825MasonryRoof", Stream2=join_17, Stream3=join_17, NullGaps=False)

decomposeepconstruction_5 = Honeybee_DecomposeEPConstruction(cnstrName=weave_26)  # -> materials, comments, UValue_SI, UValue_IP, RValue_SI, RValue_IP; plug-in component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
panel_385 = Panel(decomposeepconstruction_5.UValue_SI)

data_127 = Data(weave_20)

area_21 = Area(Geometry=sort.ValuesA)  # -> Area, Centroid
tag_of_block = Panel("neighborhoodName2digits_parcelNumber_buildingNumber")
sorted_points_2 = Point(area_21.Centroid)
lng_62 = ListLength(List=sorted_points_2)
series_32 = Series(Start="0", Step=1, Count=lng_62)
int = Integer(series_32)
preview_20 = CustomPreview(Geometry=geo_15, Material=ColourSwatch(SwatchColor=RGB(0, 123, 255)))
tag_2 = TextTag3D(Location=sorted_points_2, Text=int, Size="15", Colour=ColourSwatch(SwatchColor=RGB(255, 0, 0)), Justification=7)

# ----
# 08.AS-IS
# INPUT
# PARAMETERS
list_of_recordings = Panel("""(ID)
parcelUBEM
blockUBEM
---------
(UNIT)
verticalPosition
formFactor
totalWindowArea
windowcount
floorArea
z-axis
function
WWRDirectionUnitNorth
WWRDirectionUnitWest
WWRDirectionUnitSouth
WWRDirectionUnitEast
---------
(BUILDING)
uWall
#ofFloor
Infiltration
ObstacleDirectionNorth
ObstacleDirectionWest
ObstacleDirectionSouth
ObstacleDirectionEast""")

panel_387 = Panel("parcel_block order")
data_128 = Data(flatten(partition_5))

lng_63 = ListLength(List=merge_15)  # -> flatten(Length)

# ----
# public and school buildings excluded list
data_129 = Data(python_11.a)

# ----
# Indexing
partition_29 = PartitionList(List=data_128, Size=lng_63)  # -> simplify(Chunks)
cull_i_19 = CullIndex(List=partition_29, Indices=data_129, Wrap=True)  # -> simplify(flatten(List))
panel_389 = Panel(cull_i_19)

panel_390 = Panel("""parcel_block
of simulated parcel""")
item_71 = ListItem(List=cull_i_19, Index=filename, Wrap=True)

panel_391 = Panel("parcel_block")
data_130 = Data(cull_i_19)
item_72 = ListItem(List=data_130, Index=filename, Wrap=True)

# ----
# tag order
# for parcels
swatch_6 = ColourSwatch(SwatchColor=RGB(8, 0, 255))
tag_3 = TextTag3D(Location=partition_4, Text=partition_5, Size="3", Colour=swatch_6, Justification=7)

# ----
# Select Occupied Hours
getepschedules_3 = Honeybee_GetEnergyPlusSchedules(zoneProgram=item_47)  # -> occupancySchedule, occupancyActivitySch, heatingSetPtSchedule, coolingSetPtSchedule, lightingSchedule, equipmentSchedule, infiltrationSchedule; disabled; plug-in component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
# IOD calculation only for occupied hours
convertepschvalues_3 = Honeybee_ConvertEnergyPlusScheduleToValues(schName=getepschedules_3.occupancySchedule)  # -> values, holidays; disabled; plug-in component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
strnum_4 = Ladybug_SeparateData(inputList=flatten(convertepschvalues_3.values))  # -> numbers, strings; disabled; plug-in component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
python_20 = GhPythonScript(x=strnum_4.numbers)  # -> out, a; disabled; same code as python_16
panel_392 = Panel("1")  # disabled
# INDOOR OVERHEATING DEGREES
equals_17 = Equality(FirstNumber=python_20.a, SecondNumber=panel_392)  # -> Equality, Inequality; disabled

toggle_18 = BooleanToggle(False)  # disabled

# ----
# UpperBounds
importepw_2 = Ladybug_ImportEpw(epwFile=path_8)  # -> readMe, latitude, location, dryBulbTemperature, dewPointTemperature, relativeHumidity, windSpeed, windDirection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; disabled; plug-in component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
panel_393 = Panel("""key:location/dataType/units/frequency/startsAt/endsAt
Ankara Central_AN_TUR
Dry Bulb Temperature
C
Hourly
(1, 1, 1)
(12, 31, 24)""")  # disabled
number_slider_2 = Slider(6, range=0..10)  # disabled
number_slider_3 = Slider(8760, range=0..10000)  # disabled
dup_43 = DuplicateData(Data=number_slider_2, Number=number_slider_3, Order=True)  # disabled
toggle_19 = BooleanToggle(True)  # disabled
toggle_20 = BooleanToggle(True)  # disabled
merge_76 = Merge(Data1=panel_393, Data2=dup_43)  # -> flatten(Result); disabled
adaptcomfortpar = Ladybug_AdaptiveComfortParameters(ASHRAEorEN=toggle_20, eightyOrNinetyComf=toggle_18, avgMonthOrRunMean=toggle_19)  # -> comfortPar; disabled; plug-in component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
panel_394 = Panel("not important")  # disabled
toggle_21 = BooleanToggle(True)  # disabled
adaptivecomfortcalculator = Ladybug_AdaptiveComfortCalculator(
    dryBulbTemperature=merge_76,
    outdoorTemperature=importepw_2.dryBulbTemperature,
    windSpeed=importepw_2.windSpeed,
    comfortPar=adaptcomfortpar,
    runIt=toggle_21)  # -> readMe, port, comfortableOrNot, conditionOfPerson, degreesFromTarget, port_2, targetTemperature, simplify(upperTemperatureBound)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; disabled; plug-in component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
strnum_5 = Ladybug_SeparateData(inputList=flatten(adaptivecomfortcalculator.upperTemperatureBound))  # -> numbers, strings; disabled; plug-in component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

panel_395 = Panel("upperTemperatureBoundaries")  # disabled
dispatch_23 = Dispatch(List=strnum_5.numbers, DispatchPattern=equals_17.Equality)  # -> ListA, ListB; disabled

# ----
# GENERATED
data_131 = Data(filename)  # disabled
item_73 = ListItem(List=roundd.Rounded, Index=data_131, Wrap=True)  # disabled

dispatch_24 = Dispatch(List=strnum_5.numbers, DispatchPattern=equals_17.Equality)  # -> ListA, ListB; disabled

toggle_22 = BooleanToggle(False)  # disabled
air_speed_from_ceiling_fans = Slider(1, range=0..1)  # disabled
adaptcomfortpar_2 = Ladybug_AdaptiveComfortParameters(avgMonthOrRunMean=toggle_22)  # -> comfortPar; disabled; plug-in component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

# ----
# V1
panel_397 = Panel("0.85")  # disabled

# ----
# boiler efficiency is building-based
panel_398 = Panel("version implementation")  # disabled
weave_27 = Weave(Pattern=list, Stream0=panel_397, Stream1=panel_397, Stream2=item_73, Stream3=item_73, NullGaps=False)  # disabled

panel_399 = Panel("30")  # disabled
panel_400 = Panel("5")  # disabled
panel_401 = Panel("24")  # disabled
doy_hoy = Ladybug_DOY_HOY(days=panel_399, months=panel_400, hours=panel_401)  # -> HOY, DOY, date; disabled; plug-in component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

panel_402 = Panel("5")  # disabled
panel_403 = Panel("30")  # disabled
panel_404 = Panel("24")  # disabled
doy_hoy_2 = Ladybug_DOY_HOY(days=panel_403, months=panel_402, hours=panel_404)  # -> HOY, DOY, date; disabled; plug-in component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

panel_405 = Panel("9")  # disabled
panel_406 = Panel("1")  # disabled
panel_407 = Panel("1")  # disabled
doy_hoy_3 = Ladybug_DOY_HOY(days=panel_406, months=panel_405, hours=panel_407)  # -> HOY, DOY, date; disabled; plug-in component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

panel_408 = Panel("9")  # disabled
panel_409 = Panel("1")  # disabled
panel_410 = Panel("1")  # disabled
doy_hoy_4 = Ladybug_DOY_HOY(days=panel_409, months=panel_408, hours=panel_410)  # -> HOY, DOY, date; disabled; plug-in component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

panel_411 = Panel("5")  # disabled
panel_412 = Panel("1")  # disabled
panel_413 = Panel("24")  # disabled
doy_hoy_5 = Ladybug_DOY_HOY(days=panel_412, months=panel_411, hours=panel_413)  # -> HOY, DOY, date; disabled; plug-in component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

panel_414 = Panel("30May-1Sept")  # disabled
subtraction_3 = Subtraction(A=doy_hoy_3.HOY, B=doy_hoy.HOY)  # disabled
panel_415 = Panel("#of Occupied Hours")  # disabled
series_33 = Series(Start=doy_hoy.HOY, Step=1, Count=subtraction_3)  # disabled
item_74 = ListItem(List=dispatch_24.ListA, Index=series_33, Wrap=True)  # disabled

panel_416 = Panel("30")  # disabled
panel_417 = Panel("9")  # disabled
panel_418 = Panel("1")  # disabled
doy_hoy_6 = Ladybug_DOY_HOY(days=panel_416, months=panel_417, hours=panel_418)  # -> HOY, DOY, date; disabled; plug-in component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

toggle_23 = BooleanToggle(True)  # disabled
pt_3 = Point(Point(409, 1853, 0))  # disabled
swatch_7 = ColourSwatch(SwatchColor=RGB(0, 0, 0))  # disabled

# ----
# office: # of people per sqm
data_132 = Data(geteploads.numOfPeoplePerArea)

# ----
# # of parcels in the blocks
data_133 = Data(flatten(lng_20))

# ----
# public and school buildings excluded list
data_134 = Data(python_11.a)

panel_419 = Panel("TUIK")

panel_420 = Panel("parcel_number")
data_135 = Data(weave_7)

panel_421 = Panel("block_number")
data_136 = Data(weave_10)

# ----
# U-value-Window of Building
decomposeepconstruction_6 = Honeybee_DecomposeEPConstruction(cnstrName=weave_21)  # -> materials, comments, UValue_SI, UValue_IP, RValue_SI, RValue_IP; plug-in component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
lng_64 = ListLength(List=branch_12)
data_137 = Data(decomposeepconstruction_6.UValue_SI)
dup_44 = DuplicateData(Data=data_137, Number=lng_64, Order=True)

# ----
# U-value-GroundFloor of Building
lng_65 = ListLength(List=branch_12)
data_138 = Data(decomposeepconstruction_4.UValue_SI)
dup_45 = DuplicateData(Data=data_138, Number=lng_65, Order=True)

equals_18 = Equality(FirstNumber=data_126, SecondNumber="1")  # -> Equality, Inequality
dispatch_25 = Dispatch(List=dup_44, DispatchPattern=equals_18.Equality)  # -> ListA, ListB

equals_19 = Equality(FirstNumber=data_126, SecondNumber="1")  # -> Equality, Inequality
dispatch_26 = Dispatch(List=dup_45, DispatchPattern=equals_19.Equality)  # -> ListA, ListB

# ----
# Heating set point of Offices
data_139 = Data(panel_256)

# ----
# UNIT FUNCTION: 0: residential non-cooling
# 5: residential with cooling
# 2: office unit
data_140 = Data(branch_12)

panel_424 = Panel("construction Date")
data_141 = Data(item_64)

panel_425 = Panel("VTWindow")
data_142 = Data(weave_19)

panel_426 = Panel("shgcWindow")
data_143 = Data(weave_17)

panel_427 = Panel("equipment")  # disabled
path_9 = FilePath("D:\KBEM\IP2.1\csv\4\equip.csv")  # disabled
panel_428 = Panel(path_9)  # disabled

panel_429 = Panel("lighting")  # disabled
path_10 = FilePath("D:\KBEM\IP2.1\csv\3\light.csv")  # disabled
panel_430 = Panel(path_10)  # disabled

panel_431 = Panel("equip")  # disabled
toggle_24 = BooleanToggle(True)  # disabled
split_5 = TextSplit(Text=panel_428, Separators=panel_431)  # -> flatten(Result); disabled
clean_8 = CleanTree(RemoveNulls=toggle_24, RemoveInvalid=toggle_24, RemoveEmpty=toggle_24, Tree=split_5)  # disabled
brep = Brep(split_5)  # disabled
null_4 = NullItem(Item=brep)  # -> NullFlags, InvalidFlags, Description; disabled
dispatch_27 = Dispatch(List=clean_8, DispatchPattern=null_4.NullFlags)  # -> ListA, ListB; disabled
panel_432 = Panel(split_5)  # disabled

merge_77 = Merge(Data1=panel_431, Data2=filename)  # disabled
join_18 = TextJoin(Text=flatten(merge_77))  # disabled
panel_433 = Panel(join_18)  # disabled

panel_434 = Panel("light")  # disabled
toggle_25 = BooleanToggle(True)  # disabled
split_6 = TextSplit(Text=panel_430, Separators=panel_434)  # -> flatten(Result); disabled
clean_9 = CleanTree(RemoveNulls=toggle_25, RemoveInvalid=toggle_25, RemoveEmpty=toggle_25, Tree=split_6)  # disabled
brep_2 = Brep(split_6)  # disabled
null_5 = NullItem(Item=brep_2)  # -> NullFlags, InvalidFlags, Description; disabled
dispatch_28 = Dispatch(List=clean_9, DispatchPattern=null_5.NullFlags)  # -> ListA, ListB; disabled
panel_435 = Panel(split_6)  # disabled

merge_78 = Merge(Data1=panel_434, Data2=filename)  # disabled
join_19 = TextJoin(Text=flatten(merge_78))  # disabled
panel_436 = Panel(join_19)  # disabled

item_75 = ListItem(List=dispatch_27.ListA, Index=0, Wrap=True)  # disabled
item_76 = ListItem(List=dispatch_27.ListA, Index=-1, Wrap=True)  # disabled
merge_79 = Merge(Data1=item_75, Data2=join_18, Data3=item_76)  # disabled
join_20 = TextJoin(Text=merge_79)  # disabled

panel_437 = Panel("operative")  # disabled
path_11 = FilePath("D:\KBEM\IP2.1\csv\0\op.csv")  # disabled
panel_438 = Panel(path_11)  # disabled

panel_439 = Panel("AirTemp")  # disabled
path_12 = FilePath("D:\KBEM\IP2.1\csv\1\air.csv")  # disabled
panel_440 = Panel(path_12)  # disabled

panel_441 = Panel("menRad")  # disabled
path_13 = FilePath("D:\KBEM\IP2.1\csv\2\meanRad.csv")  # disabled
panel_442 = Panel(path_13)  # disabled

item_77 = ListItem(List=dispatch_28.ListA, Index=0, Wrap=True)  # disabled
item_78 = ListItem(List=dispatch_28.ListA, Index=-1, Wrap=True)  # disabled
merge_80 = Merge(Data1=item_77, Data2=join_19, Data3=item_78)  # disabled
join_21 = TextJoin(Text=merge_80)  # disabled

panel_443 = Panel("op")  # disabled
toggle_26 = BooleanToggle(True)  # disabled
split_7 = TextSplit(Text=panel_438, Separators=panel_443)  # -> flatten(Result); disabled
clean_10 = CleanTree(RemoveNulls=toggle_26, RemoveInvalid=toggle_26, RemoveEmpty=toggle_26, Tree=split_7)  # disabled
brep_3 = Brep(split_7)  # disabled
null_6 = NullItem(Item=brep_3)  # -> NullFlags, InvalidFlags, Description; disabled
dispatch_29 = Dispatch(List=clean_10, DispatchPattern=null_6.NullFlags)  # -> ListA, ListB; disabled
panel_444 = Panel(split_7)  # disabled

panel_445 = Panel("airTemp")  # disabled
toggle_27 = BooleanToggle(True)  # disabled
split_8 = TextSplit(Text=panel_440, Separators=panel_445)  # -> flatten(Result); disabled
clean_11 = CleanTree(RemoveNulls=toggle_27, RemoveInvalid=toggle_27, RemoveEmpty=toggle_27, Tree=split_8)  # disabled
brep_4 = Brep(split_8)  # disabled
null_7 = NullItem(Item=brep_4)  # -> NullFlags, InvalidFlags, Description; disabled
dispatch_30 = Dispatch(List=clean_11, DispatchPattern=null_7.NullFlags)  # -> ListA, ListB; disabled
panel_446 = Panel(split_8)  # disabled

panel_447 = Panel("meanrad")  # disabled
toggle_28 = BooleanToggle(True)  # disabled
split_9 = TextSplit(Text=panel_442, Separators=panel_447)  # -> flatten(Result); disabled
clean_12 = CleanTree(RemoveNulls=toggle_28, RemoveInvalid=toggle_28, RemoveEmpty=toggle_28, Tree=split_9)  # disabled
brep_5 = Brep(split_9)  # disabled
null_8 = NullItem(Item=brep_5)  # -> NullFlags, InvalidFlags, Description; disabled
dispatch_31 = Dispatch(List=clean_12, DispatchPattern=null_8.NullFlags)  # -> ListA, ListB; disabled
panel_448 = Panel(split_9)  # disabled

panel_449 = Panel("AllV4")  # disabled
path_14 = FilePath("C:\KBEM\IP2.1\RetrofitResults\csv\AllV4_Feyza_Retrofit_2020.csv")  # disabled

panel_450 = Panel("AllV2")  # disabled
path_15 = FilePath("C:\KBEM\IP2.1\csv\AllV2.csv")  # disabled

panel_451 = Panel("AllV1")  # disabled
path_16 = FilePath("C:\KBEM\IP2.1\csv\AllV1NormalOCC.csv")  # disabled

panel_452 = Panel("AllV3")  # disabled
path_17 = FilePath("C:\KBEM\IP2.1\csv\AllV3.csv")  # disabled

panel_453 = Panel("ParamsV1")
path_18 = FilePath("C:\KBEM\IP2.1\csv\ParamsV1.csv")

panel_454 = Panel("ParamsV3")
path_19 = FilePath("C:\KBEM\IP2.1\csv\ParamsV3.csv")

panel_455 = Panel("ParamsV2")
path_20 = FilePath("C:\KBEM\IP2.1\csv\ParamsV2.csv")

panel_456 = Panel("ParamsV4")
path_21 = FilePath("C:\KBEM\IP2.1\RetrofitResults\csv\ParamsV4_Feyza_Retrofit_2020.csv")

merge_81 = Merge(Data1=panel_443, Data2=filename)  # disabled
join_22 = TextJoin(Text=flatten(merge_81))  # disabled
panel_457 = Panel(join_22)  # disabled

merge_82 = Merge(Data1=panel_445, Data2=filename)  # disabled
join_23 = TextJoin(Text=flatten(merge_82))  # disabled
panel_458 = Panel(join_23)  # disabled

merge_83 = Merge(Data1=panel_447, Data2=filename)  # disabled
join_24 = TextJoin(Text=flatten(merge_83))  # disabled
panel_459 = Panel(join_24)  # disabled

item_79 = ListItem(List=dispatch_29.ListA, Index=0, Wrap=True)  # disabled
item_80 = ListItem(List=dispatch_29.ListA, Index=-1, Wrap=True)  # disabled
merge_84 = Merge(Data1=item_79, Data2=join_22, Data3=item_80)  # disabled
join_25 = TextJoin(Text=merge_84)  # disabled

item_81 = ListItem(List=dispatch_30.ListA, Index=0, Wrap=True)  # disabled
item_82 = ListItem(List=dispatch_30.ListA, Index=-1, Wrap=True)  # disabled
merge_85 = Merge(Data1=item_81, Data2=join_23, Data3=item_82)  # disabled
join_26 = TextJoin(Text=merge_85)  # disabled

item_83 = ListItem(List=dispatch_31.ListA, Index=0, Wrap=True)  # disabled
item_84 = ListItem(List=dispatch_31.ListA, Index=-1, Wrap=True)  # disabled
merge_86 = Merge(Data1=item_83, Data2=join_24, Data3=item_84)  # disabled
join_27 = TextJoin(Text=merge_86)  # disabled

# ----
# Entering EKB Data
# for Concrete Wall
merge_87 = Merge(Data1=graft(parcelubem_2), Data2=graft(blockubem_2))
join_28 = TextJoin(Text=merge_87, Join="_")  # -> simplify(flatten(Result))
mindex_4 = MemberIndex(Set=join_28, Member=item_11)  # -> flatten(Index), Count

# ----
# public and school buildings excluded list
cull_i_20 = CullIndex(List=ekbuwallconcrete_2, Indices=mindex_4.Index, Wrap=True)

# ----
# public and school buildings excluded list
cull_i_21 = CullIndex(List=join_28, Indices=mindex_4.Index, Wrap=True)

mindex_5 = MemberIndex(Set=flatten(cull_i_6), Member=cull_i_21)  # -> flatten(Index), Count

# ----
# EKB Concrete Embedded List
# 1st
replace_10 = ReplaceItems(List=dup_3, Item=cull_i_20, Indices=mindex_5.Index, Wrap=False)

# ----
# Masonry
# Generated
# Random Masonry Construction Values
lng_66 = ListLength(List=flatten(cull_i_6))
merge_88 = Merge(Data1=mindex_5.Index, Data2=mindex_2.Index)
panel_460 = Panel("EKB Data")
series_34 = Series(Start=0, Step=1, Count=lng_66)
cull_i_22 = CullIndex(List=series_34, Indices=merge_88, Wrap=True)
lng_67 = ListLength(List=cull_i_22)
division_9 = Division(A=lng_67, B=panel_36)
round_28 = Round(Number=division_9)  # -> Nearest, Floor, Ceiling
series_35 = Series(Start=0, Step=1, Count=round_28.Floor)
jitter_38 = Jitter(List=cull_i_22, Jitter=1, Seed=2)  # -> Values, Indices
item_85 = ListItem(List=jitter_38.Values, Index=series_35, Wrap=True)
item_86 = ListItem(List=panel_3, Index=series_35, Wrap=True)

# ----
# EKB Masonry Wall Embedded List
# 2nd
data_144 = Data(item_13)
replace_11 = ReplaceItems(List=replace_10, Item=data_144, Indices=mindex_2.Index, Wrap=False)

# ----
# 3rd
# RANDOM Masonry Embedded List
data_145 = Data(item_86)
replace_12 = ReplaceItems(List=replace_11, Item=data_145, Indices=item_85, Wrap=False)

# ----
# Concrete
# Wall Random
cull_i_23 = CullIndex(List=jitter_38.Values, Indices=series_35, Wrap=True)
lng_68 = ListLength(List=cull_i_23)
series_36 = Series(Start=0, Step=1, Count=lng_68)
item_87 = ListItem(List=panel, Index=series_36, Wrap=True)

# ----
# RANDOM Concrete Wall Embedded List
# 4th
data_146 = Data(item_87)
replace_13 = ReplaceItems(List=replace_12, Item=data_146, Indices=cull_i_23, Wrap=False)  # -> simplify(List)

# ----
# Masonry/Concrete Construction Division, EKB
panel_461 = Panel(replace_13)

lng_69 = ListLength(List=cull_i_6)
dup_46 = DuplicateData(Data="1", Number=lng_69, Order=True)  # -> simplify(flatten(Data))
merge_89 = Merge(Data1=flatten(mindex_2.Index), Data2=flatten(item_85))
panel_462 = Panel("EKB Generated Data")
replace_14 = ReplaceItems(List=dup_46, Item="0", Indices=merge_89, Wrap=False)

panel_464 = Panel("ConstructionType")
data_147 = Data(replace_14)

# ----
# extract only
# ''# of residential units''
# in the building
toggle_29 = BooleanToggle(True)
clean_13 = CleanTree(RemoveNulls=True, RemoveInvalid=True, RemoveEmpty=toggle_29, Tree=dispatch_4.ListA)
tstat_6 = TreeStatistics(Tree=clean_13)  # -> Paths, Length, Count
series_37 = Series(Start=0, Step=1, Count=tstat_6.Count)
replace_15 = ReplacePaths(Data=clean_13, Search=tstat_6.Paths, Replace=series_37)

# ----
# only, # of residential units in the building
lng_70 = ListLength(List=replace_15)  # -> flatten(Length)

# ----
# HVAC
partition_30 = PartitionList(List=merge_2, Size=lng_70)  # -> simplify(Chunks)
branch_13 = TreeBranch(Tree=partition_30, Path=filename, MaintainPaths=True)  # disabled

panel_465 = Panel(lng_70)

partition_31 = PartitionList(List=merge_5, Size=lng_70)  # -> simplify(Chunks)
branch_14 = TreeBranch(Tree=partition_31, Path=filename, MaintainPaths=True)  # disabled

partition_32 = PartitionList(List=merge_3, Size=lng_70)  # -> simplify(Chunks)
branch_15 = TreeBranch(Tree=partition_32, Path=filename, MaintainPaths=True)  # disabled

partition_33 = PartitionList(List=merge_4, Size=lng_70)  # -> simplify(Chunks)
branch_16 = TreeBranch(Tree=partition_33, Path=filename, MaintainPaths=True)  # disabled

partition_34 = PartitionList(List=merge_6, Size=lng_70)  # -> simplify(Chunks)
branch_17 = TreeBranch(Tree=partition_34, Path=filename, MaintainPaths=True)  # disabled

# ----
# # of units in the buildings
data_148 = Data(lng_70)
# Unit-based
dup_47 = DuplicateData(Data=data_148, Number="10", Order=True)

# ----
# ppl/m2
toggle_30 = BooleanToggle(True)
path_22 = FilePath("C:\KBEM\IP2.1\Retrofit\RETROFIT_UnitBased_occ.csv")
readxl_8 = ReadExcelSheet(Run=toggle_30, FilePath=path_22, Worksheet="1", Listen=False)  # -> UserMessages, Columns, Rows
roundd_8 = RoundToDecimalPlace(NumberX=readxl_8.Columns, DecimalPlace="3", RoundType=0)  # -> Rounded, Difference
partition_35 = PartitionList(List=roundd_8.Rounded, Size=dup_47)  # -> simplify(Chunks)
branch_18 = TreeBranch(Tree=partition_35, Path=filename, MaintainPaths=True)

# ----
# Heating Set Point
toggle_31 = BooleanToggle(True)
path_23 = FilePath("C:\KBEM\IP2.1\Retrofit\RETROFIT_UnitBased_Theat.csv")
readxl_9 = ReadExcelSheet(Run=toggle_31, FilePath=path_23, Worksheet="1", Listen=False)  # -> UserMessages, Columns, Rows
roundd_9 = RoundToDecimalPlace(NumberX=readxl_9.Columns, DecimalPlace="3", RoundType=0)  # -> Rounded, Difference
partition_36 = PartitionList(List=roundd_9.Rounded, Size=dup_47)  # -> simplify(Chunks)
branch_19 = TreeBranch(Tree=partition_36, Path=filename, MaintainPaths=True)

# ----
# equipmentDensity
toggle_32 = BooleanToggle(True)
path_24 = FilePath("C:\KBEM\IP2.1\Retrofit\RETROFIT_UnitBased_qequip.csv")
readxl_10 = ReadExcelSheet(Run=toggle_32, FilePath=path_24, Worksheet="1", Listen=False)  # -> UserMessages, Columns, Rows
roundd_10 = RoundToDecimalPlace(NumberX=readxl_10.Columns, DecimalPlace="3", RoundType=0)  # -> Rounded, Difference
partition_37 = PartitionList(List=roundd_10.Rounded, Size=dup_47)  # -> simplify(Chunks)
branch_20 = TreeBranch(Tree=partition_37, Path=filename, MaintainPaths=True)

# ----
# lightingDensity
toggle_33 = BooleanToggle(True)
path_25 = FilePath("C:\KBEM\IP2.1\Retrofit\RETROFIT_UnitBased_qlight.csv")
readxl_11 = ReadExcelSheet(Run=toggle_33, FilePath=path_25, Worksheet="1", Listen=False)  # -> UserMessages, Columns, Rows
roundd_11 = RoundToDecimalPlace(NumberX=readxl_11.Columns, DecimalPlace="3", RoundType=0)  # -> Rounded, Difference
partition_38 = PartitionList(List=roundd_11.Rounded, Size=dup_47)  # -> simplify(Chunks)
branch_21 = TreeBranch(Tree=partition_38, Path=filename, MaintainPaths=True)

panel_466 = Panel(branch_19)

panel_467 = Panel("""heatingSetPoint
GeneratedData""")
data_149 = Data(branch_19)

# ----
# separate for each residential unit
panel_468 = Panel("LightingDensity")
data_150 = Data(branch_21)

panel_469 = Panel("""generated
equipment density""")
data_151 = Data(branch_20)

tuık = Data(branch_18)

data_152 = Data(branch_12)
# # of people per sqm
python_21 = GhPythonScript(x=data_152, y=tuık, z=data_132)  # -> out, a
# ---------- python_21: Python ----------
__author__ = "orcun"
__version__ = "2022.03.30"

import rhinoscriptsyntax as rs
if x == 1:
    a = z
else:
    a = y
# ---------- end python_21 ----------

equals_20 = Equality(FirstNumber=data_152, SecondNumber="1")  # -> Equality, Inequality
dispatch_32 = Dispatch(List=python_21.a, DispatchPattern=equals_20.Equality)  # -> ListA, ListB

# ----
# Entering EKB Data
# for Concrete Wall
merge_90 = Merge(Data1=graft(parcelubem_5), Data2=graft(blockubem_3))
join_29 = TextJoin(Text=merge_90, Join="_")  # -> simplify(flatten(Result))
mindex_6 = MemberIndex(Set=join_29, Member=item_14)  # -> flatten(Index), Count

# ----
# public and school buildings excluded list
cull_i_24 = CullIndex(List=join_29, Indices=mindex_6.Index, Wrap=True)

# ----
# public and school buildings excluded list
cull_i_25 = CullIndex(List=ekbuwallconcrete_3, Indices=mindex_6.Index, Wrap=True)

mindex_7 = MemberIndex(Set=flatten(cull_i_8), Member=cull_i_24)  # -> flatten(Index), Count

# ----
# EKB Concrete Embedded List
# 1st
replace_16 = ReplaceItems(List=dup_4, Item=cull_i_25, Indices=mindex_7.Index, Wrap=False)

# ----
# WWR
data_153 = Data(flatten(cull_i_8))
listdexs_5 = ListIndices(List=data_153)

# ----
# Concrete
# Wall Random
cull_i_26 = CullIndex(List=listdexs_5, Indices=mindex_7.Index, Wrap=True)
lng_71 = ListLength(List=cull_i_26)
series_38 = Series(Start=0, Step=1, Count=lng_71)
item_88 = ListItem(List=panel_11, Index=series_38, Wrap=True)

# ----
# RANDOM Concrete Wall Embedded List
# 4th
data_154 = Data(item_88)
replace_17 = ReplaceItems(List=replace_16, Item=data_154, Indices=cull_i_26, Wrap=False)  # -> simplify(List)

panel_471 = Panel(replace_17)

# ----
# # of Floor of the building
toggle_34 = BooleanToggle(True)
partition_39 = PartitionList(List=data_34, Size=subtraction_2)  # -> simplify(Chunks)
clean_14 = CleanTree(RemoveNulls=True, RemoveInvalid=True, RemoveEmpty=toggle_34, Tree=partition_39)
lng_72 = ListLength(List=clean_14)  # -> flatten(Length)
partition_40 = PartitionList(List=flatten(clean_14), Size=lng_72)  # -> simplify(Chunks)

# ----
# DATA TREE: building floor info public and schoold buildings excluded
cull_i_27 = CullIndex(List=partition_40, Indices=clean_3, Wrap=True)  # -> simplify(List)

dispatch_33 = Dispatch(List=cull_i_27, DispatchPattern=data_41)  # -> ListA, ListB
weave_28 = Weave(Pattern=python_12.a, Stream0=dispatch_33.ListA, Stream1=dispatch_33.ListB, NullGaps=False)  # -> simplify(Weave)

# ----
# indices of
# selection ratio according to construction date
data_155 = Data(series_10)
item_89 = ListItem(List=simplify(weave_28), Index=simplify(data_155), Wrap=True)

panel_473 = Panel(item_89)
panel_474 = Panel(item_27)
panel_475 = Panel(item_21)

# ----
# 2D to 3D
data_156 = Data(flatten(item_89))
partition_41 = PartitionList(List=data_156, Size="1")  # -> simplify(Chunks)
Z_2 = UnitZ(Factor=data_55)
arrlinear = LinearArray(Geometry=merge_37, Direction=Z_2, Count=partition_41)  # -> Geometry, Transform
geo_46 = Geometry(arrlinear.Geometry)

# ----
# # of floor of
# the building
data_157 = Data(flatten(item_89))

item_90 = ListItem(List=data_61, Index=data_108, Wrap=True)
item_91 = ListItem(List=data_157, Index=data_108, Wrap=True)
division_10 = Division(A=item_90, B=item_91)
round_29 = Round(Number=division_10)  # -> Nearest, Floor, Ceiling
multiplication_4 = Multiplication(A=round_29.Floor, B=item_91)
subtraction_4 = Subtraction(A=item_90, B=multiplication_4)

panel_476 = Panel("# of floor")
panel_477 = Panel(item_91)

# ----
# # of Units of
# the building
panel_478 = Panel(item_90)

# ----
# Simulation Building Selection
item_92 = ListItem(List=geo_41, Index=filename, Wrap=True)
area_22 = Area(Geometry=geo_46)  # -> Area, Centroid
incurve_2 = PointInCurve(Point=area_22.Centroid, Curve=item_92)  # -> Relationship, Point
equals_21 = Equality(FirstNumber=incurve_2.Relationship, SecondNumber="2")  # -> Equality, Inequality
dispatch_34 = Dispatch(List=geo_46, DispatchPattern=equals_21.Equality)  # -> ListA, ListB

geo_47 = Geometry(flatten(partition_25))
area_23 = Area(Geometry=geo_47)  # -> Area, Centroid
panel_479 = Panel("simulated parcel CORE")
incurve_3 = PointInCurve(Point=area_23.Centroid, Curve=item_92)  # -> Relationship, Point
equals_22 = Equality(FirstNumber=incurve_3.Relationship, SecondNumber="2")  # -> Equality, Inequality
dispatch_35 = Dispatch(List=geo_47, DispatchPattern=equals_22.Equality)  # -> ListA, ListB

md_slider_4 = MDSlider(SliderMode=0, slider_value=Point(0.5, 0.5, 0.5), x_domain=Domain(0, 1), y_domain=Domain(0, 1), z_domain=Domain(0, 1))
evalsrf_2 = EvaluateSurface(Surface=dispatch_35.ListA, Point=md_slider_4)  # -> Point, Normal, UDirection, VDirection, Frame

# ----
# # of units per floor
# of the building
panel_480 = Panel(round_29.Floor)

# ----
# add additional units starting from ground:
# -> 1 unit per floor
panel_481 = Panel(subtraction_4)
panel_482 = Panel("EXTRA units")

# ----
# units of simulated parcel
# without EXTRA units (whether there are exist)
clean_15 = CleanTree(RemoveNulls=True, RemoveInvalid=True, RemoveEmpty=Toggle(True), Tree=dispatch_34.ListA)

panel_483 = Panel("additionalUnit")
data_158 = Data(subtraction_4)

# ----
# Floor-based path
# 
# -> each floor has own path
panel_484 = Panel("{")
dup_48 = DuplicateData(Data=panel_484, Number=item_91, Order=True)
dup_49 = DuplicateData(Data=data_108, Number=item_91, Order=True)
dup_50 = DuplicateData(Data=";", Number=item_91, Order=True)
dup_51 = DuplicateData(Data="}", Number=item_91, Order=True)
series_39 = Series(Start=0, Step=1, Count=item_91)
merge_91 = Merge(Data1=graft(dup_48), Data2=graft(dup_49), Data3=graft(dup_50), Data4=graft(series_39), Data5=graft(dup_51))  # -> simplify(Result)
join_30 = TextJoin(Text=merge_91)  # -> flatten(Result)
panel_485 = Panel(join_30)

# ----
# units of simulated parcel
# without additional units (whether there are exist)
geo_48 = Geometry(clean_15)

# ----
# IF,
# there are Extra Units
panel_486 = Panel(data_158)
equals_23 = Equality(FirstNumber=data_158, SecondNumber="0")  # -> Equality, Inequality
python_22 = GhPythonScript(x=equals_23.Equality, y=geo_48)  # -> out, BuildingwithExtraUnit, simplify(BuildingwithoutExtraUnit); inputs x: Boolean, y: list
# ---------- python_22: Python ----------
__author__ = "Siser"
__version__ = "2022.03.04"

import rhinoscriptsyntax as rs
if x == True:
    BuildingwithoutExtraUnit = y
else:
    BuildingwithExtraUnit = y
# ---------- end python_22 ----------

# ----
# units of simulated parcel
# without additional units (whether there are exist)
geo_49 = Geometry(flatten(geo_48))

# ----
# units of simulated parcel
# without additional units
geo_50 = Geometry(flatten(python_22.BuildingwithExtraUnit))

# ----
# units of simulated parcel
# without additional units
geo_51 = Geometry(flatten(python_22.BuildingwithExtraUnit))

# ----
# # of units per floor
# of the building
data_159 = Data(round_29.Floor)

# ----
# Extra Unit Addition to floors
# if there is no extra units, then a = 0
# else
# a=! 0, thus, the floor division changes
panel_487 = Panel("0")
equals_24 = Equality(FirstNumber=subtraction_4, SecondNumber=panel_487)  # -> Equality, Inequality
python_23 = GhPythonScript(x=equals_24.Equality)  # -> out, a; inputs x: Boolean
# ---------- python_23: Python ----------
__author__ = "Siser"
__version__ = "2022.03.04"

import rhinoscriptsyntax as rs
if x == True:
    a = 0
else:
    a = 1
# ---------- end python_23 ----------
# if x == 1:
#     a=1,1
# elif x ==2:
#     a=2,1
# elif x == 3 or x == 4:
#     a=2,2
# elif x==5 or x ==6:
#     a=3,2
# else:
#     a=4,2
addition_5 = Addition(A=data_159, B=python_23.a)

# ----
# floor division for units per floor
# 
# FOR
# SIMULATED PARCEL
python_24 = GhPythonScript(x=addition_5)  # -> out, simplify(a); inputs x: Int32; same code as python_15

# ----
# uv frame of simulated parcel
data_160 = Data(evalsrf_2.Frame)

# ----
# floors with extra units
series_40 = Series(Start=0, Step=1, Count=subtraction_4)
multiplication_5 = Multiplication(A=series_40, B=data_66)
area_24 = Area(Geometry=geo_51)  # -> Area, Centroid
pdecon_6 = Deconstruct(Point=area_24.Centroid)  # -> XComponent, YComponent, ZComponent
round_30 = Round(Number=pdecon_6.ZComponent)  # -> Nearest, Floor, Ceiling
equals_25 = Equality(FirstNumber=graft(multiplication_5), SecondNumber=round_30.Nearest)  # -> Equality, Inequality
dispatch_36 = Dispatch(List=geo_49, DispatchPattern=equals_25.Equality)  # -> ListA, simplify(ListB)
brec_3 = BoundingRectangle(Geometry=dispatch_36.ListA, Plane=data_160, Axis=0, Slide=0, Union=True)  # -> simplify(Bounding), DimensionX, DimensionY

# ----
# floors without extra units
series_41 = Series(Start=0, Step=1, Count=item_91)
cull_i_28 = CullIndex(List=series_41, Indices=series_40, Wrap=True)
multiplication_6 = Multiplication(A=cull_i_28, B=data_67)
area_25 = Area(Geometry=geo_50)  # -> Area, Centroid
pdecon_7 = Deconstruct(Point=area_25.Centroid)  # -> XComponent, YComponent, ZComponent
round_31 = Round(Number=pdecon_7.ZComponent)  # -> Nearest, Floor, Ceiling
equals_26 = Equality(FirstNumber=graft(multiplication_6), SecondNumber=round_31.Nearest)  # -> Equality, Inequality
dispatch_37 = Dispatch(List=geo_49, DispatchPattern=equals_26.Equality)  # -> simplify(ListA), simplify(ListB)

panel_488 = Panel("non-additional units")
geo_52 = Geometry(simplify(dispatch_37.ListA))

# ----
# cull paths of the additional units
data_161 = Data(series_40)

# ----
# New list path for
# floors without extra units
cull_i_29 = CullIndex(List=join_30, Indices=data_161, Wrap=True)
tstat_7 = TreeStatistics(Tree=geo_52)  # -> Paths, Length, Count
replace_18 = ReplacePaths(Data=geo_52, Search=tstat_7.Paths, Replace=cull_i_29)

# ----
# # of units per floor
# of the building
data_162 = Data(round_29.Floor)

# ----
# check whether
# 
# isotrim division number
# 
# is equal to
# 
# # of units per floor
panel_489 = Panel("1")
addition_6 = Addition(A=data_162, B=panel_489)
ma_4 = MassMultiplication(Input=python_24.a)  # -> Result, PartialResults
equals_27 = Equality(FirstNumber=addition_6, SecondNumber=ma_4.Result)  # -> Equality, Inequality
python_25 = GhPythonScript(x=equals_27.Equality)  # -> out, a; inputs x: Boolean; same code as python_23

# ----
# # of Units
# Per Floor with additional units
panel_490 = Panel(addition_6)

# ----
# no additional units
# for the building
geo_53 = Geometry(flatten(python_22.BuildingwithoutExtraUnit))

# ----
# # of units for floor(s) with extra units
weave_29 = Weave(Pattern=python_25.a, Stream0=flatten(ma_4.Result), Stream1=flatten(addition_6), NullGaps=False)

series_42 = Series(Start=0, Step=1, Count=subtraction_4)
item_93 = ListItem(List=join_30, Index=series_42, Wrap=True)

# ----
# # of units per floor
# of the building
data_163 = Data(round_29.Floor)

# ----
# # of floor of
# the building
data_164 = Data(flatten(item_89))

panel_491 = Panel("Floor-based Path")
data_165 = Data(join_30)

# ----
# staircase, before extension
# BuildingwithoutExtraUnit
area_26 = Area(Geometry=geo_53)  # -> Area, flatten(Centroid)
pdecon_8 = Deconstruct(Point=area_26.Centroid)  # -> XComponent, YComponent, ZComponent
sort_10 = SortList(Keys=pdecon_8.ZComponent, ValuesA=flatten(geo_53))  # -> Keys, ValuesA
partition_42 = PartitionList(List=sort_10.ValuesA, Size=data_163)
tstat_8 = TreeStatistics(Tree=partition_42)  # -> Paths, Length, Count
replace_19 = ReplacePaths(Data=partition_42, Search=tstat_8.Paths, Replace=data_165)

# ----
# Building without
# Extra Units
data_166 = Data(replace_19)

# ----
# Simulated Parcel Bounding Box
geo_54 = Geometry(item_92)

area_27 = Area(Geometry=geo_54)  # -> Area, Centroid

# ----
# uv frame of simulated parcel
data_167 = Data(evalsrf_2.Frame)

# ----
# floor division for units per floor
# 
# FOR
# SIMULATED PARCEL
data_168 = Data(python_24.a)

# ----
# core of simulated parcel, normal
data_169 = Data(evalsrf_2.Frame)

# ----
# center of simulated parcel
area_28 = Area(Geometry=item_92)  # -> Area, Centroid

lng_73 = ListLength(List=join_30)

lng_74 = ListLength(List=join_30)

# ----
# new path (after extra unit)
data_170 = Data(join_30)

# ----
# Simulated Parcel Bounding Box
geo_55 = Geometry(item_92)

area_29 = Area(Geometry=geo_55)  # -> Area, Centroid
circle = CircleCNR(Center=area_29.Centroid, Normal=Vector(0, 0, 1), Radius=data_74)
area_30 = Area(Geometry=geo_42)  # -> Area, Centroid
incurve_4 = PointInCurve(Point=area_30.Centroid, Curve=circle)  # -> Relationship, Point
equals_28 = Equality(FirstNumber=incurve_4.Relationship, SecondNumber="2")  # -> Equality, Inequality

panel_494 = Panel("ground floor index")
item_94 = ListItem(List=join_30, Index=0, Wrap=True)

# ----
# rectangle do not accpeted by collision component
dispatch_38 = Dispatch(List=geo_42, DispatchPattern=equals_28.Equality)  # -> ListA, ListB
debrep_5 = DeconstructBrep(Brep=dispatch_38.ListA)  # -> Faces, Edges, simplify(Vertices)
pline_2 = PolyLine(Vertices=debrep_5.Vertices, Closed=Toggle(True))  # -> flatten(Polyline)

# ----
# rectangle do not accpeted by collision component
debrep_6 = DeconstructBrep(Brep=geo_55)  # -> Faces, Edges, Vertices
pline_3 = PolyLine(Vertices=debrep_6.Vertices, Closed=Toggle(True))

# ----
# Intersected Parcels
# replace simulation unit
# because not ALL building be transformed with BOUNDING BOX component (e.g., parcel 579)
area_31 = Area(Geometry=geo_55)  # -> Area, Centroid
area_32 = Area(Geometry=pline_2)  # -> Area, Centroid
cp = ClosestPoint(Point=area_31.Centroid, Cloud=area_32.Centroid)  # -> ClosestPoint, CPIndex, Distance
replace_20 = ReplaceItems(List=pline_2, Item=pline_3, Indices=cp.CPIndex, Wrap=False)

# ----
# close parcels to the simulation building
geo_56 = Geometry(replace_20)

# ----
# Simulated Parcel Bounding Box
geo_57 = Geometry(item_92)

area_33 = Area(Geometry=geo_56)  # -> Area, Centroid
area_34 = Area(Geometry=geo_57)  # -> Area, Centroid
panel_495 = Panel("exclude simulation building")
cp_2 = ClosestPoint(Point=area_34.Centroid, Cloud=area_33.Centroid)  # -> ClosestPoint, CPIndex, Distance
cull_i_30 = CullIndex(List=geo_56, Indices=cp_2.CPIndex, Wrap=True)

area_35 = Area(Geometry=geo_57)  # -> Area, Centroid
scale_3 = Scale(Geometry=geo_57, Center=area_35.Centroid, Factor="1.25")  # -> Geometry, Transform

panel_496 = Panel("floor number")
item_95 = ListItem(List=flatten(item_89), Index=filename, Wrap=True)

# ----
# test check for close parcels intersection possibility
pop2d = Populate2D(Region=cull_i_30, Count=100, Seed=1)  # -> simplify(Population)
incurve_5 = PointInCurve(Point=pop2d, Curve=scale_3.Geometry)  # -> simplify(Relationship), Point
sort_11 = SortList(Keys=incurve_5.Relationship)  # -> Keys, ValuesA
dcon_2 = DeleteConsecutive(Set=sort_11.Keys, Wrap=False)  # -> simplify(Set), Count
equals_29 = Equality(FirstNumber=dcon_2.Set, SecondNumber="2")  # -> Equality, Inequality
dispatch_39 = Dispatch(List=dcon_2.Set, DispatchPattern=equals_29.Inequality)  # -> ListA, ListB
clean_16 = CleanTree(RemoveNulls=True, RemoveInvalid=True, RemoveEmpty=Toggle(True), Tree=dispatch_39.ListB)
tstat_9 = TreeStatistics(Tree=clean_16)  # -> Paths, Length, Count
split_10 = TextSplit(Text=tstat_9.Paths, Separators="{}")
item_96 = ListItem(List=split_10, Index=1, Wrap=True)

# ----
# this output only useful when there is no real intersection between two buildings
item_97 = ListItem(List=cull_i_30, Index=item_96, Wrap=True)
panel_497 = Panel("Too close parcel")
area_36 = Area(Geometry=item_97)  # -> Area, Centroid
scale_4 = Scale(Geometry=item_97, Center=area_36.Centroid, Factor="1.1")  # -> Geometry, Transform

area_37 = Area(Geometry=geo_43)  # -> Area, Centroid
incurve_6 = PointInCurve(Point=area_37.Centroid, Curve=scale_4.Geometry)  # -> Relationship, Point
equals_30 = Equality(FirstNumber=incurve_6.Relationship, SecondNumber="2")  # -> Equality, Inequality
md_slider_5 = MDSlider(SliderMode=0, slider_value=Point(0.5, 0.5, 0.5), x_domain=Domain(0, 1), y_domain=Domain(0, 1), z_domain=Domain(0, 1))
dispatch_40 = Dispatch(List=geo_43, DispatchPattern=equals_30.Equality)  # -> ListA, ListB
evalsrf_3 = EvaluateSurface(Surface=dispatch_40.ListA, Point=md_slider_5)  # -> Point, Normal, UDirection, VDirection, Frame

lng_75 = ListLength(List=join_30)

panel_499 = Panel("Intersected Parcel(s) Bounding Box")
brec_4 = BoundingRectangle(Geometry=scale_4.Geometry, Plane=evalsrf_3.Frame, Axis=0, Slide=0, Union=True)  # -> simplify(Bounding), DimensionX, DimensionY

# ----
# uv frame of simulated parcel
data_171 = Data(evalsrf_2.Frame)

# ----
# Simulated Parcel Bounding Box
panel_500 = Panel("Intersected Parcel(s) Bounding Box")
geo_58 = Geometry(item_92)
geo_59 = Geometry(brec_4.Bounding)

# ----
# solid union do not work with rectangle geometries, thus, they should transform to polyline
merge_92 = Merge(Data1=geo_59, Data2=geo_58)  # -> simplify(flatten(Result))
partition_43 = PartitionList(List=merge_92, Size="1")  # -> simplify(Chunks)
debrep_7 = DeconstructBrep(Brep=partition_43)  # -> Faces, Edges, Vertices
pline_4 = PolyLine(Vertices=debrep_7.Vertices, Closed=Toggle(True))
sunion_2 = SolidUnion(Breps=pline_4)
runion = RegionUnion(Curves=sunion_2)  # -> simplify(Result)

# ----
# Simulated Parcel Bounding Box
geo_60 = Geometry(item_92)
brec_5 = BoundingRectangle(Geometry=geo_60, Plane=data_171, Axis=0, Slide=0, Union=True)  # -> simplify(Bounding), DimensionX, DimensionY
xy_2 = XYPlane(Origin=Point(0, 0, 0))
project = Project(Geometry=brec_5.Bounding, Plane=xy_2)  # -> Geometry, Transform
debrep_8 = DeconstructBrep(Brep=project.Geometry)  # -> Faces, Edges, Vertices
curvepoint = PointOnCurve(debrep_8.Edges, parameter=0.5)
incurve_7 = PointInCurve(Point=curvepoint, Curve=runion)  # -> simplify(Relationship), Point
equals_31 = Equality(FirstNumber=incurve_7.Relationship, SecondNumber="2")  # -> Equality, Inequality
dispatch_41 = Dispatch(List=debrep_8.Edges, DispatchPattern=equals_31.Equality)  # -> flatten(ListA), ListB

# ----
# Windowless Unit Test
# https://drive.google.com/drive/u/1/folders/1cVOKlVuLwwMiW8gXvWmfqpKi1dvpFBbl
# Intersected surfaces with adjacent buildings
geo_61 = Geometry(dispatch_41.ListA)

curvepoint_2 = PointOnCurve(geo_61, parameter=0.5)
vec2pt_5 = Vector2Pt(PointA=curvepoint_2, PointB=area_27.Centroid, Unitize=False)  # -> Vector, Length
move_2 = Move(Geometry=geo_61, Motion=vec2pt_5.Vector)  # -> Geometry, Transform
disc_5 = Discontinuity(Curve=geo_61, Level=1)  # -> simplify(Points), Parameters
disc_6 = Discontinuity(Curve=move_2.Geometry, Level=1)  # -> simplify(Points), Parameters
merge_93 = Merge(Data1=disc_6.Points, Data2=disc_5.Points)  # -> flatten(Result)
hull_4 = ConvexHull(Points=merge_93, Plane=PlaneXY(0, 0, 0))  # -> Hull, HullZ, Indices

# ----
# Fix Windowless Unit Test
merge_94 = Merge(Data1=disc_6.Points, Data2=disc_5.Points)
hull_5 = ConvexHull(Points=merge_94, Plane=PlaneXY(0, 0, 0))  # -> Hull, HullZ, Indices

# ----
# scale-up the text geometry
# 
# because
# 
# for some buildings even a unit has a edge to the intersected surface, center of the unit do not touch the text geometry.
# for example, index of 572
area_38 = Area(Geometry=hull_5.Hull)  # -> Area, Centroid
scale_5 = Scale(Geometry=hull_5.Hull, Center=area_38.Centroid, Factor="1.1")  # -> Geometry, Transform

# ----
# Intersected surfaces with adjacent buildings
geo_62 = Geometry(dispatch_41.ListA)

item_98 = ListItem(List=flatten(item_89), Index=filename, Wrap=True)

panel_502 = Panel("Intersected Surface")
geo_63 = Geometry(dispatch_41.ListA)

# ----
# # of floor of
# the building
data_172 = Data(flatten(item_89))

item_99 = ListItem(List=flatten(item_89), Index=filename, Wrap=True)

# ----
# Context Shading: Building
# floor number of buildings
data_173 = Data(flatten(item_89))

# ----
# # of floor of
# the building
# index of selected parcel
data_174 = Data(flatten(item_89))
data_175 = Data(filename)
item_100 = ListItem(List=data_174, Index=data_175, Wrap=True)

# ----
# division of floor(s) with extra units
item_101 = ListItem(List=python_24.a, Index=1, Wrap=True)
item_102 = ListItem(List=python_24.a, Index=0, Wrap=True)
boundary_14 = BoundarySurfaces(Edges=brec_3.Bounding)
divide_3 = DivideDomain²(Domain=boundary_14, UCount=item_102, VCount=item_101)
subsrf_3 = Isotrim(Surface=boundary_14, Domain=divide_3)  # -> simplify(Surface)

panel_504 = Panel("""0
1""")
item_103 = ListItem(List=subsrf_3, Index=1, Wrap=True)
item_104 = ListItem(List=subsrf_3, Index=0, Wrap=True)
cull_i_31 = CullIndex(List=subsrf_3, Indices=panel_504, Wrap=True)  # -> simplify(List)

merge_95 = Merge(Data1=item_104, Data2=item_103)
sunion_3 = SolidUnion(Breps=merge_95)
disc_7 = Discontinuity(Curve=sunion_3, Level=1)  # -> Points, Parameters
pline_5 = PolyLine(Vertices=disc_7.Points, Closed=Toggle(True))
merge_96 = Merge(Data1=cull_i_31, Data2=simplify(pline_5))

# ----
# Extra Unit
# https://drive.google.com/drive/u/1/folders/1cVOKlVuLwwMiW8gXvWmfqpKi1dvpFBbl
# units for floor(s) with extra units
weave_30 = Weave(Pattern=python_25.a, Stream0=flatten(subsrf_3), Stream1=flatten(merge_96), NullGaps=False)

partition_44 = PartitionList(List=flatten(weave_30), Size=weave_29)  # -> simplify(Chunks)
tstat_10 = TreeStatistics(Tree=partition_44)  # -> Paths, Length, Count
replace_21 = ReplacePaths(Data=partition_44, Search=tstat_10.Paths, Replace=item_93)

# ----
# Building with
# Extra Units
merge_97 = Merge(Data1=replace_18, Data2=replace_21)

merge_98 = Merge(Data1=data_166, Data2=merge_97)
clean_17 = CleanTree(RemoveNulls=True, RemoveInvalid=True, RemoveEmpty=Toggle(True), Tree=merge_98)

tstat_11 = TreeStatistics(Tree=clean_17)  # -> Paths, Length, Count
panel_505 = Panel(tstat_11.Paths)

# ----
# TEST FOR EACH FLOOR
# 
# if there are more than 2 residential units at the side of intersected surface
# 
# for example, 0_21, 4_28
area_39 = Area(Geometry=clean_17)  # -> Area, Centroid
incurve_8 = PointInCurve(Point=area_39.Centroid, Curve=scale_5.Geometry)  # -> Relationship, Point
equals_32 = Equality(FirstNumber=incurve_8.Relationship, SecondNumber="2")  # -> Equality, Inequality
dispatch_42 = Dispatch(List=area_39.Centroid, DispatchPattern=equals_32.Equality)  # -> ListA, ListB
lng_76 = ListLength(List=dispatch_42.ListA)
larger = LargerThan(FirstNumber=lng_76, SecondNumber="2")  # -> LargerThan, OrEqualTo
panel_506 = Panel(larger.LargerThan)

# ----
# single unit per floor
panel_507 = Panel("0")

# ----
# if there is one floor at the building
item_105 = ListItem(List=data_164, Index=data_109, Wrap=True)
python_26 = GhPythonScript(x=item_105)  # -> out, a; inputs x: Int32
# ---------- python_26: Python ----------
__author__ = "orcun"
__version__ = "2022.04.08"

import rhinoscriptsyntax as rs
#if x == 1 or x == 2:
if x == 1:
    a = 0
else:
    a = 1
# ---------- end python_26 ----------

panel_508 = Panel("staircase")

python_27 = GhPythonScript(x=larger.LargerThan, y=clean_17)  # -> out, simplify(Windowless), simplify(NoWindowless); inputs x: Boolean, y: list
# ---------- python_27: Python ----------
__author__ = "Siser"
__version__ = "2022.03.04"

import rhinoscriptsyntax as rs
if x == True:
    Windowless = y
else:
    NoWindowless= y
# ---------- end python_27 ----------
geo_64 = Geometry(python_27.Windowless)
clean_18 = CleanTree(RemoveNulls=True, RemoveInvalid=True, RemoveEmpty=Toggle(True), Tree=geo_64)
brec_6 = BoundingRectangle(Geometry=clean_18, Plane=data_167, Axis=0, Slide=0, Union=True)  # -> simplify(Bounding), DimensionX, DimensionY
boundary_15 = BoundarySurfaces(Edges=brec_6.Bounding)
md_slider_6 = MDSlider(SliderMode=0, slider_value=Point(0.5, 0.5, 0.5), x_domain=Domain(0, 1), y_domain=Domain(0, 1), z_domain=Domain(0, 1))
iso_4 = IsoCurve(Surface=reparameterize(flatten(boundary_15)), UVPoint=md_slider_6)  # -> simplify(flatten(UIsocurve)), VIsocurve
item_106 = ListItem(List=iso_4.UIsocurve, Index=0, Wrap=True)
equals_33 = Equality(FirstNumber=data_168, SecondNumber="2")  # -> Equality, Inequality
sort_12 = SortList(Keys=data_168)  # -> Keys, ValuesA
dprod_4 = DotProduct(VectorA=item_106, VectorB=geo_62, Unitize=False)
dispatch_43 = Dispatch(List=data_168, DispatchPattern=equals_33.Equality)  # -> ListA, ListB
item_107 = ListItem(List=sort_12.Keys, Index=0, Wrap=True)
python_28 = GhPythonScript(x=dprod_4)  # -> out, output; inputs x: Int32
# ---------- python_28: Python ----------
__author__ = "orcun"
__version__ = "2022.04.08"

import rhinoscriptsyntax as rs
if x == -1 or x==1:
    output = True
else:
    output= False
# ---------- end python_28 ----------
srf_2 = Surface(reparameterize(boundary_15))
item_108 = ListItem(List=data_168, Index=1, Wrap=True)
item_109 = ListItem(List=data_168, Index=0, Wrap=True)

# ----
# check whether
# 
# isotrim division number
# 
# is equal to
# 
# # of units per floor
toggle_35 = BooleanToggle(True)
clean_19 = CleanTree(RemoveNulls=True, RemoveInvalid=True, RemoveEmpty=toggle_35, Tree=python_27.Windowless)
multiplication_7 = Multiplication(A=item_109, B=item_108)
lng_77 = ListLength(List=clean_19)
equals_34 = Equality(FirstNumber=lng_77, SecondNumber=multiplication_7)  # -> simplify(Equality), Inequality

panel_511 = Panel("NoWindowless")
clean_20 = CleanTree(RemoveNulls=True, RemoveInvalid=True, RemoveEmpty=Toggle(True), Tree=python_27.NoWindowless)

panel_512 = Panel("""previous
staircase""")

# ----
# Intersection of curves
panel_513 = Panel("2")

# ----
# 04.GEOMETRYFOR
# BUILDINGENERGYMODELING
dcon_3 = DeleteConsecutive(Set=python_28.output, Wrap=False)  # -> Set, Count

python_29 = PythonScript(s=srf_2, swapUV=dcon_3.Set, reverseU=Toggle(False), reverseV=Toggle(False))  # -> out, anchor, uVec, vVec, revSrf; inputs s: Surface, swapUV: Int32, reverseU: Int32, reverseV: Int32; same code as python_14
divide_4 = DivideDomain²(Domain=python_29.revSrf, UCount=item_109, VCount=item_108)
subsrf_4 = Isotrim(Surface=simplify(python_29.revSrf), Domain=simplify(divide_4))  # -> simplify(Surface)

dispatch_44 = Dispatch(List=subsrf_4, DispatchPattern=equals_34.Equality)  # -> ListA, ListB

# ----
# Windowless
# and
# not equal to
# isotrim division
panel_514 = Panel("""0
1""")
item_110 = ListItem(List=dispatch_44.ListB, Index=1, Wrap=True)
item_111 = ListItem(List=dispatch_44.ListB, Index=0, Wrap=True)
cull_i_32 = CullIndex(List=dispatch_44.ListB, Indices=panel_514, Wrap=True)  # -> simplify(List)
merge_99 = Merge(Data1=item_111, Data2=item_110)
sunion_4 = SolidUnion(Breps=merge_99)
disc_8 = Discontinuity(Curve=sunion_4, Level=1)  # -> Points, Parameters
pline_6 = PolyLine(Vertices=disc_8.Points, Closed=Toggle(True))
merge_100 = Merge(Data1=simplify(cull_i_32), Data2=simplify(pline_6))
clean_21 = CleanTree(RemoveNulls=True, RemoveInvalid=True, RemoveEmpty=Toggle(True), Tree=merge_100)

# ----
# Windowless
# and
# equal to isotrim division
toggle_36 = BooleanToggle(True)
clean_22 = CleanTree(RemoveNulls=True, RemoveInvalid=True, RemoveEmpty=toggle_36, Tree=dispatch_44.ListA)

merge_101 = Merge(Data1=simplify(clean_20), Data2=simplify(clean_22), Data3=simplify(clean_21))
wires_3 = BrepWireframe(Brep=merge_101, Density=-1)
join_31 = JoinCurves(Curves=wires_3, Preserve=False)  # -> simplify(flatten(Curves))
lng_78 = ListLength(List=merge_101)  # -> flatten(Length)
partition_45 = PartitionList(List=join_31, Size=lng_78)  # -> simplify(Chunks)

# ----
# single unit per building
lng_79 = ListLength(List=flatten(partition_45))

branch_22 = TreeBranch(Tree=partition_45, Path=panel_507, MaintainPaths=True)

python_30 = GhPythonScript(x=lng_79)  # -> out, a; same code as python_26
weave_31 = Weave(Pattern=python_30.a, Stream0=lng_79, Stream1=branch_22, NullGaps=False)

weave_32 = Weave(Pattern=python_26.a, Stream0=item_105, Stream1=weave_31, NullGaps=False)

# ----
# single unit in the building
# 
# or
# 
# single unit per floor
lng_80 = ListLength(List=weave_32)
python_31 = GhPythonScript(x=lng_80)  # -> out, a; same code as python_26

tstat_12 = TreeStatistics(Tree=partition_45)  # -> Paths, Length, Count
listdexs_6 = ListIndices(List=tstat_12.Length)
sort_13 = SortList(Keys=tstat_12.Length, ValuesA=listdexs_6)  # -> Keys, ValuesA
item_112 = ListItem(List=sort_13.ValuesA, Index="-1", Wrap=True)
item_113 = ListItem(List=flatten(partition_45), Index=item_112, Wrap=True)
branch_23 = TreeBranch(Tree=partition_45, Path=item_112, MaintainPaths=True)
weave_33 = Weave(Pattern=python_31.a, Stream0=item_113, Stream1=branch_23, NullGaps=False)

# ----
# if there are 2 or 1 unit per floor
lng_81 = ListLength(List=weave_33)
python_32 = GhPythonScript(x=lng_81)  # -> out, a
# ---------- python_32: Python ----------
__author__ = "orcun"
__version__ = "2022.04.08"

import rhinoscriptsyntax as rs
#if x == 1 or x == 2:
if x == 1:
    a = 0
elif x ==2:
    a = 2
else:
    a = 1
# ---------- end python_32 ----------

# ----
# choose the floor with the most units
lng_82 = ListLength(List=partition_45)  # -> flatten(Length)
listdexs_7 = ListIndices(List=lng_82)
sort_14 = SortList(Keys=reverse(lng_82), ValuesA=reverse(listdexs_7))  # -> Keys, ValuesA
item_114 = ListItem(List=sort_14.ValuesA, Index=-1, Wrap=True)
branch_24 = TreeBranch(Tree=partition_45, Path=item_114, MaintainPaths=True)
# staircase, after extension
project_2 = Project(Geometry=branch_24, Plane=PlaneXY(0, 0, 0))  # -> Geometry, Transform

# ----
# # of units per floor
# after extra unit addition
lng_83 = ListLength(List=partition_45)  # -> flatten(Length)

# ----
# if there are more than 4 units per floor
python_33 = GhPythonScript(x=lng_83)  # -> out, a
# ---------- python_33: Python ----------
__author__ = "Siser"
__version__ = "2022.05.06"

import rhinoscriptsyntax as rs
if x > 4:
    a = 1
else:
    a = 0
# ---------- end python_33 ----------

# ----
# select biggest number all the time, if not 0 will come
sort_15 = SortList(Keys=python_33.a)  # -> Keys, ValuesA
item_115 = ListItem(List=sort_15.Keys, Index=-1, Wrap=True)

# ----
# select only residential units
lng_84 = ListLength(List=partition_45)
series_43 = Series(Start=0, Step=1, Count=lng_84)  # -> simplify(Series)

# ----
# if single unit in the building or not,
# 
# single unit:0
# not single unit per building:1
data_176 = Data(python_31.a)

# ----
# select only residential units
lng_85 = ListLength(List=partition_45)
series_44 = Series(Start=0, Step=1, Count=lng_85)  # -> simplify(Series)

# ----
# if single unit in the building or not,
# 
# single unit:0
# not single unit per building:1
data_177 = Data(python_31.a)

# ----
# if there are 1 unit per floor
project_3 = Project(Geometry=weave_33, Plane=PlaneXY(0, 0, 0))  # -> Geometry, Transform
area_40 = Area(Geometry=project_3.Geometry)  # -> Area, Centroid
avr_4 = Average(Input=area_40.Centroid)
disc_9 = Discontinuity(Curve=weave_33, Level=1)  # -> flatten(Points), Parameters
cp_3 = ClosestPoint(Point=avr_4, Cloud=disc_9.Points)  # -> ClosestPoint, CPIndex, Distance
item_116 = ListItem(List=disc_9.Points, Index=cp_3.CPIndex, Wrap=True)

# ----
# if there are 2 unit per floor
disc_10 = Discontinuity(Curve=weave_33, Level=1)  # -> flatten(Points), Parameters
hull_6 = ConvexHull(Points=disc_10.Points, Plane=PlaneXY(0, 0, 0))  # -> Hull, HullZ, Indices
area_41 = Area(Geometry=hull_6.Hull)  # -> Area, Centroid

geo_65 = Geometry(simplify(graft(project_2.Geometry)))

# ----
# dummy geometry to prevent empty list
panel_515 = Panel("0.1")

panel_516 = Panel("""staircase
before extension""")

# ----
# for 2*3& 2*4 division floors, extend the staircase
staircase = Panel("""0: no-extend
1: extend""")

Z_3 = UnitZ(Factor=data_73)

panel_517 = Panel("""SIMULATED 
BUILDING
UNITS""")

python_34 = GhPythonScript(x=replace_9)  # -> out, a
# ---------- python_34: Python ----------
__author__ = "Siser"
__version__ = "2022.03.07"

import rhinoscriptsyntax as rs
if x == 'MidriseApartment::Apartment':
    a = 'res'
else:
    a = 'off'
# ---------- end python_34 ----------

# ----
# Naming for Staircase
Z_4 = UnitZ(Factor=data_75)
Z_5 = UnitZ(Factor=data_76)
data_178 = Data(item_48)
split_11 = TextSplit(Text=data_178, Separators=":")
item_117 = ListItem(List=split_11, Index="-1", Wrap=True)
chars_2 = Characters(Text=item_117)  # -> Result, Unicode
series_45 = Series(Start=0, Step=1, Count="3")
item_118 = ListItem(List=chars_2.Result, Index=series_45, Wrap=True)
data_179 = Data(filename)
dup_52 = DuplicateData(Data=data_179, Number=item_95, Order=True)  # -> flatten(Data)

panel_519 = Panel("unconditoned")

Z_6 = UnitZ(Factor=data_77)

panel_520 = Panel("contioned & unconditioned")

# ----
# intersect mass for all units
# -conditioned zones
# -unconditioned zones
# Error: vertex size mismatch between base surface
toggle_37 = BooleanToggle(True)

# ----
# if there is one building at the floor
lng_86 = ListLength(List=partition_45)  # -> flatten(Length)
equals_35 = Equality(FirstNumber="1", SecondNumber=lng_86)  # -> Equality, Inequality

# ----
# if # of floor is equal to 1
# 	no staircase and a = 0
python_35 = GhPythonScript(y=lng_75)  # -> out, a
# ---------- python_35: Python ----------
__author__ = "orcun"
__version__ = "2022.05.09"

import rhinoscriptsyntax as rs
if y == 1:
    a = 0
else:
    a = 1
# ---------- end python_35 ----------

panel_521 = Panel("conditioned")

panel_522 = Panel("unconditioned")

multiplication_8 = Multiplication(A=data_78, B=item_98)
Z_7 = UnitZ(Factor=multiplication_8)
curvepoint_3 = PointOnCurve(geo_63, parameter=0.5)
extr_2 = Extrude(Base=dispatch_41.ListA, Direction=Z_7)

panel_523 = Panel("include intersected surface's zone")

# ----
# Window Addition
toggle_38 = BooleanToggle(False)

panel_524 = Panel("HBzones")

panel_525 = Panel("residential non-cooling")
equals_36 = Equality(FirstNumber=data_114, SecondNumber="0")  # -> Equality, Inequality

# ----
# Residential
# with cooling
panel_526 = Panel("residential with cooling")  # disabled
panel_527 = Panel("5")  # disabled
equals_37 = Equality(FirstNumber=data_114, SecondNumber=panel_527)  # -> Equality, Inequality; disabled

panel_528 = Panel("residential all")

panel_529 = Panel("office unit(s)")
equals_38 = Equality(FirstNumber=data_114, SecondNumber="1")  # -> Equality, Inequality

panel_530 = Panel("CULL office unit(s)")
data_180 = Data(equals_38.Equality)

dup_53 = DuplicateData(Data=data_149, Number="19", Order=True)  # -> simplify(Data)
sort_16 = SortList(Keys=dup_53)  # -> Keys, ValuesA
partition_46 = PartitionList(List=sort_16.Keys, Size="19")  # -> simplify(Chunks)

panel_532 = Panel("#ofResUnits")

# ----
# AS-IS V1
# HEATING
# SET POINT
panel_534 = Panel("heatSetV1orV3")
annualschedule_26 = Honeybee_AnnualSchedule(
    sun=merge_56,
    mon=merge_56,
    tue=merge_56,
    wed=merge_56,
    thu=merge_56,
    fri=merge_56,
    sat=merge_56,
    scheduleName=simplify(graft(panel_534)),
    schedTypeLimits="Temperature",
    runIt=Toggle(True))  # -> readMe, port, flatten(schedule), port_2, simplify(weekSched), schedIDFText; plug-in component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

# ----
# separation of
# residential & office units
panel_535 = Panel("res")

# ----
# GENERATED
# HEATING
# SET POINT
toggle_39 = BooleanToggle(True)

lng_87 = ListLength(List=panel_253)

item_119 = ListItem(List=panel_251, Index="0", Wrap=True)
item_120 = ListItem(List=join_11, Index="0", Wrap=True)

dup_54 = DuplicateData(Data="18", Number="5", Order=True)
dup_55 = DuplicateData(Data=item_119, Number="19", Order=True)
merge_102 = Merge(Data1=dup_54, Data2=dup_55)

annualschedule_27 = Honeybee_AnnualSchedule(
    sun=merge_102,
    mon=merge_102,
    tue=merge_102,
    wed=merge_102,
    thu=merge_102,
    fri=merge_102,
    sat=merge_102,
    scheduleName=simplify(graft(item_120)),
    schedTypeLimits="Temperature",
    runIt=Toggle(True))  # -> readMe, port, flatten(schedule), port_2, simplify(weekSched), schedIDFText; plug-in component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

item_121 = ListItem(List=panel_251, Index="1", Wrap=True)
item_122 = ListItem(List=join_11, Index="1", Wrap=True)

dup_56 = DuplicateData(Data="18", Number="5", Order=True)
dup_57 = DuplicateData(Data=item_121, Number="19", Order=True)
merge_103 = Merge(Data1=dup_56, Data2=dup_57)

annualschedule_28 = Honeybee_AnnualSchedule(
    sun=merge_103,
    mon=merge_103,
    tue=merge_103,
    wed=merge_103,
    thu=merge_103,
    fri=merge_103,
    sat=merge_103,
    scheduleName=simplify(graft(item_122)),
    schedTypeLimits="Temperature",
    runIt=Toggle(True))  # -> readMe, port, flatten(schedule), port_2, simplify(weekSched), schedIDFText; plug-in component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

item_123 = ListItem(List=panel_251, Index="4", Wrap=True)
item_124 = ListItem(List=join_11, Index="4", Wrap=True)

dup_58 = DuplicateData(Data="18", Number="5", Order=True)
dup_59 = DuplicateData(Data=item_123, Number="19", Order=True)
merge_104 = Merge(Data1=dup_58, Data2=dup_59)

annualschedule_29 = Honeybee_AnnualSchedule(
    sun=merge_104,
    mon=merge_104,
    tue=merge_104,
    wed=merge_104,
    thu=merge_104,
    fri=merge_104,
    sat=merge_104,
    scheduleName=simplify(graft(item_124)),
    schedTypeLimits="Temperature",
    runIt=Toggle(True))  # -> readMe, port, flatten(schedule), port_2, simplify(weekSched), schedIDFText; plug-in component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

item_125 = ListItem(List=panel_251, Index="2", Wrap=True)
item_126 = ListItem(List=join_11, Index="2", Wrap=True)

dup_60 = DuplicateData(Data="18", Number="5", Order=True)
dup_61 = DuplicateData(Data=item_125, Number="19", Order=True)
merge_105 = Merge(Data1=dup_60, Data2=dup_61)

annualschedule_30 = Honeybee_AnnualSchedule(
    sun=merge_105,
    mon=merge_105,
    tue=merge_105,
    wed=merge_105,
    thu=merge_105,
    fri=merge_105,
    sat=merge_105,
    scheduleName=simplify(graft(item_126)),
    schedTypeLimits="Temperature",
    runIt=Toggle(True))  # -> readMe, port, flatten(schedule), port_2, simplify(weekSched), schedIDFText; plug-in component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

item_127 = ListItem(List=panel_251, Index="5", Wrap=True)
item_128 = ListItem(List=join_11, Index="5", Wrap=True)

dup_62 = DuplicateData(Data="18", Number="5", Order=True)
dup_63 = DuplicateData(Data=item_127, Number="19", Order=True)
merge_106 = Merge(Data1=dup_62, Data2=dup_63)

annualschedule_31 = Honeybee_AnnualSchedule(
    sun=merge_106,
    mon=merge_106,
    tue=merge_106,
    wed=merge_106,
    thu=merge_106,
    fri=merge_106,
    sat=merge_106,
    scheduleName=simplify(graft(item_128)),
    schedTypeLimits="Temperature",
    runIt=Toggle(True))  # -> readMe, port, flatten(schedule), port_2, simplify(weekSched), schedIDFText; plug-in component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

item_129 = ListItem(List=panel_251, Index="3", Wrap=True)
item_130 = ListItem(List=join_11, Index="3", Wrap=True)

dup_64 = DuplicateData(Data="18", Number="5", Order=True)
dup_65 = DuplicateData(Data=item_129, Number="19", Order=True)
merge_107 = Merge(Data1=dup_64, Data2=dup_65)

annualschedule_32 = Honeybee_AnnualSchedule(
    sun=merge_107,
    mon=merge_107,
    tue=merge_107,
    wed=merge_107,
    thu=merge_107,
    fri=merge_107,
    sat=merge_107,
    scheduleName=simplify(graft(item_130)),
    schedTypeLimits="Temperature",
    runIt=Toggle(True))  # -> readMe, port, flatten(schedule), port_2, simplify(weekSched), schedIDFText; plug-in component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

item_131 = ListItem(List=panel_251, Index="6", Wrap=True)
item_132 = ListItem(List=join_11, Index="6", Wrap=True)

dup_66 = DuplicateData(Data="18", Number="5", Order=True)
dup_67 = DuplicateData(Data=item_131, Number="19", Order=True)
merge_108 = Merge(Data1=dup_66, Data2=dup_67)

annualschedule_33 = Honeybee_AnnualSchedule(
    sun=merge_108,
    mon=merge_108,
    tue=merge_108,
    wed=merge_108,
    thu=merge_108,
    fri=merge_108,
    sat=merge_108,
    scheduleName=simplify(graft(item_132)),
    schedTypeLimits="Temperature",
    runIt=Toggle(True))  # -> readMe, port, flatten(schedule), port_2, simplify(weekSched), schedIDFText; plug-in component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

item_133 = ListItem(List=panel_251, Index="7", Wrap=True)
item_134 = ListItem(List=join_11, Index="7", Wrap=True)

dup_68 = DuplicateData(Data="18", Number="5", Order=True)
dup_69 = DuplicateData(Data=item_133, Number="19", Order=True)
merge_109 = Merge(Data1=dup_68, Data2=dup_69)

annualschedule_34 = Honeybee_AnnualSchedule(
    sun=merge_109,
    mon=merge_109,
    tue=merge_109,
    wed=merge_109,
    thu=merge_109,
    fri=merge_109,
    sat=merge_109,
    scheduleName=simplify(graft(item_134)),
    schedTypeLimits="Temperature",
    runIt=Toggle(True))  # -> readMe, port, flatten(schedule), port_2, simplify(weekSched), schedIDFText; plug-in component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

item_135 = ListItem(List=panel_251, Index="8", Wrap=True)
item_136 = ListItem(List=join_11, Index="8", Wrap=True)

dup_70 = DuplicateData(Data="18", Number="5", Order=True)
dup_71 = DuplicateData(Data=item_135, Number="19", Order=True)
merge_110 = Merge(Data1=dup_70, Data2=dup_71)

annualschedule_35 = Honeybee_AnnualSchedule(
    sun=merge_110,
    mon=merge_110,
    tue=merge_110,
    wed=merge_110,
    thu=merge_110,
    fri=merge_110,
    sat=merge_110,
    scheduleName=simplify(graft(item_136)),
    schedTypeLimits="Temperature",
    runIt=Toggle(True))  # -> readMe, port, flatten(schedule), port_2, simplify(weekSched), schedIDFText; plug-in component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

item_137 = ListItem(List=panel_251, Index="9", Wrap=True)
item_138 = ListItem(List=join_11, Index="9", Wrap=True)

dup_72 = DuplicateData(Data="18", Number="5", Order=True)
dup_73 = DuplicateData(Data=item_137, Number="19", Order=True)
merge_111 = Merge(Data1=dup_72, Data2=dup_73)

annualschedule_36 = Honeybee_AnnualSchedule(
    sun=merge_111,
    mon=merge_111,
    tue=merge_111,
    wed=merge_111,
    thu=merge_111,
    fri=merge_111,
    sat=merge_111,
    scheduleName=simplify(graft(item_138)),
    schedTypeLimits="Temperature",
    runIt=Toggle(True))  # -> readMe, port, flatten(schedule), port_2, simplify(weekSched), schedIDFText; plug-in component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

panel_537 = Panel("HeatingSetSchedule")

panel_538 = Panel("""HeatingSet
csv recordings""")

# ----
# V1/V2........
# COOLING-ON
# RESIDENTIAL
panel_539 = Panel("residential units")  # disabled
lb_schedule_4 = GenePool(
    Decimals=0,
    Maximum=100,
    Minimum=25,
    Value=[25, 25, 25, 25, 25, 25, 25, 25, 25, 25, 25, 25, 25, 25, 25, 25, 25, 25, 25, 25, 25, 25, 25, 25])  # disabled
panel_540 = Panel("RESIDENTIAL-COOLING-ON-SCHEDULE")  # disabled
toggle_40 = BooleanToggle(True)  # disabled
panel_541 = Panel("RESIDENTIAL-COOLING-OFF-SCHEDULE")  # disabled
panel_542 = Panel("Temperature")  # disabled
lb_schedule_5 = GenePool(
    Decimals=0,
    Maximum=100.001,
    Minimum=100,
    Value=[100, 100, 100, 100, 100, 100, 100, 100.001, 100.001, 100.001, 100.001, 100.001, 100.001, 100.001, 100.001, 100.001, 100.001, 100.001, 100.001, 100, 100, 100, 100, 100])  # disabled
panel_543 = Panel("15")  # disabled
panel_544 = Panel("10")  # disabled
panel_545 = Panel("4")  # disabled
panel_546 = Panel("RESIDENTIAL_COOLING_SCHEDULE-ANNUAL")  # disabled
annualschedule_37 = Honeybee_AnnualSchedule(
    sun=lb_schedule_5,
    mon=lb_schedule_5,
    tue=lb_schedule_5,
    wed=lb_schedule_5,
    thu=lb_schedule_5,
    fri=lb_schedule_5,
    sat=lb_schedule_5,
    scheduleName=panel_540,
    schedTypeLimits=panel_542,
    runIt=toggle_40)  # -> readMe, port, schedule, port_2, weekSched, schedIDFText; disabled; plug-in component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
analysisperiod_6 = Ladybug_AnalysisPeriod(fromMonth=panel_545, fromDay=panel_543, toMonth=panel_544, toDay=panel_543)  # -> readMe, analysisPeriod; disabled; plug-in component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

item_139 = ListItem(List=panel_251, Index="10", Wrap=True)
item_140 = ListItem(List=join_11, Index="10", Wrap=True)

dup_74 = DuplicateData(Data="18", Number="5", Order=True)
dup_75 = DuplicateData(Data=item_139, Number="19", Order=True)
merge_112 = Merge(Data1=dup_74, Data2=dup_75)

annualschedule_38 = Honeybee_AnnualSchedule(
    sun=merge_112,
    mon=merge_112,
    tue=merge_112,
    wed=merge_112,
    thu=merge_112,
    fri=merge_112,
    sat=merge_112,
    scheduleName=simplify(graft(item_140)),
    schedTypeLimits="Temperature",
    runIt=Toggle(True))  # -> readMe, port, flatten(schedule), port_2, simplify(weekSched), schedIDFText; plug-in component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

item_141 = ListItem(List=panel_251, Index="11", Wrap=True)
item_142 = ListItem(List=join_11, Index="11", Wrap=True)

dup_76 = DuplicateData(Data="18", Number="5", Order=True)
dup_77 = DuplicateData(Data=item_141, Number="19", Order=True)
merge_113 = Merge(Data1=dup_76, Data2=dup_77)

annualschedule_39 = Honeybee_AnnualSchedule(
    sun=merge_113,
    mon=merge_113,
    tue=merge_113,
    wed=merge_113,
    thu=merge_113,
    fri=merge_113,
    sat=merge_113,
    scheduleName=simplify(graft(item_142)),
    schedTypeLimits="Temperature",
    runIt=Toggle(True))  # -> readMe, port, flatten(schedule), port_2, simplify(weekSched), schedIDFText; plug-in component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

item_143 = ListItem(List=panel_251, Index="14", Wrap=True)
item_144 = ListItem(List=join_11, Index="14", Wrap=True)

dup_78 = DuplicateData(Data="18", Number="5", Order=True)
dup_79 = DuplicateData(Data=item_143, Number="19", Order=True)
merge_114 = Merge(Data1=dup_78, Data2=dup_79)

annualschedule_40 = Honeybee_AnnualSchedule(
    sun=merge_114,
    mon=merge_114,
    tue=merge_114,
    wed=merge_114,
    thu=merge_114,
    fri=merge_114,
    sat=merge_114,
    scheduleName=simplify(graft(item_144)),
    schedTypeLimits="Temperature",
    runIt=Toggle(True))  # -> readMe, port, flatten(schedule), port_2, simplify(weekSched), schedIDFText; plug-in component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

item_145 = ListItem(List=panel_251, Index="12", Wrap=True)
item_146 = ListItem(List=join_11, Index="12", Wrap=True)

dup_80 = DuplicateData(Data="18", Number="5", Order=True)
dup_81 = DuplicateData(Data=item_145, Number="19", Order=True)
merge_115 = Merge(Data1=dup_80, Data2=dup_81)

annualschedule_41 = Honeybee_AnnualSchedule(
    sun=merge_115,
    mon=merge_115,
    tue=merge_115,
    wed=merge_115,
    thu=merge_115,
    fri=merge_115,
    sat=merge_115,
    scheduleName=simplify(graft(item_146)),
    schedTypeLimits="Temperature",
    runIt=Toggle(True))  # -> readMe, port, flatten(schedule), port_2, simplify(weekSched), schedIDFText; plug-in component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

item_147 = ListItem(List=panel_251, Index="15", Wrap=True)
item_148 = ListItem(List=join_11, Index="15", Wrap=True)

dup_82 = DuplicateData(Data="18", Number="5", Order=True)
dup_83 = DuplicateData(Data=item_147, Number="19", Order=True)
merge_116 = Merge(Data1=dup_82, Data2=dup_83)

annualschedule_42 = Honeybee_AnnualSchedule(
    sun=merge_116,
    mon=merge_116,
    tue=merge_116,
    wed=merge_116,
    thu=merge_116,
    fri=merge_116,
    sat=merge_116,
    scheduleName=simplify(graft(item_148)),
    schedTypeLimits="Temperature",
    runIt=Toggle(True))  # -> readMe, port, flatten(schedule), port_2, simplify(weekSched), schedIDFText; plug-in component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
# ----
# Occ Schedule Versions
getepschedules_4 = Honeybee_GetEnergyPlusSchedules(zoneProgram=item_47)  # -> occupancySchedule, occupancyActivitySch, heatingSetPtSchedule, coolingSetPtSchedule, lightingSchedule, equipmentSchedule, infiltrationSchedule; plug-in component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
panel_547 = Panel("OccSchedule")

item_149 = ListItem(List=panel_251, Index="13", Wrap=True)
item_150 = ListItem(List=join_11, Index="13", Wrap=True)

dup_84 = DuplicateData(Data="18", Number="5", Order=True)
dup_85 = DuplicateData(Data=item_149, Number="19", Order=True)
merge_117 = Merge(Data1=dup_84, Data2=dup_85)

annualschedule_43 = Honeybee_AnnualSchedule(
    sun=merge_117,
    mon=merge_117,
    tue=merge_117,
    wed=merge_117,
    thu=merge_117,
    fri=merge_117,
    sat=merge_117,
    scheduleName=simplify(graft(item_150)),
    schedTypeLimits="Temperature",
    runIt=Toggle(True))  # -> readMe, port, flatten(schedule), port_2, simplify(weekSched), schedIDFText; plug-in component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

item_151 = ListItem(List=panel_251, Index="16", Wrap=True)
item_152 = ListItem(List=join_11, Index="16", Wrap=True)

dup_86 = DuplicateData(Data="18", Number="5", Order=True)
dup_87 = DuplicateData(Data=item_151, Number="19", Order=True)
merge_118 = Merge(Data1=dup_86, Data2=dup_87)

annualschedule_44 = Honeybee_AnnualSchedule(
    sun=merge_118,
    mon=merge_118,
    tue=merge_118,
    wed=merge_118,
    thu=merge_118,
    fri=merge_118,
    sat=merge_118,
    scheduleName=simplify(graft(item_152)),
    schedTypeLimits="Temperature",
    runIt=Toggle(True))  # -> readMe, port, flatten(schedule), port_2, simplify(weekSched), schedIDFText; plug-in component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

item_153 = ListItem(List=panel_251, Index="17", Wrap=True)
item_154 = ListItem(List=join_11, Index="17", Wrap=True)

dup_88 = DuplicateData(Data="18", Number="5", Order=True)
dup_89 = DuplicateData(Data=item_153, Number="19", Order=True)
merge_119 = Merge(Data1=dup_88, Data2=dup_89)

annualschedule_45 = Honeybee_AnnualSchedule(
    sun=merge_119,
    mon=merge_119,
    tue=merge_119,
    wed=merge_119,
    thu=merge_119,
    fri=merge_119,
    sat=merge_119,
    scheduleName=simplify(graft(item_154)),
    schedTypeLimits="Temperature",
    runIt=Toggle(True))  # -> readMe, port, flatten(schedule), port_2, simplify(weekSched), schedIDFText; plug-in component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

item_155 = ListItem(List=panel_251, Index="18", Wrap=True)
item_156 = ListItem(List=join_11, Index="18", Wrap=True)

dup_90 = DuplicateData(Data="18", Number="5", Order=True)
dup_91 = DuplicateData(Data=item_155, Number="19", Order=True)
merge_120 = Merge(Data1=dup_90, Data2=dup_91)

annualschedule_46 = Honeybee_AnnualSchedule(
    sun=merge_120,
    mon=merge_120,
    tue=merge_120,
    wed=merge_120,
    thu=merge_120,
    fri=merge_120,
    sat=merge_120,
    scheduleName=simplify(graft(item_156)),
    schedTypeLimits="Temperature",
    runIt=Toggle(True))  # -> readMe, port, flatten(schedule), port_2, simplify(weekSched), schedIDFText; plug-in component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

item_157 = ListItem(List=panel_251, Index="19", Wrap=True)
item_158 = ListItem(List=join_11, Index="19", Wrap=True)

dup_92 = DuplicateData(Data="18", Number="5", Order=True)
dup_93 = DuplicateData(Data=item_157, Number="19", Order=True)
merge_121 = Merge(Data1=dup_92, Data2=dup_93)

annualschedule_47 = Honeybee_AnnualSchedule(
    sun=merge_121,
    mon=merge_121,
    tue=merge_121,
    wed=merge_121,
    thu=merge_121,
    fri=merge_121,
    sat=merge_121,
    scheduleName=simplify(graft(item_158)),
    schedTypeLimits="Temperature",
    runIt=Toggle(True))  # -> readMe, port, flatten(schedule), port_2, simplify(weekSched), schedIDFText; plug-in component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

item_159 = ListItem(List=panel_251, Index="20", Wrap=True)
item_160 = ListItem(List=join_11, Index="20", Wrap=True)

dup_94 = DuplicateData(Data="18", Number="5", Order=True)
dup_95 = DuplicateData(Data=item_159, Number="19", Order=True)
merge_122 = Merge(Data1=dup_94, Data2=dup_95)

annualschedule_48 = Honeybee_AnnualSchedule(
    sun=merge_122,
    mon=merge_122,
    tue=merge_122,
    wed=merge_122,
    thu=merge_122,
    fri=merge_122,
    sat=merge_122,
    scheduleName=simplify(graft(item_160)),
    schedTypeLimits="Temperature",
    runIt=Toggle(True))  # -> readMe, port, flatten(schedule), port_2, simplify(weekSched), schedIDFText; plug-in component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

item_161 = ListItem(List=panel_251, Index="21", Wrap=True)
item_162 = ListItem(List=join_11, Index="21", Wrap=True)

dup_96 = DuplicateData(Data="18", Number="5", Order=True)
dup_97 = DuplicateData(Data=item_161, Number="19", Order=True)
merge_123 = Merge(Data1=dup_96, Data2=dup_97)

annualschedule_49 = Honeybee_AnnualSchedule(
    sun=merge_123,
    mon=merge_123,
    tue=merge_123,
    wed=merge_123,
    thu=merge_123,
    fri=merge_123,
    sat=merge_123,
    scheduleName=simplify(graft(item_162)),
    schedTypeLimits="Temperature",
    runIt=Toggle(True))  # -> readMe, port, flatten(schedule), port_2, simplify(weekSched), schedIDFText; plug-in component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

item_163 = ListItem(List=panel_251, Index="24", Wrap=True)
item_164 = ListItem(List=join_11, Index="24", Wrap=True)

dup_98 = DuplicateData(Data="18", Number="5", Order=True)
dup_99 = DuplicateData(Data=item_163, Number="19", Order=True)
merge_124 = Merge(Data1=dup_98, Data2=dup_99)

annualschedule_50 = Honeybee_AnnualSchedule(
    sun=merge_124,
    mon=merge_124,
    tue=merge_124,
    wed=merge_124,
    thu=merge_124,
    fri=merge_124,
    sat=merge_124,
    scheduleName=simplify(graft(item_164)),
    schedTypeLimits="Temperature",
    runIt=Toggle(True))  # -> readMe, port, flatten(schedule), port_2, simplify(weekSched), schedIDFText; plug-in component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

item_165 = ListItem(List=panel_251, Index="22", Wrap=True)
item_166 = ListItem(List=join_11, Index="22", Wrap=True)

dup_100 = DuplicateData(Data="18", Number="5", Order=True)
dup_101 = DuplicateData(Data=item_165, Number="19", Order=True)
merge_125 = Merge(Data1=dup_100, Data2=dup_101)

annualschedule_51 = Honeybee_AnnualSchedule(
    sun=merge_125,
    mon=merge_125,
    tue=merge_125,
    wed=merge_125,
    thu=merge_125,
    fri=merge_125,
    sat=merge_125,
    scheduleName=simplify(graft(item_166)),
    schedTypeLimits="Temperature",
    runIt=Toggle(True))  # -> readMe, port, flatten(schedule), port_2, simplify(weekSched), schedIDFText; plug-in component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

item_167 = ListItem(List=panel_251, Index="25", Wrap=True)
item_168 = ListItem(List=join_11, Index="25", Wrap=True)

dup_102 = DuplicateData(Data="18", Number="5", Order=True)
dup_103 = DuplicateData(Data=item_167, Number="19", Order=True)
merge_126 = Merge(Data1=dup_102, Data2=dup_103)

annualschedule_52 = Honeybee_AnnualSchedule(
    sun=merge_126,
    mon=merge_126,
    tue=merge_126,
    wed=merge_126,
    thu=merge_126,
    fri=merge_126,
    sat=merge_126,
    scheduleName=simplify(graft(item_168)),
    schedTypeLimits="Temperature",
    runIt=Toggle(True))  # -> readMe, port, flatten(schedule), port_2, simplify(weekSched), schedIDFText; plug-in component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

item_169 = ListItem(List=panel_251, Index="23", Wrap=True)
item_170 = ListItem(List=join_11, Index="23", Wrap=True)

dup_104 = DuplicateData(Data="18", Number="5", Order=True)
dup_105 = DuplicateData(Data=item_169, Number="19", Order=True)
merge_127 = Merge(Data1=dup_104, Data2=dup_105)

annualschedule_53 = Honeybee_AnnualSchedule(
    sun=merge_127,
    mon=merge_127,
    tue=merge_127,
    wed=merge_127,
    thu=merge_127,
    fri=merge_127,
    sat=merge_127,
    scheduleName=simplify(graft(item_170)),
    schedTypeLimits="Temperature",
    runIt=Toggle(True))  # -> readMe, port, flatten(schedule), port_2, simplify(weekSched), schedIDFText; plug-in component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

item_171 = ListItem(List=panel_251, Index="26", Wrap=True)
item_172 = ListItem(List=join_11, Index="26", Wrap=True)

dup_106 = DuplicateData(Data="18", Number="5", Order=True)
dup_107 = DuplicateData(Data=item_171, Number="19", Order=True)
merge_128 = Merge(Data1=dup_106, Data2=dup_107)

annualschedule_54 = Honeybee_AnnualSchedule(
    sun=merge_128,
    mon=merge_128,
    tue=merge_128,
    wed=merge_128,
    thu=merge_128,
    fri=merge_128,
    sat=merge_128,
    scheduleName=simplify(graft(item_172)),
    schedTypeLimits="Temperature",
    runIt=Toggle(True))  # -> readMe, port, flatten(schedule), port_2, simplify(weekSched), schedIDFText; plug-in component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

item_173 = ListItem(List=panel_251, Index="27", Wrap=True)
item_174 = ListItem(List=join_11, Index="27", Wrap=True)

dup_108 = DuplicateData(Data="18", Number="5", Order=True)
dup_109 = DuplicateData(Data=item_173, Number="19", Order=True)
merge_129 = Merge(Data1=dup_108, Data2=dup_109)

annualschedule_55 = Honeybee_AnnualSchedule(
    sun=merge_129,
    mon=merge_129,
    tue=merge_129,
    wed=merge_129,
    thu=merge_129,
    fri=merge_129,
    sat=merge_129,
    scheduleName=simplify(graft(item_174)),
    schedTypeLimits="Temperature",
    runIt=Toggle(True))  # -> readMe, port, flatten(schedule), port_2, simplify(weekSched), schedIDFText; plug-in component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

item_175 = ListItem(List=panel_251, Index="28", Wrap=True)
item_176 = ListItem(List=join_11, Index="28", Wrap=True)

dup_110 = DuplicateData(Data="18", Number="5", Order=True)
dup_111 = DuplicateData(Data=item_175, Number="19", Order=True)
merge_130 = Merge(Data1=dup_110, Data2=dup_111)

annualschedule_56 = Honeybee_AnnualSchedule(
    sun=merge_130,
    mon=merge_130,
    tue=merge_130,
    wed=merge_130,
    thu=merge_130,
    fri=merge_130,
    sat=merge_130,
    scheduleName=simplify(graft(item_176)),
    schedTypeLimits="Temperature",
    runIt=Toggle(True))  # -> readMe, port, flatten(schedule), port_2, simplify(weekSched), schedIDFText; plug-in component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

item_177 = ListItem(List=panel_251, Index="29", Wrap=True)
item_178 = ListItem(List=join_11, Index="29", Wrap=True)

dup_112 = DuplicateData(Data="18", Number="5", Order=True)
dup_113 = DuplicateData(Data=item_177, Number="19", Order=True)
merge_131 = Merge(Data1=dup_112, Data2=dup_113)

annualschedule_57 = Honeybee_AnnualSchedule(
    sun=merge_131,
    mon=merge_131,
    tue=merge_131,
    wed=merge_131,
    thu=merge_131,
    fri=merge_131,
    sat=merge_131,
    scheduleName=simplify(graft(item_178)),
    schedTypeLimits="Temperature",
    runIt=Toggle(True))  # -> readMe, port, flatten(schedule), port_2, simplify(weekSched), schedIDFText; plug-in component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

# ----
# RESIDENTIAL COOLING UNITS
panel_548 = Panel("residential all")

# ----
# OFFICE UNITS
toggle_41 = BooleanToggle(False)

toggle_42 = BooleanToggle(False)  # disabled

panel_549 = Panel("occupancy Schedules")

# ----
# Heating set point
panel_550 = Panel("1")

item_179 = ListItem(List=panel_251, Index="30", Wrap=True)
item_180 = ListItem(List=join_11, Index="30", Wrap=True)

dup_114 = DuplicateData(Data="18", Number="5", Order=True)
dup_115 = DuplicateData(Data=item_179, Number="19", Order=True)
merge_132 = Merge(Data1=dup_114, Data2=dup_115)

annualschedule_58 = Honeybee_AnnualSchedule(
    sun=merge_132,
    mon=merge_132,
    tue=merge_132,
    wed=merge_132,
    thu=merge_132,
    fri=merge_132,
    sat=merge_132,
    scheduleName=simplify(graft(item_180)),
    schedTypeLimits="Temperature",
    runIt=Toggle(True))  # -> readMe, port, flatten(schedule), port_2, simplify(weekSched), schedIDFText; plug-in component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

item_181 = ListItem(List=panel_251, Index="31", Wrap=True)
item_182 = ListItem(List=join_11, Index="31", Wrap=True)

dup_116 = DuplicateData(Data="18", Number="5", Order=True)
dup_117 = DuplicateData(Data=item_181, Number="19", Order=True)
merge_133 = Merge(Data1=dup_116, Data2=dup_117)

annualschedule_59 = Honeybee_AnnualSchedule(
    sun=merge_133,
    mon=merge_133,
    tue=merge_133,
    wed=merge_133,
    thu=merge_133,
    fri=merge_133,
    sat=merge_133,
    scheduleName=simplify(graft(item_182)),
    schedTypeLimits="Temperature",
    runIt=Toggle(True))  # -> readMe, port, flatten(schedule), port_2, simplify(weekSched), schedIDFText; plug-in component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

item_183 = ListItem(List=panel_251, Index="34", Wrap=True)
item_184 = ListItem(List=join_11, Index="34", Wrap=True)

dup_118 = DuplicateData(Data="18", Number="5", Order=True)
dup_119 = DuplicateData(Data=item_183, Number="19", Order=True)
merge_134 = Merge(Data1=dup_118, Data2=dup_119)

annualschedule_60 = Honeybee_AnnualSchedule(
    sun=merge_134,
    mon=merge_134,
    tue=merge_134,
    wed=merge_134,
    thu=merge_134,
    fri=merge_134,
    sat=merge_134,
    scheduleName=simplify(graft(item_184)),
    schedTypeLimits="Temperature",
    runIt=Toggle(True))  # -> readMe, port, flatten(schedule), port_2, simplify(weekSched), schedIDFText; plug-in component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

item_185 = ListItem(List=panel_251, Index="32", Wrap=True)
item_186 = ListItem(List=join_11, Index="32", Wrap=True)

dup_120 = DuplicateData(Data="18", Number="5", Order=True)
dup_121 = DuplicateData(Data=item_185, Number="19", Order=True)
merge_135 = Merge(Data1=dup_120, Data2=dup_121)

annualschedule_61 = Honeybee_AnnualSchedule(
    sun=merge_135,
    mon=merge_135,
    tue=merge_135,
    wed=merge_135,
    thu=merge_135,
    fri=merge_135,
    sat=merge_135,
    scheduleName=simplify(graft(item_186)),
    schedTypeLimits="Temperature",
    runIt=Toggle(True))  # -> readMe, port, flatten(schedule), port_2, simplify(weekSched), schedIDFText; plug-in component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

item_187 = ListItem(List=panel_251, Index="35", Wrap=True)
item_188 = ListItem(List=join_11, Index="35", Wrap=True)

dup_122 = DuplicateData(Data="18", Number="5", Order=True)
dup_123 = DuplicateData(Data=item_187, Number="19", Order=True)
merge_136 = Merge(Data1=dup_122, Data2=dup_123)

annualschedule_62 = Honeybee_AnnualSchedule(
    sun=merge_136,
    mon=merge_136,
    tue=merge_136,
    wed=merge_136,
    thu=merge_136,
    fri=merge_136,
    sat=merge_136,
    scheduleName=simplify(graft(item_188)),
    schedTypeLimits="Temperature",
    runIt=Toggle(True))  # -> readMe, port, flatten(schedule), port_2, simplify(weekSched), schedIDFText; plug-in component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

item_189 = ListItem(List=panel_251, Index="33", Wrap=True)
item_190 = ListItem(List=join_11, Index="33", Wrap=True)

dup_124 = DuplicateData(Data="18", Number="5", Order=True)
dup_125 = DuplicateData(Data=item_189, Number="19", Order=True)
merge_137 = Merge(Data1=dup_124, Data2=dup_125)

annualschedule_63 = Honeybee_AnnualSchedule(
    sun=merge_137,
    mon=merge_137,
    tue=merge_137,
    wed=merge_137,
    thu=merge_137,
    fri=merge_137,
    sat=merge_137,
    scheduleName=simplify(graft(item_190)),
    schedTypeLimits="Temperature",
    runIt=Toggle(True))  # -> readMe, port, flatten(schedule), port_2, simplify(weekSched), schedIDFText; plug-in component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

item_191 = ListItem(List=panel_251, Index="36", Wrap=True)
item_192 = ListItem(List=join_11, Index="36", Wrap=True)

dup_126 = DuplicateData(Data="18", Number="5", Order=True)
dup_127 = DuplicateData(Data=item_191, Number="19", Order=True)
merge_138 = Merge(Data1=dup_126, Data2=dup_127)

annualschedule_64 = Honeybee_AnnualSchedule(
    sun=merge_138,
    mon=merge_138,
    tue=merge_138,
    wed=merge_138,
    thu=merge_138,
    fri=merge_138,
    sat=merge_138,
    scheduleName=simplify(graft(item_192)),
    schedTypeLimits="Temperature",
    runIt=Toggle(True))  # -> readMe, port, flatten(schedule), port_2, simplify(weekSched), schedIDFText; plug-in component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

item_193 = ListItem(List=panel_251, Index="37", Wrap=True)
item_194 = ListItem(List=join_11, Index="37", Wrap=True)

dup_128 = DuplicateData(Data="18", Number="5", Order=True)
dup_129 = DuplicateData(Data=item_193, Number="19", Order=True)
merge_139 = Merge(Data1=dup_128, Data2=dup_129)

annualschedule_65 = Honeybee_AnnualSchedule(
    sun=merge_139,
    mon=merge_139,
    tue=merge_139,
    wed=merge_139,
    thu=merge_139,
    fri=merge_139,
    sat=merge_139,
    scheduleName=simplify(graft(item_194)),
    schedTypeLimits="Temperature",
    runIt=Toggle(True))  # -> readMe, port, flatten(schedule), port_2, simplify(weekSched), schedIDFText; plug-in component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

item_195 = ListItem(List=panel_251, Index="38", Wrap=True)
item_196 = ListItem(List=join_11, Index="38", Wrap=True)

dup_130 = DuplicateData(Data="18", Number="5", Order=True)
dup_131 = DuplicateData(Data=item_195, Number="19", Order=True)
merge_140 = Merge(Data1=dup_130, Data2=dup_131)

annualschedule_66 = Honeybee_AnnualSchedule(
    sun=merge_140,
    mon=merge_140,
    tue=merge_140,
    wed=merge_140,
    thu=merge_140,
    fri=merge_140,
    sat=merge_140,
    scheduleName=simplify(graft(item_196)),
    schedTypeLimits="Temperature",
    runIt=Toggle(True))  # -> readMe, port, flatten(schedule), port_2, simplify(weekSched), schedIDFText; plug-in component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

item_197 = ListItem(List=panel_251, Index="39", Wrap=True)
item_198 = ListItem(List=join_11, Index="39", Wrap=True)

dup_132 = DuplicateData(Data="18", Number="5", Order=True)
dup_133 = DuplicateData(Data=item_197, Number="19", Order=True)
merge_141 = Merge(Data1=dup_132, Data2=dup_133)

annualschedule_67 = Honeybee_AnnualSchedule(
    sun=merge_141,
    mon=merge_141,
    tue=merge_141,
    wed=merge_141,
    thu=merge_141,
    fri=merge_141,
    sat=merge_141,
    scheduleName=simplify(graft(item_198)),
    schedTypeLimits="Temperature",
    runIt=Toggle(True))  # -> readMe, port, flatten(schedule), port_2, simplify(weekSched), schedIDFText; plug-in component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

# ----
# Cooling Set Point Schedules
toggle_43 = BooleanToggle(True)
dup_134 = DuplicateData(Data="100", Number="24", Order=True)
annualschedule_68 = Honeybee_AnnualSchedule(
    sun=dup_134,
    mon=dup_134,
    tue=dup_134,
    wed=dup_134,
    thu=dup_134,
    fri=dup_134,
    sat=dup_134,
    scheduleName="COOL-OFF-SCHEDULE",
    schedTypeLimits="Temperature",
    runIt=toggle_43)  # -> readMe, port, schedule, port_2, weekSched, schedIDFText; plug-in component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
analysisperiod_7 = Ladybug_AnalysisPeriod(fromMonth=data_80, fromDay=data_81, toMonth=data_82, toDay=data_81)  # -> readMe, analysisPeriod; plug-in component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
panel_551 = Panel("Classroom_Cooling_25")

# ----
# Heating Set Point Schedules
panel_552 = Panel("Temperature")

item_199 = ListItem(List=panel_251, Index="40", Wrap=True)
item_200 = ListItem(List=join_11, Index="40", Wrap=True)

dup_135 = DuplicateData(Data="18", Number="5", Order=True)
dup_136 = DuplicateData(Data=item_199, Number="19", Order=True)
merge_142 = Merge(Data1=dup_135, Data2=dup_136)

annualschedule_69 = Honeybee_AnnualSchedule(
    sun=merge_142,
    mon=merge_142,
    tue=merge_142,
    wed=merge_142,
    thu=merge_142,
    fri=merge_142,
    sat=merge_142,
    scheduleName=simplify(graft(item_200)),
    schedTypeLimits="Temperature",
    runIt=Toggle(True))  # -> readMe, port, flatten(schedule), port_2, simplify(weekSched), schedIDFText; plug-in component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

merge_143 = Merge(
    Data1=annualschedule_27.schedule,
    Data2=annualschedule_28.schedule,
    Data3=annualschedule_30.schedule,
    Data4=annualschedule_32.schedule,
    Data5=annualschedule_29.schedule,
    Data6=annualschedule_31.schedule,
    Data7=annualschedule_33.schedule,
    Data8=annualschedule_34.schedule,
    Data9=annualschedule_35.schedule,
    Data10=annualschedule_36.schedule,
    Data11=annualschedule_38.schedule,
    Data12=annualschedule_39.schedule,
    Data13=annualschedule_41.schedule,
    Data14=annualschedule_43.schedule,
    Data15=annualschedule_40.schedule,
    Data16=annualschedule_42.schedule,
    Data17=annualschedule_44.schedule,
    Data18=annualschedule_45.schedule,
    Data19=annualschedule_46.schedule,
    Data20=annualschedule_47.schedule,
    Data21=annualschedule_48.schedule,
    Data22=annualschedule_49.schedule,
    Data23=annualschedule_51.schedule,
    Data24=annualschedule_53.schedule,
    Data25=annualschedule_50.schedule,
    Data26=annualschedule_52.schedule,
    Data27=annualschedule_54.schedule,
    Data28=annualschedule_55.schedule,
    Data29=annualschedule_56.schedule,
    Data30=annualschedule_57.schedule,
    Data31=annualschedule_58.schedule,
    Data32=annualschedule_59.schedule,
    Data33=annualschedule_61.schedule,
    Data34=annualschedule_63.schedule,
    Data35=annualschedule_60.schedule,
    Data36=annualschedule_62.schedule,
    Data37=annualschedule_64.schedule,
    Data38=annualschedule_65.schedule,
    Data39=annualschedule_66.schedule,
    Data40=annualschedule_67.schedule,
    Data41=annualschedule_69.schedule)

data_181 = Data(merge_143)
roundd_12 = RoundToDecimalPlace(NumberX=data_149, DecimalPlace="1", RoundType=0)  # -> Rounded, Difference
data_182 = Data(panel_251)
fsim_2 = FindSimilarMember(Data=roundd_12.Rounded, Set=data_182)  # -> Hit, Index
item_201 = ListItem(List=data_181, Index=fsim_2.Index, Wrap=True)

weave_34 = Weave(Pattern=list, Stream0=python_19.a, Stream1=python_19.a, Stream2=item_63, Stream3=item_63, NullGaps=False)

panel_553 = Panel("cooling schedules")

panel_554 = Panel("Unit Matching Data")  # disabled

# ----
# OFFICE UNITS
# AS-IS
# All office INTERNAL LOAD parameters are based on DEFAULT midriseapartment:office schedule
panel_555 = Panel("0")

panel_557 = Panel("Unconditioned Adjacent Zone")

data_183 = Data(branch_12)

# ----
# .csv recordings
# AS-IS V1
# LIGHTING DENSITY
data_184 = Data(geteploads_2.lightingDensityPerArea)

panel_558 = Panel("# of residential units")

# ----
# .csv recordings
panel_559 = Panel("#ofResUnits")

# ----
# GENERATED
# LIGHTING DENSITY
panel_561 = Panel("Lighting Density")

# ----
# construction type division,
# masonry or
# concrete
partition_47 = PartitionList(List=data_147, Size=tstat_5.Length)  # -> simplify(Chunks)
cull_i_33 = CullIndex(List=simplify(partition_47), Indices=simplify(data_95), Wrap=True)  # -> simplify(flatten(List))
item_202 = ListItem(List=cull_i_33, Index=data_117, Wrap=True)
equals_39 = Equality(FirstNumber=item_202, SecondNumber="0")  # -> Equality, Inequality

python_36 = GhPythonScript(x=equals_39.Equality)  # -> out, a
# ---------- python_36: Python ----------
__author__ = "orcun"
__version__ = "2022.05.06"

import rhinoscriptsyntax as rs
#0: masonry
#1: concrete
if x == True:
    a = 0
else:
    a = 1
# ---------- end python_36 ----------
panel_562 = Panel("""0: masonry
1: concrete""")
weave_35 = Weave(
    Pattern=python_36.a,
    Stream0=decomposeepconstruction_3.UValue_SI,
    Stream1=decomposeepconstruction_2.UValue_SI,
    NullGaps=False)

python_37 = GhPythonScript(x=equals_39.Equality)  # -> out, a; same code as python_36
weave_36 = Weave(
    Pattern=python_37.a,
    Stream0=decomposeepconstruction_5.UValue_SI,
    Stream1=decomposeepconstruction.UValue_SI,
    NullGaps=False)

# ----
# Insulated
# Flat roof
# Ankara
base_2 = Panel("0.121445")
epopaquemat_4 = Honeybee_EnergyPlusOpaqueMaterial(name="Alci siva", thickness="0.02", conductivity="0.51", density="1200", specificHeat="1090")  # -> EPMaterial; plug-in component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
epopaquemat_5 = Honeybee_EnergyPlusOpaqueMaterial(name="Betonarme", thickness="0.12", conductivity="2.5", density="2400", specificHeat="840")  # -> EPMaterial; plug-in component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

panel_564 = Panel("conductivityOfInsulationMaterial")
data_185 = Data("0.04")

# ----
# R value summation for all other lements of the construction
decomposeepmaterial = Honeybee_DecomposeEPMaterial(materialName=simplify("Alci siva"))  # -> names, values, comments, UValue_SI, UValue_IP, RValue_SI, RValue_IP; plug-in component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
decomposeepmaterial_2 = Honeybee_DecomposeEPMaterial(materialName=simplify("Betonarme"))  # -> names, values, comments, UValue_SI, UValue_IP, RValue_SI, RValue_IP; plug-in component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

merge_144 = Merge(Data2=decomposeepmaterial_2.RValue_SI, Data3=decomposeepmaterial.RValue_SI)
ma_5 = MassAddition(Input=merge_144)  # -> Result, PartialResults

division_11 = Division(A="1", B=data_118)
subtraction_5 = Subtraction(A=division_11, B=ma_5.Result)
multiplication_9 = Multiplication(A=subtraction_5, B=data_185)

data_186 = Data(multiplication_9)
weave_37 = Weave(Pattern=list, Stream0=base_2, Stream1=base_2, Stream2=data_186, Stream3=data_186, NullGaps=False)
epopaquemat_6 = Honeybee_EnergyPlusOpaqueMaterial(name="Cam yunu cati yalitim", thickness=weave_37, conductivity="0.04", density="18", specificHeat="1030")  # -> EPMaterial; plug-in component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
epconstruction_3 = Honeybee_EnergyPlusConstruction(name=weave_22, layer_1=epopaquemat_6, layer_2=epopaquemat_5, layer_3=epopaquemat_4)  # -> EPConstruction; plug-in component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

thickness_of_insulation_material = Panel(multiplication_9)

panel_565 = Panel("thickness for u-Roof")
weave_38 = Weave(Pattern=list, Stream0=base_2, Stream1=base_2, Stream2=data_186, Stream3=data_186, NullGaps=False)

# ----
# Thickness of Insulation Material
base_3 = Panel("0.0477")

# ----
# Ankara
# External wall
panel_566 = Panel("dis siva cimento esasli")
epopaquemat_7 = Honeybee_EnergyPlusOpaqueMaterial(name=panel_566, thickness="0.03", conductivity="1.6", density="2000", specificHeat="840")  # -> EPMaterial; plug-in component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
epopaquemat_8 = Honeybee_EnergyPlusOpaqueMaterial(name="ic siva alci esasli", thickness="0.02", conductivity="0.51", density="1200", specificHeat="1090")  # -> EPMaterial; plug-in component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
epopaquemat_9 = Honeybee_EnergyPlusOpaqueMaterial(name="yatay delikli tugla", thickness="0.135", conductivity="0.33", density="600", specificHeat="900")  # -> EPMaterial; plug-in component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

# ----
# R value summation for all other lements of the construction
decomposeepmaterial_3 = Honeybee_DecomposeEPMaterial(materialName=simplify("ic siva alci esasli"))  # -> names, values, comments, UValue_SI, UValue_IP, RValue_SI, RValue_IP; plug-in component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
decomposeepmaterial_4 = Honeybee_DecomposeEPMaterial(materialName=simplify(panel_566))  # -> names, values, comments, UValue_SI, UValue_IP, RValue_SI, RValue_IP; plug-in component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
decomposeepmaterial_5 = Honeybee_DecomposeEPMaterial(materialName=simplify("yatay delikli tugla"))  # -> names, values, comments, UValue_SI, UValue_IP, RValue_SI, RValue_IP; plug-in component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

merge_145 = Merge(Data1=decomposeepmaterial_4.RValue_SI, Data2=decomposeepmaterial_5.RValue_SI, Data3=decomposeepmaterial_3.RValue_SI)
ma_6 = MassAddition(Input=merge_145)  # -> Result, PartialResults

data_187 = Data("0.035")

division_12 = Division(A="1", B=data_119)
subtraction_6 = Subtraction(A=division_12, B=ma_6.Result)
multiplication_10 = Multiplication(A=subtraction_6, B=data_187)

data_188 = Data(multiplication_10)

panel_568 = Panel("thickness for u-Wall")
# Versions
weave_39 = Weave(Pattern=list, Stream0=base_3, Stream1=base_3, Stream2=data_188, Stream3=data_188, NullGaps=False)

thickness_of_insulation_material_2 = Panel(multiplication_10)

data_189 = Data("0.035")

# ----
# 07.CONSTRUCTION
# FOR ENERGY MODELING
weave_40 = Weave(Pattern=list, Stream0=base_3, Stream1=base_3, Stream2=data_188, Stream3=data_188, NullGaps=False)
panel_570 = Panel("0")  # disabled
rvalueairfilms_2 = Honeybee_RValueWithAirFilms(uValue_SI=decomposeepconstruction_2.UValue_SI, surfaceType=panel_570)  # -> UValue_SI_wAir, UValue_IP_wAir, RValue_SI_wAir, RValue_IP_wAir; disabled; plug-in component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
panel_571 = Panel("0")  # disabled
rvalueairfilms_3 = Honeybee_RValueWithAirFilms(uValue_SI=decomposeepconstruction_3.UValue_SI, surfaceType=panel_571)  # -> UValue_SI_wAir, UValue_IP_wAir, RValue_SI_wAir, RValue_IP_wAir; disabled; plug-in component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
panel_572 = Panel("3")  # disabled
rvalueairfilms_4 = Honeybee_RValueWithAirFilms(uValue_SI=decomposeepconstruction_4.UValue_SI, surfaceType=panel_572)  # -> UValue_SI_wAir, UValue_IP_wAir, RValue_SI_wAir, RValue_IP_wAir; disabled; plug-in component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
panel_573 = Panel("2")  # disabled
rvalueairfilms_5 = Honeybee_RValueWithAirFilms(uValue_SI=decomposeepconstruction_5.UValue_SI, surfaceType=panel_573)  # -> UValue_SI_wAir, UValue_IP_wAir, RValue_SI_wAir, RValue_IP_wAir; disabled; plug-in component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
base_4 = Panel("0.121445")

epopaquemat_10 = Honeybee_EnergyPlusOpaqueMaterial(name="EPS", thickness=weave_40, conductivity="0.035", density="22", specificHeat="1500")  # -> EPMaterial; plug-in component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
epconstruction_4 = Honeybee_EnergyPlusConstruction(name=weave_23, layer_1=epopaquemat_7, layer_2=epopaquemat_10, layer_3=epopaquemat_9, layer_4=epopaquemat_8)  # -> EPConstruction; plug-in component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

# ----
# thickness for Ground Floor
base_5 = Panel("0.058774")

# ----
# references: https://docs.google.com/spreadsheets/d/1WwH0E2wul-ns8CfgSEfoPrmkpj9kjO-c/edit#gid=1172685997
# Thickness of Insulation Material
base_6 = Panel("0.05")

epopaquemat_11 = Honeybee_EnergyPlusOpaqueMaterial(name="internalPlaster", thickness="0.02", conductivity="0.51", density="1200", specificHeat="840")  # -> EPMaterial; plug-in component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
epopaquemat_12 = Honeybee_EnergyPlusOpaqueMaterial(name="solidBrick", thickness="0.2", conductivity="0.5", density="1200", specificHeat="800")  # -> EPMaterial; plug-in component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
epopaquemat_13 = Honeybee_EnergyPlusOpaqueMaterial(name="externalPlaster", thickness="0.02", conductivity="0.721", density="1762", specificHeat="840")  # -> EPMaterial; plug-in component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

# ----
# R value summation for all other lements of the construction
decomposeepmaterial_6 = Honeybee_DecomposeEPMaterial(materialName=simplify("internalPlaster"))  # -> names, values, comments, UValue_SI, UValue_IP, RValue_SI, RValue_IP; plug-in component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
decomposeepmaterial_7 = Honeybee_DecomposeEPMaterial(materialName=simplify("externalPlaster"))  # -> names, values, comments, UValue_SI, UValue_IP, RValue_SI, RValue_IP; plug-in component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
decomposeepmaterial_8 = Honeybee_DecomposeEPMaterial(materialName=simplify("solidBrick"))  # -> names, values, comments, UValue_SI, UValue_IP, RValue_SI, RValue_IP; plug-in component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

merge_146 = Merge(Data1=decomposeepmaterial_7.RValue_SI, Data2=decomposeepmaterial_8.RValue_SI, Data3=decomposeepmaterial_6.RValue_SI)
ma_7 = MassAddition(Input=merge_146)  # -> Result, PartialResults

data_190 = Data("0.035")

division_13 = Division(A="1", B=data_120)
subtraction_7 = Subtraction(A=division_13, B=ma_7.Result)
multiplication_11 = Multiplication(A=subtraction_7, B=data_190)

data_191 = Data(multiplication_11)

thickness_of_insulation_material_3 = Panel(multiplication_11)

weave_41 = Weave(Pattern=list, Stream0=base_6, Stream1=base_6, Stream2=data_191, Stream3=data_191, NullGaps=False)

epopaquemat_14 = Honeybee_EnergyPlusOpaqueMaterial(name="EPS", thickness=weave_41, conductivity="0.035", density="22", specificHeat="1400")  # -> EPMaterial; plug-in component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
epconstruction_5 = Honeybee_EnergyPlusConstruction(name=weave_24, layer_1=epopaquemat_13, layer_2=epopaquemat_14, layer_3=epopaquemat_12, layer_4=epopaquemat_11)  # -> EPConstruction; plug-in component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

# ----
# Ground Floor
panel_575 = Panel("kece polyester")
epopaquemat_15 = Honeybee_EnergyPlusOpaqueMaterial(name=panel_575, thickness="0.003", conductivity="0.19", density="25", specificHeat="1500")  # -> EPMaterial; plug-in component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
epopaquemat_16 = Honeybee_EnergyPlusOpaqueMaterial(name="koruma sapi", thickness="0.05", conductivity="1.4", density="2000", specificHeat="837")  # -> EPMaterial; plug-in component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
epopaquemat_17 = Honeybee_EnergyPlusOpaqueMaterial(name="laminant parke", thickness="0.008", conductivity="0.115", density="938", specificHeat="1600")  # -> EPMaterial; plug-in component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
epopaquemat_18 = Honeybee_EnergyPlusOpaqueMaterial(name="Dolgu cakil", thickness="0.1", conductivity="2.0", density="2000", specificHeat="840")  # -> EPMaterial; plug-in component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
epopaquemat_19 = Honeybee_EnergyPlusOpaqueMaterial(name="Su yalitimi", thickness="0.003", conductivity="0.19", density="3000", specificHeat="780")  # -> EPMaterial; plug-in component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
epopaquemat_20 = Honeybee_EnergyPlusOpaqueMaterial(name="Grobeton", thickness="0.1", conductivity="1.65", density="2200", specificHeat="860")  # -> EPMaterial; plug-in component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
epopaquemat_21 = Honeybee_EnergyPlusOpaqueMaterial(name="Koruma betonu", thickness="0.1", conductivity="1.65", density="2200", specificHeat="860")  # -> EPMaterial; plug-in component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

# ----
# R value summation for all other lements of the construction
decomposeepmaterial_9 = Honeybee_DecomposeEPMaterial(materialName=simplify("Su yalitimi"))  # -> names, values, comments, UValue_SI, UValue_IP, RValue_SI, RValue_IP; plug-in component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
decomposeepmaterial_10 = Honeybee_DecomposeEPMaterial(materialName=simplify("Dolgu cakil"))  # -> names, values, comments, UValue_SI, UValue_IP, RValue_SI, RValue_IP; plug-in component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
decomposeepmaterial_11 = Honeybee_DecomposeEPMaterial(materialName=simplify(panel_575))  # -> names, values, comments, UValue_SI, UValue_IP, RValue_SI, RValue_IP; plug-in component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
decomposeepmaterial_12 = Honeybee_DecomposeEPMaterial(materialName=simplify("Grobeton"))  # -> names, values, comments, UValue_SI, UValue_IP, RValue_SI, RValue_IP; plug-in component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
decomposeepmaterial_13 = Honeybee_DecomposeEPMaterial(materialName=simplify(panel_575))  # -> names, values, comments, UValue_SI, UValue_IP, RValue_SI, RValue_IP; plug-in component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
decomposeepmaterial_14 = Honeybee_DecomposeEPMaterial(materialName=simplify("laminant parke"))  # -> names, values, comments, UValue_SI, UValue_IP, RValue_SI, RValue_IP; plug-in component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
decomposeepmaterial_15 = Honeybee_DecomposeEPMaterial(materialName=simplify("Koruma betonu"))  # -> names, values, comments, UValue_SI, UValue_IP, RValue_SI, RValue_IP; plug-in component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
decomposeepmaterial_16 = Honeybee_DecomposeEPMaterial(materialName=simplify("koruma sapi"))  # -> names, values, comments, UValue_SI, UValue_IP, RValue_SI, RValue_IP; plug-in component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

merge_147 = Merge(
    Data1=decomposeepmaterial_10.RValue_SI,
    Data2=decomposeepmaterial_12.RValue_SI,
    Data3=decomposeepmaterial_9.RValue_SI,
    Data4=decomposeepmaterial_15.RValue_SI,
    Data5=decomposeepmaterial_11.RValue_SI,
    Data6=decomposeepmaterial_13.RValue_SI,
    Data7=decomposeepmaterial_16.RValue_SI,
    Data8=decomposeepmaterial_14.RValue_SI)
ma_8 = MassAddition(Input=merge_147)  # -> Result, PartialResults

division_14 = Division(A="1", B=data_124)
subtraction_8 = Subtraction(A=division_14, B=ma_8.Result)
multiplication_12 = Multiplication(A=subtraction_8, B=data_189)

weave_42 = Weave(Pattern=list, Stream0=base_5, Stream1=base_5, Stream2=multiplication_12, Stream3=multiplication_12, NullGaps=False)

epopaquemat_22 = Honeybee_EnergyPlusOpaqueMaterial(name="XPS", thickness=weave_42, conductivity="0.035", density="25", specificHeat="1200")  # -> EPMaterial; plug-in component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
epconstruction_6 = Honeybee_EnergyPlusConstruction(
    name=weave_25,
    layer_1=epopaquemat_18,
    layer_2=epopaquemat_20,
    layer_3=epopaquemat_19,
    layer_4=epopaquemat_21,
    layer_5=epopaquemat_22,
    layer_6=epopaquemat_15,
    layer_7=epopaquemat_16,
    layer_8=epopaquemat_17)  # -> EPConstruction; plug-in component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

thickness_of_insulation_material_4 = Panel(multiplication_12)

division_15 = Division(A="1", B=data_121)

# ----
# Internal Mass Calculation
md_slider_7 = MDSlider(SliderMode=0, slider_value=Point(0.5, 0.5, 0.5), x_domain=Domain(0, 1), y_domain=Domain(0, 1), z_domain=Domain(0, 1))
panel_576 = Panel("""0
2""")
floor_height_6 = Panel("3")

# ----
# references: https://docs.google.com/spreadsheets/d/1WwH0E2wul-ns8CfgSEfoPrmkpj9kjO-c/edit#gid=1172685997
panel_578 = Panel("reinforcedConcrete")
panel_579 = Panel("0.08")
epopaquemat_23 = Honeybee_EnergyPlusOpaqueMaterial(name=panel_578, thickness="0.12", conductivity="2.5", density="2400", specificHeat="860")  # -> EPMaterial; plug-in component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
epopaquemat_24 = Honeybee_EnergyPlusOpaqueMaterial(name="externalPlaster", thickness="0.02", conductivity="0.721", density="1762", specificHeat="840")  # -> EPMaterial; plug-in component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
epopaquemat_25 = Honeybee_EnergyPlusOpaqueMaterial(name="interPlaster", thickness="0.02", conductivity="0.51", density="1200", specificHeat="840")  # -> EPMaterial; plug-in component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

# ----
# R value summation for all other lements of the construction
decomposeepmaterial_17 = Honeybee_DecomposeEPMaterial(materialName=simplify("interPlaster"))  # -> names, values, comments, UValue_SI, UValue_IP, RValue_SI, RValue_IP; plug-in component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
decomposeepmaterial_18 = Honeybee_DecomposeEPMaterial(materialName=simplify("externalPlaster"))  # -> names, values, comments, UValue_SI, UValue_IP, RValue_SI, RValue_IP; plug-in component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
decomposeepmaterial_19 = Honeybee_DecomposeEPMaterial(materialName=simplify(panel_578))  # -> names, values, comments, UValue_SI, UValue_IP, RValue_SI, RValue_IP; plug-in component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

merge_148 = Merge(Data1=decomposeepmaterial_18.RValue_SI, Data2=decomposeepmaterial_19.RValue_SI, Data3=decomposeepmaterial_17.RValue_SI)
ma_9 = MassAddition(Input=merge_148)  # -> Result, PartialResults

data_192 = Data("0.04")

subtraction_9 = Subtraction(A=division_15, B=ma_9.Result)
multiplication_13 = Multiplication(A=subtraction_9, B=data_192)

# ----
# u-valueCalculationofMaterial: Where R = Material Thickness (m) ÷ Thermal Conductivity (W/mK)
# 
# 
# https://www.tatasteeleurope.com/construction/blogs-news/blogs/blog/how-to-calculate-the-u-value-of-a-construction
thickness_of_insulation_material_5 = Panel(multiplication_13)

data_193 = Data(multiplication_13)

weave_43 = Weave(Pattern=list, Stream0=base_4, Stream1=base_4, Stream2=data_193, Stream3=data_193, NullGaps=False)

epopaquemat_26 = Honeybee_EnergyPlusOpaqueMaterial(name="glassWool", thickness=weave_43, conductivity="0.04", density="18", specificHeat="670")  # -> EPMaterial; plug-in component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
epconstruction_7 = Honeybee_EnergyPlusConstruction(name=weave_26, layer_1=epopaquemat_24, layer_2=epopaquemat_26, layer_3=epopaquemat_23, layer_4=epopaquemat_25)  # -> EPConstruction; plug-in component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

panel_580 = Panel("replace Path")

panel_581 = Panel("# of floor")  # disabled

panel_582 = Panel("simulated Parcel")  # disabled

panel_583 = Panel("simulated building PARCEL")

# ----
# x
# x
# x
# x
# x
# x
# x
# x
# x
# x
# x
# x
# x
# x
# x
# x
# x
# x
# x
# x
# x
# x
# x
# x
# x
# x
# x
# 
# x
# x
# x
# x
# x
# x
# 
# x
# x
# x
# x
# x
# 
# x
# x
# x
# x
# x
# x
# 
# x
# x
# x
# x
panel_584 = Panel("conditioned zones")

area_42 = Area(Geometry=geo_44)  # -> Area, Centroid
area_43 = Area(Geometry=geo_44)  # -> Area, Centroid

# ----
# radius of the circle is the summation of fit circle radius's and 2 times of the builing height
item_203 = ListItem(List=data_172, Index=data_125, Wrap=True)
data_194 = Data(floor_height)
multiplication_14 = Multiplication(A="2", B=item_203)
multiplication_15 = Multiplication(A=data_194, B=multiplication_14)

pop2d_2 = Populate2D(Region=geo_44, Count="25", Seed=1)  # -> simplify(Population)

panel_586 = Panel("0")  # disabled

panel_587 = Panel("0")  # disabled

# ----
# detecting circle radius is the 2 times of the building height plus fit cirle radius
multiplication_16 = Multiplication(A=item_99, B=data_101)

# ----
# height of the building
data_195 = Data(multiplication_16)

# ----
# Check whether Added Parcels inside the Block
# Added Parcel Status
panel_590 = Panel("_")
split_12 = TextSplit(Text=item_72, Separators=panel_590)
item_204 = ListItem(List=split_12, Index=-1, Wrap=True)
item_205 = ListItem(List=sorted_parcels_2, Index=item_204, Wrap=True)

panel_591 = Panel("simulation units")  # disabled

multiplication_17 = Multiplication(A=data_195, B="2")

panel_592 = Panel("context Brep")

# ----
# rectangle geometry do not work with collison component
toggle_44 = BooleanToggle(True)

panel_594 = Panel("simulated building PARCEL")  # disabled

panel_595 = Panel("detecting lines")

# ----
# Intersection Check
Z_8 = UnitZ(Factor=1)

# ----
# Context Building
panel_596 = Panel("cull intersected parcel")
panel_597 = Panel("collision detection")

panel_598 = Panel("50")  # disabled

toggle_45 = BooleanToggle(True)  # disabled

panel_599 = Panel("context surfaces")

# ----
# 00test triangle
panel_603 = Panel("50")

panel_604 = Panel("-1")  # disabled
panel_605 = Panel("starts from north")  # disabled

panel_606 = Panel("#OfUnits")

panel_607 = Panel("-1")  # disabled

panel_608 = Panel("-1")  # disabled

area_44 = Area(Geometry=geo_45)  # -> Area, Centroid
scale_6 = Scale(Geometry=geo_45, Center=area_44.Centroid, Factor="1.1")  # -> Geometry, Transform
debrep_9 = DeconstructBrep(Brep=scale_6.Geometry)  # -> Faces, Edges, Vertices
pline_7 = PolyLine(Vertices=debrep_9.Vertices, Closed=Toggle(True))  # -> flatten(Polyline)

panel_609 = Panel("simulated thermal zones")

panel_610 = Panel("Window")

series_46 = Series(Start=0, Step=1, Count="4")

panel_612 = Panel("""Window
Directions""")

panel_614 = Panel("conditioned residential units")

panel_616 = Panel("shading Context")

# ----
# height of context
panel_617 = Panel("0")  # disabled
panel_618 = Panel("4")  # disabled
dup_137 = DuplicateData(Data=panel_617, Number=panel_618, Order=True)  # disabled
panel_619 = Panel("1")  # disabled

panel_620 = Panel("""NO-Window
Directions""")

# ----
# average distance of context
panel_622 = Panel("0")  # disabled
panel_623 = Panel("4")  # disabled
dup_138 = DuplicateData(Data=panel_622, Number=panel_623, Order=True)  # disabled
panel_624 = Panel("1")  # disabled

panel_626 = Panel("simulated thermal zones")  # disabled

panel_628 = Panel("external Wall")

panel_629 = Panel("roof")

# ----
# WWR by directions
lng_88 = ListLength(List=data_127)

panel_630 = Panel("wwrByDirections")

# ----
# null olanları
# -1 ile değiştirdim
# hiç etkisi yok
# demek
panel_631 = Panel("-1")

panel_632 = Panel("WWR by directions")

panel_633 = Panel("""Obstacle by 
Directions""")

panel_634 = Panel("19")  # disabled
gradientlibrary = Ladybug_GradientLibrary(gradIndex=panel_634)  # -> customColors; disabled; plug-in component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
toggle_46 = BooleanToggle(True)  # disabled
legendpar = Ladybug_LegendParameters(customColors=flatten(gradientlibrary))  # -> legendPar; disabled; plug-in component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
toggle_47 = BooleanToggle(True)  # disabled
panel_635 = Panel("EnergyBalance")  # disabled
pt_4 = Point(Point(458, 1813, 0))  # disabled
swatch_8 = ColourSwatch(SwatchColor=RGB(0, 0, 0))  # disabled

# ----
# Colibri
panel_636 = Panel("C:\KBEM\IP2.1\RetrofitResults\colibri")
img_setting = ImageSetting(ImageSaveAsName="defaultName", Width="2500", Height="2500")

# ----
# naming (version_parsel_block)
panel_637 = Panel("593")
division_16 = Division(A=filename, B=panel_637)
round_32 = Round(Number=division_16)  # -> Nearest, Floor, Ceiling
multiplication_18 = Multiplication(A=panel_637, B=round_32.Floor)
subtraction_10 = Subtraction(A=multiplication_18, B=filename)
abs_4 = Absolute(Value=subtraction_10)
python_38 = GhPythonScript(x=filename, y=abs_4)  # -> out, a; inputs x: Int32, y: Int32
# ---------- python_38: Python ----------
__author__ = "Siser"
__version__ = "2022.07.22"

import rhinoscriptsyntax as rs
if x < y:
    a = x
else:
    a=y
# ---------- end python_38 ----------

branch_25 = TreeBranch(Tree=partition_25, Path=python_38.a, MaintainPaths=True)

branch_26 = TreeBranch(Tree=partition_25, Path=python_38.a, MaintainPaths=True)

area_45 = Area(Geometry=branch_26)  # -> Area, Centroid
move2pt_2 = MoveToPoint(Geometry=branch_26, PointA=area_45.Centroid, PointB=area_41.Centroid)  # -> Moved, Vector, Transform

disc_11 = Discontinuity(Curve=branch_25, Level=1)  # -> Points, Parameters
cp_4 = ClosestPoint(Point=item_116, Cloud=disc_11.Points)  # -> ClosestPoint, CPIndex, Distance
item_206 = ListItem(List=disc_11.Points, Index=cp_4.CPIndex, Wrap=True)
move2pt_3 = MoveToPoint(Geometry=branch_25, PointA=item_206, PointB=item_116)  # -> Moved, Vector, Transform

weave_44 = Weave(Pattern=python_32.a, Stream0=move2pt_3.Moved, Stream1=branch_25, Stream2=move2pt_2.Moved, NullGaps=False)
project_4 = Project(Geometry=weave_44, Plane=PlaneXY(0, 0, 0))  # -> Geometry, Transform

geo_66 = Geometry(project_4.Geometry)

pop2d_3 = Populate2D(Region=geo_66, Count=25, Seed=1)

incurve_9 = PointInCurve(Point=pop2d_3, Curve=graft(project_2.Geometry))  # -> Relationship, Point
equals_40 = Equality(FirstNumber=incurve_9.Relationship, SecondNumber="2")  # -> Equality, Inequality
sort_17 = SortList(Keys=equals_40.Equality)  # -> Keys, ValuesA
dcon_4 = DeleteConsecutive(Set=sort_17.Keys, Wrap=False)  # -> Set, Count
dispatch_45 = Dispatch(List=dcon_4.Set, DispatchPattern=[True, False])  # -> ListA, simplify(ListB)
clean_23 = CleanTree(RemoveNulls=True, RemoveInvalid=True, RemoveEmpty=Toggle(True), Tree=dispatch_45.ListB)
# Extension of staircase
# -Staircase should connect every residential unit
tstat_13 = TreeStatistics(Tree=clean_23)  # -> Paths, Length, Count

branch_27 = TreeBranch(Tree=geo_65, Path=tstat_13.Paths, MaintainPaths=True)  # -> flatten(Branch)

geo_67 = Geometry(project_4.Geometry)

area_46 = Area(Geometry=geo_67)  # -> Area, Centroid
scale_7 = Scale(Geometry=geo_67, Center=area_46.Centroid, Factor="1.1")  # -> Geometry, Transform

debrep_10 = DeconstructBrep(Brep=branch_27)  # -> Faces, flatten(Edges), Vertices
midpt = CurveMiddle(Curve=debrep_10.Edges)
incurve_10 = PointInCurve(Point=midpt, Curve=scale_7.Geometry)  # -> Relationship, Point
equals_41 = Equality(FirstNumber=incurve_10.Relationship, SecondNumber=panel_513)  # -> Equality, Inequality
debrep_11 = DeconstructBrep(Brep=scale_7.Geometry)  # -> Faces, Edges, Vertices
dispatch_46 = Dispatch(List=debrep_10.Edges, DispatchPattern=equals_41.Equality)  # -> ListA, ListB
ccx = CurveCurve(CurveA=debrep_11.Edges, CurveB=dispatch_46.ListA)  # -> simplify(Points), ParamsA, ParamsB
geo_68 = Geometry(simplify(graft(debrep_11.Edges)))
lng_89 = ListLength(List=ccx.Points)
equals_42 = Equality(FirstNumber=lng_89, SecondNumber="0")  # -> Equality, Inequality
dispatch_47 = Dispatch(List=geo_68, DispatchPattern=equals_42.Equality)  # -> ListA, ListB

geo_69 = Geometry(project_4.Geometry)
area_47 = Area(Geometry=geo_69)  # -> Area, Centroid
scale_8 = Scale(Geometry=geo_69, Center=area_47.Centroid, Factor=panel_515)  # -> Geometry, Transform

disc_12 = Discontinuity(Curve=dispatch_46.ListA, Level=1)  # -> Points, Parameters
disc_13 = Discontinuity(Curve=dispatch_47.ListA, Level=1)  # -> Points, Parameters
merge_149 = Merge(Data1=disc_12.Points, Data2=disc_13.Points)  # -> flatten(Result)
hull_7 = ConvexHull(Points=merge_149, Plane=PlaneXY(0, 0, 0))  # -> Hull, HullZ, Indices
brec_7 = BoundingRectangle(Geometry=hull_7.Hull, Plane=data_169, Axis=0, Slide=0, Union=True)  # -> Bounding, DimensionX, DimensionY

incurve_11 = PointInCurve(Point=area_28.Centroid, Curve=project_4.Geometry)  # -> Relationship, Point

disc_14 = Discontinuity(Curve=branch_27, Level=1)  # -> Points, Parameters
hull_8 = ConvexHull(Points=flatten(disc_14.Points), Plane=PlaneXY(0, 0, 0))  # -> Hull, HullZ, Indices
debrep_12 = DeconstructBrep(Brep=hull_8.Hull)  # -> Faces, Edges, Vertices
# scale-down or scale-up
# the staircase
len_2 = Length(Curve=debrep_12.Edges)
sort_18 = SortList(Keys=len_2, ValuesA=debrep_12.Edges)  # -> Keys, reverse(ValuesA)
debrep_13 = DeconstructBrep(Brep=brec_7.Bounding)  # -> Faces, Edges, Vertices
item_207 = ListItem(List=sort_18.ValuesA, Index=[0, 1], Wrap=True)

geo_70 = Geometry(project_4.Geometry)

# ----
# scale-up ratio of new staircase: preserve the original area of staircase
area_48 = Area(Geometry=scale_7.Geometry)  # -> Area, Centroid
area_49 = Area(Geometry=brec_7.Bounding)  # -> Area, Centroid
division_17 = Division(A=area_48.Area, B=area_49.Area)
panel_638 = Panel(area_49.Area)
panel_639 = Panel(area_48.Area)

item_208 = ListItem(List=cull_i_19, Index=python_38.a, Wrap=True)

merge_150 = Merge(Data1=round_32.Floor, Data2=item_208)
join_32 = TextJoin(Text=merge_150, Join="_")

uniffuntion_nvi = Panel(branch_12)
panel_640 = Panel(join_32)

data_196 = Data(round_32.Floor)
panel_641 = Panel("version")

# ----
# 0: if staircase is at corner of parcel
# 1: if staircase is at the center of the parcel
python_39 = GhPythonScript(x=incurve_11.Relationship)  # -> out, a
# ---------- python_39: Python ----------
__author__ = "orcun"
__version__ = "2022.05.06"

import rhinoscriptsyntax as rs
if x == 0:
    a = 0
else:
    a = 1
# ---------- end python_39 ----------

crv_cp_2 = CurveClosestPoint(Point=flatten(debrep_13.Vertices), Curve=graft(item_207))  # -> simplify(Point), Parameter, Distance

sort_pt = SortPoints(Points=crv_cp_2.Point)  # -> Points, Indices

dcon_5 = DeleteConsecutive(Set=sort_pt.Points, Wrap=False)  # -> simplify(Set), Count
pline_8 = PolyLine(Vertices=dcon_5.Set, Closed=False)
midpt_2 = CurveMiddle(Curve=pline_8)
scale_9 = Scale(Geometry=pline_8, Center=midpt_2, Factor=division_17)  # -> Geometry, Transform
disc_15 = Discontinuity(Curve=scale_9.Geometry, Level=1)  # -> flatten(Points), Parameters
# x
# x
# x
# x
# x
# x
# x
# x
# x
# x
# x
# x
# x
# x
# x
# x
# x
# x
# x
# x
# x
# x
# x
# x
# x
# x
# x
# 
# x
# x
# x
# x
# x
# x
# 
# x
# x
# x
# x
# x
# 
# x
# x
# x
# x
# x
# x
# 
# x
# x
# x
# x
hull_9 = ConvexHull(Points=disc_15.Points, Plane=PlaneXY(0, 0, 0))  # -> Hull, HullZ, Indices

# ----
# otherwise single floor buildings can be problematic (ex, ank-bahçeli,index:37)
merge_151 = Merge(Data1=hull_9.Hull, Data2=scale_8.Geometry)  # -> flatten(Result)
area_50 = Area(Geometry=merge_151)  # -> Area, Centroid
sort_19 = SortList(Keys=area_50.Area, ValuesA=merge_151)  # -> Keys, ValuesA
item_209 = ListItem(List=sort_19.ValuesA, Index=-1, Wrap=True)

weave_45 = Weave(Pattern=python_39.a, Stream0=geo_70, Stream1=item_209, NullGaps=False)

weave_46 = Weave(Pattern=item_115, Stream0=project_4.Geometry, Stream1=weave_45, NullGaps=False)

# ----
# no staircase if # of floor is equal to 1
python_40 = GhPythonScript(x=weave_46, y=lng_73)  # -> out, a
# ---------- python_40: Python ----------
__author__ = "orcun"
__version__ = "2022.05.09"

import rhinoscriptsyntax as rs
if y == 1:
    a = 'Null'
else:
    a = x
# ---------- end python_40 ----------

area_51 = Area(Geometry=hull_9.Hull)  # -> Area, Centroid
panel_642 = Panel(area_51.Area)

arrlinear_2 = LinearArray(Geometry=python_40.a, Direction=Z_3, Count=lng_74)  # -> simplify(graft(Geometry)), Transform

# ----
# replace with new path
rdiff_2 = RegionDifference(CurvesA=partition_45, CurvesB=arrlinear_2.Geometry)  # -> simplify(Result)
tstat_14 = TreeStatistics(Tree=rdiff_2)  # -> Paths, Length, Count
replace_22 = ReplacePaths(Data=rdiff_2, Search=tstat_14.Paths, Replace=data_170)

# ----
# additional units (example index 0, in bahceli)
# 
# OR
# 
# non-additional units (example index 1, in bahceli)
geo_71 = Geometry(replace_22)

# ----
# single unit per building
item_210 = ListItem(List=geo_71, Index=series_43, Wrap=True)

tstat_15 = TreeStatistics(Tree=item_210)  # -> Paths, Length, Count
split_13 = TextSplit(Text=tstat_15.Paths, Separators="{}")
item_211 = ListItem(List=split_13, Index=1, Wrap=True)  # -> simplify(Item)
split_14 = TextSplit(Text=item_211, Separators=";")
item_212 = ListItem(List=split_14, Index="1", Wrap=True)  # -> simplify(flatten(Item))
lng_90 = ListLength(List=item_212)
dup_139 = DuplicateData(Data=item_71, Number=lng_90, Order=True)  # -> flatten(Data)
merge_152 = Merge(Data1=simplify(graft(dup_139)), Data2=simplify(graft(item_212)))
join_33 = TextJoin(Text=merge_152, Join=";")

# ----
# not single unit per building
branch_28 = TreeBranch(Tree=item_210, Path=item_94, MaintainPaths=True)

weave_47 = Weave(Pattern=data_176, Stream0=flatten(item_210), Stream1=branch_28, NullGaps=False)
disc_16 = Discontinuity(Curve=weave_47, Level=1)  # -> Points, Parameters
brec_8 = BoundingRectangle(Geometry=flatten(disc_16.Points), Plane=evalsrf_2.Frame, Axis=0, Slide=0, Union=True)  # -> Bounding, DimensionX, DimensionY

# ----
# core of the building
geo_72 = Geometry(flatten(arrlinear_2.Geometry))

area_52 = Area(Geometry=geo_72)  # -> Area, Centroid
sort_pt_2 = SortPoints(Points=area_52.Centroid)  # -> Points, Indices
item_213 = ListItem(List=geo_72, Index=sort_pt_2.Indices, Wrap=True)
item_214 = ListItem(List=item_213, Index=0, Wrap=True)

boundary_16 = BoundarySurfaces(Edges=item_210)
extr_3 = Extrude(Base=boundary_16, Direction=Z_6)

# ----
# Simulated Parcel Bounding Box
geo_73 = Geometry(brec_8.Bounding)

area_53 = Area(Geometry=geo_73)  # -> Area, Centroid
vec2pt_6 = Vector2Pt(PointA=area_53.Centroid, PointB=curvepoint_3, Unitize=Toggle(True))  # -> Vector, Length
extr_4 = Extrude(Base=extr_2, Direction=vec2pt_6.Vector)
mass2zone = Honeybee_Masses2Zones(zoneMasses=flatten(extr_4), isConditioned=Toggle(False), maxRoofAngle=30, createHBZones=Toggle(True))  # -> readMe, HBZones; plug-in component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
wires_4 = BrepWireframe(Brep=mass2zone.HBZones, Density=-1)

geo_74 = Geometry(brec_8.Bounding)  # disabled

geo_75 = Geometry(brec_8.Bounding)

disc_17 = Discontinuity(Curve=geo_75, Level=1)  # -> Points, Parameters
fcircle = CircleFit(Points=disc_17.Points)  # -> Circle, Radius, Deviation

addition_7 = Addition(A=fcircle.Radius, B=multiplication_15)

area_54 = Area(Geometry=geo_75)  # -> Area, Centroid
cp_5 = ClosestPoint(Point=area_54.Centroid, Cloud=area_42.Centroid)  # -> ClosestPoint, CPIndex, Distance
item_215 = ListItem(List=geo_44, Index=cp_5.CPIndex, Wrap=True)
area_55 = Area(Geometry=item_215)  # -> Area, Centroid
circle_2 = CircleCNR(Center=area_55.Centroid, Normal=Vector(0, 0, 1), Radius=addition_7)
incurve_12 = PointInCurve(Point=area_43.Centroid, Curve=circle_2)  # -> Relationship, Point
equals_43 = Equality(FirstNumber=incurve_12.Relationship, SecondNumber="2")  # -> Equality, Inequality

incurve_13 = PointInCurve(Point=pop2d_2, Curve=circle_2)  # -> Relationship, Point
equals_44 = Equality(FirstNumber=incurve_13.Relationship, SecondNumber="2")  # -> Equality, Inequality
dispatch_48 = Dispatch(List=pop2d_2, DispatchPattern=equals_44.Equality)  # -> flatten(ListA), ListB

incurves_2 = PointInCurves(Point=dispatch_48.ListA, Curves=geo_44)  # -> Relationship, Index, Point
sort_20 = SortList(Keys=incurves_2.Index)  # -> Keys, ValuesA
dcon_6 = DeleteConsecutive(Set=sort_20.Keys, Wrap=False)  # -> Set, Count
equals_45 = Equality(FirstNumber=dcon_6.Set, SecondNumber="-1")  # -> Equality, Inequality
dispatch_49 = Dispatch(List=dcon_6.Set, DispatchPattern=equals_45.Equality)  # -> ListA, ListB
item_216 = ListItem(List=geo_44, Index=dispatch_49.ListB, Wrap=True)

geo_76 = Geometry(brec_8.Bounding)
area_56 = Area(Geometry=geo_76)  # -> Area, Centroid

geo_77 = Geometry(brec_8.Bounding)

debrep_14 = DeconstructBrep(Brep=item_216)  # -> Faces, Edges, Vertices
pline_9 = PolyLine(Vertices=debrep_14.Vertices, Closed=toggle_44)  # -> flatten(Polyline)

geo_78 = Geometry(brec_8.Bounding)  # disabled

disc_18 = Discontinuity(Curve=geo_78, Level=1)  # -> Points, Parameters; disabled
area_57 = Area(Geometry=geo_78)  # -> Area, Centroid; disabled
boundary_17 = BoundarySurfaces(Edges=geo_78)  # disabled
ln = Line(StartPoint=disc_18.Points, EndPoint=area_57.Centroid)  # disabled
srfsplit = SurfaceSplit(Surface=boundary_17, Curves=ln)  # disabled
wires_5 = BrepWireframe(Brep=srfsplit, Density=-1)  # disabled
join_34 = JoinCurves(Curves=wires_5, Preserve=False)  # -> flatten(Curves); disabled
scale_10 = Scale(Geometry=join_34, Center=area_57.Centroid, Factor=panel_598)  # -> Geometry, Transform; disabled

debrep_15 = DeconstructBrep(Brep=geo_78)  # -> Faces, Edges, Vertices; disabled
curvepoint_4 = PointOnCurve(debrep_15.Edges, parameter=0.5)  # disabled
intcrv = Interpolate(Vertices=curvepoint_4, Degree=3, Periodic=toggle_45, KnotStyle=1)  # -> Curve, Length, Domain; disabled

area_58 = Area(Geometry=scale_10.Geometry)  # -> Area, Centroid; disabled
alongcrv = SortAlongCurve(Points=area_58.Centroid, Curve=intcrv.Curve)  # -> Points, Indices; disabled
item_217 = ListItem(List=scale_10.Geometry, Index=alongcrv.Indices, Wrap=True)  # disabled

geo_79 = Geometry(brec_8.Bounding)

geo_80 = Geometry(brec_8.Bounding)

debrep_16 = DeconstructBrep(Brep=geo_79)  # -> Faces, Edges, Vertices
area_59 = Area(Geometry=geo_79)  # -> Area, Centroid
curvepoint_5 = PointOnCurve(debrep_16.Edges, parameter=0.5)
vec2pt_7 = Vector2Pt(PointA=area_59.Centroid, PointB=curvepoint_5, Unitize=Toggle(True))  # -> Vector, Length
move_3 = Move(Geometry=graft(curvepoint_5), Motion=graft(vec2pt_7.Vector))  # -> simplify(Geometry), Transform
# Building & Unit Features
disc_19 = Discontinuity(Curve=debrep_16.Edges, Level=1)  # -> simplify(Points), Parameters
merge_153 = Merge(Data1=disc_19.Points, Data2=move_3.Geometry)

area_60 = Area(Geometry=geo_80)  # -> Area, Centroid
disc_20 = Discontinuity(Curve=geo_80, Level=1)  # -> Points, Parameters
boundary_18 = BoundarySurfaces(Edges=geo_80)
ln_2 = Line(StartPoint=disc_20.Points, EndPoint=area_60.Centroid)
srfsplit_2 = SurfaceSplit(Surface=boundary_18, Curves=ln_2)
wires_6 = BrepWireframe(Brep=srfsplit_2, Density=-1)
join_35 = JoinCurves(Curves=wires_6, Preserve=False)  # -> flatten(Curves)
scale_11 = Scale(Geometry=join_35, Center=area_60.Centroid, Factor=panel_603)  # -> Geometry, Transform

shift_4 = ShiftList(List=item_217, Shift=panel_604, Wrap=True)  # disabled

area_61 = Area(Geometry=scale_11.Geometry)  # -> Area, Centroid
pdecon_9 = Deconstruct(Point=area_61.Centroid)  # -> XComponent, YComponent, ZComponent
sort_21 = SortList(Keys=pdecon_9.YComponent, ValuesA=scale_11.Geometry)  # -> Keys, reverse(ValuesA)
item_218 = ListItem(List=sort_21.ValuesA, Index=0, Wrap=True)

area_62 = Area(Geometry=scale_11.Geometry)  # -> Area, Centroid
pdecon_10 = Deconstruct(Point=area_62.Centroid)  # -> XComponent, YComponent, ZComponent
sort_22 = SortList(Keys=pdecon_10.XComponent, ValuesA=scale_11.Geometry)  # -> Keys, ValuesA
item_219 = ListItem(List=sort_22.ValuesA, Index=0, Wrap=True)

area_63 = Area(Geometry=scale_11.Geometry)  # -> Area, Centroid
pdecon_11 = Deconstruct(Point=area_63.Centroid)  # -> XComponent, YComponent, ZComponent
sort_23 = SortList(Keys=pdecon_11.YComponent, ValuesA=scale_11.Geometry)  # -> Keys, ValuesA
item_220 = ListItem(List=sort_23.ValuesA, Index=0, Wrap=True)

area_64 = Area(Geometry=scale_11.Geometry)  # -> Area, Centroid
pdecon_12 = Deconstruct(Point=area_64.Centroid)  # -> XComponent, YComponent, ZComponent
sort_24 = SortList(Keys=pdecon_12.XComponent, ValuesA=scale_11.Geometry)  # -> Keys, reverse(ValuesA)
item_221 = ListItem(List=sort_24.ValuesA, Index=0, Wrap=True)

# ----
# regions start from north
# continues counter-clockwise
merge_154 = Merge(Data1=item_218, Data2=item_219, Data3=item_220, Data4=item_221)

geo_81 = Geometry(brec_8.Bounding)  # disabled

geo_82 = Geometry(brec_8.Bounding)

geo_83 = Geometry(brec_8.Bounding)

tstat_16 = TreeStatistics(Tree=geo_71)  # -> Paths, Length, Count; disabled
panel_643 = Panel("{}")  # disabled
split_15 = TextSplit(Text=tstat_16.Paths, Separators=panel_643)  # disabled
panel_644 = Panel(";")  # disabled
split_16 = TextSplit(Text=split_15, Separators=panel_644)  # disabled
clean_24 = CleanTree(RemoveNulls=True, RemoveInvalid=True, RemoveEmpty=False, Tree=split_16)  # -> simplify(flatten(Tree)); disabled
item_222 = ListItem(List=clean_24, Index=1, Wrap=True)  # disabled

tstat_17 = TreeStatistics(Tree=geo_71)  # -> Paths, Length, Count
split_17 = TextSplit(Text=tstat_17.Paths, Separators="{}")
split_18 = TextSplit(Text=split_17, Separators=";")
clean_25 = CleanTree(RemoveNulls=True, RemoveInvalid=True, RemoveEmpty=False, Tree=split_18)  # -> simplify(flatten(Tree))
item_223 = ListItem(List=clean_25, Index=1, Wrap=True)

tstat_18 = TreeStatistics(Tree=geo_71)  # -> Paths, Length, Count; disabled
panel_645 = Panel("{}")  # disabled
split_19 = TextSplit(Text=tstat_18.Paths, Separators=panel_645)  # disabled
panel_646 = Panel(";")  # disabled
split_20 = TextSplit(Text=split_19, Separators=panel_646)  # disabled
clean_26 = CleanTree(RemoveNulls=True, RemoveInvalid=True, RemoveEmpty=False, Tree=split_20)  # -> simplify(flatten(Tree)); disabled
item_224 = ListItem(List=clean_26, Index=1, Wrap=True)  # disabled

tstat_19 = TreeStatistics(Tree=geo_71)  # -> Paths, Length, Count; disabled
panel_647 = Panel("{}")  # disabled
split_21 = TextSplit(Text=tstat_19.Paths, Separators=panel_647)  # disabled
panel_648 = Panel(";")  # disabled
split_22 = TextSplit(Text=split_21, Separators=panel_648)  # disabled
clean_27 = CleanTree(RemoveNulls=True, RemoveInvalid=True, RemoveEmpty=False, Tree=split_22)  # -> simplify(flatten(Tree)); disabled
item_225 = ListItem(List=clean_27, Index=1, Wrap=True)  # disabled

lng_91 = ListLength(List=item_210)  # -> flatten(Length)
series_47 = Series(Start=0, Step=1, Count=simplify(lng_91))  # -> simplify(flatten(Series))
partition_48 = PartitionList(List=lng_91, Size="1")  # -> simplify(Chunks)
dup_140 = DuplicateData(Data=join_33, Number=partition_48, Order=True)  # -> simplify(Data)
rep = ReplaceText(Text=dup_140, Find=";", Replace="_", RecursiveReplace=False)  # -> flatten(Result)

partition_49 = PartitionList(List=python_34.a, Size=lng_91)  # -> simplify(flatten(Chunks))

merge_155 = Merge(Data1=simplify(graft(rep)), Data2=simplify(graft(series_47)), Data3=simplify(graft(partition_49)))
join_36 = TextJoin(Text=simplify(merge_155), Join="_")  # -> flatten(Result)
partition_50 = PartitionList(List=join_36, Size=lng_91)  # -> simplify(Chunks)
item_226 = ListItem(List=partition_50, Index=series_44, Wrap=True)

panel_649 = Panel(partition_50)

# ----
# Naming for Simulated Zones
data_197 = Data(flatten(partition_50))

dispatch_50 = Dispatch(List=data_197, DispatchPattern=equals_38.Equality)  # -> ListA, ListB
lng_92 = ListLength(List=dispatch_50.ListB)
dup_141 = DuplicateData(Data="heatSet", Number=lng_92, Order=True)
merge_156 = Merge(Data1=simplify(graft(dup_141)), Data2=simplify(graft(dispatch_50.ListB)))  # -> simplify(Result)
join_37 = TextJoin(Text=merge_156)  # -> flatten(Result)

panel_650 = Panel("units")
data_198 = Data(join_36)

equals_46 = Equality(FirstNumber=data_126, SecondNumber="1")  # -> Equality, Inequality
dispatch_51 = Dispatch(List=data_198, DispatchPattern=equals_46.Equality)  # -> ListA, flatten(ListB)

lng_93 = ListLength(List=dispatch_51.ListB)
dup_142 = DuplicateData(Data=data_196, Number=lng_93, Order=True)  # -> flatten(Data)
panel_652 = Panel("version_parcel_block_floor_unit_function")
merge_157 = Merge(Data1=graft(dup_142), Data2=graft(dispatch_51.ListB))
join_38 = TextJoin(Text=merge_157, Join="_")  # -> flatten(Result)

# ----
# Unıt ID
panel_653 = Panel(join_38)

arrlinear_3 = LinearArray(Geometry=item_214, Direction=Z_4, Count=item_95)  # -> Geometry, Transform
boundary_19 = BoundarySurfaces(Edges=arrlinear_3.Geometry)
extr_5 = Extrude(Base=boundary_19, Direction=Z_5)

geo_84 = Geometry(extr_5)

lng_94 = ListLength(List=geo_84)
series_48 = Series(Start=0, Step=1, Count=lng_94)  # -> flatten(Series)
dup_143 = DuplicateData(Data=item_118, Number=lng_94, Order=True)  # -> flatten(Data)
partition_51 = PartitionList(List=dup_143, Size="3")
merge_158 = Merge(Data1=simplify(graft(series_48)), Data2=simplify(partition_51), Data3=simplify(graft(dup_52)))

data_199 = Data(extr_5)  # disabled
lng_95 = ListLength(List=data_199)  # disabled

# ----
# single unit per building
# 
# or
# 
# not
join_39 = TextJoin(Text=merge_158)  # -> flatten(Result)

dispatch_52 = Dispatch(List=geo_84, DispatchPattern=equals_35.Equality)  # -> ListA, ListB
dispatch_53 = Dispatch(List=join_39, DispatchPattern=equals_35.Equality)  # -> ListA, ListB

weave_48 = Weave(Pattern=data_177, Stream0=geo_84, Stream1=dispatch_52.ListB, NullGaps=False)
# Staircase:
# Unconditioned
weave_49 = Weave(Pattern=data_177, Stream0=join_39, Stream1=dispatch_53.ListB, NullGaps=False)

merge_159 = Merge(Data1=extr_3, Data2=weave_48)

intersectmass = Honeybee_IntersectMasses(bldgMassesBefore=flatten(merge_159), runIt=toggle_37)  # -> bldgMassesAfter; plug-in component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

volume = Volume(Geometry=weave_48)  # -> Volume, Centroid
round_33 = Round(Number=volume.Volume)  # -> Nearest, Floor, Ceiling
dcon_7 = DeleteConsecutive(Set=round_33.Nearest, Wrap=False)  # -> Set, Count

volume_2 = Volume(Geometry=intersectmass)  # -> Volume, Centroid
round_34 = Round(Number=volume_2.Volume)  # -> Nearest, Floor, Ceiling
equals_47 = Equality(FirstNumber=round_34.Nearest, SecondNumber=dcon_7.Set)  # -> Equality, Inequality
dispatch_54 = Dispatch(List=intersectmass, DispatchPattern=equals_47.Equality)  # -> ListA, ListB

geo_85 = Geometry(dispatch_54.ListB)

# ----
# Conditioned Units
weave_50 = Weave(Pattern=python_35.a, Stream0=intersectmass, Stream1=geo_85, NullGaps=False)

geo_86 = Geometry(dispatch_54.ListA)

mass2zone_2 = Honeybee_Masses2Zones(
    zoneMasses=flatten(weave_50),
    zoneNames=flatten(partition_50),
    zonePrograms=replace_9,
    isConditioned=Toggle(True),
    maxRoofAngle=30,
    createHBZones=Toggle(True))  # -> readMe, HBZones; plug-in component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

mass2zone_3 = Honeybee_Masses2Zones(
    zoneMasses=flatten(geo_86),
    zoneNames=flatten(weave_49),
    zonePrograms=item_48,
    isConditioned=Toggle(False),
    maxRoofAngle=30,
    createHBZones=Toggle(True))  # -> readMe, HBZones; plug-in component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

# ----
# if the # of floor is equal to 1
merge_160 = Merge(Data1=flatten(mass2zone_2.HBZones), Data2=flatten(mass2zone_3.HBZones))
null_9 = NullItem(Item=merge_160)  # -> flatten(NullFlags), InvalidFlags, Description
dispatch_55 = Dispatch(List=merge_160, DispatchPattern=null_9.NullFlags)  # -> ListA, flatten(ListB)

solveadjc = Honeybee_SolveAdjacencies(HBZones=flatten(dispatch_55.ListB), removeCurrentAdjc=False, findAdjc=Toggle(True))  # -> readMe, HBZonesWADJ; plug-in component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

# ----
# 05.HBZONE FORMATION
# FORENERGYMODELING
# HBzone
# Formation
merge_161 = Merge(Data1=solveadjc.HBZonesWADJ, Data2=mass2zone.HBZones)  # -> flatten(Result)
null_10 = NullItem(Item=merge_161)  # -> flatten(NullFlags), InvalidFlags, Description
dispatch_56 = Dispatch(List=merge_161, DispatchPattern=null_10.NullFlags)  # -> ListA, flatten(ListB)
solveadjc_2 = Honeybee_SolveAdjacencies(HBZones=flatten(dispatch_56.ListB), altBC="Adiabatic", removeCurrentAdjc=False, findAdjc=Toggle(True))  # -> readMe, HBZonesWADJ; plug-in component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

conditionedunconditioned = Honeybee_SeparateConditionedAndUnconditionedZones(HBZones=flatten(solveadjc_2.HBZonesWADJ))  # -> conditionedZones, unconditionedZones; plug-in component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
glazingcreator = Honeybee_GlazingBasedOnRatio(
    HBObjects=conditionedunconditioned.conditionedZones,
    glzRatio=weave_20,
    breakUpWindow=toggle_38,
    EPConstructions=epconstruction_2,
    runIt=Toggle(True))  # -> readMe, HBObjWGLZ; plug-in component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

geo_87 = Geometry(glazingcreator.HBObjWGLZ)

dispatch_57 = Dispatch(List=geo_87, DispatchPattern=equals_36.Equality)  # -> ListA, ListB

dispatch_58 = Dispatch(List=geo_87, DispatchPattern=equals_37.Equality)  # -> ListA, ListB; disabled

dispatch_59 = Dispatch(List=geo_87, DispatchPattern=equals_38.Equality)  # -> ListA, ListB

data_200 = Data(dispatch_59.ListB)
item_227 = ListItem(List=geo_87, Index=data_200, Wrap=True)

lng_96 = ListLength(List=item_227)

lng_97 = ListLength(List=item_227)

multiplication_19 = Multiplication(A="5", B=lng_96)
dup_144 = DuplicateData(Data="18", Number=multiplication_19, Order=True)
partition_52 = PartitionList(List=dup_144, Size="5")  # -> simplify(Chunks)

# ----
# .csv recordings
dup_145 = DuplicateData(Data="21.1", Number=lng_97, Order=True)

merge_162 = Merge(Data1=simplify(partition_52), Data2=simplify(partition_46))

data_201 = Data(flatten(partition_49))
tmatch = MatchText(Text=data_201, Pattern=panel_535, Case=True)
dispatch_60 = Dispatch(List=glazingcreator.HBObjWGLZ, DispatchPattern=tmatch)  # -> ListA, ListB

dup_146 = DuplicateData(Data=merge_162, Number=365, Order=True)  # -> simplify(Data)
csvschedule_2 = Honeybee_CreateCSVSchedule(values=dup_146, units="Temperature", scheduleName=simplify(graft(join_37)), writeFile=toggle_39)  # -> readMe, flatten(csvSchedule); disabled; plug-in component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

# ----
# RESIDENTIAL UNITS
debrep_17 = DeconstructBrep(Brep=dispatch_60.ListA)  # -> Faces, Edges, Vertices
item_228 = ListItem(List=debrep_17.Faces, Index=0, Wrap=True)  # -> flatten(Item)
area_65 = Area(Geometry=item_228)  # -> Area, Centroid
sort_25 = SortList(Keys=area_65.Area)  # -> Keys, ValuesA
dcon_8 = DeleteConsecutive(Set=sort_25.Keys, Wrap=False)  # -> Set, Count
mindex_8 = MemberIndex(Set=area_65.Area, Member=graft(dcon_8.Set))  # -> simplify(Index), Count

lng_98 = ListLength(List=item_227)

dup_147 = DuplicateData(Data=annualschedule_26.schedule, Number=lng_98, Order=True)

# ----
# Versions
weave_51 = Weave(Pattern=list, Stream0=dup_145, Stream1=data_149, Stream2=dup_145, Stream3=data_149, NullGaps=False)

weave_52 = Weave(Pattern=list, Stream0=dup_147, Stream1=item_201, Stream2=dup_147, Stream3=item_201, NullGaps=False)

# ----
# Group the residential Units according to their floor area
item_229 = ListItem(List=area_65.Area, Index=mindex_8.Index, Wrap=True)

item_230 = ListItem(List=item_229, Index=0, Wrap=True)
lng_99 = ListLength(List=item_230)
dup_148 = DuplicateData(Data=panel_253, Number=lng_99, Order=True)  # -> simplify(Data)
partition_53 = PartitionList(List=dup_148, Size=lng_87)  # -> simplify(Chunks)
tstat_20 = TreeStatistics(Tree=partition_53)  # -> Paths, Length, Count
tstat_21 = TreeStatistics(Tree=item_230)  # -> Paths, Length, Count
# Statistically Unit Grouping
# Matching Unit Floor Area &
# Occupant Profile Combinations
replace_23 = ReplacePaths(Data=partition_53, Search=tstat_20.Paths, Replace=tstat_21.Paths)
# based on hepsiemlak.com
subtraction_11 = Subtraction(A=item_230, B=replace_23)
abs_5 = Absolute(Value=subtraction_11)
listdexs_8 = ListIndices(List=abs_5)
sort_26 = SortList(Keys=abs_5, ValuesA=listdexs_8)  # -> Keys, ValuesA
item_231 = ListItem(List=sort_26.ValuesA, Index=0, Wrap=True)
lng_100 = ListLength(List=item_229)
dup_149 = DuplicateData(Data=item_231, Number=lng_100, Order=True)  # -> simplify(Data)

# ----
# AS-IS V2
# OCCUPANCY
# SCHEDULES
weave_53 = Weave(
    Pattern=dup_149,
    Stream0=jitter_32.Values,
    Stream1=jitter_31.Values,
    Stream2=jitter_29.Values,
    Stream3=jitter_28.Values,
    Stream4=jitter_30.Values,
    NullGaps=False)

lng_101 = ListLength(List=dup_149)  # -> simplify(Length)
series_49 = Series(Start=0, Step=1, Count=lng_101)
item_232 = ListItem(List=simplify(weave_53), Index=simplify(series_49), Wrap=True)  # -> simplify(Item)

lng_102 = ListLength(List=item_232)
dup_150 = DuplicateData(Data=getepschedules_4.occupancySchedule, Number=lng_102, Order=True)
weave_54 = Weave(Pattern=list, Stream0=simplify(dup_150), Stream1=item_232, Stream2=dup_150, Stream3=item_232, NullGaps=False)

item_233 = ListItem(List=data_114, Index=data_200, Wrap=True)

data_202 = Data(weave_54)

equals_48 = Equality(FirstNumber=item_233, SecondNumber=panel_550)  # -> Equality, Inequality
dispatch_61 = Dispatch(List=weave_52, DispatchPattern=equals_48.Equality)  # -> ListA, ListB

# ----
# RESIDENTIAL
# COOLING-OFF
# UNITS
setepnatvent = Honeybee_SetEPAirFlow(
    HBZones=flatten(dispatch_57.ListA),
    naturalVentilationType="1",
    minIndoorTempForNatVent="24.0",
    minOutdoorTempForNatVent="12",
    deltaTempForNatVent=panel_257,
    fractionOfGlzAreaOperable="0.4",
    windDrivenCrossVent=Toggle(False))  # -> readMe, simplify(HBZones); plug-in component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
setepzoneschedules = Honeybee_SetEnergyPlusZoneSchedules(
    HBZones=setepnatvent.HBZones,
    heatingSetPtSchedules=dispatch_61.ListB,
    coolingSetPtSchedules=annualschedule_24.schedule,
    lightingSchedules=item_49)  # -> schedules, simplify(flatten(HBZones)); plug-in component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

split_23 = TextSplit(Text=flatten(data_202), Separators="_")  # -> simplify(Result)
python_41 = GhPythonScript(x=split_23, A=panel_266)  # -> out, a
# ---------- python_41: Python ----------
__author__ = "orcun"
__version__ = "2021.11.30"

import rhinoscriptsyntax as rs
if x == A:
    a = 0
else:
    a = 1
# ---------- end python_41 ----------
sort_27 = SortList(Keys=python_41.a)  # -> Keys, ValuesA
item_234 = ListItem(List=sort_27.Keys, Index=0, Wrap=True)  # -> flatten(Item)
lng_103 = ListLength(List=data_202)

setepnatvent_2 = Honeybee_SetEPAirFlow(
    HBZones=flatten(dispatch_59.ListA),
    naturalVentilationType="1",
    minIndoorTempForNatVent="24.0",
    maxIndoorTempForNatVent="25.0",
    minOutdoorTempForNatVent="12",
    deltaTempForNatVent="0.0",
    fractionOfGlzAreaOperable="0.4",
    windDrivenCrossVent=toggle_41)  # -> readMe, simplify(HBZones); plug-in component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
setepzoneschedules_2 = Honeybee_SetEnergyPlusZoneSchedules(
    HBZones=setepnatvent_2.HBZones,
    heatingSetPtSchedules=annualschedule_25.schedule,
    coolingSetPtSchedules=honeybee_seasonalschedule.schedule)  # -> schedules, simplify(HBZones); plug-in component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

item_235 = ListItem(List=cooling_set_points, Index=item_234, Wrap=True)  # -> simplify(graft(Item))
lng_104 = ListLength(List=item_235)
dup_151 = DuplicateData(Data="100", Number=lng_104, Order=True)
dup_152 = DuplicateData(Data=dup_151, Number="8", Order=True)  # -> simplify(Data)
dup_153 = DuplicateData(Data=item_235, Number="12", Order=True)  # -> simplify(Data)
dup_154 = DuplicateData(Data=dup_151, Number="4", Order=True)  # -> simplify(Data)
merge_163 = Merge(Data1=dup_152, Data2=dup_153, Data3=dup_154)

item_236 = ListItem(List=heating_set_points_name, Index=item_234, Wrap=True)  # -> simplify(graft(Item))
lng_105 = ListLength(List=item_236)
dup_155 = DuplicateData(Data="CoolResidential", Number=lng_105, Order=True)  # -> simplify(Data)
merge_164 = Merge(Data1=dup_155, Data2=item_236)
join_40 = TextJoin(Text=merge_164, Join="_")

item_237 = ListItem(List=heating_set_points, Index=item_234, Wrap=True)  # -> simplify(graft(Item))
lng_106 = ListLength(List=item_237)
dup_156 = DuplicateData(Data="18", Number=lng_106, Order=True)
dup_157 = DuplicateData(Data=dup_156, Number="7", Order=True)  # -> simplify(Data)
dup_158 = DuplicateData(Data=item_237, Number="17", Order=True)  # -> simplify(Data)
merge_165 = Merge(Data1=dup_157, Data2=dup_158)

item_238 = ListItem(List=heating_set_points_name, Index=item_234, Wrap=True)  # -> simplify(graft(Item))
lng_107 = ListLength(List=item_238)
dup_159 = DuplicateData(Data="HEATSET", Number=lng_107, Order=True)  # -> simplify(Data)
merge_166 = Merge(Data1=dup_159, Data2=item_238)
join_41 = TextJoin(Text=merge_166, Join="_")

# ----
# indices
# of
# residential non-cooling
listdexs_9 = ListIndices(List=geo_87)
dispatch_62 = Dispatch(List=listdexs_9, DispatchPattern=equals_36.Equality)  # -> ListA, ListB

# ----
# geometry of residential non-cooling
geo_88 = Geometry(setepzoneschedules.HBZones)

replace_24 = ReplaceItems(List=data_115, Item=geo_88, Indices=dispatch_62.ListA, Wrap=False)

annualschedule_70 = Honeybee_AnnualSchedule(
    sun=merge_163,
    mon=merge_163,
    tue=merge_163,
    wed=merge_163,
    thu=merge_163,
    fri=merge_163,
    sat=merge_163,
    scheduleName="COOL-ON-SCHEDULE",
    schedTypeLimits="Temperature",
    runIt=toggle_43)  # -> readMe, port, schedule, port_2, weekSched, schedIDFText; plug-in component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
honeybee_seasonalschedule_2 = Honeybee_SeasonalSchedule(
    scheduleName=join_40,
    schedTypeLimits="Temperature",
    baseWeekSched=annualschedule_68.weekSched,
    seasonWeekSched1=annualschedule_70.weekSched,
    analysisPeriod1=analysisperiod_7.analysisPeriod)  # -> readMe, flatten(schedule), schedIDFText; plug-in component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

# ----
# indices
# of
# residential cooling
listdexs_10 = ListIndices(List=geo_87)
dispatch_63 = Dispatch(List=listdexs_10, DispatchPattern=equals_37.Equality)  # -> ListA, ListB

annualschedule_71 = Honeybee_AnnualSchedule(
    sun=merge_165,
    mon=merge_165,
    tue=merge_165,
    wed=merge_165,
    thu=merge_165,
    fri=merge_165,
    sat=merge_165,
    scheduleName=simplify(graft(join_41)),
    schedTypeLimits=panel_552,
    runIt=Toggle(True))  # -> readMe, port, flatten(schedule), port_2, simplify(weekSched), schedIDFText; plug-in component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
partition_54 = PartitionList(List=annualschedule_71.schedule, Size=flatten(lng_103))  # -> simplify(Chunks); disabled

partition_55 = PartitionList(List=honeybee_seasonalschedule_2.schedule, Size=flatten(lng_103))  # -> simplify(Chunks); disabled

data_203 = Data(dup_149)  # disabled

# ----
# AS-IS V2
# # OF PEOPLE IN THE
# RESIDENTIAL UNIT
weave_55 = Weave(
    Pattern=data_203,
    Stream0=jitter_37.Values,
    Stream1=jitter_36.Values,
    Stream2=jitter_34.Values,
    Stream3=jitter_35.Values,
    Stream4=jitter_33.Values,
    NullGaps=False)  # disabled

# ----
# Group the residential Units according to their floor area
data_204 = Data(item_229)  # disabled

lng_108 = ListLength(List=item_227)

lng_109 = ListLength(List=data_203)  # -> simplify(Length); disabled
series_50 = Series(Start=0, Step=1, Count=lng_109)  # disabled
# x
# x
# x
# x
# x
# x
# x
# x
# x
# x
# x
# x
# x
# x
# x
# x
# x
# x
# x
# x
# x
# x
# x
# x
# x
# x
# x
# 
# x
# x
# x
# x
# x
# x
# 
# x
# x
# x
# x
# x
# 
# x
# x
# x
# x
# x
# x
# 
# x
# x
# x
# x
# x
# x
# x
# x
# x
# x
# x
# x
# x
# x
# x
# x
# x
# x
# x
# x
# x
# x
# x
# x
# x
# x
# x
# x
# x
# x
# x
# 
# x
# x
# x
# x
# x
# x
# 
# x
# x
# x
# x
# x
# 
# x
# x
# x
# x
# x
# x
# 
# x
# x
# x
# x
item_239 = ListItem(List=simplify(weave_55), Index=series_50, Wrap=True)  # -> simplify(Item); disabled

# ----
# # of people per unit
data_205 = Data(item_239)  # disabled

conditionedunconditioned_2 = Honeybee_SeparateConditionedAndUnconditionedZones(HBZones=flatten(solveadjc.HBZonesWADJ))  # -> conditionedZones, unconditionedZones; plug-in component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

# ----
# #of people per unit
division_18 = Division(A=data_205, B=data_204)  # disabled

# ----
# indices of all residentials
listdexs_11 = ListIndices(List=geo_87)
dispatch_64 = Dispatch(List=listdexs_11, DispatchPattern=equals_38.Equality)  # -> ListA, ListB

lng_110 = ListLength(List=item_227)
dup_160 = DuplicateData(Data=geteploads_2.equipmentLoadPerArea, Number=lng_110, Order=True)

lng_111 = ListLength(List=item_227)

dup_161 = DuplicateData(Data=data_184, Number=lng_111, Order=True)

weave_56 = Weave(
    Pattern=list,
    Stream0=dup_161,
    Stream1=flatten(data_150),
    Stream2=flatten(dup_161),
    Stream3=flatten(data_150),
    NullGaps=False)

# ----
# equipmentDensity
weave_57 = Weave(
    Pattern=list,
    Stream0=dup_160,
    Stream1=flatten(data_151),
    Stream2=flatten(dup_160),
    Stream3=flatten(data_151),
    NullGaps=False)

# ----
# scheduleRecord
# Occ
data_206 = Data(flatten(weave_54))  # disabled
rec = DataRecorder(data_206, DataLimit=-10, RecordData=True)  # disabled
panel_654 = Panel(rec)  # disabled

# ----
# indices of all residentials
listdexs_12 = ListIndices(List=geo_87)
dispatch_65 = Dispatch(List=listdexs_12, DispatchPattern=equals_38.Equality)  # -> ListA, ListB

# ----
# Heating set point of Residentials
data_207 = Data(weave_51)

# ----
# LightingDensity of
# residential Units (kWh/sqm)
data_208 = Data(weave_56)

replace_25 = ReplaceItems(List=data_140, Item=data_139, Indices=dispatch_65.ListA, Wrap=False)
replace_26 = ReplaceItems(List=replace_25, Item=data_207, Indices=dispatch_65.ListB, Wrap=False)

# ----
# Occ
data_209 = Data(flatten(weave_54))

# ----
# Heating Set Point
panel_655 = Panel("cullOfficeUnits")
equals_49 = Equality(FirstNumber=data_126, SecondNumber="1")  # -> Equality, Inequality
dispatch_66 = Dispatch(List=replace_26, DispatchPattern=equals_49.Equality)  # -> ListA, ListB

setepnatvent_3 = Honeybee_SetEPAirFlow(
    HBZones=flatten(dispatch_58.ListA),
    naturalVentilationType=panel_261,
    minIndoorTempForNatVent=panel_263,
    maxIndoorTempForNatVent=panel_260,
    minOutdoorTempForNatVent=panel_264,
    deltaTempForNatVent=panel_262,
    fractionOfGlzAreaOperable=panel_265,
    windDrivenCrossVent=toggle_42)  # -> readMe, simplify(HBZones); disabled; plug-in component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

gethbzoneepschedules = Honeybee_GetZoneEnergyPlusSchedules(HBZone=setepnatvent_3.HBZones)  # -> occupancySchedule, occupancyActivitySch, heatingSetPtSchedule, coolingSetPtSchedule, lightingSchedule, equipmentSchedule, infiltrationSchedule; disabled; plug-in component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
item_240 = ListItem(List=gethbzoneepschedules.occupancySchedule, Index=0, Wrap=True)  # disabled
convertepschvalues_4 = Honeybee_ConvertEnergyPlusScheduleToValues(schName=item_240)  # -> values, holidays; disabled; plug-in component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
strnum_6 = Ladybug_SeparateData(inputList=flatten(convertepschvalues_4.values))  # -> numbers, strings; disabled; plug-in component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
python_42 = GhPythonScript(x=strnum_6.numbers, y=lb_schedule_4)  # -> out, a; disabled
# ---------- python_42: Python ----------
__author__ = "Siser"
__version__ = "2022.03.07"

import rhinoscriptsyntax as rs
if x>0:
    a=y
else:
    a=100
# ---------- end python_42 ----------
annualschedule_72 = Honeybee_AnnualSchedule(
    sun=python_42.a,
    mon=python_42.a,
    tue=python_42.a,
    wed=python_42.a,
    thu=python_42.a,
    fri=python_42.a,
    sat=python_42.a,
    scheduleName=panel_541,
    schedTypeLimits=panel_542,
    runIt=toggle_40)  # -> readMe, port, schedule, port_2, weekSched, schedIDFText; disabled; plug-in component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
honeybee_seasonalschedule_3 = Honeybee_SeasonalSchedule(
    scheduleName=panel_546,
    schedTypeLimits=panel_542,
    baseWeekSched=annualschedule_37.weekSched,
    seasonWeekSched1=annualschedule_72.weekSched,
    analysisPeriod1=analysisperiod_6.analysisPeriod)  # -> readMe, schedule, schedIDFText; disabled; plug-in component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

setepzoneschedules_3 = Honeybee_SetEnergyPlusZoneSchedules(
    HBZones=setepnatvent_3.HBZones,
    heatingSetPtSchedules=weave_52,
    coolingSetPtSchedules=honeybee_seasonalschedule_3.schedule,
    lightingSchedules=item_49)  # -> schedules, simplify(HBZones); disabled; plug-in component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

# ----
# geometry of residential cooling
geo_89 = Geometry(setepzoneschedules_3.HBZones)

# ----
# merge residential units
# (i.e., cooling, non-cooling)
# index-based
replace_27 = ReplaceItems(List=replace_24, Item=geo_89, Indices=dispatch_63.ListA, Wrap=False)

dispatch_67 = Dispatch(List=replace_27, DispatchPattern=data_180)  # -> ListA, ListB

null_11 = NullItem(Item=dispatch_67.ListB)  # -> NullFlags, InvalidFlags, Description
dispatch_68 = Dispatch(List=dispatch_67.ListB, DispatchPattern=null_11.NullFlags)  # -> ListA, ListB

ach2m3_s_m2_calculator_2 = Honeybee_infORventPerAreaCalculator(HBZones=flatten(dispatch_68.ListB), airFlowRate=weave_34, ACHorM3sM2=Toggle(False))  # -> readMe, infPerAreaFacade, ventPerAreaFloor, allExposed, allFloors; plug-in component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

ach2m3_s_m2_calculator_3 = Honeybee_infORventPerAreaCalculator(HBZones=flatten(dispatch_68.ListB), airFlowRate="0.5", ACHorM3sM2=boolean_toggle_2)  # -> readMe, infPerAreaFacade, ventPerAreaFloor, allExposed, allFloors; plug-in component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

setepzoneloads = Honeybee_SetEnergyPlusZoneLoads(
    HBZones=setepzoneschedules_2.HBZones,
    equipmentLoadPerArea=geteploads.equipmentLoadPerArea,
    infilRatePerArea_Facade=ach2m3_s_m2_calculator_2.infPerAreaFacade,
    lightingDensityPerArea=geteploads.lightingDensityPerArea,
    numOfPeoplePerArea=geteploads.numOfPeoplePerArea,
    ventilationPerArea=geteploads.ventilationPerArea,
    ventilationPerPerson=geteploads.ventilationPerPerson,
    recirculatedAirPerArea=panel_555)  # -> loads, flatten(HBZones); plug-in component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

lng_112 = ListLength(List=dispatch_68.ListB)

# ----
# # of people
dup_162 = DuplicateData(Data=geteploads_2.numOfPeoplePerArea, Number=lng_112, Order=True)
weave_58 = Weave(
    Pattern=list,
    Stream0=dup_162,
    Stream1=flatten(branch_18),
    Stream2=flatten(dup_162),
    Stream3=flatten(branch_18),
    NullGaps=False)

# ----
# RESIDENTIAL UNITS
setepzoneloads_2 = Honeybee_SetEnergyPlusZoneLoads(
    HBZones=dispatch_68.ListB,
    equipmentLoadPerArea=weave_57,
    infilRatePerArea_Facade=ach2m3_s_m2_calculator_2.infPerAreaFacade,
    lightingDensityPerArea=weave_56,
    numOfPeoplePerArea=weave_58,
    ventilationPerArea=ach2m3_s_m2_calculator_3.ventPerAreaFloor,
    ventilationPerPerson=panel_280,
    recirculatedAirPerArea="0")  # -> loads, flatten(HBZones); plug-in component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

replace_28 = ReplaceItems(List=data_183, Item=setepzoneloads_2.HBZones, Indices=dispatch_64.ListB, Wrap=False)
replace_29 = ReplaceItems(List=replace_28, Item=setepzoneloads.HBZones, Indices=dispatch_64.ListA, Wrap=False)

# ----
# exclude intersected surface's zone
# 
# merge all units
# - unconditioned units are always at the end
merge_167 = Merge(Data1=flatten(replace_29), Data2=flatten(conditionedunconditioned_2.unconditionedZones))
null_12 = NullItem(Item=merge_167)  # -> NullFlags, InvalidFlags, Description
dispatch_69 = Dispatch(List=merge_167, DispatchPattern=null_12.NullFlags)  # -> ListA, ListB

dispatch_70 = Dispatch(List=dispatch_69.ListB, DispatchPattern=equals_39.Equality)  # -> ListA, ListB

# ----
# if buildings' construction type concrete
geo_90 = Geometry(dispatch_70.ListB)

# ----
# if buildings' construction type masonry
geo_91 = Geometry(dispatch_70.ListA)

# ----
# V1-Masonry Construction Set
# V1-Concrete Construction Set
setepzonecnstr = Honeybee_SetEPZoneConstruction(HBZones=flatten(geo_91), wallEPConstruction=epconstruction_5, roofEPConstruction=epconstruction_7)  # -> simplify(modifiedHBZones); plug-in component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
setepzonecnstr_2 = Honeybee_SetEPZoneConstruction(HBZones=flatten(geo_90), wallEPConstruction=epconstruction_4, roofEPConstruction=epconstruction_3)  # -> simplify(modifiedHBZones); plug-in component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
merge_168 = Merge(Data1=setepzonecnstr, Data2=setepzonecnstr_2)  # -> flatten(Result)
null_13 = NullItem(Item=merge_168)  # -> NullFlags, InvalidFlags, Description
dispatch_71 = Dispatch(List=merge_168, DispatchPattern=null_13.NullFlags)  # -> ListA, ListB
setepzoneundergroundcnstr = Honeybee_SetEPZoneUndergroundConstruction(HBZones=dispatch_71.ListB, groundFloorEPConstruction=epconstruction_6)  # -> simplify(modifiedHBZones); plug-in component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
setepzoneintcnstr = Honeybee_SetEPZoneInteriorConstruction(HBZones=setepzoneundergroundcnstr, intWallEPConstruction=epconstruction)  # -> simplify(modifiedHBZones); plug-in component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
conditionedunconditioned_3 = Honeybee_SeparateConditionedAndUnconditionedZones(HBZones=flatten(setepzoneintcnstr))  # -> conditionedZones, unconditionedZones; plug-in component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

conditionedunconditioned_4 = Honeybee_SeparateConditionedAndUnconditionedZones(HBZones=flatten(dispatch_71.ListB))  # -> conditionedZones, unconditionedZones; plug-in component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

lng_113 = ListLength(List=dispatch_71.ListB)
data_210 = Data(filename)
dup_163 = DuplicateData(Data=data_210, Number=lng_113, Order=True)
rec_2 = DataRecorder(dup_163, DataLimit=-10, RecordData=True)
panel_656 = Panel(rec_2)

# ----
# 10.RESULT RECORDINGS
# AVERAGE
# # of people per building
avr_5 = Average(Input=flatten(weave_58))  # disabled
data_211 = Data(avr_5)  # disabled
rec_3 = DataRecorder(data_211, DataLimit=-10, RecordData=True)  # disabled
panel_657 = Panel(rec_3)  # disabled

# ----
# # of people per sqm at unit
data_212 = Data(flatten(weave_58))  # disabled
rec_4 = DataRecorder(data_212, DataLimit=-10, RecordData=True)  # disabled
panel_658 = Panel(rec_4)  # disabled

# ----
# UNITS
data_213 = Data(flatten(weave_58))

# ----
# residential: # of people per sqm
data_214 = Data(weave_58)

debrep_18 = DeconstructBrep(Brep=conditionedunconditioned_3.conditionedZones)  # -> Faces, Edges, Vertices
item_241 = ListItem(List=debrep_18.Faces, Index=0, Wrap=True)  # -> simplify(graft(Item))
evalsrf_4 = EvaluateSurface(Surface=item_241, Point=md_slider_7)  # -> Point, Normal, UDirection, VDirection, Frame
brec_9 = BoundingRectangle(Geometry=item_241, Plane=evalsrf_4.Frame, Axis=0, Slide=0, Union=True)  # -> Bounding, DimensionX, DimensionY
debrep_19 = DeconstructBrep(Brep=brec_9.Bounding)  # -> Faces, Edges, Vertices
shift_5 = ShiftList(List=debrep_19.Edges, Shift=1, Wrap=True)
item_242 = ListItem(List=debrep_19.Edges, Index=panel_576, Wrap=True)  # -> simplify(Item)
item_243 = ListItem(List=shift_5, Index=panel_576, Wrap=True)  # -> simplify(Item)
curvepoint_6 = PointOnCurve(item_242, parameter=0.5)
curvepoint_7 = PointOnCurve(item_243, parameter=0.5)
item_244 = ListItem(List=curvepoint_6, Index=1, Wrap=True)
item_245 = ListItem(List=curvepoint_7, Index=0, Wrap=True)
item_246 = ListItem(List=curvepoint_7, Index=1, Wrap=True)
item_247 = ListItem(List=curvepoint_6, Index=0, Wrap=True)
ln_3 = Line(StartPoint=item_245, EndPoint=item_246)  # -> simplify(Line)
ln_4 = Line(StartPoint=item_247, EndPoint=item_244)  # -> simplify(Line)
len_3 = Length(Curve=ln_3)  # -> simplify(Length)
len_4 = Length(Curve=ln_4)
division_19 = Division(A=simplify(len_3), B="2")  # -> simplify(Result)

tstat_22 = TreeStatistics(Tree=simplify(len_4))  # -> Paths, Length, Count
tstat_23 = TreeStatistics(Tree=simplify(division_19))  # -> Paths, Length, Count
replace_30 = ReplacePaths(Data=division_19, Search=tstat_23.Paths, Replace=tstat_22.Paths)

merge_169 = Merge(Data1=simplify(len_4), Data2=simplify(replace_30))  # -> simplify(Result)
ma_10 = MassAddition(Input=merge_169)  # -> Result, PartialResults
multiplication_20 = Multiplication(A=ma_10.Result, B=floor_height_6)  # -> flatten(Result)

# ----
# internal Mass Added Units
addinternalmass = Honeybee_AddInternalMassToZone(HBZones=conditionedunconditioned_3.conditionedZones, srfsOrSrfArea=multiplication_20, EPConstruction=epconstruction)  # -> readMe, HBZones; plug-in component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
merge_170 = Merge(Data1=flatten(addinternalmass.HBZones), Data2=flatten(conditionedunconditioned_3.unconditionedZones))

null_14 = NullItem(Item=merge_170)  # -> NullFlags, InvalidFlags, Description
dispatch_72 = Dispatch(List=merge_170, DispatchPattern=null_14.NullFlags)  # -> ListA, ListB

geo_92 = Geometry(dispatch_72.ListB)  # disabled
volume_3 = Volume(Geometry=geo_92)  # -> Volume, Centroid; disabled
pdecon_13 = Deconstruct(Point=volume_3.Centroid)  # -> XComponent, YComponent, ZComponent; disabled
sort_28 = SortList(Keys=pdecon_13.ZComponent, ValuesA=geo_92)  # -> Keys, ValuesA; disabled

# ----
# sort conditioned zones according to z-axis value
# # of unit per floor
lng_114 = ListLength(List=sort_28.ValuesA)  # disabled
division_20 = Division(A=lng_114, B=lng_95)  # disabled
partition_56 = PartitionList(List=sort_28.ValuesA, Size=division_20)  # -> simplify(Chunks); disabled

volume_4 = Volume(Geometry=partition_56)  # -> Volume, Centroid; disabled
area_66 = Area(Geometry=geo_74)  # -> Area, Centroid; disabled
circle_3 = CircleCNR(Center=area_66.Centroid, Normal=Vector(0, 0, 1), Radius=1)  # disabled
alongcrv_2 = SortAlongCurve(Points=volume_4.Centroid, Curve=circle_3)  # -> Points, simplify(Indices); disabled

# ----
# start bottom-left
# return counter clockwise
item_248 = ListItem(List=partition_56, Index=alongcrv_2.Indices, Wrap=True)  # disabled

volume_5 = Volume(Geometry=item_248)  # -> Volume, Centroid; disabled
pdecon_14 = Deconstruct(Point=volume_5.Centroid)  # -> XComponent, YComponent, ZComponent; disabled
addition_8 = Addition(A=pdecon_14.XComponent, B=pdecon_14.YComponent)  # disabled
sort_29 = SortList(Keys=addition_8, ValuesA=volume_5.Centroid)  # -> Keys, ValuesA; disabled
item_249 = ListItem(List=sort_29.ValuesA, Index=0, Wrap=True)  # -> simplify(Item); disabled

lng_115 = ListLength(List=item_248)  # disabled
branch_29 = TreeBranch(Tree=simplify(item_248), Path=panel_586, MaintainPaths=True)  # disabled
python_43 = GhPythonScript(x=lng_115)  # -> out, a; disabled
# ---------- python_43: Python ----------
__author__ = "orcun"
__version__ = "2022.03.23"

import rhinoscriptsyntax as rs
if x == 1:
    a = 1
else:
    a = 0
# ---------- end python_43 ----------
weave_59 = Weave(Pattern=python_43.a, Stream0=branch_29, Stream1=item_248, NullGaps=False)  # disabled

lng_116 = ListLength(List=item_249)  # disabled
branch_30 = TreeBranch(Tree=item_249, Path=panel_587, MaintainPaths=True)  # disabled
python_44 = GhPythonScript(x=lng_116)  # -> out, a; disabled; same code as python_43
weave_60 = Weave(Pattern=python_44.a, Stream0=branch_30, Stream1=item_249, NullGaps=False)  # disabled

volume_6 = Volume(Geometry=weave_59)  # -> Volume, Centroid; disabled
cp_6 = ClosestPoint(Point=weave_60, Cloud=volume_6.Centroid)  # -> ClosestPoint, CPIndex, Distance; disabled

# ----
# start bottom-left
# return counter clockwise
shift_6 = ShiftList(List=item_248, Shift=cp_6.CPIndex, Wrap=True)  # disabled

merge_171 = Merge(Data1=flatten(shift_6), Data2=conditionedunconditioned_3.unconditionedZones)  # -> flatten(Result); disabled

conditionedunconditioned_5 = Honeybee_SeparateConditionedAndUnconditionedZones(HBZones=flatten(dispatch_72.ListB))  # -> conditionedZones, unconditionedZones; disabled; plug-in component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

conditionedunconditioned_6 = Honeybee_SeparateConditionedAndUnconditionedZones(HBZones=flatten(dispatch_72.ListB))  # -> conditionedZones, unconditionedZones; disabled; plug-in component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

conditionedunconditioned_7 = Honeybee_SeparateConditionedAndUnconditionedZones(HBZones=flatten(dispatch_72.ListB))  # -> simplify(conditionedZones), unconditionedZones; plug-in component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
decomposebytype = Honeybee_DecomposeBasedOnType(HBZone=conditionedunconditioned_7.conditionedZones)  # -> walls, interiorWalls, airWalls, simplify(windows), interiorWindows, skylights, simplify(roofs), simplify(ceilings)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; plug-in component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

data_215 = Data(conditionedunconditioned_7.conditionedZones)
decomposebytype_2 = Honeybee_DecomposeBasedOnType(HBZone=data_215)  # -> walls, interiorWalls, airWalls, simplify(windows), interiorWindows, skylights, simplify(roofs), simplify(ceilings)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; plug-in component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

area_67 = Area(Geometry=decomposebytype_2.windows)  # -> Area, Centroid
evalsrf_5 = EvaluateSurface(Surface=decomposebytype_2.windows, Point=area_67.Centroid)  # -> Point, Normal, UDirection, VDirection, Frame
vec = Vector(evalsrf_5.Normal)
vdis = VectorDisplay(Anchor=area_67.Centroid, Vector=vec)

area_68 = Area(Geometry=decomposebytype_2.windows)  # -> Area, Centroid
circle_4 = CircleCNR(Center=area_68.Centroid, Normal=vec, Radius=1)
rotate = RotateDirection(Geometry=circle_4, Center=area_68.Centroid, From=Vector(1, 0, 0), To=Vector(0, 1, 0))  # -> Geometry, Transform
line = LineSDL(Start=area_67.Centroid, Direction=vec, Length=1)
rotax = RotateAxis(Geometry=rotate.Geometry, Angle=degrees("90"), Axis=line)  # -> Geometry, Transform
area_69 = Area(Geometry=rotax.Geometry)  # -> Area, Centroid

srf_3 = Surface(decomposebytype_2.windows)
split_24 = SplitWithBreps(Curve=rotax.Geometry, Brep=srf_3)  # -> Curve, Points
divide_5 = DivideCurve(Curve=split_24.Curve, Count="13", Kinks=False)  # -> Points, Tangents, Parameters
pshift = ShiftPaths(Data=divide_5.Points, Offset=-1)
brepsinc = PointInBreps(Brep=conditionedunconditioned_7.conditionedZones, Point=pshift, Strict=False)  # -> Inside, Index
dispatch_73 = Dispatch(List=pshift, DispatchPattern=brepsinc.Inside)  # -> ListA, ListB

lng_117 = ListLength(List=flatten(conditionedunconditioned_7.conditionedZones))
dup_164 = DuplicateData(Data="0", Number=lng_117, Order=True)

lng_118 = ListLength(List=decomposebytype.roofs)  # -> flatten(Length)

lng_119 = ListLength(List=decomposebytype.groundFloors)  # -> flatten(Length)

dup_165 = DuplicateData(Data="0", Number=lng_119, Order=True)  # -> simplify(Data)
dup_166 = DuplicateData(Data="2", Number=lng_118, Order=True)  # -> simplify(Data)
merge_172 = Merge(Data1=dup_166, Data2=dup_165)

lng_120 = ListLength(List=merge_172)  # -> flatten(Length)
# position of units
# (0:base, 1: middle, 2:roof)
rep_2 = ReplaceText(Text=lng_120, Find="3", Replace="0", RecursiveReplace=False)
mindex_9 = MemberIndex(Set=rep_2, Member="0")  # -> Index, Count
lng_121 = ListLength(List=mindex_9.Index)
dup_167 = DuplicateData(Data="3", Number=lng_121, Order=True)
partition_57 = PartitionList(List=dup_167, Size="1")  # -> simplify(Chunks)
tstat_24 = TreeStatistics(Tree=partition_57)  # -> Paths, Length, Count
replace_31 = ReplacePaths(Data=partition_57, Search=tstat_24.Paths, Replace=mindex_9.Index)
python_45 = GhPythonScript(x=replace_31)  # -> out, a; inputs x: Int32
# ---------- python_45: Python ----------
__author__ = "Siser"
__version__ = "2022.03.02"

import rhinoscriptsyntax as rs
if x == 3:
    a = 1
else:
    pass
# ---------- end python_45 ----------

area_70 = Area(Geometry=decomposebytype.windows)  # -> Area, Centroid

panel_659 = Panel(area_68.Centroid)
pdecon_15 = Deconstruct(Point=panel_659)  # -> XComponent, YComponent, graft(ZComponent)
panel_660 = Panel(pdecon_15.ZComponent)

tstat_25 = TreeStatistics(Tree=area_70.Centroid)  # -> Paths, Length, Count
lng_122 = ListLength(List=tstat_25.Length)
dup_168 = DuplicateData(Data=series_46, Number=lng_122, Order=True)
partition_58 = PartitionList(List=dup_168, Size="4")  # -> simplify(Chunks)

geo_93 = Geometry(conditionedunconditioned_7.conditionedZones)

lng_123 = ListLength(List=dup_168)
dup_169 = DuplicateData(Data="5", Number=lng_123, Order=True)
partition_59 = PartitionList(List=dup_169, Size="4")  # -> simplify(Chunks)

debrep_20 = DeconstructBrep(Brep=geo_93)  # -> Faces, Edges, Vertices
item_250 = ListItem(List=debrep_20.Faces, Index=0, Wrap=True)
evalsrf_6 = EvaluateSurface(Surface=reparameterize(item_250), Point="{0.5, 0.5, 0}")  # -> Point, Normal, UDirection, VDirection, Frame
brec_10 = BoundingRectangle(Geometry=item_250, Plane=evalsrf_6.Frame, Axis=0, Slide=0, Union=True)  # -> Bounding, DimensionX, DimensionY

merge_173 = Merge(Data1=merge_172, Data2=python_45.a)  # -> flatten(Result)
panel_661 = Panel(merge_173)
null_15 = NullItem(Item=merge_173)  # -> NullFlags, InvalidFlags, Description
dispatch_74 = Dispatch(List=merge_173, DispatchPattern=null_15.NullFlags)  # -> ListA, ListB

debrep_21 = DeconstructBrep(Brep=brec_10.Bounding)  # -> Faces, simplify(Edges), Vertices
curvepoint_8 = PointOnCurve(debrep_21.Edges, parameter=0.5)
pdecon_16 = Deconstruct(Point=curvepoint_8)  # -> XComponent, YComponent, ZComponent
sort_30 = SortList(Keys=pdecon_16.YComponent, ValuesA=debrep_21.Edges)  # -> Keys, reverse(simplify(ValuesA))
item_251 = ListItem(List=sort_30.ValuesA, Index=0, Wrap=True)
item_252 = ListItem(List=sort_30.ValuesA, Index=1, Wrap=True)
len_5 = Length(Curve=item_251)
len_6 = Length(Curve=item_252)
division_21 = Division(A=len_5, B=len_6)  # -> flatten(Result)

geo_94 = Geometry(simplify(decomposebytype.walls))

geo_95 = Geometry(decomposebytype.roofs)

# ----
# volume of simulated unit
volume_7 = Volume(Geometry=conditionedunconditioned_7.conditionedZones)  # -> Volume, Centroid

merge_174 = Merge(Data1=geo_94, Data2=geo_95)
area_71 = Area(Geometry=merge_174)  # -> Area, Centroid
ma_11 = MassAddition(Input=area_71.Area)  # -> flatten(Result), PartialResults
division_22 = Division(A=ma_11.Result, B=volume_7.Volume)

panel_662 = Panel("simulation units")
geo_96 = Geometry(dispatch_72.ListB)

# ----
# IC
debrep_22 = DeconstructBrep(Brep=geo_96)  # -> Faces, Edges, Vertices
# 09.SIMULATION
area_72 = Area(Geometry=simplify(debrep_22.Faces))  # -> Area, Centroid
pdecon_17 = Deconstruct(Point=area_72.Centroid)  # -> XComponent, YComponent, ZComponent
sort_31 = SortList(Keys=pdecon_17.ZComponent)  # -> Keys, ValuesA
dcon_9 = DeleteConsecutive(Set=sort_31.Keys, Wrap=False)  # -> Set, Count
item_253 = ListItem(List=dcon_9.Set, Index=0, Wrap=True)
equals_50 = Equality(FirstNumber=pdecon_17.ZComponent, SecondNumber=item_253)  # -> Equality, Inequality
dispatch_75 = Dispatch(List=simplify(debrep_22.Faces), DispatchPattern=simplify(equals_50.Equality))  # -> ListA, ListB
sunion_5 = SolidUnion(Breps=dispatch_75.ListA)
disc_21 = Discontinuity(Curve=sunion_5, Level=1)  # -> Points, Parameters
pline_10 = PolyLine(Vertices=disc_21.Points, Closed=Toggle(True))  # -> flatten(Polyline)

panel_663 = Panel("conditioned HBzones")
geo_97 = Geometry(conditionedunconditioned_7.conditionedZones)

decomposebytype_3 = Honeybee_DecomposeBasedOnType(HBZone=geo_96)  # -> simplify(walls), interiorWalls, airWalls, simplify(windows), interiorWindows, skylights, simplify(roofs), simplify(ceilings)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; plug-in component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
preview_21 = CustomPreview(Geometry=decomposebytype_3.windows, Material=ColourSwatch(SwatchColor=RGB(0, 72, 255)))
preview_22 = CustomPreview(Geometry=decomposebytype_3.floors, Material=ColourSwatch(SwatchColor=RGB(48, 191, 0)))
preview_23 = CustomPreview(Geometry=decomposebytype_3.walls, Material=ColourSwatch(SwatchColor=RGBA(236, 255, 23, 138)))
preview_24 = CustomPreview(Geometry=decomposebytype_3.roofs, Material=ColourSwatch(SwatchColor=RGBA(191, 89, 0, 174)))
preview_25 = CustomPreview(Geometry=decomposebytype_3.interiorWalls, Material=ColourSwatch(SwatchColor=RGB(121, 0, 191)))
preview_26 = CustomPreview(Geometry=decomposebytype_3.groundFloors, Material=ColourSwatch(SwatchColor=RGB(0, 0, 0)))

zoneattributelist = Honeybee_ZoneAttributeList({"Name": "name", "Zone Program": "zoneProgram", "Zone Floor Area": "zoneFloorArea", "Zone Volume": "zoneVolume", "Building Program": "bldgProgram", "Is Conditioned": "isConditioned", "HVAC System Type": "HVACSystem", "Occupancy Schedule": "occupancySchedule", "Occupancy Activity Schedule": "occupancyActivitySch", "Heating SetPoint Schedule": "heatingSetPtSchedule"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}, selected="Name")
labelzones = Honeybee_LabelZones(HBZones=flatten(geo_96), attribute=zoneattributelist)  # -> zoneTxtLabels, labelBasePts, brepTxtLabels, zoneWireFrames; plug-in component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

debrep_23 = DeconstructBrep(Brep=geo_97)  # -> Faces, Edges, Vertices
item_254 = ListItem(List=debrep_23.Faces, Index=0, Wrap=True)

panel_664 = Panel("simulated units")
geo_98 = Geometry(conditionedunconditioned_7.conditionedZones)

area_73 = Area(Geometry=item_254)  # -> simplify(flatten(Area)), Centroid

# ----
# total # of residential units
lng_124 = ListLength(List=geo_96)  # disabled

# ----
# total # of residential units
lng_125 = ListLength(List=geo_96)  # disabled

lng_126 = ListLength(List=conditionedunconditioned_7.unconditionedZones)  # disabled
# extract unConditioned Zones
panel_666 = Panel("1")  # disabled
series_51 = Series(Start=panel_666, Step=1, Count=lng_126)  # disabled
neg_2 = Negative(Value=series_51)  # disabled

# ----
# If there is a single unit in the building
lng_127 = ListLength(List=geo_96)
equals_51 = Equality(FirstNumber=lng_127, SecondNumber="2")  # -> Equality, Inequality
data_216 = Data(flatten(dispatch_74.ListB))
python_46 = GhPythonScript(x=equals_51.Equality)  # -> out, a; inputs x: Boolean
# ---------- python_46: Python ----------
__author__ = "orcun"
__version__ = "2022.04.06"

import rhinoscriptsyntax as rs
if x == True:
    a = 0
else:
    a=1
# ---------- end python_46 ----------
weave_61 = Weave(Pattern=python_46.a, Stream0="0", Stream1=data_216, NullGaps=False)

panel_667 = Panel("# of units")
lng_128 = ListLength(List=conditionedunconditioned_7.conditionedZones)

# ----
# If there is an one floor with multiple units
python_47 = GhPythonScript(x=item_100, y=lng_128)  # -> out, a; inputs x: Int32, y: Int32
# ---------- python_47: Python ----------
__author__ = "orcun"
__version__ = "2022.04.06"

import rhinoscriptsyntax as rs
if x == 1 and y!=0:
    a = 1
else:
    a=0
# ---------- end python_47 ----------

# ----
# Width/Depth ratio of
# Simulated Units
data_217 = Data(division_21)

dup_170 = DuplicateData(Data="0", Number=lng_128, Order=True)
weave_62 = Weave(Pattern=python_47.a, Stream0=weave_61, Stream1=dup_170, NullGaps=False)

equals_52 = Equality(FirstNumber=data_126, SecondNumber="1")  # -> Equality, Inequality
dispatch_76 = Dispatch(List=data_217, DispatchPattern=equals_52.Equality)  # -> ListA, ListB

equals_53 = Equality(FirstNumber=data_126, SecondNumber="1")  # -> Equality, Inequality
dispatch_77 = Dispatch(List=weave_62, DispatchPattern=equals_53.Equality)  # -> ListA, ListB

partition_60 = PartitionList(List=data_135, Size=data_133)  # -> simplify(Chunks)
cull_i_34 = CullIndex(List=partition_60, Indices=data_134, Wrap=True)  # -> flatten(List)
item_255 = ListItem(List=cull_i_34, Index=filename, Wrap=True)
lng_129 = ListLength(List=conditionedunconditioned_7.conditionedZones)
dup_171 = DuplicateData(Data=flatten(item_255), Number=lng_129, Order=True)

# ----
# verticalPosition
# (2:base, 3: middle, 4:roof)
rec_5 = DataRecorder(dispatch_77.ListB, DataLimit=-10, RecordData=True)
panel_670 = Panel(rec_5)

partition_61 = PartitionList(List=data_136, Size=data_133)  # -> simplify(Chunks)
cull_i_35 = CullIndex(List=partition_61, Indices=data_134, Wrap=True)  # -> flatten(List)
item_256 = ListItem(List=cull_i_35, Index=filename, Wrap=True)
lng_130 = ListLength(List=conditionedunconditioned_7.conditionedZones)
dup_172 = DuplicateData(Data=flatten(item_256), Number=lng_130, Order=True)

# ----
# U-value-Wall of Building
# BUILDING
panel_671 = Panel("3")
roundd_13 = RoundToDecimalPlace(NumberX=weave_35, DecimalPlace=panel_671, RoundType=0)  # -> Rounded, Difference
lng_131 = ListLength(List=conditionedunconditioned_7.conditionedZones)
dup_173 = DuplicateData(Data=roundd_13.Rounded, Number=lng_131, Order=True)

# ----
# U-value-Roof of Building
panel_672 = Panel("3")
roundd_14 = RoundToDecimalPlace(NumberX=weave_36, DecimalPlace=panel_672, RoundType=0)  # -> Rounded, Difference
lng_132 = ListLength(List=conditionedunconditioned_7.conditionedZones)
dup_174 = DuplicateData(Data=roundd_14.Rounded, Number=lng_132, Order=True)

# ----
# properties of Units
debrep_24 = DeconstructBrep(Brep=conditionedunconditioned_7.conditionedZones)  # -> simplify(Faces), Edges, Vertices
item_257 = ListItem(List=debrep_24.Faces, Index=0, Wrap=True)
area_74 = Area(Geometry=item_257)  # -> flatten(Area), Centroid

equals_54 = Equality(FirstNumber=data_126, SecondNumber="1")  # -> Equality, Inequality
dispatch_78 = Dispatch(List=dup_174, DispatchPattern=equals_54.Equality)  # -> ListA, ListB

equals_55 = Equality(FirstNumber=data_126, SecondNumber="1")  # -> Equality, Inequality
dispatch_79 = Dispatch(List=dup_173, DispatchPattern=equals_55.Equality)  # -> ListA, ListB

equals_56 = Equality(FirstNumber=data_126, SecondNumber="1")  # -> Equality, Inequality
dispatch_80 = Dispatch(List=dup_171, DispatchPattern=equals_56.Equality)  # -> ListA, ListB

equals_57 = Equality(FirstNumber=data_126, SecondNumber="1")  # -> Equality, Inequality
dispatch_81 = Dispatch(List=dup_172, DispatchPattern=equals_57.Equality)  # -> ListA, ListB

pdecon_18 = Deconstruct(Point=area_74.Centroid)  # -> XComponent, YComponent, ZComponent
division_23 = Division(A=pdecon_18.ZComponent, B="3")  # -> flatten(Result)

panel_677 = Panel("conditioned units")
lng_133 = ListLength(List=conditionedunconditioned_7.conditionedZones)

lng_134 = ListLength(List=conditionedunconditioned_7.conditionedZones)

lng_135 = ListLength(List=conditionedunconditioned_7.conditionedZones)

lng_136 = ListLength(List=conditionedunconditioned_7.conditionedZones)

# ----
# boiler efficiency
data_218 = Data(weave_27)
dup_175 = DuplicateData(Data=data_218, Number=lng_133, Order=True)

# ----
# Parcel info of Building
rec_6 = DataRecorder(dispatch_80.ListB, DataLimit=-10, RecordData=True)
# ID
panel_681 = Panel(rec_6)

# ----
# Block value of Building
rec_7 = DataRecorder(dispatch_81.ListB, DataLimit=-10, RecordData=True)
panel_682 = Panel(rec_7)

# ----
# Infiltration Rate
lng_137 = ListLength(List=conditionedunconditioned_7.conditionedZones)
dup_176 = DuplicateData(Data=weave_34, Number=lng_137, Order=True)

equals_58 = Equality(FirstNumber=data_126, SecondNumber="1")  # -> Equality, Inequality
dispatch_82 = Dispatch(List=division_23, DispatchPattern=equals_58.Equality)  # -> ListA, ListB

# ----
# VT Window
dup_177 = DuplicateData(Data=data_142, Number=lng_135, Order=True)

# ----
# shgc Window
dup_178 = DuplicateData(Data=data_143, Number=lng_136, Order=True)

# ----
# Construction Date
dup_179 = DuplicateData(Data=data_141, Number=lng_134, Order=True)

equals_59 = Equality(FirstNumber=data_126, SecondNumber="1")  # -> Equality, Inequality
dispatch_83 = Dispatch(List=dup_175, DispatchPattern=equals_59.Equality)  # -> ListA, ListB

equals_60 = Equality(FirstNumber=data_126, SecondNumber="1")  # -> Equality, Inequality
dispatch_84 = Dispatch(List=dup_177, DispatchPattern=equals_60.Equality)  # -> ListA, ListB

equals_61 = Equality(FirstNumber=data_126, SecondNumber="1")  # -> Equality, Inequality
dispatch_85 = Dispatch(List=dup_178, DispatchPattern=equals_61.Equality)  # -> ListA, ListB

equals_62 = Equality(FirstNumber=data_126, SecondNumber="1")  # -> Equality, Inequality
dispatch_86 = Dispatch(List=dup_176, DispatchPattern=equals_62.Equality)  # -> ListA, ListB

equals_63 = Equality(FirstNumber=data_126, SecondNumber="1")  # -> Equality, Inequality
dispatch_87 = Dispatch(List=dup_179, DispatchPattern=equals_63.Equality)  # -> ListA, ListB

# ----
# z-axis value of Units
panel_689 = Panel(dispatch_82.ListB)

debrep_25 = DeconstructBrep(Brep=geo_77)  # -> Faces, Edges, Vertices
fcircle_2 = CircleFit(Points=debrep_25.Vertices)  # -> Circle, Radius, Deviation
addition_9 = Addition(A=multiplication_17, B=fcircle_2.Radius)

area_75 = Area(Geometry=geo_77)  # -> Area, Centroid

circle_5 = CircleCNR(Center=area_75.Centroid, Normal=Vector(0, 0, 1), Radius=addition_9)

divide_6 = DivideCurve(Curve=circle_5, Count="180", Kinks=False)  # -> Points, Tangents, Parameters

ln_5 = Line(StartPoint=area_75.Centroid, EndPoint=divide_6.Points)

lng_138 = ListLength(List=ln_5)

# ----
# center of simulated PARCEL
data_219 = Data(area_75.Centroid)

pt_5 = Point(dispatch_73.ListB)
ln_6 = Line(StartPoint=graft(area_69.Centroid), EndPoint=pt_5)
stretch = Stretch(Geometry=ln_6, Axis=ln_6, Length="50", Rigid=False)

area_76 = Area(Geometry=item_216)  # -> Area, Centroid
equals_64 = Equality(FirstNumber=area_76.Centroid, SecondNumber=area_55.Centroid)  # -> Equality, Inequality

dispatch_88 = Dispatch(List=pline_9, DispatchPattern=equals_64.Equality)  # -> ListA, ListB
area_77 = Area(Geometry=dispatch_88.ListA)  # -> Area, Centroid
scale_12 = Scale(Geometry=dispatch_88.ListA, Center=area_77.Centroid, Factor="1.1")  # -> Geometry, Transform

colom_2 = CollisionOneMany(Collider=scale_12.Geometry, Obstacles=simplify(graft(dispatch_88.ListB)))  # -> simplify(flatten(Collision)), simplify(Index)
dispatch_89 = Dispatch(List=dispatch_88.ListB, DispatchPattern=colom_2.Collision)  # -> ListA, ListB

geo_99 = Geometry(dispatch_89.ListB)
area_78 = Area(Geometry=geo_99)  # -> Area, Centroid

# ----
# Context Shading: Added Parcel
vec2pt_8 = Vector2Pt(PointA=area_78.Centroid, PointB=graft(area_56.Centroid), Unitize=False)  # -> Vector, Length
multiplication_21 = Multiplication(A=vec2pt_8.Vector, B="2")
move_4 = Move(Geometry=geo_99, Motion=multiplication_21)  # -> Geometry, Transform

# ----
# OSCInfo
dispatch_90 = Dispatch(List=data_102, DispatchPattern=equals_43.Equality)  # -> ListA, ListB
dispatch_91 = Dispatch(List=dispatch_90.ListA, DispatchPattern=equals_45.Equality)  # -> ListA, ListB
multiplication_22 = Multiplication(A=dispatch_91.ListB, B=data_103)
boundary_20 = BoundarySurfaces(Edges=dispatch_89.ListB)
Z_9 = UnitZ(Factor=multiplication_22)
extr_6 = Extrude(Base=boundary_20, Direction=Z_9)

rint = RegionIntersection(CurvesA=geo_99, CurvesB=simplify(graft(move_4.Geometry)))  # -> simplify(Result)
area_79 = Area(Geometry=flatten(rint))  # -> Area, Centroid
incurves_3 = PointInCurves(Point=area_79.Centroid, Curves=move_4.Geometry)  # -> Relationship, Index, Point
cull_i_36 = CullIndex(List=move_4.Geometry, Indices=incurves_3.Index, Wrap=True)

area_80 = Area(Geometry=cull_i_36)  # -> Area, Centroid
incurves_4 = PointInCurves(Point=area_80.Centroid, Curves=item_205)  # -> Relationship, Index, Point
equals_65 = Equality(FirstNumber=incurves_4.Relationship, SecondNumber="2")  # -> Equality, Inequality
dispatch_92 = Dispatch(List=cull_i_36, DispatchPattern=equals_65.Equality)  # -> ListA, ListB

merge_175 = Merge(Data1=dispatch_89.ListB, Data2=dispatch_92.ListB)
debrep_26 = DeconstructBrep(Brep=flatten(merge_175))  # -> Faces, simplify(flatten(Edges)), Vertices

extr_7 = Extrude(Base=ln_5, Direction=Z_8)
split_25 = SplitWithBrep(Curve=debrep_26.Edges, Brep=graft(extr_7))  # -> flatten(Curve), simplify(Points)
clean_28 = CleanTree(RemoveNulls=True, RemoveInvalid=True, RemoveEmpty=Toggle(True), Tree=split_25.Points)
item_258 = ListItem(List=clean_28, Index=0, Wrap=True)
dcon_10 = DeleteConsecutive(Set=item_258, Wrap=False)  # -> simplify(Set), Count
tstat_26 = TreeStatistics(Tree=dcon_10.Set)  # -> Paths, Length, Count
split_26 = TextSplit(Text=tstat_26.Paths, Separators="{;}")

series_52 = Series(Start=0, Step=1, Count=lng_138)
item_259 = ListItem(List=split_26, Index=2, Wrap=True)  # -> flatten(Item)
item_260 = ListItem(List=split_26, Index=1, Wrap=True)  # -> flatten(Item)
equals_66 = Equality(FirstNumber=graft(series_52), SecondNumber=item_260)  # -> Equality, Inequality
dispatch_93 = Dispatch(List=item_260, DispatchPattern=equals_66.Equality)  # -> simplify(ListA), ListB
lng_139 = ListLength(List=dispatch_93.ListA)
partition_62 = PartitionList(List=item_259, Size=flatten(lng_139))
item_261 = ListItem(List=debrep_26.Edges, Index=partition_62, Wrap=True)  # -> simplify(Item)

curvepoint_9 = PointOnCurve(item_261, parameter=0.5)
dist = Distance(PointA=curvepoint_9, PointB=data_219)  # -> simplify(Distance)
sort_32 = SortList(Keys=dist, ValuesA=item_261)  # -> Keys, ValuesA
item_262 = ListItem(List=sort_32.ValuesA, Index=0, Wrap=True)  # -> flatten(Item)
null_16 = NullItem(Item=item_262)  # -> NullFlags, InvalidFlags, Description
dispatch_94 = Dispatch(List=item_262, DispatchPattern=null_16.NullFlags)  # -> ListA, ListB
curvepoint_10 = PointOnCurve(dispatch_94.ListB, parameter=0.5)
sort_pt_3 = SortPoints(Points=curvepoint_10)  # -> Points, Indices
dcon_11 = DeleteConsecutive(Set=sort_pt_3.Points, Wrap=False)  # -> Set, Count
geo_100 = Geometry(dispatch_94.ListB)
pdecon_19 = Deconstruct(Point=dcon_11.Set)  # -> XComponent, YComponent, ZComponent
curvepoint_11 = PointOnCurve(geo_100, parameter=0.5)
addition_10 = Addition(A=pdecon_19.XComponent, B=pdecon_19.YComponent)
pdecon_20 = Deconstruct(Point=curvepoint_11)  # -> XComponent, YComponent, ZComponent
roundd_15 = RoundToDecimalPlace(NumberX=addition_10, DecimalPlace="2", RoundType=0)  # -> Rounded, Difference
addition_11 = Addition(A=pdecon_20.XComponent, B=pdecon_20.YComponent)
roundd_16 = RoundToDecimalPlace(NumberX=addition_11, DecimalPlace="2", RoundType=0)  # -> Rounded, Difference
equals_67 = Equality(FirstNumber=roundd_16.Rounded, SecondNumber=graft(roundd_15.Rounded))  # -> Equality, Inequality
dispatch_95 = Dispatch(List=geo_100, DispatchPattern=equals_67.Equality)  # -> simplify(ListA), ListB

item_263 = ListItem(List=dispatch_95.ListA, Index=0, Wrap=True)  # -> flatten(Item)

curvepoint_12 = PointOnCurve(item_263, parameter=0.5)
incurves_5 = PointInCurves(Point=curvepoint_12, Curves=pline_7)  # -> Relationship, Index, Point
sort_33 = SortList(Keys=incurves_5.Index)  # -> Keys, ValuesA
dcon_12 = DeleteConsecutive(Set=sort_33.Keys, Wrap=False)  # -> Set, Count
item_264 = ListItem(List=data_173, Index=dcon_12.Set, Wrap=True)  # -> flatten(Item)

# ----
# average of all context buildings height
ma_12 = MassAddition(Input=item_264)  # -> Result, PartialResults
lng_140 = ListLength(List=item_264)
division_24 = Division(A=ma_12.Result, B=lng_140)

# ----
# average of all context buildings height
data_220 = Data(division_24)

# ----
# OSCInfo_ContextShadingAddedBlocks
multiplication_23 = Multiplication(A=data_220, B=data_104)
boundary_21 = BoundarySurfaces(Edges=dispatch_92.ListB)
Z_10 = UnitZ(Factor=multiplication_23)
extr_8 = Extrude(Base=boundary_21, Direction=Z_10)

brep_6 = Brep(flatten([extr_6, extr_8]))

merge_176 = Merge(Data1=extr_6, Data2=extr_8)  # disabled
area_81 = Area(Geometry=merge_176)  # -> Area, flatten(Centroid); disabled

merge_177 = Merge(Data1=extr_6, Data2=extr_8)  # -> flatten(Result); disabled
null_17 = NullItem(Item=merge_177)  # -> NullFlags, InvalidFlags, Description; disabled
dispatch_96 = Dispatch(List=merge_177, DispatchPattern=null_17.NullFlags)  # -> ListA, ListB; disabled
debrep_27 = DeconstructBrep(Brep=dispatch_96.ListB)  # -> simplify(Faces), Edges, Vertices; disabled
area_82 = Area(Geometry=debrep_27.Faces)  # -> Area, Centroid; disabled
pdecon_21 = Deconstruct(Point=area_82.Centroid)  # -> XComponent, YComponent, ZComponent; disabled
sort_34 = SortList(Keys=pdecon_21.ZComponent, ValuesA=debrep_27.Faces)  # -> Keys, reverse(ValuesA); disabled

area_83 = Area(Geometry=dispatch_96.ListB)  # -> Area, Centroid; disabled
incurves_6 = PointInCurves(Point=area_83.Centroid, Curves=shift_4)  # -> Relationship, Index, Point; disabled
sort_35 = SortList(Keys=incurves_6.Index)  # -> Keys, ValuesA; disabled
dcon_13 = DeleteConsecutive(Set=sort_35.Keys, Wrap=False)  # -> Set, Count; disabled
equals_68 = Equality(FirstNumber=dcon_13.Set, SecondNumber=panel_608)  # -> Equality, Inequality; disabled
dispatch_97 = Dispatch(List=dcon_13.Set, DispatchPattern=equals_68.Equality)  # -> ListA, ListB; disabled

item_265 = ListItem(List=sort_34.ValuesA, Index=0, Wrap=True)  # disabled
area_84 = Area(Geometry=item_265)  # -> Area, Centroid; disabled
incurves_7 = PointInCurves(Point=area_84.Centroid, Curves=shift_4)  # -> Relationship, simplify(Index), Point; disabled
equals_69 = Equality(FirstNumber=incurves_7.Index, SecondNumber=panel_607)  # -> Equality, Inequality; disabled
dispatch_98 = Dispatch(List=incurves_7.Index, DispatchPattern=equals_69.Equality)  # -> ListA, ListB; disabled

pdecon_22 = Deconstruct(Point=area_84.Centroid)  # -> XComponent, YComponent, ZComponent; disabled
sort_36 = SortList(Keys=pdecon_22.ZComponent, ValuesA=area_84.Centroid)  # -> reverse(Keys), reverse(ValuesA); disabled
item_266 = ListItem(List=sort_36.Keys, Index=0, Wrap=True)  # disabled

# ----
# count
# occurences
# in list
# + partition from
# north to east
sort_37 = SortList(Keys=flatten(dispatch_98.ListB), ValuesA=flatten(item_266))  # -> Keys, ValuesA; disabled
dcon_14 = DeleteConsecutive(Set=sort_37.Keys, Wrap=False)  # -> Set, Count; disabled
panel_690 = Panel(sort_37.Keys)  # disabled
equals_70 = Equality(FirstNumber=panel_690, SecondNumber=graft(dcon_14.Set))  # -> Equality, Inequality; disabled
dispatch_99 = Dispatch(List=panel_690, DispatchPattern=equals_70.Equality)  # -> simplify(ListA), ListB; disabled

sort_38 = SortList(Keys=pdecon_21.ZComponent, ValuesA=debrep_27.Faces)  # -> Keys, ValuesA; disabled
item_267 = ListItem(List=sort_38.ValuesA, Index=0, Wrap=True)  # disabled
area_85 = Area(Geometry=item_267)  # -> Area, Centroid; disabled
area_86 = Area(Geometry=geo_81)  # -> Area, Centroid; disabled
dist_2 = Distance(PointA=area_86.Centroid, PointB=area_85.Centroid)  # -> flatten(Distance); disabled
lng_141 = ListLength(List=dispatch_99.ListA)  # -> flatten(Length); disabled
partition_63 = PartitionList(List=dist_2, Size=lng_141)  # disabled
avr_6 = Average(Input=partition_63)  # -> flatten(ArithmeticMean); disabled
replace_32 = ReplaceItems(List=dup_138, Item=avr_6, Indices=dispatch_97.ListB, Wrap=False)  # disabled
roundd_17 = RoundToDecimalPlace(NumberX=replace_32, DecimalPlace=panel_624, RoundType=0)  # -> Rounded, Difference; disabled
lng_142 = ListLength(List=roundd_17.Rounded)  # disabled
lng_143 = ListLength(List=conditionedunconditioned_6.conditionedZones)  # disabled
dup_180 = DuplicateData(Data=roundd_17.Rounded, Number=lng_143, Order=True)  # disabled
partition_64 = PartitionList(List=dup_180, Size=lng_142)  # -> simplify(Chunks); disabled

lng_144 = ListLength(List=dispatch_99.ListA)  # -> flatten(Length); disabled
partition_65 = PartitionList(List=sort_37.ValuesA, Size=lng_144)  # disabled
avr_7 = Average(Input=partition_65)  # -> flatten(ArithmeticMean); disabled
replace_33 = ReplaceItems(List=dup_137, Item=avr_7, Indices=dispatch_97.ListB, Wrap=False)  # disabled
roundd_18 = RoundToDecimalPlace(NumberX=replace_33, DecimalPlace=panel_619, RoundType=0)  # -> Rounded, Difference; disabled
lng_145 = ListLength(List=roundd_18.Rounded)  # disabled
lng_146 = ListLength(List=conditionedunconditioned_5.conditionedZones)  # disabled
dup_181 = DuplicateData(Data=roundd_17.Rounded, Number=lng_146, Order=True)  # disabled
partition_66 = PartitionList(List=dup_181, Size=lng_145)  # -> simplify(Chunks); disabled

multiplication_24 = Multiplication(A=data_105, B=division_24)
Z_11 = UnitZ(Factor=multiplication_24)

geo_101 = Geometry(item_263)

# ----
# context without ground surface
extr_9 = Extrude(Base=geo_101, Direction=Z_11)

# ----
# context without ground surface
geo_102 = Geometry(extr_9)

colom_3 = CollisionOneMany(Collider=stretch, Obstacles=geo_102)  # -> Collision, Index
dispatch_100 = Dispatch(List=stretch, DispatchPattern=colom_3.Collision)  # -> ListA, ListB
split_27 = SplitWithBreps(Curve=dispatch_100.ListA, Brep=geo_102)  # -> Curve, Points
crv = Curve(split_27.Curve)
item_268 = ListItem(List=crv, Index=0, Wrap=True)
null_18 = NullItem(Item=item_268)  # -> NullFlags, InvalidFlags, Description
dispatch_101 = Dispatch(List=item_268, DispatchPattern=null_18.NullFlags)  # -> ListA, ListB
crv_2 = Curve(dispatch_101.ListB)
len_7 = Length(Curve=crv_2)
end_2 = EndPoints(Curve=crv_2)  # -> Start, End
vec2pt_9 = Vector2Pt(PointA=end_2.Start, PointB=end_2.End, Unitize=False)  # -> Vector, Length
pshift_2 = ShiftPaths(Data=len_7, Offset=-1)
null_19 = NullItem(Item=pshift_2)  # -> NullFlags, InvalidFlags, Description
dispatch_102 = Dispatch(List=pshift_2, DispatchPattern=null_19.NullFlags)  # -> ListA, ListB

angle = Angle(VectorA=graft(evalsrf_5.Normal), VectorB=simplify(vec2pt_9.Vector))  # -> Angle, Reflex
deg_2 = Degrees(Radians=angle.Angle)
larger_2 = LargerThan(FirstNumber=deg_2, SecondNumber="90")  # -> LargerThan, OrEqualTo
python_48 = GhPythonScript(x=simplify(deg_2))  # -> simplify(out), a
# ---------- python_48: Python ----------
__author__ = "ipg"
__version__ = "2022.01.28"

import rhinoscriptsyntax as rs
if x>=90:
    x = x-90
    print(x)
else:
    pass
# ---------- end python_48 ----------
dispatch_103 = Dispatch(List=deg_2, DispatchPattern=larger_2.OrEqualTo)  # -> ListA, ListB
merge_178 = Merge(Data1=dispatch_103.ListB, Data2=python_48.out)  # -> simplify(Result)
pshift_3 = ShiftPaths(Data=merge_178, Offset=-1)

join_42 = BrepJoin(Breps=brep_6)  # -> flatten(Breps), Closed
volume_8 = Volume(Geometry=join_42.Breps)  # -> Volume, Centroid
bcx = BrepCurve(Brep=flatten(brep_6), Curve=dispatch_101.ListB)  # -> Curves, Points
crv_cp_3 = CurveCP(Point=volume_8.Centroid, Curve=crv_2)  # -> Point, Parameter, Distance
pshift_4 = ShiftPaths(Data=bcx.Points, Offset=-1)
dist_3 = Distance(PointA=volume_8.Centroid, PointB=crv_cp_3.Point)
sort_39 = SortList(Keys=dist_3, ValuesA=join_42.Breps)  # -> Keys, ValuesA
lng_147 = ListLength(List=pshift_4)
split_28 = SplitList(List=sort_39.ValuesA, Index=lng_147)  # -> ListA, ListB
brep_7 = Brep(simplify(graft(split_28.ListA)))

pshift_5 = ShiftPaths(Data=simplify(brep_7), Offset=-1)
panel_691 = Panel(pshift_5)

multiplication_25 = Multiplication(A=pshift_3, B=dispatch_102.ListB)
python_49 = GhPythonScript(x=multiplication_25)  # -> out, a
# ---------- python_49: Python ----------
__author__ = "ipg"
__version__ = "2022.01.28"

import rhinoscriptsyntax as rs
if x == 0 : 
    x = x + 0.1
    print(x)
else:
    print(x)
# ---------- end python_49 ----------
pshift_6 = ShiftPaths(Data=python_49.out, Offset=-1)
panel_692 = Panel(multiplication_25)

lng_148 = ListLength(List=multiplication_25)  # -> flatten(Length)
data_221 = Data(flatten(brep_7))
partition_67 = PartitionList(List=data_221, Size=lng_148)  # -> simplify(Chunks)
tstat_27 = TreeStatistics(Tree=partition_67)  # -> Paths, Length, Count
tstat_28 = TreeStatistics(Tree=multiplication_25)  # -> Paths, Length, Count
replace_34 = ReplacePaths(Data=partition_67, Search=tstat_27.Paths, Replace=tstat_28.Paths)

debrep_28 = DeconstructBrep(Brep=replace_34)  # -> simplify(Faces), Edges, Vertices
area_87 = Area(Geometry=debrep_28.Faces)  # -> Area, Centroid
pdecon_23 = Deconstruct(Point=area_87.Centroid)  # -> XComponent, YComponent, ZComponent
sort_40 = SortList(Keys=pdecon_23.ZComponent, ValuesA=debrep_28.Faces)  # -> Keys, reverse(ValuesA)
null_20 = NullItem(Item=sort_40.ValuesA)  # -> NullFlags, InvalidFlags, Description
dispatch_104 = Dispatch(List=sort_40.ValuesA, DispatchPattern=null_20.NullFlags)  # -> ListA, ListB
area_88 = Area(Geometry=dispatch_104.ListB)  # -> Area, Centroid
pdecon_24 = Deconstruct(Point=area_88.Centroid)  # -> XComponent, YComponent, ZComponent
sort_41 = SortList(Keys=pdecon_24.ZComponent, ValuesA=area_88.Centroid)  # -> reverse(Keys), reverse(ValuesA)
item_269 = ListItem(List=sort_41.Keys, Index=0, Wrap=True)
null_21 = NullItem(Item=item_269)  # -> NullFlags, InvalidFlags, Description
dispatch_105 = Dispatch(List=item_269, DispatchPattern=null_21.NullFlags)  # -> ListA, simplify(ListB)

pshift_7 = ShiftPaths(Data=dispatch_105.ListB, Offset=-1)
panel_693 = Panel(pshift_7)

geo_103 = Geometry(flatten(extr_9))

subtraction_12 = Subtraction(A=pshift_7, B=panel_660)
python_50 = GhPythonScript(x=pdecon_15.ZComponent, y=panel_693, z=subtraction_12)  # -> out, a
# ---------- python_50: Python ----------
__author__ = "ipg"
__version__ = "2022.01.28"

import rhinoscriptsyntax as rs
if x > y:
    z = 0
    print(z)
if z < 0 :
    z = 0 
    print(z)
else:
    print(z)
# ---------- end python_50 ----------
pshift_8 = ShiftPaths(Data=python_50.out, Offset=-1)
panel_694 = Panel(pshift_8)

division_25 = Division(A=pshift_8, B=multiplication_25)
panel_695 = Panel(division_25)

area_89 = Area(Geometry=geo_103)  # -> Area, Centroid
incurves_8 = PointInCurves(Point=area_89.Centroid, Curves=merge_154)  # -> Relationship, Index, Point
sort_42 = SortList(Keys=incurves_8.Index)  # -> Keys, ValuesA
dcon_15 = DeleteConsecutive(Set=sort_42.Keys, Wrap=False)  # -> Set, Count

# ----
# 01find directions of external walls
# 2-steps shading selection
# find directions of external walls
# test wether obstacle exist these directions
decomposebytype_4 = Honeybee_DecomposeBasedOnType(HBZone=conditionedunconditioned_4.conditionedZones)  # -> simplify(walls), simplify(interiorWalls), airWalls, simplify(windows), interiorWindows, skylights, roofs, ceilings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; plug-in component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
replace_35 = ReplaceItems(List=dup_40, Item="1", Indices=dcon_15.Set, Wrap=False)

merge_179 = Merge(Data1=extr_9, Data2=geo_83)  # -> flatten(Result)
debrep_29 = DeconstructBrep(Brep=flatten(merge_179))  # -> Faces, Edges, flatten(Vertices)
hull_10 = ConvexHull(Points=debrep_29.Vertices, Plane=PlaneXY(0, 0, 0))  # -> Hull, HullZ, Indices
area_90 = Area(Geometry=hull_10.Hull)  # -> Area, Centroid
scale_13 = Scale(Geometry=hull_10.Hull, Center=area_90.Centroid, Factor="1.05")  # -> Geometry, Transform
boundary_22 = BoundarySurfaces(Edges=scale_13.Geometry)

# ----
# average (it gives
# one result for each
# window unit)
avr_8 = Average(Input=division_25)
panel_696 = Panel(avr_8)

# ----
# summation (it gives
#  one result for each
#  window in the unit)
ma_13 = MassAddition(Input=division_25)  # -> Result, PartialResults
panel_697 = Panel(ma_13.Result)

# ----
# 02test wether obstacle
# exist these directions
area_91 = Area(Geometry=decomposebytype_4.walls)  # -> Area, Centroid
incurves_9 = PointInCurves(Point=area_91.Centroid, Curves=merge_154)  # -> Relationship, Index, Point
item_270 = ListItem(List=replace_35, Index=incurves_9.Index, Wrap=True)  # -> simplify(Item)
replace_36 = ReplaceItems(List=dup_41, Item=item_270, Indices=incurves_9.Index, Wrap=False)  # -> simplify(List)

# ----
# Context Surface
merge_180 = Merge(Data1=flatten(extr_9), Data2=flatten(boundary_22))
hb_epcontextsrf = HoneybeeEPContextSurfaces(shdSurfaces=flatten(merge_180))  # -> HBContext; inputs shdSurfaces: list of Brep, justBoundingBox: Boolean
# ---------- hb_epcontextsrf: Python ----------
"""
prepare shading/context geometries

    Args:
        northVectorOrRotation: A vector that shows North or a number that shows
                               the rotation of the North from the Y axis
        bldgMasses: List of closed Breps as thermal zones.
    Returns:
        report: ...
        thermalZones: Thermal zone's geometries for visualiza
"""

ghenv.Component.Name = 'Honeybee EP context Surfaces'
ghenv.Component.NickName = 'HB_EPContextSrf'
ghenv.Component.Message = 'VER 0.0.66\nJUL_07_2020'
ghenv.Component.IconDisplayMode = ghenv.Component.IconDisplayMode.application
ghenv.Component.Category = "HB-Legacy"
ghenv.Component.SubCategory = "10 | Energy | Energy"
#compatibleHBVersion = VER 0.0.57\nNOV_04_2016
#compatibleLBVersion = VER 0.0.59\nFEB_01_2015
ghenv.Component.AdditionalHelpFromDocStrings = "2"

import rhinoscriptsyntax as rs
import Rhino as rc
import scriptcontext as sc
import os
import System
import Grasshopper.Kernel as gh
import uuid

tolerance = sc.doc.ModelAbsoluteTolerance
import math


def main(shdSurfaces, EPTransSchedule, meshingSettings, justBoundingBox):
    
    # import the classes
    if sc.sticky.has_key('honeybee_release'):

        try:
            if not sc.sticky['honeybee_release'].isCompatible(ghenv.Component): return -1
            if sc.sticky['honeybee_release'].isInputMissing(ghenv.Component): return -1
        except:
            warning = "You need a newer version of Honeybee to use this compoent." + \
            " Use updateHoneybee component to update userObjects.\n" + \
            "If you have already updated userObjects drag Honeybee_Honeybee component " + \
            "into canvas and try again."
            w = gh.GH_RuntimeMessageLevel.Warning
            ghenv.Component.AddRuntimeMessage(w, warning)
            return -1
        
        # don't customize this part
        hb_EPSrf = sc.sticky["honeybee_EPSurface"]
        hb_EPSHDSurface = sc.sticky["honeybee_EPShdSurface"]
        hb_RADMaterialAUX = sc.sticky["honeybee_RADMaterialAUX"]
        hb_EPObjectsAux = sc.sticky["honeybee_EPObjectsAUX"]()
        HBScheduleList = sc.sticky["honeybee_ScheduleLib"].keys()

        ########################################################################
        #----------------------------------------------------------------------#
        shdBreps = []
        # create bounding box of shading geometries
        if justBoundingBox:
            for brep in shdSurfaces:
                if brep.Faces.Count>1 or not brep.Faces[0].IsPlanar(sc.doc.ModelAbsoluteTolerance):
                    shdBreps.append(brep.GetBoundingBox(True).ToBrep())
                else:
                    shdBreps.append(brep)
        else:
            shdBreps = shdSurfaces
        
        shadingClasses = []
        shadingMeshPreview = []
        
        if meshingSettings == None:
            mp = rc.Geometry.MeshingParameters.Minimal
            mp.SimplePlanes = True
        else:
            mp = meshingSettings
        
        def getRadMaterialName(radMaterial):
            nameStr = radMaterial.split(" ")[2]
            name =  nameStr.split("\n")[0]
            return name
        
        for brepCount, brep in enumerate(shdBreps):
            if brep != None:
                isPlanar = True
                # check planarity
                for face in brep.Faces:
                    if not face.IsPlanar(tolerance):
                        isPlanar = False
                        break
                
                shadingBreps = []
                if not isPlanar:
                    meshArray = rc.Geometry.Mesh.CreateFromBrep(brep, mp)
                    for mesh in meshArray:
                        for meshFace in range(mesh.Faces.Count):
                            vertices = list(mesh.Faces.GetFaceVertices(meshFace))[1:]
                            vertices = vertices + [sc.doc.ModelAbsoluteTolerance]
                            # create the brep from mesh
                            shdBrep = rc.Geometry.Brep.CreateFromCornerPoints(*vertices)
                            shadingBreps.append(shdBrep)
                else:
                    for face in brep.Faces:
                        shadingBreps.append(face.DuplicateFace(False))
                
                for faceCount, shdBrep in enumerate(shadingBreps):
                        thisShading = hb_EPSHDSurface(shdBrep, 1000*brepCount + faceCount, 'shdSrf_' + `brepCount` + '_' + `faceCount` + "_" + str(uuid.uuid4()))
                        
                        # add transmittance schedule if any
                        if EPTransSchedule!=None:
                            schedule= EPTransSchedule.upper()
                            if schedule!=None and not schedule.lower().endswith(".csv") and schedule not in HBScheduleList:
                                msg = "Cannot find " + schedule + " in Honeybee schedule library."
                                print msg
                                ghenv.Component.AddRuntimeMessage(gh.GH_RuntimeMessageLevel.Warning, msg)
                                return -1
                            elif schedule!=None and schedule.lower().endswith(".csv"):
                                # check if csv file is existed
                                if not os.path.isfile(schedule):
                                    msg = "Cannot find the shchedule file: " + schedule
                                    print msg
                                    ghenv.Component.AddRuntimeMessage(gh.GH_RuntimeMessageLevel.Warning, msg)
                                    return -1
                            
                            thisShading.TransmittanceSCH = schedule
                        
                        # add the Rad Material if any
                        if RADMaterial!=None:
                            # if it is just the name of the material make sure it is already defined
                            if len(RADMaterial.split(" ")) == 1:
                                # if the material is not in the library add it to the library
                                if not hb_RADMaterialAUX.isMatrialExistInLibrary(RADMaterial):
                                    warningMsg = "Can't find " + RADMaterial + " in RAD Material Library.\n" + \
                                                "Add the material to the library and try again."
                                    ghenv.Component.AddRuntimeMessage(gh.GH_RuntimeMessageLevel.Warning, warningMsg)
                                    return
                                
                                try:
                                    thisShading.setRADMaterial(RADMaterial)
                                except Exception, e:
                                    print e
                                    warningMsg = "You are using an old version of Honeybee_Honeybee! Update your files and try again."
                                    print warningMsg
                                    ghenv.Component.AddRuntimeMessage(gh.GH_RuntimeMessageLevel.Warning, warningMsg)
                                    return
                                
                                addedToLib = True
                            else:
                                
                                # try to add the material to the library
                                addedToLib, thisShading.RadMaterial = hb_RADMaterialAUX.analyseRadMaterials(RADMaterial, True)
                                
                            if addedToLib==False:
                                warningMsg = "Failed to add " + RADMaterial + " to the Library."
                                ghenv.Component.AddRuntimeMessage(gh.GH_RuntimeMessageLevel.Warning, warningMsg)
                                return
                        
                        # add shading to the list
                        shadingClasses.append(thisShading)
                
        # add to the hive
        hb_hive = sc.sticky["honeybee_Hive"]()
        HBContext  = hb_hive.addToHoneybeeHive(shadingClasses, ghenv.Component)
        return HBContext
        ################################################################################################
    else:
        print "You should first let Honeybee to fly..."
        w = gh.GH_RuntimeMessageLevel.Warning
        ghenv.Component.AddRuntimeMessage(w, "You should first let Honeybee to fly...")
        return -1
        

if _shdSurfaces and _shdSurfaces[0]!=None:
    # add cleaning function
    result= main(_shdSurfaces, EPTransSchedule_, meshingSettings_, justBoundingBox_)
    
    if result != -1: HBContext = result
# ---------- end hb_epcontextsrf ----------

context = Brep(hb_epcontextsrf)

nullrep = ReplaceNulls(Items=panel_696, Replacements="-1")  # -> Items, Count
pshift_9 = ShiftPaths(Data=nullrep.Items, Offset=-1)

nullrep_2 = ReplaceNulls(Items=panel_697, Replacements=panel_631)  # -> Items, Count
pshift_10 = ShiftPaths(Data=nullrep_2.Items, Offset=-1)

data_222 = Data(replace_36)

exporttoopenstudio = Honeybee_ExportToOpenStudio(
    epwWeatherFile=path_8,
    energySimPar=energysimpar,
    HBZones=flatten(geo_96),
    HBContext=flatten(hb_epcontextsrf),
    simulationOutputs=flatten(merge_69),
    writeOSM=Toggle(True),
    runSimulation="3",
    fileName=join_32,
    workingDir=panel_349)  # -> readMe, osmFileAddress, idfFileAddress, resultFileAddress, eioFileAddress, rddFileAddress, htmlReport, studyFolder, model; plug-in component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

data_223 = Data(exporttoopenstudio.resultFileAddress)
parameters = ColibriParameters(Data=flatten(data_223))
colibri_aggregator = ColibriAggregator(
    Folder=panel_636,
    IterationGenomeID=iterator.IterationGenome,
    IterationPhenomeResults=parameters,
    ImgSetting=img_setting,
    Write=Toggle(True),
    recordingMode=0)

readepresult = Honeybee_ReadEPResult(resultFileAddress=exporttoopenstudio.resultFileAddress)  # -> totalThermalLoad, thermalLoadBalance, cooling, heating, electricLight, electricEquip, fanElectric, pumpElectric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; plug-in component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

readepsrfresult = Honeybee_ReadEPSurfaceResult(resultFileAddress=exporttoopenstudio.resultFileAddress)  # -> port, port_2, port_3, port_4, port_5, port_6, port_7, port_8, port_9; disabled; plug-in component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
energybalance = Honeybee_ConstructEnergyBalance(
    HBZones=flatten(geo_96),
    cooling=readepresult.cooling,
    heating=readepresult.heating,
    electricLight=readepresult.electricLight,
    electricEquip=readepresult.electricEquip,
    fanElectric=readepresult.fanElectric,
    peopleGains=readepresult.peopleGains,
    totalSolarGain=readepresult.totalSolarGain,
    infiltrationEnergy=readepresult.infiltrationEnergy,
    mechVentilationEnergy=readepresult.mechVentilationEnergy,
    natVentEnergy=readepresult.natVentEnergy,
    surfaceEnergyFlow=readepsrfresult.port_3)  # -> readMe, port, flrNormEnergyBal, flrNormBalWStorage, port_2, modelEnergyBalance, energyBalWithStorage; disabled; plug-in component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
selectandaveragedata = Ladybug_AverageData(annualHourlyData=energybalance.flrNormBalWStorage, totalOrAverage=toggle_46)  # -> readMe, selHourlyData, totaledDaily, totaledMonthly, totMonthlyPerHour, totMonthlyMinPerHour, totMonthlyMaxPerHour; disabled; plug-in component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
barchart = Ladybug_MonthlyBarChart(
    inputData=flatten(energybalance.flrNormBalWStorage),
    stackValues=toggle_47,
    altTitle=panel_635,
    basePoint=pt_4,
    legendPar=legendpar)  # -> readMe, dataMesh, dataCurves, dataCrvColors, graphAxes, graphLabels, title, titleBasePt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; disabled; plug-in component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
preview_27 = CustomPreview(Geometry=barchart.graphAxes, Material=swatch_8)  # disabled

# ----
# Simulated Parcel
# Visualisation
wires_7 = BrepWireframe(Brep=merge_180, Density=-1)
preview_28 = CustomPreview(Geometry=hb_epcontextsrf, Material=ColourSwatch(SwatchColor=RGBA(0, 255, 55, 145)))
preview_29 = CustomPreview(Geometry=wires_7, Material=ColourSwatch(SwatchColor=RGB(0, 0, 0)))

# ----
# People Gain (kWh/sqm)
flrnorm = Honeybee_NormalizeDataByFloorArea(simData=readepresult.peopleGains, HBZones=flatten(geo_96))  # -> totNormData, zoneNormData; disabled; plug-in component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
strnum_7 = Ladybug_SeparateData(inputList=flatten(flrnorm.zoneNormData))  # -> numbers, strings; disabled; plug-in component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
ma_14 = MassAddition(Input=strnum_7.numbers)  # -> flatten(Result), PartialResults; disabled

# ----
# Bahçeli-Ankara Heating Demand Reference Building, EKB0_4: 80kWh/sqm
strnum_8 = Ladybug_SeparateData(inputList=flatten(readepresult.heating))  # -> numbers, strings; disabled; plug-in component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
debrep_30 = DeconstructBrep(Brep=geo_96)  # -> simplify(Faces), Edges, Vertices; disabled
item_271 = ListItem(List=debrep_30.Faces, Index=0, Wrap=True)  # disabled
ma_15 = MassAddition(Input=strnum_8.numbers)  # -> flatten(Result), PartialResults; disabled
area_92 = Area(Geometry=item_271)  # -> flatten(Area), Centroid; disabled
ma_16 = MassAddition(Input=ma_15.Result)  # -> Result, PartialResults; disabled
ma_17 = MassAddition(Input=area_92.Area)  # -> Result, PartialResults; disabled
division_26 = Division(A=ma_16.Result, B=ma_17.Result)  # disabled
panel_698 = Panel(division_26)  # disabled

# ----
# Total Solar Gain (kWh/sqm)
flrnorm_2 = Honeybee_NormalizeDataByFloorArea(simData=readepresult.totalSolarGain, HBZones=flatten(geo_96))  # -> totNormData, zoneNormData; disabled; plug-in component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
strnum_9 = Ladybug_SeparateData(inputList=flatten(flrnorm_2.zoneNormData))  # -> numbers, strings; disabled; plug-in component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
ma_18 = MassAddition(Input=strnum_9.numbers)  # -> flatten(Result), PartialResults; disabled
panel_699 = Panel("0")  # disabled
equals_71 = Equality(FirstNumber=ma_18.Result, SecondNumber=panel_699)  # -> Equality, Inequality; disabled
dispatch_106 = Dispatch(List=ma_18.Result, DispatchPattern=equals_71.Equality)  # -> ListA, ListB; disabled

# ----
# Infiltration Energy (kWh/sqm)
flrnorm_3 = Honeybee_NormalizeDataByFloorArea(simData=readepresult.infiltrationEnergy, HBZones=flatten(geo_96))  # -> totNormData, zoneNormData; disabled; plug-in component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
strnum_10 = Ladybug_SeparateData(inputList=flatten(flrnorm_3.zoneNormData))  # -> numbers, strings; disabled; plug-in component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
ma_19 = MassAddition(Input=strnum_10.numbers)  # -> flatten(Result), PartialResults; disabled
dispatch_107 = Dispatch(List=ma_19.Result, DispatchPattern=equals_71.Equality)  # -> ListA, ListB; disabled

# ----
# Natural Ventilation Energy (kWh/sqm)
flrnorm_4 = Honeybee_NormalizeDataByFloorArea(simData=readepresult.natVentEnergy, HBZones=flatten(geo_96))  # -> totNormData, zoneNormData; disabled; plug-in component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
strnum_11 = Ladybug_SeparateData(inputList=flatten(flrnorm_4.zoneNormData))  # -> numbers, strings; disabled; plug-in component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
ma_20 = MassAddition(Input=strnum_11.numbers)  # -> flatten(Result), PartialResults; disabled

# ----
# Air Temperature
# (Celcius/sqm)
strnum_12 = Ladybug_SeparateData(inputList=flatten(readepresult.airTemperature))  # -> numbers, strings; disabled; plug-in component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
avr_9 = Average(Input=strnum_12.numbers)  # disabled
dispatch_108 = Dispatch(List=flatten(avr_9), DispatchPattern=equals_71.Equality)  # -> ListA, ListB; disabled

toggle_48 = BooleanToggle(False)  # disabled
readepsrfresult_2 = Honeybee_ReadEPSurfaceResult(resultFileAddress=exporttoopenstudio.resultFileAddress, normBySrfArea=toggle_48)  # -> surfaceIndoorTemp, surfaceOutdoorTemp, surfaceEnergyFlow, opaqueEnergyFlow, glazEnergyFlow, windowTotalSolarEnergy, windowBeamEnergy, windowDiffEnergy, windowTransmissivity; disabled; plug-in component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

# ----
# COOLING ENERGY DEMAND
# (kWh/sqm)
flrnorm_5 = Honeybee_NormalizeDataByFloorArea(simData=readepresult.cooling, HBZones=flatten(geo_96))  # -> totNormData, zoneNormData; disabled; plug-in component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
strnum_13 = Ladybug_SeparateData(inputList=flatten(flrnorm_5.zoneNormData))  # -> numbers, strings; disabled; plug-in component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
ma_21 = MassAddition(Input=strnum_13.numbers)  # -> flatten(Result), PartialResults; disabled

flrnorm_6 = Honeybee_NormalizeDataByFloorArea(simData=readepresult.heating, HBZones=flatten(geo_96))  # -> totNormData, zoneNormData; disabled; plug-in component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
strnum_14 = Ladybug_SeparateData(inputList=flatten(flrnorm_6.zoneNormData))  # -> numbers, strings; disabled; plug-in component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
ma_22 = MassAddition(Input=strnum_14.numbers)  # -> flatten(Result), PartialResults; disabled

toggle_49 = BooleanToggle(True)  # disabled
pt_6 = Point(<point referenced from the Rhino model>)  # disabled
panel_700 = Panel("1")  # disabled
adaptivecomfortcalculator_2 = Ladybug_AdaptiveComfortCalculator(
    dryBulbTemperature=readepresult.airTemperature,
    meanRadiantTemperature=readepresult.meanRadTemperature,
    outdoorTemperature=importepw_2.dryBulbTemperature,
    windSpeed=panel_700,
    comfortPar=adaptcomfortpar,
    runIt=toggle_49)  # -> readMe, port, comfortableOrNot, conditionOfPerson, degreesFromTarget, port_2, targetTemperature, upperTemperatureBound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; disabled; plug-in component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
adaptivechart = Ladybug_AdaptiveComfortChart(
    dryBulbTemperature=readepresult.airTemperature,
    meanRadiantTemperature=readepresult.meanRadTemperature,
    outdoorTemperature=importepw_2.dryBulbTemperature,
    windSpeed=panel_700,
    comfortPar=adaptcomfortpar,
    basePoint=pt_6,
    runIt=toggle_49)  # -> readMe, comfPercentOfTime, percentHotCold, comfortableOrNot, conditionOfPerson, degreesFromTarget, prevailingTemp, targetTemperature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; disabled; plug-in component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

# ----
# exclude
# unconditioned zones
# using total solar gain results
data_224 = Data(equals_71.Equality)  # disabled

# ----
# Cull Unconditioned Zones
series_53 = Series(Start=0, Step=1, Count=lng_124)  # disabled
dispatch_109 = Dispatch(List=series_53, DispatchPattern=data_224)  # -> ListA, ListB; disabled
branch_31 = TreeBranch(Tree=readepresult.operativeTemperature, Path=dispatch_109.ListB, MaintainPaths=True)  # disabled

# ----
# exclude
# unconditioned zones
# using total solar gain results
data_225 = Data(equals_71.Equality)  # disabled

# ----
# Cull Unconditioned Zones
series_54 = Series(Start=0, Step=1, Count=lng_125)  # disabled
dispatch_110 = Dispatch(List=series_54, DispatchPattern=data_225)  # -> ListA, ListB; disabled
branch_32 = TreeBranch(Tree=readepresult.airTemperature, Path=dispatch_110.ListB, MaintainPaths=True)  # disabled

panel_701 = Panel("1")  # disabled
panel_702 = Panel("cullOfficeUnits")  # disabled
equals_72 = Equality(FirstNumber=data_126, SecondNumber=panel_701)  # -> Equality, Inequality; disabled
dispatch_111 = Dispatch(List=dispatch_108.ListB, DispatchPattern=equals_72.Equality)  # -> ListA, ListB; disabled

# ----
# opaque Conduction
strnum_15 = Ladybug_SeparateData(inputList=flatten(readepsrfresult_2.opaqueEnergyFlow))  # -> numbers, strings; disabled; plug-in component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
ma_23 = MassAddition(Input=strnum_15.numbers)  # -> Result, PartialResults; disabled
panel_703 = Panel(strnum_15.numbers)  # disabled
tstat_29 = TreeStatistics(Tree=readepsrfresult_2.opaqueEnergyFlow)  # -> Paths, Length, Count; disabled
tstat_30 = TreeStatistics(Tree=ma_23.Result)  # -> Paths, Length, Count; disabled
replace_37 = ReplacePaths(Data=ma_23.Result, Search=tstat_30.Paths, Replace=tstat_29.Paths)  # disabled
pshift_11 = ShiftPaths(Data=replace_37, Offset=-1)  # disabled
ma_24 = MassAddition(Input=pshift_11)  # -> flatten(Result), PartialResults; disabled

panel_704 = Panel("1")  # disabled
equals_73 = Equality(FirstNumber=data_126, SecondNumber=panel_704)  # -> Equality, Inequality; disabled
dispatch_112 = Dispatch(List=ma_14.Result, DispatchPattern=equals_73.Equality)  # -> ListA, ListB; disabled

# ----
# glazing Conduction
strnum_16 = Ladybug_SeparateData(inputList=flatten(readepsrfresult_2.glazEnergyFlow))  # -> numbers, strings; disabled; plug-in component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
panel_706 = Panel(strnum_16.numbers)  # disabled
ma_25 = MassAddition(Input=strnum_16.numbers)  # -> Result, PartialResults; disabled
tstat_31 = TreeStatistics(Tree=readepsrfresult_2.glazEnergyFlow)  # -> Paths, Length, Count; disabled
tstat_32 = TreeStatistics(Tree=ma_25.Result)  # -> Paths, Length, Count; disabled
replace_38 = ReplacePaths(Data=ma_25.Result, Search=tstat_32.Paths, Replace=tstat_31.Paths)  # disabled
pshift_12 = ShiftPaths(Data=replace_38, Offset=-1)  # disabled
ma_26 = MassAddition(Input=pshift_12)  # -> flatten(Result), PartialResults; disabled
panel_707 = Panel(ma_26.Result)  # disabled

panel_708 = Panel("1")  # disabled
equals_74 = Equality(FirstNumber=data_126, SecondNumber=panel_708)  # -> Equality, Inequality; disabled
dispatch_113 = Dispatch(List=ma_22.Result, DispatchPattern=equals_74.Equality)  # -> ListA, ListB; disabled

panel_710 = Panel("1")  # disabled
equals_75 = Equality(FirstNumber=data_126, SecondNumber=panel_710)  # -> Equality, Inequality; disabled
dispatch_114 = Dispatch(List=ma_21.Result, DispatchPattern=equals_75.Equality)  # -> ListA, ListB; disabled

strnum_17 = Ladybug_SeparateData(inputList=flatten(branch_31))  # -> numbers, strings; disabled; plug-in component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

panel_712 = Panel("1")  # disabled
equals_76 = Equality(FirstNumber=data_126, SecondNumber=panel_712)  # -> Equality, Inequality; disabled
dispatch_115 = Dispatch(List=ma_20.Result, DispatchPattern=equals_76.Equality)  # -> ListA, ListB; disabled

# ----
# Air Temperature
strnum_18 = Ladybug_SeparateData(inputList=flatten(branch_32))  # -> numbers, strings; disabled; plug-in component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

panel_714 = Panel("1")  # disabled
equals_77 = Equality(FirstNumber=data_126, SecondNumber=panel_714)  # -> Equality, Inequality; disabled
dispatch_116 = Dispatch(List=dispatch_107.ListB, DispatchPattern=equals_77.Equality)  # -> ListA, ListB; disabled

panel_716 = Panel("1")  # disabled
equals_78 = Equality(FirstNumber=data_126, SecondNumber=panel_716)  # -> Equality, Inequality; disabled
dispatch_117 = Dispatch(List=dispatch_106.ListB, DispatchPattern=equals_78.Equality)  # -> ListA, ListB; disabled

panel_718 = Panel("occupiedHours")  # disabled
dispatch_118 = Dispatch(List=strnum_17.numbers, DispatchPattern=equals_17.Equality)  # -> ListA, ListB; disabled

dispatch_119 = Dispatch(List=strnum_18.numbers, DispatchPattern=equals_17.Equality)  # -> ListA, ListB; disabled

flrnorm_7 = Honeybee_NormalizeDataByFloorArea(simData=readepresult.electricLight, HBZones=flatten(geo_96))  # -> totNormData, zoneNormData; disabled; plug-in component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
strnum_19 = Ladybug_SeparateData(inputList=flatten(flrnorm_7.zoneNormData))  # -> numbers, strings; disabled; plug-in component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
ma_27 = MassAddition(Input=strnum_19.numbers)  # -> flatten(Result), PartialResults; disabled

subtraction_13 = Subtraction(A=dispatch_118.ListA, B=dispatch_23.ListA)  # disabled
python_51 = GhPythonScript(x=subtraction_13)  # -> out, a; disabled
# ---------- python_51: Python ----------
__author__ = "Siser"
__version__ = "2022.03.16"

import rhinoscriptsyntax as rs
if x > 0:
    a = x
else:
    a = 0
# ---------- end python_51 ----------

# ----
# ELECTRICEQUIP ENERGY DEMAND
# (kWh/sqm)
flrnorm_8 = Honeybee_NormalizeDataByFloorArea(simData=readepresult.electricEquip, HBZones=flatten(geo_96))  # -> totNormData, zoneNormData; disabled; plug-in component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
strnum_20 = Ladybug_SeparateData(inputList=flatten(flrnorm_8.zoneNormData))  # -> numbers, strings; disabled; plug-in component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
ma_28 = MassAddition(Input=strnum_20.numbers)  # -> flatten(Result), PartialResults; disabled

# ----
# HEATING ENERGY DEMAND
# (kWh/sqm)
division_27 = Division(A=dispatch_113.ListB, B=weave_27)  # disabled

# ----
# MECHANICALVENTILATION
# ELECTRICLIGHT DEMAND
# (kWh/sqm)
flrnorm_9 = Honeybee_NormalizeDataByFloorArea(simData=readepresult.mechVentilationEnergy, HBZones=flatten(geo_96))  # -> totNormData, zoneNormData; disabled; plug-in component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
strnum_21 = Ladybug_SeparateData(inputList=flatten(flrnorm_9.zoneNormData))  # -> numbers, strings; disabled; plug-in component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
ma_29 = MassAddition(Input=strnum_21.numbers)  # -> flatten(Result), PartialResults; disabled

# ----
# MEANRADIANTTEMPERATURE
strnum_22 = Ladybug_SeparateData(inputList=flatten(readepresult.meanRadTemperature))  # -> numbers, strings; disabled; plug-in component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
avr_10 = Average(Input=strnum_22.numbers)  # disabled
dispatch_120 = Dispatch(List=flatten(avr_10), DispatchPattern=equals_71.Equality)  # -> ListA, ListB; disabled

subtraction_14 = Subtraction(A=doy_hoy_4.HOY, B=doy_hoy_2.HOY)  # disabled
series_55 = Series(Start=doy_hoy_2.HOY, Step=1, Count=subtraction_14)  # disabled
item_272 = ListItem(List=dispatch_119.ListA, Index=series_55, Wrap=True)  # disabled

# ----
# Operative Temperature
strnum_23 = Ladybug_SeparateData(inputList=flatten(readepresult.operativeTemperature))  # -> numbers, strings; disabled; plug-in component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
avr_11 = Average(Input=strnum_23.numbers)  # disabled
dispatch_121 = Dispatch(List=flatten(avr_11), DispatchPattern=equals_71.Equality)  # -> ListA, ListB; disabled

# ----
# https://www.sciencedirect.com/science/article/pii/S0360132317302664?via%3Dihub
# https://www.researchgate.net/publication/280443859_ASSESSMENT_OF_OVERHEATING_RISK_IN_DWELLINGS
# https://docs.google.com/document/d/1_ABXp2oo5wBXnJP1ug-vCfKyITPYSoL8V3BUiou2ZRM/edit
panel_722 = Panel("1May-30Sept")  # disabled
subtraction_15 = Subtraction(A=doy_hoy_6.HOY, B=doy_hoy_5.HOY)  # disabled
series_56 = Series(Start=doy_hoy_5.HOY, Step=1, Count=subtraction_15)  # disabled
# https://www.zerocarbonhub.org/sites/default/files/resources/reports/ZCH-OverheatingEvidenceReview-Definitions.pdf
item_273 = ListItem(List=python_51.a, Index=series_56, Wrap=True)  # disabled

adaptivechart_2 = Ladybug_AdaptiveComfortChart(
    dryBulbTemperature=readepresult.airTemperature,
    meanRadiantTemperature=readepresult.meanRadTemperature,
    outdoorTemperature=importepw_2.dryBulbTemperature,
    windSpeed=air_speed_from_ceiling_fans,
    comfortPar=adaptcomfortpar_2,
    basePoint=pt_3,
    runIt=toggle_23)  # -> readMe, comfPercentOfTime, percentHotCold, comfortableOrNot, conditionOfPerson, degreesFromTarget, prevailingTemp, targetTemperature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; disabled; plug-in component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

panel_725 = Panel("1")  # disabled
equals_79 = Equality(FirstNumber=data_126, SecondNumber=panel_725)  # -> Equality, Inequality; disabled
dispatch_122 = Dispatch(List=flatten(ma_26.Result), DispatchPattern=equals_79.Equality)  # -> ListA, ListB; disabled

panel_726 = Panel("0")  # disabled
equals_80 = Equality(FirstNumber=ma_18.Result, SecondNumber=panel_726)  # -> Equality, Inequality; disabled
dispatch_123 = Dispatch(List=ma_27.Result, DispatchPattern=equals_80.Equality)  # -> ListA, ListB; disabled

# ----
# GWP heating
panel_727 = Panel("0.181")  # disabled
multiplication_26 = Multiplication(A=division_27, B=panel_727)  # disabled

panel_728 = Panel("1")  # disabled
equals_81 = Equality(FirstNumber=data_126, SecondNumber=panel_728)  # -> Equality, Inequality; disabled
dispatch_124 = Dispatch(List=ma_28.Result, DispatchPattern=equals_81.Equality)  # -> ListA, ListB; disabled

sort_43 = SortList(Keys=ma_24.Result)  # -> Keys, ValuesA; disabled
cull_i_37 = CullIndex(List=sort_43.Keys, Indices=neg_2, Wrap=True)  # disabled

panel_730 = Panel("1")  # disabled
equals_82 = Equality(FirstNumber=data_126, SecondNumber=panel_730)  # -> Equality, Inequality; disabled
dispatch_125 = Dispatch(List=dispatch_120.ListB, DispatchPattern=equals_82.Equality)  # -> ListA, ListB; disabled

panel_732 = Panel("1")  # disabled
equals_83 = Equality(FirstNumber=data_126, SecondNumber=panel_732)  # -> Equality, Inequality; disabled
dispatch_126 = Dispatch(List=ma_29.Result, DispatchPattern=equals_83.Equality)  # -> ListA, ListB; disabled

panel_734 = Panel("1")  # disabled
equals_84 = Equality(FirstNumber=data_126, SecondNumber=panel_734)  # -> Equality, Inequality; disabled
dispatch_127 = Dispatch(List=dispatch_121.ListB, DispatchPattern=equals_84.Equality)  # -> ListA, ListB; disabled

panel_736 = Panel("1")  # disabled
equals_85 = Equality(FirstNumber=data_126, SecondNumber=panel_736)  # -> Equality, Inequality; disabled
dispatch_128 = Dispatch(List=dispatch_123.ListB, DispatchPattern=equals_85.Equality)  # -> ListA, ListB; disabled

# ----
# GWP electricity
merge_181 = Merge(Data1=graft(dispatch_128.ListB), Data2=graft(dispatch_124.ListB))  # disabled
ma_30 = MassAddition(Input=merge_181)  # -> flatten(Result), PartialResults; disabled
panel_738 = Panel("0.545")  # disabled
multiplication_27 = Multiplication(A=ma_30.Result, B=panel_738)  # disabled

preview_30 = CustomPreview(Geometry=[adaptivechart_2.chartCurvesAndTxt, adaptivechart_2.comfortPolygons], Shader=swatch_7)  # disabled

ma_31 = MassAddition(Input=item_273)  # -> flatten(Result), PartialResults; disabled
division_28 = Division(A=ma_31.Result, B=subtraction_15)  # disabled

panel_739 = Panel("1")  # disabled
equals_86 = Equality(FirstNumber=data_126, SecondNumber=panel_739)  # -> Equality, Inequality; disabled
dispatch_129 = Dispatch(List=flatten(cull_i_37), DispatchPattern=equals_86.Equality)  # -> ListA, ListB; disabled

mesh = Mesh(adaptivechart_2.adaptiveChartMesh)  # disabled

# ----
# IOD
data_226 = Data(division_28)  # disabled
null_22 = NullItem(Item=data_226)  # -> NullFlags, InvalidFlags, Description; disabled
dispatch_130 = Dispatch(List=data_226, DispatchPattern=null_22.NullFlags)  # -> ListA, ListB; disabled

panel_741 = Panel("1")  # disabled
equals_87 = Equality(FirstNumber=data_126, SecondNumber=panel_741)  # -> Equality, Inequality; disabled
dispatch_131 = Dispatch(List=dispatch_130.ListB, DispatchPattern=equals_87.Equality)  # -> ListA, ListB; disabled

panel_743 = Panel("11")  # disabled
panel_744 = Panel("4")  # disabled
panel_745 = Panel("7")  # disabled
panel_746 = Panel("12")  # disabled
panel_747 = Panel("5")  # disabled
panel_748 = Panel("9")  # disabled
panel_749 = Panel("2")  # disabled
panel_750 = Panel("8")  # disabled
panel_751 = Panel("10")  # disabled
panel_752 = Panel("3")  # disabled
panel_753 = Panel("6")  # disabled
panel_754 = Panel("13")  # disabled
branch_33 = TreeBranch(Tree=item_272, Path=panel_743, MaintainPaths=True)  # disabled
branch_34 = TreeBranch(Tree=item_272, Path=panel_744, MaintainPaths=True)  # disabled
branch_35 = TreeBranch(Tree=item_272, Path=panel_746, MaintainPaths=True)  # disabled
branch_36 = TreeBranch(Tree=item_272, Path=panel_747, MaintainPaths=True)  # disabled
branch_37 = TreeBranch(Tree=item_272, Path=panel_745, MaintainPaths=True)  # disabled
branch_38 = TreeBranch(Tree=item_272, Path=panel_748, MaintainPaths=True)  # disabled
branch_39 = TreeBranch(Tree=item_272, Path=panel_749, MaintainPaths=True)  # disabled
branch_40 = TreeBranch(Tree=item_272, Path=panel_750, MaintainPaths=True)  # disabled
branch_41 = TreeBranch(Tree=item_272, Path=panel_754, MaintainPaths=True)  # disabled
branch_42 = TreeBranch(Tree=item_272, Path=panel_753, MaintainPaths=True)  # disabled
branch_43 = TreeBranch(Tree=item_272, Path=panel_751, MaintainPaths=True)  # disabled
branch_44 = TreeBranch(Tree=item_272, Path=panel_752, MaintainPaths=True)  # disabled
weave_63 = Weave(
    Pattern=[0, 1, 2, 3, 4, 5, 6, 7, 8, 9, 10, 11],
    Stream0=branch_39,
    Stream1=branch_44,
    Stream2=branch_34,
    Stream3=branch_36,
    Stream4=branch_42,
    Stream5=branch_37,
    Stream6=branch_40,
    Stream7=branch_38,
    Stream8=branch_43,
    Stream9=branch_33,
    Stream10=branch_35,
    Stream11=branch_41,
    NullGaps=False)  # disabled

lng_149 = ListLength(List=dispatch_131.ListB)  # disabled

partition_68 = PartitionList(List=weave_63, Size=lng_149)  # -> simplify(Chunks); disabled
series_57 = Series(Start=0, Step=1, Count=lng_149)  # disabled
panel_755 = Panel(",")  # disabled
join_43 = TextJoin(Text=partition_68, Join=panel_755)  # -> simplify(Result); disabled

tstat_33 = TreeStatistics(Tree=join_43)  # -> Paths, Length, Count; disabled
lng_150 = ListLength(List=tstat_33.Length)  # disabled
series_58 = Series(Start=0, Step=1, Count=lng_150)  # disabled
panel_756 = Panel("}")  # disabled
dup_182 = DuplicateData(Data=panel_756, Number=lng_150, Order=True)  # disabled
panel_757 = Panel(";")  # disabled
dup_183 = DuplicateData(Data=panel_757, Number=lng_150, Order=True)  # disabled
dup_184 = DuplicateData(Data=item_222, Number=lng_150, Order=True)  # disabled
panel_758 = Panel("{")  # disabled
dup_185 = DuplicateData(Data=panel_758, Number=lng_150, Order=True)  # disabled
merge_182 = Merge(
    Data1=simplify(graft(dup_185)),
    Data2=simplify(graft(dup_184)),
    Data3=simplify(graft(dup_183)),
    Data4=simplify(graft(series_58)),
    Data5=simplify(graft(dup_182)))  # disabled
join_44 = TextJoin(Text=merge_182)  # disabled
replace_39 = ReplacePaths(Data=join_43, Search=flatten(tstat_33.Paths), Replace=flatten(join_44))  # disabled

# ----
# https://discourse.mcneel.com/t/improvement-of-data-recorder-rec/56940/7
toggle_50 = BooleanToggle(True)  # disabled
panel_759 = Panel("1000000")  # disabled
panel_760 = Panel("improved data recorder")  # disabled
data_rec = PythonScript(x=replace_39, enable=toggle_50, reset=button, limit=panel_759)  # -> x; inputs x: tree, enable: Boolean, reset: Boolean, limit: Int32; disabled
# ---------- data_rec: Python ----------
from Grasshopper import DataTree
if reset or 'rec' not in globals(): rec = DataTree[object]()
if enable and not reset: rec.MergeTree(x)
if limit > 0:
  for branch in rec.Branches:
    if branch.Count > limit:
      branch.RemoveRange(0, branch.Count - limit)
x = rec
# ---------- end data_rec ----------

toggle_51 = BooleanToggle(True)  # disabled
panel_761 = Panel("csv recording")  # disabled
path_26 = FilePath("C:\KBEM\IP2.1\csv\IODannual.csv")  # disabled
c_script_2 = CSharpScript(save=toggle_51, path=path_26, data=flatten(data_rec))  # inputs save: Boolean, path: String, data: list of String; disabled
# ---------- c_script_2: C# ----------
    if(save){
      var fileinfo = new System.IO.FileInfo(path);
      if(!fileinfo.Directory.Exists){
        fileinfo.Directory.Create();
      }
      
      var sw = fileinfo.CreateText();
      for(int i = 0; i < data.Count; i++){
        string row = data[i];
        if(i < data.Count - 1){
          sw.WriteLine(row);
        }else{
          sw.Write(row);
        }
      }
      
      sw.Flush();
      sw.Close();
    }
# ---------- end c_script_2 ----------

# ----
# Solar Gain
flrnorm_10 = Honeybee_NormalizeDataByFloorArea(simData=readepresult.totalSolarGain, HBZones=flatten(geo_96))  # -> totNormData, zoneNormData; disabled; plug-in component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
strnum_24 = Ladybug_SeparateData(inputList=flatten(flrnorm_10.zoneNormData))  # -> numbers, strings; disabled; plug-in component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
ma_32 = MassAddition(Input=strnum_24.numbers)  # -> flatten(Result), PartialResults; disabled
panel_762 = Panel("0")  # disabled
lng_151 = ListLength(List=ma_32.Result)  # disabled
equals_88 = Equality(FirstNumber=ma_32.Result, SecondNumber=panel_762)  # -> Equality, Inequality; disabled
series_59 = Series(Start=0, Step=1, Count=lng_151)  # disabled
dispatch_132 = Dispatch(List=series_59, DispatchPattern=equals_88.Equality)  # -> ListA, ListB; disabled

avr_12 = Average(Input=dispatch_131.ListB)  # disabled
avr_13 = Average(Input=dispatch_113.ListB)  # disabled
ma_33 = MassAddition(Input=dispatch_131.ListB)  # -> Result, PartialResults; disabled
ma_34 = MassAddition(Input=dispatch_113.ListB)  # -> Result, PartialResults; disabled

# ----
# equipment
strnum_25 = Ladybug_SeparateData(inputList=flatten(readepresult.electricEquip))  # -> numbers, strings; disabled; plug-in component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
branch_45 = TreeBranch(Tree=strnum_25.numbers, Path=dispatch_132.ListB, MaintainPaths=True)  # disabled

# ----
# electLight
strnum_26 = Ladybug_SeparateData(inputList=flatten(readepresult.electricLight))  # -> numbers, strings; disabled; plug-in component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
branch_46 = TreeBranch(Tree=strnum_26.numbers, Path=dispatch_132.ListB, MaintainPaths=True)  # disabled

flip = FlipMatrix(Data=branch_45)  # disabled
avr_14 = Average(Input=flip)  # -> flatten(ArithmeticMean); disabled

flip_2 = FlipMatrix(Data=branch_46)  # disabled
avr_15 = Average(Input=flip_2)  # -> flatten(ArithmeticMean); disabled

panel_763 = Panel("2")  # disabled
roundd_19 = RoundToDecimalPlace(NumberX=avr_14, DecimalPlace=panel_763, RoundType=0)  # -> Rounded, Difference; disabled

# ----
# AirTemp
strnum_27 = Ladybug_SeparateData(inputList=flatten(readepresult.airTemperature))  # -> numbers, strings; disabled; plug-in component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
branch_47 = TreeBranch(Tree=strnum_27.numbers, Path=dispatch_132.ListB, MaintainPaths=True)  # disabled

# ----
# OperativeTemp
strnum_28 = Ladybug_SeparateData(inputList=flatten(readepresult.operativeTemperature))  # -> numbers, strings; disabled; plug-in component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
branch_48 = TreeBranch(Tree=strnum_28.numbers, Path=dispatch_132.ListB, MaintainPaths=True)  # disabled

panel_764 = Panel("2")  # disabled
roundd_20 = RoundToDecimalPlace(NumberX=avr_15, DecimalPlace=panel_764, RoundType=0)  # -> Rounded, Difference; disabled

# ----
# AdaptiveComfort
# MeanRadAirTemp
strnum_29 = Ladybug_SeparateData(inputList=flatten(readepresult.meanRadTemperature))  # -> numbers, strings; disabled; plug-in component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
branch_49 = TreeBranch(Tree=strnum_29.numbers, Path=dispatch_132.ListB, MaintainPaths=True)  # disabled

flip_3 = FlipMatrix(Data=branch_47)  # disabled
avr_16 = Average(Input=flip_3)  # -> flatten(ArithmeticMean); disabled

flip_4 = FlipMatrix(Data=branch_48)  # disabled
avr_17 = Average(Input=flip_4)  # -> flatten(ArithmeticMean); disabled

flip_5 = FlipMatrix(Data=branch_49)  # disabled
avr_18 = Average(Input=flip_5)  # -> flatten(ArithmeticMean); disabled

panel_765 = Panel("2")  # disabled
roundd_21 = RoundToDecimalPlace(NumberX=avr_17, DecimalPlace=panel_765, RoundType=0)  # -> Rounded, Difference; disabled

panel_766 = Panel("2")  # disabled
roundd_22 = RoundToDecimalPlace(NumberX=avr_16, DecimalPlace=panel_766, RoundType=0)  # -> Rounded, Difference; disabled

panel_767 = Panel("2")  # disabled
roundd_23 = RoundToDecimalPlace(NumberX=avr_18, DecimalPlace=panel_767, RoundType=0)  # -> Rounded, Difference; disabled

toggle_52 = BooleanToggle(True)  # disabled
c_script_3 = CSharpScript(save=toggle_52, path=join_20, data=flatten(roundd_19.Rounded))  # inputs save: Boolean, path: String, data: list of String; disabled; same code as c_script_2

toggle_53 = BooleanToggle(True)  # disabled
c_script_4 = CSharpScript(save=toggle_53, path=join_21, data=flatten(roundd_20.Rounded))  # inputs save: Boolean, path: String, data: list of String; disabled; same code as c_script_2

toggle_54 = BooleanToggle(True)  # disabled
c_script_5 = CSharpScript(save=toggle_54, path=join_25, data=flatten(roundd_21.Rounded))  # inputs save: Boolean, path: String, data: list of String; disabled; same code as c_script_2

toggle_55 = BooleanToggle(True)  # disabled
c_script_6 = CSharpScript(save=toggle_55, path=join_26, data=flatten(roundd_22.Rounded))  # inputs save: Boolean, path: String, data: list of String; disabled; same code as c_script_2

toggle_56 = BooleanToggle(True)  # disabled
c_script_7 = CSharpScript(save=toggle_56, path=join_27, data=flatten(roundd_23.Rounded))  # inputs save: Boolean, path: String, data: list of String; disabled; same code as c_script_2

intcrv_2 = Interpolate(Vertices=merge_153, Degree=3, Periodic=Toggle(True), KnotStyle=1)  # -> flatten(Curve), Length, Domain

area_93 = Area(Geometry=intcrv_2.Curve)  # -> Area, Centroid
# regions start from north
# continues counter-clockwise
pdecon_25 = Deconstruct(Point=area_93.Centroid)  # -> XComponent, YComponent, ZComponent
sort_44 = SortList(Keys=pdecon_25.YComponent, ValuesA=intcrv_2.Curve)  # -> Keys, reverse(ValuesA)
item_274 = ListItem(List=sort_44.ValuesA, Index=0, Wrap=True)

area_94 = Area(Geometry=intcrv_2.Curve)  # -> Area, Centroid
pdecon_26 = Deconstruct(Point=area_94.Centroid)  # -> XComponent, YComponent, ZComponent
sort_45 = SortList(Keys=pdecon_26.XComponent, ValuesA=intcrv_2.Curve)  # -> Keys, reverse(ValuesA)
item_275 = ListItem(List=sort_45.ValuesA, Index=0, Wrap=True)

area_95 = Area(Geometry=intcrv_2.Curve)  # -> Area, Centroid
pdecon_27 = Deconstruct(Point=area_95.Centroid)  # -> XComponent, YComponent, ZComponent
sort_46 = SortList(Keys=pdecon_27.XComponent, ValuesA=intcrv_2.Curve)  # -> Keys, ValuesA
item_276 = ListItem(List=sort_46.ValuesA, Index=0, Wrap=True)

area_96 = Area(Geometry=intcrv_2.Curve)  # -> Area, Centroid
pdecon_28 = Deconstruct(Point=area_96.Centroid)  # -> XComponent, YComponent, ZComponent
sort_47 = SortList(Keys=pdecon_28.YComponent, ValuesA=intcrv_2.Curve)  # -> Keys, ValuesA
item_277 = ListItem(List=sort_47.ValuesA, Index=0, Wrap=True)

merge_183 = Merge(Data1=item_274, Data2=item_276, Data3=item_277, Data4=item_275)

incurves_10 = PointInCurves(Point=area_70.Centroid, Curves=merge_183)  # -> Relationship, Index, Point

cull_i_38 = CullIndex(List=partition_58, Indices=incurves_10.Index, Wrap=True)  # -> simplify(List)

replace_40 = ReplaceItems(List=partition_59, Item="3", Indices=incurves_10.Index, Wrap=False)  # -> simplify(List)
replace_41 = ReplaceItems(List=replace_40, Item="2", Indices=cull_i_38, Wrap=False)

lng_152 = ListLength(List=replace_41)  # -> simplify(flatten(Length))
lng_153 = ListLength(List=lng_152)  # -> simplify(Length)
dup_186 = DuplicateData(Data=data_127, Number=lng_153, Order=True)
partition_69 = PartitionList(List=dup_186, Size=lng_88)  # -> simplify(Chunks)

mindex_10 = MemberIndex(Set=replace_41, Member="2")  # -> simplify(Index), Count

replace_42 = ReplaceItems(List=partition_69, Item="0", Indices=mindex_10.Index, Wrap=False)  # -> simplify(List)

data_227 = Data(replace_42)

equals_89 = Equality(FirstNumber=data_227, SecondNumber="0")  # -> Equality, Inequality
dispatch_133 = Dispatch(List=data_227, DispatchPattern=equals_89.Equality)  # -> ListA, ListB
tmatch_2 = MatchText(Text=data_227, Pattern=dispatch_133.ListB, Case=True)
python_52 = GhPythonScript(x=tmatch_2)  # -> out, a; inputs x: list
# ---------- python_52: Python ----------
__author__ = "Siser"
__version__ = "2022.02.23"

import rhinoscriptsyntax as rs
TrueList=[]
for i in range(len(x)):
    if x[i] == 'True':
        TrueList.append(i)
    else:
        pass
a = TrueList
# ---------- end python_52 ----------

# ----
# ObstacleShadingCoefficient_IC
mindex_11 = MemberIndex(Set=data_227)  # -> Index, Count; disabled
panel_773 = Panel(pshift_10)

# ----
# SkyExposure_ic
panel_774 = Panel("0")
shadingmask = Ladybug_ShadingMask(centerPtOrPlane=area_68.Centroid, context=hb_epcontextsrf)  # -> contextMask, orientationMask, strategyMask, skyMask, port, contextExposure, orientExposure, strategyExposure, skyExposure; plug-in component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
equals_90 = Equality(FirstNumber=data_227, SecondNumber=panel_774)  # -> Equality, Inequality
dispatch_134 = Dispatch(List=data_227, DispatchPattern=equals_90.Equality)  # -> ListA, ListB
tmatch_3 = MatchText(Text=data_227, Pattern=dispatch_134.ListB, Case=True)
python_53 = GhPythonScript(x=tmatch_3)  # -> out, a; inputs x: list; same code as python_52
replace_43 = ReplaceItems(List=data_227, Item=shadingmask.skyExposure, Indices=python_53.a, Wrap=False)  # -> simplify(List)
panel_775 = Panel(replace_43)

data_228 = Data(replace_42)

# ----
# Window area/floor area
# Obstacle
# Shading
# Coefficient_IC
debrep_31 = DeconstructBrep(Brep=mass2zone_2.HBZones)  # -> simplify(Faces), Edges, Vertices
item_278 = ListItem(List=debrep_31.Faces, Index=0, Wrap=True)
area_97 = Area(Geometry=decomposebytype.windows)  # -> Area, Centroid
area_98 = Area(Geometry=item_278)  # -> Area, Centroid
division_29 = Division(A=simplify(area_97.Area), B=area_98.Area)
replace_44 = ReplaceItems(List=data_228, Item=division_29, Indices=python_52.a, Wrap=False)  # -> simplify(List)

data_229 = Data(replace_42)

data_230 = Data(replace_42)

# ----
# summation record
# (it gives
# one result for each
# window unit)
replace_45 = ReplaceItems(List=data_229, Item=pshift_10, Indices=python_52.a, Wrap=False)  # -> simplify(List)

# ----
# average record
# (it gives
# one result for each
# window unit)
replace_46 = ReplaceItems(List=data_230, Item=pshift_9, Indices=python_52.a, Wrap=False)  # -> simplify(List)

# ----
# WWRDirectionUnitNorth
item_279 = ListItem(List=replace_42, Index=0, Wrap=True)  # -> flatten(Item)

# ----
# WWRDirectionUnitSouth
item_280 = ListItem(List=replace_42, Index=2, Wrap=True)  # -> flatten(Item)

# ----
# WWRDirectionUnitEast
item_281 = ListItem(List=replace_42, Index=3, Wrap=True)  # -> flatten(Item)

# ----
# WWRDirectionUnitWest
item_282 = ListItem(List=replace_42, Index=1, Wrap=True)  # -> flatten(Item)

# ----
# AvOSC South
item_283 = ListItem(List=replace_46, Index=2, Wrap=True)  # -> flatten(Item)

# ----
# AvOSC North
item_284 = ListItem(List=replace_46, Index=0, Wrap=True)  # -> flatten(Item)

# ----
# AvOSC East
item_285 = ListItem(List=replace_46, Index=3, Wrap=True)  # -> flatten(Item)

# ----
# AvOSC West
item_286 = ListItem(List=replace_46, Index=1, Wrap=True)  # -> flatten(Item)

equals_91 = Equality(FirstNumber=data_126, SecondNumber="1")  # -> Equality, Inequality
dispatch_135 = Dispatch(List=item_279, DispatchPattern=equals_91.Equality)  # -> ListA, ListB

equals_92 = Equality(FirstNumber=data_126, SecondNumber="1")  # -> Equality, Inequality
dispatch_136 = Dispatch(List=item_280, DispatchPattern=equals_92.Equality)  # -> ListA, ListB

equals_93 = Equality(FirstNumber=data_126, SecondNumber="1")  # -> Equality, Inequality
dispatch_137 = Dispatch(List=item_282, DispatchPattern=equals_93.Equality)  # -> ListA, ListB

equals_94 = Equality(FirstNumber=data_126, SecondNumber="1")  # -> Equality, Inequality
dispatch_138 = Dispatch(List=item_281, DispatchPattern=equals_94.Equality)  # -> ListA, ListB

equals_95 = Equality(FirstNumber=data_126, SecondNumber="1")  # -> Equality, Inequality
dispatch_139 = Dispatch(List=item_284, DispatchPattern=equals_95.Equality)  # -> ListA, ListB

equals_96 = Equality(FirstNumber=data_126, SecondNumber="1")  # -> Equality, Inequality
dispatch_140 = Dispatch(List=item_283, DispatchPattern=equals_96.Equality)  # -> ListA, ListB

equals_97 = Equality(FirstNumber=data_126, SecondNumber="1")  # -> Equality, Inequality
dispatch_141 = Dispatch(List=item_285, DispatchPattern=equals_97.Equality)  # -> ListA, ListB

equals_98 = Equality(FirstNumber=data_126, SecondNumber="1")  # -> Equality, Inequality
dispatch_142 = Dispatch(List=item_286, DispatchPattern=equals_98.Equality)  # -> ListA, ListB

# ----
# SumOSC North
item_287 = ListItem(List=replace_45, Index=0, Wrap=True)  # -> flatten(Item)

# ----
# SumOSC West
item_288 = ListItem(List=replace_45, Index=1, Wrap=True)  # -> flatten(Item)

# ----
# SumOSC East
item_289 = ListItem(List=replace_45, Index=3, Wrap=True)  # -> flatten(Item)

# ----
# W/F East
item_290 = ListItem(List=replace_44, Index=3, Wrap=True)  # -> flatten(Item)

# ----
# SumOSC South
item_291 = ListItem(List=replace_45, Index=2, Wrap=True)  # -> flatten(Item)

# ----
# W/F North
item_292 = ListItem(List=replace_44, Index=0, Wrap=True)  # -> flatten(Item)

# ----
# W/F South
item_293 = ListItem(List=replace_44, Index=2, Wrap=True)  # -> flatten(Item)

# ----
# W/F West
item_294 = ListItem(List=replace_44, Index=1, Wrap=True)  # -> flatten(Item)

equals_99 = Equality(FirstNumber=data_126, SecondNumber="1")  # -> Equality, Inequality
dispatch_143 = Dispatch(List=item_287, DispatchPattern=equals_99.Equality)  # -> ListA, ListB

equals_100 = Equality(FirstNumber=data_126, SecondNumber="1")  # -> Equality, Inequality
dispatch_144 = Dispatch(List=item_289, DispatchPattern=equals_100.Equality)  # -> ListA, ListB

equals_101 = Equality(FirstNumber=data_126, SecondNumber="1")  # -> Equality, Inequality
dispatch_145 = Dispatch(List=item_288, DispatchPattern=equals_101.Equality)  # -> ListA, ListB

equals_102 = Equality(FirstNumber=data_126, SecondNumber="1")  # -> Equality, Inequality
dispatch_146 = Dispatch(List=item_293, DispatchPattern=equals_102.Equality)  # -> ListA, ListB

equals_103 = Equality(FirstNumber=data_126, SecondNumber="1")  # -> Equality, Inequality
dispatch_147 = Dispatch(List=item_291, DispatchPattern=equals_103.Equality)  # -> ListA, ListB

equals_104 = Equality(FirstNumber=data_126, SecondNumber="1")  # -> Equality, Inequality
dispatch_148 = Dispatch(List=item_294, DispatchPattern=equals_104.Equality)  # -> ListA, ListB

equals_105 = Equality(FirstNumber=data_126, SecondNumber="1")  # -> Equality, Inequality
dispatch_149 = Dispatch(List=item_292, DispatchPattern=equals_105.Equality)  # -> ListA, ListB

equals_106 = Equality(FirstNumber=data_126, SecondNumber="1")  # -> Equality, Inequality
dispatch_150 = Dispatch(List=item_290, DispatchPattern=equals_106.Equality)  # -> ListA, ListB

separatezonesbyprogram = Honeybee_SeparateZonesByProgram(HBZones=flatten(conditionedunconditioned_7.conditionedZones))  # -> zonePrograms, HBZones; plug-in component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

mindex_12 = MemberIndex(Set=flatten(separatezonesbyprogram.zonePrograms), Member="MidriseApartment::Office")  # -> Index, Count

branch_50 = TreeBranch(Tree=separatezonesbyprogram.HBZones, Path=mindex_12.Index, MaintainPaths=True)

area_99 = Area(Geometry=geo_98)  # -> Area, Centroid
area_100 = Area(Geometry=branch_50)  # -> Area, Centroid
cps_2 = ClosestPoints(Point=area_100.Centroid, Cloud=area_99.Centroid, Count="1")  # -> ClosestPoint, flatten(CPIndex), Distance
panel_795 = Panel("find office units")
panel_796 = Panel(cps_2.CPIndex)

# ----
# floorArea of Units
zoneattributelist_2 = Honeybee_ZoneAttributeList({"Name": "name", "Zone Program": "zoneProgram", "Zone Floor Area": "zoneFloorArea", "Zone Volume": "zoneVolume", "Building Program": "bldgProgram", "Is Conditioned": "isConditioned", "HVAC System Type": "HVACSystem", "Occupancy Schedule": "occupancySchedule", "Occupancy Activity Schedule": "occupancyActivitySch", "Heating SetPoint Schedule": "heatingSetPtSchedule"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}, selected="Zone Floor Area")
labelzones_2 = Honeybee_LabelZones(HBZones=flatten(conditionedunconditioned_7.conditionedZones), attribute=zoneattributelist_2)  # -> zoneTxtLabels, labelBasePts, brepTxtLabels, zoneWireFrames; plug-in component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
roundd_24 = RoundToDecimalPlace(NumberX=labelzones_2.zoneTxtLabels, DecimalPlace="1", RoundType=0)  # -> Rounded, Difference

equals_107 = Equality(FirstNumber=data_126, SecondNumber="1")  # -> Equality, Inequality
dispatch_151 = Dispatch(List=roundd_24.Rounded, DispatchPattern=equals_107.Equality)  # -> ListA, ListB

rec_8 = DataRecorder(dispatch_151.ListB, DataLimit=-10, RecordData=True)
panel_798 = Panel(rec_8)

# ----
# formFactor of Units
data_231 = Data(flatten(division_22))
roundd_25 = RoundToDecimalPlace(NumberX=data_231, DecimalPlace="3", RoundType=0)  # -> Rounded, Difference

equals_108 = Equality(FirstNumber=data_126, SecondNumber="1")  # -> Equality, Inequality
dispatch_152 = Dispatch(List=roundd_25.Rounded, DispatchPattern=equals_108.Equality)  # -> ListA, ListB

rec_9 = DataRecorder(dispatch_152.ListB, DataLimit=-10, RecordData=True)
panel_800 = Panel(rec_9)

# ----
# SkyExposure_East
item_295 = ListItem(List=replace_43, Index=3, Wrap=True)  # -> flatten(Item)

equals_109 = Equality(FirstNumber=data_126, SecondNumber="1")  # -> Equality, Inequality
dispatch_153 = Dispatch(List=item_295, DispatchPattern=equals_109.Equality)  # -> ListA, ListB

data_232 = Data(dispatch_153.ListB)
rec_10 = DataRecorder(data_232, DataLimit=-10, RecordData=True)
panel_802 = Panel(rec_10)

# ----
# SkyExposure_West
item_296 = ListItem(List=replace_43, Index=1, Wrap=True)  # -> flatten(Item)

equals_110 = Equality(FirstNumber=data_126, SecondNumber="1")  # -> Equality, Inequality
dispatch_154 = Dispatch(List=item_296, DispatchPattern=equals_110.Equality)  # -> ListA, ListB

rec_11 = DataRecorder(dispatch_154.ListB, DataLimit=-10, RecordData=True)
panel_804 = Panel(rec_11)

# ----
# SkyExposure_South
item_297 = ListItem(List=replace_43, Index=2, Wrap=True)  # -> flatten(Item)

equals_111 = Equality(FirstNumber=data_126, SecondNumber="1")  # -> Equality, Inequality
dispatch_155 = Dispatch(List=item_297, DispatchPattern=equals_111.Equality)  # -> ListA, ListB

data_233 = Data(dispatch_155.ListB)
rec_12 = DataRecorder(data_233, DataLimit=-10, RecordData=True)
panel_806 = Panel(rec_12)

# ----
# SkyExposure_North
item_298 = ListItem(List=replace_43, Index=0, Wrap=True)  # -> flatten(Item)

equals_112 = Equality(FirstNumber=data_126, SecondNumber="1")  # -> Equality, Inequality
dispatch_156 = Dispatch(List=item_298, DispatchPattern=equals_112.Equality)  # -> ListA, ListB

rec_13 = DataRecorder(dispatch_156.ListB, DataLimit=-10, RecordData=True)
panel_808 = Panel(rec_13)

list_of_recordings_2 = Panel("""parcelUBEM
blockUBEM
UnitID
verticalBoundary
formFactor
floorArea
widthToDepth
unitwwrNorth
unitwwrWest
unitwwrSouth
unitwwrEast
skyExposureNorth
skyExposureWest
skyExposureSouth
skyExposureEast
WFNorth
WFWest
WFSouth
WFEast
HeatSet
NumberOfPeople
LightDens
equipDens
ConsDate
uWall
uWindow
uRoof
uGroundFloor
SHGCWindow
VTWindow
Infiltration
UBEMOcc
boilerEfficiency
z-axisOfUnit
OSCNorthAvg
OSCWestAvg
OSCSouthAvg
OSCEastAvg
TotOSCNorth
TotOSCWest
TotOSCSouth
TotOSCEast""")

list_of_recordings_3 = Panel("""parcelUBEM
blockUBEM
UnitID
verticalPos
formFactor
floorArea
widthToDepth
unitwwrNorth
unitwwrWest
unitwwrSouth
unitwwrEast
skyExposureNorth
skyExposureEast
skyExposureSouth
skyExposureWest
WFNorth
WFWest
WFSouth
WFEast
HeatSet
PeopleDensity
LightDens
equipDens
ConsDate
uWall
uWindow
uRoof
uGroundFloor
SHGCWindow
VTWindow
Infiltration
UBEMOcc
boilerEfficiency
HeatEnUse
heating_Ideal loads
cooling_Ideal loads
opaqueConduction
glazingConduction
IOD
GWPheating
GWPelectricty
peopleGain
TotSolarGain
infiltEnergy
natVentEnergy
mechVentilation
airTemp
operativeTemp
meanRadiantTemp
electLight
electEquip
z-axisOfUnit
OSCNorthAvg
OSCWestAvg
OSCSouthAvg
OSCEastAvg
TotOSCNorth
TotOSCWest
TotOSCSouth
TotOSCEast""")  # disabled

list_of_recordings_4 = Panel("""buildingID
heatingAverage
heatingSum
IODAverage
IODSum""")  # disabled

# ----
# CSV
# RECORDINGS
# Building-Based
lng_154 = ListLength(List=list_of_recordings_4)  # disabled

# ----
# CSV
# RECORDINGS
# PARAMS
# M.L.
lng_155 = ListLength(List=list_of_recordings_2)

# ----
# CSV
# RECORDINGS
# ALL
# M.L.
lng_156 = ListLength(List=list_of_recordings_3)  # disabled

series_60 = Series(Start=0, Step=1, Count=lng_155)

weave_64 = Weave(
    Pattern=series_60,
    Stream0=dispatch_80.ListB,
    Stream1=dispatch_81.ListB,
    Stream2=join_38,
    Stream3=dispatch_77.ListB,
    Stream4=dispatch_152.ListB,
    Stream5=dispatch_151.ListB,
    Stream6=dispatch_76.ListB,
    Stream7=dispatch_135.ListB,
    Stream8=dispatch_137.ListB,
    Stream9=dispatch_136.ListB,
    Stream10=dispatch_138.ListB,
    Stream11=dispatch_156.ListB,
    Stream12=dispatch_154.ListB,
    Stream13=dispatch_155.ListB,
    Stream14=dispatch_153.ListB,
    Stream15=dispatch_149.ListB,
    Stream16=dispatch_148.ListB,
    Stream17=dispatch_146.ListB,
    Stream18=dispatch_150.ListB,
    Stream19=dispatch_66.ListB,
    Stream20=tuık,
    Stream21=data_208,
    Stream22=weave_57,
    Stream23=dispatch_87.ListB,
    Stream24=dispatch_79.ListB,
    Stream25=dispatch_25.ListB,
    Stream26=dispatch_78.ListB,
    Stream27=dispatch_26.ListB,
    Stream28=dispatch_85.ListB,
    Stream29=dispatch_84.ListB,
    Stream30=dispatch_86.ListB,
    Stream31=data_209,
    Stream32=dispatch_83.ListB,
    Stream33=dispatch_82.ListB,
    Stream34=dispatch_139.ListB,
    Stream35=dispatch_142.ListB,
    Stream36=dispatch_140.ListB,
    Stream37=dispatch_141.ListB,
    Stream38=dispatch_143.ListB,
    Stream39=dispatch_145.ListB,
    Stream40=dispatch_147.ListB,
    Stream41=dispatch_144.ListB,
    NullGaps=False)

partition_70 = PartitionList(List=weave_64, Size=lng_155)  # -> simplify(Chunks)
join_45 = TextJoin(Text=partition_70, Join=",")  # -> simplify(Result)

tstat_34 = TreeStatistics(Tree=join_45)  # -> Paths, Length, Count
lng_157 = ListLength(List=tstat_34.Length)
series_61 = Series(Start=0, Step=1, Count=lng_157)
dup_187 = DuplicateData(Data="}", Number=lng_157, Order=True)
dup_188 = DuplicateData(Data=";", Number=lng_157, Order=True)
dup_189 = DuplicateData(Data=item_223, Number=lng_157, Order=True)
dup_190 = DuplicateData(Data="{", Number=lng_157, Order=True)
merge_184 = Merge(
    Data1=simplify(graft(dup_190)),
    Data2=simplify(graft(dup_189)),
    Data3=simplify(graft(dup_188)),
    Data4=simplify(graft(series_61)),
    Data5=simplify(graft(dup_187)))
join_46 = TextJoin(Text=merge_184)
replace_47 = ReplacePaths(Data=join_45, Search=flatten(tstat_34.Paths), Replace=flatten(join_46))

# ----
# https://discourse.mcneel.com/t/improvement-of-data-recorder-rec/56940/7
toggle_57 = BooleanToggle(True)
panel_809 = Panel("improved data recorder")
data_rec_2 = PythonScript(x=replace_47, enable=toggle_57, reset=button, limit="1000000")  # -> x; inputs x: tree, enable: Boolean, reset: Boolean, limit: Int32; same code as data_rec

panel_810 = Panel(data_rec_2)

panel_811 = Panel("csv recording")
weave_65 = Weave(Pattern=list, Stream0=path_18, Stream1=path_20, Stream2=path_19, Stream3=path_21, NullGaps=False)
c_script_8 = CSharpScript(save=Toggle(True), path=weave_65, data=flatten(data_rec_2))  # inputs save: Boolean, path: String, data: list of String; same code as c_script_2

panel_812 = Panel(",")  # disabled
series_62 = Series(Start=0, Step=1, Count=lng_156)  # disabled

weave_66 = Weave(
    Pattern=series_62,
    Stream0=dispatch_80.ListB,
    Stream1=dispatch_81.ListB,
    Stream2=join_38,
    Stream3=dispatch_77.ListB,
    Stream4=dispatch_152.ListB,
    Stream5=dispatch_151.ListB,
    Stream6=dispatch_76.ListB,
    Stream7=dispatch_135.ListB,
    Stream8=dispatch_137.ListB,
    Stream9=dispatch_136.ListB,
    Stream10=dispatch_138.ListB,
    Stream11=dispatch_156.ListB,
    Stream12=data_232,
    Stream13=data_233,
    Stream14=dispatch_154.ListB,
    Stream15=dispatch_149.ListB,
    Stream16=dispatch_148.ListB,
    Stream17=dispatch_146.ListB,
    Stream18=dispatch_150.ListB,
    Stream19=dispatch_66.ListB,
    Stream20=tuık,
    Stream21=data_208,
    Stream22=weave_57,
    Stream23=dispatch_87.ListB,
    Stream24=dispatch_79.ListB,
    Stream25=dispatch_25.ListB,
    Stream26=dispatch_78.ListB,
    Stream27=dispatch_26.ListB,
    Stream28=dispatch_85.ListB,
    Stream29=dispatch_84.ListB,
    Stream30=dispatch_86.ListB,
    Stream31=data_209,
    Stream32=dispatch_83.ListB,
    Stream33=division_27,
    Stream34=dispatch_113.ListB,
    Stream35=dispatch_114.ListB,
    Stream36=dispatch_129.ListB,
    Stream37=dispatch_122.ListB,
    Stream38=dispatch_131.ListB,
    Stream39=multiplication_26,
    Stream40=multiplication_27,
    Stream41=dispatch_112.ListB,
    Stream42=dispatch_117.ListB,
    Stream43=dispatch_116.ListB,
    Stream44=dispatch_115.ListB,
    Stream45=dispatch_126.ListB,
    Stream46=dispatch_111.ListB,
    Stream47=dispatch_127.ListB,
    Stream48=dispatch_125.ListB,
    Stream49=dispatch_128.ListB,
    Stream50=dispatch_124.ListB,
    Stream51=dispatch_82.ListB,
    Stream52=dispatch_139.ListB,
    Stream53=dispatch_142.ListB,
    Stream54=dispatch_140.ListB,
    Stream55=dispatch_141.ListB,
    Stream56=dispatch_143.ListB,
    Stream57=dispatch_145.ListB,
    Stream58=dispatch_147.ListB,
    Stream59=dispatch_144.ListB,
    NullGaps=False)  # disabled

partition_71 = PartitionList(List=weave_66, Size=lng_156)  # -> simplify(Chunks); disabled
join_47 = TextJoin(Text=partition_71, Join=panel_812)  # -> simplify(Result); disabled

tstat_35 = TreeStatistics(Tree=join_47)  # -> Paths, Length, Count; disabled
lng_158 = ListLength(List=tstat_35.Length)  # disabled
series_63 = Series(Start=0, Step=1, Count=lng_158)  # disabled
panel_813 = Panel("}")  # disabled
dup_191 = DuplicateData(Data=panel_813, Number=lng_158, Order=True)  # disabled
panel_814 = Panel(";")  # disabled
dup_192 = DuplicateData(Data=panel_814, Number=lng_158, Order=True)  # disabled
panel_815 = Panel("{")  # disabled
dup_193 = DuplicateData(Data=item_224, Number=lng_158, Order=True)  # disabled
dup_194 = DuplicateData(Data=panel_815, Number=lng_158, Order=True)  # disabled
merge_185 = Merge(
    Data1=simplify(graft(dup_194)),
    Data2=simplify(graft(dup_193)),
    Data3=simplify(graft(dup_192)),
    Data4=simplify(graft(series_63)),
    Data5=simplify(graft(dup_191)))  # disabled
join_48 = TextJoin(Text=merge_185)  # disabled
replace_48 = ReplacePaths(Data=join_47, Search=flatten(tstat_35.Paths), Replace=flatten(join_48))  # disabled

# ----
# https://discourse.mcneel.com/t/improvement-of-data-recorder-rec/56940/7
toggle_58 = BooleanToggle(True)  # disabled
panel_816 = Panel("1000000")  # disabled
data_rec_3 = PythonScript(x=replace_48, enable=toggle_58, reset=button, limit=panel_816)  # -> x; inputs x: tree, enable: Boolean, reset: Boolean, limit: Int32; disabled; same code as data_rec
toggle_59 = BooleanToggle(True)  # disabled
weave_67 = Weave(Pattern=list, Stream0=path_16, Stream1=path_15, Stream2=path_17, Stream3=path_14, NullGaps=False)  # disabled
c_script_9 = CSharpScript(save=toggle_59, path=weave_67, data=flatten(data_rec_3))  # inputs save: Boolean, path: String, data: list of String; disabled; same code as c_script_2

panel_819 = Panel(data_rec_3)  # disabled

panel_820 = Panel(",")  # disabled
series_64 = Series(Start=0, Step=1, Count=lng_154)  # disabled

weave_68 = Weave(
    Pattern=series_64,
    Stream0=filename,
    Stream1=avr_13,
    Stream2=ma_34.Result,
    Stream3=avr_12,
    Stream4=ma_33.Result,
    NullGaps=False)  # disabled

partition_72 = PartitionList(List=weave_68, Size=lng_154)  # -> simplify(Chunks); disabled
join_49 = TextJoin(Text=partition_72, Join=panel_820)  # -> simplify(Result); disabled

tstat_36 = TreeStatistics(Tree=join_49)  # -> Paths, Length, Count; disabled
lng_159 = ListLength(List=tstat_36.Length)  # disabled
series_65 = Series(Start=0, Step=1, Count=lng_159)  # disabled
panel_821 = Panel("}")  # disabled
panel_822 = Panel(";")  # disabled
panel_823 = Panel("{")  # disabled
dup_195 = DuplicateData(Data=panel_821, Number=lng_159, Order=True)  # disabled
dup_196 = DuplicateData(Data=panel_822, Number=lng_159, Order=True)  # disabled
dup_197 = DuplicateData(Data=item_225, Number=lng_159, Order=True)  # disabled
dup_198 = DuplicateData(Data=panel_823, Number=lng_159, Order=True)  # disabled
merge_186 = Merge(
    Data1=simplify(graft(dup_198)),
    Data2=simplify(graft(dup_197)),
    Data3=simplify(graft(dup_196)),
    Data4=simplify(graft(series_65)),
    Data5=simplify(graft(dup_195)))  # disabled
join_50 = TextJoin(Text=merge_186)  # disabled
replace_49 = ReplacePaths(Data=join_49, Search=flatten(tstat_36.Paths), Replace=flatten(join_50))  # disabled

# ----
# https://discourse.mcneel.com/t/improvement-of-data-recorder-rec/56940/7
toggle_60 = BooleanToggle(True)  # disabled
panel_824 = Panel("1000000")  # disabled
data_rec_4 = PythonScript(x=replace_49, enable=toggle_60, reset=button, limit=panel_824)  # -> x; inputs x: tree, enable: Boolean, reset: Boolean, limit: Int32; disabled; same code as data_rec
toggle_61 = BooleanToggle(True)  # disabled
path_27 = FilePath("C:\KBEM\IP2.1\RetrofitResults\csv\BuildingBased.csv")  # disabled
c_script_10 = CSharpScript(save=toggle_61, path=path_27, data=flatten(data_rec_4))  # inputs save: Boolean, path: String, data: list of String; disabled; same code as c_script_2
