# Grasshopper definition KBEM_Ankara_020522_As-IsV3_ic & dg added.gh (Grasshopper 1.0.7)
# plug-ins: Pufferfish, Colibri

# ----
# Add All Buildings
panel = Panel("""0
0
0
0
0
0
0
0
0
0
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""")
panel_2 = Panel("""2
2
2
2
2
2
2
2
2
2
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""")
merge = Merge(Data1=panel, Data2=panel_2)
panel_3 = Panel(merge)

panel_4 = Panel("if residential")
equals = Equality(FirstNumber=panel_3, SecondNumber="0")  # -> Equality, Inequality
dispatch = Dispatch(List=panel_3, DispatchPattern=equals.Equality)  # -> ListA, ListB

# ----
# Add All Buildings
# https://docs.google.com/spreadsheets/d/1OhTFdR_YYA37wmvLVmGtL0KkaVhocj32rAnVd95tpRM/edit#gid=0
panel_5 = Panel("=IFS(H7537=\"office\", 1, H7537=\"dwelling\",0, H7537=\"public\",2, H7537=\"school\",3)")
panel_6 = Panel("""1
1
0
0
0
0
0
0
0
1
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""")

# ----
# Add All Buildings
# https://docs.google.com/spreadsheets/d/1MF4ZDFJ7wzA6lBgT1GTvoWXtCjiJDwMzJt_3lfO9U7o/edit#gid=1131947531
panel_7 = Panel("=IFS(H7537=\"office\", 1, H7537=\"dwelling\",0, H7537=\"public\",2, H7537=\"school\",3)")
panel_8 = Panel("""0
1
0
0
0
0
0
0
0
0
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""")

# ----
# FOR ANKARA, Cooling System Ratio Inside Residential Units, %
lng = ListLength(List=dispatch.ListA)
pcent = Percentage(Number=lng, Percent="3")
round = Round(Number=pcent)  # -> Nearest, Floor, Ceiling
series = Series(Start=0, Step=1, Count=round.Floor)

# ----
# select which residential units will have cooling
listdexs = ListIndices(List=panel_3)
dispatch_2 = Dispatch(List=listdexs, DispatchPattern=equals.Equality)  # -> ListA, ListB
jitter = Jitter(List=dispatch_2.ListA, Jitter=1, Seed=2)  # -> Values, Indices
# 0: residential non-cooling
# 5: residential with cooling
# 1: office unit
item = ListItem(List=jitter.Values, Index=series, Wrap=True)

equals_2 = Equality(FirstNumber=panel_6, SecondNumber="0")  # -> Equality, Inequality
dispatch_3 = Dispatch(List=panel_6, DispatchPattern=equals_2.Equality)  # -> ListA, ListB

equals_3 = Equality(FirstNumber=panel_8, SecondNumber="0")  # -> Equality, Inequality
dispatch_4 = Dispatch(List=panel_8, DispatchPattern=equals_3.Equality)  # -> ListA, ListB

# ----
# FOR ANKARA, Cooling System Ratio Inside Residential Units, %
lng_2 = ListLength(List=dispatch_3.ListA)
pcent_2 = Percentage(Number=lng_2, Percent="3")
round_2 = Round(Number=pcent_2)  # -> Nearest, Floor, Ceiling
series_2 = Series(Start=0, Step=1, Count=round_2.Floor)

# ----
# FOR ANKARA, Cooling System Ratio Inside Residential Units, %
lng_3 = ListLength(List=dispatch_4.ListA)
pcent_3 = Percentage(Number=lng_3, Percent="3")
round_3 = Round(Number=pcent_3)  # -> Nearest, Floor, Ceiling
series_3 = Series(Start=0, Step=1, Count=round_3.Floor)

# ----
# add residential with cooling units
panel_11 = Panel("5")
replace = ReplaceItems(List=panel_3, Item=panel_11, Indices=item, Wrap=False)

# ----
# select which residential units will have cooling
listdexs_2 = ListIndices(List=panel_6)
dispatch_5 = Dispatch(List=listdexs_2, DispatchPattern=equals_2.Equality)  # -> ListA, ListB
jitter_2 = Jitter(List=dispatch_5.ListA, Jitter=1, Seed=2)  # -> Values, Indices
# 0: residential non-cooling
# 5: residential with cooling
# 1: office unit
item_2 = ListItem(List=jitter_2.Values, Index=series_2, Wrap=True)

# ----
# select which residential units will have cooling
listdexs_3 = ListIndices(List=panel_8)
dispatch_6 = Dispatch(List=listdexs_3, DispatchPattern=equals_3.Equality)  # -> ListA, ListB
jitter_3 = Jitter(List=dispatch_6.ListA, Jitter=1, Seed=2)  # -> Values, Indices
# 0: residential non-cooling
# 5: residential with cooling
# 1: office unit
item_3 = ListItem(List=jitter_3.Values, Index=series_3, Wrap=True)

panel_12 = Panel("""1.351
0.910
0.443
0.441
0.595
1.623
0.664
1.604
0.699
1.599
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""")
panel_13 = Panel("UwallConcrete Generated")

# ----
# EKB Construction data for UwallMasonry
ekbuwallconcrete = Panel("""1.83
1.69
0.48
1.99
0.42
0.67
0.27
1.9
0.36
1.32
1.19
2.25
0.41
0.38
0.61
0.68
0.67
1.87""")
parcelubem = Panel("""4
5
5
11
2
7
2
0
3
1
17
5
7
1
3
4
16
2""")
blockubem = Panel("""6
8
17
24
36
36
37
39
39
42
42
43
44
46
46
46
46
50""")

# ----
# EKB Construction data for UwallConcrete
ekbuwallconcrete_2 = Panel("""0.49
0.2
0.49
1.46
1.46
0.68
1.44
1.46
0.49
0.68
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""")
parcelubem_2 = Panel("""2
4
1
4
11
1
3
1
2
10
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""")
blockubem_2 = Panel("""0
0
1
1
1
2
2
3
3
3
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""")

# ----
# # of units per building
# unitFunction
data = Data()
partition = PartitionList(List=replace, Size=data)  # -> simplify(Chunks)

panel_14 = Panel("""1.686
0.935
0.370
1.244
1.687
1.833
0.323
0.620
2.110
2.116
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""")
panel_15 = Panel("UwallMasonry Generated")

# ----
# add residential with cooling units
panel_16 = Panel("5")
replace_2 = ReplaceItems(List=panel_6, Item=panel_16, Indices=item_2, Wrap=False)

# ----
# add residential with cooling units
panel_17 = Panel("5")
replace_3 = ReplaceItems(List=panel_8, Item=panel_17, Indices=item_3, Wrap=False)

# ----
# Add Only
# Residential Buildings
# Random Distribution for all Construction Sets: https://docs.google.com/spreadsheets/d/1dVqoGlL5SpjtWETs8iGa3fb79QarzpHjeZR7tKplJOw/edit#gid=574847703
# UGroundFloor Generate Edilmedi! (YB ve Emek için)
ugroundfloor = Panel("")
vtwindow = Panel("""0.4333966864
0.1668520507
0.5072806106
0.4329595552
0.4232390714
0.3647176337
0.2830216121
0.5525261281
0.3447755379
0.3234377288
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""")
shgcwindow = Panel("""0.4115969413
0.1655557391
0.4797974867
0.4111934356
0.4022206813
0.3482008926
0.2727891804
0.5215625798
0.3297928042
0.3100963651
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""")
wwr = Panel("""0.2840956952
0.2894378654
0.114868553
0.2520098937
0.34
2.8311297
0.197
0.249
0.3235718612
0.4356551353
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""")
uwindow = Panel("""2.925900216
1.442786023
2.802440503
1.456257254
2.9
2.79094413
2.9
2.877311833
2.928908561
2.836767524
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""")
uroof = Panel("""1.150532915
0.416830927
0.4345205905
0.5563733929
0.43
0.3550525017
0.66
0.16
1.213742887
0.4273972756
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""")
uwall = Panel("""0.3625381081
1.29435051
1.336713807
1.090169337
1.33
0.4234351174
1.91
0.46
0.7356970742
0.3692959788
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""")

# ----
# EMEK
# neighborhood related data
# https://docs.google.com/spreadsheets/d/1dVqoGlL5SpjtWETs8iGa3fb79QarzpHjeZR7tKplJOw/edit#gid=574847703
# parcel_block ordered lists
# Mixed or Not
panel_18 = Panel("""0
0
0
0
0
0
0
0
0
1
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""")

# ----
# Real Data
# Building
# Parcel No
panel_19 = Panel("""0
1
2
3
4
5
0
1
2
0
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""")

# ----
# Real Data
# # of floor
real_data_of_floor = Panel("""9
9
9
10
10
10
4
4
4
1
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""")

# ----
# Add Only
# Residential Buildings
ugroundfloor_2 = Panel("""0.79
1.93
0.75
0.44
0.59
0.80
0.66
0.69
0.70
0.40
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""")
# Random Distribution for all Construction Sets: https://docs.google.com/document/d/1WU0D6LcI17LYl9msHEWG7eir8bg52xUF9ubXD48ZJ14/edit
vtwindow_2 = Panel("""0.433
0.167
0.507
0.433
0.423
0.365
0.283
0.553
0.345
0.323
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""")
shgcwindow_2 = Panel("""0.35
0.16
0.40
0.35
0.34
0.30
0.24
0.43
0.28
0.27
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""")
wwr_2 = Panel("""0.18
0.14
0.17
0.25
0.35
0.29
0.17
0.17
0.31
0.27
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""")
uwindow_2 = Panel("""2.46
2.7
2.7
2.75
2.5
3.03
2.75
2.08
2.76
2.65
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""")
uroof_2 = Panel("""0.4453
0.14
0.27
0.2472
0.26
1.2826
0.4635
0.4036
0.3572
0.4068
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""")
# YUKARI BAHÇELİEVLER
uwall_2 = Panel("""1.025
1.307
0.49
0.661
0.2
0.808
0.441
1.296
1.547
0.766
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""")

# ----
# Add Only
# Residential Buildings
ugroundfloor_3 = Panel("")
# Random Distribution for all Construction Sets: https://docs.google.com/spreadsheets/d/1OXMzIesyRE01nLoX3t1EUuKLoFw8Ft8k3F_-NCRB1iU/edit#gid=607337562
vtwindow_3 = Panel("""0.4333966864
0.1668520507
0.5072806106
0.4329595552
0.4232390714
0.3647176337
0.2830216121
0.5525261281
0.3447755379
0.3234377288
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""")
shgcwindow_3 = Panel("""0.4115969413
0.1655557391
0.4797974867
0.4111934356
0.4022206813
0.3482008926
0.2727891804
0.5215625798
0.3297928042
0.3100963651
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""")
wwr_3 = Panel("""0.2992920753
0.21
0.1796624059
0.1610359171
0.1892498833
0.1781205569
0.26
0.2181320291
0.261383973
0.13
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""")
uwindow_3 = Panel("""1.199791913
1.89525652
2.730182231
2.788305433
2.919214191
2.751658054
2.1
1.47173174
2.603408819
2.9
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""")
uroof_3 = Panel("""0.4684696428
0.4426835044
0.4747678621
0.4013053619
0.4582035361
0.4081164227
0.37
0.4779887327
0.4829851055
0.52
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""")
uwall_3 = Panel("""0.5867058762
1.56
1.491664882
1.431235972
0.7496970655
1.56528835
0.37
1.606871738
1.593819455
1.46
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""")

merge_2 = Merge(Data1=graft(parcelubem), Data2=graft(blockubem))

# ----
# # of Units of
# the building
of_units_of_the_building = Panel("""21
21
21
20
20
20
19
9
13
1
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""")

# ----
# BAHÇELİEVLER
# neighborhood related data
# Add All
# Buildings
# Mixed or Not
panel_20 = Panel("""1
1
0
0
0
0
1
1
1
1
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""")

# ----
# Add All
# Buildings
# Real Data
# Building
# Parcel No
panel_21 = Panel("""0
1
2
3
4
5
6
7
8
9
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""")

# ----
# parcel_block ordered lists
# https://docs.google.com/spreadsheets/d/1OXMzIesyRE01nLoX3t1EUuKLoFw8Ft8k3F_-NCRB1iU/edit#gid=607337562
# Mixed or Not
panel_22 = Panel("""1
1
0
0
1
0
0
1
0
1
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""")

panel_23 = Panel("""1962
1960
2010
2008
1958
1974
1982
1980
2001
1974
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""")  # disabled
panel_24 = Panel("construction date transformation")
python = GhPythonScript(x=panel_23)  # -> out, a; inputs x: Int32; disabled
# ---------- python: Python ----------
__author__ = "Siser"
__version__ = "2022.03.17"

import rhinoscriptsyntax as rs
if x < 1980:
    a = 1960
elif x < 2000 and x >= 1980:
    a = 1980
else:
    a = 2000
# ---------- end python ----------
panel_25 = Panel(python.a)  # disabled

# ----
# Real Data
# Building
# Parcel No
panel_26 = Panel("""0
1
2
3
4
5
6
7
8
0
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""")

# ----
# Add All
# Buildings
# Real Data
# # of floor
# https://docs.google.com/spreadsheets/d/1HeNCj9cvZVeU73J5g7iW2pWBtRtmiiCzG14sOCkgrVs/edit#gid=0
panel_27 = Panel("""4
4
4
4
4
4
5
5
5
5
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""")

panel_28 = Panel("compare two points")  # disabled
python_2 = PythonScript()  # -> out, a; inputs x: list of Point3d; disabled
# ---------- python_2: Python ----------
if x[0] == x[1]:
    a =True
    print("centroids are the same")
else:
    a =False
    print("centroids are not the same")
# ---------- end python_2 ----------

# ----
# neighborhood related data
# https://docs.google.com/spreadsheets/d/1L3Ca3pI_2Zk8sqpA5S26HTBe5FzKtIOFTXeKStPdVgI/edit#gid=1110302639
# Real Data
# # of floor
real_data_of_floor_2 = Panel("""6
5
5
6
5
5
5
3
5
5
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""")

# ----
# Generated
# # of Units
# Per Floor
division = Division(A=of_units_of_the_building, B=real_data_of_floor)
round_4 = Round(Number=division)  # -> Nearest, Floor, Ceiling

# ----
# https://docs.google.com/spreadsheets/d/18MLfzQqm2u-x1I9CiO8GDrrBI3HEgol9LwWBEFC5yFs/edit#gid=0
# https://docs.google.com/spreadsheets/d/1OhTFdR_YYA37wmvLVmGtL0KkaVhocj32rAnVd95tpRM/edit#gid=0
parcel = Panel("""0
0
0
0
0
0
0
0
0
0
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""")
block = Panel("""0
0
0
0
0
0
0
0
0
0
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""")

# ----
# check if there is 0 value for # of units
lng_4 = ListLength(List=round_4.Floor)
series_4 = Series(Start=0, Step=1, Count=lng_4)
equals_4 = Equality(FirstNumber=round_4.Floor, SecondNumber="0")  # -> Equality, Inequality
panel_29 = Panel(round_4.Floor)
dispatch_7 = Dispatch(List=series_4, DispatchPattern=equals_4.Equality)  # -> ListA, ListB
panel_30 = Panel(dispatch_7.ListA)

# ----
# # of Units of
# the building
of_units_of_the_building_2 = Panel("""15
17
11
11
8
12
10
15
8
15
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""")

# ----
# Add All
# Buildings
# # of units per building
sqr = Square(Value=block)
# parcel_block ordered lists
sqr_2 = Square(Value=parcel)
addition = Addition(A=sqr_2, B=sqr)

# ----
# Construction
const_date = Panel("""1960
1960
1960
1960
1960
1960
1975
1960
1960
1980
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""")
parcelubem_3 = Panel("""0
1
2
3
4
5
0
1
2
0
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""")
block_ubem = Panel("""0
0
0
0
0
0
1
1
1
2
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""")

# ----
# Add All
# Buildings
# Construction
const_date_2 = Panel("""1960
1960
2000
2000
1960
1960
1980
1980
2000
1960
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""")
parcelubem_4 = Panel("""0
1
2
3
4
5
6
7
8
9
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""")
block_ubem_2 = Panel("""0
0
0
0
0
0
0
0
0
0
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""")

# ----
# Construction
const_date_3 = Panel("""2014
1990
1988
2015
1993
2015
1960
1970
1960
1967
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""")
parcelubem_5 = Panel("""0
1
2
3
4
5
6
7
8
0
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""")
block_ubem_3 = Panel("""0
0
0
0
0
0
0
0
0
1
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""")

# ----
# Generated
# # of Units
# Per Floor
division_2 = Division(A=of_units_of_the_building_2, B=real_data_of_floor_2)
round_5 = Round(Number=division_2)  # -> Nearest, Floor, Ceiling

# ----
# python count consecutive duplicates in list, itertools
# https://www.w3resource.com/python-exercises/itertools/python-itertools-exercise-31.php
python_3 = GhPythonScript(x=addition)  # -> out, a; inputs x: list
# ---------- python_3: Python ----------
__author__ = "Siser"
__version__ = "2022.03.08"

import rhinoscriptsyntax as rs
from itertools import groupby
a = [sum(1 for _ in group) for _, group in groupby(x)]
# ---------- end python_3 ----------

# ----
# # of units per building
data_2 = Data(python_3.a)

# ----
# # of units per building
# Tree Branch BAĞLANMADI HENÜZ
data_3 = Data(python_3.a)

# ----
# unitFunction
partition_2 = PartitionList(List=replace_2, Size=data_2)  # -> simplify(Chunks)

# ----
# unitFunction
partition_3 = PartitionList(List=replace_3, Size=data_3)  # -> simplify(Chunks)

# ----
# python count consecutive duplicates in list, itertools
# https://www.w3resource.com/python-exercises/itertools/python-itertools-exercise-31.php
python_4 = GhPythonScript()  # -> out, a; inputs x: list; disabled; same code as python_3

# ----
# check if there is 0 value for # of units
lng_5 = ListLength(List=round_5.Floor)
series_5 = Series(Start=0, Step=1, Count=lng_5)
equals_5 = Equality(FirstNumber=round_5.Floor, SecondNumber="0")  # -> Equality, Inequality
dispatch_8 = Dispatch(List=series_5, DispatchPattern=equals_5.Equality)  # -> ListA, ListB
panel_31 = Panel(dispatch_8.ListA)

# ----
# %10 of all buildings are masonry
# according to EKB data of Bahçelievler
panel_32 = Panel("10")

# ----
# Generated
# # of Units
# Per Floor
division_3 = Division(A=python_3.a, B=panel_27)
round_6 = Round(Number=division_3)  # -> Nearest, Floor, Ceiling

panel_33 = Panel(round_5.Floor)

panel_34 = Panel("PUBLIC")
geo = Geometry([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])

panel_35 = Panel("SCHOOL")
geo_2 = Geometry([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])

panel_36 = Panel("DWELLING")
geo_3 = Geometry([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])

panel_37 = Panel("COMMERCIAL")
geo_4 = Geometry([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])

boundary = BoundarySurfaces(Edges=geo_3)
preview = CustomPreview(Geometry=boundary, Material=ColourSwatch(SwatchColor=RGB(204, 0, 255)))

boundary_2 = BoundarySurfaces(Edges=geo_4)
preview_2 = CustomPreview(Geometry=boundary_2, Material=ColourSwatch(SwatchColor=RGB(0, 255, 30)))

boundary_3 = BoundarySurfaces(Edges=geo)
preview_3 = CustomPreview(Geometry=boundary_3, Material=ColourSwatch(SwatchColor=RGB(255, 0, 0)))

boundary_4 = BoundarySurfaces(Edges=geo_2)
preview_4 = CustomPreview(Geometry=boundary_4, Material=ColourSwatch(SwatchColor=RGB(0, 38, 255)))

panel_38 = Panel(round_6.Floor)

geo_5 = Geometry([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])

geo_6 = Geometry([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])

geo_7 = Geometry([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])

geo_8 = Geometry([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])

geo_9 = Geometry([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])

geo_10 = Geometry([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])

geo_11 = Geometry([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])

geo_12 = Geometry([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])

panel_47 = Panel("BLOCK BOUNDARIES")
curve = Curve([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])

# ----
# Geometric Input
merge_3 = Merge(Data1=geo_3, Data2=geo_4, Data3=geo, Data4=geo_2)

boundary_5 = BoundarySurfaces(Edges=geo_7)
preview_5 = CustomPreview(Geometry=boundary_5, Material=ColourSwatch(SwatchColor=RGB(204, 0, 255)))

boundary_6 = BoundarySurfaces(Edges=geo_8)
preview_6 = CustomPreview(Geometry=boundary_6, Material=ColourSwatch(SwatchColor=RGB(0, 255, 30)))

boundary_7 = BoundarySurfaces(Edges=geo_5)
preview_7 = CustomPreview(Geometry=boundary_7, Material=ColourSwatch(SwatchColor=RGB(255, 0, 0)))

boundary_8 = BoundarySurfaces(Edges=geo_6)
preview_8 = CustomPreview(Geometry=boundary_8, Material=ColourSwatch(SwatchColor=RGB(0, 38, 255)))

boundary_9 = BoundarySurfaces(Edges=geo_9)
preview_9 = CustomPreview(Geometry=boundary_9, Material=ColourSwatch(SwatchColor=RGB(255, 0, 0)))

boundary_10 = BoundarySurfaces(Edges=geo_11)
preview_10 = CustomPreview(Geometry=boundary_10, Material=ColourSwatch(SwatchColor=RGB(0, 255, 30)))

boundary_11 = BoundarySurfaces(Edges=geo_10)
preview_11 = CustomPreview(Geometry=boundary_11, Material=ColourSwatch(SwatchColor=RGB(0, 38, 255)))

boundary_12 = BoundarySurfaces(Edges=geo_12)
preview_12 = CustomPreview(Geometry=boundary_12, Material=ColourSwatch(SwatchColor=RGB(204, 0, 255)))

curve_2 = Curve([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])

# ----
# Geometric Input
merge_4 = Merge(Data1=geo_7, Data2=geo_8, Data3=geo_5, Data4=geo_6)

curve_3 = Curve([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])

# ----
# Geometric Input
merge_5 = Merge(Data1=geo_12, Data2=geo_11, Data3=geo_9, Data4=geo_10)

# ----
# total # of parcels in the neighborhood
lng_6 = ListLength(List=merge_5)

# ----
# total # of parcels in the neighborhood
lng_7 = ListLength(List=merge_5)

series_6 = Series(Start=0, Step=1, Count=lng_6)

series_7 = Series(Start=0, Step=1, Count=lng_7)

# ----
# 0: Bahçelievler, Ankara
# 1: Yukarı Bahçelievler, Ankara
# 2: Emek, Ankara
number_slider = Slider(0, range=0..2)
panel_50 = Panel("""0
1
2""")
item_4 = ListItem(List=panel_50, Index=number_slider, Wrap=True)

# ----
# # of units
panel_51 = Panel("""minimum stair dimensions
2m*4m""")
# RESULT
# ToDO
# old
# note it down resources
geo_13 = Geometry([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])

# ----
# Data Challenges: # of floors and # of units in the building can not match. for some cases # of floors is higher than # of units in the building
# 
# 
# https://docs.google.com/document/d/1INWO2i1du29ZDZWHUi1IJCvi89qGMdNHIzGieotD-bE/edit
panel_52 = Panel("Radius")
_40 = Data(40)

# ----
# Reference Vector
pt = ConstructPoint(XCoordinate=0, YCoordinate=0, ZCoordinate=0)
pt_2 = Point(Point(485242, 4421817, 0))
# VISUAL
# OUTPUT
# INPUT
vec2pt = Vector2Pt(PointA=pt_2, PointB=pt, Unitize=False)  # -> Vector, Length

weave = Weave(Pattern=item_4, Stream0=wwr_2, Stream1=wwr_3, Stream2=wwr, NullGaps=False)
weave_2 = Weave(Pattern=item_4, Stream0=uroof_2, Stream1=uroof_3, Stream2=uroof, NullGaps=False)
panel_53 = Panel("WWR")
panel_54 = Panel("U-Roof")
weave_3 = Weave(Pattern=item_4, Stream0=shgcwindow_2, Stream1=shgcwindow_3, Stream2=shgcwindow, NullGaps=False)
panel_55 = Panel("shgc")
weave_4 = Weave(Pattern=item_4, Stream0=uwall_2, Stream1=uwall_3, Stream2=uwall, NullGaps=False)
panel_56 = Panel("U-Wall")
weave_5 = Weave(Pattern=item_4, Stream0=uwindow_2, Stream1=uwindow_3, Stream2=uwindow, NullGaps=False)
panel_57 = Panel("U-Window")
weave_6 = Weave(Pattern=item_4, Stream0=vtwindow_2, Stream1=vtwindow_3, Stream2=vtwindow, NullGaps=False)
panel_58 = Panel("vtWindow")

weave_7 = Weave(Pattern=item_4, Stream0=merge_5, Stream1=merge_4, Stream2=merge_3, NullGaps=False)
# neighborhood selection
panel_59 = Panel("parcelsGeometry")

# ----
# Real Data
# Building
# Parcel No
weave_8 = Weave(Pattern=item_4, Stream0=panel_21, Stream1=panel_26, Stream2=panel_19, NullGaps=False)

weave_9 = Weave(Pattern=item_4, Stream0=const_date_2, Stream1=const_date_3, Stream2=const_date, NullGaps=False)
panel_60 = Panel("Construction Date")

panel_61 = Panel("Commercial")
weave_10 = Weave(Pattern=item_4, Stream0=geo_11, Stream1=geo_8, Stream2=geo_4, NullGaps=False)

panel_62 = Panel("staircase ratio")

# ----
# VENTILATION PER AREA
# DO NOT USE WITH RESIDENTIAL AND OFFICE UNITS: it works with specific zone types (cleanroom, laboratories)
# http://hydrashare.github.io/hydra/viewer?owner=chriswmackey&fork=hydra_2&id=Customizing_HVAC_Systems&slide=0&scale=2.0000000000000018&offset=-769.4718387139474,-192.523115453532
boolean_toggle = BooleanToggle(False)
ach2m3_s_m2_calculator = Honeybee_infORventPerAreaCalculator(airFlowRate="0.0003", ACHorM3sM2=boolean_toggle)  # -> readMe, infPerAreaFacade, ventPerAreaFloor, allExposed, allFloors; plug-in component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

weave_11 = Weave(Pattern=item_4, Stream0=curve_3, Stream1=curve_2, Stream2=curve, NullGaps=False)
panel_63 = Panel("blockGeometry")

weave_12 = Weave(Pattern=item_4, Stream0=parcelubem_4, Stream1=parcelubem_5, Stream2=parcelubem_3, NullGaps=False)
panel_64 = Panel("parcelUBEM")

weave_13 = Weave(Pattern=item_4, Stream0=panel_27, Stream1=real_data_of_floor_2, Stream2=real_data_of_floor, NullGaps=False)
panel_65 = Panel("""Real Data
# of floor """)

panel_66 = Panel("Public")
weave_14 = Weave(Pattern=item_4, Stream0=geo_9, Stream1=geo_5, Stream2=geo, NullGaps=False)

# ----
# INFO/EXTRA
floor_height = Panel("3")

weave_15 = Weave(Pattern=item_4, Stream0=block_ubem_2, Stream1=block_ubem_3, Stream2=block_ubem, NullGaps=False)
panel_67 = Panel("blockUBEM")

# ----
# # of Units of
# the building
weave_16 = Weave(Pattern=item_4, Stream0=python_3.a, Stream1=of_units_of_the_building_2, Stream2=of_units_of_the_building, NullGaps=False)

panel_68 = Panel("School")
weave_17 = Weave(Pattern=item_4, Stream0=geo_10, Stream1=geo_6, Stream2=geo_2, NullGaps=False)

# ----
# SMALLEST
# SUB-STEPS
# TEST
# SUB-STEPS
# STEPS
tolerance = Panel("0.5")

# ----
# Generated
# # of Units
# Per Floor
weave_18 = Weave(Pattern=item_4, Stream0=round_6.Floor, Stream1=round_5.Floor, Stream2=panel_29, NullGaps=False)

# ----
# Geometric Input
swatch = ColourSwatch(SwatchColor=RGB(0, 0, 0))
wires = BrepWireframe(Brep=weave_7, Density=-1)
preview_13 = CustomPreview(Geometry=wires, Material=swatch)

cls = Closed(Curve=weave_7)  # -> Closed, Periodic
dispatch_9 = Dispatch(List=weave_7, DispatchPattern=cls.Closed)  # -> ListA, ListB

# ---- group: if it is not closed
geo_14 = Geometry(dispatch_9.ListB)

# ----
geo_15 = Geometry(weave_11)
# x
# x
# x
# x
# x
# x
# x
# x
# x
# x
# x
# x
# x
# x
# x
# x
# x
# x
# x
# x
# x
# x
panel_69 = Panel("BLOCK BOUNDARIES")

# ----
# Sort Blocks by X,Y Coordinates
area = Area(Geometry=geo_15)  # -> Area, Centroid
pdecon = Deconstruct(Point=area.Centroid)  # -> graft(XComponent), graft(YComponent), ZComponent
avr = Average(Input=[pdecon.XComponent, pdecon.YComponent])  # -> flatten(ArithmeticMean)
sort = SortList(Keys=avr, ValuesA=geo_15)  # -> Keys, ValuesA

panel_70 = Panel("""SORTED 
BLOCKS""")
sorted_parcels = Geometry(sort.ValuesA)

panel_71 = Panel("PARCELS")
area_2 = Area(Geometry=weave_7)  # -> Area, Centroid

# ----
# Curve selection is important: while setting curves; start selection with the curve at the left bottom corner (so that sorting will start there)
# Building footprint curves in each parcel
incurve = PointInCurve(Point=area_2.Centroid, Curve=graft(sorted_parcels))  # -> Relationship, Point
if_it_is_inside = Panel("2")
equals_6 = Equality(FirstNumber=incurve.Relationship, SecondNumber=if_it_is_inside)  # -> Equality, Inequality
dispatch_10 = Dispatch(List=incurve.Point, DispatchPattern=equals_6.Equality)  # -> simplify(ListA), ListB
fsim = FindSimilarMember(Data=dispatch_10.ListA, Set=area_2.Centroid)  # -> Hit, Index

panel_72 = Panel("""SORTED 
PARCELS""")
item_5 = ListItem(List=weave_7, Index=fsim.Index, Wrap=True)

# ----
# Cull Empty Blocks
lng_8 = ListLength(List=item_5)  # -> flatten(Length)
equals_7 = Equality(FirstNumber=lng_8, SecondNumber="0")  # -> Equality, Inequality
panel_73 = Panel(equals_7.Equality)
viewer = ParamViewer(item_5)
not = GateNot(A=panel_73)
python_5 = PythonScript(InList=panel_73)  # -> TrueList, FalseList; inputs InList: list
# ---------- python_5: Python ----------
TrueList = []
FalseList = []
for id,value in enumerate(InList):
    if value == "True":
        TrueList.append(id)
    else:
        FalseList.append(id)
# ---------- end python_5 ----------
cull = CullPattern(List=viewer, CullPattern=not)
branch = TreeBranch(Tree=item_5, Path=cull, MaintainPaths=True)  # -> simplify(Branch)
lng_9 = ListLength(List=branch)  # -> flatten(Length)

partition_4 = PartitionList(List=flatten(branch), Size=lng_9)  # -> simplify(Chunks)
panel_74 = Panel("""CULLED 
EMPTY
BLOCKS""")

geo_16 = Geometry(partition_4)

# ---- group: BLOCKS
geo_17 = Geometry(sorted_parcels)
cull_i = CullIndex(List=geo_17, Indices=python_5.TrueList, Wrap=True)

# ----
area_3 = Area(Geometry=geo_16)  # -> Area, Centroid
fline = FitLine(Points=area_3.Centroid)

# ----
# Fit Line for the parcels in the block
null = NullItem(Item=fline)  # -> flatten(NullFlags), InvalidFlags, Description
# # of parcels
panel_76 = Panel(null.NullFlags)
python_6 = PythonScript(InList=panel_76)  # -> TrueList, FalseList; inputs InList: list; same code as python_5

crv_cp = CurveClosestPoint(Point=area_3.Centroid, Curve=fline)  # -> Point, Parameter, Distance
avr_2 = Average(Input=crv_cp.Distance)
smaller = SmallerThan(FirstNumber=avr_2, SecondNumber="5")  # -> flatten(SmallerThan), OrEqualTo
panel_77 = Panel(smaller.SmallerThan)
python_7 = PythonScript(InList=panel_77)  # -> TrueList, FalseList; inputs InList: list; same code as python_5

# ----
# Parcels with two or more lines
lng_10 = ListLength(List=cull_i)
series_8 = Series(Start=0, Step=1, Count=lng_10)
merge_6 = Merge(Data1=python_6.TrueList, Data2=python_7.TrueList)
cull_i_2 = CullIndex(List=series_8, Indices=merge_6, Wrap=True)

area_4 = Area(Geometry=geo_15)  # -> Area, Centroid
panel_78 = Panel("""CULLED 
EMPTY
PARCELS""")

# ----
# Parcels with less than two lines
item_6 = ListItem(List=series_8, Index=merge_6, Wrap=True)
branch_2 = TreeBranch(Tree=area_3.Centroid, Path=item_6, MaintainPaths=True)
fline_2 = FitLine(Points=branch_2)
avr_3 = Average(Input=area_4.Centroid)
Y = UnitY(Factor="1000")
move = Move(Geometry=avr_3, Motion=Y)  # -> Geometry, Transform
end = EndPoints(Curve=fline_2)  # -> Start, End
vec2pt_2 = Vector2Pt(PointA=avr_3, PointB=move.Geometry, Unitize=Toggle(True))  # -> Vector, Length
vec2pt_3 = Vector2Pt(PointA=end.Start, PointB=end.End, Unitize=Toggle(True))  # -> Vector, Length
dprod = DotProduct(VectorA=vec2pt_3.Vector, VectorB=vec2pt_2.Vector, Unitize=False)

# ----
# horizontal fitted lines:
# parcels with less than two lines
abs = Absolute(Value=dprod)
smaller_2 = SmallerThan(FirstNumber=abs, SecondNumber="0.5")  # -> flatten(SmallerThan), OrEqualTo
viewer_2 = ParamViewer(abs)
dispatch_11 = Dispatch(List=viewer_2, DispatchPattern=smaller_2.SmallerThan)  # -> ListA, ListB
branch_3 = TreeBranch(Tree=geo_16, Path=dispatch_11.ListA, MaintainPaths=True)
area_5 = Area(Geometry=branch_3)  # -> Area, Centroid
pdecon_2 = Deconstruct(Point=area_5.Centroid)  # -> XComponent, YComponent, ZComponent
sort_2 = SortList(Keys=pdecon_2.XComponent, ValuesA=branch_3)  # -> Keys, ValuesA

# ----
# single parcels in the block
# parcels with less than two lines
null_2 = NullItem(Item=dprod)  # -> NullFlags, InvalidFlags, Description
dispatch_12 = Dispatch(List=branch_2, DispatchPattern=null_2.NullFlags)  # -> ListA, ListB
viewer_3 = ParamViewer(dispatch_12.ListA)
dispatch_13 = Dispatch(List=viewer_3, DispatchPattern=flatten(null_2.NullFlags))  # -> ListA, ListB
branch_4 = TreeBranch(Tree=geo_16, Path=dispatch_13.ListA, MaintainPaths=True)

# ----
# vertical fitted lines:
# parcels with less than two lines
abs_2 = Absolute(Value=dprod)
similar = Similarity(FirstNumber=abs_2, SecondNumber="1", Threshold="10")  # -> flatten(Similarity), AbsoluteDifference
panel_79 = Panel(similar.Similarity)
viewer_4 = ParamViewer(abs_2)
dispatch_14 = Dispatch(List=viewer_4, DispatchPattern=panel_79)  # -> ListA, ListB
branch_5 = TreeBranch(Tree=geo_16, Path=dispatch_14.ListA, MaintainPaths=True)
area_6 = Area(Geometry=branch_5)  # -> Area, Centroid
pdecon_3 = Deconstruct(Point=area_6.Centroid)  # -> XComponent, YComponent, ZComponent
sort_3 = SortList(Keys=pdecon_3.YComponent, ValuesA=branch_5)  # -> Keys, ValuesA

# ----
# Parcels with two or more lines
panel_80 = Panel("{}")
split = TextSplit(Text=flatten(dispatch_14.ListA), Separators=flatten("{}"))
split_2 = TextSplit(Text=flatten(dispatch_11.ListA), Separators=flatten(panel_80))
split_3 = TextSplit(Text=flatten(dispatch_13.ListA), Separators=flatten("{}"))
item_7 = ListItem(List=split_2, Index="1", Wrap=True)  # -> flatten(Item)
item_8 = ListItem(List=split, Index="1", Wrap=True)  # -> flatten(Item)
item_9 = ListItem(List=split_3, Index="1", Wrap=True)  # -> flatten(Item)
merge_7 = Merge(Data1=item_9, Data2=item_8, Data3=item_7)
data_4 = Data(item_6)
equals_8 = Equality(FirstNumber=data_4, SecondNumber=graft(merge_7))  # -> Equality, Inequality
panel_81 = Panel(equals_8.Equality)
python_8 = PythonScript(InList=panel_81)  # -> flatten(TrueList), FalseList; inputs InList: list; same code as python_5
cull_i_3 = CullIndex(List=data_4, Indices=python_8.TrueList, Wrap=True)
ins = InsertItems(List=cull_i_2, Item=cull_i_3, Indices=Toggle(False), Wrap=True)
sort_4 = SortList(Keys=ins, ValuesA=ins)  # -> Keys, ValuesA

geo_18 = Geometry(sorted_parcels)
cull_i_4 = CullIndex(List=geo_18, Indices=python_5.TrueList, Wrap=True)
geo_19 = Geometry(simplify(graft(cull_i_4)))

# ----
# Parcels with two or more line indices
data_5 = Data(sort_4.ValuesA)

branch_6 = TreeBranch(Tree=area_3.Centroid, Path=data_5, MaintainPaths=True)
branch_7 = TreeBranch(Tree=geo_19, Path=data_5, MaintainPaths=True)
disc = Discontinuity(Curve=branch_7, Level=1)  # -> simplify(Points), Parameters
area_7 = Area(Geometry=branch_7)  # -> Area, flatten(Centroid)
vec2pt_4 = Vector2Pt(PointA=graft(area_7.Centroid), PointB=simplify(branch_6), Unitize=False)  # -> simplify(Vector), Length
merge_8 = Merge(Data1=branch_6, Data2=disc.Points)
plfit = PlaneFit(Points=merge_8)  # -> Plane, Deviation
unit = UnitVector(Vector=vec2pt_4.Vector)
# Defining Positions of Parcels in the Block
# according to degree
deplane = DeconstructPlane(Plane=plfit.Plane)  # -> Origin, XAxis, YAxis, ZAxis
abs_3 = Absolute(Value=deplane.XAxis)
neg = Negative(Value=abs_3)
dprod_2 = DotProduct(VectorA=neg, VectorB=unit, Unitize=False)
dprod_3 = DotProduct(VectorA=deplane.YAxis, VectorB=unit, Unitize=False)
python_9 = GhPythonScript(x=dprod_2, y=dprod_3)  # -> out, a
# ---------- python_9: Python ----------
__author__ = "jhorikawa"
__version__ = "2020.07.27"

import rhinoscriptsyntax as rs
import math

a = math.atan2(x, y)
# ---------- end python_9 ----------

# ----
# single parcels in the block
# parcels with less than two lines
area_8 = Area(Geometry=branch_4)  # -> Area, Centroid

# ----
# vertical fitted lines:
# parcels with less than two lines
area_9 = Area(Geometry=sort_3.ValuesA)  # -> Area, Centroid

# ----
# horizontal fitted lines:
# parcels with less than two lines
area_10 = Area(Geometry=sort_2.ValuesA)  # -> Area, Centroid

# ----
# # of blocks in the neighborhood
lng_11 = ListLength(List=equals_7.Equality)

# ----
# 01.ORDERING BUILDINGS
# Define Empty List
panel_83 = Panel("empty")
dup = DuplicateData(Data=panel_83, Number=lng_11, Order=True)

# ----
# Buildings degrees of positions
deg = Degrees(Radians=python_9.a)

# ----
# sorted parcels which buildings included
geo_20 = Geometry(geo_17)

area_11 = Area(Geometry=geo_20)  # -> Area, Centroid
sorted_points = Point(flatten(area_11.Centroid))
lng_12 = ListLength(List=sorted_points)
series_9 = Series(Start="0", Step=1, Count=lng_12)  # -> simplify(Series)

# ----
# Empty Blocks
data_6 = Data(python_5.TrueList)
replace_4 = ReplaceItems(List=dup, Item="0", Indices=data_6, Wrap=False)

# ----
# Parcels with two or more lines
pdecon_4 = Deconstruct(Point=branch_6)  # -> XComponent, YComponent, ZComponent
addition_2 = Addition(A=pdecon_4.XComponent, B=pdecon_4.YComponent)
division_4 = Division(A=addition_2, B="2")
sort_5 = SortList(Keys=deg, ValuesA=branch_6)  # -> Keys, ValuesA
sort_6 = SortList(Keys=division_4, ValuesA=branch_6)  # -> Keys, ValuesA
item_10 = ListItem(List=sort_6.ValuesA, Index=0, Wrap=True)
equals_9 = Equality(FirstNumber=sort_5.ValuesA, SecondNumber=item_10)  # -> Equality, Inequality
panel_84 = Panel(equals_9.Equality)
python_10 = PythonScript(InList=panel_84)  # -> TrueList, FalseList; inputs InList: list; same code as python_5

data_7 = Data(series_9)
partition_5 = PartitionList(List=data_7, Size="1")  # -> simplify(Chunks)

# ----
# indices of buildings in parcels with two or more line
shift = ShiftList(List=sort_5.ValuesA, Shift=python_10.TrueList, Wrap=True)  # -> simplify(List)

# ----
# indices of buildings in parcels with two or more line
geo_21 = Geometry(shift)

merge_9 = Merge(Data1=geo_21, Data2=area_8.Centroid, Data3=area_9.Centroid, Data4=area_10.Centroid)  # -> simplify(Result)

# ----
# Not-Empty Blocks
tstat = TreeStatistics(Tree=merge_9)  # -> Paths, Length, Count
data_8 = Data(python_5.FalseList)
replace_5 = ReplaceItems(List=replace_4, Item=tstat.Length, Indices=data_8, Wrap=False)

geo_22 = Geometry(flatten(merge_9))
partition_6 = PartitionList(List=geo_22, Size=replace_5)  # -> simplify(Chunks)

listdexs_4 = ListIndices(List=partition_6)
lng_13 = ListLength(List=listdexs_4)
dup_2 = DuplicateData(Data=partition_5, Number=lng_13, Order=True)  # -> simplify(graft(Data))

merge_10 = Merge(Data1=graft(listdexs_4), Data2=simplify(dup_2))
join = TextJoin(Text=merge_10, Join="_")  # -> flatten(Result)
null_3 = NullItem(Item=join)  # -> NullFlags, InvalidFlags, Description
lng_14 = ListLength(List=listdexs_4)  # -> flatten(Length)
dispatch_15 = Dispatch(List=join, DispatchPattern=null_3.NullFlags)  # -> ListA, ListB
partition_7 = PartitionList(List=dispatch_15.ListB, Size=lng_14)  # -> simplify(Chunks)

# ----
# Empty List
# tag order for parcels
data_9 = Data(flatten(partition_7))

branch_8 = TreeBranch(Tree=geo_16, Path=data_5, MaintainPaths=True)
sort_7 = SortList(Keys=deg, ValuesA=branch_8)  # -> Keys, ValuesA
shift_2 = ShiftList(List=sort_7.ValuesA, Shift=python_10.TrueList, Wrap=True)  # -> simplify(List)
merge_11 = Merge(Data1=shift_2, Data2=branch_4, Data3=sort_3.ValuesA, Data4=sort_2.ValuesA)

# ----
# # of parcels in the blocks
# complete list of THE NEIGHBORHOOD
lng_15 = ListLength(List=merge_11)  # -> flatten(Length)

# ----
# tag order for parcels
partition_8 = PartitionList(List=data_9, Size=lng_15)  # -> simplify(Chunks)

# ----
# tag order for parcels
swatch_2 = ColourSwatch(SwatchColor=RGB(8, 0, 255))
tag = TextTag3D(Location=partition_6, Text=partition_7, Size="3", Colour=swatch_2, Justification=7)

preview_14 = CustomPreview(Geometry=merge_11, Material=ColourSwatch(SwatchColor=RGB(0, 0, 0)))

tstat_2 = TreeStatistics(Tree=merge_11)  # -> Paths, Length, Count
panel_85 = Panel(tstat_2.Paths)

panel_86 = Panel(partition_7)

# ----
# public and school buildings excluded list
panel_87 = Panel("PARCELS")
geo_23 = Geometry(merge_11)

panel_88 = Panel("BLOCKS")
geo_24 = Geometry(cull_i)

# ----
# Input
lng_16 = ListLength(List=geo_24)
series_10 = Series(Start=0, Step=1, Count=lng_16)
branch_9 = TreeBranch(Tree=geo_23, Path=series_10, MaintainPaths=True)

# ----
# 4edged layout transformation has applied to all parcel layouts due to energy modeling standards of E+ (adjacency problems)
# 4 edges and others
debrep = DeconstructBrep(Brep=flatten(branch_9))  # -> Faces, Edges, Vertices
_4edged_transformation = Panel("4")
lng_17 = ListLength(List=debrep.Vertices)  # -> flatten(Length)
lng_18 = ListLength(List=branch_9)  # -> flatten(Length)
equals_10 = Equality(FirstNumber=lng_17, SecondNumber=_4edged_transformation)  # -> Equality, Inequality
partition_9 = PartitionList(List=flatten(equals_10.Equality), Size=lng_18)  # -> simplify(Chunks)
dispatch_16 = Dispatch(List=branch_9, DispatchPattern=partition_9)  # -> ListA, ListB

panel_89 = Panel("4 edges")
geo_25 = Geometry(dispatch_16.ListA)

panel_90 = Panel("More than 4 edges")
geo_26 = Geometry(dispatch_16.ListB)

geo_27 = Geometry(geo_26)

# ----
# ConvexToConcave
# Transformation
debrep_2 = DeconstructBrep(Brep=flatten(geo_27))  # -> Faces, Edges, simplify(Vertices)
hull = ConvexHull(Points=debrep_2.Vertices, Plane=PlaneXY(0, 0, 0))  # -> flatten(Hull), HullZ, Indices
area_12 = Area(Geometry=flatten(geo_27))  # -> Area, Centroid
original_values = Panel(area_12.Area)
xy = XYPlane(Origin=area_12.Centroid)
scale2area = ScaleToArea(Geometry=hull.Hull, Plane=xy, Area=original_values, FactorX=1, FactorY=1, FactorZ=1)  # -> Scaled, Transform

panel_92 = Panel("""Concave
To
Convex""")
geo_28 = Geometry(scale2area.Scaled)

# ----
# Degree Resolution
degreerangeratio = Panel("15")
division_5 = Division(A="360", B=degreerangeratio)
addition_3 = Addition(A=division_5, B="1")
series_11 = Series(Start=0, Step=degreerangeratio, Count=addition_3)

# ----
# FIT 4 edged rectangle
# select smallest one
area_13 = Area(Geometry=geo_28)  # -> Area, Centroid
pl = ConstructPlane(Origin=area_13.Centroid, XAxis=Vector(1, 0, 0), YAxis=Vector(0, 1, 0))
prot = RotatePlane(Plane=pl, Angle=series_11)
brec = BoundingRectangle(Geometry=graft(geo_28), Plane=prot, Axis=0, Slide=0, Union=True)  # -> flatten(Bounding), DimensionX, DimensionY
lng_19 = ListLength(List=geo_28)  # -> flatten(Length)
lng_20 = ListLength(List=brec.Bounding)
division_6 = Division(A=lng_20, B=lng_19)
partition_10 = PartitionList(List=brec.Bounding, Size=division_6)  # -> simplify(Chunks)
area_14 = Area(Geometry=partition_10)  # -> Area, Centroid
sort_8 = SortList(Keys=area_14.Area, ValuesA=partition_10)  # -> Keys, ValuesA
item_11 = ListItem(List=sort_8.ValuesA, Index=0, Wrap=True)  # -> flatten(Item)

geo_29 = Geometry(geo_26)

lng_21 = ListLength(List=geo_29)  # -> flatten(Length)
geo_30 = Geometry(item_11)
panel_94 = Panel("""4 edged
non organized""")
partition_11 = PartitionList(List=geo_30, Size=lng_21)  # -> simplify(Chunks)

# ----
# EdgeTo4
merge_12 = Merge(Data1=geo_25, Data2=partition_11)

# ----
# non-organized 4edged building floor layouts
geo_31 = Geometry(merge_12)

# ----
# public and school buildings excluded list
# organized non-4edged building floor layouts
geo_32 = Geometry(merge_11)

# ----
# public and school buildings
merge_13 = Merge(Data1=weave_10, Data2=weave_14, Data3=weave_17)
disc_2 = Discontinuity(Curve=merge_13, Level=1)  # -> Points, Parameters
hull_2 = ConvexHull(Points=disc_2.Points, Plane=PlaneXY(0, 0, 0))  # -> flatten(Hull), HullZ, Indices

# ----
# Re-Organize list
area_15 = Area(Geometry=geo_31)  # -> Area, Centroid
area_16 = Area(Geometry=geo_32)  # -> Area, Centroid
cps = ClosestPoints(Point=area_16.Centroid, Cloud=area_15.Centroid, Count="1")  # -> ClosestPoint, flatten(CPIndex), Distance
lng_22 = ListLength(List=area_16.Centroid)
partition_12 = PartitionList(List=cps.CPIndex, Size=flatten(lng_22))  # -> simplify(Chunks)
item_12 = ListItem(List=geo_31, Index=partition_12, Wrap=True)
area_17 = Area(Geometry=item_12)  # -> Area, Centroid
incurves = PointInCurves(Point=area_17.Centroid, Curves=hull_2.Hull)  # -> Relationship, Index, Point
python_11 = GhPythonScript(x=incurves.Relationship)  # -> out, a; inputs x: list
# ---------- python_11: Python ----------
__author__ = "orcun"
__version__ = "2021.09.25"


import rhinoscriptsyntax as rs
a = []
'2 if it is inside'
for i in range(len(x)): 
    if x[i] == 2:
        a.append(i)
# ---------- end python_11 ----------

# ----
# total # of parcels in the neighborhood
# public and school buildings excluded list
# # of parcels in the block
lng_23 = ListLength(List=merge_5)
data_10 = Data(flatten(lng_22))
# Tree Branch BAĞLANMADI HENÜZ
series_12 = Series(Start=0, Step=1, Count=lng_23)
partition_13 = PartitionList(List=series_12, Size=data_10)  # -> simplify(Chunks)
data_11 = Data(python_11.a)
cull_i_5 = CullIndex(List=partition_13, Indices=data_11, Wrap=True)  # -> simplify(flatten(List))

# ----
# # of parcels in the block
data_12 = Data(flatten(lng_22))

# ----
# # of parcels in the block
data_13 = Data(flatten(lng_22))

# ----
# public and school buildings excluded list
data_14 = Data(python_11.a)

partition_14 = PartitionList(List=series_6, Size=data_12)  # -> simplify(Chunks)
cull_i_6 = CullIndex(List=partition_14, Indices=data_14, Wrap=True)  # -> simplify(flatten(List))

# ----
# public and school buildings excluded list
data_15 = Data(python_11.a)

partition_15 = PartitionList(List=series_7, Size=data_13)  # -> simplify(Chunks)
cull_i_7 = CullIndex(List=partition_15, Indices=data_15, Wrap=True)  # -> simplify(flatten(List))

# ----
# public and school buildings
item_13 = ListItem(List=partition_8, Index=python_11.a, Wrap=True)  # -> flatten(Item)

# ----
# public and school buildings
data_16 = Data(python_11.a)

# ----
# tag order for parcels
# public and school buildings excluded list
cull_i_8 = CullIndex(List=partition_8, Indices=data_16, Wrap=True)  # -> simplify(List)

lng_24 = ListLength(List=cull_i_8)
dup_3 = DuplicateData(Data="empty", Number=lng_24, Order=True)  # -> simplify(flatten(Data))
panel_95 = Panel("empty list")

# ----
# public and school buildings
item_14 = ListItem(List=partition_8, Index=python_11.a, Wrap=True)  # -> flatten(Item)

# ----
# Entering EKB Data
# for Masonry Wall
panel_96 = Panel("_")
join_2 = TextJoin(Text=merge_2, Join=panel_96)  # -> simplify(flatten(Result))
mindex = MemberIndex(Set=join_2, Member=item_14)  # -> flatten(Index), Count

# ----
# public and school buildings excluded list
cull_i_9 = CullIndex(List=join_2, Indices=mindex.Index, Wrap=True)

mindex_2 = MemberIndex(Set=flatten(cull_i_8), Member=cull_i_9)  # -> flatten(Index), Count
lng_25 = ListLength(List=mindex_2.Index)
series_13 = Series(Start=0, Step=1, Count=lng_25)
item_15 = ListItem(List=ekbuwallconcrete, Index=series_13, Wrap=True)

panel_97 = Panel("block-list")
data_17 = Data(lng_22)

# ----
# Parcel_Block Coordinates
# public and school buildings excluded list
area_18 = Area(Geometry=merge_3)  # -> Area, Centroid
data_18 = Data(lng_22)
pdecon_5 = Deconstruct(Point=area_18.Centroid)  # -> XComponent, YComponent, ZComponent
partition_16 = PartitionList(List=pdecon_5.XComponent, Size=flatten(data_18))  # -> simplify(Chunks)
partition_17 = PartitionList(List=pdecon_5.YComponent, Size=flatten(data_18))  # -> simplify(Chunks)
data_19 = Data(python_11.a)
cull_i_10 = CullIndex(List=partition_17, Indices=data_19, Wrap=True)  # -> simplify(List)
cull_i_11 = CullIndex(List=partition_16, Indices=data_19, Wrap=True)  # -> simplify(List)
panel_99 = Panel(partition_16)
panel_100 = Panel(partition_17)

data_20 = Data(lng_22)

# ----
# public and school buildings excluded list
data_21 = Data(python_11.a)

# ----
# Parcel_Block Coordinates
area_19 = Area(Geometry=merge_5)  # -> Area, Centroid
pdecon_6 = Deconstruct(Point=area_19.Centroid)  # -> XComponent, YComponent, ZComponent
partition_18 = PartitionList(List=pdecon_6.XComponent, Size=flatten(data_17))  # -> simplify(Chunks)
partition_19 = PartitionList(List=pdecon_6.YComponent, Size=flatten(data_17))  # -> simplify(Chunks)
cull_i_12 = CullIndex(List=partition_19, Indices=data_21, Wrap=True)  # -> simplify(List)
cull_i_13 = CullIndex(List=partition_18, Indices=data_21, Wrap=True)  # -> simplify(List)
panel_102 = Panel(partition_18)
panel_103 = Panel(partition_19)

# ----
# public and school buildings excluded list
data_22 = Data(python_11.a)

# ----
# Parcel_Block Coordinates
area_20 = Area(Geometry=merge_4)  # -> Area, Centroid
pdecon_7 = Deconstruct(Point=area_20.Centroid)  # -> XComponent, YComponent, ZComponent
partition_20 = PartitionList(List=pdecon_7.XComponent, Size=flatten(data_20))  # -> simplify(Chunks)
partition_21 = PartitionList(List=pdecon_7.YComponent, Size=flatten(data_20))  # -> simplify(Chunks)
cull_i_14 = CullIndex(List=partition_21, Indices=data_22, Wrap=True)  # -> simplify(List)
cull_i_15 = CullIndex(List=partition_20, Indices=data_22, Wrap=True)  # -> simplify(List)
panel_104 = Panel(partition_20)
panel_105 = Panel(partition_21)

# ----
# RENEWABLE_AD
data_23 = Data(flatten(lng_22))
data_24 = Data(weave_13)
partition_22 = PartitionList(List=data_24, Size=data_23)
cull_i_16 = CullIndex(List=partition_22, Indices=python_11.a, Wrap=True)  # -> simplify(List)
multiplication = Multiplication(A=cull_i_16, B="3")
Z = UnitZ(Factor=multiplication)
extr = Extrude(Base=merge_11, Direction=Z)

# ----
# 4-edged
# Ordered
# Parcels
swatch_3 = ColourSwatch(SwatchColor=RGB(255, 255, 255))
geo_33 = Geometry(item_12)
preview_15 = CustomPreview(Geometry=geo_33, Material=swatch_3)

panel_106 = Panel("""simplified &
ordered
parcel
layouts""")
# x
# x
# x
# x
# x
# x
# x
# x
# x
# x
# x
# x
# x
# x
# x
# x
# x
# x
# x
# x
# x
# x
# 02.SIMPLIFICATION
panel_107 = Panel(item_12)

# ----
# public and school buildings excluded list
cull_i_17 = CullIndex(List=item_12, Indices=python_11.a, Wrap=True)  # -> simplify(List)

panel_108 = Panel("# of block")
lng_26 = ListLength(List=merge_11)  # -> flatten(Length)

# ----
# if necessary,
# select and simulate,
# only,
# according to construction date
panel_109 = Panel("construction date")
data_25 = Data(weave_9)

# ----
# CONSTRUCTION DATE SELECTION
# 0 means, no selection according to construction date
panel_110 = Panel("0")
data_26 = Data(panel_110)

partition_23 = PartitionList(List=data_25, Size=lng_26)  # -> simplify(Chunks)

# ----
# public and school buildings excluded list
data_27 = Data(python_11.a)

panel_111 = Panel("""1960
1980
2000""")
equals_11 = Equality(FirstNumber=data_26, SecondNumber=panel_111)  # -> Equality, Inequality
dcon = DeleteConsecutive(Set=equals_11.Equality, Wrap=False)  # -> Set, Count
item_16 = ListItem(List=dcon.Set, Index=0, Wrap=True)
python_12 = GhPythonScript(x=item_16)  # -> out, a
# ---------- python_12: Python ----------
__author__ = "Siser"
__version__ = "2022.01.08"

import rhinoscriptsyntax as rs
if x == True:
    a = 0
else:
    a = 1
# ---------- end python_12 ----------

cull_i_18 = CullIndex(List=partition_23, Indices=data_27, Wrap=True)  # -> simplify(List)

# ----
# # of units
toggle = BooleanToggle(True)

panel_112 = Panel("0=masonry, 1=concrete")  # disabled
panel_113 = Panel("0")  # disabled
panel_114 = Panel("1")  # disabled

concrete = Panel("""0.567
1.149
1.024
1.800
1.008
1.740
0.312
2.826
0.531
0.623
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""")  # disabled
lng_27 = ListLength(List=concrete)  # disabled
dup_4 = DuplicateData(Data=panel_114, Number=lng_27, Order=True)  # disabled

masonry = Panel("""0.597
3.534
3.046
0.226
0.695
2.336
1.488
3.046
1.230
3.399
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""")  # disabled
lng_28 = ListLength(List=masonry)  # disabled
dup_5 = DuplicateData(Data=panel_113, Number=lng_28, Order=True)  # disabled

# ----
# public and school buildings excluded list
geo_34 = Geometry(cull_i_17)  # disabled
lng_29 = ListLength(List=flatten(geo_34))  # disabled

concrete_2 = Panel("163")  # disabled
masonry_2 = Panel("18")  # disabled
addition_4 = Addition(A=concrete_2, B=masonry_2)  # disabled

# ----
# organized 4edged
# building PARCELS
geo_35 = Geometry(cull_i_17)

# ----
# selection
# according to
# construction date
equals_12 = Equality(FirstNumber=cull_i_18, SecondNumber=data_26)  # -> Equality, Inequality
dispatch_17 = Dispatch(List=geo_35, DispatchPattern=equals_12.Equality)  # -> ListA, ListB
weave_19 = Weave(Pattern=python_12.a, Stream0=dispatch_17.ListA, Stream1=dispatch_17.ListB, NullGaps=False)  # -> simplify(Weave)

division_7 = Division(A=lng_29, B=addition_4)  # disabled
multiplication_2 = Multiplication(A=concrete_2, B=division_7)  # disabled
round_7 = Round(Number=multiplication_2)  # -> Nearest, Floor, Ceiling; disabled
subtraction = Subtraction(A=lng_29, B=round_7.Nearest)  # disabled

# ----
# all values are average
panel_115 = Panel("scheduleA")
genes = GenePool(Decimals=1, Maximum=1, Minimum=0, Value=[1, 1, 1, 1, 1, 1, 1, 1, 1, 1, 1, 1, 1, 1, 1, 1, 1, 1, 1, 1, 1, 1, 1, 1])

# ----
# Wall Construction
merge_14 = Merge(Data1=dup_5, Data2=dup_4)  # disabled
jitter_4 = Jitter(List=merge_14, Jitter=1, Seed=2)  # -> Values, Indices; disabled
weave_20 = Weave(Pattern=jitter_4.Values, Stream0=masonry, Stream1=concrete, NullGaps=False)  # disabled
panel_116 = Panel(weave_20)  # disabled

# ----
# 1 person
_1_person_percentage = Panel("17.9")

panel_117 = Panel("1 person percentage")
data_28 = Data(_1_person_percentage)

data_29 = Data(_1_person_percentage)

data_30 = Data(_1_person_percentage)

genes_2 = GenePool(
    Decimals=1,
    Maximum=1,
    Minimum=0,
    Value=[1, 1, 1, 1, 1, 1, 1, 1, 1, 1, 0.4, 0.4, 0.4, 0.6, 0.5, 0.5, 0.6, 0.4, 0.4, 0.4, 1, 1, 1, 1])

merge_15 = Merge(Data1=panel_115, Data2="scheduleB")
max = Maximum(A=genes, B=genes_2)
join_3 = TextJoin(Text=merge_15, Join="_")
panel_120 = Panel(join_3)

panel_121 = Panel("saturday")
# Since the leisure time data is not available in TUIK, modeling for the weekend was not done in the UBEM occupancy schedule modeling. SAME weekend values were determined for all daily schedule of occupant profiles.
genes_3 = GenePool(
    Decimals=1,
    Maximum=1,
    Minimum=0,
    Value=[1, 1, 1, 1, 1, 1, 1, 1, 0.3, 0.3, 0.3, 0.3, 0.3, 0.3, 0.7, 0.7, 0.7, 0.7, 0.7, 1, 1, 1, 1, 1])

# ----
# if construction date did not entered, no shuffling
python_13 = GhPythonScript(x=panel_110)  # -> out, a; inputs x: Int32
# ---------- python_13: Python ----------
__author__ = "Siser"
__version__ = "2022.02.03"

import rhinoscriptsyntax as rs
if x == 0:
    a = 0
else:
    a = 1
# ---------- end python_13 ----------

# ----
# seed
panel_122 = Panel("5")

genes_4 = GenePool(
    Decimals=1,
    Maximum=1,
    Minimum=0,
    Value=[1, 1, 1, 1, 1, 1, 1, 0.6, 0.6, 0.4, 0.4, 0, 0, 0, 0, 0, 0, 0.4, 0.4, 0.6, 0.6, 1, 1, 1])

merge_16 = Merge(Data1="scheduleC", Data2="scheduleB", Data3=panel_115)
max_2 = Maximum(A=genes_4, B=genes_2)
max_3 = Maximum(A=max_2, B=genes)
join_4 = TextJoin(Text=merge_16, Join="_")
panel_123 = Panel(join_4)

panel_124 = Panel("sunday")
genes_5 = GenePool(Decimals=1, Maximum=1, Minimum=0, Value=[1, 1, 1, 1, 1, 1, 1, 1, 1, 1, 1, 1, 1, 1, 1, 1, 1, 1, 1, 1, 1, 1, 1, 1])

annualschedule = Honeybee_AnnualSchedule(
    sun=genes_5,
    mon=genes_2,
    tue=genes_2,
    wed=genes_2,
    thu=genes_2,
    fri=genes_2,
    sat=genes_3,
    scheduleName="scheduleB",
    runIt=toggle)  # -> readMe, port, schedule, port_2, weekSched, schedIDFText; plug-in component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
panel_125 = Panel(annualschedule.weekSched)

annualschedule_2 = Honeybee_AnnualSchedule(sun=genes_5, mon=genes, tue=genes, wed=genes, thu=genes, fri=genes, sat=genes_3, scheduleName=panel_115, runIt=toggle)  # -> readMe, port, schedule, port_2, weekSched, schedIDFText; plug-in component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
panel_126 = Panel(annualschedule_2.weekSched)

panel_127 = Panel("adult")

concrete_3 = Panel(round_7.Nearest)  # disabled
masonry_3 = Panel(subtraction)  # disabled

merge_17 = Merge(Data1="scheduleC", Data2="scheduleB")
max_4 = Maximum(A=genes_4, B=genes_2)
join_5 = TextJoin(Text=merge_17, Join="_")
panel_130 = Panel(join_5)

genes_6 = GenePool(
    Decimals=1,
    Maximum=1,
    Minimum=0,
    Value=[0.9, 0.9, 0.9, 0.9, 0.9, 0.9, 0.9, 0.6, 0.6, 0.5, 0.5, 0.4, 0.4, 0.4, 0.4, 0.4, 0.4, 0.4, 0.4, 0.6, 0.6, 0.9, 0.9, 0.9])

annualschedule_3 = Honeybee_AnnualSchedule(
    sun=genes_5,
    mon=genes_6,
    tue=genes_6,
    wed=genes_6,
    thu=genes_6,
    fri=genes_6,
    sat=genes_3,
    scheduleName="scheduleD",
    runIt=toggle)  # -> readMe, port, schedule, port_2, weekSched, schedIDFText; plug-in component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
panel_131 = Panel(annualschedule_3.weekSched)

merge_18 = Merge(Data1="scheduleB", Data2="scheduleD", Data3=panel_115)
max_5 = Maximum(A=genes_2, B=genes_6)
join_6 = TextJoin(Text=merge_18, Join="_")
max_6 = Maximum(A=max_5, B=genes)
panel_132 = Panel(join_6)

merge_19 = Merge(Data1="scheduleC", Data2="scheduleD", Data3=panel_115)
max_7 = Maximum(A=genes_4, B=genes_6)
max_8 = Maximum(A=max_7, B=genes)
join_7 = TextJoin(Text=merge_19, Join="_")
panel_133 = Panel(join_7)

merge_20 = Merge(Data1="scheduleB", Data2="scheduleD")
max_9 = Maximum(A=genes_2, B=genes_6)
join_8 = TextJoin(Text=merge_20, Join="_")
panel_134 = Panel(join_8)

merge_21 = Merge(Data1="scheduleC", Data2="scheduleD")
max_10 = Maximum(A=genes_4, B=genes_6)
join_9 = TextJoin(Text=merge_21, Join="_")
panel_135 = Panel(join_9)

merge_22 = Merge(Data1=panel_115, Data2="scheduleD")
max_11 = Maximum(A=genes, B=genes_6)
join_10 = TextJoin(Text=merge_22, Join="_")
panel_136 = Panel(join_10)

# ----
# CONSTRUCTION DATE
# SELECTION PERCENTAGE
panel_137 = Panel("100")

panel_138 = Panel("selection ratio")
data_31 = Data(panel_137)

# ----
# if necessary,
# select and simulate,
# only,
# according to construction date
# and,
# percentage
# indices of
# selection ratio
jitter_5 = Jitter(List=weave_19, Jitter=python_13.a, Seed=2)  # -> simplify(Values), Indices
lng_30 = ListLength(List=weave_19)
division_8 = Division(A=lng_30, B=100)
multiplication_3 = Multiplication(A=division_8, B=data_31)
round_8 = Round(Number=multiplication_3)  # -> Nearest, Floor, Ceiling
series_14 = Series(Start=0, Step=1, Count=round_8.Nearest)  # -> simplify(Series)
item_17 = ListItem(List=jitter_5.Values, Index=series_14, Wrap=True)

# ----
# Ordered Building Layouts
geo_36 = Geometry(item_17)
# x
# x
# x
# x
# x
# x
# x
# x
# x
# x
# x
# x
# x
# x
# x
# x
# x
# x
# x
# x
# x
# x
preview_16 = CustomPreview(Geometry=geo_36, Material=ColourSwatch(SwatchColor=RGB(181, 0, 0)))

panel_139 = Panel("schedule_D")

panel_140 = Panel("schedule_B")

data_32 = Data(panel_122)
panel_142 = Panel("seed")

# ----
# 2 people
# 2 persons Family with Kids
annualschedule_4 = Honeybee_AnnualSchedule(sun=genes_5, mon=max, tue=max, wed=max, thu=max, fri=max, sat=genes_3, scheduleName=panel_120, runIt=toggle)  # -> readMe, port, schedule, port_2, weekSched, schedIDFText; plug-in component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
panel_143 = Panel(annualschedule_4.weekSched)

annualschedule_5 = Honeybee_AnnualSchedule(sun=genes_5, mon=max_10, tue=max_10, wed=max_10, thu=max_10, fri=max_10, sat=genes_3, scheduleName=join_9, runIt=toggle)  # -> readMe, port, schedule, port_2, weekSched, schedIDFText; plug-in component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
panel_144 = Panel(annualschedule_5.weekSched)

annualschedule_6 = Honeybee_AnnualSchedule(sun=genes_5, mon=max_9, tue=max_9, wed=max_9, thu=max_9, fri=max_9, sat=genes_3, scheduleName=join_8, runIt=toggle)  # -> readMe, port, schedule, port_2, weekSched, schedIDFText; plug-in component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
panel_145 = Panel(annualschedule_6.weekSched)

annualschedule_7 = Honeybee_AnnualSchedule(sun=genes_5, mon=max_4, tue=max_4, wed=max_4, thu=max_4, fri=max_4, sat=genes_3, scheduleName=join_5, runIt=toggle)  # -> readMe, port, schedule, port_2, weekSched, schedIDFText; plug-in component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
panel_146 = Panel(annualschedule_7.weekSched)

annualschedule_8 = Honeybee_AnnualSchedule(sun=genes_5, mon=max, tue=max, wed=max, thu=max, fri=max, sat=genes_3, scheduleName=panel_120, runIt=toggle)  # -> readMe, port, schedule, port_2, weekSched, schedIDFText; plug-in component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
panel_147 = Panel(annualschedule_8.weekSched)

annualschedule_9 = Honeybee_AnnualSchedule(sun=genes_5, mon=max_11, tue=max_11, wed=max_11, thu=max_11, fri=max_11, sat=genes_3, scheduleName=join_10, runIt=toggle)  # -> readMe, port, schedule, port_2, weekSched, schedIDFText; plug-in component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
panel_148 = Panel(annualschedule_9.weekSched)

annualschedule_10 = Honeybee_AnnualSchedule(
    sun=genes_5,
    mon=genes_2,
    tue=genes_2,
    wed=genes_2,
    thu=genes_2,
    fri=genes_2,
    sat=genes_3,
    scheduleName="scheduleB",
    runIt=toggle)  # -> readMe, port, schedule, port_2, weekSched, schedIDFText; plug-in component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
panel_149 = Panel(annualschedule_10.weekSched)

annualschedule_11 = Honeybee_AnnualSchedule(sun=genes_5, mon=genes, tue=genes, wed=genes, thu=genes, fri=genes, sat=genes_3, scheduleName=panel_115, runIt=toggle)  # -> readMe, port, schedule, port_2, weekSched, schedIDFText; plug-in component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
panel_150 = Panel(annualschedule_11.weekSched)

annualschedule_12 = Honeybee_AnnualSchedule(sun=genes_5, mon=max_9, tue=max_9, wed=max_9, thu=max_9, fri=max_9, sat=genes_3, scheduleName=join_8, runIt=toggle)  # -> readMe, port, schedule, port_2, weekSched, schedIDFText; plug-in component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
panel_151 = Panel(annualschedule_12.weekSched)

annualschedule_13 = Honeybee_AnnualSchedule(sun=genes_5, mon=max_11, tue=max_11, wed=max_11, thu=max_11, fri=max_11, sat=genes_3, scheduleName=join_10, runIt=toggle)  # -> readMe, port, schedule, port_2, weekSched, schedIDFText; plug-in component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
panel_152 = Panel(annualschedule_13.weekSched)

annualschedule_14 = Honeybee_AnnualSchedule(
    sun=genes_5,
    mon=genes_2,
    tue=genes_2,
    wed=genes_2,
    thu=genes_2,
    fri=genes_2,
    sat=genes_3,
    scheduleName="scheduleB",
    runIt=toggle)  # -> readMe, port, schedule, port_2, weekSched, schedIDFText; plug-in component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
panel_153 = Panel(annualschedule_14.weekSched)

annualschedule_15 = Honeybee_AnnualSchedule(
    sun=genes_5,
    mon=genes_6,
    tue=genes_6,
    wed=genes_6,
    thu=genes_6,
    fri=genes_6,
    sat=genes_3,
    scheduleName="scheduleD",
    runIt=toggle)  # -> readMe, port, schedule, port_2, weekSched, schedIDFText; plug-in component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
panel_154 = Panel(annualschedule_15.weekSched)

# ----
# x
# x
# x
# x
# x
# x
# x
# x
# x
# x
# x
# x
# x
# x
# x
# x
# x
# x
# x
# x
# x
# x
# organized 4edged building PARCELS
geo_37 = Geometry(item_17)

# ----
# Check for UV organization of surface
geo_38 = Geometry(flatten(geo_37))
disc_3 = Discontinuity(Curve=geo_38, Level=1)  # -> Points, Parameters
hull_3 = ConvexHull(Points=disc_3.Points, Plane=PlaneXY(0, 0, 0))  # -> flatten(Hull), HullZ, Indices
boundary_13 = BoundarySurfaces(Edges=hull_3.Hull)
wires_2 = BrepWireframe(Brep=boundary_13, Density=-1)  # -> simplify(Wireframe)
len = Length(Curve=wires_2)
partition_24 = PartitionList(List=boundary_13, Size="1")  # -> simplify(Chunks)
listdexs_5 = ListIndices(List=len)
sort_9 = SortList(Keys=len, ValuesA=listdexs_5)  # -> Keys, reverse(ValuesA)
md_slider = MDSlider(SliderMode=0, slider_value=Point(0.5, 0.5, 0.5), x_domain=Domain(0, 1), y_domain=Domain(0, 1), z_domain=Domain(0, 1))
item_18 = ListItem(List=sort_9.ValuesA, Index=0, Wrap=True)
iso = IsoCurve(Surface=reparameterize(boundary_13), UVPoint=md_slider)  # -> simplify(UIsocurve), VIsocurve
item_19 = ListItem(List=wires_2, Index=item_18, Wrap=True)
colom = CollisionOneMany(Collider=iso.UIsocurve, Obstacles=item_19)  # -> Collision, Index
dispatch_18 = Dispatch(List=partition_24, DispatchPattern=colom.Collision)  # -> simplify(ListA), ListB
clean = CleanTree(RemoveNulls=True, RemoveInvalid=True, RemoveEmpty=Toggle(True), Tree=dispatch_18.ListA)

_2_people_percentage = Panel("19.1")

panel_155 = Panel("-")

# ----
# 2 persons Family no Family
_2_people_percentage_2 = Panel("2.0")

panel_159 = Panel(panel_147)
panel_160 = Panel("Normalized (sch_x*sch_y)")

panel_163 = Panel(panel_150)

panel_165 = Panel(panel_152)

panel_166 = Panel(panel_151)

panel_170 = Panel(panel_153)

panel_172 = Panel(panel_154)

panel_174 = Panel(panel_145)

panel_176 = Panel(panel_149)

panel_178 = Panel(panel_148)

panel_180 = Panel(panel_146)

panel_182 = Panel(panel_144)

panel_184 = Panel(panel_143)

panel_185 = Panel("""UBEM 
Parcel No
List""")
data_33 = Data(weave_8)

# ----
# block number division
panel_186 = Panel("0")
equals_13 = Equality(FirstNumber=data_33, SecondNumber=panel_186)  # -> Equality, Inequality
num = Number(equals_13.Equality)
num_2 = Number("1")
lng_31 = ListLength(List=num)
mindex_3 = MemberIndex(Set=num, Member=num_2)  # -> Index, Count
merge_23 = Merge(Data1="0", Data2=lng_31)
panel_187 = Panel("""0
-1""")
ins_2 = InsertItems(List=mindex_3.Index, Item=merge_23, Indices=panel_187, Wrap=True)
cull_i_19 = CullIndex(List=ins_2, Indices="-1", Wrap=True)
shift_3 = ShiftList(List=ins_2, Shift=1, Wrap=Toggle(False))
subtraction_2 = Subtraction(A=shift_3, B=cull_i_19)

# ----
# Implementation of Real Data
# for Flat per Floor
# (division numbers,
# percentage for divisions)
unit_per_floor_division = Panel("""1
2
3
4""")
# room number: 50 To 95
# 95 To 140
# 140 To 185
# Implementation of Real Data
# for Unit Sqm
panel_188 = Panel("3")

data_34 = Data(panel_122)

data_35 = Data(panel_122)

data_36 = Data(weave_13)

# ----
# Generated
# # of Units
# Per Floor
data_37 = Data(weave_18)

# ----
# reverse UV of surfaces
data_38 = Data(flatten(clean))
srf = Surface(reparameterize(data_38))
python_14 = PythonScript(s=srf, swapUV=Toggle(True), reverseU=Toggle(False), reverseV=Toggle(False))  # -> out, anchor, uVec, vVec, revSrf; inputs s: Surface, swapUV: Int32, reverseU: Int32, reverseV: Int32
# ---------- python_14: Python ----------
import Rhino

if reverseU:
    uS,uE = s.Domain(0)
    inter0 = Rhino.Geometry.Interval(-uE, -uS)
    s.SetDomain(0,inter0)
    s = s.Reverse(0)

if reverseV:
    vS,vE = s.Domain(1)
    inter1 = Rhino.Geometry.Interval(-vE, -vS)
    s.SetDomain(1,inter1)
    s = s.Reverse(1)

if swapUV:
    s = s.Transpose()

anchor = s.PointAt(0,0)
uend = s.PointAt(0.5,0)
vend = s.PointAt(0,0.5)
uVec = uend - anchor
vVec = vend - anchor

revSrf = s
# ---------- end python_14 ----------

# ----
# # of Units of
# the building
data_39 = Data(weave_16)

data_40 = Data(panel_122)

u = ColourSwatch(SwatchColor=RGB(2, 4, 255))
v = ColourSwatch(SwatchColor=RGB(225, 0, 0))
vdisex = VectorDisplayEx(Point=python_14.anchor, Vector=python_14.uVec, Colour=u, Width=3)
vdisex_2 = VectorDisplayEx(Point=python_14.anchor, Vector=python_14.vVec, Colour=v, Width=3)

panel_193 = Panel("exclude non-residential buildings")
clean_2 = CleanTree(RemoveNulls=True, RemoveInvalid=True, RemoveEmpty=False, Tree=python_11.a)

clean_3 = CleanTree(RemoveNulls=True, RemoveInvalid=True, RemoveEmpty=False, Tree=python_11.a)

clean_4 = CleanTree(RemoveNulls=True, RemoveInvalid=True, RemoveEmpty=False, Tree=python_11.a)

annualschedule_16 = Honeybee_AnnualSchedule(sun=genes_5, mon=max_8, tue=max_8, wed=max_8, thu=max_8, fri=max_8, sat=genes_3, scheduleName=join_7, runIt=toggle)  # -> readMe, port, schedule, port_2, weekSched, schedIDFText; plug-in component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
panel_196 = Panel(annualschedule_16.weekSched)

annualschedule_17 = Honeybee_AnnualSchedule(sun=genes_5, mon=max_6, tue=max_6, wed=max_6, thu=max_6, fri=max_6, sat=genes_3, scheduleName=join_6, runIt=toggle)  # -> readMe, port, schedule, port_2, weekSched, schedIDFText; plug-in component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
panel_197 = Panel(annualschedule_17.weekSched)

annualschedule_18 = Honeybee_AnnualSchedule(sun=genes_5, mon=max_11, tue=max_11, wed=max_11, thu=max_11, fri=max_11, sat=genes_3, scheduleName=join_10, runIt=toggle)  # -> readMe, port, schedule, port_2, weekSched, schedIDFText; plug-in component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
panel_198 = Panel(annualschedule_18.weekSched)

annualschedule_19 = Honeybee_AnnualSchedule(sun=genes_5, mon=max, tue=max, wed=max, thu=max, fri=max, sat=genes_3, scheduleName=panel_120, runIt=toggle)  # -> readMe, port, schedule, port_2, weekSched, schedIDFText; plug-in component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
panel_199 = Panel(annualschedule_19.weekSched)

annualschedule_20 = Honeybee_AnnualSchedule(sun=genes_5, mon=max, tue=max, wed=max, thu=max, fri=max, sat=genes_3, scheduleName=panel_120, runIt=toggle)  # -> readMe, port, schedule, port_2, weekSched, schedIDFText; plug-in component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
panel_200 = Panel(annualschedule_20.weekSched)

annualschedule_21 = Honeybee_AnnualSchedule(sun=genes_5, mon=max_3, tue=max_3, wed=max_3, thu=max_3, fri=max_3, sat=genes_3, scheduleName=join_4, runIt=toggle)  # -> readMe, port, schedule, port_2, weekSched, schedIDFText; plug-in component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
panel_201 = Panel(annualschedule_21.weekSched)

geo_39 = Geometry(boundary_13)

# ----
# u(uv)and longest edge is at the same orientation
tstat_3 = TreeStatistics(Tree=clean)  # -> Paths, Length, Count
split_4 = TextSplit(Text=tstat_3.Paths, Separators="{}")
item_20 = ListItem(List=split_4, Index="1", Wrap=True)  # -> flatten(Item)
replace_6 = ReplaceItems(List=geo_39, Item=python_14.revSrf, Indices=item_20, Wrap=False)

md_slider_2 = MDSlider(SliderMode=0, slider_value=Point(0.5, 0.5, 0.5), x_domain=Domain(0, 1), y_domain=Domain(0, 1), z_domain=Domain(0, 1))
iso_2 = IsoCurve(Surface=reparameterize(replace_6), UVPoint=md_slider_2)  # -> simplify(UIsocurve), VIsocurve
preview_17 = CustomPreview(Geometry=iso_2.UIsocurve, Material=ColourSwatch(SwatchColor=RGB(47, 255, 0)))

# ----
# selection according to
# construction date
data_41 = Data(equals_12.Equality)

# ----
# # of Units Per Floor in the building
toggle_2 = BooleanToggle(True)
partition_25 = PartitionList(List=data_37, Size=subtraction_2)  # -> simplify(Chunks)
clean_5 = CleanTree(RemoveNulls=True, RemoveInvalid=True, RemoveEmpty=toggle_2, Tree=partition_25)
lng_32 = ListLength(List=clean_5)  # -> flatten(Length)
partition_26 = PartitionList(List=flatten(clean_5), Size=lng_32)  # -> simplify(Chunks)
cull_i_20 = CullIndex(List=partition_26, Indices=clean_3, Wrap=True)  # -> simplify(List)
dispatch_19 = Dispatch(List=cull_i_20, DispatchPattern=data_41)  # -> ListA, ListB
weave_21 = Weave(Pattern=python_12.a, Stream0=dispatch_19.ListA, Stream1=dispatch_19.ListB, NullGaps=False)  # -> simplify(Weave)

data_42 = Data(panel_122)

# ----
# selection according to
# construction date
data_43 = Data(equals_12.Equality)

# ----
# # of Units of the building
toggle_3 = BooleanToggle(True)
partition_27 = PartitionList(List=data_39, Size=subtraction_2)  # -> simplify(Chunks)
clean_6 = CleanTree(RemoveNulls=True, RemoveInvalid=True, RemoveEmpty=toggle_3, Tree=partition_27)
lng_33 = ListLength(List=clean_6)  # -> flatten(Length)
partition_28 = PartitionList(List=flatten(clean_6), Size=lng_33)  # -> simplify(Chunks)
cull_i_21 = CullIndex(List=partition_28, Indices=clean_4, Wrap=True)  # -> simplify(List)
dispatch_20 = Dispatch(List=cull_i_21, DispatchPattern=data_43)  # -> ListA, ListB
weave_22 = Weave(Pattern=python_12.a, Stream0=dispatch_20.ListA, Stream1=dispatch_20.ListB, NullGaps=False)  # -> simplify(Weave)

# ----
# selection according to
# construction date
data_44 = Data(equals_12.Equality)

data_45 = Data(panel_122)

# ----
# Arrange
# Surface
# U V values
c_script = CSharpScript()  # -> out, A; inputs x: Surface; disabled
# ---------- c_script: C# ----------
    double pi = 3.1415926535897932384626433832795;
    
    Rhino.Geometry.Point3d p;
    Rhino.Geometry.Vector3d[] UV;
    // Evaluating surfaces at center (median of domain start and end)
    x.Evaluate((x.Domain(0).T0 + x.Domain(0).T1) / 2, (x.Domain(1).T0 + x.Domain(1).T1) / 2, 1, out p, out UV);
    
    // U, V, WorldX, WorldY vectors
    Rhino.Geometry.Vector3d U = UV[0];    
    Rhino.Geometry.Vector3d V = UV[1];    
    Rhino.Geometry.Vector3d X = Rhino.Geometry.Plane.WorldXY.XAxis;
    Rhino.Geometry.Vector3d Y = Rhino.Geometry.Plane.WorldXY.YAxis;
    
    // Unitizing vectors to make tests
    U.Unitize();
    V.Unitize();

    if (Math.Abs(U.X) < Math.Abs(V.X)){ // If this is "true" it means V isocurves are more suitable to be aligned with World X axis than U; U and V needs to be swapped
      x.Transpose(true); //Swapping UV
      if (Vector3d.VectorAngle(V, X) > pi / 2){ // Flipping new U if angle with X is larger than 90°
        x.Reverse(0, true);}
      if (Vector3d.VectorAngle(U, Y) > pi / 2){ // Flipping new V if angle with Y is larger than 90°
        x.Reverse(1, true);}
    }
    else{ // U an V doesn't need to be swapped
      if (Vector3d.VectorAngle(U, X) > pi / 2){ // Flipping U if angle with X is larger than 90°
        x.Reverse(0, true);}
      if (Vector3d.VectorAngle(V, Y) > pi / 2){ // Flipping V if angle with Y is larger than 90°
        x.Reverse(1, true);}
    }
    A = x;
# ---------- end c_script ----------

panel_206 = Panel(panel_196)

panel_208 = Panel(panel_197)

panel_210 = Panel(panel_198)

panel_212 = Panel(panel_201)

geo_40 = Geometry(flatten(replace_6))

panel_215 = Panel(panel_199)

panel_217 = Panel(panel_200)

# ----
# indices of
# selection ratio according to construction date
data_46 = Data(series_14)
panel_218 = Panel("organized list")
item_21 = ListItem(List=simplify(weave_22), Index=simplify(data_46), Wrap=True)  # -> flatten(Item)

data_47 = Data(item_21)
ma = MassAddition(Input=data_47)  # -> Result, PartialResults
total_number_of_units = Panel(ma.Result)

data_48 = Data(item_21)
ma_2 = MassAddition(Input=data_48)  # -> Result, PartialResults
total_number_of_units_2 = Panel(ma_2.Result)

# ----
# 00.INPUT
data_49 = Data(item_21)
ma_3 = MassAddition(Input=data_49)  # -> Result, PartialResults
total_number_of_units_3 = Panel(ma_3.Result)

# ----
# total #of unit
# in the neighborhood
data_50 = Data(ma_3.Result)

pcent_4 = Percentage(Number=data_50, Percent=data_28)
pcent_5 = Percentage(Number=pcent_4, Percent="86")
pcent_6 = Percentage(Number=pcent_5, Percent="52.8")
round_9 = Round(Number=pcent_6)  # -> Nearest, Floor, Ceiling
dup_6 = DuplicateData(Data=annualschedule_3.schedule, Number=round_9.Nearest, Order=True)

pcent_7 = Percentage(Number=data_50, Percent=data_29)
pcent_8 = Percentage(Number=pcent_7, Percent="86")
pcent_9 = Percentage(Number=pcent_8, Percent="47.2")
round_10 = Round(Number=pcent_9)  # -> Nearest, Floor, Ceiling
dup_7 = DuplicateData(Data=annualschedule.schedule, Number=round_10.Nearest, Order=True)

pcent_10 = Percentage(Number=data_50, Percent=data_30)
pcent_11 = Percentage(Number=pcent_10, Percent="14")
pcent_12 = Percentage(Number=pcent_11, Percent="100")
round_11 = Round(Number=pcent_12)  # -> Nearest, Floor, Ceiling
dup_8 = DuplicateData(Data=annualschedule_2.schedule, Number=round_11.Nearest, Order=True)

merge_24 = Merge(Data1=dup_7, Data2=dup_6, Data3=dup_8)
jitter_6 = Jitter(List=merge_24, Jitter=1, Seed=data_32)  # -> Values, Indices

pcent_13 = Percentage(Number=data_50, Percent="23.44")
round_12 = Round(Number=pcent_13)  # -> Nearest, Floor, Ceiling
dup_9 = DuplicateData(Data=annualschedule_14.schedule, Number=round_12.Nearest, Order=True)

pcent_14 = Percentage(Number=data_50, Percent="3.02")
round_13 = Round(Number=pcent_14)  # -> Nearest, Floor, Ceiling
dup_10 = DuplicateData(Data=annualschedule_11.schedule, Number=round_13.Nearest, Order=True)

pcent_15 = Percentage(Number=data_50, Percent="9.43")
round_14 = Round(Number=pcent_15)  # -> Nearest, Floor, Ceiling
dup_11 = DuplicateData(Data=annualschedule_13.schedule, Number=round_14.Nearest, Order=True)

pcent_16 = Percentage(Number=data_50, Percent="8.41")
round_15 = Round(Number=pcent_16)  # -> Nearest, Floor, Ceiling
dup_12 = DuplicateData(Data=annualschedule_8.schedule, Number=round_15.Nearest, Order=True)

pcent_17 = Percentage(Number=data_50, Percent="29.43")
round_16 = Round(Number=pcent_17)  # -> Nearest, Floor, Ceiling
dup_13 = DuplicateData(Data=annualschedule_15.schedule, Number=round_16.Nearest, Order=True)

pcent_18 = Percentage(Number=data_50, Percent="26.27")
round_17 = Round(Number=pcent_18)  # -> Nearest, Floor, Ceiling
dup_14 = DuplicateData(Data=annualschedule_12.schedule, Number=round_17.Nearest, Order=True)

pcent_19 = Percentage(Number=data_50, Percent="100")
pcent_20 = Percentage(Number=pcent_19, Percent="3.4")
round_18 = Round(Number=pcent_20)  # -> Nearest, Floor, Ceiling
dup_15 = DuplicateData(Data=annualschedule_6.schedule, Number=round_18.Nearest, Order=True)

pcent_21 = Percentage(Number=data_50, Percent="100")
pcent_22 = Percentage(Number=pcent_21, Percent="10.8")
round_19 = Round(Number=pcent_22)  # -> Nearest, Floor, Ceiling
dup_16 = DuplicateData(Data=annualschedule_9.schedule, Number=round_19.Nearest, Order=True)

pcent_23 = Percentage(Number=data_50, Percent="100")
pcent_24 = Percentage(Number=pcent_23, Percent="36.6")
round_20 = Round(Number=pcent_24)  # -> Nearest, Floor, Ceiling
dup_17 = DuplicateData(Data=annualschedule_7.schedule, Number=round_20.Nearest, Order=True)

pcent_25 = Percentage(Number=data_50, Percent="100")
pcent_26 = Percentage(Number=pcent_25, Percent="36.6")
round_21 = Round(Number=pcent_26)  # -> Nearest, Floor, Ceiling
dup_18 = DuplicateData(Data=annualschedule_5.schedule, Number=round_21.Nearest, Order=True)

pcent_27 = Percentage(Number=data_50, Percent="100")
pcent_28 = Percentage(Number=pcent_27, Percent="9.7")
round_22 = Round(Number=pcent_28)  # -> Nearest, Floor, Ceiling
dup_19 = DuplicateData(Data=annualschedule_4.schedule, Number=round_22.Nearest, Order=True)

pcent_29 = Percentage(Number=data_50, Percent="100")
pcent_30 = Percentage(Number=pcent_29, Percent="3")
round_23 = Round(Number=pcent_30)  # -> Nearest, Floor, Ceiling
dup_20 = DuplicateData(Data=annualschedule_10.schedule, Number=round_23.Nearest, Order=True)

merge_25 = Merge(Data1=dup_12, Data2=dup_11, Data3=dup_9, Data4=dup_14, Data5=dup_13, Data6=dup_10)
jitter_7 = Jitter(List=merge_25, Jitter=1, Seed=data_34)  # -> Values, Indices
lng_34 = ListLength(List=jitter_7.Values)
pcent_31 = Percentage(Number=lng_34, Percent=_2_people_percentage_2)
series_15 = Series(Start=0, Step=1, Count=pcent_31)
item_22 = ListItem(List=jitter_7.Values, Index=series_15, Wrap=True)

merge_26 = Merge(Data1=dup_19, Data2=dup_16, Data3=dup_20, Data4=dup_15, Data5=dup_17, Data6=dup_18)
jitter_8 = Jitter(List=merge_26, Jitter=1, Seed=data_35)  # -> Values, Indices
lng_35 = ListLength(List=jitter_8.Values)
pcent_32 = Percentage(Number=lng_35, Percent=_2_people_percentage)
series_16 = Series(Start=0, Step=1, Count=pcent_32)
item_23 = ListItem(List=jitter_8.Values, Index=series_16, Wrap=True)

merge_27 = Merge(Data1=item_23, Data2=item_22)
jitter_9 = Jitter(List=merge_27, Jitter=1, Seed=data_40)  # -> Values, Indices

# ----
# 3 people
# 3 people Family with Kids
merge_28 = Merge(Data1=dup_19, Data2=dup_16, Data3=dup_20, Data4=dup_15, Data5=dup_17, Data6=dup_18)
_3_people_percentage_family_with_kids = Panel("17.3")
jitter_10 = Jitter(List=merge_28, Jitter=1, Seed=data_42)  # -> Values, Indices
lng_36 = ListLength(List=jitter_10.Values)
pcent_33 = Percentage(Number=lng_36, Percent=_3_people_percentage_family_with_kids)
series_17 = Series(Start=0, Step=1, Count=pcent_33)
item_24 = ListItem(List=jitter_10.Values, Index=series_17, Wrap=True)

# ----
# 3 people Family no Family
merge_29 = Merge(Data1=dup_12, Data2=dup_11, Data3=dup_9, Data4=dup_14, Data5=dup_13, Data6=dup_10)
_3_people_percentage_no_family = Panel("0.4")
jitter_11 = Jitter(List=merge_29, Jitter=1, Seed=data_45)  # -> Values, Indices
lng_37 = ListLength(List=jitter_11.Values)
pcent_34 = Percentage(Number=lng_37, Percent=_2_people_percentage_2)
series_18 = Series(Start=0, Step=1, Count=pcent_34)
item_25 = ListItem(List=jitter_11.Values, Index=series_18, Wrap=True)

pcent_35 = Percentage(Number=data_50, Percent="38.05")
round_24 = Round(Number=pcent_35)  # -> Nearest, Floor, Ceiling
dup_21 = DuplicateData(Data=annualschedule_16.schedule, Number=round_24.Nearest, Order=True)

pcent_36 = Percentage(Number=data_50, Percent="11.28")
round_25 = Round(Number=pcent_36)  # -> Nearest, Floor, Ceiling
dup_22 = DuplicateData(Data=annualschedule_18.schedule, Number=round_25.Nearest, Order=True)

pcent_37 = Percentage(Number=data_50, Percent="33.95")
round_26 = Round(Number=pcent_37)  # -> Nearest, Floor, Ceiling
dup_23 = DuplicateData(Data=annualschedule_21.schedule, Number=round_26.Nearest, Order=True)

pcent_38 = Percentage(Number=data_50, Percent="3.51")
round_27 = Round(Number=pcent_38)  # -> Nearest, Floor, Ceiling
dup_24 = DuplicateData(Data=annualschedule_17.schedule, Number=round_27.Nearest, Order=True)

pcent_39 = Percentage(Number=data_50, Percent="3.13")
round_28 = Round(Number=pcent_39)  # -> Nearest, Floor, Ceiling
dup_25 = DuplicateData(Data=annualschedule_19.schedule, Number=round_28.Nearest, Order=True)

pcent_40 = Percentage(Number=data_50, Percent="10.07")
round_29 = Round(Number=pcent_40)  # -> Nearest, Floor, Ceiling
dup_26 = DuplicateData(Data=annualschedule_20.schedule, Number=round_29.Nearest, Order=True)

# ----
# indices of
# selection ratio according to construction date
data_51 = Data(series_14)
item_26 = ListItem(List=simplify(weave_21), Index=simplify(data_51), Wrap=True)  # -> flatten(Item)

# ----
# # of Units
# Per Floor
# if x == 1:
#     a=1,1
# elif x ==2:
#     a=2,1
# elif x == 3 or x == 4:
#     a=2,2
# elif x==5 or x ==6:
#     a=3,2
# else:
#     a=4,2
python_15 = GhPythonScript(x=item_26)  # -> out, simplify(a); inputs x: Int32
# ---------- python_15: Python ----------
__author__ = "orcun"
__version__ = "2021.11.17"

import rhinoscriptsyntax as rs
if x == 1:
    a=1,1
elif x ==2:
    a=2,1
elif x == 3 or x == 4:
    a=2,2
elif x==5 or x ==6:
    a=3,2
else:
    a=4,2
# ---------- end python_15 ----------
item_27 = ListItem(List=python_15.a, Index=0, Wrap=True)  # -> flatten(Item)
item_28 = ListItem(List=python_15.a, Index=1, Wrap=True)  # -> flatten(Item)

# ----
# # of Units Per Floor
data_52 = Data(item_26)

# ----
# Test surface U V values
panel_220 = Panel("0.5,0.5")  # disabled
iso_3 = IsoCurve(Surface=reparameterize(c_script.A), UVPoint=panel_220)  # -> UIsocurve, VIsocurve; disabled
swatch_4 = ColourSwatch(SwatchColor=RGB(255, 0, 0))  # disabled
swatch_5 = ColourSwatch(SwatchColor=RGB(0, 255, 4))  # disabled
# 3.1 - UNIT DIVISION
#   3.1.1 - 2 UNIT PER FLOOR
# Unit division types
# - Floor division with stairs
# - Floor division without stairs
# Adaptation with Real Data
# for unit division
# - L shape
# - Rectangular
# - I shape
# etc.
preview_18 = CustomPreview(Geometry=iso_3.UIsocurve, Material=swatch_4)  # disabled
# Full list control
# - Recording complete information of the unit
# --parcel, building, floor, number in the building
preview_19 = CustomPreview(Geometry=iso_3.VIsocurve, Material=swatch_5)  # disabled

_2_people_percentage_3 = Panel("1.9")

# ----
# # of Units Per Floor
data_53 = Data(item_26)

divide = DivideDomain²(Domain=replace_6, UCount=item_27, VCount=item_28)  # -> simplify(Segments)
partition_29 = PartitionList(List=replace_6, Size="1")
subsrf = Isotrim(Surface=partition_29, Domain=divide)  # -> simplify(Surface)
lng_38 = ListLength(List=subsrf)  # -> flatten(Length)
lng_39 = ListLength(List=data_53)
series_19 = Series(Start=0, Step=1, Count=lng_39)
equals_14 = Equality(FirstNumber=data_53, SecondNumber=lng_38)  # -> Equality, Inequality
dispatch_21 = Dispatch(List=series_19, DispatchPattern=equals_14.Equality)  # -> ListA, ListB
series_20 = Series(Start=0, Step=1, Count="2")
branch_10 = TreeBranch(Tree=subsrf, Path=dispatch_21.ListB, MaintainPaths=True)
item_29 = ListItem(List=branch_10, Index=series_20, Wrap=True)
# Unit per floor Division
sunion = SolidUnion(Breps=item_29)
disc_4 = Discontinuity(Curve=sunion, Level=1)  # -> Points, Parameters
pline = PolyLine(Vertices=disc_4.Points, Closed=Toggle(True))  # -> simplify(Polyline)
cull_i_22 = CullIndex(List=branch_10, Indices=series_20, Wrap=True)  # -> simplify(List)
merge_30 = Merge(Data1=cull_i_22, Data2=pline)
data_54 = Data(dispatch_21.ListB)
tstat_4 = TreeStatistics(Tree=merge_30)  # -> Paths, Length, Count
replace_7 = ReplacePaths(Data=merge_30, Search=tstat_4.Paths, Replace=data_54)

data_55 = Data("0.25")

data_56 = Data(panel_122)

# ----
# 3 people Family
# with Kids and Elderly
merge_31 = Merge(Data1=dup_26, Data2=dup_22, Data3=dup_25, Data4=dup_24, Data5=dup_23, Data6=dup_21)
jitter_12 = Jitter(List=merge_31, Jitter=1, Seed=data_56)  # -> Values, Indices
lng_40 = ListLength(List=jitter_12.Values)
pcent_41 = Percentage(Number=lng_40, Percent=_2_people_percentage_3)
series_21 = Series(Start=0, Step=1, Count=pcent_41)
item_30 = ListItem(List=jitter_12.Values, Index=series_21, Wrap=True)

data_57 = Data("0.25")

partition_30 = PartitionList(List=geo_40, Size="1")
divide_2 = DivideDomain²(Domain=partition_30, UCount="2", VCount="1")  # -> simplify(Segments)
subsrf_2 = Isotrim(Surface=partition_30, Domain=divide_2)  # -> simplify(Surface)
# 03.FLOORTOUNITDIVISION
md_slider_3 = MDSlider(SliderMode=0, slider_value=Point(0.5, 0.5, 0.5), x_domain=Domain(0, 1), y_domain=Domain(0, 1), z_domain=Domain(0, 1))
item_31 = ListItem(List=subsrf_2, Index=0, Wrap=True)
evalsrf = EvaluateSurface(Surface=item_31, Point=md_slider_3)  # -> Point, Normal, UDirection, VDirection, Frame
brec_2 = BoundingRectangle(Geometry=subsrf_2, Plane=evalsrf.Frame, Axis=0, Slide=0, Union=True)  # -> simplify(flatten(Bounding)), DimensionX, DimensionY
area_21 = Area(Geometry=brec_2.Bounding)  # -> Area, Centroid
scale = Scale(Geometry=brec_2.Bounding, Center=area_21.Centroid, Factor=data_57)  # -> Geometry, Transform

equals_15 = Equality(FirstNumber=data_52, SecondNumber="1")  # -> Equality, Inequality
lng_41 = ListLength(List=data_52)
series_22 = Series(Start=0, Step=1, Count=lng_41)
dispatch_22 = Dispatch(List=series_22, DispatchPattern=equals_15.Equality)  # -> ListA, ListB
item_32 = ListItem(List=brec_2.Bounding, Index=dispatch_22.ListA, Wrap=True)
area_22 = Area(Geometry=item_32)  # -> Area, Centroid
debrep_3 = DeconstructBrep(Brep=item_32)  # -> Faces, Edges, Vertices
scale_2 = Scale(Geometry=item_32, Center=area_22.Centroid, Factor=data_55)  # -> Geometry, Transform
item_33 = ListItem(List=debrep_3.Vertices, Index=0, Wrap=True)  # -> simplify(Item)
debrep_4 = DeconstructBrep(Brep=scale_2.Geometry)  # -> Faces, Edges, Vertices
item_34 = ListItem(List=debrep_4.Vertices, Index=0, Wrap=True)
move2pt = MoveToPoint(Geometry=scale_2.Geometry, PointA=flatten(item_34), PointB=flatten(item_33))  # -> simplify(Moved), Vector, Transform

partition_31 = PartitionList(List=equals_14.Equality, Size="1")  # -> simplify(Chunks)
dispatch_23 = Dispatch(List=subsrf, DispatchPattern=partition_31)  # -> ListA, ListB
clean_7 = CleanTree(RemoveNulls=True, RemoveInvalid=True, RemoveEmpty=Toggle(True), Tree=dispatch_23.ListA)

# ----
# rotateStaircase for better floor division, otherwise, units has strange edges
# StairCase
replace_8 = ReplaceItems(List=scale.Geometry, Item=move2pt.Moved, Indices=dispatch_22.ListA, Wrap=False)
partition_32 = PartitionList(List=replace_8, Size="1")  # -> simplify(Chunks)

data_58 = Data(panel_122)

merge_32 = Merge(Data1=item_24, Data2=item_25, Data3=item_30)
jitter_13 = Jitter(List=merge_32, Jitter=1, Seed=data_58)  # -> Values, Indices

# ----
# Unit per floor
# Divided Units
merge_33 = Merge(Data1=clean_7, Data2=replace_7)

data_59 = Data(panel_122)

# ----
# 4 people
# Family with Kids
merge_34 = Merge(Data1=dup_19, Data2=dup_16, Data3=dup_20, Data4=dup_15, Data5=dup_17, Data6=dup_18)
percentage_family_with_kids = Panel("17.1")
jitter_14 = Jitter(List=merge_34, Jitter=1, Seed=data_59)  # -> Values, Indices
lng_42 = ListLength(List=jitter_14.Values)
pcent_42 = Percentage(Number=lng_42, Percent=percentage_family_with_kids)
series_23 = Series(Start=0, Step=1, Count=pcent_42)
item_35 = ListItem(List=jitter_14.Values, Index=series_23, Wrap=True)

data_60 = Data(panel_122)

# ----
# Family with Kids and Elderly
merge_35 = Merge(Data1=dup_26, Data2=dup_22, Data3=dup_25, Data4=dup_24, Data5=dup_23, Data6=dup_21)
jitter_15 = Jitter(List=merge_35, Jitter=1, Seed=data_60)  # -> Values, Indices
percentage = Panel("2.7")
lng_43 = ListLength(List=jitter_15.Values)
pcent_43 = Percentage(Number=lng_43, Percent=percentage)
series_24 = Series(Start=0, Step=1, Count=pcent_43)
item_36 = ListItem(List=jitter_15.Values, Index=series_24, Wrap=True)

data_61 = Data(panel_122)

# ----
# Family no Family
merge_36 = Merge(Data1=dup_12, Data2=dup_11, Data3=dup_9, Data4=dup_14, Data5=dup_13, Data6=dup_10)
percentage_no_family = Panel("0.2")
jitter_16 = Jitter(List=merge_36, Jitter=1, Seed=data_61)  # -> Values, Indices
lng_44 = ListLength(List=jitter_16.Values)
pcent_44 = Percentage(Number=lng_44, Percent=_2_people_percentage_2)
series_25 = Series(Start=0, Step=1, Count=pcent_44)
item_37 = ListItem(List=jitter_16.Values, Index=series_25, Wrap=True)

panel_228 = Panel("floor height")
data_62 = Data(floor_height)

# ----
# no need to use anymore, because when a parcel enter into simulation the staircase implementation gets activated
rdiff = RegionDifference(CurvesA=merge_33, CurvesB=partition_32)  # -> simplify(Result); disabled

data_63 = Data(panel_122)

merge_37 = Merge(Data1=item_35, Data2=item_37, Data3=item_36)
jitter_17 = Jitter(List=merge_37, Jitter=1, Seed=data_63)  # -> Values, Indices

# ----
# x
# x
# x
# x
# x
# x
# x
# x
# x
# x
# x
# x
# x
# x
# x
# x
# x
# x
# x
# x
# x
# x
# x
# x
# x
# x
# x
# 
# x
# x
# x
# x
# x
# x
# 
# x
# x
# x
# x
# x
# 
# x
# x
# x
# x
# x
# x
# 
# x
# x
# x
# x
ladybug = Ladybug_Ladybug()  # -> Vviiiiiiiiiizzz; plug-in component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
# Construction Date
# Tüik 6.1 - Households by constrcution year of the building
# 1981-2000: %43,5
# 1980 and before: %23,4
# 2001 and after: %21,8
# Unknown: %11,3
# -------------
# SO AFTER ROUND UP
# before 2000: %80
# 2001 and after:  %20
# construction: construction layers
# - according to construction date
# -- before 80s / 80-00 / after 00
honeybee = Honeybee_Honeybee()  # -> Vviiiiiiiiiizzz; plug-in component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
# Retail, commercial building function determination
# FOR EACH
# building
# 
# How to do?
# Room, unit, elevator area division, M.L.
# 
# resource:endeksa
# 2:bedroom, living room
# 3:bedroom, living room, service (non-conditioning)
# 4:bedroom (x2), living room, service (non-conditioning)
# 3.1 - UNIT DIVISION
panel_230 = Panel(honeybee)

data_64 = Data(panel_122)

# ----
# 5 people
# Family with Kids
merge_38 = Merge(Data1=dup_19, Data2=dup_16, Data3=dup_20, Data4=dup_15, Data5=dup_17, Data6=dup_18)
percentage_family_with_kids_2 = Panel("7.6")
jitter_18 = Jitter(List=merge_38, Jitter=1, Seed=data_64)  # -> Values, Indices
lng_45 = ListLength(List=jitter_18.Values)
pcent_45 = Percentage(Number=lng_45, Percent=percentage_family_with_kids_2)
series_26 = Series(Start=0, Step=1, Count=pcent_45)
item_38 = ListItem(List=jitter_18.Values, Index=series_26, Wrap=True)

data_65 = Data(panel_122)

# ----
# Family with Kids and Elderly
merge_39 = Merge(Data1=dup_26, Data2=dup_22, Data3=dup_25, Data4=dup_24, Data5=dup_23, Data6=dup_21)
jitter_19 = Jitter(List=merge_39, Jitter=1, Seed=data_65)  # -> Values, Indices
percentage_2 = Panel("3.1")
lng_46 = ListLength(List=jitter_19.Values)
pcent_46 = Percentage(Number=lng_46, Percent=percentage_2)
series_27 = Series(Start=0, Step=1, Count=pcent_46)
item_39 = ListItem(List=jitter_19.Values, Index=series_27, Wrap=True)

data_66 = Data(panel_122)

# ----
# Family no Family
merge_40 = Merge(Data1=dup_12, Data2=dup_11, Data3=dup_9, Data4=dup_14, Data5=dup_13, Data6=dup_10)
percentage_no_family_2 = Panel("0.1")
jitter_20 = Jitter(List=merge_40, Jitter=1, Seed=data_66)  # -> Values, Indices
lng_47 = ListLength(List=jitter_20.Values)
pcent_47 = Percentage(Number=lng_47, Percent=_2_people_percentage_2)
series_28 = Series(Start=0, Step=1, Count=pcent_47)
item_40 = ListItem(List=jitter_20.Values, Index=series_28, Wrap=True)

# ----
# # of Units of
# the building
data_67 = Data(item_21)

# ----
# organized 4edged building PARCELS
geo_41 = Geometry(flatten(cull_i_17))

data_68 = Data(panel_122)

merge_41 = Merge(Data1=item_38, Data2=item_40, Data3=item_39)
jitter_21 = Jitter(List=merge_41, Jitter=1, Seed=data_68)  # -> Values, Indices

data_69 = Data(panel_122)

# ----
# 6 people
# Family with Kids
merge_42 = Merge(Data1=dup_19, Data2=dup_16, Data3=dup_20, Data4=dup_15, Data5=dup_17, Data6=dup_18)
percentage_family_with_kids_3 = Panel("2.5")
jitter_22 = Jitter(List=merge_42, Jitter=1, Seed=data_69)  # -> Values, Indices
lng_48 = ListLength(List=jitter_22.Values)
pcent_48 = Percentage(Number=lng_48, Percent=percentage_family_with_kids_3)
series_29 = Series(Start=0, Step=1, Count=pcent_48)
item_41 = ListItem(List=jitter_22.Values, Index=series_29, Wrap=True)

data_70 = Data(panel_122)

# ----
# Family with Kids and Elderly
merge_43 = Merge(Data1=dup_26, Data2=dup_22, Data3=dup_25, Data4=dup_24, Data5=dup_23, Data6=dup_21)
jitter_23 = Jitter(List=merge_43, Jitter=1, Seed=data_70)  # -> Values, Indices
percentage_3 = Panel("2.5")
lng_49 = ListLength(List=jitter_23.Values)
pcent_49 = Percentage(Number=lng_49, Percent=percentage_3)
series_30 = Series(Start=0, Step=1, Count=pcent_49)
item_42 = ListItem(List=jitter_23.Values, Index=series_30, Wrap=True)

data_71 = Data(panel_122)

# ----
# Family no Family
merge_44 = Merge(Data1=dup_12, Data2=dup_11, Data3=dup_9, Data4=dup_14, Data5=dup_13, Data6=dup_10)
jitter_24 = Jitter(List=merge_44, Jitter=1, Seed=data_71)  # -> Values, Indices
lng_50 = ListLength(List=jitter_24.Values)
pcent_50 = Percentage(Number=lng_50, Percent=_2_people_percentage_2)
series_31 = Series(Start=0, Step=1, Count=pcent_50)
item_43 = ListItem(List=jitter_24.Values, Index=series_31, Wrap=True)

data_72 = Data(floor_height)

data_73 = Data(floor_height)

data_74 = Data(panel_122)
# OCCUPANCY SCHEDULES
panel_240 = Panel("seed")

merge_45 = Merge(Data1=item_41, Data2=item_43, Data3=item_42)
jitter_25 = Jitter(List=merge_45, Jitter=1, Seed=data_74)  # -> Values, Indices

data_75 = Data(panel_122)

# ----
# 7 people
# Family with Kids
merge_46 = Merge(Data1=dup_19, Data2=dup_16, Data3=dup_20, Data4=dup_15, Data5=dup_17, Data6=dup_18)
percentage_family_with_kids_4 = Panel("1.5")
jitter_26 = Jitter(List=merge_46, Jitter=1, Seed=data_75)  # -> Values, Indices
lng_51 = ListLength(List=jitter_26.Values)
pcent_51 = Percentage(Number=lng_51, Percent=percentage_family_with_kids_4)
series_32 = Series(Start=0, Step=1, Count=pcent_51)
item_44 = ListItem(List=jitter_26.Values, Index=series_32, Wrap=True)

data_76 = Data(panel_122)

# ----
# Family with Kids and Elderly
merge_47 = Merge(Data1=dup_26, Data2=dup_22, Data3=dup_25, Data4=dup_24, Data5=dup_23, Data6=dup_21)
jitter_27 = Jitter(List=merge_47, Jitter=1, Seed=data_76)  # -> Values, Indices
percentage_4 = Panel("3.9")
lng_52 = ListLength(List=jitter_27.Values)
pcent_52 = Percentage(Number=lng_52, Percent=percentage_4)
series_33 = Series(Start=0, Step=1, Count=pcent_52)
item_45 = ListItem(List=jitter_27.Values, Index=series_33, Wrap=True)

data_77 = Data(panel_122)

# ----
# Family no Family
merge_48 = Merge(Data1=dup_12, Data2=dup_11, Data3=dup_9, Data4=dup_14, Data5=dup_13, Data6=dup_10)
jitter_28 = Jitter(List=merge_48, Jitter=1, Seed=data_77)  # -> Values, Indices
lng_53 = ListLength(List=jitter_28.Values)
pcent_53 = Percentage(Number=lng_53, Percent=_2_people_percentage_2)
series_34 = Series(Start=0, Step=1, Count=pcent_53)
item_46 = ListItem(List=jitter_28.Values, Index=series_34, Wrap=True)

data_78 = Data(panel_122)

merge_49 = Merge(Data1=item_44, Data2=item_46, Data3=item_45)
jitter_29 = Jitter(List=merge_49, Jitter=1, Seed=data_78)  # -> Values, Indices

data_79 = Data(floor_height)

# ----
# non-organized ALL building parcels four-edge (non-residential builidngs included)
geo_42 = Geometry(flatten(item_12))

panel_246 = Panel("Radius")
data_80 = Data(_40)

bldgprograms = Honeybee_bldgPrograms({"Office": 0, "Retail": 1, "MidriseApartment": 2, "PrimarySchool": 3, "SecondarySchool": 4, "SmallHotel": 5, "LargeHotel": 6, "Hospital": 7, "Outpatient": 8, "Warehouse": 9, "SuperMarket": 10, "FullServiceRestaurant": 11, "QuickServiceRestaurant": 12}, selected="MidriseApartment")
listzoneprograms = Honeybee_ListZonePrograms(bldgProgram=bldgprograms)  # -> MidriseApartmentZonePrograms; plug-in component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
item_47 = ListItem(List=listzoneprograms, Index="1", Wrap=True)

bldgprograms_2 = Honeybee_bldgPrograms({"Office": 0, "Retail": 1, "MidriseApartment": 2, "PrimarySchool": 3, "SecondarySchool": 4, "SmallHotel": 5, "LargeHotel": 6, "Hospital": 7, "Outpatient": 8, "Warehouse": 9, "SuperMarket": 10, "FullServiceRestaurant": 11, "QuickServiceRestaurant": 12}, selected="MidriseApartment")
listzoneprograms_2 = Honeybee_ListZonePrograms(bldgProgram=bldgprograms_2)  # -> MidriseApartmentZonePrograms; plug-in component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
item_48 = ListItem(List=listzoneprograms_2, Index=0, Wrap=True)

data_81 = Data(floor_height)

bldgprograms_3 = Honeybee_bldgPrograms({"Office": 0, "Retail": 1, "MidriseApartment": 2, "PrimarySchool": 3, "SecondarySchool": 4, "SmallHotel": 5, "LargeHotel": 6, "Hospital": 7, "Outpatient": 8, "Warehouse": 9, "SuperMarket": 10, "FullServiceRestaurant": 11, "QuickServiceRestaurant": 12}, selected="MidriseApartment")
listzoneprograms_3 = Honeybee_ListZonePrograms(bldgProgram=bldgprograms_3)  # -> MidriseApartmentZonePrograms; plug-in component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
item_49 = ListItem(List=listzoneprograms_3, Index=2, Wrap=True)

data_82 = Data(floor_height)

data_83 = Data(floor_height)

# ----
# simplified &
# ordered
# parcels (non-residentail buildings included)
# Adiabatic Surface Extraction from Intersected Buildings
geo_43 = Geometry(flatten(item_12))

data_84 = Data(floor_height)
# Intersected Building:
# Unconditioned
panel_250 = Panel("floor height")

# ----
# V1, V2: TS-825
# Window Parameters
singlepanebase = Panel("0.9")
singlepanebase_2 = Panel("0.75")
base = Panel("2.4")

data_85 = Data(weave)

# ----
# AS-IS V1
# WWR
panel_252 = Panel("0.2")
glzparamlist = Honeybee_GlazingParametersList(northGlzParam=panel_252, westGlzParam=panel_252, southGlzParam=panel_252, eastGlzParam=panel_252)  # -> glzParamList; plug-in component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

getepschedules = Honeybee_GetEnergyPlusSchedules(zoneProgram=item_48)  # -> occupancySchedule, occupancyActivitySch, heatingSetPtSchedule, coolingSetPtSchedule, lightingSchedule, equipmentSchedule, infiltrationSchedule; disabled; plug-in component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
# AS-IS V1/V2/V3
# LIGHTING
# SCHEDULE
convertepschvalues = Honeybee_ConvertEnergyPlusScheduleToValues(schName=getepschedules.occupancySchedule)  # -> values, holidays; disabled; plug-in component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
# https://drive.google.com/drive/u/1/folders/18A2Se-Wr7nzwbHcDhlTYeW92EyIVbHKy
strnum = Ladybug_SeparateData(inputList=flatten(convertepschvalues.values))  # -> numbers, strings; disabled; plug-in component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

# ----
# HVAC
# AS-IS V3
heatingsetpoint = Panel("""21.54
21.94
19.66
23.80
20.04
21.08
22.55
20.64
20.84
21.00
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""")

panel_253 = Panel("""heatingSetPoint
GeneratedData""")
data_86 = Data(heatingsetpoint)

# ----
# x
# x
# x
# x
# x
# x
# x
# x
# x
# x
# x
# x
# x
# x
# x
# x
# x
# x
# x
# x
# x
# x
# x
# x
# x
# x
# x
# 
# x
# x
# x
# x
# x
# x
# 
# x
# x
# x
# x
# x
# 
# x
# x
# x
# x
# x
# x
# 
# x
# x
# x
# x
# Domain
# Boundaries
panel_254 = Panel("55")
dom = ConstructDomain(DomainStart="74", DomainEnd="200")
dom_2 = ConstructDomain(DomainStart="90", DomainEnd="230")
dom_3 = ConstructDomain(DomainStart="135", DomainEnd="385")
dom_4 = ConstructDomain(DomainStart="200", DomainEnd="350")
# 06.CONDITIONING
# FORENERGYMODELING
dom_5 = ConstructDomain(DomainStart=panel_254, DomainEnd="85")
merge_50 = Merge(Data1=dom_5, Data2=dom, Data3=dom_2, Data4=dom_3, Data5=dom_4)  # -> simplify(Result)
panel_255 = Panel("hepsiemlak.com")

# ----
# Average
# Boundaries
panel_256 = Panel("""64.00
96.67
128.40
199.64
234.86""")

# ----
# binary transformation for occupied hours
python_16 = GhPythonScript(x=strnum.numbers)  # -> out, a; disabled
# ---------- python_16: Python ----------
__author__ = "Siser"
__version__ = "2022.03.16"

import rhinoscriptsyntax as rs
if x >0:
    a = 1
else:
    a = 0
# ---------- end python_16 ----------

callfromepschlibrary = Honeybee_CallFromEPScheduleLibrary(keywords="apart")  # -> scheduleTypeLimits, scheduleList; plug-in component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
panel_257 = Panel("usethisforLaptop")
item_50 = ListItem(List=callfromepschlibrary.scheduleList, Index="16", Wrap=True)

# ----
# 4+1
merge_51 = Merge(Data1=jitter_13.Values, Data2=jitter_17.Values, Data3=jitter_21.Values, Data4=jitter_25.Values, Data5=jitter_29.Values)
jitter_30 = Jitter(List=merge_51, Jitter=1, Seed=2)  # -> flatten(Values), Indices

# ----
# 3+1
merge_52 = Merge(Data1=jitter_9.Values, Data2=jitter_13.Values, Data3=jitter_17.Values, Data4=jitter_21.Values)
jitter_31 = Jitter(List=merge_52, Jitter=1, Seed=2)  # -> flatten(Values), Indices

# ----
# 5+1
merge_53 = Merge(Data1=jitter_17.Values, Data2=jitter_21.Values, Data3=jitter_25.Values, Data4=jitter_29.Values)
jitter_32 = Jitter(List=merge_53, Jitter=1, Seed=2)  # -> flatten(Values), Indices

# ----
# 2+1
merge_54 = Merge(Data1=jitter_6.Values, Data2=jitter_9.Values, Data3=jitter_13.Values)
jitter_33 = Jitter(List=merge_54, Jitter=1, Seed=2)  # -> flatten(Values), Indices

# ----
# 1+1
merge_55 = Merge(Data1=jitter_6.Values, Data2=merge_27)
jitter_34 = Jitter(List=merge_55, Jitter=1, Seed=2)  # -> flatten(Values), Indices

# ----
# COOLING-ON OFFICE
lb_schedule = GenePool(
    Decimals=0,
    Maximum=100.001,
    Minimum=100,
    Value=[100, 100, 100, 100, 100, 100, 100, 100.001, 100.001, 100.001, 100.001, 100.001, 100.001, 100.001, 100.001, 100.001, 100.001, 100.001, 100.001, 100, 100, 100, 100, 100])
lb_schedule_2 = GenePool(
    Decimals=0,
    Maximum=100,
    Minimum=24,
    Value=[100, 100, 100, 100, 100, 100, 100, 100, 24, 24, 24, 24, 24, 24, 24, 24, 24, 24, 24, 24, 100, 100, 100, 100])
toggle_4 = BooleanToggle(True)
annualschedule_22 = Honeybee_AnnualSchedule(
    sun=lb_schedule,
    mon=lb_schedule_2,
    tue=lb_schedule_2,
    wed=lb_schedule_2,
    thu=lb_schedule_2,
    fri=lb_schedule_2,
    sat=lb_schedule_2,
    scheduleName="OFFICE-COOLING-OFF-SCHEDULE",
    schedTypeLimits="Temperature",
    runIt=toggle_4)  # -> readMe, port, schedule, port_2, weekSched, schedIDFText; plug-in component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
annualschedule_23 = Honeybee_AnnualSchedule(
    sun=lb_schedule,
    mon=lb_schedule,
    tue=lb_schedule,
    wed=lb_schedule,
    thu=lb_schedule,
    fri=lb_schedule,
    sat=lb_schedule,
    scheduleName="OFFICE-COOLING-ON-SCHEDULE",
    schedTypeLimits="Temperature",
    runIt=toggle_4)  # -> readMe, port, schedule, port_2, weekSched, schedIDFText; plug-in component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
analysisperiod = Ladybug_AnalysisPeriod(fromMonth="4", fromDay="15", toMonth="10", toDay="15")  # -> readMe, analysisPeriod; plug-in component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
honeybee_seasonalschedule = Honeybee_SeasonalSchedule(
    scheduleName="OFFICE_COOLING_SCHEDULE-ANNUAL",
    schedTypeLimits="Temperature",
    baseWeekSched=annualschedule_23.weekSched,
    seasonWeekSched1=annualschedule_22.weekSched,
    analysisPeriod1=analysisperiod.analysisPeriod)  # -> readMe, schedule, schedIDFText; plug-in component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

# ----
# COOLING-OFF
# RESIDENTIAL
panel_258 = Panel("COOLING_OFF")
lb_schedule_3 = GenePool(
    Decimals=1,
    Maximum=100,
    Minimum=25,
    Value=[100, 100, 100, 100, 100, 100, 100, 100, 100, 100, 100, 100, 100, 100, 100, 100, 100, 100, 100, 100, 100, 100, 100, 100])
annualschedule_24 = Honeybee_AnnualSchedule(
    sun=lb_schedule_3,
    mon=lb_schedule_3,
    tue=lb_schedule_3,
    wed=lb_schedule_3,
    thu=lb_schedule_3,
    fri=lb_schedule_3,
    sat=lb_schedule_3,
    scheduleName=panel_258,
    schedTypeLimits="Temperature",
    runIt=Toggle(True))  # -> readMe, port, schedule, port_2, weekSched, schedIDFText; plug-in component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

panel_259 = Panel("references")

# ----
# heating Office
panel_260 = Panel("21")
dup_27 = DuplicateData(Data=panel_260, Number="19", Order=True)
dup_28 = DuplicateData(Data="18", Number="5", Order=True)
merge_56 = Merge(Data1=dup_28, Data2=dup_27)
annualschedule_25 = Honeybee_AnnualSchedule(
    sun=merge_56,
    mon=merge_56,
    tue=merge_56,
    wed=merge_56,
    thu=merge_56,
    fri=merge_56,
    sat=merge_56,
    scheduleName=simplify(graft("heatingOffice")),
    schedTypeLimits="Temperature",
    runIt=Toggle(True))  # -> readMe, port, schedule, port_2, simplify(weekSched), schedIDFText; plug-in component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

# ----
# if outdoor temperature hotter than the indoor temperature then close the natural ventilation
panel_261 = Panel("0")

# ----
# BepTr
heating_set_back = Panel("10")
# Conditioning  Temperatures
cooling_set_point_set_back = Panel("100")
heating_set_point = Panel("20")

# ----
# Estimating space heating determinants: An analysis of Greek households: More energy is needed for space heating as the household head becomes older [11,21]. Elderly prefer higher room temperatures and are home owners of rather old, noninsulated dwellings, reasons that contributed to higher per capita energy consumption for space heating [9]. The same holds true in case of Norwegian households, as older people not only prefer a relatively high indoor temperature but also stay at home more than younger ones due to sociological reasons [6,7].
# SCHEDULE_A(i.e., 0to4, 65+) demand warmer spaces than the others thus heating set point starts 2 degree lower. Set back value is the same for all schedules.
panel_264 = Panel("scheduleA")
panel_265 = Panel("SCHEDULE_A: 23, others: 21 ")

# ----
# ASHRAE
# Heating Set Point: distribution for set points:
# 21-23
heating_set_back_2 = Panel("10")
# ANKARA
cooling_set_point = Panel("25")
cooling_set_back = Panel("28")

# ----
# SET POINT SCHEDULES
# Aging population increases energy use: https://news.harvard.edu/gazette/story/2019/06/harvard-research-shows-energy-use-climbs-with-age-and-temperature/
heating_set_points = Panel("""23
21""")
heating_set_points_name = Panel("""A
others""")
cooling_set_points = Panel("""27
25""")

data_87 = Data(weave_9)

lng_54 = ListLength(List=merge_11)  # -> flatten(Length)

# ----
# %33 for all selection
# -before 80s
# -80-00
# -after 00s
infiltration_rate = Panel("""0.000285
0.0004
0.0005""")

# ----
# public and school buildings excluded list
data_88 = Data(python_11.a)

data_89 = Data("5")
data_90 = Data("1")
data_91 = Data("10")

# ----
# Heating Set Point: distribution for set points:
# 21-23
heating_set_back_3 = Panel("10")
cooling_set_point_set_back_2 = Panel("100")

heating_set_back_4 = Panel("10")
cooling_set_point_2 = Panel("25")

# ----
# Air Change Rate: Identification of the Retrofit Actions to Achieve Cost-Optimal and
# NZEB Levels for Residential Buildings in Istanbul Considering
# the Remaining Building Lifetime
boolean_toggle_2 = BooleanToggle(True)

data_92 = Data(item_48)
panel_269 = Panel(data_92)
geteploads = Honeybee_GetEnergyPlusLoads(zoneProgram=data_92)  # -> equipmentLoadPerArea, infilRatePerArea_Facade, lightingDensityPerArea, numOfPeoplePerArea, ventilationPerArea, ventilationPerPerson; plug-in component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

m3sm2 = Panel("0.0003")
panel_270 = Panel("IGD")

data_93 = Data(merge_45)
lng_55 = ListLength(List=data_93)
dup_29 = DuplicateData(Data="6", Number=lng_55, Order=True)

data_94 = Data(merge_41)
lng_56 = ListLength(List=data_94)
dup_30 = DuplicateData(Data="5", Number=lng_56, Order=True)

data_95 = Data(merge_49)
lng_57 = ListLength(List=data_95)
dup_31 = DuplicateData(Data="7", Number=lng_57, Order=True)

data_96 = Data(merge_32)
lng_58 = ListLength(List=data_96)
dup_32 = DuplicateData(Data="3", Number=lng_58, Order=True)

data_97 = Data(jitter_6.Values)
lng_59 = ListLength(List=data_97)
dup_33 = DuplicateData(Data="1", Number=lng_59, Order=True)

data_98 = Data(merge_37)
lng_60 = ListLength(List=data_98)
dup_34 = DuplicateData(Data="4", Number=lng_60, Order=True)

data_99 = Data(merge_27)
lng_61 = ListLength(List=data_99)
dup_35 = DuplicateData(Data="2", Number=lng_61, Order=True)

data_100 = Data(item_47)
panel_271 = Panel(data_100)
geteploads_2 = Honeybee_GetEnergyPlusLoads(zoneProgram=data_100)  # -> equipmentLoadPerArea, infilRatePerArea_Facade, lightingDensityPerArea, numOfPeoplePerArea, ventilationPerArea, ventilationPerPerson; plug-in component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

merge_57 = Merge(Data1=dup_34, Data2=dup_30, Data3=dup_29, Data4=dup_31)
jitter_35 = Jitter(List=merge_57, Jitter=1, Seed=2)  # -> flatten(Values), Indices

merge_58 = Merge(Data1=dup_35, Data2=dup_32, Data3=dup_34, Data4=dup_30)
jitter_36 = Jitter(List=merge_58, Jitter=1, Seed=2)  # -> flatten(Values), Indices

merge_59 = Merge(Data1=dup_32, Data2=dup_34, Data3=dup_30, Data4=dup_29, Data5=dup_31)
jitter_37 = Jitter(List=merge_59, Jitter=1, Seed=2)  # -> flatten(Values), Indices

merge_60 = Merge(Data1=dup_33, Data2=dup_35, Data3=dup_32)
jitter_38 = Jitter(List=merge_60, Jitter=1, Seed=2)  # -> flatten(Values), Indices

merge_61 = Merge(Data1=dup_33, Data2=dup_35)
jitter_39 = Jitter(List=merge_61, Jitter=1, Seed=2)  # -> flatten(Values), Indices

# ----
# AS-ISV1
panel_272 = Panel("0")

# ----
# AS-IS V1
# LIGHTING DENSITY
data_101 = Data(geteploads.lightingDensityPerArea)

ground_truth_from_municipality_construct = Panel("""1
0
1
1
1
1
1
1
1
1
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""")  # "GROUND TRUTH FROM MUNICIPALITY ConstructionType"
# x
# x
# x
# x
# x
# x
# x
# x
# x
# x
# x
# x
# x
# x
# x
# x
# x
# x
# x
# x
# x
# x
# x
# x
# x
# x
# x
# 
# x
# x
# x
# x
# x
# x
# 
# x
# x
# x
# x
# x
# 
# x
# x
# x
# x
# x
# x
# 
# x
# x
# x
# x
panel_273 = Panel("0=masonry, 1=concrete")

# ----
# ordered buildings list information
data_102 = Data(merge_11)
tstat_5 = TreeStatistics(Tree=data_102)  # -> Paths, Length, Count

# ----
# public and school buildings excluded list
data_103 = Data(python_11.a)

panel_274 = Panel("weather data")
path = FilePath("D:\KBEM\IP2.1\EPW\TUR_AN_Ankara.Central.171300_TMYx.2004-2018.epw")

panel_275 = Panel("weatherdata")  # disabled
data_104 = Data(path)  # disabled

importepw = Ladybug_ImportEpw(epwFile=data_104)  # -> readMe, latitude, location, dryBulbTemperature, dewPointTemperature, relativeHumidity, windSpeed, windDirection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; disabled; plug-in component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
strnum_2 = Ladybug_SeparateData(inputList=flatten(importepw.globalHorizontalIlluminance))  # -> numbers, strings; disabled; plug-in component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

panel_276 = Panel(strnum_2.numbers)  # disabled
panel_277 = Panel("reference")  # disabled

# ----
# close the lights during daylight hours
python_17 = GhPythonScript(x=strnum_2.numbers, y=python_16.a)  # -> out, a; disabled
# ---------- python_17: Python ----------
__author__ = "Siser"
__version__ = "2022.03.16"

import rhinoscriptsyntax as rs
if x <1000:
    a = 1
else:
    a = 0
# ---------- end python_17 ----------

# ----
# close when everyone sleeps
panel_278 = Panel("24")  # disabled
panel_279 = Panel("6")  # disabled
partition_33 = PartitionList(List=simplify(python_17.a), Size=panel_278)  # -> simplify(Chunks); disabled
series_35 = Series(Start=0, Step=1, Count=panel_279)  # disabled
panel_280 = Panel("0")  # disabled
replace_9 = ReplaceItems(List=partition_33, Item=panel_280, Indices=series_35, Wrap=False)  # -> simplify(List); disabled

# ----
# 1st
# 2nd
# 3rd
data_105 = Data(flatten(replace_9))  # disabled

panel_281 = Panel("binaryLightSchedule")  # disabled
toggle_5 = BooleanToggle(False)  # disabled
csvschedule = Honeybee_CreateCSVSchedule(values=data_105, scheduleName=panel_281, writeFile=toggle_5)  # -> readMe, csvSchedule; disabled; plug-in component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
panel_282 = Panel("usethisforDesktop")  # disabled

# ----
# Working Direction
panel_283 = Panel("D:\KBEM\IP2.1\resV3")

number_slider_2 = Slider(0, range=0..2)

panel_284 = Panel("Simulation")

button = Button()
panel_285 = Panel("Reset CSV Recorders")
python_18 = PythonScript(Toggle=button)
# ---------- python_18: Python ----------
import Grasshopper as gh

if Toggle:
    
    # Get the Grasshopper document and objects
    ghDoc = ghenv.Component.OnPingDocument()
    ghObjects = ghDoc.Objects
    
    # Iterate the GH objects, check type and reset data recorders
    for obj in ghObjects:
        if type(obj) is gh.Kernel.Special.GH_DataRecorder:
            obj.DestroyRecordedData()
            obj.ExpireSolution(True)
# ---------- end python_18 ----------

panel_286 = Panel("Colibri")

# ----
# Selection
# Slider of
# Building
# there are 599 residential buildings
filename = Slider(20, range=0..592)

panel_287 = Panel("selected parcel- unitFunctions")
item_51 = ListItem(List=cull_i_5, Index=filename, Wrap=True)
branch_11 = TreeBranch(Tree=partition, Path=item_51, MaintainPaths=True)

item_52 = ListItem(List=cull_i_6, Index=filename, Wrap=True)
branch_12 = TreeBranch(Tree=partition_2, Path=item_52, MaintainPaths=True)

item_53 = ListItem(List=cull_i_7, Index=filename, Wrap=True)
branch_13 = TreeBranch(Tree=partition_3, Path=item_53, MaintainPaths=True)

panel_290 = Panel("selected parcel")
data_106 = Data(filename)

data_107 = Data(filename)

panel_292 = Panel("staircase")
branch_14 = TreeBranch(Tree=partition_32, Path=filename, MaintainPaths=True)

branch_15 = TreeBranch(Tree=partition_32, Path=filename, MaintainPaths=True)

# ----
# 0: residential non-cooling
# 5: residential with cooling
# 1: office unit
data_108 = Data(branch_12)

# ----
# Zone Program
panel_294 = Panel("1")
equals_16 = Equality(FirstNumber=data_108, SecondNumber=panel_294)  # -> Equality, Inequality
lng_62 = ListLength(List=data_108)
listdexs_6 = ListIndices(List=data_108)
dispatch_24 = Dispatch(List=listdexs_6, DispatchPattern=equals_16.Equality)  # -> ListA, ListB
# Naming for Simulated  Zones
dup_36 = DuplicateData(Data="0", Number=lng_62, Order=True)
replace_10 = ReplaceItems(List=dup_36, Item=item_48, Indices=dispatch_24.ListB, Wrap=False)
replace_11 = ReplaceItems(List=replace_10, Item=item_47, Indices=dispatch_24.ListA, Wrap=False)
panel_295 = Panel(replace_11)

panel_296 = Panel("Window shgc")
data_109 = Data(weave_3)
item_54 = ListItem(List=data_109, Index=filename, Wrap=True)

data_110 = Data(weave_6)
item_55 = ListItem(List=data_110, Index=filename, Wrap=True)

# ----
# V3: Generated
# Window Parameters
panel_298 = Panel("uWindow")
data_111 = Data(weave_5)
item_56 = ListItem(List=data_111, Index=filename, Wrap=True)

# ----
# 05.HBZONE FORMATION
# FORENERGYMODELING
panel_299 = Panel("Building-based EKB")
panel_300 = Panel("Window U value")
item_57 = ListItem(List=data_85, Index=filename, Wrap=True)

# ----
# Generated
# WWR
glzparamlist_2 = Honeybee_GlazingParametersList(northGlzParam=item_57, westGlzParam=item_57, southGlzParam=item_57, eastGlzParam=item_57)  # -> glzParamList; plug-in component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

panel_301 = Panel("Window SHGC")
weave_23 = Weave(Pattern=number_slider_2, Stream0=singlepanebase_2, Stream1=singlepanebase_2, Stream2=item_54, NullGaps=False)

panel_302 = Panel("Window uValue")
weave_24 = Weave(Pattern=number_slider_2, Stream0=base, Stream1=base, Stream2=item_56, NullGaps=False)

weave_25 = Weave(Pattern=number_slider_2, Stream0=singlepanebase, Stream1=singlepanebase, Stream2=item_55, NullGaps=False)

weave_26 = Weave(Pattern=number_slider_2, Stream0=glzparamlist, Stream1=glzparamlist, Stream2=glzparamlist_2, NullGaps=False)

merge_62 = Merge(Data1="Generated_WINDOW", Data2=weave_24, Data3=weave_23, Data4=weave_25)
join_11 = TextJoin(Text=merge_62, Join="_")

panel_305 = Panel("Window ConstName")
weave_27 = Weave(Pattern=number_slider_2, Stream0="TS-825_WINDOW", Stream1="TS-825_WINDOW", Stream2=join_11, NullGaps=False)

epwindowmat = Honeybee_EnergyPlusWindowMaterial(name="GLASSUBEM", U_Value=weave_24, SHGC=weave_23, VT=weave_25)  # -> EPMaterial; plug-in component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
epconstruction = Honeybee_EnergyPlusConstruction(name=weave_27, layer_1=epwindowmat)  # -> EPConstruction; plug-in component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

# ----
# 0: residential non-cooling
# 5: residential with cooling
# 1: office unit
data_112 = Data(branch_12)

# ----
# 0: residential non-cooling
# 1: residential with cooling
# 2: office unit
data_113 = Data(branch_12)

# ----
# 0: residential non-cooling
# 1: residential with cooling
# 2: office unit
data_114 = Data(branch_12)

# ----
# information of Selection
# Slider of Building
data_115 = Data(filename)

construct_domain = ConstructDomain(DomainStart="0", DomainEnd="20")
iteration_selection = IterationSelection(Domain=construct_domain)
iterator = ColibriIterator(fileName=filename, Selection=iteration_selection, RemoteFly=False, ignoreAllWarningMsg=False)  # -> FileName_, Value_N, IterationGenome

uniffuntion_nvi = Panel([branch_12, branch_11])

area_23 = Area(Geometry=sort.ValuesA)  # -> Area, Centroid
tag_of_block = Panel("neighborhoodName2digits_parcelNumber_buildingNumber")
sorted_points_2 = Point(area_23.Centroid)
lng_63 = ListLength(List=sorted_points_2)
series_36 = Series(Start="0", Step=1, Count=lng_63)
int = Integer(series_36)
preview_20 = CustomPreview(Geometry=geo_15, Material=ColourSwatch(SwatchColor=RGB(0, 123, 255)))
tag_2 = TextTag3D(Location=sorted_points_2, Text=int, Size="15", Colour=ColourSwatch(SwatchColor=RGB(255, 0, 0)), Justification=7)

panel_306 = Panel("parcel_block order")
data_116 = Data(flatten(partition_7))

lng_64 = ListLength(List=merge_11)  # -> flatten(Length)

# ----
# public and school buildings excluded list
data_117 = Data(python_11.a)

# ----
# Indexing
partition_34 = PartitionList(List=data_116, Size=lng_64)  # -> simplify(Chunks)
cull_i_23 = CullIndex(List=partition_34, Indices=data_117, Wrap=True)  # -> simplify(flatten(List))
panel_308 = Panel(cull_i_23)

panel_309 = Panel("""parcel_block
of simulated parcel""")
item_58 = ListItem(List=cull_i_23, Index=filename, Wrap=True)

# ----
# tag order
# for parcels
swatch_6 = ColourSwatch(SwatchColor=RGB(8, 0, 255))
tag_3 = TextTag3D(Location=partition_6, Text=partition_7, Size="3", Colour=swatch_6, Justification=7)

data_118 = Data(weave_2)
panel_310 = Panel("U-roof")

item_59 = ListItem(List=data_118, Index=filename, Wrap=True)
panel_311 = Panel("Insulation U value")

panel_312 = Panel("uValue Input")
data_119 = Data(item_59)

# ----
# U-Factor no Film [W/m2-K]
panel_313 = Panel("https://unmethours.com/question/55666/what-is-the-basis-for-air-film-resistances-used-to-calculate-u-factor-with-film/")

panel_314 = Panel("U-wall")
data_120 = Data(weave_4)

item_60 = ListItem(List=data_120, Index=filename, Wrap=True)

data_121 = Data(item_60)

epopaquemat = Honeybee_EnergyPlusOpaqueMaterial(name="icSivaAlciEsasliInt", thickness="0.02", conductivity="0.51", density="1200", specificHeat="1090")  # -> EPMaterial; plug-in component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
epopaquemat_2 = Honeybee_EnergyPlusOpaqueMaterial(name="icSivaAlciEsasliInt", thickness="0.02", conductivity="0.51", density="1200", specificHeat="1090")  # -> EPMaterial; plug-in component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
epopaquemat_3 = Honeybee_EnergyPlusOpaqueMaterial(name="yatay delikli tugla", thickness="0.085", conductivity="0.33", density="600", specificHeat="900")  # -> EPMaterial; plug-in component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

data_122 = Data(weave_4)

item_61 = ListItem(List=data_122, Index=filename, Wrap=True)

data_123 = Data(item_61)

# ----
# Internal wall
epconstruction_2 = Honeybee_EnergyPlusConstruction(name="CC_Internal_wall", layer_1=epopaquemat, layer_2=epopaquemat_3, layer_3=epopaquemat_2)  # -> EPConstruction; plug-in component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

# ----
# Ground Floor
# U-Factor no Film [W/m2-K]
panel_320 = Panel("https://unmethours.com/question/55666/what-is-the-basis-for-air-film-resistances-used-to-calculate-u-factor-with-film/")

data_124 = Data(weave_2)

item_62 = ListItem(List=data_124, Index=filename, Wrap=True)

data_125 = Data(item_62)

# ----
# U-Factor no Film [W/m2-K]
panel_324 = Panel("https://unmethours.com/question/55666/what-is-the-basis-for-air-film-resistances-used-to-calculate-u-factor-with-film/")

data_126 = Data(ugroundfloor_2)
item_63 = ListItem(List=data_126, Index=filename, Wrap=True)

panel_325 = Panel("U-GroundFloor")
data_127 = Data(item_63)

item_64 = ListItem(List=data_127, Index=filename, Wrap=True)

data_128 = Data(item_64)

geo_44 = Geometry(flatten(item_12))

# ----
# index of selected parcel
# 08.OUTPUT MANAGEMENT
data_129 = Data(filename)

data_130 = Data(_40)

panel_330 = Panel("parcel_block")
data_131 = Data(cull_i_23)
item_65 = ListItem(List=data_131, Index=filename, Wrap=True)

floor_height_2 = Panel("3")
data_132 = Data(floor_height)

panel_331 = Panel("SORTED BLOCK BOUNDARIES")
sorted_parcels_2 = Geometry(sort.ValuesA)

data_133 = Data(weave_13)

data_134 = Data(floor_height)

data_135 = Data(floor_height)

geo_45 = Geometry(geo_44)

panel_334 = Panel("""3332
3332
3332
3332
3233
3233
3233
3233
3223
3223
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""")  # disabled
chars = Characters(Text=panel_334)  # -> simplify(Result), Unicode; disabled
panel_335 = Panel(chars.Result)  # disabled
item_66 = ListItem(List=panel_335, Index=1, Wrap=True)  # -> flatten(Item); disabled
item_67 = ListItem(List=panel_335, Index=1, Wrap=True)  # -> flatten(Item); disabled
item_68 = ListItem(List=panel_335, Index=0, Wrap=True)  # -> flatten(Item); disabled
item_69 = ListItem(List=panel_335, Index=2, Wrap=True)  # -> flatten(Item); disabled
panel_336 = Panel(item_68)  # disabled
panel_337 = Panel(item_66)  # disabled
panel_338 = Panel(item_69)  # disabled
panel_339 = Panel(item_67)  # disabled

# ----
# 2nd week - Coldest Week
panel_340 = Panel("13")  # disabled
panel_341 = Panel("1")  # disabled
panel_342 = Panel("7")  # disabled
analysisperiod_2 = Ladybug_AnalysisPeriod(fromMonth=panel_341, fromDay=panel_342, toMonth=panel_341, toDay=panel_340)  # -> readMe, analysisPeriod; disabled; plug-in component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
panel_343 = Panel(analysisperiod_2.analysisPeriod)  # disabled

# ----
# 15th week - Spring
panel_344 = Panel("14")  # disabled
panel_345 = Panel("4")  # disabled
panel_346 = Panel("8")  # disabled
analysisperiod_3 = Ladybug_AnalysisPeriod(fromMonth=panel_345, fromDay=panel_346, toMonth=panel_345, toDay=panel_344)  # -> readMe, analysisPeriod; disabled; plug-in component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
panel_347 = Panel(analysisperiod_3.analysisPeriod)  # disabled

data_136 = Data(floor_height)

# ----
# if context do not exist
panel_348 = Panel("0")
dup_37 = DuplicateData(Data=panel_348, Number="4", Order=True)

getepschedules_2 = Honeybee_GetEnergyPlusSchedules()  # -> occupancySchedule, occupancyActivitySch, heatingSetPtSchedule, coolingSetPtSchedule, lightingSchedule, equipmentSchedule, infiltrationSchedule; disabled; plug-in component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
decomposeepsch = Honeybee_DecomposeEnergyPlusSchedule(schName=getepschedules_2.occupancySchedule)  # -> name, schedule, comments; disabled; plug-in component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
convertepschvalues_2 = Honeybee_ConvertEnergyPlusScheduleToValues(schName=decomposeepsch.name)  # -> values, holidays; disabled; plug-in component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
strnum_3 = Ladybug_SeparateData(inputList=flatten(convertepschvalues_2.values))  # -> numbers, strings; disabled; plug-in component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
panel_349 = Panel("168")  # disabled
partition_35 = PartitionList(List=strnum_3.numbers, Size=panel_349)  # -> simplify(Chunks); disabled
# x
# x
# x
# x
# x
# x
# x
# x
# x
# x
# x
# x
# x
# x
# x
# x
# x
# x
# x
# x
# x
# x
# x
# x
# x
# 
# x
# x
# x
# x
# 
# x
# x
# x
# x
# x
# X
# x
# X
# X
# X
# X
# X
# 
# X
# X
# X
# X
# X
# X
# 
# X
# X
# X
# X
# X
# X
# 
# X
# X
# X
# X
# X
# X
# X
# X
# X
# 
# X
# X
# X
panel_350 = Panel("0")
branch_16 = TreeBranch(Tree=partition_35, Path=panel_350, MaintainPaths=True)  # disabled
graph = QuickGraph(branch_16, SortOrder=0)  # disabled
# Run Periods
# RunPeriod,
#   Autumn,                           !- Name
#   10,                                      !- Begin Month
#   21,                                      !- Begin Day of Month
#   10,                                     !- End Month
#   27,                                     !- End Day of Month
# Monday,
#   No,                                     !- Use Weather File Holidays and Special Days
#   No,                                     !- Use Weather File Daylight Saving Period
#   No,                                     !- Apply Weekend Holiday Rule
#   Yes,                                    !- Use Weather File Rain Indicators
#   Yes,                                    !- Use Weather File Snow Indicators
#   1;                                      !- Number of Times Runperiod to be Repeated
panel_351 = Panel(branch_16)  # disabled

panel_352 = Panel("if context exist")

# ----
# Window Directions
panel_353 = Panel("""2: no window
3: window""")

# ----
# 28th week - Hottest Week
panel_354 = Panel("14")  # disabled
panel_355 = Panel("7")  # disabled
panel_356 = Panel("8")  # disabled
analysisperiod_4 = Ladybug_AnalysisPeriod(fromMonth=panel_355, fromDay=panel_356, toMonth=panel_355, toDay=panel_354)  # -> readMe, analysisPeriod; disabled; plug-in component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
# Run Periods
# Run Periods
# RunPeriod,
#   Spring,                           !- Name
#   4,                                      !- Begin Month
#   8,                                      !- Begin Day of Month
#   4,                                     !- End Month
#   14,                                     !- End Day of Month
# Monday,
#   No,                                     !- Use Weather File Holidays and Special Days
#   No,                                     !- Use Weather File Daylight Saving Period
#   No,                                     !- Apply Weekend Holiday Rule
#   Yes,                                    !- Use Weather File Rain Indicators
#   Yes,                                    !- Use Weather File Snow Indicators
#   1;                                      !- Number of Times Runperiod to be Repeated
# RunPeriod,
#   Summer,                           !- Name
#   7,                                      !- Begin Month
#   8,                                      !- Begin Day of Month
#   7,                                     !- End Month
#   14,                                     !- End Day of Month
# Monday,
#   No,                                     !- Use Weather File Holidays and Special Days
#   No,                                     !- Use Weather File Daylight Saving Period
#   No,                                     !- Apply Weekend Holiday Rule
#   Yes,                                    !- Use Weather File Rain Indicators
#   Yes,                                    !- Use Weather File Snow Indicators
#   1;                                      !- Number of Times Runperiod to be Repeated
panel_357 = Panel(analysisperiod_4.analysisPeriod)  # disabled

# ----
# 43th week - Autumn
panel_358 = Panel("27")  # disabled
panel_359 = Panel("10")  # disabled
panel_360 = Panel("21")  # disabled
analysisperiod_5 = Ladybug_AnalysisPeriod(fromMonth=panel_359, fromDay=panel_360, toMonth=panel_359, toDay=panel_358)  # -> readMe, analysisPeriod; disabled; plug-in component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
panel_361 = Panel(analysisperiod_5.analysisPeriod)  # disabled

# ----
# formFactor of
# Simulated Units
reference = Panel("https://greenbuildingencyclopaedia.uk/encyclopaedia/files/calculators/equations/form-factor-equation/")

data_137 = Data(weave_26)

# ----
# if context do not exist
panel_363 = Panel("0")
dup_38 = DuplicateData(Data=panel_363, Number="4", Order=True)

# ----
# Width/Depth ratio of
# Simulated Units
panel_364 = Panel("""width: eastToWest
depth: northToSouth""")

# ----
# Optimized
# Simulation
# Output
# Zone,Average,Site Outdoor Air Drybulb Temperature
# 
# Output:Variable,*,Zone Ideal Loads Supply Air Total Cooling Energy, hourly;
toggle_6 = BooleanToggle(True)
panel_365 = Panel("Output:Variable,*,Site Outdoor Air Drybulb Temperature, hourly;")
panel_366 = Panel("""0
1
2
12
13
14
23
24
25
26
27
28
29
30
31
32""")
epoutput = Honeybee_GenerateEPOutput(
    zoneEnergyUse=toggle_6,
    zoneGainsAndLosses=toggle_6,
    zoneComfortMetrics=toggle_6,
    surfaceTempAnalysis="False",
    surfaceEnergyAnalysis=toggle_6,
    timestep="hourly")  # -> report, flatten(simulationOutputs); plug-in component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
item_70 = ListItem(List=epoutput.simulationOutputs, Index=panel_366, Wrap=True)
merge_63 = Merge(Data1=item_70, Data2=panel_365)  # -> flatten(Result)

# ----
# Energy Balance
toggle_7 = BooleanToggle(True)  # disabled
panel_368 = Panel("""0
1
2
10
12
13
14
23
24
25
26
27
28
29
30
31
32
35
36
37""")  # disabled
panel_369 = Panel("monthly")  # disabled
epoutput_2 = Honeybee_GenerateEPOutput(
    zoneEnergyUse=toggle_7,
    zoneGainsAndLosses=toggle_7,
    zoneComfortMetrics=toggle_7,
    surfaceTempAnalysis="False",
    surfaceEnergyAnalysis=toggle_7,
    timestep=panel_369)  # -> report, flatten(simulationOutputs); disabled; plug-in component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
item_71 = ListItem(List=epoutput_2.simulationOutputs, Index=panel_368, Wrap=True)  # disabled

simcontrol = Honeybee_SimulationControl(maxWarmupDays="150", minWarmupDays="6")  # -> simControls; plug-in component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
energysimpar = Honeybee_EnergySimulationPar(timestep=6, solarDistribution="4", startDayOfWeek="1", simulationControls=simcontrol, terrain="0")  # -> energySimPar; plug-in component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

# ----
# Function of Units
# (0:residential, 1: office)
data_138 = Data(branch_12)

# ----
# 08.AS-IS
# INPUT
# PARAMETERS
list_of_recordings = Panel("""(ID)
parcelUBEM
blockUBEM
---------
(UNIT)
verticalPosition
formFactor
totalWindowArea
windowcount
floorArea
z-axis
function
WWRDirectionUnitNorth
WWRDirectionUnitWest
WWRDirectionUnitSouth
WWRDirectionUnitEast
---------
(BUILDING)
uWall
#ofFloor
Infiltration
ObstacleDirectionNorth
ObstacleDirectionWest
ObstacleDirectionSouth
ObstacleDirectionEast""")

# ----
# UpperBounds
panel_370 = Panel("""key:location/dataType/units/frequency/startsAt/endsAt
Ankara Central_AN_TUR
Dry Bulb Temperature
C
Hourly
(1, 1, 1)
(12, 31, 24)""")
importepw_2 = Ladybug_ImportEpw(epwFile=path)  # -> readMe, latitude, location, dryBulbTemperature, dewPointTemperature, relativeHumidity, windSpeed, windDirection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; plug-in component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
dup_39 = DuplicateData(Data=Slider(6, range=0..10), Number=Slider(8760, range=0..10000), Order=True)
merge_64 = Merge(Data1=panel_370, Data2=dup_39)  # -> flatten(Result)
adaptcomfortpar = Ladybug_AdaptiveComfortParameters(ASHRAEorEN=Toggle(False), avgMonthOrRunMean=Toggle(False))  # -> comfortPar; plug-in component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
panel_371 = Panel("not important")
adaptivecomfortcalculator = Ladybug_AdaptiveComfortCalculator(
    dryBulbTemperature=merge_64,
    outdoorTemperature=importepw_2.dryBulbTemperature,
    windSpeed=importepw_2.windSpeed,
    comfortPar=adaptcomfortpar,
    runIt=Toggle(True))  # -> readMe, port, comfortableOrNot, conditionOfPerson, degreesFromTarget, port_2, targetTemperature, simplify(upperTemperatureBound)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; plug-in component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
strnum_4 = Ladybug_SeparateData(inputList=flatten(adaptivecomfortcalculator.upperTemperatureBound))  # -> numbers, strings; plug-in component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

# ----
# Select Occupied Hours
getepschedules_3 = Honeybee_GetEnergyPlusSchedules(zoneProgram=item_48)  # -> occupancySchedule, occupancyActivitySch, heatingSetPtSchedule, coolingSetPtSchedule, lightingSchedule, equipmentSchedule, infiltrationSchedule; plug-in component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
# IOD calculation only for occupied hours
convertepschvalues_3 = Honeybee_ConvertEnergyPlusScheduleToValues(schName=getepschedules_3.occupancySchedule)  # -> values, holidays; plug-in component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
strnum_5 = Ladybug_SeparateData(inputList=flatten(convertepschvalues_3.values))  # -> numbers, strings; plug-in component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
python_19 = GhPythonScript(x=strnum_5.numbers)  # -> out, a; same code as python_16
# INDOOR OVERHEATING DEGREES
panel_372 = Panel("1")
equals_17 = Equality(FirstNumber=python_19.a, SecondNumber=panel_372)  # -> Equality, Inequality

panel_373 = Panel("upperTemperatureBoundaries")
dispatch_25 = Dispatch(List=strnum_4.numbers, DispatchPattern=equals_17.Equality)  # -> ListA, ListB

panel_374 = Panel("#of Occupied Hours")
lng_65 = ListLength(List=dispatch_25.ListA)

panel_375 = Panel("cullOfficeUnits")
equals_18 = Equality(FirstNumber=data_138, SecondNumber="1")  # -> Equality, Inequality
dispatch_26 = Dispatch(DispatchPattern=equals_18.Equality)  # -> ListA, ListB

# ----
# U-value-Window of Building
decomposeepconstruction = Honeybee_DecomposeEPConstruction(cnstrName=weave_27)  # -> materials, comments, UValue_SI, UValue_IP, RValue_SI, RValue_IP; plug-in component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
lng_66 = ListLength(List=branch_12)
data_139 = Data(decomposeepconstruction.UValue_SI)
dup_40 = DuplicateData(Data=data_139, Number=lng_66, Order=True)

# ----
# # of parcels in the blocks
data_140 = Data(flatten(lng_22))

# ----
# public and school buildings excluded list
data_141 = Data(python_11.a)

equals_19 = Equality(FirstNumber=data_138, SecondNumber="1")  # -> Equality, Inequality
dispatch_27 = Dispatch(List=dup_40, DispatchPattern=equals_19.Equality)  # -> ListA, ListB

panel_377 = Panel("parcel_number")
data_142 = Data(weave_12)

panel_378 = Panel("block_number")
data_143 = Data(weave_15)

# ----
# office: # of people per sqm
data_144 = Data(geteploads_2.numOfPeoplePerArea)

# ----
# residential: # of people per sqm
data_145 = Data(geteploads.numOfPeoplePerArea)

data_146 = Data(branch_12)
# # of people per sqm
python_20 = GhPythonScript(x=data_146, y=data_145, z=data_144)  # -> out, a
# ---------- python_20: Python ----------
__author__ = "orcun"
__version__ = "2022.03.30"

import rhinoscriptsyntax as rs
if x == 1:
    a = z
else:
    a = y
# ---------- end python_20 ----------

equals_20 = Equality(FirstNumber=data_146, SecondNumber="1")  # -> Equality, Inequality
dispatch_28 = Dispatch(List=python_20.a, DispatchPattern=equals_20.Equality)  # -> ListA, ListB

panel_380 = Panel("shgcWindow")
data_147 = Data(weave_23)

# ----
# Heating set point of Offices
data_148 = Data(panel_260)

# ----
# UNIT FUNCTION: 0: residential non-cooling
# 5: residential with cooling
# 2: office unit
data_149 = Data(branch_12)

panel_381 = Panel("AllV2")
path_2 = FilePath("C:\KBEM\IP2.1\csv\AllV2.csv")

panel_382 = Panel("AllV1")
path_3 = FilePath("C:\KBEM\IP2.1\csv\AllV1.csv")

panel_383 = Panel("AllV3")
path_4 = FilePath("C:\KBEM\IP2.1\csv\AllV3.csv")

panel_384 = Panel("ParamsV3")
path_5 = FilePath("C:\KBEM\IP2.1\csv\ParamsV3.csv")

panel_385 = Panel("ParamsV2")
path_6 = FilePath("C:\KBEM\IP2.1\csv\ParamsV2.csv")

panel_386 = Panel("ParamsV1")
path_7 = FilePath("C:\KBEM\IP2.1\csv\ParamsV1.csv")

weave_28 = Weave(Pattern=number_slider_2, Stream0=path_3, Stream1=path_2, Stream2=path_4, NullGaps=False)

weave_29 = Weave(Pattern=number_slider_2, Stream0=path_7, Stream1=path_6, Stream2=path_5, NullGaps=False)

# ----
# Entering EKB Data
# for Concrete Wall
merge_65 = Merge(Data1=graft(parcelubem_2), Data2=graft(blockubem_2))
join_12 = TextJoin(Text=merge_65, Join="_")  # -> simplify(flatten(Result))
mindex_4 = MemberIndex(Set=join_12, Member=item_13)  # -> flatten(Index), Count

# ----
# public and school buildings excluded list
cull_i_24 = CullIndex(List=ekbuwallconcrete_2, Indices=mindex_4.Index, Wrap=True)

# ----
# public and school buildings excluded list
cull_i_25 = CullIndex(List=join_12, Indices=mindex_4.Index, Wrap=True)

mindex_5 = MemberIndex(Set=flatten(cull_i_8), Member=cull_i_25)  # -> flatten(Index), Count

# ----
# Masonry/Concrete Construction Division, EKB
# EKB Concrete Embedded List
# 1st
replace_12 = ReplaceItems(List=dup_3, Item=cull_i_24, Indices=mindex_5.Index, Wrap=False)

# ----
# Masonry
# Generated
# Random Masonry Construction Values
lng_67 = ListLength(List=flatten(cull_i_8))
merge_66 = Merge(Data1=mindex_5.Index, Data2=mindex_2.Index)
panel_387 = Panel("EKB Data")
series_37 = Series(Start=0, Step=1, Count=lng_67)
cull_i_26 = CullIndex(List=series_37, Indices=merge_66, Wrap=True)
lng_68 = ListLength(List=cull_i_26)
division_9 = Division(A=lng_68, B=panel_32)
round_30 = Round(Number=division_9)  # -> Nearest, Floor, Ceiling
series_38 = Series(Start=0, Step=1, Count=round_30.Floor)
jitter_40 = Jitter(List=cull_i_26, Jitter=1, Seed=2)  # -> Values, Indices
item_72 = ListItem(List=jitter_40.Values, Index=series_38, Wrap=True)
item_73 = ListItem(List=panel_14, Index=series_38, Wrap=True)

# ----
# EKB Masonry Wall Embedded List
# 2nd
data_150 = Data(item_15)
replace_13 = ReplaceItems(List=replace_12, Item=data_150, Indices=mindex_2.Index, Wrap=False)

# ----
# 3rd
# RANDOM Masonry Embedded List
data_151 = Data(item_73)
replace_14 = ReplaceItems(List=replace_13, Item=data_151, Indices=item_72, Wrap=False)

# ----
# Concrete
# Wall Random
cull_i_27 = CullIndex(List=jitter_40.Values, Indices=series_38, Wrap=True)
lng_69 = ListLength(List=cull_i_27)
series_39 = Series(Start=0, Step=1, Count=lng_69)
item_74 = ListItem(List=panel_12, Index=series_39, Wrap=True)

# ----
# RANDOM Concrete Wall Embedded List
# 4th
data_152 = Data(item_74)
replace_15 = ReplaceItems(List=replace_14, Item=data_152, Indices=cull_i_27, Wrap=False)  # -> simplify(List)

panel_388 = Panel(replace_15)

lng_70 = ListLength(List=cull_i_8)
dup_41 = DuplicateData(Data="1", Number=lng_70, Order=True)  # -> simplify(flatten(Data))
merge_67 = Merge(Data1=flatten(mindex_2.Index), Data2=flatten(item_72))
panel_389 = Panel("EKB Generated Data")
replace_16 = ReplaceItems(List=dup_41, Item="0", Indices=merge_67, Wrap=False)

panel_390 = Panel("0=masonry, 1=concrete")
panel_391 = Panel("ConstructionType")
data_153 = Data(replace_16)

# ----
# # of Floor of the building
toggle_8 = BooleanToggle(True)
partition_36 = PartitionList(List=data_36, Size=subtraction_2)  # -> simplify(Chunks)
clean_8 = CleanTree(RemoveNulls=True, RemoveInvalid=True, RemoveEmpty=toggle_8, Tree=partition_36)
lng_71 = ListLength(List=clean_8)  # -> flatten(Length)
partition_37 = PartitionList(List=flatten(clean_8), Size=lng_71)  # -> simplify(Chunks)

# ----
# DATA TREE: building floor info public and schoold buildings excluded
cull_i_28 = CullIndex(List=partition_37, Indices=clean_2, Wrap=True)  # -> simplify(List)

dispatch_29 = Dispatch(List=cull_i_28, DispatchPattern=data_44)  # -> ListA, ListB
weave_30 = Weave(Pattern=python_12.a, Stream0=dispatch_29.ListA, Stream1=dispatch_29.ListB, NullGaps=False)  # -> simplify(Weave)

# ----
# indices of
# selection ratio according to construction date
data_154 = Data(series_14)
item_75 = ListItem(List=simplify(weave_30), Index=simplify(data_154), Wrap=True)

panel_393 = Panel(item_75)
panel_394 = Panel(item_26)
panel_395 = Panel(item_21)

# ----
# 2D to 3D
data_155 = Data(flatten(item_75))
partition_38 = PartitionList(List=data_155, Size="1")  # -> simplify(Chunks)
Z_2 = UnitZ(Factor=data_62)
arrlinear = LinearArray(Geometry=merge_33, Direction=Z_2, Count=partition_38)  # -> Geometry, Transform
geo_46 = Geometry(arrlinear.Geometry)

# ----
# # of floor of
# the building
data_156 = Data(flatten(item_75))

item_76 = ListItem(List=data_67, Index=data_106, Wrap=True)
item_77 = ListItem(List=data_156, Index=data_106, Wrap=True)
division_10 = Division(A=item_76, B=item_77)
round_31 = Round(Number=division_10)  # -> Nearest, Floor, Ceiling
multiplication_4 = Multiplication(A=round_31.Floor, B=item_77)
subtraction_3 = Subtraction(A=item_76, B=multiplication_4)

panel_396 = Panel("# of floor")
panel_397 = Panel(item_77)

# ----
# # of Units of
# the building
panel_398 = Panel(item_76)

# ----
# Simulation Building Selection
item_78 = ListItem(List=geo_41, Index=filename, Wrap=True)
area_24 = Area(Geometry=geo_46)  # -> Area, Centroid
incurve_2 = PointInCurve(Point=area_24.Centroid, Curve=item_78)  # -> Relationship, Point
equals_21 = Equality(FirstNumber=incurve_2.Relationship, SecondNumber="2")  # -> Equality, Inequality
dispatch_30 = Dispatch(List=geo_46, DispatchPattern=equals_21.Equality)  # -> ListA, ListB

geo_47 = Geometry(flatten(partition_32))
area_25 = Area(Geometry=geo_47)  # -> Area, Centroid
panel_399 = Panel("simulated parcel CORE")
incurve_3 = PointInCurve(Point=area_25.Centroid, Curve=item_78)  # -> Relationship, Point
equals_22 = Equality(FirstNumber=incurve_3.Relationship, SecondNumber="2")  # -> Equality, Inequality
dispatch_31 = Dispatch(List=geo_47, DispatchPattern=equals_22.Equality)  # -> ListA, ListB

md_slider_4 = MDSlider(SliderMode=0, slider_value=Point(0.5, 0.5, 0.5), x_domain=Domain(0, 1), y_domain=Domain(0, 1), z_domain=Domain(0, 1))
evalsrf_2 = EvaluateSurface(Surface=dispatch_31.ListA, Point=md_slider_4)  # -> Point, Normal, UDirection, VDirection, Frame

# ----
# # of units per floor
# of the building
panel_400 = Panel(round_31.Floor)

# ----
# add additional units starting from ground:
# -> 1 unit per floor
panel_401 = Panel(subtraction_3)
panel_402 = Panel("EXTRA units")

# ----
# units of simulated parcel
# without EXTRA units (whether there are exist)
clean_9 = CleanTree(RemoveNulls=True, RemoveInvalid=True, RemoveEmpty=Toggle(True), Tree=dispatch_30.ListA)

panel_403 = Panel("additionalUnit")
data_157 = Data(subtraction_3)

# ----
# Floor-based path
# 
# -> each floor has own path
panel_404 = Panel("{")
dup_42 = DuplicateData(Data=panel_404, Number=item_77, Order=True)
dup_43 = DuplicateData(Data=data_106, Number=item_77, Order=True)
dup_44 = DuplicateData(Data=";", Number=item_77, Order=True)
dup_45 = DuplicateData(Data="}", Number=item_77, Order=True)
series_40 = Series(Start=0, Step=1, Count=item_77)
merge_68 = Merge(Data1=graft(dup_42), Data2=graft(dup_43), Data3=graft(dup_44), Data4=graft(series_40), Data5=graft(dup_45))  # -> simplify(Result)
join_13 = TextJoin(Text=merge_68)  # -> flatten(Result)
panel_405 = Panel(join_13)

# ----
# units of simulated parcel
# without additional units (whether there are exist)
geo_48 = Geometry(clean_9)

# ----
# IF,
# there are Extra Units
panel_406 = Panel(data_157)
equals_23 = Equality(FirstNumber=data_157, SecondNumber="0")  # -> Equality, Inequality
python_21 = GhPythonScript(x=equals_23.Equality, y=geo_48)  # -> out, BuildingwithExtraUnit, simplify(BuildingwithoutExtraUnit); inputs x: Boolean, y: list
# ---------- python_21: Python ----------
__author__ = "Siser"
__version__ = "2022.03.04"

import rhinoscriptsyntax as rs
if x == True:
    BuildingwithoutExtraUnit = y
else:
    BuildingwithExtraUnit = y
# ---------- end python_21 ----------

# ----
# units of simulated parcel
# without additional units (whether there are exist)
geo_49 = Geometry(flatten(geo_48))

# ----
# units of simulated parcel
# without additional units
geo_50 = Geometry(flatten(python_21.BuildingwithExtraUnit))

# ----
# units of simulated parcel
# without additional units
geo_51 = Geometry(flatten(python_21.BuildingwithExtraUnit))

# ----
# # of units per floor
# of the building
data_158 = Data(round_31.Floor)

# ----
# Extra Unit Addition to floors
# if there is no extra units, then a = 0
# else
# a=! 0, thus, the floor division changes
panel_407 = Panel("0")
equals_24 = Equality(FirstNumber=subtraction_3, SecondNumber=panel_407)  # -> Equality, Inequality
python_22 = GhPythonScript(x=equals_24.Equality)  # -> out, a; inputs x: Boolean
# ---------- python_22: Python ----------
__author__ = "Siser"
__version__ = "2022.03.04"

import rhinoscriptsyntax as rs
if x == True:
    a = 0
else:
    a = 1
# ---------- end python_22 ----------
# if x == 1:
#     a=1,1
# elif x ==2:
#     a=2,1
# elif x == 3 or x == 4:
#     a=2,2
# elif x==5 or x ==6:
#     a=3,2
# else:
#     a=4,2
addition_5 = Addition(A=data_158, B=python_22.a)

# ----
# floor division for units per floor
# 
# FOR
# SIMULATED PARCEL
python_23 = GhPythonScript(x=addition_5)  # -> out, simplify(a); inputs x: Int32; same code as python_15

# ----
# uv frame of simulated parcel
data_159 = Data(evalsrf_2.Frame)

# ----
# floors with extra units
series_41 = Series(Start=0, Step=1, Count=subtraction_3)
multiplication_5 = Multiplication(A=series_41, B=data_72)
area_26 = Area(Geometry=geo_51)  # -> Area, Centroid
pdecon_8 = Deconstruct(Point=area_26.Centroid)  # -> XComponent, YComponent, ZComponent
round_32 = Round(Number=pdecon_8.ZComponent)  # -> Nearest, Floor, Ceiling
equals_25 = Equality(FirstNumber=graft(multiplication_5), SecondNumber=round_32.Nearest)  # -> Equality, Inequality
dispatch_32 = Dispatch(List=geo_49, DispatchPattern=equals_25.Equality)  # -> ListA, simplify(ListB)
brec_3 = BoundingRectangle(Geometry=dispatch_32.ListA, Plane=data_159, Axis=0, Slide=0, Union=True)  # -> simplify(Bounding), DimensionX, DimensionY

# ----
# floors without extra units
series_42 = Series(Start=0, Step=1, Count=item_77)
cull_i_29 = CullIndex(List=series_42, Indices=series_41, Wrap=True)
multiplication_6 = Multiplication(A=cull_i_29, B=data_73)
area_27 = Area(Geometry=geo_50)  # -> Area, Centroid
pdecon_9 = Deconstruct(Point=area_27.Centroid)  # -> XComponent, YComponent, ZComponent
round_33 = Round(Number=pdecon_9.ZComponent)  # -> Nearest, Floor, Ceiling
equals_26 = Equality(FirstNumber=graft(multiplication_6), SecondNumber=round_33.Nearest)  # -> Equality, Inequality
dispatch_33 = Dispatch(List=geo_49, DispatchPattern=equals_26.Equality)  # -> simplify(ListA), simplify(ListB)

panel_408 = Panel("non-additional units")
geo_52 = Geometry(simplify(dispatch_33.ListA))

# ----
# cull paths of the additional units
data_160 = Data(series_41)

# ----
# New list path for
# floors without extra units
cull_i_30 = CullIndex(List=join_13, Indices=data_160, Wrap=True)
tstat_6 = TreeStatistics(Tree=geo_52)  # -> Paths, Length, Count
replace_17 = ReplacePaths(Data=geo_52, Search=tstat_6.Paths, Replace=cull_i_30)

# ----
# # of units per floor
# of the building
data_161 = Data(round_31.Floor)

# ----
# check whether
# 
# isotrim division number
# 
# is equal to
# 
# # of units per floor
panel_409 = Panel("1")
addition_6 = Addition(A=data_161, B=panel_409)
ma_4 = MassMultiplication(Input=python_23.a)  # -> Result, PartialResults
equals_27 = Equality(FirstNumber=addition_6, SecondNumber=ma_4.Result)  # -> Equality, Inequality
python_24 = GhPythonScript(x=equals_27.Equality)  # -> out, a; inputs x: Boolean; same code as python_22

# ----
# # of Units
# Per Floor with additional units
panel_410 = Panel(addition_6)

# ----
# no additional units
# for the building
geo_53 = Geometry(flatten(python_21.BuildingwithoutExtraUnit))

# ----
# # of units for floor(s) with extra units
weave_31 = Weave(Pattern=python_24.a, Stream0=flatten(ma_4.Result), Stream1=flatten(addition_6), NullGaps=False)

series_43 = Series(Start=0, Step=1, Count=subtraction_3)
item_79 = ListItem(List=join_13, Index=series_43, Wrap=True)

# ----
# # of units per floor
# of the building
data_162 = Data(round_31.Floor)

panel_411 = Panel("Floor-based Path")
data_163 = Data(join_13)

# ----
# BuildingwithoutExtraUnit
area_28 = Area(Geometry=geo_53)  # -> Area, flatten(Centroid)
pdecon_10 = Deconstruct(Point=area_28.Centroid)  # -> XComponent, YComponent, ZComponent
sort_10 = SortList(Keys=pdecon_10.ZComponent, ValuesA=flatten(geo_53))  # -> Keys, ValuesA
partition_39 = PartitionList(List=sort_10.ValuesA, Size=data_162)
tstat_7 = TreeStatistics(Tree=partition_39)  # -> Paths, Length, Count
replace_18 = ReplacePaths(Data=partition_39, Search=tstat_7.Paths, Replace=data_163)

# ----
# Building without
# Extra Units
data_164 = Data(replace_18)

# ----
# Simulated Parcel Bounding Box
geo_54 = Geometry(item_78)

area_29 = Area(Geometry=geo_54)  # -> Area, Centroid

# ----
# uv frame of simulated parcel
data_165 = Data(evalsrf_2.Frame)

# ----
# floor division for units per floor
# 
# FOR
# SIMULATED PARCEL
data_166 = Data(python_23.a)

# ----
# # of floor of
# the building
data_167 = Data(flatten(item_75))

lng_72 = ListLength(List=join_13)

# ----
# new path (after extra unit)
data_168 = Data(join_13)

# ----
# Simulated Parcel Bounding Box
geo_55 = Geometry(item_78)

area_30 = Area(Geometry=geo_55)  # -> Area, Centroid
circle = CircleCNR(Center=area_30.Centroid, Normal=Vector(0, 0, 1), Radius=data_80)
area_31 = Area(Geometry=geo_42)  # -> Area, Centroid
incurve_4 = PointInCurve(Point=area_31.Centroid, Curve=circle)  # -> Relationship, Point
equals_28 = Equality(FirstNumber=incurve_4.Relationship, SecondNumber="2")  # -> Equality, Inequality

panel_413 = Panel("ground floor index")
item_80 = ListItem(List=join_13, Index=0, Wrap=True)

# ----
# rectangle do not accpeted by collision component
dispatch_34 = Dispatch(List=geo_42, DispatchPattern=equals_28.Equality)  # -> ListA, ListB
debrep_5 = DeconstructBrep(Brep=dispatch_34.ListA)  # -> Faces, Edges, simplify(Vertices)
pline_2 = PolyLine(Vertices=debrep_5.Vertices, Closed=Toggle(True))  # -> flatten(Polyline)

# ----
# rectangle do not accpeted by collision component
debrep_6 = DeconstructBrep(Brep=geo_55)  # -> Faces, Edges, Vertices
pline_3 = PolyLine(Vertices=debrep_6.Vertices, Closed=Toggle(True))

# ----
# Intersected Parcels
# replace simulation unit
# because not ALL building be transformed with BOUNDING BOX component (e.g., parcel 579)
area_32 = Area(Geometry=geo_55)  # -> Area, Centroid
area_33 = Area(Geometry=pline_2)  # -> Area, Centroid
cp = ClosestPoint(Point=area_32.Centroid, Cloud=area_33.Centroid)  # -> ClosestPoint, CPIndex, Distance
replace_19 = ReplaceItems(List=pline_2, Item=pline_3, Indices=cp.CPIndex, Wrap=False)

# ----
# close parcels to the simulation building
geo_56 = Geometry(replace_19)

# ----
# Simulated Parcel Bounding Box
geo_57 = Geometry(item_78)

area_34 = Area(Geometry=geo_56)  # -> Area, Centroid
area_35 = Area(Geometry=geo_57)  # -> Area, Centroid
panel_414 = Panel("exclude simulation building")
cp_2 = ClosestPoint(Point=area_35.Centroid, Cloud=area_34.Centroid)  # -> ClosestPoint, CPIndex, Distance
cull_i_31 = CullIndex(List=geo_56, Indices=cp_2.CPIndex, Wrap=True)

area_36 = Area(Geometry=geo_57)  # -> Area, Centroid
scale_3 = Scale(Geometry=geo_57, Center=area_36.Centroid, Factor="1.25")  # -> Geometry, Transform

panel_415 = Panel("floor number")
item_81 = ListItem(List=flatten(item_75), Index=filename, Wrap=True)

# ----
# test check for close parcels intersection possibility
pop2d = Populate2D(Region=cull_i_31, Count=100, Seed=1)  # -> simplify(Population)
incurve_5 = PointInCurve(Point=pop2d, Curve=scale_3.Geometry)  # -> simplify(Relationship), Point
sort_11 = SortList(Keys=incurve_5.Relationship)  # -> Keys, ValuesA
dcon_2 = DeleteConsecutive(Set=sort_11.Keys, Wrap=False)  # -> simplify(Set), Count
equals_29 = Equality(FirstNumber=dcon_2.Set, SecondNumber="2")  # -> Equality, Inequality
dispatch_35 = Dispatch(List=dcon_2.Set, DispatchPattern=equals_29.Inequality)  # -> ListA, ListB
clean_10 = CleanTree(RemoveNulls=True, RemoveInvalid=True, RemoveEmpty=Toggle(True), Tree=dispatch_35.ListB)
tstat_8 = TreeStatistics(Tree=clean_10)  # -> Paths, Length, Count
split_5 = TextSplit(Text=tstat_8.Paths, Separators="{}")
item_82 = ListItem(List=split_5, Index=1, Wrap=True)

# ----
# this output only useful when there is no real intersection between two buildings
panel_416 = Panel("Too close parcel")
item_83 = ListItem(List=cull_i_31, Index=item_82, Wrap=True)
area_37 = Area(Geometry=item_83)  # -> Area, Centroid
scale_4 = Scale(Geometry=item_83, Center=area_37.Centroid, Factor="1.1")  # -> Geometry, Transform

area_38 = Area(Geometry=geo_43)  # -> Area, Centroid
incurve_6 = PointInCurve(Point=area_38.Centroid, Curve=scale_4.Geometry)  # -> Relationship, Point
equals_30 = Equality(FirstNumber=incurve_6.Relationship, SecondNumber="2")  # -> Equality, Inequality
md_slider_5 = MDSlider(SliderMode=0, slider_value=Point(0.5, 0.5, 0.5), x_domain=Domain(0, 1), y_domain=Domain(0, 1), z_domain=Domain(0, 1))
dispatch_36 = Dispatch(List=geo_43, DispatchPattern=equals_30.Equality)  # -> ListA, ListB
evalsrf_3 = EvaluateSurface(Surface=dispatch_36.ListA, Point=md_slider_5)  # -> Point, Normal, UDirection, VDirection, Frame

panel_417 = Panel("Intersected Parcel(s) Bounding Box")
brec_4 = BoundingRectangle(Geometry=scale_4.Geometry, Plane=evalsrf_3.Frame, Axis=0, Slide=0, Union=True)  # -> simplify(Bounding), DimensionX, DimensionY

# ----
# uv frame of simulated parcel
data_169 = Data(evalsrf_2.Frame)

# ----
# Simulated Parcel Bounding Box
panel_418 = Panel("Intersected Parcel(s) Bounding Box")
geo_58 = Geometry(item_78)
geo_59 = Geometry(brec_4.Bounding)

# ----
# solid union do not work with rectangle geometries, thus, they should transform to polyline
merge_69 = Merge(Data1=geo_59, Data2=geo_58)  # -> simplify(flatten(Result))
partition_40 = PartitionList(List=merge_69, Size="1")  # -> simplify(Chunks)
debrep_7 = DeconstructBrep(Brep=partition_40)  # -> Faces, Edges, Vertices
pline_4 = PolyLine(Vertices=debrep_7.Vertices, Closed=Toggle(True))
sunion_2 = SolidUnion(Breps=pline_4)
runion = RegionUnion(Curves=sunion_2)  # -> simplify(Result)

# ----
# Simulated Parcel Bounding Box
geo_60 = Geometry(item_78)
brec_5 = BoundingRectangle(Geometry=geo_60, Plane=data_169, Axis=0, Slide=0, Union=True)  # -> simplify(Bounding), DimensionX, DimensionY
xy_2 = XYPlane(Origin=Point(0, 0, 0))
project = Project(Geometry=brec_5.Bounding, Plane=xy_2)  # -> Geometry, Transform
debrep_8 = DeconstructBrep(Brep=project.Geometry)  # -> Faces, Edges, Vertices
curvepoint = PointOnCurve(debrep_8.Edges, parameter=0.5)
incurve_7 = PointInCurve(Point=curvepoint, Curve=runion)  # -> simplify(Relationship), Point
equals_31 = Equality(FirstNumber=incurve_7.Relationship, SecondNumber="2")  # -> Equality, Inequality
dispatch_37 = Dispatch(List=debrep_8.Edges, DispatchPattern=equals_31.Equality)  # -> flatten(ListA), ListB

# ----
# Windowless Unit Test
# https://drive.google.com/drive/u/1/folders/1cVOKlVuLwwMiW8gXvWmfqpKi1dvpFBbl
# Intersected surfaces with adjacent buildings
geo_61 = Geometry(dispatch_37.ListA)

curvepoint_2 = PointOnCurve(geo_61, parameter=0.5)
vec2pt_5 = Vector2Pt(PointA=curvepoint_2, PointB=area_29.Centroid, Unitize=False)  # -> Vector, Length
move_2 = Move(Geometry=geo_61, Motion=vec2pt_5.Vector)  # -> Geometry, Transform
disc_5 = Discontinuity(Curve=geo_61, Level=1)  # -> simplify(Points), Parameters
disc_6 = Discontinuity(Curve=move_2.Geometry, Level=1)  # -> simplify(Points), Parameters
merge_70 = Merge(Data1=disc_6.Points, Data2=disc_5.Points)  # -> flatten(Result)
hull_4 = ConvexHull(Points=merge_70, Plane=PlaneXY(0, 0, 0))  # -> Hull, HullZ, Indices

# ----
# Fix Windowless Unit Test
merge_71 = Merge(Data1=disc_6.Points, Data2=disc_5.Points)
hull_5 = ConvexHull(Points=merge_71, Plane=PlaneXY(0, 0, 0))  # -> Hull, HullZ, Indices

# ----
# scale-up the text geometry
# 
# because
# 
# for some buildings even a unit has a edge to the intersected surface, center of the unit do not touch the text geometry.
# for example, index of 572
area_39 = Area(Geometry=hull_5.Hull)  # -> Area, Centroid
scale_5 = Scale(Geometry=hull_5.Hull, Center=area_39.Centroid, Factor="1.1")  # -> Geometry, Transform

# ----
# Intersected surfaces with adjacent buildings
geo_62 = Geometry(dispatch_37.ListA)

item_84 = ListItem(List=flatten(item_75), Index=filename, Wrap=True)

panel_420 = Panel("Intersected Surface")
geo_63 = Geometry(dispatch_37.ListA)

# ----
# # of floor of
# the building
data_170 = Data(flatten(item_75))

item_85 = ListItem(List=flatten(item_75), Index=filename, Wrap=True)

# ----
# Context Shading: Building
# floor number of buildings
data_171 = Data(flatten(item_75))

# ----
# # of floor of
# the building
# index of selected parcel
data_172 = Data(flatten(item_75))
data_173 = Data(filename)
item_86 = ListItem(List=data_172, Index=data_173, Wrap=True)

# ----
# division of floor(s) with extra units
item_87 = ListItem(List=python_23.a, Index=1, Wrap=True)
item_88 = ListItem(List=python_23.a, Index=0, Wrap=True)
boundary_14 = BoundarySurfaces(Edges=brec_3.Bounding)
divide_3 = DivideDomain²(Domain=boundary_14, UCount=item_88, VCount=item_87)
subsrf_3 = Isotrim(Surface=boundary_14, Domain=divide_3)  # -> simplify(Surface)

panel_422 = Panel("""0
1""")
item_89 = ListItem(List=subsrf_3, Index=1, Wrap=True)
item_90 = ListItem(List=subsrf_3, Index=0, Wrap=True)
cull_i_32 = CullIndex(List=subsrf_3, Indices=panel_422, Wrap=True)  # -> simplify(List)

merge_72 = Merge(Data1=item_90, Data2=item_89)
sunion_3 = SolidUnion(Breps=merge_72)
disc_7 = Discontinuity(Curve=sunion_3, Level=1)  # -> Points, Parameters
pline_5 = PolyLine(Vertices=disc_7.Points, Closed=Toggle(True))
merge_73 = Merge(Data1=cull_i_32, Data2=simplify(pline_5))

# ----
# Extra Unit
# https://drive.google.com/drive/u/1/folders/1cVOKlVuLwwMiW8gXvWmfqpKi1dvpFBbl
# units for floor(s) with extra units
weave_32 = Weave(Pattern=python_24.a, Stream0=flatten(subsrf_3), Stream1=flatten(merge_73), NullGaps=False)

partition_41 = PartitionList(List=flatten(weave_32), Size=weave_31)  # -> simplify(Chunks)
tstat_9 = TreeStatistics(Tree=partition_41)  # -> Paths, Length, Count
replace_20 = ReplacePaths(Data=partition_41, Search=tstat_9.Paths, Replace=item_79)

# ----
# Building with
# Extra Units
merge_74 = Merge(Data1=replace_17, Data2=replace_20)

merge_75 = Merge(Data1=data_164, Data2=merge_74)
clean_11 = CleanTree(RemoveNulls=True, RemoveInvalid=True, RemoveEmpty=Toggle(True), Tree=merge_75)

tstat_10 = TreeStatistics(Tree=clean_11)  # -> Paths, Length, Count
panel_423 = Panel(tstat_10.Paths)

# ----
# TEST FOR EACH FLOOR
# 
# if there are more than 2 residential units at the side of intersected surface
# 
# for example, 0_21, 4_28
area_40 = Area(Geometry=clean_11)  # -> Area, Centroid
incurve_8 = PointInCurve(Point=area_40.Centroid, Curve=scale_5.Geometry)  # -> Relationship, Point
equals_32 = Equality(FirstNumber=incurve_8.Relationship, SecondNumber="2")  # -> Equality, Inequality
dispatch_38 = Dispatch(List=area_40.Centroid, DispatchPattern=equals_32.Equality)  # -> ListA, ListB
lng_73 = ListLength(List=dispatch_38.ListA)
larger = LargerThan(FirstNumber=lng_73, SecondNumber="2")  # -> LargerThan, OrEqualTo
panel_424 = Panel(larger.LargerThan)

python_25 = GhPythonScript(x=larger.LargerThan, y=clean_11)  # -> out, simplify(Windowless), simplify(NoWindowless); inputs x: Boolean, y: list
# ---------- python_25: Python ----------
__author__ = "Siser"
__version__ = "2022.03.04"

import rhinoscriptsyntax as rs
if x == True:
    Windowless = y
else:
    NoWindowless= y
# ---------- end python_25 ----------
geo_64 = Geometry(python_25.Windowless)
clean_12 = CleanTree(RemoveNulls=True, RemoveInvalid=True, RemoveEmpty=Toggle(True), Tree=geo_64)
brec_6 = BoundingRectangle(Geometry=clean_12, Plane=data_165, Axis=0, Slide=0, Union=True)  # -> simplify(Bounding), DimensionX, DimensionY
boundary_15 = BoundarySurfaces(Edges=brec_6.Bounding)
md_slider_6 = MDSlider(SliderMode=0, slider_value=Point(0.5, 0.5, 0.5), x_domain=Domain(0, 1), y_domain=Domain(0, 1), z_domain=Domain(0, 1))
iso_4 = IsoCurve(Surface=reparameterize(flatten(boundary_15)), UVPoint=md_slider_6)  # -> simplify(flatten(UIsocurve)), VIsocurve
item_91 = ListItem(List=iso_4.UIsocurve, Index=0, Wrap=True)
equals_33 = Equality(FirstNumber=data_166, SecondNumber="2")  # -> Equality, Inequality
sort_12 = SortList(Keys=data_166)  # -> Keys, ValuesA
dprod_4 = DotProduct(VectorA=item_91, VectorB=geo_62, Unitize=False)
dispatch_39 = Dispatch(List=data_166, DispatchPattern=equals_33.Equality)  # -> ListA, ListB
item_92 = ListItem(List=sort_12.Keys, Index=0, Wrap=True)
python_26 = GhPythonScript(x=dprod_4)  # -> out, output; inputs x: Int32
# ---------- python_26: Python ----------
__author__ = "orcun"
__version__ = "2022.04.08"

import rhinoscriptsyntax as rs
if x == -1 or x==1:
    output = True
else:
    output= False
# ---------- end python_26 ----------
srf_2 = Surface(reparameterize(boundary_15))
item_93 = ListItem(List=data_166, Index=1, Wrap=True)
item_94 = ListItem(List=data_166, Index=0, Wrap=True)

# ----
# check whether
# 
# isotrim division number
# 
# is equal to
# 
# # of units per floor
toggle_9 = BooleanToggle(True)
clean_13 = CleanTree(RemoveNulls=True, RemoveInvalid=True, RemoveEmpty=toggle_9, Tree=python_25.Windowless)
multiplication_7 = Multiplication(A=item_94, B=item_93)
lng_74 = ListLength(List=clean_13)
equals_34 = Equality(FirstNumber=lng_74, SecondNumber=multiplication_7)  # -> simplify(Equality), Inequality

panel_425 = Panel("NoWindowless")
clean_14 = CleanTree(RemoveNulls=True, RemoveInvalid=True, RemoveEmpty=Toggle(True), Tree=python_25.NoWindowless)

# ----
# single unit per floor
panel_426 = Panel("0")

# ----
# 04.GEOMETRYFOR
# BUILDINGENERGYMODELING
# staircase
dcon_3 = DeleteConsecutive(Set=python_26.output, Wrap=False)  # -> Set, Count

python_27 = PythonScript(s=srf_2, swapUV=dcon_3.Set, reverseU=Toggle(False), reverseV=Toggle(False))  # -> out, anchor, uVec, vVec, revSrf; inputs s: Surface, swapUV: Int32, reverseU: Int32, reverseV: Int32; same code as python_14
divide_4 = DivideDomain²(Domain=python_27.revSrf, UCount=item_94, VCount=item_93)
subsrf_4 = Isotrim(Surface=simplify(python_27.revSrf), Domain=simplify(divide_4))  # -> simplify(Surface)

dispatch_40 = Dispatch(List=subsrf_4, DispatchPattern=equals_34.Equality)  # -> ListA, ListB

# ----
# Windowless
# and
# not equal to
# isotrim division
panel_427 = Panel("""0
1""")
item_95 = ListItem(List=dispatch_40.ListB, Index=1, Wrap=True)
item_96 = ListItem(List=dispatch_40.ListB, Index=0, Wrap=True)
cull_i_33 = CullIndex(List=dispatch_40.ListB, Indices=panel_427, Wrap=True)  # -> simplify(List)
merge_76 = Merge(Data1=item_96, Data2=item_95)
sunion_4 = SolidUnion(Breps=merge_76)
disc_8 = Discontinuity(Curve=sunion_4, Level=1)  # -> Points, Parameters
pline_6 = PolyLine(Vertices=disc_8.Points, Closed=Toggle(True))
merge_77 = Merge(Data1=simplify(cull_i_33), Data2=simplify(pline_6))
clean_15 = CleanTree(RemoveNulls=True, RemoveInvalid=True, RemoveEmpty=Toggle(True), Tree=merge_77)

# ----
# Windowless
# and
# equal to isotrim division
toggle_10 = BooleanToggle(True)
clean_16 = CleanTree(RemoveNulls=True, RemoveInvalid=True, RemoveEmpty=toggle_10, Tree=dispatch_40.ListA)

merge_78 = Merge(Data1=simplify(clean_14), Data2=simplify(clean_16), Data3=simplify(clean_15))
wires_3 = BrepWireframe(Brep=merge_78, Density=-1)
join_14 = JoinCurves(Curves=wires_3, Preserve=False)  # -> simplify(flatten(Curves))
lng_75 = ListLength(List=merge_78)  # -> flatten(Length)
partition_42 = PartitionList(List=join_14, Size=lng_75)  # -> simplify(Chunks)

# ----
# single unit per building
lng_76 = ListLength(List=flatten(partition_42))

branch_17 = TreeBranch(Tree=partition_42, Path=panel_426, MaintainPaths=True)

python_28 = GhPythonScript(x=lng_76)  # -> out, a
# ---------- python_28: Python ----------
__author__ = "orcun"
__version__ = "2022.04.08"

import rhinoscriptsyntax as rs
#if x == 1 or x == 2:
if x == 1:
    a = 0
else:
    a = 1
# ---------- end python_28 ----------
weave_33 = Weave(Pattern=python_28.a, Stream0=lng_76, Stream1=branch_17, NullGaps=False)

# ----
# if there is one floor at the building
item_97 = ListItem(List=data_167, Index=data_107, Wrap=True)
python_29 = GhPythonScript(x=item_97)  # -> out, a; inputs x: Int32; same code as python_28
weave_34 = Weave(Pattern=python_29.a, Stream0=item_97, Stream1=weave_33, NullGaps=False)

# ----
# single unit in the building
# 
# or
# 
# single unit per floor
lng_77 = ListLength(List=weave_34)
python_30 = GhPythonScript(x=lng_77)  # -> out, a; same code as python_28

tstat_11 = TreeStatistics(Tree=partition_42)  # -> Paths, Length, Count
listdexs_7 = ListIndices(List=tstat_11.Length)
sort_13 = SortList(Keys=tstat_11.Length, ValuesA=listdexs_7)  # -> Keys, ValuesA
item_98 = ListItem(List=sort_13.ValuesA, Index="-1", Wrap=True)
item_99 = ListItem(List=flatten(partition_42), Index=item_98, Wrap=True)
branch_18 = TreeBranch(Tree=partition_42, Path=item_98, MaintainPaths=True)
weave_35 = Weave(Pattern=python_30.a, Stream0=item_99, Stream1=branch_18, NullGaps=False)

# ----
# if there are 1 unit per floor
project_2 = Project(Geometry=weave_35, Plane=PlaneXY(0, 0, 0))  # -> Geometry, Transform
area_41 = Area(Geometry=project_2.Geometry)  # -> Area, Centroid
avr_4 = Average(Input=area_41.Centroid)
disc_9 = Discontinuity(Curve=weave_35, Level=1)  # -> flatten(Points), Parameters
cp_3 = ClosestPoint(Point=avr_4, Cloud=disc_9.Points)  # -> ClosestPoint, CPIndex, Distance
disc_10 = Discontinuity(Curve=branch_14, Level=1)  # -> Points, Parameters
item_100 = ListItem(List=disc_9.Points, Index=cp_3.CPIndex, Wrap=True)
cp_4 = ClosestPoint(Point=item_100, Cloud=disc_10.Points)  # -> ClosestPoint, CPIndex, Distance
item_101 = ListItem(List=disc_10.Points, Index=cp_4.CPIndex, Wrap=True)
move2pt_2 = MoveToPoint(Geometry=branch_14, PointA=item_101, PointB=item_100)  # -> Moved, Vector, Transform

# ----
# if there are 2 or 1 unit per floor
lng_78 = ListLength(List=weave_35)
python_31 = GhPythonScript(x=lng_78)  # -> out, a
# ---------- python_31: Python ----------
__author__ = "orcun"
__version__ = "2022.04.08"

import rhinoscriptsyntax as rs
#if x == 1 or x == 2:
if x == 1:
    a = 0
elif x ==2:
    a = 2
else:
    a = 1
# ---------- end python_31 ----------

# ----
# if there are 2 unit per floor
area_42 = Area(Geometry=branch_15)  # -> Area, Centroid
disc_11 = Discontinuity(Curve=weave_35, Level=1)  # -> flatten(Points), Parameters
hull_6 = ConvexHull(Points=disc_11.Points, Plane=PlaneXY(0, 0, 0))  # -> Hull, HullZ, Indices
area_43 = Area(Geometry=hull_6.Hull)  # -> Area, Centroid
move2pt_3 = MoveToPoint(Geometry=branch_15, PointA=area_42.Centroid, PointB=area_43.Centroid)  # -> Moved, Vector, Transform

# ----
# select only residential units
lng_79 = ListLength(List=partition_42)
series_44 = Series(Start=0, Step=1, Count=lng_79)  # -> simplify(Series)

# ----
# if single unit in the building or not,
# 
# single unit:0
# not single unit per building:1
data_174 = Data(python_30.a)

# ----
# select only residential units
lng_80 = ListLength(List=partition_42)
series_45 = Series(Start=0, Step=1, Count=lng_80)  # -> simplify(Series)

# ----
# if single unit in the building or not,
# 
# single unit:0
# not single unit per building:1
data_175 = Data(python_30.a)

weave_36 = Weave(Pattern=python_31.a, Stream0=move2pt_2.Moved, Stream1=branch_14, Stream2=move2pt_3.Moved, NullGaps=False)
Z_3 = UnitZ(Factor=data_79)

project_3 = Project(Geometry=weave_36, Plane=PlaneXY(0, 0, 0))  # -> Geometry, Transform

# ----
# x
# x
# x
# x
# x
# x
# x
# x
# x
# x
# x
# x
# x
# x
# x
# x
# x
# x
# x
# x
# x
# x
# x
# x
# x
# x
# x
# 
# x
# x
# x
# x
# x
# x
# 
# x
# x
# x
# x
# x
# 
# x
# x
# x
# x
# x
# x
# 
# x
# x
# x
# x
arrlinear_2 = LinearArray(Geometry=project_3.Geometry, Direction=Z_3, Count=lng_72)  # -> simplify(graft(Geometry)), Transform

# ----
# replace with new path
rdiff_2 = RegionDifference(CurvesA=partition_42, CurvesB=arrlinear_2.Geometry)  # -> simplify(Result)
tstat_12 = TreeStatistics(Tree=rdiff_2)  # -> Paths, Length, Count
replace_21 = ReplacePaths(Data=rdiff_2, Search=tstat_12.Paths, Replace=data_168)

# ----
# additional units (example index 0, in bahceli)
# 
# OR
# 
# non-additional units (example index 1, in bahceli)
geo_65 = Geometry(replace_21)

# ----
# single unit per building
item_102 = ListItem(List=geo_65, Index=series_44, Wrap=True)

tstat_13 = TreeStatistics(Tree=item_102)  # -> Paths, Length, Count
split_6 = TextSplit(Text=tstat_13.Paths, Separators="{}")
item_103 = ListItem(List=split_6, Index=1, Wrap=True)  # -> simplify(Item)
split_7 = TextSplit(Text=item_103, Separators=";")
item_104 = ListItem(List=split_7, Index="1", Wrap=True)  # -> simplify(flatten(Item))
lng_81 = ListLength(List=item_104)
dup_46 = DuplicateData(Data=item_58, Number=lng_81, Order=True)  # -> flatten(Data)
merge_79 = Merge(Data1=simplify(graft(dup_46)), Data2=simplify(graft(item_104)))
join_15 = TextJoin(Text=merge_79, Join=";")

# ----
# not single unit per building
branch_19 = TreeBranch(Tree=item_102, Path=item_80, MaintainPaths=True)

weave_37 = Weave(Pattern=data_174, Stream0=flatten(item_102), Stream1=branch_19, NullGaps=False)
disc_12 = Discontinuity(Curve=weave_37, Level=1)  # -> Points, Parameters
brec_7 = BoundingRectangle(Geometry=flatten(disc_12.Points), Plane=evalsrf_2.Frame, Axis=0, Slide=0, Union=True)  # -> Bounding, DimensionX, DimensionY
panel_428 = Panel("""SIMULATED 
BUILDING
UNITS""")

# ----
# core of the building
geo_66 = Geometry(flatten(arrlinear_2.Geometry))

area_44 = Area(Geometry=geo_66)  # -> Area, Centroid
sort_pt = SortPoints(Points=area_44.Centroid)  # -> Points, Indices
item_105 = ListItem(List=geo_66, Index=sort_pt.Indices, Wrap=True)
item_106 = ListItem(List=item_105, Index=0, Wrap=True)

boundary_16 = BoundarySurfaces(Edges=item_102)
Z_4 = UnitZ(Factor=data_83)
extr_2 = Extrude(Base=boundary_16, Direction=Z_4)

# ----
# Simulated Parcel Bounding Box
geo_67 = Geometry(brec_7.Bounding)

multiplication_8 = Multiplication(A=data_84, B=item_84)
Z_5 = UnitZ(Factor=multiplication_8)
area_45 = Area(Geometry=geo_67)  # -> Area, Centroid
curvepoint_3 = PointOnCurve(geo_63, parameter=0.5)
extr_3 = Extrude(Base=dispatch_37.ListA, Direction=Z_5)
vec2pt_6 = Vector2Pt(PointA=area_45.Centroid, PointB=curvepoint_3, Unitize=Toggle(True))  # -> Vector, Length
extr_4 = Extrude(Base=extr_3, Direction=vec2pt_6.Vector)
mass2zone = Honeybee_Masses2Zones(zoneMasses=flatten(extr_4), isConditioned=Toggle(False), maxRoofAngle=30, createHBZones=Toggle(True))  # -> readMe, HBZones; plug-in component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
wires_4 = BrepWireframe(Brep=mass2zone.HBZones, Density=-1)

panel_429 = Panel("simulated Parcel")  # disabled
geo_68 = Geometry(brec_7.Bounding)  # disabled

panel_430 = Panel("simulated building PARCEL")
geo_69 = Geometry(brec_7.Bounding)

# ----
# radius of the circle is the summation of fit circle radius's and 2 times of the builing height
disc_13 = Discontinuity(Curve=geo_69, Level=1)  # -> Points, Parameters
fcircle = CircleFit(Points=disc_13.Points)  # -> Circle, Radius, Deviation
item_107 = ListItem(List=data_170, Index=data_129, Wrap=True)
data_176 = Data(floor_height)
multiplication_9 = Multiplication(A="2", B=item_107)
multiplication_10 = Multiplication(A=data_176, B=multiplication_9)

addition_7 = Addition(A=fcircle.Radius, B=multiplication_10)

area_46 = Area(Geometry=geo_44)  # -> Area, Centroid
area_47 = Area(Geometry=geo_69)  # -> Area, Centroid
cp_5 = ClosestPoint(Point=area_47.Centroid, Cloud=area_46.Centroid)  # -> ClosestPoint, CPIndex, Distance
item_108 = ListItem(List=geo_44, Index=cp_5.CPIndex, Wrap=True)
area_48 = Area(Geometry=item_108)  # -> Area, Centroid
area_49 = Area(Geometry=geo_44)  # -> Area, Centroid
circle_2 = CircleCNR(Center=area_48.Centroid, Normal=Vector(0, 0, 1), Radius=addition_7)
incurve_9 = PointInCurve(Point=area_49.Centroid, Curve=circle_2)  # -> Relationship, Point
equals_35 = Equality(FirstNumber=incurve_9.Relationship, SecondNumber="2")  # -> Equality, Inequality

pop2d_2 = Populate2D(Region=geo_44, Count="25", Seed=1)  # -> simplify(Population)
incurve_10 = PointInCurve(Point=pop2d_2, Curve=circle_2)  # -> Relationship, Point
equals_36 = Equality(FirstNumber=incurve_10.Relationship, SecondNumber="2")  # -> Equality, Inequality
dispatch_41 = Dispatch(List=pop2d_2, DispatchPattern=equals_36.Equality)  # -> flatten(ListA), ListB

incurves_2 = PointInCurves(Point=dispatch_41.ListA, Curves=geo_44)  # -> Relationship, Index, Point
sort_14 = SortList(Keys=incurves_2.Index)  # -> Keys, ValuesA
dcon_4 = DeleteConsecutive(Set=sort_14.Keys, Wrap=False)  # -> Set, Count
equals_37 = Equality(FirstNumber=dcon_4.Set, SecondNumber="-1")  # -> Equality, Inequality
dispatch_42 = Dispatch(List=dcon_4.Set, DispatchPattern=equals_37.Equality)  # -> ListA, ListB
item_109 = ListItem(List=geo_44, Index=dispatch_42.ListB, Wrap=True)

geo_70 = Geometry(brec_7.Bounding)
area_50 = Area(Geometry=geo_70)  # -> Area, Centroid

geo_71 = Geometry(brec_7.Bounding)

# ----
# rectangle geometry do not work with collison component
toggle_11 = BooleanToggle(True)
debrep_9 = DeconstructBrep(Brep=item_109)  # -> Faces, Edges, Vertices
pline_7 = PolyLine(Vertices=debrep_9.Vertices, Closed=toggle_11)  # -> flatten(Polyline)

geo_72 = Geometry(brec_7.Bounding)

disc_14 = Discontinuity(Curve=geo_72, Level=1)  # -> Points, Parameters
area_51 = Area(Geometry=geo_72)  # -> Area, Centroid
boundary_17 = BoundarySurfaces(Edges=geo_72)
ln = Line(StartPoint=disc_14.Points, EndPoint=area_51.Centroid)
srfsplit = SurfaceSplit(Surface=boundary_17, Curves=ln)
wires_5 = BrepWireframe(Brep=srfsplit, Density=-1)
join_16 = JoinCurves(Curves=wires_5, Preserve=False)  # -> flatten(Curves)
scale_6 = Scale(Geometry=join_16, Center=area_51.Centroid, Factor="50")  # -> Geometry, Transform

debrep_10 = DeconstructBrep(Brep=geo_72)  # -> Faces, Edges, Vertices
curvepoint_4 = PointOnCurve(debrep_10.Edges, parameter=0.5)
intcrv = Interpolate(Vertices=curvepoint_4, Degree=3, Periodic=Toggle(True), KnotStyle=1)  # -> Curve, Length, Domain

geo_73 = Geometry(brec_7.Bounding)

geo_74 = Geometry(brec_7.Bounding)

debrep_11 = DeconstructBrep(Brep=geo_73)  # -> Faces, Edges, Vertices
area_52 = Area(Geometry=geo_73)  # -> Area, Centroid
curvepoint_5 = PointOnCurve(debrep_11.Edges, parameter=0.5)
vec2pt_7 = Vector2Pt(PointA=area_52.Centroid, PointB=curvepoint_5, Unitize=Toggle(True))  # -> Vector, Length
move_3 = Move(Geometry=graft(curvepoint_5), Motion=graft(vec2pt_7.Vector))  # -> simplify(Geometry), Transform
# Building & Unit Features
disc_15 = Discontinuity(Curve=debrep_11.Edges, Level=1)  # -> simplify(Points), Parameters
merge_80 = Merge(Data1=disc_15.Points, Data2=move_3.Geometry)

# ----
# 00test triangle
area_53 = Area(Geometry=geo_74)  # -> Area, Centroid
disc_16 = Discontinuity(Curve=geo_74, Level=1)  # -> Points, Parameters
boundary_18 = BoundarySurfaces(Edges=geo_74)
ln_2 = Line(StartPoint=disc_16.Points, EndPoint=area_53.Centroid)
srfsplit_2 = SurfaceSplit(Surface=boundary_18, Curves=ln_2)
wires_6 = BrepWireframe(Brep=srfsplit_2, Density=-1)
join_17 = JoinCurves(Curves=wires_6, Preserve=False)  # -> flatten(Curves)
scale_7 = Scale(Geometry=join_17, Center=area_53.Centroid, Factor="50")  # -> Geometry, Transform

area_54 = Area(Geometry=scale_6.Geometry)  # -> Area, Centroid
alongcrv = SortAlongCurve(Points=area_54.Centroid, Curve=intcrv.Curve)  # -> Points, Indices
item_110 = ListItem(List=scale_6.Geometry, Index=alongcrv.Indices, Wrap=True)

area_55 = Area(Geometry=scale_7.Geometry)  # -> Area, Centroid
pdecon_11 = Deconstruct(Point=area_55.Centroid)  # -> XComponent, YComponent, ZComponent
sort_15 = SortList(Keys=pdecon_11.YComponent, ValuesA=scale_7.Geometry)  # -> Keys, reverse(ValuesA)
item_111 = ListItem(List=sort_15.ValuesA, Index=0, Wrap=True)

area_56 = Area(Geometry=scale_7.Geometry)  # -> Area, Centroid
pdecon_12 = Deconstruct(Point=area_56.Centroid)  # -> XComponent, YComponent, ZComponent
sort_16 = SortList(Keys=pdecon_12.XComponent, ValuesA=scale_7.Geometry)  # -> Keys, ValuesA
item_112 = ListItem(List=sort_16.ValuesA, Index=0, Wrap=True)

area_57 = Area(Geometry=scale_7.Geometry)  # -> Area, Centroid
pdecon_13 = Deconstruct(Point=area_57.Centroid)  # -> XComponent, YComponent, ZComponent
sort_17 = SortList(Keys=pdecon_13.YComponent, ValuesA=scale_7.Geometry)  # -> Keys, ValuesA
item_113 = ListItem(List=sort_17.ValuesA, Index=0, Wrap=True)

area_58 = Area(Geometry=scale_7.Geometry)  # -> Area, Centroid
pdecon_14 = Deconstruct(Point=area_58.Centroid)  # -> XComponent, YComponent, ZComponent
sort_18 = SortList(Keys=pdecon_14.XComponent, ValuesA=scale_7.Geometry)  # -> Keys, reverse(ValuesA)
item_114 = ListItem(List=sort_18.ValuesA, Index=0, Wrap=True)

shift_4 = ShiftList(List=item_110, Shift="-1", Wrap=True)
panel_437 = Panel("starts from north")

# ----
# regions start from north
# continues counter-clockwise
merge_81 = Merge(Data1=item_111, Data2=item_112, Data3=item_113, Data4=item_114)

geo_75 = Geometry(brec_7.Bounding)

geo_76 = Geometry(brec_7.Bounding)

geo_77 = Geometry(brec_7.Bounding)

tstat_14 = TreeStatistics(Tree=geo_65)  # -> Paths, Length, Count
split_8 = TextSplit(Text=tstat_14.Paths, Separators="{}")
split_9 = TextSplit(Text=split_8, Separators=";")
clean_17 = CleanTree(RemoveNulls=True, RemoveInvalid=True, RemoveEmpty=False, Tree=split_9)  # -> simplify(flatten(Tree))
item_115 = ListItem(List=clean_17, Index=1, Wrap=True)

tstat_15 = TreeStatistics(Tree=geo_65)  # -> Paths, Length, Count
split_10 = TextSplit(Text=tstat_15.Paths, Separators="{}")
split_11 = TextSplit(Text=split_10, Separators=";")
clean_18 = CleanTree(RemoveNulls=True, RemoveInvalid=True, RemoveEmpty=False, Tree=split_11)  # -> simplify(flatten(Tree))
item_116 = ListItem(List=clean_18, Index=1, Wrap=True)

lng_82 = ListLength(List=item_102)  # -> flatten(Length)
series_46 = Series(Start=0, Step=1, Count=simplify(lng_82))  # -> simplify(flatten(Series))
partition_43 = PartitionList(List=lng_82, Size="1")  # -> simplify(Chunks)
dup_47 = DuplicateData(Data=join_15, Number=partition_43, Order=True)  # -> simplify(Data)
rep = ReplaceText(Text=dup_47, Find=";", Replace="_", RecursiveReplace=False)  # -> flatten(Result)

python_32 = GhPythonScript(x=replace_11)  # -> out, a
# ---------- python_32: Python ----------
__author__ = "Siser"
__version__ = "2022.03.07"

import rhinoscriptsyntax as rs
if x == 'MidriseApartment::Apartment':
    a = 'res'
else:
    a = 'off'
# ---------- end python_32 ----------
partition_44 = PartitionList(List=python_32.a, Size=lng_82)  # -> simplify(flatten(Chunks))

merge_82 = Merge(Data1=simplify(graft(rep)), Data2=simplify(graft(series_46)), Data3=simplify(graft(partition_44)))
join_18 = TextJoin(Text=simplify(merge_82), Join="_")  # -> flatten(Result)
partition_45 = PartitionList(List=join_18, Size=lng_82)  # -> simplify(Chunks)
item_117 = ListItem(List=partition_45, Index=series_45, Wrap=True)

panel_441 = Panel("parcel_floor_unit_function")
panel_442 = Panel(partition_45)

# ----
# Naming for Simulated Zones
data_177 = Data(flatten(partition_45))

# ----
# Naming for Simulated Zones
data_178 = Data(flatten(partition_45))

# ----
# Naming for Staircase
Z_6 = UnitZ(Factor=data_81)
arrlinear_3 = LinearArray(Geometry=item_106, Direction=Z_6, Count=item_81)  # -> Geometry, Transform
Z_7 = UnitZ(Factor=data_82)
boundary_19 = BoundarySurfaces(Edges=arrlinear_3.Geometry)
data_179 = Data(item_49)
split_12 = TextSplit(Text=data_179, Separators=":")
extr_5 = Extrude(Base=boundary_19, Direction=Z_7)
item_118 = ListItem(List=split_12, Index="-1", Wrap=True)
chars_2 = Characters(Text=item_118)  # -> Result, Unicode
series_47 = Series(Start=0, Step=1, Count="3")
item_119 = ListItem(List=chars_2.Result, Index=series_47, Wrap=True)
data_180 = Data(filename)
dup_48 = DuplicateData(Data=data_180, Number=item_81, Order=True)  # -> flatten(Data)

panel_443 = Panel("unconditoned")
geo_78 = Geometry(extr_5)

lng_83 = ListLength(List=geo_78)
series_48 = Series(Start=0, Step=1, Count=lng_83)  # -> flatten(Series)
dup_49 = DuplicateData(Data=item_119, Number=lng_83, Order=True)  # -> flatten(Data)
partition_46 = PartitionList(List=dup_49, Size="3")
merge_83 = Merge(Data1=simplify(graft(series_48)), Data2=simplify(partition_46), Data3=simplify(graft(dup_48)))

data_181 = Data(extr_5)  # disabled
panel_444 = Panel("# of floor")  # disabled
lng_84 = ListLength(List=data_181)  # disabled

panel_445 = Panel("contioned & unconditioned")

# ----
# intersect mass for all units
# -conditioned zones
# -unconditioned zones
# Error: vertex size mismatch between base surface
toggle_12 = BooleanToggle(True)

# ----
# single unit per building
# 
# or
# 
# not
join_19 = TextJoin(Text=merge_83)  # -> flatten(Result)

# ----
# if there is one building at the floor
lng_85 = ListLength(List=partition_42)  # -> flatten(Length)
equals_38 = Equality(FirstNumber="1", SecondNumber=lng_85)  # -> Equality, Inequality
dispatch_43 = Dispatch(List=geo_78, DispatchPattern=equals_38.Equality)  # -> ListA, ListB
dispatch_44 = Dispatch(List=join_19, DispatchPattern=equals_38.Equality)  # -> ListA, ListB

weave_38 = Weave(Pattern=data_175, Stream0=geo_78, Stream1=dispatch_43.ListB, NullGaps=False)
# Staircase:
# Unconditioned
weave_39 = Weave(Pattern=data_175, Stream0=join_19, Stream1=dispatch_44.ListB, NullGaps=False)

merge_84 = Merge(Data1=extr_2, Data2=weave_38)

intersectmass = Honeybee_IntersectMasses(bldgMassesBefore=flatten(merge_84), runIt=toggle_12)  # -> bldgMassesAfter; plug-in component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

volume = Volume(Geometry=weave_38)  # -> Volume, Centroid
round_34 = Round(Number=volume.Volume)  # -> Nearest, Floor, Ceiling
dcon_5 = DeleteConsecutive(Set=round_34.Nearest, Wrap=False)  # -> Set, Count

volume_2 = Volume(Geometry=intersectmass)  # -> Volume, Centroid
round_35 = Round(Number=volume_2.Volume)  # -> Nearest, Floor, Ceiling
equals_39 = Equality(FirstNumber=round_35.Nearest, SecondNumber=dcon_5.Set)  # -> Equality, Inequality
dispatch_45 = Dispatch(List=intersectmass, DispatchPattern=equals_39.Equality)  # -> ListA, ListB

panel_446 = Panel("conditioned")
geo_79 = Geometry(dispatch_45.ListB)

panel_447 = Panel("unconditioned")
geo_80 = Geometry(dispatch_45.ListA)

mass2zone_2 = Honeybee_Masses2Zones(
    zoneMasses=flatten(geo_80),
    zoneNames=flatten(weave_39),
    zonePrograms=item_49,
    isConditioned=Toggle(False),
    maxRoofAngle=30,
    createHBZones=Toggle(True))  # -> readMe, HBZones; plug-in component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

# ----
# Conditioned Units
mass2zone_3 = Honeybee_Masses2Zones(
    zoneMasses=flatten(geo_79),
    zoneNames=flatten(partition_45),
    zonePrograms=replace_11,
    isConditioned=Toggle(True),
    maxRoofAngle=30,
    createHBZones=Toggle(True))  # -> readMe, HBZones; plug-in component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

merge_85 = Merge(Data1=flatten(mass2zone_3.HBZones), Data2=flatten(mass2zone_2.HBZones))
solveadjc = Honeybee_SolveAdjacencies(HBZones=flatten(merge_85), removeCurrentAdjc=False, findAdjc=Toggle(True))  # -> readMe, HBZonesWADJ; plug-in component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

# ----
# HBzone
# Formation
merge_86 = Merge(Data1=solveadjc.HBZonesWADJ, Data2=mass2zone.HBZones)  # -> flatten(Result)
null_4 = NullItem(Item=merge_86)  # -> flatten(NullFlags), InvalidFlags, Description
dispatch_46 = Dispatch(List=merge_86, DispatchPattern=null_4.NullFlags)  # -> ListA, flatten(ListB)
panel_448 = Panel("include intersected surface's zone")
solveadjc_2 = Honeybee_SolveAdjacencies(HBZones=flatten(dispatch_46.ListB), altBC="Adiabatic", removeCurrentAdjc=False, findAdjc=Toggle(True))  # -> readMe, HBZonesWADJ; plug-in component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

# ----
# Window Addition
conditionedunconditioned = Honeybee_SeparateConditionedAndUnconditionedZones(HBZones=flatten(solveadjc_2.HBZonesWADJ))  # -> conditionedZones, unconditionedZones; plug-in component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
glazingcreator = Honeybee_GlazingBasedOnRatio(
    HBObjects=conditionedunconditioned.conditionedZones,
    glzRatio=weave_26,
    breakUpWindow=Toggle(False),
    EPConstructions=epconstruction,
    runIt=Toggle(True))  # -> readMe, HBObjWGLZ; plug-in component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

geo_81 = Geometry(glazingcreator.HBObjWGLZ)
panel_449 = Panel("HBzones")

panel_450 = Panel("residential non-cooling")
equals_40 = Equality(FirstNumber=data_112, SecondNumber="0")  # -> Equality, Inequality
dispatch_47 = Dispatch(List=geo_81, DispatchPattern=equals_40.Equality)  # -> ListA, ListB

panel_451 = Panel("office unit(s)")
equals_41 = Equality(FirstNumber=data_112, SecondNumber="1")  # -> Equality, Inequality
dispatch_48 = Dispatch(List=geo_81, DispatchPattern=equals_41.Equality)  # -> ListA, ListB

# ----
# Unit Separation by Function
panel_452 = Panel("residential all")
data_182 = Data(dispatch_48.ListB)
item_120 = ListItem(List=geo_81, Index=data_182, Wrap=True)

panel_453 = Panel("residential with cooling")
equals_42 = Equality(FirstNumber=data_112, SecondNumber="5")  # -> Equality, Inequality
dispatch_49 = Dispatch(List=geo_81, DispatchPattern=equals_42.Equality)  # -> ListA, ListB

panel_454 = Panel("#ofResUnits")
lng_86 = ListLength(List=item_120)

lng_87 = ListLength(List=data_86)
dom_6 = ConstructDomain(DomainStart=0, DomainEnd=lng_87)
random = Random(Range=dom_6, Number=lng_86, Seed=2)
round_36 = Round(Number=random)  # -> Nearest, Floor, Ceiling

panel_455 = Panel("indices residential")
data_183 = Data(dispatch_48.ListB)

data_184 = Data(dispatch_48.ListB)

lng_88 = ListLength(List=item_120)

lng_89 = ListLength(List=item_120)

item_121 = ListItem(List=data_177, Index=data_183, Wrap=True)
lng_90 = ListLength(List=item_121)
panel_459 = Panel("naming")
dup_50 = DuplicateData(Data="heatSet", Number=lng_90, Order=True)
merge_87 = Merge(Data1=simplify(graft(dup_50)), Data2=simplify(graft(item_121)))  # -> simplify(Result)
join_20 = TextJoin(Text=merge_87)  # -> flatten(Result)

multiplication_11 = Multiplication(A="19", B=lng_89)
dup_51 = DuplicateData(Data="21.1", Number=multiplication_11, Order=True)
partition_47 = PartitionList(List=dup_51, Size="19")  # -> simplify(Chunks)

item_122 = ListItem(List=data_178, Index=data_184, Wrap=True)
lng_91 = ListLength(List=item_122)
dup_52 = DuplicateData(Data="heatSet", Number=lng_91, Order=True)
merge_88 = Merge(Data1=simplify(graft(dup_52)), Data2=simplify(graft(item_122)))  # -> simplify(Result)
join_21 = TextJoin(Text=merge_88)  # -> flatten(Result)

multiplication_12 = Multiplication(A="5", B=lng_88)
dup_53 = DuplicateData(Data="18", Number=multiplication_12, Order=True)
partition_48 = PartitionList(List=dup_53, Size="5")  # -> simplify(Chunks)

lng_92 = ListLength(List=item_120)

lng_93 = ListLength(List=item_120)

multiplication_13 = Multiplication(A="5", B=lng_93)
dup_54 = DuplicateData(Data="18", Number=multiplication_13, Order=True)
partition_49 = PartitionList(List=dup_54, Size="5")  # -> simplify(Chunks)

item_123 = ListItem(List=data_86, Index=round_36.Nearest, Wrap=True)
dup_55 = DuplicateData(Data=item_123, Number="19", Order=True)  # -> simplify(Data)
sort_19 = SortList(Keys=dup_55)  # -> Keys, ValuesA
partition_50 = PartitionList(List=sort_19.Keys, Size="19")  # -> simplify(Chunks)
merge_89 = Merge(Data1=partition_49, Data2=partition_50)

# ----
# .csv recordings
dup_56 = DuplicateData(Data="21.1", Number=lng_92, Order=True)

# ----
# separation of
# residential & office units
data_185 = Data(flatten(partition_44))
tmatch = MatchText(Text=data_185, Pattern="res", Case=True)
dispatch_50 = Dispatch(List=glazingcreator.HBObjWGLZ, DispatchPattern=tmatch)  # -> ListA, ListB

# ----
# AS-IS V1
# HEATING
# SET POINT
merge_90 = Merge(Data1=partition_48, Data2=partition_47)
annualschedule_26 = Honeybee_AnnualSchedule(
    sun=merge_90,
    mon=merge_90,
    tue=merge_90,
    wed=merge_90,
    thu=merge_90,
    fri=merge_90,
    sat=merge_90,
    scheduleName=simplify(graft(join_20)),
    schedTypeLimits="Temperature",
    runIt=Toggle(True))  # -> readMe, port, flatten(schedule), port_2, simplify(weekSched), schedIDFText; plug-in component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

# ----
# RESIDENTIAL UNITS
debrep_12 = DeconstructBrep(Brep=dispatch_50.ListA)  # -> Faces, Edges, Vertices
item_124 = ListItem(List=debrep_12.Faces, Index=0, Wrap=True)  # -> flatten(Item)
area_59 = Area(Geometry=item_124)  # -> Area, Centroid
sort_20 = SortList(Keys=area_59.Area)  # -> Keys, ValuesA
dcon_6 = DeleteConsecutive(Set=sort_20.Keys, Wrap=False)  # -> Set, Count
mindex_6 = MemberIndex(Set=area_59.Area, Member=graft(dcon_6.Set))  # -> simplify(Index), Count

# ----
# GENERATED
# HEATING
# SET POINT
annualschedule_27 = Honeybee_AnnualSchedule(
    sun=merge_89,
    mon=merge_89,
    tue=merge_89,
    wed=merge_89,
    thu=merge_89,
    fri=merge_89,
    sat=merge_89,
    scheduleName=simplify(graft(join_21)),
    schedTypeLimits="Temperature",
    runIt=Toggle(True))  # -> readMe, port, flatten(schedule), port_2, simplify(weekSched), schedIDFText; plug-in component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

# ----
# Group the residential Units according to their floor area
item_125 = ListItem(List=area_59.Area, Index=mindex_6.Index, Wrap=True)

item_126 = ListItem(List=item_125, Index=0, Wrap=True)
lng_94 = ListLength(List=item_126)
dup_57 = DuplicateData(Data=panel_256, Number=lng_94, Order=True)  # -> simplify(Data)
lng_95 = ListLength(List=panel_256)
partition_51 = PartitionList(List=dup_57, Size=lng_95)  # -> simplify(Chunks)
tstat_16 = TreeStatistics(Tree=partition_51)  # -> Paths, Length, Count
tstat_17 = TreeStatistics(Tree=item_126)  # -> Paths, Length, Count
# Statistically Unit Grouping
# Matching Unit Floor Area &
# Occupant Profile Combinations
replace_22 = ReplacePaths(Data=partition_51, Search=tstat_16.Paths, Replace=tstat_17.Paths)
# based on hepsiemlak.com
subtraction_4 = Subtraction(A=item_126, B=replace_22)
abs_4 = Absolute(Value=subtraction_4)
listdexs_8 = ListIndices(List=abs_4)
sort_21 = SortList(Keys=abs_4, ValuesA=listdexs_8)  # -> Keys, ValuesA
item_127 = ListItem(List=sort_21.ValuesA, Index=0, Wrap=True)
lng_96 = ListLength(List=item_125)
dup_58 = DuplicateData(Data=item_127, Number=lng_96, Order=True)  # -> simplify(Data)

# ----
# AS-IS V2
# OCCUPANCY
# SCHEDULES
weave_40 = Weave(
    Pattern=dup_58,
    Stream0=jitter_34.Values,
    Stream1=jitter_33.Values,
    Stream2=jitter_31.Values,
    Stream3=jitter_30.Values,
    Stream4=jitter_32.Values,
    NullGaps=False)

lng_97 = ListLength(List=dup_58)  # -> simplify(Length)
series_49 = Series(Start=0, Step=1, Count=lng_97)
item_128 = ListItem(List=simplify(weave_40), Index=simplify(series_49), Wrap=True)  # -> simplify(Item)

panel_463 = Panel(item_128)

panel_464 = Panel("residential all")
item_129 = ListItem(List=data_112, Index=data_182, Wrap=True)

# ----
# OFFICE UNITS
toggle_13 = BooleanToggle(False)
setepnatvent = Honeybee_SetEPAirFlow(
    HBZones=flatten(dispatch_48.ListA),
    naturalVentilationType="1",
    minIndoorTempForNatVent="24.0",
    maxIndoorTempForNatVent="25.0",
    minOutdoorTempForNatVent="12",
    deltaTempForNatVent="0.0",
    fractionOfGlzAreaOperable="0.4",
    windDrivenCrossVent=toggle_13)  # -> readMe, simplify(HBZones); plug-in component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
setepzoneschedules = Honeybee_SetEnergyPlusZoneSchedules(
    HBZones=setepnatvent.HBZones,
    heatingSetPtSchedules=annualschedule_25.schedule,
    coolingSetPtSchedules=honeybee_seasonalschedule.schedule)  # -> schedules, simplify(HBZones); plug-in component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

panel_465 = Panel("occupancy Schedules")
data_186 = Data(item_128)

split_13 = TextSplit(Text=flatten(data_186), Separators="_")  # -> simplify(Result)
python_33 = GhPythonScript(x=split_13, A=panel_264)  # -> out, a
# ---------- python_33: Python ----------
__author__ = "orcun"
__version__ = "2021.11.30"

import rhinoscriptsyntax as rs
if x == A:
    a = 0
else:
    a = 1
# ---------- end python_33 ----------
sort_22 = SortList(Keys=python_33.a)  # -> Keys, ValuesA
item_130 = ListItem(List=sort_22.Keys, Index=0, Wrap=True)  # -> flatten(Item)
lng_98 = ListLength(List=data_186)

item_131 = ListItem(List=cooling_set_points, Index=item_130, Wrap=True)  # -> simplify(graft(Item))
lng_99 = ListLength(List=item_131)
dup_59 = DuplicateData(Data="100", Number=lng_99, Order=True)
dup_60 = DuplicateData(Data=dup_59, Number="8", Order=True)  # -> simplify(Data)
dup_61 = DuplicateData(Data=item_131, Number="12", Order=True)  # -> simplify(Data)
dup_62 = DuplicateData(Data=dup_59, Number="4", Order=True)  # -> simplify(Data)
merge_91 = Merge(Data1=dup_60, Data2=dup_61, Data3=dup_62)

item_132 = ListItem(List=heating_set_points_name, Index=item_130, Wrap=True)  # -> simplify(graft(Item))
lng_100 = ListLength(List=item_132)
dup_63 = DuplicateData(Data="CoolResidential", Number=lng_100, Order=True)  # -> simplify(Data)
merge_92 = Merge(Data1=dup_63, Data2=item_132)
join_22 = TextJoin(Text=merge_92, Join="_")

item_133 = ListItem(List=heating_set_points, Index=item_130, Wrap=True)  # -> simplify(graft(Item))
lng_101 = ListLength(List=item_133)
dup_64 = DuplicateData(Data="18", Number=lng_101, Order=True)
dup_65 = DuplicateData(Data=dup_64, Number="7", Order=True)  # -> simplify(Data)
dup_66 = DuplicateData(Data=item_133, Number="17", Order=True)  # -> simplify(Data)
merge_93 = Merge(Data1=dup_65, Data2=dup_66)

item_134 = ListItem(List=heating_set_points_name, Index=item_130, Wrap=True)  # -> simplify(graft(Item))
lng_102 = ListLength(List=item_134)
dup_67 = DuplicateData(Data="HEATSET", Number=lng_102, Order=True)  # -> simplify(Data)
merge_94 = Merge(Data1=dup_67, Data2=item_134)
join_23 = TextJoin(Text=merge_94, Join="_")

# ----
# indices
# of
# residential non-cooling
listdexs_9 = ListIndices(List=geo_81)
dispatch_51 = Dispatch(List=listdexs_9, DispatchPattern=equals_40.Equality)  # -> ListA, ListB

# ----
# Cooling Set Point Schedules
toggle_14 = BooleanToggle(True)
dup_68 = DuplicateData(Data="100", Number="24", Order=True)
annualschedule_28 = Honeybee_AnnualSchedule(
    sun=merge_91,
    mon=merge_91,
    tue=merge_91,
    wed=merge_91,
    thu=merge_91,
    fri=merge_91,
    sat=merge_91,
    scheduleName="COOL-ON-SCHEDULE",
    schedTypeLimits="Temperature",
    runIt=toggle_14)  # -> readMe, port, schedule, port_2, weekSched, schedIDFText; plug-in component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
annualschedule_29 = Honeybee_AnnualSchedule(
    sun=dup_68,
    mon=dup_68,
    tue=dup_68,
    wed=dup_68,
    thu=dup_68,
    fri=dup_68,
    sat=dup_68,
    scheduleName="COOL-OFF-SCHEDULE",
    schedTypeLimits="Temperature",
    runIt=toggle_14)  # -> readMe, port, schedule, port_2, weekSched, schedIDFText; plug-in component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
analysisperiod_6 = Ladybug_AnalysisPeriod(fromMonth=data_89, fromDay=data_90, toMonth=data_91, toDay=data_90)  # -> readMe, analysisPeriod; plug-in component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
panel_466 = Panel("Classroom_Cooling_25")
honeybee_seasonalschedule_2 = Honeybee_SeasonalSchedule(
    scheduleName=join_22,
    schedTypeLimits="Temperature",
    baseWeekSched=annualschedule_29.weekSched,
    seasonWeekSched1=annualschedule_28.weekSched,
    analysisPeriod1=analysisperiod_6.analysisPeriod)  # -> readMe, flatten(schedule), schedIDFText; plug-in component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

# ----
# indices
# of
# residential cooling
listdexs_10 = ListIndices(List=geo_81)
dispatch_52 = Dispatch(List=listdexs_10, DispatchPattern=equals_42.Equality)  # -> ListA, ListB

# ----
# Heating Set Point Schedules
panel_467 = Panel("Temperature")
annualschedule_30 = Honeybee_AnnualSchedule(
    sun=merge_93,
    mon=merge_93,
    tue=merge_93,
    wed=merge_93,
    thu=merge_93,
    fri=merge_93,
    sat=merge_93,
    scheduleName=simplify(graft(join_23)),
    schedTypeLimits=panel_467,
    runIt=Toggle(True))  # -> readMe, port, flatten(schedule), port_2, simplify(weekSched), schedIDFText; plug-in component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
partition_52 = PartitionList(List=annualschedule_30.schedule, Size=flatten(lng_98))  # -> simplify(Chunks); disabled

panel_468 = Panel("CULL office unit(s)")
data_187 = Data(equals_41.Equality)

panel_469 = Panel("cooling schedules")
partition_53 = PartitionList(List=honeybee_seasonalschedule_2.schedule, Size=flatten(lng_98))  # -> simplify(Chunks); disabled

conditionedunconditioned_2 = Honeybee_SeparateConditionedAndUnconditionedZones(HBZones=flatten(solveadjc.HBZonesWADJ))  # -> conditionedZones, unconditionedZones; plug-in component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
panel_470 = Panel("Unconditioned Adjacent Zone")

# ----
# OFFICE UNITS
# AS-IS
# All office INTERNAL LOAD parameters are based on DEFAULT midriseapartment:office schedule
panel_471 = Panel("0")
setepzoneloads = Honeybee_SetEnergyPlusZoneLoads(
    HBZones=setepzoneschedules.HBZones,
    equipmentLoadPerArea=geteploads_2.equipmentLoadPerArea,
    infilRatePerArea_Facade=geteploads_2.infilRatePerArea_Facade,
    lightingDensityPerArea=geteploads_2.lightingDensityPerArea,
    numOfPeoplePerArea=geteploads_2.numOfPeoplePerArea,
    ventilationPerArea=geteploads_2.ventilationPerArea,
    ventilationPerPerson=geteploads_2.ventilationPerPerson,
    recirculatedAirPerArea=panel_471)  # -> loads, flatten(HBZones); plug-in component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

panel_472 = Panel("Unit Matching Data")
data_188 = Data(dup_58)

# ----
# AS-IS V2
# # OF PEOPLE IN THE
# RESIDENTIAL UNIT
weave_41 = Weave(
    Pattern=data_188,
    Stream0=jitter_39.Values,
    Stream1=jitter_38.Values,
    Stream2=jitter_36.Values,
    Stream3=jitter_37.Values,
    Stream4=jitter_35.Values,
    NullGaps=False)

# ----
# Group the residential Units according to their floor area
data_189 = Data(item_125)

lng_103 = ListLength(List=data_188)  # -> simplify(Length)
series_50 = Series(Start=0, Step=1, Count=lng_103)
# x
# x
# x
# x
# x
# x
# x
# x
# x
# x
# x
# x
# x
# x
# x
# x
# x
# x
# x
# x
# x
# x
# x
# x
# x
# x
# x
# 
# x
# x
# x
# x
# x
# x
# 
# x
# x
# x
# x
# x
# 
# x
# x
# x
# x
# x
# x
# 
# x
# x
# x
# x
item_135 = ListItem(List=simplify(weave_41), Index=series_50, Wrap=True)  # -> simplify(Item)

# ----
# # of people per unit
data_190 = Data(item_135)

# ----
# #of people per unit
division_11 = Division(A=data_190, B=data_189)

lng_104 = ListLength(List=item_120)

# ----
# indices of all residentials
listdexs_11 = ListIndices(List=geo_81)
dispatch_53 = Dispatch(List=listdexs_11, DispatchPattern=equals_41.Equality)  # -> ListA, ListB

# ----
# .csv recordings
dup_69 = DuplicateData(Data=data_101, Number=lng_104, Order=True)

# ----
# Select Version
panel_474 = Panel("""HeatingSet
csv recordings""")
weave_42 = Weave(Pattern=number_slider_2, Stream0=dup_56, Stream1=dup_56, Stream2=item_123, NullGaps=False)

panel_475 = Panel("HeatingSetSchedule")
weave_43 = Weave(
    Pattern=number_slider_2,
    Stream0=annualschedule_26.schedule,
    Stream1=annualschedule_26.schedule,
    Stream2=annualschedule_27.schedule,
    NullGaps=False)

# ----
# Heating set point
panel_476 = Panel("1")
equals_43 = Equality(FirstNumber=item_129, SecondNumber=panel_476)  # -> Equality, Inequality
dispatch_54 = Dispatch(List=weave_43, DispatchPattern=equals_43.Equality)  # -> ListA, ListB

# ----
# RESIDENTIAL
# COOLING-OFF
# UNITS
setepnatvent_2 = Honeybee_SetEPAirFlow(
    HBZones=flatten(dispatch_47.ListA),
    naturalVentilationType="1",
    minIndoorTempForNatVent="24.0",
    minOutdoorTempForNatVent="12",
    deltaTempForNatVent=panel_261,
    fractionOfGlzAreaOperable="0.4",
    windDrivenCrossVent=Toggle(False))  # -> readMe, simplify(HBZones); plug-in component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
setepzoneschedules_2 = Honeybee_SetEnergyPlusZoneSchedules(
    HBZones=setepnatvent_2.HBZones,
    heatingSetPtSchedules=dispatch_54.ListB,
    coolingSetPtSchedules=annualschedule_24.schedule,
    lightingSchedules=item_50)  # -> schedules, simplify(flatten(HBZones)); plug-in component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

# ----
# geometry of residential non-cooling
geo_82 = Geometry(setepzoneschedules_2.HBZones)

replace_23 = ReplaceItems(List=data_113, Item=geo_82, Indices=dispatch_51.ListA, Wrap=False)

# ----
# 10.RESULT RECORDINGS
# AVERAGE
# # of people per building
avr_5 = Average(Input=flatten(division_11))  # disabled
data_191 = Data(avr_5)  # disabled
rec = DataRecorder(data_191, DataLimit=-10, RecordData=True)  # disabled
panel_477 = Panel(rec)  # disabled

# ----
# # of people per sqm at unit
data_192 = Data(flatten(division_11))  # disabled
rec_2 = DataRecorder(data_192, DataLimit=-10, RecordData=True)  # disabled
panel_478 = Panel(rec_2)  # disabled

# ----
# scheduleRecord
# Occ
data_193 = Data(flatten(item_128))  # disabled
rec_3 = DataRecorder(data_193, DataLimit=-10, RecordData=True)  # disabled
panel_479 = Panel(rec_3)  # disabled

data_194 = Data(flatten(division_11))

# ----
# indices of all residentials
listdexs_12 = ListIndices(List=geo_81)
dispatch_55 = Dispatch(List=listdexs_12, DispatchPattern=equals_41.Equality)  # -> ListA, ListB

# ----
# Heating set point of Residentials
data_195 = Data(weave_42)

replace_24 = ReplaceItems(List=data_149, Item=data_148, Indices=dispatch_55.ListA, Wrap=False)
replace_25 = ReplaceItems(List=replace_24, Item=data_195, Indices=dispatch_55.ListB, Wrap=False)

# ----
# Occ
data_196 = Data(flatten(item_128))

# ----
# Heating Set Point
panel_480 = Panel("cullOfficeUnits")
equals_44 = Equality(FirstNumber=data_138, SecondNumber="1")  # -> Equality, Inequality
dispatch_56 = Dispatch(List=replace_25, DispatchPattern=equals_44.Equality)  # -> ListA, ListB

# ----
# V1/V2........
# COOLING-ON
# RESIDENTIAL
panel_481 = Panel("residential units")
lb_schedule_4 = GenePool(
    Decimals=0,
    Maximum=100,
    Minimum=24,
    Value=[24, 24, 24, 24, 24, 24, 24, 24, 24, 24, 24, 24, 24, 24, 24, 24, 24, 24, 24, 24, 24, 24, 24, 24])
toggle_15 = BooleanToggle(True)
lb_schedule_5 = GenePool(
    Decimals=0,
    Maximum=100.001,
    Minimum=100,
    Value=[100, 100, 100, 100, 100, 100, 100, 100.001, 100.001, 100.001, 100.001, 100.001, 100.001, 100.001, 100.001, 100.001, 100.001, 100.001, 100.001, 100, 100, 100, 100, 100])
annualschedule_31 = Honeybee_AnnualSchedule(
    sun=lb_schedule_5,
    mon=lb_schedule_5,
    tue=lb_schedule_5,
    wed=lb_schedule_5,
    thu=lb_schedule_5,
    fri=lb_schedule_5,
    sat=lb_schedule_5,
    scheduleName="RESIDENTIAL-COOLING-ON-SCHEDULE",
    schedTypeLimits="Temperature",
    runIt=toggle_15)  # -> readMe, port, schedule, port_2, weekSched, schedIDFText; plug-in component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
analysisperiod_7 = Ladybug_AnalysisPeriod(fromMonth="4", fromDay="15", toMonth="10", toDay="15")  # -> readMe, analysisPeriod; plug-in component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

# ----
# RESIDENTIAL COOLING UNITS
toggle_16 = BooleanToggle(False)
setepnatvent_3 = Honeybee_SetEPAirFlow(
    HBZones=flatten(dispatch_49.ListA),
    naturalVentilationType="1",
    minIndoorTempForNatVent="24.0",
    maxIndoorTempForNatVent="25.0",
    minOutdoorTempForNatVent="12",
    deltaTempForNatVent="0.0",
    fractionOfGlzAreaOperable="0.4",
    windDrivenCrossVent=toggle_16)  # -> readMe, simplify(HBZones); plug-in component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

gethbzoneepschedules = Honeybee_GetZoneEnergyPlusSchedules(HBZone=setepnatvent_3.HBZones)  # -> occupancySchedule, occupancyActivitySch, heatingSetPtSchedule, coolingSetPtSchedule, lightingSchedule, equipmentSchedule, infiltrationSchedule; plug-in component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
item_136 = ListItem(List=gethbzoneepschedules.occupancySchedule, Index=0, Wrap=True)
convertepschvalues_4 = Honeybee_ConvertEnergyPlusScheduleToValues(schName=item_136)  # -> values, holidays; plug-in component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
strnum_6 = Ladybug_SeparateData(inputList=flatten(convertepschvalues_4.values))  # -> numbers, strings; plug-in component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
python_34 = GhPythonScript(x=strnum_6.numbers, y=lb_schedule_4)  # -> out, a
# ---------- python_34: Python ----------
__author__ = "Siser"
__version__ = "2022.03.07"

import rhinoscriptsyntax as rs
if x>0:
    a=y
else:
    a=100
# ---------- end python_34 ----------
annualschedule_32 = Honeybee_AnnualSchedule(
    sun=python_34.a,
    mon=python_34.a,
    tue=python_34.a,
    wed=python_34.a,
    thu=python_34.a,
    fri=python_34.a,
    sat=python_34.a,
    scheduleName="RESIDENTIAL-COOLING-OFF-SCHEDULE",
    schedTypeLimits="Temperature",
    runIt=toggle_15)  # -> readMe, port, schedule, port_2, weekSched, schedIDFText; plug-in component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
honeybee_seasonalschedule_3 = Honeybee_SeasonalSchedule(
    scheduleName="RESIDENTIAL_COOLING_SCHEDULE-ANNUAL",
    schedTypeLimits="Temperature",
    baseWeekSched=annualschedule_31.weekSched,
    seasonWeekSched1=annualschedule_32.weekSched,
    analysisPeriod1=analysisperiod_7.analysisPeriod)  # -> readMe, schedule, schedIDFText; plug-in component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

setepzoneschedules_3 = Honeybee_SetEnergyPlusZoneSchedules(
    HBZones=setepnatvent_3.HBZones,
    heatingSetPtSchedules=weave_43,
    coolingSetPtSchedules=honeybee_seasonalschedule_3.schedule,
    lightingSchedules=item_50)  # -> schedules, simplify(HBZones); plug-in component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

# ----
# geometry of residential cooling
geo_83 = Geometry(setepzoneschedules_3.HBZones)

# ----
# merge residential units
# (i.e., cooling, non-cooling)
# index-based
replace_26 = ReplaceItems(List=replace_23, Item=geo_83, Indices=dispatch_52.ListA, Wrap=False)

dispatch_57 = Dispatch(List=replace_26, DispatchPattern=data_187)  # -> ListA, ListB

null_5 = NullItem(Item=dispatch_57.ListB)  # -> NullFlags, InvalidFlags, Description
dispatch_58 = Dispatch(List=dispatch_57.ListB, DispatchPattern=null_5.NullFlags)  # -> ListA, ListB

ach2m3_s_m2_calculator_2 = Honeybee_infORventPerAreaCalculator(HBZones=flatten(dispatch_58.ListB), airFlowRate="0.5", ACHorM3sM2=boolean_toggle_2)  # -> readMe, infPerAreaFacade, ventPerAreaFloor, allExposed, allFloors; plug-in component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

# ----
# GENERATED
# LIGHTING DENSITY
panel_482 = Panel("# of residential units")
lng_105 = ListLength(List=dispatch_58.ListB)

series_51 = Series(Start=filename, Step=1, Count=lng_105)

# ----
# separate for each residential unit
panel_483 = Panel("""15.05
12.18
15.85
15.05
14.94
14.31
13.43
16.33
14.10
13.87
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""")
panel_484 = Panel("LightingDensity")
item_137 = ListItem(List=panel_483, Index=series_51, Wrap=True)

panel_485 = Panel("Lighting Density")
weave_44 = Weave(Pattern=number_slider_2, Stream0=dup_69, Stream1=dup_69, Stream2=item_137, NullGaps=False)

# ----
# LightingDensity of
# residential Units (kWh/sqm)
data_197 = Data(weave_44)

partition_54 = PartitionList(List=data_87, Size=lng_54)  # -> simplify(Chunks)
cull_i_34 = CullIndex(List=partition_54, Indices=data_88, Wrap=True)  # -> simplify(flatten(List))

item_138 = ListItem(List=cull_i_34, Index=filename, Wrap=True)

python_35 = GhPythonScript(x=item_138)  # -> out, a; inputs x: Int32
# ---------- python_35: Python ----------
__author__ = "Siser"
__version__ = "2022.02.21"

import rhinoscriptsyntax as rs
if x == 1960:
    a = 0.0005
elif x == 1980:
    a = 0.0004
else:
    a = 0.000285
# ---------- end python_35 ----------

# ----
# Infiltration
# Ventilation
# (AS-IS/RETROFIT)
toggle_17 = BooleanToggle(False)
ach2m3_s_m2_calculator_3 = Honeybee_infORventPerAreaCalculator(HBZones=flatten(dispatch_58.ListB), airFlowRate=python_35.a, ACHorM3sM2=toggle_17)  # -> readMe, flatten(infPerAreaFacade), ventPerAreaFloor, allExposed, allFloors; plug-in component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
tstat_18 = TreeStatistics(Tree=item_120)  # -> Paths, Length, Count
partition_55 = PartitionList(List=ach2m3_s_m2_calculator_3.infPerAreaFacade, Size=tstat_18.Length)  # -> simplify(Chunks)

# ----
# RESIDENTIAL UNITS
setepzoneloads_2 = Honeybee_SetEnergyPlusZoneLoads(
    HBZones=dispatch_58.ListB,
    equipmentLoadPerArea=geteploads.equipmentLoadPerArea,
    infilRatePerArea_Facade=partition_55,
    lightingDensityPerArea=weave_44,
    numOfPeoplePerArea=geteploads.numOfPeoplePerArea,
    ventilationPerArea=ach2m3_s_m2_calculator_2.ventPerAreaFloor,
    ventilationPerPerson="0.0001",
    recirculatedAirPerArea=panel_272)  # -> loads, flatten(HBZones); plug-in component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

replace_27 = ReplaceItems(List=data_114, Item=setepzoneloads_2.HBZones, Indices=dispatch_53.ListB, Wrap=False)
replace_28 = ReplaceItems(List=replace_27, Item=setepzoneloads.HBZones, Indices=dispatch_53.ListA, Wrap=False)

# ----
# exclude intersected surface's zone
# 
# merge all units
# - unconditioned units are always at the end
merge_95 = Merge(Data1=flatten(replace_28), Data2=flatten(conditionedunconditioned_2.unconditionedZones))
null_6 = NullItem(Item=merge_95)  # -> NullFlags, InvalidFlags, Description
dispatch_59 = Dispatch(List=merge_95, DispatchPattern=null_6.NullFlags)  # -> ListA, ListB

# ----
# construction type division,
# masonry or
# concrete
partition_56 = PartitionList(List=data_153, Size=tstat_5.Length)  # -> simplify(Chunks)
cull_i_35 = CullIndex(List=simplify(partition_56), Indices=simplify(data_103), Wrap=True)  # -> simplify(flatten(List))
item_139 = ListItem(List=cull_i_35, Index=data_115, Wrap=True)
equals_45 = Equality(FirstNumber=item_139, SecondNumber="0")  # -> Equality, Inequality
dispatch_60 = Dispatch(List=dispatch_59.ListB, DispatchPattern=equals_45.Equality)  # -> ListA, ListB

# ----
# if buildings' construction type concrete
geo_84 = Geometry(dispatch_60.ListB)

# ----
# if buildings' construction type masonry
geo_85 = Geometry(dispatch_60.ListA)

panel_486 = Panel("construction Date")
data_198 = Data(item_138)

# ----
# Colibri
panel_487 = Panel("2000")
img_setting = ImageSetting(ImageSaveAsName="defaultName", Width=panel_487, Height=panel_487)

data_199 = Data(filename)

zoneattributelist = Honeybee_ZoneAttributeList({"Name": "name", "Zone Program": "zoneProgram", "Zone Floor Area": "zoneFloorArea", "Zone Volume": "zoneVolume", "Building Program": "bldgProgram", "Is Conditioned": "isConditioned", "HVAC System Type": "HVACSystem", "Occupancy Schedule": "occupancySchedule", "Occupancy Activity Schedule": "occupancyActivitySch", "Heating SetPoint Schedule": "heatingSetPtSchedule"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}, selected="Name")

# ----
# Insulated
# Flat roof
# Ankara
panel_488 = Panel("Alci siva")
base_2 = Panel("0.121445")
epopaquemat_4 = Honeybee_EnergyPlusOpaqueMaterial(name=panel_488, thickness="0.02", conductivity="0.51", density="1200", specificHeat="1090")  # -> EPMaterial; plug-in component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
epopaquemat_5 = Honeybee_EnergyPlusOpaqueMaterial(name="Betonarme", thickness="0.12", conductivity="2.5", density="2400", specificHeat="840")  # -> EPMaterial; plug-in component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
merge_96 = Merge(Data1="Generated_Roof", Data2=filename)
join_24 = TextJoin(Text=merge_96)

panel_489 = Panel("conductivityOfInsulationMaterial")
data_200 = Data("0.04")

# ----
# R value summation for all other lements of the construction
decomposeepmaterial = Honeybee_DecomposeEPMaterial(materialName=simplify("Betonarme"))  # -> names, values, comments, UValue_SI, UValue_IP, RValue_SI, RValue_IP; plug-in component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
decomposeepmaterial_2 = Honeybee_DecomposeEPMaterial(materialName=simplify(panel_488))  # -> names, values, comments, UValue_SI, UValue_IP, RValue_SI, RValue_IP; plug-in component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

merge_97 = Merge(Data2=decomposeepmaterial.RValue_SI, Data3=decomposeepmaterial_2.RValue_SI)
ma_5 = MassAddition(Input=merge_97)  # -> Result, PartialResults

division_12 = Division(A="1", B=data_119)
subtraction_5 = Subtraction(A=division_12, B=ma_5.Result)
multiplication_14 = Multiplication(A=subtraction_5, B=data_200)

data_201 = Data(multiplication_14)
epopaquemat_6 = Honeybee_EnergyPlusOpaqueMaterial(name="Cam yunu cati yalitim", thickness=data_201, conductivity="0.04", density="18", specificHeat="1030")  # -> EPMaterial; plug-in component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
epconstruction_3 = Honeybee_EnergyPlusConstruction(name=join_24, layer_1=epopaquemat_6, layer_2=epopaquemat_5, layer_3=epopaquemat_4)  # -> EPConstruction; plug-in component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

thickness_of_insulation_material = Panel(multiplication_14)

# ----
# Thickness of Insulation Material
base_3 = Panel("0.0477")

# ----
# Ankara
panel_490 = Panel("dis siva cimento esasli")
epopaquemat_7 = Honeybee_EnergyPlusOpaqueMaterial(name="ic siva alci esasli", thickness="0.02", conductivity="0.51", density="1200", specificHeat="1090")  # -> EPMaterial; plug-in component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
epopaquemat_8 = Honeybee_EnergyPlusOpaqueMaterial(name="yatay delikli tugla", thickness="0.135", conductivity="0.33", density="600", specificHeat="900")  # -> EPMaterial; plug-in component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
epopaquemat_9 = Honeybee_EnergyPlusOpaqueMaterial(name=panel_490, thickness="0.03", conductivity="1.6", density="2000", specificHeat="840")  # -> EPMaterial; plug-in component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
merge_98 = Merge(Data1="GeneratedWall", Data2=filename)
join_25 = TextJoin(Text=merge_98)

# ----
# R value summation for all other lements of the construction
decomposeepmaterial_3 = Honeybee_DecomposeEPMaterial(materialName=simplify("ic siva alci esasli"))  # -> names, values, comments, UValue_SI, UValue_IP, RValue_SI, RValue_IP; plug-in component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
decomposeepmaterial_4 = Honeybee_DecomposeEPMaterial(materialName=simplify(panel_490))  # -> names, values, comments, UValue_SI, UValue_IP, RValue_SI, RValue_IP; plug-in component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
decomposeepmaterial_5 = Honeybee_DecomposeEPMaterial(materialName=simplify("yatay delikli tugla"))  # -> names, values, comments, UValue_SI, UValue_IP, RValue_SI, RValue_IP; plug-in component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

merge_99 = Merge(Data1=decomposeepmaterial_4.RValue_SI, Data2=decomposeepmaterial_5.RValue_SI, Data3=decomposeepmaterial_3.RValue_SI)
ma_6 = MassAddition(Input=merge_99)  # -> Result, PartialResults

data_202 = Data("0.035")

division_13 = Division(A="1", B=data_121)
subtraction_6 = Subtraction(A=division_13, B=ma_6.Result)
multiplication_15 = Multiplication(A=subtraction_6, B=data_202)

data_203 = Data(multiplication_15)

epopaquemat_10 = Honeybee_EnergyPlusOpaqueMaterial(name="EPS", thickness=data_203, conductivity="0.035", density="22", specificHeat="1500")  # -> EPMaterial; plug-in component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

decomposeepconstruction_2 = Honeybee_DecomposeEPConstruction(cnstrName=join_25)  # -> materials, comments, UValue_SI, UValue_IP, RValue_SI, RValue_IP; plug-in component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
panel_492 = Panel(decomposeepconstruction_2.UValue_SI)

# ----
# External wall
epconstruction_4 = Honeybee_EnergyPlusConstruction(name=join_25, layer_1=epopaquemat_9, layer_2=epopaquemat_10, layer_3=epopaquemat_8, layer_4=epopaquemat_7)  # -> EPConstruction; plug-in component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
thickness_of_insulation_material_2 = Panel(multiplication_15)

data_204 = Data("0.035")

# ----
# references: https://docs.google.com/spreadsheets/d/1WwH0E2wul-ns8CfgSEfoPrmkpj9kjO-c/edit#gid=1172685997
# Thickness of Insulation Material
base_4 = Panel("0.05")

epopaquemat_11 = Honeybee_EnergyPlusOpaqueMaterial(name="externalPlaster", thickness="0.02", conductivity="0.721", density="1762", specificHeat="840")  # -> EPMaterial; plug-in component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
epopaquemat_12 = Honeybee_EnergyPlusOpaqueMaterial(name="solidBrick", thickness="0.2", conductivity="0.5", density="1200", specificHeat="800")  # -> EPMaterial; plug-in component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
epopaquemat_13 = Honeybee_EnergyPlusOpaqueMaterial(name="internalPlaster", thickness="0.02", conductivity="0.51", density="1200", specificHeat="840")  # -> EPMaterial; plug-in component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
merge_100 = Merge(Data1="masonry_wall", Data2=filename)
join_26 = TextJoin(Text=merge_100)

# ----
# R value summation for all other lements of the construction
decomposeepmaterial_6 = Honeybee_DecomposeEPMaterial(materialName=simplify("internalPlaster"))  # -> names, values, comments, UValue_SI, UValue_IP, RValue_SI, RValue_IP; plug-in component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
decomposeepmaterial_7 = Honeybee_DecomposeEPMaterial(materialName=simplify("externalPlaster"))  # -> names, values, comments, UValue_SI, UValue_IP, RValue_SI, RValue_IP; plug-in component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
decomposeepmaterial_8 = Honeybee_DecomposeEPMaterial(materialName=simplify("solidBrick"))  # -> names, values, comments, UValue_SI, UValue_IP, RValue_SI, RValue_IP; plug-in component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

merge_101 = Merge(Data1=decomposeepmaterial_7.RValue_SI, Data2=decomposeepmaterial_8.RValue_SI, Data3=decomposeepmaterial_6.RValue_SI)
ma_7 = MassAddition(Input=merge_101)  # -> Result, PartialResults

data_205 = Data("0.035")

division_14 = Division(A="1", B=data_123)
subtraction_7 = Subtraction(A=division_14, B=ma_7.Result)
multiplication_16 = Multiplication(A=subtraction_7, B=data_205)

data_206 = Data(multiplication_16)

epopaquemat_14 = Honeybee_EnergyPlusOpaqueMaterial(name="EPS", thickness=data_206, conductivity="0.035", density="22", specificHeat="1400")  # -> EPMaterial; plug-in component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
epconstruction_5 = Honeybee_EnergyPlusConstruction(name=join_26, layer_1=epopaquemat_11, layer_2=epopaquemat_14, layer_3=epopaquemat_12, layer_4=epopaquemat_13)  # -> EPConstruction; plug-in component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

thickness_of_insulation_material_3 = Panel(multiplication_16)

# ----
# V1-Masonry Construction Set
# V1-Concrete Construction Set
setepzonecnstr = Honeybee_SetEPZoneConstruction(HBZones=flatten(geo_84), wallEPConstruction=epconstruction_4, roofEPConstruction=epconstruction_3)  # -> simplify(modifiedHBZones); plug-in component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

epopaquemat_15 = Honeybee_EnergyPlusOpaqueMaterial(name="kece polyester", thickness="0.003", conductivity="0.19", density="25", specificHeat="1500")  # -> EPMaterial; plug-in component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
epopaquemat_16 = Honeybee_EnergyPlusOpaqueMaterial(name="koruma sapi", thickness="0.05", conductivity="1.4", density="2000", specificHeat="837")  # -> EPMaterial; plug-in component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
epopaquemat_17 = Honeybee_EnergyPlusOpaqueMaterial(name="laminant parke", thickness="0.008", conductivity="0.115", density="938", specificHeat="1600")  # -> EPMaterial; plug-in component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
epopaquemat_18 = Honeybee_EnergyPlusOpaqueMaterial(name="Su yalitimi", thickness="0.003", conductivity="0.19", density="3000", specificHeat="780")  # -> EPMaterial; plug-in component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
epopaquemat_19 = Honeybee_EnergyPlusOpaqueMaterial(name="Dolgu cakil", thickness="0.1", conductivity="2.0", density="2000", specificHeat="840")  # -> EPMaterial; plug-in component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
epopaquemat_20 = Honeybee_EnergyPlusOpaqueMaterial(name="Grobeton", thickness="0.1", conductivity="1.65", density="2200", specificHeat="860")  # -> EPMaterial; plug-in component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
epopaquemat_21 = Honeybee_EnergyPlusOpaqueMaterial(name="Koruma betonu", thickness="0.1", conductivity="1.65", density="2200", specificHeat="860")  # -> EPMaterial; plug-in component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

merge_102 = Merge(Data1="generatedGroundFloor", Data2=filename)
join_27 = TextJoin(Text=merge_102)

decomposeepconstruction_3 = Honeybee_DecomposeEPConstruction(cnstrName=join_27)  # -> materials, comments, UValue_SI, UValue_IP, RValue_SI, RValue_IP; plug-in component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
panel_495 = Panel(decomposeepconstruction_3.UValue_SI)

# ----
# R value summation for all other lements of the construction
decomposeepmaterial_9 = Honeybee_DecomposeEPMaterial(materialName=simplify("Su yalitimi"))  # -> names, values, comments, UValue_SI, UValue_IP, RValue_SI, RValue_IP; plug-in component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
decomposeepmaterial_10 = Honeybee_DecomposeEPMaterial(materialName=simplify("Dolgu cakil"))  # -> names, values, comments, UValue_SI, UValue_IP, RValue_SI, RValue_IP; plug-in component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
decomposeepmaterial_11 = Honeybee_DecomposeEPMaterial(materialName=simplify("kece polyester"))  # -> names, values, comments, UValue_SI, UValue_IP, RValue_SI, RValue_IP; plug-in component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
decomposeepmaterial_12 = Honeybee_DecomposeEPMaterial(materialName=simplify("Grobeton"))  # -> names, values, comments, UValue_SI, UValue_IP, RValue_SI, RValue_IP; plug-in component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
decomposeepmaterial_13 = Honeybee_DecomposeEPMaterial(materialName=simplify("kece polyester"))  # -> names, values, comments, UValue_SI, UValue_IP, RValue_SI, RValue_IP; plug-in component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
decomposeepmaterial_14 = Honeybee_DecomposeEPMaterial(materialName=simplify("laminant parke"))  # -> names, values, comments, UValue_SI, UValue_IP, RValue_SI, RValue_IP; plug-in component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
decomposeepmaterial_15 = Honeybee_DecomposeEPMaterial(materialName=simplify("Koruma betonu"))  # -> names, values, comments, UValue_SI, UValue_IP, RValue_SI, RValue_IP; plug-in component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
decomposeepmaterial_16 = Honeybee_DecomposeEPMaterial(materialName=simplify("koruma sapi"))  # -> names, values, comments, UValue_SI, UValue_IP, RValue_SI, RValue_IP; plug-in component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

merge_103 = Merge(
    Data1=decomposeepmaterial_10.RValue_SI,
    Data2=decomposeepmaterial_12.RValue_SI,
    Data3=decomposeepmaterial_9.RValue_SI,
    Data4=decomposeepmaterial_15.RValue_SI,
    Data5=decomposeepmaterial_11.RValue_SI,
    Data6=decomposeepmaterial_13.RValue_SI,
    Data7=decomposeepmaterial_16.RValue_SI,
    Data8=decomposeepmaterial_14.RValue_SI)
ma_8 = MassAddition(Input=merge_103)  # -> Result, PartialResults

division_15 = Division(A="1", B=data_128)
subtraction_8 = Subtraction(A=division_15, B=ma_8.Result)
multiplication_17 = Multiplication(A=subtraction_8, B=data_204)

epopaquemat_22 = Honeybee_EnergyPlusOpaqueMaterial(name="XPS", thickness=multiplication_17, conductivity="0.035", density="25", specificHeat="1200")  # -> EPMaterial; plug-in component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
epconstruction_6 = Honeybee_EnergyPlusConstruction(
    name=join_27,
    layer_1=epopaquemat_19,
    layer_2=epopaquemat_20,
    layer_3=epopaquemat_18,
    layer_4=epopaquemat_21,
    layer_5=epopaquemat_22,
    layer_6=epopaquemat_15,
    layer_7=epopaquemat_16,
    layer_8=epopaquemat_17)  # -> EPConstruction; plug-in component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

thickness_of_insulation_material_4 = Panel(multiplication_17)

# ----
# U-value-GroundFloor of Building
decomposeepconstruction_4 = Honeybee_DecomposeEPConstruction(cnstrName=join_27)  # -> materials, comments, UValue_SI, UValue_IP, RValue_SI, RValue_IP; plug-in component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
lng_106 = ListLength(List=branch_12)
data_207 = Data(decomposeepconstruction_4.UValue_SI)
dup_70 = DuplicateData(Data=data_207, Number=lng_106, Order=True)

equals_46 = Equality(FirstNumber=data_138, SecondNumber="1")  # -> Equality, Inequality
dispatch_61 = Dispatch(List=dup_70, DispatchPattern=equals_46.Equality)  # -> ListA, ListB

# ----
# references: https://docs.google.com/spreadsheets/d/1WwH0E2wul-ns8CfgSEfoPrmkpj9kjO-c/edit#gid=1172685997
panel_497 = Panel("reinforcedConcrete")
panel_498 = Panel("0.08")
epopaquemat_23 = Honeybee_EnergyPlusOpaqueMaterial(name=panel_497, thickness="0.12", conductivity="2.5", density="2400", specificHeat="860")  # -> EPMaterial; plug-in component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
epopaquemat_24 = Honeybee_EnergyPlusOpaqueMaterial(name="externalPlaster", thickness="0.02", conductivity="0.721", density="1762", specificHeat="840")  # -> EPMaterial; plug-in component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
epopaquemat_25 = Honeybee_EnergyPlusOpaqueMaterial(name="interPlaster", thickness="0.02", conductivity="0.51", density="1200", specificHeat="840")  # -> EPMaterial; plug-in component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
merge_104 = Merge(Data1="roofForMasonry", Data2=filename)
join_28 = TextJoin(Text=merge_104)

# ----
# R value summation for all other lements of the construction
decomposeepmaterial_17 = Honeybee_DecomposeEPMaterial(materialName=simplify("interPlaster"))  # -> names, values, comments, UValue_SI, UValue_IP, RValue_SI, RValue_IP; plug-in component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
decomposeepmaterial_18 = Honeybee_DecomposeEPMaterial(materialName=simplify("externalPlaster"))  # -> names, values, comments, UValue_SI, UValue_IP, RValue_SI, RValue_IP; plug-in component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
decomposeepmaterial_19 = Honeybee_DecomposeEPMaterial(materialName=simplify(panel_497))  # -> names, values, comments, UValue_SI, UValue_IP, RValue_SI, RValue_IP; plug-in component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

merge_105 = Merge(Data1=decomposeepmaterial_18.RValue_SI, Data2=decomposeepmaterial_19.RValue_SI, Data3=decomposeepmaterial_17.RValue_SI)
ma_9 = MassAddition(Input=merge_105)  # -> Result, PartialResults

data_208 = Data("0.04")

division_16 = Division(A="1", B=data_125)
subtraction_9 = Subtraction(A=division_16, B=ma_9.Result)
multiplication_18 = Multiplication(A=subtraction_9, B=data_208)

data_209 = Data(multiplication_18)
epopaquemat_26 = Honeybee_EnergyPlusOpaqueMaterial(name="glassWool", thickness=data_209, conductivity="0.04", density="18", specificHeat="670")  # -> EPMaterial; plug-in component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
epconstruction_7 = Honeybee_EnergyPlusConstruction(name=join_28, layer_1=epopaquemat_24, layer_2=epopaquemat_26, layer_3=epopaquemat_23, layer_4=epopaquemat_25)  # -> EPConstruction; plug-in component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

# ----
# u-valueCalculationofMaterial: Where R = Material Thickness (m) ÷ Thermal Conductivity (W/mK)
# 
# 
# https://www.tatasteeleurope.com/construction/blogs-news/blogs/blog/how-to-calculate-the-u-value-of-a-construction
thickness_of_insulation_material_5 = Panel(multiplication_18)

decomposeepconstruction_5 = Honeybee_DecomposeEPConstruction(cnstrName=join_28)  # -> materials, comments, UValue_SI, UValue_IP, RValue_SI, RValue_IP; plug-in component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
panel_500 = Panel(decomposeepconstruction_5.UValue_SI)

setepzonecnstr_2 = Honeybee_SetEPZoneConstruction(HBZones=flatten(geo_85), wallEPConstruction=epconstruction_5, roofEPConstruction=epconstruction_7)  # -> simplify(modifiedHBZones); plug-in component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
merge_106 = Merge(Data1=setepzonecnstr_2, Data2=setepzonecnstr)  # -> flatten(Result)
null_7 = NullItem(Item=merge_106)  # -> NullFlags, InvalidFlags, Description
dispatch_62 = Dispatch(List=merge_106, DispatchPattern=null_7.NullFlags)  # -> ListA, ListB
setepzoneundergroundcnstr = Honeybee_SetEPZoneUndergroundConstruction(HBZones=dispatch_62.ListB, groundFloorEPConstruction=epconstruction_6)  # -> simplify(modifiedHBZones); plug-in component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

lng_107 = ListLength(List=dispatch_62.ListB)
dup_71 = DuplicateData(Data=data_199, Number=lng_107, Order=True)
rec_4 = DataRecorder(dup_71, DataLimit=-10, RecordData=True)
panel_501 = Panel(rec_4)

# ----
# 07.CONSTRUCTION
# FOR ENERGY MODELING
# 07.CONSTRUCTION
# FOR ENERGY MODELING
# V1 CONSTRUCTIONS
setepzoneintcnstr = Honeybee_SetEPZoneInteriorConstruction(HBZones=setepzoneundergroundcnstr, intWallEPConstruction=epconstruction_2)  # -> simplify(modifiedHBZones); plug-in component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

conditionedunconditioned_3 = Honeybee_SeparateConditionedAndUnconditionedZones(HBZones=flatten(setepzoneintcnstr))  # -> conditionedZones, unconditionedZones; plug-in component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

conditionedunconditioned_4 = Honeybee_SeparateConditionedAndUnconditionedZones(HBZones=flatten(dispatch_62.ListB))  # -> conditionedZones, unconditionedZones; plug-in component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
panel_502 = Panel("simulated thermal zones")

# ----
# Internal Mass Calculation
debrep_13 = DeconstructBrep(Brep=conditionedunconditioned_3.conditionedZones)  # -> Faces, Edges, Vertices
item_140 = ListItem(List=debrep_13.Faces, Index=0, Wrap=True)  # -> simplify(graft(Item))
md_slider_7 = MDSlider(SliderMode=0, slider_value=Point(0.5, 0.5, 0.5), x_domain=Domain(0, 1), y_domain=Domain(0, 1), z_domain=Domain(0, 1))
evalsrf_4 = EvaluateSurface(Surface=item_140, Point=md_slider_7)  # -> Point, Normal, UDirection, VDirection, Frame
brec_8 = BoundingRectangle(Geometry=item_140, Plane=evalsrf_4.Frame, Axis=0, Slide=0, Union=True)  # -> Bounding, DimensionX, DimensionY
debrep_14 = DeconstructBrep(Brep=brec_8.Bounding)  # -> Faces, Edges, Vertices
shift_5 = ShiftList(List=debrep_14.Edges, Shift=1, Wrap=True)
panel_503 = Panel("""0
2""")
item_141 = ListItem(List=debrep_14.Edges, Index=panel_503, Wrap=True)  # -> simplify(Item)
item_142 = ListItem(List=shift_5, Index=panel_503, Wrap=True)  # -> simplify(Item)
curvepoint_6 = PointOnCurve(item_141, parameter=0.5)
curvepoint_7 = PointOnCurve(item_142, parameter=0.5)
item_143 = ListItem(List=curvepoint_6, Index=1, Wrap=True)
item_144 = ListItem(List=curvepoint_7, Index=0, Wrap=True)
item_145 = ListItem(List=curvepoint_7, Index=1, Wrap=True)
item_146 = ListItem(List=curvepoint_6, Index=0, Wrap=True)
ln_3 = Line(StartPoint=item_144, EndPoint=item_145)  # -> simplify(Line)
ln_4 = Line(StartPoint=item_146, EndPoint=item_143)  # -> simplify(Line)
len_2 = Length(Curve=ln_3)  # -> simplify(Length)
len_3 = Length(Curve=ln_4)
division_17 = Division(A=simplify(len_2), B="2")  # -> simplify(Result)
floor_height_6 = Panel("3")

tstat_19 = TreeStatistics(Tree=simplify(len_3))  # -> Paths, Length, Count
tstat_20 = TreeStatistics(Tree=simplify(division_17))  # -> Paths, Length, Count
panel_504 = Panel("replace Path")
replace_29 = ReplacePaths(Data=division_17, Search=tstat_20.Paths, Replace=tstat_19.Paths)

merge_107 = Merge(Data1=simplify(len_3), Data2=simplify(replace_29))  # -> simplify(Result)
ma_10 = MassAddition(Input=merge_107)  # -> Result, PartialResults
multiplication_19 = Multiplication(A=ma_10.Result, B=floor_height_6)  # -> flatten(Result)

# ----
# internal Mass Added Units
addinternalmass = Honeybee_AddInternalMassToZone(HBZones=conditionedunconditioned_3.conditionedZones, srfsOrSrfArea=multiplication_19, EPConstruction=epconstruction_2)  # -> readMe, HBZones; plug-in component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
merge_108 = Merge(Data1=flatten(addinternalmass.HBZones), Data2=flatten(conditionedunconditioned_3.unconditionedZones))

geo_86 = Geometry(merge_108)  # disabled
volume_3 = Volume(Geometry=geo_86)  # -> Volume, Centroid; disabled
pdecon_15 = Deconstruct(Point=volume_3.Centroid)  # -> XComponent, YComponent, ZComponent; disabled
sort_23 = SortList(Keys=pdecon_15.ZComponent, ValuesA=geo_86)  # -> Keys, ValuesA; disabled

# ----
# sort conditioned zones according to z-axis value
# # of unit per floor
lng_108 = ListLength(List=sort_23.ValuesA)  # disabled
division_18 = Division(A=lng_108, B=lng_84)  # disabled
partition_57 = PartitionList(List=sort_23.ValuesA, Size=division_18)  # -> simplify(Chunks); disabled

volume_4 = Volume(Geometry=partition_57)  # -> Volume, Centroid; disabled
area_60 = Area(Geometry=geo_68)  # -> Area, Centroid; disabled
circle_3 = CircleCNR(Center=area_60.Centroid, Normal=Vector(0, 0, 1), Radius=1)  # disabled
alongcrv_2 = SortAlongCurve(Points=volume_4.Centroid, Curve=circle_3)  # -> Points, simplify(Indices); disabled

# ----
# start bottom-left
# return counter clockwise
item_147 = ListItem(List=partition_57, Index=alongcrv_2.Indices, Wrap=True)  # disabled

volume_5 = Volume(Geometry=item_147)  # -> Volume, Centroid; disabled
pdecon_16 = Deconstruct(Point=volume_5.Centroid)  # -> XComponent, YComponent, ZComponent; disabled
addition_8 = Addition(A=pdecon_16.XComponent, B=pdecon_16.YComponent)  # disabled
sort_24 = SortList(Keys=addition_8, ValuesA=volume_5.Centroid)  # -> Keys, ValuesA; disabled
item_148 = ListItem(List=sort_24.ValuesA, Index=0, Wrap=True)  # -> simplify(Item); disabled

lng_109 = ListLength(List=item_147)  # disabled
panel_505 = Panel("0")  # disabled
branch_20 = TreeBranch(Tree=simplify(item_147), Path=panel_505, MaintainPaths=True)  # disabled
python_36 = GhPythonScript(x=lng_109)  # -> out, a; disabled
# ---------- python_36: Python ----------
__author__ = "orcun"
__version__ = "2022.03.23"

import rhinoscriptsyntax as rs
if x == 1:
    a = 1
else:
    a = 0
# ---------- end python_36 ----------
weave_45 = Weave(Pattern=python_36.a, Stream0=branch_20, Stream1=item_147, NullGaps=False)  # disabled

panel_506 = Panel("0")  # disabled
lng_110 = ListLength(List=item_148)  # disabled
branch_21 = TreeBranch(Tree=item_148, Path=panel_506, MaintainPaths=True)  # disabled
python_37 = GhPythonScript(x=lng_110)  # -> out, a; disabled; same code as python_36
weave_46 = Weave(Pattern=python_37.a, Stream0=branch_21, Stream1=item_148, NullGaps=False)  # disabled

volume_6 = Volume(Geometry=weave_45)  # -> Volume, Centroid; disabled
cp_6 = ClosestPoint(Point=weave_46, Cloud=volume_6.Centroid)  # -> ClosestPoint, CPIndex, Distance; disabled

# ----
# start bottom-left
# return counter clockwise
shift_6 = ShiftList(List=item_147, Shift=cp_6.CPIndex, Wrap=True)  # disabled

panel_507 = Panel("simulation units")  # disabled
merge_109 = Merge(Data1=flatten(shift_6), Data2=conditionedunconditioned_3.unconditionedZones)  # -> flatten(Result); disabled

conditionedunconditioned_5 = Honeybee_SeparateConditionedAndUnconditionedZones(HBZones=flatten(merge_108))  # -> conditionedZones, unconditionedZones; plug-in component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

conditionedunconditioned_6 = Honeybee_SeparateConditionedAndUnconditionedZones(HBZones=flatten(merge_108))  # -> conditionedZones, unconditionedZones; plug-in component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

conditionedunconditioned_7 = Honeybee_SeparateConditionedAndUnconditionedZones(HBZones=flatten(merge_108))  # -> simplify(conditionedZones), unconditionedZones; plug-in component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
decomposebytype = Honeybee_DecomposeBasedOnType(HBZone=conditionedunconditioned_7.conditionedZones)  # -> walls, interiorWalls, airWalls, simplify(windows), interiorWindows, skylights, simplify(roofs), simplify(ceilings)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; plug-in component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

# ----
# x
# x
# x
# x
# x
# x
# x
# x
# x
# x
# x
# x
# x
# x
# x
# x
# x
# x
# x
# x
# x
# x
# x
# x
# x
# x
# x
# 
# x
# x
# x
# x
# x
# x
# 
# x
# x
# x
# x
# x
# 
# x
# x
# x
# x
# x
# x
# 
# x
# x
# x
# x
panel_510 = Panel("conditioned zones")
data_210 = Data(conditionedunconditioned_7.conditionedZones)
decomposebytype_2 = Honeybee_DecomposeBasedOnType(HBZone=data_210)  # -> walls, interiorWalls, airWalls, simplify(windows), interiorWindows, skylights, simplify(roofs), simplify(ceilings)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; plug-in component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

area_61 = Area(Geometry=decomposebytype_2.windows)  # -> Area, Centroid
evalsrf_5 = EvaluateSurface(Surface=decomposebytype_2.windows, Point=area_61.Centroid)  # -> Point, Normal, UDirection, VDirection, Frame
vec = Vector(evalsrf_5.Normal)
vdis = VectorDisplay(Anchor=area_61.Centroid, Vector=vec)

area_62 = Area(Geometry=decomposebytype_2.windows)  # -> Area, Centroid
circle_4 = CircleCNR(Center=area_62.Centroid, Normal=vec, Radius=1)
rotate = RotateDirection(Geometry=circle_4, Center=area_62.Centroid, From=Vector(1, 0, 0), To=Vector(0, 1, 0))  # -> Geometry, Transform
line = LineSDL(Start=area_61.Centroid, Direction=vec, Length=1)
rotax = RotateAxis(Geometry=rotate.Geometry, Angle=degrees("90"), Axis=line)  # -> Geometry, Transform
area_63 = Area(Geometry=rotax.Geometry)  # -> Area, Centroid

srf_3 = Surface(decomposebytype_2.windows)
split_14 = SplitWithBreps(Curve=rotax.Geometry, Brep=srf_3)  # -> Curve, Points
divide_5 = DivideCurve(Curve=split_14.Curve, Count="13", Kinks=False)  # -> Points, Tangents, Parameters
pshift = ShiftPaths(Data=divide_5.Points, Offset=-1)
brepsinc = PointInBreps(Brep=conditionedunconditioned_7.conditionedZones, Point=pshift, Strict=False)  # -> Inside, Index
dispatch_63 = Dispatch(List=pshift, DispatchPattern=brepsinc.Inside)  # -> ListA, ListB

lng_111 = ListLength(List=flatten(conditionedunconditioned_7.conditionedZones))
panel_511 = Panel("#OfUnits")
dup_72 = DuplicateData(Data="0", Number=lng_111, Order=True)

area_64 = Area(Geometry=decomposebytype.windows)  # -> Area, Centroid
panel_512 = Panel("Window")

lng_112 = ListLength(List=decomposebytype.roofs)  # -> flatten(Length)

lng_113 = ListLength(List=decomposebytype.groundFloors)  # -> flatten(Length)

panel_513 = Panel(area_62.Centroid)
pdecon_17 = Deconstruct(Point=panel_513)  # -> XComponent, YComponent, graft(ZComponent)
panel_514 = Panel(pdecon_17.ZComponent)

dup_73 = DuplicateData(Data="0", Number=lng_113, Order=True)  # -> simplify(Data)
dup_74 = DuplicateData(Data="2", Number=lng_112, Order=True)  # -> simplify(Data)
merge_110 = Merge(Data1=dup_74, Data2=dup_73)

tstat_21 = TreeStatistics(Tree=area_64.Centroid)  # -> Paths, Length, Count
series_52 = Series(Start=0, Step=1, Count="4")
lng_114 = ListLength(List=tstat_21.Length)
dup_75 = DuplicateData(Data=series_52, Number=lng_114, Order=True)
partition_58 = PartitionList(List=dup_75, Size="4")  # -> simplify(Chunks)

panel_515 = Panel("conditioned residential units")
geo_87 = Geometry(conditionedunconditioned_7.conditionedZones)

lng_115 = ListLength(List=merge_110)  # -> flatten(Length)
# position of units
# (0:base, 1: middle, 2:roof)
rep_2 = ReplaceText(Text=lng_115, Find="3", Replace="0", RecursiveReplace=False)
mindex_7 = MemberIndex(Set=rep_2, Member="0")  # -> Index, Count
lng_116 = ListLength(List=mindex_7.Index)
dup_76 = DuplicateData(Data="3", Number=lng_116, Order=True)
partition_59 = PartitionList(List=dup_76, Size="1")  # -> simplify(Chunks)
tstat_22 = TreeStatistics(Tree=partition_59)  # -> Paths, Length, Count
replace_30 = ReplacePaths(Data=partition_59, Search=tstat_22.Paths, Replace=mindex_7.Index)
python_38 = GhPythonScript(x=replace_30)  # -> out, a; inputs x: Int32
# ---------- python_38: Python ----------
__author__ = "Siser"
__version__ = "2022.03.02"

import rhinoscriptsyntax as rs
if x == 3:
    a = 1
else:
    pass
# ---------- end python_38 ----------

lng_117 = ListLength(List=dup_75)
dup_77 = DuplicateData(Data="5", Number=lng_117, Order=True)
partition_60 = PartitionList(List=dup_77, Size="4")  # -> simplify(Chunks)

debrep_15 = DeconstructBrep(Brep=geo_87)  # -> Faces, Edges, Vertices
item_149 = ListItem(List=debrep_15.Faces, Index=0, Wrap=True)
evalsrf_6 = EvaluateSurface(Surface=reparameterize(item_149), Point="{0.5, 0.5, 0}")  # -> Point, Normal, UDirection, VDirection, Frame
brec_9 = BoundingRectangle(Geometry=item_149, Plane=evalsrf_6.Frame, Axis=0, Slide=0, Union=True)  # -> Bounding, DimensionX, DimensionY

debrep_16 = DeconstructBrep(Brep=brec_9.Bounding)  # -> Faces, simplify(Edges), Vertices
curvepoint_8 = PointOnCurve(debrep_16.Edges, parameter=0.5)
pdecon_18 = Deconstruct(Point=curvepoint_8)  # -> XComponent, YComponent, ZComponent
sort_25 = SortList(Keys=pdecon_18.YComponent, ValuesA=debrep_16.Edges)  # -> Keys, reverse(simplify(ValuesA))
item_150 = ListItem(List=sort_25.ValuesA, Index=0, Wrap=True)
item_151 = ListItem(List=sort_25.ValuesA, Index=1, Wrap=True)
len_4 = Length(Curve=item_150)
len_5 = Length(Curve=item_151)
division_19 = Division(A=len_4, B=len_5)  # -> flatten(Result)

panel_516 = Panel("external Wall")
geo_88 = Geometry(simplify(decomposebytype.walls))

merge_111 = Merge(Data1=merge_110, Data2=python_38.a)  # -> flatten(Result)
panel_517 = Panel(merge_111)
null_8 = NullItem(Item=merge_111)  # -> NullFlags, InvalidFlags, Description
dispatch_64 = Dispatch(List=merge_111, DispatchPattern=null_8.NullFlags)  # -> ListA, ListB

panel_518 = Panel("roof")
geo_89 = Geometry(decomposebytype.roofs)

# ----
# volume of simulated unit
volume_7 = Volume(Geometry=conditionedunconditioned_7.conditionedZones)  # -> Volume, Centroid

merge_112 = Merge(Data1=geo_88, Data2=geo_89)
area_65 = Area(Geometry=merge_112)  # -> Area, Centroid
ma_11 = MassAddition(Input=area_65.Area)  # -> flatten(Result), PartialResults
division_20 = Division(A=ma_11.Result, B=volume_7.Volume)

panel_519 = Panel("simulation units")
geo_90 = Geometry(merge_108)

decomposebytype_3 = Honeybee_DecomposeBasedOnType(HBZone=geo_90)  # -> simplify(walls), interiorWalls, airWalls, simplify(windows), interiorWindows, skylights, simplify(roofs), simplify(ceilings)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; plug-in component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
preview_21 = CustomPreview(Geometry=decomposebytype_3.windows, Material=ColourSwatch(SwatchColor=RGB(0, 72, 255)))
preview_22 = CustomPreview(Geometry=decomposebytype_3.floors, Material=ColourSwatch(SwatchColor=RGB(48, 191, 0)))
preview_23 = CustomPreview(Geometry=decomposebytype_3.walls, Material=ColourSwatch(SwatchColor=RGBA(236, 255, 23, 138)))
preview_24 = CustomPreview(Geometry=decomposebytype_3.roofs, Material=ColourSwatch(SwatchColor=RGBA(191, 89, 0, 174)))
preview_25 = CustomPreview(Geometry=decomposebytype_3.interiorWalls, Material=ColourSwatch(SwatchColor=RGB(121, 0, 191)))
preview_26 = CustomPreview(Geometry=decomposebytype_3.groundFloors, Material=ColourSwatch(SwatchColor=RGB(0, 0, 0)))

labelzones = Honeybee_LabelZones(HBZones=flatten(geo_90), attribute=zoneattributelist)  # -> zoneTxtLabels, labelBasePts, brepTxtLabels, zoneWireFrames; plug-in component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

panel_520 = Panel("conditioned HBzones")
geo_91 = Geometry(conditionedunconditioned_7.conditionedZones)

debrep_17 = DeconstructBrep(Brep=geo_91)  # -> Faces, Edges, Vertices
item_152 = ListItem(List=debrep_17.Faces, Index=0, Wrap=True)

panel_521 = Panel("simulated units")
geo_92 = Geometry(conditionedunconditioned_7.conditionedZones)

area_66 = Area(Geometry=item_152)  # -> simplify(flatten(Area)), Centroid

# ----
# total # of residential units
lng_118 = ListLength(List=geo_90)

# ----
# If there is a single unit in the building
lng_119 = ListLength(List=geo_90)
equals_47 = Equality(FirstNumber=lng_119, SecondNumber="2")  # -> Equality, Inequality
data_211 = Data(flatten(dispatch_64.ListB))
python_39 = GhPythonScript(x=equals_47.Equality)  # -> out, a; inputs x: Boolean
# ---------- python_39: Python ----------
__author__ = "orcun"
__version__ = "2022.04.06"

import rhinoscriptsyntax as rs
if x == True:
    a = 0
else:
    a=1
# ---------- end python_39 ----------
weave_47 = Weave(Pattern=python_39.a, Stream0="0", Stream1=data_211, NullGaps=False)

# ----
# U-value-Roof of Building
decomposeepconstruction_6 = Honeybee_DecomposeEPConstruction(cnstrName=join_24)  # -> materials, comments, UValue_SI, UValue_IP, RValue_SI, RValue_IP; plug-in component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
decomposeepconstruction_7 = Honeybee_DecomposeEPConstruction(cnstrName=join_24)  # -> materials, comments, UValue_SI, UValue_IP, RValue_SI, RValue_IP; plug-in component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
merge_113 = Merge(Data1=decomposeepconstruction_7.UValue_SI, Data2=decomposeepconstruction_6.UValue_SI)
null_9 = NullItem(Item=merge_113)  # -> NullFlags, InvalidFlags, Description
dispatch_65 = Dispatch(List=merge_113, DispatchPattern=null_9.NullFlags)  # -> ListA, ListB
roundd = RoundToDecimalPlace(NumberX=decomposeepconstruction_6.UValue_SI, DecimalPlace="3", RoundType=0)  # -> Rounded, Difference
lng_120 = ListLength(List=conditionedunconditioned_7.conditionedZones)
dup_78 = DuplicateData(Data=roundd.Rounded, Number=lng_120, Order=True)

# ----
# U-value-Wall of Building
decomposeepconstruction_8 = Honeybee_DecomposeEPConstruction(cnstrName=join_25)  # -> materials, comments, UValue_SI, UValue_IP, RValue_SI, RValue_IP; plug-in component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
decomposeepconstruction_9 = Honeybee_DecomposeEPConstruction(cnstrName=join_25)  # -> materials, comments, UValue_SI, UValue_IP, RValue_SI, RValue_IP; plug-in component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
merge_114 = Merge(Data1=decomposeepconstruction_9.UValue_SI, Data2=decomposeepconstruction_8.UValue_SI)
null_10 = NullItem(Item=merge_114)  # -> NullFlags, InvalidFlags, Description
dispatch_66 = Dispatch(List=merge_114, DispatchPattern=null_10.NullFlags)  # -> ListA, ListB
roundd_2 = RoundToDecimalPlace(NumberX=decomposeepconstruction_8.UValue_SI, DecimalPlace="3", RoundType=0)  # -> Rounded, Difference
lng_121 = ListLength(List=conditionedunconditioned_7.conditionedZones)
dup_79 = DuplicateData(Data=roundd_2.Rounded, Number=lng_121, Order=True)

panel_523 = Panel("# of units")
lng_122 = ListLength(List=conditionedunconditioned_7.conditionedZones)

# ----
# If there is an one floor with multiple units
python_40 = GhPythonScript(x=item_86, y=lng_122)  # -> out, a; inputs x: Int32, y: Int32
# ---------- python_40: Python ----------
__author__ = "orcun"
__version__ = "2022.04.06"

import rhinoscriptsyntax as rs
if x == 1 and y!=0:
    a = 1
else:
    a=0
# ---------- end python_40 ----------

partition_61 = PartitionList(List=data_142, Size=data_140)  # -> simplify(Chunks)
cull_i_36 = CullIndex(List=partition_61, Indices=data_141, Wrap=True)  # -> flatten(List)
item_153 = ListItem(List=cull_i_36, Index=filename, Wrap=True)
lng_123 = ListLength(List=conditionedunconditioned_7.conditionedZones)
dup_80 = DuplicateData(Data=flatten(item_153), Number=lng_123, Order=True)

# ----
# Width/Depth ratio of
# Simulated Units
data_212 = Data(division_19)

partition_62 = PartitionList(List=data_143, Size=data_140)  # -> simplify(Chunks)
cull_i_37 = CullIndex(List=partition_62, Indices=data_141, Wrap=True)  # -> flatten(List)
item_154 = ListItem(List=cull_i_37, Index=filename, Wrap=True)
lng_124 = ListLength(List=conditionedunconditioned_7.conditionedZones)
dup_81 = DuplicateData(Data=flatten(item_154), Number=lng_124, Order=True)

equals_48 = Equality(FirstNumber=data_138, SecondNumber="1")  # -> Equality, Inequality
dispatch_67 = Dispatch(List=dup_78, DispatchPattern=equals_48.Equality)  # -> ListA, ListB

equals_49 = Equality(FirstNumber=data_138, SecondNumber="1")  # -> Equality, Inequality
dispatch_68 = Dispatch(List=dup_79, DispatchPattern=equals_49.Equality)  # -> ListA, ListB

dup_82 = DuplicateData(Data="0", Number=lng_122, Order=True)
weave_48 = Weave(Pattern=python_40.a, Stream0=weave_47, Stream1=dup_82, NullGaps=False)

equals_50 = Equality(FirstNumber=data_138, SecondNumber="1")  # -> Equality, Inequality
dispatch_69 = Dispatch(List=data_212, DispatchPattern=equals_50.Equality)  # -> ListA, ListB

equals_51 = Equality(FirstNumber=data_138, SecondNumber="1")  # -> Equality, Inequality
dispatch_70 = Dispatch(List=weave_48, DispatchPattern=equals_51.Equality)  # -> ListA, ListB

# ----
# Infiltration Rate
item_155 = ListItem(List=flatten(ach2m3_s_m2_calculator_3.infPerAreaFacade), Index=0, Wrap=True)
lng_125 = ListLength(List=conditionedunconditioned_7.conditionedZones)
dup_83 = DuplicateData(Data=item_155, Number=lng_125, Order=True)

panel_528 = Panel("conditioned units")
lng_126 = ListLength(List=conditionedunconditioned_7.conditionedZones)

# ----
# BUILDING
panel_529 = Panel("conditioned units")
lng_127 = ListLength(List=conditionedunconditioned_7.conditionedZones)

# ----
# verticalPosition
# (2:base, 3: middle, 4:roof)
rec_5 = DataRecorder(dispatch_70.ListB, DataLimit=-10, RecordData=True)
panel_530 = Panel(rec_5)

# ----
# shgc Window
dup_84 = DuplicateData(Data=data_147, Number=lng_127, Order=True)

# ----
# Construction Date
dup_85 = DuplicateData(Data=data_198, Number=lng_126, Order=True)

equals_52 = Equality(FirstNumber=data_138, SecondNumber="1")  # -> Equality, Inequality
dispatch_71 = Dispatch(List=dup_80, DispatchPattern=equals_52.Equality)  # -> ListA, ListB

equals_53 = Equality(FirstNumber=data_138, SecondNumber="1")  # -> Equality, Inequality
dispatch_72 = Dispatch(List=dup_84, DispatchPattern=equals_53.Equality)  # -> ListA, ListB

equals_54 = Equality(FirstNumber=data_138, SecondNumber="1")  # -> Equality, Inequality
dispatch_73 = Dispatch(List=dup_83, DispatchPattern=equals_54.Equality)  # -> ListA, ListB

equals_55 = Equality(FirstNumber=data_138, SecondNumber="1")  # -> Equality, Inequality
dispatch_74 = Dispatch(List=dup_85, DispatchPattern=equals_55.Equality)  # -> ListA, ListB

equals_56 = Equality(FirstNumber=data_138, SecondNumber="1")  # -> Equality, Inequality
dispatch_75 = Dispatch(List=dup_81, DispatchPattern=equals_56.Equality)  # -> ListA, ListB

# ----
# Parcel info of Building
rec_6 = DataRecorder(dispatch_71.ListB, DataLimit=-10, RecordData=True)
# ID
panel_536 = Panel(rec_6)

# ----
# Block value of Building
rec_7 = DataRecorder(dispatch_75.ListB, DataLimit=-10, RecordData=True)
panel_537 = Panel(rec_7)

# ----
# properties of Units
debrep_18 = DeconstructBrep(Brep=conditionedunconditioned_7.conditionedZones)  # -> simplify(Faces), Edges, Vertices
item_156 = ListItem(List=debrep_18.Faces, Index=0, Wrap=True)
area_67 = Area(Geometry=item_156)  # -> flatten(Area), Centroid

pdecon_19 = Deconstruct(Point=area_67.Centroid)  # -> XComponent, YComponent, ZComponent
division_21 = Division(A=pdecon_19.ZComponent, B="3")  # -> flatten(Result)

equals_57 = Equality(FirstNumber=data_138, SecondNumber="1")  # -> Equality, Inequality
dispatch_76 = Dispatch(List=division_21, DispatchPattern=equals_57.Equality)  # -> ListA, ListB

# ----
# z-axis value of Units
panel_539 = Panel(dispatch_76.ListB)

# ----
# detecting circle radius is the 2 times of the building height plus fit cirle radius
multiplication_20 = Multiplication(A=item_85, B=data_132)
debrep_19 = DeconstructBrep(Brep=geo_71)  # -> Faces, Edges, Vertices
fcircle_2 = CircleFit(Points=debrep_19.Vertices)  # -> Circle, Radius, Deviation

# ----
# height of the building
data_213 = Data(multiplication_20)

# ----
# Check whether Added Parcels inside the Block
# Added Parcel Status
panel_540 = Panel("_")
split_15 = TextSplit(Text=item_65, Separators=panel_540)
item_157 = ListItem(List=split_15, Index=-1, Wrap=True)
item_158 = ListItem(List=sorted_parcels_2, Index=item_157, Wrap=True)

multiplication_21 = Multiplication(A=data_213, B="2")
addition_9 = Addition(A=multiplication_21, B=fcircle_2.Radius)

area_68 = Area(Geometry=geo_71)  # -> Area, Centroid

circle_5 = CircleCNR(Center=area_68.Centroid, Normal=Vector(0, 0, 1), Radius=addition_9)

divide_6 = DivideCurve(Curve=circle_5, Count="180", Kinks=False)  # -> Points, Tangents, Parameters

panel_541 = Panel("detecting lines")
ln_5 = Line(StartPoint=area_68.Centroid, EndPoint=divide_6.Points)

lng_128 = ListLength(List=ln_5)

# ----
# center of simulated PARCEL
data_214 = Data(area_68.Centroid)
pt_3 = Point(dispatch_63.ListB)
ln_6 = Line(StartPoint=graft(area_63.Centroid), EndPoint=pt_3)
stretch = Stretch(Geometry=ln_6, Axis=ln_6, Length="50", Rigid=False)

panel_543 = Panel("context Brep")

# ----
# Context Building
area_69 = Area(Geometry=item_109)  # -> Area, Centroid
equals_58 = Equality(FirstNumber=area_69.Centroid, SecondNumber=area_48.Centroid)  # -> Equality, Inequality
panel_544 = Panel("cull intersected parcel")
panel_545 = Panel("collision detection")

dispatch_77 = Dispatch(List=pline_7, DispatchPattern=equals_58.Equality)  # -> ListA, ListB
area_70 = Area(Geometry=dispatch_77.ListA)  # -> Area, Centroid
scale_8 = Scale(Geometry=dispatch_77.ListA, Center=area_70.Centroid, Factor="1.1")  # -> Geometry, Transform

colom_2 = CollisionOneMany(Collider=scale_8.Geometry, Obstacles=simplify(graft(dispatch_77.ListB)))  # -> simplify(flatten(Collision)), simplify(Index)
dispatch_78 = Dispatch(List=dispatch_77.ListB, DispatchPattern=colom_2.Collision)  # -> ListA, ListB

geo_93 = Geometry(dispatch_78.ListB)
area_71 = Area(Geometry=geo_93)  # -> Area, Centroid

# ----
# Context Shading: Added Parcel
vec2pt_8 = Vector2Pt(PointA=area_71.Centroid, PointB=graft(area_50.Centroid), Unitize=False)  # -> Vector, Length
multiplication_22 = Multiplication(A=vec2pt_8.Vector, B="2")
move_4 = Move(Geometry=geo_93, Motion=multiplication_22)  # -> Geometry, Transform

# ----
# OSCInfo
dispatch_79 = Dispatch(List=data_133, DispatchPattern=equals_35.Equality)  # -> ListA, ListB
dispatch_80 = Dispatch(List=dispatch_79.ListA, DispatchPattern=equals_37.Equality)  # -> ListA, ListB
multiplication_23 = Multiplication(A=dispatch_80.ListB, B=data_134)
boundary_20 = BoundarySurfaces(Edges=dispatch_78.ListB)
Z_8 = UnitZ(Factor=multiplication_23)
extr_6 = Extrude(Base=boundary_20, Direction=Z_8)

rint = RegionIntersection(CurvesA=geo_93, CurvesB=simplify(graft(move_4.Geometry)))  # -> simplify(Result)
area_72 = Area(Geometry=flatten(rint))  # -> Area, Centroid
incurves_3 = PointInCurves(Point=area_72.Centroid, Curves=move_4.Geometry)  # -> Relationship, Index, Point
cull_i_38 = CullIndex(List=move_4.Geometry, Indices=incurves_3.Index, Wrap=True)

area_73 = Area(Geometry=cull_i_38)  # -> Area, Centroid
incurves_4 = PointInCurves(Point=area_73.Centroid, Curves=item_158)  # -> Relationship, Index, Point
equals_59 = Equality(FirstNumber=incurves_4.Relationship, SecondNumber="2")  # -> Equality, Inequality
dispatch_81 = Dispatch(List=cull_i_38, DispatchPattern=equals_59.Equality)  # -> ListA, ListB

panel_546 = Panel("context surfaces")
merge_115 = Merge(Data1=dispatch_78.ListB, Data2=dispatch_81.ListB)
debrep_20 = DeconstructBrep(Brep=flatten(merge_115))  # -> Faces, simplify(flatten(Edges)), Vertices

# ----
# Intersection Check
Z_9 = UnitZ(Factor=1)
extr_7 = Extrude(Base=ln_5, Direction=Z_9)
split_16 = SplitWithBrep(Curve=debrep_20.Edges, Brep=graft(extr_7))  # -> flatten(Curve), simplify(Points)
clean_19 = CleanTree(RemoveNulls=True, RemoveInvalid=True, RemoveEmpty=Toggle(True), Tree=split_16.Points)
item_159 = ListItem(List=clean_19, Index=0, Wrap=True)
dcon_7 = DeleteConsecutive(Set=item_159, Wrap=False)  # -> simplify(Set), Count
tstat_23 = TreeStatistics(Tree=dcon_7.Set)  # -> Paths, Length, Count
split_17 = TextSplit(Text=tstat_23.Paths, Separators="{;}")

series_53 = Series(Start=0, Step=1, Count=lng_128)
item_160 = ListItem(List=split_17, Index=2, Wrap=True)  # -> flatten(Item)
item_161 = ListItem(List=split_17, Index=1, Wrap=True)  # -> flatten(Item)
equals_60 = Equality(FirstNumber=graft(series_53), SecondNumber=item_161)  # -> Equality, Inequality
dispatch_82 = Dispatch(List=item_161, DispatchPattern=equals_60.Equality)  # -> simplify(ListA), ListB
lng_129 = ListLength(List=dispatch_82.ListA)
partition_63 = PartitionList(List=item_160, Size=flatten(lng_129))
item_162 = ListItem(List=debrep_20.Edges, Index=partition_63, Wrap=True)  # -> simplify(Item)

curvepoint_9 = PointOnCurve(item_162, parameter=0.5)
dist = Distance(PointA=curvepoint_9, PointB=data_214)  # -> simplify(Distance)
sort_26 = SortList(Keys=dist, ValuesA=item_162)  # -> Keys, ValuesA
item_163 = ListItem(List=sort_26.ValuesA, Index=0, Wrap=True)  # -> flatten(Item)
null_11 = NullItem(Item=item_163)  # -> NullFlags, InvalidFlags, Description
dispatch_83 = Dispatch(List=item_163, DispatchPattern=null_11.NullFlags)  # -> ListA, ListB
curvepoint_10 = PointOnCurve(dispatch_83.ListB, parameter=0.5)
sort_pt_2 = SortPoints(Points=curvepoint_10)  # -> Points, Indices
dcon_8 = DeleteConsecutive(Set=sort_pt_2.Points, Wrap=False)  # -> Set, Count
geo_94 = Geometry(dispatch_83.ListB)
pdecon_20 = Deconstruct(Point=dcon_8.Set)  # -> XComponent, YComponent, ZComponent
curvepoint_11 = PointOnCurve(geo_94, parameter=0.5)
addition_10 = Addition(A=pdecon_20.XComponent, B=pdecon_20.YComponent)
pdecon_21 = Deconstruct(Point=curvepoint_11)  # -> XComponent, YComponent, ZComponent
roundd_3 = RoundToDecimalPlace(NumberX=addition_10, DecimalPlace="2", RoundType=0)  # -> Rounded, Difference
addition_11 = Addition(A=pdecon_21.XComponent, B=pdecon_21.YComponent)
roundd_4 = RoundToDecimalPlace(NumberX=addition_11, DecimalPlace="2", RoundType=0)  # -> Rounded, Difference
equals_61 = Equality(FirstNumber=roundd_4.Rounded, SecondNumber=graft(roundd_3.Rounded))  # -> Equality, Inequality
dispatch_84 = Dispatch(List=geo_94, DispatchPattern=equals_61.Equality)  # -> simplify(ListA), ListB

item_164 = ListItem(List=dispatch_84.ListA, Index=0, Wrap=True)  # -> flatten(Item)

area_74 = Area(Geometry=geo_45)  # -> Area, Centroid
scale_9 = Scale(Geometry=geo_45, Center=area_74.Centroid, Factor="1.1")  # -> Geometry, Transform
debrep_21 = DeconstructBrep(Brep=scale_9.Geometry)  # -> Faces, Edges, Vertices
pline_8 = PolyLine(Vertices=debrep_21.Vertices, Closed=Toggle(True))  # -> flatten(Polyline)
curvepoint_12 = PointOnCurve(item_164, parameter=0.5)
incurves_5 = PointInCurves(Point=curvepoint_12, Curves=pline_8)  # -> Relationship, Index, Point
sort_27 = SortList(Keys=incurves_5.Index)  # -> Keys, ValuesA
dcon_9 = DeleteConsecutive(Set=sort_27.Keys, Wrap=False)  # -> Set, Count
item_165 = ListItem(List=data_171, Index=dcon_9.Set, Wrap=True)  # -> flatten(Item)

# ----
# average of all context buildings height
ma_12 = MassAddition(Input=item_165)  # -> Result, PartialResults
lng_130 = ListLength(List=item_165)
division_22 = Division(A=ma_12.Result, B=lng_130)

# ----
# average of all context buildings height
data_215 = Data(division_22)

# ----
# OSCInfo_ContextShadingAddedBlocks
multiplication_24 = Multiplication(A=data_215, B=data_135)
boundary_21 = BoundarySurfaces(Edges=dispatch_81.ListB)
Z_10 = UnitZ(Factor=multiplication_24)
extr_8 = Extrude(Base=boundary_21, Direction=Z_10)

brep = Brep(flatten([extr_6, extr_8]))

merge_116 = Merge(Data1=extr_6, Data2=extr_8)
area_75 = Area(Geometry=merge_116)  # -> Area, flatten(Centroid)

merge_117 = Merge(Data1=extr_6, Data2=extr_8)  # -> flatten(Result)
null_12 = NullItem(Item=merge_117)  # -> NullFlags, InvalidFlags, Description
dispatch_85 = Dispatch(List=merge_117, DispatchPattern=null_12.NullFlags)  # -> ListA, ListB
debrep_22 = DeconstructBrep(Brep=dispatch_85.ListB)  # -> simplify(Faces), Edges, Vertices
area_76 = Area(Geometry=debrep_22.Faces)  # -> Area, Centroid
pdecon_22 = Deconstruct(Point=area_76.Centroid)  # -> XComponent, YComponent, ZComponent
sort_28 = SortList(Keys=pdecon_22.ZComponent, ValuesA=debrep_22.Faces)  # -> Keys, reverse(ValuesA)

area_77 = Area(Geometry=dispatch_85.ListB)  # -> Area, Centroid
incurves_6 = PointInCurves(Point=area_77.Centroid, Curves=shift_4)  # -> Relationship, Index, Point
sort_29 = SortList(Keys=incurves_6.Index)  # -> Keys, ValuesA
dcon_10 = DeleteConsecutive(Set=sort_29.Keys, Wrap=False)  # -> Set, Count
equals_62 = Equality(FirstNumber=dcon_10.Set, SecondNumber="-1")  # -> Equality, Inequality
dispatch_86 = Dispatch(List=dcon_10.Set, DispatchPattern=equals_62.Equality)  # -> ListA, ListB

item_166 = ListItem(List=sort_28.ValuesA, Index=0, Wrap=True)
area_78 = Area(Geometry=item_166)  # -> Area, Centroid
incurves_7 = PointInCurves(Point=area_78.Centroid, Curves=shift_4)  # -> Relationship, simplify(Index), Point
equals_63 = Equality(FirstNumber=incurves_7.Index, SecondNumber="-1")  # -> Equality, Inequality
dispatch_87 = Dispatch(List=incurves_7.Index, DispatchPattern=equals_63.Equality)  # -> ListA, ListB

pdecon_23 = Deconstruct(Point=area_78.Centroid)  # -> XComponent, YComponent, ZComponent
sort_30 = SortList(Keys=pdecon_23.ZComponent, ValuesA=area_78.Centroid)  # -> reverse(Keys), reverse(ValuesA)
item_167 = ListItem(List=sort_30.Keys, Index=0, Wrap=True)

# ----
# count
# occurences
# in list
# + partition from
# north to east
sort_31 = SortList(Keys=flatten(dispatch_87.ListB), ValuesA=flatten(item_167))  # -> Keys, ValuesA
dcon_11 = DeleteConsecutive(Set=sort_31.Keys, Wrap=False)  # -> Set, Count
panel_549 = Panel(sort_31.Keys)
equals_64 = Equality(FirstNumber=panel_549, SecondNumber=graft(dcon_11.Set))  # -> Equality, Inequality
dispatch_88 = Dispatch(List=panel_549, DispatchPattern=equals_64.Equality)  # -> simplify(ListA), ListB

# ----
# average distance of context
sort_32 = SortList(Keys=pdecon_22.ZComponent, ValuesA=debrep_22.Faces)  # -> Keys, ValuesA
item_168 = ListItem(List=sort_32.ValuesA, Index=0, Wrap=True)
area_79 = Area(Geometry=item_168)  # -> Area, Centroid
area_80 = Area(Geometry=geo_76)  # -> Area, Centroid
dist_2 = Distance(PointA=area_80.Centroid, PointB=area_79.Centroid)  # -> flatten(Distance)
lng_131 = ListLength(List=dispatch_88.ListA)  # -> flatten(Length)
partition_64 = PartitionList(List=dist_2, Size=lng_131)
avr_6 = Average(Input=partition_64)  # -> flatten(ArithmeticMean)
dup_86 = DuplicateData(Data="0", Number="4", Order=True)
replace_31 = ReplaceItems(List=dup_86, Item=avr_6, Indices=dispatch_86.ListB, Wrap=False)
roundd_5 = RoundToDecimalPlace(NumberX=replace_31, DecimalPlace="1", RoundType=0)  # -> Rounded, Difference
lng_132 = ListLength(List=roundd_5.Rounded)
lng_133 = ListLength(List=conditionedunconditioned_6.conditionedZones)
dup_87 = DuplicateData(Data=roundd_5.Rounded, Number=lng_133, Order=True)
partition_65 = PartitionList(List=dup_87, Size=lng_132)  # -> simplify(Chunks)

multiplication_25 = Multiplication(A=data_136, B=division_22)
Z_11 = UnitZ(Factor=multiplication_25)

# ----
# height of context
lng_134 = ListLength(List=dispatch_88.ListA)  # -> flatten(Length)
partition_66 = PartitionList(List=sort_31.ValuesA, Size=lng_134)
avr_7 = Average(Input=partition_66)  # -> flatten(ArithmeticMean)
dup_88 = DuplicateData(Data="0", Number="4", Order=True)
replace_32 = ReplaceItems(List=dup_88, Item=avr_7, Indices=dispatch_86.ListB, Wrap=False)
roundd_6 = RoundToDecimalPlace(NumberX=replace_32, DecimalPlace="1", RoundType=0)  # -> Rounded, Difference
lng_135 = ListLength(List=roundd_6.Rounded)
lng_136 = ListLength(List=conditionedunconditioned_5.conditionedZones)
dup_89 = DuplicateData(Data=roundd_5.Rounded, Number=lng_136, Order=True)
partition_67 = PartitionList(List=dup_89, Size=lng_135)  # -> simplify(Chunks)

geo_95 = Geometry(item_164)

# ----
# context without ground surface
extr_9 = Extrude(Base=geo_95, Direction=Z_11)

# ----
# context without ground surface
geo_96 = Geometry(extr_9)

colom_3 = CollisionOneMany(Collider=stretch, Obstacles=geo_96)  # -> Collision, Index
dispatch_89 = Dispatch(List=stretch, DispatchPattern=colom_3.Collision)  # -> ListA, ListB
split_18 = SplitWithBreps(Curve=dispatch_89.ListA, Brep=geo_96)  # -> Curve, Points
crv = Curve(split_18.Curve)
item_169 = ListItem(List=crv, Index=0, Wrap=True)
null_13 = NullItem(Item=item_169)  # -> NullFlags, InvalidFlags, Description
dispatch_90 = Dispatch(List=item_169, DispatchPattern=null_13.NullFlags)  # -> ListA, ListB
crv_2 = Curve(dispatch_90.ListB)
len_6 = Length(Curve=crv_2)
end_2 = EndPoints(Curve=crv_2)  # -> Start, End
vec2pt_9 = Vector2Pt(PointA=end_2.Start, PointB=end_2.End, Unitize=False)  # -> Vector, Length
pshift_2 = ShiftPaths(Data=len_6, Offset=-1)
null_14 = NullItem(Item=pshift_2)  # -> NullFlags, InvalidFlags, Description
dispatch_91 = Dispatch(List=pshift_2, DispatchPattern=null_14.NullFlags)  # -> ListA, ListB

angle = Angle(VectorA=graft(evalsrf_5.Normal), VectorB=simplify(vec2pt_9.Vector))  # -> Angle, Reflex
deg_2 = Degrees(Radians=angle.Angle)
larger_2 = LargerThan(FirstNumber=deg_2, SecondNumber="90")  # -> LargerThan, OrEqualTo
python_41 = GhPythonScript(x=simplify(deg_2))  # -> simplify(out), a
# ---------- python_41: Python ----------
__author__ = "ipg"
__version__ = "2022.01.28"

import rhinoscriptsyntax as rs
if x>=90:
    x = x-90
    print(x)
else:
    pass
# ---------- end python_41 ----------
dispatch_92 = Dispatch(List=deg_2, DispatchPattern=larger_2.OrEqualTo)  # -> ListA, ListB
merge_118 = Merge(Data1=dispatch_92.ListB, Data2=python_41.out)  # -> simplify(Result)
pshift_3 = ShiftPaths(Data=merge_118, Offset=-1)

join_29 = BrepJoin(Breps=brep)  # -> flatten(Breps), Closed
volume_8 = Volume(Geometry=join_29.Breps)  # -> Volume, Centroid
bcx = BrepCurve(Brep=flatten(brep), Curve=dispatch_90.ListB)  # -> Curves, Points
crv_cp_2 = CurveCP(Point=volume_8.Centroid, Curve=crv_2)  # -> Point, Parameter, Distance
pshift_4 = ShiftPaths(Data=bcx.Points, Offset=-1)
dist_3 = Distance(PointA=volume_8.Centroid, PointB=crv_cp_2.Point)
sort_33 = SortList(Keys=dist_3, ValuesA=join_29.Breps)  # -> Keys, ValuesA
lng_137 = ListLength(List=pshift_4)
split_19 = SplitList(List=sort_33.ValuesA, Index=lng_137)  # -> ListA, ListB
brep_2 = Brep(simplify(graft(split_19.ListA)))

pshift_5 = ShiftPaths(Data=simplify(brep_2), Offset=-1)
panel_551 = Panel(pshift_5)

multiplication_26 = Multiplication(A=pshift_3, B=dispatch_91.ListB)
python_42 = GhPythonScript(x=multiplication_26)  # -> out, a
# ---------- python_42: Python ----------
__author__ = "ipg"
__version__ = "2022.01.28"

import rhinoscriptsyntax as rs
if x == 0 : 
    x = x + 0.1
    print(x)
else:
    print(x)
# ---------- end python_42 ----------
pshift_6 = ShiftPaths(Data=python_42.out, Offset=-1)
panel_552 = Panel(multiplication_26)

lng_138 = ListLength(List=multiplication_26)  # -> flatten(Length)
data_216 = Data(flatten(brep_2))
partition_68 = PartitionList(List=data_216, Size=lng_138)  # -> simplify(Chunks)
tstat_24 = TreeStatistics(Tree=partition_68)  # -> Paths, Length, Count
tstat_25 = TreeStatistics(Tree=multiplication_26)  # -> Paths, Length, Count
replace_33 = ReplacePaths(Data=partition_68, Search=tstat_24.Paths, Replace=tstat_25.Paths)

debrep_23 = DeconstructBrep(Brep=replace_33)  # -> simplify(Faces), Edges, Vertices
area_81 = Area(Geometry=debrep_23.Faces)  # -> Area, Centroid
pdecon_24 = Deconstruct(Point=area_81.Centroid)  # -> XComponent, YComponent, ZComponent
sort_34 = SortList(Keys=pdecon_24.ZComponent, ValuesA=debrep_23.Faces)  # -> Keys, reverse(ValuesA)
null_15 = NullItem(Item=sort_34.ValuesA)  # -> NullFlags, InvalidFlags, Description
dispatch_93 = Dispatch(List=sort_34.ValuesA, DispatchPattern=null_15.NullFlags)  # -> ListA, ListB
area_82 = Area(Geometry=dispatch_93.ListB)  # -> Area, Centroid
pdecon_25 = Deconstruct(Point=area_82.Centroid)  # -> XComponent, YComponent, ZComponent
sort_35 = SortList(Keys=pdecon_25.ZComponent, ValuesA=area_82.Centroid)  # -> reverse(Keys), reverse(ValuesA)
item_170 = ListItem(List=sort_35.Keys, Index=0, Wrap=True)
null_16 = NullItem(Item=item_170)  # -> NullFlags, InvalidFlags, Description
dispatch_94 = Dispatch(List=item_170, DispatchPattern=null_16.NullFlags)  # -> ListA, simplify(ListB)

pshift_7 = ShiftPaths(Data=dispatch_94.ListB, Offset=-1)
panel_553 = Panel(pshift_7)

geo_97 = Geometry(flatten(extr_9))
panel_554 = Panel("shading Context")

subtraction_10 = Subtraction(A=pshift_7, B=panel_514)
python_43 = GhPythonScript(x=pdecon_17.ZComponent, y=panel_553, z=subtraction_10)  # -> out, a
# ---------- python_43: Python ----------
__author__ = "ipg"
__version__ = "2022.01.28"

import rhinoscriptsyntax as rs
if x > y:
    z = 0
    print(z)
if z < 0 :
    z = 0 
    print(z)
else:
    print(z)
# ---------- end python_43 ----------
pshift_8 = ShiftPaths(Data=python_43.out, Offset=-1)
panel_555 = Panel(pshift_8)

division_23 = Division(A=pshift_8, B=multiplication_26)
panel_556 = Panel(division_23)

area_83 = Area(Geometry=geo_97)  # -> Area, Centroid
incurves_8 = PointInCurves(Point=area_83.Centroid, Curves=merge_81)  # -> Relationship, Index, Point
sort_36 = SortList(Keys=incurves_8.Index)  # -> Keys, ValuesA
dcon_12 = DeleteConsecutive(Set=sort_36.Keys, Wrap=False)  # -> Set, Count

# ----
# 01find directions of external walls
# 2-steps shading selection
# find directions of external walls
# test wether obstacle exist these directions
decomposebytype_4 = Honeybee_DecomposeBasedOnType(HBZone=conditionedunconditioned_4.conditionedZones)  # -> simplify(walls), simplify(interiorWalls), airWalls, simplify(windows), interiorWindows, skylights, roofs, ceilings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; plug-in component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
replace_34 = ReplaceItems(List=dup_37, Item="1", Indices=dcon_12.Set, Wrap=False)

merge_119 = Merge(Data1=extr_9, Data2=geo_77)  # -> flatten(Result)
debrep_24 = DeconstructBrep(Brep=flatten(merge_119))  # -> Faces, Edges, flatten(Vertices)
hull_7 = ConvexHull(Points=debrep_24.Vertices, Plane=PlaneXY(0, 0, 0))  # -> Hull, HullZ, Indices
area_84 = Area(Geometry=hull_7.Hull)  # -> Area, Centroid
scale_10 = Scale(Geometry=hull_7.Hull, Center=area_84.Centroid, Factor="1.05")  # -> Geometry, Transform
boundary_22 = BoundarySurfaces(Edges=scale_10.Geometry)

# ----
# average (it gives
# one result for each
# window unit)
avr_8 = Average(Input=division_23)
panel_557 = Panel(avr_8)

# ----
# summation (it gives
#  one result for each
#  window in the unit)
ma_13 = MassAddition(Input=division_23)  # -> Result, PartialResults
panel_558 = Panel(ma_13.Result)

# ----
# 02test wether obstacle
# exist these directions
area_85 = Area(Geometry=decomposebytype_4.walls)  # -> Area, Centroid
incurves_9 = PointInCurves(Point=area_85.Centroid, Curves=merge_81)  # -> Relationship, Index, Point
item_171 = ListItem(List=replace_34, Index=incurves_9.Index, Wrap=True)  # -> simplify(Item)
replace_35 = ReplaceItems(List=dup_38, Item=item_171, Indices=incurves_9.Index, Wrap=False)  # -> simplify(List)

nullrep = ReplaceNulls(Items=panel_557, Replacements="-1")  # -> Items, Count
pshift_9 = ShiftPaths(Data=nullrep.Items, Offset=-1)

# ----
# null olanları
# -1 ile değiştirdim
# hiç etkisi yok
# demek
panel_559 = Panel("-1")
nullrep_2 = ReplaceNulls(Items=panel_558, Replacements=panel_559)  # -> Items, Count
pshift_10 = ShiftPaths(Data=nullrep_2.Items, Offset=-1)

# ----
# Context Surface
merge_120 = Merge(Data1=flatten(extr_9), Data2=flatten(boundary_22))
hb_epcontextsrf = HoneybeeEPContextSurfaces(shdSurfaces=flatten(merge_120))  # -> HBContext; inputs shdSurfaces: list of Brep, justBoundingBox: Boolean
# ---------- hb_epcontextsrf: Python ----------
"""
prepare shading/context geometries

    Args:
        northVectorOrRotation: A vector that shows North or a number that shows
                               the rotation of the North from the Y axis
        bldgMasses: List of closed Breps as thermal zones.
    Returns:
        report: ...
        thermalZones: Thermal zone's geometries for visualiza
"""

ghenv.Component.Name = 'Honeybee EP context Surfaces'
ghenv.Component.NickName = 'HB_EPContextSrf'
ghenv.Component.Message = 'VER 0.0.66\nJUL_07_2020'
ghenv.Component.IconDisplayMode = ghenv.Component.IconDisplayMode.application
ghenv.Component.Category = "HB-Legacy"
ghenv.Component.SubCategory = "10 | Energy | Energy"
#compatibleHBVersion = VER 0.0.57\nNOV_04_2016
#compatibleLBVersion = VER 0.0.59\nFEB_01_2015
ghenv.Component.AdditionalHelpFromDocStrings = "2"

import rhinoscriptsyntax as rs
import Rhino as rc
import scriptcontext as sc
import os
import System
import Grasshopper.Kernel as gh
import uuid

tolerance = sc.doc.ModelAbsoluteTolerance
import math


def main(shdSurfaces, EPTransSchedule, meshingSettings, justBoundingBox):
    
    # import the classes
    if sc.sticky.has_key('honeybee_release'):

        try:
            if not sc.sticky['honeybee_release'].isCompatible(ghenv.Component): return -1
            if sc.sticky['honeybee_release'].isInputMissing(ghenv.Component): return -1
        except:
            warning = "You need a newer version of Honeybee to use this compoent." + \
            " Use updateHoneybee component to update userObjects.\n" + \
            "If you have already updated userObjects drag Honeybee_Honeybee component " + \
            "into canvas and try again."
            w = gh.GH_RuntimeMessageLevel.Warning
            ghenv.Component.AddRuntimeMessage(w, warning)
            return -1
        
        # don't customize this part
        hb_EPSrf = sc.sticky["honeybee_EPSurface"]
        hb_EPSHDSurface = sc.sticky["honeybee_EPShdSurface"]
        hb_RADMaterialAUX = sc.sticky["honeybee_RADMaterialAUX"]
        hb_EPObjectsAux = sc.sticky["honeybee_EPObjectsAUX"]()
        HBScheduleList = sc.sticky["honeybee_ScheduleLib"].keys()

        ########################################################################
        #----------------------------------------------------------------------#
        shdBreps = []
        # create bounding box of shading geometries
        if justBoundingBox:
            for brep in shdSurfaces:
                if brep.Faces.Count>1 or not brep.Faces[0].IsPlanar(sc.doc.ModelAbsoluteTolerance):
                    shdBreps.append(brep.GetBoundingBox(True).ToBrep())
                else:
                    shdBreps.append(brep)
        else:
            shdBreps = shdSurfaces
        
        shadingClasses = []
        shadingMeshPreview = []
        
        if meshingSettings == None:
            mp = rc.Geometry.MeshingParameters.Minimal
            mp.SimplePlanes = True
        else:
            mp = meshingSettings
        
        def getRadMaterialName(radMaterial):
            nameStr = radMaterial.split(" ")[2]
            name =  nameStr.split("\n")[0]
            return name
        
        for brepCount, brep in enumerate(shdBreps):
            if brep != None:
                isPlanar = True
                # check planarity
                for face in brep.Faces:
                    if not face.IsPlanar(tolerance):
                        isPlanar = False
                        break
                
                shadingBreps = []
                if not isPlanar:
                    meshArray = rc.Geometry.Mesh.CreateFromBrep(brep, mp)
                    for mesh in meshArray:
                        for meshFace in range(mesh.Faces.Count):
                            vertices = list(mesh.Faces.GetFaceVertices(meshFace))[1:]
                            vertices = vertices + [sc.doc.ModelAbsoluteTolerance]
                            # create the brep from mesh
                            shdBrep = rc.Geometry.Brep.CreateFromCornerPoints(*vertices)
                            shadingBreps.append(shdBrep)
                else:
                    for face in brep.Faces:
                        shadingBreps.append(face.DuplicateFace(False))
                
                for faceCount, shdBrep in enumerate(shadingBreps):
                        thisShading = hb_EPSHDSurface(shdBrep, 1000*brepCount + faceCount, 'shdSrf_' + `brepCount` + '_' + `faceCount` + "_" + str(uuid.uuid4()))
                        
                        # add transmittance schedule if any
                        if EPTransSchedule!=None:
                            schedule= EPTransSchedule.upper()
                            if schedule!=None and not schedule.lower().endswith(".csv") and schedule not in HBScheduleList:
                                msg = "Cannot find " + schedule + " in Honeybee schedule library."
                                print msg
                                ghenv.Component.AddRuntimeMessage(gh.GH_RuntimeMessageLevel.Warning, msg)
                                return -1
                            elif schedule!=None and schedule.lower().endswith(".csv"):
                                # check if csv file is existed
                                if not os.path.isfile(schedule):
                                    msg = "Cannot find the shchedule file: " + schedule
                                    print msg
                                    ghenv.Component.AddRuntimeMessage(gh.GH_RuntimeMessageLevel.Warning, msg)
                                    return -1
                            
                            thisShading.TransmittanceSCH = schedule
                        
                        # add the Rad Material if any
                        if RADMaterial!=None:
                            # if it is just the name of the material make sure it is already defined
                            if len(RADMaterial.split(" ")) == 1:
                                # if the material is not in the library add it to the library
                                if not hb_RADMaterialAUX.isMatrialExistInLibrary(RADMaterial):
                                    warningMsg = "Can't find " + RADMaterial + " in RAD Material Library.\n" + \
                                                "Add the material to the library and try again."
                                    ghenv.Component.AddRuntimeMessage(gh.GH_RuntimeMessageLevel.Warning, warningMsg)
                                    return
                                
                                try:
                                    thisShading.setRADMaterial(RADMaterial)
                                except Exception, e:
                                    print e
                                    warningMsg = "You are using an old version of Honeybee_Honeybee! Update your files and try again."
                                    print warningMsg
                                    ghenv.Component.AddRuntimeMessage(gh.GH_RuntimeMessageLevel.Warning, warningMsg)
                                    return
                                
                                addedToLib = True
                            else:
                                
                                # try to add the material to the library
                                addedToLib, thisShading.RadMaterial = hb_RADMaterialAUX.analyseRadMaterials(RADMaterial, True)
                                
                            if addedToLib==False:
                                warningMsg = "Failed to add " + RADMaterial + " to the Library."
                                ghenv.Component.AddRuntimeMessage(gh.GH_RuntimeMessageLevel.Warning, warningMsg)
                                return
                        
                        # add shading to the list
                        shadingClasses.append(thisShading)
                
        # add to the hive
        hb_hive = sc.sticky["honeybee_Hive"]()
        HBContext  = hb_hive.addToHoneybeeHive(shadingClasses, ghenv.Component)
        return HBContext
        ################################################################################################
    else:
        print "You should first let Honeybee to fly..."
        w = gh.GH_RuntimeMessageLevel.Warning
        ghenv.Component.AddRuntimeMessage(w, "You should first let Honeybee to fly...")
        return -1
        

if _shdSurfaces and _shdSurfaces[0]!=None:
    # add cleaning function
    result= main(_shdSurfaces, EPTransSchedule_, meshingSettings_, justBoundingBox_)
    
    if result != -1: HBContext = result
# ---------- end hb_epcontextsrf ----------

# ----
# Simulated Parcel
# Visualisation
wires_7 = BrepWireframe(Brep=merge_120, Density=-1)
preview_27 = CustomPreview(Geometry=hb_epcontextsrf, Material=ColourSwatch(SwatchColor=RGBA(0, 255, 55, 145)))
preview_28 = CustomPreview(Geometry=wires_7, Material=ColourSwatch(SwatchColor=RGB(0, 0, 0)))

context = Brep(hb_epcontextsrf)

panel_560 = Panel("""Obstacle by 
Directions""")
data_217 = Data(replace_35)

# ----
# 09.SIMULATION
panel_561 = Panel("2")
exporttoopenstudio = Honeybee_ExportToOpenStudio(
    epwWeatherFile=path,
    energySimPar=energysimpar,
    HBZones=flatten(geo_90),
    HBContext=flatten(hb_epcontextsrf),
    simulationOutputs=flatten(merge_63),
    writeOSM=Toggle(False),
    runSimulation=panel_561,
    fileName=filename,
    workingDir=panel_283)  # -> readMe, osmFileAddress, idfFileAddress, resultFileAddress, eioFileAddress, rddFileAddress, htmlReport, studyFolder, model; plug-in component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

data_218 = Data(exporttoopenstudio.resultFileAddress)
parameters = ColibriParameters(Data=flatten(data_218))
colibri_aggregator = ColibriAggregator(
    Folder="D:\KBEM\IP2.1\resV3Colibri",
    IterationGenomeID=iterator.IterationGenome,
    IterationPhenomeResults=parameters,
    ImgSetting=img_setting,
    Write=Toggle(False),
    recordingMode=0)

readepresult = Honeybee_ReadEPResult(resultFileAddress=exporttoopenstudio.resultFileAddress)  # -> totalThermalLoad, thermalLoadBalance, cooling, heating, electricLight, electricEquip, fanElectric, pumpElectric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; plug-in component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

readepsrfresult = Honeybee_ReadEPSurfaceResult(resultFileAddress=exporttoopenstudio.resultFileAddress)  # -> surfaceIndoorTemp, surfaceOutdoorTemp, surfaceEnergyFlow, opaqueEnergyFlow, glazEnergyFlow, windowTotalSolarEnergy, windowBeamEnergy, windowDiffEnergy, windowTransmissivity; disabled; plug-in component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
energybalance = Honeybee_ConstructEnergyBalance(
    HBZones=flatten(dispatch_62.ListB),
    cooling=readepresult.cooling,
    heating=readepresult.heating,
    electricLight=readepresult.electricLight,
    electricEquip=readepresult.electricEquip,
    fanElectric=readepresult.fanElectric,
    peopleGains=readepresult.peopleGains,
    totalSolarGain=readepresult.totalSolarGain,
    infiltrationEnergy=readepresult.infiltrationEnergy,
    mechVentilationEnergy=readepresult.mechVentilationEnergy,
    natVentEnergy=readepresult.natVentEnergy,
    surfaceEnergyFlow=readepsrfresult.surfaceEnergyFlow)  # -> readMe, port, flrNormEnergyBal, flrNormBalWStorage, port_2, modelEnergyBalance, energyBalWithStorage; disabled; plug-in component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
panel_562 = Panel("19")  # disabled
gradientlibrary = Ladybug_GradientLibrary(gradIndex=panel_562)  # -> customColors; disabled; plug-in component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
legendpar = Ladybug_LegendParameters(customColors=flatten(gradientlibrary))  # -> legendPar; disabled; plug-in component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
toggle_18 = BooleanToggle(True)  # disabled
panel_563 = Panel("EnergyBalance")  # disabled
pt_4 = Point(Point(458, 1813, 0))  # disabled
barchart = Ladybug_MonthlyBarChart(
    inputData=flatten(energybalance.flrNormBalWStorage),
    stackValues=toggle_18,
    altTitle=panel_563,
    basePoint=pt_4,
    legendPar=legendpar)  # -> readMe, dataMesh, dataCurves, dataCrvColors, graphAxes, graphLabels, title, titleBasePt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; disabled; plug-in component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
swatch_7 = ColourSwatch(SwatchColor=RGB(0, 0, 0))  # disabled
preview_29 = CustomPreview(Geometry=barchart.graphAxes, Material=swatch_7)  # disabled

# ----
# People Gain (kWh/sqm)
flrnorm = Honeybee_NormalizeDataByFloorArea(simData=readepresult.peopleGains, HBZones=flatten(geo_90))  # -> totNormData, zoneNormData; plug-in component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
strnum_7 = Ladybug_SeparateData(inputList=flatten(flrnorm.zoneNormData))  # -> numbers, strings; plug-in component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
ma_14 = MassAddition(Input=strnum_7.numbers)  # -> flatten(Result), PartialResults

# ----
# Bahçeli-Ankara Heating Demand Reference Building, EKB0_4: 80kWh/sqm
strnum_8 = Ladybug_SeparateData(inputList=flatten(readepresult.heating))  # -> numbers, strings; plug-in component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
debrep_25 = DeconstructBrep(Brep=geo_90)  # -> simplify(Faces), Edges, Vertices
item_172 = ListItem(List=debrep_25.Faces, Index=0, Wrap=True)
ma_15 = MassAddition(Input=strnum_8.numbers)  # -> flatten(Result), PartialResults
area_86 = Area(Geometry=item_172)  # -> flatten(Area), Centroid
ma_16 = MassAddition(Input=ma_15.Result)  # -> Result, PartialResults
ma_17 = MassAddition(Input=area_86.Area)  # -> Result, PartialResults
division_24 = Division(A=ma_16.Result, B=ma_17.Result)
panel_564 = Panel(division_24)

# ----
# Total Solar Gain (kWh/sqm)
flrnorm_2 = Honeybee_NormalizeDataByFloorArea(simData=readepresult.totalSolarGain, HBZones=flatten(geo_90))  # -> totNormData, zoneNormData; plug-in component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
strnum_9 = Ladybug_SeparateData(inputList=flatten(flrnorm_2.zoneNormData))  # -> numbers, strings; plug-in component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
ma_18 = MassAddition(Input=strnum_9.numbers)  # -> flatten(Result), PartialResults
equals_65 = Equality(FirstNumber=ma_18.Result, SecondNumber="0")  # -> Equality, Inequality
dispatch_95 = Dispatch(List=ma_18.Result, DispatchPattern=equals_65.Equality)  # -> ListA, ListB

# ----
# Infiltration Energy (kWh/sqm)
flrnorm_3 = Honeybee_NormalizeDataByFloorArea(simData=readepresult.infiltrationEnergy, HBZones=flatten(geo_90))  # -> totNormData, zoneNormData; plug-in component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
strnum_10 = Ladybug_SeparateData(inputList=flatten(flrnorm_3.zoneNormData))  # -> numbers, strings; plug-in component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
ma_19 = MassAddition(Input=strnum_10.numbers)  # -> flatten(Result), PartialResults
dispatch_96 = Dispatch(List=ma_19.Result, DispatchPattern=equals_65.Equality)  # -> ListA, ListB

# ----
# Natural Ventilation Energy (kWh/sqm)
flrnorm_4 = Honeybee_NormalizeDataByFloorArea(simData=readepresult.natVentEnergy, HBZones=flatten(geo_90))  # -> totNormData, zoneNormData; plug-in component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
strnum_11 = Ladybug_SeparateData(inputList=flatten(flrnorm_4.zoneNormData))  # -> numbers, strings; plug-in component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
ma_20 = MassAddition(Input=strnum_11.numbers)  # -> flatten(Result), PartialResults

# ----
# Air Temperature
# (Celcius/sqm)
strnum_12 = Ladybug_SeparateData(inputList=flatten(readepresult.airTemperature))  # -> numbers, strings; plug-in component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
avr_9 = Average(Input=strnum_12.numbers)
dispatch_97 = Dispatch(List=flatten(avr_9), DispatchPattern=equals_65.Equality)  # -> ListA, ListB

# ----
# HEATING ENERGY DEMAND
# (kWh/sqm)
flrnorm_5 = Honeybee_NormalizeDataByFloorArea(simData=readepresult.heating, HBZones=flatten(geo_90))  # -> totNormData, zoneNormData; plug-in component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
strnum_13 = Ladybug_SeparateData(inputList=flatten(flrnorm_5.zoneNormData))  # -> numbers, strings; plug-in component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
ma_21 = MassAddition(Input=strnum_13.numbers)  # -> flatten(Result), PartialResults

# ----
# COOLING ENERGY DEMAND
# (kWh/sqm)
flrnorm_6 = Honeybee_NormalizeDataByFloorArea(simData=readepresult.cooling, HBZones=flatten(geo_90))  # -> totNormData, zoneNormData; plug-in component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
strnum_14 = Ladybug_SeparateData(inputList=flatten(flrnorm_6.zoneNormData))  # -> numbers, strings; plug-in component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
ma_22 = MassAddition(Input=strnum_14.numbers)  # -> flatten(Result), PartialResults

# ----
# exclude
# unconditioned zones
# using total solar gain results
data_219 = Data(equals_65.Equality)

# ----
# Cull Unconditioned Zones
series_54 = Series(Start=0, Step=1, Count=lng_118)
dispatch_98 = Dispatch(List=series_54, DispatchPattern=data_219)  # -> ListA, ListB
branch_22 = TreeBranch(Tree=readepresult.operativeTemperature, Path=dispatch_98.ListB, MaintainPaths=True)

equals_66 = Equality(FirstNumber=data_138, SecondNumber="1")  # -> Equality, Inequality
dispatch_99 = Dispatch(List=dispatch_97.ListB, DispatchPattern=equals_66.Equality)  # -> ListA, ListB

equals_67 = Equality(FirstNumber=data_138, SecondNumber="1")  # -> Equality, Inequality
dispatch_100 = Dispatch(List=ma_14.Result, DispatchPattern=equals_67.Equality)  # -> ListA, ListB

equals_68 = Equality(FirstNumber=data_138, SecondNumber="1")  # -> Equality, Inequality
dispatch_101 = Dispatch(List=ma_21.Result, DispatchPattern=equals_68.Equality)  # -> ListA, ListB

equals_69 = Equality(FirstNumber=data_138, SecondNumber="1")  # -> Equality, Inequality
dispatch_102 = Dispatch(List=ma_22.Result, DispatchPattern=equals_69.Equality)  # -> ListA, ListB

equals_70 = Equality(FirstNumber=data_138, SecondNumber="1")  # -> Equality, Inequality
dispatch_103 = Dispatch(List=ma_20.Result, DispatchPattern=equals_70.Equality)  # -> ListA, ListB

equals_71 = Equality(FirstNumber=data_138, SecondNumber="1")  # -> Equality, Inequality
dispatch_104 = Dispatch(List=dispatch_96.ListB, DispatchPattern=equals_71.Equality)  # -> ListA, ListB

equals_72 = Equality(FirstNumber=data_138, SecondNumber="1")  # -> Equality, Inequality
dispatch_105 = Dispatch(List=dispatch_95.ListB, DispatchPattern=equals_72.Equality)  # -> ListA, ListB

flrnorm_7 = Honeybee_NormalizeDataByFloorArea(simData=readepresult.electricLight, HBZones=flatten(geo_90))  # -> totNormData, zoneNormData; plug-in component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
# ELECTRICLIGHT DEMAND
# (kWh/sqm)
strnum_15 = Ladybug_SeparateData(inputList=flatten(flrnorm_7.zoneNormData))  # -> numbers, strings; plug-in component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
ma_23 = MassAddition(Input=strnum_15.numbers)  # -> flatten(Result), PartialResults

# ----
# ELECTRICEQUIP ENERGY DEMAND
# (kWh/sqm)
flrnorm_8 = Honeybee_NormalizeDataByFloorArea(simData=readepresult.electricEquip, HBZones=flatten(geo_90))  # -> totNormData, zoneNormData; plug-in component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
strnum_16 = Ladybug_SeparateData(inputList=flatten(flrnorm_8.zoneNormData))  # -> numbers, strings; plug-in component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
ma_24 = MassAddition(Input=strnum_16.numbers)  # -> flatten(Result), PartialResults

equals_73 = Equality(FirstNumber=ma_18.Result, SecondNumber="0")  # -> Equality, Inequality
dispatch_106 = Dispatch(List=ma_23.Result, DispatchPattern=equals_73.Equality)  # -> ListA, ListB

equals_74 = Equality(FirstNumber=data_138, SecondNumber="1")  # -> Equality, Inequality
dispatch_107 = Dispatch(List=ma_24.Result, DispatchPattern=equals_74.Equality)  # -> ListA, ListB

equals_75 = Equality(FirstNumber=data_138, SecondNumber="1")  # -> Equality, Inequality
dispatch_108 = Dispatch(List=dispatch_106.ListB, DispatchPattern=equals_75.Equality)  # -> ListA, ListB

intcrv_2 = Interpolate(Vertices=merge_80, Degree=3, Periodic=Toggle(True), KnotStyle=1)  # -> flatten(Curve), Length, Domain

area_87 = Area(Geometry=intcrv_2.Curve)  # -> Area, Centroid
# regions start from north
# continues counter-clockwise
pdecon_26 = Deconstruct(Point=area_87.Centroid)  # -> XComponent, YComponent, ZComponent
sort_37 = SortList(Keys=pdecon_26.YComponent, ValuesA=intcrv_2.Curve)  # -> Keys, reverse(ValuesA)
item_173 = ListItem(List=sort_37.ValuesA, Index=0, Wrap=True)

area_88 = Area(Geometry=intcrv_2.Curve)  # -> Area, Centroid
pdecon_27 = Deconstruct(Point=area_88.Centroid)  # -> XComponent, YComponent, ZComponent
sort_38 = SortList(Keys=pdecon_27.XComponent, ValuesA=intcrv_2.Curve)  # -> Keys, reverse(ValuesA)
item_174 = ListItem(List=sort_38.ValuesA, Index=0, Wrap=True)

area_89 = Area(Geometry=intcrv_2.Curve)  # -> Area, Centroid
pdecon_28 = Deconstruct(Point=area_89.Centroid)  # -> XComponent, YComponent, ZComponent
sort_39 = SortList(Keys=pdecon_28.XComponent, ValuesA=intcrv_2.Curve)  # -> Keys, ValuesA
item_175 = ListItem(List=sort_39.ValuesA, Index=0, Wrap=True)

area_90 = Area(Geometry=intcrv_2.Curve)  # -> Area, Centroid
pdecon_29 = Deconstruct(Point=area_90.Centroid)  # -> XComponent, YComponent, ZComponent
sort_40 = SortList(Keys=pdecon_29.YComponent, ValuesA=intcrv_2.Curve)  # -> Keys, ValuesA
item_176 = ListItem(List=sort_40.ValuesA, Index=0, Wrap=True)

merge_121 = Merge(Data1=item_173, Data2=item_175, Data3=item_176, Data4=item_174)

panel_574 = Panel("""Window
Directions""")
incurves_10 = PointInCurves(Point=area_64.Centroid, Curves=merge_121)  # -> Relationship, Index, Point

cull_i_39 = CullIndex(List=partition_58, Indices=incurves_10.Index, Wrap=True)  # -> simplify(List)
panel_575 = Panel("""NO-Window
Directions""")

replace_36 = ReplaceItems(List=partition_60, Item="3", Indices=incurves_10.Index, Wrap=False)  # -> simplify(List)
replace_37 = ReplaceItems(List=replace_36, Item="2", Indices=cull_i_39, Wrap=False)

# ----
# WWR by directions
lng_139 = ListLength(List=replace_37)  # -> simplify(flatten(Length))
lng_140 = ListLength(List=lng_139)  # -> simplify(Length)
dup_90 = DuplicateData(Data=data_137, Number=lng_140, Order=True)
lng_141 = ListLength(List=data_137)
partition_69 = PartitionList(List=dup_90, Size=lng_141)  # -> simplify(Chunks)

mindex_8 = MemberIndex(Set=replace_37, Member="2")  # -> simplify(Index), Count

panel_576 = Panel("WWR by directions")
replace_38 = ReplaceItems(List=partition_69, Item="0", Indices=mindex_8.Index, Wrap=False)  # -> simplify(List)

panel_577 = Panel("wwrByDirections")
data_220 = Data(replace_38)

equals_76 = Equality(FirstNumber=data_220, SecondNumber="0")  # -> Equality, Inequality
dispatch_109 = Dispatch(List=data_220, DispatchPattern=equals_76.Equality)  # -> ListA, ListB
tmatch_2 = MatchText(Text=data_220, Pattern=dispatch_109.ListB, Case=True)
python_44 = GhPythonScript(x=tmatch_2)  # -> out, a; inputs x: list
# ---------- python_44: Python ----------
__author__ = "Siser"
__version__ = "2022.02.23"

import rhinoscriptsyntax as rs
TrueList=[]
for i in range(len(x)):
    if x[i] == 'True':
        TrueList.append(i)
    else:
        pass
a = TrueList
# ---------- end python_44 ----------

# ----
# ObstacleShadingCoefficient_IC
mindex_9 = MemberIndex(Set=data_220)  # -> Index, Count; disabled
panel_578 = Panel(pshift_10)

# ----
# SkyExposure_ic
panel_579 = Panel("0")
shadingmask = Ladybug_ShadingMask(centerPtOrPlane=area_62.Centroid, context=hb_epcontextsrf)  # -> contextMask, orientationMask, strategyMask, skyMask, port, contextExposure, orientExposure, strategyExposure, skyExposure; plug-in component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
equals_77 = Equality(FirstNumber=data_220, SecondNumber=panel_579)  # -> Equality, Inequality
dispatch_110 = Dispatch(List=data_220, DispatchPattern=equals_77.Equality)  # -> ListA, ListB
tmatch_3 = MatchText(Text=data_220, Pattern=dispatch_110.ListB, Case=True)
python_45 = GhPythonScript(x=tmatch_3)  # -> out, a; inputs x: list; same code as python_44
replace_39 = ReplaceItems(List=data_220, Item=shadingmask.skyExposure, Indices=python_45.a, Wrap=False)  # -> simplify(List)
panel_580 = Panel(replace_39)

data_221 = Data(replace_38)

# ----
# Window area/floor area
# Obstacle
# Shading
# Coefficient_IC
debrep_26 = DeconstructBrep(Brep=mass2zone_3.HBZones)  # -> simplify(Faces), Edges, Vertices
item_177 = ListItem(List=debrep_26.Faces, Index=0, Wrap=True)
area_91 = Area(Geometry=decomposebytype.windows)  # -> Area, Centroid
area_92 = Area(Geometry=item_177)  # -> Area, Centroid
division_25 = Division(A=simplify(area_91.Area), B=area_92.Area)
replace_40 = ReplaceItems(List=data_221, Item=division_25, Indices=python_44.a, Wrap=False)  # -> simplify(List)

data_222 = Data(replace_38)

data_223 = Data(replace_38)

# ----
# summation record
# (it gives
# one result for each
# window unit)
replace_41 = ReplaceItems(List=data_222, Item=pshift_10, Indices=python_44.a, Wrap=False)  # -> simplify(List)

# ----
# average record
# (it gives
# one result for each
# window unit)
replace_42 = ReplaceItems(List=data_223, Item=pshift_9, Indices=python_44.a, Wrap=False)  # -> simplify(List)

# ----
# WWRDirectionUnitNorth
item_178 = ListItem(List=replace_38, Index=0, Wrap=True)  # -> flatten(Item)

# ----
# WWRDirectionUnitSouth
item_179 = ListItem(List=replace_38, Index=2, Wrap=True)  # -> flatten(Item)

# ----
# WWRDirectionUnitEast
item_180 = ListItem(List=replace_38, Index=3, Wrap=True)  # -> flatten(Item)

# ----
# WWRDirectionUnitWest
item_181 = ListItem(List=replace_38, Index=1, Wrap=True)  # -> flatten(Item)

# ----
# AvOSC South
item_182 = ListItem(List=replace_42, Index=2, Wrap=True)  # -> flatten(Item)

# ----
# AvOSC North
item_183 = ListItem(List=replace_42, Index=0, Wrap=True)  # -> flatten(Item)

# ----
# AvOSC East
item_184 = ListItem(List=replace_42, Index=3, Wrap=True)  # -> flatten(Item)

# ----
# AvOSC West
item_185 = ListItem(List=replace_42, Index=1, Wrap=True)  # -> flatten(Item)

equals_78 = Equality(FirstNumber=data_138, SecondNumber="1")  # -> Equality, Inequality
dispatch_111 = Dispatch(List=item_178, DispatchPattern=equals_78.Equality)  # -> ListA, ListB

equals_79 = Equality(FirstNumber=data_138, SecondNumber="1")  # -> Equality, Inequality
dispatch_112 = Dispatch(List=item_179, DispatchPattern=equals_79.Equality)  # -> ListA, ListB

equals_80 = Equality(FirstNumber=data_138, SecondNumber="1")  # -> Equality, Inequality
dispatch_113 = Dispatch(List=item_181, DispatchPattern=equals_80.Equality)  # -> ListA, ListB

equals_81 = Equality(FirstNumber=data_138, SecondNumber="1")  # -> Equality, Inequality
dispatch_114 = Dispatch(List=item_180, DispatchPattern=equals_81.Equality)  # -> ListA, ListB

equals_82 = Equality(FirstNumber=data_138, SecondNumber="1")  # -> Equality, Inequality
dispatch_115 = Dispatch(List=item_183, DispatchPattern=equals_82.Equality)  # -> ListA, ListB

equals_83 = Equality(FirstNumber=data_138, SecondNumber="1")  # -> Equality, Inequality
dispatch_116 = Dispatch(List=item_182, DispatchPattern=equals_83.Equality)  # -> ListA, ListB

equals_84 = Equality(FirstNumber=data_138, SecondNumber="1")  # -> Equality, Inequality
dispatch_117 = Dispatch(List=item_184, DispatchPattern=equals_84.Equality)  # -> ListA, ListB

equals_85 = Equality(FirstNumber=data_138, SecondNumber="1")  # -> Equality, Inequality
dispatch_118 = Dispatch(List=item_185, DispatchPattern=equals_85.Equality)  # -> ListA, ListB

# ----
# SumOSC North
item_186 = ListItem(List=replace_41, Index=0, Wrap=True)  # -> flatten(Item)

# ----
# SumOSC West
item_187 = ListItem(List=replace_41, Index=1, Wrap=True)  # -> flatten(Item)

# ----
# SumOSC East
item_188 = ListItem(List=replace_41, Index=3, Wrap=True)  # -> flatten(Item)

# ----
# W/F East
item_189 = ListItem(List=replace_40, Index=3, Wrap=True)  # -> flatten(Item)

# ----
# SumOSC South
item_190 = ListItem(List=replace_41, Index=2, Wrap=True)  # -> flatten(Item)

# ----
# W/F North
item_191 = ListItem(List=replace_40, Index=0, Wrap=True)  # -> flatten(Item)

# ----
# W/F South
item_192 = ListItem(List=replace_40, Index=2, Wrap=True)  # -> flatten(Item)

# ----
# W/F West
item_193 = ListItem(List=replace_40, Index=1, Wrap=True)  # -> flatten(Item)

equals_86 = Equality(FirstNumber=data_138, SecondNumber="1")  # -> Equality, Inequality
dispatch_119 = Dispatch(List=item_186, DispatchPattern=equals_86.Equality)  # -> ListA, ListB

equals_87 = Equality(FirstNumber=data_138, SecondNumber="1")  # -> Equality, Inequality
dispatch_120 = Dispatch(List=item_188, DispatchPattern=equals_87.Equality)  # -> ListA, ListB

equals_88 = Equality(FirstNumber=data_138, SecondNumber="1")  # -> Equality, Inequality
dispatch_121 = Dispatch(List=item_187, DispatchPattern=equals_88.Equality)  # -> ListA, ListB

equals_89 = Equality(FirstNumber=data_138, SecondNumber="1")  # -> Equality, Inequality
dispatch_122 = Dispatch(List=item_190, DispatchPattern=equals_89.Equality)  # -> ListA, ListB

equals_90 = Equality(FirstNumber=data_138, SecondNumber="1")  # -> Equality, Inequality
dispatch_123 = Dispatch(List=item_192, DispatchPattern=equals_90.Equality)  # -> ListA, ListB

equals_91 = Equality(FirstNumber=data_138, SecondNumber="1")  # -> Equality, Inequality
dispatch_124 = Dispatch(List=item_193, DispatchPattern=equals_91.Equality)  # -> ListA, ListB

equals_92 = Equality(FirstNumber=data_138, SecondNumber="1")  # -> Equality, Inequality
dispatch_125 = Dispatch(List=item_191, DispatchPattern=equals_92.Equality)  # -> ListA, ListB

equals_93 = Equality(FirstNumber=data_138, SecondNumber="1")  # -> Equality, Inequality
dispatch_126 = Dispatch(List=item_189, DispatchPattern=equals_93.Equality)  # -> ListA, ListB

separatezonesbyprogram = Honeybee_SeparateZonesByProgram(HBZones=flatten(conditionedunconditioned_7.conditionedZones))  # -> zonePrograms, HBZones; plug-in component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

mindex_10 = MemberIndex(Set=flatten(separatezonesbyprogram.zonePrograms), Member="MidriseApartment::Office")  # -> Index, Count

branch_23 = TreeBranch(Tree=separatezonesbyprogram.HBZones, Path=mindex_10.Index, MaintainPaths=True)

area_93 = Area(Geometry=geo_92)  # -> Area, Centroid
area_94 = Area(Geometry=branch_23)  # -> Area, Centroid
cps_2 = ClosestPoints(Point=area_94.Centroid, Cloud=area_93.Centroid, Count="1")  # -> ClosestPoint, flatten(CPIndex), Distance
panel_600 = Panel("find office units")
panel_601 = Panel(cps_2.CPIndex)

strnum_17 = Ladybug_SeparateData(inputList=flatten(branch_22))  # -> numbers, strings; plug-in component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

panel_602 = Panel("occupiedHours")
dispatch_127 = Dispatch(List=strnum_17.numbers, DispatchPattern=equals_17.Equality)  # -> ListA, ListB

subtraction_11 = Subtraction(A=dispatch_127.ListA, B=dispatch_25.ListA)
# https://www.researchgate.net/publication/280443859_ASSESSMENT_OF_OVERHEATING_RISK_IN_DWELLINGS
python_46 = GhPythonScript(x=subtraction_11)  # -> out, a
# ---------- python_46: Python ----------
__author__ = "Siser"
__version__ = "2022.03.16"

import rhinoscriptsyntax as rs
if x > 0:
    a = x
else:
    a = 0
# ---------- end python_46 ----------
division_26 = Division(A=python_46.a, B=lng_65)
# https://docs.google.com/document/d/1_ABXp2oo5wBXnJP1ug-vCfKyITPYSoL8V3BUiou2ZRM/edit
ma_25 = MassAddition(Input=division_26)  # -> flatten(Result), PartialResults

# ----
# https://www.zerocarbonhub.org/sites/default/files/resources/reports/ZCH-OverheatingEvidenceReview-Definitions.pdf
# IOD
data_224 = Data(ma_25.Result)
null_17 = NullItem(Item=data_224)  # -> NullFlags, InvalidFlags, Description
dispatch_128 = Dispatch(List=data_224, DispatchPattern=null_17.NullFlags)  # -> ListA, ListB

equals_94 = Equality(FirstNumber=data_138, SecondNumber="1")  # -> Equality, Inequality
dispatch_129 = Dispatch(List=dispatch_128.ListB, DispatchPattern=equals_94.Equality)  # -> ListA, ListB

# ----
# floorArea of Units
# UNITS
zoneattributelist_2 = Honeybee_ZoneAttributeList({"Name": "name", "Zone Program": "zoneProgram", "Zone Floor Area": "zoneFloorArea", "Zone Volume": "zoneVolume", "Building Program": "bldgProgram", "Is Conditioned": "isConditioned", "HVAC System Type": "HVACSystem", "Occupancy Schedule": "occupancySchedule", "Occupancy Activity Schedule": "occupancyActivitySch", "Heating SetPoint Schedule": "heatingSetPtSchedule"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}, selected="Zone Floor Area")
labelzones_2 = Honeybee_LabelZones(HBZones=flatten(conditionedunconditioned_7.conditionedZones), attribute=zoneattributelist_2)  # -> zoneTxtLabels, labelBasePts, brepTxtLabels, zoneWireFrames; plug-in component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
roundd_7 = RoundToDecimalPlace(NumberX=labelzones_2.zoneTxtLabels, DecimalPlace="1", RoundType=0)  # -> Rounded, Difference

equals_95 = Equality(FirstNumber=data_138, SecondNumber="1")  # -> Equality, Inequality
dispatch_130 = Dispatch(List=roundd_7.Rounded, DispatchPattern=equals_95.Equality)  # -> ListA, ListB

rec_8 = DataRecorder(dispatch_130.ListB, DataLimit=-10, RecordData=True)
panel_605 = Panel(rec_8)

# ----
# formFactor of Units
data_225 = Data(flatten(division_20))
roundd_8 = RoundToDecimalPlace(NumberX=data_225, DecimalPlace="3", RoundType=0)  # -> Rounded, Difference

equals_96 = Equality(FirstNumber=data_138, SecondNumber="1")  # -> Equality, Inequality
dispatch_131 = Dispatch(List=roundd_8.Rounded, DispatchPattern=equals_96.Equality)  # -> ListA, ListB

rec_9 = DataRecorder(dispatch_131.ListB, DataLimit=-10, RecordData=True)
panel_607 = Panel(rec_9)

# ----
# SkyExposure_East
item_194 = ListItem(List=replace_39, Index=3, Wrap=True)  # -> flatten(Item)

equals_97 = Equality(FirstNumber=data_138, SecondNumber="1")  # -> Equality, Inequality
dispatch_132 = Dispatch(List=item_194, DispatchPattern=equals_97.Equality)  # -> ListA, ListB

data_226 = Data(dispatch_132.ListB)
rec_10 = DataRecorder(data_226, DataLimit=-10, RecordData=True)
panel_609 = Panel(rec_10)

# ----
# SkyExposure_West
item_195 = ListItem(List=replace_39, Index=1, Wrap=True)  # -> flatten(Item)

equals_98 = Equality(FirstNumber=data_138, SecondNumber="1")  # -> Equality, Inequality
dispatch_133 = Dispatch(List=item_195, DispatchPattern=equals_98.Equality)  # -> ListA, ListB

rec_11 = DataRecorder(dispatch_133.ListB, DataLimit=-10, RecordData=True)
panel_611 = Panel(rec_11)

# ----
# SkyExposure_South
item_196 = ListItem(List=replace_39, Index=2, Wrap=True)  # -> flatten(Item)

equals_99 = Equality(FirstNumber=data_138, SecondNumber="1")  # -> Equality, Inequality
dispatch_134 = Dispatch(List=item_196, DispatchPattern=equals_99.Equality)  # -> ListA, ListB

data_227 = Data(dispatch_134.ListB)
rec_12 = DataRecorder(data_227, DataLimit=-10, RecordData=True)
panel_613 = Panel(rec_12)

# ----
# SkyExposure_North
item_197 = ListItem(List=replace_39, Index=0, Wrap=True)  # -> flatten(Item)

equals_100 = Equality(FirstNumber=data_138, SecondNumber="1")  # -> Equality, Inequality
dispatch_135 = Dispatch(List=item_197, DispatchPattern=equals_100.Equality)  # -> ListA, ListB

rec_13 = DataRecorder(dispatch_135.ListB, DataLimit=-10, RecordData=True)
panel_615 = Panel(rec_13)

# ----
# Unıt ID
data_228 = Data(join_18)

equals_101 = Equality(FirstNumber=data_138, SecondNumber="1")  # -> Equality, Inequality
dispatch_136 = Dispatch(List=data_228, DispatchPattern=equals_101.Equality)  # -> ListA, ListB

rec_14 = DataRecorder(dispatch_136.ListB, DataLimit=-10, RecordData=True)
panel_617 = Panel(rec_14)

list_of_recordings_2 = Panel("""parcelUBEM
blockUBEM
UnitID
verticalBoundaryCondition
formFactor
floorArea
widthToDepth
NumberOfPeople
unitwwrNorth
unitwwrWest
unitwwrSouth
unitwwrEast
skyExposureNorth
skyExposureWest
skyExposureSouth
skyExposureEast
WFNorth
WFWest
WFSouth
WFEast
HeatSet
LightDens
ConsDate
uWall
uWindow
uRoof
uGroundFloor
Infiltration
UBEMOcc
z-axisOfUnit
OSCNorthAvg
OSCWestAvg
OSCSouthAvg
OSCEastAvg
TotOSCNorth
TotOSCWest
TotOSCSouth
TotOSCEast""")

list_of_recordings_3 = Panel("""parcelUBEM
blockUBEM
UnitID
verticalBoundaryCondition
formFactor
floorArea
widthToDepth
NumberOfPeople
unitwwrNorth
unitwwrWest
unitwwrSouth
unitwwrEast
skyExposureNorth
skyExposureEast
skyExposureSouth
skyExposureWest
WFNorth
WFWest
WFSouth
WFEast
HeatSet
LightDens
ConsDate
uWall
uWindow
uRoof
uGroundFloor
Infiltration
UBEMOcc
heating
cooling
IOD
peopleGain
TotSolarGain
infiltEnergy
natVentEnergy
airTemp
electLight
electEquip
z-axisOfUnit
OSCNorthAvg
OSCWestAvg
OSCSouthAvg
OSCEastAvg
TotOSCNorth
TotOSCWest
TotOSCSouth
TotOSCEast""")

# ----
# CSV
# RECORDINGS
# PARAMS
# M.L.
lng_142 = ListLength(List=list_of_recordings_2)

# ----
# CSV
# RECORDINGS
# ALL
# M.L.
# https://discourse.mcneel.com/t/improvement-of-data-recorder-rec/56940/7
lng_143 = ListLength(List=list_of_recordings_3)
panel_618 = Panel("improved data recorder")

series_55 = Series(Start=0, Step=1, Count=lng_142)

weave_49 = Weave(
    Pattern=series_55,
    Stream0=dispatch_71.ListB,
    Stream1=dispatch_75.ListB,
    Stream2=dispatch_136.ListB,
    Stream3=dispatch_70.ListB,
    Stream4=dispatch_131.ListB,
    Stream5=dispatch_130.ListB,
    Stream6=dispatch_69.ListB,
    Stream7=dispatch_28.ListB,
    Stream8=dispatch_111.ListB,
    Stream9=dispatch_113.ListB,
    Stream10=dispatch_112.ListB,
    Stream11=dispatch_114.ListB,
    Stream12=dispatch_135.ListB,
    Stream13=dispatch_133.ListB,
    Stream14=dispatch_134.ListB,
    Stream15=dispatch_132.ListB,
    Stream16=dispatch_125.ListB,
    Stream17=dispatch_124.ListB,
    Stream18=dispatch_123.ListB,
    Stream19=dispatch_126.ListB,
    Stream20=dispatch_56.ListB,
    Stream21=data_197,
    Stream22=dispatch_74.ListB,
    Stream23=dispatch_68.ListB,
    Stream24=dispatch_27.ListB,
    Stream25=dispatch_67.ListB,
    Stream26=dispatch_61.ListB,
    Stream27=dispatch_73.ListB,
    Stream28=data_196,
    Stream29=dispatch_76.ListB,
    Stream30=dispatch_115.ListB,
    Stream31=dispatch_118.ListB,
    Stream32=dispatch_116.ListB,
    Stream33=dispatch_117.ListB,
    Stream34=dispatch_119.ListB,
    Stream35=dispatch_121.ListB,
    Stream36=dispatch_122.ListB,
    Stream37=dispatch_120.ListB,
    NullGaps=False)

partition_70 = PartitionList(List=weave_49, Size=lng_142)  # -> simplify(Chunks)
join_30 = TextJoin(Text=partition_70, Join=",")  # -> simplify(Result)

tstat_26 = TreeStatistics(Tree=join_30)  # -> Paths, Length, Count
lng_144 = ListLength(List=tstat_26.Length)
series_56 = Series(Start=0, Step=1, Count=lng_144)
dup_91 = DuplicateData(Data="}", Number=lng_144, Order=True)
dup_92 = DuplicateData(Data=";", Number=lng_144, Order=True)
dup_93 = DuplicateData(Data=item_115, Number=lng_144, Order=True)
dup_94 = DuplicateData(Data="{", Number=lng_144, Order=True)
merge_122 = Merge(
    Data1=simplify(graft(dup_94)),
    Data2=simplify(graft(dup_93)),
    Data3=simplify(graft(dup_92)),
    Data4=simplify(graft(series_56)),
    Data5=simplify(graft(dup_91)))
join_31 = TextJoin(Text=merge_122)
replace_43 = ReplacePaths(Data=join_30, Search=flatten(tstat_26.Paths), Replace=flatten(join_31))

# ----
# https://discourse.mcneel.com/t/improvement-of-data-recorder-rec/56940/7
toggle_19 = BooleanToggle(True)
data_rec = PythonScript(x=replace_43, enable=toggle_19, reset=button, limit="1000000")  # -> x; inputs x: tree, enable: Boolean, reset: Boolean, limit: Int32
# ---------- data_rec: Python ----------
from Grasshopper import DataTree
if reset or 'rec' not in globals(): rec = DataTree[object]()
if enable and not reset: rec.MergeTree(x)
if limit > 0:
  for branch in rec.Branches:
    if branch.Count > limit:
      branch.RemoveRange(0, branch.Count - limit)
x = rec
# ---------- end data_rec ----------

panel_620 = Panel(data_rec)

panel_621 = Panel("csv recording")
c_script_2 = CSharpScript(save=Toggle(True), path=weave_29, data=flatten(data_rec))  # inputs save: Boolean, path: String, data: list of String
# ---------- c_script_2: C# ----------
    if(save){
      var fileinfo = new System.IO.FileInfo(path);
      if(!fileinfo.Directory.Exists){
        fileinfo.Directory.Create();
      }
      
      var sw = fileinfo.CreateText();
      for(int i = 0; i < data.Count; i++){
        string row = data[i];
        if(i < data.Count - 1){
          sw.WriteLine(row);
        }else{
          sw.Write(row);
        }
      }
      
      sw.Flush();
      sw.Close();
    }
# ---------- end c_script_2 ----------

series_57 = Series(Start=0, Step=1, Count=lng_143)

weave_50 = Weave(
    Pattern=series_57,
    Stream0=dispatch_71.ListB,
    Stream1=dispatch_75.ListB,
    Stream2=dispatch_136.ListB,
    Stream3=dispatch_70.ListB,
    Stream4=dispatch_131.ListB,
    Stream5=dispatch_130.ListB,
    Stream6=dispatch_69.ListB,
    Stream7=dispatch_28.ListB,
    Stream8=dispatch_111.ListB,
    Stream9=dispatch_113.ListB,
    Stream10=dispatch_112.ListB,
    Stream11=dispatch_114.ListB,
    Stream12=dispatch_135.ListB,
    Stream13=data_226,
    Stream14=data_227,
    Stream15=dispatch_133.ListB,
    Stream16=dispatch_125.ListB,
    Stream17=dispatch_124.ListB,
    Stream18=dispatch_123.ListB,
    Stream19=dispatch_126.ListB,
    Stream20=dispatch_56.ListB,
    Stream21=data_197,
    Stream22=dispatch_74.ListB,
    Stream23=dispatch_68.ListB,
    Stream24=dispatch_27.ListB,
    Stream25=dispatch_67.ListB,
    Stream26=dispatch_61.ListB,
    Stream27=dispatch_73.ListB,
    Stream28=data_196,
    Stream29=dispatch_101.ListB,
    Stream30=dispatch_102.ListB,
    Stream31=dispatch_129.ListB,
    Stream32=dispatch_100.ListB,
    Stream33=dispatch_105.ListB,
    Stream34=dispatch_104.ListB,
    Stream35=dispatch_103.ListB,
    Stream36=dispatch_99.ListB,
    Stream37=dispatch_108.ListB,
    Stream38=dispatch_107.ListB,
    Stream39=dispatch_76.ListB,
    Stream40=dispatch_115.ListB,
    Stream41=dispatch_118.ListB,
    Stream42=dispatch_116.ListB,
    Stream43=dispatch_117.ListB,
    Stream44=dispatch_119.ListB,
    Stream45=dispatch_121.ListB,
    Stream46=dispatch_122.ListB,
    Stream47=dispatch_120.ListB,
    NullGaps=False)

partition_71 = PartitionList(List=weave_50, Size=lng_143)  # -> simplify(Chunks)
join_32 = TextJoin(Text=partition_71, Join=",")  # -> simplify(Result)

tstat_27 = TreeStatistics(Tree=join_32)  # -> Paths, Length, Count
lng_145 = ListLength(List=tstat_27.Length)
series_58 = Series(Start=0, Step=1, Count=lng_145)
dup_95 = DuplicateData(Data="}", Number=lng_145, Order=True)
dup_96 = DuplicateData(Data=";", Number=lng_145, Order=True)
dup_97 = DuplicateData(Data=item_116, Number=lng_145, Order=True)
dup_98 = DuplicateData(Data="{", Number=lng_145, Order=True)
merge_123 = Merge(
    Data1=simplify(graft(dup_98)),
    Data2=simplify(graft(dup_97)),
    Data3=simplify(graft(dup_96)),
    Data4=simplify(graft(series_58)),
    Data5=simplify(graft(dup_95)))
join_33 = TextJoin(Text=merge_123)
replace_44 = ReplacePaths(Data=join_32, Search=flatten(tstat_27.Paths), Replace=flatten(join_33))

data_rec_2 = PythonScript(x=replace_44, enable=Toggle(True), reset=button, limit="1000000")  # -> x; inputs x: tree, enable: Boolean, reset: Boolean, limit: Int32; same code as data_rec
panel_622 = Panel(data_rec_2)

c_script_3 = CSharpScript(save=Toggle(True), path=weave_28, data=flatten(data_rec_2))  # inputs save: Boolean, path: String, data: list of String; same code as c_script_2
