# Grasshopper definition KBEM_Ankara_220622.gh (Grasshopper 1.0.7)
# plug-ins: Pufferfish, Colibri

panel = Panel("""0.61
1.24
1.42
0.39
0.49
1.44
0.68
0.47
0.67
1.65
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""")
panel_2 = Panel("UwallConcrete Generated")

# ----
# EKB Construction data for UwallMasonry
ekbuwallconcrete = Panel("""0.67
0.68
1.83
2.25
1.19
0.42
0.48
1.69
0.61
1.99
1.9
1.87
0.67
1.32
0.41
0.38
0.27
0.36""")
parcelubem = Panel("""7
4
4
5
17
2
5
5
3
11
0
2
16
1
7
1
2
3""")
blockubem = Panel("""36
46
6
43
42
36
17
8
46
24
39
50
46
42
44
46
37
39""")

# ----
# EKB Construction data for UwallConcrete
ekbuwallconcrete_2 = Panel("""0.68
0.68
0.47
0.56
0.45
0.34
0.34
1.36
1.44
1.48
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""")
parcelubem_2 = Panel("""15
10
14
8
10
20
10
22
4
7
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""")
blockubem_2 = Panel("""17
3
24
17
20
31
49
3
23
24
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""")

panel_3 = Panel("""1.47
0.66
0.43
1.24
1.46
1.57
0.67
1.32
0.35
1.86
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""")
panel_4 = Panel("UwallMasonry Generated")

# ----
# Add All Buildings
# https://docs.google.com/spreadsheets/d/1OhTFdR_YYA37wmvLVmGtL0KkaVhocj32rAnVd95tpRM/edit#gid=0
panel_5 = Panel("=IFS(H7537=\"office\", 1, H7537=\"dwelling\",0, H7537=\"public\",2, H7537=\"school\",3)")
panel_6 = Panel("""1
1
0
0
0
0
0
0
0
1
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""")

panel_7 = Panel("0")  # disabled
# to see the implementation of cooling,
# 
# check before
# KBEM_Ankara_060522_As-Is.gh file
# cooling units are excluded from Ankara simulations: 0: residential non-cooling
# 5: residential with cooling
# 1: office unit
panel_8 = Panel("if residential")  # disabled
equals = Equality(FirstNumber=panel_6, SecondNumber=panel_7)  # -> Equality, Inequality; disabled
dispatch = Dispatch(List=panel_6, DispatchPattern=equals.Equality)  # -> ListA, ListB; disabled

# ----
# FOR ANKARA, Cooling System Ratio Inside Residential Units, %
lng = ListLength(List=dispatch.ListA)  # disabled
panel_9 = Panel("3")  # disabled
pcent = Percentage(Number=lng, Percent=panel_9)  # disabled
round = Round(Number=pcent)  # -> Nearest, Floor, Ceiling; disabled
series = Series(Start=0, Step=1, Count=round.Floor)  # disabled

# ----
# select which residential units will have cooling
listdexs = ListIndices(List=panel_6)  # disabled
# Residential with cooling
dispatch_2 = Dispatch(List=listdexs, DispatchPattern=equals.Equality)  # -> ListA, ListB; disabled
jitter = Jitter(List=dispatch_2.ListA, Jitter=1, Seed=2)  # -> Values, Indices; disabled
item = ListItem(List=jitter.Values, Index=series, Wrap=True)  # disabled

# ----
# add residential with cooling units
panel_10 = Panel("5")  # disabled
replace = ReplaceItems(List=panel_6, Item=panel_10, Indices=item, Wrap=False)  # disabled

# ----
# Construction
const_date = Panel("""1960
1960
1960
1960
1960
1960
1975
1960
1960
1980
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""")
parcelubem_3 = Panel("""0
1
2
3
4
5
0
1
2
0
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""")
block_ubem = Panel("""0
0
0
0
0
0
1
1
1
2
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""")

# ----
# Construction
const_date_2 = Panel("""2014
1990
1988
2015
1993
2015
1960
1970
1960
1967
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""")
parcelubem_4 = Panel("""0
1
2
3
4
5
6
7
8
0
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""")
block_ubem_2 = Panel("""0
0
0
0
0
0
0
0
0
1
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""")

panel_11 = Panel("""0.23
0.24
0.21
0.18
0.13
0.16
0.20
0.22
0.21
0.17
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""")

# ----
# EKB Construction data for UwallConcrete
ekbuwallconcrete_3 = Panel("""0.10
0.16
0.11
0.11
0.10
0.14
0.20
0.12
0.16
0.13
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""")
parcelubem_5 = Panel("""2
4
1
2
15
7
1
4
11
1
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""")
blockubem_3 = Panel("""0
0
3
3
3
5
1
1
1
2
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""")

merge = Merge(Data1=graft(parcelubem), Data2=graft(blockubem))

# ----
# BAHÇELİEVLER
# neighborhood related data
# Add All
# Buildings
# Mixed or Not
panel_13 = Panel("""1
1
0
0
0
0
1
1
1
1
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""")

# ----
# Mixed or Not
panel_14 = Panel("""0
0
0
0
0
0
0
0
0
1
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""")

# ----
# heatingSetPoint
panel_15 = Panel("""23.24
22.89
22.47
22.19
21.14
21.43
21.53
23.65
20.32
21.01
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""")
panel_16 = Panel("""23.09
20.08
22.53
23.00
21.99
20.90
20.79
23.04
20.68
20.35
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""")
merge_2 = Merge(Data1=panel_16, Data2=panel_15)

# ----
# Add Only
# Residential Buildings
vtwindow = Panel("""0.43
0.17
0.51
0.43
0.42
0.36
0.28
0.55
0.34
0.32
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""")
shgcwindow = Panel("""0.767
0.398
0.330
0.499
0.451
0.592
0.468
0.467
0.361
0.437
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""")
wwr = Panel("""0.23
0.24
0.10
0.21
0.16
0.18
0.13
0.16
0.20
0.22
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""")
ugroundfloor = Panel("""0.75
1.93
0.75
0.57
0.59
1.93
0.75
0.55
0.75
0.74
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""")
uwindow = Panel("""1.20
2.7
2.7
2.60
2.5
1.95
1.20
2.69
2.70
2.90
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""")
uroof = Panel("""0.34
0.39
0.43
0.65
0.58
0.43
0.53
0.36
0.43
0.39
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""")
uwall = Panel("""1.00
0.49
0.49
0.34
0.49
0.39
0.47
0.82
0.47
0.49
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""")

# ----
# Add All
# Buildings
# Real Data
# Building
# Parcel No
panel_17 = Panel("""0
1
2
3
4
5
6
7
8
9
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""")

# ----
# parcel_block ordered lists
# https://docs.google.com/spreadsheets/d/1OXMzIesyRE01nLoX3t1EUuKLoFw8Ft8k3F_-NCRB1iU/edit#gid=607337562
# Mixed or Not
panel_18 = Panel("""1
1
0
0
1
0
0
1
0
1
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""")

# ----
# Real Data
# Building
# Parcel No
panel_19 = Panel("""0
1
2
3
4
5
0
1
2
0
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""")

panel_20 = Panel("""1962
1960
2010
2008
1958
1974
1982
1980
2001
1974
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""")  # disabled
panel_21 = Panel("construction date transformation")
python = GhPythonScript(x=panel_20)  # -> out, a; inputs x: Int32; disabled
# ---------- python: Python ----------
__author__ = "Siser"
__version__ = "2022.03.17"

import rhinoscriptsyntax as rs
if x < 1980:
    a = 1960
elif x < 2000 and x >= 1980:
    a = 1980
else:
    a = 2000
# ---------- end python ----------
panel_22 = Panel(python.a)  # disabled

# ----
# Add All
# Buildings
# Real Data
# # of floor
# https://docs.google.com/spreadsheets/d/1HeNCj9cvZVeU73J5g7iW2pWBtRtmiiCzG14sOCkgrVs/edit#gid=0
panel_23 = Panel("""4
4
4
4
4
4
5
5
5
5
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""")

# ----
# EMEK
# neighborhood related data
# https://docs.google.com/spreadsheets/d/1dVqoGlL5SpjtWETs8iGa3fb79QarzpHjeZR7tKplJOw/edit#gid=2128463022
# Real Data
# # of floor
real_data_of_floor = Panel("""9
9
9
10
10
10
4
4
4
1
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""")

# ----
# Real Data
# Building
# Parcel No
panel_24 = Panel("""0
1
2
3
4
5
6
7
8
0
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""")

panel_25 = Panel("compare two points")  # disabled
python_2 = PythonScript()  # -> out, a; inputs x: list of Point3d; disabled
# ---------- python_2: Python ----------
if x[0] == x[1]:
    a =True
    print("centroids are the same")
else:
    a =False
    print("centroids are not the same")
# ---------- end python_2 ----------

# ----
# neighborhood related data
# https://docs.google.com/spreadsheets/d/1L3Ca3pI_2Zk8sqpA5S26HTBe5FzKtIOFTXeKStPdVgI/edit#gid=1110302639
# Real Data
# # of floor
real_data_of_floor_2 = Panel("""6
5
5
6
5
5
5
3
5
5
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""")

# ----
# # of Units of
# the building
of_units_of_the_building = Panel("""21
21
21
20
20
20
19
9
13
1
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""")

# ----
# https://docs.google.com/spreadsheets/d/18MLfzQqm2u-x1I9CiO8GDrrBI3HEgol9LwWBEFC5yFs/edit#gid=0
# https://docs.google.com/spreadsheets/d/1OhTFdR_YYA37wmvLVmGtL0KkaVhocj32rAnVd95tpRM/edit#gid=0
parcel = Panel("""0
0
0
0
0
0
0
0
0
0
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""")
block = Panel("""0
0
0
0
0
0
0
0
0
0
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""")

# ----
# Random Distribution for all Construction Sets: https://docs.google.com/document/d/1WU0D6LcI17LYl9msHEWG7eir8bg52xUF9ubXD48ZJ14/edit
# Internal Loads
boiler_efficiency = Panel("""0.878
0.942
0.915
0.842
0.833
0.903
0.825
0.859
0.893
0.862
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""")
infiltration = Panel("""0.000306
0.000449
0.000338
0.000315
0.000356
0.000303
0.000429
0.000458
0.000496
0.000422
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""")

# ----
# # of Units of
# the building
of_units_of_the_building_2 = Panel("""15
17
11
11
8
12
10
15
8
15
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""")

# ----
# Add All
# Buildings
# # of units per building
sqr = Square(Value=block)
# parcel_block ordered lists
sqr_2 = Square(Value=parcel)
addition = Addition(A=sqr_2, B=sqr)

# ----
# Generated
# # of Units
# Per Floor
division = Division(A=of_units_of_the_building, B=real_data_of_floor)
round_2 = Round(Number=division)  # -> Nearest, Floor, Ceiling

# ----
# ppl/m2
panel_26 = Panel("""0.0542
0.0338
0.0318
0.0101
0.0366
0.0335
0.0313
0.0398
0.0409
0.0260
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""")
# YUKARI BAHÇELİEVLER
panel_27 = Panel("""0.0358
0.0336
0.0390
0.0423
0.0447
0.0444
0.0454
0.0168
0.0383
0.0413
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""")
merge_3 = Merge(Data1=panel_26, Data2=panel_27)

# ----
# check if there is 0 value for # of units
lng_2 = ListLength(List=round_2.Floor)
series_2 = Series(Start=0, Step=1, Count=lng_2)
equals_2 = Equality(FirstNumber=round_2.Floor, SecondNumber="0")  # -> Equality, Inequality
dispatch_3 = Dispatch(List=series_2, DispatchPattern=equals_2.Equality)  # -> ListA, ListB
panel_28 = Panel(dispatch_3.ListA)

# ----
# equipmentDensity
panel_29 = Panel("""3.26
0.69
3.68
4.32
4.19
5.21
2.79
2.49
3.11
2.40
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""")
panel_30 = Panel("""3.81
1.82
1.86
0.96
2.15
2.16
2.24
2.46
1.52
3.23
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""")
merge_4 = Merge(Data1=panel_29, Data2=panel_30)

# ----
# lightingDensity
panel_31 = Panel("""16.55
15.54
18.15
13.27
17.97
17.25
16.66
18.92
13.80
12.20
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""")
panel_32 = Panel("""18.32
18.03
18.29
13.91
16.59
18.98
16.27
12.67
15.68
14.45
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""")
merge_5 = Merge(Data1=panel_31, Data2=panel_32)

# ----
# Add All
# Buildings
# Construction
const_date_3 = Panel("""1960
1960
2000
2000
1960
1960
1980
1980
2000
1960
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""")
parcelubem_6 = Panel("""0
1
2
3
4
5
6
7
8
9
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""")
block_ubem_3 = Panel("""0
0
0
0
0
0
0
0
0
0
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""")

# ----
# python count consecutive duplicates in list, itertools
# https://www.w3resource.com/python-exercises/itertools/python-itertools-exercise-31.php
python_3 = GhPythonScript()  # -> out, a; inputs x: list; disabled
# ---------- python_3: Python ----------
__author__ = "Siser"
__version__ = "2022.03.08"

import rhinoscriptsyntax as rs
from itertools import groupby
a = [sum(1 for _ in group) for _, group in groupby(x)]
# ---------- end python_3 ----------

# ----
# Generated
# # of Units
# Per Floor
division_2 = Division(A=of_units_of_the_building_2, B=real_data_of_floor_2)
round_3 = Round(Number=division_2)  # -> Nearest, Floor, Ceiling

# ----
# python count consecutive duplicates in list, itertools
# https://www.w3resource.com/python-exercises/itertools/python-itertools-exercise-31.php
python_4 = GhPythonScript(x=addition)  # -> out, a; inputs x: list; same code as python_3

# ----
# # of units per building
data = Data(python_4.a)

# ----
# unitFunction
partition = PartitionList(List=panel_6, Size=data)  # -> simplify(Chunks)

panel_33 = Panel("unitFunction")
data_2 = Data(partition)

equals_3 = Equality(FirstNumber=data_2, SecondNumber="0")  # -> Equality, Inequality
dispatch_4 = Dispatch(List=data_2, DispatchPattern=equals_3.Equality)  # -> ListA, ListB

# ----
# check if there is 0 value for # of units
lng_3 = ListLength(List=round_3.Floor)
series_3 = Series(Start=0, Step=1, Count=lng_3)
equals_4 = Equality(FirstNumber=round_3.Floor, SecondNumber="0")  # -> Equality, Inequality
dispatch_5 = Dispatch(List=series_3, DispatchPattern=equals_4.Equality)  # -> ListA, ListB
panel_34 = Panel(dispatch_5.ListA)

# ----
# parcel_block ordered lists
panel_35 = Panel(round_2.Floor)

# ----
# %10 of all buildings are masonry
# according to EKB data of Bahçelievler
panel_36 = Panel("10")

# ----
# Generated
# # of Units
# Per Floor
division_3 = Division(A=python_4.a, B=panel_23)
round_4 = Round(Number=division_3)  # -> Nearest, Floor, Ceiling

panel_37 = Panel(round_3.Floor)

panel_38 = Panel(round_4.Floor)

panel_39 = Panel("DWELLING")
geo = Geometry([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])

panel_40 = Panel("COMMERCIAL")
geo_2 = Geometry([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])

panel_41 = Panel("PUBLIC")
geo_3 = Geometry([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])

panel_42 = Panel("SCHOOL")
geo_4 = Geometry([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])

boundary = BoundarySurfaces(Edges=geo)
preview = CustomPreview(Geometry=boundary, Material=ColourSwatch(SwatchColor=RGB(204, 0, 255)))

boundary_2 = BoundarySurfaces(Edges=geo_2)
preview_2 = CustomPreview(Geometry=boundary_2, Material=ColourSwatch(SwatchColor=RGB(0, 255, 30)))

boundary_3 = BoundarySurfaces(Edges=geo_3)
preview_3 = CustomPreview(Geometry=boundary_3, Material=ColourSwatch(SwatchColor=RGB(255, 0, 0)))

boundary_4 = BoundarySurfaces(Edges=geo_4)
preview_4 = CustomPreview(Geometry=boundary_4, Material=ColourSwatch(SwatchColor=RGB(0, 38, 255)))

geo_5 = Geometry([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])

geo_6 = Geometry([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])

geo_7 = Geometry([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])

geo_8 = Geometry([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])

geo_9 = Geometry([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])

geo_10 = Geometry([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])

geo_11 = Geometry([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])

geo_12 = Geometry([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])

boundary_5 = BoundarySurfaces(Edges=geo_5)
preview_5 = CustomPreview(Geometry=boundary_5, Material=ColourSwatch(SwatchColor=RGB(255, 0, 0)))

boundary_6 = BoundarySurfaces(Edges=geo_7)
preview_6 = CustomPreview(Geometry=boundary_6, Material=ColourSwatch(SwatchColor=RGB(0, 255, 30)))

boundary_7 = BoundarySurfaces(Edges=geo_6)
preview_7 = CustomPreview(Geometry=boundary_7, Material=ColourSwatch(SwatchColor=RGB(0, 38, 255)))

boundary_8 = BoundarySurfaces(Edges=geo_8)
preview_8 = CustomPreview(Geometry=boundary_8, Material=ColourSwatch(SwatchColor=RGB(204, 0, 255)))

boundary_9 = BoundarySurfaces(Edges=geo_11)
preview_9 = CustomPreview(Geometry=boundary_9, Material=ColourSwatch(SwatchColor=RGB(204, 0, 255)))

boundary_10 = BoundarySurfaces(Edges=geo_12)
preview_10 = CustomPreview(Geometry=boundary_10, Material=ColourSwatch(SwatchColor=RGB(0, 255, 30)))

boundary_11 = BoundarySurfaces(Edges=geo_9)
preview_11 = CustomPreview(Geometry=boundary_11, Material=ColourSwatch(SwatchColor=RGB(255, 0, 0)))

boundary_12 = BoundarySurfaces(Edges=geo_10)
preview_12 = CustomPreview(Geometry=boundary_12, Material=ColourSwatch(SwatchColor=RGB(0, 38, 255)))

panel_51 = Panel("BLOCK BOUNDARIES")
curve = Curve([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])

# ----
# Geometric Input
merge_6 = Merge(Data1=geo, Data2=geo_2, Data3=geo_3, Data4=geo_4)

curve_2 = Curve([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])

curve_3 = Curve([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])

# ----
# Geometric Input
merge_7 = Merge(Data1=geo_11, Data2=geo_12, Data3=geo_9, Data4=geo_10)

# ----
# Geometric Input
merge_8 = Merge(Data1=geo_8, Data2=geo_7, Data3=geo_5, Data4=geo_6)

# ----
# total # of parcels in the neighborhood
lng_4 = ListLength(List=merge_8)

series_4 = Series(Start=0, Step=1, Count=lng_4)

# ----
# 0: Bahçelievler, Ankara
# 1: Yukarı Bahçelievler, Ankara
# 2: Emek, Ankara
number_slider = Slider(0, range=0..2)
panel_54 = Panel("""0
1
2""")
item_2 = ListItem(List=panel_54, Index=number_slider, Wrap=True)

# ----
# # of units
panel_55 = Panel("""minimum stair dimensions
2m*4m""")
# RESULT
# ToDO
# old
# note it down resources
geo_13 = Geometry([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])

# ----
# Data Challenges: # of floors and # of units in the building can not match. for some cases # of floors is higher than # of units in the building
# 
# 
# https://docs.google.com/document/d/1INWO2i1du29ZDZWHUi1IJCvi89qGMdNHIzGieotD-bE/edit
panel_56 = Panel("Radius")
_40 = Data(40)

# ----
# Reference Vector
pt = ConstructPoint(XCoordinate=0, YCoordinate=0, ZCoordinate=0)
pt_2 = Point(Point(485242, 4421817, 0))
# VISUAL
# OUTPUT
# INPUT
vec2pt = Vector2Pt(PointA=pt_2, PointB=pt, Unitize=False)  # -> Vector, Length

panel_57 = Panel("Commercial")
weave = Weave(Pattern=item_2, Stream0=geo_7, Stream1=geo_12, Stream2=geo_2, NullGaps=False)

weave_2 = Weave(Pattern=item_2, Stream0=merge_8, Stream1=merge_7, Stream2=merge_6, NullGaps=False)
# neighborhood selection
panel_58 = Panel("parcelsGeometry")

# ----
# Real Data
# Building
# Parcel No
weave_3 = Weave(Pattern=item_2, Stream0=panel_17, Stream1=panel_24, Stream2=panel_19, NullGaps=False)

weave_4 = Weave(Pattern=item_2, Stream0=const_date_3, Stream1=const_date_2, Stream2=const_date, NullGaps=False)
panel_59 = Panel("Construction Date")

panel_60 = Panel("staircase ratio")

panel_61 = Panel("Public")
weave_5 = Weave(Pattern=item_2, Stream0=geo_5, Stream1=geo_9, Stream2=geo_3, NullGaps=False)

# ----
# VENTILATION PER AREA
# DO NOT USE WITH RESIDENTIAL AND OFFICE UNITS: it works with specific zone types (cleanroom, laboratories)
# http://hydrashare.github.io/hydra/viewer?owner=chriswmackey&fork=hydra_2&id=Customizing_HVAC_Systems&slide=0&scale=2.0000000000000018&offset=-769.4718387139474,-192.523115453532
boolean_toggle = BooleanToggle(False)
ach2m3_s_m2_calculator = Honeybee_infORventPerAreaCalculator(airFlowRate="0.0003", ACHorM3sM2=boolean_toggle)  # -> readMe, infPerAreaFacade, ventPerAreaFloor, allExposed, allFloors; plug-in component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

weave_6 = Weave(Pattern=item_2, Stream0=curve_3, Stream1=curve_2, Stream2=curve, NullGaps=False)
panel_62 = Panel("blockGeometry")

weave_7 = Weave(Pattern=item_2, Stream0=parcelubem_6, Stream1=parcelubem_4, Stream2=parcelubem_3, NullGaps=False)
panel_63 = Panel("parcelUBEM")

weave_8 = Weave(Pattern=item_2, Stream0=panel_23, Stream1=real_data_of_floor_2, Stream2=real_data_of_floor, NullGaps=False)
panel_64 = Panel("""Real Data
# of floor """)

# ----
# INFO/EXTRA
floor_height = Panel("3")

panel_65 = Panel("School")
weave_9 = Weave(Pattern=item_2, Stream0=geo_6, Stream1=geo_10, Stream2=geo_4, NullGaps=False)

weave_10 = Weave(Pattern=item_2, Stream0=block_ubem_3, Stream1=block_ubem_2, Stream2=block_ubem, NullGaps=False)
panel_66 = Panel("blockUBEM")

# ----
# # of Units of
# the building
weave_11 = Weave(Pattern=item_2, Stream0=python_4.a, Stream1=of_units_of_the_building_2, Stream2=of_units_of_the_building, NullGaps=False)

# ----
# SMALLEST
# SUB-STEPS
# TEST
# SUB-STEPS
# STEPS
tolerance = Panel("0.5")

# ----
# Generated
# # of Units
# Per Floor
weave_12 = Weave(Pattern=item_2, Stream0=round_4.Floor, Stream1=round_3.Floor, Stream2=round_2.Floor, NullGaps=False)

# ----
# Geometric Input
swatch = ColourSwatch(SwatchColor=RGB(0, 0, 0))
wires = BrepWireframe(Brep=weave_2, Density=-1)
preview_13 = CustomPreview(Geometry=wires, Material=swatch)

cls = Closed(Curve=weave_2)  # -> Closed, Periodic
dispatch_6 = Dispatch(List=weave_2, DispatchPattern=cls.Closed)  # -> ListA, ListB

# ---- group: if it is not closed
geo_14 = Geometry(dispatch_6.ListB)

# ----
geo_15 = Geometry(weave_6)
# x
# x
# x
# x
# x
# x
# x
# x
# x
# x
# x
# x
# x
# x
# x
# x
# x
# x
# x
# x
# x
# x
panel_67 = Panel("BLOCK BOUNDARIES")

# ----
# Sort Blocks by X,Y Coordinates
area = Area(Geometry=geo_15)  # -> Area, Centroid
pdecon = Deconstruct(Point=area.Centroid)  # -> graft(XComponent), graft(YComponent), ZComponent
avr = Average(Input=[pdecon.XComponent, pdecon.YComponent])  # -> flatten(ArithmeticMean)
sort = SortList(Keys=avr, ValuesA=geo_15)  # -> Keys, ValuesA

panel_68 = Panel("""SORTED 
BLOCKS""")
sorted_parcels = Geometry(sort.ValuesA)

panel_69 = Panel("PARCELS")
area_2 = Area(Geometry=weave_2)  # -> Area, Centroid

# ----
# Curve selection is important: while setting curves; start selection with the curve at the left bottom corner (so that sorting will start there)
# Building footprint curves in each parcel
incurve = PointInCurve(Point=area_2.Centroid, Curve=graft(sorted_parcels))  # -> Relationship, Point
if_it_is_inside = Panel("2")
equals_5 = Equality(FirstNumber=incurve.Relationship, SecondNumber=if_it_is_inside)  # -> Equality, Inequality
dispatch_7 = Dispatch(List=incurve.Point, DispatchPattern=equals_5.Equality)  # -> simplify(ListA), ListB
fsim = FindSimilarMember(Data=dispatch_7.ListA, Set=area_2.Centroid)  # -> Hit, Index

panel_70 = Panel("""SORTED 
PARCELS""")
item_3 = ListItem(List=weave_2, Index=fsim.Index, Wrap=True)

# ----
# Cull Empty Blocks
lng_5 = ListLength(List=item_3)  # -> flatten(Length)
equals_6 = Equality(FirstNumber=lng_5, SecondNumber="0")  # -> Equality, Inequality
panel_71 = Panel(equals_6.Equality)
viewer = ParamViewer(item_3)
not = GateNot(A=panel_71)
python_5 = PythonScript(InList=panel_71)  # -> TrueList, FalseList; inputs InList: list
# ---------- python_5: Python ----------
TrueList = []
FalseList = []
for id,value in enumerate(InList):
    if value == "True":
        TrueList.append(id)
    else:
        FalseList.append(id)
# ---------- end python_5 ----------
cull = CullPattern(List=viewer, CullPattern=not)
branch = TreeBranch(Tree=item_3, Path=cull, MaintainPaths=True)  # -> simplify(Branch)
lng_6 = ListLength(List=branch)  # -> flatten(Length)

partition_2 = PartitionList(List=flatten(branch), Size=lng_6)  # -> simplify(Chunks)
panel_72 = Panel("""CULLED 
EMPTY
BLOCKS""")

geo_16 = Geometry(partition_2)

# ---- group: BLOCKS
geo_17 = Geometry(sorted_parcels)
cull_i = CullIndex(List=geo_17, Indices=python_5.TrueList, Wrap=True)

# ----
area_3 = Area(Geometry=geo_16)  # -> Area, Centroid
fline = FitLine(Points=area_3.Centroid)

# ----
# Fit Line for the parcels in the block
null = NullItem(Item=fline)  # -> flatten(NullFlags), InvalidFlags, Description
# # of parcels
panel_74 = Panel(null.NullFlags)
python_6 = PythonScript(InList=panel_74)  # -> TrueList, FalseList; inputs InList: list; same code as python_5

crv_cp = CurveClosestPoint(Point=area_3.Centroid, Curve=fline)  # -> Point, Parameter, Distance
avr_2 = Average(Input=crv_cp.Distance)
smaller = SmallerThan(FirstNumber=avr_2, SecondNumber="5")  # -> flatten(SmallerThan), OrEqualTo
panel_75 = Panel(smaller.SmallerThan)
python_7 = PythonScript(InList=panel_75)  # -> TrueList, FalseList; inputs InList: list; same code as python_5

# ----
# Parcels with two or more lines
lng_7 = ListLength(List=cull_i)
series_5 = Series(Start=0, Step=1, Count=lng_7)
merge_9 = Merge(Data1=python_6.TrueList, Data2=python_7.TrueList)
cull_i_2 = CullIndex(List=series_5, Indices=merge_9, Wrap=True)

area_4 = Area(Geometry=geo_15)  # -> Area, Centroid
panel_76 = Panel("""CULLED 
EMPTY
PARCELS""")

# ----
# Parcels with less than two lines
item_4 = ListItem(List=series_5, Index=merge_9, Wrap=True)
branch_2 = TreeBranch(Tree=area_3.Centroid, Path=item_4, MaintainPaths=True)
fline_2 = FitLine(Points=branch_2)
avr_3 = Average(Input=area_4.Centroid)
Y = UnitY(Factor="1000")
move = Move(Geometry=avr_3, Motion=Y)  # -> Geometry, Transform
end = EndPoints(Curve=fline_2)  # -> Start, End
vec2pt_2 = Vector2Pt(PointA=avr_3, PointB=move.Geometry, Unitize=Toggle(True))  # -> Vector, Length
vec2pt_3 = Vector2Pt(PointA=end.Start, PointB=end.End, Unitize=Toggle(True))  # -> Vector, Length
dprod = DotProduct(VectorA=vec2pt_3.Vector, VectorB=vec2pt_2.Vector, Unitize=False)

# ----
# horizontal fitted lines:
# parcels with less than two lines
abs = Absolute(Value=dprod)
smaller_2 = SmallerThan(FirstNumber=abs, SecondNumber="0.5")  # -> flatten(SmallerThan), OrEqualTo
viewer_2 = ParamViewer(abs)
dispatch_8 = Dispatch(List=viewer_2, DispatchPattern=smaller_2.SmallerThan)  # -> ListA, ListB
branch_3 = TreeBranch(Tree=geo_16, Path=dispatch_8.ListA, MaintainPaths=True)
area_5 = Area(Geometry=branch_3)  # -> Area, Centroid
pdecon_2 = Deconstruct(Point=area_5.Centroid)  # -> XComponent, YComponent, ZComponent
sort_2 = SortList(Keys=pdecon_2.XComponent, ValuesA=branch_3)  # -> Keys, ValuesA

# ----
# single parcels in the block
# parcels with less than two lines
null_2 = NullItem(Item=dprod)  # -> NullFlags, InvalidFlags, Description
dispatch_9 = Dispatch(List=branch_2, DispatchPattern=null_2.NullFlags)  # -> ListA, ListB
viewer_3 = ParamViewer(dispatch_9.ListA)
dispatch_10 = Dispatch(List=viewer_3, DispatchPattern=flatten(null_2.NullFlags))  # -> ListA, ListB
branch_4 = TreeBranch(Tree=geo_16, Path=dispatch_10.ListA, MaintainPaths=True)

# ----
# vertical fitted lines:
# parcels with less than two lines
abs_2 = Absolute(Value=dprod)
similar = Similarity(FirstNumber=abs_2, SecondNumber="1", Threshold="10")  # -> flatten(Similarity), AbsoluteDifference
panel_77 = Panel(similar.Similarity)
viewer_4 = ParamViewer(abs_2)
dispatch_11 = Dispatch(List=viewer_4, DispatchPattern=panel_77)  # -> ListA, ListB
branch_5 = TreeBranch(Tree=geo_16, Path=dispatch_11.ListA, MaintainPaths=True)
area_6 = Area(Geometry=branch_5)  # -> Area, Centroid
pdecon_3 = Deconstruct(Point=area_6.Centroid)  # -> XComponent, YComponent, ZComponent
sort_3 = SortList(Keys=pdecon_3.YComponent, ValuesA=branch_5)  # -> Keys, ValuesA

# ----
# Parcels with two or more lines
panel_78 = Panel("{}")
split = TextSplit(Text=flatten(dispatch_11.ListA), Separators=flatten("{}"))
split_2 = TextSplit(Text=flatten(dispatch_8.ListA), Separators=flatten(panel_78))
split_3 = TextSplit(Text=flatten(dispatch_10.ListA), Separators=flatten("{}"))
item_5 = ListItem(List=split_2, Index="1", Wrap=True)  # -> flatten(Item)
item_6 = ListItem(List=split, Index="1", Wrap=True)  # -> flatten(Item)
item_7 = ListItem(List=split_3, Index="1", Wrap=True)  # -> flatten(Item)
merge_10 = Merge(Data1=item_7, Data2=item_6, Data3=item_5)
data_3 = Data(item_4)
equals_7 = Equality(FirstNumber=data_3, SecondNumber=graft(merge_10))  # -> Equality, Inequality
panel_79 = Panel(equals_7.Equality)
python_8 = PythonScript(InList=panel_79)  # -> flatten(TrueList), FalseList; inputs InList: list; same code as python_5
cull_i_3 = CullIndex(List=data_3, Indices=python_8.TrueList, Wrap=True)
ins = InsertItems(List=cull_i_2, Item=cull_i_3, Indices=Toggle(False), Wrap=True)
sort_4 = SortList(Keys=ins, ValuesA=ins)  # -> Keys, ValuesA

geo_18 = Geometry(sorted_parcels)
cull_i_4 = CullIndex(List=geo_18, Indices=python_5.TrueList, Wrap=True)
geo_19 = Geometry(simplify(graft(cull_i_4)))

# ----
# Parcels with two or more line indices
data_4 = Data(sort_4.ValuesA)

branch_6 = TreeBranch(Tree=area_3.Centroid, Path=data_4, MaintainPaths=True)
branch_7 = TreeBranch(Tree=geo_19, Path=data_4, MaintainPaths=True)
disc = Discontinuity(Curve=branch_7, Level=1)  # -> simplify(Points), Parameters
area_7 = Area(Geometry=branch_7)  # -> Area, flatten(Centroid)
vec2pt_4 = Vector2Pt(PointA=graft(area_7.Centroid), PointB=simplify(branch_6), Unitize=False)  # -> simplify(Vector), Length
merge_11 = Merge(Data1=branch_6, Data2=disc.Points)
plfit = PlaneFit(Points=merge_11)  # -> Plane, Deviation
unit = UnitVector(Vector=vec2pt_4.Vector)
# Defining Positions of Parcels in the Block
# according to degree
deplane = DeconstructPlane(Plane=plfit.Plane)  # -> Origin, XAxis, YAxis, ZAxis
abs_3 = Absolute(Value=deplane.XAxis)
neg = Negative(Value=abs_3)
dprod_2 = DotProduct(VectorA=neg, VectorB=unit, Unitize=False)
dprod_3 = DotProduct(VectorA=deplane.YAxis, VectorB=unit, Unitize=False)
python_9 = GhPythonScript(x=dprod_2, y=dprod_3)  # -> out, a
# ---------- python_9: Python ----------
__author__ = "jhorikawa"
__version__ = "2020.07.27"

import rhinoscriptsyntax as rs
import math

a = math.atan2(x, y)
# ---------- end python_9 ----------

# ----
# single parcels in the block
# parcels with less than two lines
area_8 = Area(Geometry=branch_4)  # -> Area, Centroid

# ----
# vertical fitted lines:
# parcels with less than two lines
area_9 = Area(Geometry=sort_3.ValuesA)  # -> Area, Centroid

# ----
# horizontal fitted lines:
# parcels with less than two lines
area_10 = Area(Geometry=sort_2.ValuesA)  # -> Area, Centroid

# ----
# # of blocks in the neighborhood
lng_8 = ListLength(List=equals_6.Equality)

# ----
# 01.ORDERING BUILDINGS
# Define Empty List
panel_81 = Panel("empty")
dup = DuplicateData(Data=panel_81, Number=lng_8, Order=True)

# ----
# Buildings degrees of positions
deg = Degrees(Radians=python_9.a)

# ----
# sorted parcels which buildings included
geo_20 = Geometry(geo_17)

area_11 = Area(Geometry=geo_20)  # -> Area, Centroid
sorted_points = Point(flatten(area_11.Centroid))
lng_9 = ListLength(List=sorted_points)
series_6 = Series(Start="0", Step=1, Count=lng_9)  # -> simplify(Series)

# ----
# Empty Blocks
data_5 = Data(python_5.TrueList)
replace_2 = ReplaceItems(List=dup, Item="0", Indices=data_5, Wrap=False)

# ----
# Parcels with two or more lines
pdecon_4 = Deconstruct(Point=branch_6)  # -> XComponent, YComponent, ZComponent
addition_2 = Addition(A=pdecon_4.XComponent, B=pdecon_4.YComponent)
division_4 = Division(A=addition_2, B="2")
sort_5 = SortList(Keys=deg, ValuesA=branch_6)  # -> Keys, ValuesA
sort_6 = SortList(Keys=division_4, ValuesA=branch_6)  # -> Keys, ValuesA
item_8 = ListItem(List=sort_6.ValuesA, Index=0, Wrap=True)
equals_8 = Equality(FirstNumber=sort_5.ValuesA, SecondNumber=item_8)  # -> Equality, Inequality
panel_82 = Panel(equals_8.Equality)
python_10 = PythonScript(InList=panel_82)  # -> TrueList, FalseList; inputs InList: list; same code as python_5

data_6 = Data(series_6)
partition_3 = PartitionList(List=data_6, Size="1")  # -> simplify(Chunks)

# ----
# indices of buildings in parcels with two or more line
shift = ShiftList(List=sort_5.ValuesA, Shift=python_10.TrueList, Wrap=True)  # -> simplify(List)

# ----
# indices of buildings in parcels with two or more line
geo_21 = Geometry(shift)

merge_12 = Merge(Data1=geo_21, Data2=area_8.Centroid, Data3=area_9.Centroid, Data4=area_10.Centroid)  # -> simplify(Result)

# ----
# Not-Empty Blocks
tstat = TreeStatistics(Tree=merge_12)  # -> Paths, Length, Count
data_7 = Data(python_5.FalseList)
replace_3 = ReplaceItems(List=replace_2, Item=tstat.Length, Indices=data_7, Wrap=False)

geo_22 = Geometry(flatten(merge_12))
partition_4 = PartitionList(List=geo_22, Size=replace_3)  # -> simplify(Chunks)

listdexs_2 = ListIndices(List=partition_4)
lng_10 = ListLength(List=listdexs_2)
dup_2 = DuplicateData(Data=partition_3, Number=lng_10, Order=True)  # -> simplify(graft(Data))

merge_13 = Merge(Data1=graft(listdexs_2), Data2=simplify(dup_2))
join = TextJoin(Text=merge_13, Join="_")  # -> flatten(Result)
null_3 = NullItem(Item=join)  # -> NullFlags, InvalidFlags, Description
lng_11 = ListLength(List=listdexs_2)  # -> flatten(Length)
dispatch_12 = Dispatch(List=join, DispatchPattern=null_3.NullFlags)  # -> ListA, ListB
partition_5 = PartitionList(List=dispatch_12.ListB, Size=lng_11)  # -> simplify(Chunks)

# ----
# Empty List
# tag order for parcels
data_8 = Data(flatten(partition_5))

# ----
# Empty List
# tag order for parcels
data_9 = Data(flatten(partition_5))

branch_8 = TreeBranch(Tree=geo_16, Path=data_4, MaintainPaths=True)
sort_7 = SortList(Keys=deg, ValuesA=branch_8)  # -> Keys, ValuesA
shift_2 = ShiftList(List=sort_7.ValuesA, Shift=python_10.TrueList, Wrap=True)  # -> simplify(List)
merge_14 = Merge(Data1=shift_2, Data2=branch_4, Data3=sort_3.ValuesA, Data4=sort_2.ValuesA)

# ----
# # of parcels in the blocks
# complete list of THE NEIGHBORHOOD
lng_12 = ListLength(List=merge_14)  # -> flatten(Length)

# ----
# tag order for parcels
partition_6 = PartitionList(List=data_8, Size=lng_12)  # -> simplify(Chunks)

# ----
# # of parcels in the blocks
# complete list of THE NEIGHBORHOOD
lng_13 = ListLength(List=merge_14)  # -> flatten(Length)

# ----
# tag order for parcels
partition_7 = PartitionList(List=data_9, Size=lng_13)  # -> simplify(Chunks)

# ----
# tag order for parcels
swatch_2 = ColourSwatch(SwatchColor=RGB(8, 0, 255))
tag = TextTag3D(Location=partition_4, Text=partition_5, Size="3", Colour=swatch_2, Justification=7)

preview_14 = CustomPreview(Geometry=merge_14, Material=ColourSwatch(SwatchColor=RGB(0, 0, 0)))

tstat_2 = TreeStatistics(Tree=merge_14)  # -> Paths, Length, Count
panel_83 = Panel(tstat_2.Paths)

panel_84 = Panel(partition_5)

# ----
# public and school buildings excluded list
panel_85 = Panel("PARCELS")
geo_23 = Geometry(merge_14)

panel_86 = Panel("BLOCKS")
geo_24 = Geometry(cull_i)

# ----
# Input
lng_14 = ListLength(List=geo_24)
series_7 = Series(Start=0, Step=1, Count=lng_14)
branch_9 = TreeBranch(Tree=geo_23, Path=series_7, MaintainPaths=True)

# ----
# 4edged layout transformation has applied to all parcel layouts due to energy modeling standards of E+ (adjacency problems)
# 4 edges and others
debrep = DeconstructBrep(Brep=flatten(branch_9))  # -> Faces, Edges, Vertices
_4edged_transformation = Panel("4")
lng_15 = ListLength(List=debrep.Vertices)  # -> flatten(Length)
lng_16 = ListLength(List=branch_9)  # -> flatten(Length)
equals_9 = Equality(FirstNumber=lng_15, SecondNumber=_4edged_transformation)  # -> Equality, Inequality
partition_8 = PartitionList(List=flatten(equals_9.Equality), Size=lng_16)  # -> simplify(Chunks)
dispatch_13 = Dispatch(List=branch_9, DispatchPattern=partition_8)  # -> ListA, ListB

panel_87 = Panel("4 edges")
geo_25 = Geometry(dispatch_13.ListA)

panel_88 = Panel("More than 4 edges")
geo_26 = Geometry(dispatch_13.ListB)

geo_27 = Geometry(geo_26)

# ----
# ConvexToConcave
# Transformation
debrep_2 = DeconstructBrep(Brep=flatten(geo_27))  # -> Faces, Edges, simplify(Vertices)
hull = ConvexHull(Points=debrep_2.Vertices, Plane=PlaneXY(0, 0, 0))  # -> flatten(Hull), HullZ, Indices
area_12 = Area(Geometry=flatten(geo_27))  # -> Area, Centroid
original_values = Panel(area_12.Area)
xy = XYPlane(Origin=area_12.Centroid)
scale2area = ScaleToArea(Geometry=hull.Hull, Plane=xy, Area=original_values, FactorX=1, FactorY=1, FactorZ=1)  # -> Scaled, Transform

panel_90 = Panel("""Concave
To
Convex""")
geo_28 = Geometry(scale2area.Scaled)

# ----
# Degree Resolution
degreerangeratio = Panel("15")
division_5 = Division(A="360", B=degreerangeratio)
addition_3 = Addition(A=division_5, B="1")
series_8 = Series(Start=0, Step=degreerangeratio, Count=addition_3)

# ----
# FIT 4 edged rectangle
# select smallest one
area_13 = Area(Geometry=geo_28)  # -> Area, Centroid
pl = ConstructPlane(Origin=area_13.Centroid, XAxis=Vector(1, 0, 0), YAxis=Vector(0, 1, 0))
prot = RotatePlane(Plane=pl, Angle=series_8)
brec = BoundingRectangle(Geometry=graft(geo_28), Plane=prot, Axis=0, Slide=0, Union=True)  # -> flatten(Bounding), DimensionX, DimensionY
lng_17 = ListLength(List=geo_28)  # -> flatten(Length)
lng_18 = ListLength(List=brec.Bounding)
division_6 = Division(A=lng_18, B=lng_17)
partition_9 = PartitionList(List=brec.Bounding, Size=division_6)  # -> simplify(Chunks)
area_14 = Area(Geometry=partition_9)  # -> Area, Centroid
sort_8 = SortList(Keys=area_14.Area, ValuesA=partition_9)  # -> Keys, ValuesA
item_9 = ListItem(List=sort_8.ValuesA, Index=0, Wrap=True)  # -> flatten(Item)

geo_29 = Geometry(geo_26)

lng_19 = ListLength(List=geo_29)  # -> flatten(Length)
geo_30 = Geometry(item_9)
panel_92 = Panel("""4 edged
non organized""")
partition_10 = PartitionList(List=geo_30, Size=lng_19)  # -> simplify(Chunks)

# ----
# EdgeTo4
merge_15 = Merge(Data1=geo_25, Data2=partition_10)

# ----
# non-organized 4edged building floor layouts
geo_31 = Geometry(merge_15)

# ----
# public and school buildings excluded list
# organized non-4edged building floor layouts
geo_32 = Geometry(merge_14)

# ----
# public and school buildings
merge_16 = Merge(Data1=weave, Data2=weave_5, Data3=weave_9)
disc_2 = Discontinuity(Curve=merge_16, Level=1)  # -> Points, Parameters
hull_2 = ConvexHull(Points=disc_2.Points, Plane=PlaneXY(0, 0, 0))  # -> flatten(Hull), HullZ, Indices

# ----
# Re-Organize list
area_15 = Area(Geometry=geo_31)  # -> Area, Centroid
# 02.SIMPLIFICATION
area_16 = Area(Geometry=geo_32)  # -> Area, Centroid
cps = ClosestPoints(Point=area_16.Centroid, Cloud=area_15.Centroid, Count="1")  # -> ClosestPoint, flatten(CPIndex), Distance
lng_20 = ListLength(List=area_16.Centroid)
partition_11 = PartitionList(List=cps.CPIndex, Size=flatten(lng_20))  # -> simplify(Chunks)
item_10 = ListItem(List=geo_31, Index=partition_11, Wrap=True)
area_17 = Area(Geometry=item_10)  # -> Area, Centroid
incurves = PointInCurves(Point=area_17.Centroid, Curves=hull_2.Hull)  # -> Relationship, Index, Point
python_11 = GhPythonScript(x=incurves.Relationship)  # -> out, a; inputs x: list
# ---------- python_11: Python ----------
__author__ = "orcun"
__version__ = "2021.09.25"


import rhinoscriptsyntax as rs
a = []
'2 if it is inside'
for i in range(len(x)): 
    if x[i] == 2:
        a.append(i)
# ---------- end python_11 ----------

# ----
# # of parcels in the block
data_10 = Data(flatten(lng_20))

# ----
# public and school buildings excluded list
data_11 = Data(python_11.a)

partition_12 = PartitionList(List=series_4, Size=data_10)  # -> simplify(Chunks)
cull_i_5 = CullIndex(List=partition_12, Indices=data_11, Wrap=True)  # -> simplify(flatten(List))

# ----
# public and school buildings
item_11 = ListItem(List=partition_6, Index=python_11.a, Wrap=True)  # -> flatten(Item)

# ----
# public and school buildings
data_12 = Data(python_11.a)

# ----
# tag order for parcels
# public and school buildings excluded list
cull_i_6 = CullIndex(List=partition_6, Indices=data_12, Wrap=True)  # -> simplify(List)

lng_21 = ListLength(List=cull_i_6)
panel_93 = Panel("empty list")
dup_3 = DuplicateData(Data="empty", Number=lng_21, Order=True)  # -> simplify(flatten(Data))

# ----
# public and school buildings
item_12 = ListItem(List=partition_6, Index=python_11.a, Wrap=True)  # -> flatten(Item)

# ----
# Entering EKB Data
# for Masonry Wall
panel_94 = Panel("_")
join_2 = TextJoin(Text=merge, Join=panel_94)  # -> simplify(flatten(Result))
mindex = MemberIndex(Set=join_2, Member=item_12)  # -> flatten(Index), Count

# ----
# public and school buildings excluded list
cull_i_7 = CullIndex(List=join_2, Indices=mindex.Index, Wrap=True)

mindex_2 = MemberIndex(Set=flatten(cull_i_6), Member=cull_i_7)  # -> flatten(Index), Count
lng_22 = ListLength(List=mindex_2.Index)
series_9 = Series(Start=0, Step=1, Count=lng_22)
item_13 = ListItem(List=ekbuwallconcrete, Index=series_9, Wrap=True)

# ----
# public and school buildings
item_14 = ListItem(List=partition_7, Index=python_11.a, Wrap=True)  # -> flatten(Item)

# ----
# public and school buildings
data_13 = Data(python_11.a)

# ----
# tag order for parcels
# public and school buildings excluded list
cull_i_8 = CullIndex(List=partition_7, Indices=data_13, Wrap=True)  # -> simplify(List)

lng_23 = ListLength(List=cull_i_8)
dup_4 = DuplicateData(Data="empty", Number=lng_23, Order=True)  # -> simplify(flatten(Data))

panel_96 = Panel("block-list")
data_14 = Data(lng_20)

# ----
# public and school buildings excluded list
data_15 = Data(python_11.a)

# ----
# Parcel_Block Coordinates
area_18 = Area(Geometry=merge_8)  # -> Area, Centroid
pdecon_5 = Deconstruct(Point=area_18.Centroid)  # -> XComponent, YComponent, ZComponent
partition_13 = PartitionList(List=pdecon_5.XComponent, Size=flatten(data_14))  # -> simplify(Chunks)
partition_14 = PartitionList(List=pdecon_5.YComponent, Size=flatten(data_14))  # -> simplify(Chunks)
cull_i_9 = CullIndex(List=partition_14, Indices=data_15, Wrap=True)  # -> simplify(List)
cull_i_10 = CullIndex(List=partition_13, Indices=data_15, Wrap=True)  # -> simplify(List)
panel_97 = Panel(partition_14)
panel_98 = Panel(partition_13)

# ----
# RENEWABLE_AD
data_16 = Data(flatten(lng_20))
data_17 = Data(weave_8)
partition_15 = PartitionList(List=data_17, Size=data_16)
cull_i_11 = CullIndex(List=partition_15, Indices=python_11.a, Wrap=True)  # -> simplify(List)
multiplication = Multiplication(A=cull_i_11, B="3")
Z = UnitZ(Factor=multiplication)
extr = Extrude(Base=merge_14, Direction=Z)

# ----
# 4-edged
# Ordered
# Parcels
swatch_3 = ColourSwatch(SwatchColor=RGB(255, 255, 255))
geo_33 = Geometry(item_10)
preview_15 = CustomPreview(Geometry=geo_33, Material=swatch_3)

# ----
# x
# x
# x
# x
# x
# x
# x
# x
# x
# x
# x
# x
# x
# x
# x
# x
# x
# x
# x
# x
# x
# x
panel_99 = Panel("""simplified &
ordered
parcel
layouts""")

# ----
# public and school buildings excluded list
cull_i_12 = CullIndex(List=item_10, Indices=python_11.a, Wrap=True)  # -> simplify(List)

panel_100 = Panel("# of block")
lng_24 = ListLength(List=merge_14)  # -> flatten(Length)

# ----
# if necessary,
# select and simulate,
# only,
# according to construction date
panel_101 = Panel("construction date")
data_18 = Data(weave_4)

# ----
# CONSTRUCTION DATE SELECTION
# 0 means, no selection according to construction date
panel_102 = Panel("0")
data_19 = Data(panel_102)

partition_16 = PartitionList(List=data_18, Size=lng_24)  # -> simplify(Chunks)

# ----
# public and school buildings excluded list
data_20 = Data(python_11.a)

panel_103 = Panel("""1960
1980
2000""")
equals_10 = Equality(FirstNumber=data_19, SecondNumber=panel_103)  # -> Equality, Inequality
dcon = DeleteConsecutive(Set=equals_10.Equality, Wrap=False)  # -> Set, Count
item_15 = ListItem(List=dcon.Set, Index=0, Wrap=True)
python_12 = GhPythonScript(x=item_15)  # -> out, a
# ---------- python_12: Python ----------
__author__ = "Siser"
__version__ = "2022.01.08"

import rhinoscriptsyntax as rs
if x == True:
    a = 0
else:
    a = 1
# ---------- end python_12 ----------

cull_i_13 = CullIndex(List=partition_16, Indices=data_20, Wrap=True)  # -> simplify(List)

# ----
# # of units
toggle = BooleanToggle(True)

panel_104 = Panel("0=masonry, 1=concrete")  # disabled
panel_105 = Panel("0")  # disabled
panel_106 = Panel("1")  # disabled

concrete = Panel("""0.567
1.149
1.024
1.800
1.008
1.740
0.312
2.826
0.531
0.623
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""")  # disabled
lng_25 = ListLength(List=concrete)  # disabled
dup_5 = DuplicateData(Data=panel_106, Number=lng_25, Order=True)  # disabled

masonry = Panel("""0.597
3.534
3.046
0.226
0.695
2.336
1.488
3.046
1.230
3.399
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""")  # disabled
lng_26 = ListLength(List=masonry)  # disabled
dup_6 = DuplicateData(Data=panel_105, Number=lng_26, Order=True)  # disabled

# ----
# public and school buildings excluded list
geo_34 = Geometry(cull_i_12)  # disabled
lng_27 = ListLength(List=flatten(geo_34))  # disabled

concrete_2 = Panel("163")  # disabled
masonry_2 = Panel("18")  # disabled
addition_4 = Addition(A=concrete_2, B=masonry_2)  # disabled

# ----
# organized 4edged
# building PARCELS
geo_35 = Geometry(cull_i_12)

# ----
# selection
# according to
# construction date
equals_11 = Equality(FirstNumber=cull_i_13, SecondNumber=data_19)  # -> Equality, Inequality
dispatch_14 = Dispatch(List=geo_35, DispatchPattern=equals_11.Equality)  # -> ListA, ListB
weave_13 = Weave(Pattern=python_12.a, Stream0=dispatch_14.ListA, Stream1=dispatch_14.ListB, NullGaps=False)  # -> simplify(Weave)

division_7 = Division(A=lng_27, B=addition_4)  # disabled
multiplication_2 = Multiplication(A=concrete_2, B=division_7)  # disabled
round_5 = Round(Number=multiplication_2)  # -> Nearest, Floor, Ceiling; disabled
subtraction = Subtraction(A=lng_27, B=round_5.Nearest)  # disabled

# ----
# all values are average
panel_107 = Panel("scheduleA")
genes = GenePool(Decimals=1, Maximum=1, Minimum=0, Value=[1, 1, 1, 1, 1, 1, 1, 1, 1, 1, 1, 1, 1, 1, 1, 1, 1, 1, 1, 1, 1, 1, 1, 1])

# ----
# Wall Construction
merge_17 = Merge(Data1=dup_6, Data2=dup_5)  # disabled
jitter_2 = Jitter(List=merge_17, Jitter=1, Seed=2)  # -> Values, Indices; disabled
weave_14 = Weave(Pattern=jitter_2.Values, Stream0=masonry, Stream1=concrete, NullGaps=False)  # disabled
panel_108 = Panel(weave_14)  # disabled

# ----
# 1 person
_1_person_percentage = Panel("17.9")

panel_109 = Panel("1 person percentage")
data_21 = Data(_1_person_percentage)

data_22 = Data(_1_person_percentage)

data_23 = Data(_1_person_percentage)

genes_2 = GenePool(
    Decimals=1,
    Maximum=1,
    Minimum=0,
    Value=[1, 1, 1, 1, 1, 1, 1, 1, 1, 1, 0.4, 0.4, 0.4, 0.6, 0.5, 0.5, 0.6, 0.4, 0.4, 0.4, 1, 1, 1, 1])

merge_18 = Merge(Data1=panel_107, Data2="scheduleB")
max = Maximum(A=genes, B=genes_2)
join_3 = TextJoin(Text=merge_18, Join="_")
panel_112 = Panel(join_3)

panel_113 = Panel("saturday")
# Since the leisure time data is not available in TUIK, modeling for the weekend was not done in the UBEM occupancy schedule modeling. SAME weekend values were determined for all daily schedule of occupant profiles.
genes_3 = GenePool(
    Decimals=1,
    Maximum=1,
    Minimum=0,
    Value=[1, 1, 1, 1, 1, 1, 1, 1, 0.3, 0.3, 0.3, 0.3, 0.3, 0.3, 0.7, 0.7, 0.7, 0.7, 0.7, 1, 1, 1, 1, 1])

# ----
# if construction date did not entered, no shuffling
python_13 = GhPythonScript(x=panel_102)  # -> out, a; inputs x: Int32
# ---------- python_13: Python ----------
__author__ = "Siser"
__version__ = "2022.02.03"

import rhinoscriptsyntax as rs
if x == 0:
    a = 0
else:
    a = 1
# ---------- end python_13 ----------

# ----
# seed
panel_114 = Panel("5")

genes_4 = GenePool(
    Decimals=1,
    Maximum=1,
    Minimum=0,
    Value=[1, 1, 1, 1, 1, 1, 1, 0.6, 0.6, 0.4, 0.4, 0, 0, 0, 0, 0, 0, 0.4, 0.4, 0.6, 0.6, 1, 1, 1])

merge_19 = Merge(Data1="scheduleC", Data2="scheduleB", Data3=panel_107)
max_2 = Maximum(A=genes_4, B=genes_2)
max_3 = Maximum(A=max_2, B=genes)
join_4 = TextJoin(Text=merge_19, Join="_")
panel_115 = Panel(join_4)

panel_116 = Panel("sunday")
genes_5 = GenePool(Decimals=1, Maximum=1, Minimum=0, Value=[1, 1, 1, 1, 1, 1, 1, 1, 1, 1, 1, 1, 1, 1, 1, 1, 1, 1, 1, 1, 1, 1, 1, 1])

annualschedule = Honeybee_AnnualSchedule(
    sun=genes_5,
    mon=genes_2,
    tue=genes_2,
    wed=genes_2,
    thu=genes_2,
    fri=genes_2,
    sat=genes_3,
    scheduleName="scheduleB",
    runIt=toggle)  # -> readMe, port, schedule, port_2, weekSched, schedIDFText; plug-in component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
panel_117 = Panel(annualschedule.weekSched)

annualschedule_2 = Honeybee_AnnualSchedule(sun=genes_5, mon=genes, tue=genes, wed=genes, thu=genes, fri=genes, sat=genes_3, scheduleName=panel_107, runIt=toggle)  # -> readMe, port, schedule, port_2, weekSched, schedIDFText; plug-in component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
panel_118 = Panel(annualschedule_2.weekSched)

panel_119 = Panel("adult")

concrete_3 = Panel(round_5.Nearest)  # disabled
masonry_3 = Panel(subtraction)  # disabled

merge_20 = Merge(Data1="scheduleC", Data2="scheduleB")
max_4 = Maximum(A=genes_4, B=genes_2)
join_5 = TextJoin(Text=merge_20, Join="_")
panel_122 = Panel(join_5)

genes_6 = GenePool(
    Decimals=1,
    Maximum=1,
    Minimum=0,
    Value=[0.9, 0.9, 0.9, 0.9, 0.9, 0.9, 0.9, 0.6, 0.6, 0.5, 0.5, 0.4, 0.4, 0.4, 0.4, 0.4, 0.4, 0.4, 0.4, 0.6, 0.6, 0.9, 0.9, 0.9])

annualschedule_3 = Honeybee_AnnualSchedule(
    sun=genes_5,
    mon=genes_6,
    tue=genes_6,
    wed=genes_6,
    thu=genes_6,
    fri=genes_6,
    sat=genes_3,
    scheduleName="scheduleD",
    runIt=toggle)  # -> readMe, port, schedule, port_2, weekSched, schedIDFText; plug-in component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
panel_123 = Panel(annualschedule_3.weekSched)

merge_21 = Merge(Data1="scheduleB", Data2="scheduleD", Data3=panel_107)
max_5 = Maximum(A=genes_2, B=genes_6)
join_6 = TextJoin(Text=merge_21, Join="_")
max_6 = Maximum(A=max_5, B=genes)
panel_124 = Panel(join_6)

merge_22 = Merge(Data1="scheduleC", Data2="scheduleD", Data3=panel_107)
max_7 = Maximum(A=genes_4, B=genes_6)
max_8 = Maximum(A=max_7, B=genes)
join_7 = TextJoin(Text=merge_22, Join="_")
panel_125 = Panel(join_7)

merge_23 = Merge(Data1="scheduleB", Data2="scheduleD")
max_9 = Maximum(A=genes_2, B=genes_6)
join_8 = TextJoin(Text=merge_23, Join="_")
panel_126 = Panel(join_8)

merge_24 = Merge(Data1="scheduleC", Data2="scheduleD")
max_10 = Maximum(A=genes_4, B=genes_6)
join_9 = TextJoin(Text=merge_24, Join="_")
panel_127 = Panel(join_9)

merge_25 = Merge(Data1=panel_107, Data2="scheduleD")
max_11 = Maximum(A=genes, B=genes_6)
join_10 = TextJoin(Text=merge_25, Join="_")
panel_128 = Panel(join_10)

# ----
# CONSTRUCTION DATE
# SELECTION PERCENTAGE
panel_129 = Panel("100")

panel_130 = Panel("selection ratio")
data_24 = Data(panel_129)

# ----
# if necessary,
# select and simulate,
# only,
# according to construction date
# and,
# percentage
# indices of
# selection ratio
jitter_3 = Jitter(List=weave_13, Jitter=python_13.a, Seed=2)  # -> simplify(Values), Indices
lng_28 = ListLength(List=weave_13)
division_8 = Division(A=lng_28, B=100)
multiplication_3 = Multiplication(A=division_8, B=data_24)
round_6 = Round(Number=multiplication_3)  # -> Nearest, Floor, Ceiling
series_10 = Series(Start=0, Step=1, Count=round_6.Nearest)  # -> simplify(Series)
item_16 = ListItem(List=jitter_3.Values, Index=series_10, Wrap=True)

# ----
# Ordered Building Layouts
geo_36 = Geometry(item_16)
# x
# x
# x
# x
# x
# x
# x
# x
# x
# x
# x
# x
# x
# x
# x
# x
# x
# x
# x
# x
# x
# x
preview_16 = CustomPreview(Geometry=geo_36, Material=ColourSwatch(SwatchColor=RGB(181, 0, 0)))

panel_131 = Panel("schedule_D")

panel_132 = Panel("schedule_B")

data_25 = Data(panel_114)
panel_134 = Panel("seed")

# ----
# 2 people
# 2 persons Family with Kids
annualschedule_4 = Honeybee_AnnualSchedule(sun=genes_5, mon=max, tue=max, wed=max, thu=max, fri=max, sat=genes_3, scheduleName=panel_112, runIt=toggle)  # -> readMe, port, schedule, port_2, weekSched, schedIDFText; plug-in component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
panel_135 = Panel(annualschedule_4.weekSched)

annualschedule_5 = Honeybee_AnnualSchedule(sun=genes_5, mon=max_10, tue=max_10, wed=max_10, thu=max_10, fri=max_10, sat=genes_3, scheduleName=join_9, runIt=toggle)  # -> readMe, port, schedule, port_2, weekSched, schedIDFText; plug-in component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
panel_136 = Panel(annualschedule_5.weekSched)

annualschedule_6 = Honeybee_AnnualSchedule(sun=genes_5, mon=max_9, tue=max_9, wed=max_9, thu=max_9, fri=max_9, sat=genes_3, scheduleName=join_8, runIt=toggle)  # -> readMe, port, schedule, port_2, weekSched, schedIDFText; plug-in component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
panel_137 = Panel(annualschedule_6.weekSched)

annualschedule_7 = Honeybee_AnnualSchedule(sun=genes_5, mon=max_4, tue=max_4, wed=max_4, thu=max_4, fri=max_4, sat=genes_3, scheduleName=join_5, runIt=toggle)  # -> readMe, port, schedule, port_2, weekSched, schedIDFText; plug-in component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
panel_138 = Panel(annualschedule_7.weekSched)

annualschedule_8 = Honeybee_AnnualSchedule(sun=genes_5, mon=max, tue=max, wed=max, thu=max, fri=max, sat=genes_3, scheduleName=panel_112, runIt=toggle)  # -> readMe, port, schedule, port_2, weekSched, schedIDFText; plug-in component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
panel_139 = Panel(annualschedule_8.weekSched)

annualschedule_9 = Honeybee_AnnualSchedule(sun=genes_5, mon=max_11, tue=max_11, wed=max_11, thu=max_11, fri=max_11, sat=genes_3, scheduleName=join_10, runIt=toggle)  # -> readMe, port, schedule, port_2, weekSched, schedIDFText; plug-in component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
panel_140 = Panel(annualschedule_9.weekSched)

annualschedule_10 = Honeybee_AnnualSchedule(
    sun=genes_5,
    mon=genes_2,
    tue=genes_2,
    wed=genes_2,
    thu=genes_2,
    fri=genes_2,
    sat=genes_3,
    scheduleName="scheduleB",
    runIt=toggle)  # -> readMe, port, schedule, port_2, weekSched, schedIDFText; plug-in component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
panel_141 = Panel(annualschedule_10.weekSched)

annualschedule_11 = Honeybee_AnnualSchedule(sun=genes_5, mon=genes, tue=genes, wed=genes, thu=genes, fri=genes, sat=genes_3, scheduleName=panel_107, runIt=toggle)  # -> readMe, port, schedule, port_2, weekSched, schedIDFText; plug-in component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
panel_142 = Panel(annualschedule_11.weekSched)

annualschedule_12 = Honeybee_AnnualSchedule(sun=genes_5, mon=max_9, tue=max_9, wed=max_9, thu=max_9, fri=max_9, sat=genes_3, scheduleName=join_8, runIt=toggle)  # -> readMe, port, schedule, port_2, weekSched, schedIDFText; plug-in component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
panel_143 = Panel(annualschedule_12.weekSched)

annualschedule_13 = Honeybee_AnnualSchedule(sun=genes_5, mon=max_11, tue=max_11, wed=max_11, thu=max_11, fri=max_11, sat=genes_3, scheduleName=join_10, runIt=toggle)  # -> readMe, port, schedule, port_2, weekSched, schedIDFText; plug-in component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
panel_144 = Panel(annualschedule_13.weekSched)

annualschedule_14 = Honeybee_AnnualSchedule(
    sun=genes_5,
    mon=genes_2,
    tue=genes_2,
    wed=genes_2,
    thu=genes_2,
    fri=genes_2,
    sat=genes_3,
    scheduleName="scheduleB",
    runIt=toggle)  # -> readMe, port, schedule, port_2, weekSched, schedIDFText; plug-in component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
panel_145 = Panel(annualschedule_14.weekSched)

annualschedule_15 = Honeybee_AnnualSchedule(
    sun=genes_5,
    mon=genes_6,
    tue=genes_6,
    wed=genes_6,
    thu=genes_6,
    fri=genes_6,
    sat=genes_3,
    scheduleName="scheduleD",
    runIt=toggle)  # -> readMe, port, schedule, port_2, weekSched, schedIDFText; plug-in component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
panel_146 = Panel(annualschedule_15.weekSched)

# ----
# x
# x
# x
# x
# x
# x
# x
# x
# x
# x
# x
# x
# x
# x
# x
# x
# x
# x
# x
# x
# x
# x
# organized 4edged building PARCELS
geo_37 = Geometry(item_16)

# ----
# Check for UV organization of surface
geo_38 = Geometry(flatten(geo_37))
disc_3 = Discontinuity(Curve=geo_38, Level=1)  # -> Points, Parameters
hull_3 = ConvexHull(Points=disc_3.Points, Plane=PlaneXY(0, 0, 0))  # -> flatten(Hull), HullZ, Indices
boundary_13 = BoundarySurfaces(Edges=hull_3.Hull)
wires_2 = BrepWireframe(Brep=boundary_13, Density=-1)  # -> simplify(Wireframe)
len = Length(Curve=wires_2)
partition_17 = PartitionList(List=boundary_13, Size="1")  # -> simplify(Chunks)
listdexs_3 = ListIndices(List=len)
sort_9 = SortList(Keys=len, ValuesA=listdexs_3)  # -> Keys, reverse(ValuesA)
md_slider = MDSlider(SliderMode=0, slider_value=Point(0.5, 0.5, 0.5), x_domain=Domain(0, 1), y_domain=Domain(0, 1), z_domain=Domain(0, 1))
item_17 = ListItem(List=sort_9.ValuesA, Index=0, Wrap=True)
iso = IsoCurve(Surface=reparameterize(boundary_13), UVPoint=md_slider)  # -> simplify(UIsocurve), VIsocurve
item_18 = ListItem(List=wires_2, Index=item_17, Wrap=True)
colom = CollisionOneMany(Collider=iso.UIsocurve, Obstacles=item_18)  # -> Collision, Index
dispatch_15 = Dispatch(List=partition_17, DispatchPattern=colom.Collision)  # -> simplify(ListA), ListB
clean = CleanTree(RemoveNulls=True, RemoveInvalid=True, RemoveEmpty=Toggle(True), Tree=dispatch_15.ListA)

_2_people_percentage = Panel("19.1")

panel_147 = Panel("-")

# ----
# 2 persons Family no Family
_2_people_percentage_2 = Panel("2.0")

panel_151 = Panel(panel_139)
panel_152 = Panel("Normalized (sch_x*sch_y)")

panel_155 = Panel(panel_142)

panel_157 = Panel(panel_144)

panel_158 = Panel(panel_143)

panel_162 = Panel(panel_145)

panel_164 = Panel(panel_146)

panel_166 = Panel(panel_137)

panel_168 = Panel(panel_141)

panel_170 = Panel(panel_140)

panel_172 = Panel(panel_138)

panel_174 = Panel(panel_136)

panel_176 = Panel(panel_135)

# ----
# Implementation of Real Data
# for Flat per Floor
# (division numbers,
# percentage for divisions)
unit_per_floor_division = Panel("""1
2
3
4""")
# room number: 50 To 95
# 95 To 140
# 140 To 185
# Implementation of Real Data
# for Unit Sqm
panel_177 = Panel("3")

data_26 = Data(panel_114)

data_27 = Data(panel_114)

# ----
# reverse UV of surfaces
data_28 = Data(flatten(clean))
srf = Surface(reparameterize(data_28))
python_14 = PythonScript(s=srf, swapUV=Toggle(True), reverseU=Toggle(False), reverseV=Toggle(False))  # -> out, anchor, uVec, vVec, revSrf; inputs s: Surface, swapUV: Int32, reverseU: Int32, reverseV: Int32
# ---------- python_14: Python ----------
import Rhino

if reverseU:
    uS,uE = s.Domain(0)
    inter0 = Rhino.Geometry.Interval(-uE, -uS)
    s.SetDomain(0,inter0)
    s = s.Reverse(0)

if reverseV:
    vS,vE = s.Domain(1)
    inter1 = Rhino.Geometry.Interval(-vE, -vS)
    s.SetDomain(1,inter1)
    s = s.Reverse(1)

if swapUV:
    s = s.Transpose()

anchor = s.PointAt(0,0)
uend = s.PointAt(0.5,0)
vend = s.PointAt(0,0.5)
uVec = uend - anchor
vVec = vend - anchor

revSrf = s
# ---------- end python_14 ----------

panel_180 = Panel("""UBEM 
Parcel No
List""")
data_29 = Data(weave_3)

# ----
# block number division
panel_181 = Panel("0")
equals_12 = Equality(FirstNumber=data_29, SecondNumber=panel_181)  # -> Equality, Inequality
num = Number(equals_12.Equality)
num_2 = Number("1")
lng_29 = ListLength(List=num)
mindex_3 = MemberIndex(Set=num, Member=num_2)  # -> Index, Count
merge_26 = Merge(Data1="0", Data2=lng_29)
panel_182 = Panel("""0
-1""")
ins_2 = InsertItems(List=mindex_3.Index, Item=merge_26, Indices=panel_182, Wrap=True)
cull_i_14 = CullIndex(List=ins_2, Indices="-1", Wrap=True)
shift_3 = ShiftList(List=ins_2, Shift=1, Wrap=Toggle(False))
subtraction_2 = Subtraction(A=shift_3, B=cull_i_14)

data_30 = Data(panel_114)

u = ColourSwatch(SwatchColor=RGB(2, 4, 255))
v = ColourSwatch(SwatchColor=RGB(225, 0, 0))
vdisex = VectorDisplayEx(Point=python_14.anchor, Vector=python_14.uVec, Colour=u, Width=3)
vdisex_2 = VectorDisplayEx(Point=python_14.anchor, Vector=python_14.vVec, Colour=v, Width=3)

annualschedule_16 = Honeybee_AnnualSchedule(sun=genes_5, mon=max_8, tue=max_8, wed=max_8, thu=max_8, fri=max_8, sat=genes_3, scheduleName=join_7, runIt=toggle)  # -> readMe, port, schedule, port_2, weekSched, schedIDFText; plug-in component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
panel_184 = Panel(annualschedule_16.weekSched)

annualschedule_17 = Honeybee_AnnualSchedule(sun=genes_5, mon=max_6, tue=max_6, wed=max_6, thu=max_6, fri=max_6, sat=genes_3, scheduleName=join_6, runIt=toggle)  # -> readMe, port, schedule, port_2, weekSched, schedIDFText; plug-in component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
panel_185 = Panel(annualschedule_17.weekSched)

annualschedule_18 = Honeybee_AnnualSchedule(sun=genes_5, mon=max_11, tue=max_11, wed=max_11, thu=max_11, fri=max_11, sat=genes_3, scheduleName=join_10, runIt=toggle)  # -> readMe, port, schedule, port_2, weekSched, schedIDFText; plug-in component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
panel_186 = Panel(annualschedule_18.weekSched)

annualschedule_19 = Honeybee_AnnualSchedule(sun=genes_5, mon=max, tue=max, wed=max, thu=max, fri=max, sat=genes_3, scheduleName=panel_112, runIt=toggle)  # -> readMe, port, schedule, port_2, weekSched, schedIDFText; plug-in component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
panel_187 = Panel(annualschedule_19.weekSched)

annualschedule_20 = Honeybee_AnnualSchedule(sun=genes_5, mon=max, tue=max, wed=max, thu=max, fri=max, sat=genes_3, scheduleName=panel_112, runIt=toggle)  # -> readMe, port, schedule, port_2, weekSched, schedIDFText; plug-in component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
panel_188 = Panel(annualschedule_20.weekSched)

annualschedule_21 = Honeybee_AnnualSchedule(sun=genes_5, mon=max_3, tue=max_3, wed=max_3, thu=max_3, fri=max_3, sat=genes_3, scheduleName=join_4, runIt=toggle)  # -> readMe, port, schedule, port_2, weekSched, schedIDFText; plug-in component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
panel_189 = Panel(annualschedule_21.weekSched)

geo_39 = Geometry(boundary_13)

# ----
# u(uv)and longest edge is at the same orientation
tstat_3 = TreeStatistics(Tree=clean)  # -> Paths, Length, Count
split_4 = TextSplit(Text=tstat_3.Paths, Separators="{}")
item_19 = ListItem(List=split_4, Index="1", Wrap=True)  # -> flatten(Item)
replace_4 = ReplaceItems(List=geo_39, Item=python_14.revSrf, Indices=item_19, Wrap=False)

md_slider_2 = MDSlider(SliderMode=0, slider_value=Point(0.5, 0.5, 0.5), x_domain=Domain(0, 1), y_domain=Domain(0, 1), z_domain=Domain(0, 1))
iso_2 = IsoCurve(Surface=reparameterize(replace_4), UVPoint=md_slider_2)  # -> simplify(UIsocurve), VIsocurve
preview_17 = CustomPreview(Geometry=iso_2.UIsocurve, Material=ColourSwatch(SwatchColor=RGB(47, 255, 0)))

data_31 = Data(panel_114)

data_32 = Data(panel_114)

data_33 = Data(weave_8)

# ----
# Arrange
# Surface
# U V values
c_script = CSharpScript()  # -> out, A; inputs x: Surface; disabled
# ---------- c_script: C# ----------
    double pi = 3.1415926535897932384626433832795;
    
    Rhino.Geometry.Point3d p;
    Rhino.Geometry.Vector3d[] UV;
    // Evaluating surfaces at center (median of domain start and end)
    x.Evaluate((x.Domain(0).T0 + x.Domain(0).T1) / 2, (x.Domain(1).T0 + x.Domain(1).T1) / 2, 1, out p, out UV);
    
    // U, V, WorldX, WorldY vectors
    Rhino.Geometry.Vector3d U = UV[0];    
    Rhino.Geometry.Vector3d V = UV[1];    
    Rhino.Geometry.Vector3d X = Rhino.Geometry.Plane.WorldXY.XAxis;
    Rhino.Geometry.Vector3d Y = Rhino.Geometry.Plane.WorldXY.YAxis;
    
    // Unitizing vectors to make tests
    U.Unitize();
    V.Unitize();

    if (Math.Abs(U.X) < Math.Abs(V.X)){ // If this is "true" it means V isocurves are more suitable to be aligned with World X axis than U; U and V needs to be swapped
      x.Transpose(true); //Swapping UV
      if (Vector3d.VectorAngle(V, X) > pi / 2){ // Flipping new U if angle with X is larger than 90°
        x.Reverse(0, true);}
      if (Vector3d.VectorAngle(U, Y) > pi / 2){ // Flipping new V if angle with Y is larger than 90°
        x.Reverse(1, true);}
    }
    else{ // U an V doesn't need to be swapped
      if (Vector3d.VectorAngle(U, X) > pi / 2){ // Flipping U if angle with X is larger than 90°
        x.Reverse(0, true);}
      if (Vector3d.VectorAngle(V, Y) > pi / 2){ // Flipping V if angle with Y is larger than 90°
        x.Reverse(1, true);}
    }
    A = x;
# ---------- end c_script ----------

# ----
# Generated
# # of Units
# Per Floor
data_34 = Data(weave_12)

panel_195 = Panel(panel_184)

# ----
# # of Units of
# the building
data_35 = Data(weave_11)

panel_197 = Panel(panel_185)

panel_199 = Panel(panel_186)

panel_201 = Panel(panel_189)

geo_40 = Geometry(flatten(replace_4))

panel_204 = Panel(panel_187)

panel_206 = Panel(panel_188)

# ----
# Test surface U V values
panel_207 = Panel("0.5,0.5")  # disabled
iso_3 = IsoCurve(Surface=reparameterize(c_script.A), UVPoint=panel_207)  # -> UIsocurve, VIsocurve; disabled
swatch_4 = ColourSwatch(SwatchColor=RGB(255, 0, 0))  # disabled
swatch_5 = ColourSwatch(SwatchColor=RGB(0, 255, 4))  # disabled
# 3.1 - UNIT DIVISION
#   3.1.1 - 2 UNIT PER FLOOR
# Unit division types
# - Floor division with stairs
# - Floor division without stairs
# Adaptation with Real Data
# for unit division
# - L shape
# - Rectangular
# - I shape
# etc.
preview_18 = CustomPreview(Geometry=iso_3.UIsocurve, Material=swatch_4)  # disabled
# Full list control
# - Recording complete information of the unit
# --parcel, building, floor, number in the building
preview_19 = CustomPreview(Geometry=iso_3.VIsocurve, Material=swatch_5)  # disabled

_2_people_percentage_3 = Panel("1.9")

panel_208 = Panel("exclude non-residential buildings")
clean_2 = CleanTree(RemoveNulls=True, RemoveInvalid=True, RemoveEmpty=False, Tree=python_11.a)

clean_3 = CleanTree(RemoveNulls=True, RemoveInvalid=True, RemoveEmpty=False, Tree=python_11.a)

data_36 = Data("0.25")

clean_4 = CleanTree(RemoveNulls=True, RemoveInvalid=True, RemoveEmpty=False, Tree=python_11.a)

data_37 = Data(panel_114)

# ----
# selection according to
# construction date
data_38 = Data(equals_11.Equality)

# ----
# # of Units of the building
toggle_2 = BooleanToggle(True)
partition_18 = PartitionList(List=data_35, Size=subtraction_2)  # -> simplify(Chunks)
clean_5 = CleanTree(RemoveNulls=True, RemoveInvalid=True, RemoveEmpty=toggle_2, Tree=partition_18)
lng_30 = ListLength(List=clean_5)  # -> flatten(Length)
partition_19 = PartitionList(List=flatten(clean_5), Size=lng_30)  # -> simplify(Chunks)
cull_i_15 = CullIndex(List=partition_19, Indices=clean_4, Wrap=True)  # -> simplify(List)
dispatch_16 = Dispatch(List=cull_i_15, DispatchPattern=data_38)  # -> ListA, ListB
weave_15 = Weave(Pattern=python_12.a, Stream0=dispatch_16.ListA, Stream1=dispatch_16.ListB, NullGaps=False)  # -> simplify(Weave)

# ----
# selection according to
# construction date
data_39 = Data(equals_11.Equality)

# ----
# # of Units Per Floor in the building
toggle_3 = BooleanToggle(True)
partition_20 = PartitionList(List=data_34, Size=subtraction_2)  # -> simplify(Chunks)
clean_6 = CleanTree(RemoveNulls=True, RemoveInvalid=True, RemoveEmpty=toggle_3, Tree=partition_20)
lng_31 = ListLength(List=clean_6)  # -> flatten(Length)
partition_21 = PartitionList(List=flatten(clean_6), Size=lng_31)  # -> simplify(Chunks)
cull_i_16 = CullIndex(List=partition_21, Indices=clean_2, Wrap=True)  # -> simplify(List)
dispatch_17 = Dispatch(List=cull_i_16, DispatchPattern=data_39)  # -> ListA, ListB
weave_16 = Weave(Pattern=python_12.a, Stream0=dispatch_17.ListA, Stream1=dispatch_17.ListB, NullGaps=False)  # -> simplify(Weave)

# ----
# selection according to
# construction date
data_40 = Data(equals_11.Equality)

data_41 = Data("0.25")

partition_22 = PartitionList(List=geo_40, Size="1")
divide = DivideDomain²(Domain=partition_22, UCount="2", VCount="1")  # -> simplify(Segments)
subsrf = Isotrim(Surface=partition_22, Domain=divide)  # -> simplify(Surface)
# 03.FLOORTOUNITDIVISION
md_slider_3 = MDSlider(SliderMode=0, slider_value=Point(0.5, 0.5, 0.5), x_domain=Domain(0, 1), y_domain=Domain(0, 1), z_domain=Domain(0, 1))
item_20 = ListItem(List=subsrf, Index=0, Wrap=True)
evalsrf = EvaluateSurface(Surface=item_20, Point=md_slider_3)  # -> Point, Normal, UDirection, VDirection, Frame
brec_2 = BoundingRectangle(Geometry=subsrf, Plane=evalsrf.Frame, Axis=0, Slide=0, Union=True)  # -> simplify(flatten(Bounding)), DimensionX, DimensionY
area_19 = Area(Geometry=brec_2.Bounding)  # -> Area, Centroid
scale = Scale(Geometry=brec_2.Bounding, Center=area_19.Centroid, Factor=data_41)  # -> Geometry, Transform

# ----
# indices of
# selection ratio according to construction date
data_42 = Data(series_10)
panel_214 = Panel("organized list")
item_21 = ListItem(List=simplify(weave_15), Index=simplify(data_42), Wrap=True)  # -> flatten(Item)

data_43 = Data(item_21)
ma = MassAddition(Input=data_43)  # -> Result, PartialResults
total_number_of_units = Panel(ma.Result)

data_44 = Data(item_21)
ma_2 = MassAddition(Input=data_44)  # -> Result, PartialResults
total_number_of_units_2 = Panel(ma_2.Result)

# ----
# 00.INPUT
data_45 = Data(item_21)
ma_3 = MassAddition(Input=data_45)  # -> Result, PartialResults
total_number_of_units_3 = Panel(ma_3.Result)

# ----
# total #of unit
# in the neighborhood
data_46 = Data(ma_3.Result)

pcent_2 = Percentage(Number=data_46, Percent=data_21)
pcent_3 = Percentage(Number=pcent_2, Percent="86")
pcent_4 = Percentage(Number=pcent_3, Percent="52.8")
round_7 = Round(Number=pcent_4)  # -> Nearest, Floor, Ceiling
dup_7 = DuplicateData(Data=annualschedule_3.schedule, Number=round_7.Nearest, Order=True)

pcent_5 = Percentage(Number=data_46, Percent=data_22)
pcent_6 = Percentage(Number=pcent_5, Percent="86")
pcent_7 = Percentage(Number=pcent_6, Percent="47.2")
round_8 = Round(Number=pcent_7)  # -> Nearest, Floor, Ceiling
dup_8 = DuplicateData(Data=annualschedule.schedule, Number=round_8.Nearest, Order=True)

pcent_8 = Percentage(Number=data_46, Percent=data_23)
pcent_9 = Percentage(Number=pcent_8, Percent="14")
pcent_10 = Percentage(Number=pcent_9, Percent="100")
round_9 = Round(Number=pcent_10)  # -> Nearest, Floor, Ceiling
dup_9 = DuplicateData(Data=annualschedule_2.schedule, Number=round_9.Nearest, Order=True)

merge_27 = Merge(Data1=dup_8, Data2=dup_7, Data3=dup_9)
jitter_4 = Jitter(List=merge_27, Jitter=1, Seed=data_25)  # -> Values, Indices

pcent_11 = Percentage(Number=data_46, Percent="23.44")
round_10 = Round(Number=pcent_11)  # -> Nearest, Floor, Ceiling
dup_10 = DuplicateData(Data=annualschedule_14.schedule, Number=round_10.Nearest, Order=True)

pcent_12 = Percentage(Number=data_46, Percent="3.02")
round_11 = Round(Number=pcent_12)  # -> Nearest, Floor, Ceiling
dup_11 = DuplicateData(Data=annualschedule_11.schedule, Number=round_11.Nearest, Order=True)

pcent_13 = Percentage(Number=data_46, Percent="9.43")
round_12 = Round(Number=pcent_13)  # -> Nearest, Floor, Ceiling
dup_12 = DuplicateData(Data=annualschedule_13.schedule, Number=round_12.Nearest, Order=True)

pcent_14 = Percentage(Number=data_46, Percent="8.41")
round_13 = Round(Number=pcent_14)  # -> Nearest, Floor, Ceiling
dup_13 = DuplicateData(Data=annualschedule_8.schedule, Number=round_13.Nearest, Order=True)

pcent_15 = Percentage(Number=data_46, Percent="29.43")
round_14 = Round(Number=pcent_15)  # -> Nearest, Floor, Ceiling
dup_14 = DuplicateData(Data=annualschedule_15.schedule, Number=round_14.Nearest, Order=True)

pcent_16 = Percentage(Number=data_46, Percent="26.27")
round_15 = Round(Number=pcent_16)  # -> Nearest, Floor, Ceiling
dup_15 = DuplicateData(Data=annualschedule_12.schedule, Number=round_15.Nearest, Order=True)

pcent_17 = Percentage(Number=data_46, Percent="100")
pcent_18 = Percentage(Number=pcent_17, Percent="3.4")
round_16 = Round(Number=pcent_18)  # -> Nearest, Floor, Ceiling
dup_16 = DuplicateData(Data=annualschedule_6.schedule, Number=round_16.Nearest, Order=True)

pcent_19 = Percentage(Number=data_46, Percent="100")
pcent_20 = Percentage(Number=pcent_19, Percent="10.8")
round_17 = Round(Number=pcent_20)  # -> Nearest, Floor, Ceiling
dup_17 = DuplicateData(Data=annualschedule_9.schedule, Number=round_17.Nearest, Order=True)

pcent_21 = Percentage(Number=data_46, Percent="100")
pcent_22 = Percentage(Number=pcent_21, Percent="36.6")
round_18 = Round(Number=pcent_22)  # -> Nearest, Floor, Ceiling
dup_18 = DuplicateData(Data=annualschedule_7.schedule, Number=round_18.Nearest, Order=True)

pcent_23 = Percentage(Number=data_46, Percent="100")
pcent_24 = Percentage(Number=pcent_23, Percent="36.6")
round_19 = Round(Number=pcent_24)  # -> Nearest, Floor, Ceiling
dup_19 = DuplicateData(Data=annualschedule_5.schedule, Number=round_19.Nearest, Order=True)

pcent_25 = Percentage(Number=data_46, Percent="100")
pcent_26 = Percentage(Number=pcent_25, Percent="9.7")
round_20 = Round(Number=pcent_26)  # -> Nearest, Floor, Ceiling
dup_20 = DuplicateData(Data=annualschedule_4.schedule, Number=round_20.Nearest, Order=True)

pcent_27 = Percentage(Number=data_46, Percent="100")
pcent_28 = Percentage(Number=pcent_27, Percent="3")
round_21 = Round(Number=pcent_28)  # -> Nearest, Floor, Ceiling
dup_21 = DuplicateData(Data=annualschedule_10.schedule, Number=round_21.Nearest, Order=True)

merge_28 = Merge(Data1=dup_13, Data2=dup_12, Data3=dup_10, Data4=dup_15, Data5=dup_14, Data6=dup_11)
jitter_5 = Jitter(List=merge_28, Jitter=1, Seed=data_26)  # -> Values, Indices
lng_32 = ListLength(List=jitter_5.Values)
pcent_29 = Percentage(Number=lng_32, Percent=_2_people_percentage_2)
series_11 = Series(Start=0, Step=1, Count=pcent_29)
item_22 = ListItem(List=jitter_5.Values, Index=series_11, Wrap=True)

merge_29 = Merge(Data1=dup_20, Data2=dup_17, Data3=dup_21, Data4=dup_16, Data5=dup_18, Data6=dup_19)
jitter_6 = Jitter(List=merge_29, Jitter=1, Seed=data_27)  # -> Values, Indices
lng_33 = ListLength(List=jitter_6.Values)
pcent_30 = Percentage(Number=lng_33, Percent=_2_people_percentage)
series_12 = Series(Start=0, Step=1, Count=pcent_30)
item_23 = ListItem(List=jitter_6.Values, Index=series_12, Wrap=True)

merge_30 = Merge(Data1=item_23, Data2=item_22)
jitter_7 = Jitter(List=merge_30, Jitter=1, Seed=data_30)  # -> Values, Indices

# ----
# 3 people
# 3 people Family with Kids
merge_31 = Merge(Data1=dup_20, Data2=dup_17, Data3=dup_21, Data4=dup_16, Data5=dup_18, Data6=dup_19)
_3_people_percentage_family_with_kids = Panel("17.3")
jitter_8 = Jitter(List=merge_31, Jitter=1, Seed=data_31)  # -> Values, Indices
lng_34 = ListLength(List=jitter_8.Values)
pcent_31 = Percentage(Number=lng_34, Percent=_3_people_percentage_family_with_kids)
series_13 = Series(Start=0, Step=1, Count=pcent_31)
item_24 = ListItem(List=jitter_8.Values, Index=series_13, Wrap=True)

# ----
# 3 people Family no Family
merge_32 = Merge(Data1=dup_13, Data2=dup_12, Data3=dup_10, Data4=dup_15, Data5=dup_14, Data6=dup_11)
_3_people_percentage_no_family = Panel("0.4")
jitter_9 = Jitter(List=merge_32, Jitter=1, Seed=data_32)  # -> Values, Indices
lng_35 = ListLength(List=jitter_9.Values)
pcent_32 = Percentage(Number=lng_35, Percent=_2_people_percentage_2)
series_14 = Series(Start=0, Step=1, Count=pcent_32)
item_25 = ListItem(List=jitter_9.Values, Index=series_14, Wrap=True)

pcent_33 = Percentage(Number=data_46, Percent="38.05")
round_22 = Round(Number=pcent_33)  # -> Nearest, Floor, Ceiling
dup_22 = DuplicateData(Data=annualschedule_16.schedule, Number=round_22.Nearest, Order=True)

pcent_34 = Percentage(Number=data_46, Percent="11.28")
round_23 = Round(Number=pcent_34)  # -> Nearest, Floor, Ceiling
dup_23 = DuplicateData(Data=annualschedule_18.schedule, Number=round_23.Nearest, Order=True)

pcent_35 = Percentage(Number=data_46, Percent="33.95")
round_24 = Round(Number=pcent_35)  # -> Nearest, Floor, Ceiling
dup_24 = DuplicateData(Data=annualschedule_21.schedule, Number=round_24.Nearest, Order=True)

pcent_36 = Percentage(Number=data_46, Percent="3.51")
round_25 = Round(Number=pcent_36)  # -> Nearest, Floor, Ceiling
dup_25 = DuplicateData(Data=annualschedule_17.schedule, Number=round_25.Nearest, Order=True)

pcent_37 = Percentage(Number=data_46, Percent="3.13")
round_26 = Round(Number=pcent_37)  # -> Nearest, Floor, Ceiling
dup_26 = DuplicateData(Data=annualschedule_19.schedule, Number=round_26.Nearest, Order=True)

pcent_38 = Percentage(Number=data_46, Percent="10.07")
round_27 = Round(Number=pcent_38)  # -> Nearest, Floor, Ceiling
dup_27 = DuplicateData(Data=annualschedule_20.schedule, Number=round_27.Nearest, Order=True)

# ----
# 3 people Family
# with Kids and Elderly
merge_33 = Merge(Data1=dup_27, Data2=dup_23, Data3=dup_26, Data4=dup_25, Data5=dup_24, Data6=dup_22)
jitter_10 = Jitter(List=merge_33, Jitter=1, Seed=data_37)  # -> Values, Indices
lng_36 = ListLength(List=jitter_10.Values)
pcent_39 = Percentage(Number=lng_36, Percent=_2_people_percentage_3)
series_15 = Series(Start=0, Step=1, Count=pcent_39)
item_26 = ListItem(List=jitter_10.Values, Index=series_15, Wrap=True)

# ----
# indices of
# selection ratio according to construction date
data_47 = Data(series_10)
item_27 = ListItem(List=simplify(weave_16), Index=simplify(data_47), Wrap=True)  # -> flatten(Item)

# ----
# # of Units
# Per Floor
# if x == 1:
#     a=1,1
# elif x ==2:
#     a=2,1
# elif x == 3 or x == 4:
#     a=2,2
# elif x==5 or x ==6:
#     a=3,2
# else:
#     a=4,2
python_15 = GhPythonScript(x=item_27)  # -> out, simplify(a); inputs x: Int32
# ---------- python_15: Python ----------
__author__ = "orcun"
__version__ = "2021.11.17"

import rhinoscriptsyntax as rs
if x == 1:
    a=1,1
elif x ==2:
    a=2,1
elif x == 3 or x == 4:
    a=2,2
elif x==5 or x ==6:
    a=3,2
else:
    a=4,2
# ---------- end python_15 ----------
item_28 = ListItem(List=python_15.a, Index=0, Wrap=True)  # -> flatten(Item)
item_29 = ListItem(List=python_15.a, Index=1, Wrap=True)  # -> flatten(Item)

# ----
# # of Units Per Floor
data_48 = Data(item_27)

equals_13 = Equality(FirstNumber=data_48, SecondNumber="1")  # -> Equality, Inequality
lng_37 = ListLength(List=data_48)
series_16 = Series(Start=0, Step=1, Count=lng_37)
dispatch_18 = Dispatch(List=series_16, DispatchPattern=equals_13.Equality)  # -> ListA, ListB
item_30 = ListItem(List=brec_2.Bounding, Index=dispatch_18.ListA, Wrap=True)
area_20 = Area(Geometry=item_30)  # -> Area, Centroid
debrep_3 = DeconstructBrep(Brep=item_30)  # -> Faces, Edges, Vertices
scale_2 = Scale(Geometry=item_30, Center=area_20.Centroid, Factor=data_36)  # -> Geometry, Transform
item_31 = ListItem(List=debrep_3.Vertices, Index=0, Wrap=True)  # -> simplify(Item)
debrep_4 = DeconstructBrep(Brep=scale_2.Geometry)  # -> Faces, Edges, Vertices
item_32 = ListItem(List=debrep_4.Vertices, Index=0, Wrap=True)
move2pt = MoveToPoint(Geometry=scale_2.Geometry, PointA=flatten(item_32), PointB=flatten(item_31))  # -> simplify(Moved), Vector, Transform

# ----
# # of Units Per Floor
data_49 = Data(item_27)

divide_2 = DivideDomain²(Domain=replace_4, UCount=item_28, VCount=item_29)  # -> simplify(Segments)
partition_23 = PartitionList(List=replace_4, Size="1")
subsrf_2 = Isotrim(Surface=partition_23, Domain=divide_2)  # -> simplify(Surface)
lng_38 = ListLength(List=subsrf_2)  # -> flatten(Length)
lng_39 = ListLength(List=data_49)
series_17 = Series(Start=0, Step=1, Count=lng_39)
equals_14 = Equality(FirstNumber=data_49, SecondNumber=lng_38)  # -> Equality, Inequality
dispatch_19 = Dispatch(List=series_17, DispatchPattern=equals_14.Equality)  # -> ListA, ListB
series_18 = Series(Start=0, Step=1, Count="2")
branch_10 = TreeBranch(Tree=subsrf_2, Path=dispatch_19.ListB, MaintainPaths=True)
item_33 = ListItem(List=branch_10, Index=series_18, Wrap=True)
# Unit per floor Division
sunion = SolidUnion(Breps=item_33)
disc_4 = Discontinuity(Curve=sunion, Level=1)  # -> Points, Parameters
pline = PolyLine(Vertices=disc_4.Points, Closed=Toggle(True))  # -> simplify(Polyline)
cull_i_17 = CullIndex(List=branch_10, Indices=series_18, Wrap=True)  # -> simplify(List)
merge_34 = Merge(Data1=cull_i_17, Data2=pline)
data_50 = Data(dispatch_19.ListB)
tstat_4 = TreeStatistics(Tree=merge_34)  # -> Paths, Length, Count
replace_5 = ReplacePaths(Data=merge_34, Search=tstat_4.Paths, Replace=data_50)

partition_24 = PartitionList(List=equals_14.Equality, Size="1")  # -> simplify(Chunks)
dispatch_20 = Dispatch(List=subsrf_2, DispatchPattern=partition_24)  # -> ListA, ListB
clean_7 = CleanTree(RemoveNulls=True, RemoveInvalid=True, RemoveEmpty=Toggle(True), Tree=dispatch_20.ListA)

# ----
# rotateStaircase for better floor division, otherwise, units has strange edges
# StairCase
replace_6 = ReplaceItems(List=scale.Geometry, Item=move2pt.Moved, Indices=dispatch_18.ListA, Wrap=False)
partition_25 = PartitionList(List=replace_6, Size="1")  # -> simplify(Chunks)

data_51 = Data(panel_114)

merge_35 = Merge(Data1=item_24, Data2=item_25, Data3=item_26)
jitter_11 = Jitter(List=merge_35, Jitter=1, Seed=data_51)  # -> Values, Indices

# ----
# Unit per floor
# Divided Units
merge_36 = Merge(Data1=clean_7, Data2=replace_5)

data_52 = Data(panel_114)

# ----
# 4 people
# Family with Kids
merge_37 = Merge(Data1=dup_20, Data2=dup_17, Data3=dup_21, Data4=dup_16, Data5=dup_18, Data6=dup_19)
percentage_family_with_kids = Panel("17.1")
jitter_12 = Jitter(List=merge_37, Jitter=1, Seed=data_52)  # -> Values, Indices
lng_40 = ListLength(List=jitter_12.Values)
pcent_40 = Percentage(Number=lng_40, Percent=percentage_family_with_kids)
series_19 = Series(Start=0, Step=1, Count=pcent_40)
item_34 = ListItem(List=jitter_12.Values, Index=series_19, Wrap=True)

data_53 = Data(panel_114)

# ----
# Family with Kids and Elderly
merge_38 = Merge(Data1=dup_27, Data2=dup_23, Data3=dup_26, Data4=dup_25, Data5=dup_24, Data6=dup_22)
jitter_13 = Jitter(List=merge_38, Jitter=1, Seed=data_53)  # -> Values, Indices
percentage = Panel("2.7")
lng_41 = ListLength(List=jitter_13.Values)
pcent_41 = Percentage(Number=lng_41, Percent=percentage)
series_20 = Series(Start=0, Step=1, Count=pcent_41)
item_35 = ListItem(List=jitter_13.Values, Index=series_20, Wrap=True)

panel_219 = Panel("floor height")
data_54 = Data(floor_height)

# ----
# no need to use anymore, because when a parcel enter into simulation the staircase implementation gets activated
rdiff = RegionDifference(CurvesA=merge_36, CurvesB=partition_25)  # -> simplify(Result); disabled

data_55 = Data(panel_114)

# ----
# Family no Family
merge_39 = Merge(Data1=dup_13, Data2=dup_12, Data3=dup_10, Data4=dup_15, Data5=dup_14, Data6=dup_11)
percentage_no_family = Panel("0.2")
jitter_14 = Jitter(List=merge_39, Jitter=1, Seed=data_55)  # -> Values, Indices
lng_42 = ListLength(List=jitter_14.Values)
pcent_42 = Percentage(Number=lng_42, Percent=_2_people_percentage_2)
series_21 = Series(Start=0, Step=1, Count=pcent_42)
item_36 = ListItem(List=jitter_14.Values, Index=series_21, Wrap=True)

data_56 = Data(panel_114)

merge_40 = Merge(Data1=item_34, Data2=item_36, Data3=item_35)
jitter_15 = Jitter(List=merge_40, Jitter=1, Seed=data_56)  # -> Values, Indices

# ----
# x
# x
# x
# x
# x
# x
# x
# x
# x
# x
# x
# x
# x
# x
# x
# x
# x
# x
# x
# x
# x
# x
# x
# x
# x
# x
# x
# 
# x
# x
# x
# x
# x
# x
# 
# x
# x
# x
# x
# x
# 
# x
# x
# x
# x
# x
# x
# 
# x
# x
# x
# x
ladybug = Ladybug_Ladybug()  # -> Vviiiiiiiiiizzz; plug-in component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
# Construction Date
# Tüik 6.1 - Households by constrcution year of the building
# 1981-2000: %43,5
# 1980 and before: %23,4
# 2001 and after: %21,8
# Unknown: %11,3
# -------------
# SO AFTER ROUND UP
# before 2000: %80
# 2001 and after:  %20
# construction: construction layers
# - according to construction date
# -- before 80s / 80-00 / after 00
honeybee = Honeybee_Honeybee()  # -> Vviiiiiiiiiizzz; plug-in component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
# Retail, commercial building function determination
# FOR EACH
# building
# 
# How to do?
# Room, unit, elevator area division, M.L.
# 
# resource:endeksa
# 2:bedroom, living room
# 3:bedroom, living room, service (non-conditioning)
# 4:bedroom (x2), living room, service (non-conditioning)
# 3.1 - UNIT DIVISION
panel_222 = Panel(honeybee)

data_57 = Data(panel_114)

# ----
# 5 people
# Family with Kids
merge_41 = Merge(Data1=dup_20, Data2=dup_17, Data3=dup_21, Data4=dup_16, Data5=dup_18, Data6=dup_19)
percentage_family_with_kids_2 = Panel("7.6")
jitter_16 = Jitter(List=merge_41, Jitter=1, Seed=data_57)  # -> Values, Indices
lng_43 = ListLength(List=jitter_16.Values)
pcent_43 = Percentage(Number=lng_43, Percent=percentage_family_with_kids_2)
series_22 = Series(Start=0, Step=1, Count=pcent_43)
item_37 = ListItem(List=jitter_16.Values, Index=series_22, Wrap=True)

data_58 = Data(panel_114)

# ----
# Family with Kids and Elderly
merge_42 = Merge(Data1=dup_27, Data2=dup_23, Data3=dup_26, Data4=dup_25, Data5=dup_24, Data6=dup_22)
jitter_17 = Jitter(List=merge_42, Jitter=1, Seed=data_58)  # -> Values, Indices
percentage_2 = Panel("3.1")
lng_44 = ListLength(List=jitter_17.Values)
pcent_44 = Percentage(Number=lng_44, Percent=percentage_2)
series_23 = Series(Start=0, Step=1, Count=pcent_44)
item_38 = ListItem(List=jitter_17.Values, Index=series_23, Wrap=True)

data_59 = Data(panel_114)

# ----
# Family no Family
merge_43 = Merge(Data1=dup_13, Data2=dup_12, Data3=dup_10, Data4=dup_15, Data5=dup_14, Data6=dup_11)
percentage_no_family_2 = Panel("0.1")
jitter_18 = Jitter(List=merge_43, Jitter=1, Seed=data_59)  # -> Values, Indices
lng_45 = ListLength(List=jitter_18.Values)
pcent_45 = Percentage(Number=lng_45, Percent=_2_people_percentage_2)
series_24 = Series(Start=0, Step=1, Count=pcent_45)
item_39 = ListItem(List=jitter_18.Values, Index=series_24, Wrap=True)

# ----
# # of Units of
# the building
data_60 = Data(item_21)

# ----
# organized 4edged building PARCELS
geo_41 = Geometry(flatten(cull_i_12))

data_61 = Data(panel_114)

merge_44 = Merge(Data1=item_37, Data2=item_39, Data3=item_38)
jitter_19 = Jitter(List=merge_44, Jitter=1, Seed=data_61)  # -> Values, Indices

data_62 = Data(panel_114)

# ----
# 6 people
# Family with Kids
merge_45 = Merge(Data1=dup_20, Data2=dup_17, Data3=dup_21, Data4=dup_16, Data5=dup_18, Data6=dup_19)
percentage_family_with_kids_3 = Panel("2.5")
jitter_20 = Jitter(List=merge_45, Jitter=1, Seed=data_62)  # -> Values, Indices
lng_46 = ListLength(List=jitter_20.Values)
pcent_46 = Percentage(Number=lng_46, Percent=percentage_family_with_kids_3)
series_25 = Series(Start=0, Step=1, Count=pcent_46)
item_40 = ListItem(List=jitter_20.Values, Index=series_25, Wrap=True)

data_63 = Data(panel_114)

# ----
# Family with Kids and Elderly
merge_46 = Merge(Data1=dup_27, Data2=dup_23, Data3=dup_26, Data4=dup_25, Data5=dup_24, Data6=dup_22)
jitter_21 = Jitter(List=merge_46, Jitter=1, Seed=data_63)  # -> Values, Indices
percentage_3 = Panel("2.5")
lng_47 = ListLength(List=jitter_21.Values)
pcent_47 = Percentage(Number=lng_47, Percent=percentage_3)
series_26 = Series(Start=0, Step=1, Count=pcent_47)
item_41 = ListItem(List=jitter_21.Values, Index=series_26, Wrap=True)

data_64 = Data(panel_114)

# ----
# Family no Family
merge_47 = Merge(Data1=dup_13, Data2=dup_12, Data3=dup_10, Data4=dup_15, Data5=dup_14, Data6=dup_11)
jitter_22 = Jitter(List=merge_47, Jitter=1, Seed=data_64)  # -> Values, Indices
lng_48 = ListLength(List=jitter_22.Values)
pcent_48 = Percentage(Number=lng_48, Percent=_2_people_percentage_2)
series_27 = Series(Start=0, Step=1, Count=pcent_48)
item_42 = ListItem(List=jitter_22.Values, Index=series_27, Wrap=True)

data_65 = Data(floor_height)

data_66 = Data(floor_height)

data_67 = Data(panel_114)
# OCCUPANCY SCHEDULES
panel_232 = Panel("seed")

merge_48 = Merge(Data1=item_40, Data2=item_42, Data3=item_41)
jitter_23 = Jitter(List=merge_48, Jitter=1, Seed=data_67)  # -> Values, Indices

data_68 = Data(panel_114)

# ----
# 7 people
# Family with Kids
merge_49 = Merge(Data1=dup_20, Data2=dup_17, Data3=dup_21, Data4=dup_16, Data5=dup_18, Data6=dup_19)
percentage_family_with_kids_4 = Panel("1.5")
jitter_24 = Jitter(List=merge_49, Jitter=1, Seed=data_68)  # -> Values, Indices
lng_49 = ListLength(List=jitter_24.Values)
pcent_49 = Percentage(Number=lng_49, Percent=percentage_family_with_kids_4)
series_28 = Series(Start=0, Step=1, Count=pcent_49)
item_43 = ListItem(List=jitter_24.Values, Index=series_28, Wrap=True)

data_69 = Data(panel_114)

# ----
# Family with Kids and Elderly
merge_50 = Merge(Data1=dup_27, Data2=dup_23, Data3=dup_26, Data4=dup_25, Data5=dup_24, Data6=dup_22)
jitter_25 = Jitter(List=merge_50, Jitter=1, Seed=data_69)  # -> Values, Indices
percentage_4 = Panel("3.9")
lng_50 = ListLength(List=jitter_25.Values)
pcent_50 = Percentage(Number=lng_50, Percent=percentage_4)
series_29 = Series(Start=0, Step=1, Count=pcent_50)
item_44 = ListItem(List=jitter_25.Values, Index=series_29, Wrap=True)

data_70 = Data(panel_114)

# ----
# Family no Family
merge_51 = Merge(Data1=dup_13, Data2=dup_12, Data3=dup_10, Data4=dup_15, Data5=dup_14, Data6=dup_11)
jitter_26 = Jitter(List=merge_51, Jitter=1, Seed=data_70)  # -> Values, Indices
lng_51 = ListLength(List=jitter_26.Values)
pcent_51 = Percentage(Number=lng_51, Percent=_2_people_percentage_2)
series_30 = Series(Start=0, Step=1, Count=pcent_51)
item_45 = ListItem(List=jitter_26.Values, Index=series_30, Wrap=True)

data_71 = Data(panel_114)

merge_52 = Merge(Data1=item_43, Data2=item_45, Data3=item_44)
jitter_27 = Jitter(List=merge_52, Jitter=1, Seed=data_71)  # -> Values, Indices

data_72 = Data(floor_height)

# ----
# non-organized ALL building parcels four-edge (non-residential builidngs included)
geo_42 = Geometry(flatten(item_10))

panel_238 = Panel("Radius")
data_73 = Data(_40)

bldgprograms = Honeybee_bldgPrograms({"Office": 0, "Retail": 1, "MidriseApartment": 2, "PrimarySchool": 3, "SecondarySchool": 4, "SmallHotel": 5, "LargeHotel": 6, "Hospital": 7, "Outpatient": 8, "Warehouse": 9, "SuperMarket": 10, "FullServiceRestaurant": 11, "QuickServiceRestaurant": 12}, selected="MidriseApartment")
listzoneprograms = Honeybee_ListZonePrograms(bldgProgram=bldgprograms)  # -> MidriseApartmentZonePrograms; plug-in component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
item_46 = ListItem(List=listzoneprograms, Index="1", Wrap=True)

bldgprograms_2 = Honeybee_bldgPrograms({"Office": 0, "Retail": 1, "MidriseApartment": 2, "PrimarySchool": 3, "SecondarySchool": 4, "SmallHotel": 5, "LargeHotel": 6, "Hospital": 7, "Outpatient": 8, "Warehouse": 9, "SuperMarket": 10, "FullServiceRestaurant": 11, "QuickServiceRestaurant": 12}, selected="MidriseApartment")
listzoneprograms_2 = Honeybee_ListZonePrograms(bldgProgram=bldgprograms_2)  # -> MidriseApartmentZonePrograms; plug-in component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
item_47 = ListItem(List=listzoneprograms_2, Index=0, Wrap=True)

data_74 = Data(floor_height)

bldgprograms_3 = Honeybee_bldgPrograms({"Office": 0, "Retail": 1, "MidriseApartment": 2, "PrimarySchool": 3, "SecondarySchool": 4, "SmallHotel": 5, "LargeHotel": 6, "Hospital": 7, "Outpatient": 8, "Warehouse": 9, "SuperMarket": 10, "FullServiceRestaurant": 11, "QuickServiceRestaurant": 12}, selected="MidriseApartment")
listzoneprograms_3 = Honeybee_ListZonePrograms(bldgProgram=bldgprograms_3)  # -> MidriseApartmentZonePrograms; plug-in component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
item_48 = ListItem(List=listzoneprograms_3, Index=2, Wrap=True)

data_75 = Data(floor_height)

data_76 = Data(floor_height)

# ----
# simplified &
# ordered
# parcels (non-residentail buildings included)
# Adiabatic Surface Extraction from Intersected Buildings
geo_43 = Geometry(flatten(item_10))

data_77 = Data(floor_height)
# Intersected Building:
# Unconditioned
panel_242 = Panel("floor height")

# ----
# V1, V2: TS-825
# Window Parameters
singlepanebase = Panel("0.9")
singlepanebase_2 = Panel("0.75")
base = Panel("2.4")

panel_243 = Panel("WWR")
data_78 = Data(wwr)

# ----
# AS-IS V1
# WWR
panel_244 = Panel("0.2")
glzparamlist = Honeybee_GlazingParametersList(northGlzParam=panel_244, westGlzParam=panel_244, southGlzParam=panel_244, eastGlzParam=panel_244)  # -> glzParamList; plug-in component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

getepschedules = Honeybee_GetEnergyPlusSchedules(zoneProgram=item_47)  # -> occupancySchedule, occupancyActivitySch, heatingSetPtSchedule, coolingSetPtSchedule, lightingSchedule, equipmentSchedule, infiltrationSchedule; disabled; plug-in component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
# AS-IS V1/V2/V3
# LIGHTING
# SCHEDULE
convertepschvalues = Honeybee_ConvertEnergyPlusScheduleToValues(schName=getepschedules.occupancySchedule)  # -> values, holidays; disabled; plug-in component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
# https://drive.google.com/drive/u/1/folders/18A2Se-Wr7nzwbHcDhlTYeW92EyIVbHKy
strnum = Ladybug_SeparateData(inputList=flatten(convertepschvalues.values))  # -> numbers, strings; disabled; plug-in component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

# ----
# x
# x
# x
# x
# x
# x
# x
# x
# x
# x
# x
# x
# x
# x
# x
# x
# x
# x
# x
# x
# x
# x
# x
# x
# x
# x
# x
# 
# x
# x
# x
# x
# x
# x
# 
# x
# x
# x
# x
# x
# 
# x
# x
# x
# x
# x
# x
# 
# x
# x
# x
# x
# Domain
# Boundaries
panel_245 = Panel("55")
dom = ConstructDomain(DomainStart="135", DomainEnd="385")
dom_2 = ConstructDomain(DomainStart="200", DomainEnd="350")
dom_3 = ConstructDomain(DomainStart=panel_245, DomainEnd="85")
dom_4 = ConstructDomain(DomainStart="74", DomainEnd="200")
dom_5 = ConstructDomain(DomainStart="90", DomainEnd="230")
# 06.CONDITIONING
# FORENERGYMODELING
panel_246 = Panel("hepsiemlak.com")
merge_53 = Merge(Data1=dom_3, Data2=dom_4, Data3=dom_5, Data4=dom, Data5=dom_2)  # -> simplify(Result)

dup_28 = DuplicateData(Data="18", Number="5", Order=True)
dup_29 = DuplicateData(Data="21.1", Number="19", Order=True)
merge_54 = Merge(Data1=dup_28, Data2=dup_29)

# ----
# Average
# Boundaries
panel_247 = Panel("""64.00
96.67
128.40
199.64
234.86""")
# ----
# binary transformation for occupied hours
python_16 = GhPythonScript(x=strnum.numbers)  # -> out, a; disabled
# ---------- python_16: Python ----------
__author__ = "Siser"
__version__ = "2022.03.16"

import rhinoscriptsyntax as rs
if x >0:
    a = 1
else:
    a = 0
# ---------- end python_16 ----------

callfromepschlibrary = Honeybee_CallFromEPScheduleLibrary(keywords="apart")  # -> scheduleTypeLimits, scheduleList; plug-in component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
panel_248 = Panel("usethisforLaptop")
item_49 = ListItem(List=callfromepschlibrary.scheduleList, Index="16", Wrap=True)

# ----
# 4+1
merge_55 = Merge(Data1=jitter_11.Values, Data2=jitter_15.Values, Data3=jitter_19.Values, Data4=jitter_23.Values, Data5=jitter_27.Values)
jitter_28 = Jitter(List=merge_55, Jitter=1, Seed=2)  # -> flatten(Values), Indices

# ----
# 3+1
merge_56 = Merge(Data1=jitter_7.Values, Data2=jitter_11.Values, Data3=jitter_15.Values, Data4=jitter_19.Values)
jitter_29 = Jitter(List=merge_56, Jitter=1, Seed=2)  # -> flatten(Values), Indices

# ----
# 5+1
merge_57 = Merge(Data1=jitter_15.Values, Data2=jitter_19.Values, Data3=jitter_23.Values, Data4=jitter_27.Values)
jitter_30 = Jitter(List=merge_57, Jitter=1, Seed=2)  # -> flatten(Values), Indices

# ----
# 2+1
merge_58 = Merge(Data1=jitter_4.Values, Data2=jitter_7.Values, Data3=jitter_11.Values)
jitter_31 = Jitter(List=merge_58, Jitter=1, Seed=2)  # -> flatten(Values), Indices

# ----
# 1+1
merge_59 = Merge(Data1=jitter_4.Values, Data2=merge_30)
jitter_32 = Jitter(List=merge_59, Jitter=1, Seed=2)  # -> flatten(Values), Indices

# ----
# COOLING-ON OFFICE
lb_schedule = GenePool(
    Decimals=0,
    Maximum=100.001,
    Minimum=100,
    Value=[100, 100, 100, 100, 100, 100, 100, 100.001, 100.001, 100.001, 100.001, 100.001, 100.001, 100.001, 100.001, 100.001, 100.001, 100.001, 100.001, 100, 100, 100, 100, 100])
lb_schedule_2 = GenePool(
    Decimals=0,
    Maximum=100,
    Minimum=24,
    Value=[100, 100, 100, 100, 100, 100, 100, 100, 24, 24, 24, 24, 24, 24, 24, 24, 24, 24, 24, 24, 100, 100, 100, 100])
toggle_4 = BooleanToggle(True)
annualschedule_22 = Honeybee_AnnualSchedule(
    sun=lb_schedule,
    mon=lb_schedule_2,
    tue=lb_schedule_2,
    wed=lb_schedule_2,
    thu=lb_schedule_2,
    fri=lb_schedule_2,
    sat=lb_schedule_2,
    scheduleName="OFFICE-COOLING-OFF-SCHEDULE",
    schedTypeLimits="Temperature",
    runIt=toggle_4)  # -> readMe, port, schedule, port_2, weekSched, schedIDFText; plug-in component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
annualschedule_23 = Honeybee_AnnualSchedule(
    sun=lb_schedule,
    mon=lb_schedule,
    tue=lb_schedule,
    wed=lb_schedule,
    thu=lb_schedule,
    fri=lb_schedule,
    sat=lb_schedule,
    scheduleName="OFFICE-COOLING-ON-SCHEDULE",
    schedTypeLimits="Temperature",
    runIt=toggle_4)  # -> readMe, port, schedule, port_2, weekSched, schedIDFText; plug-in component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
analysisperiod = Ladybug_AnalysisPeriod(fromMonth="4", fromDay="15", toMonth="10", toDay="15")  # -> readMe, analysisPeriod; plug-in component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
honeybee_seasonalschedule = Honeybee_SeasonalSchedule(
    scheduleName="OFFICE_COOLING_SCHEDULE-ANNUAL",
    schedTypeLimits="Temperature",
    baseWeekSched=annualschedule_23.weekSched,
    seasonWeekSched1=annualschedule_22.weekSched,
    analysisPeriod1=analysisperiod.analysisPeriod)  # -> readMe, schedule, schedIDFText; plug-in component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

# ----
# COOLING-OFF
# RESIDENTIAL
lb_schedule_3 = GenePool(
    Decimals=1,
    Maximum=100,
    Minimum=25,
    Value=[100, 100, 100, 100, 100, 100, 100, 100, 100, 100, 100, 100, 100, 100, 100, 100, 100, 100, 100, 100, 100, 100, 100, 100])
annualschedule_24 = Honeybee_AnnualSchedule(
    sun=lb_schedule_3,
    mon=lb_schedule_3,
    tue=lb_schedule_3,
    wed=lb_schedule_3,
    thu=lb_schedule_3,
    fri=lb_schedule_3,
    sat=lb_schedule_3,
    scheduleName="COOLING_OFF",
    schedTypeLimits="Temperature",
    runIt=Toggle(True))  # -> readMe, port, schedule, port_2, weekSched, schedIDFText; plug-in component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

panel_249 = Panel("references")

# ----
# heating Office
panel_250 = Panel("21")
dup_30 = DuplicateData(Data=panel_250, Number="19", Order=True)
dup_31 = DuplicateData(Data="18", Number="5", Order=True)
merge_60 = Merge(Data1=dup_31, Data2=dup_30)
annualschedule_25 = Honeybee_AnnualSchedule(
    sun=merge_60,
    mon=merge_60,
    tue=merge_60,
    wed=merge_60,
    thu=merge_60,
    fri=merge_60,
    sat=merge_60,
    scheduleName=simplify(graft("heatingOffice")),
    schedTypeLimits="Temperature",
    runIt=Toggle(True))  # -> readMe, port, schedule, port_2, simplify(weekSched), schedIDFText; plug-in component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

# ----
# if outdoor temperature hotter than the indoor temperature then close the natural ventilation
panel_251 = Panel("0")

panel_253 = Panel("references")  # disabled
panel_254 = Panel("25.0")  # disabled
panel_255 = Panel("1")  # disabled
panel_256 = Panel("0.0")  # disabled
panel_257 = Panel("24.0")  # disabled
panel_258 = Panel("12")  # disabled
panel_259 = Panel("0.4")  # disabled

# ----
# BepTr
heating_set_back = Panel("10")
# Conditioning  Temperatures
cooling_set_point_set_back = Panel("100")
heating_set_point = Panel("20")

# ----
# Estimating space heating determinants: An analysis of Greek households: More energy is needed for space heating as the household head becomes older [11,21]. Elderly prefer higher room temperatures and are home owners of rather old, noninsulated dwellings, reasons that contributed to higher per capita energy consumption for space heating [9]. The same holds true in case of Norwegian households, as older people not only prefer a relatively high indoor temperature but also stay at home more than younger ones due to sociological reasons [6,7].
# SCHEDULE_A(i.e., 0to4, 65+) demand warmer spaces than the others thus heating set point starts 2 degree lower. Set back value is the same for all schedules.
panel_260 = Panel("scheduleA")
panel_261 = Panel("SCHEDULE_A: 23, others: 21 ")

# ----
# ASHRAE
# Heating Set Point: distribution for set points:
# 21-23
heating_set_back_2 = Panel("10")
# ANKARA
cooling_set_point = Panel("25")
cooling_set_back = Panel("28")

# ----
# SET POINT SCHEDULES
# Aging population increases energy use: https://news.harvard.edu/gazette/story/2019/06/harvard-research-shows-energy-use-climbs-with-age-and-temperature/
heating_set_points = Panel("""23
21""")
heating_set_points_name = Panel("""A
others""")
cooling_set_points = Panel("""27
25""")

data_79 = Data("5")
data_80 = Data("1")
data_81 = Data("10")

# ----
# Heating Set Point: distribution for set points:
# 21-23
heating_set_back_3 = Panel("10")
cooling_set_point_set_back_2 = Panel("100")

lng_52 = ListLength(List=merge_14)  # -> flatten(Length)

data_82 = Data(weave_4)

heating_set_back_4 = Panel("10")
cooling_set_point_2 = Panel("25")

# ----
# %33 for all selection
# -before 80s
# -80-00
# -after 00s
infiltration_rate = Panel("""0.000285
0.0004
0.0005""")

# ----
# public and school buildings excluded list
data_83 = Data(python_11.a)

# ----
# Air Change Rate: Identification of the Retrofit Actions to Achieve Cost-Optimal and
# NZEB Levels for Residential Buildings in Istanbul Considering
# the Remaining Building Lifetime
boolean_toggle_2 = BooleanToggle(True)

data_84 = Data(merge_48)  # disabled
lng_53 = ListLength(List=data_84)  # disabled
panel_265 = Panel("6")  # disabled
dup_32 = DuplicateData(Data=panel_265, Number=lng_53, Order=True)  # disabled

data_85 = Data(merge_44)  # disabled
lng_54 = ListLength(List=data_85)  # disabled
panel_266 = Panel("5")  # disabled
dup_33 = DuplicateData(Data=panel_266, Number=lng_54, Order=True)  # disabled

data_86 = Data(merge_52)  # disabled
lng_55 = ListLength(List=data_86)  # disabled
panel_267 = Panel("7")  # disabled
dup_34 = DuplicateData(Data=panel_267, Number=lng_55, Order=True)  # disabled

data_87 = Data(merge_35)  # disabled
lng_56 = ListLength(List=data_87)  # disabled
panel_268 = Panel("3")  # disabled
dup_35 = DuplicateData(Data=panel_268, Number=lng_56, Order=True)  # disabled

data_88 = Data(jitter_4.Values)  # disabled
lng_57 = ListLength(List=data_88)  # disabled
panel_269 = Panel("1")  # disabled
dup_36 = DuplicateData(Data=panel_269, Number=lng_57, Order=True)  # disabled

data_89 = Data(merge_40)  # disabled
lng_58 = ListLength(List=data_89)  # disabled
panel_270 = Panel("4")  # disabled
dup_37 = DuplicateData(Data=panel_270, Number=lng_58, Order=True)  # disabled

data_90 = Data(merge_30)  # disabled
lng_59 = ListLength(List=data_90)  # disabled
panel_271 = Panel("2")  # disabled
dup_38 = DuplicateData(Data=panel_271, Number=lng_59, Order=True)  # disabled

m3sm2 = Panel("0.0003")
panel_272 = Panel("IGD")

data_91 = Data(item_46)
panel_273 = Panel(data_91)
geteploads = Honeybee_GetEnergyPlusLoads(zoneProgram=data_91)  # -> equipmentLoadPerArea, infilRatePerArea_Facade, lightingDensityPerArea, numOfPeoplePerArea, ventilationPerArea, ventilationPerPerson; plug-in component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

merge_61 = Merge(Data1=dup_37, Data2=dup_33, Data3=dup_32, Data4=dup_34)  # disabled
jitter_33 = Jitter(List=merge_61, Jitter=1, Seed=2)  # -> flatten(Values), Indices; disabled

merge_62 = Merge(Data1=dup_38, Data2=dup_35, Data3=dup_37, Data4=dup_33)  # disabled
jitter_34 = Jitter(List=merge_62, Jitter=1, Seed=2)  # -> flatten(Values), Indices; disabled

merge_63 = Merge(Data1=dup_35, Data2=dup_37, Data3=dup_33, Data4=dup_32, Data5=dup_34)  # disabled
jitter_35 = Jitter(List=merge_63, Jitter=1, Seed=2)  # -> flatten(Values), Indices; disabled

merge_64 = Merge(Data1=dup_36, Data2=dup_38, Data3=dup_35)  # disabled
jitter_36 = Jitter(List=merge_64, Jitter=1, Seed=2)  # -> flatten(Values), Indices; disabled

merge_65 = Merge(Data1=dup_36, Data2=dup_38)  # disabled
jitter_37 = Jitter(List=merge_65, Jitter=1, Seed=2)  # -> flatten(Values), Indices; disabled

# ----
# AS-ISV1
panel_274 = Panel("0.0001")

data_92 = Data(item_47)
panel_275 = Panel(data_92)
geteploads_2 = Honeybee_GetEnergyPlusLoads(zoneProgram=data_92)  # -> equipmentLoadPerArea, infilRatePerArea_Facade, lightingDensityPerArea, numOfPeoplePerArea, ventilationPerArea, ventilationPerPerson; plug-in component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

ground_truth_from_municipality_construct = Panel("""1
0
1
1
1
1
1
1
1
1
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""")  # "GROUND TRUTH FROM MUNICIPALITY ConstructionType"
panel_276 = Panel("0=masonry, 1=concrete")

# ----
# ordered buildings list information
data_93 = Data(merge_14)
tstat_5 = TreeStatistics(Tree=data_93)  # -> Paths, Length, Count

# ----
# public and school buildings excluded list
data_94 = Data(python_11.a)

panel_277 = Panel("U-roof")
data_95 = Data(uroof)

# ----
# U-Factor no Film [W/m2-K]
panel_278 = Panel("https://unmethours.com/question/55666/what-is-the-basis-for-air-film-resistances-used-to-calculate-u-factor-with-film/")

# ----
# U-Factor no Film [W/m2-K]
panel_279 = Panel("https://unmethours.com/question/55666/what-is-the-basis-for-air-film-resistances-used-to-calculate-u-factor-with-film/")

# ----
# U-Factor no Film [W/m2-K]
panel_280 = Panel("https://unmethours.com/question/55666/what-is-the-basis-for-air-film-resistances-used-to-calculate-u-factor-with-film/")

panel_281 = Panel("U-wall")
data_96 = Data(uwall)

data_97 = Data(uwall)

epopaquemat = Honeybee_EnergyPlusOpaqueMaterial(name="icSivaAlciEsasliInt", thickness="0.02", conductivity="0.51", density="1200", specificHeat="1090")  # -> EPMaterial; plug-in component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
epopaquemat_2 = Honeybee_EnergyPlusOpaqueMaterial(name="icSivaAlciEsasliInt", thickness="0.02", conductivity="0.51", density="1200", specificHeat="1090")  # -> EPMaterial; plug-in component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
epopaquemat_3 = Honeybee_EnergyPlusOpaqueMaterial(name="yatay delikli tugla", thickness="0.085", conductivity="0.33", density="600", specificHeat="900")  # -> EPMaterial; plug-in component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

# ----
# Internal wall
epconstruction = Honeybee_EnergyPlusConstruction(name="CC_Internal_wall", layer_1=epopaquemat, layer_2=epopaquemat_3, layer_3=epopaquemat_2)  # -> EPConstruction; plug-in component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

# ----
# U-Factor no Film [W/m2-K]
panel_283 = Panel("https://unmethours.com/question/55666/what-is-the-basis-for-air-film-resistances-used-to-calculate-u-factor-with-film/")

# ----
# U-Factor no Film [W/m2-K]
panel_284 = Panel("https://unmethours.com/question/55666/what-is-the-basis-for-air-film-resistances-used-to-calculate-u-factor-with-film/")

data_98 = Data(uroof)

panel_286 = Panel("""simplified &
ordered
parcel
layouts""")
geo_44 = Geometry(flatten(item_10))

data_99 = Data(_40)

floor_height_2 = Panel("3")
data_100 = Data(floor_height)

panel_288 = Panel("SORTED BLOCK BOUNDARIES")
sorted_parcels_2 = Geometry(sort.ValuesA)

data_101 = Data(weave_8)

data_102 = Data(floor_height)

data_103 = Data(floor_height)

geo_45 = Geometry(geo_44)

panel_291 = Panel("""3332
3332
3332
3332
3233
3233
3233
3233
3223
3223
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""")  # disabled
chars = Characters(Text=panel_291)  # -> simplify(Result), Unicode; disabled
panel_292 = Panel(chars.Result)  # disabled
item_50 = ListItem(List=panel_292, Index=1, Wrap=True)  # -> flatten(Item); disabled
item_51 = ListItem(List=panel_292, Index=1, Wrap=True)  # -> flatten(Item); disabled
item_52 = ListItem(List=panel_292, Index=0, Wrap=True)  # -> flatten(Item); disabled
item_53 = ListItem(List=panel_292, Index=2, Wrap=True)  # -> flatten(Item); disabled
panel_293 = Panel(item_52)  # disabled
panel_294 = Panel(item_50)  # disabled
panel_295 = Panel(item_53)  # disabled
panel_296 = Panel(item_51)  # disabled

# ----
# 2nd week - Coldest Week
panel_297 = Panel("13")  # disabled
panel_298 = Panel("1")  # disabled
panel_299 = Panel("7")  # disabled
analysisperiod_2 = Ladybug_AnalysisPeriod(fromMonth=panel_298, fromDay=panel_299, toMonth=panel_298, toDay=panel_297)  # -> readMe, analysisPeriod; disabled; plug-in component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
panel_300 = Panel(analysisperiod_2.analysisPeriod)  # disabled

# ----
# 15th week - Spring
panel_301 = Panel("14")  # disabled
panel_302 = Panel("4")  # disabled
panel_303 = Panel("8")  # disabled
analysisperiod_3 = Ladybug_AnalysisPeriod(fromMonth=panel_302, fromDay=panel_303, toMonth=panel_302, toDay=panel_301)  # -> readMe, analysisPeriod; disabled; plug-in component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
panel_304 = Panel(analysisperiod_3.analysisPeriod)  # disabled

data_104 = Data(floor_height)

# ----
# if context do not exist
panel_305 = Panel("0")
dup_39 = DuplicateData(Data=panel_305, Number="4", Order=True)

getepschedules_2 = Honeybee_GetEnergyPlusSchedules()  # -> occupancySchedule, occupancyActivitySch, heatingSetPtSchedule, coolingSetPtSchedule, lightingSchedule, equipmentSchedule, infiltrationSchedule; disabled; plug-in component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
decomposeepsch = Honeybee_DecomposeEnergyPlusSchedule(schName=getepschedules_2.occupancySchedule)  # -> name, schedule, comments; disabled; plug-in component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
convertepschvalues_2 = Honeybee_ConvertEnergyPlusScheduleToValues(schName=decomposeepsch.name)  # -> values, holidays; disabled; plug-in component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
strnum_2 = Ladybug_SeparateData(inputList=flatten(convertepschvalues_2.values))  # -> numbers, strings; disabled; plug-in component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
panel_306 = Panel("168")  # disabled
partition_26 = PartitionList(List=strnum_2.numbers, Size=panel_306)  # -> simplify(Chunks); disabled
# x
# x
# x
# x
# x
# x
# x
# x
# x
# x
# x
# x
# x
# x
# x
# x
# x
# x
# x
# x
# x
# x
# x
# x
# x
# 
# x
# x
# x
# x
# 
# x
# x
# x
# x
# x
# X
# x
# X
# X
# X
# X
# X
# 
# X
# X
# X
# X
# X
# X
# 
# X
# X
# X
# X
# X
# X
# 
# X
# X
# X
# X
# X
# X
# X
# X
# X
# 
# X
# X
# X
panel_307 = Panel("0")
branch_11 = TreeBranch(Tree=partition_26, Path=panel_307, MaintainPaths=True)  # disabled
graph = QuickGraph(branch_11, SortOrder=0)  # disabled
# Run Periods
# RunPeriod,
#   Autumn,                           !- Name
#   10,                                      !- Begin Month
#   21,                                      !- Begin Day of Month
#   10,                                     !- End Month
#   27,                                     !- End Day of Month
# Monday,
#   No,                                     !- Use Weather File Holidays and Special Days
#   No,                                     !- Use Weather File Daylight Saving Period
#   No,                                     !- Apply Weekend Holiday Rule
#   Yes,                                    !- Use Weather File Rain Indicators
#   Yes,                                    !- Use Weather File Snow Indicators
#   1;                                      !- Number of Times Runperiod to be Repeated
panel_308 = Panel(branch_11)  # disabled

panel_309 = Panel("if context exist")

# ----
# Window Directions
panel_310 = Panel("""2: no window
3: window""")

# ----
# 28th week - Hottest Week
panel_311 = Panel("14")  # disabled
panel_312 = Panel("7")  # disabled
panel_313 = Panel("8")  # disabled
analysisperiod_4 = Ladybug_AnalysisPeriod(fromMonth=panel_312, fromDay=panel_313, toMonth=panel_312, toDay=panel_311)  # -> readMe, analysisPeriod; disabled; plug-in component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
# Run Periods
# Run Periods
# RunPeriod,
#   Spring,                           !- Name
#   4,                                      !- Begin Month
#   8,                                      !- Begin Day of Month
#   4,                                     !- End Month
#   14,                                     !- End Day of Month
# Monday,
#   No,                                     !- Use Weather File Holidays and Special Days
#   No,                                     !- Use Weather File Daylight Saving Period
#   No,                                     !- Apply Weekend Holiday Rule
#   Yes,                                    !- Use Weather File Rain Indicators
#   Yes,                                    !- Use Weather File Snow Indicators
#   1;                                      !- Number of Times Runperiod to be Repeated
# RunPeriod,
#   Summer,                           !- Name
#   7,                                      !- Begin Month
#   8,                                      !- Begin Day of Month
#   7,                                     !- End Month
#   14,                                     !- End Day of Month
# Monday,
#   No,                                     !- Use Weather File Holidays and Special Days
#   No,                                     !- Use Weather File Daylight Saving Period
#   No,                                     !- Apply Weekend Holiday Rule
#   Yes,                                    !- Use Weather File Rain Indicators
#   Yes,                                    !- Use Weather File Snow Indicators
#   1;                                      !- Number of Times Runperiod to be Repeated
panel_314 = Panel(analysisperiod_4.analysisPeriod)  # disabled

# ----
# 43th week - Autumn
panel_315 = Panel("27")  # disabled
panel_316 = Panel("10")  # disabled
panel_317 = Panel("21")  # disabled
analysisperiod_5 = Ladybug_AnalysisPeriod(fromMonth=panel_316, fromDay=panel_317, toMonth=panel_316, toDay=panel_315)  # -> readMe, analysisPeriod; disabled; plug-in component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
panel_318 = Panel(analysisperiod_5.analysisPeriod)  # disabled

# ----
# formFactor of
# Simulated Units
reference = Panel("https://greenbuildingencyclopaedia.uk/encyclopaedia/files/calculators/equations/form-factor-equation/")

# ----
# if context do not exist
panel_319 = Panel("0")
dup_40 = DuplicateData(Data=panel_319, Number="4", Order=True)

# ----
# Width/Depth ratio of
# Simulated Units
panel_320 = Panel("""width: eastToWest
depth: northToSouth""")

toggle_5 = BooleanToggle(True)  # disabled
# AdaptiveComfort
panel_321 = Panel("hourly")  # disabled
epoutput = Honeybee_GenerateEPOutput(
    zoneEnergyUse=toggle_5,
    zoneGainsAndLosses=toggle_5,
    zoneComfortMetrics=toggle_5,
    surfaceTempAnalysis="False",
    surfaceEnergyAnalysis=toggle_5,
    timestep=panel_321)  # -> report, flatten(simulationOutputs); disabled; plug-in component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
panel_322 = Panel("""0
23
31
32
33""")  # disabled
item_54 = ListItem(List=epoutput.simulationOutputs, Index=panel_322, Wrap=True)  # disabled

# ----
# Optimized
# Simulation
# Output
# Zone,Average,Site Outdoor Air Drybulb Temperature
# 
# Output:Variable,*,Zone Ideal Loads Supply Air Total Cooling Energy, hourly;
toggle_6 = BooleanToggle(True)
panel_323 = Panel("Output:Variable,*,Site Outdoor Air Drybulb Temperature, hourly;")
panel_324 = Panel("""0
1
2
12
13
14
23
24
25
26
27
28
29
30
31
32
33""")
epoutput_2 = Honeybee_GenerateEPOutput(
    zoneEnergyUse=toggle_6,
    zoneGainsAndLosses=toggle_6,
    zoneComfortMetrics=toggle_6,
    surfaceTempAnalysis="False",
    surfaceEnergyAnalysis=toggle_6,
    timestep="hourly")  # -> report, flatten(simulationOutputs); plug-in component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
item_55 = ListItem(List=epoutput_2.simulationOutputs, Index=panel_324, Wrap=True)
merge_66 = Merge(Data1=item_55, Data2=panel_323)  # -> flatten(Result)

# ----
# Energy Balance
toggle_7 = BooleanToggle(True)  # disabled
panel_326 = Panel("""0
1
2
10
12
13
14
23
24
25
26
27
28
29
30
31
32
35
36
37""")  # disabled
panel_327 = Panel("monthly")  # disabled
epoutput_3 = Honeybee_GenerateEPOutput(
    zoneEnergyUse=toggle_7,
    zoneGainsAndLosses=toggle_7,
    zoneComfortMetrics=toggle_7,
    surfaceTempAnalysis="False",
    surfaceEnergyAnalysis=toggle_7,
    timestep=panel_327)  # -> report, flatten(simulationOutputs); disabled; plug-in component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
item_56 = ListItem(List=epoutput_3.simulationOutputs, Index=panel_326, Wrap=True)  # disabled

panel_328 = Panel("monthly")  # disabled

toggle_8 = BooleanToggle(True)  # disabled
epoutput_4 = Honeybee_GenerateEPOutput(
    zoneEnergyUse=toggle_8,
    zoneGainsAndLosses=toggle_8,
    zoneComfortMetrics="False",
    surfaceTempAnalysis="False",
    surfaceEnergyAnalysis=toggle_8,
    timestep=panel_328)  # -> report, flatten(simulationOutputs); disabled; plug-in component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

simcontrol = Honeybee_SimulationControl(maxWarmupDays="150", minWarmupDays="6")  # -> simControls; plug-in component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
energysimpar = Honeybee_EnergySimulationPar(timestep=6, solarDistribution="4", startDayOfWeek="1", simulationControls=simcontrol, terrain="0")  # -> energySimPar; plug-in component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

path = FilePath("D:\KBEM\IP2.1\EPW\ANKARA_TUR_RenewablePaper.epw")
panel_329 = Panel("weather data")

panel_330 = Panel("weatherdata")  # disabled
data_105 = Data(path)  # disabled

importepw = Ladybug_ImportEpw(epwFile=data_105)  # -> readMe, latitude, location, dryBulbTemperature, dewPointTemperature, relativeHumidity, windSpeed, windDirection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; disabled; plug-in component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
strnum_3 = Ladybug_SeparateData(inputList=flatten(importepw.globalHorizontalIlluminance))  # -> numbers, strings; disabled; plug-in component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

panel_331 = Panel(strnum_3.numbers)  # disabled
panel_332 = Panel("reference")  # disabled

# ----
# close the lights during daylight hours
python_17 = GhPythonScript(x=strnum_3.numbers, y=python_16.a)  # -> out, a; disabled
# ---------- python_17: Python ----------
__author__ = "Siser"
__version__ = "2022.03.16"

import rhinoscriptsyntax as rs
if x <1000:
    a = 1
else:
    a = 0
# ---------- end python_17 ----------

# ----
# close when everyone sleeps
panel_333 = Panel("24")  # disabled
panel_334 = Panel("6")  # disabled
partition_27 = PartitionList(List=simplify(python_17.a), Size=panel_333)  # -> simplify(Chunks); disabled
series_31 = Series(Start=0, Step=1, Count=panel_334)  # disabled
panel_335 = Panel("0")  # disabled
replace_7 = ReplaceItems(List=partition_27, Item=panel_335, Indices=series_31, Wrap=False)  # -> simplify(List); disabled

# ----
# 1st
# 2nd
# 3rd
data_106 = Data(flatten(replace_7))  # disabled

panel_336 = Panel("binaryLightSchedule")  # disabled
toggle_9 = BooleanToggle(False)  # disabled
csvschedule = Honeybee_CreateCSVSchedule(values=data_106, scheduleName=panel_336, writeFile=toggle_9)  # -> readMe, csvSchedule; disabled; plug-in component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
panel_337 = Panel("usethisforDesktop")  # disabled

# ----
# Working Direction
panel_338 = Panel("D:\KBEM\IP2.1\resV2")

panel_339 = Panel("Simulation")

button = Button()
panel_340 = Panel("Reset CSV Recorders")
python_18 = PythonScript(Toggle=button)
# ---------- python_18: Python ----------
import Grasshopper as gh

if Toggle:
    
    # Get the Grasshopper document and objects
    ghDoc = ghenv.Component.OnPingDocument()
    ghObjects = ghDoc.Objects
    
    # Iterate the GH objects, check type and reset data recorders
    for obj in ghObjects:
        if type(obj) is gh.Kernel.Special.GH_DataRecorder:
            obj.DestroyRecordedData()
            obj.ExpireSolution(True)
# ---------- end python_18 ----------

panel_341 = Panel("Colibri")

# ----
# Selection
# Slider of
# Building
# there are 599 residential buildings
filename = Slider(20, range=0..592)

panel_342 = Panel("selected parcel- unitFunctions")
item_57 = ListItem(List=cull_i_5, Index=filename, Wrap=True)
branch_12 = TreeBranch(Tree=partition, Path=item_57, MaintainPaths=True)

panel_343 = Panel("selected parcel")
data_107 = Data(filename)

data_108 = Data(filename)

panel_345 = Panel("staircase")
branch_13 = TreeBranch(Tree=partition_25, Path=filename, MaintainPaths=True)

branch_14 = TreeBranch(Tree=partition_25, Path=filename, MaintainPaths=True)

# ----
# 0: residential non-cooling
# 5: residential with cooling
# 1: office unit
data_109 = Data(branch_12)

# ----
# Zone Program
panel_347 = Panel("1")
equals_15 = Equality(FirstNumber=data_109, SecondNumber=panel_347)  # -> Equality, Inequality
lng_60 = ListLength(List=data_109)
listdexs_4 = ListIndices(List=data_109)
dispatch_21 = Dispatch(List=listdexs_4, DispatchPattern=equals_15.Equality)  # -> ListA, ListB
# Naming for Simulated  Zones
dup_41 = DuplicateData(Data="0", Number=lng_60, Order=True)
replace_8 = ReplaceItems(List=dup_41, Item=item_47, Indices=dispatch_21.ListB, Wrap=False)
replace_9 = ReplaceItems(List=replace_8, Item=item_46, Indices=dispatch_21.ListA, Wrap=False)
panel_348 = Panel(replace_9)

panel_349 = Panel("Window shgc")
data_110 = Data(shgcwindow)
item_58 = ListItem(List=data_110, Index=filename, Wrap=True)

panel_350 = Panel("vtWindow")
data_111 = Data(vtwindow)
item_59 = ListItem(List=data_111, Index=filename, Wrap=True)

# ----
# V3: Generated
# Window Parameters
panel_351 = Panel("uWindow")
data_112 = Data(uwindow)
item_60 = ListItem(List=data_112, Index=filename, Wrap=True)

panel_352 = Panel("Building-based EKB")
item_61 = ListItem(List=data_78, Index=filename, Wrap=True)

# ----
# Generated
# WWR
glzparamlist_2 = Honeybee_GlazingParametersList(northGlzParam=item_61, westGlzParam=item_61, southGlzParam=item_61, eastGlzParam=item_61)  # -> glzParamList; plug-in component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

# ----
# Unit Separation by Function
panel_353 = Panel("""0: residential non-cooling
1: office unit""")
data_113 = Data(branch_12)

# ----
# 0: residential non-cooling
# 1: residential with cooling
# 2: office unit
data_114 = Data(branch_12)

# ----
# Infiltration
# GENERATED
data_115 = Data(infiltration)
item_62 = ListItem(List=data_115, Index=filename, Wrap=True)

partition_28 = PartitionList(List=data_82, Size=lng_52)  # -> simplify(Chunks)
cull_i_18 = CullIndex(List=partition_28, Indices=data_83, Wrap=True)  # -> simplify(flatten(List))
item_63 = ListItem(List=cull_i_18, Index=filename, Wrap=True)

# ----
# Infiltration
# V1
python_19 = GhPythonScript(x=item_63)  # -> out, a; inputs x: Int32
# ---------- python_19: Python ----------
__author__ = "Siser"
__version__ = "2022.02.21"

import rhinoscriptsyntax as rs
if x == 1960:
    a = 0.0005
elif x == 1980:
    a = 0.0004
else:
    a = 0.000285
# ---------- end python_19 ----------

# ----
# information of Selection
# Slider of Building
data_116 = Data(filename)

item_64 = ListItem(List=data_95, Index=filename, Wrap=True)
panel_354 = Panel("Insulation U value")

panel_355 = Panel("uValue Input")
data_117 = Data(item_64)

merge_67 = Merge(Data1="GeneratedConcreteRoof", Data2=filename)
join_11 = TextJoin(Text=merge_67)

merge_68 = Merge(Data1="GeneratedMasonryWall", Data2=filename)
join_12 = TextJoin(Text=merge_68)

merge_69 = Merge(Data1="GeneratedConcreteWall", Data2=filename)
join_13 = TextJoin(Text=merge_69)

item_65 = ListItem(List=data_96, Index=filename, Wrap=True)

data_118 = Data(item_65)

item_66 = ListItem(List=data_97, Index=filename, Wrap=True)

data_119 = Data(item_66)

merge_70 = Merge(Data1="generatedGroundFloor", Data2=filename)
join_14 = TextJoin(Text=merge_70)

item_67 = ListItem(List=data_98, Index=filename, Wrap=True)

data_120 = Data(item_67)

data_121 = Data(ugroundfloor)
item_68 = ListItem(List=data_121, Index=filename, Wrap=True)

panel_362 = Panel("U-GroundFloor")
data_122 = Data(item_68)

item_69 = ListItem(List=data_122, Index=filename, Wrap=True)

data_123 = Data(item_69)

# ----
# index of selected parcel
# 08.OUTPUT MANAGEMENT
data_124 = Data(filename)

construct_domain = ConstructDomain(DomainStart="0", DomainEnd="592")
iteration_selection = IterationSelection(Domain=construct_domain)
iterator = ColibriIterator(fileName=filename, Selection=iteration_selection, RemoteFly=False, ignoreAllWarningMsg=False)  # -> FileName_, Value_N, IterationGenome

uniffuntion_nvi = Panel(branch_12)

# ----
# Select Version
list = ValueList({"V1": 0, "V2": 1, "V3": 2, "V4": 3}, selected="V2")

panel_365 = Panel("Window SHGC")
weave_17 = Weave(Pattern=list, Stream0=singlepanebase_2, Stream1=singlepanebase_2, Stream2=item_58, Stream3=item_58, NullGaps=False)

panel_366 = Panel("Window uValue")
weave_18 = Weave(Pattern=list, Stream0=base, Stream1=base, Stream2=item_60, Stream3=item_60, NullGaps=False)

panel_367 = Panel("Window VT")
weave_19 = Weave(Pattern=list, Stream0=singlepanebase, Stream1=singlepanebase, Stream2=item_59, Stream3=item_59, NullGaps=False)

weave_20 = Weave(Pattern=list, Stream0=glzparamlist, Stream1=glzparamlist, Stream2=glzparamlist_2, Stream3=glzparamlist_2, NullGaps=False)

merge_71 = Merge(Data1="Generated_WINDOW", Data2=weave_18, Data3=weave_17, Data4=weave_19)
join_15 = TextJoin(Text=merge_71, Join="_")

panel_369 = Panel("Window ConstName")
weave_21 = Weave(Pattern=list, Stream0="TS-825_WINDOW", Stream1="TS-825_WINDOW", Stream2=join_15, Stream3=join_15, NullGaps=False)

epwindowmat = Honeybee_EnergyPlusWindowMaterial(name="GLASSUBEM", U_Value=weave_18, SHGC=weave_17, VT=weave_19)  # -> EPMaterial; plug-in component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
epconstruction_2 = Honeybee_EnergyPlusConstruction(name=weave_21, layer_1=epwindowmat)  # -> EPConstruction; plug-in component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

panel_370 = Panel("Naming for Roof")
weave_22 = Weave(
    Pattern=list,
    Stream0="TS-825ConcreteRoof",
    Stream1="TS-825ConcreteRoof",
    Stream2=join_11,
    Stream3=join_11,
    NullGaps=False)

decomposeepconstruction = Honeybee_DecomposeEPConstruction(cnstrName=weave_22)  # -> materials, comments, UValue_SI, UValue_IP, RValue_SI, RValue_IP; plug-in component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
panel_371 = Panel(decomposeepconstruction.UValue_SI)

weave_23 = Weave(
    Pattern=list,
    Stream0="TS-825ConcreteWall",
    Stream1="TS-825ConcreteWall",
    Stream2=join_13,
    Stream3=join_13,
    NullGaps=False)

decomposeepconstruction_2 = Honeybee_DecomposeEPConstruction(cnstrName=weave_23)  # -> materials, comments, UValue_SI, UValue_IP, RValue_SI, RValue_IP; plug-in component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
panel_372 = Panel(decomposeepconstruction_2.UValue_SI)

weave_24 = Weave(Pattern=list, Stream0="TS-825MasonryWall", Stream1="TS-825MasonryWall", Stream2=join_12, Stream3=join_12, NullGaps=False)

decomposeepconstruction_3 = Honeybee_DecomposeEPConstruction(cnstrName=weave_24)  # -> materials, comments, UValue_SI, UValue_IP, RValue_SI, RValue_IP; plug-in component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
panel_373 = Panel(decomposeepconstruction_3.UValue_SI)

panel_374 = Panel("Naming for GroundFloor")
weave_25 = Weave(Pattern=list, Stream0="TS-825GROUNDFLOOR", Stream1="TS-825GROUNDFLOOR", Stream2=join_14, Stream3=join_14, NullGaps=False)

decomposeepconstruction_4 = Honeybee_DecomposeEPConstruction(cnstrName=weave_25)  # -> materials, comments, UValue_SI, UValue_IP, RValue_SI, RValue_IP; plug-in component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
panel_375 = Panel(decomposeepconstruction_4.UValue_SI)

merge_72 = Merge(Data1="GeneratedMasonryRoof", Data2=filename)
join_16 = TextJoin(Text=merge_72)
weave_26 = Weave(Pattern=list, Stream0="TS-825MasonryRoof", Stream1="TS-825MasonryRoof", Stream2=join_16, Stream3=join_16, NullGaps=False)

decomposeepconstruction_5 = Honeybee_DecomposeEPConstruction(cnstrName=weave_26)  # -> materials, comments, UValue_SI, UValue_IP, RValue_SI, RValue_IP; plug-in component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
panel_377 = Panel(decomposeepconstruction_5.UValue_SI)

data_125 = Data(weave_20)

# ----
# Function of Units
# (0:residential, 1: office)
data_126 = Data(branch_12)

area_21 = Area(Geometry=sort.ValuesA)  # -> Area, Centroid
tag_of_block = Panel("neighborhoodName2digits_parcelNumber_buildingNumber")
sorted_points_2 = Point(area_21.Centroid)
lng_61 = ListLength(List=sorted_points_2)
series_32 = Series(Start="0", Step=1, Count=lng_61)
int = Integer(series_32)
preview_20 = CustomPreview(Geometry=geo_15, Material=ColourSwatch(SwatchColor=RGB(0, 123, 255)))
tag_2 = TextTag3D(Location=sorted_points_2, Text=int, Size="15", Colour=ColourSwatch(SwatchColor=RGB(255, 0, 0)), Justification=7)

panel_379 = Panel("parcel_block order")
data_127 = Data(flatten(partition_5))

lng_62 = ListLength(List=merge_14)  # -> flatten(Length)

# ----
# public and school buildings excluded list
data_128 = Data(python_11.a)

# ----
# Indexing
partition_29 = PartitionList(List=data_127, Size=lng_62)  # -> simplify(Chunks)
cull_i_19 = CullIndex(List=partition_29, Indices=data_128, Wrap=True)  # -> simplify(flatten(List))
panel_381 = Panel(cull_i_19)

panel_382 = Panel("""parcel_block
of simulated parcel""")
item_70 = ListItem(List=cull_i_19, Index=filename, Wrap=True)

panel_383 = Panel("parcel_block")
data_129 = Data(cull_i_19)
item_71 = ListItem(List=data_129, Index=filename, Wrap=True)

# ----
# tag order
# for parcels
swatch_6 = ColourSwatch(SwatchColor=RGB(8, 0, 255))
tag_3 = TextTag3D(Location=partition_4, Text=partition_5, Size="3", Colour=swatch_6, Justification=7)

# ----
# 08.AS-IS
# INPUT
# PARAMETERS
list_of_recordings = Panel("""(ID)
parcelUBEM
blockUBEM
---------
(UNIT)
verticalPosition
formFactor
totalWindowArea
windowcount
floorArea
z-axis
function
WWRDirectionUnitNorth
WWRDirectionUnitWest
WWRDirectionUnitSouth
WWRDirectionUnitEast
---------
(BUILDING)
uWall
#ofFloor
Infiltration
ObstacleDirectionNorth
ObstacleDirectionWest
ObstacleDirectionSouth
ObstacleDirectionEast""")

# ----
# Select Occupied Hours
getepschedules_3 = Honeybee_GetEnergyPlusSchedules(zoneProgram=item_47)  # -> occupancySchedule, occupancyActivitySch, heatingSetPtSchedule, coolingSetPtSchedule, lightingSchedule, equipmentSchedule, infiltrationSchedule; plug-in component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
# IOD calculation only for occupied hours
convertepschvalues_3 = Honeybee_ConvertEnergyPlusScheduleToValues(schName=getepschedules_3.occupancySchedule)  # -> values, holidays; plug-in component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
strnum_4 = Ladybug_SeparateData(inputList=flatten(convertepschvalues_3.values))  # -> numbers, strings; plug-in component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
python_20 = GhPythonScript(x=strnum_4.numbers)  # -> out, a; same code as python_16
equals_16 = Equality(FirstNumber=python_20.a, SecondNumber="1")  # -> Equality, Inequality

# ----
# UpperBounds
importepw_2 = Ladybug_ImportEpw(epwFile=path)  # -> readMe, latitude, location, dryBulbTemperature, dewPointTemperature, relativeHumidity, windSpeed, windDirection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; plug-in component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
panel_384 = Panel("""key:location/dataType/units/frequency/startsAt/endsAt
Ankara Central_AN_TUR
Dry Bulb Temperature
C
Hourly
(1, 1, 1)
(12, 31, 24)""")
dup_42 = DuplicateData(Data=Slider(6, range=0..10), Number=Slider(8760, range=0..10000), Order=True)
merge_73 = Merge(Data1=panel_384, Data2=dup_42)  # -> flatten(Result)
adaptcomfortpar = Ladybug_AdaptiveComfortParameters(ASHRAEorEN=Toggle(True), eightyOrNinetyComf=Toggle(False), avgMonthOrRunMean=Toggle(True))  # -> comfortPar; plug-in component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
panel_385 = Panel("not important")
adaptivecomfortcalculator = Ladybug_AdaptiveComfortCalculator(
    dryBulbTemperature=merge_73,
    outdoorTemperature=importepw_2.dryBulbTemperature,
    windSpeed=importepw_2.windSpeed,
    comfortPar=adaptcomfortpar,
    runIt=Toggle(True))  # -> readMe, port, comfortableOrNot, conditionOfPerson, degreesFromTarget, port_2, targetTemperature, simplify(upperTemperatureBound)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; plug-in component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
strnum_5 = Ladybug_SeparateData(inputList=flatten(adaptivecomfortcalculator.upperTemperatureBound))  # -> numbers, strings; plug-in component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

panel_386 = Panel("upperTemperatureBoundaries")
dispatch_22 = Dispatch(List=strnum_5.numbers, DispatchPattern=equals_16.Equality)  # -> ListA, ListB

# ----
# GENERATED
data_130 = Data(filename)
item_72 = ListItem(List=boiler_efficiency, Index=data_130, Wrap=True)

panel_387 = Panel("upperTemperatureBoundaries")  # disabled
dispatch_23 = Dispatch(List=strnum_5.numbers, DispatchPattern=equals_16.Equality)  # -> ListA, ListB; disabled

# ----
# V1
panel_388 = Panel("0.85")

toggle_10 = BooleanToggle(False)  # disabled
air_speed_from_ceiling_fans = Slider(1, range=0..1)  # disabled
adaptcomfortpar_2 = Ladybug_AdaptiveComfortParameters(avgMonthOrRunMean=toggle_10)  # -> comfortPar; disabled; plug-in component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

panel_389 = Panel("cullOfficeUnits")
equals_17 = Equality(FirstNumber=data_126, SecondNumber="1")  # -> Equality, Inequality
dispatch_24 = Dispatch(DispatchPattern=equals_17.Equality)  # -> ListA, ListB

# ----
# boiler efficiency is building-based
panel_390 = Panel("version implementation")
weave_27 = Weave(Pattern=list, Stream0=panel_388, Stream1=panel_388, Stream2=item_72, Stream3=item_72, NullGaps=False)

doy_hoy = Ladybug_DOY_HOY(days="1", months="5", hours="24")  # -> HOY, DOY, date; plug-in component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

doy_hoy_2 = Ladybug_DOY_HOY(days="30", months="9", hours="1")  # -> HOY, DOY, date; plug-in component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

panel_391 = Panel("5")  # disabled
panel_392 = Panel("30")  # disabled
panel_393 = Panel("24")  # disabled
doy_hoy_3 = Ladybug_DOY_HOY(days=panel_392, months=panel_391, hours=panel_393)  # -> HOY, DOY, date; disabled; plug-in component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

panel_394 = Panel("5")  # disabled
panel_395 = Panel("30")  # disabled
panel_396 = Panel("24")  # disabled
doy_hoy_4 = Ladybug_DOY_HOY(days=panel_395, months=panel_394, hours=panel_396)  # -> HOY, DOY, date; disabled; plug-in component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

panel_397 = Panel("9")  # disabled
panel_398 = Panel("1")  # disabled
panel_399 = Panel("1")  # disabled
doy_hoy_5 = Ladybug_DOY_HOY(days=panel_398, months=panel_397, hours=panel_399)  # -> HOY, DOY, date; disabled; plug-in component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

panel_400 = Panel("9")  # disabled
panel_401 = Panel("1")  # disabled
panel_402 = Panel("1")  # disabled
doy_hoy_6 = Ladybug_DOY_HOY(days=panel_401, months=panel_400, hours=panel_402)  # -> HOY, DOY, date; disabled; plug-in component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

panel_403 = Panel("30May-1Sept")  # disabled
subtraction_3 = Subtraction(A=doy_hoy_5.HOY, B=doy_hoy_3.HOY)  # disabled
panel_404 = Panel("#of Occupied Hours")  # disabled
series_33 = Series(Start=doy_hoy_3.HOY, Step=1, Count=subtraction_3)  # disabled
item_73 = ListItem(List=dispatch_23.ListA, Index=series_33, Wrap=True)  # disabled

toggle_11 = BooleanToggle(True)  # disabled
pt_3 = Point(Point(409, 1853, 0))  # disabled
swatch_7 = ColourSwatch(SwatchColor=RGB(0, 0, 0))  # disabled

# ----
# U-value-Window of Building
decomposeepconstruction_6 = Honeybee_DecomposeEPConstruction(cnstrName=weave_21)  # -> materials, comments, UValue_SI, UValue_IP, RValue_SI, RValue_IP; plug-in component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
lng_63 = ListLength(List=branch_12)
data_131 = Data(decomposeepconstruction_6.UValue_SI)
dup_43 = DuplicateData(Data=data_131, Number=lng_63, Order=True)

# ----
# U-value-GroundFloor of Building
decomposeepconstruction_7 = Honeybee_DecomposeEPConstruction(cnstrName=weave_25)  # -> materials, comments, UValue_SI, UValue_IP, RValue_SI, RValue_IP; plug-in component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
lng_64 = ListLength(List=branch_12)
data_132 = Data(decomposeepconstruction_7.UValue_SI)
dup_44 = DuplicateData(Data=data_132, Number=lng_64, Order=True)

# ----
# # of parcels in the blocks
data_133 = Data(flatten(lng_20))

# ----
# public and school buildings excluded list
data_134 = Data(python_11.a)

panel_405 = Panel("parcel_number")
data_135 = Data(weave_7)

panel_406 = Panel("block_number")
data_136 = Data(weave_10)

# ----
# office: # of people per sqm
data_137 = Data(geteploads.numOfPeoplePerArea)

equals_18 = Equality(FirstNumber=data_126, SecondNumber="1")  # -> Equality, Inequality
dispatch_25 = Dispatch(List=dup_43, DispatchPattern=equals_18.Equality)  # -> ListA, ListB

equals_19 = Equality(FirstNumber=data_126, SecondNumber="1")  # -> Equality, Inequality
dispatch_26 = Dispatch(List=dup_44, DispatchPattern=equals_19.Equality)  # -> ListA, ListB

panel_409 = Panel("construction Date")
data_138 = Data(item_63)

panel_410 = Panel("VTWindow")
data_139 = Data(weave_19)

panel_411 = Panel("shgcWindow")
data_140 = Data(weave_17)

# ----
# Heating set point of Offices
data_141 = Data(panel_250)

# ----
# UNIT FUNCTION: 0: residential non-cooling
# 5: residential with cooling
# 2: office unit
data_142 = Data(branch_12)

panel_412 = Panel("AllV4")
path_2 = FilePath("C:\KBEM\IP2.1\csv\AllV4.csv")

panel_413 = Panel("AllV1")
path_3 = FilePath("C:\KBEM\IP2.1\csv\AllV1NormalOCC.csv")

panel_414 = Panel("AllV3")
path_4 = FilePath("C:\KBEM\IP2.1\csv\AllV3.csv")

panel_415 = Panel("AllV2")
path_5 = FilePath("C:\KBEM\IP2.1\csv\AllV2.csv")

panel_416 = Panel("ParamsV1")
path_6 = FilePath("C:\KBEM\IP2.1\csv\ParamsV1.csv")

panel_417 = Panel("ParamsV3")
path_7 = FilePath("C:\KBEM\IP2.1\csv\ParamsV3.csv")

panel_418 = Panel("ParamsV2")
path_8 = FilePath("C:\KBEM\IP2.1\csv\ParamsV2.csv")

panel_419 = Panel("ParamsV4")
path_9 = FilePath("C:\KBEM\IP2.1\csv\ParamsV4.csv")

panel_420 = Panel("equipment")
path_10 = FilePath("C:\KBEM\IP2.1\csv\4\equip.csv")
panel_421 = Panel(path_10)

panel_422 = Panel("lighting")
path_11 = FilePath("C:\KBEM\IP2.1\csv\3\light.csv")
panel_423 = Panel(path_11)

toggle_12 = BooleanToggle(True)
split_5 = TextSplit(Text=panel_421, Separators="equip")  # -> flatten(Result)
clean_8 = CleanTree(RemoveNulls=toggle_12, RemoveInvalid=toggle_12, RemoveEmpty=toggle_12, Tree=split_5)
brep = Brep(split_5)
null_4 = NullItem(Item=brep)  # -> NullFlags, InvalidFlags, Description
dispatch_27 = Dispatch(List=clean_8, DispatchPattern=null_4.NullFlags)  # -> ListA, ListB
panel_424 = Panel(split_5)

merge_74 = Merge(Data1="equip", Data2=filename)
join_17 = TextJoin(Text=flatten(merge_74))
panel_425 = Panel(join_17)

toggle_13 = BooleanToggle(True)
split_6 = TextSplit(Text=panel_423, Separators="light")  # -> flatten(Result)
clean_9 = CleanTree(RemoveNulls=toggle_13, RemoveInvalid=toggle_13, RemoveEmpty=toggle_13, Tree=split_6)
brep_2 = Brep(split_6)
null_5 = NullItem(Item=brep_2)  # -> NullFlags, InvalidFlags, Description
dispatch_28 = Dispatch(List=clean_9, DispatchPattern=null_5.NullFlags)  # -> ListA, ListB
panel_426 = Panel(split_6)

merge_75 = Merge(Data1="light", Data2=filename)
join_18 = TextJoin(Text=flatten(merge_75))
panel_427 = Panel(join_18)

item_74 = ListItem(List=dispatch_27.ListA, Index=0, Wrap=True)
item_75 = ListItem(List=dispatch_27.ListA, Index=-1, Wrap=True)
merge_76 = Merge(Data1=item_74, Data2=join_17, Data3=item_75)
join_19 = TextJoin(Text=merge_76)

panel_428 = Panel("operative")
path_12 = FilePath("C:\KBEM\IP2.1\csv\0\op.csv")
panel_429 = Panel(path_12)

panel_430 = Panel("AirTemp")
path_13 = FilePath("C:\KBEM\IP2.1\csv\1\AirTemp.csv")
panel_431 = Panel(path_13)

panel_432 = Panel("menRad")
path_14 = FilePath("C:\KBEM\IP2.1\csv\2\meanrad.csv")
panel_433 = Panel(path_14)

item_76 = ListItem(List=dispatch_28.ListA, Index=0, Wrap=True)
item_77 = ListItem(List=dispatch_28.ListA, Index=-1, Wrap=True)
merge_77 = Merge(Data1=item_76, Data2=join_18, Data3=item_77)
join_20 = TextJoin(Text=merge_77)

toggle_14 = BooleanToggle(True)
split_7 = TextSplit(Text=panel_429, Separators="op")  # -> flatten(Result)
clean_10 = CleanTree(RemoveNulls=toggle_14, RemoveInvalid=toggle_14, RemoveEmpty=toggle_14, Tree=split_7)
brep_3 = Brep(split_7)
null_6 = NullItem(Item=brep_3)  # -> NullFlags, InvalidFlags, Description
dispatch_29 = Dispatch(List=clean_10, DispatchPattern=null_6.NullFlags)  # -> ListA, ListB
panel_434 = Panel(split_7)

toggle_15 = BooleanToggle(True)
split_8 = TextSplit(Text=panel_431, Separators="airTemp")  # -> flatten(Result)
clean_11 = CleanTree(RemoveNulls=toggle_15, RemoveInvalid=toggle_15, RemoveEmpty=toggle_15, Tree=split_8)
brep_4 = Brep(split_8)
null_7 = NullItem(Item=brep_4)  # -> NullFlags, InvalidFlags, Description
dispatch_30 = Dispatch(List=clean_11, DispatchPattern=null_7.NullFlags)  # -> ListA, ListB
panel_435 = Panel(split_8)

toggle_16 = BooleanToggle(True)
split_9 = TextSplit(Text=panel_433, Separators="meanrad")  # -> flatten(Result)
clean_12 = CleanTree(RemoveNulls=toggle_16, RemoveInvalid=toggle_16, RemoveEmpty=toggle_16, Tree=split_9)
brep_5 = Brep(split_9)
null_8 = NullItem(Item=brep_5)  # -> NullFlags, InvalidFlags, Description
dispatch_31 = Dispatch(List=clean_12, DispatchPattern=null_8.NullFlags)  # -> ListA, ListB
panel_436 = Panel(split_9)

merge_78 = Merge(Data1="op", Data2=filename)
join_21 = TextJoin(Text=flatten(merge_78))
panel_437 = Panel(join_21)

merge_79 = Merge(Data1="airTemp", Data2=filename)
join_22 = TextJoin(Text=flatten(merge_79))
panel_438 = Panel(join_22)

merge_80 = Merge(Data1="meanrad", Data2=filename)
join_23 = TextJoin(Text=flatten(merge_80))
panel_439 = Panel(join_23)

item_78 = ListItem(List=dispatch_29.ListA, Index=0, Wrap=True)
item_79 = ListItem(List=dispatch_29.ListA, Index=-1, Wrap=True)
merge_81 = Merge(Data1=item_78, Data2=join_21, Data3=item_79)
join_24 = TextJoin(Text=merge_81)

item_80 = ListItem(List=dispatch_30.ListA, Index=0, Wrap=True)
item_81 = ListItem(List=dispatch_30.ListA, Index=-1, Wrap=True)
merge_82 = Merge(Data1=item_80, Data2=join_22, Data3=item_81)
join_25 = TextJoin(Text=merge_82)

item_82 = ListItem(List=dispatch_31.ListA, Index=0, Wrap=True)
item_83 = ListItem(List=dispatch_31.ListA, Index=-1, Wrap=True)
merge_83 = Merge(Data1=item_82, Data2=join_23, Data3=item_83)
join_26 = TextJoin(Text=merge_83)

# ----
# Entering EKB Data
# for Concrete Wall
merge_84 = Merge(Data1=graft(parcelubem_2), Data2=graft(blockubem_2))
join_27 = TextJoin(Text=merge_84, Join="_")  # -> simplify(flatten(Result))
mindex_4 = MemberIndex(Set=join_27, Member=item_11)  # -> flatten(Index), Count

# ----
# public and school buildings excluded list
cull_i_20 = CullIndex(List=ekbuwallconcrete_2, Indices=mindex_4.Index, Wrap=True)

# ----
# public and school buildings excluded list
cull_i_21 = CullIndex(List=join_27, Indices=mindex_4.Index, Wrap=True)

mindex_5 = MemberIndex(Set=flatten(cull_i_6), Member=cull_i_21)  # -> flatten(Index), Count

# ----
# EKB Concrete Embedded List
# 1st
replace_10 = ReplaceItems(List=dup_3, Item=cull_i_20, Indices=mindex_5.Index, Wrap=False)

# ----
# Masonry
# Generated
# Random Masonry Construction Values
lng_65 = ListLength(List=flatten(cull_i_6))
merge_85 = Merge(Data1=mindex_5.Index, Data2=mindex_2.Index)
panel_440 = Panel("EKB Data")
series_34 = Series(Start=0, Step=1, Count=lng_65)
cull_i_22 = CullIndex(List=series_34, Indices=merge_85, Wrap=True)
lng_66 = ListLength(List=cull_i_22)
division_9 = Division(A=lng_66, B=panel_36)
round_28 = Round(Number=division_9)  # -> Nearest, Floor, Ceiling
series_35 = Series(Start=0, Step=1, Count=round_28.Floor)
jitter_38 = Jitter(List=cull_i_22, Jitter=1, Seed=2)  # -> Values, Indices
item_84 = ListItem(List=jitter_38.Values, Index=series_35, Wrap=True)
item_85 = ListItem(List=panel_3, Index=series_35, Wrap=True)

# ----
# EKB Masonry Wall Embedded List
# 2nd
data_143 = Data(item_13)
replace_11 = ReplaceItems(List=replace_10, Item=data_143, Indices=mindex_2.Index, Wrap=False)

# ----
# 3rd
# RANDOM Masonry Embedded List
data_144 = Data(item_85)
replace_12 = ReplaceItems(List=replace_11, Item=data_144, Indices=item_84, Wrap=False)

# ----
# Concrete
# Wall Random
cull_i_23 = CullIndex(List=jitter_38.Values, Indices=series_35, Wrap=True)
lng_67 = ListLength(List=cull_i_23)
series_36 = Series(Start=0, Step=1, Count=lng_67)
item_86 = ListItem(List=panel, Index=series_36, Wrap=True)

# ----
# RANDOM Concrete Wall Embedded List
# 4th
data_145 = Data(item_86)
replace_13 = ReplaceItems(List=replace_12, Item=data_145, Indices=cull_i_23, Wrap=False)  # -> simplify(List)

# ----
# Masonry/Concrete Construction Division, EKB
panel_441 = Panel(replace_13)

lng_68 = ListLength(List=cull_i_6)
dup_45 = DuplicateData(Data="1", Number=lng_68, Order=True)  # -> simplify(flatten(Data))
merge_86 = Merge(Data1=flatten(mindex_2.Index), Data2=flatten(item_84))
panel_442 = Panel("EKB Generated Data")
replace_14 = ReplaceItems(List=dup_45, Item="0", Indices=merge_86, Wrap=False)

panel_444 = Panel("ConstructionType")
data_146 = Data(replace_14)

# ----
# extract only
# ''# of residential units''
# in the building
toggle_17 = BooleanToggle(True)
clean_13 = CleanTree(RemoveNulls=True, RemoveInvalid=True, RemoveEmpty=toggle_17, Tree=dispatch_4.ListA)
tstat_6 = TreeStatistics(Tree=clean_13)  # -> Paths, Length, Count
series_37 = Series(Start=0, Step=1, Count=tstat_6.Count)
replace_15 = ReplacePaths(Data=clean_13, Search=tstat_6.Paths, Replace=series_37)

# ----
# only, # of residential units in the building
lng_69 = ListLength(List=replace_15)  # -> flatten(Length)

# ----
# HVAC
partition_30 = PartitionList(List=merge_2, Size=lng_69)  # -> simplify(Chunks)
branch_15 = TreeBranch(Tree=partition_30, Path=filename, MaintainPaths=True)

panel_445 = Panel(lng_69)

partition_31 = PartitionList(List=merge_5, Size=lng_69)  # -> simplify(Chunks)
branch_16 = TreeBranch(Tree=partition_31, Path=filename, MaintainPaths=True)

partition_32 = PartitionList(List=merge_3, Size=lng_69)  # -> simplify(Chunks)
branch_17 = TreeBranch(Tree=partition_32, Path=filename, MaintainPaths=True)

partition_33 = PartitionList(List=merge_4, Size=lng_69)  # -> simplify(Chunks)
branch_18 = TreeBranch(Tree=partition_33, Path=filename, MaintainPaths=True)

panel_446 = Panel("""heatingSetPoint
GeneratedData""")
data_147 = Data(branch_15)

panel_447 = Panel("""generated
equipment density""")
data_148 = Data(branch_18)

# ----
# separate for each residential unit
panel_448 = Panel("LightingDensity")
data_149 = Data(branch_16)

# ----
# Entering EKB Data
# for Concrete Wall
merge_87 = Merge(Data1=graft(parcelubem_5), Data2=graft(blockubem_3))
join_28 = TextJoin(Text=merge_87, Join="_")  # -> simplify(flatten(Result))
mindex_6 = MemberIndex(Set=join_28, Member=item_14)  # -> flatten(Index), Count

# ----
# public and school buildings excluded list
cull_i_24 = CullIndex(List=join_28, Indices=mindex_6.Index, Wrap=True)

# ----
# public and school buildings excluded list
cull_i_25 = CullIndex(List=ekbuwallconcrete_3, Indices=mindex_6.Index, Wrap=True)

mindex_7 = MemberIndex(Set=flatten(cull_i_8), Member=cull_i_24)  # -> flatten(Index), Count

# ----
# EKB Concrete Embedded List
# 1st
replace_16 = ReplaceItems(List=dup_4, Item=cull_i_25, Indices=mindex_7.Index, Wrap=False)

# ----
# WWR
data_150 = Data(flatten(cull_i_8))
listdexs_5 = ListIndices(List=data_150)

# ----
# Concrete
# Wall Random
cull_i_26 = CullIndex(List=listdexs_5, Indices=mindex_7.Index, Wrap=True)
lng_70 = ListLength(List=cull_i_26)
series_38 = Series(Start=0, Step=1, Count=lng_70)
item_87 = ListItem(List=panel_11, Index=series_38, Wrap=True)

# ----
# RANDOM Concrete Wall Embedded List
# 4th
data_151 = Data(item_87)
replace_17 = ReplaceItems(List=replace_16, Item=data_151, Indices=cull_i_26, Wrap=False)  # -> simplify(List)

panel_449 = Panel(replace_17)

# ----
# # of Floor of the building
toggle_18 = BooleanToggle(True)
partition_34 = PartitionList(List=data_33, Size=subtraction_2)  # -> simplify(Chunks)
clean_14 = CleanTree(RemoveNulls=True, RemoveInvalid=True, RemoveEmpty=toggle_18, Tree=partition_34)
lng_71 = ListLength(List=clean_14)  # -> flatten(Length)
partition_35 = PartitionList(List=flatten(clean_14), Size=lng_71)  # -> simplify(Chunks)

# ----
# DATA TREE: building floor info public and schoold buildings excluded
cull_i_27 = CullIndex(List=partition_35, Indices=clean_3, Wrap=True)  # -> simplify(List)

dispatch_32 = Dispatch(List=cull_i_27, DispatchPattern=data_40)  # -> ListA, ListB
weave_28 = Weave(Pattern=python_12.a, Stream0=dispatch_32.ListA, Stream1=dispatch_32.ListB, NullGaps=False)  # -> simplify(Weave)

# ----
# indices of
# selection ratio according to construction date
data_152 = Data(series_10)
item_88 = ListItem(List=simplify(weave_28), Index=simplify(data_152), Wrap=True)

panel_451 = Panel(item_88)
panel_452 = Panel(item_27)
panel_453 = Panel(item_21)

# ----
# 2D to 3D
data_153 = Data(flatten(item_88))
partition_36 = PartitionList(List=data_153, Size="1")  # -> simplify(Chunks)
Z_2 = UnitZ(Factor=data_54)
arrlinear = LinearArray(Geometry=merge_36, Direction=Z_2, Count=partition_36)  # -> Geometry, Transform
geo_46 = Geometry(arrlinear.Geometry)

# ----
# # of floor of
# the building
data_154 = Data(flatten(item_88))

item_89 = ListItem(List=data_60, Index=data_107, Wrap=True)
item_90 = ListItem(List=data_154, Index=data_107, Wrap=True)
division_10 = Division(A=item_89, B=item_90)
round_29 = Round(Number=division_10)  # -> Nearest, Floor, Ceiling
multiplication_4 = Multiplication(A=round_29.Floor, B=item_90)
subtraction_4 = Subtraction(A=item_89, B=multiplication_4)

panel_454 = Panel("# of floor")
panel_455 = Panel(item_90)

# ----
# # of Units of
# the building
panel_456 = Panel(item_89)

# ----
# Simulation Building Selection
item_91 = ListItem(List=geo_41, Index=filename, Wrap=True)
area_22 = Area(Geometry=geo_46)  # -> Area, Centroid
incurve_2 = PointInCurve(Point=area_22.Centroid, Curve=item_91)  # -> Relationship, Point
equals_20 = Equality(FirstNumber=incurve_2.Relationship, SecondNumber="2")  # -> Equality, Inequality
dispatch_33 = Dispatch(List=geo_46, DispatchPattern=equals_20.Equality)  # -> ListA, ListB

geo_47 = Geometry(flatten(partition_25))
area_23 = Area(Geometry=geo_47)  # -> Area, Centroid
panel_457 = Panel("simulated parcel CORE")
incurve_3 = PointInCurve(Point=area_23.Centroid, Curve=item_91)  # -> Relationship, Point
equals_21 = Equality(FirstNumber=incurve_3.Relationship, SecondNumber="2")  # -> Equality, Inequality
dispatch_34 = Dispatch(List=geo_47, DispatchPattern=equals_21.Equality)  # -> ListA, ListB

md_slider_4 = MDSlider(SliderMode=0, slider_value=Point(0.5, 0.5, 0.5), x_domain=Domain(0, 1), y_domain=Domain(0, 1), z_domain=Domain(0, 1))
evalsrf_2 = EvaluateSurface(Surface=dispatch_34.ListA, Point=md_slider_4)  # -> Point, Normal, UDirection, VDirection, Frame

# ----
# # of units per floor
# of the building
panel_458 = Panel(round_29.Floor)

# ----
# add additional units starting from ground:
# -> 1 unit per floor
panel_459 = Panel(subtraction_4)
panel_460 = Panel("EXTRA units")

# ----
# units of simulated parcel
# without EXTRA units (whether there are exist)
clean_15 = CleanTree(RemoveNulls=True, RemoveInvalid=True, RemoveEmpty=Toggle(True), Tree=dispatch_33.ListA)

panel_461 = Panel("additionalUnit")
data_155 = Data(subtraction_4)

# ----
# Floor-based path
# 
# -> each floor has own path
panel_462 = Panel("{")
dup_46 = DuplicateData(Data=panel_462, Number=item_90, Order=True)
dup_47 = DuplicateData(Data=data_107, Number=item_90, Order=True)
dup_48 = DuplicateData(Data=";", Number=item_90, Order=True)
dup_49 = DuplicateData(Data="}", Number=item_90, Order=True)
series_39 = Series(Start=0, Step=1, Count=item_90)
merge_88 = Merge(Data1=graft(dup_46), Data2=graft(dup_47), Data3=graft(dup_48), Data4=graft(series_39), Data5=graft(dup_49))  # -> simplify(Result)
join_29 = TextJoin(Text=merge_88)  # -> flatten(Result)
panel_463 = Panel(join_29)

# ----
# units of simulated parcel
# without additional units (whether there are exist)
geo_48 = Geometry(clean_15)

# ----
# IF,
# there are Extra Units
panel_464 = Panel(data_155)
equals_22 = Equality(FirstNumber=data_155, SecondNumber="0")  # -> Equality, Inequality
python_21 = GhPythonScript(x=equals_22.Equality, y=geo_48)  # -> out, BuildingwithExtraUnit, simplify(BuildingwithoutExtraUnit); inputs x: Boolean, y: list
# ---------- python_21: Python ----------
__author__ = "Siser"
__version__ = "2022.03.04"

import rhinoscriptsyntax as rs
if x == True:
    BuildingwithoutExtraUnit = y
else:
    BuildingwithExtraUnit = y
# ---------- end python_21 ----------

# ----
# units of simulated parcel
# without additional units (whether there are exist)
geo_49 = Geometry(flatten(geo_48))

# ----
# units of simulated parcel
# without additional units
geo_50 = Geometry(flatten(python_21.BuildingwithExtraUnit))

# ----
# units of simulated parcel
# without additional units
geo_51 = Geometry(flatten(python_21.BuildingwithExtraUnit))

# ----
# # of units per floor
# of the building
data_156 = Data(round_29.Floor)

# ----
# Extra Unit Addition to floors
# if there is no extra units, then a = 0
# else
# a=! 0, thus, the floor division changes
panel_465 = Panel("0")
equals_23 = Equality(FirstNumber=subtraction_4, SecondNumber=panel_465)  # -> Equality, Inequality
python_22 = GhPythonScript(x=equals_23.Equality)  # -> out, a; inputs x: Boolean
# ---------- python_22: Python ----------
__author__ = "Siser"
__version__ = "2022.03.04"

import rhinoscriptsyntax as rs
if x == True:
    a = 0
else:
    a = 1
# ---------- end python_22 ----------
# if x == 1:
#     a=1,1
# elif x ==2:
#     a=2,1
# elif x == 3 or x == 4:
#     a=2,2
# elif x==5 or x ==6:
#     a=3,2
# else:
#     a=4,2
addition_5 = Addition(A=data_156, B=python_22.a)

# ----
# floor division for units per floor
# 
# FOR
# SIMULATED PARCEL
python_23 = GhPythonScript(x=addition_5)  # -> out, simplify(a); inputs x: Int32; same code as python_15

# ----
# uv frame of simulated parcel
data_157 = Data(evalsrf_2.Frame)

# ----
# floors with extra units
series_40 = Series(Start=0, Step=1, Count=subtraction_4)
multiplication_5 = Multiplication(A=series_40, B=data_65)
area_24 = Area(Geometry=geo_51)  # -> Area, Centroid
pdecon_6 = Deconstruct(Point=area_24.Centroid)  # -> XComponent, YComponent, ZComponent
round_30 = Round(Number=pdecon_6.ZComponent)  # -> Nearest, Floor, Ceiling
equals_24 = Equality(FirstNumber=graft(multiplication_5), SecondNumber=round_30.Nearest)  # -> Equality, Inequality
dispatch_35 = Dispatch(List=geo_49, DispatchPattern=equals_24.Equality)  # -> ListA, simplify(ListB)
brec_3 = BoundingRectangle(Geometry=dispatch_35.ListA, Plane=data_157, Axis=0, Slide=0, Union=True)  # -> simplify(Bounding), DimensionX, DimensionY

# ----
# floors without extra units
series_41 = Series(Start=0, Step=1, Count=item_90)
cull_i_28 = CullIndex(List=series_41, Indices=series_40, Wrap=True)
multiplication_6 = Multiplication(A=cull_i_28, B=data_66)
area_25 = Area(Geometry=geo_50)  # -> Area, Centroid
pdecon_7 = Deconstruct(Point=area_25.Centroid)  # -> XComponent, YComponent, ZComponent
round_31 = Round(Number=pdecon_7.ZComponent)  # -> Nearest, Floor, Ceiling
equals_25 = Equality(FirstNumber=graft(multiplication_6), SecondNumber=round_31.Nearest)  # -> Equality, Inequality
dispatch_36 = Dispatch(List=geo_49, DispatchPattern=equals_25.Equality)  # -> simplify(ListA), simplify(ListB)

panel_466 = Panel("non-additional units")
geo_52 = Geometry(simplify(dispatch_36.ListA))

# ----
# cull paths of the additional units
data_158 = Data(series_40)

# ----
# New list path for
# floors without extra units
cull_i_29 = CullIndex(List=join_29, Indices=data_158, Wrap=True)
tstat_7 = TreeStatistics(Tree=geo_52)  # -> Paths, Length, Count
replace_18 = ReplacePaths(Data=geo_52, Search=tstat_7.Paths, Replace=cull_i_29)

# ----
# # of units per floor
# of the building
data_159 = Data(round_29.Floor)

# ----
# check whether
# 
# isotrim division number
# 
# is equal to
# 
# # of units per floor
panel_467 = Panel("1")
addition_6 = Addition(A=data_159, B=panel_467)
ma_4 = MassMultiplication(Input=python_23.a)  # -> Result, PartialResults
equals_26 = Equality(FirstNumber=addition_6, SecondNumber=ma_4.Result)  # -> Equality, Inequality
python_24 = GhPythonScript(x=equals_26.Equality)  # -> out, a; inputs x: Boolean; same code as python_22

# ----
# # of Units
# Per Floor with additional units
panel_468 = Panel(addition_6)

# ----
# no additional units
# for the building
geo_53 = Geometry(flatten(python_21.BuildingwithoutExtraUnit))

# ----
# # of units for floor(s) with extra units
weave_29 = Weave(Pattern=python_24.a, Stream0=flatten(ma_4.Result), Stream1=flatten(addition_6), NullGaps=False)

series_42 = Series(Start=0, Step=1, Count=subtraction_4)
item_92 = ListItem(List=join_29, Index=series_42, Wrap=True)

# ----
# # of units per floor
# of the building
data_160 = Data(round_29.Floor)

# ----
# # of floor of
# the building
data_161 = Data(flatten(item_88))

panel_469 = Panel("Floor-based Path")
data_162 = Data(join_29)

# ----
# staircase, before extension
# BuildingwithoutExtraUnit
area_26 = Area(Geometry=geo_53)  # -> Area, flatten(Centroid)
pdecon_8 = Deconstruct(Point=area_26.Centroid)  # -> XComponent, YComponent, ZComponent
sort_10 = SortList(Keys=pdecon_8.ZComponent, ValuesA=flatten(geo_53))  # -> Keys, ValuesA
partition_37 = PartitionList(List=sort_10.ValuesA, Size=data_160)
tstat_8 = TreeStatistics(Tree=partition_37)  # -> Paths, Length, Count
replace_19 = ReplacePaths(Data=partition_37, Search=tstat_8.Paths, Replace=data_162)

# ----
# Building without
# Extra Units
data_163 = Data(replace_19)

# ----
# Simulated Parcel Bounding Box
geo_54 = Geometry(item_91)

area_27 = Area(Geometry=geo_54)  # -> Area, Centroid

# ----
# uv frame of simulated parcel
data_164 = Data(evalsrf_2.Frame)

# ----
# floor division for units per floor
# 
# FOR
# SIMULATED PARCEL
data_165 = Data(python_23.a)

# ----
# core of simulated parcel, normal
data_166 = Data(evalsrf_2.Frame)

# ----
# center of simulated parcel
area_28 = Area(Geometry=item_91)  # -> Area, Centroid

lng_72 = ListLength(List=join_29)

lng_73 = ListLength(List=join_29)

# ----
# new path (after extra unit)
data_167 = Data(join_29)

# ----
# Simulated Parcel Bounding Box
geo_55 = Geometry(item_91)

area_29 = Area(Geometry=geo_55)  # -> Area, Centroid
circle = CircleCNR(Center=area_29.Centroid, Normal=Vector(0, 0, 1), Radius=data_73)
area_30 = Area(Geometry=geo_42)  # -> Area, Centroid
incurve_4 = PointInCurve(Point=area_30.Centroid, Curve=circle)  # -> Relationship, Point
equals_27 = Equality(FirstNumber=incurve_4.Relationship, SecondNumber="2")  # -> Equality, Inequality

panel_472 = Panel("ground floor index")
item_93 = ListItem(List=join_29, Index=0, Wrap=True)

# ----
# rectangle do not accpeted by collision component
dispatch_37 = Dispatch(List=geo_42, DispatchPattern=equals_27.Equality)  # -> ListA, ListB
debrep_5 = DeconstructBrep(Brep=dispatch_37.ListA)  # -> Faces, Edges, simplify(Vertices)
pline_2 = PolyLine(Vertices=debrep_5.Vertices, Closed=Toggle(True))  # -> flatten(Polyline)

# ----
# rectangle do not accpeted by collision component
debrep_6 = DeconstructBrep(Brep=geo_55)  # -> Faces, Edges, Vertices
pline_3 = PolyLine(Vertices=debrep_6.Vertices, Closed=Toggle(True))

# ----
# Intersected Parcels
# replace simulation unit
# because not ALL building be transformed with BOUNDING BOX component (e.g., parcel 579)
area_31 = Area(Geometry=geo_55)  # -> Area, Centroid
area_32 = Area(Geometry=pline_2)  # -> Area, Centroid
cp = ClosestPoint(Point=area_31.Centroid, Cloud=area_32.Centroid)  # -> ClosestPoint, CPIndex, Distance
replace_20 = ReplaceItems(List=pline_2, Item=pline_3, Indices=cp.CPIndex, Wrap=False)

# ----
# close parcels to the simulation building
geo_56 = Geometry(replace_20)

# ----
# Simulated Parcel Bounding Box
geo_57 = Geometry(item_91)

area_33 = Area(Geometry=geo_56)  # -> Area, Centroid
area_34 = Area(Geometry=geo_57)  # -> Area, Centroid
panel_473 = Panel("exclude simulation building")
cp_2 = ClosestPoint(Point=area_34.Centroid, Cloud=area_33.Centroid)  # -> ClosestPoint, CPIndex, Distance
cull_i_30 = CullIndex(List=geo_56, Indices=cp_2.CPIndex, Wrap=True)

area_35 = Area(Geometry=geo_57)  # -> Area, Centroid
scale_3 = Scale(Geometry=geo_57, Center=area_35.Centroid, Factor="1.25")  # -> Geometry, Transform

panel_474 = Panel("floor number")
item_94 = ListItem(List=flatten(item_88), Index=filename, Wrap=True)

# ----
# test check for close parcels intersection possibility
pop2d = Populate2D(Region=cull_i_30, Count=100, Seed=1)  # -> simplify(Population)
incurve_5 = PointInCurve(Point=pop2d, Curve=scale_3.Geometry)  # -> simplify(Relationship), Point
sort_11 = SortList(Keys=incurve_5.Relationship)  # -> Keys, ValuesA
dcon_2 = DeleteConsecutive(Set=sort_11.Keys, Wrap=False)  # -> simplify(Set), Count
equals_28 = Equality(FirstNumber=dcon_2.Set, SecondNumber="2")  # -> Equality, Inequality
dispatch_38 = Dispatch(List=dcon_2.Set, DispatchPattern=equals_28.Inequality)  # -> ListA, ListB
clean_16 = CleanTree(RemoveNulls=True, RemoveInvalid=True, RemoveEmpty=Toggle(True), Tree=dispatch_38.ListB)
tstat_9 = TreeStatistics(Tree=clean_16)  # -> Paths, Length, Count
split_10 = TextSplit(Text=tstat_9.Paths, Separators="{}")
item_95 = ListItem(List=split_10, Index=1, Wrap=True)

# ----
# this output only useful when there is no real intersection between two buildings
item_96 = ListItem(List=cull_i_30, Index=item_95, Wrap=True)
panel_475 = Panel("Too close parcel")
area_36 = Area(Geometry=item_96)  # -> Area, Centroid
scale_4 = Scale(Geometry=item_96, Center=area_36.Centroid, Factor="1.1")  # -> Geometry, Transform

area_37 = Area(Geometry=geo_43)  # -> Area, Centroid
incurve_6 = PointInCurve(Point=area_37.Centroid, Curve=scale_4.Geometry)  # -> Relationship, Point
equals_29 = Equality(FirstNumber=incurve_6.Relationship, SecondNumber="2")  # -> Equality, Inequality
md_slider_5 = MDSlider(SliderMode=0, slider_value=Point(0.5, 0.5, 0.5), x_domain=Domain(0, 1), y_domain=Domain(0, 1), z_domain=Domain(0, 1))
dispatch_39 = Dispatch(List=geo_43, DispatchPattern=equals_29.Equality)  # -> ListA, ListB
evalsrf_3 = EvaluateSurface(Surface=dispatch_39.ListA, Point=md_slider_5)  # -> Point, Normal, UDirection, VDirection, Frame

lng_74 = ListLength(List=join_29)

panel_477 = Panel("Intersected Parcel(s) Bounding Box")
brec_4 = BoundingRectangle(Geometry=scale_4.Geometry, Plane=evalsrf_3.Frame, Axis=0, Slide=0, Union=True)  # -> simplify(Bounding), DimensionX, DimensionY

# ----
# uv frame of simulated parcel
data_168 = Data(evalsrf_2.Frame)

# ----
# Simulated Parcel Bounding Box
panel_478 = Panel("Intersected Parcel(s) Bounding Box")
geo_58 = Geometry(item_91)
geo_59 = Geometry(brec_4.Bounding)

# ----
# solid union do not work with rectangle geometries, thus, they should transform to polyline
merge_89 = Merge(Data1=geo_59, Data2=geo_58)  # -> simplify(flatten(Result))
partition_38 = PartitionList(List=merge_89, Size="1")  # -> simplify(Chunks)
debrep_7 = DeconstructBrep(Brep=partition_38)  # -> Faces, Edges, Vertices
pline_4 = PolyLine(Vertices=debrep_7.Vertices, Closed=Toggle(True))
sunion_2 = SolidUnion(Breps=pline_4)
runion = RegionUnion(Curves=sunion_2)  # -> simplify(Result)

# ----
# Simulated Parcel Bounding Box
geo_60 = Geometry(item_91)
brec_5 = BoundingRectangle(Geometry=geo_60, Plane=data_168, Axis=0, Slide=0, Union=True)  # -> simplify(Bounding), DimensionX, DimensionY
xy_2 = XYPlane(Origin=Point(0, 0, 0))
project = Project(Geometry=brec_5.Bounding, Plane=xy_2)  # -> Geometry, Transform
debrep_8 = DeconstructBrep(Brep=project.Geometry)  # -> Faces, Edges, Vertices
curvepoint = PointOnCurve(debrep_8.Edges, parameter=0.5)
incurve_7 = PointInCurve(Point=curvepoint, Curve=runion)  # -> simplify(Relationship), Point
equals_30 = Equality(FirstNumber=incurve_7.Relationship, SecondNumber="2")  # -> Equality, Inequality
dispatch_40 = Dispatch(List=debrep_8.Edges, DispatchPattern=equals_30.Equality)  # -> flatten(ListA), ListB

# ----
# Windowless Unit Test
# https://drive.google.com/drive/u/1/folders/1cVOKlVuLwwMiW8gXvWmfqpKi1dvpFBbl
# Intersected surfaces with adjacent buildings
geo_61 = Geometry(dispatch_40.ListA)

curvepoint_2 = PointOnCurve(geo_61, parameter=0.5)
vec2pt_5 = Vector2Pt(PointA=curvepoint_2, PointB=area_27.Centroid, Unitize=False)  # -> Vector, Length
move_2 = Move(Geometry=geo_61, Motion=vec2pt_5.Vector)  # -> Geometry, Transform
disc_5 = Discontinuity(Curve=geo_61, Level=1)  # -> simplify(Points), Parameters
disc_6 = Discontinuity(Curve=move_2.Geometry, Level=1)  # -> simplify(Points), Parameters
merge_90 = Merge(Data1=disc_6.Points, Data2=disc_5.Points)  # -> flatten(Result)
hull_4 = ConvexHull(Points=merge_90, Plane=PlaneXY(0, 0, 0))  # -> Hull, HullZ, Indices

# ----
# Fix Windowless Unit Test
merge_91 = Merge(Data1=disc_6.Points, Data2=disc_5.Points)
hull_5 = ConvexHull(Points=merge_91, Plane=PlaneXY(0, 0, 0))  # -> Hull, HullZ, Indices

# ----
# scale-up the text geometry
# 
# because
# 
# for some buildings even a unit has a edge to the intersected surface, center of the unit do not touch the text geometry.
# for example, index of 572
area_38 = Area(Geometry=hull_5.Hull)  # -> Area, Centroid
scale_5 = Scale(Geometry=hull_5.Hull, Center=area_38.Centroid, Factor="1.1")  # -> Geometry, Transform

# ----
# Intersected surfaces with adjacent buildings
geo_62 = Geometry(dispatch_40.ListA)

item_97 = ListItem(List=flatten(item_88), Index=filename, Wrap=True)

panel_480 = Panel("Intersected Surface")
geo_63 = Geometry(dispatch_40.ListA)

# ----
# # of floor of
# the building
data_169 = Data(flatten(item_88))

item_98 = ListItem(List=flatten(item_88), Index=filename, Wrap=True)

# ----
# Context Shading: Building
# floor number of buildings
data_170 = Data(flatten(item_88))

# ----
# # of floor of
# the building
# index of selected parcel
data_171 = Data(flatten(item_88))
data_172 = Data(filename)
item_99 = ListItem(List=data_171, Index=data_172, Wrap=True)

# ----
# division of floor(s) with extra units
item_100 = ListItem(List=python_23.a, Index=1, Wrap=True)
item_101 = ListItem(List=python_23.a, Index=0, Wrap=True)
boundary_14 = BoundarySurfaces(Edges=brec_3.Bounding)
divide_3 = DivideDomain²(Domain=boundary_14, UCount=item_101, VCount=item_100)
subsrf_3 = Isotrim(Surface=boundary_14, Domain=divide_3)  # -> simplify(Surface)

panel_482 = Panel("""0
1""")
item_102 = ListItem(List=subsrf_3, Index=1, Wrap=True)
item_103 = ListItem(List=subsrf_3, Index=0, Wrap=True)
cull_i_31 = CullIndex(List=subsrf_3, Indices=panel_482, Wrap=True)  # -> simplify(List)

merge_92 = Merge(Data1=item_103, Data2=item_102)
sunion_3 = SolidUnion(Breps=merge_92)
disc_7 = Discontinuity(Curve=sunion_3, Level=1)  # -> Points, Parameters
pline_5 = PolyLine(Vertices=disc_7.Points, Closed=Toggle(True))
merge_93 = Merge(Data1=cull_i_31, Data2=simplify(pline_5))

# ----
# Extra Unit
# https://drive.google.com/drive/u/1/folders/1cVOKlVuLwwMiW8gXvWmfqpKi1dvpFBbl
# units for floor(s) with extra units
weave_30 = Weave(Pattern=python_24.a, Stream0=flatten(subsrf_3), Stream1=flatten(merge_93), NullGaps=False)

partition_39 = PartitionList(List=flatten(weave_30), Size=weave_29)  # -> simplify(Chunks)
tstat_10 = TreeStatistics(Tree=partition_39)  # -> Paths, Length, Count
replace_21 = ReplacePaths(Data=partition_39, Search=tstat_10.Paths, Replace=item_92)

# ----
# Building with
# Extra Units
merge_94 = Merge(Data1=replace_18, Data2=replace_21)

merge_95 = Merge(Data1=data_163, Data2=merge_94)
clean_17 = CleanTree(RemoveNulls=True, RemoveInvalid=True, RemoveEmpty=Toggle(True), Tree=merge_95)

tstat_11 = TreeStatistics(Tree=clean_17)  # -> Paths, Length, Count
panel_483 = Panel(tstat_11.Paths)

# ----
# TEST FOR EACH FLOOR
# 
# if there are more than 2 residential units at the side of intersected surface
# 
# for example, 0_21, 4_28
area_39 = Area(Geometry=clean_17)  # -> Area, Centroid
incurve_8 = PointInCurve(Point=area_39.Centroid, Curve=scale_5.Geometry)  # -> Relationship, Point
equals_31 = Equality(FirstNumber=incurve_8.Relationship, SecondNumber="2")  # -> Equality, Inequality
dispatch_41 = Dispatch(List=area_39.Centroid, DispatchPattern=equals_31.Equality)  # -> ListA, ListB
lng_75 = ListLength(List=dispatch_41.ListA)
larger = LargerThan(FirstNumber=lng_75, SecondNumber="2")  # -> LargerThan, OrEqualTo
panel_484 = Panel(larger.LargerThan)

# ----
# single unit per floor
panel_485 = Panel("0")

# ----
# if there is one floor at the building
item_104 = ListItem(List=data_161, Index=data_108, Wrap=True)
python_25 = GhPythonScript(x=item_104)  # -> out, a; inputs x: Int32
# ---------- python_25: Python ----------
__author__ = "orcun"
__version__ = "2022.04.08"

import rhinoscriptsyntax as rs
#if x == 1 or x == 2:
if x == 1:
    a = 0
else:
    a = 1
# ---------- end python_25 ----------

# ----
# if there are 2 unit per floor
area_40 = Area(Geometry=branch_14)  # -> Area, Centroid

# ----
# if there are 1 unit per floor
disc_8 = Discontinuity(Curve=branch_13, Level=1)  # -> Points, Parameters

python_26 = GhPythonScript(x=larger.LargerThan, y=clean_17)  # -> out, simplify(Windowless), simplify(NoWindowless); inputs x: Boolean, y: list
# ---------- python_26: Python ----------
__author__ = "Siser"
__version__ = "2022.03.04"

import rhinoscriptsyntax as rs
if x == True:
    Windowless = y
else:
    NoWindowless= y
# ---------- end python_26 ----------
geo_64 = Geometry(python_26.Windowless)
clean_18 = CleanTree(RemoveNulls=True, RemoveInvalid=True, RemoveEmpty=Toggle(True), Tree=geo_64)
brec_6 = BoundingRectangle(Geometry=clean_18, Plane=data_164, Axis=0, Slide=0, Union=True)  # -> simplify(Bounding), DimensionX, DimensionY
boundary_15 = BoundarySurfaces(Edges=brec_6.Bounding)
md_slider_6 = MDSlider(SliderMode=0, slider_value=Point(0.5, 0.5, 0.5), x_domain=Domain(0, 1), y_domain=Domain(0, 1), z_domain=Domain(0, 1))
iso_4 = IsoCurve(Surface=reparameterize(flatten(boundary_15)), UVPoint=md_slider_6)  # -> simplify(flatten(UIsocurve)), VIsocurve
item_105 = ListItem(List=iso_4.UIsocurve, Index=0, Wrap=True)
equals_32 = Equality(FirstNumber=data_165, SecondNumber="2")  # -> Equality, Inequality
sort_12 = SortList(Keys=data_165)  # -> Keys, ValuesA
dprod_4 = DotProduct(VectorA=item_105, VectorB=geo_62, Unitize=False)
dispatch_42 = Dispatch(List=data_165, DispatchPattern=equals_32.Equality)  # -> ListA, ListB
item_106 = ListItem(List=sort_12.Keys, Index=0, Wrap=True)
python_27 = GhPythonScript(x=dprod_4)  # -> out, output; inputs x: Int32
# ---------- python_27: Python ----------
__author__ = "orcun"
__version__ = "2022.04.08"

import rhinoscriptsyntax as rs
if x == -1 or x==1:
    output = True
else:
    output= False
# ---------- end python_27 ----------
srf_2 = Surface(reparameterize(boundary_15))
item_107 = ListItem(List=data_165, Index=1, Wrap=True)
item_108 = ListItem(List=data_165, Index=0, Wrap=True)

# ----
# check whether
# 
# isotrim division number
# 
# is equal to
# 
# # of units per floor
toggle_19 = BooleanToggle(True)
clean_19 = CleanTree(RemoveNulls=True, RemoveInvalid=True, RemoveEmpty=toggle_19, Tree=python_26.Windowless)
multiplication_7 = Multiplication(A=item_108, B=item_107)
lng_76 = ListLength(List=clean_19)
equals_33 = Equality(FirstNumber=lng_76, SecondNumber=multiplication_7)  # -> simplify(Equality), Inequality

panel_487 = Panel("NoWindowless")
clean_20 = CleanTree(RemoveNulls=True, RemoveInvalid=True, RemoveEmpty=Toggle(True), Tree=python_26.NoWindowless)

panel_488 = Panel("""previous
staircase""")

# ----
# Intersection of curves
panel_489 = Panel("2")

# ----
# 04.GEOMETRYFOR
# BUILDINGENERGYMODELING
dcon_3 = DeleteConsecutive(Set=python_27.output, Wrap=False)  # -> Set, Count

python_28 = PythonScript(s=srf_2, swapUV=dcon_3.Set, reverseU=Toggle(False), reverseV=Toggle(False))  # -> out, anchor, uVec, vVec, revSrf; inputs s: Surface, swapUV: Int32, reverseU: Int32, reverseV: Int32; same code as python_14
divide_4 = DivideDomain²(Domain=python_28.revSrf, UCount=item_108, VCount=item_107)
subsrf_4 = Isotrim(Surface=simplify(python_28.revSrf), Domain=simplify(divide_4))  # -> simplify(Surface)

dispatch_43 = Dispatch(List=subsrf_4, DispatchPattern=equals_33.Equality)  # -> ListA, ListB

# ----
# Windowless
# and
# not equal to
# isotrim division
panel_490 = Panel("""0
1""")
item_109 = ListItem(List=dispatch_43.ListB, Index=1, Wrap=True)
item_110 = ListItem(List=dispatch_43.ListB, Index=0, Wrap=True)
cull_i_32 = CullIndex(List=dispatch_43.ListB, Indices=panel_490, Wrap=True)  # -> simplify(List)
merge_96 = Merge(Data1=item_110, Data2=item_109)
sunion_4 = SolidUnion(Breps=merge_96)
disc_9 = Discontinuity(Curve=sunion_4, Level=1)  # -> Points, Parameters
pline_6 = PolyLine(Vertices=disc_9.Points, Closed=Toggle(True))
merge_97 = Merge(Data1=simplify(cull_i_32), Data2=simplify(pline_6))
clean_21 = CleanTree(RemoveNulls=True, RemoveInvalid=True, RemoveEmpty=Toggle(True), Tree=merge_97)

# ----
# Windowless
# and
# equal to isotrim division
toggle_20 = BooleanToggle(True)
clean_22 = CleanTree(RemoveNulls=True, RemoveInvalid=True, RemoveEmpty=toggle_20, Tree=dispatch_43.ListA)

merge_98 = Merge(Data1=simplify(clean_20), Data2=simplify(clean_22), Data3=simplify(clean_21))
wires_3 = BrepWireframe(Brep=merge_98, Density=-1)
join_30 = JoinCurves(Curves=wires_3, Preserve=False)  # -> simplify(flatten(Curves))
lng_77 = ListLength(List=merge_98)  # -> flatten(Length)
partition_40 = PartitionList(List=join_30, Size=lng_77)  # -> simplify(Chunks)

# ----
# single unit per building
lng_78 = ListLength(List=flatten(partition_40))

branch_19 = TreeBranch(Tree=partition_40, Path=panel_485, MaintainPaths=True)

python_29 = GhPythonScript(x=lng_78)  # -> out, a; same code as python_25
weave_31 = Weave(Pattern=python_29.a, Stream0=lng_78, Stream1=branch_19, NullGaps=False)

weave_32 = Weave(Pattern=python_25.a, Stream0=item_104, Stream1=weave_31, NullGaps=False)

# ----
# single unit in the building
# 
# or
# 
# single unit per floor
lng_79 = ListLength(List=weave_32)
python_30 = GhPythonScript(x=lng_79)  # -> out, a; same code as python_25

tstat_12 = TreeStatistics(Tree=partition_40)  # -> Paths, Length, Count
listdexs_6 = ListIndices(List=tstat_12.Length)
sort_13 = SortList(Keys=tstat_12.Length, ValuesA=listdexs_6)  # -> Keys, ValuesA
item_111 = ListItem(List=sort_13.ValuesA, Index="-1", Wrap=True)
item_112 = ListItem(List=flatten(partition_40), Index=item_111, Wrap=True)
branch_20 = TreeBranch(Tree=partition_40, Path=item_111, MaintainPaths=True)
weave_33 = Weave(Pattern=python_30.a, Stream0=item_112, Stream1=branch_20, NullGaps=False)

project_2 = Project(Geometry=weave_33, Plane=PlaneXY(0, 0, 0))  # -> Geometry, Transform
area_41 = Area(Geometry=project_2.Geometry)  # -> Area, Centroid
avr_4 = Average(Input=area_41.Centroid)
disc_10 = Discontinuity(Curve=weave_33, Level=1)  # -> flatten(Points), Parameters
cp_3 = ClosestPoint(Point=avr_4, Cloud=disc_10.Points)  # -> ClosestPoint, CPIndex, Distance
item_113 = ListItem(List=disc_10.Points, Index=cp_3.CPIndex, Wrap=True)
cp_4 = ClosestPoint(Point=item_113, Cloud=disc_8.Points)  # -> ClosestPoint, CPIndex, Distance
item_114 = ListItem(List=disc_8.Points, Index=cp_4.CPIndex, Wrap=True)
move2pt_2 = MoveToPoint(Geometry=branch_13, PointA=item_114, PointB=item_113)  # -> Moved, Vector, Transform

# ----
# if there are 2 or 1 unit per floor
lng_80 = ListLength(List=weave_33)
python_31 = GhPythonScript(x=lng_80)  # -> out, a
# ---------- python_31: Python ----------
__author__ = "orcun"
__version__ = "2022.04.08"

import rhinoscriptsyntax as rs
#if x == 1 or x == 2:
if x == 1:
    a = 0
elif x ==2:
    a = 2
else:
    a = 1
# ---------- end python_31 ----------

disc_11 = Discontinuity(Curve=weave_33, Level=1)  # -> flatten(Points), Parameters
hull_6 = ConvexHull(Points=disc_11.Points, Plane=PlaneXY(0, 0, 0))  # -> Hull, HullZ, Indices
area_42 = Area(Geometry=hull_6.Hull)  # -> Area, Centroid
move2pt_3 = MoveToPoint(Geometry=branch_14, PointA=area_40.Centroid, PointB=area_42.Centroid)  # -> Moved, Vector, Transform

weave_34 = Weave(Pattern=python_31.a, Stream0=move2pt_2.Moved, Stream1=branch_13, Stream2=move2pt_3.Moved, NullGaps=False)
project_3 = Project(Geometry=weave_34, Plane=PlaneXY(0, 0, 0))  # -> Geometry, Transform

# ----
# choose the floor with the most units
lng_81 = ListLength(List=partition_40)  # -> flatten(Length)
listdexs_7 = ListIndices(List=lng_81)
sort_14 = SortList(Keys=reverse(lng_81), ValuesA=reverse(listdexs_7))  # -> Keys, ValuesA
item_115 = ListItem(List=sort_14.ValuesA, Index=-1, Wrap=True)
branch_21 = TreeBranch(Tree=partition_40, Path=item_115, MaintainPaths=True)
# staircase, after extension
project_4 = Project(Geometry=branch_21, Plane=PlaneXY(0, 0, 0))  # -> Geometry, Transform

geo_65 = Geometry(project_3.Geometry)

pop2d_2 = Populate2D(Region=geo_65, Count=25, Seed=1)

incurve_9 = PointInCurve(Point=pop2d_2, Curve=graft(project_4.Geometry))  # -> Relationship, Point
equals_34 = Equality(FirstNumber=incurve_9.Relationship, SecondNumber="2")  # -> Equality, Inequality
sort_15 = SortList(Keys=equals_34.Equality)  # -> Keys, ValuesA
dcon_4 = DeleteConsecutive(Set=sort_15.Keys, Wrap=False)  # -> Set, Count
dispatch_44 = Dispatch(List=dcon_4.Set, DispatchPattern=[True, False])  # -> ListA, simplify(ListB)
clean_23 = CleanTree(RemoveNulls=True, RemoveInvalid=True, RemoveEmpty=Toggle(True), Tree=dispatch_44.ListB)
# Extension of staircase
# -Staircase should connect every residential unit
tstat_13 = TreeStatistics(Tree=clean_23)  # -> Paths, Length, Count

geo_66 = Geometry(simplify(graft(project_4.Geometry)))
branch_22 = TreeBranch(Tree=geo_66, Path=tstat_13.Paths, MaintainPaths=True)  # -> flatten(Branch)

geo_67 = Geometry(project_3.Geometry)

area_43 = Area(Geometry=geo_67)  # -> Area, Centroid
scale_6 = Scale(Geometry=geo_67, Center=area_43.Centroid, Factor="1.1")  # -> Geometry, Transform

debrep_9 = DeconstructBrep(Brep=branch_22)  # -> Faces, flatten(Edges), Vertices
midpt = CurveMiddle(Curve=debrep_9.Edges)
incurve_10 = PointInCurve(Point=midpt, Curve=scale_6.Geometry)  # -> Relationship, Point
equals_35 = Equality(FirstNumber=incurve_10.Relationship, SecondNumber=panel_489)  # -> Equality, Inequality
debrep_10 = DeconstructBrep(Brep=scale_6.Geometry)  # -> Faces, Edges, Vertices
dispatch_45 = Dispatch(List=debrep_9.Edges, DispatchPattern=equals_35.Equality)  # -> ListA, ListB
ccx = CurveCurve(CurveA=debrep_10.Edges, CurveB=dispatch_45.ListA)  # -> simplify(Points), ParamsA, ParamsB
geo_68 = Geometry(simplify(graft(debrep_10.Edges)))
lng_82 = ListLength(List=ccx.Points)
equals_36 = Equality(FirstNumber=lng_82, SecondNumber="0")  # -> Equality, Inequality
dispatch_46 = Dispatch(List=geo_68, DispatchPattern=equals_36.Equality)  # -> ListA, ListB

# ----
# dummy geometry to prevent empty list
geo_69 = Geometry(project_3.Geometry)
area_44 = Area(Geometry=geo_69)  # -> Area, Centroid
scale_7 = Scale(Geometry=geo_69, Center=area_44.Centroid, Factor="0.1")  # -> Geometry, Transform

disc_12 = Discontinuity(Curve=dispatch_45.ListA, Level=1)  # -> Points, Parameters
disc_13 = Discontinuity(Curve=dispatch_46.ListA, Level=1)  # -> Points, Parameters
merge_99 = Merge(Data1=disc_12.Points, Data2=disc_13.Points)  # -> flatten(Result)
hull_7 = ConvexHull(Points=merge_99, Plane=PlaneXY(0, 0, 0))  # -> Hull, HullZ, Indices
brec_7 = BoundingRectangle(Geometry=hull_7.Hull, Plane=data_166, Axis=0, Slide=0, Union=True)  # -> Bounding, DimensionX, DimensionY

# ----
# # of units per floor
# after extra unit addition
lng_83 = ListLength(List=partition_40)  # -> flatten(Length)

# ----
# if there are more than 4 units per floor
python_32 = GhPythonScript(x=lng_83)  # -> out, a
# ---------- python_32: Python ----------
__author__ = "Siser"
__version__ = "2022.05.06"

import rhinoscriptsyntax as rs
if x > 4:
    a = 1
else:
    a = 0
# ---------- end python_32 ----------

incurve_11 = PointInCurve(Point=area_28.Centroid, Curve=project_3.Geometry)  # -> Relationship, Point

disc_14 = Discontinuity(Curve=branch_22, Level=1)  # -> Points, Parameters
hull_8 = ConvexHull(Points=flatten(disc_14.Points), Plane=PlaneXY(0, 0, 0))  # -> Hull, HullZ, Indices
debrep_11 = DeconstructBrep(Brep=hull_8.Hull)  # -> Faces, Edges, Vertices
# scale-down or scale-up
# the staircase
len_2 = Length(Curve=debrep_11.Edges)
sort_16 = SortList(Keys=len_2, ValuesA=debrep_11.Edges)  # -> Keys, reverse(ValuesA)
debrep_12 = DeconstructBrep(Brep=brec_7.Bounding)  # -> Faces, Edges, Vertices
item_116 = ListItem(List=sort_16.ValuesA, Index=[0, 1], Wrap=True)

panel_491 = Panel("""staircase
before extension""")
geo_70 = Geometry(project_3.Geometry)

# ----
# select biggest number all the time, if not 0 will come
sort_17 = SortList(Keys=python_32.a)  # -> Keys, ValuesA
item_117 = ListItem(List=sort_17.Keys, Index=-1, Wrap=True)

# ----
# scale-up ratio of new staircase: preserve the original area of staircase
area_45 = Area(Geometry=scale_6.Geometry)  # -> Area, Centroid
area_46 = Area(Geometry=brec_7.Bounding)  # -> Area, Centroid
division_11 = Division(A=area_45.Area, B=area_46.Area)
panel_492 = Panel(area_46.Area)
panel_493 = Panel(area_45.Area)

# ----
# select only residential units
lng_84 = ListLength(List=partition_40)
series_43 = Series(Start=0, Step=1, Count=lng_84)  # -> simplify(Series)

# ----
# if single unit in the building or not,
# 
# single unit:0
# not single unit per building:1
data_173 = Data(python_30.a)

# ----
# select only residential units
lng_85 = ListLength(List=partition_40)
series_44 = Series(Start=0, Step=1, Count=lng_85)  # -> simplify(Series)

# ----
# if single unit in the building or not,
# 
# single unit:0
# not single unit per building:1
data_174 = Data(python_30.a)

# ----
# 0: if staircase is at corner of parcel
# 1: if staircase is at the center of the parcel
python_33 = GhPythonScript(x=incurve_11.Relationship)  # -> out, a
# ---------- python_33: Python ----------
__author__ = "orcun"
__version__ = "2022.05.06"

import rhinoscriptsyntax as rs
if x == 0:
    a = 0
else:
    a = 1
# ---------- end python_33 ----------

# ----
# for 2*3& 2*4 division floors, extend the staircase
staircase = Panel("""0: no-extend
1: extend""")

crv_cp_2 = CurveClosestPoint(Point=flatten(debrep_12.Vertices), Curve=graft(item_116))  # -> simplify(Point), Parameter, Distance

sort_pt = SortPoints(Points=crv_cp_2.Point)  # -> Points, Indices

dcon_5 = DeleteConsecutive(Set=sort_pt.Points, Wrap=False)  # -> simplify(Set), Count
pline_7 = PolyLine(Vertices=dcon_5.Set, Closed=False)
midpt_2 = CurveMiddle(Curve=pline_7)
scale_8 = Scale(Geometry=pline_7, Center=midpt_2, Factor=division_11)  # -> Geometry, Transform
disc_15 = Discontinuity(Curve=scale_8.Geometry, Level=1)  # -> flatten(Points), Parameters
# x
# x
# x
# x
# x
# x
# x
# x
# x
# x
# x
# x
# x
# x
# x
# x
# x
# x
# x
# x
# x
# x
# x
# x
# x
# x
# x
# 
# x
# x
# x
# x
# x
# x
# 
# x
# x
# x
# x
# x
# 
# x
# x
# x
# x
# x
# x
# 
# x
# x
# x
# x
hull_9 = ConvexHull(Points=disc_15.Points, Plane=PlaneXY(0, 0, 0))  # -> Hull, HullZ, Indices

# ----
# otherwise single floor buildings can be problematic (ex, ank-bahçeli,index:37)
merge_100 = Merge(Data1=hull_9.Hull, Data2=scale_7.Geometry)  # -> flatten(Result)
area_47 = Area(Geometry=merge_100)  # -> Area, Centroid
sort_18 = SortList(Keys=area_47.Area, ValuesA=merge_100)  # -> Keys, ValuesA
item_118 = ListItem(List=sort_18.ValuesA, Index=-1, Wrap=True)

weave_35 = Weave(Pattern=python_33.a, Stream0=geo_70, Stream1=item_118, NullGaps=False)

weave_36 = Weave(Pattern=item_117, Stream0=project_3.Geometry, Stream1=weave_35, NullGaps=False)

# ----
# no staircase if # of floor is equal to 1
python_34 = GhPythonScript(x=weave_36, y=lng_72)  # -> out, a
# ---------- python_34: Python ----------
__author__ = "orcun"
__version__ = "2022.05.09"

import rhinoscriptsyntax as rs
if y == 1:
    a = 'Null'
else:
    a = x
# ---------- end python_34 ----------

area_48 = Area(Geometry=hull_9.Hull)  # -> Area, Centroid
panel_494 = Panel(area_48.Area)

Z_3 = UnitZ(Factor=data_72)
arrlinear_2 = LinearArray(Geometry=python_34.a, Direction=Z_3, Count=lng_73)  # -> simplify(graft(Geometry)), Transform

# ----
# replace with new path
rdiff_2 = RegionDifference(CurvesA=partition_40, CurvesB=arrlinear_2.Geometry)  # -> simplify(Result)
tstat_14 = TreeStatistics(Tree=rdiff_2)  # -> Paths, Length, Count
replace_22 = ReplacePaths(Data=rdiff_2, Search=tstat_14.Paths, Replace=data_167)

# ----
# additional units (example index 0, in bahceli)
# 
# OR
# 
# non-additional units (example index 1, in bahceli)
geo_71 = Geometry(replace_22)

# ----
# single unit per building
item_119 = ListItem(List=geo_71, Index=series_43, Wrap=True)

tstat_15 = TreeStatistics(Tree=item_119)  # -> Paths, Length, Count
split_11 = TextSplit(Text=tstat_15.Paths, Separators="{}")
item_120 = ListItem(List=split_11, Index=1, Wrap=True)  # -> simplify(Item)
split_12 = TextSplit(Text=item_120, Separators=";")
item_121 = ListItem(List=split_12, Index="1", Wrap=True)  # -> simplify(flatten(Item))
lng_86 = ListLength(List=item_121)
dup_50 = DuplicateData(Data=item_70, Number=lng_86, Order=True)  # -> flatten(Data)
merge_101 = Merge(Data1=simplify(graft(dup_50)), Data2=simplify(graft(item_121)))
join_31 = TextJoin(Text=merge_101, Join=";")

# ----
# not single unit per building
branch_23 = TreeBranch(Tree=item_119, Path=item_93, MaintainPaths=True)

weave_37 = Weave(Pattern=data_173, Stream0=flatten(item_119), Stream1=branch_23, NullGaps=False)
disc_16 = Discontinuity(Curve=weave_37, Level=1)  # -> Points, Parameters
brec_8 = BoundingRectangle(Geometry=flatten(disc_16.Points), Plane=evalsrf_2.Frame, Axis=0, Slide=0, Union=True)  # -> Bounding, DimensionX, DimensionY
panel_495 = Panel("""SIMULATED 
BUILDING
UNITS""")

# ----
# core of the building
geo_72 = Geometry(flatten(arrlinear_2.Geometry))

area_49 = Area(Geometry=geo_72)  # -> Area, Centroid
sort_pt_2 = SortPoints(Points=area_49.Centroid)  # -> Points, Indices
item_122 = ListItem(List=geo_72, Index=sort_pt_2.Indices, Wrap=True)
item_123 = ListItem(List=item_122, Index=0, Wrap=True)

boundary_16 = BoundarySurfaces(Edges=item_119)
Z_4 = UnitZ(Factor=data_76)
extr_2 = Extrude(Base=boundary_16, Direction=Z_4)

# ----
# Simulated Parcel Bounding Box
geo_73 = Geometry(brec_8.Bounding)

multiplication_8 = Multiplication(A=data_77, B=item_97)
Z_5 = UnitZ(Factor=multiplication_8)
area_50 = Area(Geometry=geo_73)  # -> Area, Centroid
curvepoint_3 = PointOnCurve(geo_63, parameter=0.5)
extr_3 = Extrude(Base=dispatch_40.ListA, Direction=Z_5)
vec2pt_6 = Vector2Pt(PointA=area_50.Centroid, PointB=curvepoint_3, Unitize=Toggle(True))  # -> Vector, Length
extr_4 = Extrude(Base=extr_3, Direction=vec2pt_6.Vector)
mass2zone = Honeybee_Masses2Zones(zoneMasses=flatten(extr_4), isConditioned=Toggle(False), maxRoofAngle=30, createHBZones=Toggle(True))  # -> readMe, HBZones; plug-in component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
wires_4 = BrepWireframe(Brep=mass2zone.HBZones, Density=-1)

panel_496 = Panel("simulated Parcel")  # disabled
geo_74 = Geometry(brec_8.Bounding)  # disabled

panel_497 = Panel("simulated building PARCEL")
geo_75 = Geometry(brec_8.Bounding)

# ----
# radius of the circle is the summation of fit circle radius's and 2 times of the builing height
disc_17 = Discontinuity(Curve=geo_75, Level=1)  # -> Points, Parameters
fcircle = CircleFit(Points=disc_17.Points)  # -> Circle, Radius, Deviation
item_124 = ListItem(List=data_169, Index=data_124, Wrap=True)
data_175 = Data(floor_height)
multiplication_9 = Multiplication(A="2", B=item_124)
multiplication_10 = Multiplication(A=data_175, B=multiplication_9)

addition_7 = Addition(A=fcircle.Radius, B=multiplication_10)

area_51 = Area(Geometry=geo_44)  # -> Area, Centroid
area_52 = Area(Geometry=geo_75)  # -> Area, Centroid
cp_5 = ClosestPoint(Point=area_52.Centroid, Cloud=area_51.Centroid)  # -> ClosestPoint, CPIndex, Distance
item_125 = ListItem(List=geo_44, Index=cp_5.CPIndex, Wrap=True)
area_53 = Area(Geometry=item_125)  # -> Area, Centroid
area_54 = Area(Geometry=geo_44)  # -> Area, Centroid
circle_2 = CircleCNR(Center=area_53.Centroid, Normal=Vector(0, 0, 1), Radius=addition_7)
incurve_12 = PointInCurve(Point=area_54.Centroid, Curve=circle_2)  # -> Relationship, Point
equals_37 = Equality(FirstNumber=incurve_12.Relationship, SecondNumber="2")  # -> Equality, Inequality

pop2d_3 = Populate2D(Region=geo_44, Count="25", Seed=1)  # -> simplify(Population)
incurve_13 = PointInCurve(Point=pop2d_3, Curve=circle_2)  # -> Relationship, Point
equals_38 = Equality(FirstNumber=incurve_13.Relationship, SecondNumber="2")  # -> Equality, Inequality
dispatch_47 = Dispatch(List=pop2d_3, DispatchPattern=equals_38.Equality)  # -> flatten(ListA), ListB

incurves_2 = PointInCurves(Point=dispatch_47.ListA, Curves=geo_44)  # -> Relationship, Index, Point
sort_19 = SortList(Keys=incurves_2.Index)  # -> Keys, ValuesA
dcon_6 = DeleteConsecutive(Set=sort_19.Keys, Wrap=False)  # -> Set, Count
equals_39 = Equality(FirstNumber=dcon_6.Set, SecondNumber="-1")  # -> Equality, Inequality
dispatch_48 = Dispatch(List=dcon_6.Set, DispatchPattern=equals_39.Equality)  # -> ListA, ListB
item_126 = ListItem(List=geo_44, Index=dispatch_48.ListB, Wrap=True)

geo_76 = Geometry(brec_8.Bounding)
area_55 = Area(Geometry=geo_76)  # -> Area, Centroid

geo_77 = Geometry(brec_8.Bounding)

# ----
# rectangle geometry do not work with collison component
toggle_21 = BooleanToggle(True)
debrep_13 = DeconstructBrep(Brep=item_126)  # -> Faces, Edges, Vertices
pline_8 = PolyLine(Vertices=debrep_13.Vertices, Closed=toggle_21)  # -> flatten(Polyline)

geo_78 = Geometry(brec_8.Bounding)

disc_18 = Discontinuity(Curve=geo_78, Level=1)  # -> Points, Parameters
area_56 = Area(Geometry=geo_78)  # -> Area, Centroid
boundary_17 = BoundarySurfaces(Edges=geo_78)
ln = Line(StartPoint=disc_18.Points, EndPoint=area_56.Centroid)
srfsplit = SurfaceSplit(Surface=boundary_17, Curves=ln)
wires_5 = BrepWireframe(Brep=srfsplit, Density=-1)
join_32 = JoinCurves(Curves=wires_5, Preserve=False)  # -> flatten(Curves)
scale_9 = Scale(Geometry=join_32, Center=area_56.Centroid, Factor="50")  # -> Geometry, Transform

debrep_14 = DeconstructBrep(Brep=geo_78)  # -> Faces, Edges, Vertices
curvepoint_4 = PointOnCurve(debrep_14.Edges, parameter=0.5)
intcrv = Interpolate(Vertices=curvepoint_4, Degree=3, Periodic=Toggle(True), KnotStyle=1)  # -> Curve, Length, Domain

geo_79 = Geometry(brec_8.Bounding)

geo_80 = Geometry(brec_8.Bounding)

debrep_15 = DeconstructBrep(Brep=geo_79)  # -> Faces, Edges, Vertices
area_57 = Area(Geometry=geo_79)  # -> Area, Centroid
curvepoint_5 = PointOnCurve(debrep_15.Edges, parameter=0.5)
vec2pt_7 = Vector2Pt(PointA=area_57.Centroid, PointB=curvepoint_5, Unitize=Toggle(True))  # -> Vector, Length
move_3 = Move(Geometry=graft(curvepoint_5), Motion=graft(vec2pt_7.Vector))  # -> simplify(Geometry), Transform
# Building & Unit Features
disc_19 = Discontinuity(Curve=debrep_15.Edges, Level=1)  # -> simplify(Points), Parameters
merge_102 = Merge(Data1=disc_19.Points, Data2=move_3.Geometry)

# ----
# 00test triangle
area_58 = Area(Geometry=geo_80)  # -> Area, Centroid
disc_20 = Discontinuity(Curve=geo_80, Level=1)  # -> Points, Parameters
boundary_18 = BoundarySurfaces(Edges=geo_80)
ln_2 = Line(StartPoint=disc_20.Points, EndPoint=area_58.Centroid)
srfsplit_2 = SurfaceSplit(Surface=boundary_18, Curves=ln_2)
wires_6 = BrepWireframe(Brep=srfsplit_2, Density=-1)
join_33 = JoinCurves(Curves=wires_6, Preserve=False)  # -> flatten(Curves)
scale_10 = Scale(Geometry=join_33, Center=area_58.Centroid, Factor="50")  # -> Geometry, Transform

area_59 = Area(Geometry=scale_9.Geometry)  # -> Area, Centroid
alongcrv = SortAlongCurve(Points=area_59.Centroid, Curve=intcrv.Curve)  # -> Points, Indices
item_127 = ListItem(List=scale_9.Geometry, Index=alongcrv.Indices, Wrap=True)

area_60 = Area(Geometry=scale_10.Geometry)  # -> Area, Centroid
pdecon_9 = Deconstruct(Point=area_60.Centroid)  # -> XComponent, YComponent, ZComponent
sort_20 = SortList(Keys=pdecon_9.YComponent, ValuesA=scale_10.Geometry)  # -> Keys, reverse(ValuesA)
item_128 = ListItem(List=sort_20.ValuesA, Index=0, Wrap=True)

area_61 = Area(Geometry=scale_10.Geometry)  # -> Area, Centroid
pdecon_10 = Deconstruct(Point=area_61.Centroid)  # -> XComponent, YComponent, ZComponent
sort_21 = SortList(Keys=pdecon_10.XComponent, ValuesA=scale_10.Geometry)  # -> Keys, ValuesA
item_129 = ListItem(List=sort_21.ValuesA, Index=0, Wrap=True)

area_62 = Area(Geometry=scale_10.Geometry)  # -> Area, Centroid
pdecon_11 = Deconstruct(Point=area_62.Centroid)  # -> XComponent, YComponent, ZComponent
sort_22 = SortList(Keys=pdecon_11.YComponent, ValuesA=scale_10.Geometry)  # -> Keys, ValuesA
item_130 = ListItem(List=sort_22.ValuesA, Index=0, Wrap=True)

area_63 = Area(Geometry=scale_10.Geometry)  # -> Area, Centroid
pdecon_12 = Deconstruct(Point=area_63.Centroid)  # -> XComponent, YComponent, ZComponent
sort_23 = SortList(Keys=pdecon_12.XComponent, ValuesA=scale_10.Geometry)  # -> Keys, reverse(ValuesA)
item_131 = ListItem(List=sort_23.ValuesA, Index=0, Wrap=True)

shift_4 = ShiftList(List=item_127, Shift="-1", Wrap=True)
panel_504 = Panel("starts from north")

# ----
# regions start from north
# continues counter-clockwise
merge_103 = Merge(Data1=item_128, Data2=item_129, Data3=item_130, Data4=item_131)

geo_81 = Geometry(brec_8.Bounding)

geo_82 = Geometry(brec_8.Bounding)

geo_83 = Geometry(brec_8.Bounding)

tstat_16 = TreeStatistics(Tree=geo_71)  # -> Paths, Length, Count; disabled
panel_508 = Panel("{}")  # disabled
split_13 = TextSplit(Text=tstat_16.Paths, Separators=panel_508)  # disabled
panel_509 = Panel(";")  # disabled
split_14 = TextSplit(Text=split_13, Separators=panel_509)  # disabled
clean_24 = CleanTree(RemoveNulls=True, RemoveInvalid=True, RemoveEmpty=False, Tree=split_14)  # -> simplify(flatten(Tree)); disabled
item_132 = ListItem(List=clean_24, Index=1, Wrap=True)  # disabled

tstat_17 = TreeStatistics(Tree=geo_71)  # -> Paths, Length, Count
split_15 = TextSplit(Text=tstat_17.Paths, Separators="{}")
split_16 = TextSplit(Text=split_15, Separators=";")
clean_25 = CleanTree(RemoveNulls=True, RemoveInvalid=True, RemoveEmpty=False, Tree=split_16)  # -> simplify(flatten(Tree))
item_133 = ListItem(List=clean_25, Index=1, Wrap=True)

tstat_18 = TreeStatistics(Tree=geo_71)  # -> Paths, Length, Count
split_17 = TextSplit(Text=tstat_18.Paths, Separators="{}")
split_18 = TextSplit(Text=split_17, Separators=";")
clean_26 = CleanTree(RemoveNulls=True, RemoveInvalid=True, RemoveEmpty=False, Tree=split_18)  # -> simplify(flatten(Tree))
item_134 = ListItem(List=clean_26, Index=1, Wrap=True)

tstat_19 = TreeStatistics(Tree=geo_71)  # -> Paths, Length, Count
split_19 = TextSplit(Text=tstat_19.Paths, Separators="{}")
split_20 = TextSplit(Text=split_19, Separators=";")
clean_27 = CleanTree(RemoveNulls=True, RemoveInvalid=True, RemoveEmpty=False, Tree=split_20)  # -> simplify(flatten(Tree))
item_135 = ListItem(List=clean_27, Index=1, Wrap=True)

lng_87 = ListLength(List=item_119)  # -> flatten(Length)
series_45 = Series(Start=0, Step=1, Count=simplify(lng_87))  # -> simplify(flatten(Series))
partition_41 = PartitionList(List=lng_87, Size="1")  # -> simplify(Chunks)
dup_51 = DuplicateData(Data=join_31, Number=partition_41, Order=True)  # -> simplify(Data)
rep = ReplaceText(Text=dup_51, Find=";", Replace="_", RecursiveReplace=False)  # -> flatten(Result)

python_35 = GhPythonScript(x=replace_9)  # -> out, a
# ---------- python_35: Python ----------
__author__ = "Siser"
__version__ = "2022.03.07"

import rhinoscriptsyntax as rs
if x == 'MidriseApartment::Apartment':
    a = 'res'
else:
    a = 'off'
# ---------- end python_35 ----------
partition_42 = PartitionList(List=python_35.a, Size=lng_87)  # -> simplify(flatten(Chunks))

merge_104 = Merge(Data1=simplify(graft(rep)), Data2=simplify(graft(series_45)), Data3=simplify(graft(partition_42)))
join_34 = TextJoin(Text=simplify(merge_104), Join="_")  # -> flatten(Result)
partition_43 = PartitionList(List=join_34, Size=lng_87)  # -> simplify(Chunks)
item_136 = ListItem(List=partition_43, Index=series_44, Wrap=True)

panel_510 = Panel("parcel_floor_unit_function")
panel_511 = Panel(partition_43)

# ----
# Naming for Simulated Zones
data_176 = Data(flatten(partition_43))

# ----
# Naming for Staircase
Z_6 = UnitZ(Factor=data_74)
arrlinear_3 = LinearArray(Geometry=item_123, Direction=Z_6, Count=item_94)  # -> Geometry, Transform
Z_7 = UnitZ(Factor=data_75)
boundary_19 = BoundarySurfaces(Edges=arrlinear_3.Geometry)
data_177 = Data(item_48)
split_21 = TextSplit(Text=data_177, Separators=":")
extr_5 = Extrude(Base=boundary_19, Direction=Z_7)
item_137 = ListItem(List=split_21, Index="-1", Wrap=True)
chars_2 = Characters(Text=item_137)  # -> Result, Unicode
series_46 = Series(Start=0, Step=1, Count="3")
item_138 = ListItem(List=chars_2.Result, Index=series_46, Wrap=True)
data_178 = Data(filename)
dup_52 = DuplicateData(Data=data_178, Number=item_94, Order=True)  # -> flatten(Data)

panel_512 = Panel("unconditoned")
geo_84 = Geometry(extr_5)

lng_88 = ListLength(List=geo_84)
series_47 = Series(Start=0, Step=1, Count=lng_88)  # -> flatten(Series)
dup_53 = DuplicateData(Data=item_138, Number=lng_88, Order=True)  # -> flatten(Data)
partition_44 = PartitionList(List=dup_53, Size="3")
merge_105 = Merge(Data1=simplify(graft(series_47)), Data2=simplify(partition_44), Data3=simplify(graft(dup_52)))

data_179 = Data(extr_5)  # disabled
panel_513 = Panel("# of floor")  # disabled
lng_89 = ListLength(List=data_179)  # disabled

panel_514 = Panel("contioned & unconditioned")

# ----
# intersect mass for all units
# -conditioned zones
# -unconditioned zones
# Error: vertex size mismatch between base surface
toggle_22 = BooleanToggle(True)

# ----
# single unit per building
# 
# or
# 
# not
join_35 = TextJoin(Text=merge_105)  # -> flatten(Result)

# ----
# if there is one building at the floor
lng_90 = ListLength(List=partition_40)  # -> flatten(Length)
equals_40 = Equality(FirstNumber="1", SecondNumber=lng_90)  # -> Equality, Inequality
dispatch_49 = Dispatch(List=geo_84, DispatchPattern=equals_40.Equality)  # -> ListA, ListB
dispatch_50 = Dispatch(List=join_35, DispatchPattern=equals_40.Equality)  # -> ListA, ListB

weave_38 = Weave(Pattern=data_174, Stream0=geo_84, Stream1=dispatch_49.ListB, NullGaps=False)
# Staircase:
# Unconditioned
weave_39 = Weave(Pattern=data_174, Stream0=join_35, Stream1=dispatch_50.ListB, NullGaps=False)

merge_106 = Merge(Data1=extr_2, Data2=weave_38)

intersectmass = Honeybee_IntersectMasses(bldgMassesBefore=flatten(merge_106), runIt=toggle_22)  # -> bldgMassesAfter; plug-in component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

volume = Volume(Geometry=weave_38)  # -> Volume, Centroid
round_32 = Round(Number=volume.Volume)  # -> Nearest, Floor, Ceiling
dcon_7 = DeleteConsecutive(Set=round_32.Nearest, Wrap=False)  # -> Set, Count

volume_2 = Volume(Geometry=intersectmass)  # -> Volume, Centroid
round_33 = Round(Number=volume_2.Volume)  # -> Nearest, Floor, Ceiling
equals_41 = Equality(FirstNumber=round_33.Nearest, SecondNumber=dcon_7.Set)  # -> Equality, Inequality
dispatch_51 = Dispatch(List=intersectmass, DispatchPattern=equals_41.Equality)  # -> ListA, ListB

panel_515 = Panel("conditioned")
geo_85 = Geometry(dispatch_51.ListB)

# ----
# if # of floor is equal to 1
# 	no staircase and a = 0
python_36 = GhPythonScript(y=lng_74)  # -> out, a
# ---------- python_36: Python ----------
__author__ = "orcun"
__version__ = "2022.05.09"

import rhinoscriptsyntax as rs
if y == 1:
    a = 0
else:
    a = 1
# ---------- end python_36 ----------
# Conditioned Units
weave_40 = Weave(Pattern=python_36.a, Stream0=intersectmass, Stream1=geo_85, NullGaps=False)

panel_516 = Panel("unconditioned")
geo_86 = Geometry(dispatch_51.ListA)

mass2zone_2 = Honeybee_Masses2Zones(
    zoneMasses=flatten(geo_86),
    zoneNames=flatten(weave_39),
    zonePrograms=item_48,
    isConditioned=Toggle(False),
    maxRoofAngle=30,
    createHBZones=Toggle(True))  # -> readMe, HBZones; plug-in component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

mass2zone_3 = Honeybee_Masses2Zones(
    zoneMasses=flatten(weave_40),
    zoneNames=flatten(partition_43),
    zonePrograms=replace_9,
    isConditioned=Toggle(True),
    maxRoofAngle=30,
    createHBZones=Toggle(True))  # -> readMe, HBZones; plug-in component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

# ----
# if the # of floor is equal to 1
merge_107 = Merge(Data1=flatten(mass2zone_3.HBZones), Data2=flatten(mass2zone_2.HBZones))
null_9 = NullItem(Item=merge_107)  # -> flatten(NullFlags), InvalidFlags, Description
dispatch_52 = Dispatch(List=merge_107, DispatchPattern=null_9.NullFlags)  # -> ListA, flatten(ListB)

solveadjc = Honeybee_SolveAdjacencies(HBZones=flatten(dispatch_52.ListB), removeCurrentAdjc=False, findAdjc=Toggle(True))  # -> readMe, HBZonesWADJ; plug-in component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

# ----
# 05.HBZONE FORMATION
# FORENERGYMODELING
# HBzone
# Formation
merge_108 = Merge(Data1=solveadjc.HBZonesWADJ, Data2=mass2zone.HBZones)  # -> flatten(Result)
null_10 = NullItem(Item=merge_108)  # -> flatten(NullFlags), InvalidFlags, Description
dispatch_53 = Dispatch(List=merge_108, DispatchPattern=null_10.NullFlags)  # -> ListA, flatten(ListB)
panel_517 = Panel("include intersected surface's zone")
solveadjc_2 = Honeybee_SolveAdjacencies(HBZones=flatten(dispatch_53.ListB), altBC="Adiabatic", removeCurrentAdjc=False, findAdjc=Toggle(True))  # -> readMe, HBZonesWADJ; plug-in component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

# ----
# Window Addition
conditionedunconditioned = Honeybee_SeparateConditionedAndUnconditionedZones(HBZones=flatten(solveadjc_2.HBZonesWADJ))  # -> conditionedZones, unconditionedZones; plug-in component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
glazingcreator = Honeybee_GlazingBasedOnRatio(
    HBObjects=conditionedunconditioned.conditionedZones,
    glzRatio=weave_20,
    breakUpWindow=Toggle(False),
    EPConstructions=epconstruction_2,
    runIt=Toggle(True))  # -> readMe, HBObjWGLZ; plug-in component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

geo_87 = Geometry(glazingcreator.HBObjWGLZ)
panel_518 = Panel("HBzones")

panel_519 = Panel("residential non-cooling")
equals_42 = Equality(FirstNumber=data_113, SecondNumber="0")  # -> Equality, Inequality
dispatch_54 = Dispatch(List=geo_87, DispatchPattern=equals_42.Equality)  # -> ListA, ListB

# ----
# Residential
# with cooling
panel_520 = Panel("residential with cooling")  # disabled
panel_521 = Panel("5")  # disabled
equals_43 = Equality(FirstNumber=data_113, SecondNumber=panel_521)  # -> Equality, Inequality; disabled
dispatch_55 = Dispatch(List=geo_87, DispatchPattern=equals_43.Equality)  # -> ListA, ListB; disabled

panel_522 = Panel("office unit(s)")
equals_44 = Equality(FirstNumber=data_113, SecondNumber="1")  # -> Equality, Inequality
dispatch_56 = Dispatch(List=geo_87, DispatchPattern=equals_44.Equality)  # -> ListA, ListB

panel_523 = Panel("residential all")
data_180 = Data(dispatch_56.ListB)
item_139 = ListItem(List=geo_87, Index=data_180, Wrap=True)

dispatch_57 = Dispatch(List=data_176, DispatchPattern=equals_44.Equality)  # -> ListA, ListB
lng_91 = ListLength(List=dispatch_57.ListB)
panel_524 = Panel("naming")
dup_54 = DuplicateData(Data="heatSet", Number=lng_91, Order=True)
merge_109 = Merge(Data1=simplify(graft(dup_54)), Data2=simplify(graft(dispatch_57.ListB)))  # -> simplify(Result)
join_36 = TextJoin(Text=merge_109)  # -> flatten(Result)

panel_525 = Panel("#ofResUnits")
lng_92 = ListLength(List=item_139)

lng_93 = ListLength(List=item_139)

multiplication_11 = Multiplication(A="5", B=lng_92)
dup_55 = DuplicateData(Data="18", Number=multiplication_11, Order=True)
partition_45 = PartitionList(List=dup_55, Size="5")  # -> simplify(Chunks)

dup_56 = DuplicateData(Data=data_147, Number="19", Order=True)  # -> simplify(Data)
sort_24 = SortList(Keys=dup_56)  # -> Keys, ValuesA
partition_46 = PartitionList(List=sort_24.Keys, Size="19")  # -> simplify(Chunks)
merge_110 = Merge(Data1=partition_45, Data2=partition_46)

# ----
# .csv recordings
dup_57 = DuplicateData(Data="21.1", Number=lng_93, Order=True)

# ----
# separation of
# residential & office units
data_181 = Data(flatten(partition_42))
tmatch = MatchText(Text=data_181, Pattern="res", Case=True)
dispatch_58 = Dispatch(List=glazingcreator.HBObjWGLZ, DispatchPattern=tmatch)  # -> ListA, ListB

# ----
# GENERATED
# HEATING
# SET POINT
toggle_23 = BooleanToggle(True)
dup_58 = DuplicateData(Data=merge_110, Number=365, Order=True)  # -> simplify(Data)
csvschedule_2 = Honeybee_CreateCSVSchedule(values=dup_58, units="Temperature", scheduleName=simplify(graft(join_36)), writeFile=toggle_23)  # -> readMe, flatten(csvSchedule); plug-in component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

# ----
# RESIDENTIAL UNITS
debrep_16 = DeconstructBrep(Brep=dispatch_58.ListA)  # -> Faces, Edges, Vertices
item_140 = ListItem(List=debrep_16.Faces, Index=0, Wrap=True)  # -> flatten(Item)
area_64 = Area(Geometry=item_140)  # -> Area, Centroid
sort_25 = SortList(Keys=area_64.Area)  # -> Keys, ValuesA
dcon_8 = DeleteConsecutive(Set=sort_25.Keys, Wrap=False)  # -> Set, Count
mindex_8 = MemberIndex(Set=area_64.Area, Member=graft(dcon_8.Set))  # -> simplify(Index), Count

lng_94 = ListLength(List=item_139)

# ----
# AS-IS V1
# HEATING
# SET POINT
panel_528 = Panel("heatSetV1orV3")
annualschedule_26 = Honeybee_AnnualSchedule(
    sun=merge_54,
    mon=merge_54,
    tue=merge_54,
    wed=merge_54,
    thu=merge_54,
    fri=merge_54,
    sat=merge_54,
    scheduleName=simplify(graft(panel_528)),
    schedTypeLimits="Temperature",
    runIt=Toggle(True))  # -> readMe, port, flatten(schedule), port_2, simplify(weekSched), schedIDFText; plug-in component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
dup_59 = DuplicateData(Data=annualschedule_26.schedule, Number=lng_94, Order=True)

panel_529 = Panel("HeatingSetSchedule")
weave_41 = Weave(
    Pattern=list,
    Stream0=dup_59,
    Stream1=csvschedule_2.csvSchedule,
    Stream2=dup_59,
    Stream3=csvschedule_2.csvSchedule,
    NullGaps=False)

panel_530 = Panel("""HeatingSet
csv recordings""")
# Versions
weave_42 = Weave(Pattern=list, Stream0=dup_57, Stream1=data_147, Stream2=dup_57, Stream3=data_147, NullGaps=False)

# ----
# Group the residential Units according to their floor area
item_141 = ListItem(List=area_64.Area, Index=mindex_8.Index, Wrap=True)

item_142 = ListItem(List=item_141, Index=0, Wrap=True)
lng_95 = ListLength(List=item_142)
dup_60 = DuplicateData(Data=panel_247, Number=lng_95, Order=True)  # -> simplify(Data)
lng_96 = ListLength(List=panel_247)
partition_47 = PartitionList(List=dup_60, Size=lng_96)  # -> simplify(Chunks)
tstat_20 = TreeStatistics(Tree=partition_47)  # -> Paths, Length, Count
tstat_21 = TreeStatistics(Tree=item_142)  # -> Paths, Length, Count
# Statistically Unit Grouping
# Matching Unit Floor Area &
# Occupant Profile Combinations
replace_23 = ReplacePaths(Data=partition_47, Search=tstat_20.Paths, Replace=tstat_21.Paths)
# based on hepsiemlak.com
subtraction_5 = Subtraction(A=item_142, B=replace_23)
abs_4 = Absolute(Value=subtraction_5)
listdexs_8 = ListIndices(List=abs_4)
sort_26 = SortList(Keys=abs_4, ValuesA=listdexs_8)  # -> Keys, ValuesA
item_143 = ListItem(List=sort_26.ValuesA, Index=0, Wrap=True)
lng_97 = ListLength(List=item_141)
dup_61 = DuplicateData(Data=item_143, Number=lng_97, Order=True)  # -> simplify(Data)

# ----
# AS-IS V2
# OCCUPANCY
# SCHEDULES
weave_43 = Weave(
    Pattern=dup_61,
    Stream0=jitter_32.Values,
    Stream1=jitter_31.Values,
    Stream2=jitter_29.Values,
    Stream3=jitter_28.Values,
    Stream4=jitter_30.Values,
    NullGaps=False)

lng_98 = ListLength(List=dup_61)  # -> simplify(Length)
series_48 = Series(Start=0, Step=1, Count=lng_98)
item_144 = ListItem(List=simplify(weave_43), Index=simplify(series_48), Wrap=True)  # -> simplify(Item)

# ----
# Occ Schedule Versions
getepschedules_4 = Honeybee_GetEnergyPlusSchedules(zoneProgram=item_47)  # -> occupancySchedule, occupancyActivitySch, heatingSetPtSchedule, coolingSetPtSchedule, lightingSchedule, equipmentSchedule, infiltrationSchedule; plug-in component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
lng_99 = ListLength(List=item_144)
dup_62 = DuplicateData(Data=getepschedules_4.occupancySchedule, Number=lng_99, Order=True)
panel_531 = Panel("OccSchedule")
weave_44 = Weave(Pattern=list, Stream0=simplify(dup_62), Stream1=item_144, Stream2=dup_62, Stream3=item_144, NullGaps=False)

# ----
# RESIDENTIAL COOLING UNITS
panel_532 = Panel("residential all")
item_145 = ListItem(List=data_113, Index=data_180, Wrap=True)

# ----
# OFFICE UNITS
toggle_24 = BooleanToggle(False)
setepnatvent = Honeybee_SetEPAirFlow(
    HBZones=flatten(dispatch_56.ListA),
    naturalVentilationType="1",
    minIndoorTempForNatVent="24.0",
    maxIndoorTempForNatVent="25.0",
    minOutdoorTempForNatVent="12",
    deltaTempForNatVent="0.0",
    fractionOfGlzAreaOperable="0.4",
    windDrivenCrossVent=toggle_24)  # -> readMe, simplify(HBZones); plug-in component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
setepzoneschedules = Honeybee_SetEnergyPlusZoneSchedules(
    HBZones=setepnatvent.HBZones,
    heatingSetPtSchedules=annualschedule_25.schedule,
    coolingSetPtSchedules=honeybee_seasonalschedule.schedule)  # -> schedules, simplify(HBZones); plug-in component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

panel_533 = Panel("occupancy Schedules")
data_182 = Data(weave_44)

# ----
# Heating set point
panel_534 = Panel("1")
equals_45 = Equality(FirstNumber=item_145, SecondNumber=panel_534)  # -> Equality, Inequality
dispatch_59 = Dispatch(List=weave_41, DispatchPattern=equals_45.Equality)  # -> ListA, ListB

# ----
# RESIDENTIAL
# COOLING-OFF
# UNITS
setepnatvent_2 = Honeybee_SetEPAirFlow(
    HBZones=flatten(dispatch_54.ListA),
    naturalVentilationType="1",
    minIndoorTempForNatVent="24.0",
    minOutdoorTempForNatVent="12",
    deltaTempForNatVent=panel_251,
    fractionOfGlzAreaOperable="0.4",
    windDrivenCrossVent=Toggle(False))  # -> readMe, simplify(HBZones); plug-in component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
setepzoneschedules_2 = Honeybee_SetEnergyPlusZoneSchedules(
    HBZones=setepnatvent_2.HBZones,
    heatingSetPtSchedules=dispatch_59.ListB,
    coolingSetPtSchedules=annualschedule_24.schedule,
    lightingSchedules=item_49)  # -> schedules, simplify(flatten(HBZones)); plug-in component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

split_22 = TextSplit(Text=flatten(data_182), Separators="_")  # -> simplify(Result)
python_37 = GhPythonScript(x=split_22, A=panel_260)  # -> out, a
# ---------- python_37: Python ----------
__author__ = "orcun"
__version__ = "2021.11.30"

import rhinoscriptsyntax as rs
if x == A:
    a = 0
else:
    a = 1
# ---------- end python_37 ----------
sort_27 = SortList(Keys=python_37.a)  # -> Keys, ValuesA
item_146 = ListItem(List=sort_27.Keys, Index=0, Wrap=True)  # -> flatten(Item)
lng_100 = ListLength(List=data_182)

item_147 = ListItem(List=cooling_set_points, Index=item_146, Wrap=True)  # -> simplify(graft(Item))
lng_101 = ListLength(List=item_147)
dup_63 = DuplicateData(Data="100", Number=lng_101, Order=True)
dup_64 = DuplicateData(Data=dup_63, Number="8", Order=True)  # -> simplify(Data)
dup_65 = DuplicateData(Data=item_147, Number="12", Order=True)  # -> simplify(Data)
dup_66 = DuplicateData(Data=dup_63, Number="4", Order=True)  # -> simplify(Data)
merge_111 = Merge(Data1=dup_64, Data2=dup_65, Data3=dup_66)

item_148 = ListItem(List=heating_set_points_name, Index=item_146, Wrap=True)  # -> simplify(graft(Item))
lng_102 = ListLength(List=item_148)
dup_67 = DuplicateData(Data="CoolResidential", Number=lng_102, Order=True)  # -> simplify(Data)
merge_112 = Merge(Data1=dup_67, Data2=item_148)
join_37 = TextJoin(Text=merge_112, Join="_")

item_149 = ListItem(List=heating_set_points, Index=item_146, Wrap=True)  # -> simplify(graft(Item))
lng_103 = ListLength(List=item_149)
dup_68 = DuplicateData(Data="18", Number=lng_103, Order=True)
dup_69 = DuplicateData(Data=dup_68, Number="7", Order=True)  # -> simplify(Data)
dup_70 = DuplicateData(Data=item_149, Number="17", Order=True)  # -> simplify(Data)
merge_113 = Merge(Data1=dup_69, Data2=dup_70)

item_150 = ListItem(List=heating_set_points_name, Index=item_146, Wrap=True)  # -> simplify(graft(Item))
lng_104 = ListLength(List=item_150)
dup_71 = DuplicateData(Data="HEATSET", Number=lng_104, Order=True)  # -> simplify(Data)
merge_114 = Merge(Data1=dup_71, Data2=item_150)
join_38 = TextJoin(Text=merge_114, Join="_")

# ----
# indices
# of
# residential non-cooling
listdexs_9 = ListIndices(List=geo_87)
dispatch_60 = Dispatch(List=listdexs_9, DispatchPattern=equals_42.Equality)  # -> ListA, ListB

# ----
# Cooling Set Point Schedules
toggle_25 = BooleanToggle(True)
dup_72 = DuplicateData(Data="100", Number="24", Order=True)
annualschedule_27 = Honeybee_AnnualSchedule(
    sun=merge_111,
    mon=merge_111,
    tue=merge_111,
    wed=merge_111,
    thu=merge_111,
    fri=merge_111,
    sat=merge_111,
    scheduleName="COOL-ON-SCHEDULE",
    schedTypeLimits="Temperature",
    runIt=toggle_25)  # -> readMe, port, schedule, port_2, weekSched, schedIDFText; plug-in component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
annualschedule_28 = Honeybee_AnnualSchedule(
    sun=dup_72,
    mon=dup_72,
    tue=dup_72,
    wed=dup_72,
    thu=dup_72,
    fri=dup_72,
    sat=dup_72,
    scheduleName="COOL-OFF-SCHEDULE",
    schedTypeLimits="Temperature",
    runIt=toggle_25)  # -> readMe, port, schedule, port_2, weekSched, schedIDFText; plug-in component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
analysisperiod_6 = Ladybug_AnalysisPeriod(fromMonth=data_79, fromDay=data_80, toMonth=data_81, toDay=data_80)  # -> readMe, analysisPeriod; plug-in component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
panel_535 = Panel("Classroom_Cooling_25")
honeybee_seasonalschedule_2 = Honeybee_SeasonalSchedule(
    scheduleName=join_37,
    schedTypeLimits="Temperature",
    baseWeekSched=annualschedule_28.weekSched,
    seasonWeekSched1=annualschedule_27.weekSched,
    analysisPeriod1=analysisperiod_6.analysisPeriod)  # -> readMe, flatten(schedule), schedIDFText; plug-in component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

# ----
# geometry of residential non-cooling
geo_88 = Geometry(setepzoneschedules_2.HBZones)

replace_24 = ReplaceItems(List=data_114, Item=geo_88, Indices=dispatch_60.ListA, Wrap=False)

# ----
# Heating Set Point Schedules
panel_536 = Panel("Temperature")
annualschedule_29 = Honeybee_AnnualSchedule(
    sun=merge_113,
    mon=merge_113,
    tue=merge_113,
    wed=merge_113,
    thu=merge_113,
    fri=merge_113,
    sat=merge_113,
    scheduleName=simplify(graft(join_38)),
    schedTypeLimits=panel_536,
    runIt=Toggle(True))  # -> readMe, port, flatten(schedule), port_2, simplify(weekSched), schedIDFText; plug-in component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
partition_48 = PartitionList(List=annualschedule_29.schedule, Size=flatten(lng_100))  # -> simplify(Chunks); disabled

# ----
# indices
# of
# residential cooling
listdexs_10 = ListIndices(List=geo_87)
dispatch_61 = Dispatch(List=listdexs_10, DispatchPattern=equals_43.Equality)  # -> ListA, ListB

panel_537 = Panel("CULL office unit(s)")
data_183 = Data(equals_44.Equality)

panel_538 = Panel("cooling schedules")
partition_49 = PartitionList(List=honeybee_seasonalschedule_2.schedule, Size=flatten(lng_100))  # -> simplify(Chunks); disabled

panel_539 = Panel("Unit Matching Data")  # disabled
data_184 = Data(dup_61)  # disabled

# ----
# AS-IS V2
# # OF PEOPLE IN THE
# RESIDENTIAL UNIT
weave_45 = Weave(
    Pattern=data_184,
    Stream0=jitter_37.Values,
    Stream1=jitter_36.Values,
    Stream2=jitter_34.Values,
    Stream3=jitter_35.Values,
    Stream4=jitter_33.Values,
    NullGaps=False)  # disabled

# ----
# Group the residential Units according to their floor area
data_185 = Data(item_141)  # disabled

lng_105 = ListLength(List=data_184)  # -> simplify(Length); disabled
series_49 = Series(Start=0, Step=1, Count=lng_105)  # disabled
# x
# x
# x
# x
# x
# x
# x
# x
# x
# x
# x
# x
# x
# x
# x
# x
# x
# x
# x
# x
# x
# x
# x
# x
# x
# x
# x
# 
# x
# x
# x
# x
# x
# x
# 
# x
# x
# x
# x
# x
# 
# x
# x
# x
# x
# x
# x
# 
# x
# x
# x
# x
# x
# x
# x
# x
# x
# x
# x
# x
# x
# x
# x
# x
# x
# x
# x
# x
# x
# x
# x
# x
# x
# x
# x
# x
# x
# x
# x
# 
# x
# x
# x
# x
# x
# x
# 
# x
# x
# x
# x
# x
# 
# x
# x
# x
# x
# x
# x
# 
# x
# x
# x
# x
item_151 = ListItem(List=simplify(weave_45), Index=series_49, Wrap=True)  # -> simplify(Item); disabled

# ----
# # of people per unit
data_186 = Data(item_151)  # disabled

conditionedunconditioned_2 = Honeybee_SeparateConditionedAndUnconditionedZones(HBZones=flatten(solveadjc.HBZonesWADJ))  # -> conditionedZones, unconditionedZones; plug-in component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
panel_540 = Panel("Unconditioned Adjacent Zone")

# ----
# #of people per unit
division_12 = Division(A=data_186, B=data_185)  # disabled

# ----
# indices of all residentials
listdexs_11 = ListIndices(List=geo_87)
dispatch_62 = Dispatch(List=listdexs_11, DispatchPattern=equals_44.Equality)  # -> ListA, ListB

# ----
# .csv recordings
panel_541 = Panel("#ofResUnits")
lng_106 = ListLength(List=item_139)
dup_73 = DuplicateData(Data=geteploads_2.equipmentLoadPerArea, Number=lng_106, Order=True)

lng_107 = ListLength(List=item_139)

# ----
# .csv recordings
# AS-IS V1
# LIGHTING DENSITY
data_187 = Data(geteploads_2.lightingDensityPerArea)
dup_74 = DuplicateData(Data=data_187, Number=lng_107, Order=True)

# ----
# equipmentDensity
weave_46 = Weave(
    Pattern=list,
    Stream0=dup_73,
    Stream1=flatten(data_148),
    Stream2=flatten(dup_73),
    Stream3=flatten(data_148),
    NullGaps=False)

# ----
# GENERATED
# LIGHTING DENSITY
panel_543 = Panel("Lighting Density")
weave_47 = Weave(
    Pattern=list,
    Stream0=dup_74,
    Stream1=flatten(data_149),
    Stream2=flatten(dup_74),
    Stream3=flatten(data_149),
    NullGaps=False)

# ----
# scheduleRecord
# Occ
data_188 = Data(flatten(weave_44))  # disabled
rec = DataRecorder(data_188, DataLimit=-10, RecordData=True)  # disabled
panel_544 = Panel(rec)  # disabled

# ----
# LightingDensity of
# residential Units (kWh/sqm)
data_189 = Data(weave_47)

# ----
# indices of all residentials
listdexs_12 = ListIndices(List=geo_87)
dispatch_63 = Dispatch(List=listdexs_12, DispatchPattern=equals_44.Equality)  # -> ListA, ListB

# ----
# Heating set point of Residentials
data_190 = Data(weave_42)

replace_25 = ReplaceItems(List=data_142, Item=data_141, Indices=dispatch_63.ListA, Wrap=False)
replace_26 = ReplaceItems(List=replace_25, Item=data_190, Indices=dispatch_63.ListB, Wrap=False)

# ----
# Occ
data_191 = Data(flatten(weave_44))

# ----
# Heating Set Point
panel_545 = Panel("cullOfficeUnits")
equals_46 = Equality(FirstNumber=data_126, SecondNumber="1")  # -> Equality, Inequality
dispatch_64 = Dispatch(List=replace_26, DispatchPattern=equals_46.Equality)  # -> ListA, ListB

# ----
# V1/V2........
# COOLING-ON
# RESIDENTIAL
panel_546 = Panel("residential units")  # disabled
lb_schedule_4 = GenePool(
    Decimals=0,
    Maximum=100,
    Minimum=25,
    Value=[25, 25, 25, 25, 25, 25, 25, 25, 25, 25, 25, 25, 25, 25, 25, 25, 25, 25, 25, 25, 25, 25, 25, 25])  # disabled
panel_547 = Panel("RESIDENTIAL-COOLING-ON-SCHEDULE")  # disabled
toggle_26 = BooleanToggle(True)  # disabled
panel_548 = Panel("RESIDENTIAL-COOLING-OFF-SCHEDULE")  # disabled
panel_549 = Panel("Temperature")  # disabled
lb_schedule_5 = GenePool(
    Decimals=0,
    Maximum=100.001,
    Minimum=100,
    Value=[100, 100, 100, 100, 100, 100, 100, 100.001, 100.001, 100.001, 100.001, 100.001, 100.001, 100.001, 100.001, 100.001, 100.001, 100.001, 100.001, 100, 100, 100, 100, 100])  # disabled
panel_550 = Panel("15")  # disabled
panel_551 = Panel("10")  # disabled
panel_552 = Panel("4")  # disabled
panel_553 = Panel("RESIDENTIAL_COOLING_SCHEDULE-ANNUAL")  # disabled
annualschedule_30 = Honeybee_AnnualSchedule(
    sun=lb_schedule_5,
    mon=lb_schedule_5,
    tue=lb_schedule_5,
    wed=lb_schedule_5,
    thu=lb_schedule_5,
    fri=lb_schedule_5,
    sat=lb_schedule_5,
    scheduleName=panel_547,
    schedTypeLimits=panel_549,
    runIt=toggle_26)  # -> readMe, port, schedule, port_2, weekSched, schedIDFText; disabled; plug-in component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
analysisperiod_7 = Ladybug_AnalysisPeriod(fromMonth=panel_552, fromDay=panel_550, toMonth=panel_551, toDay=panel_550)  # -> readMe, analysisPeriod; disabled; plug-in component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

toggle_27 = BooleanToggle(False)  # disabled
setepnatvent_3 = Honeybee_SetEPAirFlow(
    HBZones=flatten(dispatch_55.ListA),
    naturalVentilationType=panel_255,
    minIndoorTempForNatVent=panel_257,
    maxIndoorTempForNatVent=panel_254,
    minOutdoorTempForNatVent=panel_258,
    deltaTempForNatVent=panel_256,
    fractionOfGlzAreaOperable=panel_259,
    windDrivenCrossVent=toggle_27)  # -> readMe, simplify(HBZones); disabled; plug-in component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

gethbzoneepschedules = Honeybee_GetZoneEnergyPlusSchedules(HBZone=setepnatvent_3.HBZones)  # -> occupancySchedule, occupancyActivitySch, heatingSetPtSchedule, coolingSetPtSchedule, lightingSchedule, equipmentSchedule, infiltrationSchedule; disabled; plug-in component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
item_152 = ListItem(List=gethbzoneepschedules.occupancySchedule, Index=0, Wrap=True)  # disabled
convertepschvalues_4 = Honeybee_ConvertEnergyPlusScheduleToValues(schName=item_152)  # -> values, holidays; disabled; plug-in component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
strnum_6 = Ladybug_SeparateData(inputList=flatten(convertepschvalues_4.values))  # -> numbers, strings; disabled; plug-in component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
python_38 = GhPythonScript(x=strnum_6.numbers, y=lb_schedule_4)  # -> out, a; disabled
# ---------- python_38: Python ----------
__author__ = "Siser"
__version__ = "2022.03.07"

import rhinoscriptsyntax as rs
if x>0:
    a=y
else:
    a=100
# ---------- end python_38 ----------
annualschedule_31 = Honeybee_AnnualSchedule(
    sun=python_38.a,
    mon=python_38.a,
    tue=python_38.a,
    wed=python_38.a,
    thu=python_38.a,
    fri=python_38.a,
    sat=python_38.a,
    scheduleName=panel_548,
    schedTypeLimits=panel_549,
    runIt=toggle_26)  # -> readMe, port, schedule, port_2, weekSched, schedIDFText; disabled; plug-in component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
honeybee_seasonalschedule_3 = Honeybee_SeasonalSchedule(
    scheduleName=panel_553,
    schedTypeLimits=panel_549,
    baseWeekSched=annualschedule_30.weekSched,
    seasonWeekSched1=annualschedule_31.weekSched,
    analysisPeriod1=analysisperiod_7.analysisPeriod)  # -> readMe, schedule, schedIDFText; disabled; plug-in component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

setepzoneschedules_3 = Honeybee_SetEnergyPlusZoneSchedules(
    HBZones=setepnatvent_3.HBZones,
    heatingSetPtSchedules=weave_41,
    coolingSetPtSchedules=honeybee_seasonalschedule_3.schedule,
    lightingSchedules=item_49)  # -> schedules, simplify(HBZones); disabled; plug-in component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

# ----
# geometry of residential cooling
geo_89 = Geometry(setepzoneschedules_3.HBZones)

# ----
# merge residential units
# (i.e., cooling, non-cooling)
# index-based
replace_27 = ReplaceItems(List=replace_24, Item=geo_89, Indices=dispatch_61.ListA, Wrap=False)

dispatch_65 = Dispatch(List=replace_27, DispatchPattern=data_183)  # -> ListA, ListB

null_11 = NullItem(Item=dispatch_65.ListB)  # -> NullFlags, InvalidFlags, Description
dispatch_66 = Dispatch(List=dispatch_65.ListB, DispatchPattern=null_11.NullFlags)  # -> ListA, ListB

weave_48 = Weave(Pattern=list, Stream0=python_19.a, Stream1=python_19.a, Stream2=item_62, Stream3=item_62, NullGaps=False)
ach2m3_s_m2_calculator_2 = Honeybee_infORventPerAreaCalculator(HBZones=flatten(dispatch_66.ListB), airFlowRate=weave_48, ACHorM3sM2=Toggle(False))  # -> readMe, infPerAreaFacade, ventPerAreaFloor, allExposed, allFloors; plug-in component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

ach2m3_s_m2_calculator_3 = Honeybee_infORventPerAreaCalculator(HBZones=flatten(dispatch_66.ListB), airFlowRate="0.5", ACHorM3sM2=boolean_toggle_2)  # -> readMe, infPerAreaFacade, ventPerAreaFloor, allExposed, allFloors; plug-in component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

# ----
# OFFICE UNITS
# AS-IS
# All office INTERNAL LOAD parameters are based on DEFAULT midriseapartment:office schedule
panel_554 = Panel("0")
setepzoneloads = Honeybee_SetEnergyPlusZoneLoads(
    HBZones=setepzoneschedules.HBZones,
    equipmentLoadPerArea=geteploads.equipmentLoadPerArea,
    infilRatePerArea_Facade=ach2m3_s_m2_calculator_2.infPerAreaFacade,
    lightingDensityPerArea=geteploads.lightingDensityPerArea,
    numOfPeoplePerArea=geteploads.numOfPeoplePerArea,
    ventilationPerArea=geteploads.ventilationPerArea,
    ventilationPerPerson=geteploads.ventilationPerPerson,
    recirculatedAirPerArea=panel_554)  # -> loads, flatten(HBZones); plug-in component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

panel_555 = Panel("# of residential units")
lng_108 = ListLength(List=dispatch_66.ListB)

# ----
# # of people
dup_75 = DuplicateData(Data=geteploads_2.numOfPeoplePerArea, Number=lng_108, Order=True)
weave_49 = Weave(
    Pattern=list,
    Stream0=dup_75,
    Stream1=flatten(branch_17),
    Stream2=flatten(dup_75),
    Stream3=flatten(branch_17),
    NullGaps=False)

# ----
# RESIDENTIAL UNITS
setepzoneloads_2 = Honeybee_SetEnergyPlusZoneLoads(
    HBZones=dispatch_66.ListB,
    equipmentLoadPerArea=weave_46,
    infilRatePerArea_Facade=ach2m3_s_m2_calculator_2.infPerAreaFacade,
    lightingDensityPerArea=weave_47,
    numOfPeoplePerArea=weave_49,
    ventilationPerArea=ach2m3_s_m2_calculator_3.ventPerAreaFloor,
    ventilationPerPerson=panel_274,
    recirculatedAirPerArea="0")  # -> loads, flatten(HBZones); plug-in component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

data_192 = Data(branch_12)
replace_28 = ReplaceItems(List=data_192, Item=setepzoneloads_2.HBZones, Indices=dispatch_62.ListB, Wrap=False)
replace_29 = ReplaceItems(List=replace_28, Item=setepzoneloads.HBZones, Indices=dispatch_62.ListA, Wrap=False)

# ----
# exclude intersected surface's zone
# 
# merge all units
# - unconditioned units are always at the end
merge_115 = Merge(Data1=flatten(replace_29), Data2=flatten(conditionedunconditioned_2.unconditionedZones))
null_12 = NullItem(Item=merge_115)  # -> NullFlags, InvalidFlags, Description
dispatch_67 = Dispatch(List=merge_115, DispatchPattern=null_12.NullFlags)  # -> ListA, ListB

# ----
# construction type division,
# masonry or
# concrete
partition_50 = PartitionList(List=data_146, Size=tstat_5.Length)  # -> simplify(Chunks)
cull_i_33 = CullIndex(List=simplify(partition_50), Indices=simplify(data_94), Wrap=True)  # -> simplify(flatten(List))
item_153 = ListItem(List=cull_i_33, Index=data_116, Wrap=True)
equals_47 = Equality(FirstNumber=item_153, SecondNumber="0")  # -> Equality, Inequality
dispatch_68 = Dispatch(List=dispatch_67.ListB, DispatchPattern=equals_47.Equality)  # -> ListA, ListB

# ----
# if buildings' construction type concrete
geo_90 = Geometry(dispatch_68.ListB)

# ----
# if buildings' construction type masonry
geo_91 = Geometry(dispatch_68.ListA)

# ----
# 10.RESULT RECORDINGS
# AVERAGE
# # of people per building
avr_5 = Average(Input=flatten(weave_49))  # disabled
data_193 = Data(avr_5)  # disabled
rec_2 = DataRecorder(data_193, DataLimit=-10, RecordData=True)  # disabled
panel_556 = Panel(rec_2)  # disabled

# ----
# # of people per sqm at unit
data_194 = Data(flatten(weave_49))  # disabled
rec_3 = DataRecorder(data_194, DataLimit=-10, RecordData=True)  # disabled
panel_557 = Panel(rec_3)  # disabled

python_39 = GhPythonScript(x=equals_47.Equality)  # -> out, a
# ---------- python_39: Python ----------
__author__ = "orcun"
__version__ = "2022.05.06"

import rhinoscriptsyntax as rs
#0: masonry
#1: concrete
if x == True:
    a = 0
else:
    a = 1
# ---------- end python_39 ----------
panel_558 = Panel("""0: masonry
1: concrete""")
weave_50 = Weave(
    Pattern=python_39.a,
    Stream0=decomposeepconstruction_3.UValue_SI,
    Stream1=decomposeepconstruction_2.UValue_SI,
    NullGaps=False)

python_40 = GhPythonScript(x=equals_47.Equality)  # -> out, a; same code as python_39
weave_51 = Weave(
    Pattern=python_40.a,
    Stream0=decomposeepconstruction_5.UValue_SI,
    Stream1=decomposeepconstruction.UValue_SI,
    NullGaps=False)

# ----
# UNITS
data_195 = Data(flatten(weave_49))

# ----
# residential: # of people per sqm
data_196 = Data(weave_49)

data_197 = Data(branch_12)
# # of people per sqm
python_41 = GhPythonScript(x=data_197, y=data_196, z=data_137)  # -> out, a
# ---------- python_41: Python ----------
__author__ = "orcun"
__version__ = "2022.03.30"

import rhinoscriptsyntax as rs
if x == 1:
    a = z
else:
    a = y
# ---------- end python_41 ----------

equals_48 = Equality(FirstNumber=data_197, SecondNumber="1")  # -> Equality, Inequality
dispatch_69 = Dispatch(List=python_41.a, DispatchPattern=equals_48.Equality)  # -> ListA, ListB

# ----
# Insulated
# Flat roof
# Ankara
panel_561 = Panel("Cam yunu cati yalitim")
base_2 = Panel("0.121445")
epopaquemat_4 = Honeybee_EnergyPlusOpaqueMaterial(name="Alci siva", thickness="0.02", conductivity="0.51", density="1200", specificHeat="1090")  # -> EPMaterial; plug-in component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
epopaquemat_5 = Honeybee_EnergyPlusOpaqueMaterial(name="Betonarme", thickness="0.12", conductivity="2.5", density="2400", specificHeat="840")  # -> EPMaterial; plug-in component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

panel_562 = Panel("conductivityOfInsulationMaterial")
data_198 = Data("0.04")

# ----
# R value summation for all other lements of the construction
decomposeepmaterial = Honeybee_DecomposeEPMaterial(materialName=simplify("Betonarme"))  # -> names, values, comments, UValue_SI, UValue_IP, RValue_SI, RValue_IP; plug-in component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
decomposeepmaterial_2 = Honeybee_DecomposeEPMaterial(materialName=simplify("Alci siva"))  # -> names, values, comments, UValue_SI, UValue_IP, RValue_SI, RValue_IP; plug-in component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

merge_116 = Merge(Data2=decomposeepmaterial.RValue_SI, Data3=decomposeepmaterial_2.RValue_SI)
ma_5 = MassAddition(Input=merge_116)  # -> Result, PartialResults

division_13 = Division(A="1", B=data_117)
subtraction_6 = Subtraction(A=division_13, B=ma_5.Result)
multiplication_12 = Multiplication(A=subtraction_6, B=data_198)

thickness_of_insulation_material = Panel(multiplication_12)

data_199 = Data(multiplication_12)

panel_563 = Panel("thickness for u-Roof")
weave_52 = Weave(Pattern=list, Stream0=base_2, Stream1=base_2, Stream2=data_199, Stream3=data_199, NullGaps=False)

epopaquemat_6 = Honeybee_EnergyPlusOpaqueMaterial(name=panel_561, thickness=weave_52, conductivity="0.04", density="18", specificHeat="1030")  # -> EPMaterial; plug-in component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
epconstruction_3 = Honeybee_EnergyPlusConstruction(name=weave_22, layer_1=epopaquemat_6, layer_2=epopaquemat_5, layer_3=epopaquemat_4)  # -> EPConstruction; plug-in component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

# ----
# Thickness of Insulation Material
base_3 = Panel("0.0477")

# ----
# Ankara
# External wall
panel_564 = Panel("dis siva cimento esasli")
epopaquemat_7 = Honeybee_EnergyPlusOpaqueMaterial(name="ic siva alci esasli", thickness="0.02", conductivity="0.51", density="1200", specificHeat="1090")  # -> EPMaterial; plug-in component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
epopaquemat_8 = Honeybee_EnergyPlusOpaqueMaterial(name=panel_564, thickness="0.03", conductivity="1.6", density="2000", specificHeat="840")  # -> EPMaterial; plug-in component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
epopaquemat_9 = Honeybee_EnergyPlusOpaqueMaterial(name="yatay delikli tugla", thickness="0.135", conductivity="0.33", density="600", specificHeat="900")  # -> EPMaterial; plug-in component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

# ----
# R value summation for all other lements of the construction
decomposeepmaterial_3 = Honeybee_DecomposeEPMaterial(materialName=simplify("ic siva alci esasli"))  # -> names, values, comments, UValue_SI, UValue_IP, RValue_SI, RValue_IP; plug-in component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
decomposeepmaterial_4 = Honeybee_DecomposeEPMaterial(materialName=simplify(panel_564))  # -> names, values, comments, UValue_SI, UValue_IP, RValue_SI, RValue_IP; plug-in component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
decomposeepmaterial_5 = Honeybee_DecomposeEPMaterial(materialName=simplify("yatay delikli tugla"))  # -> names, values, comments, UValue_SI, UValue_IP, RValue_SI, RValue_IP; plug-in component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

merge_117 = Merge(Data1=decomposeepmaterial_4.RValue_SI, Data2=decomposeepmaterial_5.RValue_SI, Data3=decomposeepmaterial_3.RValue_SI)
ma_6 = MassAddition(Input=merge_117)  # -> Result, PartialResults

data_200 = Data("0.035")

division_14 = Division(A="1", B=data_118)
subtraction_7 = Subtraction(A=division_14, B=ma_6.Result)
multiplication_13 = Multiplication(A=subtraction_7, B=data_200)

data_201 = Data(multiplication_13)

panel_566 = Panel("thickness for u-Wall")
# Versions
weave_53 = Weave(Pattern=list, Stream0=base_3, Stream1=base_3, Stream2=data_201, Stream3=data_201, NullGaps=False)

epopaquemat_10 = Honeybee_EnergyPlusOpaqueMaterial(name="EPS", thickness=weave_53, conductivity="0.035", density="22", specificHeat="1500")  # -> EPMaterial; plug-in component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
epconstruction_4 = Honeybee_EnergyPlusConstruction(name=weave_23, layer_1=epopaquemat_8, layer_2=epopaquemat_10, layer_3=epopaquemat_9, layer_4=epopaquemat_7)  # -> EPConstruction; plug-in component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

thickness_of_insulation_material_2 = Panel(multiplication_13)

data_202 = Data("0.035")

# ----
# thickness for Ground Floor
base_4 = Panel("0.058774")

# ----
# V1-Masonry Construction Set
# V1-Concrete Construction Set
setepzonecnstr = Honeybee_SetEPZoneConstruction(HBZones=flatten(geo_90), wallEPConstruction=epconstruction_4, roofEPConstruction=epconstruction_3)  # -> simplify(modifiedHBZones); plug-in component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

# ----
# references: https://docs.google.com/spreadsheets/d/1WwH0E2wul-ns8CfgSEfoPrmkpj9kjO-c/edit#gid=1172685997
# Thickness of Insulation Material
base_5 = Panel("0.05")

epopaquemat_11 = Honeybee_EnergyPlusOpaqueMaterial(name="externalPlaster", thickness="0.02", conductivity="0.721", density="1762", specificHeat="840")  # -> EPMaterial; plug-in component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
epopaquemat_12 = Honeybee_EnergyPlusOpaqueMaterial(name="internalPlaster", thickness="0.02", conductivity="0.51", density="1200", specificHeat="840")  # -> EPMaterial; plug-in component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
epopaquemat_13 = Honeybee_EnergyPlusOpaqueMaterial(name="solidBrick", thickness="0.2", conductivity="0.5", density="1200", specificHeat="800")  # -> EPMaterial; plug-in component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

# ----
# R value summation for all other lements of the construction
decomposeepmaterial_6 = Honeybee_DecomposeEPMaterial(materialName=simplify("internalPlaster"))  # -> names, values, comments, UValue_SI, UValue_IP, RValue_SI, RValue_IP; plug-in component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
decomposeepmaterial_7 = Honeybee_DecomposeEPMaterial(materialName=simplify("externalPlaster"))  # -> names, values, comments, UValue_SI, UValue_IP, RValue_SI, RValue_IP; plug-in component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
decomposeepmaterial_8 = Honeybee_DecomposeEPMaterial(materialName=simplify("solidBrick"))  # -> names, values, comments, UValue_SI, UValue_IP, RValue_SI, RValue_IP; plug-in component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

merge_118 = Merge(Data1=decomposeepmaterial_7.RValue_SI, Data2=decomposeepmaterial_8.RValue_SI, Data3=decomposeepmaterial_6.RValue_SI)
ma_7 = MassAddition(Input=merge_118)  # -> Result, PartialResults

data_203 = Data("0.035")

division_15 = Division(A="1", B=data_119)
subtraction_8 = Subtraction(A=division_15, B=ma_7.Result)
multiplication_14 = Multiplication(A=subtraction_8, B=data_203)

data_204 = Data(multiplication_14)

epopaquemat_14 = Honeybee_EnergyPlusOpaqueMaterial(name="EPS", thickness=data_204, conductivity="0.035", density="22", specificHeat="1400")  # -> EPMaterial; plug-in component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
epconstruction_5 = Honeybee_EnergyPlusConstruction(name=weave_24, layer_1=epopaquemat_11, layer_2=epopaquemat_14, layer_3=epopaquemat_13, layer_4=epopaquemat_12)  # -> EPConstruction; plug-in component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

thickness_of_insulation_material_3 = Panel(multiplication_14)

# ----
# Ground Floor
panel_569 = Panel("kece polyester")
epopaquemat_15 = Honeybee_EnergyPlusOpaqueMaterial(name=panel_569, thickness="0.003", conductivity="0.19", density="25", specificHeat="1500")  # -> EPMaterial; plug-in component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
epopaquemat_16 = Honeybee_EnergyPlusOpaqueMaterial(name="koruma sapi", thickness="0.05", conductivity="1.4", density="2000", specificHeat="837")  # -> EPMaterial; plug-in component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
epopaquemat_17 = Honeybee_EnergyPlusOpaqueMaterial(name="laminant parke", thickness="0.008", conductivity="0.115", density="938", specificHeat="1600")  # -> EPMaterial; plug-in component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
epopaquemat_18 = Honeybee_EnergyPlusOpaqueMaterial(name="Su yalitimi", thickness="0.003", conductivity="0.19", density="3000", specificHeat="780")  # -> EPMaterial; plug-in component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
epopaquemat_19 = Honeybee_EnergyPlusOpaqueMaterial(name="Dolgu cakil", thickness="0.1", conductivity="2.0", density="2000", specificHeat="840")  # -> EPMaterial; plug-in component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
epopaquemat_20 = Honeybee_EnergyPlusOpaqueMaterial(name="Grobeton", thickness="0.1", conductivity="1.65", density="2200", specificHeat="860")  # -> EPMaterial; plug-in component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
epopaquemat_21 = Honeybee_EnergyPlusOpaqueMaterial(name="Koruma betonu", thickness="0.1", conductivity="1.65", density="2200", specificHeat="860")  # -> EPMaterial; plug-in component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

# ----
# R value summation for all other lements of the construction
decomposeepmaterial_9 = Honeybee_DecomposeEPMaterial(materialName=simplify("Su yalitimi"))  # -> names, values, comments, UValue_SI, UValue_IP, RValue_SI, RValue_IP; plug-in component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
decomposeepmaterial_10 = Honeybee_DecomposeEPMaterial(materialName=simplify("Dolgu cakil"))  # -> names, values, comments, UValue_SI, UValue_IP, RValue_SI, RValue_IP; plug-in component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
decomposeepmaterial_11 = Honeybee_DecomposeEPMaterial(materialName=simplify(panel_569))  # -> names, values, comments, UValue_SI, UValue_IP, RValue_SI, RValue_IP; plug-in component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
decomposeepmaterial_12 = Honeybee_DecomposeEPMaterial(materialName=simplify("Grobeton"))  # -> names, values, comments, UValue_SI, UValue_IP, RValue_SI, RValue_IP; plug-in component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
decomposeepmaterial_13 = Honeybee_DecomposeEPMaterial(materialName=simplify(panel_569))  # -> names, values, comments, UValue_SI, UValue_IP, RValue_SI, RValue_IP; plug-in component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
decomposeepmaterial_14 = Honeybee_DecomposeEPMaterial(materialName=simplify("laminant parke"))  # -> names, values, comments, UValue_SI, UValue_IP, RValue_SI, RValue_IP; plug-in component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
decomposeepmaterial_15 = Honeybee_DecomposeEPMaterial(materialName=simplify("Koruma betonu"))  # -> names, values, comments, UValue_SI, UValue_IP, RValue_SI, RValue_IP; plug-in component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
decomposeepmaterial_16 = Honeybee_DecomposeEPMaterial(materialName=simplify("koruma sapi"))  # -> names, values, comments, UValue_SI, UValue_IP, RValue_SI, RValue_IP; plug-in component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

merge_119 = Merge(
    Data1=decomposeepmaterial_10.RValue_SI,
    Data2=decomposeepmaterial_12.RValue_SI,
    Data3=decomposeepmaterial_9.RValue_SI,
    Data4=decomposeepmaterial_15.RValue_SI,
    Data5=decomposeepmaterial_11.RValue_SI,
    Data6=decomposeepmaterial_13.RValue_SI,
    Data7=decomposeepmaterial_16.RValue_SI,
    Data8=decomposeepmaterial_14.RValue_SI)
ma_8 = MassAddition(Input=merge_119)  # -> Result, PartialResults

division_16 = Division(A="1", B=data_123)
subtraction_9 = Subtraction(A=division_16, B=ma_8.Result)
multiplication_15 = Multiplication(A=subtraction_9, B=data_202)

weave_54 = Weave(Pattern=list, Stream0=base_4, Stream1=base_4, Stream2=multiplication_15, Stream3=multiplication_15, NullGaps=False)

epopaquemat_22 = Honeybee_EnergyPlusOpaqueMaterial(name="XPS", thickness=weave_54, conductivity="0.035", density="25", specificHeat="1200")  # -> EPMaterial; plug-in component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
epconstruction_6 = Honeybee_EnergyPlusConstruction(
    name=weave_25,
    layer_1=epopaquemat_19,
    layer_2=epopaquemat_20,
    layer_3=epopaquemat_18,
    layer_4=epopaquemat_21,
    layer_5=epopaquemat_22,
    layer_6=epopaquemat_15,
    layer_7=epopaquemat_16,
    layer_8=epopaquemat_17)  # -> EPConstruction; plug-in component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

thickness_of_insulation_material_4 = Panel(multiplication_15)

# ----
# Internal Mass Calculation
md_slider_7 = MDSlider(SliderMode=0, slider_value=Point(0.5, 0.5, 0.5), x_domain=Domain(0, 1), y_domain=Domain(0, 1), z_domain=Domain(0, 1))
panel_570 = Panel("""0
2""")
floor_height_6 = Panel("3")

division_17 = Division(A="1", B=data_120)

# ----
# references: https://docs.google.com/spreadsheets/d/1WwH0E2wul-ns8CfgSEfoPrmkpj9kjO-c/edit#gid=1172685997
panel_572 = Panel("reinforcedConcrete")
panel_573 = Panel("0.08")
epopaquemat_23 = Honeybee_EnergyPlusOpaqueMaterial(name=panel_572, thickness="0.12", conductivity="2.5", density="2400", specificHeat="860")  # -> EPMaterial; plug-in component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
epopaquemat_24 = Honeybee_EnergyPlusOpaqueMaterial(name="externalPlaster", thickness="0.02", conductivity="0.721", density="1762", specificHeat="840")  # -> EPMaterial; plug-in component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
epopaquemat_25 = Honeybee_EnergyPlusOpaqueMaterial(name="interPlaster", thickness="0.02", conductivity="0.51", density="1200", specificHeat="840")  # -> EPMaterial; plug-in component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

# ----
# R value summation for all other lements of the construction
decomposeepmaterial_17 = Honeybee_DecomposeEPMaterial(materialName=simplify("interPlaster"))  # -> names, values, comments, UValue_SI, UValue_IP, RValue_SI, RValue_IP; plug-in component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
decomposeepmaterial_18 = Honeybee_DecomposeEPMaterial(materialName=simplify("externalPlaster"))  # -> names, values, comments, UValue_SI, UValue_IP, RValue_SI, RValue_IP; plug-in component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
decomposeepmaterial_19 = Honeybee_DecomposeEPMaterial(materialName=simplify(panel_572))  # -> names, values, comments, UValue_SI, UValue_IP, RValue_SI, RValue_IP; plug-in component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

merge_120 = Merge(Data1=decomposeepmaterial_18.RValue_SI, Data2=decomposeepmaterial_19.RValue_SI, Data3=decomposeepmaterial_17.RValue_SI)
ma_9 = MassAddition(Input=merge_120)  # -> Result, PartialResults

data_205 = Data("0.04")

subtraction_10 = Subtraction(A=division_17, B=ma_9.Result)
multiplication_16 = Multiplication(A=subtraction_10, B=data_205)

# ----
# u-valueCalculationofMaterial: Where R = Material Thickness (m) ÷ Thermal Conductivity (W/mK)
# 
# 
# https://www.tatasteeleurope.com/construction/blogs-news/blogs/blog/how-to-calculate-the-u-value-of-a-construction
thickness_of_insulation_material_5 = Panel(multiplication_16)

data_206 = Data(multiplication_16)
epopaquemat_26 = Honeybee_EnergyPlusOpaqueMaterial(name="glassWool", thickness=data_206, conductivity="0.04", density="18", specificHeat="670")  # -> EPMaterial; plug-in component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
epconstruction_7 = Honeybee_EnergyPlusConstruction(name=weave_26, layer_1=epopaquemat_24, layer_2=epopaquemat_26, layer_3=epopaquemat_23, layer_4=epopaquemat_25)  # -> EPConstruction; plug-in component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

setepzonecnstr_2 = Honeybee_SetEPZoneConstruction(HBZones=flatten(geo_91), wallEPConstruction=epconstruction_5, roofEPConstruction=epconstruction_7)  # -> simplify(modifiedHBZones); plug-in component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
merge_121 = Merge(Data1=setepzonecnstr_2, Data2=setepzonecnstr)  # -> flatten(Result)
null_13 = NullItem(Item=merge_121)  # -> NullFlags, InvalidFlags, Description
dispatch_70 = Dispatch(List=merge_121, DispatchPattern=null_13.NullFlags)  # -> ListA, ListB
setepzoneundergroundcnstr = Honeybee_SetEPZoneUndergroundConstruction(HBZones=dispatch_70.ListB, groundFloorEPConstruction=epconstruction_6)  # -> simplify(modifiedHBZones); plug-in component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
setepzoneintcnstr = Honeybee_SetEPZoneInteriorConstruction(HBZones=setepzoneundergroundcnstr, intWallEPConstruction=epconstruction)  # -> simplify(modifiedHBZones); plug-in component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
conditionedunconditioned_3 = Honeybee_SeparateConditionedAndUnconditionedZones(HBZones=flatten(setepzoneintcnstr))  # -> conditionedZones, unconditionedZones; plug-in component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

conditionedunconditioned_4 = Honeybee_SeparateConditionedAndUnconditionedZones(HBZones=flatten(dispatch_70.ListB))  # -> conditionedZones, unconditionedZones; plug-in component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
panel_574 = Panel("simulated thermal zones")

lng_109 = ListLength(List=dispatch_70.ListB)
data_207 = Data(filename)
dup_76 = DuplicateData(Data=data_207, Number=lng_109, Order=True)
rec_4 = DataRecorder(dup_76, DataLimit=-10, RecordData=True)
panel_575 = Panel(rec_4)

debrep_17 = DeconstructBrep(Brep=conditionedunconditioned_3.conditionedZones)  # -> Faces, Edges, Vertices
item_154 = ListItem(List=debrep_17.Faces, Index=0, Wrap=True)  # -> simplify(graft(Item))
evalsrf_4 = EvaluateSurface(Surface=item_154, Point=md_slider_7)  # -> Point, Normal, UDirection, VDirection, Frame
brec_9 = BoundingRectangle(Geometry=item_154, Plane=evalsrf_4.Frame, Axis=0, Slide=0, Union=True)  # -> Bounding, DimensionX, DimensionY
debrep_18 = DeconstructBrep(Brep=brec_9.Bounding)  # -> Faces, Edges, Vertices
shift_5 = ShiftList(List=debrep_18.Edges, Shift=1, Wrap=True)
item_155 = ListItem(List=debrep_18.Edges, Index=panel_570, Wrap=True)  # -> simplify(Item)
item_156 = ListItem(List=shift_5, Index=panel_570, Wrap=True)  # -> simplify(Item)
curvepoint_6 = PointOnCurve(item_155, parameter=0.5)
curvepoint_7 = PointOnCurve(item_156, parameter=0.5)
item_157 = ListItem(List=curvepoint_6, Index=1, Wrap=True)
item_158 = ListItem(List=curvepoint_7, Index=0, Wrap=True)
item_159 = ListItem(List=curvepoint_7, Index=1, Wrap=True)
item_160 = ListItem(List=curvepoint_6, Index=0, Wrap=True)
ln_3 = Line(StartPoint=item_158, EndPoint=item_159)  # -> simplify(Line)
ln_4 = Line(StartPoint=item_160, EndPoint=item_157)  # -> simplify(Line)
len_3 = Length(Curve=ln_3)  # -> simplify(Length)
len_4 = Length(Curve=ln_4)
division_18 = Division(A=simplify(len_3), B="2")  # -> simplify(Result)

tstat_22 = TreeStatistics(Tree=simplify(len_4))  # -> Paths, Length, Count
tstat_23 = TreeStatistics(Tree=simplify(division_18))  # -> Paths, Length, Count
panel_576 = Panel("replace Path")
replace_30 = ReplacePaths(Data=division_18, Search=tstat_23.Paths, Replace=tstat_22.Paths)

merge_122 = Merge(Data1=simplify(len_4), Data2=simplify(replace_30))  # -> simplify(Result)
ma_10 = MassAddition(Input=merge_122)  # -> Result, PartialResults
multiplication_17 = Multiplication(A=ma_10.Result, B=floor_height_6)  # -> flatten(Result)

# ----
# internal Mass Added Units
addinternalmass = Honeybee_AddInternalMassToZone(HBZones=conditionedunconditioned_3.conditionedZones, srfsOrSrfArea=multiplication_17, EPConstruction=epconstruction)  # -> readMe, HBZones; plug-in component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
merge_123 = Merge(Data1=flatten(addinternalmass.HBZones), Data2=flatten(conditionedunconditioned_3.unconditionedZones))

# ----
# 07.CONSTRUCTION
# FOR ENERGY MODELING
null_14 = NullItem(Item=merge_123)  # -> NullFlags, InvalidFlags, Description
dispatch_71 = Dispatch(List=merge_123, DispatchPattern=null_14.NullFlags)  # -> ListA, ListB

geo_92 = Geometry(dispatch_71.ListB)  # disabled
volume_3 = Volume(Geometry=geo_92)  # -> Volume, Centroid; disabled
pdecon_13 = Deconstruct(Point=volume_3.Centroid)  # -> XComponent, YComponent, ZComponent; disabled
sort_28 = SortList(Keys=pdecon_13.ZComponent, ValuesA=geo_92)  # -> Keys, ValuesA; disabled

# ----
# sort conditioned zones according to z-axis value
# # of unit per floor
lng_110 = ListLength(List=sort_28.ValuesA)  # disabled
division_19 = Division(A=lng_110, B=lng_89)  # disabled
partition_51 = PartitionList(List=sort_28.ValuesA, Size=division_19)  # -> simplify(Chunks); disabled

volume_4 = Volume(Geometry=partition_51)  # -> Volume, Centroid; disabled
area_65 = Area(Geometry=geo_74)  # -> Area, Centroid; disabled
circle_3 = CircleCNR(Center=area_65.Centroid, Normal=Vector(0, 0, 1), Radius=1)  # disabled
alongcrv_2 = SortAlongCurve(Points=volume_4.Centroid, Curve=circle_3)  # -> Points, simplify(Indices); disabled

# ----
# start bottom-left
# return counter clockwise
item_161 = ListItem(List=partition_51, Index=alongcrv_2.Indices, Wrap=True)  # disabled

volume_5 = Volume(Geometry=item_161)  # -> Volume, Centroid; disabled
pdecon_14 = Deconstruct(Point=volume_5.Centroid)  # -> XComponent, YComponent, ZComponent; disabled
addition_8 = Addition(A=pdecon_14.XComponent, B=pdecon_14.YComponent)  # disabled
sort_29 = SortList(Keys=addition_8, ValuesA=volume_5.Centroid)  # -> Keys, ValuesA; disabled
item_162 = ListItem(List=sort_29.ValuesA, Index=0, Wrap=True)  # -> simplify(Item); disabled

lng_111 = ListLength(List=item_161)  # disabled
panel_577 = Panel("0")  # disabled
branch_24 = TreeBranch(Tree=simplify(item_161), Path=panel_577, MaintainPaths=True)  # disabled
python_42 = GhPythonScript(x=lng_111)  # -> out, a; disabled
# ---------- python_42: Python ----------
__author__ = "orcun"
__version__ = "2022.03.23"

import rhinoscriptsyntax as rs
if x == 1:
    a = 1
else:
    a = 0
# ---------- end python_42 ----------
weave_55 = Weave(Pattern=python_42.a, Stream0=branch_24, Stream1=item_161, NullGaps=False)  # disabled

panel_578 = Panel("0")  # disabled
lng_112 = ListLength(List=item_162)  # disabled
branch_25 = TreeBranch(Tree=item_162, Path=panel_578, MaintainPaths=True)  # disabled
python_43 = GhPythonScript(x=lng_112)  # -> out, a; disabled; same code as python_42
weave_56 = Weave(Pattern=python_43.a, Stream0=branch_25, Stream1=item_162, NullGaps=False)  # disabled

volume_6 = Volume(Geometry=weave_55)  # -> Volume, Centroid; disabled
cp_6 = ClosestPoint(Point=weave_56, Cloud=volume_6.Centroid)  # -> ClosestPoint, CPIndex, Distance; disabled

# ----
# start bottom-left
# return counter clockwise
shift_6 = ShiftList(List=item_161, Shift=cp_6.CPIndex, Wrap=True)  # disabled

panel_579 = Panel("simulation units")  # disabled
merge_124 = Merge(Data1=flatten(shift_6), Data2=conditionedunconditioned_3.unconditionedZones)  # -> flatten(Result); disabled

conditionedunconditioned_5 = Honeybee_SeparateConditionedAndUnconditionedZones(HBZones=flatten(dispatch_71.ListB))  # -> conditionedZones, unconditionedZones; plug-in component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

conditionedunconditioned_6 = Honeybee_SeparateConditionedAndUnconditionedZones(HBZones=flatten(dispatch_71.ListB))  # -> conditionedZones, unconditionedZones; plug-in component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

conditionedunconditioned_7 = Honeybee_SeparateConditionedAndUnconditionedZones(HBZones=flatten(dispatch_71.ListB))  # -> simplify(conditionedZones), unconditionedZones; plug-in component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
decomposebytype = Honeybee_DecomposeBasedOnType(HBZone=conditionedunconditioned_7.conditionedZones)  # -> walls, interiorWalls, airWalls, simplify(windows), interiorWindows, skylights, simplify(roofs), simplify(ceilings)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; plug-in component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

# ----
# x
# x
# x
# x
# x
# x
# x
# x
# x
# x
# x
# x
# x
# x
# x
# x
# x
# x
# x
# x
# x
# x
# x
# x
# x
# x
# x
# 
# x
# x
# x
# x
# x
# x
# 
# x
# x
# x
# x
# x
# 
# x
# x
# x
# x
# x
# x
# 
# x
# x
# x
# x
panel_582 = Panel("conditioned zones")
data_208 = Data(conditionedunconditioned_7.conditionedZones)
decomposebytype_2 = Honeybee_DecomposeBasedOnType(HBZone=data_208)  # -> walls, interiorWalls, airWalls, simplify(windows), interiorWindows, skylights, simplify(roofs), simplify(ceilings)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; plug-in component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

area_66 = Area(Geometry=decomposebytype_2.windows)  # -> Area, Centroid
evalsrf_5 = EvaluateSurface(Surface=decomposebytype_2.windows, Point=area_66.Centroid)  # -> Point, Normal, UDirection, VDirection, Frame
vec = Vector(evalsrf_5.Normal)
vdis = VectorDisplay(Anchor=area_66.Centroid, Vector=vec)

area_67 = Area(Geometry=decomposebytype_2.windows)  # -> Area, Centroid
circle_4 = CircleCNR(Center=area_67.Centroid, Normal=vec, Radius=1)
rotate = RotateDirection(Geometry=circle_4, Center=area_67.Centroid, From=Vector(1, 0, 0), To=Vector(0, 1, 0))  # -> Geometry, Transform
line = LineSDL(Start=area_66.Centroid, Direction=vec, Length=1)
rotax = RotateAxis(Geometry=rotate.Geometry, Angle=degrees("90"), Axis=line)  # -> Geometry, Transform
area_68 = Area(Geometry=rotax.Geometry)  # -> Area, Centroid

srf_3 = Surface(decomposebytype_2.windows)
split_23 = SplitWithBreps(Curve=rotax.Geometry, Brep=srf_3)  # -> Curve, Points
divide_5 = DivideCurve(Curve=split_23.Curve, Count="13", Kinks=False)  # -> Points, Tangents, Parameters
pshift = ShiftPaths(Data=divide_5.Points, Offset=-1)
brepsinc = PointInBreps(Brep=conditionedunconditioned_7.conditionedZones, Point=pshift, Strict=False)  # -> Inside, Index
dispatch_72 = Dispatch(List=pshift, DispatchPattern=brepsinc.Inside)  # -> ListA, ListB

lng_113 = ListLength(List=flatten(conditionedunconditioned_7.conditionedZones))
panel_583 = Panel("#OfUnits")
dup_77 = DuplicateData(Data="0", Number=lng_113, Order=True)

lng_114 = ListLength(List=decomposebytype.roofs)  # -> flatten(Length)

lng_115 = ListLength(List=decomposebytype.groundFloors)  # -> flatten(Length)

dup_78 = DuplicateData(Data="0", Number=lng_115, Order=True)  # -> simplify(Data)
dup_79 = DuplicateData(Data="2", Number=lng_114, Order=True)  # -> simplify(Data)
merge_125 = Merge(Data1=dup_79, Data2=dup_78)

lng_116 = ListLength(List=merge_125)  # -> flatten(Length)
# position of units
# (0:base, 1: middle, 2:roof)
rep_2 = ReplaceText(Text=lng_116, Find="3", Replace="0", RecursiveReplace=False)
mindex_9 = MemberIndex(Set=rep_2, Member="0")  # -> Index, Count
lng_117 = ListLength(List=mindex_9.Index)
dup_80 = DuplicateData(Data="3", Number=lng_117, Order=True)
partition_52 = PartitionList(List=dup_80, Size="1")  # -> simplify(Chunks)
tstat_24 = TreeStatistics(Tree=partition_52)  # -> Paths, Length, Count
replace_31 = ReplacePaths(Data=partition_52, Search=tstat_24.Paths, Replace=mindex_9.Index)
python_44 = GhPythonScript(x=replace_31)  # -> out, a; inputs x: Int32
# ---------- python_44: Python ----------
__author__ = "Siser"
__version__ = "2022.03.02"

import rhinoscriptsyntax as rs
if x == 3:
    a = 1
else:
    pass
# ---------- end python_44 ----------

area_69 = Area(Geometry=decomposebytype.windows)  # -> Area, Centroid
panel_584 = Panel("Window")

panel_585 = Panel(area_67.Centroid)
pdecon_15 = Deconstruct(Point=panel_585)  # -> XComponent, YComponent, graft(ZComponent)
panel_586 = Panel(pdecon_15.ZComponent)

tstat_25 = TreeStatistics(Tree=area_69.Centroid)  # -> Paths, Length, Count
series_50 = Series(Start=0, Step=1, Count="4")
lng_118 = ListLength(List=tstat_25.Length)
dup_81 = DuplicateData(Data=series_50, Number=lng_118, Order=True)
partition_53 = PartitionList(List=dup_81, Size="4")  # -> simplify(Chunks)

panel_587 = Panel("conditioned residential units")
geo_93 = Geometry(conditionedunconditioned_7.conditionedZones)

lng_119 = ListLength(List=dup_81)
dup_82 = DuplicateData(Data="5", Number=lng_119, Order=True)
partition_54 = PartitionList(List=dup_82, Size="4")  # -> simplify(Chunks)

debrep_19 = DeconstructBrep(Brep=geo_93)  # -> Faces, Edges, Vertices
item_163 = ListItem(List=debrep_19.Faces, Index=0, Wrap=True)
evalsrf_6 = EvaluateSurface(Surface=reparameterize(item_163), Point="{0.5, 0.5, 0}")  # -> Point, Normal, UDirection, VDirection, Frame
brec_10 = BoundingRectangle(Geometry=item_163, Plane=evalsrf_6.Frame, Axis=0, Slide=0, Union=True)  # -> Bounding, DimensionX, DimensionY

merge_126 = Merge(Data1=merge_125, Data2=python_44.a)  # -> flatten(Result)
panel_588 = Panel(merge_126)
null_15 = NullItem(Item=merge_126)  # -> NullFlags, InvalidFlags, Description
dispatch_73 = Dispatch(List=merge_126, DispatchPattern=null_15.NullFlags)  # -> ListA, ListB

debrep_20 = DeconstructBrep(Brep=brec_10.Bounding)  # -> Faces, simplify(Edges), Vertices
curvepoint_8 = PointOnCurve(debrep_20.Edges, parameter=0.5)
pdecon_16 = Deconstruct(Point=curvepoint_8)  # -> XComponent, YComponent, ZComponent
sort_30 = SortList(Keys=pdecon_16.YComponent, ValuesA=debrep_20.Edges)  # -> Keys, reverse(simplify(ValuesA))
item_164 = ListItem(List=sort_30.ValuesA, Index=0, Wrap=True)
item_165 = ListItem(List=sort_30.ValuesA, Index=1, Wrap=True)
len_5 = Length(Curve=item_164)
len_6 = Length(Curve=item_165)
division_20 = Division(A=len_5, B=len_6)  # -> flatten(Result)

panel_589 = Panel("external Wall")
geo_94 = Geometry(simplify(decomposebytype.walls))

panel_590 = Panel("roof")
geo_95 = Geometry(decomposebytype.roofs)

# ----
# volume of simulated unit
volume_7 = Volume(Geometry=conditionedunconditioned_7.conditionedZones)  # -> Volume, Centroid

merge_127 = Merge(Data1=geo_94, Data2=geo_95)
area_70 = Area(Geometry=merge_127)  # -> Area, Centroid
ma_11 = MassAddition(Input=area_70.Area)  # -> flatten(Result), PartialResults
division_21 = Division(A=ma_11.Result, B=volume_7.Volume)

panel_591 = Panel("simulation units")
geo_96 = Geometry(dispatch_71.ListB)

# ----
# IC
debrep_21 = DeconstructBrep(Brep=geo_96)  # -> Faces, Edges, Vertices
# 09.SIMULATION
area_71 = Area(Geometry=simplify(debrep_21.Faces))  # -> Area, Centroid
pdecon_17 = Deconstruct(Point=area_71.Centroid)  # -> XComponent, YComponent, ZComponent
sort_31 = SortList(Keys=pdecon_17.ZComponent)  # -> Keys, ValuesA
dcon_9 = DeleteConsecutive(Set=sort_31.Keys, Wrap=False)  # -> Set, Count
item_166 = ListItem(List=dcon_9.Set, Index=0, Wrap=True)
equals_49 = Equality(FirstNumber=pdecon_17.ZComponent, SecondNumber=item_166)  # -> Equality, Inequality
dispatch_74 = Dispatch(List=simplify(debrep_21.Faces), DispatchPattern=simplify(equals_49.Equality))  # -> ListA, ListB
sunion_5 = SolidUnion(Breps=dispatch_74.ListA)
disc_21 = Discontinuity(Curve=sunion_5, Level=1)  # -> Points, Parameters
pline_9 = PolyLine(Vertices=disc_21.Points, Closed=Toggle(True))  # -> flatten(Polyline)

decomposebytype_3 = Honeybee_DecomposeBasedOnType(HBZone=geo_96)  # -> simplify(walls), interiorWalls, airWalls, simplify(windows), interiorWindows, skylights, simplify(roofs), simplify(ceilings)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; plug-in component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
preview_21 = CustomPreview(Geometry=decomposebytype_3.windows, Material=ColourSwatch(SwatchColor=RGB(0, 72, 255)))
preview_22 = CustomPreview(Geometry=decomposebytype_3.floors, Material=ColourSwatch(SwatchColor=RGB(48, 191, 0)))
preview_23 = CustomPreview(Geometry=decomposebytype_3.walls, Material=ColourSwatch(SwatchColor=RGBA(236, 255, 23, 138)))
preview_24 = CustomPreview(Geometry=decomposebytype_3.roofs, Material=ColourSwatch(SwatchColor=RGBA(191, 89, 0, 174)))
preview_25 = CustomPreview(Geometry=decomposebytype_3.interiorWalls, Material=ColourSwatch(SwatchColor=RGB(121, 0, 191)))
preview_26 = CustomPreview(Geometry=decomposebytype_3.groundFloors, Material=ColourSwatch(SwatchColor=RGB(0, 0, 0)))

zoneattributelist = Honeybee_ZoneAttributeList({"Name": "name", "Zone Program": "zoneProgram", "Zone Floor Area": "zoneFloorArea", "Zone Volume": "zoneVolume", "Building Program": "bldgProgram", "Is Conditioned": "isConditioned", "HVAC System Type": "HVACSystem", "Occupancy Schedule": "occupancySchedule", "Occupancy Activity Schedule": "occupancyActivitySch", "Heating SetPoint Schedule": "heatingSetPtSchedule"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}, selected="Name")
labelzones = Honeybee_LabelZones(HBZones=flatten(geo_96), attribute=zoneattributelist)  # -> zoneTxtLabels, labelBasePts, brepTxtLabels, zoneWireFrames; plug-in component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

panel_592 = Panel("conditioned HBzones")
geo_97 = Geometry(conditionedunconditioned_7.conditionedZones)

debrep_22 = DeconstructBrep(Brep=geo_97)  # -> Faces, Edges, Vertices
item_167 = ListItem(List=debrep_22.Faces, Index=0, Wrap=True)

panel_593 = Panel("simulated units")
geo_98 = Geometry(conditionedunconditioned_7.conditionedZones)

area_72 = Area(Geometry=item_167)  # -> simplify(flatten(Area)), Centroid

# ----
# total # of residential units
lng_120 = ListLength(List=geo_96)

# ----
# total # of residential units
lng_121 = ListLength(List=geo_96)  # disabled

# ----
# If there is a single unit in the building
lng_122 = ListLength(List=geo_96)
equals_50 = Equality(FirstNumber=lng_122, SecondNumber="2")  # -> Equality, Inequality
data_209 = Data(flatten(dispatch_73.ListB))
python_45 = GhPythonScript(x=equals_50.Equality)  # -> out, a; inputs x: Boolean
# ---------- python_45: Python ----------
__author__ = "orcun"
__version__ = "2022.04.06"

import rhinoscriptsyntax as rs
if x == True:
    a = 0
else:
    a=1
# ---------- end python_45 ----------
weave_57 = Weave(Pattern=python_45.a, Stream0="0", Stream1=data_209, NullGaps=False)

panel_595 = Panel("# of units")
lng_123 = ListLength(List=conditionedunconditioned_7.conditionedZones)

# ----
# U-value-Wall of Building
# BUILDING
panel_596 = Panel("3")
roundd = RoundToDecimalPlace(NumberX=weave_50, DecimalPlace=panel_596, RoundType=0)  # -> Rounded, Difference
lng_124 = ListLength(List=conditionedunconditioned_7.conditionedZones)
dup_83 = DuplicateData(Data=roundd.Rounded, Number=lng_124, Order=True)

# ----
# U-value-Roof of Building
panel_597 = Panel("3")
roundd_2 = RoundToDecimalPlace(NumberX=weave_51, DecimalPlace=panel_597, RoundType=0)  # -> Rounded, Difference
lng_125 = ListLength(List=conditionedunconditioned_7.conditionedZones)
dup_84 = DuplicateData(Data=roundd_2.Rounded, Number=lng_125, Order=True)

# ----
# If there is an one floor with multiple units
python_46 = GhPythonScript(x=item_99, y=lng_123)  # -> out, a; inputs x: Int32, y: Int32
# ---------- python_46: Python ----------
__author__ = "orcun"
__version__ = "2022.04.06"

import rhinoscriptsyntax as rs
if x == 1 and y!=0:
    a = 1
else:
    a=0
# ---------- end python_46 ----------

# ----
# Width/Depth ratio of
# Simulated Units
data_210 = Data(division_20)

partition_55 = PartitionList(List=data_135, Size=data_133)  # -> simplify(Chunks)
cull_i_34 = CullIndex(List=partition_55, Indices=data_134, Wrap=True)  # -> flatten(List)
item_168 = ListItem(List=cull_i_34, Index=filename, Wrap=True)
lng_126 = ListLength(List=conditionedunconditioned_7.conditionedZones)
dup_85 = DuplicateData(Data=flatten(item_168), Number=lng_126, Order=True)

equals_51 = Equality(FirstNumber=data_126, SecondNumber="1")  # -> Equality, Inequality
dispatch_75 = Dispatch(List=dup_84, DispatchPattern=equals_51.Equality)  # -> ListA, ListB

dup_86 = DuplicateData(Data="0", Number=lng_123, Order=True)
weave_58 = Weave(Pattern=python_46.a, Stream0=weave_57, Stream1=dup_86, NullGaps=False)

equals_52 = Equality(FirstNumber=data_126, SecondNumber="1")  # -> Equality, Inequality
dispatch_76 = Dispatch(List=dup_83, DispatchPattern=equals_52.Equality)  # -> ListA, ListB

partition_56 = PartitionList(List=data_136, Size=data_133)  # -> simplify(Chunks)
cull_i_35 = CullIndex(List=partition_56, Indices=data_134, Wrap=True)  # -> flatten(List)
item_169 = ListItem(List=cull_i_35, Index=filename, Wrap=True)
lng_127 = ListLength(List=conditionedunconditioned_7.conditionedZones)
dup_87 = DuplicateData(Data=flatten(item_169), Number=lng_127, Order=True)

equals_53 = Equality(FirstNumber=data_126, SecondNumber="1")  # -> Equality, Inequality
dispatch_77 = Dispatch(List=data_210, DispatchPattern=equals_53.Equality)  # -> ListA, ListB

equals_54 = Equality(FirstNumber=data_126, SecondNumber="1")  # -> Equality, Inequality
dispatch_78 = Dispatch(List=weave_58, DispatchPattern=equals_54.Equality)  # -> ListA, ListB

panel_602 = Panel("conditioned units")
lng_128 = ListLength(List=conditionedunconditioned_7.conditionedZones)

lng_129 = ListLength(List=conditionedunconditioned_7.conditionedZones)

lng_130 = ListLength(List=conditionedunconditioned_7.conditionedZones)

lng_131 = ListLength(List=conditionedunconditioned_7.conditionedZones)

# ----
# boiler efficiency
data_211 = Data(weave_27)
dup_88 = DuplicateData(Data=data_211, Number=lng_128, Order=True)

# ----
# Infiltration Rate
lng_132 = ListLength(List=conditionedunconditioned_7.conditionedZones)
dup_89 = DuplicateData(Data=weave_48, Number=lng_132, Order=True)

# ----
# verticalPosition
# (2:base, 3: middle, 4:roof)
rec_5 = DataRecorder(dispatch_78.ListB, DataLimit=-10, RecordData=True)
panel_606 = Panel(rec_5)

# ----
# VT Window
dup_90 = DuplicateData(Data=data_139, Number=lng_130, Order=True)

# ----
# shgc Window
dup_91 = DuplicateData(Data=data_140, Number=lng_131, Order=True)

# ----
# Construction Date
dup_92 = DuplicateData(Data=data_138, Number=lng_129, Order=True)

equals_55 = Equality(FirstNumber=data_126, SecondNumber="1")  # -> Equality, Inequality
dispatch_79 = Dispatch(List=dup_88, DispatchPattern=equals_55.Equality)  # -> ListA, ListB

equals_56 = Equality(FirstNumber=data_126, SecondNumber="1")  # -> Equality, Inequality
dispatch_80 = Dispatch(List=dup_90, DispatchPattern=equals_56.Equality)  # -> ListA, ListB

equals_57 = Equality(FirstNumber=data_126, SecondNumber="1")  # -> Equality, Inequality
dispatch_81 = Dispatch(List=dup_85, DispatchPattern=equals_57.Equality)  # -> ListA, ListB

equals_58 = Equality(FirstNumber=data_126, SecondNumber="1")  # -> Equality, Inequality
dispatch_82 = Dispatch(List=dup_91, DispatchPattern=equals_58.Equality)  # -> ListA, ListB

equals_59 = Equality(FirstNumber=data_126, SecondNumber="1")  # -> Equality, Inequality
dispatch_83 = Dispatch(List=dup_89, DispatchPattern=equals_59.Equality)  # -> ListA, ListB

equals_60 = Equality(FirstNumber=data_126, SecondNumber="1")  # -> Equality, Inequality
dispatch_84 = Dispatch(List=dup_92, DispatchPattern=equals_60.Equality)  # -> ListA, ListB

equals_61 = Equality(FirstNumber=data_126, SecondNumber="1")  # -> Equality, Inequality
dispatch_85 = Dispatch(List=dup_87, DispatchPattern=equals_61.Equality)  # -> ListA, ListB

# ----
# Parcel info of Building
rec_6 = DataRecorder(dispatch_81.ListB, DataLimit=-10, RecordData=True)
# ID
panel_614 = Panel(rec_6)

# ----
# properties of Units
debrep_23 = DeconstructBrep(Brep=conditionedunconditioned_7.conditionedZones)  # -> simplify(Faces), Edges, Vertices
item_170 = ListItem(List=debrep_23.Faces, Index=0, Wrap=True)
area_73 = Area(Geometry=item_170)  # -> flatten(Area), Centroid

# ----
# Block value of Building
rec_7 = DataRecorder(dispatch_85.ListB, DataLimit=-10, RecordData=True)
panel_615 = Panel(rec_7)

pdecon_18 = Deconstruct(Point=area_73.Centroid)  # -> XComponent, YComponent, ZComponent
division_22 = Division(A=pdecon_18.ZComponent, B="3")  # -> flatten(Result)

equals_62 = Equality(FirstNumber=data_126, SecondNumber="1")  # -> Equality, Inequality
dispatch_86 = Dispatch(List=division_22, DispatchPattern=equals_62.Equality)  # -> ListA, ListB

# ----
# z-axis value of Units
panel_617 = Panel(dispatch_86.ListB)

# ----
# detecting circle radius is the 2 times of the building height plus fit cirle radius
multiplication_18 = Multiplication(A=item_98, B=data_100)
debrep_24 = DeconstructBrep(Brep=geo_77)  # -> Faces, Edges, Vertices
fcircle_2 = CircleFit(Points=debrep_24.Vertices)  # -> Circle, Radius, Deviation

# ----
# height of the building
data_212 = Data(multiplication_18)

# ----
# Check whether Added Parcels inside the Block
# Added Parcel Status
panel_618 = Panel("_")
split_24 = TextSplit(Text=item_71, Separators=panel_618)
item_171 = ListItem(List=split_24, Index=-1, Wrap=True)
item_172 = ListItem(List=sorted_parcels_2, Index=item_171, Wrap=True)

multiplication_19 = Multiplication(A=data_212, B="2")
addition_9 = Addition(A=multiplication_19, B=fcircle_2.Radius)

area_74 = Area(Geometry=geo_77)  # -> Area, Centroid

circle_5 = CircleCNR(Center=area_74.Centroid, Normal=Vector(0, 0, 1), Radius=addition_9)

divide_6 = DivideCurve(Curve=circle_5, Count="180", Kinks=False)  # -> Points, Tangents, Parameters

panel_619 = Panel("detecting lines")
ln_5 = Line(StartPoint=area_74.Centroid, EndPoint=divide_6.Points)

lng_133 = ListLength(List=ln_5)

# ----
# center of simulated PARCEL
data_213 = Data(area_74.Centroid)

pt_4 = Point(dispatch_72.ListB)
ln_6 = Line(StartPoint=graft(area_68.Centroid), EndPoint=pt_4)
stretch = Stretch(Geometry=ln_6, Axis=ln_6, Length="50", Rigid=False)

panel_621 = Panel("context Brep")

# ----
# Context Building
area_75 = Area(Geometry=item_126)  # -> Area, Centroid
equals_63 = Equality(FirstNumber=area_75.Centroid, SecondNumber=area_53.Centroid)  # -> Equality, Inequality
panel_622 = Panel("cull intersected parcel")
panel_623 = Panel("collision detection")

dispatch_87 = Dispatch(List=pline_8, DispatchPattern=equals_63.Equality)  # -> ListA, ListB
area_76 = Area(Geometry=dispatch_87.ListA)  # -> Area, Centroid
scale_11 = Scale(Geometry=dispatch_87.ListA, Center=area_76.Centroid, Factor="1.1")  # -> Geometry, Transform

colom_2 = CollisionOneMany(Collider=scale_11.Geometry, Obstacles=simplify(graft(dispatch_87.ListB)))  # -> simplify(flatten(Collision)), simplify(Index)
dispatch_88 = Dispatch(List=dispatch_87.ListB, DispatchPattern=colom_2.Collision)  # -> ListA, ListB

geo_99 = Geometry(dispatch_88.ListB)
area_77 = Area(Geometry=geo_99)  # -> Area, Centroid

# ----
# Context Shading: Added Parcel
vec2pt_8 = Vector2Pt(PointA=area_77.Centroid, PointB=graft(area_55.Centroid), Unitize=False)  # -> Vector, Length
multiplication_20 = Multiplication(A=vec2pt_8.Vector, B="2")
move_4 = Move(Geometry=geo_99, Motion=multiplication_20)  # -> Geometry, Transform

# ----
# OSCInfo
dispatch_89 = Dispatch(List=data_101, DispatchPattern=equals_37.Equality)  # -> ListA, ListB
dispatch_90 = Dispatch(List=dispatch_89.ListA, DispatchPattern=equals_39.Equality)  # -> ListA, ListB
multiplication_21 = Multiplication(A=dispatch_90.ListB, B=data_102)
boundary_20 = BoundarySurfaces(Edges=dispatch_88.ListB)
Z_8 = UnitZ(Factor=multiplication_21)
extr_6 = Extrude(Base=boundary_20, Direction=Z_8)

rint = RegionIntersection(CurvesA=geo_99, CurvesB=simplify(graft(move_4.Geometry)))  # -> simplify(Result)
area_78 = Area(Geometry=flatten(rint))  # -> Area, Centroid
incurves_3 = PointInCurves(Point=area_78.Centroid, Curves=move_4.Geometry)  # -> Relationship, Index, Point
cull_i_36 = CullIndex(List=move_4.Geometry, Indices=incurves_3.Index, Wrap=True)

area_79 = Area(Geometry=cull_i_36)  # -> Area, Centroid
incurves_4 = PointInCurves(Point=area_79.Centroid, Curves=item_172)  # -> Relationship, Index, Point
equals_64 = Equality(FirstNumber=incurves_4.Relationship, SecondNumber="2")  # -> Equality, Inequality
dispatch_91 = Dispatch(List=cull_i_36, DispatchPattern=equals_64.Equality)  # -> ListA, ListB

panel_624 = Panel("context surfaces")
merge_128 = Merge(Data1=dispatch_88.ListB, Data2=dispatch_91.ListB)
debrep_25 = DeconstructBrep(Brep=flatten(merge_128))  # -> Faces, simplify(flatten(Edges)), Vertices

# ----
# Intersection Check
Z_9 = UnitZ(Factor=1)
extr_7 = Extrude(Base=ln_5, Direction=Z_9)
split_25 = SplitWithBrep(Curve=debrep_25.Edges, Brep=graft(extr_7))  # -> flatten(Curve), simplify(Points)
clean_28 = CleanTree(RemoveNulls=True, RemoveInvalid=True, RemoveEmpty=Toggle(True), Tree=split_25.Points)
item_173 = ListItem(List=clean_28, Index=0, Wrap=True)
dcon_10 = DeleteConsecutive(Set=item_173, Wrap=False)  # -> simplify(Set), Count
tstat_26 = TreeStatistics(Tree=dcon_10.Set)  # -> Paths, Length, Count
split_26 = TextSplit(Text=tstat_26.Paths, Separators="{;}")

series_51 = Series(Start=0, Step=1, Count=lng_133)
item_174 = ListItem(List=split_26, Index=2, Wrap=True)  # -> flatten(Item)
item_175 = ListItem(List=split_26, Index=1, Wrap=True)  # -> flatten(Item)
equals_65 = Equality(FirstNumber=graft(series_51), SecondNumber=item_175)  # -> Equality, Inequality
dispatch_92 = Dispatch(List=item_175, DispatchPattern=equals_65.Equality)  # -> simplify(ListA), ListB
lng_134 = ListLength(List=dispatch_92.ListA)
partition_57 = PartitionList(List=item_174, Size=flatten(lng_134))
item_176 = ListItem(List=debrep_25.Edges, Index=partition_57, Wrap=True)  # -> simplify(Item)

curvepoint_9 = PointOnCurve(item_176, parameter=0.5)
dist = Distance(PointA=curvepoint_9, PointB=data_213)  # -> simplify(Distance)
sort_32 = SortList(Keys=dist, ValuesA=item_176)  # -> Keys, ValuesA
item_177 = ListItem(List=sort_32.ValuesA, Index=0, Wrap=True)  # -> flatten(Item)
null_16 = NullItem(Item=item_177)  # -> NullFlags, InvalidFlags, Description
dispatch_93 = Dispatch(List=item_177, DispatchPattern=null_16.NullFlags)  # -> ListA, ListB
curvepoint_10 = PointOnCurve(dispatch_93.ListB, parameter=0.5)
sort_pt_3 = SortPoints(Points=curvepoint_10)  # -> Points, Indices
dcon_11 = DeleteConsecutive(Set=sort_pt_3.Points, Wrap=False)  # -> Set, Count
geo_100 = Geometry(dispatch_93.ListB)
pdecon_19 = Deconstruct(Point=dcon_11.Set)  # -> XComponent, YComponent, ZComponent
curvepoint_11 = PointOnCurve(geo_100, parameter=0.5)
addition_10 = Addition(A=pdecon_19.XComponent, B=pdecon_19.YComponent)
pdecon_20 = Deconstruct(Point=curvepoint_11)  # -> XComponent, YComponent, ZComponent
roundd_3 = RoundToDecimalPlace(NumberX=addition_10, DecimalPlace="2", RoundType=0)  # -> Rounded, Difference
addition_11 = Addition(A=pdecon_20.XComponent, B=pdecon_20.YComponent)
roundd_4 = RoundToDecimalPlace(NumberX=addition_11, DecimalPlace="2", RoundType=0)  # -> Rounded, Difference
equals_66 = Equality(FirstNumber=roundd_4.Rounded, SecondNumber=graft(roundd_3.Rounded))  # -> Equality, Inequality
dispatch_94 = Dispatch(List=geo_100, DispatchPattern=equals_66.Equality)  # -> simplify(ListA), ListB

item_178 = ListItem(List=dispatch_94.ListA, Index=0, Wrap=True)  # -> flatten(Item)

area_80 = Area(Geometry=geo_45)  # -> Area, Centroid
scale_12 = Scale(Geometry=geo_45, Center=area_80.Centroid, Factor="1.1")  # -> Geometry, Transform
debrep_26 = DeconstructBrep(Brep=scale_12.Geometry)  # -> Faces, Edges, Vertices
pline_10 = PolyLine(Vertices=debrep_26.Vertices, Closed=Toggle(True))  # -> flatten(Polyline)
curvepoint_12 = PointOnCurve(item_178, parameter=0.5)
incurves_5 = PointInCurves(Point=curvepoint_12, Curves=pline_10)  # -> Relationship, Index, Point
sort_33 = SortList(Keys=incurves_5.Index)  # -> Keys, ValuesA
dcon_12 = DeleteConsecutive(Set=sort_33.Keys, Wrap=False)  # -> Set, Count
item_179 = ListItem(List=data_170, Index=dcon_12.Set, Wrap=True)  # -> flatten(Item)

# ----
# average of all context buildings height
ma_12 = MassAddition(Input=item_179)  # -> Result, PartialResults
lng_135 = ListLength(List=item_179)
division_23 = Division(A=ma_12.Result, B=lng_135)

# ----
# average of all context buildings height
data_214 = Data(division_23)

# ----
# OSCInfo_ContextShadingAddedBlocks
multiplication_22 = Multiplication(A=data_214, B=data_103)
boundary_21 = BoundarySurfaces(Edges=dispatch_91.ListB)
Z_10 = UnitZ(Factor=multiplication_22)
extr_8 = Extrude(Base=boundary_21, Direction=Z_10)

brep_6 = Brep(flatten([extr_6, extr_8]))

merge_129 = Merge(Data1=extr_6, Data2=extr_8)
area_81 = Area(Geometry=merge_129)  # -> Area, flatten(Centroid)

merge_130 = Merge(Data1=extr_6, Data2=extr_8)  # -> flatten(Result)
null_17 = NullItem(Item=merge_130)  # -> NullFlags, InvalidFlags, Description
dispatch_95 = Dispatch(List=merge_130, DispatchPattern=null_17.NullFlags)  # -> ListA, ListB
debrep_27 = DeconstructBrep(Brep=dispatch_95.ListB)  # -> simplify(Faces), Edges, Vertices
area_82 = Area(Geometry=debrep_27.Faces)  # -> Area, Centroid
pdecon_21 = Deconstruct(Point=area_82.Centroid)  # -> XComponent, YComponent, ZComponent
sort_34 = SortList(Keys=pdecon_21.ZComponent, ValuesA=debrep_27.Faces)  # -> Keys, reverse(ValuesA)

area_83 = Area(Geometry=dispatch_95.ListB)  # -> Area, Centroid
incurves_6 = PointInCurves(Point=area_83.Centroid, Curves=shift_4)  # -> Relationship, Index, Point
sort_35 = SortList(Keys=incurves_6.Index)  # -> Keys, ValuesA
dcon_13 = DeleteConsecutive(Set=sort_35.Keys, Wrap=False)  # -> Set, Count
equals_67 = Equality(FirstNumber=dcon_13.Set, SecondNumber="-1")  # -> Equality, Inequality
dispatch_96 = Dispatch(List=dcon_13.Set, DispatchPattern=equals_67.Equality)  # -> ListA, ListB

item_180 = ListItem(List=sort_34.ValuesA, Index=0, Wrap=True)
area_84 = Area(Geometry=item_180)  # -> Area, Centroid
incurves_7 = PointInCurves(Point=area_84.Centroid, Curves=shift_4)  # -> Relationship, simplify(Index), Point
equals_68 = Equality(FirstNumber=incurves_7.Index, SecondNumber="-1")  # -> Equality, Inequality
dispatch_97 = Dispatch(List=incurves_7.Index, DispatchPattern=equals_68.Equality)  # -> ListA, ListB

pdecon_22 = Deconstruct(Point=area_84.Centroid)  # -> XComponent, YComponent, ZComponent
sort_36 = SortList(Keys=pdecon_22.ZComponent, ValuesA=area_84.Centroid)  # -> reverse(Keys), reverse(ValuesA)
item_181 = ListItem(List=sort_36.Keys, Index=0, Wrap=True)

# ----
# count
# occurences
# in list
# + partition from
# north to east
sort_37 = SortList(Keys=flatten(dispatch_97.ListB), ValuesA=flatten(item_181))  # -> Keys, ValuesA
dcon_14 = DeleteConsecutive(Set=sort_37.Keys, Wrap=False)  # -> Set, Count
panel_627 = Panel(sort_37.Keys)
equals_69 = Equality(FirstNumber=panel_627, SecondNumber=graft(dcon_14.Set))  # -> Equality, Inequality
dispatch_98 = Dispatch(List=panel_627, DispatchPattern=equals_69.Equality)  # -> simplify(ListA), ListB

# ----
# average distance of context
sort_38 = SortList(Keys=pdecon_21.ZComponent, ValuesA=debrep_27.Faces)  # -> Keys, ValuesA
item_182 = ListItem(List=sort_38.ValuesA, Index=0, Wrap=True)
area_85 = Area(Geometry=item_182)  # -> Area, Centroid
area_86 = Area(Geometry=geo_82)  # -> Area, Centroid
dist_2 = Distance(PointA=area_86.Centroid, PointB=area_85.Centroid)  # -> flatten(Distance)
lng_136 = ListLength(List=dispatch_98.ListA)  # -> flatten(Length)
partition_58 = PartitionList(List=dist_2, Size=lng_136)
avr_6 = Average(Input=partition_58)  # -> flatten(ArithmeticMean)
dup_93 = DuplicateData(Data="0", Number="4", Order=True)
replace_32 = ReplaceItems(List=dup_93, Item=avr_6, Indices=dispatch_96.ListB, Wrap=False)
roundd_5 = RoundToDecimalPlace(NumberX=replace_32, DecimalPlace="1", RoundType=0)  # -> Rounded, Difference
lng_137 = ListLength(List=roundd_5.Rounded)
lng_138 = ListLength(List=conditionedunconditioned_6.conditionedZones)
dup_94 = DuplicateData(Data=roundd_5.Rounded, Number=lng_138, Order=True)
partition_59 = PartitionList(List=dup_94, Size=lng_137)  # -> simplify(Chunks)

multiplication_23 = Multiplication(A=data_104, B=division_23)
Z_11 = UnitZ(Factor=multiplication_23)

# ----
# height of context
lng_139 = ListLength(List=dispatch_98.ListA)  # -> flatten(Length)
partition_60 = PartitionList(List=sort_37.ValuesA, Size=lng_139)
avr_7 = Average(Input=partition_60)  # -> flatten(ArithmeticMean)
dup_95 = DuplicateData(Data="0", Number="4", Order=True)
replace_33 = ReplaceItems(List=dup_95, Item=avr_7, Indices=dispatch_96.ListB, Wrap=False)
roundd_6 = RoundToDecimalPlace(NumberX=replace_33, DecimalPlace="1", RoundType=0)  # -> Rounded, Difference
lng_140 = ListLength(List=roundd_6.Rounded)
lng_141 = ListLength(List=conditionedunconditioned_5.conditionedZones)
dup_96 = DuplicateData(Data=roundd_5.Rounded, Number=lng_141, Order=True)
partition_61 = PartitionList(List=dup_96, Size=lng_140)  # -> simplify(Chunks)

geo_101 = Geometry(item_178)

# ----
# context without ground surface
extr_9 = Extrude(Base=geo_101, Direction=Z_11)

# ----
# context without ground surface
geo_102 = Geometry(extr_9)

colom_3 = CollisionOneMany(Collider=stretch, Obstacles=geo_102)  # -> Collision, Index
dispatch_99 = Dispatch(List=stretch, DispatchPattern=colom_3.Collision)  # -> ListA, ListB
split_27 = SplitWithBreps(Curve=dispatch_99.ListA, Brep=geo_102)  # -> Curve, Points
crv = Curve(split_27.Curve)
item_183 = ListItem(List=crv, Index=0, Wrap=True)
null_18 = NullItem(Item=item_183)  # -> NullFlags, InvalidFlags, Description
dispatch_100 = Dispatch(List=item_183, DispatchPattern=null_18.NullFlags)  # -> ListA, ListB
crv_2 = Curve(dispatch_100.ListB)
len_7 = Length(Curve=crv_2)
end_2 = EndPoints(Curve=crv_2)  # -> Start, End
vec2pt_9 = Vector2Pt(PointA=end_2.Start, PointB=end_2.End, Unitize=False)  # -> Vector, Length
pshift_2 = ShiftPaths(Data=len_7, Offset=-1)
null_19 = NullItem(Item=pshift_2)  # -> NullFlags, InvalidFlags, Description
dispatch_101 = Dispatch(List=pshift_2, DispatchPattern=null_19.NullFlags)  # -> ListA, ListB

angle = Angle(VectorA=graft(evalsrf_5.Normal), VectorB=simplify(vec2pt_9.Vector))  # -> Angle, Reflex
deg_2 = Degrees(Radians=angle.Angle)
larger_2 = LargerThan(FirstNumber=deg_2, SecondNumber="90")  # -> LargerThan, OrEqualTo
python_47 = GhPythonScript(x=simplify(deg_2))  # -> simplify(out), a
# ---------- python_47: Python ----------
__author__ = "ipg"
__version__ = "2022.01.28"

import rhinoscriptsyntax as rs
if x>=90:
    x = x-90
    print(x)
else:
    pass
# ---------- end python_47 ----------
dispatch_102 = Dispatch(List=deg_2, DispatchPattern=larger_2.OrEqualTo)  # -> ListA, ListB
merge_131 = Merge(Data1=dispatch_102.ListB, Data2=python_47.out)  # -> simplify(Result)
pshift_3 = ShiftPaths(Data=merge_131, Offset=-1)

join_39 = BrepJoin(Breps=brep_6)  # -> flatten(Breps), Closed
volume_8 = Volume(Geometry=join_39.Breps)  # -> Volume, Centroid
bcx = BrepCurve(Brep=flatten(brep_6), Curve=dispatch_100.ListB)  # -> Curves, Points
crv_cp_3 = CurveCP(Point=volume_8.Centroid, Curve=crv_2)  # -> Point, Parameter, Distance
pshift_4 = ShiftPaths(Data=bcx.Points, Offset=-1)
dist_3 = Distance(PointA=volume_8.Centroid, PointB=crv_cp_3.Point)
sort_39 = SortList(Keys=dist_3, ValuesA=join_39.Breps)  # -> Keys, ValuesA
lng_142 = ListLength(List=pshift_4)
split_28 = SplitList(List=sort_39.ValuesA, Index=lng_142)  # -> ListA, ListB
brep_7 = Brep(simplify(graft(split_28.ListA)))

pshift_5 = ShiftPaths(Data=simplify(brep_7), Offset=-1)
panel_629 = Panel(pshift_5)

multiplication_24 = Multiplication(A=pshift_3, B=dispatch_101.ListB)
python_48 = GhPythonScript(x=multiplication_24)  # -> out, a
# ---------- python_48: Python ----------
__author__ = "ipg"
__version__ = "2022.01.28"

import rhinoscriptsyntax as rs
if x == 0 : 
    x = x + 0.1
    print(x)
else:
    print(x)
# ---------- end python_48 ----------
pshift_6 = ShiftPaths(Data=python_48.out, Offset=-1)
panel_630 = Panel(multiplication_24)

lng_143 = ListLength(List=multiplication_24)  # -> flatten(Length)
data_215 = Data(flatten(brep_7))
partition_62 = PartitionList(List=data_215, Size=lng_143)  # -> simplify(Chunks)
tstat_27 = TreeStatistics(Tree=partition_62)  # -> Paths, Length, Count
tstat_28 = TreeStatistics(Tree=multiplication_24)  # -> Paths, Length, Count
replace_34 = ReplacePaths(Data=partition_62, Search=tstat_27.Paths, Replace=tstat_28.Paths)

debrep_28 = DeconstructBrep(Brep=replace_34)  # -> simplify(Faces), Edges, Vertices
area_87 = Area(Geometry=debrep_28.Faces)  # -> Area, Centroid
pdecon_23 = Deconstruct(Point=area_87.Centroid)  # -> XComponent, YComponent, ZComponent
sort_40 = SortList(Keys=pdecon_23.ZComponent, ValuesA=debrep_28.Faces)  # -> Keys, reverse(ValuesA)
null_20 = NullItem(Item=sort_40.ValuesA)  # -> NullFlags, InvalidFlags, Description
dispatch_103 = Dispatch(List=sort_40.ValuesA, DispatchPattern=null_20.NullFlags)  # -> ListA, ListB
area_88 = Area(Geometry=dispatch_103.ListB)  # -> Area, Centroid
pdecon_24 = Deconstruct(Point=area_88.Centroid)  # -> XComponent, YComponent, ZComponent
sort_41 = SortList(Keys=pdecon_24.ZComponent, ValuesA=area_88.Centroid)  # -> reverse(Keys), reverse(ValuesA)
item_184 = ListItem(List=sort_41.Keys, Index=0, Wrap=True)
null_21 = NullItem(Item=item_184)  # -> NullFlags, InvalidFlags, Description
dispatch_104 = Dispatch(List=item_184, DispatchPattern=null_21.NullFlags)  # -> ListA, simplify(ListB)

pshift_7 = ShiftPaths(Data=dispatch_104.ListB, Offset=-1)
panel_631 = Panel(pshift_7)

geo_103 = Geometry(flatten(extr_9))
panel_632 = Panel("shading Context")

subtraction_11 = Subtraction(A=pshift_7, B=panel_586)
python_49 = GhPythonScript(x=pdecon_15.ZComponent, y=panel_631, z=subtraction_11)  # -> out, a
# ---------- python_49: Python ----------
__author__ = "ipg"
__version__ = "2022.01.28"

import rhinoscriptsyntax as rs
if x > y:
    z = 0
    print(z)
if z < 0 :
    z = 0 
    print(z)
else:
    print(z)
# ---------- end python_49 ----------
pshift_8 = ShiftPaths(Data=python_49.out, Offset=-1)
panel_633 = Panel(pshift_8)

division_24 = Division(A=pshift_8, B=multiplication_24)
panel_634 = Panel(division_24)

area_89 = Area(Geometry=geo_103)  # -> Area, Centroid
incurves_8 = PointInCurves(Point=area_89.Centroid, Curves=merge_103)  # -> Relationship, Index, Point
sort_42 = SortList(Keys=incurves_8.Index)  # -> Keys, ValuesA
dcon_15 = DeleteConsecutive(Set=sort_42.Keys, Wrap=False)  # -> Set, Count

# ----
# 01find directions of external walls
# 2-steps shading selection
# find directions of external walls
# test wether obstacle exist these directions
decomposebytype_4 = Honeybee_DecomposeBasedOnType(HBZone=conditionedunconditioned_4.conditionedZones)  # -> simplify(walls), simplify(interiorWalls), airWalls, simplify(windows), interiorWindows, skylights, roofs, ceilings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; plug-in component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
replace_35 = ReplaceItems(List=dup_39, Item="1", Indices=dcon_15.Set, Wrap=False)

merge_132 = Merge(Data1=extr_9, Data2=geo_83)  # -> flatten(Result)
debrep_29 = DeconstructBrep(Brep=flatten(merge_132))  # -> Faces, Edges, flatten(Vertices)
hull_10 = ConvexHull(Points=debrep_29.Vertices, Plane=PlaneXY(0, 0, 0))  # -> Hull, HullZ, Indices
area_90 = Area(Geometry=hull_10.Hull)  # -> Area, Centroid
scale_13 = Scale(Geometry=hull_10.Hull, Center=area_90.Centroid, Factor="1.05")  # -> Geometry, Transform
boundary_22 = BoundarySurfaces(Edges=scale_13.Geometry)

# ----
# average (it gives
# one result for each
# window unit)
avr_8 = Average(Input=division_24)
panel_635 = Panel(avr_8)

# ----
# summation (it gives
#  one result for each
#  window in the unit)
ma_13 = MassAddition(Input=division_24)  # -> Result, PartialResults
panel_636 = Panel(ma_13.Result)

# ----
# 02test wether obstacle
# exist these directions
area_91 = Area(Geometry=decomposebytype_4.walls)  # -> Area, Centroid
incurves_9 = PointInCurves(Point=area_91.Centroid, Curves=merge_103)  # -> Relationship, Index, Point
item_185 = ListItem(List=replace_35, Index=incurves_9.Index, Wrap=True)  # -> simplify(Item)
replace_36 = ReplaceItems(List=dup_40, Item=item_185, Indices=incurves_9.Index, Wrap=False)  # -> simplify(List)

nullrep = ReplaceNulls(Items=panel_635, Replacements="-1")  # -> Items, Count
pshift_9 = ShiftPaths(Data=nullrep.Items, Offset=-1)

# ----
# null olanları
# -1 ile değiştirdim
# hiç etkisi yok
# demek
panel_637 = Panel("-1")
nullrep_2 = ReplaceNulls(Items=panel_636, Replacements=panel_637)  # -> Items, Count
pshift_10 = ShiftPaths(Data=nullrep_2.Items, Offset=-1)

# ----
# Context Surface
merge_133 = Merge(Data1=flatten(extr_9), Data2=flatten(boundary_22))
hb_epcontextsrf = HoneybeeEPContextSurfaces(shdSurfaces=flatten(merge_133))  # -> HBContext; inputs shdSurfaces: list of Brep, justBoundingBox: Boolean
# ---------- hb_epcontextsrf: Python ----------
"""
prepare shading/context geometries

    Args:
        northVectorOrRotation: A vector that shows North or a number that shows
                               the rotation of the North from the Y axis
        bldgMasses: List of closed Breps as thermal zones.
    Returns:
        report: ...
        thermalZones: Thermal zone's geometries for visualiza
"""

ghenv.Component.Name = 'Honeybee EP context Surfaces'
ghenv.Component.NickName = 'HB_EPContextSrf'
ghenv.Component.Message = 'VER 0.0.66\nJUL_07_2020'
ghenv.Component.IconDisplayMode = ghenv.Component.IconDisplayMode.application
ghenv.Component.Category = "HB-Legacy"
ghenv.Component.SubCategory = "10 | Energy | Energy"
#compatibleHBVersion = VER 0.0.57\nNOV_04_2016
#compatibleLBVersion = VER 0.0.59\nFEB_01_2015
ghenv.Component.AdditionalHelpFromDocStrings = "2"

import rhinoscriptsyntax as rs
import Rhino as rc
import scriptcontext as sc
import os
import System
import Grasshopper.Kernel as gh
import uuid

tolerance = sc.doc.ModelAbsoluteTolerance
import math


def main(shdSurfaces, EPTransSchedule, meshingSettings, justBoundingBox):
    
    # import the classes
    if sc.sticky.has_key('honeybee_release'):

        try:
            if not sc.sticky['honeybee_release'].isCompatible(ghenv.Component): return -1
            if sc.sticky['honeybee_release'].isInputMissing(ghenv.Component): return -1
        except:
            warning = "You need a newer version of Honeybee to use this compoent." + \
            " Use updateHoneybee component to update userObjects.\n" + \
            "If you have already updated userObjects drag Honeybee_Honeybee component " + \
            "into canvas and try again."
            w = gh.GH_RuntimeMessageLevel.Warning
            ghenv.Component.AddRuntimeMessage(w, warning)
            return -1
        
        # don't customize this part
        hb_EPSrf = sc.sticky["honeybee_EPSurface"]
        hb_EPSHDSurface = sc.sticky["honeybee_EPShdSurface"]
        hb_RADMaterialAUX = sc.sticky["honeybee_RADMaterialAUX"]
        hb_EPObjectsAux = sc.sticky["honeybee_EPObjectsAUX"]()
        HBScheduleList = sc.sticky["honeybee_ScheduleLib"].keys()

        ########################################################################
        #----------------------------------------------------------------------#
        shdBreps = []
        # create bounding box of shading geometries
        if justBoundingBox:
            for brep in shdSurfaces:
                if brep.Faces.Count>1 or not brep.Faces[0].IsPlanar(sc.doc.ModelAbsoluteTolerance):
                    shdBreps.append(brep.GetBoundingBox(True).ToBrep())
                else:
                    shdBreps.append(brep)
        else:
            shdBreps = shdSurfaces
        
        shadingClasses = []
        shadingMeshPreview = []
        
        if meshingSettings == None:
            mp = rc.Geometry.MeshingParameters.Minimal
            mp.SimplePlanes = True
        else:
            mp = meshingSettings
        
        def getRadMaterialName(radMaterial):
            nameStr = radMaterial.split(" ")[2]
            name =  nameStr.split("\n")[0]
            return name
        
        for brepCount, brep in enumerate(shdBreps):
            if brep != None:
                isPlanar = True
                # check planarity
                for face in brep.Faces:
                    if not face.IsPlanar(tolerance):
                        isPlanar = False
                        break
                
                shadingBreps = []
                if not isPlanar:
                    meshArray = rc.Geometry.Mesh.CreateFromBrep(brep, mp)
                    for mesh in meshArray:
                        for meshFace in range(mesh.Faces.Count):
                            vertices = list(mesh.Faces.GetFaceVertices(meshFace))[1:]
                            vertices = vertices + [sc.doc.ModelAbsoluteTolerance]
                            # create the brep from mesh
                            shdBrep = rc.Geometry.Brep.CreateFromCornerPoints(*vertices)
                            shadingBreps.append(shdBrep)
                else:
                    for face in brep.Faces:
                        shadingBreps.append(face.DuplicateFace(False))
                
                for faceCount, shdBrep in enumerate(shadingBreps):
                        thisShading = hb_EPSHDSurface(shdBrep, 1000*brepCount + faceCount, 'shdSrf_' + `brepCount` + '_' + `faceCount` + "_" + str(uuid.uuid4()))
                        
                        # add transmittance schedule if any
                        if EPTransSchedule!=None:
                            schedule= EPTransSchedule.upper()
                            if schedule!=None and not schedule.lower().endswith(".csv") and schedule not in HBScheduleList:
                                msg = "Cannot find " + schedule + " in Honeybee schedule library."
                                print msg
                                ghenv.Component.AddRuntimeMessage(gh.GH_RuntimeMessageLevel.Warning, msg)
                                return -1
                            elif schedule!=None and schedule.lower().endswith(".csv"):
                                # check if csv file is existed
                                if not os.path.isfile(schedule):
                                    msg = "Cannot find the shchedule file: " + schedule
                                    print msg
                                    ghenv.Component.AddRuntimeMessage(gh.GH_RuntimeMessageLevel.Warning, msg)
                                    return -1
                            
                            thisShading.TransmittanceSCH = schedule
                        
                        # add the Rad Material if any
                        if RADMaterial!=None:
                            # if it is just the name of the material make sure it is already defined
                            if len(RADMaterial.split(" ")) == 1:
                                # if the material is not in the library add it to the library
                                if not hb_RADMaterialAUX.isMatrialExistInLibrary(RADMaterial):
                                    warningMsg = "Can't find " + RADMaterial + " in RAD Material Library.\n" + \
                                                "Add the material to the library and try again."
                                    ghenv.Component.AddRuntimeMessage(gh.GH_RuntimeMessageLevel.Warning, warningMsg)
                                    return
                                
                                try:
                                    thisShading.setRADMaterial(RADMaterial)
                                except Exception, e:
                                    print e
                                    warningMsg = "You are using an old version of Honeybee_Honeybee! Update your files and try again."
                                    print warningMsg
                                    ghenv.Component.AddRuntimeMessage(gh.GH_RuntimeMessageLevel.Warning, warningMsg)
                                    return
                                
                                addedToLib = True
                            else:
                                
                                # try to add the material to the library
                                addedToLib, thisShading.RadMaterial = hb_RADMaterialAUX.analyseRadMaterials(RADMaterial, True)
                                
                            if addedToLib==False:
                                warningMsg = "Failed to add " + RADMaterial + " to the Library."
                                ghenv.Component.AddRuntimeMessage(gh.GH_RuntimeMessageLevel.Warning, warningMsg)
                                return
                        
                        # add shading to the list
                        shadingClasses.append(thisShading)
                
        # add to the hive
        hb_hive = sc.sticky["honeybee_Hive"]()
        HBContext  = hb_hive.addToHoneybeeHive(shadingClasses, ghenv.Component)
        return HBContext
        ################################################################################################
    else:
        print "You should first let Honeybee to fly..."
        w = gh.GH_RuntimeMessageLevel.Warning
        ghenv.Component.AddRuntimeMessage(w, "You should first let Honeybee to fly...")
        return -1
        

if _shdSurfaces and _shdSurfaces[0]!=None:
    # add cleaning function
    result= main(_shdSurfaces, EPTransSchedule_, meshingSettings_, justBoundingBox_)
    
    if result != -1: HBContext = result
# ---------- end hb_epcontextsrf ----------

context = Brep(hb_epcontextsrf)

panel_638 = Panel("""Obstacle by 
Directions""")
data_216 = Data(replace_36)

exporttoopenstudio = Honeybee_ExportToOpenStudio(
    epwWeatherFile=path,
    energySimPar=energysimpar,
    HBZones=flatten(geo_96),
    HBContext=flatten(hb_epcontextsrf),
    simulationOutputs=flatten(merge_66),
    writeOSM=Toggle(True),
    runSimulation="2",
    fileName=filename,
    workingDir=panel_338)  # -> readMe, osmFileAddress, idfFileAddress, resultFileAddress, eioFileAddress, rddFileAddress, htmlReport, studyFolder, model; plug-in component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

# ----
# Colibri
panel_639 = Panel("D:\KBEM\IP2.1\resV2Colib")
data_217 = Data(exporttoopenstudio.resultFileAddress)
parameters = ColibriParameters(Data=flatten(data_217))
img_setting = ImageSetting(ImageSaveAsName="defaultName", Width="2500", Height="2500")
colibri_aggregator = ColibriAggregator(
    Folder=panel_639,
    IterationGenomeID=iterator.IterationGenome,
    IterationPhenomeResults=parameters,
    ImgSetting=img_setting,
    Write=Toggle(False),
    recordingMode=0)

readepresult = Honeybee_ReadEPResult(resultFileAddress=exporttoopenstudio.resultFileAddress)  # -> totalThermalLoad, thermalLoadBalance, cooling, heating, electricLight, electricEquip, fanElectric, port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; plug-in component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

readepsrfresult = Honeybee_ReadEPSurfaceResult(resultFileAddress=exporttoopenstudio.resultFileAddress)  # -> port, port_2, port_3, port_4, port_5, port_6, port_7, port_8, port_9; disabled; plug-in component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
energybalance = Honeybee_ConstructEnergyBalance(
    HBZones=flatten(geo_96),
    cooling=readepresult.cooling,
    heating=readepresult.heating,
    electricLight=readepresult.electricLight,
    electricEquip=readepresult.electricEquip,
    fanElectric=readepresult.fanElectric,
    peopleGains=readepresult.peopleGains,
    totalSolarGain=readepresult.totalSolarGain,
    infiltrationEnergy=readepresult.infiltrationEnergy,
    mechVentilationEnergy=readepresult.mechVentilationEnergy,
    natVentEnergy=readepresult.natVentEnergy,
    surfaceEnergyFlow=readepsrfresult.port_3)  # -> readMe, port, flrNormEnergyBal, flrNormBalWStorage, port_2, modelEnergyBalance, energyBalWithStorage; disabled; plug-in component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
panel_640 = Panel("19")  # disabled
gradientlibrary = Ladybug_GradientLibrary(gradIndex=panel_640)  # -> customColors; disabled; plug-in component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
toggle_28 = BooleanToggle(True)  # disabled
selectandaveragedata = Ladybug_AverageData(annualHourlyData=energybalance.flrNormBalWStorage, totalOrAverage=toggle_28)  # -> readMe, selHourlyData, totaledDaily, totaledMonthly, totMonthlyPerHour, totMonthlyMinPerHour, totMonthlyMaxPerHour; disabled; plug-in component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
legendpar = Ladybug_LegendParameters(customColors=flatten(gradientlibrary))  # -> legendPar; disabled; plug-in component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
toggle_29 = BooleanToggle(True)  # disabled
panel_641 = Panel("EnergyBalance")  # disabled
pt_5 = Point(Point(458, 1813, 0))  # disabled
barchart = Ladybug_MonthlyBarChart(
    inputData=flatten(energybalance.flrNormBalWStorage),
    stackValues=toggle_29,
    altTitle=panel_641,
    basePoint=pt_5,
    legendPar=legendpar)  # -> readMe, dataMesh, dataCurves, dataCrvColors, graphAxes, graphLabels, title, titleBasePt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; disabled; plug-in component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
swatch_8 = ColourSwatch(SwatchColor=RGB(0, 0, 0))  # disabled
preview_27 = CustomPreview(Geometry=barchart.graphAxes, Material=swatch_8)  # disabled

# ----
# Simulated Parcel
# Visualisation
wires_7 = BrepWireframe(Brep=merge_133, Density=-1)
preview_28 = CustomPreview(Geometry=hb_epcontextsrf, Material=ColourSwatch(SwatchColor=RGBA(0, 255, 55, 145)))
preview_29 = CustomPreview(Geometry=wires_7, Material=ColourSwatch(SwatchColor=RGB(0, 0, 0)))

# ----
# People Gain (kWh/sqm)
flrnorm = Honeybee_NormalizeDataByFloorArea(simData=readepresult.peopleGains, HBZones=flatten(geo_96))  # -> totNormData, zoneNormData; plug-in component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
strnum_7 = Ladybug_SeparateData(inputList=flatten(flrnorm.zoneNormData))  # -> numbers, strings; plug-in component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
ma_14 = MassAddition(Input=strnum_7.numbers)  # -> flatten(Result), PartialResults

# ----
# Total Solar Gain (kWh/sqm)
flrnorm_2 = Honeybee_NormalizeDataByFloorArea(simData=readepresult.totalSolarGain, HBZones=flatten(geo_96))  # -> totNormData, zoneNormData; plug-in component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
strnum_8 = Ladybug_SeparateData(inputList=flatten(flrnorm_2.zoneNormData))  # -> numbers, strings; plug-in component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
ma_15 = MassAddition(Input=strnum_8.numbers)  # -> flatten(Result), PartialResults
equals_70 = Equality(FirstNumber=ma_15.Result, SecondNumber="0")  # -> Equality, Inequality
dispatch_105 = Dispatch(List=ma_15.Result, DispatchPattern=equals_70.Equality)  # -> ListA, ListB

# ----
# Infiltration Energy (kWh/sqm)
flrnorm_3 = Honeybee_NormalizeDataByFloorArea(simData=readepresult.infiltrationEnergy, HBZones=flatten(geo_96))  # -> totNormData, zoneNormData; plug-in component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
strnum_9 = Ladybug_SeparateData(inputList=flatten(flrnorm_3.zoneNormData))  # -> numbers, strings; plug-in component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
ma_16 = MassAddition(Input=strnum_9.numbers)  # -> flatten(Result), PartialResults
dispatch_106 = Dispatch(List=ma_16.Result, DispatchPattern=equals_70.Equality)  # -> ListA, ListB

# ----
# Natural Ventilation Energy (kWh/sqm)
flrnorm_4 = Honeybee_NormalizeDataByFloorArea(simData=readepresult.natVentEnergy, HBZones=flatten(geo_96))  # -> totNormData, zoneNormData; plug-in component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
strnum_10 = Ladybug_SeparateData(inputList=flatten(flrnorm_4.zoneNormData))  # -> numbers, strings; plug-in component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
ma_17 = MassAddition(Input=strnum_10.numbers)  # -> flatten(Result), PartialResults

# ----
# Air Temperature
# (Celcius/sqm)
strnum_11 = Ladybug_SeparateData(inputList=flatten(readepresult.airTemperature))  # -> numbers, strings; plug-in component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
avr_9 = Average(Input=strnum_11.numbers)
dispatch_107 = Dispatch(List=flatten(avr_9), DispatchPattern=equals_70.Equality)  # -> ListA, ListB

# ----
# Bahçeli-Ankara Heating Demand Reference Building, EKB0_4: 80kWh/sqm
strnum_12 = Ladybug_SeparateData(inputList=flatten(readepresult.heating))  # -> numbers, strings; plug-in component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
debrep_30 = DeconstructBrep(Brep=geo_96)  # -> simplify(Faces), Edges, Vertices
item_186 = ListItem(List=debrep_30.Faces, Index=0, Wrap=True)
ma_18 = MassAddition(Input=strnum_12.numbers)  # -> flatten(Result), PartialResults
area_92 = Area(Geometry=item_186)  # -> flatten(Area), Centroid
ma_19 = MassAddition(Input=ma_18.Result)  # -> Result, PartialResults
ma_20 = MassAddition(Input=area_92.Area)  # -> Result, PartialResults
division_25 = Division(A=ma_19.Result, B=ma_20.Result)
panel_642 = Panel(division_25)

# ----
# COOLING ENERGY DEMAND
# (kWh/sqm)
flrnorm_5 = Honeybee_NormalizeDataByFloorArea(simData=readepresult.cooling, HBZones=flatten(geo_96))  # -> totNormData, zoneNormData; plug-in component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
strnum_13 = Ladybug_SeparateData(inputList=flatten(flrnorm_5.zoneNormData))  # -> numbers, strings; plug-in component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
ma_21 = MassAddition(Input=strnum_13.numbers)  # -> flatten(Result), PartialResults

flrnorm_6 = Honeybee_NormalizeDataByFloorArea(simData=readepresult.heating, HBZones=flatten(geo_96))  # -> totNormData, zoneNormData; plug-in component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
strnum_14 = Ladybug_SeparateData(inputList=flatten(flrnorm_6.zoneNormData))  # -> numbers, strings; plug-in component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
ma_22 = MassAddition(Input=strnum_14.numbers)  # -> flatten(Result), PartialResults

pt_6 = Point(<point referenced from the Rhino model>)  # disabled
toggle_30 = BooleanToggle(True)  # disabled
panel_643 = Panel("1")  # disabled
adaptivecomfortcalculator_2 = Ladybug_AdaptiveComfortCalculator(
    dryBulbTemperature=readepresult.airTemperature,
    meanRadiantTemperature=readepresult.meanRadTemperature,
    outdoorTemperature=importepw_2.dryBulbTemperature,
    windSpeed=panel_643,
    comfortPar=adaptcomfortpar,
    runIt=toggle_30)  # -> readMe, port, comfortableOrNot, conditionOfPerson, degreesFromTarget, port_2, targetTemperature, upperTemperatureBound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; disabled; plug-in component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
adaptivechart = Ladybug_AdaptiveComfortChart(
    dryBulbTemperature=readepresult.airTemperature,
    meanRadiantTemperature=readepresult.meanRadTemperature,
    outdoorTemperature=importepw_2.dryBulbTemperature,
    windSpeed=panel_643,
    comfortPar=adaptcomfortpar,
    basePoint=pt_6,
    runIt=toggle_30)  # -> readMe, comfPercentOfTime, percentHotCold, comfortableOrNot, conditionOfPerson, degreesFromTarget, prevailingTemp, targetTemperature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; disabled; plug-in component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

# ----
# exclude
# unconditioned zones
# using total solar gain results
data_218 = Data(equals_70.Equality)

# ----
# Cull Unconditioned Zones
series_52 = Series(Start=0, Step=1, Count=lng_120)
dispatch_108 = Dispatch(List=series_52, DispatchPattern=data_218)  # -> ListA, ListB
branch_26 = TreeBranch(Tree=readepresult.operativeTemperature, Path=dispatch_108.ListB, MaintainPaths=True)

equals_71 = Equality(FirstNumber=data_126, SecondNumber="1")  # -> Equality, Inequality
dispatch_109 = Dispatch(List=dispatch_107.ListB, DispatchPattern=equals_71.Equality)  # -> ListA, ListB

# ----
# exclude
# unconditioned zones
# using total solar gain results
data_219 = Data(equals_70.Equality)  # disabled

# ----
# Cull Unconditioned Zones
series_53 = Series(Start=0, Step=1, Count=lng_121)  # disabled
dispatch_110 = Dispatch(List=series_53, DispatchPattern=data_219)  # -> ListA, ListB; disabled
branch_27 = TreeBranch(Tree=readepresult.airTemperature, Path=dispatch_110.ListB, MaintainPaths=True)  # disabled

equals_72 = Equality(FirstNumber=data_126, SecondNumber="1")  # -> Equality, Inequality
dispatch_111 = Dispatch(List=ma_14.Result, DispatchPattern=equals_72.Equality)  # -> ListA, ListB

strnum_15 = Ladybug_SeparateData(inputList=flatten(branch_26))  # -> numbers, strings; plug-in component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

equals_73 = Equality(FirstNumber=data_126, SecondNumber="1")  # -> Equality, Inequality
dispatch_112 = Dispatch(List=ma_21.Result, DispatchPattern=equals_73.Equality)  # -> ListA, ListB

equals_74 = Equality(FirstNumber=data_126, SecondNumber="1")  # -> Equality, Inequality
dispatch_113 = Dispatch(List=ma_22.Result, DispatchPattern=equals_74.Equality)  # -> ListA, ListB

equals_75 = Equality(FirstNumber=data_126, SecondNumber="1")  # -> Equality, Inequality
dispatch_114 = Dispatch(List=ma_17.Result, DispatchPattern=equals_75.Equality)  # -> ListA, ListB

equals_76 = Equality(FirstNumber=data_126, SecondNumber="1")  # -> Equality, Inequality
dispatch_115 = Dispatch(List=dispatch_106.ListB, DispatchPattern=equals_76.Equality)  # -> ListA, ListB

# ----
# Air Temperature
strnum_16 = Ladybug_SeparateData(inputList=flatten(branch_27))  # -> numbers, strings; disabled; plug-in component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

panel_650 = Panel("occupiedHours")
dispatch_116 = Dispatch(List=strnum_15.numbers, DispatchPattern=equals_16.Equality)  # -> ListA, ListB

equals_77 = Equality(FirstNumber=data_126, SecondNumber="1")  # -> Equality, Inequality
dispatch_117 = Dispatch(List=dispatch_105.ListB, DispatchPattern=equals_77.Equality)  # -> ListA, ListB

subtraction_12 = Subtraction(A=dispatch_116.ListA, B=dispatch_22.ListA)
python_50 = GhPythonScript(x=subtraction_12)  # -> out, a
# ---------- python_50: Python ----------
__author__ = "Siser"
__version__ = "2022.03.16"

import rhinoscriptsyntax as rs
if x > 0:
    a = x
else:
    a = 0
# ---------- end python_50 ----------

panel_652 = Panel("occupiedHours")  # disabled
dispatch_118 = Dispatch(List=strnum_16.numbers, DispatchPattern=equals_16.Equality)  # -> ListA, ListB; disabled

flrnorm_7 = Honeybee_NormalizeDataByFloorArea(simData=readepresult.electricLight, HBZones=flatten(geo_96))  # -> totNormData, zoneNormData; plug-in component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
strnum_17 = Ladybug_SeparateData(inputList=flatten(flrnorm_7.zoneNormData))  # -> numbers, strings; plug-in component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
ma_23 = MassAddition(Input=strnum_17.numbers)  # -> flatten(Result), PartialResults

panel_653 = Panel(dispatch_112.ListB)

# ----
# ELECTRICEQUIP ENERGY DEMAND
# (kWh/sqm)
# INDOOR OVERHEATING DEGREES
flrnorm_8 = Honeybee_NormalizeDataByFloorArea(simData=readepresult.electricEquip, HBZones=flatten(geo_96))  # -> totNormData, zoneNormData; plug-in component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
strnum_18 = Ladybug_SeparateData(inputList=flatten(flrnorm_8.zoneNormData))  # -> numbers, strings; plug-in component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
ma_24 = MassAddition(Input=strnum_18.numbers)  # -> flatten(Result), PartialResults

# ----
# MECHANICALVENTILATION
# ELECTRICLIGHT DEMAND
# (kWh/sqm)
flrnorm_9 = Honeybee_NormalizeDataByFloorArea(simData=readepresult.mechVentilationEnergy, HBZones=flatten(geo_96))  # -> totNormData, zoneNormData; plug-in component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
strnum_19 = Ladybug_SeparateData(inputList=flatten(flrnorm_9.zoneNormData))  # -> numbers, strings; plug-in component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
ma_25 = MassAddition(Input=strnum_19.numbers)  # -> flatten(Result), PartialResults

# ----
# HEATING ENERGY DEMAND
# (kWh/sqm)
division_26 = Division(A=dispatch_113.ListB, B=weave_27)

# ----
# MEANRADIANTTEMPERATURE
strnum_20 = Ladybug_SeparateData(inputList=flatten(readepresult.meanRadTemperature))  # -> numbers, strings; plug-in component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
avr_10 = Average(Input=strnum_20.numbers)
dispatch_119 = Dispatch(List=flatten(avr_10), DispatchPattern=equals_70.Equality)  # -> ListA, ListB

# ----
# https://www.sciencedirect.com/science/article/pii/S0360132317302664?via%3Dihub
# https://www.researchgate.net/publication/280443859_ASSESSMENT_OF_OVERHEATING_RISK_IN_DWELLINGS
# https://docs.google.com/document/d/1_ABXp2oo5wBXnJP1ug-vCfKyITPYSoL8V3BUiou2ZRM/edit
panel_654 = Panel("1May-30Sept")
subtraction_13 = Subtraction(A=doy_hoy_2.HOY, B=doy_hoy.HOY)
panel_655 = Panel("#of Occupied Hours")
series_54 = Series(Start=doy_hoy.HOY, Step=1, Count=subtraction_13)
# https://www.zerocarbonhub.org/sites/default/files/resources/reports/ZCH-OverheatingEvidenceReview-Definitions.pdf
item_187 = ListItem(List=python_50.a, Index=series_54, Wrap=True)

subtraction_14 = Subtraction(A=doy_hoy_6.HOY, B=doy_hoy_4.HOY)  # disabled
series_55 = Series(Start=doy_hoy_4.HOY, Step=1, Count=subtraction_14)  # disabled
item_188 = ListItem(List=dispatch_118.ListA, Index=series_55, Wrap=True)  # disabled

equals_78 = Equality(FirstNumber=ma_15.Result, SecondNumber="0")  # -> Equality, Inequality
dispatch_120 = Dispatch(List=ma_23.Result, DispatchPattern=equals_78.Equality)  # -> ListA, ListB

adaptivechart_2 = Ladybug_AdaptiveComfortChart(
    dryBulbTemperature=readepresult.airTemperature,
    meanRadiantTemperature=readepresult.meanRadTemperature,
    outdoorTemperature=importepw_2.dryBulbTemperature,
    windSpeed=air_speed_from_ceiling_fans,
    comfortPar=adaptcomfortpar_2,
    basePoint=pt_3,
    runIt=toggle_11)  # -> readMe, comfPercentOfTime, percentHotCold, comfortableOrNot, conditionOfPerson, degreesFromTarget, prevailingTemp, targetTemperature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; disabled; plug-in component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

equals_79 = Equality(FirstNumber=data_126, SecondNumber="1")  # -> Equality, Inequality
dispatch_121 = Dispatch(List=ma_24.Result, DispatchPattern=equals_79.Equality)  # -> ListA, ListB

equals_80 = Equality(FirstNumber=data_126, SecondNumber="1")  # -> Equality, Inequality
dispatch_122 = Dispatch(List=dispatch_119.ListB, DispatchPattern=equals_80.Equality)  # -> ListA, ListB

equals_81 = Equality(FirstNumber=data_126, SecondNumber="1")  # -> Equality, Inequality
dispatch_123 = Dispatch(List=ma_25.Result, DispatchPattern=equals_81.Equality)  # -> ListA, ListB

equals_82 = Equality(FirstNumber=data_126, SecondNumber="1")  # -> Equality, Inequality
dispatch_124 = Dispatch(List=dispatch_120.ListB, DispatchPattern=equals_82.Equality)  # -> ListA, ListB

ma_26 = MassAddition(Input=item_187)  # -> flatten(Result), PartialResults
division_27 = Division(A=ma_26.Result, B=subtraction_13)

preview_30 = CustomPreview(Geometry=[adaptivechart_2.chartCurvesAndTxt, adaptivechart_2.comfortPolygons], Shader=swatch_7)
mesh = Mesh(adaptivechart_2.adaptiveChartMesh)  # disabled

# ----
# IOD
data_220 = Data(division_27)
null_22 = NullItem(Item=data_220)  # -> NullFlags, InvalidFlags, Description
dispatch_125 = Dispatch(List=data_220, DispatchPattern=null_22.NullFlags)  # -> ListA, ListB

equals_83 = Equality(FirstNumber=data_126, SecondNumber="1")  # -> Equality, Inequality
dispatch_126 = Dispatch(List=dispatch_125.ListB, DispatchPattern=equals_83.Equality)  # -> ListA, ListB

panel_663 = Panel("4")  # disabled
panel_664 = Panel("11")  # disabled
panel_665 = Panel("7")  # disabled
panel_666 = Panel("5")  # disabled
panel_667 = Panel("12")  # disabled
panel_668 = Panel("2")  # disabled
panel_669 = Panel("8")  # disabled
panel_670 = Panel("9")  # disabled
panel_671 = Panel("3")  # disabled
panel_672 = Panel("10")  # disabled
panel_673 = Panel("13")  # disabled
panel_674 = Panel("6")  # disabled
branch_28 = TreeBranch(Tree=item_188, Path=panel_664, MaintainPaths=True)  # disabled
branch_29 = TreeBranch(Tree=item_188, Path=panel_663, MaintainPaths=True)  # disabled
branch_30 = TreeBranch(Tree=item_188, Path=panel_667, MaintainPaths=True)  # disabled
branch_31 = TreeBranch(Tree=item_188, Path=panel_666, MaintainPaths=True)  # disabled
branch_32 = TreeBranch(Tree=item_188, Path=panel_665, MaintainPaths=True)  # disabled
branch_33 = TreeBranch(Tree=item_188, Path=panel_670, MaintainPaths=True)  # disabled
branch_34 = TreeBranch(Tree=item_188, Path=panel_668, MaintainPaths=True)  # disabled
branch_35 = TreeBranch(Tree=item_188, Path=panel_669, MaintainPaths=True)  # disabled
branch_36 = TreeBranch(Tree=item_188, Path=panel_673, MaintainPaths=True)  # disabled
branch_37 = TreeBranch(Tree=item_188, Path=panel_674, MaintainPaths=True)  # disabled
branch_38 = TreeBranch(Tree=item_188, Path=panel_672, MaintainPaths=True)  # disabled
branch_39 = TreeBranch(Tree=item_188, Path=panel_671, MaintainPaths=True)  # disabled
weave_59 = Weave(
    Pattern=[0, 1, 2, 3, 4, 5, 6, 7, 8, 9, 10, 11],
    Stream0=branch_34,
    Stream1=branch_39,
    Stream2=branch_29,
    Stream3=branch_31,
    Stream4=branch_37,
    Stream5=branch_32,
    Stream6=branch_35,
    Stream7=branch_33,
    Stream8=branch_38,
    Stream9=branch_28,
    Stream10=branch_30,
    Stream11=branch_36,
    NullGaps=False)  # disabled

lng_144 = ListLength(List=dispatch_126.ListB)  # disabled

partition_63 = PartitionList(List=weave_59, Size=lng_144)  # -> simplify(Chunks); disabled
series_56 = Series(Start=0, Step=1, Count=lng_144)  # disabled
panel_675 = Panel(",")  # disabled
join_40 = TextJoin(Text=partition_63, Join=panel_675)  # -> simplify(Result); disabled

tstat_29 = TreeStatistics(Tree=join_40)  # -> Paths, Length, Count; disabled
lng_145 = ListLength(List=tstat_29.Length)  # disabled
series_57 = Series(Start=0, Step=1, Count=lng_145)  # disabled
panel_676 = Panel(";")  # disabled
panel_677 = Panel("}")  # disabled
dup_97 = DuplicateData(Data=panel_677, Number=lng_145, Order=True)  # disabled
panel_678 = Panel("{")  # disabled
dup_98 = DuplicateData(Data=panel_676, Number=lng_145, Order=True)  # disabled
dup_99 = DuplicateData(Data=item_132, Number=lng_145, Order=True)  # disabled
dup_100 = DuplicateData(Data=panel_678, Number=lng_145, Order=True)  # disabled
merge_134 = Merge(
    Data1=simplify(graft(dup_100)),
    Data2=simplify(graft(dup_99)),
    Data3=simplify(graft(dup_98)),
    Data4=simplify(graft(series_57)),
    Data5=simplify(graft(dup_97)))  # disabled
join_41 = TextJoin(Text=merge_134)  # disabled
replace_37 = ReplacePaths(Data=join_40, Search=flatten(tstat_29.Paths), Replace=flatten(join_41))  # disabled

# ----
# https://discourse.mcneel.com/t/improvement-of-data-recorder-rec/56940/7
toggle_31 = BooleanToggle(True)  # disabled
panel_679 = Panel("1000000")  # disabled
panel_680 = Panel("improved data recorder")  # disabled
data_rec = PythonScript(x=replace_37, enable=toggle_31, reset=button, limit=panel_679)  # -> x; inputs x: tree, enable: Boolean, reset: Boolean, limit: Int32; disabled
# ---------- data_rec: Python ----------
from Grasshopper import DataTree
if reset or 'rec' not in globals(): rec = DataTree[object]()
if enable and not reset: rec.MergeTree(x)
if limit > 0:
  for branch in rec.Branches:
    if branch.Count > limit:
      branch.RemoveRange(0, branch.Count - limit)
x = rec
# ---------- end data_rec ----------

toggle_32 = BooleanToggle(True)  # disabled
panel_681 = Panel("csv recording")  # disabled
path_15 = FilePath("C:\KBEM\IP2.1\csv\IODannual.csv")  # disabled
c_script_2 = CSharpScript(save=toggle_32, path=path_15, data=flatten(data_rec))  # inputs save: Boolean, path: String, data: list of String; disabled
# ---------- c_script_2: C# ----------
    if(save){
      var fileinfo = new System.IO.FileInfo(path);
      if(!fileinfo.Directory.Exists){
        fileinfo.Directory.Create();
      }
      
      var sw = fileinfo.CreateText();
      for(int i = 0; i < data.Count; i++){
        string row = data[i];
        if(i < data.Count - 1){
          sw.WriteLine(row);
        }else{
          sw.Write(row);
        }
      }
      
      sw.Flush();
      sw.Close();
    }
# ---------- end c_script_2 ----------

avr_11 = Average(Input=dispatch_126.ListB)
avr_12 = Average(Input=dispatch_113.ListB)
ma_27 = MassAddition(Input=dispatch_126.ListB)  # -> Result, PartialResults
ma_28 = MassAddition(Input=dispatch_113.ListB)  # -> Result, PartialResults

# ----
# Solar Gain
flrnorm_10 = Honeybee_NormalizeDataByFloorArea(simData=readepresult.totalSolarGain, HBZones=flatten(geo_96))  # -> totNormData, zoneNormData; plug-in component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
strnum_21 = Ladybug_SeparateData(inputList=flatten(flrnorm_10.zoneNormData))  # -> numbers, strings; plug-in component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
ma_29 = MassAddition(Input=strnum_21.numbers)  # -> flatten(Result), PartialResults
lng_146 = ListLength(List=ma_29.Result)
equals_84 = Equality(FirstNumber=ma_29.Result, SecondNumber="0")  # -> Equality, Inequality
series_58 = Series(Start=0, Step=1, Count=lng_146)
dispatch_127 = Dispatch(List=series_58, DispatchPattern=equals_84.Equality)  # -> ListA, ListB

# ----
# equipment
strnum_22 = Ladybug_SeparateData(inputList=flatten(readepresult.electricEquip))  # -> numbers, strings; plug-in component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
branch_40 = TreeBranch(Tree=strnum_22.numbers, Path=dispatch_127.ListB, MaintainPaths=True)

# ----
# electLight
strnum_23 = Ladybug_SeparateData(inputList=flatten(readepresult.electricLight))  # -> numbers, strings; plug-in component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
branch_41 = TreeBranch(Tree=strnum_23.numbers, Path=dispatch_127.ListB, MaintainPaths=True)

flip = FlipMatrix(Data=branch_40)
avr_13 = Average(Input=flip)  # -> flatten(ArithmeticMean)

flip_2 = FlipMatrix(Data=branch_41)
avr_14 = Average(Input=flip_2)  # -> flatten(ArithmeticMean)

roundd_7 = RoundToDecimalPlace(NumberX=avr_13, DecimalPlace="2", RoundType=0)  # -> Rounded, Difference

# ----
# AirTemp
strnum_24 = Ladybug_SeparateData(inputList=flatten(readepresult.airTemperature))  # -> numbers, strings; plug-in component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
branch_42 = TreeBranch(Tree=strnum_24.numbers, Path=dispatch_127.ListB, MaintainPaths=True)

# ----
# OperativeTemp
strnum_25 = Ladybug_SeparateData(inputList=flatten(readepresult.operativeTemperature))  # -> numbers, strings; plug-in component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
branch_43 = TreeBranch(Tree=strnum_25.numbers, Path=dispatch_127.ListB, MaintainPaths=True)

roundd_8 = RoundToDecimalPlace(NumberX=avr_14, DecimalPlace="2", RoundType=0)  # -> Rounded, Difference

# ----
# AdaptiveComfort
# MeanRadAirTemp
strnum_26 = Ladybug_SeparateData(inputList=flatten(readepresult.meanRadTemperature))  # -> numbers, strings; plug-in component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
branch_44 = TreeBranch(Tree=strnum_26.numbers, Path=dispatch_127.ListB, MaintainPaths=True)

flip_3 = FlipMatrix(Data=branch_42)
avr_15 = Average(Input=flip_3)  # -> flatten(ArithmeticMean)

flip_4 = FlipMatrix(Data=branch_43)
avr_16 = Average(Input=flip_4)  # -> flatten(ArithmeticMean)

flip_5 = FlipMatrix(Data=branch_44)
avr_17 = Average(Input=flip_5)  # -> flatten(ArithmeticMean)

roundd_9 = RoundToDecimalPlace(NumberX=avr_16, DecimalPlace="2", RoundType=0)  # -> Rounded, Difference

roundd_10 = RoundToDecimalPlace(NumberX=avr_15, DecimalPlace="2", RoundType=0)  # -> Rounded, Difference

roundd_11 = RoundToDecimalPlace(NumberX=avr_17, DecimalPlace="2", RoundType=0)  # -> Rounded, Difference

panel_682 = Panel("csv recording")
c_script_3 = CSharpScript(save=Toggle(True), path=join_19, data=flatten(roundd_7.Rounded))  # inputs save: Boolean, path: String, data: list of String; same code as c_script_2

c_script_4 = CSharpScript(save=Toggle(True), path=join_20, data=flatten(roundd_8.Rounded))  # inputs save: Boolean, path: String, data: list of String; same code as c_script_2

c_script_5 = CSharpScript(save=Toggle(True), path=join_24, data=flatten(roundd_9.Rounded))  # inputs save: Boolean, path: String, data: list of String; same code as c_script_2

c_script_6 = CSharpScript(save=Toggle(True), path=join_25, data=flatten(roundd_10.Rounded))  # inputs save: Boolean, path: String, data: list of String; same code as c_script_2

c_script_7 = CSharpScript(save=Toggle(True), path=join_26, data=flatten(roundd_11.Rounded))  # inputs save: Boolean, path: String, data: list of String; same code as c_script_2

intcrv_2 = Interpolate(Vertices=merge_102, Degree=3, Periodic=Toggle(True), KnotStyle=1)  # -> flatten(Curve), Length, Domain

area_93 = Area(Geometry=intcrv_2.Curve)  # -> Area, Centroid
# regions start from north
# continues counter-clockwise
pdecon_25 = Deconstruct(Point=area_93.Centroid)  # -> XComponent, YComponent, ZComponent
sort_43 = SortList(Keys=pdecon_25.YComponent, ValuesA=intcrv_2.Curve)  # -> Keys, reverse(ValuesA)
item_189 = ListItem(List=sort_43.ValuesA, Index=0, Wrap=True)

area_94 = Area(Geometry=intcrv_2.Curve)  # -> Area, Centroid
pdecon_26 = Deconstruct(Point=area_94.Centroid)  # -> XComponent, YComponent, ZComponent
sort_44 = SortList(Keys=pdecon_26.XComponent, ValuesA=intcrv_2.Curve)  # -> Keys, reverse(ValuesA)
item_190 = ListItem(List=sort_44.ValuesA, Index=0, Wrap=True)

area_95 = Area(Geometry=intcrv_2.Curve)  # -> Area, Centroid
pdecon_27 = Deconstruct(Point=area_95.Centroid)  # -> XComponent, YComponent, ZComponent
sort_45 = SortList(Keys=pdecon_27.XComponent, ValuesA=intcrv_2.Curve)  # -> Keys, ValuesA
item_191 = ListItem(List=sort_45.ValuesA, Index=0, Wrap=True)

area_96 = Area(Geometry=intcrv_2.Curve)  # -> Area, Centroid
pdecon_28 = Deconstruct(Point=area_96.Centroid)  # -> XComponent, YComponent, ZComponent
sort_46 = SortList(Keys=pdecon_28.YComponent, ValuesA=intcrv_2.Curve)  # -> Keys, ValuesA
item_192 = ListItem(List=sort_46.ValuesA, Index=0, Wrap=True)

merge_135 = Merge(Data1=item_189, Data2=item_191, Data3=item_192, Data4=item_190)

panel_687 = Panel("""Window
Directions""")
incurves_10 = PointInCurves(Point=area_69.Centroid, Curves=merge_135)  # -> Relationship, Index, Point

cull_i_37 = CullIndex(List=partition_53, Indices=incurves_10.Index, Wrap=True)  # -> simplify(List)
panel_688 = Panel("""NO-Window
Directions""")

replace_38 = ReplaceItems(List=partition_54, Item="3", Indices=incurves_10.Index, Wrap=False)  # -> simplify(List)
replace_39 = ReplaceItems(List=replace_38, Item="2", Indices=cull_i_37, Wrap=False)

# ----
# WWR by directions
lng_147 = ListLength(List=replace_39)  # -> simplify(flatten(Length))
lng_148 = ListLength(List=lng_147)  # -> simplify(Length)
dup_101 = DuplicateData(Data=data_125, Number=lng_148, Order=True)
lng_149 = ListLength(List=data_125)
partition_64 = PartitionList(List=dup_101, Size=lng_149)  # -> simplify(Chunks)

mindex_10 = MemberIndex(Set=replace_39, Member="2")  # -> simplify(Index), Count

panel_689 = Panel("WWR by directions")
replace_40 = ReplaceItems(List=partition_64, Item="0", Indices=mindex_10.Index, Wrap=False)  # -> simplify(List)

panel_690 = Panel("wwrByDirections")
data_221 = Data(replace_40)

equals_85 = Equality(FirstNumber=data_221, SecondNumber="0")  # -> Equality, Inequality
dispatch_128 = Dispatch(List=data_221, DispatchPattern=equals_85.Equality)  # -> ListA, ListB
tmatch_2 = MatchText(Text=data_221, Pattern=dispatch_128.ListB, Case=True)
python_51 = GhPythonScript(x=tmatch_2)  # -> out, a; inputs x: list
# ---------- python_51: Python ----------
__author__ = "Siser"
__version__ = "2022.02.23"

import rhinoscriptsyntax as rs
TrueList=[]
for i in range(len(x)):
    if x[i] == 'True':
        TrueList.append(i)
    else:
        pass
a = TrueList
# ---------- end python_51 ----------

# ----
# ObstacleShadingCoefficient_IC
mindex_11 = MemberIndex(Set=data_221)  # -> Index, Count; disabled
panel_691 = Panel(pshift_10)

# ----
# SkyExposure_ic
panel_692 = Panel("0")
shadingmask = Ladybug_ShadingMask(centerPtOrPlane=area_67.Centroid, context=hb_epcontextsrf)  # -> contextMask, orientationMask, strategyMask, skyMask, port, contextExposure, orientExposure, strategyExposure, skyExposure; plug-in component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
equals_86 = Equality(FirstNumber=data_221, SecondNumber=panel_692)  # -> Equality, Inequality
dispatch_129 = Dispatch(List=data_221, DispatchPattern=equals_86.Equality)  # -> ListA, ListB
tmatch_3 = MatchText(Text=data_221, Pattern=dispatch_129.ListB, Case=True)
python_52 = GhPythonScript(x=tmatch_3)  # -> out, a; inputs x: list; same code as python_51
replace_41 = ReplaceItems(List=data_221, Item=shadingmask.skyExposure, Indices=python_52.a, Wrap=False)  # -> simplify(List)
panel_693 = Panel(replace_41)

data_222 = Data(replace_40)

# ----
# Window area/floor area
# Obstacle
# Shading
# Coefficient_IC
debrep_31 = DeconstructBrep(Brep=mass2zone_3.HBZones)  # -> simplify(Faces), Edges, Vertices
item_193 = ListItem(List=debrep_31.Faces, Index=0, Wrap=True)
area_97 = Area(Geometry=decomposebytype.windows)  # -> Area, Centroid
area_98 = Area(Geometry=item_193)  # -> Area, Centroid
division_28 = Division(A=simplify(area_97.Area), B=area_98.Area)
replace_42 = ReplaceItems(List=data_222, Item=division_28, Indices=python_51.a, Wrap=False)  # -> simplify(List)

data_223 = Data(replace_40)

data_224 = Data(replace_40)

# ----
# summation record
# (it gives
# one result for each
# window unit)
replace_43 = ReplaceItems(List=data_223, Item=pshift_10, Indices=python_51.a, Wrap=False)  # -> simplify(List)

# ----
# average record
# (it gives
# one result for each
# window unit)
replace_44 = ReplaceItems(List=data_224, Item=pshift_9, Indices=python_51.a, Wrap=False)  # -> simplify(List)

# ----
# WWRDirectionUnitNorth
item_194 = ListItem(List=replace_40, Index=0, Wrap=True)  # -> flatten(Item)

# ----
# WWRDirectionUnitSouth
item_195 = ListItem(List=replace_40, Index=2, Wrap=True)  # -> flatten(Item)

# ----
# WWRDirectionUnitEast
item_196 = ListItem(List=replace_40, Index=3, Wrap=True)  # -> flatten(Item)

# ----
# WWRDirectionUnitWest
item_197 = ListItem(List=replace_40, Index=1, Wrap=True)  # -> flatten(Item)

# ----
# AvOSC South
item_198 = ListItem(List=replace_44, Index=2, Wrap=True)  # -> flatten(Item)

# ----
# AvOSC North
item_199 = ListItem(List=replace_44, Index=0, Wrap=True)  # -> flatten(Item)

# ----
# AvOSC East
item_200 = ListItem(List=replace_44, Index=3, Wrap=True)  # -> flatten(Item)

# ----
# AvOSC West
item_201 = ListItem(List=replace_44, Index=1, Wrap=True)  # -> flatten(Item)

equals_87 = Equality(FirstNumber=data_126, SecondNumber="1")  # -> Equality, Inequality
dispatch_130 = Dispatch(List=item_194, DispatchPattern=equals_87.Equality)  # -> ListA, ListB

equals_88 = Equality(FirstNumber=data_126, SecondNumber="1")  # -> Equality, Inequality
dispatch_131 = Dispatch(List=item_195, DispatchPattern=equals_88.Equality)  # -> ListA, ListB

equals_89 = Equality(FirstNumber=data_126, SecondNumber="1")  # -> Equality, Inequality
dispatch_132 = Dispatch(List=item_197, DispatchPattern=equals_89.Equality)  # -> ListA, ListB

equals_90 = Equality(FirstNumber=data_126, SecondNumber="1")  # -> Equality, Inequality
dispatch_133 = Dispatch(List=item_196, DispatchPattern=equals_90.Equality)  # -> ListA, ListB

equals_91 = Equality(FirstNumber=data_126, SecondNumber="1")  # -> Equality, Inequality
dispatch_134 = Dispatch(List=item_199, DispatchPattern=equals_91.Equality)  # -> ListA, ListB

equals_92 = Equality(FirstNumber=data_126, SecondNumber="1")  # -> Equality, Inequality
dispatch_135 = Dispatch(List=item_198, DispatchPattern=equals_92.Equality)  # -> ListA, ListB

equals_93 = Equality(FirstNumber=data_126, SecondNumber="1")  # -> Equality, Inequality
dispatch_136 = Dispatch(List=item_200, DispatchPattern=equals_93.Equality)  # -> ListA, ListB

equals_94 = Equality(FirstNumber=data_126, SecondNumber="1")  # -> Equality, Inequality
dispatch_137 = Dispatch(List=item_201, DispatchPattern=equals_94.Equality)  # -> ListA, ListB

# ----
# SumOSC North
item_202 = ListItem(List=replace_43, Index=0, Wrap=True)  # -> flatten(Item)

# ----
# SumOSC West
item_203 = ListItem(List=replace_43, Index=1, Wrap=True)  # -> flatten(Item)

# ----
# SumOSC East
item_204 = ListItem(List=replace_43, Index=3, Wrap=True)  # -> flatten(Item)

# ----
# W/F East
item_205 = ListItem(List=replace_42, Index=3, Wrap=True)  # -> flatten(Item)

# ----
# SumOSC South
item_206 = ListItem(List=replace_43, Index=2, Wrap=True)  # -> flatten(Item)

# ----
# W/F North
item_207 = ListItem(List=replace_42, Index=0, Wrap=True)  # -> flatten(Item)

# ----
# W/F South
item_208 = ListItem(List=replace_42, Index=2, Wrap=True)  # -> flatten(Item)

# ----
# W/F West
item_209 = ListItem(List=replace_42, Index=1, Wrap=True)  # -> flatten(Item)

equals_95 = Equality(FirstNumber=data_126, SecondNumber="1")  # -> Equality, Inequality
dispatch_138 = Dispatch(List=item_202, DispatchPattern=equals_95.Equality)  # -> ListA, ListB

equals_96 = Equality(FirstNumber=data_126, SecondNumber="1")  # -> Equality, Inequality
dispatch_139 = Dispatch(List=item_204, DispatchPattern=equals_96.Equality)  # -> ListA, ListB

equals_97 = Equality(FirstNumber=data_126, SecondNumber="1")  # -> Equality, Inequality
dispatch_140 = Dispatch(List=item_203, DispatchPattern=equals_97.Equality)  # -> ListA, ListB

equals_98 = Equality(FirstNumber=data_126, SecondNumber="1")  # -> Equality, Inequality
dispatch_141 = Dispatch(List=item_208, DispatchPattern=equals_98.Equality)  # -> ListA, ListB

equals_99 = Equality(FirstNumber=data_126, SecondNumber="1")  # -> Equality, Inequality
dispatch_142 = Dispatch(List=item_206, DispatchPattern=equals_99.Equality)  # -> ListA, ListB

equals_100 = Equality(FirstNumber=data_126, SecondNumber="1")  # -> Equality, Inequality
dispatch_143 = Dispatch(List=item_209, DispatchPattern=equals_100.Equality)  # -> ListA, ListB

equals_101 = Equality(FirstNumber=data_126, SecondNumber="1")  # -> Equality, Inequality
dispatch_144 = Dispatch(List=item_207, DispatchPattern=equals_101.Equality)  # -> ListA, ListB

equals_102 = Equality(FirstNumber=data_126, SecondNumber="1")  # -> Equality, Inequality
dispatch_145 = Dispatch(List=item_205, DispatchPattern=equals_102.Equality)  # -> ListA, ListB

separatezonesbyprogram = Honeybee_SeparateZonesByProgram(HBZones=flatten(conditionedunconditioned_7.conditionedZones))  # -> zonePrograms, HBZones; plug-in component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

mindex_12 = MemberIndex(Set=flatten(separatezonesbyprogram.zonePrograms), Member="MidriseApartment::Office")  # -> Index, Count

branch_45 = TreeBranch(Tree=separatezonesbyprogram.HBZones, Path=mindex_12.Index, MaintainPaths=True)

area_99 = Area(Geometry=geo_98)  # -> Area, Centroid
area_100 = Area(Geometry=branch_45)  # -> Area, Centroid
cps_2 = ClosestPoints(Point=area_100.Centroid, Cloud=area_99.Centroid, Count="1")  # -> ClosestPoint, flatten(CPIndex), Distance
panel_713 = Panel("find office units")
panel_714 = Panel(cps_2.CPIndex)

# ----
# floorArea of Units
zoneattributelist_2 = Honeybee_ZoneAttributeList({"Name": "name", "Zone Program": "zoneProgram", "Zone Floor Area": "zoneFloorArea", "Zone Volume": "zoneVolume", "Building Program": "bldgProgram", "Is Conditioned": "isConditioned", "HVAC System Type": "HVACSystem", "Occupancy Schedule": "occupancySchedule", "Occupancy Activity Schedule": "occupancyActivitySch", "Heating SetPoint Schedule": "heatingSetPtSchedule"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}, selected="Zone Floor Area")
labelzones_2 = Honeybee_LabelZones(HBZones=flatten(conditionedunconditioned_7.conditionedZones), attribute=zoneattributelist_2)  # -> zoneTxtLabels, labelBasePts, brepTxtLabels, zoneWireFrames; plug-in component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
roundd_12 = RoundToDecimalPlace(NumberX=labelzones_2.zoneTxtLabels, DecimalPlace="1", RoundType=0)  # -> Rounded, Difference

equals_103 = Equality(FirstNumber=data_126, SecondNumber="1")  # -> Equality, Inequality
dispatch_146 = Dispatch(List=roundd_12.Rounded, DispatchPattern=equals_103.Equality)  # -> ListA, ListB

rec_8 = DataRecorder(dispatch_146.ListB, DataLimit=-10, RecordData=True)
panel_716 = Panel(rec_8)

# ----
# formFactor of Units
data_225 = Data(flatten(division_21))
roundd_13 = RoundToDecimalPlace(NumberX=data_225, DecimalPlace="3", RoundType=0)  # -> Rounded, Difference

equals_104 = Equality(FirstNumber=data_126, SecondNumber="1")  # -> Equality, Inequality
dispatch_147 = Dispatch(List=roundd_13.Rounded, DispatchPattern=equals_104.Equality)  # -> ListA, ListB

rec_9 = DataRecorder(dispatch_147.ListB, DataLimit=-10, RecordData=True)
panel_718 = Panel(rec_9)

# ----
# SkyExposure_East
item_210 = ListItem(List=replace_41, Index=3, Wrap=True)  # -> flatten(Item)

equals_105 = Equality(FirstNumber=data_126, SecondNumber="1")  # -> Equality, Inequality
dispatch_148 = Dispatch(List=item_210, DispatchPattern=equals_105.Equality)  # -> ListA, ListB

data_226 = Data(dispatch_148.ListB)
rec_10 = DataRecorder(data_226, DataLimit=-10, RecordData=True)
panel_720 = Panel(rec_10)

# ----
# SkyExposure_West
item_211 = ListItem(List=replace_41, Index=1, Wrap=True)  # -> flatten(Item)

equals_106 = Equality(FirstNumber=data_126, SecondNumber="1")  # -> Equality, Inequality
dispatch_149 = Dispatch(List=item_211, DispatchPattern=equals_106.Equality)  # -> ListA, ListB

rec_11 = DataRecorder(dispatch_149.ListB, DataLimit=-10, RecordData=True)
panel_722 = Panel(rec_11)

# ----
# SkyExposure_South
item_212 = ListItem(List=replace_41, Index=2, Wrap=True)  # -> flatten(Item)

equals_107 = Equality(FirstNumber=data_126, SecondNumber="1")  # -> Equality, Inequality
dispatch_150 = Dispatch(List=item_212, DispatchPattern=equals_107.Equality)  # -> ListA, ListB

data_227 = Data(dispatch_150.ListB)
rec_12 = DataRecorder(data_227, DataLimit=-10, RecordData=True)
panel_724 = Panel(rec_12)

# ----
# SkyExposure_North
item_213 = ListItem(List=replace_41, Index=0, Wrap=True)  # -> flatten(Item)

equals_108 = Equality(FirstNumber=data_126, SecondNumber="1")  # -> Equality, Inequality
dispatch_151 = Dispatch(List=item_213, DispatchPattern=equals_108.Equality)  # -> ListA, ListB

rec_13 = DataRecorder(dispatch_151.ListB, DataLimit=-10, RecordData=True)
panel_726 = Panel(rec_13)

# ----
# Unıt ID
data_228 = Data(join_34)

equals_109 = Equality(FirstNumber=data_126, SecondNumber="1")  # -> Equality, Inequality
dispatch_152 = Dispatch(List=data_228, DispatchPattern=equals_109.Equality)  # -> ListA, ListB

rec_14 = DataRecorder(dispatch_152.ListB, DataLimit=-10, RecordData=True)
panel_728 = Panel(rec_14)

panel_729 = Panel(dispatch_152.ListB)

list_of_recordings_2 = Panel("""parcelUBEM
blockUBEM
UnitID
verticalBoundary
formFactor
floorArea
widthToDepth
unitwwrNorth
unitwwrWest
unitwwrSouth
unitwwrEast
skyExposureNorth
skyExposureWest
skyExposureSouth
skyExposureEast
WFNorth
WFWest
WFSouth
WFEast
NumberOfPeople
HeatSet
LightDens
equipDens
ConsDate
uWall
uWindow
uRoof
uGroundFloor
SHGCWindow
VTWindow
Infiltration
UBEMOcc
boilerEfficiency
z-axisOfUnit
OSCNorthAvg
OSCWestAvg
OSCSouthAvg
OSCEastAvg
TotOSCNorth
TotOSCWest
TotOSCSouth
TotOSCEast""")

list_of_recordings_3 = Panel("""parcelUBEM
blockUBEM
UnitID
verticalPos
formFactor
floorArea
widthToDepth
unitwwrNorth
unitwwrWest
unitwwrSouth
unitwwrEast
skyExposureNorth
skyExposureEast
skyExposureSouth
skyExposureWest
WFNorth
WFWest
WFSouth
WFEast
PeoplePerSqm
HeatSet
LightDens
equipDens
ConsDate
uWall
uWindow
uRoof
uGroundFloor
SHGCWindow
VTWindow
Infiltration
UBEMOcc
boilerEfficiency
heating
cooling
IOD
peopleGain
TotSolarGain
infiltEnergy
natVentEnergy
mechVentilation
airTemp
meanRadiantTemperature
electLight
electEquip
z-axisOfUnit
OSCNorthAvg
OSCWestAvg
OSCSouthAvg
OSCEastAvg
TotOSCNorth
TotOSCWest
TotOSCSouth
TotOSCEast""")

list_of_recordings_4 = Panel("""buildingID
heatingAverage
heatingSum
IODAverage
IODSum""")

# ----
# CSV
# RECORDINGS
# Building-Based
lng_150 = ListLength(List=list_of_recordings_4)

# ----
# CSV
# RECORDINGS
# PARAMS
# M.L.
lng_151 = ListLength(List=list_of_recordings_2)

# ----
# CSV
# RECORDINGS
# ALL
# M.L.
lng_152 = ListLength(List=list_of_recordings_3)

series_59 = Series(Start=0, Step=1, Count=lng_151)

weave_60 = Weave(
    Pattern=series_59,
    Stream0=dispatch_81.ListB,
    Stream1=dispatch_85.ListB,
    Stream2=dispatch_152.ListB,
    Stream3=dispatch_78.ListB,
    Stream4=dispatch_147.ListB,
    Stream5=dispatch_146.ListB,
    Stream6=dispatch_77.ListB,
    Stream7=dispatch_130.ListB,
    Stream8=dispatch_132.ListB,
    Stream9=dispatch_131.ListB,
    Stream10=dispatch_133.ListB,
    Stream11=dispatch_151.ListB,
    Stream12=dispatch_149.ListB,
    Stream13=dispatch_150.ListB,
    Stream14=dispatch_148.ListB,
    Stream15=dispatch_144.ListB,
    Stream16=dispatch_143.ListB,
    Stream17=dispatch_141.ListB,
    Stream18=dispatch_145.ListB,
    Stream19=dispatch_69.ListB,
    Stream20=dispatch_64.ListB,
    Stream21=data_189,
    Stream22=weave_46,
    Stream23=dispatch_84.ListB,
    Stream24=dispatch_76.ListB,
    Stream25=dispatch_25.ListB,
    Stream26=dispatch_75.ListB,
    Stream27=dispatch_26.ListB,
    Stream28=dispatch_82.ListB,
    Stream29=dispatch_80.ListB,
    Stream30=dispatch_83.ListB,
    Stream31=data_191,
    Stream32=dispatch_79.ListB,
    Stream33=dispatch_86.ListB,
    Stream34=dispatch_134.ListB,
    Stream35=dispatch_137.ListB,
    Stream36=dispatch_135.ListB,
    Stream37=dispatch_136.ListB,
    Stream38=dispatch_138.ListB,
    Stream39=dispatch_140.ListB,
    Stream40=dispatch_142.ListB,
    Stream41=dispatch_139.ListB,
    NullGaps=False)

partition_65 = PartitionList(List=weave_60, Size=lng_151)  # -> simplify(Chunks)
join_42 = TextJoin(Text=partition_65, Join=",")  # -> simplify(Result)

tstat_30 = TreeStatistics(Tree=join_42)  # -> Paths, Length, Count
lng_153 = ListLength(List=tstat_30.Length)
series_60 = Series(Start=0, Step=1, Count=lng_153)
dup_102 = DuplicateData(Data="}", Number=lng_153, Order=True)
dup_103 = DuplicateData(Data=";", Number=lng_153, Order=True)
dup_104 = DuplicateData(Data=item_133, Number=lng_153, Order=True)
dup_105 = DuplicateData(Data="{", Number=lng_153, Order=True)
merge_136 = Merge(
    Data1=simplify(graft(dup_105)),
    Data2=simplify(graft(dup_104)),
    Data3=simplify(graft(dup_103)),
    Data4=simplify(graft(series_60)),
    Data5=simplify(graft(dup_102)))
join_43 = TextJoin(Text=merge_136)
replace_45 = ReplacePaths(Data=join_42, Search=flatten(tstat_30.Paths), Replace=flatten(join_43))

# ----
# https://discourse.mcneel.com/t/improvement-of-data-recorder-rec/56940/7
toggle_33 = BooleanToggle(True)
panel_730 = Panel("improved data recorder")
data_rec_2 = PythonScript(x=replace_45, enable=toggle_33, reset=button, limit="1000000")  # -> x; inputs x: tree, enable: Boolean, reset: Boolean, limit: Int32; same code as data_rec

panel_731 = Panel(data_rec_2)

weave_61 = Weave(Pattern=list, Stream0=path_6, Stream1=path_8, Stream2=path_7, Stream3=path_9, NullGaps=False)
c_script_8 = CSharpScript(save=Toggle(True), path=weave_61, data=flatten(data_rec_2))  # inputs save: Boolean, path: String, data: list of String; same code as c_script_2

series_61 = Series(Start=0, Step=1, Count=lng_152)

weave_62 = Weave(
    Pattern=series_61,
    Stream0=dispatch_81.ListB,
    Stream1=dispatch_85.ListB,
    Stream2=dispatch_152.ListB,
    Stream3=dispatch_78.ListB,
    Stream4=dispatch_147.ListB,
    Stream5=dispatch_146.ListB,
    Stream6=dispatch_77.ListB,
    Stream7=dispatch_130.ListB,
    Stream8=dispatch_132.ListB,
    Stream9=dispatch_131.ListB,
    Stream10=dispatch_133.ListB,
    Stream11=dispatch_151.ListB,
    Stream12=data_226,
    Stream13=data_227,
    Stream14=dispatch_149.ListB,
    Stream15=dispatch_144.ListB,
    Stream16=dispatch_143.ListB,
    Stream17=dispatch_141.ListB,
    Stream18=dispatch_145.ListB,
    Stream19=dispatch_69.ListB,
    Stream20=dispatch_64.ListB,
    Stream21=data_189,
    Stream22=weave_46,
    Stream23=dispatch_84.ListB,
    Stream24=dispatch_76.ListB,
    Stream25=dispatch_25.ListB,
    Stream26=dispatch_75.ListB,
    Stream27=dispatch_26.ListB,
    Stream28=dispatch_82.ListB,
    Stream29=dispatch_80.ListB,
    Stream30=dispatch_83.ListB,
    Stream31=data_191,
    Stream32=dispatch_79.ListB,
    Stream33=division_26,
    Stream34=dispatch_112.ListB,
    Stream35=dispatch_126.ListB,
    Stream36=dispatch_111.ListB,
    Stream37=dispatch_117.ListB,
    Stream38=dispatch_115.ListB,
    Stream39=dispatch_114.ListB,
    Stream40=dispatch_123.ListB,
    Stream41=dispatch_109.ListB,
    Stream42=dispatch_122.ListB,
    Stream43=dispatch_124.ListB,
    Stream44=dispatch_121.ListB,
    Stream45=dispatch_86.ListB,
    Stream46=dispatch_134.ListB,
    Stream47=dispatch_137.ListB,
    Stream48=dispatch_135.ListB,
    Stream49=dispatch_136.ListB,
    Stream50=dispatch_138.ListB,
    Stream51=dispatch_140.ListB,
    Stream52=dispatch_142.ListB,
    Stream53=dispatch_139.ListB,
    NullGaps=False)

partition_66 = PartitionList(List=weave_62, Size=lng_152)  # -> simplify(Chunks)
join_44 = TextJoin(Text=partition_66, Join=",")  # -> simplify(Result)

tstat_31 = TreeStatistics(Tree=join_44)  # -> Paths, Length, Count
lng_154 = ListLength(List=tstat_31.Length)
series_62 = Series(Start=0, Step=1, Count=lng_154)
dup_106 = DuplicateData(Data="}", Number=lng_154, Order=True)
dup_107 = DuplicateData(Data=";", Number=lng_154, Order=True)
dup_108 = DuplicateData(Data=item_134, Number=lng_154, Order=True)
dup_109 = DuplicateData(Data="{", Number=lng_154, Order=True)
merge_137 = Merge(
    Data1=simplify(graft(dup_109)),
    Data2=simplify(graft(dup_108)),
    Data3=simplify(graft(dup_107)),
    Data4=simplify(graft(series_62)),
    Data5=simplify(graft(dup_106)))
join_45 = TextJoin(Text=merge_137)
replace_46 = ReplacePaths(Data=join_44, Search=flatten(tstat_31.Paths), Replace=flatten(join_45))

# ----
# https://discourse.mcneel.com/t/improvement-of-data-recorder-rec/56940/7
toggle_34 = BooleanToggle(True)
data_rec_3 = PythonScript(x=replace_46, enable=toggle_34, reset=button, limit="1000000")  # -> x; inputs x: tree, enable: Boolean, reset: Boolean, limit: Int32; same code as data_rec
weave_63 = Weave(Pattern=list, Stream0=path_3, Stream1=path_5, Stream2=path_4, Stream3=path_2, NullGaps=False)
c_script_9 = CSharpScript(save=Toggle(True), path=weave_63, data=flatten(data_rec_3))  # inputs save: Boolean, path: String, data: list of String; same code as c_script_2

panel_735 = Panel(data_rec_3)

series_63 = Series(Start=0, Step=1, Count=lng_150)

weave_64 = Weave(
    Pattern=series_63,
    Stream0=filename,
    Stream1=avr_12,
    Stream2=ma_28.Result,
    Stream3=avr_11,
    Stream4=ma_27.Result,
    NullGaps=False)

partition_67 = PartitionList(List=weave_64, Size=lng_150)  # -> simplify(Chunks)
join_46 = TextJoin(Text=partition_67, Join=",")  # -> simplify(Result)

tstat_32 = TreeStatistics(Tree=join_46)  # -> Paths, Length, Count
lng_155 = ListLength(List=tstat_32.Length)
series_64 = Series(Start=0, Step=1, Count=lng_155)
dup_110 = DuplicateData(Data="}", Number=lng_155, Order=True)
dup_111 = DuplicateData(Data=";", Number=lng_155, Order=True)
dup_112 = DuplicateData(Data=item_135, Number=lng_155, Order=True)
dup_113 = DuplicateData(Data="{", Number=lng_155, Order=True)
merge_138 = Merge(
    Data1=simplify(graft(dup_113)),
    Data2=simplify(graft(dup_112)),
    Data3=simplify(graft(dup_111)),
    Data4=simplify(graft(series_64)),
    Data5=simplify(graft(dup_110)))
join_47 = TextJoin(Text=merge_138)
replace_47 = ReplacePaths(Data=join_46, Search=flatten(tstat_32.Paths), Replace=flatten(join_47))

# ----
# https://discourse.mcneel.com/t/improvement-of-data-recorder-rec/56940/7
toggle_35 = BooleanToggle(True)
data_rec_4 = PythonScript(x=replace_47, enable=toggle_35, reset=button, limit="1000000")  # -> x; inputs x: tree, enable: Boolean, reset: Boolean, limit: Int32; same code as data_rec
path_16 = FilePath("C:\KBEM\IP2.1\csv\BuildingBased.csv")
c_script_10 = CSharpScript(save=Toggle(True), path=path_16, data=flatten(data_rec_4))  # inputs save: Boolean, path: String, data: list of String; same code as c_script_2
