# Grasshopper definition referenceUBEM030522_intersectMasses.gh (Grasshopper 1.0.7)

panel = Panel("unconditioned")
brep = Brep([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])

panel_2 = Panel("conditioned")
brep_2 = Brep([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])

merge = Merge(Data1=flatten(brep_2), Data2=flatten(brep))
intersectmass = Honeybee_IntersectMasses(bldgMassesBefore=flatten(merge), runIt=Toggle(True))  # -> bldgMassesAfter; plug-in component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

series = Series(Start="1", Step=1, Count="4")
neg = Negative(Value=series)
item = ListItem(List=intersectmass, Index=neg, Wrap=True)

cull_i = CullIndex(List=intersectmass, Indices=neg, Wrap=True)

bldgprograms = Honeybee_bldgPrograms({"Office": 0, "Retail": 1, "MidriseApartment": 2, "PrimarySchool": 3, "SecondarySchool": 4, "SmallHotel": 5, "LargeHotel": 6, "Hospital": 7, "Outpatient": 8, "Warehouse": 9, "SuperMarket": 10, "FullServiceRestaurant": 11, "QuickServiceRestaurant": 12}, selected="MidriseApartment")
listzoneprograms = Honeybee_ListZonePrograms(bldgProgram=bldgprograms)  # -> MidriseApartmentZonePrograms; plug-in component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
item_2 = ListItem(List=listzoneprograms, Index=0, Wrap=True)
mass2zone = Honeybee_Masses2Zones(zoneMasses=flatten(cull_i), zonePrograms=item_2, maxRoofAngle=30, createHBZones=Toggle(True))  # -> readMe, HBZones; plug-in component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

bldgprograms_2 = Honeybee_bldgPrograms({"Office": 0, "Retail": 1, "MidriseApartment": 2, "PrimarySchool": 3, "SecondarySchool": 4, "SmallHotel": 5, "LargeHotel": 6, "Hospital": 7, "Outpatient": 8, "Warehouse": 9, "SuperMarket": 10, "FullServiceRestaurant": 11, "QuickServiceRestaurant": 12}, selected="MidriseApartment")
listzoneprograms_2 = Honeybee_ListZonePrograms(bldgProgram=bldgprograms_2)  # -> MidriseApartmentZonePrograms; plug-in component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
item_3 = ListItem(List=listzoneprograms_2, Index=2, Wrap=True)
mass2zone_2 = Honeybee_Masses2Zones(zoneMasses=flatten(item), zonePrograms=item_3, isConditioned=Toggle(False), maxRoofAngle=30, createHBZones=Toggle(True))  # -> readMe, HBZones; plug-in component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

merge_2 = Merge(Data1=mass2zone.HBZones, Data2=mass2zone_2.HBZones)  # -> flatten(Result)

solveadjc = Honeybee_SolveAdjacencies(HBZones=flatten(merge_2), removeCurrentAdjc=False, findAdjc=Toggle(True))  # -> readMe, HBZonesWADJ; plug-in component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

ladybug = Ladybug_Ladybug()  # -> Vviiiiiiiiiizzz; plug-in component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
honeybee = Honeybee_Honeybee()  # -> Vviiiiiiiiiizzz; plug-in component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

single_pane = Panel("0.9")
single_pane_2 = Panel("0.75")
epwindowmat = Honeybee_EnergyPlusWindowMaterial(name="window_aft_2000", U_Value="2.4", SHGC=single_pane_2, VT=single_pane)  # -> EPMaterial; plug-in component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
epconstruction = Honeybee_EnergyPlusConstruction(name="WINDOW_AFT", layer_1=epwindowmat)  # -> EPConstruction; plug-in component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

conditionedunconditioned = Honeybee_SeparateConditionedAndUnconditionedZones(HBZones=flatten(solveadjc.HBZonesWADJ))  # -> conditionedZones, unconditionedZones; plug-in component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

glazingcreator = Honeybee_GlazingBasedOnRatio(
    HBObjects=conditionedunconditioned.conditionedZones,
    glzRatio="0.2",
    breakUpWindow=Toggle(False),
    EPConstructions=epconstruction,
    runIt=Toggle(True))  # -> readMe, HBObjWGLZ; plug-in component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

setepnatvent = Honeybee_SetEPAirFlow(
    HBZones=flatten(glazingcreator.HBObjWGLZ),
    naturalVentilationType="1",
    minIndoorTempForNatVent="24",
    minOutdoorTempForNatVent="12",
    deltaTempForNatVent="0.0",
    fractionOfGlzAreaOperable="0.4",
    windDrivenCrossVent=Toggle(False))  # -> readMe, simplify(HBZones); plug-in component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

# ----
# HEATING
panel_3 = Panel("5")
dup = DuplicateData(Data="21", Number="19", Order=True)  # -> simplify(Data)
dup_2 = DuplicateData(Data="18", Number=panel_3, Order=True)
merge_3 = Merge(Data1=flatten(dup_2), Data2=flatten(dup))
annualschedule = Honeybee_AnnualSchedule(
    sun=merge_3,
    mon=merge_3,
    tue=merge_3,
    wed=merge_3,
    thu=merge_3,
    fri=merge_3,
    sat=merge_3,
    scheduleName=simplify(graft("HEATING_SETPOINT")),
    schedTypeLimits="Temperature",
    runIt=Toggle(True))  # -> readMe, port, schedule, port_2, simplify(weekSched), schedIDFText; plug-in component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

# ----
# COOLING-OFF
lb_schedule = GenePool(
    Decimals=1,
    Maximum=100,
    Minimum=25,
    Value=[100, 100, 100, 100, 100, 100, 100, 100, 100, 100, 100, 100, 100, 100, 100, 100, 100, 100, 100, 100, 100, 100, 100, 100])
annualschedule_2 = Honeybee_AnnualSchedule(
    sun=lb_schedule,
    mon=lb_schedule,
    tue=lb_schedule,
    wed=lb_schedule,
    thu=lb_schedule,
    fri=lb_schedule,
    sat=lb_schedule,
    scheduleName="COOLING_OFF",
    schedTypeLimits="Temperature",
    runIt=Toggle(True))  # -> readMe, port, schedule, port_2, weekSched, schedIDFText; plug-in component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

setepzoneschedules = Honeybee_SetEnergyPlusZoneSchedules(
    HBZones=setepnatvent.HBZones,
    heatingSetPtSchedules=annualschedule.schedule,
    coolingSetPtSchedules=annualschedule_2.schedule)  # -> schedules, simplify(HBZones); plug-in component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

ach2m3_s_m2_calculator = Honeybee_infORventPerAreaCalculator(HBZones=flatten(setepzoneschedules.HBZones), airFlowRate="0.0003", ACHorM3sM2=Toggle(False))  # -> readMe, infPerAreaFacade, ventPerAreaFloor, allExposed, allFloors; plug-in component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
setepzoneloads = Honeybee_SetEnergyPlusZoneLoads(
    HBZones=setepzoneschedules.HBZones,
    infilRatePerArea_Facade="0.0005",
    numOfPeoplePerArea="0.03",
    ventilationPerArea=ach2m3_s_m2_calculator.ventPerAreaFloor,
    ventilationPerPerson="0.001")  # -> loads, HBZones; plug-in component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

conditionedunconditioned_2 = Honeybee_SeparateConditionedAndUnconditionedZones(HBZones=flatten(glazingcreator.HBObjWGLZ))  # -> conditionedZones, unconditionedZones; plug-in component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
wires = BrepWireframe(Brep=conditionedunconditioned_2.unconditionedZones, Density=-1)
preview = CustomPreview(Geometry=wires, Material=ColourSwatch(SwatchColor=RGB(0, 0, 0)))
preview_2 = CustomPreview(Geometry=conditionedunconditioned_2.unconditionedZones, Material=ColourSwatch(SwatchColor=RGBA(255, 255, 255, 70)))
preview_3 = CustomPreview(Geometry=conditionedunconditioned_2.conditionedZones, Material=ColourSwatch(SwatchColor=RGBA(105, 105, 105, 70)))

merge_4 = Merge(Data1=flatten(setepzoneloads.HBZones), Data2=flatten(conditionedunconditioned.unconditionedZones))

decomposebytype = Honeybee_DecomposeBasedOnType(HBZone=merge_4)  # -> walls, simplify(interiorWalls), airWalls, windows, interiorWindows, skylights, roofs, ceilings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; plug-in component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
preview_4 = CustomPreview(Geometry=decomposebytype.walls, Material=ColourSwatch(SwatchColor=RGBA(204, 201, 0, 152)))
preview_5 = CustomPreview(Geometry=decomposebytype.groundFloors, Material=ColourSwatch(SwatchColor=RGBA(0, 0, 0, 53)))
preview_6 = CustomPreview(Geometry=decomposebytype.windows, Material=ColourSwatch(SwatchColor=RGB(0, 174, 255)))
preview_7 = CustomPreview(Geometry=decomposebytype.floors, Material=ColourSwatch(SwatchColor=RGBA(49, 209, 0, 133)))

preview_8 = CustomPreview(Geometry=decomposebytype.roofs, Material=ColourSwatch(SwatchColor=RGBA(209, 59, 0, 133)))
geo = Geometry(flatten(decomposebytype.floors))
item_4 = ListItem(List=decomposebytype.interiorWalls, Index=0, Wrap=True)

epopaquemat = Honeybee_EnergyPlusOpaqueMaterial(name="plasterconcrete", thickness="0.03", conductivity="1.6", density="2000", specificHeat="840")  # -> EPMaterial; plug-in component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

epopaquemat_2 = Honeybee_EnergyPlusOpaqueMaterial(name="yatay delikli tugla", thickness="0.135", conductivity="0.33", density="600", specificHeat="900")  # -> EPMaterial; plug-in component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

epopaquemat_3 = Honeybee_EnergyPlusOpaqueMaterial(name="ic siva alci esasli", thickness="0.02", conductivity="0.51", density="1200", specificHeat="1090")  # -> EPMaterial; plug-in component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

# ----
# EPS Thickness
panel_4 = Panel("22")
epopaquemat_4 = Honeybee_EnergyPlusOpaqueMaterial(name="EPS", thickness="0.0477", conductivity="0.035", density=panel_4, specificHeat="1500")  # -> EPMaterial; plug-in component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

# ----
# External
# wall
# Insulated Flat roof
panel_5 = Panel("CC_Flat_Insulated_Roof")
epopaquemat_5 = Honeybee_EnergyPlusOpaqueMaterial(name="insulation", thickness="0.121445", conductivity="0.04", density="18", specificHeat="1030")  # -> EPMaterial; plug-in component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
epopaquemat_6 = Honeybee_EnergyPlusOpaqueMaterial(name="Betonarme", thickness="0.12", conductivity="2.5", density="2400", specificHeat="840")  # -> EPMaterial; plug-in component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
epopaquemat_7 = Honeybee_EnergyPlusOpaqueMaterial(name="Alci siva", thickness="0.02", conductivity="0.51", density="1200", specificHeat="1090")  # -> EPMaterial; plug-in component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
epconstruction_2 = Honeybee_EnergyPlusConstruction(name=panel_5, layer_1=epopaquemat_5, layer_2=epopaquemat_6, layer_3=epopaquemat_7)  # -> EPConstruction; plug-in component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
epconstruction_3 = Honeybee_EnergyPlusConstruction(name="CC_External_wall", layer_1=epopaquemat, layer_2=epopaquemat_4, layer_3=epopaquemat_2, layer_4=epopaquemat_3)  # -> EPConstruction; plug-in component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
setepzonecnstr = Honeybee_SetEPZoneConstruction(HBZones=flatten(merge_4), wallEPConstruction=epconstruction_3, roofEPConstruction=epconstruction_2)  # -> simplify(modifiedHBZones); plug-in component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

callfromepconstrlibrary = Honeybee_CallFromEPConstructionLibrary(keywords="ceiling")  # -> ThermMaterials, EPMaterials, EPWindowMaterials, EPConstructions; plug-in component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
callfromepconstrlibrary_2 = Honeybee_CallFromEPConstructionLibrary(keywords="interior floor")  # -> ThermMaterials, EPMaterials, EPWindowMaterials, EPConstructions; plug-in component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

epopaquemat_8 = Honeybee_EnergyPlusOpaqueMaterial(name="yatay delikli tugla", thickness="0.085", conductivity="0.33", density="600", specificHeat="900")  # -> EPMaterial; plug-in component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
epopaquemat_9 = Honeybee_EnergyPlusOpaqueMaterial(name="icSivaAlciEsasliInt", thickness="0.02", conductivity="0.51", density="1200", specificHeat="1090")  # -> EPMaterial; plug-in component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
epopaquemat_10 = Honeybee_EnergyPlusOpaqueMaterial(name="icSivaAlciEsasliInt", thickness="0.02", conductivity="0.51", density="1200", specificHeat="1090")  # -> EPMaterial; plug-in component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

# ----
# Internal wall
epconstruction_4 = Honeybee_EnergyPlusConstruction(name="CC_Internal_wall", layer_1=epopaquemat_9, layer_2=epopaquemat_8, layer_3=epopaquemat_10)  # -> EPConstruction; plug-in component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

item_5 = ListItem(List=callfromepconstrlibrary.EPConstructions, Index=1, Wrap=True)
setepzoneintcnstr = Honeybee_SetEPZoneInteriorConstruction(HBZones=setepzonecnstr, intWallEPConstruction=epconstruction_4, intCeilingEPConstruction=item_5)  # -> simplify(modifiedHBZones); plug-in component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

epopaquemat_11 = Honeybee_EnergyPlusOpaqueMaterial(name="XPS", thickness="0.060774", conductivity="0.035", density="25", specificHeat="1200")  # -> EPMaterial; plug-in component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
epopaquemat_12 = Honeybee_EnergyPlusOpaqueMaterial(name="Dolgu cakil", thickness="0.1", conductivity="2.0", density="2000", specificHeat="840")  # -> EPMaterial; plug-in component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
epopaquemat_13 = Honeybee_EnergyPlusOpaqueMaterial(name="Grobeton", thickness="0.1", conductivity="1.65", density="2200", specificHeat="860")  # -> EPMaterial; plug-in component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
epopaquemat_14 = Honeybee_EnergyPlusOpaqueMaterial(name="Su yalitimi", thickness="0.003", conductivity="0.19", density="3000", specificHeat="780")  # -> EPMaterial; plug-in component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
epopaquemat_15 = Honeybee_EnergyPlusOpaqueMaterial(name="Koruma betonu", thickness="0.1", conductivity="1.65", density="2200", specificHeat="860")  # -> EPMaterial; plug-in component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
epopaquemat_16 = Honeybee_EnergyPlusOpaqueMaterial(name="Temel", thickness="0.15", conductivity="2.5", density="2400", specificHeat="860")  # -> EPMaterial; plug-in component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
epopaquemat_17 = Honeybee_EnergyPlusOpaqueMaterial(name="kece polyester", thickness="0.003", conductivity="0.19", density="25", specificHeat="1500")  # -> EPMaterial; plug-in component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
epopaquemat_18 = Honeybee_EnergyPlusOpaqueMaterial(name="koruma sapi", thickness="0.05", conductivity="1.4", density="2000", specificHeat="837")  # -> EPMaterial; plug-in component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
epopaquemat_19 = Honeybee_EnergyPlusOpaqueMaterial(name="laminant parke", thickness="0.008", conductivity="0.115", density="938", specificHeat="1600")  # -> EPMaterial; plug-in component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

# ----
# construction: insert layers to modular
# -- call simply
panel_6 = Panel("CC_Ground_Floor")
epconstruction_5 = Honeybee_EnergyPlusConstruction(
    name=panel_6,
    layer_1=epopaquemat_12,
    layer_2=epopaquemat_13,
    layer_3=epopaquemat_14,
    layer_4=epopaquemat_15,
    layer_5=epopaquemat_11,
    layer_6=epopaquemat_17,
    layer_7=epopaquemat_18,
    layer_8=epopaquemat_19)  # -> EPConstruction; plug-in component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

setepzoneundergroundcnstr = Honeybee_SetEPZoneUndergroundConstruction(HBZones=setepzoneintcnstr, groundFloorEPConstruction=epconstruction_5)  # -> simplify(modifiedHBZones); plug-in component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

item_6 = ListItem(List=setepzoneundergroundcnstr, Index="-1", Wrap=True)

# ----
# Energy Balance
toggle = BooleanToggle(True)
panel_7 = Panel("""0
1
2
10
12
13
14
23
24
25
26
27
28
29
30
31
32
35
36
37""")
epoutput = Honeybee_GenerateEPOutput(
    zoneEnergyUse=toggle,
    zoneGainsAndLosses=toggle,
    zoneComfortMetrics=toggle,
    surfaceTempAnalysis="False",
    surfaceEnergyAnalysis=toggle,
    timestep="monthly")  # -> report, flatten(simulationOutputs); plug-in component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
item_7 = ListItem(List=epoutput.simulationOutputs, Index=panel_7, Wrap=True)

addinternalmass = Honeybee_AddInternalMassToZone()  # -> readMe, HBZones; plug-in component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
panel_8 = Panel(epoutput.simulationOutputs)
path = FilePath("C:\KBEM\IP2.1\epw\TUR_Ankara_Central_HadCM3-A2-2050.epw")
exporttoopenstudio = Honeybee_ExportToOpenStudio(
    epwWeatherFile=path,
    HBZones=flatten(solveadjc.HBZonesWADJ),
    simulationOutputs=flatten(epoutput.simulationOutputs),
    writeOSM=Toggle(True),
    runSimulation="3",
    fileName="trial",
    workingDir="C:\KBEM\IP2.1\trial")  # -> readMe, osmFileAddress, idfFileAddress, resultFileAddress, eioFileAddress, rddFileAddress, htmlReport, studyFolder, model; plug-in component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
readepresult = Honeybee_ReadEPResult(resultFileAddress=exporttoopenstudio.resultFileAddress)  # -> totalThermalLoad, thermalLoadBalance, cooling, heating, electricLight, electricEquip, fanElectric, pumpElectric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; plug-in component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
readepsrfresult = Honeybee_ReadEPSurfaceResult(resultFileAddress=exporttoopenstudio.resultFileAddress)  # -> surfaceIndoorTemp, surfaceOutdoorTemp, surfaceEnergyFlow, opaqueEnergyFlow, glazEnergyFlow, windowTotalSolarEnergy, windowBeamEnergy, windowDiffEnergy, windowTransmissivity; plug-in component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
strnum = Ladybug_SeparateData(inputList=flatten(readepresult.fanElectric))  # -> numbers, strings; plug-in component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

flrnorm = Honeybee_NormalizeDataByFloorArea(simData=readepresult.heating, HBZones=flatten(setepzoneundergroundcnstr))  # -> totNormData, zoneNormData; plug-in component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
strnum_2 = Ladybug_SeparateData(inputList=flatten(flrnorm.zoneNormData))  # -> numbers, strings; plug-in component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
ma = MassAddition(Input=strnum_2.numbers)  # -> flatten(Result), PartialResults
panel_9 = Panel(ma.Result)
graph = QuickGraph(panel_9, SortOrder=0)

energybalance = Honeybee_ConstructEnergyBalance(
    HBZones=flatten(merge_4),
    cooling=readepresult.cooling,
    heating=readepresult.heating,
    electricLight=readepresult.electricLight,
    electricEquip=readepresult.electricEquip,
    peopleGains=readepresult.peopleGains,
    totalSolarGain=readepresult.totalSolarGain,
    infiltrationEnergy=readepresult.infiltrationEnergy,
    mechVentilationEnergy=readepresult.mechVentilationEnergy,
    natVentEnergy=readepresult.natVentEnergy,
    surfaceEnergyFlow=readepsrfresult.surfaceEnergyFlow)  # -> readMe, port, flrNormEnergyBal, flrNormBalWStorage, port_2, modelEnergyBalance, energyBalWithStorage; disabled; plug-in component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
toggle_2 = BooleanToggle(True)  # disabled
panel_10 = Panel("19")  # disabled
gradientlibrary = Ladybug_GradientLibrary(gradIndex=panel_10)  # -> customColors; disabled; plug-in component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
selectandaveragedata = Ladybug_AverageData(annualHourlyData=energybalance.flrNormBalWStorage, totalOrAverage=toggle_2)  # -> readMe, selHourlyData, totaledDaily, totaledMonthly, totMonthlyPerHour, totMonthlyMinPerHour, totMonthlyMaxPerHour; disabled; plug-in component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
legendpar = Ladybug_LegendParameters(customColors=flatten(gradientlibrary))  # -> legendPar; disabled; plug-in component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
toggle_3 = BooleanToggle(True)  # disabled
panel_11 = Panel("EnergyBalance")  # disabled
pt = Point(Point(302, 2433, 0))  # disabled
barchart = Ladybug_MonthlyBarChart(
    inputData=flatten(energybalance.flrNormBalWStorage),
    stackValues=toggle_3,
    altTitle=panel_11,
    basePoint=pt,
    legendPar=legendpar)  # -> readMe, dataMesh, dataCurves, dataCrvColors, graphAxes, graphLabels, title, titleBasePt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; disabled; plug-in component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
swatch = ColourSwatch(SwatchColor=RGB(0, 0, 0))  # disabled
preview_9 = CustomPreview(Geometry=barchart.graphAxes, Material=swatch)  # disabled

panel_12 = Panel("""25.771231
18.278203
18.665001
10.093072
19.458962
27.241253
27.874361
19.879852
63.515941
47.566765
59.702236
71.196252
71.755745
60.162933
18.212417
10.159929
19.201667
26.559615
27.120954
19.590614
16.65761
8.899062
17.918934
25.237237""")
avr = Average(Input=ma.Result)
panel_13 = Panel("""29.173367
21.167809
21.933518
12.431782
22.488084
30.722011
31.395194
22.93693
67.535332
51.375962
63.496124
75.146695
75.711917
63.973039
21.299731
12.389206
22.109396
29.92918
30.519434
22.51588
19.6969
11.062028
20.786821
28.609818""")
panel_14 = Panel(avr)
graph_2 = QuickGraph([panel_12, panel_13], SortOrder=0)

# ----
# Adjacent Suface Example
toggle_4 = BooleanToggle(True)
geo_2 = Geometry([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])
item_8 = ListItem(List=geo_2, Index=0, Wrap=True)
mass2zone_3 = Honeybee_Masses2Zones(zoneMasses=flatten(geo_2), maxRoofAngle=30, createHBZones=toggle_4)  # -> readMe, HBZones; plug-in component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
wires_2 = BrepWireframe(Brep=item_8, Density=-1)
solveadjc_2 = Honeybee_SolveAdjacencies(HBZones=flatten(mass2zone_3.HBZones), altBC="Adiabatic", removeCurrentAdjc=False, findAdjc=toggle_4)  # -> readMe, HBZonesWADJ; plug-in component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
decomposebybc = Honeybee_DecomposeBasedOnBoundaryCondition(HBZone=solveadjc_2.HBZonesWADJ)  # -> outdoors, surface, flatten(adiabatic), ground; plug-in component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

decomposebytype_2 = Honeybee_DecomposeBasedOnType(HBZone=solveadjc_2.HBZonesWADJ)  # -> walls, interiorWalls, airWalls, simplify(windows), interiorWindows, skylights, simplify(roofs), simplify(ceilings)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; plug-in component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
preview_10 = CustomPreview(Geometry=decomposebytype_2.walls, Material=ColourSwatch(SwatchColor=RGBA(236, 255, 23, 138)))
preview_11 = CustomPreview(Geometry=decomposebytype_2.windows, Material=ColourSwatch(SwatchColor=RGB(0, 72, 255)))
preview_12 = CustomPreview(Geometry=decomposebytype_2.interiorWalls, Material=ColourSwatch(SwatchColor=RGB(121, 0, 191)))
preview_13 = CustomPreview(Geometry=decomposebytype_2.roofs, Material=ColourSwatch(SwatchColor=RGBA(191, 89, 0, 174)))
preview_14 = CustomPreview(Geometry=decomposebytype_2.floors, Material=ColourSwatch(SwatchColor=RGB(48, 191, 0)))
preview_15 = CustomPreview(Geometry=decomposebytype_2.groundFloors, Material=ColourSwatch(SwatchColor=RGB(0, 0, 0)))

item_9 = ListItem(List=flatten(decomposebytype_2.interiorWalls), Index=0, Wrap=True)
